# Grasshopper definition Solar_Fan_Envelope_Analysis_Period.gh (Grasshopper 0.9.76)
# plug-ins: Python Interpreter

number_slider = Slider(6, range=0..10)
number_slider_2 = Slider(21, range=0..100)
analysisperiod = Ladybug_AnalysisPeriod(
    fromMonth=number_slider,
    fromDay=number_slider_2,
    fromHour=Slider(11, range=0..100),
    toMonth=number_slider,
    toDay=number_slider_2,
    toHour=Slider(13, range=0..100))  # -> readMe, analysisPeriod; plug-in component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
constructlocation = Ladybug_ConstructLocation(locationName="unknown_Location", latitude=Slider(42, range=0..100), longitude=0, timeZone=0, elevation=0)  # -> location; plug-in component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
geo = Geometry(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)
number_slider_3 = Slider(2, range=0..10)
solarfanbasic = Ladybug_SolarFanBasic(boundary=geo, location=constructlocation, height=Slider(100, range=0..100), analysisPeriod=analysisperiod.analysisPeriod)  # -> readMe, solarFan; plug-in component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
