# Grasshopper definition UWGWorkflow.gh (Grasshopper 0.9.76)
# plug-ins: Python Interpreter

# ----
# Import Geometry
commercialbuildings = Brep([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])
residentialbuildings = Brep([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])
parkingtransitbuildings = Brep([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])
pavement = Brep([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])
trees = Brep([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])
grass = Brep([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])

dragonfly = Dragonfly_Dragonfly()  # -> Vviiiiiiiiiizzz; plug-in component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
dragonfly_2 = Dragonfly(update=Toggle(False))  # -> whirrrrrrrrrr; "DF::DF"; plug-in component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
# Define Typologies
bldgprograms = Honeybee_bldgPrograms({"Office": 0, "Retail": 1, "MidriseApartment": 2, "PrimarySchool": 3, "SecondarySchool": 4, "SmallHotel": 5, "LargeHotel": 6, "Hospital": 7, "Outpatient": 8, "Warehouse": 9, "SuperMarket": 10, "FullServiceRestaurant": 11, "QuickServiceRestaurant": 12}, selected="Office")

# ----
# Visualize Urban Area
swatch = ColourSwatch(SwatchColor=RGB(82, 82, 82))
preview = CustomPreview(Geometry=pavement, Shader=swatch)
preview_2 = CustomPreview(Geometry=grass, Shader=ColourSwatch(SwatchColor=RGB(118, 168, 133)))
preview_3 = CustomPreview(Geometry=trees, Shader=ColourSwatch(SwatchColor=RGB(40, 102, 58)))
preview_4 = CustomPreview(Geometry=commercialbuildings, Shader=ColourSwatch(SwatchColor=RGB(95, 100, 178)))
preview_5 = CustomPreview(Geometry=residentialbuildings, Shader=ColourSwatch(SwatchColor=RGB(235, 206, 94)))
preview_6 = CustomPreview(Geometry=parkingtransitbuildings, Shader=ColourSwatch(SwatchColor=RGB(143, 143, 143)))

bldgtypology = Dragonfly_UWGBuildingTypology(bldgGeo=commercialbuildings, bldgProgram=bldgprograms)  # -> buildingTypology; plug-in component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

# ----
# Define The City
vegetationpar = Dragonfly_VegetationParameters(treeLatentFraction="0.8")  # -> vegetationPar; plug-in component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
# 1
toggle = BooleanToggle(True)
city = Dragonfly_UWGCity(
    buildingTypologies=flatten(bldgtypology),
    pavementBrep=flatten(pavement),
    treesOrCoverage=flatten(trees),
    grassOrCoverage=flatten(grass),
    vegetationPar=vegetationpar,
    nonBldgHeat="10",
    runIt=toggle)  # -> readMe, port, UWGCity, port_2, joinedBldgs, bldgFootprints, treeFootprints, pavementSrf, grassSrf; plug-in component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

# ----
# Import Climate Data
panel = Panel("http://apps1.eere.energy.gov/buildings/energyplus/weatherdata/4_north_and_central_america_wmo_region_4/1_usa/USA_FL_Miami.Intl.AP.722020_TMY3.zip")
epw_stat = Ladybug_OpenEPWAndSTATWeatherFiles(weatherFileURL=panel)  # -> epwFile, statFile; plug-in component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

boundarylayerpar = Dragonfly_BoundaryLayerParameters()  # -> boundLayerPar; plug-in component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

# ----
# Run the UWG
panel_2 = Panel("1")
# 2
toggle_2 = BooleanToggle(False)

refepwpar = Dragonfly_ReferenceEPWParameters(vegetationCoverage=panel_2)  # -> epwSitePar; plug-in component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

runuwg = Dragonfly_RunUrbanWeatherGenerator(
    epwFile=epw_stat.epwFile,
    UWGCity=city.UWGCity,
    epwSitePar=refepwpar,
    boundLayerPar=boundarylayerpar,
    writeFile=toggle_2,
    runUWG=toggle_2)  # -> readMe, xmlText, xmlFileAddress, epwFileAddress; plug-in component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
