# Grasshopper definition Urban_Weather_Generator_Workflow.gh (Grasshopper 0.9.76)
# plug-ins: Python Interpreter

honeybee = Honeybee_Honeybee()  # -> Vviiiiiiiiiizzz; plug-in component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
dragonfly = Dragonfly_Dragonfly()  # -> Vviiiiiiiiiizzz; plug-in component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
ladybug = Ladybug_Ladybug()  # -> Vviiiiiiiiiizzz; plug-in component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

toggle = BooleanToggle(False)
parking_transit_zone = Brep(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)

# ----
# Import the City Geometry
commercialbuildings = Brep([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])
pavement = Brep([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])
trees = Brep([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])
grass = Brep([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])
residentialbuildings = Brep([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])
parkingtransitbuildings = Brep([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])
buildings = Brep([commercialbuildings, residentialbuildings, parkingtransitbuildings])

updatehoneybee = Honeybee_UpdateHoneybee(updateThisFile=toggle, updateAllUObjects=toggle)  # -> out; plug-in component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

# ----
# Define a Custom Typological Honyebee Zone With Programs + Windows + Constructions
bldgprograms = Honeybee_bldgPrograms({"Office": 0, "Retail": 1, "MidriseApartment": 2, "PrimarySchool": 3, "SecondarySchool": 4, "SmallHotel": 5, "LargeHotel": 6, "Hospital": 7, "Outpatient": 8, "Warehouse": 9, "SuperMarket": 10, "FullServiceRestaurant": 11, "QuickServiceRestaurant": 12}, selected="Warehouse")
listzoneprograms = Honeybee_ListZonePrograms(bldgProgram=bldgprograms)  # -> WarehouseZonePrograms; plug-in component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
item = ListItem(List=listzoneprograms, Index="2", Wrap=True)

# ----
# Import Climate Data
panel = Panel("http://apps1.eere.energy.gov/buildings/energyplus/weatherdata/4_north_and_central_america_wmo_region_4/1_usa/USA_FL_Miami.Intl.AP.722020_TMY3.zip")
epw_stat = Ladybug_OpenEPWAndSTATWeatherFiles(weatherFileURL=panel)  # -> epwFile, statFile; plug-in component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

# ----
# Visualize Urban Area
swatch = ColourSwatch(SwatchColor=RGB(82, 82, 82))
preview = CustomPreview(Geometry=pavement, Shader=swatch)
preview_2 = CustomPreview(Geometry=grass, Shader=ColourSwatch(SwatchColor=RGB(118, 168, 133)))
preview_3 = CustomPreview(Geometry=trees, Shader=ColourSwatch(SwatchColor=RGB(40, 102, 58)))
preview_4 = CustomPreview(Geometry=commercialbuildings, Shader=ColourSwatch(SwatchColor=RGB(95, 100, 178)))
preview_5 = CustomPreview(Geometry=residentialbuildings, Shader=ColourSwatch(SwatchColor=RGB(235, 206, 94)))
preview_6 = CustomPreview(Geometry=parkingtransitbuildings, Shader=ColourSwatch(SwatchColor=RGB(143, 143, 143)))

# ----
# Parking Structure Constructions
panel_2 = Panel("AsphaltMembrane")
callfromepconstrlibrary = Honeybee_CallFromEPConstructionLibrary(keywords="concrete")  # -> EPMaterials, EPWindowMaterils, EPConstructions; plug-in component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
epnomassmat = Honeybee_EnergyPlusNoMassOpaqueMaterial(name=panel_2, R_Value="0.5", thermAbsp="0.9", solAbsp="0.8", visAbsp="0.8")  # -> EPMaterial; plug-in component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
item_2 = ListItem(List=callfromepconstrlibrary.EPMaterials, Index="2", Wrap=True)
panel_3 = Panel(item_2)
epconstruction = Honeybee_EnergyPlusConstruction(name="ConcreteWall", layer_1=item_2)  # -> EPConstruction; plug-in component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
epconstruction_2 = Honeybee_EnergyPlusConstruction(name="AsphaltRoof", layer_1=epnomassmat, layer_2=item_2)  # -> EPConstruction; plug-in component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

importstat = Ladybug_ImportStat(statFile=epw_stat.statFile)  # -> readMe, ashraeClimateZone, koppenClimateZone, port, heatingDesignTemp, coolingDesignTemp, port_2, extremeHotWeek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; plug-in component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

# ----
# Calculate Ratios of
# Typlogies in Urban Area
panel_4 = Panel("0.25")
# Define Residential
# + Commercial Typologies
panel_5 = Panel("3")
residentialtypology = Dragonfly_DefaultResidentialTypology(flr2FlrHeight="3", window2Wall=panel_4, climateZone=importstat.ashraeClimateZone)  # -> buildingTypology; plug-in component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
commercialtypology = Dragonfly_DefaultCommericalTypology(flr2FlrHeight=panel_5, window2Wall="0.7", climateZone=importstat.ashraeClimateZone)  # -> buildingTypology; plug-in component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

typologyratios = Dragonfly_TypologyRatios(
    typology1Breps=commercialbuildings,
    typology2Breps=residentialbuildings,
    typology3Breps=parkingtransitbuildings,
    runIt=Toggle(True))  # -> typologyRatios, roofAngles, wallAngles, port, roofBreps, wallBreps, footprintBreps; plug-in component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

boundarylayerpar = Dragonfly_BoundaryLayerParameters()  # -> boundLayerPar; plug-in component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
extreme_hot_week = Data(importstat.extremeHotWeek)
original_weather_file = Data(epw_stat.epwFile)

# ----
# Import Rural + Urban EPWs
importepw = Ladybug_ImportEpw(epwFile=original_weather_file)  # -> readMe, latitude, location, dryBulbTemperature, dewPointTemperature, relativeHumidity, windSpeed, windDirection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; plug-in component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
selectandaveragedata = Ladybug_AverageData(annualHourlyData=importepw.dryBulbTemperature, analysisPeriod=extreme_hot_week)  # -> readMe, selHourlyData, averagedDaily, averagedMonthly, avrMonthlyPerHour, avrAnalysisPeriod; plug-in component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

selectandaveragedata_2 = Ladybug_AverageData(annualHourlyData=importepw.relativeHumidity, analysisPeriod=extreme_hot_week)  # -> readMe, selHourlyData, averagedDaily, averagedMonthly, avrMonthlyPerHour, avrAnalysisPeriod; plug-in component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

mass2zone = Honeybee_Masses2Zones(
    zoneMasses=flatten(parking_transit_zone),
    zoneNames="Transit",
    zonePrograms=item,
    isConditioned=Toggle(False),
    maxRoofAngle=30,
    createHBZones=Toggle(True))  # -> readMe, HBZones; plug-in component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

glazingcreator = Honeybee_GlazingBasedOnRatio(HBObjects=mass2zone.HBZones, glzRatio="0.4", breakUpWindow=Toggle(False), runIt=Toggle(True))  # -> readMe, HBObjWGLZ; plug-in component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

createepplenum = Honeybee_CreateEPPlenum(HBZones=glazingcreator.HBObjWGLZ)  # -> HBPlenumZones; plug-in component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
setepzonecnstr = Honeybee_SetEPZoneConstruction(HBZones=createepplenum, wallEPConstruction=epconstruction_2, roofEPConstruction=epconstruction)  # -> simplify(modifiedHBZones); plug-in component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

# ----
# Convert Custom
# Typological
# Zone to UWG
# Building Typology
bldgtypologyfromzone = Dragonfly_BuildingTypologyFromHBZone(HBZone=flatten(setepzonecnstr), coolingCOP="1.7", heatFract2Canyon="1")  # -> buildingTypology; plug-in component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

# ----
# 1
toggle_2 = BooleanToggle(True)

# ----
# Define The City
vegetationpar = Dragonfly_VegetationParameters(treeLatentFraction="0.8")  # -> vegetationPar; plug-in component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

uwgcityfromtypology = Dragonfly_UWGCityFromTypologies(
    buildingTypologies=flatten([commercialtypology, residentialtypology, bldgtypologyfromzone]),
    typologyRatios=flatten(typologyratios.typologyRatios),
    roofAngles=flatten(typologyratios.roofAngles),
    wallAngles=flatten(typologyratios.wallAngles),
    buildingBreps=flatten(buildings),
    pavementBrep=flatten(pavement),
    treesOrCoverage=flatten(trees),
    grassOrCoverage=flatten(grass),
    vegetationPar=vegetationpar,
    nonBldgHeat="10",
    runIt=toggle_2)  # -> readMe, port, UWGCity, port_2, joinedBldgs, bldgFootprints, treeFootprints, pavementSrf, grassSrf; plug-in component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

panel_6 = Panel(uwgcityfromtypology.readMe)

# ----
# 2
toggle_3 = BooleanToggle(True)

# ----
# Run the UWG
refepwpar = Dragonfly_ReferenceEPWParameters(vegetationCoverage="1")  # -> epwSitePar; plug-in component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

runuwg = Dragonfly_RunUrbanWeatherGenerator(
    epwFile=epw_stat.epwFile,
    UWGCity=uwgcityfromtypology.UWGCity,
    analysisPeriod=extreme_hot_week,
    epwSitePar=refepwpar,
    boundLayerPar=boundarylayerpar,
    writeXML=toggle_3,
    runUWG=toggle_3)  # -> readMe, xmlText, xmlFileAddress, epwFileAddress; plug-in component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

panel_7 = Panel(runuwg.readMe)

importepw_2 = Ladybug_ImportEpw(epwFile=runuwg.epwFileAddress)  # -> readMe, latitude, location, dryBulbTemperature, dewPointTemperature, relativeHumidity, windSpeed, windDirection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; plug-in component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
selectandaveragedata_3 = Ladybug_AverageData(annualHourlyData=importepw_2.relativeHumidity, analysisPeriod=extreme_hot_week)  # -> readMe, selHourlyData, averagedDaily, averagedMonthly, avrMonthlyPerHour, avrAnalysisPeriod; plug-in component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
selectandaveragedata_4 = Ladybug_AverageData(annualHourlyData=importepw_2.dryBulbTemperature, analysisPeriod=extreme_hot_week)  # -> readMe, selHourlyData, averagedDaily, averagedMonthly, avrMonthlyPerHour, avrAnalysisPeriod; plug-in component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

toggle_4 = BooleanToggle(True)
outdoorcomfortcalculator = Ladybug_OutdoorComfortCalculator(
    dryBulbTemperature=selectandaveragedata_4.selHourlyData,
    relativeHumidity=selectandaveragedata_3.selHourlyData,
    runIt=toggle_4)  # -> readMe, port, universalThermalClimateIndex, comfortableOrNot, thermalStress, conditionOfPerson, port_2, percentOfTimeComfortable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; plug-in component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
# Look at the Effect of UHI on Outdoor Comfort
outdoorcomfortcalculator_2 = Ladybug_OutdoorComfortCalculator(
    dryBulbTemperature=selectandaveragedata.selHourlyData,
    relativeHumidity=selectandaveragedata_2.selHourlyData,
    runIt=toggle_4)  # -> readMe, port, universalThermalClimateIndex, comfortableOrNot, thermalStress, conditionOfPerson, port_2, percentOfTimeComfortable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; plug-in component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
panel_8 = Panel(outdoorcomfortcalculator_2.percentHeatStress)
panel_9 = Panel(outdoorcomfortcalculator.percentHeatStress)

strnum = Ladybug_SeparateData(inputList=flatten(selectandaveragedata_4.selHourlyData))  # -> numbers, strings; plug-in component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
# Look at Maximum and Average UHI
strnum_2 = Ladybug_SeparateData(inputList=flatten(selectandaveragedata.selHourlyData))  # -> numbers, strings; plug-in component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
avr = Average(Input=strnum.numbers)
avr_2 = Average(Input=strnum_2.numbers)
subtraction = Subtraction(A=strnum.numbers, B=strnum_2.numbers)
subtraction_2 = Subtraction(A=avr, B=avr_2)
sort = SortList(Keys=subtraction)  # -> Keys, ValuesA
rev = ReverseList(List=sort.Keys)
item_3 = ListItem(List=rev, Index=0, Wrap=True)
avg_uhi_c = Panel(subtraction_2)
maximum_uhi_c = Panel(item_3)

pt = ConstructPoint(XCoordinate="300", YCoordinate=0, ZCoordinate="-250")
_3dchart = Ladybug_3DChart(
    inputData=flatten([outdoorcomfortcalculator_2.universalThermalClimateIndex, outdoorcomfortcalculator.universalThermalClimateIndex]),
    basePoint=pt)  # -> readMe, graphMesh, graphCurves, legend, legendBasePts, title, titleBasePts, dataPts, conditionalHOY; plug-in component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
