# Grasshopper definition Estimate_Glare_Potential_Over_a_Year.gh (Grasshopper 0.9.76)
# plug-ins: Python Interpreter

# NUMERICAL
# INPUTS
ladybug = Ladybug_Ladybug()  # -> Vviiiiiiiiiizzz; plug-in component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

weather_file_url = Panel("http://apps1.eere.energy.gov/buildings/energyplus/weatherdata/4_north_and_central_america_wmo_region_4/1_usa/USA_MA_Boston-Logan.Intl.AP.725090_TMY3.zip")
occupancy_start_hour = Panel("6")
occupancy_end_hour = Panel("22")
daylight_threshold_lux = Panel("4000")
window_transmittance = Panel("0.6")

grid_size = Panel("0.25")
test_surface = Brep(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)
# GEOMETRIC
# INPUTS
opaque_geometry = Brep([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])

epw_stat = Ladybug_OpenEPWAndSTATWeatherFiles(weatherFileURL=weather_file_url)  # -> epwFile, statFile; plug-in component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
importepw = Ladybug_ImportEpw(epwFile=epw_stat.epwFile)  # -> readMe, latitude, location, dryBulbTemperature, dewPointTemperature, relativeHumidity, windSpeed, windDirection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; plug-in component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
# Import EPW and Define Analysis Period
analysisperiod = Ladybug_AnalysisPeriod(fromHour=occupancy_start_hour, toHour=occupancy_end_hour)  # -> readMe, analysisPeriod; plug-in component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

edges = BrepEdges(Brep=[opaque_geometry, test_surface])  # -> Naked, Interior, NonManifold
preview = CustomPreview(Geometry=[edges.Naked, edges.Interior, edges.NonManifold], Shader=ColourSwatch(SwatchColor=RGB(0, 0, 0)))

# ----
# Make a statement to remove sun vectors below an illuminance threshold
panel = Panel("1")
division = Division(A=panel, B=window_transmittance)
multiplication = Multiplication(A=daylight_threshold_lux, B=division)
concat = Concatenate(FragmentA="a>", FragmentB=multiplication)
conditional_statement = Panel(concat)

# ----
# Account for the fact that illuminance is recorded at the end
# of each hour in the EPW by averaging the start and end of
# each hour (effectively interpolating between hours).
strnum = Ladybug_SeparateData(inputList=flatten(importepw.globalHorizontalIlluminance))  # -> numbers, strings; plug-in component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
cull_i = CullIndex(List=strnum.numbers, Indices="0", Wrap=True)  # -> graft(List)
cull_i_2 = CullIndex(List=strnum.numbers, Indices="-1", Wrap=True)  # -> graft(List)
avr = Average(Input=[cull_i_2, cull_i])  # -> flatten(ArithmeticMean)
ins = InsertItems(List=avr, Item="0", Indices="0", Wrap=True)
data = Data(flatten([strnum.strings, ins]))

col = Colour([ColourSwatch(SwatchColor=RGB(255, 255, 255)), ColourSwatch(SwatchColor=RGB(255, 243, 77)), ColourSwatch(SwatchColor=RGB(255, 0, 0)), ColourSwatch(SwatchColor=RGB(0, 0, 0))])
# Select a Color Scheme
panel_2 = Panel("0")
legendpar = Ladybug_LegendParameters(lowBound=panel_2, customColors=flatten(col))  # -> legendPar; plug-in component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

# ----
# Get Sun Vectors for Hours Above Threshold
sunpath = Ladybug_SunPath(
    location=importepw.location,
    hour=12,
    day=21,
    month=12,
    timeStep=1,
    analysisPeriod=analysisperiod.analysisPeriod,
    sunPathScale="0.08",
    annualHourlyData=flatten(data),
    conditionalStatement=conditional_statement,
    legendPar=legendpar,
    dailyOrAnnualSunPath=True)  # -> readMe, sunVectors, sunAltitudes, sunAzimuths, port, sunSpheresMesh, sunPathCrvs, legend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; plug-in component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
preview_2 = CustomPreview(Geometry=[sunpath.sunPathCrvs, sunpath.sunSpheresMesh], Shader=ColourSwatch(SwatchColor=RGB(0, 0, 0)))

# ----
# Get Sunlight Hours Hitting the Test Surface
panel_3 = Panel("0.0001")
sunlighthoursanalysis = Ladybug_SunlightHoursAnalysis(
    geometry=flatten(test_surface),
    context=flatten(opaque_geometry),
    gridSize=grid_size,
    disFromBase=panel_3,
    sunVectors=flatten(sunpath.sunVectors),
    timeStep=1,
    parallel=Toggle(True),
    runIt=Toggle(False))  # -> readMe, contextMesh, analysisMesh, testPts, testVec, port, sunlightHoursResult, sunlightHoursMesh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; plug-in component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

flip = FlipMatrix(Data=sunlighthoursanalysis.sunIsVisible)
ma = MassAddition(Input=flip)  # -> flatten(Result), PartialResults
# Get % of Floor In Direct Sun
lng = ListLength(List=sunlighthoursanalysis.testPts)
division_2 = Division(A=ma.Result, B=lng)
multiplication_2 = Multiplication(A=division_2, B="100")

# ----
# Convert "Sunlight Hours" to "Hours of a Typical Day"
panel_4 = Panel("0")
legendpar_2 = Ladybug_LegendParameters(lowBound=panel_4, highBound="3", numSegments="4", customColors=flatten(col))  # -> legendPar; plug-in component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
division_3 = Division(A=sunlighthoursanalysis.sunlightHoursResult, B="365")
recolormesh = Ladybug_RecolorMesh(
    analysisResult=division_3,
    inputMesh=sunlighthoursanalysis.analysisMesh,
    legendPar=legendpar_2,
    analysisTitle="Hours of a Typical Day in Direct Sun",
    legendTitle="hours")  # -> readMe, newMesh, newLegend, legendBasePt, meshColors, legendColors; plug-in component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

# ----
# Create a List of 8760 Values
# With Sun In % of Floor Data
panel_5 = Panel("1")
dup = DuplicateData(Data="0", Number="8760", Order=True)
subtraction = Subtraction(A=sunpath.sunPositionsHOY, B=panel_5)
replace = ReplaceItems(List=dup, Item=multiplication_2, Indices=subtraction, Wrap=False)

# ----
# Add a Header to the Data
createheader = Ladybug_CreateLBHeader(location="Test Surface", dataType="Percent of Floor in Direct Sun", units="%")  # -> flatten(LBHeader); plug-in component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
data_2 = Data(flatten([createheader, replace]))

# ----
# Make Temporal Map of When Glare is a Problem
panel_6 = Panel("25,-8,0")
_3dchart = Ladybug_3DChart(inputData=flatten(data_2), basePoint=panel_6, xScale="0.01", yScale="0.1", zScale="0", legendPar=legendpar)  # -> readMe, graphMesh, graphCurves, legend, legendBasePts, title, titleBasePts, dataPts, conditionalHOY; plug-in component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
preview_3 = CustomPreview(Geometry=_3dchart.graphCurves, Shader=ColourSwatch(SwatchColor=RGB(0, 0, 0)))
