# Grasshopper definition Quick analysis.gh (Grasshopper 0.9.76)
# plug-ins: Python Interpreter

# BIBIL_CLASSES
panel = Panel("C:\\Users\\vasanthakumars\\Documents\\GitHub\\bibil\\src")
panel_2 = Panel("C:\\saeran\\master\\git\\bibil\\src")
txt = Text(panel)

# ---- group: grammar
python_script = PythonScript(i=txt)  # -> o
# ---------- python_script: Python ----------
import os

o = os.path.join(str(i),"bibil\\bibil_rule.py")
# ---------- end python_script ----------
file = ReadFile(File=python_script, PerLineParse=False)
bibil = PythonScript(Code=file)

# ---- group: pattern
python_script_2 = PythonScript(i=txt)  # -> o
# ---------- python_script_2: Python ----------
import os

o = os.path.join(str(i),"bibil\\bibil_pattern.py")
# ---------- end python_script_2 ----------
file_2 = ReadFile(File=python_script_2, PerLineParse=False)
bibil_2 = PythonScript(Code=file_2)

# ---- group: shape
python_script_3 = PythonScript(i=txt)  # -> o
# ---------- python_script_3: Python ----------
import os

o = os.path.join(str(i),"bibil\\bibil_shape.py")
#o = os.path.join(str(i),"research\\bibil_shape_shape_3d_2d.py")
# ---------- end python_script_3 ----------
file_3 = ReadFile(File=python_script_3, PerLineParse=False)
bibil_3 = PythonScript(Code=file_3)

# ---- group: tree
python_script_4 = PythonScript(i=txt)  # -> o
# ---------- python_script_4: Python ----------
import os

o = os.path.join(str(i),"bibil\\bibil_tree.py")
# ---------- end python_script_4 ----------
file_4 = ReadFile(File=python_script_4, PerLineParse=False)
bibil_4 = PythonScript(Code=file_4)

# ---- group: node_comp
python_script_5 = PythonScript(i=txt)  # -> o
# ---------- python_script_5: Python ----------
import os

o = os.path.join(str(i),"bibil\\bibil_plain.py")
# ---------- end python_script_5 ----------
file_5 = ReadFile(File=python_script_5, PerLineParse=False)

# ---- group: grammar_divide
python_script_6 = PythonScript(i=txt)  # -> o
# ---------- python_script_6: Python ----------
import os

o = os.path.join(str(i),"miru\\miru_plain.py")
# ---------- end python_script_6 ----------
file_6 = ReadFile(File=python_script_6, PerLineParse=False)

# ---- group: grammar_tower
python_script_7 = PythonScript(i=txt)  # -> o
# ---------- python_script_7: Python ----------
import os

o = os.path.join(str(i),"miru\\miru_plain_towers.py")
# ---------- end python_script_7 ----------
file_7 = ReadFile(File=python_script_7, PerLineParse=False)

# ---- group: grammar_courtyard
python_script_8 = PythonScript(i=txt)  # -> o
# ---------- python_script_8: Python ----------
import os

o = os.path.join(str(i),"miru\\miru_plain_podium.py")
# ---------- end python_script_8 ----------
file_8 = ReadFile(File=python_script_8, PerLineParse=False)

# ----
# SHAPE GENERATE
number_slider = Slider(1, range=0..10)
list = ValueList({"divide by depth": "subdivide_depth", "divide by same depth": "subdivide_depth_same", "divide by dim": "subdivide_dim"}, selected="divide by depth")
list_2 = ValueList({"NS", "EW"}, selected="NS")
bibil_5 = PythonScript(Code=file_6, Divide_num=number_slider, Divide_cut=Slider(5, range=0..10), Divide_type=list, Axis=list_2)
geo = Geometry(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)
geometry = Geometry(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)
# ghenv.Component.Params.Output[0].Name = bldgProgram + "ZonePrograms"
#         ghenv.Component.Params.Output[0].NickName = bldgProgram + "ZonePrograms"
toggle = BooleanToggle(True)
trinco_park = PythonScript(Code=file_5, Rule_in=bibil_5, Node_in=geometry, Label_="street", Run=toggle)  # -> Node_out, Debug
g = PythonScript(node=trinco_park.Node_out)  # -> geom; inputs node: list
# ---------- g: Python ----------
if node:
    geom = []
    #lot_lst = node.traverse_tree(lambda n:n,internal=False)
    for n in node:
        geom.append(n.data.shape.bottom_crv)
    print geom
# ---------- end g ----------
bibil_6 = PythonScript(Code=file_7)
bibil_7 = PythonScript(
    Code=file_8,
    Podium_depth=Slider(25, range=0..100),
    Podium_ht=Slider(16.5, range=0..100),
    Node_depth=Slider(0, range=-1..1))
trinco_park_2 = PythonScript(rule_in=bibil_6, node_in=trinco_park.Node_out, label="tower", run=Toggle(True))  # -> node_out, debug; inputs rule_in: list, node_in: list, run: Boolean
# ---------- trinco_park_2: Python ----------
"""
Bibil plain
"""

import rhinoscriptsyntax as rs
import Rhino as rc
from Rhino import RhinoApp
import scriptcontext as sc
import copy

## Import classes
Pattern = sc.sticky["Pattern"]
Shape_3D = sc.sticky["Shape_3D"]
Tree = sc.sticky["Tree"] 
Grammar = sc.sticky["Grammar"]

def copy_node_lst(nlst):
    L = []
    for n in nlst:
        L.append(copy.deepcopy(n))
    return L

def make_node_lst(copy_node_in_): 
    L = []
    P = Pattern()
    ref_geom = rs.coercebrep(rs.AddBox([[0,0,0],[0,1,0],[-1,1,0],[-1,0,0],\
                                        [0,0,1],[0,1,1],[-1,1,1],[-1,0,1]]))
    ref_shape = Shape_3D(ref_geom,cplane=None)
    ref_grammar = Grammar(ref_shape)
    ref_node = Tree(ref_grammar,parent=None,depth=0)
    
    for node_geom in copy_node_in_:
        if type(ref_node) == type(node_geom):
            n_ = node_geom
        else:
            n_ = P.helper_geom2node(node_geom,None,label=label_)
        L.append(n_)
    return L

def node2pattern(lst_node_,rule_in_):
    def type2node(copy_node_,type_):
        #type: list of (dictionary of typology parameters)
        copytype = copy.deepcopy(type_)
        copy_node_.data.type.update(copytype)
        return copy_node_
    ## Purpose: Input list of nodes, applies type
    ## Applies pattern based on types
    ## outputs node    
    P = Pattern()
    NL = []
    for node_ in lst_node_:
        ## Apply type to node
        node_ = type2node(node_,rule_in_)
        ## Apply pattern
        if True:#try:
            node_out_ = P.main_pattern(node_)
            nlst = node_out_.traverse_tree(lambda n:n,internal=False)
            NL.extend(nlst)
            #NL.append(node_out)
            print nlst
            RhinoApp.Wait()
        #except Exception as e:
        #    print "Error @ Pattern.main_pattern"
    return NL

def main(node_in_,rule_in):
    ### Grid_Subdivide: (listof node) int int -> (listof node))
    node_in_ = copy_node_lst(node_in_)     
    lst_node = make_node_lst(node_in_)
    lst_node = node2pattern(lst_node,rule_in)
    return lst_node

node_in = filter(lambda n: n!=None,node_in)
if run and node_in != []:
    sc.sticky["debug"] = []
    debug = sc.sticky["debug"]
    rule_in = rule_in[0]
    node_out = main(node_in,rule_in)
else:
    print 'Add inputs!'
# ---------- end trinco_park_2 ----------
trinco_park_3 = PythonScript(Code=file_5, Rule_in=bibil_7, Node_in=trinco_park.Node_out, Label_="podium", Run=Toggle(True))  # -> Node_out, Debug
ladybug = Ladybug_Ladybug()  # -> Vviiiiiiiiiizzz; plug-in component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
panel_3 = Panel("C:\Users\vasanthakumars\Desktop\simulation4ladybug3")
path = FilePath("C:\Users\vasanthakumars\Documents\GitHub\bibil\src\reference\CAN_ON_Toronto.716240_CWEC\CAN_ON_Toronto.716240_CWEC.epw")
# SIMULATE
path_2 = FilePath("C:\saeran\master\git\bibil\src\reference\CAN_ON_Toronto.716240_CWEC\CAN_ON_Toronto.716240_CWEC.epw")
g_2 = PythonScript(node=trinco_park_2.node_out)  # -> geom
# ---------- g_2: Python ----------
if node:
    geom = []
    lot_lst = node.traverse_tree(lambda n:n,internal=False)
    for n in lot_lst:
        if n.data.shape.x_dist < 23. or n.data.shape.y_dist < 23. or n.data.shape.get_area() < 615.:
            pass
        else:
            n.data.shape.op_extrude(90.)
            geom.append(n.data.shape.geom)
    print geom
# ---------- end g_2 ----------
g_3 = PythonScript(node=trinco_park_3.Node_out)  # -> geom
# ---------- g_3: Python ----------
if node:
    geom = []
    lot_lst = node.traverse_tree(lambda n:n,internal=False)
    for n in lot_lst:
        geom.append(n.data.shape.geom)
    print geom
# ---------- end g_3 ----------
geo_2 = Geometry([g_2, g_3])
gencumulativeskymtx = Ladybug_GenCumulativeSkyMtx(epwFile=path_2, skyDensity=0, workingDir="C:\Users\user\Desktop\simtest", useOldRes=Toggle(False), runIt=Toggle(False))  # -> out, cumulativeSkyMtx; plug-in component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
selectskymtx = Ladybug_selectSkyMtx(cumulativeSkyMtx=gencumulativeskymtx.cumulativeSkyMtx, removeDiffuse=False, removeDirect=False)  # -> out, selectedSkyMtx; plug-in component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
geometry_2 = Geometry([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])
geo_3 = Geometry(geo_2)
geo_4 = Geometry(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)
radiationanalysis = Ladybug_RadiationAnalysis(
    north=0,
    geometry=flatten(geo_4),
    context=flatten(geo_3),
    gridSize=Slider(12, range=0..100),
    disFromBase=Slider(1, range=0..1),
    selectedSkyMtx=flatten(selectskymtx.selectedSkyMtx),
    runIt=Toggle(False))  # -> out, contextMesh, analysisMesh, testPts, testVec, port, radiationResult, radiationMesh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; plug-in component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
mesh = Mesh(radiationanalysis.radiationMesh)
geo_5 = Geometry(<brep referenced from the Rhino model>)  # disabled
geo_6 = Geometry([<brep referenced from the Rhino model> x6])  # disabled
geo_7 = Geometry([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])
geo_8 = Geometry([<brep referenced from the Rhino model> x5])  # disabled
geo_9 = Geometry(<brep referenced from the Rhino model>)  # disabled
geo_10 = Geometry([<brep referenced from the Rhino model> x5])  # disabled
geo_11 = Geometry([<brep referenced from the Rhino model> x5])  # disabled
geo_12 = Geometry([<brep referenced from the Rhino model> x4])  # disabled
geo_13 = Geometry([<brep referenced from the Rhino model> x4])  # disabled
geo_14 = Geometry(<brep referenced from the Rhino model>)  # disabled
geo_15 = Geometry(<brep referenced from the Rhino model>)  # disabled
geo_16 = Geometry([<brep referenced from the Rhino model> x6])  # disabled
capex = CapHolesEx(Brep=[geo_9, geo_5, geo_15])  # -> Brep, Caps, Solid; disabled
toggle_2 = BooleanToggle(True)
northarrow = Ladybug_North(scale="8")  # -> northSign; plug-in component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
splitmass = Honeybee_SplitBuildingMass(bldgMasses=geometry_2, bldgsFlr2FloorHeights="@4.2", runIt=toggle_2)  # -> readMe, splitBldgMasses; plug-in component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
splitmass_2 = Honeybee_SplitBuildingMass(bldgMasses=geo_16, bldgsFlr2FloorHeights="@4.2", runIt=toggle_2)  # -> readMe, splitBldgMasses; disabled; plug-in component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
splitmass_3 = Honeybee_SplitBuildingMass(bldgMasses=[geo_14, capex.Brep], bldgsFlr2FloorHeights="@4.2", runIt=toggle_2)  # -> readMe, splitBldgMasses; disabled; plug-in component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
honeybee = Honeybee_Honeybee()  # -> Vviiiiiiiiiizzz; plug-in component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
geometry_3 = Geometry(splitmass.splitBldgMasses)
python_script_9 = PythonScript(x=splitmass.splitBldgMasses)  # -> out, a; inputs x: list
# ---------- python_script_9: Python ----------
a = filter(lambda n: n!=None,x)

print x
print a
# ---------- end python_script_9 ----------
ladybug_2 = Ladybug_Ladybug()  # -> Vviiiiiiiiiizzz; plug-in component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
mass2zone = Honeybee_Masses2Zones(zoneMasses=flatten(python_script_9.a), isConditioned=True, maxRoofAngle=30, createHBZones=Toggle(True))  # -> readMe, HBZones; plug-in component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
concat = Concatenate(FragmentA="2")
concat_2 = Concatenate(FragmentA="2", FragmentB="window", JoinSeparator=" ")
callfromepconstrlibrary = Honeybee_CallFromEPConstructionLibrary(keywords=concat)  # -> ThermMaterials, EPMaterials, EPWindowMaterials, EPConstructions; plug-in component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
callfromepconstrlibrary_2 = Honeybee_CallFromEPConstructionLibrary(keywords=concat_2)  # -> ThermMaterials, EPMaterials, EPWindowMaterials, EPConstructions; plug-in component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
glazingcreator = Honeybee_GlazingBasedOnRatio(HBObjects=mass2zone.HBZones, glzRatio="0.5", runIt=Toggle(True))  # -> readMe, HBObjWGLZ; plug-in component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
panel_4 = Panel(callfromepconstrlibrary.EPConstructions)
panel_5 = Panel(callfromepconstrlibrary_2.EPConstructions)
item = ListItem(List=callfromepconstrlibrary_2.EPConstructions, Index=44, Wrap=True)
item_2 = ListItem(List=callfromepconstrlibrary.EPConstructions, Index=198, Wrap=True)
decomposebytype = Honeybee_DecomposeBasedOnType(HBZone=glazingcreator.HBObjWGLZ)  # -> walls, interiorWalls, airWalls, flatten(windows), interiorWindows, skylights, roofs, ceilings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; plug-in component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
eplushotwaterboiler = Honeybee_OpenStudioHotWaterBoiler(name="boilerr")  # -> out, HotWaterBoiler; plug-in component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
setepzonecnstr = Honeybee_SetEPZoneConstruction(HBZone=glazingcreator.HBObjWGLZ, wallEPConstruction=item_2, windowEPConstruction=item)  # -> simplify(modifiedHBZone); plug-in component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
wires = BrepWireframe(
    Brep=[decomposebytype.exposedFloors, decomposebytype.groundFloors, decomposebytype.floors, decomposebytype.ceilings, decomposebytype.roofs, decomposebytype.walls, decomposebytype.windows],
    Density=-1)
preview = CustomPreview(Geometry=decomposebytype.windows, Shader=ColourSwatch(SwatchColor=RGBA(84, 218, 255, 126)))
open_weather_file = Ladybug_OpenEPWWeatherFile(open=Toggle(True))  # -> epwFile; plug-in component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
openstudiohvacsystemslist = Honeybee_OpenStudioHVACSystemsList({"0. Ideal Air Loads": 0, "1. PTAC | Residential": 1, "2. PTHP | Residential": 2, "3. PSZ-AC": 3, "4. PSZ-HP": 4, "5. Packaged VAV w/ Reheat": 5, "6. Packaged VAV w/ PFP Boxes": 6, "7. VAV w/ Reheat": 7, "8. VAV w/ PFP Boxes": 8, "9. Warm Air Furnace - Gas Fired": 9, "10.Warm Air Furnace - Electric": 10}, selected="5. Packaged VAV w/ Reheat")
toggle_3 = BooleanToggle(True)
epoutput = Honeybee_GenerateEPOutput(
    zoneEnergyUse=toggle_3,
    zoneGainsAndLosses=toggle_3,
    zoneComfortMetrics=toggle_3,
    comfortMapVariables=toggle_3,
    zoneHVACParams=toggle_3,
    surfaceTempAnalysis=toggle_3,
    surfaceEnergyAnalysis=toggle_3,
    glazingSolarAnalysis=toggle_3,
    timestep="annual")  # -> report, flatten(simulationOutputs); plug-in component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
airhandlerdetails = Honeybee_OpenStudioAirHandlerDetail(HVACSystemID=openstudiohvacsystemslist, coolingCoil="Grasshopper.Kernel.Types.GH_ObjectWrapper")  # -> out, airHandlerDetail; plug-in component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
epluscentralplant = Honeybee_OpenStudioCentralPlantOrchestrator(HVACSystemID=openstudiohvacsystemslist)  # -> out, plantDetails; plug-in component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
toggle_4 = BooleanToggle(True)
oshvacsystems = Honeybee_OpenStudioSystems(
    HBZones=mass2zone.HBZones,
    HVACSystems=openstudiohvacsystemslist,
    airSideDetails=airhandlerdetails.airHandlerDetail,
    plantDetails=epluscentralplant.plantDetails,
    seeHVACDesc=Toggle(True))  # -> readMe, HBZones; plug-in component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
northarrow_2 = Ladybug_North(north="18.75", scale="3")  # -> northSign; plug-in component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
open_weather_file_2 = Ladybug_OpenEPWWeatherFile(open=Toggle(True))  # -> epwFile; plug-in component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
exporttoopenstudio = Honeybee_ExportToOpenStudio(
    north="18.75",
    epwWeatherFile=open_weather_file,
    HBZones=flatten(setepzonecnstr),
    simulationOutputs=flatten(epoutput.simulationOutputs),
    writeOSM=toggle_4,
    runSimulation=toggle_4,
    workingDir="C:\Users\vasanthakumars\Desktop\temp_folder")  # -> readMe, osmFileAddress, idfFileAddress, resultsFileAddress, rddFileAddress, studyFolder; plug-in component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
exporttoopenstudio_2 = Honeybee_ExportToOpenStudio(epwWeatherFile=open_weather_file_2, HBZones=flatten(oshvacsystems.HBZones))  # -> readMe, osmFileAddress, idfFileAddress, resultsFileAddress, eioFileAddress, rddFileAddress, studyFolder; plug-in component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
readepresult = Honeybee_ReadEPResult(resultFileAddress=exporttoopenstudio.resultsFileAddress)  # -> totalThermalLoad, thermalLoadBalance, cooling, heating, electricLight, electricEquip, port, port_2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; plug-in component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
readepsrfresult = Honeybee_ReadEPSurfaceResult(resultFileAddress=exporttoopenstudio.resultsFileAddress)  # -> surfaceIndoorTemp, surfaceOutdoorTemp, surfaceEnergyFlow, opaqueEnergyFlow, glazEnergyFlow, windowTotalSolarEnergy, windowBeamEnergy, windowDiffEnergy, windowTransmissivity, port; disabled; plug-in component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
toggle_5 = BooleanToggle(True)  # disabled
colorsurfaces = Honeybee_ColorSurfacesByEPResult(srfData=readepsrfresult.surfaceIndoorTemp, HBZones=flatten(mass2zone.HBZones), runIt=toggle_5)  # -> readMe, srfColoredMesh, zoneWireFrame, legend, legendBasePt, analysisTitle, srfBreps, srfColors, srfValues, port; disabled; plug-in component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
flrnorm = Honeybee_NormalizeDataByFloorArea(simData=readepresult.cooling, HBZones=flatten(glazingcreator.HBObjWGLZ))  # -> totNormData, zoneNormData; plug-in component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
mesh_2 = Mesh(colorsurfaces.srfColoredMesh)  # disabled
colorzones = Honeybee_ColorZonesByEPResult(
    zoneData=readepresult.totalThermalLoad,
    HBZones=flatten(glazingcreator.HBObjWGLZ),
    normalizeByFloorArea=Toggle(True),
    runIt=Toggle(True))  # -> readMe, zoneColoredMesh, zoneWireFrame, legend, legendBasePt, analysisTitle, zoneBreps, zoneColors, zoneValues, floorNormZoneData; plug-in component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
panel_6 = Panel(flrnorm.totNormData)
preview_2 = CustomPreview(Geometry=colorzones.zoneWireFrame, Shader=colorzones.zoneColors)
