# Grasshopper definition beta_gfa_calc_0.gh (Grasshopper 0.9.76)
# plug-ins: Python Interpreter, LunchBox

bibil = PythonScript()  # -> o
# ---------- bibil: Python ----------
"""
Created on Jun 6, 2016
@author: Saeran Vasanthakumar
"""

import scriptcontext as sc

class Tree:
    """
    http://stackoverflow.com/questions/14084367/tree-in-python-recursive-children-creating
    http://www.laurentluce.com/posts/binary-search-tree-library-in-python/
    double-linked binary tree
    """
    def __init__(self,shape=None,grammar=None,loc=None,parent=None,sib=None,depth=0):
        self.shape = shape
        self.grammar = grammar
        if loc is None: loc = []
        self.loc = loc
        self.parent = parent
        self.depth = depth
        
    def __repr__(self):
        ret = "nd__" + str(self.grammar.type['label']) \
        + "__%s__%s" % (self.grammar.type['grammar'],self.depth)
        #for child in self.loc:
        #    ret += child.__repr__()
        return ret
    def delete_node(self):
        if self is not None:
            self.loc = []
            if self.parent:
                for i,pc in enumerate(self.parent.loc):
                    if self.parent.loc[i] is self: 
                        self.parent.loc.pop(i)
                        break
        self = None
        del self
        
    def get_root(self):
        if self.parent ==  None:
            return self
        else:
            return self.parent.get_root()
    
    def backtrack_tree(self,foo,accumulate=False):
        def helper_backtrack_tree(node,foo,accumulator,acc_):
            #tail-end recursion backtracking
            if foo(node)==True:
                if acc_ == False:
                    return node
                else:
                    accumulator.append(node) 
            elif node.parent == None:
                if acc_ == False:
                    return None
                else:
                    return accumulator
            return helper_backtrack_tree(node.parent,foo,accumulator,acc_)
        """ 
        Backtracks tree, applies function argument to every
        node until parent. Use tail-end recurusion
        """
        return helper_backtrack_tree(self,foo,[],accumulate)
            
    def traverse_tree(self,foo,internal=True):
        """ 
        traverse tree, applies function argument to every
        node, leaf
        """
        if self.loc == []:
            # base case
            return [foo(self)]
        else:
            L = []
            if internal:
                L = [foo(self)] 
            for i,child in enumerate(self.loc):
                if child:
                    L += self.loc[i].traverse_tree(foo,internal)
            return L
            
if True:
    sc.sticky["Tree"] = Tree
# ---------- end bibil ----------
bibil_2 = PythonScript()  # -> o
# ---------- bibil_2: Python ----------
import rhinoscriptsyntax as rs
import Rhino as rc
import random
import scriptcontext as sc
import copy
import math
import ghpythonlib.components as ghcomp
import clr
from Rhino import RhinoApp

clr.AddReference("Grasshopper")
from Grasshopper.Kernel.Data import GH_Path
from Grasshopper import DataTree


"""import classes"""
Shape = sc.sticky["Shape"]
Tree = sc.sticky["Tree"]
Bula = sc.sticky["Bula"]
Miru = sc.sticky["Miru"]

sc.sticky['debug'] = []
debug = sc.sticky["debug"]

TOL = sc.doc.ModelAbsoluteTolerance
    
class Grammar:
    """Grammar """
    def __init__(self):
        self.type = {'label':"x",'grammar':"null",'axis':"NS",'ratio':0.,'top':False,'freeze':False}
        #need to move axis, NS, ratio to divide
        empty_rule_dict = copy.deepcopy(Miru)
        self.type.update(empty_rule_dict)
        
    def helper_geom2node(self,geom,parent_node=None,label="x",grammar="null"):
        def helper_curve2srf(geom_):
            #check if not guid and is a curve
            curve_guid = None
            if type(geom_) != type(rs.AddPoint(0,0,0)):
                points = [rc.Geometry.Point3d(0,0,0),rc.Geometry.Point3d(0,1,0),rc.Geometry.Point3d(1,0,0)]
                curve = rc.Geometry.Curve.CreateControlPointCurve(points,1)
                if geom_.ObjectType == curve.ObjectType: 
                    curve_guid = sc.doc.Objects.AddCurve(geom_)
            else:
                if rs.IsCurve(geom_): 
                    curve_guid = geom_
            if curve_guid:
                srf_guid = rs.AddPlanarSrf(curve_guid)[0]
                rc_brep = rs.coercebrep(srf_guid)
                return rc_brep
            else:
                return rs.coercebrep(geom_)     
        
        debug = sc.sticky['debug']
        child_node,child_shape = None, None
        IsDegenerate = False
        tree_depth = 0
        try:
            if geom:
                geom = helper_curve2srf(geom)
                cplane_ref = None
                if parent_node: 
                    cplane_ref = parent_node.shape.cplane
                try:
                    child_shape = Shape(geom,cplane=cplane_ref)
                except Exception as e: 
                    print 'Bibil has detected a degenerate shape', str(e)
                    child_shape = Shape(geom,parent_node.shape.cplane)
                IsDegenerate = abs(child_shape.x_dist-0.) < 0.01 or abs(child_shape.y_dist-0.) < 0.01
            elif parent_node:
                #cloned nodes get link to parent_node.shape
                child_shape = parent_node.shape
            if parent_node: 
                tree_depth = parent_node.depth+1
            if IsDegenerate == False:
                if geom:
                    if child_shape.z_dist!=None and int(child_shape.z_dist) <= 0.0001:
                        child_shape.op_extrude(1.)
                child_grammar = Grammar()
                child_grammar.type["label"] = label
                child_grammar.type["grammar"] = grammar
                child_node = Tree(child_shape,child_grammar,parent=parent_node,depth=tree_depth)
        except Exception as e:
            print "Error at Pattern.helper_geom2node", str(e)
        return child_node
    def helper_clone_node(self,node_,parent_node=None,label="x"):
        #Purpose: Input node, and output new node with same Shape, new Grammar
        return self.helper_geom2node(None,parent_node,label)
        
    def is_near_zero(self,num,eps=1E-10):
        return abs(float(num)) < eps
    def solar_envelope_uni(self,node_0,time,seht,stype):
        def helper_get_curve_in_tree(node_,stype_,seht_):
            if stype_ == 3:
                noderoot = node_.get_root()
                basecrv = copy.copy(noderoot.shape.bottom_crv)
                ###debug.append(basecrv)
            else:
                basecrv = copy.copy(node_.shape.bottom_crv)
            # Move up to lot_node height
            rc.Geometry.PolyCurve.Translate(basecrv,0.,0.,seht_)
            return basecrv
        
        def helper_intersect_solar(se_,node_,seht_):
            nodegeomlst = node_.shape.op_split("Z",seht_/node_.shape.z_dist)
            nodebase,nodetop = nodegeomlst[0],nodegeomlst[1]
            se_intersect =  rc.Geometry.Brep.CreateBooleanIntersection(nodetop,se_,TOL)[0]
            rc.RhinoApp.Wait()
            se_union =  rc.Geometry.Brep.CreateBooleanUnion([se_intersect,nodebase],TOL)[0]
            return se_union

        #debug = sc.sticky["debu
        TOL = sc.doc.ModelAbsoluteTolerance
        start,end = time, abs(time - 12.) + 12.
        debug = sc.sticky['debug']
        try:
            node_0.get_root().traverse_tree(lambda n: n.shape.convert_rc('3d'))
            ## Get correct curve from data tree
            se_crv = helper_get_curve_in_tree(node_0,stype,seht)
            ## Get base and top
            #split_ratio = seht/node_0.shape.z_dist
            #lstchild = node_0.shape.op_split("Z",split_ratio)
            #lot_base,lot_top = lstchild[0],lstchild[1]
            ## Generate solar envelope
            #print 'se_crv', se_crv
            se = node_0.shape.op_solar_envelope(start,end,se_crv)
            sebrep = helper_intersect_solar(se,node_0,seht)
            #print 'solarbrep', sebrep
            ###debug.append(sebrep)
            return sebrep
        except Exception as e:
            print "Error @ solar_env_uni", str(e)
    def solar_envelope_multi(self,temp_node_,solartime_,data,solarht_):
        def helper_solar_envelope_multi(data,time,ht):
            try:
                #debug = sc.sticky["debug"]
                cpt = data.shape.cpt
                #time = [9,10,11,12,13]
                time += random.randint(-3,3)
                start = time
                end = start + 1.
                data.shape.make_top_crv()
                data.shape.convert_guid(dim='3d')
                #curve = top_crv#rs.CopyObject(data.shape.bottom_crv,[0,0,data.shape.ht])
                #g = copy.copy(rs.coercegeometry(data.shape.geom))
                cpt = rs.coerce3dpoint(data.shape.top_cpt)#[cpt[0], cpt[1], data.shape.ht] 
                curve = data.shape.top_crv
                
                se = data.shape.op_solar_envelope(start,end,curve)
                
                htpt = rs.AddPoint(cpt[0],cpt[1],ht)#data.shape.ht)
                if curve:
                    bottom_crv = curve
                else:
                    if not data.shape.is_guid(data.shape.bottom_crv):
                        tcrv = sc.doc.Objects.AddCurve(data.shape.bottom_crv)
                    else: 
                        tcrv = data.shape.bottom_crv
                    tvec = rs.VectorCreate(data.shape.top_cpt, data.shape.cpt)
                    bottom_crv = rs.CopyObject(tcrv,tvec)
                dcpt = data.shape.cpt
                if not data.shape.is_guid(dcpt):
                    dcpt = rs.AddPoint(dcpt[0],dcpt[1], dcpt[2])
                path_ = rs.AddCurve([dcpt,htpt])
                srf = rs.ExtrudeCurve(bottom_crv,path_)
                rs.CapPlanarHoles(srf)
                srf = rs.coercegeometry(srf)
                TOL = sc.doc.ModelAbsoluteTolerance
                ###debug.append(srf)
                try: 
                    se =  rc.Geometry.Brep.CreateBooleanIntersection(se,srf,TOL)[0]
                except: 
                    print 'error at solar multi helper'
                return se
            except Exception as e:
                print e
        try:
            sublst = temp_node_.traverse_tree(lambda n:n,internal=False)
            for subnode in sublst:
                add_hour = float(random.randint(-2,2))
                if add_hour == 0.: add_hour = 1
                solartime_ += 1/add_hour
                try:
                    se = helper_solar_envelope_multi(subnode.grammar,solartime_,solarht_)
                    geo_brep = rs.coercebrep(rs.CopyObject(subnode.shape.geom))
                    unioned =  rc.Geometry.Brep.CreateBooleanUnion([se,geo_brep],TOL)
                except Exception as e:
                    print "Error at solar_envelope multi"
                    print e
                try: 
                    unioned = unioned[0]
                    subnode.shape.geom = unioned
                except: 
                    print 'error multi unioning solartypes'
            return temp_node_
        except Exception as e:
            print "Error at pattern solar envelope multi"
            print e
    def stepback(self,tnode,PD_):
        debug = sc.sticky['debug']
        sb_ref = PD_['stepback_ref']
        sb_data = PD_['stepback_data'] #height:stepback
        sb_random = PD_['stepback_randomize']
        ##sb_data: [(height,distance),(height,distance)...]     
        if True:#try:
            #Parse setback data
            for i,sbd in enumerate(sb_data):
                sb_data[i] = map(lambda s: float(s), sbd.split(':'))
            #Parse setback_randomize
            if sb_random:
                random_bounds = sb_random.split(':')
                for i,rb in enumerate(random_bounds):
                    random_bounds[i] = map(lambda r: int(float(r)),rb.split('>'))
                randht_lo,randht_hi = random_bounds[0][0],random_bounds[0][1]
                randsb_lo,randsb_hi = random_bounds[1][0],random_bounds[1][1]
            
            #Get data if not geometry
            sbg_type = self.helper_get_type(sb_ref[0])
            if sbg_type != "geometry":
                sb_node_ref = self.helper_get_ref_node(sb_ref[0],tnode)
                axis_matrix = sb_node_ref.shape.set_base_matrix()
                line_lst = []
                for vectors in axis_matrix:
                    line =  rc.Geometry.Curve.CreateControlPointCurve(vectors,0)
                    line_lst.append(line)
                sb_ref = line_lst
            ## Loop through the height,setback tuples
            for sbd in sb_data:
                ht, dist = sbd[0], sbd[1]
                if sb_random:
                    if not self.is_near_zero(randht_lo) and not self.is_near_zero(randht_hi):
                        ht += random.randrange(randht_lo,randht_hi)
                    if not self.is_near_zero(randsb_lo) and not self.is_near_zero(randsb_hi):
                        dist += random.randrange(randsb_lo,randsb_hi)
                
                #Dissect floor
                if True:
                    sh_top_node = None
                    if ht < tnode.shape.ht:
                        sh_bot_node,sh_top_node = self.helper_divide_through_normal(tnode,ht)
                else:
                    sh_top_node = tnode
                ##Loop through all sb_geoms
                if sh_top_node:
                    sh_top_node.grammar.type['label'] = 'stepbacktop'
                    sh_bot_node.grammar.type['label'] = 'stepbackbot'
                    for sbg in sb_ref:
                        # move sbref
                        move_vector= sh_top_node.shape.normal*float(ht)
                        sbref_crv = sc.doc.Objects.AddCurve(sbg)
                        sbref_crv = rs.coercecurve(rs.CopyObject(sbref_crv,move_vector))
                        cut_geom = None
                        #cut at ht
                        #then take top node and split that
                        try: 
                            cut_geom = sh_top_node.shape.op_split("EW",0.5,deg=0.,\
                                                split_depth=float(dist*2.),split_line_ref=sbref_crv)
                        except:
                            pass
                        if cut_geom:
                            sh_top_node.shape.geom = cut_geom[0]
                            sh_top_node.shape.reset(xy_change=True)
        #except Exception as e:
        #    print str(e)#,sys.exc_traceback.tb_lineno 
        #    print "Error at Pattern.stepback"
        return tnode    
    def helper_divide_through_normal(self,temp_node_,dist_):
        #Need to rewrite this so all variables in divide is null
        #and option to orient results vertically exists
        #Divides based on 'height'
        #print 'helperdividethroughnormal chk'
        bottom_shape,top_shape = None, None
        ratio_ = (dist_ - temp_node_.shape.cpt[2])/temp_node_.shape.z_dist
        PD = {}
        PD['div_num'] = 1
        PD['div_deg'] = 0.
        PD['div_cut'] = 0.
        PD['div_ratio'] = ratio_
        PD['div_type'] = 'simple_divide'
        PD['axis'] = "Z"
        temp_node_ = self.divide(temp_node_,PD)
        if temp_node_.loc:
            ext_pt = temp_node_.shape.cpt + (temp_node_.shape.normal * dist_)
            dist_0 = temp_node_.loc[0].shape.cpt - ext_pt
            dist_1 = temp_node_.loc[1].shape.cpt - ext_pt
            
            if dist_0.Length > dist_1.Length:
                bottom_shape = temp_node_.loc[0]
                top_shape = temp_node_.loc[1]
            else:
                bottom_shape = temp_node_.loc[1]
                top_shape = temp_node_.loc[0]
            #mark top ##this should be an automatic check in helpergeom2node or clonenodes
            lst_top_nodes = temp_node_.backtrack_tree(lambda n:n.grammar.type['top'],accumulate=True)
            for tn in lst_top_nodes: tn.grammar.type['top'] = False
            top_shape.grammar.type['top'] = True
        return bottom_shape,top_shape
    def divide(self,node,PD_):       
        def helper_subdivide_depth(hnode,div,div_depth,ratio_,axis_ref="NS"):            
            #print 'divdepth, div', div_depth,',', div
            # stop subdivide
            if int(div_depth) >= int(div) or abs(div-0.) <= 0.01:
                haxis,hratio = axis_ref,0.
            # start subdivide
            elif int(div_depth) == 0 and int(div) > 0:
                haxis,hratio = axis_ref,ratio_
            # alternate subdivide by axis
            elif "NS" in hnode.parent.grammar.type['axis']:
                haxis,hratio = "EW",ratio_
            elif "EW" in hnode.parent.grammar.type['axis']:
                haxis,hratio = "NS",ratio_
            hnode.grammar.type['axis'] = haxis
            hnode.grammar.type['ratio'] = hratio
            return hnode
        def helper_subdivide_depth_same(hnode,div,div_depth,ratio_,axis_ref="NS"):            
            # base case: stop subdivide
            if int(div_depth) >= int(div) or abs(div-0.) <= 0.01:
                haxis,hratio = axis_ref,0.
            # alternate subdivide by axis
            elif float(div_depth) < 0.5 and int(div) > 0.01:
                haxis,hratio = axis_ref,ratio_
            # alternate subdivide by axis
            else:
                haxis,hratio = node.parent.grammar.type['axis'],0.5
            hnode.grammar.type['axis'] = haxis
            hnode.grammar.type['ratio'] = hratio
            return hnode
        def helper_subdivide_dim(hnode,div,div_depth,ratio_,axis_ref="NS",tol_=3.):            
            def equals(a,b,tol=int(3)):
                return abs(a-b) <= tol
            def greater(a,b,tol=int(3)):
                checktol = abs(a-b) <= tol
                return a >= b and not checktol
            ss = hnode.shape
            tol_ = 2.5
            grid_x, grid_y = float(div[0]), float(div[1])
            #print 'g', grid_x, grid_y
            #print 'gref', ss.y_dist, ss.x_dist
            
            if greater(ss.y_dist,grid_y,tol_):
                haxis = "EW" 
                hratio = grid_y/float(ss.y_dist)
            elif greater(ss.x_dist,grid_x,tol_): 
                haxis = "NS"
                hratio = grid_x/float(ss.x_dist)
            else: 
                haxis,hratio = axis_ref,0.
            #print haxis, hratio
            #print '--'
            hnode.grammar.type['axis'] = haxis
            hnode.grammar.type['ratio'] = hratio
            return hnode
        def helper_simple_divide(hnode,div_,div_depth_,ratio_,axis_ref="NS"):
            hnode.grammar.type['axis'] = axis_ref
            hnode.grammar.type['ratio'] =ratio_
            return hnode
        def helper_divide_recurse(node_,grid_type_,div_,div_depth_,cwidth_,ratio_,axis_,count):
            ## Split, make a node, and recurse.
            if grid_type == "subdivide_depth":
                node_ = helper_subdivide_depth(node_,div_,div_depth_,ratio_,axis_ref=axis_)
            elif grid_type == "subdivide_depth_same":
                node_ = helper_subdivide_depth_same(node_,div_,div_depth_,ratio_,axis_ref=axis_)
            elif grid_type == "subdivide_dim":
                node_ = helper_subdivide_dim(node_,div_,div_depth_,ratio_,axis_ref=axis_)
            else:#simple_divide
                node_ = helper_simple_divide(node_,div_,div_depth_,ratio_,axis_ref=axis_)
        
            if count >=200.:
                pass
            elif node_.grammar.type['ratio'] > 0.0001:
                #node_.grammar.type['ratio'] = 1. - node_.grammar.type['ratio']
                #debug.extend(node_.shape.bbpts)
                loc = node_.shape.op_split(node_.grammar.type['axis'],node_.grammar.type['ratio'],0.,split_depth=cwidth_)
                #debug.extend(loc)
                #print len(loc)
                for i,child_geom in enumerate(loc):
                    #print 'child nodes'
                    ###debug.append(child_geom)
                    child_node = self.helper_geom2node(child_geom,node_)
                    #print child_node.shape.x_dist
                    #print child_node.shape.y_dist
                    if child_node: node_.loc.append(child_node)
                #print loc
                #print '----'
                if 'simple_divide' not in grid_type: 
                    for nc in node_.loc:
                        helper_divide_recurse(nc,grid_type,div_,div_depth_+1,cwidth_,ratio_,axis_,count+1)
        debug = sc.sticky['debug']
        if type(PD_)==type([]):
            div = PD_[0]
            div_deg = PD_[1]
            cut_width = PD_[2]
            ratio = PD_[3]
            grid_type = PD_[4]
            axis = PD_[5]
        else:
            div = PD_['div_num']
            div_deg = PD_['div_deg']
            cut_width = PD_['div_cut']
            ratio = PD_['div_ratio']
            grid_type = PD_['div_type']
            axis = PD_['axis']
        tree_depth = 0.
        helper_divide_recurse(node,grid_type,div,tree_depth,cut_width,ratio,axis,0)
        return node
    def helper_normal2extsrf(self,temp_node_):
        def get_colinear_line(refnode_,tn_):
            def get_max_magnitude(lst):
                max_index = 0
                max_dist = rs.Distance(lst[0][0],lst[0][1])
                for i,ln in enumerate(lst[1:]):
                    dist = rs.Distance(ln[0],ln[1])
                    if dist > max_dist:
                        max_dist = dist
                        max_index = i+1
                lst = [lst[max_index]]
                return lst
            ## Input refnode, and tn
            ## Outputs the lines of tn that are colinear to refnode
            ## Loop through all lines in refshape
            ## Loop through all lines in tempnode
            ## if colinear line, add to colinear_lst 
            ref_base = refnode_.shape.set_base_matrix()
            foo_colinear = refnode_.shape.check_colinear_pt
            colinear_lst = []
            newht = tn_.shape.cpt[2]
            n_matrix = tn_.shape.set_base_matrix()
            check_x = False
            check_y = False
            for line in ref_base:
                newline = map(lambda p: [p[0],p[1],newht],line)
                refcrv = rs.coercecurve(rs.AddLine(newline[0],newline[1]))
                ##debug.append(refcrv)
                for nline in n_matrix:
                    pt_0 = foo_colinear(refcrv,nline[0],tol=0.5)
                    pt_1 = foo_colinear(refcrv,nline[1],tol=0.5)
                    if pt_0 and pt_1:
                        colinear_lst.append(nline)
            if len(colinear_lst) < 1:
                colinear_lst = get_max_magnitude(tn_.shape.base_matrix)
            if len(colinear_lst) > 1:
                colinear_lst = get_max_magnitude(colinear_lst)
            return colinear_lst.pop(0)
        def get_normal_to_exterior_vector(parallel2ext):
            ## Take cross product ccw * [0,0,1] vector
            ## solution vector is inward pointing vector
            ccw_vec = parallel2ext[1] - parallel2ext[0]
            up_vec = rc.Geometry.Vector3d(0,0,1)
            cross = rc.Geometry.Vector3d.CrossProduct(ccw_vec,up_vec)
            return cross
        
        ## Takes a node and finds the vector perpendicular to the surface
        ## pointing inward, relative to the rootnode surface
        ## This should be abstracted and moved to shape class
        debug = sc.sticky['debug']
        temp_node_.traverse_tree(lambda n: n,internal=False)
        ref_node = temp_node_.get_root()
        parallel2refext = get_colinear_line(ref_node,temp_node_)
        #line = rs.AddLine(parallel2refext[0],parallel2refext[1])
        ##debug.append(line)
        normal2srf = get_normal_to_exterior_vector(parallel2refext)
        return normal2srf
    def separate_by_dist(self,temp_node_,PD_):
        def check_shape_validity(t_,dim2chk_tuple,minarea,tol_=2.):
            ## Move this to shape class
            ## Flip cut axis to check the resulting dim
            ## EW akways checks x axis, NS always checks y axis
            IsEWDim,IsNSDim,IsMinArea = False, False, False
            x_dim = dim2chk_tuple[0]
            y_dim = dim2chk_tuple[1]
            try:
                IsEWDim = t_.shape.check_shape_dim("EW",x_dim,tol=tol_)
                IsNSDim = t_.shape.check_shape_dim("NS",y_dim,tol=tol_)
                IsMinArea = abs(t_.shape.get_area() - minarea) <= tol_
            except:
                pass
            #print IsNSDim, IsEWDim, IsMinArea
            return IsEWDim and IsNSDim and IsMinArea
        def separate_dim(temp_node_topo_,x_keep_omit_,y_keep_omit_,cut_axis,cut_axis_alt):
            def helper_simple_divide(lstvalidshape_,dimkeep,dimaxis):
                #Now cut the valid shapes
                VL = []
                for validshape in lstvalidshape_:
                    simple_ratio = validshape.shape.calculate_ratio_from_dist(dimaxis,dimkeep,dir_=0.)
                    validshape_param_lst = [1.,dummy_deg,0.,simple_ratio,"simple_divide",dimaxis]
                    try:
                        self.divide(validshape,validshape_param_lst)
                    except:
                        pass
                    VL.extend(validshape.traverse_tree(lambda n:n, internal=False))
                return VL
            #Axis issue:
            #cut_axis: axis that cuts perpendicular to primary axis of shape
            #EW will cut y_dist
            #NS will cut x_dist
            #In bibil - y_axis (cutting EW) is always set as the primary axis. 
            
            #Prep inputs
            x_keep_,x_omit_ = x_keep_omit_[0],x_keep_omit_[1] 
            y_keep_,y_omit_ = y_keep_omit_[0],y_keep_omit_[1]
            
            #Make first division
            divbydim = (x_keep_+x_omit_,y_keep_+y_omit_)
            dummy_ratio, dummy_axis, dummy_deg = 0.5, "NS", 0.
            param_lst = [divbydim,dummy_deg,0.,dummy_ratio,"subdivide_dim",dummy_axis]
            try:
                self.divide(temp_node_topo_,param_lst)
            except:
                pass
            ##Now recursively divide once for dim keep and check dim...
            shape2keep_lst = []
            shape2omit_lst = []
            
            #Set inputs for simple divide
            topo_child_lst = temp_node_topo_.traverse_tree(lambda n:n, internal=False)
            #EW checks x_dist, NS checks y_dist << THIS SHOULD BE CHANGED TO HAVE SAME NAME        
            if "EW" in cut_axis:##then the we are cutting y axis, give y dims
                dimprimekeep = y_keep_
                dimsecondkeep = x_keep_
            else:
                dimprimekeep = x_keep_
                dimsecondkeep = y_keep_
            lstfirkeepnodes = helper_simple_divide(topo_child_lst,dimprimekeep,cut_axis)
            lstseckeepnodes = helper_simple_divide(lstfirkeepnodes,dimsecondkeep,cut_axis_alt)
            
            for final_node in lstseckeepnodes:
                min_area = x_keep_ * y_keep_
                div2keep = (x_keep_,y_keep_)
                IsValidDimKeepOmit = check_shape_validity(final_node,div2keep,min_area,tol_=2.)
                if IsValidDimKeepOmit:
                    shape2keep_lst.append(final_node)
                else:
                    shape2omit_lst.append(final_node)
            #debug.extend(map(lambda n: n.shape.geom,shape2keep_lst))
            return shape2omit_lst,shape2keep_lst
        def check_base_with_offset(shape2off,GLOBLST):
            # check if interect with tower-seperation list
            intersect_offset = False
            for offset in GLOBLST:
                crvA = offset
                crvB = shape2off.shape.bottom_crv
                ##debug.append(offset)
                print crvA
                setrel = shape2off.shape.check_region(crvA,crvB,tol=0.1)
                #If not disjoint
                if not abs(setrel-0.)<0.1:
                    intersect_offset = True
                    break
            return not intersect_offset
        def set_separation_record(shape2record,sep_dist,separation_tol_):
            ## Add some tolerance to separation distance
            sep_dist_tol = (sep_dist - separation_tol_) * -1
            sep_crv = shape2record.shape.op_offset_crv(sep_dist_tol,corner=3)
            #debug.append(check_base_separation_.shape.bottom_crv)
            #debug.append(sep_crv)
            ## Append crv
            sc.sticky['GLOBAL_COLLISION_LIST'].append(rs.coercecurve(sep_crv))
            
        debug = sc.sticky['debug']
        
        #Extract data
        x_keep_omit = PD_['x_keep_omit']
        y_keep_omit = PD_['y_keep_omit']
        
        #Parse the data
        x_keep_omit = map(lambda s: float(s), x_keep_omit.split(','))
        y_keep_omit = map(lambda s: float(s), y_keep_omit.split(','))
        
        temp_node_topo = temp_node_#copy.deepcopy(sep_ref_node)
        
        ## Get normal to exterior srf
        try:
            normal2srf = self.helper_normal2extsrf(temp_node_topo)
            cut_axis = temp_node_topo.shape.vector2axis(normal2srf)
        except:
            cut_axis = "NS"
        noncut_axis = "EW" if "NS" in cut_axis else "NS" 
        
        ## Get cut dimensions     
        shapes2omit,shapes2keep = separate_dim(temp_node_topo,x_keep_omit,y_keep_omit,cut_axis,noncut_axis)
        
        temp_node_topo.loc = []
        
        if shapes2keep:
            #Flatten tree
            temp_node_topo = self.flatten_node_tree_single_child(shapes2keep,temp_node_topo,grammar="shape2keep",empty_parent=True)
            temp_node_topo = self.flatten_node_tree_single_child(shapes2omit,temp_node_topo,grammar="shape2omit",empty_parent=False)
            
            # Make/call global collision list
            #if not sc.sticky.has_key('GLOBAL_COLLISION_LIST'):
            sc.sticky['GLOBAL_COLLISION_LIST'] = []
            
            offset_dist = x_keep_omit[1]
            seperate_tol = 0.5
            # Check shape separation
            for i,t in enumerate(temp_node_topo.loc):
                if 'shape2keep' in t.grammar.type['grammar']:
                    GLOBAL_LST = sc.sticky['GLOBAL_COLLISION_LIST']
                    GLOBAL_LST = filter(lambda offcrv: offcrv!=None,GLOBAL_LST)
                    isSeperate = check_base_with_offset(t,GLOBAL_LST)
                    if isSeperate == True:
                        #offset_tuple
                        set_separation_record(t,offset_dist,seperate_tol)
        else: 
            temp_node_topo.loc = [] 
        ##TEMP4MEETING
        for i,t in enumerate(temp_node_topo.loc):
            if 'omit' in t.grammar.type['grammar']:
                temp_node_topo.loc[i] = None
                debug.append(t)
        temp_node_topo.loc = filter(lambda n:n!=None,temp_node_topo.loc)
        return temp_node_topo
    def extract_slice(self,temp_node_,PD_):
        def extract_topo(n_,ht_):
            pt = n_.shape.cpt
            refpt = rs.AddPoint(pt[0],pt[1],ht_)
            topcrv = n_.shape.get_bottom(n_.shape.geom,refpt)
            childn = self.helper_geom2node(topcrv,n_,'extracted_slice')
            
            ##this should be an automatic check in helpergeom2node or clonenodes
            childn.grammar.type['top'] = True
            lst_top_nodes = n_.backtrack_tree(lambda n:n.grammar.type['top'],accumulate=True)
            ##
            for tn in lst_top_nodes: tn.grammar.type['top'] = None
            n_.loc.append(childn)
            return childn

        ## Warning: this function will raise height of geom 1m.
        slice_ht = PD_['extract_slice_height']
        IsTop = False
        #Check inputs
        if type(slice_ht) != type([]): slice_ht = [slice_ht]
        if slice_ht == [] or slice_ht == [None]: 
            slice_ht = ['max']
            ##unsure about this but works for now...
            IsTop = temp_node_.backtrack_tree(lambda n:n.grammar.type['top'])
        
        if temp_node_.parent:
            for sib in temp_node_.parent.loc:
                sib.grammar.type['freeze'] = True
        
        #print 'istop', IsTop
        #print temp_node_
        #print temp_node_.parent, temp_node_.parent.grammar.type['top']
        if slice_ht and IsTop:  
            if self.helper_get_type(slice_ht[0]) == "string":
                if slice_ht[0] == 'max':
                    slice_ht = [temp_node_.shape.ht]
                else:
                    slice_ht = map(lambda s: float(s),slice_ht)            
            #Extract topo
            for slht in slice_ht:
                extract_topo(temp_node_,slht)
        return temp_node_
    def set_height(self,temp_node_,PD_):
        def height_from_bula(n_):
            setht = 6. #default ht = midrise
            bula_node_lst = temp_node_.backtrack_tree(lambda n: n.grammar.type['bula'],accumulate=True)
            #temp
            min_bula_node_sum = None
            min_bula_node_index = None
            
            for bula_ref_index,bula_node in enumerate(bula_node_lst):
                bula_node_sum = 0
                buladata = bula_node.grammar.type['bula_data']
                lpl_,lvl_, lvl_actual = buladata.set_node_bula_pt_ref(temp_node_,bula_node)
                
                #for vl_ in lvl_:
                bula_node_min = min(reduce(lambda x,y: x+y,lvl_))
                
                if min_bula_node_sum == None or min_bula_node_sum > bula_node_min:
                    min_bula_node_sum = bula_node_min
                    min_bula_node_index = bula_ref_index
            buladata = bula_node_lst[min_bula_node_index].grammar.type['bula_data']
            lpl_,lvl_,actual_lvl_ = buladata.set_node_bula_pt_ref(temp_node_,bula_node_lst[min_bula_node_index])
            if lpl_ != [[]]:
                n_ = buladata.generate_bula_point([n_],lpl_,lvl_,actual_lvl_)[0]
                val_lst = n_.grammar.type['bula_data'].value_lst
                setht = min(val_lst)#sum(val_lst)/float(len(val_lst))
            return setht
        
        debug = sc.sticky['debug']
        #print 'We are setting height!'
        ht_ = PD_['height']
        randomize_ht = PD_['height_randomize']
        if randomize_ht:
            random_bounds = map(lambda r: int(float(r)),randomize_ht.split('>'))
            randht_lo,randht_hi = random_bounds[0],random_bounds[1]
            ht_ += random.randrange(randht_lo,randht_hi)
        n_ = temp_node_
        #print 'labelchk', temp_node_.parent.parent.grammar.type['label']
        if type(ht_)==type('') and 'bula' in ht_:
            setht_ = height_from_bula(n_)
        else:
            setht_ = ht_
        n_.shape.op_extrude(setht_)
        #print '---'
        return temp_node_
    def get_solar_zone(self,start_time,end_time,curve=None,zonetype='envelope'):
        try:
            if type(curve) == type(rs.AddPoint(0,0,0)): 
                curve = rs.coercecurve(curve)
            if 'envelope' in zonetype:
                se = ghcomp.DIVA.SolarEnvelope(curve,43.65,start_time,end_time)
            else:
                minhr = end_time-start_time
                se = ghcomp.DIVA.SolarFan(curve,43.65,minhr,263,200.)
            return se
        except Exception as e:
            print "P.op_solar_envelope error"
            print e
    def concentric_divide(self,temp_node_,distlst,dellst,ROOTREF):
        def helper_recurse(curr_node_,rootref_,distlst_,dist_acc,dellst_,lst_ring,diffn,count):
            ##base case: fail chk_offset
            if ROOTREF:
                rootshape = ROOTREF
            else:
                rootshape = 0
            if curr_node_ == None or count > 10:
                if diffn!=None:
                    lst_ring.append(diffn.shape.geom)
                return lst_ring
            else:
                try:
                    dist_ = distlst_.pop(1)
                    shgeom = curr_node_.shape.geom
                    curr_node_ = self.helper_geom2node(shgeom,rootref_)
                    #debug.append(curr_node_.shape.geom)
                    try:
                        diff_node = self.court(curr_node_,rootshape,dist_+dist_acc,slice=True)
                        #dl = diff_node.traverse_tree(lambda n:n,internal=False)
                        #debug.extend(map(lambda n:n.shape.geom,dl))
                    except:
                        pass
                    #fig this out: diff_node.parent = curr_node_.get_root()
                    if dist_ not in dellst_:
                        for cn in curr_node_.loc:
                            lst_ring.append(cn.shape.geom)
                    ## Check diff node dimension and store it
                    if diff_node:
                        chk_EW_dim = diff_node.shape.check_shape_dim("EW",dist_,min_or_max='min')
                        chk_NS_dim = diff_node.shape.check_shape_dim("NS",dist_,min_or_max='min') 
                        if chk_EW_dim and chk_NS_dim:
                            diffn = diff_node
                    distlst_.insert(0,dist_)
                    ## Change the relationships 
                    return helper_recurse(diff_node,rootref_,distlst_,dist_acc+dist_,dellst_,lst_ring,diffn,count+1)
                except Exception as e:
                    pass#print 'error at concentric', str(e)
        debug = sc.sticky['debug']
        lon = temp_node_.traverse_tree(lambda n: n,internal=False)
        rootref = temp_node_.get_root()
        
        for subdiv in lon:
            ringlst = helper_recurse(subdiv,rootref,distlst,0.,dellst,[],None,0)
            ringlst = filter(lambda n: n!=None,ringlst)
            ##debug.extend(ringlst)
            for ring in ringlst:
                childnode = self.helper_geom2node(ring,subdiv)
                subdiv.loc.append(childnode)
        return temp_node_
    #Abstract this as helper to parse ref geoms
    def helper_get_type(self,type_ref_):
        type_info = None
        N = Tree()
        S = Shape()
        #Check if number reference to index of depth in binary data tree
        if type_ref_ == None:
            type_info = None
        elif type(type_ref_)==type(""): 
            type_info = "string"
        elif type(type_ref_) == type(1) or type(type_ref_) == type(1.):
            type_info = "number"
        elif type(type_ref_) == type(N):
            type_info = "tree"
        elif type(type_ref_) == type(S):
            type_info = "shape"
        else:
            type_info = "geometry"
        return type_info
    def helper_get_ref_node(self,shape_ref_,node_):
        ##Checks the input type and outputs the a Node based on reference
        refshape_ = None
        #Base case
        type_info = self.helper_get_type(shape_ref_)
        if type_info == None:
            refshape_ = node_
        else:
            #Check if number reference to index of depth in binary data tree
            if type_info == "string": 
                shape_ref_ = int(shape_ref_)
                type_info = "number"
            if type_info == "number":
                shape_ref_ = int(shape_ref_)
                #positive or zero or negative
                if shape_ref_ > -0.5:
                    refdepth = shape_ref_
                else:
                    refdepth = node_.depth + (shape_ref_ + 1)
                refshape_backtrack = node_.backtrack_tree(lambda n:n.depth==refdepth,accumulate=False)
                if refshape_backtrack:
                    refshape_ = refshape_backtrack
            #Check if node
            elif type_info == "node":
                refshape_ = node_
            #Assume geom
            else:
                try:
                    shape_node = self.helper_geom2node(shape_ref_)
                    refshape_ = shape_node
                except:
                    pass
        #check if nothing matches
        if refshape_ == None:
            refshape_ = node_
        return refshape_
    def flatten_node_tree_single_child(self,lstofchild,parent_ref_node,grammar="null",empty_parent=True):
        #Input list of nodes at different depths, a parent, grammar
        #Create flat list of nodes w/ same parent
        def clean_child_nodes(loc):
            #Clean child nodes of links to parent or childs
            for i,c in enumerate(loc):
                for lc in c.loc:
                    try:
                        del lc.shape.geom
                    except:
                        pass
                    del lc
                c.loc = []
                c.parent = None
                loc[i] = c
            return loc
        if empty_parent == True:
            parent_ref_node.loc = []
        lstofchild = clean_child_nodes(lstofchild)
        for i,n in enumerate(lstofchild):
            n.depth = parent_ref_node.depth+1
            n.parent = parent_ref_node
            lstofchild[i] = n
            if grammar != "null":
                n.grammar.type['grammar'] = grammar
        parent_ref_node.loc.extend(lstofchild)
        return parent_ref_node
    def court(self,temp_node_,PD_):        
        def court_slice(curr_node,rootshape,width_,cut_width_):
            def recurse_slice(curr_node_,matrice,valid_node_lst,diff,count,count_subdiv,cut_width__):
                #print count, curr_node_
                cmax = 20.
                tol = 2.
                invalid_node = None
                valid_node = None
                #Base case
                if count >= cmax or curr_node_==None:
                    return valid_node_lst,diff
                else:
                    diff = curr_node_
                    #chk_offset_ = rootshape.op_offset_crv(width_+0.1)
                    matrice_max = False
                    #print 'start---'
                    set_rel = -100
                    for i,line in enumerate(matrice):
                        #print i
                        dirvec = line[1]-line[0]
                        # get magnitude of line
                        dist = math.sqrt(sum(map(lambda p: p*p,dirvec)))
                        if dist > tol: 
                            split_crv = rs.AddCurve(line,1)
                            midpt = curr_node_.shape.get_midpoint(line)
                            sc_ = 5,5,0
                            split_crv = rs.ScaleObject(split_crv,midpt,sc_)
                            if True:#try:
                                split_node_lst = []
                                split_geoms = curr_node_.shape.op_split("NS",0.5,split_depth=cut_width__,split_line_ref=split_crv)
                                for geom in split_geoms:
                                    #if type(geom)!= type(rootshape.shape.geom):
                                    #    ##debug.append(geom)
                                    split_node = self.helper_geom2node(geom,None)
                                    split_node_lst.append(split_node)
                                    split_crv = split_node.shape.bottom_crv
                                    set_rel = curr_node_.shape.check_region(chk_offset,split_crv,tol=0.1)
                                    if abs(set_rel-0.)<0.1:
                                        valid_node = split_node
                                    else:
                                        invalid_node = split_node
                            #except:
                                #pass## Split fail, so test the next line split
                        matrice_max = len(matrice)==i+1
                        if invalid_node != None and valid_node != None:
                            valid_node_lst.append(valid_node)
                            matrice.pop(i)
                            break
                    if matrice_max == True and abs(set_rel-2.)<0.1:
                        #debug.append(curr_node_.shape.geom)
                        chk_offset_out = rootshape.op_offset_crv(width_-1.)
                        for sn in split_node_lst:
                            split_crv = sn.shape.bottom_crv
                            set_rel = curr_node_.shape.check_region(chk_offset_out,split_crv,tol=0.1)
                            if abs(set_rel-2.)<0.1 and count_subdiv < 1.:
                                try:
                                    L_,diff_ = recurse_slice(sn,shape_matrix,[],None,0,count_subdiv+1,cut_width__)
                                    valid_node_lst.extend(L_)
                                    #debug.extend(map(lambda n:n.shape.geom,L_))
                                except:
                                    pass
                                #debug.append(sn.shape.geom)
                # If the node has been split (invalid_node!= None)
                # OR the node has no valid split lines (invalid_node == None)
                # then we send it back into the recurser.
                return recurse_slice(invalid_node,matrice,valid_node_lst,diff,count+1,count_subdiv,cut_width__)
            
            ### REWRITE AS EXTRUSION OF BASE_MATRIX
            ### O(2n) complexity time
            offset = rootshape.op_offset_crv(width_)
            ###debug.append(rootshape.bottom_crv)
            chk_offset = rootshape.op_offset_crv(width_+0.21)
            diff = None
            if chk_offset:
                off_node = self.helper_geom2node(offset,curr_node)
                shape_matrix = off_node.shape.set_base_matrix()
                #debug.append(curr_node.shape.geom)
                L,diff = recurse_slice(curr_node,shape_matrix,[],None,0,0,cut_width_)
                #debug.extend(map(lambda n:n.shape.geom,L))
                #debug.append(diff.shape.geom)
                #print diff
                curr_node = self.flatten_node_tree_single_child(L,curr_node,grammar="courtslice")
                
            else:
                diff = None
            return diff
        
        #Unpack the parameters         
        court_ref = PD_['court_ref']
        court_width = PD_['court_width']
        court_slice_bool = PD_['court_slice']
        court_randomize = PD_['court_randomize']
        cut_width = PD_['court_cut_width']
        if not cut_width:
            cut_width = 0.
        if court_randomize:
            random_bounds = map(lambda r: int(float(r)),court_randomize.split('>'))
            randct_lo,randct_hi = random_bounds[0],random_bounds[1]
            court_width += random.randrange(randct_lo,randct_hi)
        
        debug = sc.sticky['debug']
        diff = None
        lon = temp_node_.traverse_tree(lambda n: n,internal=False)
        
        for subdiv in lon:
            subdiv.shape.convert_rc('3d')
            refshape_node = self.helper_get_ref_node(court_ref,subdiv)
            refshape = refshape_node.shape
            if court_slice_bool:
                try:
                    diff = court_slice(subdiv,refshape,court_width,cut_width)
                except Exception as e:
                    print 'Error @ court_slice', str(e)
            elif court_width > 0.:
                try:
                    subdiv.shape.op_offset(court_width,refshape.bottom_crv,dir="courtyard")
                except Exception as e:
                    print 'Error @ court', str(e)        
        return diff
    def set_bula_point(self,temp_node_,PD_):
        #Move this back to Bula as main_bula
        B = Bula()
        S = Shape()
        #Get the inputs
        analysis_ref = PD_['bula_point_lst']
        value_ref = PD_['bula_value_lst']
        
        ##Check to see what are input combo
        chk_apt = filter(lambda x: x!=None,analysis_ref) != []
        chk_val = filter(lambda x: x!=None,value_ref) != []
        value_ref_actual = None
        #Set defaults or add warnings
        if not chk_apt:
            print 'Analysis inputs are missing!'
            chk_apt = False
        if not chk_val:
            val_num = len(analysis_ref)
            value_ref = [0]*val_num
            chk_val = True
        elif chk_val and type(value_ref[0]) == type(''): #should be more explicit
            #If value is a formula
            if chk_apt:
                value_ref,value_ref_actual = B.apply_formula2points(value_ref,analysis_ref)
        if value_ref_actual == None:
                value_ref_actual = copy.copy(value_ref)
        if chk_apt and chk_val: 
            #Convert from guid 
            if S.is_guid(analysis_ref[0]):
                analysis_pts = map(lambda p: rs.coerce3dpoint(p),analysis_ref)
            #Sort analysis pts into leaf nodes
            shape_leaves = temp_node_.traverse_tree(lambda n: n,internal=False)
            #shape_leaves = [temp_node_]
            lst_plain_pt_lst, lst_value_lst,lst_value_lst_actual = B.getpoints4lot(shape_leaves,analysis_ref,value_ref,value_ref_actual)
            #Make bula point for each lot
            B.generate_bula_point(shape_leaves,lst_plain_pt_lst,lst_value_lst,lst_value_lst_actual)
            B.set_bula_height4viz(shape_leaves)
    def meta_tree(self,temp_node_,PD_):
        def inc_depth(n):
            if n.parent:
                n.depth = n.parent.depth + 1
            else:
                n.depth = 0
        meta_node = PD_['meta_node']
        #THIS SHOULD BE DONE IN TREE CLASS
        #print 'label metanode:', meta_node.parent
        #print 'label currnode: ', temp_node_
        meta_root = meta_node.get_root()
        temp_root = temp_node_.get_root()
        #Check to make sure we haven't already inserted as root
        chklabel = temp_root.grammar.type['label'] != meta_root.grammar.type['label']
        if chklabel:
            new_child_node = temp_node_.get_root()
            #Insert and link both ways
            meta_node.loc.append(new_child_node)
            #Give a unique id to meta_node to make sure we don't double ref 
            meta_node.grammar.type['label'] += str(random.randrange(1,1000))
            #Now reference it
            new_child_node.parent = meta_node
            #Reset depths
            root = meta_node.get_root()
            root.traverse_tree(lambda n:inc_depth(n),internal=True)
    def landuse(self,temp_node_,PD_):
        nodes2bucket = PD_['nodes2bucket']
        node_lst = []
        """
        #Make nodes/labels of inputs
        for node,label in zip(landuse_node,landuse_label):
            emptyrules = DataTree[object]()
            print node
            print label
            landuse_node = self.main_UI([node],emptyrules,label)
            node_lst.append(landuse_node)
        temp_node_.loc.extend(node_lst)
        """
        return temp_node_
    def building_analysis(self,node_in,height,GFA,groundFloor_ht,restFloor_ht):
        def get_label(n):
            label_ = []
            root = n[0].get_root()
            L = root.traverse_tree(lambda n:n,internal=True) 
            for nl in L:
                #print nl
                label_.append(nl)
            return label_
        def make_analysis(nodelen,pd):
            ## Input: dictionary of parameter key, list of data value 
            ## Output: Filtered list of str: with keys and value
            L = [""] * nodelen
            if pd.has_key('height'):
                for i,ht in enumerate(pd['height']):
                    valstr = 'height: %s' % (ht)
                    L[i] += valstr
            if pd.has_key('GFA'):
                for i,gfa in enumerate(pd['GFA']):
                    valstr = '\nGFA: %s' % (gfa)
                    L[i] += valstr
            return L
        def get_ht(node_):
            L = []
            for n_ in node_:
                storey = str(round(n_.shape.ht,1))
                L.append(storey)
            return L
        def get_GFA(node_,ght,rht):
            def helper_by_floor_div(n__,groundht):
                ratio = groundht/n__.shape.ht
                PD = {}
                PD['div_num'] = 1
                PD['div_deg'] = 0.
                PD['div_cut'] = 0.
                PD['div_ratio'] = ratio
                PD['div_type'] = 'simple_divide'
                PD['axis'] = "Z"
                divnode = n__.grammar.divide(n_,PD)
                
                if abs(divnode.loc[0].shape.ht - groundht) < 0.01:
                    groundfloor = divnode.loc[0]
                    restfloor = divnode.loc[1]
                else:
                    groundfloor = divnode.loc[1]
                    restfloor = divnode.loc[0]
                return groundfloor,restfloor
            def helper_by_floor_calc(n__,htdiv):
                n__.shape.geom = ghcomp.CapHolesEx(n__.shape.geom)[0]
                shapevol = rc.Geometry.VolumeMassProperties.Compute(n__.shape.geom).Volume
                shapegfa = shapevol/htdiv
                return shapegfa
            debug = sc.sticky['debug']
            ReadMe_ = ""
            L = []
            for n_ in node_:
                if abs(ght-rht)<0.1:
                    gfacalc = helper_by_floor_calc(n_,rht)
                else:
                    try:
                        grndshape,rstshape = helper_by_floor_div(n_,ght)
                        grndgfa = grndshape.shape.get_area()
                        rstgfa = helper_by_floor_calc(rstshape,rht)
                        gfacalc = grndgfa + rstgfa
                    except:
                        ReadMe_ = "Calculating by specific floor heights has failed, probably because the geometry was too complicated. GFA is now based on restfloorht."
                        gfacalc = helper_by_floor_calc(rstshape,3.)
                #debug.extend(map(lambda n:n.shape.geom,divnode.loc))
                L.append(str(round(abs(gfacalc),1)))
            return L,ReadMe_
        
        node = filter(lambda n: n!=None,node_in)
        if node and node != []:
            node = map(lambda n: copy.deepcopy(n),node)
            debug = sc.sticky['debug']
            ReadMe = ""
            
            #These always appear by default
            label_out = get_label(node)
            geom_out = map(lambda n:n.shape.geom,node)
            pt_out = map(lambda n:n.shape.cpt,node)
            #Analysis paramaters
            param_dict = {}
            if height==True:
                ht_out = get_ht(node)
                param_dict['height'] = ht_out
            if GFA == True:
                if not groundFloor_ht:
                    groundFloor_ht = 3.0
                if not restFloor_ht:
                    restFloor_ht = 3.0
                gfa_out,readmegfa = get_GFA(node,groundFloor_ht,restFloor_ht)
                param_dict['GFA'] = gfa_out
                ReadMe += readmegfa
            analysis_out = make_analysis(len(node),param_dict)
            if not ReadMe:
                ReadMe = "Successfully calculated"
    def shape2height(self,temp_node_,PD_):
        angle = 0.5
        ht_inc = 3.0
        side_inc = 0.1
        ht = temp_node_.shape.ht
        floor_div = int(math.floor(ht/ht_inc))
        input_node = temp_node_
        #print 'floordiv', floor_div
        for i,fdiv in enumerate(range(floor_div)):
            print 'fdiv', fdiv
            if fdiv > 10.0:
                inc_angle = angle * -1.0
            else:
                inc_angle = angle
            print 'angle', inc_angle
            input_node_with_child = self.squeeze_angle(input_node,inc_angle,ht_inc,side_inc)
            input_node = input_node_with_child.loc[0]
        loc = temp_node_.traverse_tree(lambda n:n,internal=True)
        loc.pop(0)
        temp_node_ = self.flatten_node_tree_single_child(loc,temp_node_)
        
        return temp_node_
    def squeeze_angle(self,temp_node_,angle,ht_inc,side_inc):
        #Purpose: Input node, angle degree
        #Output a shape2d with angle chagned according to degree
        
        ## Prep inputs
        debug = sc.sticky['debug']
        #Get base matrix
        base_matrix = temp_node_.shape.set_base_matrix()
        lines2rotate = [base_matrix[0],base_matrix[1]]
        line2intersect = []
        
        ## Roteate intersection lines outside 
        for i,linept_ in enumerate(lines2rotate):
            if i%2==0:
                heta = False
                basept_index = 0
            else:
                heta = True
                basept_index = 1 
            toin = False
            linept_ = temp_node_.shape.rotate_vector_from_axis(angle,linept_,movehead=heta,to_inside=toin)    
            
            ## Increment side length
            if not self.is_near_zero(side_inc,eps=1E-10): 
                newdirvec = linept_[1] - linept_[0]
                newdirvec.Unitize()
                sideincvec = newdirvec * side_inc
                orig_vec = linept_[1] - linept_[0]
                extended_vec = orig_vec + sideincvec
                linept_[1] = linept_[0] + extended_vec
            
            lines2rotate[i] = linept_
            newbasept = lines2rotate[i][basept_index]
            #Getting the perp pt for each rotated line
            perppt = temp_node_.shape.extrude_pt_perpendicular_to_pt(newbasept,linept_)
            if i%2==0:
                perp_linept_ = [perppt,newbasept]
            else:
                perp_linept_ = [newbasept,perppt]
            line2intersect.append(perp_linept_)
        
        ## Intersect the two lines
        #lines2rotate: first two lines that we rotated
        #line2intersect: lines we are going to intersect
        #Intersecting the lines
        IsIntersect,intpt = temp_node_.shape.get_pt_of_intersection(line2intersect)
        if IsIntersect:
            for i,linept in enumerate(line2intersect):
                if i%2==0:
                    line2intersect[i] = [intpt,linept[1]]
                else:
                    line2intersect[i] = [linept[0],intpt]
            # To perserve the ccw order
            line2intersect = [line2intersect[1],line2intersect[0]]
            # Now add everything together and draw the lines
            base_matrix = lines2rotate + line2intersect
            pts4crv = []
            for i,b in enumerate(base_matrix):
                pts4crv.append(b[0])
            pts4crv += [pts4crv[0]]
            shapecrv = rc.Geometry.Curve.CreateControlPointCurve(pts4crv,1)
            
            ## Increment height
            if not self.is_near_zero(ht_inc,eps=1E-10):
                htvec = rc.Geometry.Vector3d(0,0,ht_inc)
                shapecrv_guid = sc.doc.Objects.AddCurve(shapecrv)
                movevec = temp_node_.shape.move_geom(shapecrv_guid,htvec) 
                shapecrv = rs.coercecurve(movevec)
            
            ## Mutate the node
            temp_node_child = self.helper_geom2node(shapecrv,temp_node_,grammar="squeeze_angle")
            temp_node_.loc.append(temp_node_child)
        return temp_node_
    def node2grammar(self,lst_node_,rule_in_):
        def helper_type2node(copy_node_,type_):
            #type: list of (dictionary of typology parameters)
            copytype = copy.deepcopy(type_)
            copy_node_.grammar.type.update(copytype)
            return copy_node_
        def helper_clone_node(node_geom): 
            #Purpose: Create a node from geometry/parent node
            #if geometry, turned into node w/ blank label
            #if node, clone a child node w/ blank label
            if type(T) == type(node_geom):
                #print 'make cloned node'
                childn = self.helper_clone_node(node_geom,parent_node=node_geom)
                node_geom.loc.append(childn)
                n_ = childn
            else:
                #print 'make a geom'
                n_ = self.helper_geom2node(node_geom)
            return n_       
        ## Purpose: Input list of nodes, applies type
        ## Applies pattern based on types
        ## outputs node
        T = Tree()
        L = []
        for i,node_ in enumerate(lst_node_):
            ## Everytime we add a rule, we clone a node. 
            ## Every rule mutates the node, or creates child nodes.
            child_node_ = helper_clone_node(node_)
            ## Apply type to node
            child_node_ = helper_type2node(child_node_,rule_in_)
            ## Apply pattern
            if True:#try:
                node_out_ = self.main_grammar(child_node_)
                RhinoApp.Wait() 
            #print 'label', node_out_
            #print '---'
            #yield node_out_
            L.extend(node_out_)
            #except Exception as e:
            #    print "Error @ Pattern.main_pattern"
            #print node_out_[0]
        #print '--'

        return L
    def main_grammar(self,node):
        ## Check geometry
        if node.shape:
            gb = node.shape.geom
            if node.shape.is_guid(gb): node.shape.geom = rs.coercebrep(gb)
        
        PD = node.grammar.type
        temp_node = node
        
        if PD['label_UI'] == True:
            #simple therefore keep in UI for now...
            temp_node.grammar.type['label'] = PD['label']
            temp_node.grammar.type['grammar'] = 'label'
        elif PD['divide'] == True:
            temp_node = self.divide(temp_node,PD)
            temp_node.grammar.type['grammar'] = 'divide'
        elif PD['height'] != False:
            temp_node = self.set_height(temp_node,PD)
            temp_node.grammar.type['grammar'] = 'height'
        elif PD['stepback']:
            ## Ref: TT['stepback'] = [(ht3,sb3),(ht2,sb2),(ht1,sb1)]
            temp_node = self.stepback(temp_node,PD)
            temp_node.grammar.type['grammar'] = 'stepback'
        elif PD['court'] == True:
            self.court(temp_node,PD)
            temp_node.grammar.type['grammar'] = 'court'
        elif PD['bula'] == True:
            self.set_bula_point(temp_node,PD)
            temp_node.grammar.type['grammar'] = 'bula'
        elif PD['meta_tree'] == True:
            self.meta_tree(temp_node,PD)
            temp_node.grammar.type['grammar'] = 'meta_tree'
        elif PD['landuse'] == True:
            temp_node = self.landuse(temp_node,PD)
            temp_node.grammar.type['grammar'] = 'landuse'
        elif PD['separate'] == True:
            temp_node = self.separate_by_dist(temp_node,PD)
            temp_node.grammar.type['grammar'] = 'separate'
        elif PD['shape2height'] == True:
            temp_node = self.shape2height(temp_node,PD)
            temp_node.grammar.type['grammar'] = 'shape2height'
        elif PD['extract_slice'] == True:
            temp_node = self.extract_slice(temp_node,PD)
            temp_node.grammar.type['grammar'] = 'extract_slice'
        """
        These have to be rewritten
        if solartype == 2: # multi_cell
            try:
                temp_node = self.solar_envelope_multi(temp_node,solartime,node.grammar,solarht)
            except Exception as e:
                print e
        if PD['concentric_divide']:
            dist_lst = PD['dist_lst']
            del_dist_lst = PD['delete_dist']
            temp_node = self.concentric_divide(temp_node,dist_lst,del_dist_lst,ROOTREF) 
        ## 1. param 1 or param 3
        solartype = PD['solartype']
        solartime = PD['solartime']
        solarht = PD['solarht']
        if solartype == 1 or solartype == 3: # uni-cell
            try:
                geo_brep = self.solar_envelope_uni(node,solartime,solarht,solartype)
            except Exception as e:
                    print "Error @ solartype 1 or 3", str(e)
        """
        ## Finish
        lst_childs = temp_node.traverse_tree(lambda n:n,internal=False)
        lst_childs = filter(lambda n:n.grammar.type['freeze']==False,lst_childs)
        return lst_childs
    def main_UI(self,node_in_,rule_in_,label__):
        def helper_nest_rules(label_lst_,rule_tree_):
            #Purpose: Extract rules from tree insert nest list of rule dictionaries
            B = Bula()
            
            #Convert tree to flat list
            #Also we will add label rules to top
            
            flat_lst = label_lst_
            flat_lst_ = B.ghtree2nestlist(rule_tree_,nest=False)
            flat_lst += flat_lst_ 
            
            #Convert flat list to nested list of typology rules
            nest_rdict = []
            rdict = copy.deepcopy(Miru)
            for parselst in flat_lst:
                if parselst[0] != 'end_rule':
                    miru_key,miru_val = parselst[0],parselst[1]
                    rdict[miru_key] = miru_val  
                else:
                    nest_rdict.append(rdict)
                    rdict = copy.deepcopy(Miru)
            #Test
            #for i in nest_rdict:
            #    print 'bula', i['bula']
            #    print 'bula', i['bula_value_lst'][0]
            #    print '---'
            
            return nest_rdict
        def helper_label2rule(labelin): 
            rule_ = []
            if labelin:
                rule_ = [\
                ['label_UI', True],\
                ['label', labelin],\
                ['end_rule']]
            return rule_
        def helper_main_recurse(lst_node_,rule_lst):
            #if no rules/label_rules node is just passed through
            if rule_lst == []:
                for i,ng in enumerate(lst_node_):
                    if type(T) != type(ng):
                        ng = self.helper_geom2node(ng)
                        lst_node_[i] = ng
                return lst_node_
            else:
                rule_ = rule_lst.pop(0)
                #apply rule to current list of nodes, get child lists flat
                lst_node_leaves = self.node2grammar(lst_node_,rule_)
                return helper_main_recurse(lst_node_leaves,rule_lst)
        
        T = Tree()
        lst_node_out = []
        #Check inputs
        chk_input_len = False
        #if node and label are ==
        if abs(len(label__)-len(node_in_)) < 0.5:
            chk_input_len = True
        #if llabel = 1
        elif abs(len(label__)-1.) < 0.5:
            chk_input_len = True
        elif len(label__) <= 0.5:
            chk_input_len = True
        
        #Check if rule has already propogated
        for n in node_in_:
            if type(n) == type(T) and len(n.loc) > 0.5:
                n.traverse_tree(lambda n:n.delete_node(),internal=True)
                if n.grammar.type['top'] == None:
                    n.grammar.type['top'] = True
            
        if chk_input_len:
            if abs(len(label__)-1.) < 0.5 or abs(len(label__)-0.) < 0.5:
                #label is treated as a rule
                if len(label__) > 0.5:
                    label_rule_ = helper_label2rule(label__[0])
                else:
                    label_rule_ = []
                #nest rules
                nested_rule_dict = helper_nest_rules(label_rule_,rule_in_)    
                #make label a rule
                #recursively create a child node derived from parent and apply a grammar rule           
                lst_node_out_ = helper_main_recurse(node_in_,nested_rule_dict)
                lst_node_out.extend(lst_node_out_)
            else:
                #print 'multiple labels'                
                #Map label num to label num if multiple labels
                for lab,node_ in zip(label__,node_in_):
                    #label is treated as a rule
                    label_rule_ = helper_label2rule(lab)
                    #nest rules
                    nested_rule_dict = helper_nest_rules(label_rule_,rule_in_)
                    #make label a rule
                    #recursively create a child node derived from parent and apply a grammar rule           
                    lst_node_out_ = helper_main_recurse([node_],nested_rule_dict)
                    lst_node_out.extend(lst_node_out_)
        else:
            print 'Check the length of your inputs'
        
        return lst_node_out 
                    
if True:
    sc.sticky["Grammar"] = Grammar
# ---------- end bibil_2 ----------
bibil_3 = PythonScript()  # -> o
# ---------- bibil_3: Python ----------
"""
Created on Jun 6, 2016
@author: Saeran Vasanthakumar
"""

import rhinoscriptsyntax as rs
import Rhino as rc
import math
import ghpythonlib.components as ghcomp
import copy
import scriptcontext as sc

TOL = sc.doc.ModelAbsoluteTolerance



class Shape:
    """
    Parent shape operations and information
    """
    TOL = sc.doc.ModelAbsoluteTolerance
    
    def __init__(self,geom=None,cplane=None):
        self.geom = geom
        self.cplane = cplane
        self.north = rs.VectorCreate([0,1,0],[0,0,0])
        self.area = None
        self.dimension = '3d'
        self.bottom_crv = None
        self.primary_axis_vector = None
        self.base_matrix = None
        self.normal = rc.Geometry.Vector3d(0,0,1)
        if geom == None:
            self.geom = rs.coercebrep(rs.AddBox([[0,0,0],[0,10,0],[-10,10,0],[-10,0,0],\
                                        [0,0,10],[0,10,10],[-10,10,10],[-10,0,10]]))
        else:
            try:
                self.reset(xy_change=True)
            except Exception as e:
                print str(e), "Error at Shape.reset()"
    def reset(self,xy_change=True):
        def get_dim_bbox(b):
            ## counterclockwise, start @ bottom SW  
            #      n_wt
            #      -----
            #      |   |
            # w_ht |   | e_ht = y_dist
            #      |   |
            #      -----
            #     s_wt = x_dist
            """    self.s_wt,self.e_ht,self.n_wt,self.w_ht """
            return b[:2],b[1:3],b[2:4],[b[3],b[0]]
                
        # primary edges
        if xy_change == True:
            try:
                self.bottom_crv = self.get_bottom(self.geom,self.get_boundingbox(self.geom,None)[0])
            except Exception as e:
                #print str(e)##sys.exc_traceback.tb_lineno 
                self.bottom_crv = None
            try:
                if self.cplane == None:
                    self.cplane = self.get_cplane_advanced(self.geom)
                self.primary_axis_vector = self.cplane.YAxis
                
            except Exception as e:
                print str(e)##sys.exc_traceback.tb_lineno 
                self.cplane, self.primary_axis_vector = None, None
            try:
                self.bbpts = self.get_boundingbox(self.geom,self.cplane)
                self.s_wt,self.e_ht,self.n_wt,self.w_ht = get_dim_bbox(self.bbpts)
                self.ew_vector = self.n_wt[1]-self.n_wt[0]
                self.ns_vector = self.e_ht[1]-self.e_ht[0]
                """
                print 'check ew'
                print self.primary_axis_vector.IsParallelTo(self.ew_vector)
                print self.primary_axis_vector.IsPerpendicularTo(self.ew_vector)
                print ''
                """
                # x,y,z distances
                self.x_dist = float(rs.Distance(self.s_wt[0],self.s_wt[1]))
                self.y_dist = float(rs.Distance(self.e_ht[0],self.e_ht[1]))
                self.area = None
            except Exception as e:
                #print str(e)
                self.bbpts,self.s_wt,self.e_ht,self.n_wt,self.w_ht = None, None, None, None, None 
            try:
                bp = self.bbpts
                self.cpt = rc.Geometry.AreaMassProperties.Compute(self.bottom_crv).Centroid
            except Exception as e:
                #print str(e)#sys.exc_traceback.tb_lineno 
                self.cpt = None
        try:# curve profile info
            if xy_change == False:
                self.bbpts = self.get_boundingbox(self.geom,self.cplane)
            self.ht = float(self.bbpts[4][2])
            self.z_dist = float(float(self.bbpts[4][2]) - self.cpt[2])
        except Exception as e:
            #print str(e)#sys.exc_traceback.tb_lineno 
            self.ht, self.z_dist = None, None
    def calculate_ratio_from_dist(self,axis,dist,dir_=0.):
        # Direction of cut   
        # Long axis: YAxis
        # 1.0 ^
        #     |   
        # 0.5 ^ w_ht = y_dist  
        #     |   
        # 0.0 ->->->->->->->
        #     0.0  0.5   1.0
        #  s_wt = x_dist
        
        ## dir: 0 = cut dist from bottom 
        ## dir: 1 = cut dist from top
        ## test1: 25m/100m
        ## if dir == 0: ratio = 0.25
        ## if dir == 1: ratio = 0.75
        ## test2: 75m/100m
        ## if dir == 0: ratio = 0.75
        ## if dir == 1: ratio = 0.25
        if "NS" in axis:
            total_dist = self.x_dist
        else:# if "EW" in axis
            total_dist = self.y_dist
        # Cut from bottom
        ratio = dist/float(total_dist)
        # Cut from top
        if dir_ > 0.5: 
            ratio = 1. - ratio
        return ratio
    def vector2axis(self,ref_vector):
        ## Compare ref_vector with shape axis, and return
        ## closest shape axis
        ew_axis = self.n_wt[1]-self.n_wt[0]
        ns_axis = self.e_ht[1]-self.e_ht[0]
        ## unitize
        ref_vector.Unitize()
        ew_axis.Unitize()
        ns_axis.Unitize()
        ew_dotprod = rc.Geometry.Vector3d.Multiply(ew_axis,ref_vector)
        ns_dotprod = rc.Geometry.Vector3d.Multiply(ns_axis,ref_vector)
        ## Greater the dot product, closer it is to 90
        cutaxis = "NS" if abs(ew_dotprod) < abs(ns_dotprod) else "EW"
        return cutaxis
    def op_split(self,axis,ratio,deg=0.,split_depth=0,split_line_ref=None):
        """
        op_split: self, ratio -> (list of geom)
        Splits original geom into two
        """
        debug = sc.sticky['debug']
        def helper_make_split_surf_z(ratio_):
            try:
                zht = ratio_ * self.z_dist
                splitptlst = self.bbpts[:4]+[self.bbpts[0]]
                splitptlst = map(lambda b:rc.Geometry.Point3d(b[0],b[1],b[2]+zht),splitptlst)
                splitcurve = rc.Geometry.Curve.CreateControlPointCurve(splitptlst,1)
                split_surf_ = rc.Geometry.Brep.CreatePlanarBreps(splitcurve)[0]
                return split_surf_
            except Exception as e:
                print "Error @ shape.helper_make_split_srf_z"
                print str(e)#sys.exc_traceback.tb_lineno 
        def helper_make_split_line_xy(ratio_,degree,ref_shape=None):
            debug = sc.sticky['debug']
            try:
                if ref_shape:
                    s_wt,n_wt = ref_shape.s_wt,ref_shape.n_wt
                    e_ht,w_ht = ref_shape.e_ht,ref_shape.w_ht
                    x_dist,y_dist = ref_shape.x_dist,ref_shape.y_dist
                else:
                    s_wt,n_wt = self.s_wt,self.n_wt
                    e_ht,w_ht = self.e_ht,self.w_ht
                    x_dist,y_dist = self.x_dist,self.y_dist
                    
                if axis == "NS":
                    edge_0, edge_1 = s_wt, n_wt
                    dist = ratio_* x_dist
                else:#if axis == "EW"
                    edge_0, edge_1 = e_ht, w_ht
                    dist = ratio_* y_dist
                    
                ### helper geom that splits box
                line_0 = rs.AddLine(edge_0[0],edge_0[1])
                line_1 = rs.AddLine(edge_1[1],edge_1[0])
                # ^flip because counterclockwise
                mid_0 = rs.DivideCurveLength(line_0,dist,True,True)[1]
                mid_1 = rs.DivideCurveLength(line_1,dist,True,True)[1]            
                split_line = rs.AddCurve([mid_0,mid_1],1)
                if float(degree) > 0.5:
                    cpt = rs.DivideCurve(split_line,2,True,True)[1] 
                    split_line = rs.RotateObject(split_line,cpt,degree)
                sc_ = 1.5,1.5,1.5
                line_cpt = rs.DivideCurve(split_line,2)[1]
                split_line_sc = rs.ScaleObject(split_line,line_cpt,sc_)
                #split_line_sc = rs.coercecurve(split_line_sc)
                return split_line_sc
            except Exception as e:
                pass#print "Error @ shape.helper_make_split_srf_xy"
                #print str(e)#sys.exc_traceback.tb_lineno 
        def helper_make_split_surf(split_line__):
            if self.ht < 1: 
                ht = 1.
            else: 
                ht = self.ht
            split_path = rs.AddCurve([[0,0,0],[0,0,ht*2]],1)    
            if not self.is_guid(split_line__):
                split_line__ = sc.doc.Objects.AddCurve(split_line__)
            split_surf = rs.coercebrep(rs.ExtrudeCurve(split_line__,split_path))
            return split_surf
        def helper_get_split_line_surf(ratio_,axis_,deg_,split_line_ref_):
            split_line_, split_surf_ = None,None
            if split_line_ref_ != None:
                ## Check if Closed curve
                if type(self) == type(split_line_ref_):
                    split_line_ = helper_make_split_line_xy(ratio_,deg_,ref_shape=split_line_ref_)
                else:
                    split_line_ = split_line_ref_
                    if not self.is_guid(split_line_):
                        split_line_ = sc.doc.Objects.AddCurve(split_line_)
                    sc_ = 3,3,3
                    line_cpt = rs.DivideCurve(split_line_,2)[1]
                    split_line_ = rs.ScaleObject(split_line_,line_cpt,sc_)
                #debug.append(split_line_)
                split_surf_ = helper_make_split_surf(split_line_)
            elif axis_ == "Z":
                split_surf_ = helper_make_split_surf_z(ratio_)
            else:
                split_line_ = helper_make_split_line_xy(ratio_,deg_)
                split_line_ = rs.coercecurve(split_line_)
                split_surf_ = helper_make_split_surf(split_line_)
                
            return split_line_, split_surf_
        
        rs.EnableRedraw(False)
        split_line,split_surf = helper_get_split_line_surf(ratio,axis,deg,split_line_ref)
        #debug.append(split_surf)
        try:#if True:
            ## For split_depth == 0.
            if split_depth <= 0.1:
                geom = rs.coercebrep(self.geom) if self.is_guid(self.geom) else self.geom 
                lst_child = geom.Split(split_surf,TOL)
            ## For split_depth > 0.
            else:
                if self.z_dist < 0.09:
                    print 'not a 3d geom, therefore will not split'
                # vec transformation
                if self.is_guid(split_line):
                    split_line = rs.coercecurve(split_line)
                nc = split_line.ToNurbsCurve()
                end_pts = [nc.Points[i_].Location for i_ in xrange(nc.Points.Count)]
                dir_vector = end_pts[1] - end_pts[0]
                z_vector = rs.VectorCreate([0,0,0],[0,0,1])
                # create forward and backwards vector using crossproduct
                normal_f = rs.VectorCrossProduct(dir_vector,z_vector)
                normal_b = rs.VectorCrossProduct(z_vector,dir_vector) 
                
                sc_ = split_depth,split_depth,split_depth
                
                normal_f.Unitize()
                normal_b.Unitize()
                normal_b = map(lambda v: v*split_depth/2.,normal_b)
                
                c = rs.AddCurve([rs.AddPoint(0,0,0),rs.AddPoint(normal_f[0],normal_f[1],normal_f[2])],0)
                c = rs.ScaleObject(c,rs.AddPoint(0,0,0),sc_)
                rc_cut = rs.ExtrudeSurface(split_surf,c)
                rc_cut = rs.MoveObject(rc_cut,normal_b)
                #debug.append(rc_cut)
                #debug.append(split_surf)
                lst_child = []
                rc_geom,rc_cut = rs.coercebrep(self.geom),rs.coercebrep(rc_cut)
                #ghcomp.Flip(rc_cut,sc.sticky['surface_ref'])[0]
                geom_childs = rc.Geometry.Brep.CreateBooleanDifference(rc_geom,rc_cut,TOL)
                lst_child.extend(geom_childs)
                #debug.extend(geom_childs)
        except Exception as e:
            print "Error @ shape.op_split while splitting"
            print str(e)#, sys.traceback.tb_lineno 
            
        ## Clean up or rearrange or cap the split child geometries
        try:
            if float(len(lst_child)) < 1. or lst_child == [None] or lst_child == []:
                lst_child = []
            else:
                if not self.is_guid(lst_child[0]): 
                    lst_child_ = map(lambda child: sc.doc.Objects.AddBrep(child), lst_child)
                map(lambda child: rs.CapPlanarHoles(child),lst_child_)
                lst_child = map(lambda child: rs.coercebrep(child),lst_child_)
                if axis == "Z":
                    z_0 = rc.Geometry.AreaMassProperties.Compute(lst_child[0]).Centroid[2]
                    z_1 = rc.Geometry.AreaMassProperties.Compute(lst_child[1]).Centroid[2]    
                    if z_0 > z_1: 
                        tempchild = lst_child.pop(0)
                        lst_child.append(tempchild)
        except Exception as e:
            print "Error @ shape.op_split while formatting children"
            print str(e)#, sys.traceback.tb_lineno 
        
        rs.EnableRedraw(False)
        return lst_child
    def get_boundingbox(self,geom_,cplane_):
        def check_bbpts(b):
            ## check if 3d shape and if first 4 pts at bottom
            if b[0][2] > b[4][2]:
                b_ = b[4:] + b[:4]
                b = b_
            return b
        try:
            bbpts_ = rs.BoundingBox(geom_,cplane_)
            return check_bbpts(bbpts_)
        except Exception as e:
            print "Error @ get_boundingbox"
            #print str(e)#sys.exc_traceback.tb_lineno 
    def check_shape_dim(self,axis_,dim_,shape=None,min_or_max=False,tol=0.1):
        ### Checks that the shape dimension is equal to
        if shape==None:
            shape = self
        if "EW" in axis_:    
            shapedim = shape.x_dist
        else:
            shapedim = shape.y_dist
        if min_or_max != False:
            ## Check if more than min
            if 'min' in min_or_max: 
                IsWidth = (shapedim+tol) >= dim_
            ## Check if less than max
            else:
                IsWidth = shapedim <= (dim_+tol) 
        else:
            IsWidth = abs(shapedim-dim_) <= tol
            #print shapedim, dim_
        return IsWidth
    def is_guid(self,geom):
        return type(rs.AddPoint(0,0,0)) == type(geom)     
    def convert_rc(self,dim=None):
        # phase this function out
        try:
            if dim==None: dim = self.dimension
            if dim == "2d":
                if self.is_guid(self.crv):
                    self.crv = rs.coercecurve(self.crv)
                if self.is_guid(self.ext):
                    self.ext = rs.coercebrep(self.ext)
            else:
                if self.is_guid(self.bottom_crv):
                    self.bottom_crv = rs.coercecurve(self.bottom_crv)
            if self.is_guid(self.geom):
                self.geom = rs.coercegeometry(self.geom)
        except Exception as e:
            print "Error @ shape.convert_rc"
            print str(e)#sys.exc_traceback.tb_lineno 
    def convert_guid(self,dim='2d'):
        # phase this out
        try:
            if dim == "2d":
                if not self.is_guid(self.crv):
                    self.crv = sc.doc.Objects.AddCurve(self.crv)
                if not self.is_guid(self.ext):
                    self.ext = sc.doc.Objects.AddBrep(self.ext)
            else:
                if self.bottom_crv and not self.is_guid(self.bottom_crv):
                    self.bottom_crv = sc.doc.Objects.AddCurve(self.bottom_crv)
            if not self.is_guid(self.geom):
                self.geom = sc.doc.Objects.AddBrep(self.geom)
        except Exception as e:
            print "Error @ shape.convert_guid"
            print str(e)#sys.exc_traceback.tb_lineno 
    def get_bottom(self,g,refpt,tol=0.1):
        ## Extract curves from brep according to input cpt lvl
        try:
            if g == None: g = self.geom
            if self.is_guid(refpt): refpt = rs.coerce3dpoint(refpt)
            if self.is_guid(g): g = rs.coercebrep(g)
            plane = rc.Geometry.Plane(refpt,rc.Geometry.Vector3d(0,0,1))
            crvs = g.CreateContourCurves(g,plane)
            return crvs[0]
        except Exception as e:
            print "Error @ shape.get_bottom"
            print str(e)#sys.exc_traceback.tb_lineno 
    def move_geom(self,obj,dir_vector,copy=False):
        #Moves a geometry
        #Note, you will likely have to convert to guid and convert back to rc geom
        xf = rc.Geometry.Transform.Translation(dir_vector)
        xform = rs.coercexform(xf, True)
        id = rs.coerceguid(obj, False)
        id = sc.doc.Objects.Transform(id, xform, not copy)
        return id
    def is_near_zero(self,num,eps=1E-10):
        return abs(float(num)) < eps
    def check_region(self,crvA,crvB=None,tol=0.1):
            """
            If disjoint, output 0 else returns 1.
            Disjoint    0    There is no common area between the two regions.
            Intersect   1    The two curves intersect. There is therefore no full containment relationship either way.
            AInsideB    2    Region bounded by curveA (first curve) is inside of curveB (second curve).
            BInsideA    3    Region bounded by curveB (second curve) is inside of curveA (first curve).
            """
            disjoint = rc.Geometry.RegionContainment.Disjoint
            intersect = rc.Geometry.RegionContainment.MutualIntersection
            #add the rest
            if crvB == None:
                crvB = self.bottom_crv
            if self.is_guid(crvB):
                crvB = rs.coercecurve(crvB)
            if self.is_guid(crvA):
                crvA = rs.coercecurve(crvA) 
            refplane = self.cplane
            setrel = rc.Geometry.Curve.PlanarClosedCurveRelationship (crvA,crvB,refplane,tol)
            if disjoint == setrel:
                return 0
            elif intersect == setrel:
                return 2
            else:
                return 1
    def get_normal_point_inwards(self,refline_,to_outside=False):
        ## Input a reference line and self.shape.polygon
        ## Returns the normal vector pointing
        ## into the polygon
        z_vector = rs.VectorCreate([0,0,0],[0,0,1]) 
        ## Make sure the line is CCW, else reverse order
        IsCCW = self.check_vertex_order(refline=refline_)
        #Check to see if reffline is not a list of two points already
        if type(refline_) != type([]):
            end_pts = self.get_endpt4line(refline_)
        else:
            end_pts = refline_
        if not IsCCW:
            end_pts = [end_pts[1],end_pts[0]]
        #To check the CCW dir
        #debug.append(n_.data.shape.get_endpt4line(park_line_)[0])
        
        # Get direction vector and take cross-product
        dir_vector = end_pts[1] - end_pts[0]
        # Create to_inner vector using crossproduct
        # CCW dir_vector X z_vector = to_inner vector 
        to_inner = rs.VectorCrossProduct(dir_vector,z_vector) 
        if to_outside == True:
            to_inner.Reverse()
        return to_inner
    def extrude_pt_perpendicular_to_pt(self,basept_,reflineptlst,to_inside=False):
        #Input: basept, list of line pts, boolean for out or in
        #Output: pt that is 90 degrees from that pt
        normvector = self.get_normal_point_inwards(reflineptlst)
        perppt = basept_ + normvector
        return perppt
    def check_vertex_order(self,refline=None):
        ### Check if the shape is counter-clockwise
        ### This is achieved by walking the polygon, 
        ### and then summing the crossproduct
        ### of each adjacent vectors. If the resulting crossproduct sum
        ### is positive, then according to the RHR it is CCW else it 
        ### is negative. If refline provided, we make a triangle
        ### with refline and cpt  
        ### Ref: http://stackoverflow.com/posts/1167206/revisions
        if refline!=None:
            endpts_lst = []
            if type(refline) != type([]):
                linepts = self.get_endpt4line(refline)
            else:
                linepts = refline
            # Make triangle
            endpts_lst.append([self.cpt,linepts[0]])
            endpts_lst.append(linepts)
            endpts_lst.append([linepts[1],self.cpt])    
        else:
            #need to test this!
            print 'First time testing the vertex order for polygon'
            print 'double check this at def check_vertex_order'
            endpts_lst = self.set_base_matrix()
        
        ## Loop through and take the crossproduct of edge
        i = 0
        sum_of_cross_product = 0.
        while i < (len(endpts_lst)-1):
            curr_edgepts = endpts_lst[i]
            next_edgepts = endpts_lst[i+1]
            
            curr_edgevector = curr_edgepts[1]-curr_edgepts[0]   
            next_edgevector = next_edgepts[1]-curr_edgepts[0]
            cp = rs.VectorCrossProduct(curr_edgevector,next_edgevector) 
            sum_of_cross_product += cp[2]
            i+=1
        
        #if positive, then according to RHR, vertices are CCW
        if sum_of_cross_product > 0.:
            return True
        else:
            return False
    def rotate_vector_from_axis(self,angle_,lineveclst,movehead=True,to_inside=False):
        def helper_rotate_vector(vector,deg,axis=[0,0,1]):
            axis = rs.coerce3dvector(axis)
            angle_radians = rc.RhinoMath.ToRadians(deg)
            rotvec = rc.Geometry.Vector3d(vector.X, vector.Y, vector.Z)
            rotvec.Rotate(angle_radians, axis)
            return rotvec
        #Rotates the lst of vectors (of line) around axis pt
        #if we are moving the tail, you ahve to flip the vector so rotate vector works
        if movehead==True:
            dir_vec = lineveclst[1]-lineveclst[0]
            refvec4axis = lineveclst[0]
        else:
            dir_vec = lineveclst[0]-lineveclst[1]
            refvec4axis = lineveclst[1]
        #Vectors in rhino want to move inwards (counterwclockwise)
        #However if you are moving the tail then dsire to flip out so reverse vector
        if movehead==False:
            angle_ = angle_ * -1.0
        if to_inside == False:
            angle_ = angle_ * -1.0
        #print rotatehead
        rot_vector = helper_rotate_vector(dir_vec,angle_,axis=[0,0,1])
        rot_vector.Unitize()
        magnitude = dir_vec.Length
        rot_vector = rot_vector * magnitude
        rotated_linept = rot_vector + refvec4axis
        
        if movehead==True:
            linept_ = [refvec4axis,rotated_linept]
        else:
            linept_ = [rotated_linept,refvec4axis]
        return linept_
    def get_pt_of_intersection(self,line2intersect):
        #Takes to list of pts for lines
        #Returns the pt of intersection and bool of is intersection exist
        linelst4int = map(lambda lpt: rc.Geometry.Curve.CreateControlPointCurve(lpt,0),line2intersect)
        linelst4int = map(lambda crv: rs.coerceline(crv),linelst4int)    
        lineA,lineB = linelst4int[0], linelst4int[1]
        IsIntersect,a,b = rc.Geometry.Intersect.Intersection.LineLine(lineA,lineB)
        if IsIntersect:
            a = lineA.PointAt(a)
        return IsIntersect,a
    def get_endpt4line(self,line_):
        if self.is_guid(line_):
            line_ = rs.coercecurve(line_)
        nc = line_.ToNurbsCurve()
        end_pts = [nc.Points[i_].Location for i_ in xrange(nc.Points.Count)]
        return end_pts
    def set_base_matrix(self,crv=None):
        ## Breaks up geometry into:
        ##[ [[vector1a,vector1b],  // line 1
        ##   [vector2a,vector2b],  // line 2
        ##          ....
        ##   [vectorna, vectornb]] // line n
        ## topological ordering preserved
        ## direction counterclockwise
        ## but can start from anywhere!
        #debug = sc.sticky['debug']
        
        if self.base_matrix == None:
            if crv == None:
                crv = self.bottom_crv
            if not self.is_guid(crv):
                crv = rs.coercecurve(crv)
            segments = crv.DuplicateSegments()
            matrix = []
            for i in xrange(len(segments)):
                segment = segments[i]
                nc = segment.ToNurbsCurve()
                end_pts = [nc.Points[i_].Location for i_ in xrange(nc.Points.Count)]
                matrix.append(end_pts)
            self.base_matrix = matrix
        return self.base_matrix
    def get_midpoint(self,line):
        #Midpoint formula: x1+x2/2, y1+y2/2
        pt1,pt2 = line[0], line[1]
        midpt = (line[0]+line[1])/2. #vector addition and division
        return midpt
    def get_shape_axis(self,crv=None):
        def helper_group_parallel(AL):
            ## Identifies parallel lines and groups them
            lop = []
            CULLDICT = {}
            for i,v in enumerate(AL):
                refdist = rs.Distance(v[0],v[1])
                refdir = v[1] - v[0]
                power_lst = []
                if i < len(AL)-1 and not CULLDICT.has_key(refdist):
                    power_lst.append(refdist)
                    AL_ = AL[i+1:]
                    for v_ in AL_:
                        currdist = rs.Distance(v_[0],v_[1])
                        currdir = v_[1] - v_[0]
                        if currdir.IsParallelTo(refdir) != 0 and not CULLDICT.has_key(currdist):
                            power_lst.append(currdist)
                            CULLDICT[currdist] = True
                if power_lst != []:
                    power_lst.sort(reverse=True)
                    power_num = reduce(lambda x,y: x+y,power_lst)
                else:
                    power_num = 0.
                lop.append(power_num)
            return lop
        
        ### Purpose: Input 2d planar curve
        ### and return list of vector axis based
        ### on prominence
        debug = sc.sticky['debug']
        try:
            if crv==None:
                crv = self.bottom_crv
            axis_matrix = self.set_base_matrix(crv)
            if axis_matrix != []:
                axis_power_lst = helper_group_parallel(axis_matrix)
                pa_index = axis_power_lst.index(max(axis_power_lst))
                pa_vector = axis_matrix[pa_index][1]-axis_matrix[pa_index][0]
            else:
                #degenerate crv
                pa_vector = None
            self.primary_axis_vector = pa_vector
            return self.primary_axis_vector
        except Exception as e:
            print "Error @ shape.get_shape_axis"
            print str(e)#sys.exc_traceback.tb_lineno 
    def get_cplane_advanced(self,g):
        def helper_define_axis_pts(primary_vec):
            ##(origin,x,y)
            o_pt_ = rc.Geometry.Point3d(0,0,0)
            y_pt_ = primary_vec
            z_pt_ = rc.Geometry.Vector3d(0,0,1)
            ## construct x_pt_ using the communitive property of crossproduct
            x_pt_ = rc.Geometry.Vector3d.CrossProduct(y_pt_,z_pt_)
            return o_pt_,x_pt_,y_pt_
        try:
            if self.is_guid(g):
                brep = rs.coercebrep(g)
            else: brep = g
            debug = sc.sticky['debug']
            ## Get primary axis
            nc = self.bottom_crv.ToNurbsCurve()
            planar_pts = [nc.Points[i].Location for i in xrange(nc.Points.Count)]
            primary_axis_vector = self.get_shape_axis(self.bottom_crv)
            if primary_axis_vector:
                o_pt,x_pt,y_pt = helper_define_axis_pts(primary_axis_vector)
            else:
                #degenerate shape
                o_pt = rc.Geometry.Point3d(0,0,0)
                x_pt = rc.Geometry.Point3d(1,0,0)
                y_pt = rc.Geometry.Point3d(0,1,0)
            cplane = rc.Geometry.Plane(o_pt,x_pt,y_pt)
            return cplane
        except Exception as e:
            print "Error @ shape.get_cplane_advanced"
            print str(e)#sys.exc_traceback.tb_lineno 
    def check_colinear_pt(self,crv,testpt,tol=0.01):
        ## May need to swap with own method
        dist = ghcomp.CurveClosestPoint(testpt,crv)[2]
        IsColinear = True if abs(dist-0.)<tol else False
        return IsColinear
    def get_area(self):
        try:
            area_crv = self.bottom_crv if self.dimension == '3d' else self.crv
            if self.is_guid(area_crv):area_crv = rs.coercecurve(area_crv)
            try:
                area = rc.Geometry.AreaMassProperties.Compute(area_crv).Area
            except Exception as e:
                print e
                area = self.x_dist * self.y_dist
            self.area = area
            return area
        except Exception as e:
            print "Error @ shape.get_area"
            print str(e)#sys.exc_traceback.tb_lineno 
    def get_long_short_axis(self):
        if (self.x_dist > self.y_dist): 
            long_dist,short_dist = self.x_dist,self.y_dist
            long_axis,short_axis = 'EW','NS'
        else:
            long_dist,short_dist = self.y_dist,self.x_dist
            long_axis,short_axis = 'NS','EW'
        return long_axis,long_dist,short_axis,short_dist
    def op_extrude(self,z_dist,curve=None):
        debug = sc.sticky['debug']
        try:
            returnflag = True 
            if curve == None:
                curve = rs.coercecurve(self.bottom_crv) if self.is_guid(self.bottom_crv) else self.bottom_crv
                returnflag = True
            ext = rc.Geometry.Extrusion.Create(curve,z_dist,True)
            ## check if extruded correct dir
            refcpt = rc.Geometry.AreaMassProperties.Compute(ext).Centroid
            v = rc.Geometry.Vector3d(0,0,1)
            if z_dist > 0.:
                if refcpt[2] < self.cpt[2]:
                    #print 'move up'
                    ext.Translate(0.,0.,z_dist)
            else: 
                if refcpt[2] > self.cpt[2]:
                    #print 'move down'
                    ext.Translate(0.,0.,z_dist*-1)
            brep = ext.ToBrep()
            #if returnflag == False:
            #    return brep
            if True:#else:
                self.geom = brep
                self.reset(xy_change=False)
        except Exception as e:
            print "Error @ Shape.op_extrude"
            print str(e)#sys.exc_traceback.tb_lineno 
    def op_offset_crv(self,dim,curve=None,count=0,refcpt=None,corner=1):
        #print 'count: ', count, 'dim: ', dim
        if count > 5. or abs(dim-0.)<=0.1:
            return None
        else: 
            try:    
                if not curve:
                    curve = copy.copy(self.bottom_crv)
                if not self.is_guid(curve):
                    curve = sc.doc.Objects.AddCurve(curve)            
                if not refcpt: 
                    refcpt = rs.CurveAreaCentroid(curve)[0]
                offcurve = rs.OffsetCurve(rs.CopyObject(curve),refcpt,dim,None,corner)
                #print 'offcurve', offcurve
                if not offcurve or len(offcurve) > 1: 
                    dim -= 1.
                    count += 1
                    return self.op_offset_crv(dim,curve,count,refcpt,corner)
                else:
                    return offcurve[0] 
            except Exception as e:
                print "Error @ Shape.op_offset_crv"
                print str(e)#sys.exc_traceback.tb_lineno 
    def op_offset(self,dim,curve,dir="courtyard",useoffcrv=False):
        try:
            rs.EnableRedraw(False)
            shapecurve = self.bottom_crv
            abort = False
            if not self.is_guid(curve):
                curve = sc.doc.Objects.AddCurve(curve)            
            if self.is_guid(shapecurve):
                shapecurve = rs.coercegeometry(rs.CopyObject(shapecurve))
            #curve = "let's break this fucker."
            cpt = rs.CurveAreaCentroid(curve)[0]
            #style[opt] = the corner style
            #0 = None, 1 = Sharp, 2 = Round, 3 = Smooth, 4 = Chamfer
            copy_curve = rs.CopyObject(curve)
            if not useoffcrv:
                check_curve = self.op_offset_crv(dim,copy_curve,0,refcpt=cpt)
            else: check_curve = copy_curve
        
            if check_curve:
                if self.is_guid(check_curve): 
                    offcurve = rs.coercecurve(check_curve)
                else:
                    offcurve = check_curve
            else:
                print 'courtyard/terrace offset failed'
                diff_geom = None
                abort = True
            if dir=="courtyard" and not abort:
                ht = self.z_dist * 2.5
                geom = copy.copy(self.geom)
                geom = rs.coercegeometry(geom)
                diff_geom = rc.Geometry.Extrusion.Create(offcurve,ht,True)
                #diff_geom = sc.doc.Objects.AddBrep(rs.coercebrep(ext))
                diff_geom = rs.coercebrep(diff_geom)
            elif dir=="terrace" and not abort:
                ht = self.z_dist+1.
                offgeom = rc.Geometry.Extrusion.Create(offcurve,self.z_dist,True)
                offgeom = sc.doc.Objects.AddBrep(rs.coercebrep(offgeom))
                diff_geom = sc.doc.Objects.AddBrep(rs.coercebrep(ext))
            elif dir=="terrace_3d" and not abort:
                ht = self.z_dist+1.
                offgeom = rc.Geometry.Extrusion.Create(offcurve,self.z_dist,True)
                offgeom = rs.coercebrep(offgeom)
                geom = copy.copy(self.geom)
                geom = rs.coercebrep(geom)
                ext = rc.Geometry.Extrusion.Create(shapecurve,ht,True)
                diff_geom = sc.doc.Objects.AddBrep(rs.coercebrep(ext))
            #if dir == "courtyard":
                #print diff_geom
            if not abort:
                try:
                    #if True:
                    if dir=="courtyard":
                        booldiff = rc.Geometry.Brep.CreateBooleanDifference(geom,diff_geom,TOL)
                        if len(booldiff) > 1:
                            self.geom = booldiff
                        elif len(booldiff) > 0:
                            self.geom = booldiff[0]
                    elif dir=="terrace":
                        booldiff = rs.BooleanIntersection(diff_geom,offgeom,True)
                        #booldiff = map(lambda c: rs.coercegeometry(c),booldiff)
                        if len(booldiff)>0.1:
                            self.geom = booldiff[0]
                    elif dir=="terrace_3d":
                        booldiff = rc.Geometry.Brep.CreateBooleanIntersection(geom,offgeom,TOL)
                        booldiff = map(lambda c: sc.doc.Objects.AddBrep(c),booldiff)
                        diff_geom = offgeom
                        if len(booldiff) > 1:
                            self.geom = booldiff
                        elif len(booldiff)> 0.1:
                            self.geom = booldiff[0]
                    self.reset()
                except Exception,e: 
                    print str(e)#sys.exc_traceback.tb_lineno 
                    print 'fail op_offset'
            rs.EnableRedraw(True)
            return diff_geom
        except Exception as e:
            print 'Error @ Shape.op_offset'
            print str(e)#sys.exc_traceback.tb_l          
    

if True:
    sc.sticky["Shape"] = Shape
# ---------- end bibil_3 ----------
bibil_4 = PythonScript()  # -> o
# ---------- bibil_4: Python ----------
'''
Created on Sep 13, 2016
@author: vasanthakumars
'''

import scriptcontext as sc
import copy

Miru = \
{'child':None,\
'type_id':'type_blank',\
'axis':None,\
'solartype':0,\
'divide':False,\
'court':False,\
'stepback':False,\
'separate':False,\
'height':False,\
'concentric_divide': False,\
'label_UI':False,\
'bula':False,\
'landuse':False,\
'meta_tree':False,\
'extract_slice':False,\
'shape2height':False}
"""--------------------------------"""

if True:
    sc.sticky["Miru"] = Miru
# ---------- end bibil_4 ----------
bibil_5 = PythonScript()  # -> o
# ---------- bibil_5: Python ----------
"""
Created on Jun 25, 2016
@author: Saeran Vasanthakumar
"""

import rhinoscriptsyntax as rs
import Rhino as rc
import scriptcontext as sc
import math
import copy
import itertools

"""
Bula takes in data points (i.e. from GIS, from manhattan distance 
analysis) and uses data to drive form generative methods i.e. height, 
setback distance, tower separation at a high degree of precision. 
Since the data points are normalized, you must set the domain extents
of the data you are working with in order to get sensible data. 
By incrementing the bula.value, you can experiment with densities, 
but the density will always be DIRECTIONALLY DRIVEN by underling point
data.
"""
class Bula:
    def __init__(self,bpt_lst=None,value_lst=None,avg_val=0.):
        #Set defaults for list types
        if bpt_lst == None:
            bpt_lst = []
        if value_lst == None:
            value_lst = []
        #Init
        self.bpt_lst = bpt_lst
        self.value_lst = value_lst
        self.avg_value = avg_val
        self.bpt_viz_lst = copy.copy(bpt_lst)
        self.value_actual = []
        
    def normalize_list(self,lov,hibound,lobound):
        """normalized_val = ( (val-min)*(hibound-lobound) )/(max-min) + lobound"""
        max_ = max(lov)
        min_ = min(lov)
        L = []
        
        for i,v in enumerate(lov):
            if max_-min_ > 0.:
                norm_val = ((hibound-lobound)*(v-min_))/(max_-min_) + lobound
            else: 
                norm_val = 1/float(len(lov))
            L.append(norm_val)
        return L
    def calculate_combination(self,iterable,r):
        # combinations(iterable, r)
        # combinations('ABCD', 2) --> AB AC AD BC BD CD
        return itertools.combinations(iterable,r)

    def ghtree2nestlist(self,tree,nest=True):
        nested_lst = []
        for i in range(tree.BranchCount):
            branchList = tree.Branch(i)
            #change from listobject
            lst = []
            for b in branchList:
                if nest: 
                    lst.append(b)
                else: 
                    nested_lst.append(b)
            if nest: 
                nested_lst.append(lst)
        return nested_lst
    def normalize_cpt_data(self,cpt_lst_):
        ## Normalize points
        cpt_lst_val = map(lambda cpt: cpt[2], cpt_lst_)
        ## temp add lowerbound for height
        norm_lst = self.normalize_list(cpt_lst_val,1.,0.)
        for i,val in enumerate(zip(norm_lst,cpt_lst_)):
            norm,cpt = val[0],val[1]
            cpt[2] = norm
            cpt_lst_[i] = cpt
        return cpt_lst_ 
    def set_node_bula_pt_ref(self,curr_node,bula_node_ref):
        #Purpose: Reference bula pts to curr_node's shape_geom boundaries
        #Input: curr_node,bula_node_ref
        #Output: mutated curr_node w/ bula_data if exists
        buladata = bula_node_ref.grammar.type['bula_data']
        curr_node_lst = [curr_node]
        #Input Point list, Value list
        shape_point_lst = buladata.bpt_lst
        shape_value_lst = buladata.value_lst
        shape_value_lst_actual = buladata.value_actual
        
        #Call getpoints4lst
        lst_bpt_lst_,lst_val_lst_,lst_val_lst_actual_  = buladata.getpoints4lot(curr_node_lst,shape_point_lst,shape_value_lst,shape_value_lst_actual)
        #print 'bula', lst_bpt_lst_, lst_val_lst_
        return lst_bpt_lst_,lst_val_lst_,lst_val_lst_actual_
    def getpoints4lot(self,lots_,cpt_,value_ref_,actual_value_ref_):
        ## Loop through tree lots and add the point_nodes
        ## to each lot; returns lst of (listof points inside each lot)
        ## bpt_lst,lots: listof(listof(point data) 
        debug = sc.sticky['debug']
        lst_bpt_lst_ = []
        lst_val_lst_ = []
        lst_val_lst_actual_ = []

        for j,lot in enumerate(lots_):
            boundary = lot.shape.bottom_crv
            neighbor = []
            neighbor_val= []
            neighbor_val_actual = []
            # look through all cpts from dpts and add to neighborlst
            for i,cp in enumerate(cpt_):
                
                movedist = abs(lot.shape.cpt[2]-cp[2])
                if abs(movedist-0.0)>0.1:
                    if lot.shape.cpt[2] < cp[2]:
                        movedist *= -1
                    vec = rc.Geometry.Vector3d(0,0,movedist)
                else:
                    vec = rc.Geometry.Vector3d(0,0,0)
                if not lot.shape.is_guid(cp):
                    cp = sc.doc.Objects.AddPoint(cp)
                copy_cp = rs.CopyObject(cp,vec)
                #copy_cp = rs.coerce3dpoint() 
                
                #copy_cp = cp
                in_lot = 0
                try:
                    in_lot = int(rs.PointInPlanarClosedCurve(copy_cp,boundary,lot.shape.cplane))
                except:
                    pass
                #0 = point is outside of the curve
                #1 = point is inside of the curve
                #2 = point in on the curve
                if abs(float(in_lot) - 1.) <= 0.1:
                    cp = rs.coerce3dpoint(cp)
                    neighbor.append(cp)#,datalst[i]])
                    neighbor_val.append(value_ref_[i])
                    neighbor_val_actual.append(actual_value_ref_[i])
                    #d = rs.AddPoint(copy_cp[0], copy_cp[1],0)
                    #debug.append(d)
            lst_bpt_lst_.append(neighbor)
            lst_val_lst_.append(neighbor_val)
            lst_val_lst_actual_.append(neighbor_val_actual)
        return lst_bpt_lst_,lst_val_lst_,lst_val_lst_actual_ 
    def generate_bula_point(self,shapes_,lst_bpt_lst_,lst_value_lst,lst_value_lst_actual_):
        ## Loop through shape nodes w/ bula_pts
        for i,shape_node in enumerate(shapes_):
            bpt_lst_ = lst_bpt_lst_[i]
            val_lst = lst_value_lst[i]
            actual_val_lst = lst_value_lst_actual_[i]
            avg_val = reduce(lambda x,y: x+y,val_lst)
            ## Make a bpt for each lot
            bpt = Bula(bpt_lst_,val_lst,avg_val)
            bpt.value_actual = actual_val_lst
            #if shape_node.grammar.type.has_key('bula_data'):
            #    shape_node.grammar.type['bula_data'].append(bpt)
            #else:
            shape_node.grammar.type['bula_data'] = bpt
            shapes_[i] = shape_node
        return shapes_
    def calculate_node_gfa(self,lots_,ref_density):
        ##It would be a lot easier to do all these additions
        ## and operations on lists with numpy!!
        ## Old obselete, will need to rwrite to reflect
        ## lot.grammar.type['bula_pt'] = lot.grammar.type['bula_data']
        ## is a single class not list of bpt classes

        ### This section recalculates density amounts to bring the 
        ### actual density in line with the reference density provided by
        ### the designer while maintaining the exponential or nonexponetial
        ### relationship between different lot FARS.
        lot_num = float(len(lots_))
        lot_area = sum(map(lambda l:l.shape.get_area(),lots_))
        sum_gfa = 0.
        for l in lots_:
            for bpt in l.grammar['bula_pt']:
                sum_gfa += bpt.value
            bula_num = len(l.grammar['bula_pt'])
            sum_gfa += 0 if bula_num < 1 else sum_gfa/float(bula_num)
        ref_gfa = ref_density * lot_area
        ## Calculate difference between reference FAR, and actual FAR
        abs_diff = abs(float(ref_gfa) - sum_gfa)
        abs_diff = abs_diff*-1 if ref_gfa < sum_gfa else abs_diff
        ## Sort lot nodes from lowest to highest FAR
        lots_.sort(key=lambda n: n.grammar.type['bula_pt'].value)
           
        ## Loop through the listof(lots)
        for i,lot in enumerate(lots_):
            ## Neighbor nodes are the fine grain Batty cells, within a lot
            ## used to derive density sim. Not surrounding neighbors. 
            ## Sort the neighbor nodes for each lot from 
            ## lowest to highest by their FAR 
            lot_num = float(len(lot.grammar.type['bula_pt']))
            lot_val = sum(map(lambda bpt: bpt.value,lot.grammar.type['bula_pt']))
            try: 
                lot_gfa = (lot_val/lot_num) * lot.shape.get_area()
                ## Calculate the actual lot FAR / actual total FAR
                ## This fixes the exponential relationship.
                proportion = lot_gfa/sum_gfa
                ## If there is more than one neighbor nodes (or batty cells)
                ## then change FAR to be: the (avg neighbor FAR)
                ## plus the proportional difference between reference and actual 
                ## FAR (abs_diff*proportion)
                if lot_num >= 1.:
                    new_lot_gfa = lot_gfa/lot_num + (abs_diff*proportion)
            except ZeroDivisionError:
                lot_gfa = 1.
                new_lot_gfa
            lot.grammar.type['lot_gfa'] = new_lot_gfa
        return lots_
    def sort_by_bula(self,lots_):
        ## Sort by Bula_data.value, from highest to lowest
        def helper_chk_bula(lot_):
            if lot_.grammar.type.has_key('bula_data'):
                bula_val = lot_.grammar.type['bula_data'].value 
            else: 
                bula_val = 0.
            return bula_val 
        #print map(lambda n: n.grammar.type['bula_data'].value,lots_)
        bula_sort = sorted(lots_,key=lambda n: helper_chk_bula(n),reverse=True)
        #print map(lambda n: n.grammar.type['bula_data'].value,bula_sort)
        return bula_sort
    def apply_formula2points(self,formula_ref_,analysis_pts_):
        def helper_dist2focal_lst(focal_ref_,analysis_pt_lst):
            #Create nested list:
            #lst of Focal pts (len=2): 
            #>> nested lst of distance to focal pt for every analysis pt (len=100)
            apt_lst_in_fpt_lst_ = []
            for i,fpt in enumerate(focal_ref_):
                dist_lst = []
                for j,apt_ in enumerate(analysis_pt_lst):
                    dist2fpt = rs.Distance(fpt,apt_)
                    dist_lst.append(dist2fpt)
                apt_lst_in_fpt_lst_.append(dist_lst)
            return apt_lst_in_fpt_lst_
        def helper_min_dist4apt(apt_lst_in_fpt_lst_,analysis_pt_lst,smooth_factor_): 
            #Purpose: Find the minimum distance for each apt
            #Loop through each apt
            #Then loop through each dist2fpt for each apt
            min_dist_lst_ = []
            min_fptindex_lst_ = []
            smooth_fac_lst_ = []
            for i,apt_ in enumerate(analysis_pt_lst):
                dist4fpts = []
                #lstdist2fot = dist of each analysis_pt to fpt
                for lstofdist2fpt in apt_lst_in_fpt_lst_:
                    dist4fpts.append(lstofdist2fpt[i])
                #Identify the fpt that is closer to the apt
                min_fpt_index = dist4fpts.index(min(dist4fpts))
                min_dist = min(dist4fpts)
                min_fptindex_lst_.append(min_fpt_index)
                min_dist_lst_.append(min_dist)
                
                #Calculate Smoothing factor 
                #Find all combinations of two for each fref pt
                comb_dist = self.calculate_combination(dist4fpts,2)
                #Take sqrt of abs difference btwn each dist2fpt and sum
                smooth_ = 0. 
                for fptdist in comb_dist:
                    smooth_ += math.pow(math.fabs(fptdist[0]-fptdist[1]),smooth_factor_)
                    #print smooth_factor
                smooth_fac_lst_.append(smooth_)
            return min_dist_lst_,min_fptindex_lst_,smooth_fac_lst_
        
        #Purpose: Go through each point and add value based on formula
        formula = formula_ref_[0]
        focal_ref = formula_ref_[1]
        focal_height = formula_ref_[2]
        focal_ht_min = focal_height.pop(-1)
        smooth_factor = formula_ref_[3]
        
        #Set defaults
        if len(focal_height) != len(focal_ref):
            if len(focal_height) == 1 and len(focal_ref) > 1:
                focal_height = focal_height * len(focal_ref)
            else:
                print 'Correct the number of focal_weight inputs'
        
        #Calculate distance from apt to each focal ref       
        apts_in_fpts = helper_dist2focal_lst(focal_ref,analysis_pts_)
        #Make list of the minimum distance to fpt for each apt
        min_dist_lst,min_fptindex_lst,smooth_fac_lst = helper_min_dist4apt(apts_in_fpts,analysis_pts_,smooth_factor)            
        
        #Main function apply formula to min dist of each apt
        #This is ordered by fpt so we can weight it later
        #Careful when adding lists! They are complex objects
        #can unintentionally create odd mutations
        value_lst_by_fpt = []
        for fi in enumerate(focal_ref):
            value_lst_by_fpt.append([])
        for apt_i,dist_data in enumerate(zip(min_dist_lst,min_fptindex_lst)):
            min_dist,fpt_i = dist_data[0],dist_data[1]
            #formula: 1/math.exp(0.1813*dist)
            #print 'f', formula
            #print 'd', min_dist
            #Keep track of which fpt is referenced
            try:
                dist = (min_dist/1000.)*10 #<<< convert to km * 10 for 10 min walk
                val = eval(formula)
            except ZeroDivisionError:
                val = 0.
            #store value, apt index tuple
            value_lst_by_fpt[fpt_i].append((val,apt_i))
        
        #Add weights to each
        maxht = max(focal_height)
        wtlst = map(lambda ht: ht/maxht,focal_height)
        val_actual_flt = [0]*len(value_lst_by_fpt)
        #print 'wtlst', wtlst
        for fi,val_ind_lst in enumerate(value_lst_by_fpt):
            weight = wtlst[fi]*maxht
            
            #Separate value and index
            val_lst = map(lambda v: v[0],val_ind_lst)
            ind_lst = map(lambda v: v[1],val_ind_lst)
            #print 'val', val_lst
            #Calculate weighted value
            #
            val_actual = []
            for v in val_lst:
                val_actual.append(float(v) * 100.0)
            #
            max_bound = weight * max(val_lst)
            min_bound = weight * min(val_lst)
            val_lst = self.normalize_list(val_lst,max_bound,min_bound)
            #Now merge value and index back
            val_ind_lst = map(lambda x:(x[0],x[1]),zip(val_lst,ind_lst))
            
            val_actual = map(lambda x: (x[0],x[1]),zip(val_actual,ind_lst))
            val_actual_flt[fi] = val_actual
            
            value_lst_by_fpt[fi] = val_ind_lst

        #Resort by apt order
        #this is a clever way of handling this problem
        flat_val_ind_lst = reduce(lambda x,y:x+y,value_lst_by_fpt)
        flat_val_ind_lst.sort(key=lambda n:n[1])
        value_lst = map(lambda x: x[0],flat_val_ind_lst)
        
        #Resort by apt order ACTUAL
        flat_val_ind_lst_actual = reduce(lambda x,y:x+y,val_actual_flt)
        flat_val_ind_lst_actual.sort(key=lambda n:n[1])
        value_lst_actual = map(lambda x: x[0],flat_val_ind_lst_actual)
        
        #Add smoothing factor
        if len(focal_ref) > 1:
            smooth_fac_lst = self.normalize_list(smooth_fac_lst, 1, 0.001)
        else:
            smooth_fac_lst = self.normalize_list(value_lst,1, 0.001)
        
        value_lst = map(lambda vs: vs[0]*vs[1], zip(value_lst,smooth_fac_lst))
        #max_wtd_value = max(value_lst)
        for i,wtd_val in enumerate(value_lst):
            sf = smooth_fac_lst[i]
            #wtd_sf_val = wtd_val *sf
            inc = (1.-sf)*focal_ht_min
            #print '---'
            #print 'sf: ', sf
            #print 'inc:', inc
            #print 'ht: ', wtd_val
            #if sf <= 0.999:
            #    if (wtd_val + inc) <= max_wtd_value:
            wtd_val_inc = wtd_val + inc
            value_lst[i] = wtd_val_inc 
            
        #Done!
        return value_lst, value_lst_actual
    def set_bula_height4viz(self,shape_node_lst):
        for shape_node in shape_node_lst:
            buladata = shape_node.grammar.type['bula_data']
            bpt_lst = buladata.bpt_lst
            val_lst =  buladata.value_lst
            for i,bp_tuple in enumerate(zip(bpt_lst,val_lst)):
                bpt,val = bp_tuple[0],bp_tuple[1]
                vizpt = rc.Geometry.Point3d(bpt[0],bpt[1],val)
                buladata.bpt_viz_lst[i] = vizpt
    def set_bula_line4viz(self):
        pass
        """
        #Extract bulapt for each lot and visualize as line graph
        line = []
        newlots = []
        for lot in lots:
            for bula_data in lot.data.type['bula_data']:
                ht = lot.data.type['bula_data'].value
                for bpt in bula_data.bpt_lst: 
                    cp = bpt
                    try:
                        line_ = rs.AddLine([cp[0],cp[1],ht],[cp[0],cp[1],0.])
                        line.append(line_)
                    except:
                        pass
        
        pt = line
        """
if True:
    sc.sticky['Bula'] = Bula
# ---------- end bibil_5 ----------

geo = Geometry([<brep referenced from the Rhino model> x2])

# ---- group: SHAPENODE
bibil_6 = PythonScript(node_in=flatten(geo), label="buildings4analysis", run=Toggle(True))  # -> node_out, debug; inputs rule_in: tree, node_in: list, label: list, run: Boolean
# ---------- bibil_6: Python ----------
"""
Trinco UI
"""

import scriptcontext as sc
import clr

Grammar = sc.sticky["Grammar"]
clr.AddReference("Grasshopper")
from Grasshopper.Kernel.Data import GH_Path
from Grasshopper import DataTree

if run and node_in != []:
    node_in = filter(lambda n: n!=None,node_in)
    if rule_in.BranchCount < 0.5:
        rule_in = DataTree[object]()
        rule_ = []
        for i, r in enumerate(rule_):
            rule_in.Add(r)
        
    G = Grammar()
    sc.sticky["debug"] = []
    debug = sc.sticky["debug"]
    node_out = G.main_UI(node_in,rule_in,label_)
else:
    print 'Add inputs!'
# ---------- end bibil_6 ----------

# ----
g = PythonScript(node=bibil_6.node_out)  # -> label; inputs node: list
# ---------- g: Python ----------
node = filter(lambda n: n!=None,node)
if node and node != []:
    label = []
    if True:#for i,n in enumerate(node):
        #print i
        root = node[0].get_root()
        L = root.traverse_tree(lambda n:n,internal=True) 
        for i in L:
            print i
            label.append(i)
        #label.append('--')
        #print '---'
# ---------- end g ----------
toggle = BooleanToggle(True)

# ---- group: ANALYSIS
miru = PythonScript(
    node_in=bibil_6.node_out,
    groundFloor_ht=Slider(6, range=0..10),
    restFloor_ht=Slider(3, range=0..10),
    height=toggle,
    GFA=toggle)  # -> ReadMe, geom_out, pt_out, label_out, analysis_out, debug; inputs node_in: list
# ---------- miru: Python ----------
import rhinoscriptsyntax as rs
import Rhino as rc
import random
import scriptcontext as sc
import copy
import math
import ghpythonlib.components as ghcomp

"""import classes"""
Shape = sc.sticky["Shape"]
Tree = sc.sticky["Tree"]

sc.sticky['debug'] = []
debug = sc.sticky["debug"]

TOL = sc.doc.ModelAbsoluteTolerance

def get_label(n):
    label_ = []
    root = n[0].get_root()
    L = root.traverse_tree(lambda n:n,internal=True) 
    for nl in L:
        #print nl
        label_.append(nl)
    return label_

def make_analysis(nodelen,pd):
    ## Input: dictionary of parameter key, list of data value 
    ## Output: Filtered list of str: with keys and value
    L = [""] * nodelen
    if pd.has_key('height'):
        for i,ht in enumerate(pd['height']):
            valstr = 'height: %s' % (ht)
            L[i] += valstr
    if pd.has_key('GFA'):
        for i,gfa in enumerate(pd['GFA']):
            valstr = '\nGFA: %s' % (gfa)
            L[i] += valstr
    return L

def get_ht(node_):
    L = []
    for n_ in node_:
        storey = str(round(n_.shape.ht,1))
        L.append(storey)
    return L

def get_GFA(node_,ght,rht):
    def helper_by_floor_div(n__,groundht):
        ratio = groundht/n__.shape.ht
        PD = {}
        PD['div_num'] = 1
        PD['div_deg'] = 0.
        PD['div_cut'] = 0.
        PD['div_ratio'] = ratio
        PD['div_type'] = 'simple_divide'
        PD['axis'] = "Z"
        divnode = n__.grammar.divide(n_,PD)
        
        if abs(divnode.loc[0].shape.ht - groundht) < 0.01:
            groundfloor = divnode.loc[0]
            restfloor = divnode.loc[1]
        else:
            groundfloor = divnode.loc[1]
            restfloor = divnode.loc[0]
        return groundfloor,restfloor
    def helper_by_floor_calc(n__,htdiv):
        n__.shape.geom = ghcomp.CapHolesEx(n__.shape.geom)[0]
        shapevol = rc.Geometry.VolumeMassProperties.Compute(n__.shape.geom).Volume
        shapegfa = shapevol/htdiv
        return shapegfa
        
    debug = sc.sticky['debug']
    ReadMe_ = ""
    L = []
    for n_ in node_:
        if abs(ght-rht)<0.1:
            gfacalc = helper_by_floor_calc(n_,rht)
        else:
            try:
                grndshape,rstshape = helper_by_floor_div(n_,ght)
                grndgfa = grndshape.shape.get_area()
                rstgfa = helper_by_floor_calc(rstshape,rht)
                gfacalc = grndgfa + rstgfa
            except:
                ReadMe_ = "Calculating by specific floor heights has failed, probably because the geometry was too complicated. GFA is now based on restfloorht."
                gfacalc = helper_by_floor_calc(rstshape,3.)
        #debug.extend(map(lambda n:n.shape.geom,divnode.loc))
        L.append(str(round(abs(gfacalc),1)))
    return L,ReadMe_

node = filter(lambda n: n!=None,node_in)
if node and node != []:
    node = map(lambda n: copy.deepcopy(n),node)
    sc.sticky['debug'] = []
    debug = sc.sticky['debug']
    ReadMe = ""
    
    #These always appear by default
    label_out = get_label(node)
    geom_out = map(lambda n:n.shape.geom,node)
    pt_out = map(lambda n:n.shape.cpt,node)
    #Analysis paramaters
    param_dict = {}
    if height==True:
        ht_out = get_ht(node)
        param_dict['height'] = ht_out
    if GFA == True:
        if not groundFloor_ht:
            groundFloor_ht = 3.0
        if not restFloor_ht:
            restFloor_ht = 3.0
        gfa_out,readmegfa = get_GFA(node,groundFloor_ht,restFloor_ht)
        param_dict['GFA'] = gfa_out
        ReadMe += readmegfa
    analysis_out = make_analysis(len(node),param_dict)
    if not ReadMe:
        ReadMe = "Successfully calculated"
# ---------- end miru ----------

# ---- group: Height of Line for visualization
number_slider = Slider(200, range=0..200)

# ----
Z = UnitZ(Factor=number_slider)
panel = Panel(miru.ReadMe)
panel_2 = Panel(miru.analysis_out)
geo_2 = Geometry(miru.geom_out)
geo_3 = Geometry(miru.pt_out)
move = Move(Geometry=geo_3, Motion=Z)  # -> Geometry, Transform
ln = Line(StartPoint=geo_3, EndPoint=move.Geometry)
tag = TextTag(Location=move.Geometry, Text=miru.analysis_out)
python = PythonScript(analysis_in=miru.analysis_out)  # -> ID, GFA, HT; inputs analysis_in: list
# ---------- python: Python ----------
analysis_in = filter(lambda n: n!=None,analysis_in)

if analysis_in:
    ID,GFA,HT = [],[],[]
    for an in analysis_in:
        lst = an.split('\n')
        ID.append('null')
        ht = float(lst[0].split(": ")[-1])
        gfa = float(lst[1].split(": ")[-1])
        HT.append(ht)
        GFA.append(gfa)
        #print '--'
# ---------- end python ----------
toggle_2 = BooleanToggle(True)
excelwrite = ExcelWriteLEGACY(
    WriteToggle=toggle_2,
    WriteHeading=toggle_2,
    ClearSheet=Toggle(True),
    Worksheet=1,
    ColumnStart=1,
    RowStart=1,
    ColumnHeadings=["ADDRESS", "GFA", "HEIGHT"],
    Column1=python.ID,
    Column2=python.GFA,
    Column3=python.HT)
