# Grasshopper definition beta_mineral_test_0.gh (Grasshopper 0.9.76)
# plug-ins: Python Interpreter

list = ValueList({"dir", "file"}, selected="dir")

# ---- group: find directory
bibil = PythonScript(
    dir=["C:\\Users\\vasanthakumars\\Documents\\GitHub\\bibil\\src", "C:\\saeran\\master\\git\\bibil\\src"],
    type=list,
    run=Toggle(True))  # -> dir; inputs dir: list
# ---------- bibil: Python ----------
import os

ghenv.Component.Params.Output[0].Name = "null"
ghenv.Component.Params.Output[0].NickName = "null"

if run:
    confirm_dir = None
    for d in dir:
        try:
            if type == "file":
                file_ = open(d)
                file_.close()
            else:
                print os.listdir(d)
            confirm_dir = d
            break
        except Exception as e:
            #print str(e)
            continue
    if confirm_dir != None:
        ghenv.Component.Params.Output[0].Name = type
        ghenv.Component.Params.Output[0].NickName = type
        dir = confirm_dir
        file = confirm_dir
null = None
# ---------- end bibil ----------

# ---- group: tree
python_script = PythonScript(i=bibil)  # -> o
# ---------- python_script: Python ----------
import os

if i:
    o = os.path.join(str(i),"bibil\\bibil_tree.py")
# ---------- end python_script ----------
file = ReadFile(File=python_script, PerLineParse=False)
bibil_2 = PythonScript(Code=file)

# ---- group: grammar
python_script_2 = PythonScript(i=bibil)  # -> o
# ---------- python_script_2: Python ----------
import os

if i:
    o = os.path.join(str(i),"bibil\\bibil_grammar.py")
# ---------- end python_script_2 ----------
file_2 = ReadFile(File=python_script_2, PerLineParse=False)
bibil_3 = PythonScript(Code=file_2)

# ---- group: shape
python_script_3 = PythonScript(i=bibil)  # -> o
# ---------- python_script_3: Python ----------
import os

if i:
    o = os.path.join(str(i),"bibil\\bibil_shape.py")
#o = os.path.join(str(i),"research\\bibil_shape_shape_3d_2d.py")
# ---------- end python_script_3 ----------
file_3 = ReadFile(File=python_script_3, PerLineParse=False)
bibil_4 = PythonScript(Code=file_3)

# ---- group: miru
python_script_4 = PythonScript(i=bibil)  # -> o
# ---------- python_script_4: Python ----------
import os

if i:
    o = os.path.join(str(i),"miru\\miru_miru.py")
# ---------- end python_script_4 ----------
file_4 = ReadFile(File=python_script_4, PerLineParse=False)
bibil_5 = PythonScript(Code=file_4)

# ---- group: bula
python_script_5 = PythonScript(i=bibil)  # -> o
# ---------- python_script_5: Python ----------
import os

if i:
    o = os.path.join(str(i),"bula\\bula_minimal.py")
# ---------- end python_script_5 ----------
file_5 = ReadFile(File=python_script_5, PerLineParse=False)
bibil_6 = PythonScript(Code=file_5)

# ---- group: UI
python_script_6 = PythonScript(i=bibil)  # -> o
# ---------- python_script_6: Python ----------
import os

if i:
    o = os.path.join(str(i),"bibil\\bibil_UI.py")
# ---------- end python_script_6 ----------
file_6 = ReadFile(File=python_script_6, PerLineParse=False)

# ---- group: grammar_divide
python_script_7 = PythonScript(i=bibil)  # -> o
# ---------- python_script_7: Python ----------
import os

if i:
    o = os.path.join(str(i),"miru\\miru_divide.py")
# ---------- end python_script_7 ----------
file_7 = ReadFile(File=python_script_7, PerLineParse=False)

# ---- group: grammar_courtyard
python_script_8 = PythonScript(i=bibil)  # -> o
# ---------- python_script_8: Python ----------
import os

if i:
    o = os.path.join(str(i),"miru\\miru_court.py")
# ---------- end python_script_8 ----------
file_8 = ReadFile(File=python_script_8, PerLineParse=False)

# ---- group: grammar_tower
python_script_9 = PythonScript(i=bibil)  # -> o
# ---------- python_script_9: Python ----------
import os

if i:
    o = os.path.join(str(i),"miru\\miru_packing.py")
# ---------- end python_script_9 ----------
file_9 = ReadFile(File=python_script_9, PerLineParse=False)

python_script_10 = PythonScript(i=bibil)  # -> o
# ---------- python_script_10: Python ----------
import os

if i:
    o = os.path.join(str(i),"miru\\miru_stepback.py")
# ---------- end python_script_10 ----------
file_10 = ReadFile(File=python_script_10, PerLineParse=False)

# ---- group: grammar_height
python_script_11 = PythonScript(i=bibil)  # -> o
# ---------- python_script_11: Python ----------
import os

if i:
    o = os.path.join(str(i),"miru\\miru_height.py")
# ---------- end python_script_11 ----------
file_11 = ReadFile(File=python_script_11, PerLineParse=False)

# ---- group: grammar_analysis_pts
python_script_12 = PythonScript(i=bibil)  # -> o
# ---------- python_script_12: Python ----------
import os

if i:
    o = os.path.join(str(i),"miru\\miru_analysis.py")
# ---------- end python_script_12 ----------
file_12 = ReadFile(File=python_script_12, PerLineParse=False)

# ---- group: meta_tree
python_script_13 = PythonScript(i=bibil)  # -> o
# ---------- python_script_13: Python ----------
import os

if i:
    o = os.path.join(str(i),"miru\\miru_meta_tree.py")
# ---------- end python_script_13 ----------
file_13 = ReadFile(File=python_script_13, PerLineParse=False)

# ---- group: land_use
python_script_14 = PythonScript(i=bibil)  # -> o
# ---------- python_script_14: Python ----------
import os

if i:
    o = os.path.join(str(i),"miru\\miru_landuse.py")
# ---------- end python_script_14 ----------
file_14 = ReadFile(File=python_script_14, PerLineParse=False)

# ---- group: shape2height
python_script_15 = PythonScript(i=bibil)  # -> o
# ---------- python_script_15: Python ----------
import os

if i:
    o = os.path.join(str(i),"miru\\miru_shape2height.py")
# ---------- end python_script_15 ----------
file_15 = ReadFile(File=python_script_15, PerLineParse=False)

# ---- group: extract_slice
python_script_16 = PythonScript(i=bibil)  # -> o
# ---------- python_script_16: Python ----------
import os

if i:
    o = os.path.join(str(i),"miru\\miru_extract_slice.py")
# ---------- end python_script_16 ----------
file_16 = ReadFile(File=python_script_16, PerLineParse=False)

# ---- group: strip_faces
python_script_17 = PythonScript(i=bibil)  # -> o
# ---------- python_script_17: Python ----------
import os

if i:
    o = os.path.join(str(i),"miru\\miru_strip_faces.py")
# ---------- end python_script_17 ----------
file_17 = ReadFile(File=python_script_17, PerLineParse=False)

# ----
list_2 = ValueList({"divide by depth": "subdivide_depth", "divide by same depth": "subdivide_depth_same", "divide by dim": "subdivide_dim"}, selected="divide by same depth")
list_3 = ValueList({"YZ": "NS", "XZ": "EW", "XY": "Z"}, selected="XZ")

# ---- group: EXTRACT_SLICE
miru = PythonScript(Code=file_16, Run=Toggle(False))

# ---- group: DIVIDE
miru_2 = PythonScript(
    Code=file_7,
    Divide_num=Slider(2, range=0..10),
    Divide_cut=Slider(0, range=0..100),
    Divide_type=list_2,
    Divide_ratio=Slider(0.5, range=0..1),
    Axis=list_3,
    Run=Toggle(False))

# ---- group: PERIMETER
miru_3 = PythonScript(Code=file_8, Width=Slider(20, range=0..100), Cut_width=Slider(0, range=0..100), Court_ref="0", Run=Toggle(False))

# ---- group: TREE RULES
miru_4 = PythonScript(Code=file_13, Run=Toggle(False))

# ---- group: SHAPE2HEIGHT
miru_5 = PythonScript(Code=file_15, Run=Toggle(False))

# ---- group: HEIGHT
miru_6 = PythonScript(Code=file_11, Height=Slider(16.5, range=0..100), Randomize="-10>10", Run=Toggle(True))

miru_7 = PythonScript(Code=file_11, Height=Slider(16.5, range=0..100), Randomize="-10>10", Run=Toggle(True))

# ---- group: STRIP_FACES
miru_8 = PythonScript(Code=file_17, Run=Toggle(True))

miru_9 = PythonScript(Code=file_17, Run=Toggle(True))

# ----
geo = Geometry(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)
geo_2 = Geometry(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)
geo_3 = Geometry(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)
area = Area(Geometry=geo)  # -> Area, Centroid
scale = Scale(Geometry=geo, Center=area.Centroid, Factor=Slider(0.3, range=0..1))  # -> Geometry, Transform

# ---- group: SHAPENODE
bibil_7 = PythonScript(
    Code=file_6,
    Rule_in=flatten([miru_8, miru_6, miru_9, miru_7]),
    Node_in=flatten(scale.Geometry),
    Label_="root",
    Run=Toggle(True))  # -> Node_out, Debug

# ----
python = PythonScript()  # -> a
# ---------- python: Python ----------
import rhinoscriptsyntax as rs
import Rhino as rc
import math
import ghpythonlib.components as ghcomp
import copy
import scriptcontext as sc


#rc.Geometry.Brep.DuplicateEdgeCurves

rs.JoinCurves

#rc.Geometry.Plane(
# ---------- end python ----------
geo_4 = Geometry(bibil_7.Debug)
g = PythonScript(node=bibil_7.Node_out)  # -> geom; inputs node: list
# ---------- g: Python ----------
node = filter(lambda n: n!=None,node)
if node and node != []:
    geom = []
    for n in node:
        print n.shape.z_dist
        if n.shape.z_dist < 1.1:
            geom.append(n.shape.bottom_crv)
        else:
            geom.append(n.shape.geom)
    print geom
# ---------- end g ----------
g_2 = PythonScript(node=bibil_7.Node_out)  # -> label; inputs node: list
# ---------- g_2: Python ----------
node = filter(lambda n: n!=None,node)
if node and node != []:
    label = []
    if True:#for i,n in enumerate(node):
        #print i
        root = node[0].get_root()
        L = root.traverse_tree(lambda n:n,internal=True) 
        for i in L:
            print i
            label.append(i)
        #label.append('--')
        #print '---'
# ---------- end g_2 ----------
g_3 = PythonScript(node=bibil_7.Node_out)  # -> pt, vec; inputs node: list
# ---------- g_3: Python ----------
node = filter(lambda n: n!=None,node)
if node and node != []:
    pt = []
    vec = []
    for n in node:
        pt.append(n.shape.cpt)
        vec.append(n.shape.normal*25)
# ---------- end g_3 ----------
vdisex = VectorDisplayEx(Point=g_3.pt, Vector=g_3.vec, Colour=ColourSwatch(SwatchColor=RGB(0, 255, 0)), Width=2)
material = CreateMaterial(
    Diffuse=ColourSwatch(SwatchColor=RGB(0, 255, 255)),
    Specular=RGB(255, 255, 255),
    Emission=RGB(0, 0, 0),
    Transparency=Slider(0.4, range=0..1),
    Shine=0)
mesh = Mesh(g)
panel = Panel(g_2)
wires = BrepWireframe(Brep=g, Density=-1)
preview = CustomPreview(Geometry=mesh, Shader=material)
