# Grasshopper definition bibil_GFA_calc.gh (Grasshopper 0.9.76)
# plug-ins: Python Interpreter

towers = Geometry([<brep referenced from the Rhino model> x8])
lot = Geometry(<curve referenced from the Rhino model>)
contour = Contour(Shape=towers, Point=Point(0, 0, 0), Direction=Vector(0, 0, 1), Distance=Slider(1000, range=0..1000))  # -> flatten(Contours)
brep_wireframe = BrepWireframe(Brep=towers, Density=-1)
flatten_tree = FlattenTree(Path="{0}")
area = Area(Geometry=contour)  # -> Area, Centroid
geometry = Geometry(flatten_tree)
area_2 = Area(Geometry=flatten_tree)  # -> Area, Centroid
panel = Panel(area.Area)
point_in_curves = PointInCurves(Point=area.Centroid, Curves=lot)  # -> Relationship, Index, flatten(Point)
if_x_y_a_geom = PythonScript(x=point_in_curves.Relationship, y=Slider(2, range=0..10), geom=contour)  # -> out, a
# ---------- if_x_y_a_geom: Python ----------
if x == y:
    a = geom
# ---------- end if_x_y_a_geom ----------
if_x_y_a_geom_2 = PythonScript(x=point_in_curves.Relationship, y=Slider(2, range=0..10), geom=lot)  # -> out, a; same code as if_x_y_a_geom
area_3 = Area(Geometry=if_x_y_a_geom_2.a)  # -> Area, Centroid
area_4 = Area(Geometry=if_x_y_a_geom.a)  # -> Area, Centroid
panel_2 = Panel(if_x_y_a_geom.a)
panel_3 = Panel(area_3.Area)
division = Division(A=area_4.Area, B=area_3.Area)
panel_4 = Panel(division)

geometry_2 = Geometry([<brep referenced from the Rhino model> x9])
bibil = PythonScript()  # -> o
# ---------- bibil: Python ----------
"""
Created on Jun 6, 2016
@author: Saeran Vasanthakumar
"""

import rhinoscriptsyntax as rs
import Rhino as rc
import math
import ghpythonlib.components as ghcomp
import copy
import scriptcontext as sc

TOL = sc.doc.ModelAbsoluteTolerance



class Shape_3D:
    """
    Parent shape operations and information
    """
    TOL = sc.doc.ModelAbsoluteTolerance
    
    def __init__(self,geom=None,cplane=None):
        self.geom = geom
        self.cplane = cplane
        self.north = rs.VectorCreate([0,1,0],[0,0,0])
        self.area = None
        self.dimension = '3d'
        self.bottom_crv = None
        self.primary_axis_vector = None
        self.base_matrix = None
        try:
            self.reset(xy_change=True)
        except Exception as e:
            print str(e), "Error at Shape.reset()"
    def reset(self,xy_change=True):
        def get_dim_bbox(b):
            ## counterclockwise, start @ bottom SW  
            #      n_wt
            #      -----
            #      |   |
            # w_ht |   | e_ht = y_dist
            #      |   |
            #      -----
            #     s_wt = x_dist
            """    self.s_wt,self.e_ht,self.n_wt,self.w_ht """
            return b[:2],b[1:3],b[2:4],[b[3],b[0]]
            
            
        # primary edges
        if xy_change == True:
            try:
                self.bottom_crv = self.get_bottom(self.geom,self.get_boundingbox(self.geom,None)[0])
            except Exception as e:
                #print str(e)##sys.exc_traceback.tb_lineno 
                self.bottom_crv = None
            try:
                if self.cplane == None:
                    self.cplane = self.get_cplane_advanced(self.geom)
                self.primary_axis_vector = self.cplane.YAxis
            except Exception as e:
                #print str(e)##sys.exc_traceback.tb_lineno 
                self.cplane, self.primary_axis_vector = None, None
            try:
                self.bbpts = self.get_boundingbox(self.geom,self.cplane)
                self.s_wt,self.e_ht,self.n_wt,self.w_ht = get_dim_bbox(self.bbpts)
                self.ew_vector = self.n_wt[1]-self.n_wt[0]
                self.ns_vector = self.e_ht[1]-self.e_ht[0]
                """
                print 'check ew'
                print self.primary_axis_vector.IsParallelTo(self.ew_vector)
                print self.primary_axis_vector.IsPerpendicularTo(self.ew_vector)
                print ''
                """
                # x,y,z distances
                self.x_dist = float(rs.Distance(self.s_wt[0],self.s_wt[1]))
                self.y_dist = float(rs.Distance(self.e_ht[0],self.e_ht[1]))
                self.area = None
            except Exception as e:
                #print str(e)
                self.bbpts,self.s_wt,self.e_ht,self.n_wt,self.w_ht = None, None, None, None, None 
            try:
                bp = self.bbpts
                self.cpt = rc.Geometry.AreaMassProperties.Compute(self.bottom_crv).Centroid
            except Exception as e:
                #print str(e)#sys.exc_traceback.tb_lineno 
                self.cpt = None
        try:# curve profile info
            if xy_change == False:
                self.bbpts = self.get_boundingbox(self.geom,self.cplane)
            self.ht = float(self.bbpts[4][2])
            self.z_dist = float(float(self.bbpts[4][2]) - self.cpt[2])
        except Exception as e:
            #print str(e)#sys.exc_traceback.tb_lineno 
            self.ht, self.z_dist = None, None
    def calculate_ratio_from_dist(self,axis,dist,dir=0.):
        # Direction of cut   
        # Long axis: YAxis
        # 1.0 ^
        #     |   
        # 0.5 ^ w_ht = y_dist  
        #     |   
        # 0.0 ->->->->->->->
        #     0.0  0.5   1.0
        #  s_wt = x_dist
        
        ## dir: 0 = cut dist from bottom 
        ## dir: 1 = cut dist from top
        ## test1: 25m/100m
        ## if dir == 0: ratio = 0.25
        ## if dir == 1: ratio = 0.75
        ## test2: 75m/100m
        ## if dir == 0: ratio = 0.75
        ## if dir == 1: ratio = 0.25
        if "NS" in axis:
            total_dist = self.x_dist
        else:# if "EW" in axis:
            total_dist = self.y_dist
        # Cut from bottom
        ratio = dist/float(total_dist)
        # Cut from top
        if dir > 0.5: 
            ratio = 1. - ratio
        return ratio
    def vector2axis(self,ref_vector):
        ## Compare ref_vector with shape axis, and return
        ## closest shape axis
        ew_axis = self.n_wt[1]-self.n_wt[0]
        ns_axis = self.e_ht[1]-self.e_ht[0]
        ## unitize
        ref_vector.Unitize()
        ew_axis.Unitize()
        ns_axis.Unitize()
        ew_dotprod = rc.Geometry.Vector3d.Multiply(ew_axis,ref_vector)
        ns_dotprod = rc.Geometry.Vector3d.Multiply(ns_axis,ref_vector)
        ## Greater the dot product, closer it is to 90
        cutaxis = "NS" if abs(ew_dotprod) < abs(ns_dotprod) else "EW"
        return cutaxis
    def op_split(self,axis,ratio,deg=0.,split_depth=0,split_line_ref=None):
        """
        op_split: self, ratio -> (list of geom)
        Splits original geom into two
        """
        debug = sc.sticky['debug']
        def helper_make_split_surf_z(ratio_):
            try:
                zht = ratio_ * self.z_dist
                splitptlst = self.bbpts[:4]+[self.bbpts[0]]
                splitptlst = map(lambda b:rc.Geometry.Point3d(b[0],b[1],b[2]+zht),splitptlst)
                splitcurve = rc.Geometry.Curve.CreateControlPointCurve(splitptlst,1)
                split_surf_ = rc.Geometry.Brep.CreatePlanarBreps(splitcurve)[0]
                return split_surf_
            except Exception as e:
                print "Error @ shape.helper_make_split_srf_z"
                print str(e)#sys.exc_traceback.tb_lineno 
        def helper_make_split_line_xy(ratio_,degree,ref_shape=None):
            debug = sc.sticky['debug']
            try:
                if ref_shape:
                    s_wt,n_wt = ref_shape.s_wt,ref_shape.n_wt
                    e_ht,w_ht = ref_shape.e_ht,ref_shape.w_ht
                    x_dist,y_dist = ref_shape.x_dist,ref_shape.y_dist
                else:
                    s_wt,n_wt = self.s_wt,self.n_wt
                    e_ht,w_ht = self.e_ht,self.w_ht
                    x_dist,y_dist = self.x_dist,self.y_dist
                    
                if axis == "NS":
                    edge_0, edge_1 = s_wt, n_wt
                    dist = ratio_* x_dist
                else:#if axis == "EW"
                    edge_0, edge_1 = e_ht, w_ht
                    dist = ratio_* y_dist
                    
                ### helper geom that splits box
                line_0 = rs.AddLine(edge_0[0],edge_0[1])
                line_1 = rs.AddLine(edge_1[1],edge_1[0])
                # ^flip because counterclockwise
                mid_0 = rs.DivideCurveLength(line_0,dist,True,True)[1]
                mid_1 = rs.DivideCurveLength(line_1,dist,True,True)[1]            
                split_line = rs.AddCurve([mid_0,mid_1],1)
                if float(degree) > 0.5:
                    cpt = rs.DivideCurve(split_line,2,True,True)[1] 
                    split_line = rs.RotateObject(split_line,cpt,degree)
                sc_ = 3,3,3
                line_cpt = rs.DivideCurve(split_line,2)[1]
                split_line_sc = rs.ScaleObject(split_line,line_cpt,sc_)
                return split_line_sc
            except Exception as e:
                pass#print "Error @ shape.helper_make_split_srf_xy"
                #print str(e)#sys.exc_traceback.tb_lineno 
        def helper_make_split_surf(split_line_):
            if self.ht < 1: 
                ht = 1.
            else: 
                ht = self.ht
            split_path = rs.AddCurve([[0,0,0],[0,0,ht*2]],1)    
            split_surf = rs.coercebrep(rs.ExtrudeCurve(split_line_,split_path))
            return split_surf
        def helper_get_split_line_surf(ratio_,axis_,deg_,split_line_ref_):
            split_line_, split_surf_ = None,None
            if split_line_ref_ != None:
                ## Check if Closed curve
                if type(self) == type(split_line_ref_):
                    split_line_ = helper_make_split_line_xy(ratio_,deg_,ref_shape=split_line_ref_)
                else:
                    split_line_ = split_line_ref_
                #debug.append(split_line_)
                split_surf_ = helper_make_split_surf(split_line_)
            elif axis_ == "Z":
                split_surf_ = helper_make_split_surf_z(ratio_)
            else:
                split_line_ = helper_make_split_line_xy(ratio_,deg_)
                split_surf_ = helper_make_split_surf(split_line_)           
            return split_line_, split_surf_
        
        rs.EnableRedraw(False)
        split_line,split_surf = helper_get_split_line_surf(ratio,axis,deg,split_line_ref)
        try:#if True:
            ## For split_depth == 0.
            if split_depth <= 0.1:
                geom = rs.coercebrep(self.geom) if self.is_guid(self.geom) else self.geom 
                lst_child = geom.Split(split_surf,TOL)
            ## For split_depth > 0.
            else:
                if self.z_dist < 0.09:
                    print 'not a 3d geom, therefore will not split'
                # vec transformation
                if self.is_guid(split_line):
                    split_line = rs.coercecurve(split_line)
                nc = split_line.ToNurbsCurve()
                end_pts = [nc.Points[i_].Location for i_ in xrange(nc.Points.Count)]
                dir_vector = end_pts[1] - end_pts[0]
                z_vector = rs.VectorCreate([0,0,0],[0,0,1])
                # create forward and backwards vector using crossproduct
                normal_f = rs.VectorCrossProduct(dir_vector,z_vector)
                normal_b = rs.VectorCrossProduct(z_vector,dir_vector) 
                
                sc_ = split_depth,split_depth,split_depth
                
                normal_f.Unitize()
                normal_b.Unitize()
                normal_b = map(lambda v: v*split_depth/2.,normal_b)
                
                c = rs.AddCurve([rs.AddPoint(0,0,0),rs.AddPoint(normal_f[0],normal_f[1],normal_f[2])],0)
                c = rs.ScaleObject(c,rs.AddPoint(0,0,0),sc_)
                rc_cut = rs.ExtrudeSurface(split_surf,c)
                rc_cut = rs.MoveObject(rc_cut,normal_b)
                #debug.append(rc_cut)
                #debug.append(split_surf)
                lst_child = []
                rc_geom,rc_cut = rs.coercebrep(self.geom),rs.coercebrep(rc_cut)
                #ghcomp.Flip(rc_cut,sc.sticky['surface_ref'])[0]
                geom_childs = rc.Geometry.Brep.CreateBooleanDifference(rc_geom,rc_cut,TOL)
                lst_child.extend(geom_childs)
        except Exception as e:
            print "Error @ shape.op_split while splitting"
            print str(e)#, sys.traceback.tb_lineno 
            
        ## Clean up or rearrange or cap the split child geometries
        try:
            if float(len(lst_child)) < 1. or lst_child == [None] or lst_child == []:
                lst_child = []
            else:
                if not self.is_guid(lst_child[0]): 
                    lst_child_ = map(lambda child: sc.doc.Objects.AddBrep(child), lst_child)
                map(lambda child: rs.CapPlanarHoles(child),lst_child_)
                lst_child = map(lambda child: rs.coercebrep(child),lst_child_)
                if axis == "Z":
                    z_0 = rc.Geometry.AreaMassProperties.Compute(lst_child[0]).Centroid[2]
                    z_1 = rc.Geometry.AreaMassProperties.Compute(lst_child[1]).Centroid[2]    
                    if z_0 > z_1: 
                        tempchild = lst_child.pop(0)
                        lst_child.append(tempchild)
        except Exception as e:
            print "Error @ shape.op_split while formatting children"
            print str(e)#, sys.traceback.tb_lineno 
        
        rs.EnableRedraw(False)
        return lst_child
    def get_boundingbox(self,geom_,cplane_):
        def check_bbpts(b):
            ## check if 3d shape and if first 4 pts at bottom
            if b[0][2] > b[4][2]:
                b_ = b[4:] + b[:4]
                b = b_
            return b
        try:
            bbpts_ = rs.BoundingBox(geom_,cplane_)
            return check_bbpts(bbpts_)
        except Exception as e:
            print "Error @ get_boundingbox"
            print str(e)#sys.exc_traceback.tb_lineno 
    def is_guid(self,geom):
        return type(rs.AddPoint(0,0,0)) == type(geom)     
    def convert_rc(self,dim=None):
        # phase this function out
        try:
            if dim==None: dim = self.dimension
            if dim == "2d":
                if self.is_guid(self.crv):
                    self.crv = rs.coercecurve(self.crv)
                if self.is_guid(self.ext):
                    self.ext = rs.coercebrep(self.ext)
            else:
                if self.is_guid(self.bottom_crv):
                    self.bottom_crv = rs.coercecurve(self.bottom_crv)
            if self.is_guid(self.geom):
                self.geom = rs.coercegeometry(self.geom)
        except Exception as e:
            print "Error @ shape.convert_rc"
            print str(e)#sys.exc_traceback.tb_lineno 
    def convert_guid(self,dim='2d'):
        # phase this out
        try:
            if dim == "2d":
                if not self.is_guid(self.crv):
                    self.crv = sc.doc.Objects.AddCurve(self.crv)
                if not self.is_guid(self.ext):
                    self.ext = sc.doc.Objects.AddBrep(self.ext)
            else:
                if self.bottom_crv and not self.is_guid(self.bottom_crv):
                    self.bottom_crv = sc.doc.Objects.AddCurve(self.bottom_crv)
            if not self.is_guid(self.geom):
                self.geom = sc.doc.Objects.AddBrep(self.geom)
        except Exception as e:
            print "Error @ shape.convert_guid"
            print str(e)#sys.exc_traceback.tb_lineno 
    def get_bottom(self,g,refpt,tol=0.1):
        ## Extract curves from brep according to input cpt lvl
        try:
            if g == None: g = self.geom
            if self.is_guid(refpt): refpt = rs.coerce3dpoint(refpt)
            if self.is_guid(g): g = rs.coercebrep(g)
            plane = rc.Geometry.Plane(refpt,rc.Geometry.Vector3d(0,0,1))
            crvs = g.CreateContourCurves(g,plane)
            return crvs[0]
        except Exception as e:
            print "Error @ shape.get_bottom"
            print str(e)#sys.exc_traceback.tb_lineno 
    def check_region(self,crvA,crvB=None,tol=0.1):
            """
            Disjoint    0    There is no common area between the two regions.
            Intersect   1    The two curves intersect. There is therefore no full containment relationship either way.
            AInsideB    2    Region bounded by curveA (first curve) is inside of curveB (second curve).
            BInsideA    3    Region bounded by curveB (second curve) is inside of curveA (first curve).
            """
            disjoint = rc.Geometry.RegionContainment.Disjoint 
            #add the rest
            if crvB == None:
                crvB = self.bottom_crv
            if self.is_guid(crvB):
               crvB = rs.coercecurve(crvB)
            if self.is_guid(crvA):
                crvA = rs.coercecurve(crvA) 
            refplane = self.cplane
            setrel = rc.Geometry.Curve.PlanarClosedCurveRelationship (crvA,crvB,refplane,tol)
            if disjoint == setrel:
                return 0
            else:
                return 1
    def set_base_matrix(self,crv=None):
        ## Breaks up geometry into:
        ##[ [[vector1a,vector1b],  // line 1
        ##   [vector2a,vector2b],  // line 2
        ##          ....
        ##   [vectorna, vectornb]] // line n
        ## topological ordering preserved
        ## direction counterclockwise
        ## but can start from anywhere!
        #debug = sc.sticky['debug']
        if self.base_matrix == None:
            if crv == None:
                crv = self.bottom_crv
            if not self.is_guid(crv):
                crv = rs.coercecurve(crv)
            segments = crv.DuplicateSegments()
            matrix = []
            for i in xrange(len(segments)):
                segment = segments[i]
                nc = segment.ToNurbsCurve()
                end_pts = [nc.Points[i_].Location for i_ in xrange(nc.Points.Count)]
                matrix.append(end_pts) 
            self.base_matrix = matrix
        return self.base_matrix
    def get_shape_axis(self,crv=None):
        def helper_group_parallel(AL):
            ## Identifies parallel lines and groups them
            lop = []
            CULLDICT = {}
            for i,v in enumerate(AL):
                refdist = rs.Distance(v[0],v[1])
                refdir = v[1] - v[0]
                power_lst = []
                if i < len(AL)-1 and not CULLDICT.has_key(refdist):
                    power_lst.append(refdist)
                    AL_ = AL[i+1:]
                    for v_ in AL_:
                        currdist = rs.Distance(v_[0],v_[1])
                        currdir = v_[1] - v_[0]
                        if currdir.IsParallelTo(refdir) != 0 and not CULLDICT.has_key(currdist):
                            power_lst.append(currdist)
                            CULLDICT[currdist] = True
                if power_lst:
                    power_lst.sort(reverse=True)
                    power_num = reduce(lambda x,y: x+y,power_lst)
                else:
                    power_num = 0
                lop.append(power_num)
            return lop
        
        ### Purpose: Input 2d planar curve
        ### and return list of vector axis based
        ### on prominence
        debug = sc.sticky['debug']
        try:
            if crv==None:
                crv = self.bottom_crv
            axis_matrix = self.set_base_matrix(crv)
            axis_power_lst = helper_group_parallel(axis_matrix)
            pa_index = axis_power_lst.index(max(axis_power_lst))
            pa_vector = axis_matrix[pa_index][1]-axis_matrix[pa_index][0]
            self.primary_axis_vector = pa_vector
            return self.primary_axis_vector
        except Exception as e:
            print "Error @ shape.get_shape_axis"
            print str(e)#sys.exc_traceback.tb_lineno 
    def get_cplane_advanced(self,g):
        def helper_define_axis_pts(primary_vec):
            ##(origin,x,y)
            o_pt_ = rc.Geometry.Point3d(0,0,0)
            y_pt_ = primary_vec
            z_pt_ = rc.Geometry.Vector3d(0,0,1)
            ## construct x_pt_ using the communitive property of crossproduct
            x_pt_ = rc.Geometry.Vector3d.CrossProduct(y_pt_,z_pt_)
            
            return o_pt_,x_pt_,y_pt_
        try:
            if self.is_guid(g):
                brep = rs.coercebrep(g)
            else: brep = g
            debug = sc.sticky['debug']
            ## Get primary axis
            nc = self.bottom_crv.ToNurbsCurve()
            planar_pts = [nc.Points[i].Location for i in xrange(nc.Points.Count)]
            primary_axis_vector = self.get_shape_axis(self.bottom_crv)
            o_pt,x_pt,y_pt = helper_define_axis_pts(primary_axis_vector)
            cplane = rc.Geometry.Plane(o_pt,x_pt,y_pt)
            return cplane
        except Exception as e:
            print "Error @ shape.get_cplane_advanced"
            print str(e)#sys.exc_traceback.tb_lineno 
    def check_colinear_pt(self,crv,testpt,tol=0.01):
        ## May need to swap with own method
        dist = ghcomp.CurveClosestPoint(testpt,crv)[2]
        IsColinear = True if abs(dist-0.)<tol else False
        return IsColinear
    def get_area(self):
        try:
            area_crv = self.bottom_crv if self.dimension == '3d' else self.crv
            if self.is_guid(area_crv):area_crv = rs.coercecurve(area_crv)
            try:
                area = rc.Geometry.AreaMassProperties.Compute(area_crv).Area
            except Exception as e:
                print e
                area = self.x_dist * self.y_dist
            self.area = area
            return area
        except Exception as e:
            print "Error @ shape.get_area"
            print str(e)#sys.exc_traceback.tb_lineno 
    def get_long_short_axis(self):
        if (self.x_dist > self.y_dist): 
            long_dist,short_dist = self.x_dist,self.y_dist
            long_axis,short_axis = 'EW','NS'
        else:
            long_dist,short_dist = self.y_dist,self.x_dist
            long_axis,short_axis = 'NS','EW'
        return long_axis,long_dist,short_axis,short_dist
    def op_extrude(self,z_dist,curve=None):
        debug = sc.sticky['debug']
        try:
            returnflag = True 
            if curve == None:
                curve = rs.coercecurve(self.bottom_crv) if self.is_guid(self.bottom_crv) else self.bottom_crv
                returnflag = True
            ext = rc.Geometry.Extrusion.Create(curve,z_dist,True)
            ## check if extruded correct dir
            refcpt = rc.Geometry.AreaMassProperties.Compute(ext).Centroid
            v = rc.Geometry.Vector3d(0,0,1)
            if z_dist > 0.:
                if refcpt[2] < self.cpt[2]:
                    #print 'move up'
                    ext.Translate(0.,0.,z_dist)
            else: 
                if refcpt[2] > self.cpt[2]:
                    #print 'move down'
                    ext.Translate(0.,0.,z_dist*-1)
            brep = ext.ToBrep()
            #if returnflag == False:
            #    return brep
            if True:#else:
                self.geom = brep
                self.reset(xy_change=False)
        except Exception as e:
            print "Error @ Shape_3D.op_extrude"
            print str(e)#sys.exc_traceback.tb_lineno 
    def op_offset_crv(self,dim,curve=None,count=0,refcpt = None,corner=1):
        #print 'count: ', count, 'dim: ', dim
        if count > 5. or abs(dim-0.)<=0.1:
            return None
        else: 
            try:    
                if not curve:
                    curve = copy.copy(self.bottom_crv)
                if not self.is_guid(curve):
                    curve = sc.doc.Objects.AddCurve(curve)            
                if not refcpt: 
                    refcpt = rs.CurveAreaCentroid(curve)[0]
                offcurve = rs.OffsetCurve(rs.CopyObject(curve),refcpt,dim,None,corner)
                #print 'offcurve', offcurve
                if not offcurve or len(offcurve) > 1: 
                    dim -= 1.
                    count += 1
                    return self.op_offset_crv(dim,curve,count,refcpt,corner)
                else:
                    return offcurve[0] 
            except Exception as e:
                print "Error @ Shape_3D.op_offset_crv"
                print str(e)#sys.exc_traceback.tb_lineno 
    def op_offset(self,dim,curve,dir="courtyard",useoffcrv=False):
        try:
            rs.EnableRedraw(False)
            shapecurve = self.bottom_crv
            abort = False
            if not self.is_guid(curve):
                curve = sc.doc.Objects.AddCurve(curve)            
            if self.is_guid(shapecurve):
                shapecurve = rs.coercegeometry(rs.CopyObject(shapecurve))
            #curve = "let's break this fucker."
            cpt = rs.CurveAreaCentroid(curve)[0]
            #style[opt] = the corner style
            #0 = None, 1 = Sharp, 2 = Round, 3 = Smooth, 4 = Chamfer
            copy_curve = rs.CopyObject(curve)
            if not useoffcrv:
                check_curve = self.op_offset_crv(dim,copy_curve,0,refcpt=cpt)
            else: check_curve = copy_curve
        
            if check_curve:
                if self.is_guid(check_curve): 
                    offcurve = rs.coercecurve(check_curve)
                else:
                    offcurve = check_curve
            else:
                print 'courtyard/terrace offset failed'
                diff_geom = None
                abort = True
            if dir=="courtyard" and not abort:
                ht = self.z_dist * 2.5
                geom = copy.copy(self.geom)
                geom = rs.coercegeometry(geom)
                diff_geom = rc.Geometry.Extrusion.Create(offcurve,ht,True)
                #diff_geom = sc.doc.Objects.AddBrep(rs.coercebrep(ext))
                diff_geom = rs.coercebrep(diff_geom)
            elif dir=="terrace" and not abort:
                ht = self.z_dist+1.
                offgeom = rc.Geometry.Extrusion.Create(offcurve,self.z_dist,True)
                offgeom = sc.doc.Objects.AddBrep(rs.coercebrep(offgeom))
                ext = rc.Geometry.Extrusion.Create(shapecurve,ht,True)
                diff_geom = sc.doc.Objects.AddBrep(rs.coercebrep(ext))
            elif dir=="terrace_3d" and not abort:
                ht = self.z_dist+1.
                offgeom = rc.Geometry.Extrusion.Create(offcurve,self.z_dist,True)
                offgeom = rs.coercebrep(offgeom)
                geom = copy.copy(self.geom)
                geom = rs.coercebrep(geom)
                ext = rc.Geometry.Extrusion.Create(shapecurve,ht,True)
                diff_geom = sc.doc.Objects.AddBrep(rs.coercebrep(ext))
            #if dir == "courtyard":
                #print diff_geom
            if not abort:
                try:
                    #if True:
                    if dir=="courtyard":
                        booldiff = rc.Geometry.Brep.CreateBooleanDifference(geom,diff_geom,TOL)
                        if len(booldiff) > 1:
                            self.geom = booldiff
                        elif len(booldiff) > 0:
                            self.geom = booldiff[0]
                    elif dir=="terrace":
                        booldiff = rs.BooleanIntersection(diff_geom,offgeom,True)
                        #booldiff = map(lambda c: rs.coercegeometry(c),booldiff)
                        if len(booldiff)>0.1:
                            self.geom = booldiff[0]
                    elif dir=="terrace_3d":
                        booldiff = rc.Geometry.Brep.CreateBooleanIntersection(geom,offgeom,TOL)
                        booldiff = map(lambda c: sc.doc.Objects.AddBrep(c),booldiff)
                        diff_geom = offgeom
                        if len(booldiff) > 1:
                            self.geom = booldiff
                        elif len(booldiff)> 0.1:
                            self.geom = booldiff[0]
                    self.reset()
                except Exception,e: 
                    print str(e)#sys.exc_traceback.tb_lineno 
                    print 'fail op_offset'
            rs.EnableRedraw(True)
            return diff_geom
        except Exception as e:
            print 'Error @ Shape_3D.op_offset'
            print str(e)#sys.exc_traceback.tb_l          
    

if True:
    sc.sticky["Shape_3D"] = Shape_3D
# ---------- end bibil ----------
# BIBIL_BIBIL
bibil_2 = PythonScript()  # -> o
# ---------- bibil_2: Python ----------
"""
Created on Jun 6, 2016
author: Saeran Vasanthakumar
"""

import scriptcontext as sc

##Phase this out and replace with type dictionary data

class Grammar:
    """ Parent Shape Grammar """
    ## WIll phase this out and swap with Pattern eventually   
    def __init__(self,shape):
        self.shape = shape
        self.type = {'label':None,'axis':"NS",'ratio':0.,'print':False}

TOL = sc.doc.ModelAbsoluteTolerance
if True:
    sc.sticky["Grammar"] = Grammar
# ---------- end bibil_2 ----------
bibil_3 = PythonScript()  # -> o
# ---------- bibil_3: Python ----------
"""
Created on Jun 6, 2016
@author: Saeran Vasanthakumar
"""

import rhinoscriptsyntax as rs
import Rhino as rc
import math
import ghpythonlib.components as ghcomp
import copy
import scriptcontext as sc

TOL = sc.doc.ModelAbsoluteTolerance



class Shape_3D:
    """
    Parent shape operations and information
    """
    TOL = sc.doc.ModelAbsoluteTolerance
    
    def __init__(self,geom=None,cplane=None):
        self.geom = geom
        self.cplane = cplane
        self.north = rs.VectorCreate([0,1,0],[0,0,0])
        self.area = None
        self.dimension = '3d'
        self.bottom_crv = None
        self.primary_axis_vector = None
        self.base_matrix = None
        #try:
        self.reset(xy_change=True)
        #except Exception as e:
        #    print str(e), "Error at Shape.reset()"
    def reset(self,xy_change=True):
        def get_dim_bbox(b):
            ## counterclockwise, start @ bottom SW  
            #      n_wt
            #      -----
            #      |   |
            # w_ht |   | e_ht = y_dist
            #      |   |
            #      -----
            #     s_wt = x_dist
            """    self.s_wt,self.e_ht,self.n_wt,self.w_ht """
            return b[:2],b[1:3],b[2:4],[b[3],b[0]]
            
            
        # primary edges
        if xy_change == True:
            try:
                self.bottom_crv = self.get_bottom(self.geom,self.get_boundingbox(self.geom,None)[0])
            except Exception as e:
                #print str(e)##sys.exc_traceback.tb_lineno 
                self.bottom_crv = None
            try:
                if self.cplane == None:
                    self.cplane = self.get_cplane_advanced(self.geom)
                self.primary_axis_vector = self.cplane.YAxis
            except Exception as e:
                #print str(e)##sys.exc_traceback.tb_lineno 
                self.cplane, self.primary_axis_vector = None, None
            try:
                self.bbpts = self.get_boundingbox(self.geom,self.cplane)
                self.s_wt,self.e_ht,self.n_wt,self.w_ht = get_dim_bbox(self.bbpts)
                self.ew_vector = self.n_wt[1]-self.n_wt[0]
                self.ns_vector = self.e_ht[1]-self.e_ht[0]
                """
                print 'check ew'
                print self.primary_axis_vector.IsParallelTo(self.ew_vector)
                print self.primary_axis_vector.IsPerpendicularTo(self.ew_vector)
                print ''
                """
                # x,y,z distances
                self.x_dist = float(rs.Distance(self.s_wt[0],self.s_wt[1]))
                self.y_dist = float(rs.Distance(self.e_ht[0],self.e_ht[1]))
                self.area = None
            except Exception as e:
                #print str(e)
                self.bbpts,self.s_wt,self.e_ht,self.n_wt,self.w_ht = None, None, None, None, None 
            try:
                bp = self.bbpts
                self.cpt = rc.Geometry.AreaMassProperties.Compute(self.bottom_crv).Centroid
            except Exception as e:
                #print str(e)#sys.exc_traceback.tb_lineno 
                self.cpt = None
        try:# curve profile info
            if xy_change == False:
                self.bbpts = self.get_boundingbox(self.geom,self.cplane)
            self.ht = float(self.bbpts[4][2])
            self.z_dist = float(float(self.bbpts[4][2]) - self.cpt[2])
        except Exception as e:
            #print str(e)#sys.exc_traceback.tb_lineno 
            self.ht, self.z_dist = None, None
    def calculate_ratio_from_dist(self,axis,dist,dir=0.):
        # Direction of cut   
        # Long axis: YAxis
        # 1.0 ^
        #     |   
        # 0.5 ^ w_ht = y_dist  
        #     |   
        # 0.0 ->->->->->->->
        #     0.0  0.5   1.0
        #  s_wt = x_dist
        
        ## dir: 0 = cut dist from bottom 
        ## dir: 1 = cut dist from top
        ## test1: 25m/100m
        ## if dir == 0: ratio = 0.25
        ## if dir == 1: ratio = 0.75
        ## test2: 75m/100m
        ## if dir == 0: ratio = 0.75
        ## if dir == 1: ratio = 0.25
        if "NS" in axis:
            total_dist = self.x_dist
        else:# if "EW" in axis:
            total_dist = self.y_dist
        # Cut from bottom
        ratio = dist/float(total_dist)
        # Cut from top
        if dir > 0.5: 
            ratio = 1. - ratio
        return ratio
    def vector2axis(self,ref_vector):
        ## Compare ref_vector with shape axis, and return
        ## closest shape axis
        ew_axis = self.n_wt[1]-self.n_wt[0]
        ns_axis = self.e_ht[1]-self.e_ht[0]
        ## unitize
        ref_vector.Unitize()
        ew_axis.Unitize()
        ns_axis.Unitize()
        ew_dotprod = rc.Geometry.Vector3d.Multiply(ew_axis,ref_vector)
        ns_dotprod = rc.Geometry.Vector3d.Multiply(ns_axis,ref_vector)
        ## Greater the dot product, closer it is to 90
        cutaxis = "NS" if abs(ew_dotprod) < abs(ns_dotprod) else "EW"
        return cutaxis
    def op_split(self,axis,ratio,deg=0.,split_depth=0,split_line_ref=None):
        """
        op_split: self, ratio -> (list of geom)
        Splits original geom into two
        """
        debug = sc.sticky['debug']
        def helper_make_split_surf_z(ratio_):
            try:
                zht = ratio_ * self.z_dist
                splitptlst = self.bbpts[:4]+[self.bbpts[0]]
                splitptlst = map(lambda b:rc.Geometry.Point3d(b[0],b[1],b[2]+zht),splitptlst)
                splitcurve = rc.Geometry.Curve.CreateControlPointCurve(splitptlst,1)
                split_surf_ = rc.Geometry.Brep.CreatePlanarBreps(splitcurve)[0]
                return split_surf_
            except Exception as e:
                print "Error @ shape.helper_make_split_srf_z"
                print str(e)#sys.exc_traceback.tb_lineno 
        def helper_make_split_line_xy(ratio_,degree,ref_shape=None):
            debug = sc.sticky['debug']
            try:
                if ref_shape:
                    s_wt,n_wt = ref_shape.s_wt,ref_shape.n_wt
                    e_ht,w_ht = ref_shape.e_ht,ref_shape.w_ht
                    x_dist,y_dist = ref_shape.x_dist,ref_shape.y_dist
                else:
                    s_wt,n_wt = self.s_wt,self.n_wt
                    e_ht,w_ht = self.e_ht,self.w_ht
                    x_dist,y_dist = self.x_dist,self.y_dist
                    
                if axis == "NS":
                    edge_0, edge_1 = s_wt, n_wt
                    dist = ratio_* x_dist
                else:#if axis == "EW"
                    edge_0, edge_1 = e_ht, w_ht
                    dist = ratio_* y_dist
                    
                ### helper geom that splits box
                line_0 = rs.AddLine(edge_0[0],edge_0[1])
                line_1 = rs.AddLine(edge_1[1],edge_1[0])
                # ^flip because counterclockwise
                mid_0 = rs.DivideCurveLength(line_0,dist,True,True)[1]
                mid_1 = rs.DivideCurveLength(line_1,dist,True,True)[1]            
                split_line = rs.AddCurve([mid_0,mid_1],1)
                if float(degree) > 0.5:
                    cpt = rs.DivideCurve(split_line,2,True,True)[1] 
                    split_line = rs.RotateObject(split_line,cpt,degree)
                sc_ = 3,3,3
                line_cpt = rs.DivideCurve(split_line,2)[1]
                split_line_sc = rs.ScaleObject(split_line,line_cpt,sc_)
                return split_line_sc
            except Exception as e:
                adskflajkl
                pass#print "Error @ shape.helper_make_split_srf_xy"
                #print str(e)#sys.exc_traceback.tb_lineno 
        def helper_make_split_surf(split_line_):
            if self.ht < 1: 
                ht = 1.
            else: 
                ht = self.ht
            split_path = rs.AddCurve([[0,0,0],[0,0,ht*2]],1)    
            split_surf = rs.coercebrep(rs.ExtrudeCurve(split_line_,split_path))
            return split_surf
        def helper_get_split_line_surf(ratio_,axis_,deg_,split_line_ref_):
            split_line_, split_surf_ = None,None
            if split_line_ref_ != None:
                ## Check if Closed curve
                if type(self) == type(split_line_ref_):
                    split_line_ = helper_make_split_line_xy(ratio_,deg_,ref_shape=split_line_ref_)
                else:
                    split_line_ = split_line_ref_
                #debug.append(split_line_)
                split_surf_ = helper_make_split_surf(split_line_)
            elif axis_ == "Z":
                split_surf_ = helper_make_split_surf_z(ratio_)
            else:
                split_line_ = helper_make_split_line_xy(ratio_,deg_)
                split_surf_ = helper_make_split_surf(split_line_)           
            return split_line_, split_surf_
        
        rs.EnableRedraw(False)
        split_line,split_surf = helper_get_split_line_surf(ratio,axis,deg,split_line_ref)
        try:#if True:
            ## For split_depth == 0.
            if split_depth <= 0.1:
                geom = rs.coercebrep(self.geom) if self.is_guid(self.geom) else self.geom 
                lst_child = geom.Split(split_surf,TOL)
            ## For split_depth > 0.
            else:
                if self.z_dist < 0.09:
                    print 'not a 3d geom, therefore will not split'
                # vec transformation
                if self.is_guid(split_line):
                    split_line = rs.coercecurve(split_line)
                nc = split_line.ToNurbsCurve()
                end_pts = [nc.Points[i_].Location for i_ in xrange(nc.Points.Count)]
                dir_vector = end_pts[1] - end_pts[0]
                z_vector = rs.VectorCreate([0,0,0],[0,0,1])
                # create forward and backwards vector using crossproduct
                normal_f = rs.VectorCrossProduct(dir_vector,z_vector)
                normal_b = rs.VectorCrossProduct(z_vector,dir_vector) 
                
                sc_ = split_depth,split_depth,split_depth
                
                normal_f.Unitize()
                normal_b.Unitize()
                normal_b = map(lambda v: v*split_depth/2.,normal_b)
                
                c = rs.AddCurve([rs.AddPoint(0,0,0),rs.AddPoint(normal_f[0],normal_f[1],normal_f[2])],0)
                c = rs.ScaleObject(c,rs.AddPoint(0,0,0),sc_)
                rc_cut = rs.ExtrudeSurface(split_surf,c)
                rc_cut = rs.MoveObject(rc_cut,normal_b)
                #debug.append(rc_cut)
                #debug.append(split_surf)
                lst_child = []
                rc_geom,rc_cut = rs.coercebrep(self.geom),rs.coercebrep(rc_cut)
                #ghcomp.Flip(rc_cut,sc.sticky['surface_ref'])[0]
                geom_childs = rc.Geometry.Brep.CreateBooleanDifference(rc_geom,rc_cut,TOL)
                lst_child.extend(geom_childs)
        except Exception as e:
            print "Error @ shape.op_split while splitting"
            print str(e)#, sys.traceback.tb_lineno 
            
        ## Clean up or rearrange or cap the split child geometries
        try:
            if float(len(lst_child)) < 1. or lst_child == [None] or lst_child == []:
                lst_child = []
            else:
                if not self.is_guid(lst_child[0]): 
                    lst_child_ = map(lambda child: sc.doc.Objects.AddBrep(child), lst_child)
                map(lambda child: rs.CapPlanarHoles(child),lst_child_)
                lst_child = map(lambda child: rs.coercebrep(child),lst_child_)
                if axis == "Z":
                    z_0 = rc.Geometry.AreaMassProperties.Compute(lst_child[0]).Centroid[2]
                    z_1 = rc.Geometry.AreaMassProperties.Compute(lst_child[1]).Centroid[2]    
                    if z_0 > z_1: 
                        tempchild = lst_child.pop(0)
                        lst_child.append(tempchild)
        except Exception as e:
            print "Error @ shape.op_split while formatting children"
            print str(e)#, sys.traceback.tb_lineno 
        
        rs.EnableRedraw(False)
        return lst_child
    def get_boundingbox(self,geom_,cplane_):
        def check_bbpts(b):
            ## check if 3d shape and if first 4 pts at bottom
            if b[0][2] > b[4][2]:
                b_ = b[4:] + b[:4]
                b = b_
            return b
        try:
            bbpts_ = rs.BoundingBox(geom_,cplane_)
            return check_bbpts(bbpts_)
        except Exception as e:
            print "Error @ get_boundingbox"
            print str(e)#sys.exc_traceback.tb_lineno 
    def is_guid(self,geom):
        return type(rs.AddPoint(0,0,0)) == type(geom)     
    def convert_rc(self,dim=None):
        # phase this function out
        try:
            if dim==None: dim = self.dimension
            if dim == "2d":
                if self.is_guid(self.crv):
                    self.crv = rs.coercecurve(self.crv)
                if self.is_guid(self.ext):
                    self.ext = rs.coercebrep(self.ext)
            else:
                if self.is_guid(self.bottom_crv):
                    self.bottom_crv = rs.coercecurve(self.bottom_crv)
            if self.is_guid(self.geom):
                self.geom = rs.coercegeometry(self.geom)
        except Exception as e:
            print "Error @ shape.convert_rc"
            print str(e)#sys.exc_traceback.tb_lineno 
    def convert_guid(self,dim='2d'):
        # phase this out
        try:
            if dim == "2d":
                if not self.is_guid(self.crv):
                    self.crv = sc.doc.Objects.AddCurve(self.crv)
                if not self.is_guid(self.ext):
                    self.ext = sc.doc.Objects.AddBrep(self.ext)
            else:
                if self.bottom_crv and not self.is_guid(self.bottom_crv):
                    self.bottom_crv = sc.doc.Objects.AddCurve(self.bottom_crv)
            if not self.is_guid(self.geom):
                self.geom = sc.doc.Objects.AddBrep(self.geom)
        except Exception as e:
            print "Error @ shape.convert_guid"
            print str(e)#sys.exc_traceback.tb_lineno 
    def get_bottom(self,g,refpt,tol=0.1):
        ## Extract curves from brep according to input cpt lvl
        try:
            if g == None: g = self.geom
            if self.is_guid(refpt): refpt = rs.coerce3dpoint(refpt)
            if self.is_guid(g): g = rs.coercebrep(g)
            plane = rc.Geometry.Plane(refpt,rc.Geometry.Vector3d(0,0,1))
            crvs = g.CreateContourCurves(g,plane)
            return crvs[0]
        except Exception as e:
            print "Error @ shape.get_bottom"
            print str(e)#sys.exc_traceback.tb_lineno 
    def check_region(self,crvA,crvB=None,tol=0.1):
            """
            Disjoint    0    There is no common area between the two regions.
            Intersect   1    The two curves intersect. There is therefore no full containment relationship either way.
            AInsideB    2    Region bounded by curveA (first curve) is inside of curveB (second curve).
            BInsideA    3    Region bounded by curveB (second curve) is inside of curveA (first curve).
            """
            disjoint = rc.Geometry.RegionContainment.Disjoint 
            #add the rest
            if crvB == None:
                crvB = self.bottom_crv
            if self.is_guid(crvB):
               crvB = rs.coercecurve(crvB)
            if self.is_guid(crvA):
                crvA = rs.coercecurve(crvA) 
            refplane = self.cplane
            setrel = rc.Geometry.Curve.PlanarClosedCurveRelationship (crvA,crvB,refplane,tol)
            if disjoint == setrel:
                return 0
            else:
                return 1
    def set_base_matrix(self,crv=None):
        ## Breaks up geometry into:
        ##[ [[vector1a,vector1b],  // line 1
        ##   [vector2a,vector2b],  // line 2
        ##          ....
        ##   [vectorna, vectornb]] // line n
        ## topological ordering preserved
        ## direction counterclockwise
        ## but can start from anywhere!
        #debug = sc.sticky['debug']
        if self.base_matrix == None:
            if crv == None:
                crv = self.bottom_crv
            if not self.is_guid(crv):
                crv = rs.coercecurve(crv)
            segments = crv.DuplicateSegments()
            matrix = []
            for i in xrange(len(segments)):
                segment = segments[i]
                nc = segment.ToNurbsCurve()
                end_pts = [nc.Points[i_].Location for i_ in xrange(nc.Points.Count)]
                matrix.append(end_pts) 
            self.base_matrix = matrix
        return self.base_matrix
    def get_shape_axis(self,crv=None):
        def helper_group_parallel(AL):
            ## Identifies parallel lines and groups them
            lop = []
            CULLDICT = {}
            for i,v in enumerate(AL):
                refdist = rs.Distance(v[0],v[1])
                refdir = v[1] - v[0]
                power_lst = []
                if i < len(AL)-1 and not CULLDICT.has_key(refdist):
                    power_lst.append(refdist)
                    AL_ = AL[i+1:]
                    for v_ in AL_:
                        currdist = rs.Distance(v_[0],v_[1])
                        currdir = v_[1] - v_[0]
                        if currdir.IsParallelTo(refdir) != 0 and not CULLDICT.has_key(currdist):
                            power_lst.append(currdist)
                            CULLDICT[currdist] = True
                if power_lst:
                    power_lst.sort(reverse=True)
                    power_num = reduce(lambda x,y: x+y,power_lst)
                else:
                    power_num = 0
                lop.append(power_num)
            return lop
        
        ### Purpose: Input 2d planar curve
        ### and return list of vector axis based
        ### on prominence
        debug = sc.sticky['debug']
        try:
            if crv==None:
                crv = self.bottom_crv
            axis_matrix = self.set_base_matrix(crv)
            axis_power_lst = helper_group_parallel(axis_matrix)
            pa_index = axis_power_lst.index(max(axis_power_lst))
            pa_vector = axis_matrix[pa_index][1]-axis_matrix[pa_index][0]
            self.primary_axis_vector = pa_vector
            return self.primary_axis_vector
        except Exception as e:
            print "Error @ shape.get_adfsdfshape_axis"
            print sys.exc_traceback.tb_lineno 
    def get_cplane_advanced(self,g):
        def helper_define_axis_pts(primary_vec):
            ##(origin,x,y)
            o_pt_ = rc.Geometry.Point3d(0,0,0)
            y_pt_ = primary_vec
            z_pt_ = rc.Geometry.Vector3d(0,0,1)
            ## construct x_pt_ using the communitive property of crossproduct
            x_pt_ = rc.Geometry.Vector3d.CrossProduct(y_pt_,z_pt_)
            
            return o_pt_,x_pt_,y_pt_
        try:
            if self.is_guid(g):
                brep = rs.coercebrep(g)
            else: brep = g
            debug = sc.sticky['debug']
            ## Get primary axis
            nc = self.bottom_crv.ToNurbsCurve()
            planar_pts = [nc.Points[i].Location for i in xrange(nc.Points.Count)]
            primary_axis_vector = self.get_shape_axis(self.bottom_crv)
            o_pt,x_pt,y_pt = helper_define_axis_pts(primary_axis_vector)
            cplane = rc.Geometry.Plane(o_pt,x_pt,y_pt)
            return cplane
        except Exception as e:
            print "Error @ shape.get_cplane_advanced"
            
            
    def check_colinear_pt(self,crv,testpt,tol=0.01):
        ## May need to swap with own method
        dist = ghcomp.CurveClosestPoint(testpt,crv)[2]
        IsColinear = True if abs(dist-0.)<tol else False
        return IsColinear
    def get_area(self):
        try:
            area_crv = self.bottom_crv if self.dimension == '3d' else self.crv
            if self.is_guid(area_crv):area_crv = rs.coercecurve(area_crv)
            try:
                area = rc.Geometry.AreaMassProperties.Compute(area_crv).Area
            except Exception as e:
                print e
                area = self.x_dist * self.y_dist
            self.area = area
            return area
        except Exception as e:
            print "Error @ shape.get_area"
            print str(e)#sys.exc_traceback.tb_lineno 
    def get_long_short_axis(self):
        if (self.x_dist > self.y_dist): 
            long_dist,short_dist = self.x_dist,self.y_dist
            long_axis,short_axis = 'EW','NS'
        else:
            long_dist,short_dist = self.y_dist,self.x_dist
            long_axis,short_axis = 'NS','EW'
        return long_axis,long_dist,short_axis,short_dist
    def op_extrude(self,z_dist,curve=None):
        debug = sc.sticky['debug']
        try:
            returnflag = True 
            if curve == None:
                curve = rs.coercecurve(self.bottom_crv) if self.is_guid(self.bottom_crv) else self.bottom_crv
                returnflag = True
            ext = rc.Geometry.Extrusion.Create(curve,z_dist,True)
            ## check if extruded correct dir
            refcpt = rc.Geometry.AreaMassProperties.Compute(ext).Centroid
            v = rc.Geometry.Vector3d(0,0,1)
            if z_dist > 0.:
                if refcpt[2] < self.cpt[2]:
                    #print 'move up'
                    ext.Translate(0.,0.,z_dist)
            else: 
                if refcpt[2] > self.cpt[2]:
                    #print 'move down'
                    ext.Translate(0.,0.,z_dist*-1)
            brep = ext.ToBrep()
            #if returnflag == False:
            #    return brep
            if True:#else:
                self.geom = brep
                self.reset(xy_change=False)
        except Exception as e:
            print "Error @ Shape_3D.op_extrude"
            print str(e)#sys.exc_traceback.tb_lineno 
    def op_offset_crv(self,dim,curve=None,count=0,refcpt = None,corner=1):
        #print 'count: ', count, 'dim: ', dim
        if count > 5. or abs(dim-0.)<=0.1:
            return None
        else: 
            try:    
                if not curve:
                    curve = copy.copy(self.bottom_crv)
                if not self.is_guid(curve):
                    curve = sc.doc.Objects.AddCurve(curve)            
                if not refcpt: 
                    refcpt = rs.CurveAreaCentroid(curve)[0]
                offcurve = rs.OffsetCurve(rs.CopyObject(curve),refcpt,dim,None,corner)
                #print 'offcurve', offcurve
                if not offcurve or len(offcurve) > 1: 
                    dim -= 1.
                    count += 1
                    return self.op_offset_crv(dim,curve,count,refcpt,corner)
                else:
                    return offcurve[0] 
            except Exception as e:
                print "Error @ Shape_3D.op_offset_crv"
                print str(e)#sys.exc_traceback.tb_lineno 
    def op_offset(self,dim,curve,dir="courtyard",useoffcrv=False):
        try:
            rs.EnableRedraw(False)
            shapecurve = self.bottom_crv
            abort = False
            if not self.is_guid(curve):
                curve = sc.doc.Objects.AddCurve(curve)            
            if self.is_guid(shapecurve):
                shapecurve = rs.coercegeometry(rs.CopyObject(shapecurve))
            #curve = "let's break this fucker."
            cpt = rs.CurveAreaCentroid(curve)[0]
            #style[opt] = the corner style
            #0 = None, 1 = Sharp, 2 = Round, 3 = Smooth, 4 = Chamfer
            copy_curve = rs.CopyObject(curve)
            if not useoffcrv:
                check_curve = self.op_offset_crv(dim,copy_curve,0,refcpt=cpt)
            else: check_curve = copy_curve
        
            if check_curve:
                if self.is_guid(check_curve): 
                    offcurve = rs.coercecurve(check_curve)
                else:
                    offcurve = check_curve
            else:
                print 'courtyard/terrace offset failed'
                diff_geom = None
                abort = True
            if dir=="courtyard" and not abort:
                ht = self.z_dist * 2.5
                geom = copy.copy(self.geom)
                geom = rs.coercegeometry(geom)
                diff_geom = rc.Geometry.Extrusion.Create(offcurve,ht,True)
                #diff_geom = sc.doc.Objects.AddBrep(rs.coercebrep(ext))
                diff_geom = rs.coercebrep(diff_geom)
            elif dir=="terrace" and not abort:
                ht = self.z_dist+1.
                offgeom = rc.Geometry.Extrusion.Create(offcurve,self.z_dist,True)
                offgeom = sc.doc.Objects.AddBrep(rs.coercebrep(offgeom))
                ext = rc.Geometry.Extrusion.Create(shapecurve,ht,True)
                diff_geom = sc.doc.Objects.AddBrep(rs.coercebrep(ext))
            elif dir=="terrace_3d" and not abort:
                ht = self.z_dist+1.
                offgeom = rc.Geometry.Extrusion.Create(offcurve,self.z_dist,True)
                offgeom = rs.coercebrep(offgeom)
                geom = copy.copy(self.geom)
                geom = rs.coercebrep(geom)
                ext = rc.Geometry.Extrusion.Create(shapecurve,ht,True)
                diff_geom = sc.doc.Objects.AddBrep(rs.coercebrep(ext))
            #if dir == "courtyard":
                #print diff_geom
            if not abort:
                try:
                    #if True:
                    if dir=="courtyard":
                        booldiff = rc.Geometry.Brep.CreateBooleanDifference(geom,diff_geom,TOL)
                        if len(booldiff) > 1:
                            self.geom = booldiff
                        elif len(booldiff) > 0:
                            self.geom = booldiff[0]
                    elif dir=="terrace":
                        booldiff = rs.BooleanIntersection(diff_geom,offgeom,True)
                        #booldiff = map(lambda c: rs.coercegeometry(c),booldiff)
                        if len(booldiff)>0.1:
                            self.geom = booldiff[0]
                    elif dir=="terrace_3d":
                        booldiff = rc.Geometry.Brep.CreateBooleanIntersection(geom,offgeom,TOL)
                        booldiff = map(lambda c: sc.doc.Objects.AddBrep(c),booldiff)
                        diff_geom = offgeom
                        if len(booldiff) > 1:
                            self.geom = booldiff
                        elif len(booldiff)> 0.1:
                            self.geom = booldiff[0]
                    self.reset()
                except Exception,e: 
                    print str(e)#sys.exc_traceback.tb_lineno 
                    print 'fail op_offset'
            rs.EnableRedraw(True)
            return diff_geom
        except Exception as e:
            print 'Error @ Shape_3D.op_offset'
            print str(e)#sys.exc_traceback.tb_l          
    

if True:
    sc.sticky["Shape_3D"] = Shape_3D
# ---------- end bibil_3 ----------
bibil_4 = PythonScript()  # -> o
# ---------- bibil_4: Python ----------
"""
Created on Jun 6, 2016
@author: Saeran Vasanthakumar
"""

import scriptcontext as sc

class Tree:
    """
    http://stackoverflow.com/questions/14084367/tree-in-python-recursive-children-creating
    http://www.laurentluce.com/posts/binary-search-tree-library-in-python/
    double-linked binary tree
    """
    def __init__(self,data,loc=None,parent=None,sib=None,depth=0):
        self.data = data
        self.data.node = self
        self.data.shape.node = self
        if loc is None: loc = []
        self.loc = loc
        self.parent = parent
        self.sib = sib
        self.depth = depth
        self.root_index = None
        
    def __repr__(self):
        """ http://cbio.ufs.ac.za/live_docs/nbn_tut/trees.html """
        ret = "nd:%s" % (self.depth)#"   "*self.depth+"depth:%s\n" % (self.depth)
        #for child in self.loc:
        #    ret += child.__repr__()
        return ret
    ## def lookup
    def delete_node(self):
        if self is not None:
            self.loc = []
            if self.parent:
                for i,pc in enumerate(self.parent.loc):
                    if self.parent.loc[i] is self: 
                        self.parent.loc.pop(i)
                        break
        self = None
        del self
        
    def get_root(self):
        if self.parent ==  None:
            return self
        else:
            return self.parent.get_root()
    
    def search_up_tree(self,foo):
        """ 
        Backtracks tree, applies function argument to every
        node until parent.
        """
        if foo(self)==True:
            return self
        elif self.parent == None:
            return False
        else:
            return self.parent.search_up_tree(foo)
    
    def backtrack_tree(self,foo):
        def helper_backtrack_tree(node,foo,accumulator):
            accumulator.append(foo(node))
            if node.parent == None:
                return accumulator
            else:
                return helper_backtrack_tree(node.parent,foo,accumulator)
        """ 
        Backtracks tree, applies function argument to every
        node until parent. Use tail-end recurusion
        """
        return helper_backtrack_tree(self,foo,[])
            
    def traverse_tree(self,foo,internal=True):
        """ 
        traverse tree, applies function argument to every
        node, leaf
        """
        if self.loc == []:
            # base case
            return [foo(self)]
        else:
            L = []
            if internal:
                L = [foo(self)] 
            for i,child in enumerate(self.loc):
                if child:
                    L += self.loc[i].traverse_tree(foo,internal)
            return L
            
if True:
    sc.sticky["Tree"] = Tree
# ---------- end bibil_4 ----------
bibil_5 = PythonScript()  # -> o
# ---------- bibil_5: Python ----------
'''
#Created on Jun 6, 2016
#author: Saeran Vasanthakumar
'''
from math import acos,pi
from decimal import Decimal, getcontext

## Set the decimal precision to 30 places.
getcontext().prec = 30

class Vector(object):
    
    CANNOT_NORMALIZE_ZERO_VECTOR_MSG = 'Cannot normalize zero vector'
    NO_UNIQUE_PARALLEL_COMPONENT_MSG = 'No unique parallel component'
    NO_UNIQUE_ORTHOGONAL_COMPONENT_MSG = 'No unique orthogonal component'
    ONLY_DEFINED_IN_TWO_THREE_DIM_MSG = 'Cross product is limited to 2 or 3 dimensions'
    
    def __init__(self, coord):
        try:
            if not coord:
                raise ValueError
            self.coord = tuple(map(lambda c: Decimal(c),coord))
            self.dim = len(coord)
            
        except ValueError:
            ## instantiate a custom instance of ValueError class with cust arg
            raise ValueError('The coordinates must be nonempty')
        except Exception as e: #TypeError:
            print str(e)
            #raise TypeError('The coordinates must be an iterable')
    def __str__(self):
        return str([round(float(c),4) for c in self.coord])
    def __eq__(self, v):
        return self.coord == v.coord
    def plus(self,v):
        newv = map(lambda x: x[0]+x[1],zip(self.coord,v.coord))
        return Vector(newv)
    def minus(self,v):
        newv = map(lambda x: x[0]-x[1],zip(self.coord,v.coord))
        return Vector(newv)
    def times_scalar(self,scalar):
        scalar = Decimal(scalar)
        newv = map(lambda i: i*scalar,self.coord)
        return Vector(newv)
    def magnitude(self):
        ### Purpose: find the magnitude of a vector.
        ### find square root of sum of square of 
        ### change in all coordinates
        mag_lst = map(lambda c: c*c,self.coord) 
        sum_ = reduce(lambda i,j: i+j, mag_lst)
        return sum_**Decimal(.5)
    def normalized(self):
        ### Purpose: find the direction of vector aka 
        ### return the unit vector
        ### divide the vector coordinates by the magnitde
        ### of the vector
        try:
            magnitude = self.magnitude()
            return self.times_scalar(Decimal(1.)/magnitude)
        except ZeroDivisionError:
            ## raise genertic Exception class with custom arg
            raise Exception(self.CANNOT_NORMALIZE_ZERO_VECTOR_MSG)
    def dot_product(self,v):
        ### Purpose: Return dot product of two vectors
        ### v*w = v1*w1 + v2*w2 + .... + vn*wn
        prod_lst = map(lambda i: i[0]*i[1], zip(self.coord,v.coord))
        return reduce(lambda i,j: i+j, prod_lst)
    def angle(self,v,units='deg'):
        ### Purpse: Return angle between two vectors in degrees
        ### theta = arcos(v*w / ||v|*||w||)
        ### OR
        ### theta = arcos(normalized(v)*normalized(w))
        try:
            unitdotprod = self.normalized().dot_product(v.normalized())
            rad = acos(unitdotprod)
            angle = Decimal(rad) if units == 'rad' else Decimal(rad*(180./pi))
            return angle
        except Exception as e:
            ## Pass generic Exception type as e variable 
            ## Check type e to see if cannot normalize zero vector error
            if self.CANNOT_NORMALIZE_ZERO_VECTOR_MSG in e.args:
                ## Other ways of taking out e.args
                print type(e), e.args, e
                ## raise custom exception
                raise Exception('Cannot compute an angle with the zero vector')
            else:
                print 'def angle error', str(e)
    def is_zero(self,tolerance=1e-10):
        return self.magnitude() < tolerance
    def is_parallel(self,v):
        ### Purpose: Checks if vector is parallel
        ### examines if either vector is zero vector (returns True),
        ### checks if abs angle is 0 or 180
        ### returns True; else if all False returns False.
        ### self -> boolean
        return self.is_zero() or v.is_zero()\
        or self.angle(v) == Decimal(0.) \
        or self.angle(v) == Decimal(180.)
    def is_orthogonal(self,v,tolerance=1e-10):
        ### Purpose: Checks if vector is perpendicular
        ### examines if dot product == 0. (cos(theta) == 0
        ### returns True or False
        ### self -> boolean
        return abs(self.dot_product(v)) < tolerance
    def component_projected_to(self,basis):
        ### Purpose: projects self.vector onto basis
        ### vector b; returns projected vector
        ### self, vector -> vector
        ### unitvector(b) x unitvector(b)*vector = proj(vector)
        try:
            unitb = basis.normalized()
            vbdot = unitb.dot_product(self)
            projection_vector = unitb.times_scalar(vbdot)  
            return projection_vector
        except Exception as e:
            if self.CANNOT_NORMALIZE_ZERO_VECTOR_MSG in e.args: 
                raise Exception(self.NO_UNIQUE_PARALLEL_COMPONENT_MSG)
            else:
                raise e
    def component_orthogonal_to(self,basis):
        ### Purpose: Get the perpendicular vector to a
        ### projection on the basis vector
        ### vector - vector_parrallel = vector_perpendicular
        try:
            vector_parrallel = self.component_parallel_to(basis)
            vector_perpendicular = self.minus(vector_parrallel)
            return vector_perpendicular
        except Exception as e:
            if self.NO_UNIQUE_PARALLEL_COMPONENT_MSG in e.args:
                raise Exception(self.NO_UNIQUE_ORTHOGONAL_COMPONENT_MSG)
            else:
                ## Print out e instance which contains more data about error
                raise e
    def cross_product(self,w):
        ### Purpose: Input vector self (v) and vector w,
        ### returns cross product v x w, the vector orthogonal
        ### to both (normal) as determined by right hand rule
        ### this only works for three dimensions
        ### v x w = 
        ### [[y1z2 - y2z1]
        ###  [-(x1z2 - x2z1)]
        ###  [y2x1 - y1x2]]
        try:
            if self.dim == 2:
                self, w = Vector(self.coord.append(0)), Vector(w.coord.append(0))
            x1,y1,z1 = self.coord
            x2,y2,z2 = w.coord
            if self.dim == 3:
                new_coord = [ y1*z2 - y2*z1,
                            -(x1*z2 - x2*z1),
                              x1*y2 - x2*y1]
                return Vector(new_coord)
        except ValueError as e:
            print self.ONLY_DEFINED_IN_TWO_THREE_DIM_MSG
            raise e
            
    def area_of_parallelogram(self,w):
        ### Purpose: Input two vectors in three or two dim
        ### and output the area of paralellogram defined by
        ### both
        ### Formula: ||v x w|| = |v||w||sin(theta) = area of parallelogram
        cross = self.cross_product(w)
        return cross.magnitude()
    def area_of_triangle(self,w):
        ### Purpose: Input two vectors in three or two dim
        ### and output the area of triangle defined by both
        ### Formula: ||v x w|| = |v||w||sin(theta) = area of parallelogram
        return self.area_of_parallelogram(w)/Decimal('2.0')

class MyDecimal(Decimal):
    def is_near_zero(self, eps=1e-10):
        return abs(self) < eps

if True:
    
    ### Vector Tests
    #"""
    ## cross product test
    vector_v = Vector(['4','6','5.5'])#[8.462,7.893,-8.187])
    vector_w = Vector(['6.984','-5.975','4.778'])
    print vector_v.cross_product(vector_w),'\n'
    """
    ## area parallelogram test
    vector_v = Vector([-8.987,-9.838,5.031])
    vector_w = Vector([-4.268,-1.861,-8.866])
    print vector_v.area_of_parallelogram(vector_w),'\n'
    """
    """
    ## vector projection test
    vector_0 = Vector([3.039,1.879])
    vector_1 = Vector([0.825,2.036])
    print vector_0.component_parallel_to(vector_1),'\n'
    ## vector projection perpendicular test
    vector_0 = Vector([-9.88,-3.264,-8.159])
    vector_1 = Vector([-2.155,-9.353,-9.473])
    print vector_0.component_orthogonal_to(vector_1),'\n'
    ## vector addition test
    vector_0 = Vector([3.009,-6.172,3.692,-2.51])
    vector_1 = Vector([6.404,-9.144,2.759,8.718])
    print vector_0.component_parallel_to(vector_1)
    print vector_0.component_orthogonal_to(vector_1)
    """
    """
    ## vector parralel or orthogonal test
    vector_0 = Vector([-7.579,-7.88])
    vector_1 = Vector([22.737,23.64])
    print vector_0.is_parallel(vector_1), vector_0.is_orthogonal(vector_1),'\n'
    vector_0 = Vector([-2.029,9.97,4.172])
    vector_1 = Vector([-9.231,-6.639,-7.245])
    print vector_0.is_parallel(vector_1), vector_0.is_orthogonal(vector_1),'\n'
    vector_0 = Vector([-2.328,-7.284,-1.214])
    vector_1 = Vector([-1.821,1.072,-2.94])
    print vector_0.is_parallel(vector_1), vector_0.is_orthogonal(vector_1),'\n'
    vector_0 = Vector([-2.328,-7.284,-1.214])
    vector_1 = Vector([0,0,0])
    print vector_0.is_parallel(vector_1), vector_0.is_orthogonal(vector_1),'\n'
    """
    """
    ## vector dot product test
    #vector_0 = Vector([7.887,4.138])
    #vector_1 = Vector([-8.802,6.776])
    #vector_ans = vector_0.dot_product(vector_1)
    #print vector_ans,'\n'
    #vector_0 = Vector([-5.955,-4.904,-1.874])
    #vector_1 = Vector([-4.496,-8.755,7.103])
    #vector_ans = vector_0.dot_product(vector_1)
    #print vector_ans,'\n'
    ## vector angle test
    #vector_0 = Vector([3.183,-7.627])
    #vector_1 = Vector([0,0])#([-2.668,5.319])
    #vector_ans = vector_0.angle(vector_1,'rad')
    #print vector_ans,'\n'
    #vector_0 = Vector([7.35,0.221,5.188])
    #vector_1 = Vector([2.751,8.259,3.985])
    #vector_ans = vector_0.angle(vector_1,'deg')
    #print vector_ans,'\n'
    """
    
    """
    ## vector magnitude test
    vector_0 = Vector([-0.221,7.437])
    vector_ans = vector_0.magnitude()
    print vector_ans
    vector_1 = Vector([8.813,-1.331,-6.247])
    vector_ans = vector_1.magnitude()
    print vector_ans
    ## vector direction test
    vector_0 = Vector([5.581,-2.136])
    vector_ans = vector_0.normalized()
    print vector_ans
    vector_0 = Vector([1.996,3.108,-4.554])
    vector_ans = vector_0.normalized()
    print vector_ans
    """
    
    """
    ## vector sum tests
    vector_0 = Vector([8.218,-9.341])
    vector_1 = Vector([-1.129,2.111])
    vector_sum = vector_0.plus(vector_1)
    print vector_sum
    
    ## vector minus tests
    vector_0 = Vector([7.119,8.215])
    vector_1 = Vector([-8.223,0.878])
    vector_subtract = vector_0.minus(vector_1)
    print vector_subtract
    
    ## vector scalar mutiplicationt tests
    vector_0 = Vector([1.671,-1.012,-0.318])
    vm = vector_0.times_scalar(7.41)
    print vm
    """
# ---------- end bibil_5 ----------
bibil_6 = PythonScript()  # -> o
# ---------- bibil_6: Python ----------
"""
Created on Jun 8, 2016
@author: Saeran Vasanthakumar
"""

import rhinoscriptsyntax as rs
import Rhino as rc
import random
import scriptcontext as sc
import copy
import System as sys
import math
import ghpythonlib.components as ghcomp

"""import classes"""
Shape_3D = sc.sticky["Shape_3D"]
Tree = sc.sticky["Tree"] 
Grammar = sc.sticky["Grammar"]


class Pattern:
    """Pattern"""
    def __init__(self):
        self.lot_lst = []
    def apply_pattern(self,node_,pd_):
        #print 'num', count
        try:
            tempnode = self.main_pattern(node_,pd_)
            return tempnode
        except Exception as e:
            print str(e)
    def helper_geom2node(self,geom,parent_node,label=""):
        def helper_curve2srf(geom_):
            #check if not guid and is a curve
            curve_guid = None
            if type(geom_) != type(rs.AddPoint(0,0,0)):
                points = [rc.Geometry.Point3d(0,0,0),rc.Geometry.Point3d(0,1,0),rc.Geometry.Point3d(1,0,0)]
                curve = rc.Geometry.Curve.CreateControlPointCurve(points,1)
                if geom_.ObjectType == curve.ObjectType: 
                    curve_guid = sc.doc.Objects.AddCurve(geom_)
            else:
                if rs.IsCurve(geom_): 
                    curve_guid = geom_
            if curve_guid:
                srf_guid = rs.AddPlanarSrf(curve_guid)[0]
                rc_brep = rs.coercebrep(srf_guid)
                return rc_brep
            else:
                return geom_     
        debug = sc.sticky['debug']
        child_node = None
        try:
            geom = helper_curve2srf(geom)
            cplane_ref = None
            tree_depth = 0
            
            if parent_node: 
                cplane_ref = parent_node.data.shape.cplane
                tree_depth = parent_node.depth+1
            try:
                child_shape = Shape_3D(geom,cplane=cplane_ref)
            except Exception as e: 
                print 'Bibil has detected a degenerate shape', str(e)
                child_shape = Shape_3D(geom,parent_node.data.shape.cplane)
            IsDegenerate = abs(child_shape.x_dist-0.) < 0.0001 or abs(child_shape.y_dist-0.) < 0.0001
            if not IsDegenerate:
                if child_shape.z_dist!=None and int(child_shape.z_dist) <= 0.0001:
                    child_shape.op_extrude(12.)
                child_grammar = Grammar(child_shape)
                child_grammar.type["label"] = label
                child_node = Tree(child_grammar,parent=parent_node,depth=tree_depth)
        except Exception as e:
            print "Error at Pattern.helper_geom2node", str(e)
        return child_node                   
    def pattern_solar_envelope_uni(self,node_0,time,seht,stype):
        def helper_get_curve_in_tree(node_,stype_,seht_):
            if stype_ == 3:
                noderoot = node_.get_root()
                basecrv = copy.copy(noderoot.data.shape.bottom_crv)
                #debug.append(basecrv)
            else:
                basecrv = copy.copy(node_.data.shape.bottom_crv)
            # Move up to lot_node height
            rc.Geometry.PolyCurve.Translate(basecrv,0.,0.,seht_)
            return basecrv
        
        def helper_intersect_solar(se_,node_,seht_):
            nodegeomlst = node_.data.shape.op_split("Z",seht_/node_.data.shape.z_dist)
            nodebase,nodetop = nodegeomlst[0],nodegeomlst[1]
            se_intersect =  rc.Geometry.Brep.CreateBooleanIntersection(nodetop,se_,TOL)[0]
            rc.RhinoApp.Wait()
            se_union =  rc.Geometry.Brep.CreateBooleanUnion([se_intersect,nodebase],TOL)[0]
            return se_union

        #debug = sc.sticky["debu
        TOL = sc.doc.ModelAbsoluteTolerance
        start,end = time, abs(time - 12.) + 12.
        debug = sc.sticky['debug']
        try:
            node_0.get_root().traverse_tree(lambda n: n.data.shape.convert_rc('3d'))
            ## Get correct curve from data tree
            se_crv = helper_get_curve_in_tree(node_0,stype,seht)
            ## Get base and top
            #split_ratio = seht/node_0.data.shape.z_dist
            #lstchild = node_0.data.shape.op_split("Z",split_ratio)
            #lot_base,lot_top = lstchild[0],lstchild[1]
            ## Generate solar envelope
            #print 'se_crv', se_crv
            se = node_0.data.shape.op_solar_envelope(start,end,se_crv)
            sebrep = helper_intersect_solar(se,node_0,seht)
            #print 'solarbrep', sebrep
            #debug.append(sebrep)
            return sebrep
        except Exception as e:
            print "Error @ pattern_solar_env_uni", str(e)
    def pattern_solar_envelope_multi(self,temp_node_,solartime_,data,solarht_):
        def helper_pattern_solar_envelope_multi(data,time,ht):
            try:
                #debug = sc.sticky["debug"]
                cpt = data.shape.cpt
                #time = [9,10,11,12,13]
                time += random.randint(-3,3)
                start = time
                end = start + 1.
                data.shape.make_top_crv()
                data.shape.convert_guid(dim='3d')
                #curve = top_crv#rs.CopyObject(data.shape.bottom_crv,[0,0,data.shape.ht])
                #g = copy.copy(rs.coercegeometry(data.shape.geom))
                cpt = rs.coerce3dpoint(data.shape.top_cpt)#[cpt[0], cpt[1], data.shape.ht] 
                curve = data.shape.top_crv
                
                se = data.shape.op_solar_envelope(start,end,curve)
                
                htpt = rs.AddPoint(cpt[0],cpt[1],ht)#data.shape.ht)
                if curve:
                    bottom_crv = curve
                else:
                    if not data.shape.is_guid(data.shape.bottom_crv):
                        tcrv = sc.doc.Objects.AddCurve(data.shape.bottom_crv)
                    else: 
                        tcrv = data.shape.bottom_crv
                    tvec = rs.VectorCreate(data.shape.top_cpt, data.shape.cpt)
                    bottom_crv = rs.CopyObject(tcrv,tvec)
                dcpt = data.shape.cpt
                if not data.shape.is_guid(dcpt):
                    dcpt = rs.AddPoint(dcpt[0],dcpt[1], dcpt[2])
                path_ = rs.AddCurve([dcpt,htpt])
                srf = rs.ExtrudeCurve(bottom_crv,path_)
                rs.CapPlanarHoles(srf)
                srf = rs.coercegeometry(srf)
                TOL = sc.doc.ModelAbsoluteTolerance
                #debug.append(srf)
                try: 
                    se =  rc.Geometry.Brep.CreateBooleanIntersection(se,srf,TOL)[0]
                except: 
                    print 'error at solar multi helper'
                return se
            except Exception as e:
                print e
        try:
            sublst = temp_node_.traverse_tree(lambda n:n,internal=False)
            for subnode in sublst:
                add_hour = float(random.randint(-2,2))
                if add_hour == 0.: add_hour = 1
                solartime_ += 1/add_hour
                try:
                    se = helper_pattern_solar_envelope_multi(subnode.data,solartime_,solarht_)
                    geo_brep = rs.coercebrep(rs.CopyObject(subnode.data.shape.geom))
                    unioned =  rc.Geometry.Brep.CreateBooleanUnion([se,geo_brep],TOL)
                except Exception as e:
                    print "Error at solar_envelope multi"
                    print e
                try: 
                    unioned = unioned[0]
                    subnode.data.shape.geom = unioned
                except: 
                    print 'error multi unioning solartypes'
            return temp_node_
        except Exception as e:
            print "Error at pattern solar envelope multi"
            print e
    def pattern_stepback(self,tnode,stepback_,stepback_node_,sb_ref_):
        ##stepback_: height,recess distance 
        debug = sc.sticky['debug']
        curr_n = tnode#tnode.traverse_tree(lambda n: n,internal=False)
        try:
            ht, dist = stepback_[0], stepback_[1]
            for j,sbref in enumerate(sb_ref_):
                # move sbref
                move_vector= rc.Geometry.Vector3d(0,0,float(ht))
                sbref_crv = sc.doc.Objects.AddCurve(sbref)
                sbref_crv = rs.coercecurve(rs.CopyObject(sbref_crv,move_vector))
                cut_geom = curr_n.data.shape.op_split("EW",0.5,deg=0.,\
                split_depth=float(dist),split_line_ref=sbref_crv)  
                try:
                    curr_n.data.shape.geom = cut_geom[0]
                    curr_n.data.shape.reset(xy_change=True)
                except Exception as e:
                    pass
                    #print "Error at shape.reset at pattern_stepback",str(e)
                #debug.append(curr_n.data.shape.geom)
        except Exception as e:
            print str(e)#,sys.exc_traceback.tb_lineno 
            print "Error at Pattern.stepback"
        return tnode    
    def pattern_divide(self,node,grid_type,div,axis="NS",random_tol=0,cut_width=0,div_depth=0,ratio=None,flip=False):        
        def helper_subdivide_depth(hnode,div,div_depth,ratio_,axis_ref="NS"):            
            #print 'divdepth, div', div_depth,',', div
            # stop subdivide
            if int(div_depth) >= int(div) or abs(div-0.) <= 0.01:
                haxis,hratio = axis_ref,0.
            # start subdivide
            elif int(div_depth) == 0 and int(div) > 0:
                haxis,hratio = axis_ref,0.5
            # alternate subdivide by axis
            elif "NS" in hnode.parent.data.type['axis']:
                haxis,hratio = "EW",0.5
            elif "EW" in hnode.parent.data.type['axis']:
                haxis,hratio = "NS",0.5
            hnode.data.type['axis'] = haxis
            hnode.data.type['ratio'] = hratio
            return hnode
        def helper_subdivide_depth_same(hnode,div,div_depth,ratio_,axis_ref="NS"):            
            # base case: stop subdivide
            if int(div_depth) >= int(div) or abs(div-0.) <= 0.01:
                haxis,hratio = axis_ref,0.
            # alternate subdivide by axis
            elif float(div_depth) < 0.5 and int(div) > 0.01:
                haxis,hratio = axis_ref,0.5
            # alternate subdivide by axis
            else:
                haxis,hratio = node.parent.data.type['axis'],0.5
            hnode.data.type['axis'] = haxis
            hnode.data.type['ratio'] = hratio
            return hnode
        def helper_subdivide_dim(hnode,div,div_depth,ratio_,axis_ref="NS",tol=0.1):            
            def greater(a,b,tol):
                checktol = abs(a-b) <= tol
                return a >= b and not checktol
            ss = hnode.data.shape
            grid_x, grid_y = float(div[0]), float(div[1])
            if greater(ss.y_dist,grid_y,tol):
                haxis = "EW" 
                hratio = grid_y/float(ss.y_dist)
            elif greater(ss.x_dist,grid_x,tol): 
                haxis = "NS"
                hratio = grid_x/float(ss.x_dist)
            else: 
                haxis,hratio = axis_ref,0.
            hnode.data.type['axis'] = haxis
            hnode.data.type['ratio'] = hratio
            return hnode
        def helper_simple_divide(hnode,ratio_,axis_ref="NS"):
            hnode.data.type['axis'] = axis_ref
            hnode.data.type['ratio'] =ratio_
            return hnode
        debug = sc.sticky['debug']
        if node.depth >=10: # base case 1
            print 'node.depth > 10'
        else:
            ## Calculate and encode the ratio and axis data
            axis_ = axis
            if flip:
                axis_ = "NS" if "EW" in axis else "EW"
            if grid_type == "subdivide_depth":
                node = helper_subdivide_depth(node,div,div_depth,ratio,axis_ref=axis_)
            elif grid_type == "subdivide_depth_same":
                node = helper_subdivide_depth_same(node,div,div_depth,ratio,axis_ref=axis_)
            elif grid_type == "subdivide_dim":
                node = helper_subdivide_dim(node,div,div_depth,ratio,axis_ref=axis_)
            else:#simple_divide
                node = helper_simple_divide(node,ratio,axis_ref=axis_)
            
            ## Split, make a node, and recurse.
            if node.data.type['ratio'] > 0.0001:
                loc = node.data.shape.op_split(node.data.type['axis'],node.data.type['ratio'],0.,split_depth=cut_width)
                #debug.extend(loc)
                for i,child_geom in enumerate(loc):
                    child_node = self.helper_geom2node(child_geom,node)
                    if child_node: node.loc.append(child_node)
                if 'simple_divide' not in grid_type:
                    for c in node.loc:
                        self.pattern_divide(c,grid_type,div,axis_,random_tol,cut_width,div_depth+1,ratio)
        return node
    def helper_normal2extsrf(self,temp_node_):
        def get_colinear_line(refnode_,tn_):
            def get_max_magnitude(lst):
                max_index = 0
                max_dist = rs.Distance(lst[0][0],lst[0][1])
                for i,ln in enumerate(lst[1:]):
                    dist = rs.Distance(ln[0],ln[1])
                    if dist > max_dist:
                        max_dist = dist
                        max_index = i+1
                lst = [lst[max_index]]
                return lst
            ## Input refnode, and tn
            ## Outputs the lines of tn that are colinear to refnode
            ## Loop through all lines in refshape
            ## Loop through all lines in tempnode
            ## if colinear line, add to colinear_lst 
            ref_base = refnode_.data.shape.set_base_matrix()
            foo_colinear = refnode_.data.shape.check_colinear_pt
            colinear_lst = []
            newht = tn_.data.shape.cpt[2]
            n_matrix = tn_.data.shape.set_base_matrix()
            check_x = False
            check_y = False
            for line in ref_base:
                newline = map(lambda p: [p[0],p[1],newht],line)
                refcrv = rs.coercecurve(rs.AddLine(newline[0],newline[1]))
                #debug.append(refcrv)
                for nline in n_matrix:
                    pt_0 = foo_colinear(refcrv,nline[0],tol=0.5)
                    pt_1 = foo_colinear(refcrv,nline[1],tol=0.5)
                    if pt_0 and pt_1:
                        colinear_lst.append(nline)
            if len(colinear_lst) < 1:
                colinear_lst = get_max_magnitude(tn_.data.shape.base_matrix)
            if len(colinear_lst) > 1:
                colinear_lst = get_max_magnitude(colinear_lst)
            return colinear_lst.pop(0)
        def get_normal_to_exterior_vector(parallel2ext):
            ## Take cross product ccw * [0,0,1] vector
            ## solution vector is inward pointing vector
            ccw_vec = parallel2ext[1] - parallel2ext[0]
            up_vec = rc.Geometry.Vector3d(0,0,1)
            cross = rc.Geometry.Vector3d.CrossProduct(ccw_vec,up_vec)
            return cross
        ## Takes a node and finds the vector perpendicular to the surface
        ## pointing inward, relative to the rootnode surface
        ## This should be abstracted and moved to shape class
        debug = sc.sticky['debug']
        temp_node_.traverse_tree(lambda n: n,internal=False)
        ref_node = temp_node_.get_root()
        parallel2refext = get_colinear_line(ref_node,temp_node_)
        #line = rs.AddLine(parallel2refext[0],parallel2refext[1])
        #debug.append(line)
        normal2srf = get_normal_to_exterior_vector(parallel2refext)
        return normal2srf
    def pattern_separate_by_dist(self,temp_node_,sep_dist,dim=1.):
        def extract_topo(n_):
            pt = n_.data.shape.cpt
            refpt = rs.AddPoint(pt[0],pt[1],n_.data.shape.z_dist)
            topcrv = n_.data.shape.get_bottom(n_.data.shape.geom,refpt)
            childn = self.helper_geom2node(topcrv,n_,"")
            n_.loc.append(childn)
            childn.data.shape.op_extrude(6.)
            return childn 
        def new_subdivide_by_dim(count,tn_,cut_axis_,cut_width_,recurse=True):
            ## Takes a node subdivides it along one axis according to separation distance
            ## and dimension
            if count <= 30:
                if "NS" in cut_axis_:
                    IsWidth = abs(tn_.data.shape.x_dist-cut_width_) <= 3.
                else:
                    IsWidth = abs(tn_.data.shape.y_dist-cut_width_) <= 3.
                if not IsWidth:
                    try:
                        cut_ratio_ = tn_.data.shape.calculate_ratio_from_dist(cut_axis_,cut_width_,0)
                        self.pattern_divide(tn_,'simple_divide',0,axis=cut_axis_,ratio=cut_ratio_)
                        if recurse:
                            for tnc_ in tn_.loc:
                                new_subdivide_by_dim(count+1,tnc_,cut_axis_,cut_width_)
                    except:
                        pass
            else:
                print 'newsubdivide by depth > 30 recursion!'
        def check_base_dimension(tn_,cut_axis,cut_width_):
            if "NS" in cut_axis:
                IsWidth = abs(tn_.data.shape.x_dist-cut_width_) <= 3.
                IsMin = tn_.data.shape.y_dist >= 20.
            else:
                IsWidth = abs(tn_.data.shape.y_dist-cut_width_) <= 3.
                IsMin = tn_.data.shape.x_dist >= 20.
            #debug.append(tn_.data.shape.geom)
            IsArea = tn_.data.shape.get_area() > 700.
            
            print IsArea, IsWidth, IsMin
            if IsArea and IsWidth and IsMin:
                return tn_
            else:
                return None
        def check_base_with_offset(base_,offsetlst):
            intersect_offset = False
            for offset in offsetlst:
                crvA = offset
                crvB = base_.data.shape.bottom_crv
                setrel = base_.data.shape.check_region(crvA,crvB,tol=0.1)
                #If not disjoint
                if abs(setrel-0.)>0.1:
                    intersect_offset = True
                    break
            if intersect_offset:
                return None
            else: 
                return base_
            
        debug = sc.sticky['debug']
        # get root node - not linked
        if not sc.sticky.has_key('seperation_offset_lst'):
            sc.sticky['seperation_offset_lst'] = []
        sep_lst = sc.sticky['seperation_offset_lst']
        ## Get normal to exterior srf
        
        normal2srf = self.helper_normal2extsrf(temp_node_)
        cut_axis = temp_node_.data.shape.vector2axis(normal2srf)
        cut_width = sep_dist + dim
        temp_node_.data.type['print'] = True
        temp_node_.data.type['label'] = 'base'
        temp_node_topo = extract_topo(temp_node_)
        
        ## Subdivide the lot crvs
        #subdivide by dist
        new_subdivide_by_dim(0,temp_node_topo,cut_axis,cut_width)
        topo_child_lst = temp_node_topo.traverse_tree(lambda n:n, internal=False)
        #subdivide by tower_dim
        for tnc in topo_child_lst:
            new_subdivide_by_dim(0,tnc,cut_axis,dim,recurse=False)
        topo_grand_child_lst = temp_node_topo.traverse_tree(lambda n:n, internal=False)
        
        # Sort through subdivided bases
        # label bases that are valid separations
        for t in topo_grand_child_lst:
            check_base_dim = check_base_dimension(t,cut_axis,dim)
            if check_base_dim:
                valid_base = check_base_with_offset(check_base_dim,sep_lst)
                if valid_base:# != None:
                    ## Add some tolerance to separation distance
                    tol = 1.
                    sep_dist -= tol
                    sep_crv = valid_base.data.shape.op_offset_crv(sep_dist*-1,corner=2)
                    ## For viz
                    sep_crv_viz = valid_base.data.shape.op_offset_crv((sep_dist+tol)*-1,corner=2)
                    debug.append(sep_crv_viz)
                    ## Append crv
                    sc.sticky['seperation_offset_lst'].append(sep_crv)
                    valid_base.data.type["valid_seperation"] = True
                #else recurse again!
                
        return temp_node_
    def pattern_set_height(self,temp_node_,ht_,ht_node_):
        def height_from_bula(n_):
            bula_node,bptlst = False,False
            setht = 21. #default ht = midrise
            bula_node = n_.search_up_tree(lambda n: n.data.type.has_key('bula_data'))
            if bula_node:
                buladata = bula_node.data.type['bula_data']
                crvlst = [n_]
                #make this function in bula
                inptlst = buladata.getpoints4lot(crvlst,buladata.bpt_lst)
                if inptlst != [[]]:
                    buladata.generate_bula_point(crvlst,inptlst)
                    ## you are now a bulalot!
                    ht_factor = n_.data.type['bula_data'].value
                    setht = 1000.*ht_factor
                return setht
        def height_from_envelope(n_):
            #TO['solartype'],TO['solartime']
            env = sc.sticky['envelope']
            maxht_env = 150.
            """
            if PD_['solartype']>0:
                starthr = PD_['solartime']
                endhr = starthr+5.
                crv = sc.sticky['envelope'][0].data.shape.bottom_crv
                env = self.get_solar_zone(starthr,endhr,curve=crv,zonetype='fan')
                env = [env]
            """
            env = sc.sticky['envelope']
            base_matrix = n_.data.shape.set_base_matrix()
            ptlst = map(lambda l:l[0], base_matrix)
            dir = rc.Geometry.Vector3d(0,0,1) 
            tol = sc.doc.ModelAbsoluteTolerance
            projlst = rc.Geometry.Intersect.Intersection.ProjectPointsToBreps(env,ptlst,dir,tol)
            projlst = filter(lambda pt:abs(pt[2]-200.)>0.5,projlst)
            projlst = filter(lambda p: abs(p[2]-0)>1.,projlst)
            if projlst:
                #debug.extend(projlst)
                min_index = projlst.index(min(projlst,key=lambda p:p[2]))
                min_pt = projlst[min_index]
                envht = min_pt[2]
            else:
                envht = 150.
            
            return envht-13.5
            
        debug = sc.sticky['debug']
        #print 'We are setting height!'
        overridePD = self.check_override(temp_node_)
        if overridePD!=None:
            ht_node_ = overridePD['height_node']
        lst_nodes = temp_node_.traverse_tree(lambda n: self.print_node(n,label=ht_node_))
        lst_nodes = filter(lambda n:n!=None,lst_nodes)
        for n_ in lst_nodes:
            overridePD = self.check_override(n_)
            if overridePD:
                ht_ = overridePD['height']
            if type(ht_)==type('') and 'bula' in ht_:
                ht_ = height_from_bula(n_)
            elif type(ht_)==type('') and 'envelope' in ht_:
                #ugly
                #if overridePD:
                ht_ = height_from_envelope(n_)
                #else:
                #    ht_ = height_from_envelope(n_)
            n_.data.shape.op_extrude(ht_)
            n_.data.type['print'] = True
        return temp_node_
    def get_solar_zone(self,start_time,end_time,curve=None,zonetype='envelope'):
        try:
            if type(curve) == type(rs.AddPoint(0,0,0)): 
                curve = rs.coercecurve(curve)
            if 'envelope' in zonetype:
                se = ghcomp.DIVA.SolarEnvelope(curve,43.65,start_time,end_time)
            else:
                minhr = end_time-start_time
                se = ghcomp.DIVA.SolarFan(curve,43.65,minhr,263,200.)
            return se
        except Exception as e:
            print "P.op_solar_envelope error"
            print e
    def check_override(self,node_):
        """
        Ref:
        if label in overnode.data.type['label']:
        overnode.data.type['grammar'] = grammar
        sc.sticky['override'].append(overnode)
        """
        #debug = sc.sticky['debug']
        lstoverride = sc.sticky['override']
        theoverride = None
        crvA = node_.data.shape.bottom_crv
        for overnode in lstoverride:
            crvB = overnode.data.shape.bottom_crv
            setrel = node_.data.shape.check_region(crvA,crvB,tol=0.5)
            if abs(setrel-0.)>0.1:
                theoverride = overnode.data.type['grammar']
                break
        return theoverride
    def print_node(self,node_,label='print'):
        #debug = sc.sticky['debug']
        if node_.data.type.has_key(label) and node_.data.type[label]:
            return node_
    def pattern_court(self,temp_node_,court_node,court_width,subdiv_num,subdiv_cut,subdiv_flip,slice=None):        
        def helper_court_refcrv(court_node_,subdiv_):
            if int(court_node_) == 0:
                root = temp_node_.get_root()
                refshape_ = root.data.shape
            else:
                refshape_ = subdiv_.data.shape
            return refshape_  
        def helper_court_slice(curr_node,rootshape,width_):
            L = []
            curr_node_ref = curr_node 
            for i in range(2):
                if i%2==0:
                    axis_ = "EW"
                else:
                    axis_ = "NS"
                for j in range(2):
                    if j%2==0:dir = 1. 
                    else: dir = 0.
                    ratio_ = rootshape.calculate_ratio_from_dist(axis_,width_,dir)
                    
                    ## Construct width_reference to find small slice
                    width_ref = ratio_
                    if "EW" in axis_:
                        total_dist = rootshape.y_dist
                    else:
                        total_dist = rootshape.x_dist
                    if width_/total_dist < width_ref: width_ref = 1.-ratio_
                    #y_dist = rootshape.y_dist
                    #print 'ratio',width_,axis_, round(ratio_,2)
                    #print 'y_dist', y_dist, y_dist * ratio_
                    ## Split the geom (use simple divide for this, is redundant)
                    geom_lst = curr_node.data.shape.op_split(axis_,ratio_,deg=0.,split_depth=0.,split_line_ref=rootshape)    
                    debug.extend(geom_lst)
                    for j,geom in enumerate(geom_lst):
                        child_node = self.helper_geom2node(geom,parent_node=curr_node,label="")
                        cns = child_node.data.shape
                        IsRatioX = abs(cns.x_dist/float(rootshape.x_dist)-width_ref)<=0.01
                        IsRatioY = abs(cns.y_dist/float(rootshape.y_dist)-width_ref)<=0.01
                        if IsRatioX or IsRatioY:
                            L.append(copy.deepcopy(child_node))
                        else:
                            curr_node = child_node 
            ## Make this into separate function: clean up depth (also in spearate)
            for i,n in enumerate(L):
                n.depth = curr_node_ref.depth+1
                n.parent = curr_node_ref
                L[i] = n
            curr_node_ref.loc = L 
                   
        debug = sc.sticky['debug']
        lon = temp_node_.traverse_tree(lambda n: n,internal=False)  
        for subdiv in lon:    
            subdiv.data.shape.convert_rc('3d')
            refshape = helper_court_refcrv(court_node,subdiv)
            if slice:
                try:
                    helper_court_slice(subdiv,refshape,court_width)
                except Exception as e:
                    print 'Error @ court_slice', str(e)
            elif court_width > 0.:
                try:
                    subdiv.data.shape.op_offset(court_width,refshape.bottom_crv,dir="courtyard")
                except Exception as e:
                    print 'Error @ court', str(e)
        return temp_node_
    def main_pattern(self,node,PD):
        """
        param_dictionary
        solar: solartype, solartime
        divis: div_num, div_deg, div_cut
        court: court, court_width, court_node
        sdiv: subdiv_num, subdiv_cuttime
        """
        debug = sc.sticky["debug"]
        TOL = sc.doc.ModelAbsoluteTolerance
        
        ## 0. make a copy of the geometry
        
        gb = node.data.shape.geom
        if node.data.shape.is_guid(gb): gb = rs.coercebrep(gb)#gb = sc.doc.Objects.AddBrep(gb)
        geo_brep = copy.copy(gb)
        
        ## 1. param 1 or param 3
        solartype = PD['solartype']
        solartime = PD['solartime']
        solarht = PD['solarht']
        
        if solartype == 1 or solartype == 3: # uni-cell
            try:
                geo_brep = self.pattern_solar_envelope_uni(node,solartime,solarht,solartype)
            except Exception as e:
                    print "Error @ solartype 1 or 3", str(e)

        ## 2. make a new, fresh node
        temp_node = self.helper_geom2node(geo_brep,node)
        
        
        ## 3. param 2
        div_num = PD['div_num']
        div_deg = PD['div_deg']
        div_cut = PD['div_cut']
        div_ratio = PD['div_ratio']
        flip = PD['flip']
        
        if div_num > 0:
            try:
                temp_node = self.pattern_divide(node,temp_node,div_num,div_deg,div_cut,div_ratio,flip)
            except Exception as e:
                print "Error @ main_pattern @ pattern_divide"
                print e
             
        ## 4. param 3
        if solartype == 2: # multi_cell
            try:
                temp_node = self.pattern_solar_envelope_multi(temp_node,solartime,node.data,solarht)
            except Exception as e:
                print e
            
        ## 6. separation_distance
        if PD['separate']:
            separation_dist = PD['separation_dist']
            unitdim = PD['dim']
            norm2srfvector = self.helper_normal2extsrf(temp_node)
            temp_node = self.pattern_separate_by_dist(temp_node,separation_dist,unitdim) 
        
        ## 5. Stepback
        ## Ref: TT['stepback'] = [(27.,32+14.),(12.,32+7.),(0.,32)]
        stepback = PD['stepback_base']
        stepback_node = PD['stepback_node']
        if stepback != None and stepback != []:
            setback_ref = temp_node.get_root().data.type.get('setback_reference_line')
            for step_data in stepback:
                #sr: [ht,dim]
                #fix this really bad solution
                build_lst = temp_node.traverse_tree(lambda n: self.print_node(n),internal=False)
                build_lst = filter(lambda n: n!=None,build_lst)
                if self.print_node(temp_node):
                    build_lst.append(temp_node)
                for build_node in build_lst:
                    try:
                        #print 'check', build_node.data.type['label']
                        build_node = self.pattern_stepback(build_node,step_data,stepback_node,setback_ref)
                    except Exception as e:
                        print "Error @ stepback"
                        print str(e)#,sys.exc_traceback.tb_lineno
                        
        ## 7. Extrude
        if PD['height']!=False:
            ht = PD['height']
            ht_label = PD['height_node']
            temp_node = self.pattern_set_height(temp_node,ht,ht_label)    
            
        ## 5. Stepback
        ## Ref: TT['stepback'] = [(27.,32+14.),(12.,32+7.),(0.,32)]
        stepback = PD['stepback_tower']
        stepback_node = PD['stepback_node']
        if stepback != None and stepback != []:
            setback_ref = temp_node.get_root().data.type.get('setback_reference_line')
            for step_data in stepback:
                #sr: [ht,dim]
                #fix this really bad solution
                build_lst = temp_node.traverse_tree(lambda n: self.print_node(n),internal=False)
                build_lst = filter(lambda n: n!=None,build_lst)
                if self.print_node(temp_node):
                    build_lst.append(temp_node)
                for build_node in build_lst:
                    try:
                        #print 'check', build_node.data.type['label']
                        build_node = self.pattern_stepback(build_node,step_data,stepback_node,setback_ref)
                    except Exception as e:
                        print "Error @ stepback"
                        print str(e)#,sys.exc_traceback.tb_lineno 
            
        ## 5. param 1
        court = PD['court']
        court_node = PD['court_node']
        court_width = PD['court_width']
        court_slice = PD['court_slice']
        subdiv_num = PD['subdiv_num']
        subdiv_cut = PD['subdiv_cut'] 
        subdiv_flip = PD['subdiv_flip']
        terrace = float(PD['terrace'])
        terrace_node = PD['terrace_node']
        
        if terrace > 0.:
            lon = temp_node.traverse_tree(lambda n: n,internal=False)
            for i,subdiv in enumerate(lon):
                #debug.append(subdiv.data.shape.geom)
                #tcrv = subdiv.data.shape.bottom_crv
                # 2. offset
                #if debug_print:
                #    print 'terracenode', terrace_node
                if int(terrace_node) == 0:
                    root = node.get_root()
                    tcrv = root.data.shape.bottom_crv
                elif int(terrace_node) == 1:
                    tcrv = subdiv.parent.data.shape.bottom_crv
                elif int(terrace_node) == 2 and subdiv.parent.parent:
                    tcrv = subdiv.parent.parent.data.shape.bottom_crv
                elif int(terrace_node) == 3 and subdiv.parent.parent.parent:
                    tcrv = subdiv.parent.parent.parent.data.shape.bottom_crv
                else:
                    tcrv = subdiv.data.shape.bottom_crv
                subdiv.data.shape.op_offset(terrace,tcrv,dir="terrace_3d")
        if court==1:
            try:
                #newyaxis = self.helper_normal2extsrf(temp_node)
                #oldyaxis = temp_node.data.shape.cplane.YAxis
                #radian_angle = rc.Geometry.Vector3d.VectorAngle(oldyaxis,newyaxis)
                #zaxis = rc.Geometry.Vector3d(0,0,1)
                #temp_node.data.shape.cplane.Rotate(radian_angle,zaxis)
                temp_node = self.pattern_court(temp_node,court_node,court_width,subdiv_num,subdiv_cut,subdiv_flip,slice=court_slice)            
                #print 'tn', temp_node.traverse_tree(lambda n:n,internal=False)
            except Exception as e:
                print "Error at pattern_court"
                print str(e)
        
        ## 7. finish
        return temp_node
     
TOL = sc.doc.ModelAbsoluteTolerance
if True:
    sc.sticky["Pattern"] = Pattern
# ---------- end bibil_6 ----------

# ---- group: GFA_Calculator
plain_bibil = PythonScript(crv=geometry_2, cut_num=0, cut_dim=0, run=Toggle(True))  # -> node, GFA, debug; inputs crv: list, cut_num: Int32, run: Boolean
# ---------- plain_bibil: Python ----------
"""
Created on Jun 19, 2016
author: Saeran Vasanthakumar
"""

import rhinoscriptsyntax as rs
import Rhino as rc
import scriptcontext as sc

"""import classes"""
Shape_3D = sc.sticky["Shape_3D"]
Pattern = sc.sticky["Pattern"]

def make_node_lst(block_in_,label_): 
    L = []
    P = Pattern()
    for lot_geom in block_in_:
        n_ = P.helper_geom2node(lot_geom,None,label=label_)
        L.append(n_)
    return L
def split_node_lst(node_lst_,cut_num_,cut_dim_,cut_flip_):
    P = Pattern()
    for lot_node in node_lst_:
        lot_node = P.pattern_divide(lot_node,"subdivide_depth",cut_num_,cut_width=cut_dim_)
        #lot_node.make_tree_3D("subdivide_depth_same",depth,axis=axis_,cut_width=street_dim)
        #lot_node.make_tree_3D("subdivide_dim",(18,18),axis=axis_,random_tol=0,cut_width=street_dim)
        yield lot_node.traverse_tree(lambda n:n,internal=False)
    
def main(lot_in_,label_,cut_num_,cut_dim_,cut_flip_):
    ### Grid_Subdivide: (listof node) int int -> (listof node))
    ### Purpose: This component consumes a list of node lots and two int and 
    ###generates a list of mutated nodes, with the lots subdivided according
    ###to the int int dimensions.     
    lst_node = make_node_lst(lot_in_,label_)
    split_nodes = split_node_lst(lst_node,cut_num_,cut_dim_,cut_flip_)
    split_nodes = reduce(lambda x,y: x+y,split_nodes)
    return split_nodes


if run and crv!=[None] and crv!=None and crv!=[]:
    sc.sticky["debug"] = []
    debug = sc.sticky["debug"]
    if not label:
        label = ''
    if not cut_dim:
        cut_dim = 0.
    if not cut_num:
        cut_num = 0
    if not cut_flip:
        cut_flip = False
    node_lst = main(crv,label,cut_num,cut_dim,cut_flip)
    
    gfasum = 0.
    error = False
    errornum = 0
    for i,node in enumerate(node_lst):
        if node.data.shape.cplane != None:
            debug.extend(node.data.shape.bbpts)
            if mm:
                dim = 1000.
            else:
                dim = 1.
            floorarea = (node.data.shape.x_dist/dim) * (node.data.shape.y_dist/dim)
            bldheight = max(node.data.shape.bbpts,key=lambda p:p[2])[2]/dim
            floornum = bldheight/3.
            vol = rc.Geometry.VolumeMassProperties.Compute(rs.coercegeometry(node.data.shape.geom)).Volume
            gfa_ = vol/3.
            #print floornum, 'x', floorarea
            #gfa = floornum * floorarea
            #print gfa, 'asdf', gfa_
            gfasum += gfa_
        else:
            error = True
            errornum = i
            break
    if error == False:
        gfasum = int(gfasum)
        GFA = 'GFA total for '+str(len(node_lst)) + \
        ' masses is: ' + str(gfasum) + 'm2'
    else:
        GFA = 'Error reading geometry number: ' + str(errornum+1) + ' calculate manually or remodel geometry from debug'
        debug = []
        debug.append(node_lst[errornum].data.shape.geom)
        print debug
else:
    print 'Add inputs!'
# ---------- end plain_bibil ----------

# ----
g = PythonScript(node=plain_bibil.node)  # -> geom
# ---------- g: Python ----------
if node:
    geom = []
    lot_lst = node.traverse_tree(lambda n:n,internal=False)
    for n in lot_lst:
        geom.append(n.data.shape.bottom_crv)
    print geom
# ---------- end g ----------
geometry_3 = Geometry(plain_bibil.debug)
panel_5 = Panel(plain_bibil.GFA)

mass_addition = MassAddition(Input=area_2.Area)  # -> Result, PartialResults
panel_6 = Panel(mass_addition.Result)

division_2 = Division(A=Slider(157025, range=0..1000000), B=Slider(176161, range=0..1000000))
panel_7 = Panel(division_2)
towers_2 = Geometry()

# ---- group: Input - sum
lot_2 = Geometry()

# ----
podium_tower = Geometry()

# ---- group: lots=blocks
plain_bibil_2 = PythonScript(crv=towers_2, cut_num=0, cut_dim=0, mm=Toggle(False), run=Toggle(True))  # -> node_lst, debug; inputs crv: list, cut_num: Int32, run: Boolean
# ---------- plain_bibil_2: Python ----------
"""
Created on Jun 19, 2016
author: Saeran Vasanthakumar
"""

import rhinoscriptsyntax as rs
import Rhino as rc
import scriptcontext as sc

"""import classes"""
Shape_3D = sc.sticky["Shape_3D"]
Pattern = sc.sticky["Pattern"]

def make_node_lst(block_in_,label_): 
    L = []
    P = Pattern()
    for lot_geom in block_in_:
        n_ = P.helper_geom2node(lot_geom,None,label=label_)
        L.append(n_)
    return L
def split_node_lst(node_lst_,cut_num_,cut_dim_,cut_flip_):
    P = Pattern()
    for lot_node in node_lst_:
        lot_node = P.pattern_divide(lot_node,"subdivide_depth",cut_num_,cut_width=cut_dim_)
        #lot_node.make_tree_3D("subdivide_depth_same",depth,axis=axis_,cut_width=street_dim)
        #lot_node.make_tree_3D("subdivide_dim",(18,18),axis=axis_,random_tol=0,cut_width=street_dim)
        yield lot_node.traverse_tree(lambda n:n,internal=False)
    
def main(lot_in_,label_,cut_num_,cut_dim_,cut_flip_):
    ### Grid_Subdivide: (listof node) int int -> (listof node))
    ### Purpose: This component consumes a list of node lots and two int and 
    ###generates a list of mutated nodes, with the lots subdivided according
    ###to the int int dimensions.     
    lst_node = make_node_lst(lot_in_,label_)
    split_nodes = split_node_lst(lst_node,cut_num_,cut_dim_,cut_flip_)
    split_nodes = reduce(lambda x,y: x+y,split_nodes)
    return split_nodes


if run and crv!=[None] and crv!=None and crv!=[]:
    sc.sticky["debug"] = []
    debug = sc.sticky["debug"]
    if not label:
        label = ''
    if not cut_dim:
        cut_dim = 0.
    if not cut_num:
        cut_num = 0
    if not cut_flip:
        cut_flip = False
    node_lst = main(crv,label,cut_num,cut_dim,cut_flip)
# ---------- end plain_bibil_2 ----------

# ---- group: Towers
plain_bibil_3 = PythonScript(crv=lot_2, cut_num=0, cut_dim=0, mm=Toggle(False), run=Toggle(True))  # -> node_lst, debug; inputs crv: list, cut_num: Int32, run: Boolean; same code as plain_bibil_2

# ---- group: lot_coverage
plain_bibil_4 = PythonScript(crv=podium_tower, cut_num=0, cut_dim=0, mm=Toggle(False), run=Toggle(True))  # -> node_lst, debug; inputs crv: list, cut_num: Int32, run: Boolean; same code as plain_bibil_2

# ---- group: input individually
lot_3 = Geometry()

# ----
g_2 = PythonScript(node=plain_bibil_2.node_lst)  # -> geom; same code as g
g_3 = PythonScript(node=plain_bibil_3.node_lst)  # -> geom; same code as g
g_4 = PythonScript(node=plain_bibil_4.node_lst)  # -> flatten(geom); same code as g
region_union = RegionUnion(Curves=flatten(g_4))
tar = PythonScript(towers=plain_bibil_2.node_lst, lots=plain_bibil_3.node_lst, cut_num=0, cut_dim=0, mm=Toggle(False), run=Toggle(True))  # -> node_lst, TAR, debug; inputs towers: list, lots: list, cut_num: Int32, run: Boolean
# ---------- tar: Python ----------
"""
Created on Jun 19, 2016
author: Saeran Vasanthakumar
"""

import rhinoscriptsyntax as rs
import Rhino as rc
import scriptcontext as sc

"""import classes"""
Shape_3D = sc.sticky["Shape_3D"]
Pattern = sc.sticky["Pattern"]

def make_node_lst(block_in_,label_): 
    L = []
    P = Pattern()
    for lot_geom in block_in_:
        n_ = P.helper_geom2node(lot_geom,None,label=label_)
        L.append(n_)
    return L
def split_node_lst(node_lst_,cut_num_,cut_dim_,cut_flip_):
    P = Pattern()
    for lot_node in node_lst_:
        lot_node = P.pattern_divide(lot_node,"subdivide_depth",cut_num_,cut_width=cut_dim_)
        #lot_node.make_tree_3D("subdivide_depth_same",depth,axis=axis_,cut_width=street_dim)
        #lot_node.make_tree_3D("subdivide_dim",(18,18),axis=axis_,random_tol=0,cut_width=street_dim)
        yield lot_node.traverse_tree(lambda n:n,internal=False)
    
def main(lot_in_,label_,cut_num_,cut_dim_,cut_flip_):
    ### Grid_Subdivide: (listof node) int int -> (listof node))
    ### Purpose: This component consumes a list of node lots and two int and 
    ###generates a list of mutated nodes, with the lots subdivided according
    ###to the int int dimensions.     
    lst_node = make_node_lst(lot_in_,label_)
    split_nodes = split_node_lst(lst_node,cut_num_,cut_dim_,cut_flip_)
    split_nodes = reduce(lambda x,y: x+y,split_nodes)
    return split_nodes


towers = filter(lambda n: n!=None,towers)
lots = filter(lambda n: n!=None,lots)

if run and towers!=[] and lots!=[]:
    sc.sticky["debug"] = []
    debug = sc.sticky["debug"]
    
    node_lst = []
    lot_tower_lst = []
    for lot in lots:
        print 'lot', lot.data.shape.get_area()
        tower_area = 0.
        for tower in towers:
            print 'tower', tower.data.shape.get_area()
            pt = tower.data.shape.cpt
            lotcrv = lot.data.shape.bottom_crv
            IsInside = rs.PointInPlanarClosedCurve(pt,lotcrv,lot.data.shape.cplane,0.1)
            #if 1 is inside
            if abs(IsInside-1.)<0.2:
                tower_area += tower.data.shape.get_area()
        TAR = tower_area / float(lot.data.shape.get_area())
        lot_tower_lst.append(TAR)
        node_lst.append(lot)
    TAR_ = lot_tower_lst
# ---------- end tar ----------
area_5 = Area(Geometry=region_union)  # -> Area, Centroid
area_6 = Area(Geometry=lot_3)  # -> Area, Centroid
g_5 = PythonScript(node=tar.node_lst)  # -> flatten(geom)
# ---------- g_5: Python ----------
if node:
    geom = []
    lot_lst = node.traverse_tree(lambda n:n,internal=False)
    for n in lot_lst:
        geom.append(n.data.shape.cpt)
    print geom
# ---------- end g_5 ----------
geometry_4 = Geometry(tar.debug)
mass_addition_2 = MassAddition(Input=area_5.Area)  # -> Result, PartialResults
division_3 = Division(A=mass_addition_2.Result, B=area_6.Area)
panel_8 = Panel(division_3)
panel_9 = Panel(tar.TAR)
text_tag = TextTag(Location=g_5, Text=tar.TAR)
