# Grasshopper definition bibil_acadia_22_minimal.gh (Grasshopper 0.9.76)
# plug-ins: Python Interpreter, HDTReference

list = ValueList({"dir", "file"}, selected="dir")

# ---- group: find directory
bibil = PythonScript(
    dir=["C:\\Users\\vasanthakumars\\Documents\\GitHub\\bibil\\src", "C:\\saeran\\master\\git\\bibil\\src"],
    type=list,
    run=Toggle(True))  # -> dir; inputs dir: list
# ---------- bibil: Python ----------
import os
import sys

ghenv.Component.Params.Output[0].Name = "null"
ghenv.Component.Params.Output[0].NickName = "null"

#sys.path.append("C:\Program Files\Rhinoceros 5.0 (64-bit)\System")

if run:
    confirm_dir = None
    for d in dir:
        try:
            if type == "file":
                file_ = open(d)
                file_.close()
            else:
                print os.listdir(d)
            confirm_dir = d
            break
        except Exception as e:
            #print str(e)
            continue
    if confirm_dir != None:
        ghenv.Component.Params.Output[0].Name = type
        ghenv.Component.Params.Output[0].NickName = type
        dir = confirm_dir
        file = confirm_dir
null = None
# ---------- end bibil ----------

# ---- group: node_bucket
python_script = PythonScript(i=bibil)  # -> o
# ---------- python_script: Python ----------
import os

if i:
    o = os.path.join(str(i),"miru\\miru_shape_bucket.py")
# ---------- end python_script ----------
file = ReadFile(File=python_script, PerLineParse=False)

# ---- group: stepback_manual
python_script_2 = PythonScript(i=bibil)  # -> o
# ---------- python_script_2: Python ----------
import os

if i:
    o = os.path.join(str(i),"miru\\miru_stepback_manual.py")
# ---------- end python_script_2 ----------
file_2 = ReadFile(File=python_script_2, PerLineParse=False)

# ---- group: tree
python_script_3 = PythonScript(i=bibil)  # -> o
# ---------- python_script_3: Python ----------
import os

if i:
    o = os.path.join(str(i),"bibil\\bibil_tree.py")
# ---------- end python_script_3 ----------
file_3 = ReadFile(File=python_script_3, PerLineParse=False)
bibil_2 = PythonScript(Code=file_3)

# ---- group: grammar
python_script_4 = PythonScript(i=bibil)  # -> o
# ---------- python_script_4: Python ----------
import os

if i:
    o = os.path.join(str(i),"bibil\\bibil_grammar.py")
# ---------- end python_script_4 ----------
file_4 = ReadFile(File=python_script_4, PerLineParse=False)
bibil_3 = PythonScript(Code=file_4)

# ---- group: shape
python_script_5 = PythonScript(i=bibil)  # -> o
# ---------- python_script_5: Python ----------
import os

if i:
    o = os.path.join(str(i),"bibil\\bibil_shape.py")
#o = os.path.join(str(i),"research\\bibil_shape_shape_3d_2d.py")
# ---------- end python_script_5 ----------
file_5 = ReadFile(File=python_script_5, PerLineParse=False)
bibil_4 = PythonScript(Code=file_5)

# ---- group: bula
python_script_6 = PythonScript(i=bibil)  # -> o
# ---------- python_script_6: Python ----------
import os

if i:
    o = os.path.join(str(i),"bula\\bula_minimal.py")
# ---------- end python_script_6 ----------
file_6 = ReadFile(File=python_script_6, PerLineParse=False)
bibil_5 = PythonScript(Code=file_6)

# ---- group: UI
python_script_7 = PythonScript(i=bibil)  # -> o
# ---------- python_script_7: Python ----------
import os

if i:
    o = os.path.join(str(i),"bibil\\bibil_UI.py")
# ---------- end python_script_7 ----------
file_7 = ReadFile(File=python_script_7, PerLineParse=False)

# ---- group: grammar_divide
python_script_8 = PythonScript(i=bibil)  # -> o
# ---------- python_script_8: Python ----------
import os

if i:
    o = os.path.join(str(i),"miru\\miru_divide.py")
# ---------- end python_script_8 ----------
file_8 = ReadFile(File=python_script_8, PerLineParse=False)

# ---- group: grammar_courtyard
python_script_9 = PythonScript(i=bibil)  # -> o
# ---------- python_script_9: Python ----------
import os

if i:
    o = os.path.join(str(i),"miru\\miru_court.py")
# ---------- end python_script_9 ----------
file_9 = ReadFile(File=python_script_9, PerLineParse=False)

# ---- group: grammar_tower
python_script_10 = PythonScript(i=bibil)  # -> o
# ---------- python_script_10: Python ----------
import os

if i:
    o = os.path.join(str(i),"miru\\miru_packing.py")
# ---------- end python_script_10 ----------
file_10 = ReadFile(File=python_script_10, PerLineParse=False)

# ---- group: stepback
python_script_11 = PythonScript(i=bibil)  # -> o
# ---------- python_script_11: Python ----------
import os

if i:
    o = os.path.join(str(i),"miru\\miru_stepback.py")
# ---------- end python_script_11 ----------
file_11 = ReadFile(File=python_script_11, PerLineParse=False)

# ---- group: grammar_height
python_script_12 = PythonScript(i=bibil)  # -> o
# ---------- python_script_12: Python ----------
import os

if i:
    o = os.path.join(str(i),"miru\\miru_height.py")
# ---------- end python_script_12 ----------
file_12 = ReadFile(File=python_script_12, PerLineParse=False)

# ---- group: grammar_analysis_pts
python_script_13 = PythonScript(i=bibil)  # -> o
# ---------- python_script_13: Python ----------
import os

if i:
    o = os.path.join(str(i),"miru\\miru_analysis.py")
# ---------- end python_script_13 ----------
file_13 = ReadFile(File=python_script_13, PerLineParse=False)

# ---- group: meta_tree
python_script_14 = PythonScript(i=bibil)  # -> o
# ---------- python_script_14: Python ----------
import os

if i:
    o = os.path.join(str(i),"miru\\miru_meta_tree.py")
# ---------- end python_script_14 ----------
file_14 = ReadFile(File=python_script_14, PerLineParse=False)

# ---- group: land_use
python_script_15 = PythonScript(i=bibil)  # -> o
# ---------- python_script_15: Python ----------
import os

if i:
    o = os.path.join(str(i),"miru\\miru_landuse.py")
# ---------- end python_script_15 ----------
file_15 = ReadFile(File=python_script_15, PerLineParse=False)

# ---- group: shape2height
python_script_16 = PythonScript(i=bibil)  # -> o
# ---------- python_script_16: Python ----------
import os

if i:
    o = os.path.join(str(i),"miru\\miru_shape2height.py")
# ---------- end python_script_16 ----------
file_16 = ReadFile(File=python_script_16, PerLineParse=False)

# ---- group: extract_slice
python_script_17 = PythonScript(i=bibil)  # -> o
# ---------- python_script_17: Python ----------
import os

if i:
    o = os.path.join(str(i),"miru\\miru_extract_slice.py")
# ---------- end python_script_17 ----------
file_17 = ReadFile(File=python_script_17, PerLineParse=False)

# ----
list_2 = ValueList({"divide by depth": "subdivide_depth", "divide by same depth": "subdivide_depth_same", "divide by dim": "subdivide_dim"}, selected="divide by same depth")
list_3 = ValueList({"YZ": "NS", "XZ": "EW", "XY": "Z"}, selected="XZ")

# ---- group: SETBACK
miru = PythonScript(Code=file_11, Height_stepback="22.5:6.0", Run=Toggle(False))

# ---- group: PACKING
separatedata = Ladybug_SeparateData(Code=file_10, X_keep_omit="27.0,25.0", Y_keep_omit="27.0,25.0", Seperation_ref="-1", Run=Toggle(False))

# ---- group: ENERGY_MODEL_BUCKET
miru_2 = PythonScript(Code=file, Run=Toggle(True))

# ---- group: EXTRACT_SLICE
miru_3 = PythonScript(Code=file_17, Run=Toggle(False))

# ---- group: DIVIDE
miru_4 = PythonScript(
    Code=file_8,
    Divide_num=Slider(2, range=0..10),
    Divide_cut=Slider(0, range=0..100),
    Divide_type=list_2,
    Divide_ratio=Slider(0.5, range=0..1),
    Axis=list_3,
    Run=Toggle(False))

# ---- group: PERIMETER
miru_5 = PythonScript(Code=file_9, Width=Slider(20, range=0..100), Cut_width=Slider(0, range=0..100), Court_ref="0", Run=Toggle(False))

# ---- group: HEIGHT
miru_6 = PythonScript(Code=file_12, Height=Slider(16.5, range=0..100), Run=Toggle(True))

# ---- group: TREE RULES
miru_7 = PythonScript(Code=file_14, Run=Toggle(False))

# ---- group: SHAPE2HEIGHT
miru_8 = PythonScript(Code=file_16, Run=Toggle(False))

# ----
geo = Geometry(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)
geo_2 = Geometry(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)
geo_3 = Geometry([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])

# ---- group: SQUARE DIAGONAL
geo_4 = Geometry(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)

# ---- group: META-RES
bibil_6 = PythonScript(Code=file_7, Node_in=flatten(geo), Label_="ResRoot", Run=Toggle(True))  # -> Node_out, Debug

# ---- group: META-COM
bibil_7 = PythonScript(Code=file_7, Node_in=flatten(geo_2), Label_="ComRoot", Run=Toggle(True))  # -> Node_out, Debug

# ----
bibil_8 = PythonScript(Code=file_7, Node_in=flatten(geo_3), Label_="d1", Run=Toggle(True))  # -> Node_out, Debug

# ---- group: DRAGONFLY
geo_5 = Geometry([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])

# ----
g = PythonScript(node=bibil_8.Node_out)  # -> geom; inputs node: list
# ---------- g: Python ----------
node = filter(lambda n: n!=None,node)
if node and node != []:
    geom = []
    for n in node:
        geom.append(n.shape.bottom_crv)
        
    print geom
# ---------- end g ----------
data = Data([bibil_6.Node_out, bibil_7.Node_out])
data_2 = Data(bibil_8.Node_out)
previewlw = CustomPreviewLineweights(
    Geometry=g,
    Shader={ambient=RGB(0, 0, 0), diffuse=RGB(255, 105, 180), emission=RGB(76, 32, 54), shine=0.5, specular=RGB(255, 255, 255), transparency=0},
    Thickness=Slider(2, range=0..10))

# ---- group: PODIUM HEIGHT
number_slider = Slider(5, range=0..8, expression="(x*3) + 7.5")

# ---- group: DENSITY_UNIFORMITY
number_slider_2 = Slider(0, range=0..4)

# ----
python = PythonScript(init_zones=data, init_nodes=data_2, run=Toggle(True))  # -> res_node, com_node; inputs init_zones: list, init_nodes: list
# ---------- python: Python ----------
import random
import scriptcontext as sc
import Rhino as rc
import rhinoscriptsyntax as rs

import Grasshopper
import Grasshopper.Kernel as gh
import scriptcontext as sc
ghenv.Component.Message = 'Bibil_1'

Bula = sc.sticky['Bula']
Grammar = sc.sticky['Grammar']
sc.sticky['GLOBAL_COLLISION_LIST'] = []

def normalize_all_heights(raw_nodes):
    D={}
    max = raw_nodes[0].shape.ht
    min = raw_nodes[0].shape.ht
    htlst = []
    for i in xrange(len(raw_nodes)):
        ht = raw_nodes[i].shape.ht
        if ht>max:
            max = ht
        if ht<min:
            min = ht
        htlst.append(ht)
    #max and min heights
    normlst = B.normalize_list(htlst,91.5,37.5)#10.5)
    map(lambda nh: nh[0].shape.op_extrude(nh[1]),zip(raw_nodes,normlst))
    return raw_nodes
def set_parcel_by_zone(parcel_,zone_):
    L = []
    cpt = parcel_.shape.cpt
    for j in xrange(len(zone_)):
        zonecrv = zone_[j]
        #debug.append(zonecrv)
        IsIn = rs.PointInPlanarClosedCurve(cpt,zonecrv)
        if IsIn>0.5:
            IsDefined = True
            #debug.append(parcel)
            L.append(parcel_)
            break
    return L

if run:
    B = Bula()
    G = Grammar()
    # Normalize all heights
    norm_nodes = normalize_all_heights(init_nodes)
    
    # Sort the parcels by res/com boundaries
    # There needs to be a better spatial partiioning algorithm to do this part
    # Time complexity = O(2m) + O(4n)
    
    res_zones = []
    res_parcels,com_parcels = [],[]
    
    for i in xrange(len(init_zones)):
        zone = init_zones[i]
        if 'res' in zone.grammar.type['label'].lower():
            res_zones.append(zone.shape.bottom_crv)
            
    for i in xrange(len(norm_nodes)):
        norm = norm_nodes[i]
        IsInRes = set_parcel_by_zone(norm,res_zones)
        if IsInRes:
            res_parcels.append(norm)
        else:
            com_parcels.append(norm)
    
    zone_lst = [res_parcels, com_parcels]
    
    # Bucket according to density label
    bucket_dict = {"apply2list":True, "keys2bucket":["label"],\
                    "fx2bucket":"lambda n:n.grammar.type['label']"}
    for i in xrange(len(zone_lst)):
        nodesbytype = zone_lst[i]
        bucketed_lst = G.bucket_shape(nodesbytype,bucket_dict)
        nestedbylabel = bucketed_lst[0]
        nestedbylabel.sort(key=lambda tple:tple[0])
        zone_lst[i] = map(lambda l:l[1],nestedbylabel)
    
    res_node = zone_lst[0]
    com_node = zone_lst[1]
# ---------- end python ----------

# ----
# DEMAND
# PARAMETER
podium_ht = PythonScript(node_in=python.res_node, ht_threshold=number_slider, density_index=number_slider_2)  # -> hi, lo; inputs node_in: list, density_index: Int32
# ---------- podium_ht: Python ----------
import Grasshopper
import Grasshopper.Kernel as gh

ghenv.Component.Message = 'Bibil_2'


def set_density(parcel):
    lo,hi = [],[]
    for i in xrange(len(parcel)):
        pa = parcel[i]
        x_dist = pa.shape.x_dist
        y_dist = pa.shape.y_dist
        demand_ = pa.shape.ht
        
        # HIRISE
        if demand_ > MIN_HI_HT and x_dist > MIN_HI_DIST and y_dist > MIN_HI_DIST:
            hi.append(pa)
        # LOWRISE
        else:
            lo.append(pa)
    return hi,lo

if node_in:
    MIN_HI_DIST = 20.0
    MIN_HI_HT = ht_threshold
    select_node = node_in[density_index]
    hi,lo = set_density(select_node)
# ---------- end podium_ht ----------

# ----
# DEMAND
# PARAMETER
podium_ht_2 = PythonScript(node_in=python.com_node, ht_threshold=number_slider, density_index=number_slider_2)  # -> hi, lo; inputs node_in: list, density_index: Int32; same code as podium_ht

# ---- group: DON'T PASS NODES
g_2 = PythonScript(node=podium_ht.hi)  # -> geom; inputs node: list
# ---------- g_2: Python ----------
node = filter(lambda n: n!=None,node)
if node and node != []:
    geom = []
    for n in node:
        if n.shape.z_dist < 1.2:
            geom.append(n.shape.bottom_crv)
        else:
            geom.append(n.shape.geom)
    print geom
# ---------- end g_2 ----------
g_3 = PythonScript(node=podium_ht.lo)  # -> geom; inputs node: list; same code as g_2

g_4 = PythonScript(node=podium_ht_2.hi)  # -> geom; inputs node: list; same code as g_2
g_5 = PythonScript(node=podium_ht_2.lo)  # -> geom; inputs node: list; same code as g_2

# ----
toggle = BooleanToggle(True)
toggle_2 = BooleanToggle(True)
toggle_3 = BooleanToggle(True)
data_3 = Data([g_4, g_5])

# ----
# PODIUM HT
# PARAMETER
data_4 = Data(number_slider)

# ---- group: SETBACK
miru_9 = PythonScript(Code=file_2, Height_dim=Slider(21, range=0..100), Stepback_dim=Slider(2, range=0..10), From_rear=toggle, Run=toggle)

# ---- group: HEIGHT
# MIDRISE
miru_10 = PythonScript(Code=file_12, Height=Slider(30, range=0..100), Run=Toggle(True))

# ----
# SLAB_IN_PARK
# ROOT
toggle_4 = BooleanToggle(True)
# SLAB_W_PODIUM
# ROOT
toggle_5 = BooleanToggle(True)
# STREETS
# AVENUES
number_slider_3 = Slider(11, range=0..100)
number_slider_4 = Slider(10, range=0..100)

# ---- group: TREE RULES
miru_11 = PythonScript(Code=file_14, Node=bibil_7.Node_out, Run=toggle_4)

# ----
# STREETS
# AVENUES
number_slider_5 = Slider(11, range=0..100)

# ---- group: TREE RULES
miru_12 = PythonScript(Code=file_14, Node=bibil_7.Node_out, Run=toggle_5)

# ----
geo_6 = Geometry(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)
geo_7 = Geometry([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])
geo_8 = Geometry([geo_6, geo_7])
geo_9 = Geometry([geo_6, geo_7])

# ---- group: SETBACK
miru_13 = PythonScript(
    Code=file_2,
    Height_dim=Slider(7, range=0..100),
    Stepback_dim=Slider(2, range=0..10),
    Stepback_ref=geo_8,
    Stepback_tol=Slider(51, range=0..100),
    From_rear=toggle_2,
    Run=toggle_2)

miru_14 = PythonScript(
    Code=file_2,
    Height_dim=Slider(21, range=0..100),
    Stepback_dim=Slider(6, range=0..10),
    Stepback_ref=geo_9,
    Stepback_tol=Slider(51, range=0..100),
    From_rear=toggle_3,
    Run=toggle_3)

# ----
geo_10 = Geometry(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)
geo_11 = Geometry([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])
swatch = ColourSwatch(SwatchColor=RGB(255, 255, 255))
swatch_2 = ColourSwatch(SwatchColor=RGB(255, 255, 255))
previewlw_2 = CustomPreviewLineweights(Geometry=geo_6, Shader=swatch, Thickness=Slider(5, range=0..10))
previewlw_3 = CustomPreviewLineweights(Geometry=geo_7, Shader=swatch, Thickness=Slider(2, range=0..10))
previewlw_4 = CustomPreviewLineweights(Geometry=geo_10, Shader=swatch_2, Thickness=Slider(5, range=0..10))
previewlw_5 = CustomPreviewLineweights(Geometry=geo_11, Shader=swatch_2, Thickness=Slider(2, range=0..10))

# ---- group: SHAPENODE
bibil_9 = PythonScript(Code=file_7, Rule_in=flatten(miru_11), Node_in=flatten(data_3), Label_="PerimeterBlock2", Run=Toggle(True))  # -> Node_out, Debug

bibil_10 = PythonScript(Code=file_7, Rule_in=flatten(miru_12), Node_in=flatten(data_3), Label_="PerimeterBlock", Run=Toggle(False))  # -> Node_out, Debug

# ----
# BLOCK
number_slider_6 = Slider(30, range=0..100)
toggle_6 = BooleanToggle(True)
number_slider_7 = Slider(0, range=0..10)
# BLOCK
number_slider_8 = Slider(5, range=0..10)
toggle_7 = BooleanToggle(True)
g_6 = PythonScript(node=bibil_9.Node_out)  # -> geom; inputs node: list; same code as g_2
g_7 = PythonScript(node=bibil_10.Node_out)  # -> geom; inputs node: list
# ---------- g_7: Python ----------
node = filter(lambda n: n!=None,node)
if node and node != []:
    geom = []
    for n in node:
        if n.shape.UIgeom != None:
            geom.append(n.shape.UIgeom)
        else:
            geom.append(n.shape.geom)
# ---------- end g_7 ----------

# ---- group: SETBACK
miru_15 = PythonScript(
    Code=file_2,
    Height_dim=Slider(4.5, range=0..10),
    Stepback_dim=Slider(5, range=0..10),
    Stepback_ref=geo_6,
    Stepback_tol=number_slider_3,
    Run=toggle_6)

miru_16 = PythonScript(
    Code=file_2,
    Height_dim=Slider(10, range=0..10),
    Stepback_dim=Slider(2.5, range=0..10),
    Stepback_ref=geo_7,
    Stepback_tol=number_slider_4,
    Run=toggle_6)

# ---- group: HEIGHT
miru_17 = PythonScript(Code=file_12, Height=number_slider_6, Run=Toggle(True))

# ---- group: SETBACK
miru_18 = PythonScript(
    Code=file_2,
    Height_dim=number_slider_7,
    Stepback_dim=number_slider_8,
    Stepback_ref=geo_10,
    Stepback_tol=number_slider_5,
    Run=toggle_7)

miru_19 = PythonScript(
    Code=file_2,
    Height_dim=number_slider_7,
    Stepback_dim=Slider(2.5, range=0..10),
    Stepback_ref=geo_11,
    Stepback_tol=Slider(10, range=0..100),
    Run=toggle_7)

# ---- group: PERIMETER
miru_20 = PythonScript(Code=file_9, Width=Slider(30, range=0..100), Court_ref="0", Run=Toggle(True))

# ----
panel = Panel("-1")

# ---- group: SHAPENODE
bibil_11 = PythonScript(
    Code=file_7,
    Rule_in=flatten([miru_17, miru_15, miru_16]),
    Node_in=flatten(bibil_10.Node_out),
    Label_="MidRes",
    Run=Toggle(True))  # -> Node_out, Debug

# ----
# TOWERS
panel_3 = Panel("20.0,25.0")
# COURT
number_slider_9 = Slider(35, range=0..100)
geo_12 = Geometry()
toggle_8 = BooleanToggle(True)

# ---- group: SHAPENODE
bibil_12 = PythonScript(
    Code=file_7,
    Rule_in=flatten([miru_17, miru_18, miru_19, miru_20]),
    Node_in=flatten(bibil_9.Node_out),
    Label_="Block",
    Run=Toggle(True))  # -> Node_out, Debug

# ----
python_2 = PythonScript(x=geo_12)  # -> a; inputs x: list
# ---------- python_2: Python ----------
import rhinoscriptsyntax as rs
import scriptcontext as sc

#Shape = sc.sticky['Shape']
#S = Shape()

L = []
x = filter(lambda n: n!=None,x)
if x:
    for i in x:
        cpt = rs.CurveAreaCentroid(i)[0]
        if cpt[2] > 0.0:
            obj = rs.MoveObject(i,[0,0,cpt[2]*-1])
            L.append(obj)
        else:
            L.append(i)
a = L
# ---------- end python_2 ----------
g_8 = PythonScript(node=bibil_11.Node_out)  # -> geom; inputs node: list; same code as g_2

# ---- group: PERIMETER
miru_21 = PythonScript(Code=file_9, Width=number_slider_9, Court_ref="0", Run=Toggle(True))

# ---- group: SETBACK
miru_22 = PythonScript(
    Code=file_2,
    Height_dim=Slider(21, range=0..100),
    Stepback_dim=Slider(6, range=0..10),
    Stepback_ref=[geo_7, geo_6],
    Stepback_tol=number_slider_4,
    From_rear=toggle_8,
    Run=toggle_8)

# ---- group: PACKING
separatedata_2 = Ladybug_SeparateData(Code=file_10, Short_keep_omit="20.0,25.0", Long_keep_omit="40.0,25.0", Run=Toggle(True))

separatedata_3 = Ladybug_SeparateData(Code=file_10, Short_keep_omit=panel_3, Long_keep_omit="40.0,25.0", Run=Toggle(True))

# ---- group: SETBACK
miru_23 = PythonScript(
    Code=file_2,
    Height_dim=Slider(0, range=0..100),
    Stepback_dim=Slider(40, range=0..100),
    Stepback_ref=Slider(0, range=0..100),
    Run=Toggle(True))

# ----
g_9 = PythonScript(node=bibil_12.Node_out)  # -> geom; inputs node: list; same code as g_2

# ---- group: HEIGHT
miru_24 = PythonScript(Code=file_12, Height=Slider(64, range=0..100), Run=Toggle(True))

miru_25 = PythonScript(Code=file_12, Height_ref="PerimeterBlock2", Run=Toggle(True))

# ---- group: TREE RULES
miru_26 = PythonScript(Code=file_14, Node=bibil_7.Node_out, Run=Toggle(True))

# ----
dash = DashPattern(Curve=python_2, Pattern=Slider(1, range=0..10))  # -> Dashes, Gaps
g_10 = PythonScript(node=bibil_11.Node_out)  # -> street; inputs node: list
# ---------- g_10: Python ----------
node = filter(lambda n: n!=None,node)
if node and node != []:
    street = []
    for n in node:
        loc = n.backtrack_tree(lambda n: n.grammar.type.has_key('street_tolerance_curve'),accumulate=True)
        street.extend(map(lambda n:n.grammar.type['street_tolerance_curve'],loc))
    if street:
        street = reduce(lambda x,y:x+y,street)
    print street
# ---------- end g_10 ----------
previewlw_6 = CustomPreviewLineweights(Geometry=dash.Dashes, Shader=ColourSwatch(SwatchColor=RGB(0, 255, 255)), Thickness=Slider(1, range=0..10))

# ---- group: SHAPENODE
bibil_13 = PythonScript(Code=file_7, Rule_in=flatten([miru_21, miru_22]), Node_in=flatten(bibil_10.Node_out), Run=Toggle(True))  # -> Node_out, Debug

# ----
dash_2 = DashPattern(Curve=g_10, Pattern=Slider(2, range=0..10))  # -> Dashes, Gaps
geo_13 = Geometry(bibil_12.Debug)
# TOWERS
toggle_9 = BooleanToggle(True)
preview = CustomPreview(Geometry=dash_2.Dashes, Shader=ColourSwatch(SwatchColor=RGB(255, 255, 255)))

# ---- group: SHAPENODE
bibil_14 = PythonScript(
    Code=file_7,
    Rule_in=flatten([separatedata_3, miru_25]),
    Node_in=flatten(bibil_12.Node_out),
    Label_="HiResTower2",
    Run=Toggle(True))  # -> Node_out, Debug

bibil_15 = PythonScript(Code=file_7, Rule_in=flatten([miru_10, miru_14, miru_9, miru_13]), Node_in=flatten(bibil_14.Node_out), Run=Toggle(True))  # -> Node_out, Debug

# ----
g_11 = PythonScript(node=bibil_15.Node_out)  # -> geom; inputs node: list
# ---------- g_11: Python ----------
node = filter(lambda n: n!=None,node)
if node and node != []:
    geom = []
    for n in node:
        geom.append(n.shape.geom)
# ---------- end g_11 ----------

# ---- group: SHAPENODE
bibil_16 = PythonScript(Code=file_7, Rule_in=flatten([miru_26, miru_23, separatedata_2, miru_24]), Node_in=flatten(geo_13), Run=Toggle(True))  # -> Node_out, Debug

# ---- group: PACKING
separatedata_4 = Ladybug_SeparateData(Code=file_10, Short_keep_omit="20.0,25.0", Long_keep_omit="40.0,25.0", Run=Toggle(True))

# ---- group: EXTRACT_SLICE
miru_27 = PythonScript(Code=file_17, Run=toggle_9)

# ---- group: HEIGHT
miru_28 = PythonScript(Code=file_12, Height_ref="PerimeterBlock", Run=Toggle(True))

# ----
g_12 = PythonScript(node=bibil_16.Node_out)  # -> geom; inputs node: list; same code as g_11
g_13 = PythonScript(node=bibil_14.Node_out)  # -> geom; inputs node: list; same code as g_11
g_14 = PythonScript(node=bibil_13.Node_out)  # -> geom; inputs node: list; same code as g_2

# ---- group: SHAPENODE
bibil_17 = PythonScript(
    Code=file_7,
    Rule_in=flatten([miru_27, separatedata_4, miru_28]),
    Node_in=flatten(bibil_13.Node_out),
    Label_="HiResTower",
    Run=Toggle(True))  # -> Node_out, Debug

# ----
g_15 = PythonScript(node=bibil_17.Node_out)  # -> geom; inputs node: list; same code as g_11
geo_14 = Geometry(bibil_17.Debug)
number_slider_10 = Slider(6, range=0..10)
python_3 = PythonScript(x=geo_14)  # -> a; inputs x: list; same code as python_2
dash_3 = DashPattern(Curve=python_3, Pattern=Slider(1, range=0..10))  # -> Dashes, Gaps
sunion = SolidUnion(Breps=[g_14, g_15])  # disabled
fmerge = MergeFaces(Brep=sunion)  # -> Breps, Before, After; disabled
wires = BrepWireframe(Brep=fmerge.Breps, Density=-1)  # disabled
previewlw_7 = CustomPreviewLineweights(Geometry=dash_3.Dashes, Shader=ColourSwatch(SwatchColor=RGB(0, 255, 255)), Thickness=Slider(1, range=0..10))

# ---- group: filternull
python_4 = PythonScript(x=g_15)  # -> a; inputs x: list
# ---------- python_4: Python ----------
a = filter(lambda n:n!=None,x)
# ---------- end python_4 ----------

# ----
geo_15 = Geometry(python_4)

# ----
# DEFINE GROUND ZONE
ground_zone = Brep(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)  # disabled
toggle_10 = BooleanToggle(True)  # disabled
mass2zone = Honeybee_Masses2Zones(zoneMasses=flatten(ground_zone), isConditioned=True, maxRoofAngle=30, createHBZones=toggle_10)  # -> readMe, HBZones; disabled; plug-in component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
soil_type = Panel("4")  # disabled
createepground = Honeybee_CreateEPGround(HBZones=mass2zone.HBZones, soilTypeOrMat=soil_type)  # -> HBGrndZones; disabled; plug-in component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

panel_5 = Panel("http://apps1.eere.energy.gov/buildings/energyplus/weatherdata/6_europe_wmo_region_6/FRA_Paris.Orly.071490_IWEC.zip")  # disabled

ladybug = Ladybug_Ladybug()  # -> Vviiiiiiiiiizzz; disabled; plug-in component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
honeybee = Honeybee_Honeybee()  # -> Vviiiiiiiiiizzz; disabled; plug-in component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

evaluation_surface = Brep(<brep referenced from the Rhino model>)  # disabled
geo_16 = Geometry(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)  # disabled
# CALCULATE
# VIEW FACTORS
# 2
geo_17 = Geometry(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)  # disabled
epw_stat = Ladybug_OpenEPWAndSTATWeatherFiles(weatherFileURL=panel_5)  # -> epwFile, statFile; disabled; plug-in component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
geo_18 = Geometry(g_15)  # disabled
importstat = Ladybug_ImportStat(statFile=epw_stat.statFile)  # -> readMe, ashraeClimateZone, koppenClimateZone, port, heatingDesignTemp, coolingDesignTemp, port_2, extremeHotWeek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; disabled; plug-in component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
sunion_2 = SolidUnion(Breps=geo_18)  # disabled
fmerge_2 = MergeFaces(Brep=sunion_2)  # -> Breps, Before, After; disabled
hb_epcontextsrf = HoneybeeEPContextSurfaces(shdSurfaces=flatten(fmerge_2.Breps))  # -> HBContext; inputs shdSurfaces: list of Brep, justBoundingBox: Boolean; disabled
# ---------- hb_epcontextsrf: Python ----------
"""
prepare shading/context geometries

    Args:
        northVectorOrRotation: A vector that shows North or a number that shows
                               the rotation of the North from the Y axis
        bldgMasses: List of closed Breps as thermal zones.
    Returns:
        report: ...
        thermalZones: Thermal zone's geometries for visualiza
"""

ghenv.Component.Name = 'Honeybee EP context Surfaces'
ghenv.Component.NickName = 'HB_EPContextSrf'
ghenv.Component.Message = 'VER 0.0.61\nFEB_05_2017'
ghenv.Component.IconDisplayMode = ghenv.Component.IconDisplayMode.application
ghenv.Component.Category = "Honeybee"
ghenv.Component.SubCategory = "10 | Energy | Energy"
#compatibleHBVersion = VER 0.0.57\nNOV_04_2016
#compatibleLBVersion = VER 0.0.59\nFEB_01_2015
ghenv.Component.AdditionalHelpFromDocStrings = "2"

import rhinoscriptsyntax as rs
import Rhino as rc
import scriptcontext as sc
import os
import System
import Grasshopper.Kernel as gh
import uuid

tolerance = sc.doc.ModelAbsoluteTolerance
import math


def main(shdSurfaces, EPTransSchedule, meshingSettings, justBoundingBox):
    
    # import the classes
    if sc.sticky.has_key('honeybee_release'):

        try:
            if not sc.sticky['honeybee_release'].isCompatible(ghenv.Component): return -1
            if sc.sticky['honeybee_release'].isInputMissing(ghenv.Component): return -1
        except:
            warning = "You need a newer version of Honeybee to use this compoent." + \
            " Use updateHoneybee component to update userObjects.\n" + \
            "If you have already updated userObjects drag Honeybee_Honeybee component " + \
            "into canvas and try again."
            w = gh.GH_RuntimeMessageLevel.Warning
            ghenv.Component.AddRuntimeMessage(w, warning)
            return -1
        
        # don't customize this part
        hb_EPSrf = sc.sticky["honeybee_EPSurface"]
        hb_EPSHDSurface = sc.sticky["honeybee_EPShdSurface"]
        hb_RADMaterialAUX = sc.sticky["honeybee_RADMaterialAUX"]
        hb_EPObjectsAux = sc.sticky["honeybee_EPObjectsAUX"]()
        HBScheduleList = sc.sticky["honeybee_ScheduleLib"].keys()

        ########################################################################
        #----------------------------------------------------------------------#
        shdBreps = []
        # create bounding box of shading geometries
        if justBoundingBox:
            for brep in shdSurfaces:
                if brep.Faces.Count>1 or not brep.Faces[0].IsPlanar(sc.doc.ModelAbsoluteTolerance):
                    shdBreps.append(brep.GetBoundingBox(True).ToBrep())
                else:
                    shdBreps.append(brep)
        else:
            shdBreps = shdSurfaces
        
        shadingClasses = []
        shadingMeshPreview = []
        
        if meshingSettings == None:
            mp = rc.Geometry.MeshingParameters.Minimal
            mp.SimplePlanes = True
        else:
            mp = meshingSettings
        
        def getRadMaterialName(radMaterial):
            nameStr = radMaterial.split(" ")[2]
            name =  nameStr.split("\n")[0]
            return name
        
        for brepCount, brep in enumerate(shdBreps):
            if brep != None:
                isPlanar = True
                # check planarity
                for face in brep.Faces:
                    if not face.IsPlanar(tolerance):
                        isPlanar = False
                        break
                
                shadingBreps = []
                if not isPlanar:
                    meshArray = rc.Geometry.Mesh.CreateFromBrep(brep, mp)
                    for mesh in meshArray:
                        for meshFace in range(mesh.Faces.Count):
                            vertices = list(mesh.Faces.GetFaceVertices(meshFace))[1:]
                            vertices = vertices + [sc.doc.ModelAbsoluteTolerance]
                            # create the brep from mesh
                            shdBrep = rc.Geometry.Brep.CreateFromCornerPoints(*vertices)
                            shadingBreps.append(shdBrep)
                else:
                    for face in brep.Faces:
                        shadingBreps.append(face.DuplicateFace(False))
                
                for faceCount, shdBrep in enumerate(shadingBreps):
                        thisShading = hb_EPSHDSurface(shdBrep, 1000*brepCount + faceCount, 'shdSrf_' + `brepCount` + '_' + `faceCount` + "_" + str(uuid.uuid4()))
                        
                        # add transmittance schedule if any
                        if EPTransSchedule!=None:
                            schedule= EPTransSchedule.upper()
                            if schedule!=None and not schedule.lower().endswith(".csv") and schedule not in HBScheduleList:
                                msg = "Cannot find " + schedule + " in Honeybee schedule library."
                                print msg
                                ghenv.Component.AddRuntimeMessage(gh.GH_RuntimeMessageLevel.Warning, msg)
                                return -1
                            elif schedule!=None and schedule.lower().endswith(".csv"):
                                # check if csv file is existed
                                if not os.path.isfile(schedule):
                                    msg = "Cannot find the shchedule file: " + schedule
                                    print msg
                                    ghenv.Component.AddRuntimeMessage(gh.GH_RuntimeMessageLevel.Warning, msg)
                                    return -1
                            
                            thisShading.TransmittanceSCH = schedule
                        
                        # add the Rad Material if any
                        if RADMaterial!=None:
                            # if it is just the name of the material make sure it is already defined
                            if len(RADMaterial.split(" ")) == 1:
                                # if the material is not in the library add it to the library
                                if not hb_RADMaterialAUX.isMatrialExistInLibrary(RADMaterial):
                                    warningMsg = "Can't find " + RADMaterial + " in RAD Material Library.\n" + \
                                                "Add the material to the library and try again."
                                    ghenv.Component.AddRuntimeMessage(gh.GH_RuntimeMessageLevel.Warning, warningMsg)
                                    return
                                
                                try:
                                    thisShading.setRADMaterial(RADMaterial)
                                except Exception, e:
                                    print e
                                    warningMsg = "You are using an old version of Honeybee_Honeybee! Update your files and try again."
                                    print warningMsg
                                    ghenv.Component.AddRuntimeMessage(gh.GH_RuntimeMessageLevel.Warning, warningMsg)
                                    return
                                
                                addedToLib = True
                            else:
                                
                                # try to add the material to the library
                                addedToLib, thisShading.RadMaterial = hb_RADMaterialAUX.analyseRadMaterials(RADMaterial, True)
                                
                            if addedToLib==False:
                                warningMsg = "Failed to add " + RADMaterial + " to the Library."
                                ghenv.Component.AddRuntimeMessage(gh.GH_RuntimeMessageLevel.Warning, warningMsg)
                                return
                        
                        # add shading to the list
                        shadingClasses.append(thisShading)
                
        # add to the hive
        hb_hive = sc.sticky["honeybee_Hive"]()
        HBContext  = hb_hive.addToHoneybeeHive(shadingClasses, ghenv.Component)
        return HBContext
        ################################################################################################
    else:
        print "You should first let Honeybee to fly..."
        w = gh.GH_RuntimeMessageLevel.Warning
        ghenv.Component.AddRuntimeMessage(w, "You should first let Honeybee to fly...")
        return -1
        

if _shdSurfaces and _shdSurfaces[0]!=None:
    # add cleaning function
    result= main(_shdSurfaces, EPTransSchedule_, meshingSettings_, justBoundingBox_)
    
    if result != -1: HBContext = result
# ---------- end hb_epcontextsrf ----------
number_slider_11 = Slider(10, range=0..10)  # disabled
number_slider_12 = Slider(9, range=0..100)  # disabled
number_slider_13 = Slider(11, range=0..100)  # disabled
number_slider_14 = Slider(23, range=0..100)  # disabled
panel_6 = Panel("""OutputControl:Table:Style,Comma;
Output:Variable,*,Surface Outside Face Temperature, hourly;""")  # disabled
toggle_11 = BooleanToggle(False)  # disabled
analysisperiod = Ladybug_AnalysisPeriod(
    fromMonth=number_slider_12,
    fromDay=number_slider_14,
    fromHour=number_slider_11,
    toMonth=number_slider_12,
    toDay=number_slider_14,
    toHour=number_slider_13)  # -> readMe, analysisPeriod; disabled; plug-in component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
energysimpar = Honeybee_EnergySimulationPar(timestep=6, solarDistribution="4")  # -> energySimPar; disabled; plug-in component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
panel_7 = Panel("2")  # disabled
toggle_12 = BooleanToggle(True)  # disabled
toggle_13 = BooleanToggle(True)  # disabled
# 1
toggle_14 = BooleanToggle(True)  # disabled
indoorviewfactor = Honeybee_IndoorViewFactorCalculator(
    HBZones=flatten(createepground),
    gridSize=panel_7,
    distFromFloorOrSrf=flatten([geo_17, geo_16]),
    additionalShading=flatten(fmerge_2.Breps),
    includeOutdoor=toggle_13,
    parallel=toggle_12,
    buildMesh=toggle_11,
    runIt=toggle_11)  # -> readMe, port, viewFactorMesh, viewFactorInfo, port_2, testPts, viewMeshFaces, zoneWireFrame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; disabled; plug-in component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

exporttoopenstudio = Honeybee_ExportToOpenStudio(
    epwWeatherFile=epw_stat.epwFile,
    analysisPeriod=analysisperiod.analysisPeriod,
    HBZones=flatten(createepground),
    HBContext=flatten(hb_epcontextsrf),
    simulationOutputs=flatten(panel_6),
    writeOSM=toggle_14,
    runSimulation=toggle_14)  # -> readMe, osmFileAddress, idfFileAddress, resultsFileAddress, eioFileAddress, rddFileAddress, studyFolder; disabled; plug-in component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
readepsrfresult = Honeybee_ReadEPSurfaceResult(resultFileAddress=exporttoopenstudio.resultsFileAddress)  # -> port, surfaceOutdoorTemp, port_2, port_3, port_4, port_5, port_6, port_7, port_8, port_9; disabled; plug-in component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

medges = MeshEdges(Mesh=indoorviewfactor.viewFactorMesh)  # -> NakedEdges, InteriorEdges, NonManifoldEdges; disabled
toggle_15 = BooleanToggle(True)  # disabled
colorsurfaces = Honeybee_ColorSurfacesByEPResult(srfData=readepsrfresult.surfaceOutdoorTemp, HBZones=flatten(createepground), runIt=toggle_15)  # -> readMe, srfColoredMesh, zoneWireFrame, legend, legendBasePt, analysisTitle, srfBreps, srfColors, srfValues, port; disabled; plug-in component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
area = Area(Geometry=colorsurfaces.srfBreps)  # -> Area, Centroid; disabled
tag = TextTag(Location=area.Centroid, Text=colorsurfaces.srfValues)  # disabled
panel_8 = Panel(readepsrfresult.surfaceOutdoorTemp)  # disabled
# 3
toggle_16 = BooleanToggle(True)  # disabled

# ----
# RUN MICROCLIMATE MAP
outdoorcomfrecipe = Honeybee_OutdoorComfortAnalysisRecipe(
    viewFactorMesh=indoorviewfactor.viewFactorMesh,
    viewFactorInfo=indoorviewfactor.viewFactorInfo,
    epwFile=epw_stat.epwFile,
    srfOutdoorTemp=readepsrfresult.surfaceOutdoorTemp)  # -> comfRecipe; disabled; plug-in component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
microclimatemap = Honeybee_MicroclimateMapAnalysis(
    comfAnalysisRecipe=outdoorcomfrecipe,
    analysisPeriodOrHOY=analysisperiod.analysisPeriod,
    parallel=toggle_16,
    runIt=toggle_16)  # -> readMe, port, radTempMtx, airTempMtx, operativeTempMtx, adaptComfMtx, degFromTargetMtx, port_2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; disabled; plug-in component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

# ----
# Scroll Through the Hours of the Simulation
# VISUALIZE MICROCLIMATE MAP
number_slider_15 = Slider(24, range=1..24)  # disabled
visualizemicroclimate = Honeybee_VisualizeMicroclimateMap(comfResultsMtx=microclimatemap.operativeTempMtx, viewFactorMesh=flatten(indoorviewfactor.viewFactorMesh))  # -> readMe, port, resultMesh, legend, legendBasePt, port_2, resultValues, resultColors; disabled; plug-in component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

mesh = Mesh(visualizemicroclimate.resultMesh)  # disabled
