# Grasshopper definition bibil_acadia_24_minimal.gh (Grasshopper 0.9.76)
# plug-ins: Python Interpreter, ArchsimGH, HDTReference

list = ValueList({"dir", "file"}, selected="dir")

# ---- group: find directory
bibil = PythonScript(
    dir=["C:\\Users\\vasanthakumars\\Documents\\GitHub\\bibil\\src", "C:\\saeran\\master\\git\\bibil\\src"],
    type=list,
    run=Toggle(True))  # -> dir; inputs dir: list
# ---------- bibil: Python ----------
import os
import sys

ghenv.Component.Params.Output[0].Name = "null"
ghenv.Component.Params.Output[0].NickName = "null"

#sys.path.append("C:\Program Files\Rhinoceros 5.0 (64-bit)\System")

if run:
    confirm_dir = None
    for d in dir:
        try:
            if type == "file":
                file_ = open(d)
                file_.close()
            else:
                print os.listdir(d)
            confirm_dir = d
            break
        except Exception as e:
            #print str(e)
            continue
    if confirm_dir != None:
        ghenv.Component.Params.Output[0].Name = type
        ghenv.Component.Params.Output[0].NickName = type
        dir = confirm_dir
        file = confirm_dir
null = None
# ---------- end bibil ----------

# ---- group: abstract_bem
python_script = PythonScript(i=bibil)  # -> o
# ---------- python_script: Python ----------
import os

if i:
    o = os.path.join(str(i),"miru\\miru_abstract_bem.py")
# ---------- end python_script ----------
file = ReadFile(File=python_script, PerLineParse=False)

# ---- group: stepback_manual
python_script_2 = PythonScript(i=bibil)  # -> o
# ---------- python_script_2: Python ----------
import os

if i:
    o = os.path.join(str(i),"miru\\miru_stepback_manual.py")
# ---------- end python_script_2 ----------
file_2 = ReadFile(File=python_script_2, PerLineParse=False)

# ---- group: extract_canyon
python_script_3 = PythonScript(i=bibil)  # -> o
# ---------- python_script_3: Python ----------
import os

if i:
    o = os.path.join(str(i),"miru\\miru_extract_canyon.py")
# ---------- end python_script_3 ----------
file_3 = ReadFile(File=python_script_3, PerLineParse=False)

# ---- group: interpolate_vertical
python_script_4 = PythonScript(i=bibil)  # -> o
# ---------- python_script_4: Python ----------
import os

if i:
    o = os.path.join(str(i),"miru\\miru_interpolate_vertical.py")
# ---------- end python_script_4 ----------
file_4 = ReadFile(File=python_script_4, PerLineParse=False)

# ---- group: filter_nodes
python_script_5 = PythonScript(i=bibil)  # -> o
# ---------- python_script_5: Python ----------
import os

if i:
    o = os.path.join(str(i),"miru\\miru_filter_nodes.py")
# ---------- end python_script_5 ----------
file_5 = ReadFile(File=python_script_5, PerLineParse=False)

# ---- group: tree
python_script_6 = PythonScript(i=bibil)  # -> o
# ---------- python_script_6: Python ----------
import os

if i:
    o = os.path.join(str(i),"bibil\\bibil_tree.py")
# ---------- end python_script_6 ----------
file_6 = ReadFile(File=python_script_6, PerLineParse=False)
bibil_2 = PythonScript(Code=file_6)

# ---- group: grammar
python_script_7 = PythonScript(i=bibil)  # -> o
# ---------- python_script_7: Python ----------
import os

if i:
    o = os.path.join(str(i),"bibil\\bibil_grammar.py")
# ---------- end python_script_7 ----------
file_7 = ReadFile(File=python_script_7, PerLineParse=False)
bibil_3 = PythonScript(Code=file_7)

# ---- group: shape
python_script_8 = PythonScript(i=bibil)  # -> o
# ---------- python_script_8: Python ----------
import os

if i:
    o = os.path.join(str(i),"bibil\\bibil_shape.py")
#o = os.path.join(str(i),"research\\bibil_shape_shape_3d_2d.py")
# ---------- end python_script_8 ----------
file_8 = ReadFile(File=python_script_8, PerLineParse=False)
bibil_4 = PythonScript(Code=file_8)

# ---- group: bula
python_script_9 = PythonScript(i=bibil)  # -> o
# ---------- python_script_9: Python ----------
import os

if i:
    o = os.path.join(str(i),"bula\\bula_minimal.py")
# ---------- end python_script_9 ----------
file_9 = ReadFile(File=python_script_9, PerLineParse=False)
bibil_5 = PythonScript(Code=file_9)

# ---- group: UI
python_script_10 = PythonScript(i=bibil)  # -> o
# ---------- python_script_10: Python ----------
import os

if i:
    o = os.path.join(str(i),"bibil\\bibil_UI.py")
# ---------- end python_script_10 ----------
file_10 = ReadFile(File=python_script_10, PerLineParse=False)

# ---- group: grammar_divide
python_script_11 = PythonScript(i=bibil)  # -> o
# ---------- python_script_11: Python ----------
import os

if i:
    o = os.path.join(str(i),"miru\\miru_divide.py")
# ---------- end python_script_11 ----------
file_11 = ReadFile(File=python_script_11, PerLineParse=False)

# ---- group: grammar_courtyard
python_script_12 = PythonScript(i=bibil)  # -> o
# ---------- python_script_12: Python ----------
import os

if i:
    o = os.path.join(str(i),"miru\\miru_court.py")
# ---------- end python_script_12 ----------
file_12 = ReadFile(File=python_script_12, PerLineParse=False)

# ---- group: grammar_tower
python_script_13 = PythonScript(i=bibil)  # -> o
# ---------- python_script_13: Python ----------
import os

if i:
    o = os.path.join(str(i),"miru\\miru_packing.py")
# ---------- end python_script_13 ----------
file_13 = ReadFile(File=python_script_13, PerLineParse=False)

# ---- group: stepback
python_script_14 = PythonScript(i=bibil)  # -> o
# ---------- python_script_14: Python ----------
import os

if i:
    o = os.path.join(str(i),"miru\\miru_stepback.py")
# ---------- end python_script_14 ----------
file_14 = ReadFile(File=python_script_14, PerLineParse=False)

# ---- group: grammar_height
python_script_15 = PythonScript(i=bibil)  # -> o
# ---------- python_script_15: Python ----------
import os

if i:
    o = os.path.join(str(i),"miru\\miru_height.py")
# ---------- end python_script_15 ----------
file_15 = ReadFile(File=python_script_15, PerLineParse=False)

# ---- group: grammar_analysis_pts
python_script_16 = PythonScript(i=bibil)  # -> o
# ---------- python_script_16: Python ----------
import os

if i:
    o = os.path.join(str(i),"miru\\miru_analysis.py")
# ---------- end python_script_16 ----------
file_16 = ReadFile(File=python_script_16, PerLineParse=False)

# ---- group: meta_tree
python_script_17 = PythonScript(i=bibil)  # -> o
# ---------- python_script_17: Python ----------
import os

if i:
    o = os.path.join(str(i),"miru\\miru_meta_tree.py")
# ---------- end python_script_17 ----------
file_17 = ReadFile(File=python_script_17, PerLineParse=False)

# ---- group: land_use
python_script_18 = PythonScript(i=bibil)  # -> o
# ---------- python_script_18: Python ----------
import os

if i:
    o = os.path.join(str(i),"miru\\miru_landuse.py")
# ---------- end python_script_18 ----------
file_18 = ReadFile(File=python_script_18, PerLineParse=False)

# ---- group: shape2height
python_script_19 = PythonScript(i=bibil)  # -> o
# ---------- python_script_19: Python ----------
import os

if i:
    o = os.path.join(str(i),"miru\\miru_shape2height.py")
# ---------- end python_script_19 ----------
file_19 = ReadFile(File=python_script_19, PerLineParse=False)

# ---- group: extract_slice
python_script_20 = PythonScript(i=bibil)  # -> o
# ---------- python_script_20: Python ----------
import os

if i:
    o = os.path.join(str(i),"miru\\miru_extract_slice.py")
# ---------- end python_script_20 ----------
file_20 = ReadFile(File=python_script_20, PerLineParse=False)

# ----
list_2 = ValueList({"divide by depth": "subdivide_depth", "divide by same depth": "subdivide_depth_same", "divide by dim": "subdivide_dim"}, selected="divide by same depth")
list_3 = ValueList({"YZ": "NS", "XZ": "EW", "XY": "Z"}, selected="XZ")

# ---- group: SETBACK
miru = PythonScript(Code=file_14, Height_stepback="22.5:6.0", Run=Toggle(False))

# ---- group: PACKING
separatedata = Ladybug_SeparateData(Code=file_13, X_keep_omit="27.0,25.0", Y_keep_omit="27.0,25.0", Seperation_ref="-1", Run=Toggle(False))

# ---- group: EXTRACT_SLICE
miru_2 = PythonScript(Code=file_20, Run=Toggle(False))

# ---- group: DIVIDE
miru_3 = PythonScript(
    Code=file_11,
    Divide_num=Slider(2, range=0..10),
    Divide_cut=Slider(0, range=0..100),
    Divide_type=list_2,
    Divide_ratio=Slider(0.5, range=0..1),
    Axis=list_3,
    Run=Toggle(False))

# ---- group: PERIMETER
miru_4 = PythonScript(Code=file_12, Width=Slider(20, range=0..100), Cut_width=Slider(0, range=0..100), Court_ref="0", Run=Toggle(False))

# ---- group: HEIGHT
miru_5 = PythonScript(Code=file_15, Height=Slider(16.5, range=0..100), Run=Toggle(True))

# ---- group: TREE RULES
miru_6 = PythonScript(Code=file_17, Run=Toggle(False))

# ---- group: SHAPE2HEIGHT
miru_7 = PythonScript(Code=file_19, Run=Toggle(False))

# ----
geo = Geometry([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])
geo_2 = Geometry([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])
geo_3 = Geometry([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])
geo_4 = Geometry([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])
geo_5 = Geometry([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])
bibil_6 = PythonScript(Code=file_10, Node_in=flatten(geo_3), Label_="density_04", Run=Toggle(True))  # -> Node_out, Debug
bibil_7 = PythonScript(Code=file_10, Node_in=flatten(geo_2), Label_="density_03", Run=Toggle(True))  # -> Node_out, Debug
bibil_8 = PythonScript(Code=file_10, Node_in=flatten(geo), Label_="density_02", Run=Toggle(True))  # -> Node_out, Debug
bibil_9 = PythonScript(Code=file_10, Node_in=flatten(geo_4), Label_="density_01", Run=Toggle(True))  # -> Node_out, Debug
bibil_10 = PythonScript(Code=file_10, Node_in=flatten(geo_5), Label_="density_00", Run=Toggle(True))  # -> Node_out, Debug

# ---- group: DRAGONFLY
geo_6 = Geometry([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])

# ---- group: STEPBACK_PARAMETER
number_slider = Slider(5, range=0..6)
panel = Panel("[0.0,1.5,3.0,4.5,6.0,7.5,9.0]")

# ---- group: PODIUM_PARAMETER
panel_2 = Panel("[10.5,13.5,16.5,19.5,22.5,25.5,28.5,31.5]")
number_slider_2 = Slider(0, range=0..7)

# ---- group: SETBACK_PARAMETER
panel_3 = Panel("[0.0,1.5,3.0,4.5,6.0]")
number_slider_3 = Slider(2, range=0..4)

# ---- group: ARCHETYPE_PARAMETER
panel_4 = Panel("['tower_in_park','tower_on_podium','slab_in_park','slab_on_podium']")
number_slider_4 = Slider(0, range=0..3)

# ---- group: DENSITY_PARAMETER
panel_5 = Panel("[0,1,2,3,4]")
number_slider_5 = Slider(0, range=0..4)

# ----
data = Data([bibil_6.Node_out, bibil_7.Node_out, bibil_8.Node_out, bibil_9.Node_out, bibil_10.Node_out])
fly = Ladybug_fly(inputSliders=[number_slider_5, number_slider_4])  # -> Vviiiiiiiiiizzz; plug-in component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
podium_ht = PythonScript(
    density_set=panel_5,
    density_par=number_slider_5,
    arctype_set=panel_4,
    arctype_par=number_slider_4,
    podium_set=panel_2,
    podium_par=number_slider_2,
    setback_set=panel_3,
    setback_par=number_slider_3,
    stepback_set=panel,
    stepback_par=number_slider,
    node_in=data,
    run=Toggle(True))  # -> node_out, arctype_str, podium_ht, setback_dim, stepback_dim; inputs density_par: Int32, arctype_par: Int32, podium_par: Int32, setback_par: Int32, stepback_par: Int32, node_in: list
# ---------- podium_ht: Python ----------
import Grasshopper
import Grasshopper.Kernel as gh
import scriptcontext as sc

ghenv.Component.Message = 'Bibil_2'

Bula = sc.sticky['Bula']
Grammar = sc.sticky['Grammar']

B = Bula()
G = Grammar()

if run and node_in:
    
    # Bucket according to density label
    bucket_dict = {"apply2list":True, "keys2bucket":["label"],\
                    "fx2bucket":"lambda n:n.grammar.type['label']"}
                    
    bucketed_lst = G.bucket_shape(node_in,bucket_dict)
    nestedbylabel = bucketed_lst[0]
    nestedbylabel.sort(key=lambda tple:tple[0])
    node_in = map(lambda l:l[1],nestedbylabel)
    
    #Density Parameter
    density_set = eval(density_set)
    density_index = density_set[density_par] 
    node_out = node_in[density_index]
    
    #Arctype Parameters
    arctype_set = eval(arctype_set)
    arctype_str = arctype_set[arctype_par]
    
    #Podium Parameters
    podium_set = eval(podium_set)
    podium_ht = podium_set[podium_par]
    
    #Stepback Parameters
    stepback_set = eval(stepback_set)
    stepback_dim = stepback_set[stepback_par]
    
    #Setback Parameters
    setback_set = eval(setback_set)
    setback_dim = setback_set[setback_par]
# ---------- end podium_ht ----------
python = PythonScript()  # -> res_node, com_node; inputs init_zones: list, init_nodes: list; disabled
# ---------- python: Python ----------
import random
import scriptcontext as sc
import Rhino as rc
import rhinoscriptsyntax as rs

import Grasshopper
import Grasshopper.Kernel as gh
import scriptcontext as sc
ghenv.Component.Message = 'Bibil_1'

Bula = sc.sticky['Bula']
Grammar = sc.sticky['Grammar']
sc.sticky['GLOBAL_COLLISION_LIST'] = []

def normalize_all_heights(raw_nodes):
    D={}
    max = raw_nodes[0].shape.ht
    min = raw_nodes[0].shape.ht
    htlst = []
    for i in xrange(len(raw_nodes)):
        ht = raw_nodes[i].shape.ht
        if ht>max:
            max = ht
        if ht<min:
            min = ht
        htlst.append(ht)
    #max and min heights
    normlst = B.normalize_list(htlst,91.5,10.5)
    map(lambda nh: nh[0].shape.op_extrude(nh[1]),zip(raw_nodes,normlst))
    return raw_nodes
def set_parcel_by_zone(parcel_,zone_):
    L = []
    cpt = parcel_.shape.cpt
    for j in xrange(len(zone_)):
        zonecrv = zone_[j]
        #debug.append(zonecrv)
        IsIn = rs.PointInPlanarClosedCurve(cpt,zonecrv)
        if IsIn>0.5:
            IsDefined = True
            #debug.append(parcel)
            L.append(parcel_)
            break
    return L

if run:
    B = Bula()
    G = Grammar()
    # Normalize all heights
    norm_nodes = normalize_all_heights(init_nodes)
    
    # Sort the parcels by res/com boundaries
    # There needs to be a better spatial partiioning algorithm to do this part
    # Time complexity = O(2m) + O(4n)
    
    res_zones = []
    res_parcels,com_parcels = [],[]
    
    for i in xrange(len(init_zones)):
        zone = init_zones[i]
        if 'res' in zone.grammar.type['label'].lower():
            res_zones.append(zone.shape.bottom_crv)
            
    for i in xrange(len(norm_nodes)):
        norm = norm_nodes[i]
        IsInRes = set_parcel_by_zone(norm,res_zones)
        if IsInRes:
            res_parcels.append(norm)
        else:
            com_parcels.append(norm)
    
    zone_lst = [res_parcels, com_parcels]
    
    # Bucket according to density label
    bucket_dict = {"apply2list":True, "keys2bucket":["label"],\
                    "fx2bucket":"lambda n:n.grammar.type['label']"}
    for i in xrange(len(zone_lst)):
        nodesbytype = zone_lst[i]
        bucketed_lst = G.bucket_shape(nodesbytype,bucket_dict)
        nestedbylabel = bucketed_lst[0]
        nestedbylabel.sort(key=lambda tple:tple[0])
        zone_lst[i] = map(lambda l:l[1],nestedbylabel)
    
    res_node = zone_lst[0]
    com_node = zone_lst[1]
# ---------- end python ----------
python_2 = PythonScript(x=number_slider_5, y=podium_ht.arctype_str, z=podium_ht.podium_ht, u=podium_ht.setback_dim, v=podium_ht.stepback_dim)  # -> a
# ---------- python_2: Python ----------
L = [x,y,z,u,v]
M = ['dev_','type_','podht_','set_','step_']

strout = ""
for i,j in zip(L,M):
    strout += '---' + j + str(i).replace('.','dot')
    

a = strout

print a
# ---------- end python_2 ----------
g = PythonScript(node=podium_ht.node_out)  # -> geom; inputs node: list
# ---------- g: Python ----------
node = filter(lambda n: n!=None,node)
if node and node != []:
    geom = []
    for n in node:
        if n.shape.z_dist < 1.2:
            geom.append(n.shape.bottom_crv)
        else:
            geom.append(n.shape.geom)
    print geom
# ---------- end g ----------
data_2 = Data(podium_ht.podium_ht)
data_3 = Data(podium_ht.setback_dim)
data_4 = Data(podium_ht.stepback_dim)
panel_6 = Panel(podium_ht.podium_ht)
panel_7 = Panel(podium_ht.setback_dim)
panel_8 = Panel(podium_ht.stepback_dim)
geo_7 = Geometry(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)
geo_8 = Geometry(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)
area = Area(Geometry=geo_8)  # -> Area, Centroid
area_2 = Area(Geometry=geo_7)  # -> Area, Centroid
number_slider_6 = Slider(1.1, range=0..10)
scale = Scale(Geometry=geo_7, Center=area_2.Centroid, Factor=number_slider_6)  # -> Geometry, Transform
scale_2 = Scale(Geometry=geo_8, Center=area.Centroid, Factor=number_slider_6)  # -> Geometry, Transform
python_3 = PythonScript(
    arctype_str=podium_ht.arctype_str,
    slab_short="19.0,10.0",
    slab_long="38,10.0",
    tower_short="26.0,10.0",
    tower_long="26.0,10.0",
    run=Toggle(True))  # -> park, podium, dim_short, dim_long; inputs slab_short: list, tower_short: list
# ---------- python_3: Python ----------
park,podium = False,False
dim_short,dim_long = slab_short,slab_long

if arctype_str and run:
    arc_lst = arctype_str.split('_')
    #tower in park
    if 'tower' in arc_lst and 'park' in arc_lst:
        park = True
        dim_short = tower_short
        dim_long = tower_long
    #tower in podium
    elif 'tower' in arc_lst and 'podium' in arc_lst:
        podium = True
        dim_short = tower_short
        dim_long = tower_long
    #slab in park
    elif 'slab' in arc_lst and 'park' in arc_lst:
        park = True
        dim_short = slab_short
        dim_long = slab_long
    #slab in podium
    else:#if 'slab' in arc_lst and 'podium' in arc_lst:
        podium = True
        dim_short = slab_short
        dim_long = slab_long
    
    print arctype_str
    print park
    print podium
    print dim_short
    print dim_long
# ---------- end python_3 ----------

# ---- group: grnd@0
python_4 = PythonScript(crv_in=[geo_8, geo_7])  # -> crv_out
# ---------- python_4: Python ----------
import rhinoscriptsyntax as rs
import Rhino as rc

curve = rs.coercecurve(crv_in)
rc_, polyline = curve.TryGetPolyline()
if rc_: 
    points = map(lambda pt:pt,polyline)
    for pt in points:
        pt.Z = 0.0
    curve = rc.Geometry.Curve.CreateControlPointCurve(points,1)
crv_out = curve
# ---------- end python_4 ----------

# ----
number_slider_7 = Slider(15, range=0..100)
data_5 = Data(python_3.dim_short)
data_6 = Data(python_3.dim_long)
bool = Boolean(python_3.park)
bool_2 = Boolean(python_3.podium)

# ---- group: ROOT
# ROOT
bibil_11 = PythonScript(Code=file_10, Node_in=flatten(python_4), Label_="Root", Run=Toggle(True))  # -> Node_out, Debug

# ----
geo_9 = Geometry(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)
geo_10 = Geometry([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])
g_2 = PythonScript(node=bibil_11.Node_out)  # -> geom; inputs node: list
# ---------- g_2: Python ----------
node = filter(lambda n: n!=None,node)
if node and node != []:
    geom = []
    for n in node:
        if n.shape.UIgeom != None:
            geom.append(n.shape.UIgeom)
        else:
            geom.append(n.shape.geom)
# ---------- end g_2 ----------

# ---- group: TREE RULES
miru_8 = PythonScript(Code=file_17, Node=bibil_11.Node_out, Run=Toggle(True))

# ----
swatch = ColourSwatch(SwatchColor=RGB(255, 255, 255))
previewlw = CustomPreviewLineweights(Geometry=geo_9, Shader=swatch, Thickness=Slider(5, range=0..10))
previewlw_2 = CustomPreviewLineweights(Geometry=geo_10, Shader=swatch, Thickness=Slider(2, range=0..10))

# ---- group: SHAPENODE
bibil_12 = PythonScript(Code=file_10, Rule_in=flatten(miru_8), Node_in=flatten(g), Label_="PerimeterBlock", Run=Toggle(True))  # -> Node_out, Debug

# ----
number_slider_8 = Slider(2.5, range=0..10)
number_slider_9 = Slider(5, range=0..10)
number_slider_10 = Slider(5, range=0..10)
# BLOCK
number_slider_11 = Slider(30, range=0..100)
g_3 = PythonScript(node=bibil_12.Node_out)  # -> geom; inputs node: list; same code as g_2

# ---- group: SETBACK
miru_9 = PythonScript(
    Code=file_2,
    Height_dim=Slider(4.5, range=0..10),
    Stepback_dim=data_4,
    Stepback_ref=geo_9,
    Stepback_tol=Slider(15, range=0..100),
    Run=Toggle(True))

miru_10 = PythonScript(
    Code=file_2,
    Height_dim=Slider(10, range=0..10),
    Stepback_dim=data_4,
    Stepback_ref=geo_10,
    Stepback_tol=number_slider_7,
    Run=Toggle(True))

miru_11 = PythonScript(Code=file_2, Height_dim=Slider(0, range=0..100), Stepback_dim=data_3, Run=Toggle(True))

# ---- group: HEIGHT
miru_12 = PythonScript(Code=file_15, Height=data_2, Run=Toggle(True))

# ---- group: SHAPENODE
bibil_13 = PythonScript(
    Code=file_10,
    Rule_in=flatten([miru_12, miru_9, miru_10, miru_11]),
    Node_in=flatten(bibil_12.Node_out),
    Label_="MidRes",
    Run=Toggle(True))  # -> Node_out, Debug

# ----
# COURT
number_slider_12 = Slider(36, range=0..100)
toggle = BooleanToggle(False)

# ---- group: SETBACK
miru_13 = PythonScript(
    Code=file_2,
    Height_dim=Slider(21, range=0..100),
    Stepback_dim=Slider(4, range=0..10),
    Stepback_ref=[geo_10, geo_9],
    Stepback_tol=number_slider_7,
    From_rear=toggle,
    Run=toggle)

# ---- group: PERIMETER
miru_14 = PythonScript(Code=file_12, Width=number_slider_12, Court_ref="0", Run=Toggle(True))

# ----
geo_11 = Geometry(bibil_13.Debug)
g_4 = PythonScript(node=bibil_13.Node_out)  # -> street; inputs node: list
# ---------- g_4: Python ----------
if node and node != [None]:
    street = []
    for n in node:
        foo = lambda n: n.grammar.type.has_key('street_tolerance_curve')
        n = n.backtrack_tree(foo,accumulate=False)
        if n:
            srf_data = n.grammar.type['street_tolerance_curve']
            print srf_data
            print '--'
            street.extend(srf_data)
    print street
# ---------- end g_4 ----------
g_5 = PythonScript(node=bibil_13.Node_out)  # -> geom; inputs node: list; same code as g

# ---- group: SHAPENODE
bibil_14 = PythonScript(Code=file_10, Rule_in=flatten([miru_14, miru_13]), Node_in=flatten(bibil_13.Node_out), Run=Toggle(True))  # -> Node_out, Debug

# ----
python_5 = PythonScript()  # -> a; inputs x: list
# ---------- python_5: Python ----------
import rhinoscriptsyntax as rs
import scriptcontext as sc

#Shape = sc.sticky['Shape']
#S = Shape()

L = []
x = filter(lambda n: n!=None,x)
if x:
    for i in x:
        cpt = rs.CurveAreaCentroid(i)[0]
        if cpt[2] > 0.0:
            obj = rs.MoveObject(i,[0,0,cpt[2]*-1])
            L.append(obj)
        else:
            L.append(i)
a = L
# ---------- end python_5 ----------
g_6 = PythonScript()  # -> street; inputs node: list
# ---------- g_6: Python ----------
node = filter(lambda n: n!=None,node)
if node and node != []:
    street = []
    for n in node:
        loc = n.backtrack_tree(lambda n: n.grammar.type.has_key('street_tolerance_curve'),accumulate=True)
        street.extend(map(lambda n:n.grammar.type['street_tolerance_curve'],loc))
    if street:
        street = reduce(lambda x,y:x+y,street)
    print street
# ---------- end g_6 ----------
geo_12 = Geometry(bibil_14.Debug)
g_7 = PythonScript(node=bibil_14.Node_out)  # -> geom; inputs node: list
# ---------- g_7: Python ----------
node = filter(lambda n: n!=None,node)
if node and node != []:
    geom = []
    for n in node:
        geom.append(n.shape.geom)
    print geom
# ---------- end g_7 ----------
dash = DashPattern(Curve=python_5, Pattern=Slider(1, range=0..10))  # -> Dashes, Gaps
dash_2 = DashPattern(Curve=g_6, Pattern=Slider(2, range=0..10))  # -> Dashes, Gaps
preview = CustomPreview(Geometry=dash_2.Dashes, Shader=ColourSwatch(SwatchColor=RGB(255, 255, 255)))
previewlw_3 = CustomPreviewLineweights(Geometry=dash.Dashes, Shader=ColourSwatch(SwatchColor=RGB(0, 255, 255)), Thickness=Slider(1, range=0..10))
python_6 = PythonScript(x=data_5, y=data_6)  # -> s, l
# ---------- python_6: Python ----------
shortdim = x.split(',')
longdim = y.split(',')



s_ = float(shortdim[0])
l_ = float(longdim[0])


#Tower = 26 x 26
if abs(s_ - 26.0) < 0.1:
    s = s_ - 1.5
    l = l_  - 1.5
#Slab = 19 x 38
else:
    s = None
    l = l_
# ---------- end python_6 ----------

# ---- group: FILTER_NODES
miru_15 = PythonScript(
    Code=file_5,
    Dim4long=python_6.l,
    Dim4short=python_6.s,
    ByMax=Toggle(True),
    Tol=Slider(0.5, range=0..1),
    Run=Toggle(True))

# ----
python_7 = PythonScript(node=bibil_14.Node_out, bool=bool_2)  # -> node_out
# ---------- python_7: Python ----------
if bool:
    node_out = node
else:
    node_out = None
# ---------- end python_7 ----------

# ---- group: SHAPENODE
bibil_15 = PythonScript(Code=file_10, Rule_in=flatten(miru_15), Node_in=flatten(g_7), Run=Toggle(True))  # -> Node_out, Node_dead, Debug

# ----
# W_PODIUM
toggle_2 = BooleanToggle(True)
# TOWERS
toggle_3 = BooleanToggle(True)
# IN_PARK
# TOWERS
g_8 = PythonScript(node=python_7)  # -> geom; inputs node: list; same code as g_7
g_9 = PythonScript(node=bibil_15.Node_out)  # -> geom; inputs node: list
# ---------- g_9: Python ----------
node = filter(lambda n: n!=None,node)
if node and node != []:
    geom = []
    for n in node:
        geom.append(n.shape.geom)
    #print geom
# ---------- end g_9 ----------
g_10 = PythonScript(node=bibil_15.Node_dead)  # -> geom; inputs node: list; same code as g_7

# ---- group: PACKING
separatedata_2 = Ladybug_SeparateData(Code=file_13, Short_keep_omit=data_5, Long_keep_omit=data_6, Run=Toggle(True))

separatedata_3 = Ladybug_SeparateData(Code=file_13, Short_keep_omit=data_5, Long_keep_omit=data_6, Run=Toggle(True))

# ---- group: EXTRACT_SLICE
miru_16 = PythonScript(Code=file_20, Run=toggle_3)

# ---- group: HEIGHT
miru_17 = PythonScript(Code=file_15, Height_ref="PerimeterBlock", Randomize="-12.0>12.0", Run=Toggle(True))

# ---- group: EXTRACT_SLICE
miru_18 = PythonScript(Code=file_20, Slice_height=Slider(0, range=0..100), Run=Toggle(True))

# ---- group: HEIGHT
miru_19 = PythonScript(Code=file_15, Height_ref="PerimeterBlock", Randomize="-12.0>12.0", Run=toggle_2)

# ----
preview_2 = CustomPreview(
    Geometry=g_9,
    Shader={ambient=RGB(0, 0, 0), diffuse=RGB(255, 105, 180), emission=RGB(76, 32, 54), shine=0.5, specular=RGB(255, 255, 255), transparency=0})

# ---- group: SHAPENODE
bibil_16 = PythonScript(
    Code=file_10,
    Rule_in=flatten([miru_18, separatedata_3, miru_19]),
    Node_in=flatten(bibil_14.Node_out),
    Label_="HiResTower2",
    Run=bool)  # -> Node_out, Debug

bibil_17 = PythonScript(
    Code=file_10,
    Rule_in=flatten([miru_16, separatedata_2, miru_17]),
    Node_in=flatten(bibil_14.Node_out),
    Label_="HiResTower",
    Run=bool_2)  # -> Node_out, Debug

# ----
g_11 = PythonScript(node=bibil_17.Node_out)  # -> geom; inputs node: list
# ---------- g_11: Python ----------
node = filter(lambda n: n!=None,node)
if node and node != []:
    geom = []
    for n in node:
        geom.append(n.shape.geom)
# ---------- end g_11 ----------
g_12 = PythonScript(node=bibil_16.Node_out)  # -> geom; inputs node: list; same code as g_11
number_slider_13 = Slider(7, range=0..10)
data_7 = Data([g_8, g_11])

# ---- group: FILTER_NODES
miru_20 = PythonScript(Code=file_5, Dim4long=number_slider_13, Dim4short=number_slider_13, Run=Toggle(True))

# ---- group: filternull
python_8 = PythonScript(x=[data_7, g_12])  # -> a; inputs x: list
# ---------- python_8: Python ----------
a = filter(lambda n:n!=None,x)
# ---------- end python_8 ----------

# ----
data_8 = Data([bibil_16.Node_out, bibil_17.Node_out, g_8, bibil_15.Node_out])

# ---- group: SHAPENODE
bibil_18 = PythonScript(Code=file_10, Rule_in=flatten(miru_20), Node_in=flatten(data_8), Run=Toggle(True))  # -> Node_out, Debug

# ----
geo_13 = Geometry(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)
g_13 = PythonScript(node=bibil_18.Node_out)  # -> geom; inputs node: list
# ---------- g_13: Python ----------
node = filter(lambda n: n!=None,node)
if node and node != []:
    geom = []
    for n in node:
        if n.shape.geom:
            geom.append(n.shape.geom)
    #print geom
# ---------- end g_13 ----------

# ---- group: ABSTRACT_BEM
miru_21 = PythonScript(Code=file, Bem_tol=Slider(39, range=0..100), Bem_center=geo_13, Run=Toggle(True))

# ----
number_slider_14 = Slider(2, range=0..10)
number_slider_15 = Slider(1.5, range=0..10)
wires = BrepWireframe(Brep=g_13, Density=-1)
dash_3 = DashPattern(Curve=wires, Pattern=number_slider_15)  # -> Dashes, Gaps

# ---- group: SHAPENODE
bibil_19 = PythonScript(Code=file_10, Rule_in=flatten(miru_21), Node_in=flatten(bibil_18.Node_out), Run=Toggle(True))  # -> Node_out, Node_dead, Debug

# ----
preview_3 = CustomPreview(Geometry=dash_3.Dashes, Shader=ColourSwatch(SwatchColor=RGB(255, 255, 255)))
g_14 = PythonScript(node=bibil_19.Node_out)  # -> geom; inputs node: list; same code as g_13
g_15 = PythonScript(node=bibil_19.Node_out)  # -> geom; inputs node: list; same code as g_13
geo_14 = Geometry(bibil_19.Debug)

bldgprograms = Honeybee_bldgPrograms({"Office": 0, "Retail": 1, "MidriseApartment": 2, "PrimarySchool": 3, "SecondarySchool": 4, "SmallHotel": 5, "LargeHotel": 6, "Hospital": 7, "Outpatient": 8, "Warehouse": 9, "SuperMarket": 10, "FullServiceRestaurant": 11, "QuickServiceRestaurant": 12}, selected="Warehouse")  # disabled
listzoneprograms = Honeybee_ListZonePrograms(bldgProgram=bldgprograms)  # -> zonePrograms; plug-in component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
item = ListItem(List=listzoneprograms, Index="2", Wrap=True)

wires_2 = BrepWireframe(Brep=g_15, Density=-1)
g_16 = PythonScript(node=bibil_19.Node_out)  # -> tolerance; inputs node: list
# ---------- g_16: Python ----------
node = filter(lambda n: n!=None,node)
if node and node != []:
    tolerance = []
    for n in node:
        loc = n.backtrack_tree(lambda n: n.grammar.type.has_key('tolerance_curve'),accumulate=True)
        tolerance.extend(map(lambda n:n.grammar.type['tolerance_curve'],loc))
    if tolerance:
        tolerance = reduce(lambda x,y:x+y,tolerance)
# ---------- end g_16 ----------

# ---- group: change this to come from root find context
g_17 = PythonScript(node=bibil_19.Node_dead)  # -> context; inputs node: list
# ---------- g_17: Python ----------
node = filter(lambda n: n!=None,node)
if node and node != []:
    context = []
   
    for n in node:
        print n.grammar.type
        foo = lambda n: n.grammar.type.has_key('context_geometry')
        loc = n.backtrack_tree(foo,accumulate=True)
        context.extend(map(lambda n:n.grammar.type['context_geometry'],loc))
    print context
# ---------- end g_17 ----------

# ----
wires_3 = BrepWireframe(Brep=g_17, Density=-1)
dash_4 = DashPattern(Curve=wires_3, Pattern=number_slider_15)  # -> Dashes, Gaps
panel_9 = Panel(bibil_19.Debug)
preview_4 = CustomPreview(Geometry=dash_4.Dashes, Shader=ColourSwatch(SwatchColor=RGB(64, 64, 64)))
dash_5 = DashPattern(Curve=wires_2, Pattern=Slider(1.5, range=0..10))  # -> Dashes, Gaps
previewlw_4 = CustomPreviewLineweights(Geometry=g_16, Shader=ColourSwatch(SwatchColor=RGB(255, 0, 255)), Thickness=Slider(3, range=0..10))
geo_15 = Geometry([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])
preview_5 = CustomPreview(Geometry=dash_5.Dashes, Shader=ColourSwatch(SwatchColor=RGB(255, 255, 255)))
floor_cutter = FloorCutter(BuildingVolume=geo_15, FloorHeights=Slider(3, range=0..10))
geo_16 = Geometry(g_15)
callfromepconstrlibrary = Honeybee_CallFromEPConstructionLibrary(keywords="concrete")  # -> EPMaterials, EPWindowMaterils, EPConstructions; plug-in component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
epnomassmat = Honeybee_EnergyPlusNoMassOpaqueMaterial(name="AsphaltMembrane", R_Value="0.5", thermAbsp="0.9", solAbsp="0.8", visAbsp="0.8")  # -> EPMaterial; plug-in component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
geo_17 = Geometry([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])
mass2zone = Honeybee_Masses2Zones(zoneMasses=flatten(geo_16), zonePrograms=item, isConditioned=Toggle(False), maxRoofAngle=30, createHBZones=Toggle(True))  # -> readMe, HBZones; plug-in component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
item_2 = ListItem(List=callfromepconstrlibrary.EPMaterials, Index="2", Wrap=True)
panel_10 = Panel(item_2)
epconstruction = Honeybee_EnergyPlusConstruction(name="ConcreteWall", layer_1=item_2)  # -> EPConstruction; plug-in component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
epconstruction_2 = Honeybee_EnergyPlusConstruction(name="AsphaltRoof", layer_1=epnomassmat, layer_2=item_2)  # -> EPConstruction; plug-in component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
panel_11 = Panel("6")
glazingcreator = Honeybee_GlazingBasedOnRatio(glzRatio="0.4", breakUpWindow=Toggle(False), runIt=Toggle(False))  # -> readMe, HBObjWGLZ; plug-in component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
createepplenum = Honeybee_CreateEPPlenum(HBZones=mass2zone.HBZones)  # -> HBPlenumZones; plug-in component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
ladybug = Ladybug_Ladybug()  # -> Vviiiiiiiiiizzz; plug-in component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
honeybee = Honeybee_Honeybee()  # -> Vviiiiiiiiiizzz; plug-in component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
dragonfly = Dragonfly_Dragonfly()  # -> Vviiiiiiiiiizzz; plug-in component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
srfattributelist = Honeybee_SurfaceAttributeList({"Name": "name", "Radiance Material": "RadMaterial", "EnergyPlus Construction": "EPConstruction", "Surface Type": "type", "Boundary Condition": "BC", "Sun Exposure": "sunExposure", "Wind Exposure": "windExposure", "Has Child Surface": "hasChild", "Is Child Surface": "isChild", "Is Planar": "isPlanar", "Srf Type Set By User": "srfTypeByUser", "Boundary Condition Set By User": "srfBCByUser", "Shade Material Name": "shadeMaterialName", "Shading Control Name": "shadingControlName", "Shcading Schedule Name": "shadingSchName"}, selected="Name")
zoneattributelist = Honeybee_ZoneAttributeList({"Name": "name", "Zone Program": "zoneProgram", "Zone Floor Area": "zoneFloorArea", "Zone Volume": "zoneVolume", "Building Program": "bldgProgram", "Is Conditioned": "isConditioned", "HVAC System Type": "HVACSystem", "Occupancy Schedule": "occupancySchedule", "Occupancy Activity Schedule": "occupancyActivitySch", "Heating SetPoint Schedule": "heatingSetPtSchedule"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}, selected="Name")
setepzonecnstr = Honeybee_SetEPZoneConstruction(HBZones=flatten(createepplenum), wallEPConstruction=epconstruction)  # -> simplify(modifiedHBZones); plug-in component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
labelzones = Honeybee_LabelZones(HBZones=flatten(setepzonecnstr), attribute=zoneattributelist)  # -> zoneTxtLabels, labelBasePts, brepTxtLabels, zoneWireFrames; plug-in component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
labelsurfaces = Honeybee_LabelZoneSurfaces(HBObjects=flatten(setepzonecnstr), attribute=srfattributelist)  # -> surfaceTxtLabels, labelBasePts, brepTxtLabels, surfaceWireFrames; plug-in component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
wires_4 = BrepWireframe(Brep=setepzonecnstr, Density=-1)
toggle_4 = BooleanToggle(True)
tag = TextTag(Location=labelzones.labelBasePts, Text=labelzones.zoneTxtLabels)
tag_2 = TextTag(Location=labelsurfaces.labelBasePts, Text=labelsurfaces.surfaceTxtLabels)
makeadiabaticbytype = Honeybee_MakeAdiabaticByType(HBZones=setepzonecnstr, roofs=toggle_4, ceilings=toggle_4, floors=toggle_4)  # -> HBZones; plug-in component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
panel_12 = Panel("http://apps1.eere.energy.gov/buildings/energyplus/weatherdata/6_europe_wmo_region_6/FRA_Paris.Orly.071490_IWEC.zip")
geo_18 = Geometry([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])
ground_zone = Brep([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])
floor_cutter_2 = FloorCutter(BuildingVolume=geo_18, FloorHeights="3")
mass2zone_2 = Honeybee_Masses2Zones(zoneMasses=flatten(floor_cutter_2), isConditioned=Toggle(True), maxRoofAngle=30, createHBZones=Toggle(True))  # -> readMe, HBZones; plug-in component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
mass2zone_3 = Honeybee_Masses2Zones(zoneMasses=flatten(ground_zone), isConditioned=True, maxRoofAngle=30, createHBZones=Toggle(True))  # -> readMe, HBZones; plug-in component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
epw_stat = Ladybug_OpenEPWAndSTATWeatherFiles(weatherFileURL=panel_12)  # -> epwFile, statFile; plug-in component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
soil_type = Panel("4")
panel_13 = Panel(""".4
0
.4
0""")
createepground = Honeybee_CreateEPGround(HBZones=mass2zone_3.HBZones, soilTypeOrMat=soil_type)  # -> HBGrndZones; plug-in component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
importstat = Ladybug_ImportStat(statFile=epw_stat.statFile)  # -> readMe, ashraeClimateZone, koppenClimateZone, port, heatingDesignTemp, coolingDesignTemp, port_2, extremeHotWeek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; plug-in component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
glazingcreator_2 = Honeybee_GlazingBasedOnRatio(HBObjects=mass2zone_2.HBZones, glzRatio=panel_13, breakUpWindow=Toggle(False), runIt=Toggle(True))  # -> readMe, HBObjWGLZ; plug-in component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
gencumulativeskymtx = Ladybug_GenCumulativeSkyMtx(epwFile=epw_stat.epwFile, skyDensity=0, useOldRes=True, runIt=Toggle(True))  # -> readMe, cumulativeSkyMtx; plug-in component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
geo_19 = Geometry(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)
selectskymtx = Ladybug_selectSkyMtx(cumulativeSkyMtx=gencumulativeskymtx.cumulativeSkyMtx, removeDiffuse=False, removeDirect=False)  # -> readMe, selectedSkyMtx; plug-in component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
solveadjc = Honeybee_SolveAdjacencies(HBZones=flatten([glazingcreator_2.HBObjWGLZ, createepground]), removeCurrentAdjc=False, findAdjc=Toggle(False))  # -> readMe, HBZonesWADJ; plug-in component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
hb_epcontextsrf = HoneybeeEPContextSurfaces(shdSurfaces=flatten(geo_19))  # -> HBContext; inputs shdSurfaces: list of Brep, justBoundingBox: Boolean; disabled
# ---------- hb_epcontextsrf: Python ----------
"""
prepare shading/context geometries

    Args:
        northVectorOrRotation: A vector that shows North or a number that shows
                               the rotation of the North from the Y axis
        bldgMasses: List of closed Breps as thermal zones.
    Returns:
        report: ...
        thermalZones: Thermal zone's geometries for visualiza
"""

ghenv.Component.Name = 'Honeybee EP context Surfaces'
ghenv.Component.NickName = 'HB_EPContextSrf'
ghenv.Component.Message = 'VER 0.0.61\nFEB_05_2017'
ghenv.Component.IconDisplayMode = ghenv.Component.IconDisplayMode.application
ghenv.Component.Category = "Honeybee"
ghenv.Component.SubCategory = "10 | Energy | Energy"
#compatibleHBVersion = VER 0.0.57\nNOV_04_2016
#compatibleLBVersion = VER 0.0.59\nFEB_01_2015
ghenv.Component.AdditionalHelpFromDocStrings = "2"

import rhinoscriptsyntax as rs
import Rhino as rc
import scriptcontext as sc
import os
import System
import Grasshopper.Kernel as gh
import uuid

tolerance = sc.doc.ModelAbsoluteTolerance
import math


def main(shdSurfaces, EPTransSchedule, meshingSettings, justBoundingBox):
    
    # import the classes
    if sc.sticky.has_key('honeybee_release'):

        try:
            if not sc.sticky['honeybee_release'].isCompatible(ghenv.Component): return -1
            if sc.sticky['honeybee_release'].isInputMissing(ghenv.Component): return -1
        except:
            warning = "You need a newer version of Honeybee to use this compoent." + \
            " Use updateHoneybee component to update userObjects.\n" + \
            "If you have already updated userObjects drag Honeybee_Honeybee component " + \
            "into canvas and try again."
            w = gh.GH_RuntimeMessageLevel.Warning
            ghenv.Component.AddRuntimeMessage(w, warning)
            return -1
        
        # don't customize this part
        hb_EPSrf = sc.sticky["honeybee_EPSurface"]
        hb_EPSHDSurface = sc.sticky["honeybee_EPShdSurface"]
        hb_RADMaterialAUX = sc.sticky["honeybee_RADMaterialAUX"]
        hb_EPObjectsAux = sc.sticky["honeybee_EPObjectsAUX"]()
        HBScheduleList = sc.sticky["honeybee_ScheduleLib"].keys()

        ########################################################################
        #----------------------------------------------------------------------#
        shdBreps = []
        # create bounding box of shading geometries
        if justBoundingBox:
            for brep in shdSurfaces:
                if brep.Faces.Count>1 or not brep.Faces[0].IsPlanar(sc.doc.ModelAbsoluteTolerance):
                    shdBreps.append(brep.GetBoundingBox(True).ToBrep())
                else:
                    shdBreps.append(brep)
        else:
            shdBreps = shdSurfaces
        
        shadingClasses = []
        shadingMeshPreview = []
        
        if meshingSettings == None:
            mp = rc.Geometry.MeshingParameters.Minimal
            mp.SimplePlanes = True
        else:
            mp = meshingSettings
        
        def getRadMaterialName(radMaterial):
            nameStr = radMaterial.split(" ")[2]
            name =  nameStr.split("\n")[0]
            return name
        
        for brepCount, brep in enumerate(shdBreps):
            if brep != None:
                isPlanar = True
                # check planarity
                for face in brep.Faces:
                    if not face.IsPlanar(tolerance):
                        isPlanar = False
                        break
                
                shadingBreps = []
                if not isPlanar:
                    meshArray = rc.Geometry.Mesh.CreateFromBrep(brep, mp)
                    for mesh in meshArray:
                        for meshFace in range(mesh.Faces.Count):
                            vertices = list(mesh.Faces.GetFaceVertices(meshFace))[1:]
                            vertices = vertices + [sc.doc.ModelAbsoluteTolerance]
                            # create the brep from mesh
                            shdBrep = rc.Geometry.Brep.CreateFromCornerPoints(*vertices)
                            shadingBreps.append(shdBrep)
                else:
                    for face in brep.Faces:
                        shadingBreps.append(face.DuplicateFace(False))
                
                for faceCount, shdBrep in enumerate(shadingBreps):
                        thisShading = hb_EPSHDSurface(shdBrep, 1000*brepCount + faceCount, 'shdSrf_' + `brepCount` + '_' + `faceCount` + "_" + str(uuid.uuid4()))
                        
                        # add transmittance schedule if any
                        if EPTransSchedule!=None:
                            schedule= EPTransSchedule.upper()
                            if schedule!=None and not schedule.lower().endswith(".csv") and schedule not in HBScheduleList:
                                msg = "Cannot find " + schedule + " in Honeybee schedule library."
                                print msg
                                ghenv.Component.AddRuntimeMessage(gh.GH_RuntimeMessageLevel.Warning, msg)
                                return -1
                            elif schedule!=None and schedule.lower().endswith(".csv"):
                                # check if csv file is existed
                                if not os.path.isfile(schedule):
                                    msg = "Cannot find the shchedule file: " + schedule
                                    print msg
                                    ghenv.Component.AddRuntimeMessage(gh.GH_RuntimeMessageLevel.Warning, msg)
                                    return -1
                            
                            thisShading.TransmittanceSCH = schedule
                        
                        # add the Rad Material if any
                        if RADMaterial!=None:
                            # if it is just the name of the material make sure it is already defined
                            if len(RADMaterial.split(" ")) == 1:
                                # if the material is not in the library add it to the library
                                if not hb_RADMaterialAUX.isMatrialExistInLibrary(RADMaterial):
                                    warningMsg = "Can't find " + RADMaterial + " in RAD Material Library.\n" + \
                                                "Add the material to the library and try again."
                                    ghenv.Component.AddRuntimeMessage(gh.GH_RuntimeMessageLevel.Warning, warningMsg)
                                    return
                                
                                try:
                                    thisShading.setRADMaterial(RADMaterial)
                                except Exception, e:
                                    print e
                                    warningMsg = "You are using an old version of Honeybee_Honeybee! Update your files and try again."
                                    print warningMsg
                                    ghenv.Component.AddRuntimeMessage(gh.GH_RuntimeMessageLevel.Warning, warningMsg)
                                    return
                                
                                addedToLib = True
                            else:
                                
                                # try to add the material to the library
                                addedToLib, thisShading.RadMaterial = hb_RADMaterialAUX.analyseRadMaterials(RADMaterial, True)
                                
                            if addedToLib==False:
                                warningMsg = "Failed to add " + RADMaterial + " to the Library."
                                ghenv.Component.AddRuntimeMessage(gh.GH_RuntimeMessageLevel.Warning, warningMsg)
                                return
                        
                        # add shading to the list
                        shadingClasses.append(thisShading)
                
        # add to the hive
        hb_hive = sc.sticky["honeybee_Hive"]()
        HBContext  = hb_hive.addToHoneybeeHive(shadingClasses, ghenv.Component)
        return HBContext
        ################################################################################################
    else:
        print "You should first let Honeybee to fly..."
        w = gh.GH_RuntimeMessageLevel.Warning
        ghenv.Component.AddRuntimeMessage(w, "You should first let Honeybee to fly...")
        return -1
        

if _shdSurfaces and _shdSurfaces[0]!=None:
    # add cleaning function
    result= main(_shdSurfaces, EPTransSchedule_, meshingSettings_, justBoundingBox_)
    
    if result != -1: HBContext = result
# ---------- end hb_epcontextsrf ----------
panel_14 = Panel("""OutputControl:Table:Style,Comma;
Output:Variable,*,Surface Outside Face Temperature, hourly;""")
wires_5 = BrepWireframe(Brep=geo_19, Density=-1)
number_slider_16 = Slider(6, range=0..10)
number_slider_17 = Slider(21, range=0..100)
geo_20 = Geometry([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])
wires_6 = BrepWireframe(Brep=solveadjc.HBZonesWADJ, Density=-1)
radiationanalysis = Ladybug_RadiationAnalysis(
    geometry=flatten(geo_20),
    gridSize=Slider(10, range=0..10),
    disFromBase=Slider(1, range=0..1),
    selectedSkyMtx=flatten(selectskymtx.selectedSkyMtx),
    runIt=Toggle(True))  # -> readMe, contextMesh, analysisMesh, testPts, testVec, port, radiationResult, radiationMesh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; plug-in component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
geo_21 = Geometry(solveadjc.HBZonesWADJ)
toggle_5 = BooleanToggle(True)
data_9 = Data(makeadiabaticbytype)
analysisperiod = Ladybug_AnalysisPeriod(
    fromMonth=number_slider_16,
    fromDay=number_slider_17,
    fromHour=Slider(4, range=0..10),
    toMonth=number_slider_16,
    toDay=number_slider_17,
    toHour=Slider(21, range=0..100))  # -> readMe, analysisPeriod; plug-in component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
exporttoopenstudio = Honeybee_ExportToOpenStudio(
    epwWeatherFile=epw_stat.epwFile,
    analysisPeriod=analysisperiod.analysisPeriod,
    HBZones=flatten(data_9),
    HBContext=flatten(hb_epcontextsrf),
    simulationOutputs=flatten(panel_14),
    writeOSM=toggle_5,
    runSimulation=toggle_5)  # -> readMe, osmFileAddress, idfFileAddress, resultsFileAddress, eioFileAddress, rddFileAddress, studyFolder; plug-in component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
mesh = Mesh(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)
tag_3 = TextTag(Location=radiationanalysis.testPts, Text=radiationanalysis.radiationResult)
readepsrfresult = Honeybee_ReadEPSurfaceResult(resultFileAddress=exporttoopenstudio.resultsFileAddress)  # -> port, surfaceOutdoorTemp, port_2, port_3, port_4, port_5, port_6, port_7, port_8, port_9; plug-in component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
srfattributelist_2 = Honeybee_SurfaceAttributeList({"Name": "name", "Radiance Material": "RadMaterial", "EnergyPlus Construction": "EPConstruction", "Surface Type": "type", "Boundary Condition": "BC", "Sun Exposure": "sunExposure", "Wind Exposure": "windExposure", "Has Child Surface": "hasChild", "Is Child Surface": "isChild", "Is Planar": "isPlanar", "Srf Type Set By User": "srfTypeByUser", "Boundary Condition Set By User": "srfBCByUser", "Shade Material Name": "shadeMaterialName", "Shading Control Name": "shadingControlName", "Shcading Schedule Name": "shadingSchName"}, selected="Name")
decomposebytype = Honeybee_DecomposeBasedOnType(HBZone=data_9)  # -> walls, interiorWalls, airWalls, windows, interiorWindows, skylights, roofs, ceilings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; plug-in component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
colorsurfaces = Honeybee_ColorSurfacesByEPResult(srfData=readepsrfresult.surfaceOutdoorTemp, HBZones=flatten(data_9), runIt=Toggle(True))  # -> readMe, srfColoredMesh, zoneWireFrame, legend, legendBasePt, analysisTitle, srfBreps, srfColors, srfValues, port; plug-in component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
panel_15 = Panel(readepsrfresult.surfaceOutdoorTemp)
labelsurfaces_2 = Honeybee_LabelZoneSurfaces(HBObjects=flatten(data_9), attribute=srfattributelist_2)  # -> surfaceTxtLabels, labelBasePts, brepTxtLabels, surfaceWireFrames; plug-in component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
geo_22 = Geometry(decomposebytype.windows)
tag_4 = TextTag(Location=labelsurfaces_2.labelBasePts, Text=labelsurfaces_2.surfaceTxtLabels)
medges = MeshEdges(Mesh=colorsurfaces.srfColoredMesh)  # -> NakedEdges, InteriorEdges, NonManifoldEdges
mesh_2 = Mesh(colorsurfaces.srfColoredMesh)
gradient = Gradient(
    LowerLimit=Slider(25, range=0..100),
    UpperLimit=Slider(24, range=0..100),
    Parameter=colorsurfaces.srfValues,
    stops=[0: RGB(0, 255, 255), 0.502: RGB(255, 255, 0), 1: RGB(255, 0, 138)])
area_3 = Area(Geometry=colorsurfaces.srfBreps)  # -> Area, Centroid
preview_6 = CustomPreview(
    Geometry=[medges.NakedEdges, medges.InteriorEdges, medges.NonManifoldEdges],
    Shader=ColourSwatch(SwatchColor=RGB(255, 255, 255)))
tag_5 = TextTag(Location=area_3.Centroid, Text=colorsurfaces.srfValues, Colour=ColourSwatch(SwatchColor=RGB(255, 255, 255)))

# ---- group: BIBIL2HBZone
python_9 = PythonScript(HBZones=data_9, BBNodes=bibil_19.Node_out)  # -> BBNodes; inputs HBZones: list, BBNodes: list
# ---------- python_9: Python ----------
import scriptcontext as sc
import rhinoscriptsyntax as rs

hb_hive = sc.sticky["honeybee_Hive"]()


def IsList(lst):
    return lst != [None] and lst != []

if IsList(_HBZones) and IsList(_BBNodes):
    #print len(_HBZones)
    #print len(_BBNodes)
    for i in xrange(len(_HBZones)):
        hb = _HBZones[i]
        hb = rs.coercebrep(hb)
        bb = _BBNodes[i]
        bb.grammar.type['HBZone'] = hb
        _BBNodes[i] = bb
        #zone = hb_hive.visualizeFromHoneybeeHive([hb])[0]
        #zone.Bibil = bb
        #print zone.Bibil.shape.geom
# ---------- end python_9 ----------

# ----
preview_7 = CustomPreview(Geometry=colorsurfaces.srfBreps, Shader=gradient)
geo_23 = Geometry(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)

# ---- group: EXTRACT_CANYON
miru_22 = PythonScript(
    Code=file_3,
    Canyon_tol=Slider(30, range=0..100),
    Canyon_center=geo_23,
    Srf_data=readepsrfresult.surfaceOutdoorTemp,
    Run=Toggle(True))

# ---- group: INTERPOLATE_VERTICAL
miru_23 = PythonScript(Code=file_4, Run=Toggle(True))

# ---- group: SHAPENODE
bibil_20 = PythonScript(Code=file_10, Rule_in=flatten([miru_22, miru_23]), Node_in=flatten(python_9), Run=Toggle(True))  # -> Node_out, Node_dead, Debug

# ----
geo_24 = Geometry(bibil_20.Debug)
g_18 = PythonScript(node=bibil_20.Node_out)  # -> cpt; inputs node: list
# ---------- g_18: Python ----------
if node and node != [None]:
    cpt = []
    for n in node:
        if n.grammar.type.has_key('test_interpolate'):
            srf_data = n.grammar.type['test_interpolate']
            #print srf_data
            cpt.extend(srf_data)
    #print cpt
# ---------- end g_18 ----------
g_19 = PythonScript(node=bibil_20.Node_out)  # -> t; inputs node: list
# ---------- g_19: Python ----------
if node and node != [None]:
    t = []
    for n in node:
        if n.grammar.type.has_key('temperature'):
            srf_data = n.grammar.type['temperature']
            #print srf_data
            t.extend(srf_data)
    print t
# ---------- end g_19 ----------
g_20 = PythonScript(node=bibil_20.Node_out)  # -> geom; inputs node: list; same code as g_7
g_21 = PythonScript(node=bibil_20.Node_out)  # -> temp; inputs node: list
# ---------- g_21: Python ----------
if node and node != [None]:
    temp = []
    for n in node:
        #if n.grammar.type.has_key('processed_srf_data'):
        n = n.backtrack_tree(lambda n: n.grammar.type.has_key('processed_srf_data'))
        if n:
            srf_data = n.grammar.type['processed_srf_data']
            #print srf_data
            # print '--'
            temp.extend(srf_data)
    #print temp
# ---------- end g_21 ----------
g_22 = PythonScript(node=bibil_20.Node_out)  # -> pt; inputs node: list
# ---------- g_22: Python ----------
node = filter(lambda n: n!=None,node)
if node and node != []:
    pt = []
    for n in node:
        n = n.backtrack_tree(lambda n: n.grammar.type.has_key('processed_srf_geom'))
        if n:
            srf_data = n.grammar.type['processed_srf_pt']
            #print srf_data
            # print '--'
            pt.extend(srf_data)
    #print pt
# ---------- end g_22 ----------
geo_25 = Geometry(bibil_20.Debug)
sort = SortList(Keys=g_21)  # -> Keys, ValuesA
number_slider_18 = Slider(1, range=0..10)
g_23 = PythonScript(node=bibil_20.Node_out)  # -> srf; inputs node: list
# ---------- g_23: Python ----------
if node and node != [None]:
    srf = []
    for n in node:
        n = n.backtrack_tree(lambda n: n.grammar.type.has_key('processed_srf_geom'))
        #if n.grammar.type.has_key('processed_srf_geom'):
        if n:
            srf_data = n.grammar.type['processed_srf_geom']
            #print srf_data
            srf.extend(srf_data)
    #print srf
# ---------- end g_23 ----------
area_4 = Area(Geometry=[g_23, geo_25])  # -> Area, Centroid
item_3 = ListItem(List=sort.Keys, Index=0, Wrap=True)
item_4 = ListItem(List=sort.Keys, Index="-1", Wrap=True)
ma = MassAddition(Input=[g_21, g_19])  # -> Result, PartialResults
preview_8 = CustomPreview(
    Geometry=g_22,
    Shader={ambient=RGB(0, 0, 0), diffuse=RGB(255, 105, 180), emission=RGB(76, 32, 54), shine=0.5, specular=RGB(255, 255, 255), transparency=0})
ma_2 = MassAddition(Input=area_4.Area)  # -> Result, PartialResults
panel_16 = Panel(item_3)
panel_17 = Panel(item_4)
scale_3 = Scale(Geometry=geo_25, Center=g_18, Factor=number_slider_18)  # -> Geometry, Transform
division = Division(A=ma.Result, B=ma_2.Result)
panel_18 = Panel(division)
geo_26 = Geometry([g_8, g_12, g_11])
volume = Volume(Geometry=flatten(geo_26))  # -> Volume, Centroid
scale_4 = Scale(Geometry=g_23, Center=g_22, Factor=number_slider_18)  # -> Geometry, Transform
data_10 = Data(Slider(27, range=0..100))
data_11 = Data(Slider(20, range=0..100))
gradient_2 = Gradient(
    LowerLimit=data_10,
    UpperLimit=data_11,
    Parameter=g_21,
    stops=[0: RGB(255, 0, 64), 0.25: RGB(245, 93, 0), 0.5: RGB(255, 255, 22), 0.75: RGB(93, 177, 249), 1: RGB(0, 44, 169)])
gradient_3 = Gradient(
    LowerLimit=data_10,
    UpperLimit=data_11,
    Parameter=g_19,
    stops=[0: RGB(255, 0, 64), 0.25: RGB(245, 93, 0), 0.5: RGB(255, 255, 22), 0.75: RGB(93, 177, 249), 1: RGB(0, 44, 169)])
ma_3 = MassAddition(Input=volume.Volume)  # -> Result, PartialResults
division_2 = Division(A=ma_3.Result, B=Slider(3, range=0..10))
txt = Text("normalized_srf_temp")
panel_20 = Panel(division_2)
num = Number(division)
tag_6 = TextTag(Location=g_22, Text=g_21, Colour=ColourSwatch(SwatchColor=RGB(255, 255, 255)))
preview_9 = CustomPreview(Geometry=scale_3.Geometry, Shader=gradient_3)
preview_10 = CustomPreview(Geometry=scale_4.Geometry, Shader=gradient_2)
num_2 = Number(division_2)
mesh_3 = Mesh(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)
mesh_4 = Mesh(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)
txt_2 = Text("gfa")
python_10 = PythonScript(x="soln", y=python_2)  # -> a
# ---------- python_10: Python ----------
a = x+y

print a
# ---------- end python_10 ----------
data_12 = Data(g_20)
captureview = Ladybug_CaptureView(
    fileName=python_10,
    folder="C:\Users\user\Desktop\lb_fly",
    imageWidth=Slider(800, range=0..1000),
    imageHeight=Slider(600, range=0..1000),
    displayMode="Wireframe",
    transparBack=Toggle(True),
    capture=data_12)  # -> imagePath; plug-in component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
panel_21 = Panel(captureview)

# ----
# Import Climate Data
panel_22 = Panel("https://www.energyplus.net/weather-download/southwest_pacific_wmo_region_5/SGP//SGP_Singapore.486980_IWEC/all")  # disabled
epw_stat_2 = Ladybug_OpenEPWAndSTATWeatherFiles(weatherFileURL=panel_22)  # -> epwFile, statFile; disabled; plug-in component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
importstat_2 = Ladybug_ImportStat(statFile=epw_stat_2.statFile)  # -> readMe, ashraeClimateZone, koppenClimateZone, port, heatingDesignTemp, coolingDesignTemp, port_2, extremeHotWeek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; disabled; plug-in component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

panel_23 = Panel("0.6")  # disabled
# Define Residential
# + Commercial Typologies
panel_24 = Panel("3")  # disabled
commercialtypology = Dragonfly_DefaultCommericalTypology(flr2FlrHeight=panel_24, window2Wall=panel_23, climateZone=importstat_2.ashraeClimateZone)  # -> buildingTypology; disabled; plug-in component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

buildings = Brep()  # disabled
pavement = Brep(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)  # disabled
wires_7 = BrepWireframe(Brep=buildings, Density=-1)  # disabled
toggle_6 = BooleanToggle(True)  # disabled
panel_25 = Panel("8")  # disabled
# Define The City
panel_26 = Panel("0.1")  # disabled
uwgcityfromtypology = Dragonfly_UWGCityFromTypologies(
    buildingTypologies=flatten(commercialtypology),
    buildingBreps=flatten(buildings),
    pavementBrep=flatten(pavement),
    treesOrCoverage=flatten(panel_26),
    nonBldgHeat=panel_25,
    runIt=toggle_6)  # -> readMe, port, UWGCity, port_2, joinedBldgs, bldgFootprints, treeFootprints, pavementSrf, grassSrf; disabled; plug-in component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
panel_27 = Panel(uwgcityfromtypology.readMe)  # disabled
toggle_7 = BooleanToggle(True)  # disabled
# Run the UWG
extreme_hot_week = Data(importstat_2.extremeHotWeek)  # disabled
panel_28 = Panel("SingaporeSite")  # disabled
runuwg = Dragonfly_RunUrbanWeatherGenerator(
    epwFile=epw_stat_2.epwFile,
    UWGCity=uwgcityfromtypology.UWGCity,
    analysisPeriod=extreme_hot_week,
    writeXML=toggle_7,
    runUWG=toggle_7,
    xmlFileName=panel_28)  # -> readMe, xmlText, xmlFileAddress, epwFileAddress; disabled; plug-in component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
original_weather_file = Data(epw_stat_2.epwFile)  # disabled

# ----
# Import Rural + Urban EPWs
importepw = Ladybug_ImportEpw(epwFile=original_weather_file)  # -> readMe, latitude, location, dryBulbTemperature, dewPointTemperature, relativeHumidity, windSpeed, windDirection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; disabled; plug-in component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
selectandaveragedata = Ladybug_AverageData(annualHourlyData=importepw.dryBulbTemperature, analysisPeriod=extreme_hot_week)  # -> readMe, selHourlyData, averagedDaily, averagedMonthly, avrMonthlyPerHour, avrAnalysisPeriod; disabled; plug-in component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

importepw_2 = Ladybug_ImportEpw(epwFile=runuwg.epwFileAddress)  # -> readMe, latitude, location, dryBulbTemperature, dewPointTemperature, relativeHumidity, windSpeed, windDirection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; disabled; plug-in component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
selectandaveragedata_2 = Ladybug_AverageData(annualHourlyData=importepw_2.relativeHumidity, analysisPeriod=extreme_hot_week)  # -> readMe, selHourlyData, averagedDaily, averagedMonthly, avrMonthlyPerHour, avrAnalysisPeriod; disabled; plug-in component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
selectandaveragedata_3 = Ladybug_AverageData(annualHourlyData=importepw_2.dryBulbTemperature, analysisPeriod=extreme_hot_week)  # -> readMe, selHourlyData, averagedDaily, averagedMonthly, avrMonthlyPerHour, avrAnalysisPeriod; disabled; plug-in component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

selectandaveragedata_4 = Ladybug_AverageData(annualHourlyData=importepw.relativeHumidity, analysisPeriod=extreme_hot_week)  # -> readMe, selHourlyData, averagedDaily, averagedMonthly, avrMonthlyPerHour, avrAnalysisPeriod; disabled; plug-in component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

toggle_8 = BooleanToggle(True)  # disabled
outdoorcomfortcalculator = Ladybug_OutdoorComfortCalculator(
    dryBulbTemperature=selectandaveragedata_3.selHourlyData,
    relativeHumidity=selectandaveragedata_2.selHourlyData,
    runIt=toggle_8)  # -> readMe, port, universalThermalClimateIndex, comfortableOrNot, thermalStress, conditionOfPerson, port_2, percentOfTimeComfortable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; disabled; plug-in component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
outdoorcomfortcalculator_2 = Ladybug_OutdoorComfortCalculator(
    dryBulbTemperature=selectandaveragedata.selHourlyData,
    relativeHumidity=selectandaveragedata_4.selHourlyData,
    runIt=toggle_8)  # -> readMe, port, universalThermalClimateIndex, comfortableOrNot, thermalStress, conditionOfPerson, port_2, percentOfTimeComfortable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; disabled; plug-in component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
panel_29 = Panel(outdoorcomfortcalculator_2.percentHeatStress)  # disabled
panel_30 = Panel(outdoorcomfortcalculator.percentHeatStress)  # disabled

strnum = Ladybug_SeparateData(inputList=flatten(selectandaveragedata_3.selHourlyData))  # -> numbers, strings; disabled; plug-in component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
strnum_2 = Ladybug_SeparateData(inputList=flatten(selectandaveragedata.selHourlyData))  # -> numbers, strings; disabled; plug-in component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
avr = Average(Input=strnum.numbers)  # disabled
avr_2 = Average(Input=strnum_2.numbers)  # disabled
subtraction = Subtraction(A=strnum.numbers, B=strnum_2.numbers)  # disabled
subtraction_2 = Subtraction(A=avr, B=avr_2)  # disabled
sort_2 = SortList(Keys=subtraction)  # -> Keys, ValuesA; disabled
rev = ReverseList(List=sort_2.Keys)  # disabled
item_5 = ListItem(List=rev, Index=0, Wrap=True)  # disabled
maximum_uhi_c = Panel(item_5)  # disabled
avg_uhi_c = Panel(subtraction_2)  # disabled

panel_31 = Panel("-250")  # disabled
panel_32 = Panel("300")  # disabled
pt = ConstructPoint(XCoordinate=panel_32, YCoordinate=0, ZCoordinate=panel_31)  # disabled
_3dchart = Ladybug_3DChart(
    inputData=flatten([outdoorcomfortcalculator_2.universalThermalClimateIndex, outdoorcomfortcalculator.universalThermalClimateIndex]),
    basePoint=pt)  # -> readMe, graphMesh, graphCurves, legend, legendBasePts, title, titleBasePts, dataPts, conditionalHOY; disabled; plug-in component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
