# Grasshopper definition bibil_acadia_26_minimal.gh (Grasshopper 0.9.76)
# plug-ins: Python Interpreter, ArchsimGH, HDTReference

list = ValueList({"dir", "file"}, selected="dir")

# ---- group: find directory
bibil = PythonScript(
    dir=["C:\\Users\\vasanthakumars\\Documents\\GitHub\\bibil\\src", "C:\\saeran\\master\\git\\bibil\\src"],
    type=list,
    run=Toggle(True))  # -> dir; inputs dir: list
# ---------- bibil: Python ----------
import os
import sys

ghenv.Component.Params.Output[0].Name = "null"
ghenv.Component.Params.Output[0].NickName = "null"

#sys.path.append("C:\Program Files\Rhinoceros 5.0 (64-bit)\System")

if run:
    confirm_dir = None
    for d in dir:
        try:
            if type == "file":
                file_ = open(d)
                file_.close()
            else:
                print os.listdir(d)
            confirm_dir = d
            break
        except Exception as e:
            #print str(e)
            continue
    if confirm_dir != None:
        ghenv.Component.Params.Output[0].Name = type
        ghenv.Component.Params.Output[0].NickName = type
        dir = confirm_dir
        file = confirm_dir
null = None
# ---------- end bibil ----------

# ---- group: abstract_bem
python_script = PythonScript(i=bibil)  # -> o
# ---------- python_script: Python ----------
import os

if i:
    o = os.path.join(str(i),"miru\\miru_abstract_bem.py")
# ---------- end python_script ----------
file = ReadFile(File=python_script, PerLineParse=False)

# ---- group: stepback_manual
python_script_2 = PythonScript(i=bibil)  # -> o
# ---------- python_script_2: Python ----------
import os

if i:
    o = os.path.join(str(i),"miru\\miru_stepback_manual.py")
# ---------- end python_script_2 ----------
file_2 = ReadFile(File=python_script_2, PerLineParse=False)

# ---- group: extract_canyon
python_script_3 = PythonScript(i=bibil)  # -> o
# ---------- python_script_3: Python ----------
import os

if i:
    o = os.path.join(str(i),"miru\\miru_extract_canyon.py")
# ---------- end python_script_3 ----------
file_3 = ReadFile(File=python_script_3, PerLineParse=False)

# ---- group: interpolate_vertical
python_script_4 = PythonScript(i=bibil)  # -> o
# ---------- python_script_4: Python ----------
import os

if i:
    o = os.path.join(str(i),"miru\\miru_interpolate_vertical.py")
# ---------- end python_script_4 ----------
file_4 = ReadFile(File=python_script_4, PerLineParse=False)

# ---- group: filter_nodes
python_script_5 = PythonScript(i=bibil)  # -> o
# ---------- python_script_5: Python ----------
import os

if i:
    o = os.path.join(str(i),"miru\\miru_filter_nodes.py")
# ---------- end python_script_5 ----------
file_5 = ReadFile(File=python_script_5, PerLineParse=False)

# ---- group: tree
python_script_6 = PythonScript(i=bibil)  # -> o
# ---------- python_script_6: Python ----------
import os

if i:
    o = os.path.join(str(i),"bibil\\bibil_tree.py")
# ---------- end python_script_6 ----------
file_6 = ReadFile(File=python_script_6, PerLineParse=False)
bibil_2 = PythonScript(Code=file_6)

# ---- group: grammar
python_script_7 = PythonScript(i=bibil)  # -> o
# ---------- python_script_7: Python ----------
import os

if i:
    o = os.path.join(str(i),"bibil\\bibil_grammar.py")
# ---------- end python_script_7 ----------
file_7 = ReadFile(File=python_script_7, PerLineParse=False)
bibil_3 = PythonScript(Code=file_7)

# ---- group: shape
python_script_8 = PythonScript(i=bibil)  # -> o
# ---------- python_script_8: Python ----------
import os

if i:
    o = os.path.join(str(i),"bibil\\bibil_shape.py")
#o = os.path.join(str(i),"research\\bibil_shape_shape_3d_2d.py")
# ---------- end python_script_8 ----------
file_8 = ReadFile(File=python_script_8, PerLineParse=False)
bibil_4 = PythonScript(Code=file_8)

# ---- group: bula
python_script_9 = PythonScript(i=bibil)  # -> o
# ---------- python_script_9: Python ----------
import os

if i:
    o = os.path.join(str(i),"bula\\bula_minimal.py")
# ---------- end python_script_9 ----------
file_9 = ReadFile(File=python_script_9, PerLineParse=False)
bibil_5 = PythonScript(Code=file_9)

# ---- group: UI
python_script_10 = PythonScript(i=bibil)  # -> o
# ---------- python_script_10: Python ----------
import os

if i:
    o = os.path.join(str(i),"bibil\\bibil_UI.py")
# ---------- end python_script_10 ----------
file_10 = ReadFile(File=python_script_10, PerLineParse=False)

# ---- group: grammar_divide
python_script_11 = PythonScript(i=bibil)  # -> o
# ---------- python_script_11: Python ----------
import os

if i:
    o = os.path.join(str(i),"miru\\miru_divide.py")
# ---------- end python_script_11 ----------
file_11 = ReadFile(File=python_script_11, PerLineParse=False)

# ---- group: grammar_courtyard
python_script_12 = PythonScript(i=bibil)  # -> o
# ---------- python_script_12: Python ----------
import os

if i:
    o = os.path.join(str(i),"miru\\miru_court.py")
# ---------- end python_script_12 ----------
file_12 = ReadFile(File=python_script_12, PerLineParse=False)

# ---- group: grammar_tower
python_script_13 = PythonScript(i=bibil)  # -> o
# ---------- python_script_13: Python ----------
import os

if i:
    o = os.path.join(str(i),"miru\\miru_packing.py")
# ---------- end python_script_13 ----------
file_13 = ReadFile(File=python_script_13, PerLineParse=False)

# ---- group: stepback
python_script_14 = PythonScript(i=bibil)  # -> o
# ---------- python_script_14: Python ----------
import os

if i:
    o = os.path.join(str(i),"miru\\miru_stepback.py")
# ---------- end python_script_14 ----------
file_14 = ReadFile(File=python_script_14, PerLineParse=False)

# ---- group: grammar_height
python_script_15 = PythonScript(i=bibil)  # -> o
# ---------- python_script_15: Python ----------
import os

if i:
    o = os.path.join(str(i),"miru\\miru_height.py")
# ---------- end python_script_15 ----------
file_15 = ReadFile(File=python_script_15, PerLineParse=False)

# ---- group: grammar_analysis_pts
python_script_16 = PythonScript(i=bibil)  # -> o
# ---------- python_script_16: Python ----------
import os

if i:
    o = os.path.join(str(i),"miru\\miru_analysis.py")
# ---------- end python_script_16 ----------
file_16 = ReadFile(File=python_script_16, PerLineParse=False)

# ---- group: meta_tree
python_script_17 = PythonScript(i=bibil)  # -> o
# ---------- python_script_17: Python ----------
import os

if i:
    o = os.path.join(str(i),"miru\\miru_meta_tree.py")
# ---------- end python_script_17 ----------
file_17 = ReadFile(File=python_script_17, PerLineParse=False)

# ---- group: land_use
python_script_18 = PythonScript(i=bibil)  # -> o
# ---------- python_script_18: Python ----------
import os

if i:
    o = os.path.join(str(i),"miru\\miru_landuse.py")
# ---------- end python_script_18 ----------
file_18 = ReadFile(File=python_script_18, PerLineParse=False)

# ---- group: shape2height
python_script_19 = PythonScript(i=bibil)  # -> o
# ---------- python_script_19: Python ----------
import os

if i:
    o = os.path.join(str(i),"miru\\miru_shape2height.py")
# ---------- end python_script_19 ----------
file_19 = ReadFile(File=python_script_19, PerLineParse=False)

# ---- group: extract_slice
python_script_20 = PythonScript(i=bibil)  # -> o
# ---------- python_script_20: Python ----------
import os

if i:
    o = os.path.join(str(i),"miru\\miru_extract_slice.py")
# ---------- end python_script_20 ----------
file_20 = ReadFile(File=python_script_20, PerLineParse=False)

# ----
list_2 = ValueList({"divide by depth": "subdivide_depth", "divide by same depth": "subdivide_depth_same", "divide by dim": "subdivide_dim"}, selected="divide by same depth")
list_3 = ValueList({"YZ": "NS", "XZ": "EW", "XY": "Z"}, selected="XZ")

# ---- group: SETBACK
miru = PythonScript(Code=file_14, Height_stepback="22.5:6.0", Run=Toggle(False))

# ---- group: PACKING
separatedata = Ladybug_SeparateData(Code=file_13, X_keep_omit="27.0,25.0", Y_keep_omit="27.0,25.0", Seperation_ref="-1", Run=Toggle(False))

# ---- group: EXTRACT_SLICE
miru_2 = PythonScript(Code=file_20, Run=Toggle(False))

# ---- group: DIVIDE
miru_3 = PythonScript(
    Code=file_11,
    Divide_num=Slider(2, range=0..10),
    Divide_cut=Slider(0, range=0..100),
    Divide_type=list_2,
    Divide_ratio=Slider(0.5, range=0..1),
    Axis=list_3,
    Run=Toggle(False))

# ---- group: PERIMETER
miru_4 = PythonScript(Code=file_12, Width=Slider(20, range=0..100), Cut_width=Slider(0, range=0..100), Court_ref="0", Run=Toggle(False))

# ---- group: HEIGHT
miru_5 = PythonScript(Code=file_15, Height=Slider(16.5, range=0..100), Run=Toggle(True))

# ---- group: TREE RULES
miru_6 = PythonScript(Code=file_17, Run=Toggle(False))

# ---- group: SHAPE2HEIGHT
miru_7 = PythonScript(Code=file_19, Run=Toggle(False))

# ----
geo = Geometry([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])
geo_2 = Geometry([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])
geo_3 = Geometry([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])
geo_4 = Geometry([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])
geo_5 = Geometry([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])
bibil_6 = PythonScript(Code=file_10, Node_in=flatten(geo_3), Label_="density_04", Run=Toggle(True))  # -> Node_out, Debug
bibil_7 = PythonScript(Code=file_10, Node_in=flatten(geo_2), Label_="density_03", Run=Toggle(True))  # -> Node_out, Debug
bibil_8 = PythonScript(Code=file_10, Node_in=flatten(geo), Label_="density_02", Run=Toggle(True))  # -> Node_out, Debug
bibil_9 = PythonScript(Code=file_10, Node_in=flatten(geo_4), Label_="density_01", Run=Toggle(True))  # -> Node_out, Debug
bibil_10 = PythonScript(Code=file_10, Node_in=flatten(geo_5), Label_="density_00", Run=Toggle(True))  # -> Node_out, Debug

# ---- group: DRAGONFLY
geo_6 = Geometry([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])

# ---- group: STEPBACK_PARAMETER
number_slider = Slider(6, range=0..6)
panel = Panel("[0.0,1.5,3.0,4.5,6.0,7.5,9.0]")

# ---- group: PODIUM_PARAMETER
panel_2 = Panel("[9,12,15,18,21,24,27,30]")
number_slider_2 = Slider(4, range=0..7)

# ---- group: SETBACK_PARAMETER
panel_3 = Panel("[0.0,1.5,3.0,4.5,6.0]")
number_slider_3 = Slider(2, range=0..4)

# ---- group: ARCHETYPE_PARAMETER
panel_4 = Panel("['tower_in_park','tower_on_podium','slab_in_park','slab_on_podium']")
number_slider_4 = Slider(3, range=0..3)

# ---- group: DENSITY_PARAMETER
panel_5 = Panel("[0,1,2,3,4]")
number_slider_5 = Slider(3, range=0..4)

# ----
data = Data([bibil_6.Node_out, bibil_7.Node_out, bibil_8.Node_out, bibil_9.Node_out, bibil_10.Node_out])

# ---- group: TRIGGER
data_2 = Data([number_slider_5, number_slider_4, number_slider_2, number_slider_3, number_slider])

# ----
fly = Ladybug_fly(inputSliders=[number_slider_5, number_slider_4], fly=Toggle(False))  # -> Vviiiiiiiiiizzz; plug-in component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
podium_ht = PythonScript(
    density_set=panel_5,
    density_par=number_slider_5,
    arctype_set=panel_4,
    arctype_par=number_slider_4,
    podium_set=panel_2,
    podium_par=number_slider_2,
    setback_set=panel_3,
    setback_par=number_slider_3,
    stepback_set=panel,
    stepback_par=number_slider,
    node_in=data,
    run=Toggle(True))  # -> node_out, arctype_str, podium_ht, setback_dim, stepback_dim; inputs density_par: Int32, arctype_par: Int32, podium_par: Int32, setback_par: Int32, stepback_par: Int32, node_in: list
# ---------- podium_ht: Python ----------
import Grasshopper
import Grasshopper.Kernel as gh
import scriptcontext as sc

ghenv.Component.Message = 'Bibil_2'

Bula = sc.sticky['Bula']
Grammar = sc.sticky['Grammar']

B = Bula()
G = Grammar()

if run and node_in:
    
    # Bucket according to density label
    bucket_dict = {"apply2list":True, "keys2bucket":["label"],\
                    "fx2bucket":"lambda n:n.grammar.type['label']"}
                    
    bucketed_lst = G.bucket_shape(node_in,bucket_dict)
    nestedbylabel = bucketed_lst[0]
    nestedbylabel.sort(key=lambda tple:tple[0])
    node_in = map(lambda l:l[1],nestedbylabel)
    
    #Density Parameter
    density_set = eval(density_set)
    density_index = density_set[density_par] 
    node_out = node_in[density_index]
    
    #Arctype Parameters
    arctype_set = eval(arctype_set)
    arctype_str = arctype_set[arctype_par]
    
    #Podium Parameters
    podium_set = eval(podium_set)
    podium_ht = podium_set[podium_par]
    
    #Stepback Parameters
    stepback_set = eval(stepback_set)
    stepback_dim = stepback_set[stepback_par]
    
    #Setback Parameters
    setback_set = eval(setback_set)
    setback_dim = setback_set[setback_par]
# ---------- end podium_ht ----------

# ---- group: RECOMPUTE
resetsol = PythonScript(reset=data_2)  # -> o; inputs reset: list; disabled
# ---------- resetsol: Python ----------
"""----------------
Miru Recompute Solution
----------------""" 

import Grasshopper
import Grasshopper.Kernel as gh
import scriptcontext as sc
ghenv.Component.Message = 'Recompute_Soln'



## This is a refence right now, must copy and paste 
## into ghcomponent to work

o = "Waiting..."
if reset:
    
    document = ghenv.Component.OnPingDocument()
    
    objects = list(document.Objects)
    for obj in objects:
        #get the ghpython components
        if type(obj)!= type(ghenv.Component):
            pass
        else:
            chk_bug = obj.Name!=None and "Ladybug" in obj.Name
            chk_self = obj.Message!=None and "Recompute_Soln" in obj.Message
            chk_bibil = obj.Message!=None and "Bibil" in obj.Message
            if chk_bug or chk_self:
                pass
            elif chk_bibil:#else:
                obj.ExpireSolution(True)
                
    o = 'Finished!'
# ---------- end resetsol ----------

# ----
panel_6 = Panel(resetsol)
python = PythonScript(x=number_slider_5, y=podium_ht.arctype_str, z=podium_ht.podium_ht, u=podium_ht.setback_dim, v=podium_ht.stepback_dim)  # -> a
# ---------- python: Python ----------
L = [x,y,z,u,v]
M = ['dev_','type_','podht_','set_','step_']

strout = ""
for i,j in zip(L,M):
    strout += '---' + j + str(i).replace('.','dot')
    

a = strout

print a
# ---------- end python ----------
g = PythonScript(node=podium_ht.node_out)  # -> geom; inputs node: list
# ---------- g: Python ----------
node = filter(lambda n: n!=None,node)
if node and node != []:
    geom = []
    for n in node:
        if n.shape.z_dist < 1.2:
            geom.append(n.shape.bottom_crv)
        else:
            geom.append(n.shape.geom)
    print geom
# ---------- end g ----------
data_3 = Data(podium_ht.podium_ht)
data_4 = Data(podium_ht.setback_dim)
data_5 = Data(podium_ht.stepback_dim)
panel_7 = Panel(podium_ht.podium_ht)
panel_8 = Panel(podium_ht.setback_dim)
panel_9 = Panel(podium_ht.stepback_dim)
geo_7 = Geometry(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)
geo_8 = Geometry(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)
area = Area(Geometry=geo_8)  # -> Area, Centroid
area_2 = Area(Geometry=geo_7)  # -> Area, Centroid
number_slider_6 = Slider(1.1, range=0..10)
scale = Scale(Geometry=geo_7, Center=area_2.Centroid, Factor=number_slider_6)  # -> Geometry, Transform
scale_2 = Scale(Geometry=geo_8, Center=area.Centroid, Factor=number_slider_6)  # -> Geometry, Transform
python_2 = PythonScript(
    arctype_str=podium_ht.arctype_str,
    slab_short="19.0,10.0",
    slab_long="38,10.0",
    tower_short="26.0,10.0",
    tower_long="26.0,10.0",
    run=Toggle(True))  # -> park, podium, dim_short, dim_long; inputs slab_short: list, tower_short: list
# ---------- python_2: Python ----------
park,podium = False,False
dim_short,dim_long = slab_short,slab_long

if arctype_str and run:
    arc_lst = arctype_str.split('_')
    #tower in park
    if 'tower' in arc_lst and 'park' in arc_lst:
        park = True
        dim_short = tower_short
        dim_long = tower_long
    #tower in podium
    elif 'tower' in arc_lst and 'podium' in arc_lst:
        podium = True
        dim_short = tower_short
        dim_long = tower_long
    #slab in park
    elif 'slab' in arc_lst and 'park' in arc_lst:
        park = True
        dim_short = slab_short
        dim_long = slab_long
    #slab in podium
    else:#if 'slab' in arc_lst and 'podium' in arc_lst:
        podium = True
        dim_short = slab_short
        dim_long = slab_long
    
    print arctype_str
    print park
    print podium
    print dim_short
    print dim_long
# ---------- end python_2 ----------

# ---- group: grnd@0
python_3 = PythonScript(crv_in=[geo_8, geo_7])  # -> crv_out
# ---------- python_3: Python ----------
import rhinoscriptsyntax as rs
import Rhino as rc

curve = rs.coercecurve(crv_in)
rc_, polyline = curve.TryGetPolyline()
if rc_: 
    points = map(lambda pt:pt,polyline)
    for pt in points:
        pt.Z = 0.0
    curve = rc.Geometry.Curve.CreateControlPointCurve(points,1)
crv_out = curve
# ---------- end python_3 ----------

# ----
number_slider_7 = Slider(15, range=0..100)
data_6 = Data(python_2.dim_short)
data_7 = Data(python_2.dim_long)
bool = Boolean(python_2.park)
bool_2 = Boolean(python_2.podium)

# ---- group: ROOT
# ROOT
bibil_11 = PythonScript(Code=file_10, Node_in=flatten(python_3), Label_="Root", Run=Toggle(True))  # -> Node_out, Debug

# ----
geo_9 = Geometry(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)
geo_10 = Geometry([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])
g_2 = PythonScript(node=bibil_11.Node_out)  # -> geom; inputs node: list
# ---------- g_2: Python ----------
node = filter(lambda n: n!=None,node)
if node and node != []:
    geom = []
    for n in node:
        if n.shape.UIgeom != None:
            geom.append(n.shape.UIgeom)
        else:
            geom.append(n.shape.geom)
# ---------- end g_2 ----------

# ---- group: TREE RULES
miru_8 = PythonScript(Code=file_17, Node=bibil_11.Node_out, Run=Toggle(True))

# ----
swatch = ColourSwatch(SwatchColor=RGB(255, 255, 255))
previewlw = CustomPreviewLineweights(Geometry=geo_9, Shader=swatch, Thickness=Slider(5, range=0..10))
previewlw_2 = CustomPreviewLineweights(Geometry=geo_10, Shader=swatch, Thickness=Slider(2, range=0..10))

# ---- group: SHAPENODE
bibil_12 = PythonScript(Code=file_10, Rule_in=flatten(miru_8), Node_in=flatten(g), Label_="PerimeterBlock", Run=Toggle(True))  # -> Node_out, Debug

# ----
number_slider_8 = Slider(2.5, range=0..10)
number_slider_9 = Slider(5, range=0..10)
# BLOCK
number_slider_10 = Slider(30, range=0..100)
g_3 = PythonScript(node=bibil_12.Node_out)  # -> geom; inputs node: list; same code as g_2

# ---- group: SETBACK
miru_9 = PythonScript(
    Code=file_2,
    Height_dim=Slider(6, range=0..10),
    Stepback_dim=data_5,
    Stepback_ref=geo_9,
    Stepback_tol=Slider(15, range=0..100),
    Run=Toggle(True))

miru_10 = PythonScript(
    Code=file_2,
    Height_dim=Slider(9, range=0..10),
    Stepback_dim=data_5,
    Stepback_ref=geo_10,
    Stepback_tol=number_slider_7,
    Run=Toggle(True))

miru_11 = PythonScript(Code=file_2, Height_dim=Slider(0, range=0..100), Stepback_dim=data_4, Run=Toggle(True))

# ---- group: HEIGHT
miru_12 = PythonScript(Code=file_15, Height=data_3, Run=Toggle(True))

# ---- group: SHAPENODE
bibil_13 = PythonScript(
    Code=file_10,
    Rule_in=flatten([miru_12, miru_9, miru_10, miru_11]),
    Node_in=flatten(bibil_12.Node_out),
    Label_="MidRes",
    Run=Toggle(True))  # -> Node_out, Debug

# ----
# COURT
number_slider_11 = Slider(30, range=0..100)
toggle = BooleanToggle(True)
g_4 = PythonScript(node=bibil_13.Node_out)  # -> geom; inputs node: list; same code as g

# ---- group: SETBACK
miru_13 = PythonScript(
    Code=file_2,
    Height_dim=Slider(21, range=0..100),
    Stepback_dim=Slider(2, range=0..10),
    Stepback_ref=[geo_10, geo_9],
    Stepback_tol=number_slider_7,
    From_rear=toggle,
    Run=toggle)

# ---- group: PERIMETER
miru_14 = PythonScript(Code=file_12, Width=number_slider_11, Court_ref="0", Run=Toggle(True))

# ----
geo_11 = Geometry(bibil_13.Debug)
g_5 = PythonScript(node=bibil_13.Node_out)  # -> street; inputs node: list
# ---------- g_5: Python ----------
if node and node != [None]:
    street = []
    for n in node:
        foo = lambda n: n.grammar.type.has_key('street_tolerance_curve')
        n = n.backtrack_tree(foo,accumulate=False)
        if n:
            srf_data = n.grammar.type['street_tolerance_curve']
            print srf_data
            print '--'
            street.extend(srf_data)
    print street
# ---------- end g_5 ----------

# ---- group: SHAPENODE
bibil_14 = PythonScript(Code=file_10, Rule_in=flatten([miru_14, miru_13]), Node_in=flatten(bibil_13.Node_out), Run=Toggle(True))  # -> Node_out, Debug

# ----
python_4 = PythonScript()  # -> a; inputs x: list
# ---------- python_4: Python ----------
import rhinoscriptsyntax as rs
import scriptcontext as sc

#Shape = sc.sticky['Shape']
#S = Shape()

L = []
x = filter(lambda n: n!=None,x)
if x:
    for i in x:
        cpt = rs.CurveAreaCentroid(i)[0]
        if cpt[2] > 0.0:
            obj = rs.MoveObject(i,[0,0,cpt[2]*-1])
            L.append(obj)
        else:
            L.append(i)
a = L
# ---------- end python_4 ----------
g_6 = PythonScript()  # -> street; inputs node: list
# ---------- g_6: Python ----------
node = filter(lambda n: n!=None,node)
if node and node != []:
    street = []
    for n in node:
        loc = n.backtrack_tree(lambda n: n.grammar.type.has_key('street_tolerance_curve'),accumulate=True)
        street.extend(map(lambda n:n.grammar.type['street_tolerance_curve'],loc))
    if street:
        street = reduce(lambda x,y:x+y,street)
    print street
# ---------- end g_6 ----------
geo_12 = Geometry(bibil_14.Debug)
g_7 = PythonScript(node=bibil_14.Node_out)  # -> geom; inputs node: list
# ---------- g_7: Python ----------
node = filter(lambda n: n!=None,node)
if node and node != []:
    geom = []
    for n in node:
        geom.append(n.shape.geom)
    print geom
# ---------- end g_7 ----------
dash = DashPattern(Curve=python_4, Pattern=Slider(1, range=0..10))  # -> Dashes, Gaps
dash_2 = DashPattern(Curve=g_6, Pattern=Slider(2, range=0..10))  # -> Dashes, Gaps
preview = CustomPreview(Geometry=dash_2.Dashes, Shader=ColourSwatch(SwatchColor=RGB(255, 255, 255)))
previewlw_3 = CustomPreviewLineweights(Geometry=dash.Dashes, Shader=ColourSwatch(SwatchColor=RGB(0, 255, 255)), Thickness=Slider(1, range=0..10))
python_5 = PythonScript(node=bibil_14.Node_out, bool=bool_2)  # -> node_out
# ---------- python_5: Python ----------
if bool:
    node_out = node
else:
    node_out = None
# ---------- end python_5 ----------
# W_PODIUM
toggle_2 = BooleanToggle(True)
# TOWERS
toggle_3 = BooleanToggle(True)
# IN_PARK
# TOWERS
g_8 = PythonScript(node=python_5)  # -> geom; inputs node: list; same code as g_7

# ---- group: PACKING
separatedata_2 = Ladybug_SeparateData(Code=file_13, Short_keep_omit=data_6, Long_keep_omit=data_7, Run=Toggle(True))

separatedata_3 = Ladybug_SeparateData(Code=file_13, Short_keep_omit=data_6, Long_keep_omit=data_7, Run=Toggle(True))

# ---- group: EXTRACT_SLICE
miru_15 = PythonScript(Code=file_20, Run=toggle_3)

# ---- group: HEIGHT
miru_16 = PythonScript(Code=file_15, Height_ref="PerimeterBlock", Randomize="-3.0>3.0", Run=Toggle(True))

# ---- group: EXTRACT_SLICE
miru_17 = PythonScript(Code=file_20, Slice_height=Slider(0, range=0..100), Run=Toggle(True))

# ---- group: HEIGHT
miru_18 = PythonScript(Code=file_15, Height_ref="PerimeterBlock", Randomize="-3.0>3.0", Run=toggle_2)

# ---- group: SHAPENODE
bibil_15 = PythonScript(
    Code=file_10,
    Rule_in=flatten([miru_17, separatedata_3, miru_18]),
    Node_in=flatten(bibil_14.Node_out),
    Label_="HiResTower2",
    Run=bool)  # -> Node_out, Node_dead, Debug

bibil_16 = PythonScript(
    Code=file_10,
    Rule_in=flatten([miru_15, separatedata_2, miru_16]),
    Node_in=flatten(bibil_14.Node_out),
    Label_="HiResTower",
    Run=bool_2)  # -> Node_out, Node_dead, Debug

# ----
g_9 = PythonScript(node=bibil_16.Node_out)  # -> geom; inputs node: list
# ---------- g_9: Python ----------
node = filter(lambda n: n!=None,node)
if node and node != []:
    geom = []
    for n in node:
        geom.append(n.shape.geom)
# ---------- end g_9 ----------
g_10 = PythonScript(node=bibil_15.Node_out)  # -> geom; inputs node: list; same code as g_9

# ---- group: backtrack
g_11 = PythonScript(node=bibil_15.Node_dead)  # -> node_out; inputs node: list
# ---------- g_11: Python ----------
node = filter(lambda n: n!=None,node)
if node and node != []:
    node_out = []
    for n in node:
        foo = lambda n: n.grammar.type['label']=='HiResTower2'
        n = n.backtrack_tree(foo,accumulate=False)
        print n
        node_out.append(n)
# ---------- end g_11 ----------

# ----
number_slider_12 = Slider(7, range=0..10)
g_12 = PythonScript(node=g_11)  # -> geom; inputs node: list; same code as g_9

# ---- group: FILTER_NODES
miru_19 = PythonScript(Code=file_5, Dim4long=number_slider_12, Dim4short=number_slider_12, Run=Toggle(True))

# ----
data_8 = Data([bibil_15.Node_out, bibil_16.Node_out, g_8, g_11])

# ---- group: SHAPENODE
bibil_17 = PythonScript(Code=file_10, Rule_in=flatten(miru_19), Node_in=flatten(data_8), Run=Toggle(True))  # -> Node_out, Debug

# ----
data_9 = Data([g_8, g_9])

# ---- group: filternull
python_6 = PythonScript(x=[data_9, g_10])  # -> a; inputs x: list
# ---------- python_6: Python ----------
a = filter(lambda n:n!=None,x)
# ---------- end python_6 ----------

# ----
geo_13 = Geometry(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)
g_13 = PythonScript(node=bibil_17.Node_out)  # -> geom; inputs node: list
# ---------- g_13: Python ----------
node = filter(lambda n: n!=None,node)
if node and node != []:
    geom = []
    for n in node:
        if n.shape.geom:
            geom.append(n.shape.geom)
    #print geom
# ---------- end g_13 ----------
sunion = SolidUnion(Breps=g_13)
fmerge = MergeFaces(Brep=sunion)  # -> Breps, Before, After

# ---- group: ABSTRACT_BEM
miru_20 = PythonScript(Code=file, Bem_tol=Slider(39, range=0..100), Bem_center=geo_13, Run=Toggle(True))

# ----
wires = BrepWireframe(Brep=fmerge.Breps, Density=-1)
material = CreateMaterial(
    Diffuse=ColourSwatch(SwatchColor=RGB(255, 255, 255)),
    Specular=RGB(255, 255, 255),
    Emission=RGB(0, 0, 0),
    Transparency=Slider(0.25, range=0..1),
    Shine=0)

# ---- group: SHAPENODE
bibil_18 = PythonScript(Code=file_10, Rule_in=flatten(miru_20), Node_in=flatten(bibil_17.Node_out), Run=Toggle(True))  # -> Node_out, Node_dead, Debug

# ----
mesh = Mesh(fmerge.Breps)
preview_2 = CustomPreview(Geometry=wires, Shader=ColourSwatch(SwatchColor=RGB(0, 0, 0)))
preview_3 = CustomPreview(Geometry=mesh, Shader=material)
g_14 = PythonScript(node=bibil_18.Node_out)  # -> geom; inputs node: list; same code as g_13
g_15 = PythonScript(node=bibil_18.Node_out)  # -> geom; inputs node: list; same code as g_13
geo_14 = Geometry(bibil_18.Debug)
g_16 = PythonScript(node=bibil_18.Node_out)  # -> tolerance; inputs node: list
# ---------- g_16: Python ----------
node = filter(lambda n: n!=None,node)
if node and node != []:
    tolerance = []
    for n in node:
        loc = n.backtrack_tree(lambda n: n.grammar.type.has_key('tolerance_curve'),accumulate=True)
        tolerance.extend(map(lambda n:n.grammar.type['tolerance_curve'],loc))
    if tolerance:
        tolerance = reduce(lambda x,y:x+y,tolerance)
# ---------- end g_16 ----------

# ---- group: change this to come from root find context
g_17 = PythonScript(node=bibil_18.Node_dead)  # -> context; inputs node: list
# ---------- g_17: Python ----------
node = filter(lambda n: n!=None,node)
if node and node != []:
    context = []
   
    for n in node:
        print n.grammar.type
        foo = lambda n: n.grammar.type.has_key('context_geometry')
        loc = n.backtrack_tree(foo,accumulate=True)
        context.extend(map(lambda n:n.grammar.type['context_geometry'],loc))
    print context
# ---------- end g_17 ----------

# ----
panel_10 = Panel(bibil_18.Debug)
panel_11 = Panel("http://apps1.eere.energy.gov/buildings/energyplus/weatherdata/6_europe_wmo_region_6/FRA_Paris.Orly.071490_IWEC.zip")
previewlw_4 = CustomPreviewLineweights(Geometry=g_16, Shader=ColourSwatch(SwatchColor=RGB(255, 0, 255)), Thickness=Slider(3, range=0..10))
epw_stat = Ladybug_OpenEPWAndSTATWeatherFiles(weatherFileURL=panel_11)  # -> epwFile, statFile; plug-in component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
importstat = Ladybug_ImportStat(statFile=epw_stat.statFile)  # -> readMe, ashraeClimateZone, koppenClimateZone, port, heatingDesignTemp, coolingDesignTemp, port_2, extremeHotWeek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; plug-in component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
ladybug = Ladybug_Ladybug()  # -> Vviiiiiiiiiizzz; plug-in component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
honeybee = Honeybee_Honeybee()  # -> Vviiiiiiiiiizzz; plug-in component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
dragonfly = Dragonfly_Dragonfly()  # -> Vviiiiiiiiiizzz; plug-in component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

bldgprograms = Honeybee_bldgPrograms({"Office": 0, "Retail": 1, "MidriseApartment": 2, "PrimarySchool": 3, "SecondarySchool": 4, "SmallHotel": 5, "LargeHotel": 6, "Hospital": 7, "Outpatient": 8, "Warehouse": 9, "SuperMarket": 10, "FullServiceRestaurant": 11, "QuickServiceRestaurant": 12}, selected="Warehouse")  # disabled
listzoneprograms = Honeybee_ListZonePrograms(bldgProgram=bldgprograms)  # -> zonePrograms; plug-in component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
item = ListItem(List=listzoneprograms, Index="2", Wrap=True)

geo_15 = Geometry([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])
floor_cutter = FloorCutter(BuildingVolume=geo_15, FloorHeights=Slider(3, range=0..10))
geo_16 = Geometry(g_15)
callfromepconstrlibrary = Honeybee_CallFromEPConstructionLibrary(keywords="concrete")  # -> EPMaterials, EPWindowMaterils, EPConstructions; plug-in component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
epnomassmat = Honeybee_EnergyPlusNoMassOpaqueMaterial(name="AsphaltMembrane", R_Value="0.5", thermAbsp="0.9", solAbsp="0.8", visAbsp="0.8")  # -> EPMaterial; plug-in component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
geo_17 = Geometry([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])
mass2zone = Honeybee_Masses2Zones(zoneMasses=flatten(geo_16), zonePrograms=item, isConditioned=Toggle(False), maxRoofAngle=30, createHBZones=Toggle(True))  # -> readMe, HBZones; plug-in component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
item_2 = ListItem(List=callfromepconstrlibrary.EPMaterials, Index="2", Wrap=True)
number_slider_13 = Slider(1, range=0..1)  # disabled
toggle_4 = BooleanToggle(False)  # disabled
geo_18 = Geometry()  # disabled
number_slider_14 = Slider(8, range=0..10)  # disabled
panel_12 = Panel(item_2)
gentestpts = Honeybee_GenerateTestPoints(testGeometry=geo_18, gridSize=number_slider_14, distBaseSrf=number_slider_13, moveTestMesh=toggle_4)  # -> readMe, simplify(testPoints), simplify(ptsVectors), simplify(facesArea), simplify(mesh); disabled; plug-in component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
createepplenum = Honeybee_CreateEPPlenum(HBZones=mass2zone.HBZones)  # -> HBPlenumZones; plug-in component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
epconstruction = Honeybee_EnergyPlusConstruction(name="ConcreteWall", layer_1=item_2)  # -> EPConstruction; plug-in component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
epconstruction_2 = Honeybee_EnergyPlusConstruction(name="AsphaltRoof", layer_1=epnomassmat, layer_2=item_2)  # -> EPConstruction; plug-in component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
faceb = FaceBoundaries(Mesh=gentestpts.mesh)  # disabled
geo_19 = Geometry(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)
geo_20 = Geometry(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)
brep = Brep(faceb)  # disabled
zoneattributelist = Honeybee_ZoneAttributeList({"Name": "name", "Zone Program": "zoneProgram", "Zone Floor Area": "zoneFloorArea", "Zone Volume": "zoneVolume", "Building Program": "bldgProgram", "Is Conditioned": "isConditioned", "HVAC System Type": "HVACSystem", "Occupancy Schedule": "occupancySchedule", "Occupancy Activity Schedule": "occupancyActivitySch", "Heating SetPoint Schedule": "heatingSetPtSchedule"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}, selected="Name")
sunion_2 = SolidUnion(Breps=brep)  # disabled
setepzonecnstr = Honeybee_SetEPZoneConstruction(HBZones=flatten(createepplenum), wallEPConstruction=epconstruction)  # -> simplify(modifiedHBZones); plug-in component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
mass2zone_2 = Honeybee_Masses2Zones(zoneMasses=flatten(geo_19), isConditioned=True, maxRoofAngle=30, createHBZones=Toggle(True))  # -> readMe, HBZones; plug-in component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
soil_type = Panel("4")
labelzones = Honeybee_LabelZones(HBZones=flatten(setepzonecnstr), attribute=zoneattributelist)  # -> zoneTxtLabels, labelBasePts, brepTxtLabels, zoneWireFrames; plug-in component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
createepground = Honeybee_CreateEPGround(HBZones=mass2zone_2.HBZones, soilTypeOrMat=soil_type)  # -> HBGrndZones; plug-in component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
wires_2 = BrepWireframe(Brep=setepzonecnstr, Density=-1)
toggle_5 = BooleanToggle(True)
tag = TextTag(Location=labelzones.labelBasePts, Text=labelzones.zoneTxtLabels)

# ---- group: SHAPENODE
bibil_19 = PythonScript(Code=file_10, Node_in=flatten(createepground), Label_="ground_node", Run=Toggle(True))  # -> Node_out, Node_dead, Debug

# ----
makeadiabaticbytype = Honeybee_MakeAdiabaticByType(HBZones=setepzonecnstr, roofs=toggle_5, exposedFloors=toggle_5)  # -> HBZones; plug-in component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
g_18 = PythonScript(node=bibil_19.Node_out)  # -> geom; inputs node: list; same code as g_13
srfattributelist = Honeybee_SurfaceAttributeList({"Name": "name", "Radiance Material": "RadMaterial", "EnergyPlus Construction": "EPConstruction", "Surface Type": "type", "Boundary Condition": "BC", "Sun Exposure": "sunExposure", "Wind Exposure": "windExposure", "Has Child Surface": "hasChild", "Is Child Surface": "isChild", "Is Planar": "isPlanar", "Srf Type Set By User": "srfTypeByUser", "Boundary Condition Set By User": "srfBCByUser", "Shade Material Name": "shadeMaterialName", "Shading Control Name": "shadingControlName", "Shcading Schedule Name": "shadingSchName"}, selected="Boundary Condition")  # disabled
labelsurfaces = Honeybee_LabelZoneSurfaces(attribute=srfattributelist)  # -> surfaceTxtLabels, labelBasePts, brepTxtLabels, surfaceWireFrames; disabled; plug-in component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
wires_3 = BrepWireframe(Density=-1)  # disabled
data_10 = Data([makeadiabaticbytype, createepground])
tag_2 = TextTag(Location=labelsurfaces.labelBasePts, Text=labelsurfaces.surfaceTxtLabels)  # disabled
toggle_6 = BooleanToggle(True)
panel_13 = Panel("""OutputControl:Table:Style,Comma;
Output:Variable,*,Surface Outside Face Temperature, hourly;""")
number_slider_15 = Slider(6, range=0..10)
number_slider_16 = Slider(21, range=0..100)
analysisperiod = Ladybug_AnalysisPeriod(
    fromMonth=number_slider_15,
    fromDay=number_slider_16,
    fromHour=Slider(4, range=0..10),
    toMonth=number_slider_15,
    toDay=number_slider_16,
    toHour=Slider(21, range=0..100))  # -> readMe, analysisPeriod; plug-in component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
exporttoopenstudio = Honeybee_ExportToOpenStudio(
    epwWeatherFile=epw_stat.epwFile,
    analysisPeriod=analysisperiod.analysisPeriod,
    HBZones=flatten(data_10),
    simulationOutputs=flatten(panel_13),
    writeOSM=toggle_6,
    runSimulation=toggle_6)  # -> readMe, osmFileAddress, idfFileAddress, resultsFileAddress, eioFileAddress, rddFileAddress, studyFolder; plug-in component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
readepsrfresult = Honeybee_ReadEPSurfaceResult(resultFileAddress=exporttoopenstudio.resultsFileAddress)  # -> surfaceIndoorTemp, surfaceOutdoorTemp, surfaceEnergyFlow, opaqueEnergyFlow, glazEnergyFlow, windowTotalSolarEnergy, windowBeamEnergy, windowDiffEnergy, windowTransmissivity, otherSurfaceData; plug-in component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
panel_14 = Panel(readepsrfresult.surfaceOutdoorTemp)
colorsurfaces = Honeybee_ColorSurfacesByEPResult(srfData=readepsrfresult.surfaceOutdoorTemp, HBZones=flatten(data_10), runIt=Toggle(True))  # -> readMe, srfColoredMesh, zoneWireFrame, legend, legendBasePt, analysisTitle, srfBreps, srfColors, srfValues, normalizedSrfData; plug-in component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
area_3 = Area(Geometry=colorsurfaces.srfBreps)  # -> Area, Centroid
sort = SortList(Keys=colorsurfaces.srfValues)  # -> Keys, ValuesA
tag_3 = TextTag(Location=area_3.Centroid, Text=colorsurfaces.srfValues)
geo_21 = Geometry(colorsurfaces.srfBreps)
item_3 = ListItem(List=sort.Keys, Index=0, Wrap=True)
item_4 = ListItem(List=sort.Keys, Index="-1", Wrap=True)
gradient = Gradient(
    LowerLimit=Slider(15, range=0..100),
    UpperLimit=Slider(35, range=0..100),
    Parameter=colorsurfaces.srfValues,
    stops=[0: RGB(255, 0, 64), 0.25: RGB(245, 93, 0), 0.532: RGB(255, 255, 22), 0.75: RGB(93, 177, 249), 1: RGB(0, 44, 169)])
geo_22 = Geometry(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)

# ---- group: BIBIL2HBZone
python_7 = PythonScript(HBZones=makeadiabaticbytype, BBNodes=bibil_18.Node_out, HBground=createepground, BBground=bibil_19.Node_out)  # -> BBNodes; inputs HBZones: list, BBNodes: list
# ---------- python_7: Python ----------
import scriptcontext as sc
import rhinoscriptsyntax as rs

hb_hive = sc.sticky["honeybee_Hive"]()


def IsList(lst):
    return lst != [None] and lst != []

if IsList(_HBZones) and IsList(_BBNodes):
    #print len(_HBZones)
    #print len(_BBNodes)
    for i in xrange(len(_HBZones)):
        hb = _HBZones[i]
        hb = rs.coercebrep(hb)
        #zone = hb_hive.visualizeFromHoneybeeHive([hb])[0]
        bb = _BBNodes[i]
        bb.grammar.type['HBZone'] = hb
        _BBNodes[i] = bb
    
    if _HBground and _BBground:
        _HBground = rs.coercebrep(_HBground)
        _BBground.grammar.type['HBZone'] = _HBground
        _BBNodes.append(_BBground)
# ---------- end python_7 ----------

# ---- group: EXTRACT_CANYON
miru_21 = PythonScript(
    Code=file_3,
    Canyon_tol=Slider(30, range=0..100),
    Canyon_center=geo_22,
    Srf_data=readepsrfresult.surfaceOutdoorTemp,
    Run=Toggle(True))

# ----
preview_4 = CustomPreview(Geometry=geo_21, Shader=gradient)

# ---- group: INTERPOLATE_VERTICAL
miru_22 = PythonScript(Code=file_4, Run=Toggle(True))

# ---- group: SHAPENODE
bibil_20 = PythonScript(Code=file_10, Rule_in=flatten([miru_21, miru_22]), Node_in=flatten(python_7), Run=Toggle(True))  # -> Node_out, Node_dead, Debug

# ----
data_11 = Data(Slider(23, range=0..100))
data_12 = Data(Slider(29, range=0..100))
g_19 = PythonScript(node=bibil_20.Node_out)  # -> inorm; inputs node: list
# ---------- g_19: Python ----------
if node and node != [None]:
    inorm = []
    for n in node:
        if n.grammar.type.has_key('interpolate_srf_normal'):
            srf_data = n.grammar.type['interpolate_srf_normal']
            #print srf_data
            inorm.extend(srf_data)
    
    #print isrf
# ---------- end g_19 ----------
g_20 = PythonScript(node=bibil_20.Node_out)  # -> isrf; inputs node: list
# ---------- g_20: Python ----------
if node and node != [None]:
    isrf = []
    for n in node:
        if n.grammar.type.has_key('interpolate_srf_geom'):
            srf_data = n.grammar.type['interpolate_srf_geom']
            #print srf_data
            isrf.extend(srf_data)
    
    #print isrf
# ---------- end g_20 ----------
g_21 = PythonScript(node=bibil_20.Node_out)  # -> icpt; inputs node: list
# ---------- g_21: Python ----------
if node and node != [None]:
    icpt = []
    for n in node:
        if n.grammar.type.has_key('interpolate_cpt'):
            srf_data = n.grammar.type['interpolate_cpt']
            #print srf_data
            icpt.extend(srf_data)
    #print cpt
# ---------- end g_21 ----------
g_22 = PythonScript(node=bibil_20.Node_out)  # -> itemp; inputs node: list
# ---------- g_22: Python ----------
import scriptcontext as sc
Bula = sc.sticky['Bula']
B = Bula()

if node and node != [None]:
    itemp = []
    for n in node:
        if n.grammar.type.has_key('interpolate_temperature'):
            srf_data = n.grammar.type['interpolate_temperature']
            #print srf_data
            itemp.extend(srf_data)

#itemp = B.normalize_list(itemp,1.,0.)
#print itemp
# ---------- end g_22 ----------
g_23 = PythonScript(node=bibil_20.Node_out)  # -> pt; inputs node: list
# ---------- g_23: Python ----------
node = filter(lambda n: n!=None,node)
if node and node != []:
    pt = []
    for n in node:
        n = n.backtrack_tree(lambda n: n.grammar.type.has_key('processed_srf_geom'))
        if n:
            srf_data = n.grammar.type['processed_srf_pt']
            #print srf_data
            # print '--'
            pt.extend(srf_data)
    #print pt
# ---------- end g_23 ----------
g_24 = PythonScript(node=bibil_20.Node_out)  # -> temp; inputs node: list
# ---------- g_24: Python ----------
if node and node != [None]:
    temp = []
    for n in node:
        #if n.grammar.type.has_key('processed_srf_data'):
        n = n.backtrack_tree(lambda n: n.grammar.type.has_key('processed_srf_data'))
        if n:
            srf_data = n.grammar.type['processed_srf_data']
            temp.extend(srf_data)
    #print temp
# ---------- end g_24 ----------
g_25 = PythonScript(node=bibil_20.Node_out)  # -> srf; inputs node: list
# ---------- g_25: Python ----------
if node and node != [None]:
    srf = []
    for n in node:
        n = n.backtrack_tree(lambda n: n.grammar.type.has_key('processed_srf_geom'))
        #if n.grammar.type.has_key('processed_srf_geom'):
        if n:
            srf_data = n.grammar.type['processed_srf_geom']
            #print srf_data
            #print '-'
            srf.extend(srf_data)
    #print srf
# ---------- end g_25 ----------
g_26 = PythonScript(node=bibil_20.Node_out)  # -> norm; inputs node: list
# ---------- g_26: Python ----------
node = filter(lambda n: n!=None,node)
if node and node != []:
    norm = []
    for n in node:
        n = n.backtrack_tree(lambda n: n.grammar.type.has_key('processed_srf_normal'))
        if n:
            srf_data = n.grammar.type['processed_srf_normal']
            #print srf_data
            # print '--'
            norm.extend(srf_data)
    #print norm
# ---------- end g_26 ----------
g_27 = PythonScript(node=bibil_20.Node_out)  # -> gtemp; inputs node: list
# ---------- g_27: Python ----------
import scriptcontext as sc
Bula = sc.sticky['Bula']
B = Bula()

if node and node != [None]:
    gtemp = []
    for n in node:
        n = n.backtrack_tree(lambda n:n.grammar.type.has_key('ground_srf_data'))
        if n and n.grammar.type.has_key('ground_srf_data'):
            srf_data = n.grammar.type['ground_srf_data']
            #print srf_data
            gtemp.extend(srf_data)

    #print gtemp
# ---------- end g_27 ----------
g_28 = PythonScript(node=bibil_20.Node_out)  # -> gsrf; inputs node: list
# ---------- g_28: Python ----------
if node and node != [None]:
    gsrf = []
    for n in node:
        n = n.backtrack_tree(lambda n:n.grammar.type.has_key('ground_srf_geom'))
        if n and n.grammar.type.has_key('ground_srf_geom'):
            srf_data = n.grammar.type['ground_srf_geom']
            #print srf_data
            gsrf.extend(srf_data)
    
    #print gsrf
# ---------- end g_28 ----------
g_29 = PythonScript(node=bibil_20.Node_out)  # -> gcpt; inputs node: list
# ---------- g_29: Python ----------
if node and node != [None]:
    gcpt = []
    for n in node:
        n = n.backtrack_tree(lambda n:n.grammar.type.has_key('ground_cpt'))
        if n and n.grammar.type.has_key('ground_cpt'):
            srf_data = n.grammar.type['ground_cpt']
            #print srf_data
            gcpt.extend(srf_data)
    #print cpt
# ---------- end g_29 ----------
sort_2 = SortList(Keys=g_22)  # -> Keys, ValuesA
sort_3 = SortList(Keys=g_24)  # -> Keys, ValuesA
item_5 = ListItem(List=sort_2.Keys, Index=0, Wrap=True)
item_6 = ListItem(List=sort_2.Keys, Index="-1", Wrap=True)
item_7 = ListItem(List=sort_3.Keys, Index=0, Wrap=True)
item_8 = ListItem(List=sort_3.Keys, Index="-1", Wrap=True)
panel_15 = Panel(item_5)
panel_16 = Panel(item_6)
panel_17 = Panel(item_7)
panel_18 = Panel(item_8)
move = Move(Geometry=g_25, Motion=g_26)  # -> Geometry, Transform

# ----
# Import Climate Data
panel_19 = Panel("https://www.energyplus.net/weather-download/southwest_pacific_wmo_region_5/SGP//SGP_Singapore.486980_IWEC/all")  # disabled
epw_stat_2 = Ladybug_OpenEPWAndSTATWeatherFiles(weatherFileURL=panel_19)  # -> epwFile, statFile; disabled; plug-in component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
importstat_2 = Ladybug_ImportStat(statFile=epw_stat_2.statFile)  # -> readMe, ashraeClimateZone, koppenClimateZone, port, heatingDesignTemp, coolingDesignTemp, port_2, extremeHotWeek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; disabled; plug-in component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

move_2 = Move(Geometry=g_20, Motion=g_19)  # -> Geometry, Transform
mesh_2 = Mesh(move.Geometry)
gradient_2 = Gradient(
    LowerLimit=data_11,
    UpperLimit=data_12,
    Parameter=g_22,
    stops=[0: RGB(255, 0, 64), 0.25: RGB(245, 93, 0), 0.5: RGB(255, 255, 22), 0.75: RGB(93, 177, 249), 1: RGB(0, 44, 169)])
mesh_3 = Mesh(move_2.Geometry)
gradient_3 = Gradient(
    LowerLimit=data_11,
    UpperLimit=data_12,
    Parameter=g_24,
    stops=[0: RGB(255, 0, 64), 0.25: RGB(245, 93, 0), 0.5: RGB(255, 255, 22), 0.75: RGB(93, 177, 249), 1: RGB(0, 44, 169)])
demesh = DeconstructMesh(Mesh=mesh_2)  # -> Vertices, Faces, Colours, Normals
demesh_2 = DeconstructMesh(Mesh=mesh_3)  # -> Vertices, Faces, Colours, Normals
conmesh = ConstructMesh(Vertices=demesh.Vertices, Faces=demesh.Faces)
conmesh_2 = ConstructMesh(Vertices=demesh_2.Vertices, Faces=demesh_2.Faces)
mcol = MeshColours(Mesh=graft(conmesh), Colours=graft(gradient_3))
mcol_2 = MeshColours(Mesh=graft(conmesh_2), Colours=graft(gradient_2))
mesh_4 = Mesh(mcol_2)
mesh_5 = Mesh(mcol)

panel_20 = Panel("0.6")  # disabled
# Define Residential
# + Commercial Typologies
panel_21 = Panel("3")  # disabled
commercialtypology = Dragonfly_DefaultCommericalTypology(flr2FlrHeight=panel_21, window2Wall=panel_20, climateZone=importstat_2.ashraeClimateZone)  # -> buildingTypology; disabled; plug-in component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

buildings = Brep()  # disabled
pavement = Brep(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)  # disabled
python_8 = PythonScript(x=[move_2.Geometry, move.Geometry], node_ref=bibil_20.Node_out)  # -> a; inputs x: list, node_ref: list
# ---------- python_8: Python ----------
import rhinoscriptsyntax as rs
import Rhino as rc
import scriptcontext as sc

Shape = sc.sticky['Shape']

if len(x)>0 and len(node_ref)>0:
    #shp = Shape(rs.coercebrep(x[0]),cplane=None)
    ref = node_ref[0]
    cplane = ref.shape.cplane
    
    a = cplane
# ---------- end python_8 ----------
geo_23 = Geometry([move_2.Geometry, move.Geometry])
Z = UnitZ(Factor=Slider(485, range=0..1000))
wires_4 = BrepWireframe(Brep=buildings, Density=-1)  # disabled
group = Group(Objects=geo_23)
pt = Point(Point(-73.52861214, -114.8068854, 216.8657781))
bbox = BoundingBox(Content=group, Plane=python_8)  # -> Box, Box_2

# ---- group: SHAPENODE
bibil_21 = PythonScript(Code=file_10, Node_in=flatten(bbox.Box), Label_="bbox", Run=Toggle(True))  # -> Node_out, Node_dead, Debug

# ----
g_30 = PythonScript(node=bibil_21.Node_out)  # -> crv; inputs node: list
# ---------- g_30: Python ----------
node = filter(lambda n: n!=None,node)
if node and node != []:
    crv = []
    for n in node:
        if n.shape.bottom_crv:
            crv.append(n.shape.bottom_crv)
    #print geom
# ---------- end g_30 ----------
python_9 = PythonScript(srflst=g_28, templst=g_27, boundcrv=g_30)  # -> srf_out, temp_out; inputs srflst: list, templst: list
# ---------- python_9: Python ----------
import rhinoscriptsyntax as rs
import Rhino as rc
import ghpythonlib as ghlib
import copy

srf_out, temp_out = [], []
if True:
    boundcrv = rs.coercecurve(boundcrv)
        
    for i in xrange(len(srflst)):
        srf = srflst[i]
        temp = templst[i]
        
        srf = rs.coercebrep(srf)
        srflstsplit = ghlib.components.SurfaceSplit(srf,boundcrv)
        if srflstsplit and type(srflstsplit)!=type([]):
            srflstsplit = [srflstsplit]
        if srflstsplit and len(srflstsplit)> 0.1:
            for s in srflstsplit:
                cpt = ghlib.components.Area(s)[1]
                IsIn = rs.PointInPlanarClosedCurve(cpt,boundcrv)
                if abs(IsIn - 1.0) < 0.1:
                    #is inside
                    srf_out.append(s)
                    temp_out.append(temp)
        else:
            cpt = ghlib.components.Area(srf)[1]
            IsIn = rs.PointInPlanarClosedCurve(cpt,boundcrv)
            if abs(IsIn - 1.0) < 0.1:
                srf_out.append(srf)
                temp_out.append(temp)

#print srf_out
#print temp_out
# ---------- end python_9 ----------
sort_4 = SortList(Keys=python_9.temp_out)  # -> Keys, ValuesA
item_9 = ListItem(List=sort_4.Keys, Index=0, Wrap=True)
item_10 = ListItem(List=sort_4.Keys, Index="-1", Wrap=True)
panel_22 = Panel(item_9)
panel_23 = Panel(item_10)
gradient_4 = Gradient(
    LowerLimit=data_11,
    UpperLimit=data_12,
    Parameter=python_9.temp_out,
    stops=[0: RGB(255, 0, 64), 0.25: RGB(245, 93, 0), 0.5: RGB(255, 255, 22), 0.75: RGB(93, 177, 249), 1: RGB(0, 44, 169)])
mesh_6 = Mesh(python_9.srf_out)
demesh_3 = DeconstructMesh(Mesh=mesh_6)  # -> Vertices, Faces, Colours, Normals
conmesh_3 = ConstructMesh(Vertices=demesh_3.Vertices, Faces=demesh_3.Faces)
mcol_3 = MeshColours(Mesh=graft(conmesh_3), Colours=graft(gradient_4))
mesh_7 = Mesh(mcol_3)
pdecon = Deconstruct(Point=pt)  # -> XComponent, YComponent, ZComponent
wires_5 = BrepWireframe(Brep=bbox.Box, Density=-1)
move_3 = Move(Geometry=[mesh_4, mesh_5, mesh_7], Motion=Z)  # -> Geometry, Transform
pt_2 = ConstructPoint(XCoordinate=pdecon.XComponent, YCoordinate=pdecon.YComponent, ZCoordinate=Slider(395, range=0..1000))
pt_3 = ConstructPoint(XCoordinate=pdecon.XComponent, YCoordinate=pdecon.YComponent, ZCoordinate=Slider(77, range=0..1000))
move_4 = Move(Geometry=wires_5, Motion=Z)  # -> Geometry, Transform
swatch_2 = ColourSwatch(SwatchColor=RGB(255, 0, 255))
ln = Line(StartPoint=pt_2, EndPoint=pt_3)
toggle_7 = BooleanToggle(True)  # disabled
panel_24 = Panel("8")  # disabled
# Define The City
panel_25 = Panel("0.1")  # disabled
dash_3 = DashPattern(Curve=ln, Pattern=Slider(7.7, range=0..10))  # -> Dashes, Gaps
uwgcityfromtypology = Dragonfly_UWGCityFromTypologies(
    buildingTypologies=flatten(commercialtypology),
    buildingBreps=flatten(buildings),
    pavementBrep=flatten(pavement),
    treesOrCoverage=flatten(panel_25),
    nonBldgHeat=panel_24,
    runIt=toggle_7)  # -> readMe, port, UWGCity, port_2, joinedBldgs, bldgFootprints, treeFootprints, pavementSrf, grassSrf; disabled; plug-in component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
previewlw_5 = CustomPreviewLineweights(Geometry=dash_3.Dashes, Shader=swatch_2, Thickness=Slider(2, range=0..10))
preview_5 = CustomPreview(Geometry=[move_4.Geometry, wires_5], Shader=swatch_2)
panel_26 = Panel(uwgcityfromtypology.readMe)  # disabled
python_10 = PythonScript(x="soln", y=python)  # -> a
# ---------- python_10: Python ----------
a = x+y

print a
# ---------- end python_10 ----------
data_13 = Data()
captureview = Ladybug_CaptureView(
    fileName=python_10,
    folder="C:\Users\user\Desktop\lb_fly",
    imageWidth=Slider(800, range=0..1000),
    imageHeight=Slider(600, range=0..1000),
    displayMode="Wireframe",
    transparBack=Toggle(True),
    capture=data_13)  # -> imagePath; plug-in component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
panel_27 = Panel(captureview)
toggle_8 = BooleanToggle(True)  # disabled
# Run the UWG
extreme_hot_week = Data(importstat_2.extremeHotWeek)  # disabled
panel_28 = Panel("SingaporeSite")  # disabled
runuwg = Dragonfly_RunUrbanWeatherGenerator(
    epwFile=epw_stat_2.epwFile,
    UWGCity=uwgcityfromtypology.UWGCity,
    analysisPeriod=extreme_hot_week,
    writeXML=toggle_8,
    runUWG=toggle_8,
    xmlFileName=panel_28)  # -> readMe, xmlText, xmlFileAddress, epwFileAddress; disabled; plug-in component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
original_weather_file = Data(epw_stat_2.epwFile)  # disabled

importepw = Ladybug_ImportEpw(epwFile=original_weather_file)  # -> readMe, latitude, location, dryBulbTemperature, dewPointTemperature, relativeHumidity, windSpeed, windDirection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; disabled; plug-in component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
selectandaveragedata = Ladybug_AverageData(annualHourlyData=importepw.dryBulbTemperature, analysisPeriod=extreme_hot_week)  # -> readMe, selHourlyData, averagedDaily, averagedMonthly, avrMonthlyPerHour, avrAnalysisPeriod; disabled; plug-in component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

importepw_2 = Ladybug_ImportEpw(epwFile=runuwg.epwFileAddress)  # -> readMe, latitude, location, dryBulbTemperature, dewPointTemperature, relativeHumidity, windSpeed, windDirection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; disabled; plug-in component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
# Import Rural + Urban EPWs
selectandaveragedata_2 = Ladybug_AverageData(annualHourlyData=importepw_2.relativeHumidity, analysisPeriod=extreme_hot_week)  # -> readMe, selHourlyData, averagedDaily, averagedMonthly, avrMonthlyPerHour, avrAnalysisPeriod; disabled; plug-in component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
selectandaveragedata_3 = Ladybug_AverageData(annualHourlyData=importepw_2.dryBulbTemperature, analysisPeriod=extreme_hot_week)  # -> readMe, selHourlyData, averagedDaily, averagedMonthly, avrMonthlyPerHour, avrAnalysisPeriod; disabled; plug-in component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

selectandaveragedata_4 = Ladybug_AverageData(annualHourlyData=importepw.relativeHumidity, analysisPeriod=extreme_hot_week)  # -> readMe, selHourlyData, averagedDaily, averagedMonthly, avrMonthlyPerHour, avrAnalysisPeriod; disabled; plug-in component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

toggle_9 = BooleanToggle(True)  # disabled
outdoorcomfortcalculator = Ladybug_OutdoorComfortCalculator(
    dryBulbTemperature=selectandaveragedata_3.selHourlyData,
    relativeHumidity=selectandaveragedata_2.selHourlyData,
    runIt=toggle_9)  # -> readMe, port, universalThermalClimateIndex, comfortableOrNot, thermalStress, conditionOfPerson, port_2, percentOfTimeComfortable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; disabled; plug-in component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
outdoorcomfortcalculator_2 = Ladybug_OutdoorComfortCalculator(
    dryBulbTemperature=selectandaveragedata.selHourlyData,
    relativeHumidity=selectandaveragedata_4.selHourlyData,
    runIt=toggle_9)  # -> readMe, port, universalThermalClimateIndex, comfortableOrNot, thermalStress, conditionOfPerson, port_2, percentOfTimeComfortable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; disabled; plug-in component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
panel_29 = Panel(outdoorcomfortcalculator_2.percentHeatStress)  # disabled
panel_30 = Panel(outdoorcomfortcalculator.percentHeatStress)  # disabled

strnum = Ladybug_SeparateData(inputList=flatten(selectandaveragedata_3.selHourlyData))  # -> numbers, strings; disabled; plug-in component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
strnum_2 = Ladybug_SeparateData(inputList=flatten(selectandaveragedata.selHourlyData))  # -> numbers, strings; disabled; plug-in component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
avr = Average(Input=strnum.numbers)  # disabled
avr_2 = Average(Input=strnum_2.numbers)  # disabled
subtraction = Subtraction(A=strnum.numbers, B=strnum_2.numbers)  # disabled
subtraction_2 = Subtraction(A=avr, B=avr_2)  # disabled
sort_5 = SortList(Keys=subtraction)  # -> Keys, ValuesA; disabled
rev = ReverseList(List=sort_5.Keys)  # disabled
item_11 = ListItem(List=rev, Index=0, Wrap=True)  # disabled
maximum_uhi_c = Panel(item_11)  # disabled
avg_uhi_c = Panel(subtraction_2)  # disabled

panel_31 = Panel("-250")  # disabled
panel_32 = Panel("300")  # disabled
pt_4 = ConstructPoint(XCoordinate=panel_32, YCoordinate=0, ZCoordinate=panel_31)  # disabled
_3dchart = Ladybug_3DChart(
    inputData=flatten([outdoorcomfortcalculator_2.universalThermalClimateIndex, outdoorcomfortcalculator.universalThermalClimateIndex]),
    basePoint=pt_4)  # -> readMe, graphMesh, graphCurves, legend, legendBasePts, title, titleBasePts, dataPts, conditionalHOY; disabled; plug-in component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
