# Grasshopper definition bibil_acadia_26_single_bld_viz_bem.gh (Grasshopper 0.9.76)
# plug-ins: Python Interpreter, HDTReference, LunchBox

list = ValueList({"dir", "file"}, selected="dir")

# ---- group: find directory
bibil = PythonScript(
    dir=["C:\\Users\\vasanthakumars\\Documents\\GitHub\\bibil\\src", "C:\\saeran\\master\\git\\bibil\\src"],
    type=list,
    run=Toggle(True))  # -> dir; inputs dir: list
# ---------- bibil: Python ----------
import os
import sys

ghenv.Component.Params.Output[0].Name = "null"
ghenv.Component.Params.Output[0].NickName = "null"

#sys.path.append("C:\Program Files\Rhinoceros 5.0 (64-bit)\System")

if run:
    confirm_dir = None
    for d in dir:
        try:
            if type == "file":
                file_ = open(d)
                file_.close()
            else:
                print os.listdir(d)
            confirm_dir = d
            break
        except Exception as e:
            #print str(e)
            continue
    if confirm_dir != None:
        ghenv.Component.Params.Output[0].Name = type
        ghenv.Component.Params.Output[0].NickName = type
        dir = confirm_dir
        file = confirm_dir
null = None
# ---------- end bibil ----------

# ---- group: abstract_bem
python_script = PythonScript(i=bibil)  # -> o
# ---------- python_script: Python ----------
import os

if i:
    o = os.path.join(str(i),"miru\\miru_abstract_bem.py")
# ---------- end python_script ----------
file = ReadFile(File=python_script, PerLineParse=False)

# ---- group: stepback_manual
python_script_2 = PythonScript(i=bibil)  # -> o
# ---------- python_script_2: Python ----------
import os

if i:
    o = os.path.join(str(i),"miru\\miru_stepback_manual.py")
# ---------- end python_script_2 ----------
file_2 = ReadFile(File=python_script_2, PerLineParse=False)

# ---- group: extract_canyon
python_script_3 = PythonScript(i=bibil)  # -> o
# ---------- python_script_3: Python ----------
import os

if i:
    o = os.path.join(str(i),"miru\\miru_extract_canyon.py")
# ---------- end python_script_3 ----------
file_3 = ReadFile(File=python_script_3, PerLineParse=False)

# ---- group: interpolate_vertical
python_script_4 = PythonScript(i=bibil)  # -> o
# ---------- python_script_4: Python ----------
import os

if i:
    o = os.path.join(str(i),"miru\\miru_interpolate_vertical.py")
# ---------- end python_script_4 ----------
file_4 = ReadFile(File=python_script_4, PerLineParse=False)

# ---- group: filter_nodes
python_script_5 = PythonScript(i=bibil)  # -> o
# ---------- python_script_5: Python ----------
import os

if i:
    o = os.path.join(str(i),"miru\\miru_filter_nodes.py")
# ---------- end python_script_5 ----------
file_5 = ReadFile(File=python_script_5, PerLineParse=False)

# ---- group: tree
python_script_6 = PythonScript(i=bibil)  # -> o
# ---------- python_script_6: Python ----------
import os

if i:
    o = os.path.join(str(i),"bibil\\bibil_tree.py")
# ---------- end python_script_6 ----------
file_6 = ReadFile(File=python_script_6, PerLineParse=False)
bibil_2 = PythonScript(Code=file_6)

# ---- group: grammar
python_script_7 = PythonScript(i=bibil)  # -> o
# ---------- python_script_7: Python ----------
import os

if i:
    o = os.path.join(str(i),"bibil\\bibil_grammar.py")
# ---------- end python_script_7 ----------
file_7 = ReadFile(File=python_script_7, PerLineParse=False)
bibil_3 = PythonScript(Code=file_7)

# ---- group: shape
python_script_8 = PythonScript(i=bibil)  # -> o
# ---------- python_script_8: Python ----------
import os

if i:
    o = os.path.join(str(i),"bibil\\bibil_shape.py")
#o = os.path.join(str(i),"research\\bibil_shape_shape_3d_2d.py")
# ---------- end python_script_8 ----------
file_8 = ReadFile(File=python_script_8, PerLineParse=False)
bibil_4 = PythonScript(Code=file_8)

# ---- group: bula
python_script_9 = PythonScript(i=bibil)  # -> o
# ---------- python_script_9: Python ----------
import os

if i:
    o = os.path.join(str(i),"bula\\bula_minimal.py")
# ---------- end python_script_9 ----------
file_9 = ReadFile(File=python_script_9, PerLineParse=False)
bibil_5 = PythonScript(Code=file_9)

# ---- group: UI
python_script_10 = PythonScript(i=bibil)  # -> o
# ---------- python_script_10: Python ----------
import os

if i:
    o = os.path.join(str(i),"bibil\\bibil_UI.py")
# ---------- end python_script_10 ----------
file_10 = ReadFile(File=python_script_10, PerLineParse=False)

# ---- group: grammar_divide
python_script_11 = PythonScript(i=bibil)  # -> o
# ---------- python_script_11: Python ----------
import os

if i:
    o = os.path.join(str(i),"miru\\miru_divide.py")
# ---------- end python_script_11 ----------
file_11 = ReadFile(File=python_script_11, PerLineParse=False)

# ---- group: grammar_courtyard
python_script_12 = PythonScript(i=bibil)  # -> o
# ---------- python_script_12: Python ----------
import os

if i:
    o = os.path.join(str(i),"miru\\miru_court.py")
# ---------- end python_script_12 ----------
file_12 = ReadFile(File=python_script_12, PerLineParse=False)

# ---- group: grammar_tower
python_script_13 = PythonScript(i=bibil)  # -> o
# ---------- python_script_13: Python ----------
import os

if i:
    o = os.path.join(str(i),"miru\\miru_packing.py")
# ---------- end python_script_13 ----------
file_13 = ReadFile(File=python_script_13, PerLineParse=False)

# ---- group: stepback
python_script_14 = PythonScript(i=bibil)  # -> o
# ---------- python_script_14: Python ----------
import os

if i:
    o = os.path.join(str(i),"miru\\miru_stepback.py")
# ---------- end python_script_14 ----------
file_14 = ReadFile(File=python_script_14, PerLineParse=False)

# ---- group: grammar_height
python_script_15 = PythonScript(i=bibil)  # -> o
# ---------- python_script_15: Python ----------
import os

if i:
    o = os.path.join(str(i),"miru\\miru_height.py")
# ---------- end python_script_15 ----------
file_15 = ReadFile(File=python_script_15, PerLineParse=False)

# ---- group: grammar_analysis_pts
python_script_16 = PythonScript(i=bibil)  # -> o
# ---------- python_script_16: Python ----------
import os

if i:
    o = os.path.join(str(i),"miru\\miru_analysis.py")
# ---------- end python_script_16 ----------
file_16 = ReadFile(File=python_script_16, PerLineParse=False)

# ---- group: meta_tree
python_script_17 = PythonScript(i=bibil)  # -> o
# ---------- python_script_17: Python ----------
import os

if i:
    o = os.path.join(str(i),"miru\\miru_meta_tree.py")
# ---------- end python_script_17 ----------
file_17 = ReadFile(File=python_script_17, PerLineParse=False)

# ---- group: land_use
python_script_18 = PythonScript(i=bibil)  # -> o
# ---------- python_script_18: Python ----------
import os

if i:
    o = os.path.join(str(i),"miru\\miru_landuse.py")
# ---------- end python_script_18 ----------
file_18 = ReadFile(File=python_script_18, PerLineParse=False)

# ---- group: shape2height
python_script_19 = PythonScript(i=bibil)  # -> o
# ---------- python_script_19: Python ----------
import os

if i:
    o = os.path.join(str(i),"miru\\miru_shape2height.py")
# ---------- end python_script_19 ----------
file_19 = ReadFile(File=python_script_19, PerLineParse=False)

# ---- group: extract_slice
python_script_20 = PythonScript(i=bibil)  # -> o
# ---------- python_script_20: Python ----------
import os

if i:
    o = os.path.join(str(i),"miru\\miru_extract_slice.py")
# ---------- end python_script_20 ----------
file_20 = ReadFile(File=python_script_20, PerLineParse=False)

# ----
number_slider = Slider(20, range=0..100)  # disabled
number_slider_2 = Slider(0, range=0..100)  # disabled
number_slider_3 = Slider(2, range=0..10)  # disabled
number_slider_4 = Slider(0.5, range=0..1)  # disabled
number_slider_5 = Slider(0, range=0..100)  # disabled
panel = Panel("22.5:6.0")  # disabled
number_slider_6 = Slider(16.5, range=0..100)  # disabled
panel_2 = Panel("-1")  # disabled
panel_3 = Panel("27.0,25.0")  # disabled
panel_4 = Panel("27.0,25.0")  # disabled
list_2 = ValueList({"divide by depth": "subdivide_depth", "divide by same depth": "subdivide_depth_same", "divide by dim": "subdivide_dim"}, selected="divide by same depth")  # disabled
toggle = BooleanToggle(False)  # disabled
toggle_2 = BooleanToggle(False)  # disabled
toggle_3 = BooleanToggle(False)  # disabled
toggle_4 = BooleanToggle(False)  # disabled
toggle_5 = BooleanToggle(False)  # disabled
toggle_6 = BooleanToggle(False)  # disabled
toggle_7 = BooleanToggle(True)  # disabled
toggle_8 = BooleanToggle(False)  # disabled
list_3 = ValueList({"YZ": "NS", "XZ": "EW", "XY": "Z"}, selected="XZ")  # disabled
panel_5 = Panel("0")  # disabled

# ---- group: SETBACK
miru = PythonScript(Code=file_14, Height_stepback=panel, Run=toggle)  # disabled

# ---- group: PACKING
separatedata = Ladybug_SeparateData(Code=file_13, X_keep_omit=panel_4, Y_keep_omit=panel_3, Seperation_ref=panel_2, Run=toggle_8)  # disabled

# ---- group: EXTRACT_SLICE
miru_2 = PythonScript(Code=file_20, Run=toggle_5)  # disabled

# ---- group: DIVIDE
miru_3 = PythonScript(
    Code=file_11,
    Divide_num=number_slider_3,
    Divide_cut=number_slider_5,
    Divide_type=list_2,
    Divide_ratio=number_slider_4,
    Axis=list_3,
    Run=toggle_6)  # disabled

# ---- group: PERIMETER
miru_4 = PythonScript(Code=file_12, Width=number_slider, Cut_width=number_slider_2, Court_ref=panel_5, Run=toggle_3)  # disabled

# ---- group: HEIGHT
miru_5 = PythonScript(Code=file_15, Height=number_slider_6, Run=toggle_7)  # disabled

# ---- group: TREE RULES
miru_6 = PythonScript(Code=file_17, Run=toggle_2)  # disabled

# ---- group: SHAPE2HEIGHT
miru_7 = PythonScript(Code=file_19, Run=toggle_4)  # disabled

# ----
geo = Geometry([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])
geo_2 = Geometry([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])
geo_3 = Geometry([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])
geo_4 = Geometry([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])
geo_5 = Geometry([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])
geo_6 = Geometry([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])
bibil_6 = PythonScript(Code=file_10, Node_in=flatten(geo), Label_="density_05", Run=Toggle(True))  # -> Node_out, Debug
bibil_7 = PythonScript(Code=file_10, Node_in=flatten(geo_2), Label_="density_04", Run=Toggle(True))  # -> Node_out, Debug
bibil_8 = PythonScript(Code=file_10, Node_in=flatten(geo_6), Label_="density_03", Run=Toggle(True))  # -> Node_out, Debug
bibil_9 = PythonScript(Code=file_10, Node_in=flatten(geo_3), Label_="density_02", Run=Toggle(True))  # -> Node_out, Debug
bibil_10 = PythonScript(Code=file_10, Node_in=flatten(geo_4), Label_="density_01", Run=Toggle(True))  # -> Node_out, Debug
bibil_11 = PythonScript(Code=file_10, Node_in=flatten(geo_5), Label_="density_0", Run=Toggle(True))  # -> Node_out, Debug

# ---- group: STEPBACK_PARAMETER
number_slider_7 = Slider(3, range=0..6)
panel_6 = Panel("[0.0,1.5,3.0,4.5,6.0,7.5,9.0]")

# ---- group: PODIUM_PARAMETER
number_slider_8 = Slider(5, range=0..7)
panel_7 = Panel("[9,12,15,18,21,24,27,30]")

# ---- group: SETBACK_PARAMETER
panel_8 = Panel("[0.0,1.5,3.0,4.5,6.0]")
number_slider_9 = Slider(2, range=0..4)

# ---- group: ARCHETYPE_PARAMETER
panel_9 = Panel("['tower_in_park','tower_on_podium','slab_in_park','slab_on_podium']")
number_slider_10 = Slider(3, range=0..3)

# ---- group: DENSITY_PARAMETER
panel_10 = Panel("[0,1,2,3,4,5]")
number_slider_11 = Slider(4, range=0..5)

# ----
data = Data([bibil_11.Node_out, bibil_10.Node_out, bibil_9.Node_out, bibil_8.Node_out, bibil_7.Node_out, bibil_6.Node_out])
number_slider_12 = Slider(0, range=0..31)
number_slider_13 = Slider(0, range=0..31)
fly = Ladybug_fly(inputSliders=[number_slider_11, number_slider_10], fly=Toggle(False))  # -> Vviiiiiiiiiizzz; plug-in component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
podium_ht = PythonScript(
    density_set=panel_10,
    density_par=number_slider_11,
    arctype_set=panel_9,
    arctype_par=number_slider_10,
    podium_set=panel_7,
    podium_par=number_slider_8,
    setback_set=panel_8,
    setback_par=number_slider_9,
    stepback_set=panel_6,
    stepback_par=number_slider_7,
    node_in=data,
    run=Toggle(True))  # -> node_out, develop_step, arctype_str, podium_ht, setback_dim, stepback_dim; inputs density_par: Int32, arctype_par: Int32, podium_par: Int32, setback_par: Int32, stepback_par: Int32, node_in: list, listoverride: Int32
# ---------- podium_ht: Python ----------
import Grasshopper
import Grasshopper.Kernel as gh
import scriptcontext as sc
from Rhino import RhinoApp

ghenv.Component.Message = 'Recompute_Soln'

Bula = sc.sticky['Bula']
Grammar = sc.sticky['Grammar']

B = Bula()
G = Grammar()

if run and node_in:
    
    
    # Bucket according to density label
    bucket_dict = {"apply2list":True, "keys2bucket":["label"],\
                    "fx2bucket":"lambda n:n.grammar.type['label']"}
                    
    bucketed_lst = G.bucket_shape(node_in,bucket_dict)
    nestedbylabel = bucketed_lst[0]
    nestedbylabel.sort(key=lambda tple:tple[0])
    node_in = map(lambda l:l[1],nestedbylabel)
    
    if type(listoverride)==type(1):
        #--- OVERIDE ---#
        #Override Constants
        TIP = 'tower_in_park'
        TOP = 'tower_on_podium'
        SIP = 'slab_in_park'
        SOP = 'slab_on_podium'
        
        a1 = [6,0,TIP,7.5,6]
        a2 = [1.5,0,TIP,13.5,1]
        a3 = [1.5,0,SOP,31.5,6]
        a4 = [1.5,4.5,TOP,7.5,2]
        a5 = [0,1.5,TIP,13.5,5]
        a6 = [6,6,SOP,7.5,5]
        a7 = [4.5,0,TOP,7.5,5]
        a8 = [4.5,4.5,TIP,31.5,5]
        a9 = [0,4.5,SOP,7.5,6]
        a10 = [6,1.5,TOP,31.5,1]
        a11 = [1.5,4.5,TOP,25.5,1]
        a12 = [1.5,1.5,SOP,25.5,5]
        a13 = [0,4.5,SIP,13.5,2]
        a14 = [4.5,1.5,SOP,31.5,2]
        a15 = [4.5,4.5,TIP,25.5,6]
        a16 = [0,0,SIP,31.5,1]
        a17 = [6,4.5,SIP,31.5,5]
        a18 = [6,0,TOP,13.5,3]
        a19 = [4.5,0,SIP,25.5,2]
        a20 = [0,6,TOP,31.5,6]
        a21 = [6,6,TIP,25.5,2]
        a22 = [6,1.5,SIP,25.5,6]
        a23 = [4.5,6,SIP,7.5,1]
        a24 = [0,6,TOP,25.5,5]
        a25 = [1.5,6,TIP,31.5,2]
        a26 = [4.5,6,SOP,13.5,1]
        a27 = [6,4.5,SOP,13.5,1]
        a28 = [0,0,SOP,25.5,3]
        a29 = [0,1.5,TIP,7.5,1]
        a30 = [1.5,1.5,SIP,7.5,4]
        a31 = [4.5,1.5,TOP,13.5,6]
        a32 = [1.5,6,SIP,13.5,6]
        
        LP = [a1,a2,a3,a4,a5,a6,a7,a8,a9,a10,a11,a12,a13,a14,a15,a16,a17,a18,a19,a20,a21,a22,a23,a24,a25,a26,a27,a28,a29,a30,a31,a32]
        
        #Setback,Stepback,Archetype,PodiumHt,DevelopmentStep
        
        p = LP[listoverride]
        print p
        setback_dim = p[0]
        stepback_dim = p[1] + setback_dim
        arctype_str = p[2]
        podium_ht = p[3] - 1.5
        develop_step = p[4]
        node_out =  node_in[p[4]-1]
        
        #print '[',setback_dim, stepback_dim, arctype_str, podium_ht, p[4],']'
        #print node_out[0].grammar.type['label']
        #RhinoApp.Wait()
    
    else:
        #Density Parameter
        density_set = eval(density_set)
        density_index = density_set[density_par] 
        node_out = node_in[density_index]
        
        #Arctype Parameters
        arctype_set = eval(arctype_set)
        arctype_str = arctype_set[arctype_par]
        
        #Podium Parameters
        podium_set = eval(podium_set)
        podium_ht = podium_set[podium_par]
        
        #Setback Parameters
        setback_set = eval(setback_set)
        setback_dim = setback_set[setback_par]
        
        #Stepback Parameters
        stepback_set = eval(stepback_set)
        stepback_dim = stepback_set[stepback_par]
        stepback_dim += setback_dim
# ---------- end podium_ht ----------
panel_11 = Panel(podium_ht.arctype_str)
geo_7 = Geometry(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)
panel_12 = Panel(podium_ht.setback_dim)
geo_8 = Geometry(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)
panel_13 = Panel(podium_ht.podium_ht)
panel_14 = Panel(podium_ht.stepback_dim)
data_2 = Data(podium_ht.podium_ht)
data_3 = Data(podium_ht.setback_dim)
data_4 = Data(podium_ht.stepback_dim)
panel_15 = Panel(podium_ht.develop_step)
number_slider_14 = Slider(1.01, range=0..10)  # disabled
area = Area(Geometry=geo_7)  # -> Area, Centroid; disabled
area_2 = Area(Geometry=geo_8)  # -> Area, Centroid; disabled
toggle_9 = BooleanToggle(False)
g = PythonScript(node=podium_ht.node_out)  # -> crv; inputs node: list
# ---------- g: Python ----------
ghenv.Component.Message = 'Recompute_Soln'

node = filter(lambda n: n!=None,node)
if node and node != []:
    crv = []
    for n in node:
        crv.append(n.shape.bottom_crv)
    #print geom
# ---------- end g ----------
g_2 = PythonScript(node=podium_ht.node_out)  # -> geom; inputs node: list
# ---------- g_2: Python ----------
ghenv.Component.Message = 'Recompute_Soln'

node = filter(lambda n: n!=None,node)
if node and node != []:
    geom = []
    for n in node:
        if n.shape.z_dist < 1.2:
            geom.append(n.shape.bottom_crv)
        else:
            geom.append(n.shape.geom)
    print geom
# ---------- end g_2 ----------

# ---- group: ONLY CONNECT TO ANIMATING SLIDER
data_5 = Data(Slider(11, range=0..31))

# ----
dash = DashPattern(Curve=g, Pattern=Slider(2, range=0..10))  # -> Dashes, Gaps
scale = Scale(Geometry=geo_7, Center=area.Centroid, Factor=number_slider_14)  # -> Geometry, Transform; disabled
scale_2 = Scale(Geometry=geo_8, Center=area_2.Centroid, Factor=number_slider_14)  # -> Geometry, Transform; disabled
preview = CustomPreview(Geometry=dash.Dashes, Shader=ColourSwatch(SwatchColor=RGB(0, 0, 0)))
resetsol = PythonScript(reset=data_5)  # -> o; disabled
# ---------- resetsol: Python ----------
"""----------------
Miru Recompute Solution
----------------""" 

import Grasshopper
import Grasshopper.Kernel as gh
import scriptcontext as sc
ghenv.Component.Message = 'Recompute_Soln'



## This is a refence right now, must copy and paste 
## into ghcomponent to work

o = False

if type(reset)==type(1.1):#!=None and reset!=False:
    document = ghenv.Component.OnPingDocument()
    
    objects = list(document.Objects)
    for obj in objects:
        #get the ghpython components
        if type(obj)!= type(ghenv.Component):
            pass
        else:
            chk_lbug = obj.Name!=None and "Ladybug" in obj.Name
            chk_hbug = obj.Name!=None and "Honeybee" in obj.Name
            
            chk_self = obj.Message!=None and "Recompute_Soln" in obj.Message
            chk_bibil = obj.Message!=None and "Bibil" in obj.Message
            if chk_lbug or chk_self or chk_hbug:
                pass
            elif chk_bibil:
                obj.ExpireSolution(True)
                
    o = True
# ---------- end resetsol ----------
python = PythonScript(
    arctype_str=podium_ht.arctype_str,
    slab_short="20.0,10.0",
    slab_long="40,10.0",
    tower_short="24.0,12.0",
    tower_long="24.0,12.0",
    run=Toggle(True))  # -> park, podium, dim_short, dim_long; inputs slab_short: list, tower_short: list
# ---------- python: Python ----------
park,podium = False,False
dim_short,dim_long = slab_short,slab_long

if arctype_str and run:
    arc_lst = arctype_str.split('_')
    #tower in park
    if 'tower' in arc_lst and 'park' in arc_lst:
        park = True
        dim_short = tower_short
        dim_long = tower_long
    #tower in podium
    elif 'tower' in arc_lst and 'podium' in arc_lst:
        podium = True
        dim_short = tower_short
        dim_long = tower_long
    #slab in park
    elif 'slab' in arc_lst and 'park' in arc_lst:
        park = True
        dim_short = slab_short
        dim_long = slab_long
    #slab in podium
    else:#if 'slab' in arc_lst and 'podium' in arc_lst:
        podium = True
        dim_short = slab_short
        dim_long = slab_long
    
    print arctype_str
    print park
    print podium
    print dim_short
    print dim_long
# ---------- end python ----------

# ---- group: grnd@0
python_2 = PythonScript(crv_in=[geo_8, geo_7])  # -> crv_out
# ---------- python_2: Python ----------
import rhinoscriptsyntax as rs
import Rhino as rc

curve = rs.coercecurve(crv_in)
rc_, polyline = curve.TryGetPolyline()
if rc_: 
    points = map(lambda pt:pt,polyline)
    for pt in points:
        pt.Z = 0.0
    curve = rc.Geometry.Curve.CreateControlPointCurve(points,1)
crv_out = curve
# ---------- end python_2 ----------

# ----
panel_16 = Panel(resetsol)
g_3 = PythonScript(node=podium_ht.node_out, run=Toggle(True))  # -> node_out; inputs node: list
# ---------- g_3: Python ----------
node_out = None
if run==True:
    node_out = node
# ---------- end g_3 ----------
number_slider_15 = Slider(15, range=0..100)
bool = Boolean(python.park)
bool_2 = Boolean(python.podium)
data_6 = Data(python.dim_short)
data_7 = Data(python.dim_long)

# ---- group: ROOT
# ROOT
bibil_12 = PythonScript(Code=file_10, Node_in=flatten(python_2), Label_="Root", Run=Toggle(True))  # -> Node_out, Debug

# ----
geo_9 = Geometry(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)
geo_10 = Geometry([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])
g_4 = PythonScript(node=bibil_12.Node_out)  # -> geom; inputs node: list
# ---------- g_4: Python ----------
node = filter(lambda n: n!=None,node)
if node and node != []:
    geom = []
    for n in node:
        if n.shape.UIgeom != None:
            geom.append(n.shape.UIgeom)
        else:
            geom.append(n.shape.geom)
# ---------- end g_4 ----------

# ---- group: boudnarycrv
geo_11 = Geometry(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)

# ----
geo_12 = Geometry([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])

# ---- group: TREE RULES
miru_8 = PythonScript(Code=file_17, Node=bibil_12.Node_out, Run=Toggle(True))

# ----
swatch = ColourSwatch(SwatchColor=RGB(255, 255, 255))
previewlw = CustomPreviewLineweights(Geometry=geo_9, Shader=swatch, Thickness=Slider(5, range=0..10))
previewlw_2 = CustomPreviewLineweights(Geometry=geo_10, Shader=swatch, Thickness=Slider(2, range=0..10))
number_slider_16 = Slider(5, range=0..10)

# ---- group: SHAPENODE
bibil_13 = PythonScript(Code=file_10, Rule_in=flatten(miru_8), Node_in=flatten(geo_12), Label_="PerimeterBlock", Run=Toggle(True))  # -> Node_out, Debug

# ----
number_slider_17 = Slider(2.5, range=0..10)
# BLOCK
number_slider_18 = Slider(30, range=0..100)
g_5 = PythonScript(node=bibil_13.Node_out)  # -> geom; inputs node: list; same code as g_4

# ---- group: SETBACK
miru_9 = PythonScript(
    Code=file_2,
    Height_dim=Slider(6, range=0..10),
    Stepback_dim=data_4,
    Stepback_ref=geo_9,
    Stepback_tol=number_slider_15,
    Run=Toggle(True))

miru_10 = PythonScript(
    Code=file_2,
    Height_dim=Slider(9, range=0..10),
    Stepback_dim=data_4,
    Stepback_ref=geo_10,
    Stepback_tol=Slider(15, range=0..100),
    Run=Toggle(True))

miru_11 = PythonScript(Code=file_2, Height_dim=Slider(0, range=0..100), Stepback_dim=data_3, Run=Toggle(True))

# ---- group: HEIGHT
miru_12 = PythonScript(Code=file_15, Height=data_2, Run=Toggle(True))

# ---- group: SHAPENODE
bibil_14 = PythonScript(
    Code=file_10,
    Rule_in=flatten([miru_12, miru_9, miru_10, miru_11]),
    Node_in=flatten(bibil_13.Node_out),
    Label_="MidRes",
    Run=Toggle(True))  # -> Node_out, Debug

# ----
# COURT
number_slider_19 = Slider(33.5, range=0..100)
toggle_10 = BooleanToggle(False)

# ---- group: SETBACK
miru_13 = PythonScript(
    Code=file_2,
    Height_dim=Slider(6, range=0..100),
    Stepback_dim=Slider(2.5, range=0..10),
    Stepback_ref=geo_9,
    Stepback_tol=number_slider_15,
    From_rear=toggle_10,
    Run=toggle_10)

# ---- group: PERIMETER
miru_14 = PythonScript(Code=file_12, Width=number_slider_19, Court_ref="0", Run=Toggle(True))

# ----
geo_13 = Geometry(bibil_14.Debug)
g_6 = PythonScript(node=bibil_14.Node_out)  # -> geom; inputs node: list
# ---------- g_6: Python ----------
node = filter(lambda n: n!=None,node)
if node and node != []:
    geom = []
    for n in node:
        if n.shape.z_dist < 1.2:
            geom.append(n.shape.bottom_crv)
        else:
            geom.append(n.shape.geom)
    print geom
# ---------- end g_6 ----------
g_7 = PythonScript(node=bibil_14.Node_out)  # -> street; inputs node: list
# ---------- g_7: Python ----------
if node and node != [None]:
    street = []
    for n in node:
        foo = lambda n: n.grammar.type.has_key('street_tolerance_curve')
        n = n.backtrack_tree(foo,accumulate=False)
        if n:
            srf_data = n.grammar.type['street_tolerance_curve']
            print srf_data
            print '--'
            street.extend(srf_data)
    print street
# ---------- end g_7 ----------

# ---- group: SHAPENODE
bibil_15 = PythonScript(Code=file_10, Rule_in=flatten([miru_14, miru_13]), Node_in=flatten(bibil_14.Node_out), Run=Toggle(True))  # -> Node_out, Debug

# ----
python_3 = PythonScript()  # -> a; inputs x: list
# ---------- python_3: Python ----------
import rhinoscriptsyntax as rs
import scriptcontext as sc

#Shape = sc.sticky['Shape']
#S = Shape()

L = []
x = filter(lambda n: n!=None,x)
if x:
    for i in x:
        cpt = rs.CurveAreaCentroid(i)[0]
        if cpt[2] > 0.0:
            obj = rs.MoveObject(i,[0,0,cpt[2]*-1])
            L.append(obj)
        else:
            L.append(i)
a = L
# ---------- end python_3 ----------
g_8 = PythonScript()  # -> street; inputs node: list
# ---------- g_8: Python ----------
node = filter(lambda n: n!=None,node)
if node and node != []:
    street = []
    for n in node:
        loc = n.backtrack_tree(lambda n: n.grammar.type.has_key('street_tolerance_curve'),accumulate=True)
        street.extend(map(lambda n:n.grammar.type['street_tolerance_curve'],loc))
    if street:
        street = reduce(lambda x,y:x+y,street)
    print street
# ---------- end g_8 ----------
geo_14 = Geometry(bibil_15.Debug)
g_9 = PythonScript(node=bibil_15.Node_out)  # -> geom; inputs node: list
# ---------- g_9: Python ----------
node = filter(lambda n: n!=None,node)
if node and node != []:
    geom = []
    for n in node:
        geom.append(n.shape.geom)
    print geom
# ---------- end g_9 ----------
dash_2 = DashPattern(Curve=python_3, Pattern=Slider(1, range=0..10))  # -> Dashes, Gaps
dash_3 = DashPattern(Curve=g_8, Pattern=Slider(2, range=0..10))  # -> Dashes, Gaps
preview_2 = CustomPreview(Geometry=dash_3.Dashes, Shader=ColourSwatch(SwatchColor=RGB(255, 255, 255)))
previewlw_3 = CustomPreviewLineweights(Geometry=dash_2.Dashes, Shader=ColourSwatch(SwatchColor=RGB(0, 255, 255)), Thickness=Slider(1, range=0..10))
python_4 = PythonScript(node=bibil_15.Node_out, bool=bool_2)  # -> node_out
# ---------- python_4: Python ----------
if bool:
    node_out = node
else:
    node_out = None
# ---------- end python_4 ----------
# W_PODIUM
toggle_11 = BooleanToggle(True)
# TOWERS
toggle_12 = BooleanToggle(True)
# IN_PARK
# TOWERS
g_10 = PythonScript(node=python_4)  # -> geom; inputs node: list; same code as g_9

# ---- group: PACKING
separatedata_2 = Ladybug_SeparateData(Code=file_13, Short_keep_omit=data_6, Long_keep_omit=data_7, Run=Toggle(True))

separatedata_3 = Ladybug_SeparateData(Code=file_13, Short_keep_omit=data_6, Long_keep_omit=data_7, Run=Toggle(True))

# ---- group: EXTRACT_SLICE
miru_15 = PythonScript(Code=file_20, Run=toggle_12)

# ---- group: HEIGHT
miru_16 = PythonScript(Code=file_15, Height_ref="PerimeterBlock", Randomize="-12.0>12.0", Run=Toggle(True))

# ---- group: EXTRACT_SLICE
miru_17 = PythonScript(Code=file_20, Slice_height=Slider(0, range=0..100), Run=Toggle(True))

# ---- group: HEIGHT
miru_18 = PythonScript(Code=file_15, Height_ref="PerimeterBlock", Randomize="-12.0>12.0", Run=toggle_11)

# ---- group: SHAPENODE
bibil_16 = PythonScript(
    Code=file_10,
    Rule_in=flatten([miru_17, separatedata_3, miru_18]),
    Node_in=flatten(bibil_15.Node_out),
    Label_="HiResTower2",
    Run=bool)  # -> Node_out, Node_dead, Debug

bibil_17 = PythonScript(
    Code=file_10,
    Rule_in=flatten([miru_15, separatedata_2, miru_16]),
    Node_in=flatten(bibil_15.Node_out),
    Label_="HiResTower",
    Run=bool_2)  # -> Node_out, Node_dead, Debug

# ----
g_11 = PythonScript(node=bibil_17.Node_out)  # -> geom; inputs node: list
# ---------- g_11: Python ----------
node = filter(lambda n: n!=None,node)
if node and node != []:
    geom = []
    for n in node:
        geom.append(n.shape.geom)
# ---------- end g_11 ----------

# ---- group: backtrack
g_12 = PythonScript(node=bibil_16.Node_dead)  # -> node_out; inputs node: list
# ---------- g_12: Python ----------
node = filter(lambda n: n!=None,node)
if node and node != []:
    node_out = []
    for n in node:
        foo = lambda n: n.grammar.type['label']=='HiResTower2'
        n = n.backtrack_tree(foo,accumulate=False)
        n.grammar.type['freeze'] = False
        n.shape.op_extrude(9)
        node_out.append(n)
# ---------- end g_12 ----------

# ----
g_13 = PythonScript(node=bibil_16.Node_out)  # -> geom; inputs node: list; same code as g_11
number_slider_20 = Slider(7, range=0..10)

# ---- group: SETBACK
miru_19 = PythonScript(Code=file_2, Height_dim=Slider(6, range=0..10), Stepback_dim=Slider(3.5, range=0..10), Run=Toggle(True))

miru_20 = PythonScript(Code=file_2, Height_dim=Slider(0, range=0..10), Stepback_dim=Slider(2.5, range=0..10), Run=Toggle(True))

# ----
data_8 = Data([g_10, g_11])

# ---- group: FILTER_NODES
miru_21 = PythonScript(Code=file_5, Dim4long=number_slider_20, Dim4short=number_slider_20, Run=Toggle(True))

# ---- group: filternull
python_5 = PythonScript(x=[data_8, g_13])  # -> a; inputs x: list
# ---------- python_5: Python ----------
a = filter(lambda n:n!=None,x)
# ---------- end python_5 ----------

# ---- group: SHAPENODE
bibil_18 = PythonScript(Code=file_10, Rule_in=flatten([miru_20, miru_19]), Node_in=flatten(g_12), Run=Toggle(True))  # -> Node_out, Node_dead, Debug

# ----
data_9 = Data([bibil_16.Node_out, bibil_17.Node_out, g_10, bibil_18.Node_out])

# ---- group: SHAPENODE
bibil_19 = PythonScript(Code=file_10, Rule_in=flatten(miru_21), Node_in=flatten(data_9), Run=Toggle(True))  # -> Node_out, Debug

# ----
geo_15 = Geometry(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)

# ---- group: full volumes
g_14 = PythonScript(node=bibil_19.Node_out)  # -> geom; inputs node: list
# ---------- g_14: Python ----------
node = filter(lambda n: n!=None,node)
if node and node != []:
    geom = []
    for n in node:
        if n.shape.geom:
            geom.append(n.shape.geom)
    #print geom
# ---------- end g_14 ----------

# ----
g_15 = PythonScript(node=bibil_18.Node_out)  # -> geom; inputs node: list; same code as g_11
sunion = SolidUnion(Breps=g_14)
fmerge = MergeFaces(Brep=sunion)  # -> Breps, Before, After
geo_16 = Geometry([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])

# ---- group: ABSTRACT_BEM
miru_22 = PythonScript(Code=file, Bem_tol=Slider(39, range=0..100), Bem_center=geo_15, Run=Toggle(True))

# ----
wires = BrepWireframe(Brep=fmerge.Breps, Density=-1)
splitmass = Honeybee_SplitBuildingMass(bldgMasses=geo_16, bldgsFlr2FloorHeights=Slider(3, range=0..10), runIt=Toggle(True))  # -> readMe, splitBldgMasses; plug-in component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
material = CreateMaterial(
    Diffuse=ColourSwatch(SwatchColor=RGB(255, 255, 255)),
    Specular=RGB(255, 255, 255),
    Emission=RGB(0, 0, 0),
    Transparency=Slider(0.25, range=0..1),
    Shine=0)

# ---- group: SHAPENODE
bibil_20 = PythonScript(Code=file_10, Rule_in=flatten(miru_22), Node_in=flatten(bibil_19.Node_out), Run=Toggle(True))  # -> Node_out, Node_dead, Debug

# ----
mesh = Mesh(fmerge.Breps)
preview_3 = CustomPreview(Geometry=wires, Shader=ColourSwatch(SwatchColor=RGB(0, 0, 0)))
preview_4 = CustomPreview(Geometry=mesh, Shader=material)
geo_17 = Geometry(bibil_20.Debug)
g_16 = PythonScript(node=bibil_20.Node_out)  # -> geom; inputs node: list; same code as g_14
geo_18 = Geometry(g_16)
g_17 = PythonScript(node=bibil_20.Node_out)  # -> geom; inputs node: list; same code as g_14
python_6 = PythonScript(bldgMasses=flatten(splitmass.splitBldgMasses), perimeterZoneDepth="@4", runIt=Toggle(True))  # -> readMe, splitBldgMasses; inputs bldgMasses: list, perimeterZoneDepth: list
# ---------- python_6: Python ----------
import Rhino as rc
import scriptcontext as sc
import Grasshopper.Kernel as gh
from System import Object
from Grasshopper import DataTree
from Grasshopper.Kernel.Data import GH_Path
import rhinoscriptsyntax as rs

tolerance = sc.doc.ModelAbsoluteTolerance

def checkTheInputs():
    if len(_bldgMasses) != 0 and _bldgMasses[0] != None:
        #Check for guid
        for i,b in enumerate(_bldgMasses):
            if type(b)==type(rs.AddPoint(0,0,0)):
                _bldgMasses[i] = rs.coercebrep(b)
        
        brepSolid = []
        for brep in _bldgMasses:
            if brep.IsSolid == True:
                brepSolid.append(1)
            else:
                warning = "Building masses must be closed solids!"
                print warning
                w = gh.GH_RuntimeMessageLevel.Warning
                ghenv.Component.AddRuntimeMessage(w, warning)
        if sum(brepSolid) == len(_bldgMasses):
            checkData1 = True
            
    else:
        checkData1 = False
        print "Connect closed solid building masses to split them up into zones."
    
    if perimeterZoneDepth_ == []:
        print "No value is connected for zone depth and so the model will not be divided up into perimeter and core zones."
    else: pass
    
    if perimeterZoneDepth_ != []:
        checkData2 = True
    else:
        checkData2 = False
        print "A value must be conneted for perimeterZoneDepth_ in order to run."
    
    if checkData1 == True and checkData2 == True:
        checkData = True
    else: checkData = False
    
    return checkData
#Define a function that will extract the points from a polycurve line
def getCurvePoints(curve):
    exploCurve = rc.Geometry.PolyCurve.DuplicateSegments(curve)
    individPts = []
    for line in exploCurve:
        individPts.append(line.PointAtStart)
    return individPts
#Define a function that cleans up curves by deleting out points that lie in a line and leaves the curved segments intact.  Also, have it delete out any segments that are shorter than the tolerance.
def cleanCurve(curve, curvePts, offsetDepth):
    #First check if there are any curved segements and make a list to keep track of this
    curveBool = []
    exploCurve = rc.Geometry.PolyCurve.DuplicateSegments(curve)
    for segment in exploCurve:
        if segment.IsLinear() == False: curveBool.append(True)
        else: curveBool.append(False)
    
    #Test if any of the points lie in a line and use this to generate a new list of curve segments and points.
    newPts = []
    newSegments = []
    for pointCount, point in enumerate(curvePts):
        testLine = rc.Geometry.Line(point, curvePts[pointCount-2])
        if testLine.DistanceTo(curvePts[pointCount-1], True) > tolerance and len(newPts) == 0:
            newPts.append(curvePts[pointCount-1])
        elif testLine.DistanceTo(curvePts[pointCount-1], True) > tolerance and curveBool[pointCount-2] == False and len(newPts) != 0:
            newSegments.append(rc.Geometry.LineCurve(newPts[-1], curvePts[pointCount-1]))
            newPts.append(curvePts[pointCount-1])
        elif curveBool[pointCount-2] == True and exploCurve[pointCount-2].GetLength()>offsetDepth/25:
            newPts.append(curvePts[pointCount-1])
            newSegments.append(exploCurve[pointCount-2])
        elif curveBool[pointCount-2] == True and curveBool[pointCount-1] == True and exploCurve[pointCount-2].GetLength()<offsetDepth/25:
            for counting, curve in enumerate(exploCurve):
                if counting == pointCount-1:
                    transformMatrix = rc.Geometry.Transform.Translation(exploCurve[pointCount-1].PointAtStart.X - exploCurve[pointCount-2].PointAtEnd.X, exploCurve[pointCount-1].PointAtStart.Y - exploCurve[pointCount-2].PointAtEnd.Y, exploCurve[pointCount-1].PointAtStart.Z - exploCurve[pointCount-2].PointAtEnd.Z)
                    curve.PointAtStart.Transform(transformMatrix)
                else: pass
        else: pass
    
    #Add a segment to close the curves and join them together into one polycurve.
    if curveBool[-2] == True and exploCurve[-2].GetLength()>offsetDepth/25:
        newSegments.append(exploCurve[-2])
    elif curveBool[-2] == False:
        newSegments.append(rc.Geometry.LineCurve(newPts[-1], newPts[0]))
    else:
        pass
    
    #Shift the lists over by 1 to ensure that the order of the points and curves match the input
    newCurvePts = newPts[1:]
    newCurvePts.append(newPts[0])
    newCurveSegments = newSegments[1:]
    newCurveSegments.append(newSegments[0])
    
    #Join the segments together into one curve.
    newCrv = rc.Geometry.PolyCurve()
    for seg in newCurveSegments:
        newCrv.Append(seg)
    newCrv.MakeClosed(tolerance)
    
    #return the new curve and the list of points associated with it.
    return newCrv, newCurvePts, newCurveSegments
def splitPerimZones(mass, zoneDepth, floorCrvList, topInc, totalNurbsList):
    finalZones = []
    coreZoneWallList = []
    genFailure = False

    #define a value to keep track of whether this is a courtyard building.
    if len(floorCrvList) > 1: doNotGenCore = True
    else: doNotGenCore = False
    
    for listCount, floorCrvs in enumerate(floorCrvList):
        nurbsList = totalNurbsList[listCount]
        #Get a list of curves that represent the ceiling (without the top floor). Generate a list of points for each and a brep for the ceiling surface.
        ceilingCrv = floorCrvs[1:]
        ceilingPts = []
        for curveCount, curve in enumerate(ceilingCrv):
            ceilingPts.append(getCurvePoints(curve))
        
        #Get a list of curves that represent the floors (without the top floor). Generate a list of points for each and a brep for the ceiling surface.
        floorCrv = floorCrvs[:-1]
        floorPts = []
        for curveCount, curve in enumerate(floorCrv):
            floorPts.append(getCurvePoints(curve))
        
        #Find the offset depth for each of the floors.
        numOfFlr = len(floorCrv)
        flrDepths = []
        for depth in zoneDepth:
            if '@' in depth:
                zoneD = float(depth.split('@')[1])
                try: numFlr = int(depth.split('@')[0])
                except: numFlr = numOfFlr
                for floors in range(numFlr): flrDepths.append(zoneD)
            else:
                zoneD = float(depth)
                flrDepths.append(zoneD)
        
        #Clean up the input curves, This involves testing to see if any 3 points on the floor or ceiling curves lie in a line and, if so, deleting out the redundant mid point.
        newFloorCrv = []
        newFloorPts = []
        for count, curve in enumerate(floorCrv):
            newFCrv, newFCrvPts, newFCrvSeg = cleanCurve(curve, floorPts[count], flrDepths[0])
            newFloorCrv.append(newFCrv)
            newFloorPts.append(newFCrvPts)
        floorCrv = newFloorCrv
        floorPts = newFloorPts
        
        newCeilingCrv = []
        newCeilingPts = []
        for count, curve in enumerate(ceilingCrv):
            newCCrv, newCCrvPts, newCCrvSeg  = cleanCurve(curve, ceilingPts[count], flrDepths[0])
            newCeilingCrv.append(newCCrv)
            newCeilingPts.append(newCCrvPts)
        ceilingCrv = newCeilingCrv
        ceilingPts = newCeilingPts
        
        
        #Offset the curve for each floor and use the results to create new core and perimeter zones
        
        for curveCount, curve in enumerate(floorCrv):
            try:
                #If the curves are originally Nurbs curves, Offset them with "None", corners.  Otherwise, offset them with sharp corners.
                #Offset the curves and check to be sure that they are being offset in the right direction.
                if nurbsList[curveCount] == True and listCount == 0:
                    offsetFloorCrv = curve.Offset(rc.Geometry.Plane.WorldXY, -flrDepths[curveCount], tolerance, rc.Geometry.CurveOffsetCornerStyle.None)[0]
                    offsetFloorCrv.MakeClosed(tolerance)
                    if str(offsetFloorCrv.Contains(floorPts[curveCount][0], rc.Geometry.Plane.WorldXY, tolerance)) == "Inside":
                        offsetFloorCrv = curve.Offset(rc.Geometry.Plane.WorldXY, flrDepths[curveCount], tolerance, rc.Geometry.CurveOffsetCornerStyle.None)[0]
                    else: pass
                elif listCount == 0:
                    offsetFloorCrv = curve.Offset(rc.Geometry.Plane.WorldXY, -flrDepths[curveCount], tolerance, rc.Geometry.CurveOffsetCornerStyle.Sharp)[0]
                    offsetFloorCrv.MakeClosed(tolerance)
                    if str(offsetFloorCrv.Contains(floorPts[curveCount][0], rc.Geometry.Plane.WorldXY, tolerance)) == "Inside":
                        offsetFloorCrv = curve.Offset(rc.Geometry.Plane.WorldXY, flrDepths[curveCount], tolerance, rc.Geometry.CurveOffsetCornerStyle.Sharp)[0]
                    else: pass
                elif nurbsList[curveCount] == True and listCount != 0:
                    offsetFloorCrv = curve.Offset(rc.Geometry.Plane.WorldXY, -flrDepths[curveCount], tolerance, rc.Geometry.CurveOffsetCornerStyle.None)[0]
                    offsetFloorCrv.MakeClosed(tolerance)
                    if str(offsetFloorCrv.Contains(floorPts[curveCount][0], rc.Geometry.Plane.WorldXY, tolerance)) == "Outside":
                        offsetFloorCrv = curve.Offset(rc.Geometry.Plane.WorldXY, flrDepths[curveCount], tolerance, rc.Geometry.CurveOffsetCornerStyle.None)[0]
                    else: pass
                else:
                    offsetFloorCrv = curve.Offset(rc.Geometry.Plane.WorldXY, -flrDepths[curveCount], tolerance, rc.Geometry.CurveOffsetCornerStyle.Sharp)[0]
                    offsetFloorCrv.MakeClosed(tolerance)
                    if str(offsetFloorCrv.Contains(floorPts[curveCount][0], rc.Geometry.Plane.WorldXY, tolerance)) == "Outside":
                        offsetFloorCrv = curve.Offset(rc.Geometry.Plane.WorldXY, flrDepths[curveCount], tolerance, rc.Geometry.CurveOffsetCornerStyle.Sharp)[0]
                    else: pass
                
                offsetFloorPts = getCurvePoints(offsetFloorCrv)
                
                if nurbsList[curveCount] == True and listCount == 0:
                    offsetCeilingCrv = ceilingCrv[curveCount].Offset(rc.Geometry.Plane.WorldXY, -flrDepths[curveCount], tolerance, rc.Geometry.CurveOffsetCornerStyle.None)[0]
                    offsetCeilingCrv.MakeClosed(tolerance)
                    if str(offsetCeilingCrv.Contains(ceilingPts[curveCount][0], rc.Geometry.Plane.WorldXY, tolerance)) == "Inside":
                        offsetCeilingCrv = ceilingCrv[curveCount].Offset(rc.Geometry.Plane.WorldXY, flrDepths[curveCount], tolerance, rc.Geometry.CurveOffsetCornerStyle.None)[0]
                    else: pass
                elif listCount == 0:
                    offsetCeilingCrv = ceilingCrv[curveCount].Offset(rc.Geometry.Plane.WorldXY, -flrDepths[curveCount], tolerance, rc.Geometry.CurveOffsetCornerStyle.Sharp)[0]
                    offsetCeilingCrv.MakeClosed(tolerance)
                    if str(offsetCeilingCrv.Contains(ceilingPts[curveCount][0], rc.Geometry.Plane.WorldXY, tolerance)) == "Inside":
                        offsetCeilingCrv = ceilingCrv[curveCount].Offset(rc.Geometry.Plane.WorldXY, flrDepths[curveCount], tolerance, rc.Geometry.CurveOffsetCornerStyle.Sharp)[0]
                    else: pass
                elif nurbsList[curveCount] == True and listCount != 0:
                    offsetCeilingCrv = ceilingCrv[curveCount].Offset(rc.Geometry.Plane.WorldXY, -flrDepths[curveCount], tolerance, rc.Geometry.CurveOffsetCornerStyle.None)[0]
                    offsetCeilingCrv.MakeClosed(tolerance)
                    if str(offsetCeilingCrv.Contains(ceilingPts[curveCount][0], rc.Geometry.Plane.WorldXY, tolerance)) == "Outside":
                        offsetCeilingCrv = ceilingCrv[curveCount].Offset(rc.Geometry.Plane.WorldXY, flrDepths[curveCount], tolerance, rc.Geometry.CurveOffsetCornerStyle.None)[0]
                    else: pass
                else:
                    offsetCeilingCrv = ceilingCrv[curveCount].Offset(rc.Geometry.Plane.WorldXY, -flrDepths[curveCount], tolerance, rc.Geometry.CurveOffsetCornerStyle.Sharp)[0]
                    offsetCeilingCrv.MakeClosed(tolerance)
                    if str(offsetCeilingCrv.Contains(ceilingPts[curveCount][0], rc.Geometry.Plane.WorldXY, tolerance)) == "Outside":
                        offsetCeilingCrv = ceilingCrv[curveCount].Offset(rc.Geometry.Plane.WorldXY, flrDepths[curveCount], tolerance, rc.Geometry.CurveOffsetCornerStyle.Sharp)[0]
                    else: pass
                
                offsetCeilingPts = getCurvePoints(offsetCeilingCrv)
                
                #Clean up the offset curves, This involves testing to see if any 3 points on the floor or ceiling curves lie in a line and, if so, deleting out the redundant mid point.
                offsetFloorCrv, offsetFloorPts, offsetFloorCrvSegments = cleanCurve(offsetFloorCrv, offsetFloorPts, flrDepths[0])
                offsetCeilingCrv, offsetCeilingPts, offsetCeilingCrvSegments = cleanCurve(offsetCeilingCrv, offsetCeilingPts, flrDepths[0])
                
                #Test to see if the number of segments of the offset curve is the same as that of the original curve.  If not, this component cannot handle such a calculation.
                checkCurveSeg = False
                if len(rc.Geometry.PolyCurve.DuplicateSegments(offsetFloorCrv)) == len(rc.Geometry.PolyCurve.DuplicateSegments(floorCrv[curveCount])) and len(rc.Geometry.PolyCurve.DuplicateSegments(offsetCeilingCrv)) == len(rc.Geometry.PolyCurve.DuplicateSegments(ceilingCrv[curveCount])):
                    checkCurveSeg = True
                else: pass
                
                #If the geometry fails the segment count test above but was originally a single nurbs curve, it is still possible to generate zones for it.
                #We just have to split up the outside curve into the same number of segments using the closest points.
                if checkCurveSeg == False and nurbsList[curveCount] == True:
                    closestOuterPointParams = []
                    for point in offsetFloorPts:
                        closestOuterPointParams.append(floorCrv[curveCount].ClosestPoint(point)[1])
                    closestOuterPointParamsFinal = closestOuterPointParams[1:]
                    outerFloorPts = []
                    for param in closestOuterPointParamsFinal:
                        outerFloorPts.append(floorCrv[curveCount].PointAt(param))
                    splitCurve = floorCrv[curveCount].Split(closestOuterPointParamsFinal)
                    finalJoinedCurve = rc.Geometry.PolyCurve()
                    for curveSeg in splitCurve:
                        finalJoinedCurve.Append(curveSeg)
                    finalJoinedCurve.MakeClosed(tolerance)
                    if finalJoinedCurve.SegmentCount == offsetFloorCrv.SegmentCount:
                        floorCrv[curveCount] = finalJoinedCurve
                        floorPts[curveCount] = getCurvePoints(finalJoinedCurve)
                        checkCurveSeg1 = True
                    else: checkCurveSeg1 = False
                    
                    closestOuterPointParams = []
                    for point in offsetCeilingPts:
                        closestOuterPointParams.append(ceilingCrv[curveCount].ClosestPoint(point)[1])
                    closestOuterPointParamsFinal = closestOuterPointParams[1:]
                    splitCurve = ceilingCrv[curveCount].Split(closestOuterPointParamsFinal)
                    finalJoinedCurve = rc.Geometry.PolyCurve()
                    for curveSeg in splitCurve:
                        finalJoinedCurve.Append(curveSeg)
                    finalJoinedCurve.MakeClosed(tolerance)
                    if finalJoinedCurve.SegmentCount == offsetCeilingCrv.SegmentCount:
                        ceilingCrv[curveCount] = finalJoinedCurve
                        ceilingPts[curveCount] = getCurvePoints(finalJoinedCurve)
                        checkCurveSeg2 = True
                    else: checkCurveSeg2 = False
                    
                    if checkCurveSeg1 == True and checkCurveSeg2 == True:
                        checkCurveSeg = True
                    else: pass
                
                
                if checkCurveSeg == True:
                    #Test to see which points on the inside of the floor and ceiling curves are closest to those on the outside.
                    floorConnectionPts = []
                    for point in offsetFloorPts:
                        pointDist = []
                        floorEdgePts = floorPts[curveCount][:]
                        for perimPoint in floorEdgePts:
                            pointDist.append(rc.Geometry.Point3d.DistanceTo(point, perimPoint))
                        sortDist = [x for (y,x) in sorted(zip(pointDist, floorEdgePts))]
                        pointDist.sort()
                        floorConnectionPts.append(sortDist[0])
                    
                    ceilingConnectionPts = []
                    for point in offsetCeilingPts:
                        pointDist = []
                        ceilingEdgePts = ceilingPts[curveCount][:]
                        for perimPoint in ceilingEdgePts:
                            pointDist.append(rc.Geometry.Point3d.DistanceTo(point, perimPoint))
                        sortDist = [x for (y,x) in sorted(zip(pointDist, ceilingEdgePts))]
                        ceilingConnectionPts.append(sortDist[0])
                    
                    #Create lines from the points of the offset curve to the closest point on the outside curve in order to split up the the offset boundary into different perimeter zones.
                    zoneFloorCurves = []
                    for pointCount, point in enumerate(offsetFloorPts):
                        floorZoneCurve = rc.Geometry.LineCurve(point, floorConnectionPts[pointCount])
                        zoneFloorCurves.append(floorZoneCurve)
                    
                    zoneCeilingCurves = []
                    for pointCount, point in enumerate(offsetCeilingPts):
                        ceilingCurves = rc.Geometry.LineCurve(point, ceilingConnectionPts[pointCount])
                        zoneCeilingCurves.append(ceilingCurves)
                    
                    #Determine which of the lines on the ceiling are closest to those on the floor and vice-versa.  This will determine which lines should be lofted to create interior partitions.
                    ceilingConnectionLines = []
                    for line in zoneFloorCurves:
                        lineDist = []
                        ceilingConnectors = zoneCeilingCurves[:]
                        for connectLine in ceilingConnectors:
                            lineDist.append(rc.Geometry.Point3d.DistanceTo(line.PointAt(0.5), connectLine.PointAt(0.5)))
                        sortDist = [x for (y,x) in sorted(zip(lineDist, ceilingConnectors))]
                        ceilingConnectionLines.append(sortDist[0])
                    
                    floorConnectionLines = []
                    for line in zoneCeilingCurves:
                        lineDist = []
                        floorConnectors = zoneFloorCurves[:]
                        for connectLine in floorConnectors:
                            lineDist.append(rc.Geometry.Point3d.DistanceTo(line.PointAt(0.5), connectLine.PointAt(0.5)))
                        sortDist = [x for (y,x) in sorted(zip(lineDist, floorConnectors))]
                        floorConnectionLines.append(sortDist[0])
                    
                    #Loft the floor and ceiling curves together in order to get walls that divide up the perimeter zones.
                    floorWalls = []
                    ceilingWalls = []
                    for lineCount, line in enumerate(zoneFloorCurves):
                        floorWalls.append(rc.Geometry.Brep.CreateFromLoft([line, ceilingConnectionLines[lineCount]], rc.Geometry.Point3d.Unset, rc.Geometry.Point3d.Unset, rc.Geometry.LoftType.Normal, False)[0])
                    for lineCount, line in enumerate(zoneCeilingCurves):
                        ceilingWalls.append(rc.Geometry.Brep.CreateFromLoft([floorConnectionLines[lineCount], line], rc.Geometry.Point3d.Unset, rc.Geometry.Point3d.Unset, rc.Geometry.LoftType.Normal, False)[0])
                    
                    #Make a function that pulls out the interior and exterior points of each perimeter wall brep.
                    def getIntAndExtVert(brep):
                        vert = brep.DuplicateVertices()
                        intVert = []
                        extVert = []
                        for point in vert:
                            for otherPoint in offsetFloorPts:
                                if point.X < otherPoint.X + tolerance and  point.X > otherPoint.X - tolerance and point.Y < otherPoint.Y + tolerance and  point.Y > otherPoint.Y - tolerance and point.Z < otherPoint.Z + tolerance and  point.Z > otherPoint.Z - tolerance:
                                    intVert.append(point)
                                else: pass
                            for otherPoint in offsetCeilingPts:
                                if point.X < otherPoint.X + tolerance and  point.X > otherPoint.X - tolerance and point.Y < otherPoint.Y + tolerance and  point.Y > otherPoint.Y - tolerance and point.Z < otherPoint.Z + tolerance and  point.Z > otherPoint.Z - tolerance:
                                    intVert.append(point)
                                else: pass
                        for point in vert:
                            for otherPoint in floorPts[curveCount]:
                                if point.X < otherPoint.X + tolerance and  point.X > otherPoint.X - tolerance and point.Y < otherPoint.Y + tolerance and  point.Y > otherPoint.Y - tolerance and point.Z < otherPoint.Z + tolerance and  point.Z > otherPoint.Z - tolerance:
                                    extVert.append(point)
                                else: pass
                            for otherPoint in ceilingPts[curveCount]:
                                if point.X < otherPoint.X + tolerance and  point.X > otherPoint.X - tolerance and point.Y < otherPoint.Y + tolerance and  point.Y > otherPoint.Y - tolerance and point.Z < otherPoint.Z + tolerance and  point.Z > otherPoint.Z - tolerance:
                                    extVert.append(point)
                                else: pass
                        return intVert, extVert
                    
                    #Test whetther all of the curves in the floor and ceiling are curved.
                    nurbTestList = []
                    for nurb in nurbsList:
                        if nurb == True: nurbTestList.append(1)
                        else: pass
                    if sum(nurbTestList) == len(nurbsList): totalNurbTest = True
                    else: totalNurbTest = False
                    
                    #Get a list of the exterior curves, which will be used to remove bad walls in the next step.
                    testEdgeCurves = []
                    edgeCurves = mass[curveCount].DuplicateEdgeCurves(False)
                    zHeight = []
                    for edgeCrv in edgeCurves:
                        zHeight.append((edgeCrv.PointAtStart.Z +edgeCrv.PointAtEnd.Z)/2)
                    edgeCurves = [x for (y,x) in sorted(zip(zHeight, edgeCurves))]
                    zHeight.sort()
                    zMin = zHeight[0]
                    zMax = zHeight[-1]
                    for heightCount, height in enumerate(zHeight):
                        if height > zMin + tolerance and height < zMax - tolerance:
                            testEdgeCurves.append(edgeCurves[heightCount])
                        else: pass
                    #for wall in floorWalls:
                    #    print rc.Geometry.AreaMassProperties.Compute(wall).Area
                    #Make the list of perimeter zone walls.
                    perimZoneWalls = []
                    
                    #If the geometry is all planar, check the perimeter walls against the exterior curves.
                    if totalNurbTest == False:
                        for wallCount, wall in enumerate(floorWalls):
                            wallIntVert, wallExtVert = getIntAndExtVert(wall)
                            foundIt = False
                            for testLine in testEdgeCurves:
                                if testLine.PointAtStart.X > wallExtVert[0].X - tolerance and testLine.PointAtStart.X < wallExtVert[0].X + tolerance and testLine.PointAtEnd.X > wallExtVert[1].X - tolerance and testLine.PointAtEnd.X < wallExtVert[1].X + tolerance and testLine.PointAtStart.Y > wallExtVert[0].Y - tolerance and testLine.PointAtStart.Y < wallExtVert[0].Y + tolerance and testLine.PointAtEnd.Y > wallExtVert[1].Y - tolerance and testLine.PointAtEnd.Y < wallExtVert[1].Y + tolerance and testLine.PointAtStart.Z > wallExtVert[0].Z - tolerance and testLine.PointAtStart.Z < wallExtVert[0].Z + tolerance and testLine.PointAtEnd.Z > wallExtVert[1].Z - tolerance and testLine.PointAtEnd.Z < wallExtVert[1].Z + tolerance:
                                    foundIt = True
                                elif testLine.PointAtStart.X > wallExtVert[1].X - tolerance and testLine.PointAtStart.X < wallExtVert[1].X + tolerance and testLine.PointAtEnd.X > wallExtVert[0].X - tolerance and testLine.PointAtEnd.X < wallExtVert[0].X + tolerance and testLine.PointAtStart.Y > wallExtVert[1].Y - tolerance and testLine.PointAtStart.Y < wallExtVert[1].Y + tolerance and testLine.PointAtEnd.Y > wallExtVert[0].Y - tolerance and testLine.PointAtEnd.Y < wallExtVert[0].Y + tolerance and testLine.PointAtStart.Z > wallExtVert[1].Z - tolerance and testLine.PointAtStart.Z < wallExtVert[1].Z + tolerance and testLine.PointAtEnd.Z > wallExtVert[0].Z - tolerance and testLine.PointAtEnd.Z < wallExtVert[0].Z + tolerance:
                                    foundIt = True
                                else:pass
                            if foundIt == True:
                                perimZoneWalls.append(wall)
                        
                        insertIndex = 0
                        lastTri = False
                        for wallCount, wall in enumerate(ceilingWalls):
                            wallIntVert, wallExtVert = getIntAndExtVert(wall)
                            foundIt = False
                            for testLine in testEdgeCurves:
                                if testLine.PointAtStart.X > wallExtVert[0].X - tolerance and testLine.PointAtStart.X < wallExtVert[0].X + tolerance and testLine.PointAtEnd.X > wallExtVert[1].X - tolerance and testLine.PointAtEnd.X < wallExtVert[1].X + tolerance and testLine.PointAtStart.Y > wallExtVert[0].Y - tolerance and testLine.PointAtStart.Y < wallExtVert[0].Y + tolerance and testLine.PointAtEnd.Y > wallExtVert[1].Y - tolerance and testLine.PointAtEnd.Y < wallExtVert[1].Y + tolerance and testLine.PointAtStart.Z > wallExtVert[0].Z - tolerance and testLine.PointAtStart.Z < wallExtVert[0].Z + tolerance and testLine.PointAtEnd.Z > wallExtVert[1].Z - tolerance and testLine.PointAtEnd.Z < wallExtVert[1].Z + tolerance:
                                    foundIt = True
                                elif testLine.PointAtStart.X > wallExtVert[1].X - tolerance and testLine.PointAtStart.X < wallExtVert[1].X + tolerance and testLine.PointAtEnd.X > wallExtVert[0].X - tolerance and testLine.PointAtEnd.X < wallExtVert[0].X + tolerance and testLine.PointAtStart.Y > wallExtVert[1].Y - tolerance and testLine.PointAtStart.Y < wallExtVert[1].Y + tolerance and testLine.PointAtEnd.Y > wallExtVert[0].Y - tolerance and testLine.PointAtEnd.Y < wallExtVert[0].Y + tolerance and testLine.PointAtStart.Z > wallExtVert[1].Z - tolerance and testLine.PointAtStart.Z < wallExtVert[1].Z + tolerance and testLine.PointAtEnd.Z > wallExtVert[0].Z - tolerance and testLine.PointAtEnd.Z < wallExtVert[0].Z + tolerance:
                                    foundIt = True
                                else:pass
                            #Check to see if the wall is a duplicate on the floor walls.
                            if foundIt == True:
                                isDulpicate = False
                                for otherCount, otherWall in enumerate(perimZoneWalls):
                                    if wall.IsDuplicate(otherWall, tolerance) == True:
                                        isDulpicate = True
                                        insertIndex = otherCount + 1
                                        lastTri = False
                                    else:pass
                            else:
                                isDulpicate = True
                                lastTri = False
                            if foundIt == True and isDulpicate == False:
                                if lastTri == True:
                                    insertIndex = insertIndex + 1
                                else: pass
                                perimZoneWalls.insert(insertIndex, wall)
                                lastTri = True
                    else:
                        #If the geometry is all curved, just generate the list starting with the floor curves and checking for duplicates.
                        perimZoneWalls = floorWalls[:]
                        insertIndex = 0
                        for wallCount, wall in enumerate(ceilingWalls):
                            isDulpicate = False
                            for otherCount, otherWall in enumerate(perimZoneWalls):
                                if wall.IsDuplicate(otherWall, tolerance) == True:
                                    isDulpicate = True
                                    insertIndex = otherCount + 1
                                else:pass
                            if isDulpicate == False:
                                perimZoneWalls.insert(insertIndex, wall)
                            else: pass
                    
                    
                    #Test to see if the core zone wall should be made by lofting a floor + ceiling curve or should be a triangle.
                    #Pair up the perimeter zone walls and check the condition between them to see if a triangle or a lofted surface should be generated for either the interior or exterior condition.
                    coreZoneWalls = []
                    exteriorZoneWalls = []
                    
                    perimWallsPairList = []
                    for wallCount, wall in enumerate(perimZoneWalls):
                        perimWallsPairList.append([perimZoneWalls[wallCount-1], wall])
                    
                    for pair in perimWallsPairList:
                        interiorTriangle = False
                        exteriorTriangle = False
                        intTriPts = []
                        extTriPts = []
                        intVertOne, extVertOne = getIntAndExtVert(pair[0])
                        intVertTwo, extVertTwo = getIntAndExtVert(pair[1])
                        
                        for pointCount, point in enumerate(intVertOne):
                            for otherPointCount, otherPoint in enumerate(intVertTwo):
                                if point.X < otherPoint.X + (0.5*tolerance) and  point.X > otherPoint.X - (0.5*tolerance) and point.Y < otherPoint.Y + (0.5*tolerance) and  point.Y > otherPoint.Y - (0.5*tolerance) and point.Z < otherPoint.Z + (0.5*tolerance) and  point.Z > otherPoint.Z - (0.5*tolerance):
                                    interiorTriangle = True
                                    intTriPts = [point, intVertOne[pointCount-1], intVertTwo[otherPointCount-1]]
                                else: pass
                        for pointCount, point in enumerate(extVertOne):
                            for otherPointCount, otherPoint in enumerate(extVertTwo):
                                if point.X < otherPoint.X + (0.5*tolerance) and  point.X > otherPoint.X - (0.5*tolerance) and point.Y < otherPoint.Y + (0.5*tolerance) and  point.Y > otherPoint.Y - (0.5*tolerance) and point.Z < otherPoint.Z + (0.5*tolerance) and  point.Z > otherPoint.Z - (0.5*tolerance):
                                    exteriorTriangle = True
                                    extTriPts = [point, extVertOne[pointCount-1], extVertTwo[otherPointCount-1]] 
                                else: pass
                        
                        #Make the core zone wall and append it to the list.
                        if interiorTriangle == True:
                            coreZoneWall = rc.Geometry.Brep.CreateFromCornerPoints(intTriPts[0], intTriPts[1], intTriPts[2], tolerance)
                        else:
                            #Find the line on the floor that is closest to both floor vertices.
                            distanceToLine = []
                            offsetFloorSegments = rc.Geometry.PolyCurve.DuplicateSegments(offsetFloorCrv)
                            for line in offsetFloorSegments:
                                lineDist = rc.Geometry.Point3d.DistanceTo(line.PointAtStart, intVertOne[0]) + rc.Geometry.Point3d.DistanceTo(line.PointAtEnd, intVertTwo[0])
                                distanceToLine.append(lineDist)
                            sortLineDist = [x for (y,x) in sorted(zip(distanceToLine, offsetFloorSegments))]
                            floorLine = sortLineDist[0]
                            #Find the line on the ceiling that is closest to both ceiling vertices.
                            distanceToLine = []
                            offsetCeilingSegments = rc.Geometry.PolyCurve.DuplicateSegments(offsetCeilingCrv)
                            for line in offsetCeilingSegments:
                                lineDist = rc.Geometry.Point3d.DistanceTo(line.PointAtStart, intVertOne[1]) + rc.Geometry.Point3d.DistanceTo(line.PointAtEnd, intVertTwo[1])
                                distanceToLine.append(lineDist)
                            sortLineDist = [x for (y,x) in sorted(zip(distanceToLine, offsetCeilingSegments))]
                            ceilingLine = sortLineDist[0]
                            #Loft the floor and ceiling together.
                            coreZoneWall = rc.Geometry.Brep.CreateFromLoft([floorLine, ceilingLine], rc.Geometry.Point3d.Unset, rc.Geometry.Point3d.Unset, rc.Geometry.LoftType.Normal, False)[0]
                        coreZoneWalls.append(coreZoneWall)
                        
                        # Make the exterior wall and append it to the list.
                        if exteriorTriangle == True:
                            exteriorZoneWall = rc.Geometry.Brep.CreateFromCornerPoints(extTriPts[0], extTriPts[1], extTriPts[2], tolerance)
                        else:
                            #Find the line on the floor that is closest to both floor vertices.
                            distanceToLine = []
                            floorSegments = rc.Geometry.PolyCurve.DuplicateSegments(floorCrv[curveCount])
                            for line in floorSegments:
                                lineDist = rc.Geometry.Point3d.DistanceTo(line.PointAtStart, extVertOne[0]) + rc.Geometry.Point3d.DistanceTo(line.PointAtEnd, extVertTwo[0])
                                distanceToLine.append(lineDist)
                            sortLineDist = [x for (y,x) in sorted(zip(distanceToLine, floorSegments))]
                            floorLine = sortLineDist[0]
                            #Find the line on the ceiling that is closest to both ceiling vertices.
                            distanceToLine = []
                            ceilingSegments = rc.Geometry.PolyCurve.DuplicateSegments(ceilingCrv[curveCount])
                            for line in ceilingSegments:
                                lineDist = rc.Geometry.Point3d.DistanceTo(line.PointAtStart, extVertOne[1]) + rc.Geometry.Point3d.DistanceTo(line.PointAtEnd, extVertTwo[1])
                                distanceToLine.append(lineDist)
                            sortLineDist = [x for (y,x) in sorted(zip(distanceToLine, ceilingSegments))]
                            ceilingLine = sortLineDist[0]
                            #Loft the floor and ceiling together.
                            exteriorZoneWall = rc.Geometry.Brep.CreateFromLoft([floorLine, ceilingLine], rc.Geometry.Point3d.Unset, rc.Geometry.Point3d.Unset, rc.Geometry.LoftType.Normal, False)[0]
                        exteriorZoneWalls.append(exteriorZoneWall)
                    
                    #Group the walls together by floor.
                    floorZones = []
                    #floorZones = perimZoneWalls
                    #floorZones.extend(exteriorZoneWalls)
                    
                    #Join the walls together to make zones.
                    joinedWalls = rc.Geometry.Brep.JoinBreps(coreZoneWalls, tolerance)[0]
                    if doNotGenCore == False:
                        coreZone = joinedWalls.CapPlanarHoles(tolerance)
                        floorZones.append(coreZone)
                    elif listCount == 0:
                        coreZoneWallList.append([joinedWalls])
                    else:
                        coreZoneWallList[curveCount].append(joinedWalls)
                    
                    perimZones = []
                    for wallCount, wall in enumerate(perimZoneWalls):
                        brepList = [wall, perimZoneWalls[wallCount-1], exteriorZoneWalls[wallCount], coreZoneWalls[wallCount]]
                        joinedWalls = rc.Geometry.Brep.JoinBreps(brepList, tolerance)[0]
                        cappedZone = joinedWalls.CapPlanarHoles(tolerance)
                        perimZones.append(cappedZone)
                    floorZones.extend(perimZones)
                    
                    
                    #Test to see if all of the generated zones are null and, if so, return the full floor mass.
                    noneTest = []
                    for zone in floorZones:
                        if zone == None:
                            noneTest.append(1)
                            warning = "The script has failed to create one of the zones because of a tolerance issue.  Try changing your Rhino Model's tolerance (prorbably try increasing) and recompute the GH definition to generate zones correctly."
                            print warning
                            ghenv.Component.AddRuntimeMessage(gh.GH_RuntimeMessageLevel.Warning, warning)
                        else: pass
                    
                    #Append the group to the full zone list.
                    if sum(noneTest) == len(floorZones):
                        genFailure = True
                        finalZones.append(mass[curveCount])
                        warning = "Failed to generate the perimieter zones for one floor as the geometry broke the script.  The problematic floor will be returned as a single zone."
                        print warning
                        ghenv.Component.AddRuntimeMessage(gh.GH_RuntimeMessageLevel.Warning, warning)
                    elif listCount == 0:
                        finalZones.append(floorZones)
                    else:
                        finalZones[curveCount].extend(floorZones)
                else:
                    finalZones.append(mass[curveCount])
                    print "One floor did not generate perimeter and core zones because the offsetting of the boundary causes part of the core to dissappear.  The floor will be returned as a single zone.  If perimeter zones are desired, try decreasing the perimeter depth."
            except:
                if len(floorCrvList) > 1 and listCount > 0: pass
                else:
                    try:
                        finalZones.append(mass[curveCount])
                        warning = "Failed to generate the perimieter zones for one floor as the floor's geometry is not accomodated by the script.  The floor will be returned as a single zone."
                        print warning
                        ghenv.Component.AddRuntimeMessage(gh.GH_RuntimeMessageLevel.Warning, warning)
                    except: pass
    
    # If the building is a courtyard building, generate the core zones and append them to the final zones.
    if len(coreZoneWallList) != 0 and genFailure == False:
        for floorCount, floor in enumerate(coreZoneWallList):
            coreZoneSurfaces = floor
            floorCurves = []
            ceilingCurves = []
            for brep in floor:
                edgeCurves = brep.DuplicateEdgeCurves(True)
                joinedEdgeCurves = rc.Geometry.Curve.JoinCurves(edgeCurves, tolerance, True)
                floorCurves.append(joinedEdgeCurves[0])
                ceilingCurves.append(joinedEdgeCurves[1])
            coreZoneSurfaces.append(rc.Geometry.Brep.CreatePlanarBreps(floorCurves)[0])
            coreZoneSurfaces.append(rc.Geometry.Brep.CreatePlanarBreps(ceilingCurves)[0])
            coreZone = rc.Geometry.Brep.JoinBreps(coreZoneSurfaces, tolerance)[0]
            finalZones[floorCount].append(coreZone)
    else: pass
    
    #If the top floor has not been included in the analysis above, append on the top floor mass.
    if topInc[0] == False:
        finalZones.append([mass[-1]])
    else: pass
    
    return finalZones    
#Redundant fuction temporary
def getFloorCrvs(buildingMass, floorHeights, maxHeights):
    #Draw a bounding box around the mass and use the lowest Z point to set the base point.
    massBB = buildingMass.GetBoundingBox(rc.Geometry.Plane.WorldXY)
    minZ = massBB.Min.Z
    
    basePoint = rc.Geometry.Point3d.Origin
    cntrCrvs = []; splitters = []
    bbox = buildingMass.GetBoundingBox(True)
    for count, h in enumerate(floorHeights):
        crvList = []
        floorBasePt = rc.Geometry.Point3d.Add(basePoint, rc.Geometry.Vector3d(0,0,h + minZ))
        sectionPlane = rc.Geometry.Plane(floorBasePt, rc.Geometry.Vector3d.ZAxis)
        crvList = rc.Geometry.Brep.CreateContourCurves(buildingMass, sectionPlane)
        
        #If the crvList cointains multiple curves, this probably means that it's a courtyard building.  Order the curves from greatest area to least area and create different lists of curves for the interior and exterior.
        if len(crvList) > 1 and count == 0:
            areaList = []
            for curve in crvList:
                try: areaList.append(rc.Geometry.AreaMassProperties.Compute(curve).Area)
                except: areaList.append(0.0)
            crvList = [x for (y,x) in sorted(zip(areaList, crvList))]
            crvList.reverse()
            for curve in crvList:
                cntrCrvs.append([curve])
        elif len(crvList) > 1 and count != 0:
            areaList = []
            for curve in crvList:
                try: areaList.append(rc.Geometry.AreaMassProperties.Compute(curve).Area)
                except: areaList.append(0.0)
            crvList = [x for (y,x) in sorted(zip(areaList, crvList))]
            crvList.reverse()
            for crvCount, curve in enumerate(crvList):
                try: cntrCrvs[crvCount].append(curve)
                except: pass
        elif len(crvList) == 1 and count == 0:
            cntrCrvs.append([crvList[0]])
        elif len(crvList) == 1 and count != 0:
            try: cntrCrvs[0].append(crvList[0])
            except: cntrCrvs.append([crvList[0]])
        else: pass
        
        if crvList != []:
            # This part is based on one of David Rutten's script
            bool, extU, extV = sectionPlane.ExtendThroughBox(bbox)
            # extend the plane for good measure
            extU.T0 -= 1.0
            extU.T1 += 1.0
            extV.T0 -= 1.0
            extV.T1 += 1.0
            splitters.append(rc.Geometry.PlaneSurface(sectionPlane, extU, extV))
    
    finalCrvsList = []
    finaltopIncList = []
    finalNurbsList = []
    
    for courtyrdCount, contourCrvs in enumerate(cntrCrvs):
        
        #Check if the operation has generated a single nurbs curve for a floor (like a circle) and, if so, segment it.
        goodContourCrvs = []
        nurbsList = []
        for curve in contourCrvs:
            try:
                segCount = curve.SegmentCount
                goodContourCrvs.append(curve)
                nurbsList.append(False)
            except:
                #If the curve has failed the operation above, then it is a single NURBS Curve.  Test to see if offsetting it will generate segments and, if not, it should be segemented into a polycurve.
                curveLength = curve.GetLength()
                divisionParams = curve.DivideByLength((curveLength/4), False)[0:3]
                splitCurve = curve.Split(divisionParams)
                newCrv = rc.Geometry.PolyCurve()
                for segment in splitCurve:
                    newCrv.Append(segment)
                goodContourCrvs.append(newCrv)
                nurbsList.append(True)
        contourCrvs = goodContourCrvs
        
        #Check if any of the generated curves have no area and, if so, discount them from the list. Make a note if the curves are at the top, which happens a lot with gabled roofs.  This can be corrected later.
        newContourCrvs = []
        problemIndices = []
        problem = False
        for crvCount, crv in enumerate(contourCrvs):
            if crv.SegmentCount == 2:
                segments = crv.DuplicateSegments()
                if segments[0].IsLinear and segments[1].IsLinear:
                    problem = True
                    problemIndices.append(crvCount)
                else: newContourCrvs.append(crv)
            else: newContourCrvs.append(crv)
        if problem == True:
            if problemIndices[-1] == len(contourCrvs)-1: topProblem = True
            else: topProblem = False
        else: topProblem = False
        contourCrvs = newContourCrvs
        
        #Check to see if the top floor is shorter than 2 meters and, if so, discount it.
        units = sc.doc.ModelUnitSystem
        #Define a default max height for a floor based on the model units and typical building dimensions.
        if `units` == 'Rhino.UnitSystem.Meters':
            maxHeight = 2
        elif `units` == 'Rhino.UnitSystem.Centimeters':
            maxHeight = 200
        elif `units` == 'Rhino.UnitSystem.Millimeters':
            maxHeight = 2000
        elif `units` == 'Rhino.UnitSystem.Feet':
            maxHeight = 6
        elif `units` == 'Rhino.UnitSystem.Inches':
            maxHeight = 72
        else:
            warning = "What model units are you using? Use either meters, centimeters, millimeters, feet or inches"
            print warning
            w = gh.GH_RuntimeMessageLevel.Warning
            ghenv.Component.AddRuntimeMessage(w, warning)
        
        lastFloorHeight = (maxHeights)  - floorHeights[-1]
        
        if is_near_zero(lastFloorHeight): 
            lastFloorInc = True
        else:
            if lastFloorHeight < maxHeight:
                lastFloorInc = False
            else: 
                lastFloorInc = True
        print lastFloorHeight, lastFloorInc, maxHeight
        #Check to see if the top surface is horizontal + planar and, if so, include it in the curve process below.
        if lastFloorInc == True:
            #First find the top surface
            massSurfaces = []
            faceLen = buildingMass.Faces.Count
            for surfaceCount in range(faceLen):
                massSurfaces.append(buildingMass.DuplicateSubBrep([surfaceCount]))
            srfAvgZValue = []
            for brep in massSurfaces:
                vertices = brep.DuplicateVertices()
                zValues = []
                for vertex in vertices:
                    zValues.append(vertex.Z)
                zAvg = (sum(zValues))/(len(zValues))
                srfAvgZValue.append(zAvg)
            maxIndex = max(enumerate(srfAvgZValue),key=lambda x: x[1])[0]
            topSurface = massSurfaces[maxIndex]
            
            #Check the Z-Values of the vertices to see if they are equal and check for planarity
            topZValues = []
            for vertex in topSurface.DuplicateVertices():
                topZValues.append(vertex.Z)
            refZ = topZValues[0]
            zCheckList = []
            for Z in topZValues:
                if Z < refZ + tolerance and Z > refZ - tolerance:
                    zCheckList.append(1)
                else:pass
            if sum(zCheckList) == len(topZValues): tophoriz = True
            else: tophoriz = False
            topPlanar = topSurface.Surfaces[0].IsPlanar()
            #If it's both horizontal and planar, take the boundary curve and include it in the rest of the process.
            if tophoriz == True and topPlanar == True:
                topInc = True
                edgeCurves = rc.Geometry.Curve.JoinCurves(topSurface.DuplicateEdgeCurves())
                #If the building is a courtyard one, select out the curve with the same area order.
                if len(edgeCurves) > 1:
                    areaList = []
                    for curve in edgeCurves:
                        try: areaList.append(rc.Geometry.AreaMassProperties.Compute(curve).Area)
                        except: areaList.append(0.0)
                    edgeCurvesSorted = [x for (y,x) in sorted(zip(areaList, edgeCurves))]
                    edgeCurves = [edgeCurvesSorted[courtyrdCount]]
                else: pass
                
                isNurbCurve = []
                for count, curve in enumerate(edgeCurves):
                    try:
                        segCount = edgeCurves.SegmentCount
                        isNurbCurve.append(False)
                    except:
                        isNurbCurve.append(True)
                        curveLength = curve.GetLength()
                        divisionParams = curve.DivideByLength((curveLength/4), False)[0:3]
                        splitCurve = curve.Split(divisionParams)
                        newCrv = rc.Geometry.PolyCurve()
                        for segment in splitCurve:
                            newCrv.Append(segment)
                        edgeCurves[count] = newCrv
                    for curve in edgeCurves:
                        contourCrvs.append(curve)
                    for bool in isNurbCurve:
                        nurbsList.append(bool)
            else:
                topInc = False
        else:
            if lastFloorHeight < maxHeight:
                topInc = True
            else: topInc = False
        
        if topProblem == True:
            topInc = False
        else: pass
        
        # Match the curve directions.
        if len(contourCrvs)!= 0:
            refCrv = contourCrvs[0]
            crvDir = []
            for crv in contourCrvs:
                crvDir.append(rc.Geometry.Curve.DoDirectionsMatch(refCrv, crv))
            for count, dir in enumerate(crvDir):
                if dir == True:
                    contourCrvs[count].Reverse()
        
        #Check if there are any curved segments in the polycurve and if so, make a note of it
        curveSegmentList = []
        for curve in contourCrvs:
            curved = False
            for segment in curve.DuplicateSegments():
                if segment.IsLinear(): pass
                else: curved = True
            curveSegmentList.append(curved)
        
        
        #Match the curve seams in order to ensure proper zone splitting later.
        if len(contourCrvs)!= 0:
            crvCentPt = rc.Geometry.AreaMassProperties.Compute(contourCrvs[-1]).Centroid
            # get a point from the center of the contour curve to a seam in order to adjust the seam of all other curves.
            curveLengths = []
            for curve in contourCrvs:
                curveLengths.append(curve.GetLength())
            curveLengths.sort()
            longestCurveLength = curveLengths[-1]
            factor = ((longestCurveLength)/(contourCrvs[-1].PointAtStart.X - crvCentPt.X))*2
            seamVectorPt = rc.Geometry.Vector3d((contourCrvs[-1].PointAtStart.X - crvCentPt.X)*factor, (contourCrvs[-1].PointAtStart.Y - crvCentPt.Y)*factor, 0)
            
            # Try to adjust the seam of the curves.
            crvAdjust = []
            try:
                for nurbCount, curve in enumerate(contourCrvs):
                    if curve.IsClosed:
                        if nurbsList[nurbCount] == False and curveSegmentList[nurbCount] == False:
                            curveParameter = curve.ClosestPoint(rc.Geometry.Intersect.Intersection.CurveCurve(curve, rc.Geometry.Line(rc.Geometry.AreaMassProperties.Compute(curve).Centroid, seamVectorPt).ToNurbsCurve(), sc.doc.ModelAbsoluteTolerance, sc.doc.ModelAbsoluteTolerance)[0].PointA)[1]
                            curveParameterRound = round(curveParameter)
                            curveParameterTol = round(curveParameter, (len(list(str(sc.doc.ModelAbsoluteTolerance)))-2))
                            if curveParameterRound + sc.doc.ModelAbsoluteTolerance > curveParameter and curveParameterRound - sc.doc.ModelAbsoluteTolerance < curveParameter:
                                curve.ChangeClosedCurveSeam(curveParameterRound)
                                crvAdjust.append(curve)
                            else:
                                curve.ChangeClosedCurveSeam(curveParameter)
                                if curve.IsClosed == True:
                                    crvAdjust.append(curve)
                                else:
                                    curve.ChangeClosedCurveSeam(curveParameter+sc.doc.ModelAbsoluteTolerance)
                                    if curve.IsClosed == True:
                                        crvAdjust.append(curve)
                                    else:
                                        curve.ChangeClosedCurveSeam(curveParameter-sc.doc.ModelAbsoluteTolerance)
                                        if curve.IsClosed == True:
                                            crvAdjust.append(curve)
                                        else:
                                            curve.ChangeClosedCurveSeam(curveParameter)
                                            curve.MakeClosed(sc.doc.ModelAbsoluteTolerance)
                                            crvAdjust.append(curve)
                        else:
                            crvAdjust.append(curve)
                    else:
                        crvAdjust.append(curve)
                        warning = 'The top or bottom of your mass geometry is composed of multiple surfaces and this is causing the algorithm to mess up.\n  If you re-make your top and/or bottom of your mass to be a single surface, this component should work.'
                        print warning
                        ghenv.Component.AddRuntimeMessage(gh.GH_RuntimeMessageLevel.Warning, warning)
            except: crvAdjust = contourCrvs
        
        #Simplify the contour curves to ensure that they do not mess up the next few steps.
        for curve in crvAdjust:
            curve.Simplify(rc.Geometry.CurveSimplifyOptions.All, tolerance, sc.doc.ModelAngleToleranceRadians)
        
        #Append the results to the list.
        finalCrvsList.append(crvAdjust)
        finaltopIncList.append(topInc)
        finalNurbsList.append(nurbsList)
    
    return splitters, finalCrvsList, finaltopIncList, finalNurbsList, lastFloorInc

def is_near_zero(num,eps=1E-10):
    return abs(float(num)) < eps

def main(mass, perimeterZoneDepth_):  
    debug = sc.sticky['debug']
    #Import the Ladybug Classes.
    if sc.sticky.has_key('ladybug_release')and sc.sticky.has_key('honeybee_release'):
        lb_preparation = sc.sticky["ladybug_Preparation"]()
        lb_visualization = sc.sticky["ladybug_ResultVisualization"]()
        
        #multiply and list mass to work with splitPerimZones function
        splitFloors = map(lambda n:[n],mass)
        floorCrvs = []
        topInc = []
        nurbsList = []
        for item in mass:
            bbBox = item.GetBoundingBox(rc.Geometry.Plane.WorldXY)
            maxHeights = bbBox.Max.Z
            minHeights = bbBox.Min.Z
            #Function to get floorCrvs, topInc(?), nurbsList
            #Not sure how many of these we really need
            splitters, flrCrvs, topIncl, nurbL, lastInclud = getFloorCrvs(item, [0, maxHeights-minHeights], maxHeights)
            
            floorCrvs.append(flrCrvs)
            topInc.append(topIncl)
            nurbsList.append(nurbL)
            
        #Generate perimeter/core zone
        splitZones = []
        if perimeterZoneDepth_ != []:
            for count, mass in enumerate(splitFloors):
                splitzone = splitPerimZones(mass, perimeterZoneDepth_, floorCrvs[count], topInc[count], nurbsList[count])
                splitZones.append(splitzone)
        return splitZones
    else:
        print "You should first let both Ladybug and Honeybee to fly..."
        w = gh.GH_RuntimeMessageLevel.Warning
        ghenv.Component.AddRuntimeMessage(w, "You should first let both Ladybug and Honeybee to fly...")
        return -1    

checkData = False
if _runIt == True:
    checkData = checkTheInputs()
if checkData == True:
    sc.sticky['debug'] = []
    splitBldgMassesLists = main(_bldgMasses, perimeterZoneDepth_)
    if splitBldgMassesLists!= -1:
        splitBldgMasses = DataTree[Object]()
    
    names = DataTree[Object]()
    for i, buildingMasses in enumerate(splitBldgMassesLists):
        for j, mass in enumerate(buildingMasses):
            p = GH_Path(i,j)
            
            # in case mass is not a list change it to list
            try: mass[0]
            except: mass = [mass]
            
            newMass = []
            for brep in mass:
                if brep != None:
                    #Bake the objects into the Rhino scene to ensure that surface normals are facing the correct direction
                    sc.doc = rc.RhinoDoc.ActiveDoc #change target document
                    rs.EnableRedraw(False)
                    guid1 = [sc.doc.Objects.AddBrep(brep)]
                    if guid1:
                        a = [rs.coercegeometry(a) for a in guid1]
                        for g in a: g.EnsurePrivateCopy() #must ensure copy if we delete from doc
                        
                        rs.DeleteObjects(guid1)
                    
                    sc.doc = ghdoc #put back document
                    rs.EnableRedraw()
                    newMass.append(g)
                mass = newMass
            
            try:
                splitBldgMasses.AddRange(mass, p)
            except:
                splitBldgMasses.Add(mass, p)
    debug = sc.sticky['debug']
# ---------- end python_6 ----------
geo_19 = Geometry(splitmass.splitBldgMasses)
g_18 = PythonScript(node=bibil_20.Node_out)  # -> tolerance; inputs node: list
# ---------- g_18: Python ----------
node = filter(lambda n: n!=None,node)
if node and node != []:
    tolerance = []
    for n in node:
        loc = n.backtrack_tree(lambda n: n.grammar.type.has_key('tolerance_curve'),accumulate=True)
        tolerance.extend(map(lambda n:n.grammar.type['tolerance_curve'],loc))
    if tolerance:
        tolerance = reduce(lambda x,y:x+y,tolerance)
# ---------- end g_18 ----------

# ---- group: change this to come from root find context
g_19 = PythonScript(node=bibil_20.Node_dead)  # -> context; inputs node: list
# ---------- g_19: Python ----------
node = filter(lambda n: n!=None,node)
if node and node != []:
    context = []
   
    for n in node:
        print n.grammar.type
        foo = lambda n: n.grammar.type.has_key('context_geometry')
        loc = n.backtrack_tree(foo,accumulate=True)
        context.extend(map(lambda n:n.grammar.type['context_geometry'],loc))
    print context
# ---------- end g_19 ----------

# ---- group: context
geo_20 = Geometry([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])

# ----
panel_17 = Panel(bibil_20.Debug)
geo_21 = Geometry([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])
geo_22 = Geometry()
previewlw_4 = CustomPreviewLineweights(Geometry=g_18, Shader=ColourSwatch(SwatchColor=RGB(255, 0, 255)), Thickness=Slider(3, range=0..10))
fmerge_2 = MergeFaces(Brep=geo_22)  # -> Breps, Before, After
number_slider_21 = Slider(0.25, range=0..1)
geo_23 = Geometry([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])
wires_2 = BrepWireframe(Brep=fmerge_2.Breps, Density=-1)
wires_3 = BrepWireframe(Brep=geo_23, Density=-1)
material_2 = CreateMaterial(
    Diffuse=ColourSwatch(SwatchColor=RGB(255, 255, 255)),
    Specular=RGB(255, 255, 255),
    Emission=RGB(0, 0, 0),
    Transparency=Slider(0.3, range=0..1),
    Shine=0)
mesh_2 = Mesh(fmerge_2.Breps)
geo_24 = Geometry([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])
dash_4 = DashPattern(Curve=wires_3, Pattern=Slider(1, range=0..10))  # -> Dashes, Gaps
swatch_2 = ColourSwatch(SwatchColor=RGB(255, 0, 0))
preview_5 = CustomPreview(Geometry=wires_2, Shader=ColourSwatch(SwatchColor=RGB(0, 0, 0)))
preview_6 = CustomPreview(Geometry=mesh_2, Shader=material_2)
wires_4 = BrepWireframe(Brep=geo_24, Density=-1)
geo_25 = Geometry([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])
sunion_2 = SolidUnion(Breps=geo_25)
dash_5 = DashPattern(Curve=wires_4, Pattern=Slider(0.7, range=0..1))  # -> Dashes, Gaps
previewlw_5 = CustomPreviewLineweights(Geometry=dash_4.Dashes, Shader=swatch_2, Thickness=Slider(1.5, range=0..10))
preview_7 = CustomPreview(Geometry=dash_4.Dashes, Shader=swatch_2)
fmerge_3 = MergeFaces(Brep=sunion_2)  # -> Breps, Before, After
wires_5 = BrepWireframe(Brep=fmerge_3.Breps, Density=-1)

bldgprograms = Honeybee_bldgPrograms({"Office": 0, "Retail": 1, "MidriseApartment": 2, "PrimarySchool": 3, "SecondarySchool": 4, "SmallHotel": 5, "LargeHotel": 6, "Hospital": 7, "Outpatient": 8, "Warehouse": 9, "SuperMarket": 10, "FullServiceRestaurant": 11, "QuickServiceRestaurant": 12}, selected="MidriseApartment")
listzoneprograms = Honeybee_ListZonePrograms(bldgProgram=bldgprograms)  # -> MidriseApartmentZonePrograms; plug-in component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
item = ListItem(List=listzoneprograms, Index="0", Wrap=True)

dash_6 = DashPattern(Curve=wires_5, Pattern=Slider(2, range=0..10))  # -> Dashes, Gaps
preview_8 = CustomPreview(Geometry=dash_5.Dashes, Shader=ColourSwatch(SwatchColor=RGB(153, 153, 153)))
preview_9 = CustomPreview(Geometry=dash_6.Dashes, Shader=ColourSwatch(SwatchColor=RGB(153, 153, 153)))
geo_26 = Geometry(g_17)
callfromepconstrlibrary = Honeybee_CallFromEPConstructionLibrary(keywords="Window")  # -> EPMaterials, EPWindowMaterils, EPConstructions; plug-in component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
callfromepconstrlibrary_2 = Honeybee_CallFromEPConstructionLibrary(keywords="IEAD")  # -> EPMaterials, EPWindowMaterils, EPConstructions; plug-in component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
callfromepconstrlibrary_3 = Honeybee_CallFromEPConstructionLibrary(keywords="steel")  # -> EPMaterials, EPWindowMaterils, EPConstructions; plug-in component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
toggle_13 = BooleanToggle(False)  # disabled
number_slider_22 = Slider(1, range=0..1)  # disabled
geo_27 = Geometry()  # disabled
number_slider_23 = Slider(8, range=0..10)  # disabled
mass2zone = Honeybee_Masses2Zones(zoneMasses=flatten(geo_21), zonePrograms=item, isConditioned=Toggle(True), maxRoofAngle=30, createHBZones=Toggle(True))  # -> readMe, HBZones; plug-in component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
gentestpts = Honeybee_GenerateTestPoints(testGeometry=geo_27, gridSize=number_slider_23, distBaseSrf=number_slider_22, moveTestMesh=toggle_13)  # -> readMe, simplify(testPoints), simplify(ptsVectors), simplify(facesArea), simplify(mesh); disabled; plug-in component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
panel_18 = Panel("""0.4
0.4
0.4
0.4""")
item_2 = ListItem(List=callfromepconstrlibrary_3.EPConstructions, Index="3", Wrap=True)
item_3 = ListItem(List=callfromepconstrlibrary.EPConstructions, Index="10", Wrap=True)
item_4 = ListItem(List=callfromepconstrlibrary_2.EPConstructions, Index="6", Wrap=True)
faceb = FaceBoundaries(Mesh=gentestpts.mesh)  # disabled
panel_19 = Panel(item_2)
panel_20 = Panel(item_3)
panel_21 = Panel(item_4)
solveadjc = Honeybee_SolveAdjacencies(HBZones=flatten(mass2zone.HBZones), removeCurrentAdjc=False, findAdjc=Toggle(True))  # -> readMe, HBZonesWADJ; plug-in component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
glazingcreator = Honeybee_GlazingBasedOnRatio(HBObjects=solveadjc.HBZonesWADJ, glzRatio=panel_18, breakUpWindow=Toggle(False), runIt=Toggle(True))  # -> readMe, HBObjWGLZ; plug-in component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
brep = Brep(faceb)  # disabled
sunion_3 = SolidUnion(Breps=brep)  # disabled
geo_28 = Geometry(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)
wires_6 = BrepWireframe(Brep=glazingcreator.HBObjWGLZ, Density=-1)
zoneattributelist = Honeybee_ZoneAttributeList({"Name": "name", "Zone Program": "zoneProgram", "Zone Floor Area": "zoneFloorArea", "Zone Volume": "zoneVolume", "Building Program": "bldgProgram", "Is Conditioned": "isConditioned", "HVAC System Type": "HVACSystem", "Occupancy Schedule": "occupancySchedule", "Occupancy Activity Schedule": "occupancyActivitySch", "Heating SetPoint Schedule": "heatingSetPtSchedule"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}, selected="Name")  # disabled
mass2zone_2 = Honeybee_Masses2Zones(zoneMasses=flatten(geo_28), isConditioned=True, maxRoofAngle=30, createHBZones=Toggle(True))  # -> readMe, HBZones; plug-in component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
soil_type = Panel("4")
setepzonecnstr = Honeybee_SetEPZoneConstruction(HBZones=flatten(mass2zone.HBZones), wallEPConstruction=item_2, windowEPConstruction=item_3, roofEPConstruction=item_4)  # -> simplify(modifiedHBZones); plug-in component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
labelzones = Honeybee_LabelZones(HBZones=flatten(setepzonecnstr), attribute=zoneattributelist)  # -> zoneTxtLabels, labelBasePts, brepTxtLabels, zoneWireFrames; disabled; plug-in component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
createepground = Honeybee_CreateEPGround(HBZones=mass2zone_2.HBZones, soilTypeOrMat=soil_type)  # -> HBGrndZones; plug-in component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
toggle_14 = BooleanToggle(True)
tag = TextTag(Location=labelzones.labelBasePts, Text=labelzones.zoneTxtLabels)  # disabled
path = FilePath("C:\saeran\master\git\Bibil\src\reference\CAN_ON_Toronto.716240_CWEC\CAN_ON_Toronto.716240_CWEC.epw")
path_2 = FilePath("C:\saeran\master\git\Bibil\src\reference\CAN_ON_Toronto.716240_CWEC\CAN_ON_Toronto.716240_CWEC.stat")

# ---- group: SHAPENODE
bibil_21 = PythonScript(Code=file_10, Node_in=flatten(createepground), Label_="ground_node", Run=Toggle(True))  # -> Node_out, Node_dead, Debug

# ----
makeadiabaticbytype = Honeybee_MakeAdiabaticByType(HBZones=setepzonecnstr, roofs=toggle_14, exposedFloors=toggle_14)  # -> HBZones; plug-in component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
importepw = Ladybug_ImportEpw(epwFile=path)  # -> readMe, latitude, location, dryBulbTemperature, dewPointTemperature, relativeHumidity, windSpeed, windDirection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; plug-in component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
importstat = Ladybug_ImportStat(statFile=path_2)  # -> readMe, ashraeClimateZone, koppenClimateZone, port, heatingDesignTemp, coolingDesignTemp, port_2, extremeHotWeek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; plug-in component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
ladybug = Ladybug_Ladybug()  # -> Vviiiiiiiiiizzz; plug-in component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
honeybee = Honeybee_Honeybee()  # -> Vviiiiiiiiiizzz; plug-in component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
g_20 = PythonScript(node=bibil_21.Node_out)  # -> geom; inputs node: list; same code as g_14
srfattributelist = Honeybee_SurfaceAttributeList({"Name": "name", "Radiance Material": "RadMaterial", "EnergyPlus Construction": "EPConstruction", "Surface Type": "type", "Boundary Condition": "BC", "Sun Exposure": "sunExposure", "Wind Exposure": "windExposure", "Has Child Surface": "hasChild", "Is Child Surface": "isChild", "Is Planar": "isPlanar", "Srf Type Set By User": "srfTypeByUser", "Boundary Condition Set By User": "srfBCByUser", "Shade Material Name": "shadeMaterialName", "Shading Control Name": "shadingControlName", "Shcading Schedule Name": "shadingSchName"}, selected="Boundary Condition")  # disabled
python_7 = PythonScript(x=importepw.dryBulbTemperature)  # -> a; inputs x: list
# ---------- python_7: Python ----------
a = reduce(lambda i,j:i+j,x[7:])/float(len(x[7:]))
# ---------- end python_7 ----------
python_8 = PythonScript(x=importepw.relativeHumidity)  # -> a; inputs x: list; same code as python_7
panel_22 = Panel(importepw.dryBulbTemperature)
panel_23 = Panel(python_7)
panel_24 = Panel(python_8)
labelsurfaces = Honeybee_LabelZoneSurfaces(HBObjects=flatten(makeadiabaticbytype), attribute=srfattributelist)  # -> surfaceTxtLabels, labelBasePts, brepTxtLabels, surfaceWireFrames; disabled; plug-in component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
number_slider_24 = Slider(2, range=0..10)  # disabled
swatch_3 = ColourSwatch(SwatchColor=RGB(0, 0, 0))  # disabled
data_10 = Data([makeadiabaticbytype, createepground])
tag_2 = TextTag(Location=labelsurfaces.labelBasePts, Text=labelsurfaces.surfaceTxtLabels)  # disabled
preview_10 = CustomPreview(Geometry=labelsurfaces.surfaceWireFrames, Shader=swatch_3)  # disabled
previewlw_6 = CustomPreviewLineweights(Geometry=labelsurfaces.surfaceWireFrames, Shader=swatch_3, Thickness=number_slider_24)  # disabled
toggle_15 = BooleanToggle(True)
panel_25 = Panel("""OutputControl:Table:Style,Comma;
Output:Variable,*,Surface Outside Face Temperature, hourly;""")
epoutput = Honeybee_GenerateEPOutput(zoneGainsAndLosses="False", zoneComfortMetrics=toggle_15, surfaceTempAnalysis=toggle_15)  # -> report, flatten(simulationOutputs); plug-in component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
toggle_16 = BooleanToggle(False)
data_11 = Data(importstat.typicalHotWeek)
selectandaveragedata = Ladybug_AverageData(annualHourlyData=importepw.dryBulbTemperature, analysisPeriod=data_11)  # -> readMe, selHourlyData, averagedDaily, averagedMonthly, avrMonthlyPerHour, avrAnalysisPeriod; plug-in component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
panel_26 = Panel(selectandaveragedata.avrAnalysisPeriod)
exporttoopenstudio = Honeybee_ExportToOpenStudio(
    epwWeatherFile=path,
    analysisPeriod=data_11,
    HBZones=flatten(data_10),
    simulationOutputs=flatten(panel_25),
    writeOSM=toggle_16,
    runSimulation=toggle_16)  # -> readMe, osmFileAddress, idfFileAddress, resultsFileAddress, eioFileAddress, rddFileAddress, studyFolder; plug-in component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
readepsrfresult = Honeybee_ReadEPSurfaceResult(resultFileAddress=exporttoopenstudio.resultsFileAddress)  # -> surfaceIndoorTemp, surfaceOutdoorTemp, surfaceEnergyFlow, opaqueEnergyFlow, glazEnergyFlow, windowTotalSolarEnergy, windowBeamEnergy, windowDiffEnergy, windowTransmissivity, otherSurfaceData; plug-in component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
toggle_17 = BooleanToggle(False)  # disabled
panel_27 = Panel(readepsrfresult.surfaceOutdoorTemp)
colorsurfaces = Honeybee_ColorSurfacesByEPResult(srfData=readepsrfresult.surfaceOutdoorTemp, HBZones=flatten(data_10), runIt=toggle_17)  # -> readMe, srfColoredMesh, zoneWireFrame, legend, legendBasePt, analysisTitle, srfBreps, srfColors, srfValues, port; disabled; plug-in component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
area_3 = Area(Geometry=colorsurfaces.srfBreps)  # -> Area, Centroid; disabled
number_slider_25 = Slider(15, range=0..100)  # disabled
number_slider_26 = Slider(35, range=0..100)  # disabled
sort = SortList(Keys=colorsurfaces.srfValues)  # -> Keys, ValuesA; disabled
panel_28 = Panel("-1")  # disabled
tag_3 = TextTag(Location=area_3.Centroid, Text=colorsurfaces.srfValues)  # disabled
geo_29 = Geometry(colorsurfaces.srfBreps)  # disabled
item_5 = ListItem(List=sort.Keys, Index=0, Wrap=True)  # disabled
item_6 = ListItem(List=sort.Keys, Index=panel_28, Wrap=True)  # disabled
gradient = Gradient(
    LowerLimit=number_slider_25,
    UpperLimit=number_slider_26,
    Parameter=colorsurfaces.srfValues,
    stops=[0: RGB(255, 0, 64), 0.25: RGB(245, 93, 0), 0.532: RGB(255, 255, 22), 0.75: RGB(93, 177, 249), 1: RGB(0, 44, 169)])  # disabled
geo_30 = Geometry(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)

# ---- group: BIBIL2HBZone
python_9 = PythonScript(HBZones=makeadiabaticbytype, BBNodes=bibil_20.Node_out, HBground=createepground, BBground=bibil_21.Node_out)  # -> BBNodes; inputs HBZones: list, BBNodes: list
# ---------- python_9: Python ----------
import scriptcontext as sc
import rhinoscriptsyntax as rs

hb_hive = sc.sticky["honeybee_Hive"]()


def IsList(lst):
    return lst != [None] and lst != []

if IsList(_HBZones) and IsList(_BBNodes):
    #print len(_HBZones)
    #print len(_BBNodes)
    for i in xrange(len(_HBZones)):
        hb = _HBZones[i]
        hb = rs.coercebrep(hb)
        #zone = hb_hive.visualizeFromHoneybeeHive([hb])[0]
        bb = _BBNodes[i]
        bb.grammar.type['HBZone'] = hb
        _BBNodes[i] = bb
    
    if _HBground and _BBground:
        _HBground = rs.coercebrep(_HBground)
        _BBground.grammar.type['HBZone'] = _HBground
        _BBNodes.append(_BBground)
# ---------- end python_9 ----------

# ---- group: EXTRACT_CANYON
miru_23 = PythonScript(
    Code=file_3,
    Canyon_tol=Slider(30, range=0..100),
    Canyon_center=geo_30,
    Srf_data=readepsrfresult.surfaceOutdoorTemp,
    Run=Toggle(True))

# ---- group: INTERPOLATE_VERTICAL
miru_24 = PythonScript(Code=file_4, Run=Toggle(True))

# ----
preview_11 = CustomPreview(Geometry=geo_29, Shader=gradient)  # disabled

# ---- group: SHAPENODE
bibil_22 = PythonScript(Code=file_10, Rule_in=flatten([miru_23, miru_24]), Node_in=flatten(python_9), Run=Toggle(True))  # -> Node_out, Node_dead, Debug

# ----
data_12 = Data(Slider(27, range=0..100))
data_13 = Data(Slider(18, range=0..100))
g_21 = PythonScript(node=bibil_22.Node_out)  # -> inorm; inputs node: list
# ---------- g_21: Python ----------
if node and node != [None]:
    inorm = []
    for n in node:
        if n.grammar.type.has_key('interpolate_srf_normal'):
            srf_data = n.grammar.type['interpolate_srf_normal']
            #print srf_data
            inorm.extend(srf_data)
    
    #print isrf
# ---------- end g_21 ----------
g_22 = PythonScript(node=bibil_22.Node_out)  # -> icpt; inputs node: list
# ---------- g_22: Python ----------
if node and node != [None]:
    icpt = []
    for n in node:
        if n.grammar.type.has_key('interpolate_cpt'):
            srf_data = n.grammar.type['interpolate_cpt']
            #print srf_data
            icpt.extend(srf_data)
    #print cpt
# ---------- end g_22 ----------
g_23 = PythonScript(node=bibil_22.Node_out)  # -> itemp; inputs node: list
# ---------- g_23: Python ----------
import scriptcontext as sc
Bula = sc.sticky['Bula']
B = Bula()

if node and node != [None]:
    itemp = []
    for n in node:
        if n.grammar.type.has_key('interpolate_temperature'):
            srf_data = n.grammar.type['interpolate_temperature']
            #print srf_data
            itemp.extend(srf_data)

#itemp = B.normalize_list(itemp,1.,0.)
#print itemp
# ---------- end g_23 ----------
g_24 = PythonScript(node=bibil_22.Node_out)  # -> pt; inputs node: list
# ---------- g_24: Python ----------
node = filter(lambda n: n!=None,node)
if node and node != []:
    pt = []
    for n in node:
        n = n.backtrack_tree(lambda n: n.grammar.type.has_key('processed_srf_geom'))
        if n:
            srf_data = n.grammar.type['processed_srf_pt']
            #print srf_data
            # print '--'
            pt.extend(srf_data)
    #print pt
# ---------- end g_24 ----------
g_25 = PythonScript(node=bibil_22.Node_out)  # -> temp; inputs node: list
# ---------- g_25: Python ----------
if node and node != [None]:
    temp = []
    for n in node:
        #if n.grammar.type.has_key('processed_srf_data'):
        n = n.backtrack_tree(lambda n: n.grammar.type.has_key('processed_srf_data'))
        if n:
            srf_data = n.grammar.type['processed_srf_data']
            temp.extend(srf_data)
    #print temp
# ---------- end g_25 ----------

# ---- group: facade
sort_2 = SortList(Keys=g_25)  # -> Keys, ValuesA
item_7 = ListItem(List=sort_2.Keys, Index=0, Wrap=True)
item_8 = ListItem(List=sort_2.Keys, Index="-1", Wrap=True)
panel_29 = Panel(item_7)
panel_30 = Panel(item_8)

# ----
g_26 = PythonScript(node=bibil_22.Node_out)  # -> srf; inputs node: list
# ---------- g_26: Python ----------
if node and node != [None]:
    srf = []
    for n in node:
        n = n.backtrack_tree(lambda n: n.grammar.type.has_key('processed_srf_geom'))
        #if n.grammar.type.has_key('processed_srf_geom'):
        if n:
            srf_data = n.grammar.type['processed_srf_geom']
            #print srf_data
            #print '-'
            srf.extend(srf_data)
    #print srf
# ---------- end g_26 ----------
g_27 = PythonScript(node=bibil_22.Node_out)  # -> norm; inputs node: list
# ---------- g_27: Python ----------
node = filter(lambda n: n!=None,node)
if node and node != []:
    norm = []
    for n in node:
        n = n.backtrack_tree(lambda n: n.grammar.type.has_key('processed_srf_normal'))
        if n:
            srf_data = n.grammar.type['processed_srf_normal']
            #print srf_data
            # print '--'
            norm.extend(srf_data)
    #print norm
# ---------- end g_27 ----------
g_28 = PythonScript(node=bibil_22.Node_out)  # -> isrf; inputs node: list
# ---------- g_28: Python ----------
if node and node != [None]:
    isrf = []
    for n in node:
        if n.grammar.type.has_key('interpolate_srf_geom'):
            srf_data = n.grammar.type['interpolate_srf_geom']
            #print srf_data
            isrf.extend(srf_data)
    
    #print isrf
# ---------- end g_28 ----------
g_29 = PythonScript(node=bibil_22.Node_out)  # -> gtemp; inputs node: list
# ---------- g_29: Python ----------
import scriptcontext as sc
Bula = sc.sticky['Bula']
B = Bula()

if node and node != [None]:
    gtemp = []
    for n in node:
        n = n.backtrack_tree(lambda n:n.grammar.type.has_key('ground_srf_data'))
        if n and n.grammar.type.has_key('ground_srf_data'):
            srf_data = n.grammar.type['ground_srf_data']
            #print srf_data
            gtemp.extend(srf_data)

    #print gtemp
# ---------- end g_29 ----------
g_30 = PythonScript(node=bibil_22.Node_out)  # -> gsrf; inputs node: list
# ---------- g_30: Python ----------
if node and node != [None]:
    gsrf = []
    for n in node:
        n = n.backtrack_tree(lambda n:n.grammar.type.has_key('ground_srf_geom'))
        if n and n.grammar.type.has_key('ground_srf_geom'):
            srf_data = n.grammar.type['ground_srf_geom']
            #print srf_data
            gsrf.extend(srf_data)
    
    #print gsrf
# ---------- end g_30 ----------
g_31 = PythonScript(node=bibil_22.Node_out)  # -> gcpt; inputs node: list
# ---------- g_31: Python ----------
if node and node != [None]:
    gcpt = []
    for n in node:
        n = n.backtrack_tree(lambda n:n.grammar.type.has_key('ground_srf_pt'))
        if n and n.grammar.type.has_key('ground_srf_pt'):
            srf_data = n.grammar.type['ground_srf_pt']
            #print srf_data
            gcpt.extend(srf_data)
    #print cpt
# ---------- end g_31 ----------
sort_3 = SortList(Keys=g_23)  # -> Keys, ValuesA
item_9 = ListItem(List=sort_3.Keys, Index=0, Wrap=True)
item_10 = ListItem(List=sort_3.Keys, Index="-1", Wrap=True)
sort_4 = SortList(Keys=g_25)  # -> Keys, ValuesA
g_32 = PythonScript(node=bibil_20.Node_out)  # -> crv; inputs node: list
# ---------- g_32: Python ----------
node = filter(lambda n: n!=None,node)
if node and node != []:
    crv = []
    for n in node:
        if n.shape.bottom_crv:
            crv.append(n.shape.bottom_crv)
    #print geom
# ---------- end g_32 ----------
item_11 = ListItem(List=sort_4.Keys, Index=0, Wrap=True)
item_12 = ListItem(List=sort_4.Keys, Index="-1", Wrap=True)
panel_31 = Panel(item_9)
panel_32 = Panel(item_10)
panel_33 = Panel(item_11)
panel_34 = Panel(item_12)
move = Move(Geometry=g_26, Motion=g_27)  # -> Geometry, Transform
tag_4 = TextTag(Location=g_31, Text=g_29, Colour=ColourSwatch(SwatchColor=RGB(255, 0, 255)))
move_2 = Move(Geometry=g_28, Motion=g_21)  # -> Geometry, Transform
mesh_3 = Mesh(move.Geometry)
gradient_2 = Gradient(
    LowerLimit=data_12,
    UpperLimit=data_13,
    Parameter=g_23,
    stops=[0: RGB(255, 0, 64), 0.25: RGB(245, 93, 0), 0.5: RGB(255, 255, 22), 0.75: RGB(93, 177, 249), 1: RGB(0, 44, 169)])
mesh_4 = Mesh(move_2.Geometry)
gradient_3 = Gradient(
    LowerLimit=data_12,
    UpperLimit=data_13,
    Parameter=g_25,
    stops=[0: RGB(255, 0, 64), 0.25: RGB(245, 93, 0), 0.5: RGB(255, 255, 22), 0.75: RGB(93, 177, 249), 1: RGB(0, 44, 169)])
demesh = DeconstructMesh(Mesh=mesh_3)  # -> Vertices, Faces, Colours, Normals
demesh_2 = DeconstructMesh(Mesh=mesh_4)  # -> Vertices, Faces, Colours, Normals
conmesh = ConstructMesh(Vertices=demesh.Vertices, Faces=demesh.Faces)
conmesh_2 = ConstructMesh(Vertices=demesh_2.Vertices, Faces=demesh_2.Faces)
geo_31 = Geometry([move.Geometry, move_2.Geometry])
mcol = MeshColours(Mesh=graft(conmesh), Colours=graft(gradient_3))
sunion_4 = SolidUnion(Breps=geo_31)
mcol_2 = MeshColours(Mesh=graft(conmesh_2), Colours=graft(gradient_2))
fmerge_4 = MergeFaces(Brep=sunion_4)  # -> Breps, Before, After
mesh_5 = Mesh(mcol_2)
mesh_6 = Mesh(mcol)
wires_7 = BrepWireframe(Brep=fmerge_4.Breps, Density=-1)
dash_7 = DashPattern(Curve=wires_7, Pattern=Slider(1.6, range=0..10))  # -> Dashes, Gaps

# ---- group: stb-sb
python_10 = PythonScript(sb=podium_ht.setback_dim, stb=podium_ht.stepback_dim)  # -> a
# ---------- python_10: Python ----------
a = stb - sb
# ---------- end python_10 ----------

# ---- group: + 1.5
python_11 = PythonScript(x=podium_ht.podium_ht)  # -> a
# ---------- python_11: Python ----------
a = x+1.5
# ---------- end python_11 ----------

# ----
python_12 = PythonScript(x=[move_2.Geometry, move.Geometry], node_ref=bibil_22.Node_out)  # -> a; inputs x: list, node_ref: list
# ---------- python_12: Python ----------
import rhinoscriptsyntax as rs
import Rhino as rc
import scriptcontext as sc

Shape = sc.sticky['Shape']

if len(x)>0 and len(node_ref)>0:
    #shp = Shape(rs.coercebrep(x[0]),cplane=None)
    ref = node_ref[0]
    cplane = ref.shape.cplane
    
    a = cplane
# ---------- end python_12 ----------
geo_32 = Geometry([move_2.Geometry, move.Geometry])
Z = UnitZ(Factor=Slider(623, range=0..1000))
move_3 = Move(Geometry=wires_7, Motion=Z)  # -> Geometry, Transform

# ---- group: dev
data_14 = Data(podium_ht.develop_step)

# ----
group = Group(Objects=geo_32)
previewlw_7 = CustomPreviewLineweights(Geometry=move_3.Geometry, Shader=ColourSwatch(SwatchColor=RGB(255, 255, 255)), Thickness=Slider(0.1, range=0..1))
pt = Point(Point(-73.52861214, -114.8068854, 216.8657781))
bbox = BoundingBox(Content=group, Plane=python_12)  # -> Box, Box_2

# ---- group: SHAPENODE
bibil_23 = PythonScript(Code=file_10, Node_in=flatten(bbox.Box), Label_="bbox", Run=Toggle(True))  # -> Node_out, Node_dead, Debug

# ----
# ASHRAE 55 recommends that floor temperatures stay in the range of 19–29 °C (66–84 °F) in spaces where occupants will be wearing lightweight shoes.
g_33 = PythonScript(node=bibil_23.Node_out)  # -> crv; inputs node: list; same code as g_32
python_13 = PythonScript(srflst=g_30, templst=g_29, boundcrv=g_33, bldcrv=g_32)  # -> srf_out, temp_out, totalArealst, totalTemplst, debug; inputs srflst: list, templst: list, bldcrv: list
# ---------- python_13: Python ----------
import rhinoscriptsyntax as rs
import Rhino as rc
import ghpythonlib as ghlib
import copy

ghenv.Component.Message = 'Bibil'

def check_bld_crv(pt):
    for i in xrange(len(bldcrv)):
        bld = bldcrv[i]
        IsInBld = rs.PointInPlanarClosedCurve(cpt,bld)
        if abs(IsInBld-1.)<0.1:
            return True
        
    return False

debug = []
srf_out, temp_out = [], []
totalTemplst,totalArealst = [], []

if True:
    
    boundcrv = rs.coercecurve(boundcrv)
        
    for i in xrange(len(srflst)):
        srf = srflst[i]
        temp = templst[i]
        
        IsInBld = False
        totalArea = 0
        
        srf = rs.coercebrep(srf)
        
        srflstsplit = ghlib.components.SurfaceSplit(srf,boundcrv)
        if srflstsplit and type(srflstsplit)!=type([]):
            srflstsplit = []#[srflstsplit]
        
        if srflstsplit and len(srflstsplit)> 0.1:
            for s in srflstsplit:
                arealst = ghlib.components.Area(s)
                cpt = arealst[1]
                totalArea += arealst[0]
                IsIn = rs.PointInPlanarClosedCurve(cpt,boundcrv)
                IsInBld = check_bld_crv(cpt)
                if IsInBld ==  True:
                    #debug.append(cpt)
                    temp = -100.0
                if abs(IsIn - 1.0) < 0.1:
                    #is inside
                    srf_out.append(s)
                    temp_out.append(temp)
                
        else:
            arealst = ghlib.components.Area(srf)
            cpt = arealst[1]
            totalArea += arealst[0]
            IsIn = rs.PointInPlanarClosedCurve(cpt,boundcrv)
            IsInBld = check_bld_crv(cpt)
            if IsInBld ==  True:
                temp = -100.0
                #debug.append(cpt)
            if abs(IsIn - 1.0) < 0.1:
                srf_out.append(srf)
                temp_out.append(temp)
        
        if IsInBld==False:
            totalArealst.append(totalArea)
            totalTemplst.append(temp)
            debug.append(srf)

#print srf_out
#print temp_out
# ---------- end python_13 ----------

# ---- group: grnd
sort_5 = SortList(Keys=python_13.temp_out)  # -> Keys, ValuesA
item_13 = ListItem(List=sort_5.Keys, Index=0, Wrap=True)
item_14 = ListItem(List=sort_5.Keys, Index="-1", Wrap=True)
panel_35 = Panel(item_14)
panel_36 = Panel(item_13)

# ----
sort_6 = SortList(Keys=flatten([item_13, item_14, item_9, item_10, item_11, item_12]))  # -> Keys, ValuesA
item_15 = ListItem(List=sort_6.Keys, Index=0, Wrap=True)
item_16 = ListItem(List=sort_6.Keys, Index="-1", Wrap=True)
panel_37 = Panel(item_16)
panel_38 = Panel(item_15)
geo_33 = Geometry(python_13.debug)
mesh_7 = Mesh(python_13.srf_out)
gradient_4 = Gradient(
    LowerLimit=data_12,
    UpperLimit=data_13,
    Parameter=python_13.temp_out,
    stops=[0: RGB(255, 0, 64), 0.25: RGB(245, 93, 0), 0.5: RGB(255, 255, 22), 0.75: RGB(93, 177, 249), 0.984: RGB(0, 44, 169), 1: RGB(255, 255, 255)])
demesh_3 = DeconstructMesh(Mesh=mesh_7)  # -> Vertices, Faces, Colours, Normals
conmesh_3 = ConstructMesh(Vertices=demesh_3.Vertices, Faces=demesh_3.Faces)
mcol_3 = MeshColours(Mesh=graft(conmesh_3), Colours=graft(gradient_4))
mesh_8 = Mesh(mcol_3)
pdecon = Deconstruct(Point=pt)  # -> XComponent, YComponent, ZComponent
move_4 = Move(Geometry=[mesh_5, mesh_6, mesh_8], Motion=Z)  # -> Geometry, Transform
wires_8 = BrepWireframe(Brep=bbox.Box, Density=-1)
pt_2 = ConstructPoint(XCoordinate=pdecon.XComponent, YCoordinate=pdecon.YComponent, ZCoordinate=Slider(524, range=0..1000))
pt_3 = ConstructPoint(XCoordinate=pdecon.XComponent, YCoordinate=pdecon.YComponent, ZCoordinate=Slider(77, range=0..1000))
python_14 = PythonScript(x=flatten(move_4.Geometry))  # -> a; inputs x: list
# ---------- python_14: Python ----------
from Rhino import RhinoApp

a = x[-1]

RhinoApp.Wait()
RhinoApp.Wait()
RhinoApp.Wait()
# ---------- end python_14 ----------
move_5 = Move(Geometry=wires_8, Motion=Z)  # -> Geometry, Transform
swatch_4 = ColourSwatch(SwatchColor=RGB(255, 0, 255))
ln = Line(StartPoint=pt_2, EndPoint=pt_3)

# ---- group: envelope_MAX
area_4 = Area(Geometry=g_28)  # -> Area, Centroid
area_5 = Area(Geometry=g_26)  # -> Area, Centroid
python_15 = PythonScript(srf=flatten([area_4.Area, area_5.Area]), tmp=flatten([g_23, g_25]))  # -> avgtemp; inputs srf: list, tmp: list
# ---------- python_15: Python ----------
if True:
    avgtemp_ = 0
    num = 0
    for s,t in zip(srf,tmp):
        avgtemp_ += t
        num += 1
    avgtemp = avgtemp_/num
# ---------- end python_15 ----------
panel_39 = Panel(python_15)

# ----
pt_4 = Point(Point(-12.67837996, 15.97046839, 0))
pt_5 = Point(Point(-205.6347904, -33.44289271, 0))
pt_6 = Point(Point(50.53374915, -204.0062611, 0))
pt_7 = Point(Point(-137.9979243, -274.8318814, 0))
dash_8 = DashPattern(Curve=ln, Pattern=Slider(7.7, range=0..10))  # -> Dashes, Gaps

# ---- group: GFA_MAX
volume = Volume(Geometry=g_14)  # -> Volume, Centroid
ma = MassAddition(Input=volume.Volume)  # -> Result, PartialResults
division = Division(A=ma.Result, B=Slider(3, range=0..10))
panel_40 = Panel(division)

# ---- group: ground_MAX
python_16 = PythonScript(srf=python_13.totalArealst, tmp=python_13.totalTemplst)  # -> avgtemp, grossarea; inputs srf: list, tmp: list
# ---------- python_16: Python ----------
import math

if True:
    avgtemp_ = 0
    num_ = 0
    grossarea_ = 0
    for s,t in zip(srf,tmp):
        #Check in range
        if t>=19 and t<=29:
            avgtemp_ += t 
            num_ += 1
            grossarea_ += s
    avgtemp = avgtemp_/num_
    grossarea = grossarea_
    print avgtemp
    print grossarea_
# ---------- end python_16 ----------
panel_41 = Panel(python_16.avgtemp)

# ----
python_17 = PythonScript(ground=python_16.avgtemp, groundarea=python_16.grossarea, envelope=python_15, gfa=division)  # -> outputs
# ---------- python_17: Python ----------
outputs = ""

outputs += "OUTPUTS" + "\n"
outputs += "GFA: " + str(round(gfa,2)) + "\n"
outputs += "Comfort Ground Temp (Avg): " + str(round(ground,4)) + "\n"
outputs += "Comfort Ground Area (Gross): " + str(round(groundarea,2)) + "\n"
outputs += "Envelope Temp: " + str(round(envelope,4)) + "\n"
# ---------- end python_17 ----------
python_18 = PythonScript(x=bbox.Box, refpt1=pt_4, refpt2=pt_5, refpt3=pt_6, refpt4=pt_7, c=python_12)  # -> a, dirc, ar, farsidept, debug
# ---------- python_18: Python ----------
import rhinoscriptsyntax as rs
import Rhino as rc
import scriptcontext as sc
ghenv.Component.Message = 'Bibil'
Grammar = sc.sticky['Grammar']

bbox = rs.BoundingBox(x,c)
G = Grammar()
minpts = []
maxpts = []
refindex1,refindex2,refindex3, refindex4 = 0, 0, 0, 0
mindist1,mindist2,mindist3, mindist4 = None, None, None, None
minnum = 0
for p in bbox:
    IsZero = G.is_near_zero(p[2])
    if IsZero:
        dist1 = rs.Distance(p,refpt1)
        dist2 = rs.Distance(p,refpt2)
        dist3 = rs.Distance(p,refpt3)
        dist4 = rs.Distance(p,refpt4)
        
        if dist1 < dist2 and dist1 < dist3 and dist1 < dist4:
            refindex1 = minnum
            mindist1 = dist1
        elif dist2 < dist1 and dist2 < dist3 and dist2 < dist4:
            refindex2 = minnum
            mindist2 = dist2
        elif dist3 < dist1 and dist3 < dist2 and dist3 < dist4:
            refindex3 = minnum
            mindist3 = dist4
        else:
            refindex4 = minnum
            mindist4 = dist4
        minpts.append(p)
        minnum += 1
    else:
        maxpts.append(p)

vec = minpts[refindex3] - minpts[refindex1]#direction along short axis
vec.Unitize()
#debug = minpts[refindex3]

a = minpts[refindex4] + vec*10 #direction to push
farsidept = minpts[refindex3] + vec*20 #for pt away from axis

dirc = minpts[refindex1] - minpts[refindex2]

ht = maxpts[0][2] - minpts[0][2]

shortaxis = rs.Distance(minpts[refindex4],minpts[refindex2])
ar = round(ht/shortaxis,2)
# ---------- end python_18 ----------
python_19 = PythonScript(
    x=data_14,
    y=podium_ht.arctype_str,
    z=python_11,
    u=podium_ht.setback_dim,
    v=python_10,
    ar=python_18.ar,
    outputs=python_17)  # -> a, c, b
# ---------- python_19: Python ----------
ghenv.Component.Message = 'Bibil'

L = [x,y,z,u,v]
M = ['dev_','type_','podht_','set_','step_']

strout = ""
for i,j in zip(L,M):
    strout += '---' + j + str(i).replace('.','dot')
    

a = strout

hudviz = ""
hudviz += "INPUTS" + "\n"
hudviz += "Development Iteration: " + str(x) + "\n"
hudviz += "Archetype: " + str(y) + "\n"
hudviz += "Podium Height: " + str(z) + "\n"
hudviz += "Setback: " + str(u) + "\n"
hudviz += "Stepback: " + str(v) + "\n"
hudviz += "\n" + "\n" #"- - -" + "\n"
hudviz += outputs

b = hudviz

c = "Canyon Aspect Ratio: " + str(ar) + "\n"
# ---------- end python_19 ----------
number_slider_27 = Slider(1, range=0..10)  # disabled
preview_12 = CustomPreview(Geometry=[move_5.Geometry, wires_8], Shader=swatch_4)
python_20 = PythonScript(gfa=division, ground_avg_temp=python_16.avgtemp, ground_gross_area=python_16.grossarea, envelope_avg_temp=python_15)  # -> scalar_value
# ---------- python_20: Python ----------
"""
Between 0 and 1 using xnormalized = (x – xmin)/( xmax - xmin).
Then add them up to get the Value Function.
"""
ghenv.Component.Message = 'Bibil'
def normalize(x,xmax,xmin):
    if xmin > x:
        x = xmin
        print 'low val'
    xnormalized = (x-xmin)/(xmax-xmin)
    return xnormalized

#Set constants
gfa_max,gfa_min = 690000.00,27100.00
grd_max,grd_min = 25.5, 23.5
grd_area_max,grd_area_min = 11000.00,2500.00
env_max,env_min = 25.0, 22.5

#check inputs
#print gfa
#print ground_avg_temp
#print ground_gross_area
#print envelope_avg_temp


#Get norms
gfa_norm = normalize(gfa,gfa_max,gfa_min)
grd_norm = normalize(ground_avg_temp,grd_max,grd_min)
grd_area_norm = normalize(ground_gross_area,grd_area_max,grd_area_min)
env_norm = normalize(envelope_avg_temp,env_max,env_min)

scalar_value = gfa_norm + 0.5*grd_norm + 0.5*grd_area_norm + env_norm
# ---------- end python_20 ----------
previewlw_8 = CustomPreviewLineweights(Geometry=dash_8.Dashes, Shader=swatch_4, Thickness=Slider(2, range=0..10))
move_6 = Move(Geometry=python_18.farsidept, Motion=Z)  # -> Geometry, Transform; disabled
pt_8 = ConstructPoint(XCoordinate=Slider(20, range=0..100), YCoordinate=Slider(0, range=0..100), ZCoordinate=0)
number_slider_28 = Slider(10, range=0..10)
northarrow = Ladybug_North(centerPt=move_6.Geometry, scale=number_slider_27)  # -> northSign; disabled; plug-in component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
move_7 = Move(Geometry=python_18.a, Motion=Z)  # -> Geometry, Transform
geo_34 = Geometry(python_18.dirc)
panel_42 = Panel(python_20)
align = AlignPlane(Plane=move_7.Geometry, Direction=geo_34)  # -> Plane, Angle
tag_5 = TextTag3D(Location=align.Plane, Text=python_19.c, Size=Slider(5, range=0..10), Colour=swatch_4, Justification=7)
texttoscreen = RenderTextToScreen(
    Text=python_19.b,
    Location=pt_8,
    Size=Slider(30, range=0..100),
    Color=ColourSwatch(SwatchColor=RGB(107, 107, 107)),
    m_scWithvp=False)
preview_13 = CustomPreview(Geometry=northarrow, Shader=swatch_4)  # disabled

# ---- group: dev
rec = DataRecorder(data_14, DataLimit=100000, RecordData=True)

# ---- group: arc
rec_2 = DataRecorder(podium_ht.arctype_str, DataLimit=100000, RecordData=True)

# ---- group: pht
rec_3 = DataRecorder(python_11, DataLimit=100000, RecordData=True)

# ---- group: setback
rec_4 = DataRecorder(python_10, DataLimit=100000, RecordData=True)

# ---- group: stepback
rec_5 = DataRecorder(python_10, DataLimit=100000, RecordData=True)

# ----
rec_6 = DataRecorder(python_16.avgtemp, DataLimit=100000, RecordData=True)
rec_7 = DataRecorder(python_16.grossarea, DataLimit=100000, RecordData=True)
rec_8 = DataRecorder(python_15, DataLimit=100000, RecordData=True)
rec_9 = DataRecorder(division, DataLimit=100000, RecordData=True)
rec_10 = DataRecorder(python_20, DataLimit=100000, RecordData=True)
python_21 = PythonScript(x="soln", y=python_19.a)  # -> a
# ---------- python_21: Python ----------
a = x+y

print a
# ---------- end python_21 ----------
data_15 = Data(python_14)
toggle_18 = BooleanToggle(False)
button = Button()
toggle_19 = BooleanToggle(False)
captureview = Ladybug_CaptureView(
    fileName=python_21,
    folder="C:\Users\user\Desktop\lb_fly",
    imageWidth=Slider(1200, range=0..10000),
    imageHeight=Slider(1600, range=0..10000),
    displayMode="aerial_04",
    transparBack=Toggle(True),
    capture=Toggle(False))  # -> imagePath; plug-in component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
excelwrite = ExcelWriteLEGACY(
    WriteToggle=toggle_19,
    WriteHeading=toggle_19,
    ClearSheet=toggle_18,
    Worksheet=1,
    ColumnStart=1,
    RowStart=1,
    ColumnHeadings=["Development", "Archetype", "Podium Height", "Setback", "Stepback"],
    Column1=rec,
    Column2=rec_2,
    Column3=rec_3,
    Column4=rec_4,
    Column5=rec_5)  # disabled
excelwrite_2 = ExcelWriteLEGACY(
    WriteToggle=toggle_19,
    WriteHeading=toggle_19,
    ClearSheet=toggle_18,
    Worksheet=1,
    ColumnStart=Slider(5, range=0..10),
    RowStart=1,
    ColumnHeadings=["GFA", "Ground Temp", "Ground Area", "Envelope Temp", "Scalar Value"],
    Column1=rec_9,
    Column2=rec_6,
    Column3=rec_7,
    Column4=rec_8,
    Column5=rec_10)  # disabled
panel_43 = Panel(captureview)
