# Grasshopper definition bibil_acadia_26_single_bld_viz_bem_viz.gh (Grasshopper 0.9.76)
# plug-ins: Python Interpreter, HDTReference

geo = Geometry()
geo_2 = Geometry()

list = ValueList({"dir", "file"}, selected="dir")

# ---- group: find directory
bibil = PythonScript(
    dir=["C:\\Users\\vasanthakumars\\Documents\\GitHub\\bibil\\src", "C:\\saeran\\master\\git\\bibil\\src"],
    type=list,
    run=Toggle(True))  # -> dir; inputs dir: list
# ---------- bibil: Python ----------
import os
import sys

ghenv.Component.Params.Output[0].Name = "null"
ghenv.Component.Params.Output[0].NickName = "null"

#sys.path.append("C:\Program Files\Rhinoceros 5.0 (64-bit)\System")

if run:
    confirm_dir = None
    for d in dir:
        try:
            if type == "file":
                file_ = open(d)
                file_.close()
            else:
                print os.listdir(d)
            confirm_dir = d
            break
        except Exception as e:
            #print str(e)
            continue
    if confirm_dir != None:
        ghenv.Component.Params.Output[0].Name = type
        ghenv.Component.Params.Output[0].NickName = type
        dir = confirm_dir
        file = confirm_dir
null = None
# ---------- end bibil ----------

# ---- group: abstract_bem
python_script = PythonScript(i=bibil)  # -> o
# ---------- python_script: Python ----------
import os

if i:
    o = os.path.join(str(i),"miru\\miru_abstract_bem.py")
# ---------- end python_script ----------
file = ReadFile(File=python_script, PerLineParse=False)

# ---- group: stepback_manual
python_script_2 = PythonScript(i=bibil)  # -> o
# ---------- python_script_2: Python ----------
import os

if i:
    o = os.path.join(str(i),"miru\\miru_stepback_manual.py")
# ---------- end python_script_2 ----------
file_2 = ReadFile(File=python_script_2, PerLineParse=False)

# ---- group: extract_canyon
python_script_3 = PythonScript(i=bibil)  # -> o
# ---------- python_script_3: Python ----------
import os

if i:
    o = os.path.join(str(i),"miru\\miru_extract_canyon.py")
# ---------- end python_script_3 ----------
file_3 = ReadFile(File=python_script_3, PerLineParse=False)

# ---- group: interpolate_vertical
python_script_4 = PythonScript(i=bibil)  # -> o
# ---------- python_script_4: Python ----------
import os

if i:
    o = os.path.join(str(i),"miru\\miru_interpolate_vertical.py")
# ---------- end python_script_4 ----------
file_4 = ReadFile(File=python_script_4, PerLineParse=False)

# ---- group: filter_nodes
python_script_5 = PythonScript(i=bibil)  # -> o
# ---------- python_script_5: Python ----------
import os

if i:
    o = os.path.join(str(i),"miru\\miru_filter_nodes.py")
# ---------- end python_script_5 ----------
file_5 = ReadFile(File=python_script_5, PerLineParse=False)

# ---- group: tree
python_script_6 = PythonScript(i=bibil)  # -> o
# ---------- python_script_6: Python ----------
import os

if i:
    o = os.path.join(str(i),"bibil\\bibil_tree.py")
# ---------- end python_script_6 ----------
file_6 = ReadFile(File=python_script_6, PerLineParse=False)
bibil_2 = PythonScript(Code=file_6)

# ---- group: grammar
python_script_7 = PythonScript(i=bibil)  # -> o
# ---------- python_script_7: Python ----------
import os

if i:
    o = os.path.join(str(i),"bibil\\bibil_grammar.py")
# ---------- end python_script_7 ----------
file_7 = ReadFile(File=python_script_7, PerLineParse=False)
bibil_3 = PythonScript(Code=file_7)

# ---- group: shape
python_script_8 = PythonScript(i=bibil)  # -> o
# ---------- python_script_8: Python ----------
import os

if i:
    o = os.path.join(str(i),"bibil\\bibil_shape.py")
#o = os.path.join(str(i),"research\\bibil_shape_shape_3d_2d.py")
# ---------- end python_script_8 ----------
file_8 = ReadFile(File=python_script_8, PerLineParse=False)
bibil_4 = PythonScript(Code=file_8)

# ---- group: bula
python_script_9 = PythonScript(i=bibil)  # -> o
# ---------- python_script_9: Python ----------
import os

if i:
    o = os.path.join(str(i),"bula\\bula_minimal.py")
# ---------- end python_script_9 ----------
file_9 = ReadFile(File=python_script_9, PerLineParse=False)
bibil_5 = PythonScript(Code=file_9)

# ---- group: UI
python_script_10 = PythonScript(i=bibil)  # -> o
# ---------- python_script_10: Python ----------
import os

if i:
    o = os.path.join(str(i),"bibil\\bibil_UI.py")
# ---------- end python_script_10 ----------
file_10 = ReadFile(File=python_script_10, PerLineParse=False)

# ---- group: SHAPENODE
bibil_6 = PythonScript(Code=file_10, Run=Toggle(True))  # -> Node_out, Node_dead, Debug

# ---- group: grammar_divide
python_script_11 = PythonScript(i=bibil)  # -> o
# ---------- python_script_11: Python ----------
import os

if i:
    o = os.path.join(str(i),"miru\\miru_divide.py")
# ---------- end python_script_11 ----------
file_11 = ReadFile(File=python_script_11, PerLineParse=False)

# ---- group: grammar_courtyard
python_script_12 = PythonScript(i=bibil)  # -> o
# ---------- python_script_12: Python ----------
import os

if i:
    o = os.path.join(str(i),"miru\\miru_court.py")
# ---------- end python_script_12 ----------
file_12 = ReadFile(File=python_script_12, PerLineParse=False)

# ---- group: grammar_tower
python_script_13 = PythonScript(i=bibil)  # -> o
# ---------- python_script_13: Python ----------
import os

if i:
    o = os.path.join(str(i),"miru\\miru_packing.py")
# ---------- end python_script_13 ----------
file_13 = ReadFile(File=python_script_13, PerLineParse=False)

# ---- group: stepback
python_script_14 = PythonScript(i=bibil)  # -> o
# ---------- python_script_14: Python ----------
import os

if i:
    o = os.path.join(str(i),"miru\\miru_stepback.py")
# ---------- end python_script_14 ----------
file_14 = ReadFile(File=python_script_14, PerLineParse=False)

# ---- group: grammar_height
python_script_15 = PythonScript(i=bibil)  # -> o
# ---------- python_script_15: Python ----------
import os

if i:
    o = os.path.join(str(i),"miru\\miru_height.py")
# ---------- end python_script_15 ----------
file_15 = ReadFile(File=python_script_15, PerLineParse=False)

# ---- group: grammar_analysis_pts
python_script_16 = PythonScript(i=bibil)  # -> o
# ---------- python_script_16: Python ----------
import os

if i:
    o = os.path.join(str(i),"miru\\miru_analysis.py")
# ---------- end python_script_16 ----------
file_16 = ReadFile(File=python_script_16, PerLineParse=False)

# ---- group: meta_tree
python_script_17 = PythonScript(i=bibil)  # -> o
# ---------- python_script_17: Python ----------
import os

if i:
    o = os.path.join(str(i),"miru\\miru_meta_tree.py")
# ---------- end python_script_17 ----------
file_17 = ReadFile(File=python_script_17, PerLineParse=False)

# ---- group: TREE RULES
miru = PythonScript(Code=file_17, Run=Toggle(False))

# ---- group: land_use
python_script_18 = PythonScript(i=bibil)  # -> o
# ---------- python_script_18: Python ----------
import os

if i:
    o = os.path.join(str(i),"miru\\miru_landuse.py")
# ---------- end python_script_18 ----------
file_18 = ReadFile(File=python_script_18, PerLineParse=False)

# ---- group: shape2height
python_script_19 = PythonScript(i=bibil)  # -> o
# ---------- python_script_19: Python ----------
import os

if i:
    o = os.path.join(str(i),"miru\\miru_shape2height.py")
# ---------- end python_script_19 ----------
file_19 = ReadFile(File=python_script_19, PerLineParse=False)

# ---- group: extract_slice
python_script_20 = PythonScript(i=bibil)  # -> o
# ---------- python_script_20: Python ----------
import os

if i:
    o = os.path.join(str(i),"miru\\miru_extract_slice.py")
# ---------- end python_script_20 ----------
file_20 = ReadFile(File=python_script_20, PerLineParse=False)

# ---- group: EXTRACT_SLICE
miru_2 = PythonScript(Code=file_20, Run=Toggle(False))

# ---- group: PERIMETER
miru_3 = PythonScript(Code=file_12, Width=Slider(20, range=0..100), Cut_width=Slider(0, range=0..100), Court_ref="0", Run=Toggle(False))

# ----
list_2 = ValueList({"divide by depth": "subdivide_depth", "divide by same depth": "subdivide_depth_same", "divide by dim": "subdivide_dim"}, selected="divide by same depth")
list_3 = ValueList({"YZ": "NS", "XZ": "EW", "XY": "Z"}, selected="XZ")

# ---- group: DIVIDE
miru_4 = PythonScript(
    Code=file_11,
    Divide_num=Slider(2, range=0..10),
    Divide_cut=Slider(0, range=0..100),
    Divide_type=list_2,
    Divide_ratio=Slider(0.5, range=0..1),
    Axis=list_3,
    Run=Toggle(False))

# ---- group: HEIGHT
miru_5 = PythonScript(Code=file_15, Height=Slider(16.5, range=0..100), Run=Toggle(True))

# ----
geo_3 = Geometry([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])
geo_4 = Geometry([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])
geo_5 = Geometry([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])
geo_6 = Geometry([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])
geo_7 = Geometry([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])
geo_8 = Geometry([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])

# ---- group: SETBACK
miru_6 = PythonScript(Code=file_14, Height_stepback="22.5:6.0", Run=Toggle(False))

# ----
bibil_7 = PythonScript(Code=file_10, Node_in=flatten(geo_3), Label_="density_05", Run=Toggle(True))  # -> Node_out, Debug
bibil_8 = PythonScript(Code=file_10, Node_in=flatten(geo_4), Label_="density_04", Run=Toggle(True))  # -> Node_out, Debug
bibil_9 = PythonScript(Code=file_10, Node_in=flatten(geo_8), Label_="density_03", Run=Toggle(True))  # -> Node_out, Debug
bibil_10 = PythonScript(Code=file_10, Node_in=flatten(geo_5), Label_="density_02", Run=Toggle(True))  # -> Node_out, Debug
bibil_11 = PythonScript(Code=file_10, Node_in=flatten(geo_6), Label_="density_01", Run=Toggle(True))  # -> Node_out, Debug
bibil_12 = PythonScript(Code=file_10, Node_in=flatten(geo_7), Label_="density_0", Run=Toggle(True))  # -> Node_out, Debug

# ---- group: PACKING
separatedata = Ladybug_SeparateData(Code=file_13, X_keep_omit="27.0,25.0", Y_keep_omit="27.0,25.0", Seperation_ref="-1", Run=Toggle(False))

# ----
geo_9 = Geometry(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)
geo_10 = Geometry(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)

# ---- group: PODIUM_PARAMETER
number_slider = Slider(5, range=0..7)
panel = Panel("[9,12,15,18,21,24,27,30]")

# ---- group: SETBACK_PARAMETER
panel_2 = Panel("[0.0,1.5,3.0,4.5,6.0]")
number_slider_2 = Slider(2, range=0..4)

# ---- group: ARCHETYPE_PARAMETER
panel_3 = Panel("['tower_in_park','tower_on_podium','slab_in_park','slab_on_podium']")
number_slider_3 = Slider(3, range=0..3)

# ---- group: DENSITY_PARAMETER
panel_4 = Panel("[0,1,2,3,4,5]")
number_slider_4 = Slider(4, range=0..5)

# ---- group: ABSTRACT_BEM
miru_7 = PythonScript(Code=file, Bem_tol=Slider(39, range=0..100), Bem_center=geo_10, Run=Toggle(True))

# ---- group: EXTRACT_CANYON
miru_8 = PythonScript(Code=file_3, Canyon_tol=Slider(30, range=0..100), Canyon_center=geo_9, Run=Toggle(True))

# ----
data = Data([bibil_7.Node_out, bibil_8.Node_out, bibil_9.Node_out, bibil_10.Node_out, bibil_11.Node_out, bibil_12.Node_out])
fly = Ladybug_fly(inputSliders=[number_slider_4, number_slider_3], fly=Toggle(False))  # -> Vviiiiiiiiiizzz; plug-in component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
number_slider_5 = Slider(0, range=0..31)
number_slider_6 = Slider(0, range=0..31)
podium_ht = PythonScript(
    density_set=panel_4,
    density_par=number_slider_4,
    arctype_set=panel_3,
    arctype_par=number_slider_3,
    podium_set=panel,
    podium_par=number_slider,
    setback_set=panel_2,
    setback_par=number_slider_2,
    stepback_set="[0.0,1.5,3.0,4.5,6.0,7.5,9.0]",
    stepback_par=Slider(3, range=0..6),
    node_in=data,
    run=Toggle(True))  # -> node_out, develop_step, arctype_str, podium_ht, setback_dim, stepback_dim; inputs density_par: Int32, arctype_par: Int32, podium_par: Int32, setback_par: Int32, stepback_par: Int32, node_in: list, listoverride: Int32
# ---------- podium_ht: Python ----------
import Grasshopper
import Grasshopper.Kernel as gh
import scriptcontext as sc
from Rhino import RhinoApp

ghenv.Component.Message = 'Recompute_Soln'

Bula = sc.sticky['Bula']
Grammar = sc.sticky['Grammar']

B = Bula()
G = Grammar()

if run and node_in:
    
    
    # Bucket according to density label
    bucket_dict = {"apply2list":True, "keys2bucket":["label"],\
                    "fx2bucket":"lambda n:n.grammar.type['label']"}
                    
    bucketed_lst = G.bucket_shape(node_in,bucket_dict)
    nestedbylabel = bucketed_lst[0]
    nestedbylabel.sort(key=lambda tple:tple[0])
    node_in = map(lambda l:l[1],nestedbylabel)
    
    if type(listoverride)==type(1):
        #--- OVERIDE ---#
        #Override Constants
        TIP = 'tower_in_park'
        TOP = 'tower_on_podium'
        SIP = 'slab_in_park'
        SOP = 'slab_on_podium'
        
        a1 = [6,0,TIP,7.5,6]
        a2 = [1.5,0,TIP,13.5,1]
        a3 = [1.5,0,SOP,31.5,6]
        a4 = [1.5,4.5,TOP,7.5,2]
        a5 = [0,1.5,TIP,13.5,5]
        a6 = [6,6,SOP,7.5,5]
        a7 = [4.5,0,TOP,7.5,5]
        a8 = [4.5,4.5,TIP,31.5,5]
        a9 = [0,4.5,SOP,7.5,6]
        a10 = [6,1.5,TOP,31.5,1]
        a11 = [1.5,4.5,TOP,25.5,1]
        a12 = [1.5,1.5,SOP,25.5,5]
        a13 = [0,4.5,SIP,13.5,2]
        a14 = [4.5,1.5,SOP,31.5,2]
        a15 = [4.5,4.5,TIP,25.5,6]
        a16 = [0,0,SIP,31.5,1]
        a17 = [6,4.5,SIP,31.5,5]
        a18 = [6,0,TOP,13.5,3]
        a19 = [4.5,0,SIP,25.5,2]
        a20 = [0,6,TOP,31.5,6]
        a21 = [6,6,TIP,25.5,2]
        a22 = [6,1.5,SIP,25.5,6]
        a23 = [4.5,6,SIP,7.5,1]
        a24 = [0,6,TOP,25.5,5]
        a25 = [1.5,6,TIP,31.5,2]
        a26 = [4.5,6,SOP,13.5,1]
        a27 = [6,4.5,SOP,13.5,1]
        a28 = [0,0,SOP,25.5,3]
        a29 = [0,1.5,TIP,7.5,1]
        a30 = [1.5,1.5,SIP,7.5,4]
        a31 = [4.5,1.5,TOP,13.5,6]
        a32 = [1.5,6,SIP,13.5,6]
        
        LP = [a1,a2,a3,a4,a5,a6,a7,a8,a9,a10,a11,a12,a13,a14,a15,a16,a17,a18,a19,a20,a21,a22,a23,a24,a25,a26,a27,a28,a29,a30,a31,a32]
        
        #Setback,Stepback,Archetype,PodiumHt,DevelopmentStep
        
        p = LP[listoverride]
        print p
        setback_dim = p[0]
        stepback_dim = p[1] + setback_dim
        arctype_str = p[2]
        podium_ht = p[3] - 1.5
        develop_step = p[4]
        node_out =  node_in[p[4]-1]
        
        #print '[',setback_dim, stepback_dim, arctype_str, podium_ht, p[4],']'
        #print node_out[0].grammar.type['label']
        #RhinoApp.Wait()
    
    else:
        #Density Parameter
        density_set = eval(density_set)
        density_index = density_set[density_par] 
        node_out = node_in[density_index]
        
        #Arctype Parameters
        arctype_set = eval(arctype_set)
        arctype_str = arctype_set[arctype_par]
        
        #Podium Parameters
        podium_set = eval(podium_set)
        podium_ht = podium_set[podium_par]
        
        #Setback Parameters
        setback_set = eval(setback_set)
        setback_dim = setback_set[setback_par]
        
        #Stepback Parameters
        stepback_set = eval(stepback_set)
        stepback_dim = stepback_set[stepback_par]
        stepback_dim += setback_dim
# ---------- end podium_ht ----------
g = PythonScript(node=podium_ht.node_out)  # -> geom; inputs node: list
# ---------- g: Python ----------
ghenv.Component.Message = 'Recompute_Soln'

node = filter(lambda n: n!=None,node)
if node and node != []:
    geom = []
    for n in node:
        if n.shape.z_dist < 1.2:
            geom.append(n.shape.bottom_crv)
        else:
            geom.append(n.shape.geom)
    print geom
# ---------- end g ----------
panel_5 = Panel(podium_ht.develop_step)
panel_6 = Panel(podium_ht.stepback_dim)
panel_7 = Panel(podium_ht.arctype_str)
panel_8 = Panel(podium_ht.podium_ht)
panel_9 = Panel(podium_ht.setback_dim)
geo_11 = Geometry(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)
geo_12 = Geometry(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)
number_slider_7 = Slider(1.01, range=0..10)  # disabled
area = Area(Geometry=geo_11)  # -> Area, Centroid; disabled
area_2 = Area(Geometry=geo_12)  # -> Area, Centroid; disabled
toggle = BooleanToggle(False)
g_2 = PythonScript(node=podium_ht.node_out)  # -> crv; inputs node: list
# ---------- g_2: Python ----------
ghenv.Component.Message = 'Recompute_Soln'

node = filter(lambda n: n!=None,node)
if node and node != []:
    crv = []
    for n in node:
        crv.append(n.shape.bottom_crv)
    #print geom
# ---------- end g_2 ----------
data_2 = Data(podium_ht.podium_ht)
data_3 = Data(podium_ht.stepback_dim)
data_4 = Data(podium_ht.setback_dim)

# ---- group: ONLY CONNECT TO ANIMATING SLIDER
data_5 = Data(Slider(11, range=0..31))

# ----
dash = DashPattern(Curve=g_2, Pattern=Slider(2, range=0..10))  # -> Dashes, Gaps
scale = Scale(Geometry=geo_11, Center=area.Centroid, Factor=number_slider_7)  # -> Geometry, Transform; disabled
scale_2 = Scale(Geometry=geo_12, Center=area_2.Centroid, Factor=number_slider_7)  # -> Geometry, Transform; disabled
preview = CustomPreview(Geometry=dash.Dashes, Shader=ColourSwatch(SwatchColor=RGB(0, 0, 0)))
resetsol = PythonScript(reset=data_5)  # -> o; disabled
# ---------- resetsol: Python ----------
"""----------------
Miru Recompute Solution
----------------""" 

import Grasshopper
import Grasshopper.Kernel as gh
import scriptcontext as sc
ghenv.Component.Message = 'Recompute_Soln'



## This is a refence right now, must copy and paste 
## into ghcomponent to work

o = False

if type(reset)==type(1.1):#!=None and reset!=False:
    document = ghenv.Component.OnPingDocument()
    
    objects = list(document.Objects)
    for obj in objects:
        #get the ghpython components
        if type(obj)!= type(ghenv.Component):
            pass
        else:
            chk_lbug = obj.Name!=None and "Ladybug" in obj.Name
            chk_hbug = obj.Name!=None and "Honeybee" in obj.Name
            
            chk_self = obj.Message!=None and "Recompute_Soln" in obj.Message
            chk_bibil = obj.Message!=None and "Bibil" in obj.Message
            if chk_lbug or chk_self or chk_hbug:
                pass
            elif chk_bibil:
                obj.ExpireSolution(True)
                
    o = True
# ---------- end resetsol ----------
python = PythonScript(
    arctype_str=podium_ht.arctype_str,
    slab_short="15.0,10.0",
    slab_long="38,10.0",
    tower_short="24.0,12.0",
    tower_long="24.0,12.0",
    run=Toggle(True))  # -> park, podium, dim_short, dim_long; inputs slab_short: list, tower_short: list
# ---------- python: Python ----------
park,podium = False,False
dim_short,dim_long = slab_short,slab_long

if arctype_str and run:
    arc_lst = arctype_str.split('_')
    #tower in park
    if 'tower' in arc_lst and 'park' in arc_lst:
        park = True
        dim_short = tower_short
        dim_long = tower_long
    #tower in podium
    elif 'tower' in arc_lst and 'podium' in arc_lst:
        podium = True
        dim_short = tower_short
        dim_long = tower_long
    #slab in park
    elif 'slab' in arc_lst and 'park' in arc_lst:
        park = True
        dim_short = slab_short
        dim_long = slab_long
    #slab in podium
    else:#if 'slab' in arc_lst and 'podium' in arc_lst:
        podium = True
        dim_short = slab_short
        dim_long = slab_long
    
    print arctype_str
    print park
    print podium
    print dim_short
    print dim_long
# ---------- end python ----------

# ---- group: grnd@0
python_2 = PythonScript(crv_in=[geo_12, geo_11])  # -> crv_out
# ---------- python_2: Python ----------
import rhinoscriptsyntax as rs
import Rhino as rc

curve = rs.coercecurve(crv_in)
rc_, polyline = curve.TryGetPolyline()
if rc_: 
    points = map(lambda pt:pt,polyline)
    for pt in points:
        pt.Z = 0.0
    curve = rc.Geometry.Curve.CreateControlPointCurve(points,1)
crv_out = curve
# ---------- end python_2 ----------

# ----
panel_10 = Panel(resetsol)
g_3 = PythonScript(node=podium_ht.node_out, run=Toggle(False))  # -> node_out; inputs node: list
# ---------- g_3: Python ----------
node_out = None
if run==True:
    node_out = node
# ---------- end g_3 ----------
bool = Boolean(python.park)
bool_2 = Boolean(python.podium)
data_6 = Data(python.dim_short)
data_7 = Data(python.dim_long)

# ---- group: ROOT
# ROOT
bibil_13 = PythonScript(Code=file_10, Node_in=flatten(python_2), Label_="Root", Run=Toggle(True))  # -> Node_out, Debug

# ----
geo_13 = Geometry(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)
geo_14 = Geometry([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])
g_4 = PythonScript(node=bibil_13.Node_out)  # -> geom; inputs node: list
# ---------- g_4: Python ----------
node = filter(lambda n: n!=None,node)
if node and node != []:
    geom = []
    for n in node:
        if n.shape.UIgeom != None:
            geom.append(n.shape.UIgeom)
        else:
            geom.append(n.shape.geom)
# ---------- end g_4 ----------

# ---- group: TREE RULES
miru_9 = PythonScript(Code=file_17, Node=bibil_13.Node_out, Run=Toggle(True))

# ----
swatch = ColourSwatch(SwatchColor=RGB(255, 255, 255))

geo_15 = Geometry()
geo_16 = Geometry()

geo_17 = Geometry([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])
previewlw = CustomPreviewLineweights(Geometry=geo_13, Shader=swatch, Thickness=Slider(5, range=0..10))
previewlw_2 = CustomPreviewLineweights(Geometry=geo_14, Shader=swatch, Thickness=Slider(2, range=0..10))
number_slider_8 = Slider(5, range=0..10)

# ---- group: SHAPENODE
bibil_14 = PythonScript(Code=file_10, Rule_in=flatten(miru_9), Node_in=flatten(geo_17), Label_="PerimeterBlock", Run=Toggle(True))  # -> Node_out, Debug

# ----
number_slider_9 = Slider(2.5, range=0..10)
# BLOCK
number_slider_10 = Slider(30, range=0..100)

# ---- group: STEPBACK_PARAMETER
panel_11 = Panel("[0.0,1.5,3.0,4.5,6.0,7.5,9.0]")
number_slider_11 = Slider(3, range=0..6)

# ---- group: DENSITY_PARAMETER
number_slider_12 = Slider(4, range=0..5)
panel_12 = Panel("[0,1,2,3,4,5]")

# ---- group: ARCHETYPE_PARAMETER
number_slider_13 = Slider(3, range=0..3)
panel_13 = Panel("['tower_in_park','tower_on_podium','slab_in_park','slab_on_podium']")

# ---- group: PODIUM_PARAMETER
panel_14 = Panel("[9,12,15,18,21,24,27,30]")
number_slider_14 = Slider(5, range=0..7)

# ---- group: SETBACK_PARAMETER
panel_15 = Panel("[0.0,1.5,3.0,4.5,6.0]")
number_slider_15 = Slider(2, range=0..4)

# ----
g_5 = PythonScript(node=bibil_14.Node_out)  # -> geom; inputs node: list; same code as g_4

# ---- group: SETBACK
miru_10 = PythonScript(
    Code=file_2,
    Height_dim=Slider(6, range=0..10),
    Stepback_dim=data_3,
    Stepback_ref=geo_13,
    Stepback_tol=Slider(15, range=0..100),
    Run=Toggle(True))

miru_11 = PythonScript(
    Code=file_2,
    Height_dim=Slider(9, range=0..10),
    Stepback_dim=data_3,
    Stepback_ref=geo_14,
    Stepback_tol=Slider(15, range=0..100),
    Run=Toggle(True))

miru_12 = PythonScript(Code=file_2, Height_dim=Slider(0, range=0..100), Stepback_dim=data_4, Run=Toggle(True))

# ---- group: HEIGHT
miru_13 = PythonScript(Code=file_15, Height=data_2, Run=Toggle(True))

# ----
data_8 = Data([null x98])
podium_ht_2 = PythonScript(
    density_set=panel_12,
    density_par=number_slider_12,
    arctype_set=panel_13,
    arctype_par=number_slider_13,
    podium_set=panel_14,
    podium_par=number_slider_14,
    setback_set=panel_15,
    setback_par=number_slider_15,
    stepback_set=panel_11,
    stepback_par=number_slider_11,
    node_in=data_8,
    run=Toggle(True))  # -> node_out, develop_step, arctype_str, podium_ht, setback_dim, stepback_dim; inputs density_par: Int32, arctype_par: Int32, podium_par: Int32, setback_par: Int32, stepback_par: Int32, node_in: list, listoverride: Int32
# ---------- podium_ht_2: Python ----------
import Grasshopper
import Grasshopper.Kernel as gh
import scriptcontext as sc
from Rhino import RhinoApp

ghenv.Component.Message = 'Recompute_Soln'

Bula = sc.sticky['Bula']
Grammar = sc.sticky['Grammar']

B = Bula()
G = Grammar()

if run and node_in:
    
    
    # Bucket according to density label
    bucket_dict = {"apply2list":True, "keys2bucket":["label"],\
                    "fx2bucket":"lambda n:n.grammar.type['label']"}
                    
    bucketed_lst = G.bucket_shape(node_in,bucket_dict)
    nestedbylabel = bucketed_lst[0]
    nestedbylabel.sort(key=lambda tple:tple[0])
    node_in = map(lambda l:l[1],nestedbylabel)
    
    if type(listoverride)==type(1):
        #--- OVERIDE ---#
        #Override Constants
        TIP = 'tower_in_park'
        TOP = 'tower_on_podium'
        SIP = 'slab_in_park'
        SOP = 'slab_on_podium'
        
        a1 = [6,0,TIP,7.5,6]
        a2 = [1.5,0,TIP,13.5,1]
        a3 = [1.5,0,SOP,31.5,6]
        a4 = [1.5,4.5,TOP,7.5,2]
        a5 = [0,1.5,TIP,13.5,5]
        a6 = [6,6,SOP,7.5,5]
        a7 = [4.5,0,TOP,7.5,5]
        a8 = [4.5,4.5,TIP,31.5,5]
        a9 = [0,4.5,SOP,7.5,6]
        a10 = [6,1.5,TOP,31.5,1]
        a11 = [1.5,4.5,TOP,25.5,1]
        a12 = [1.5,1.5,SOP,25.5,5]
        a13 = [0,4.5,SIP,13.5,2]
        a14 = [4.5,1.5,SOP,31.5,2]
        a15 = [4.5,4.5,TIP,25.5,6]
        a16 = [0,0,SIP,31.5,1]
        a17 = [6,4.5,SIP,31.5,5]
        a18 = [6,0,TOP,13.5,3]
        a19 = [4.5,0,SIP,25.5,2]
        a20 = [0,6,TOP,31.5,6]
        a21 = [6,6,TIP,25.5,2]
        a22 = [6,1.5,SIP,25.5,6]
        a23 = [4.5,6,SIP,7.5,1]
        a24 = [0,6,TOP,25.5,5]
        a25 = [1.5,6,TIP,31.5,2]
        a26 = [4.5,6,SOP,13.5,1]
        a27 = [6,4.5,SOP,13.5,1]
        a28 = [0,0,SOP,25.5,3]
        a29 = [0,1.5,TIP,7.5,1]
        a30 = [1.5,1.5,SIP,7.5,4]
        a31 = [4.5,1.5,TOP,13.5,6]
        a32 = [1.5,6,SIP,13.5,6]
        
        LP = [a1,a2,a3,a4,a5,a6,a7,a8,a9,a10,a11,a12,a13,a14,a15,a16,a17,a18,a19,a20,a21,a22,a23,a24,a25,a26,a27,a28,a29,a30,a31,a32]
        
        #Setback,Stepback,Archetype,PodiumHt,DevelopmentStep
        
        p = LP[listoverride]
        print p
        setback_dim = p[0]
        stepback_dim = p[1] + setback_dim
        arctype_str = p[2]
        podium_ht = p[3] - 1.5
        develop_step = p[4]
        node_out =  node_in[p[4]-1]
        
        #print '[',setback_dim, stepback_dim, arctype_str, podium_ht, p[4],']'
        #print node_out[0].grammar.type['label']
        #RhinoApp.Wait()
    
    else:
        #Density Parameter
        density_set = eval(density_set)
        density_index = density_set[density_par] 
        node_out = node_in[density_index]
        
        #Arctype Parameters
        arctype_set = eval(arctype_set)
        arctype_str = arctype_set[arctype_par]
        
        #Podium Parameters
        podium_set = eval(podium_set)
        podium_ht = podium_set[podium_par]
        
        #Setback Parameters
        setback_set = eval(setback_set)
        setback_dim = setback_set[setback_par]
        
        #Stepback Parameters
        stepback_set = eval(stepback_set)
        stepback_dim = stepback_set[stepback_par]
        stepback_dim += setback_dim
        
        develop_step = "4"
# ---------- end podium_ht_2 ----------
fly_2 = Ladybug_fly(
    inputSliders=[number_slider_12, number_slider_13, number_slider_14, number_slider_11, number_slider_15],
    fly=Toggle(False))  # -> Vviiiiiiiiiizzz; plug-in component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
g_6 = PythonScript(node=podium_ht_2.node_out)  # -> geom; inputs node: list; same code as g
panel_16 = Panel(podium_ht_2.develop_step)
panel_17 = Panel(podium_ht_2.arctype_str)
panel_18 = Panel(podium_ht_2.podium_ht)
panel_19 = Panel(podium_ht_2.setback_dim)
panel_20 = Panel(podium_ht_2.stepback_dim)

# ---- group: SHAPENODE
bibil_15 = PythonScript(
    Code=file_10,
    Rule_in=flatten([miru_13, miru_10, miru_11, miru_12]),
    Node_in=flatten(bibil_14.Node_out),
    Label_="MidRes",
    Run=Toggle(True))  # -> Node_out, Debug

# ----
# COURT
number_slider_16 = Slider(33.5, range=0..100)

# ---- group: PERIMETER
miru_14 = PythonScript(Code=file_12, Width=number_slider_16, Court_ref="0", Run=Toggle(True))

# ----
geo_18 = Geometry(bibil_15.Debug)
g_7 = PythonScript(node=bibil_15.Node_out)  # -> geom; inputs node: list
# ---------- g_7: Python ----------
node = filter(lambda n: n!=None,node)
if node and node != []:
    geom = []
    for n in node:
        if n.shape.z_dist < 1.2:
            geom.append(n.shape.bottom_crv)
        else:
            geom.append(n.shape.geom)
    print geom
# ---------- end g_7 ----------
g_8 = PythonScript(node=bibil_15.Node_out)  # -> street; inputs node: list
# ---------- g_8: Python ----------
if node and node != [None]:
    street = []
    for n in node:
        foo = lambda n: n.grammar.type.has_key('street_tolerance_curve')
        n = n.backtrack_tree(foo,accumulate=False)
        if n:
            srf_data = n.grammar.type['street_tolerance_curve']
            print srf_data
            print '--'
            street.extend(srf_data)
    print street
# ---------- end g_8 ----------

# ---- group: SHAPENODE
bibil_16 = PythonScript(Code=file_10, Rule_in=flatten(miru_14), Node_in=flatten(bibil_15.Node_out), Run=Toggle(True))  # -> Node_out, Debug

# ----
python_3 = PythonScript()  # -> a; inputs x: list
# ---------- python_3: Python ----------
import rhinoscriptsyntax as rs
import scriptcontext as sc

#Shape = sc.sticky['Shape']
#S = Shape()

L = []
x = filter(lambda n: n!=None,x)
if x:
    for i in x:
        cpt = rs.CurveAreaCentroid(i)[0]
        if cpt[2] > 0.0:
            obj = rs.MoveObject(i,[0,0,cpt[2]*-1])
            L.append(obj)
        else:
            L.append(i)
a = L
# ---------- end python_3 ----------
g_9 = PythonScript()  # -> street; inputs node: list
# ---------- g_9: Python ----------
node = filter(lambda n: n!=None,node)
if node and node != []:
    street = []
    for n in node:
        loc = n.backtrack_tree(lambda n: n.grammar.type.has_key('street_tolerance_curve'),accumulate=True)
        street.extend(map(lambda n:n.grammar.type['street_tolerance_curve'],loc))
    if street:
        street = reduce(lambda x,y:x+y,street)
    print street
# ---------- end g_9 ----------
geo_19 = Geometry(bibil_16.Debug)
g_10 = PythonScript(node=bibil_16.Node_out)  # -> geom; inputs node: list
# ---------- g_10: Python ----------
node = filter(lambda n: n!=None,node)
if node and node != []:
    geom = []
    for n in node:
        geom.append(n.shape.geom)
    print geom
# ---------- end g_10 ----------
dash_2 = DashPattern(Curve=python_3, Pattern=Slider(1, range=0..10))  # -> Dashes, Gaps
dash_3 = DashPattern(Curve=g_9, Pattern=Slider(2, range=0..10))  # -> Dashes, Gaps
preview_2 = CustomPreview(Geometry=dash_3.Dashes, Shader=ColourSwatch(SwatchColor=RGB(255, 255, 255)))
previewlw_3 = CustomPreviewLineweights(Geometry=dash_2.Dashes, Shader=ColourSwatch(SwatchColor=RGB(0, 255, 255)), Thickness=Slider(1, range=0..10))
python_4 = PythonScript(node=bibil_16.Node_out, bool=bool_2)  # -> node_out
# ---------- python_4: Python ----------
if bool:
    node_out = node
else:
    node_out = None
# ---------- end python_4 ----------
# W_PODIUM
toggle_2 = BooleanToggle(True)
# TOWERS
toggle_3 = BooleanToggle(True)
# IN_PARK
# TOWERS
g_11 = PythonScript(node=python_4)  # -> geom; inputs node: list; same code as g_10

# ---- group: PACKING
separatedata_2 = Ladybug_SeparateData(Code=file_13, Short_keep_omit=data_6, Long_keep_omit=data_7, Run=Toggle(True))

separatedata_3 = Ladybug_SeparateData(Code=file_13, Short_keep_omit=data_6, Long_keep_omit=data_7, Run=Toggle(True))

# ---- group: EXTRACT_SLICE
miru_15 = PythonScript(Code=file_20, Run=toggle_3)

# ---- group: HEIGHT
miru_16 = PythonScript(Code=file_15, Height_ref="PerimeterBlock", Randomize="-3.0>3.0", Run=Toggle(True))

# ---- group: EXTRACT_SLICE
miru_17 = PythonScript(Code=file_20, Slice_height=Slider(0, range=0..100), Run=Toggle(True))

# ---- group: HEIGHT
miru_18 = PythonScript(Code=file_15, Height_ref="PerimeterBlock", Randomize="-3.0>3.0", Run=toggle_2)

# ---- group: SHAPENODE
bibil_17 = PythonScript(
    Code=file_10,
    Rule_in=flatten([miru_17, separatedata_3, miru_18]),
    Node_in=flatten(bibil_16.Node_out),
    Label_="HiResTower2",
    Run=bool)  # -> Node_out, Node_dead, Debug

bibil_18 = PythonScript(
    Code=file_10,
    Rule_in=flatten([miru_15, separatedata_2, miru_16]),
    Node_in=flatten(bibil_16.Node_out),
    Label_="HiResTower",
    Run=bool_2)  # -> Node_out, Node_dead, Debug

# ----
g_12 = PythonScript(node=bibil_18.Node_out)  # -> geom; inputs node: list
# ---------- g_12: Python ----------
node = filter(lambda n: n!=None,node)
if node and node != []:
    geom = []
    for n in node:
        geom.append(n.shape.geom)
# ---------- end g_12 ----------

# ---- group: backtrack
g_13 = PythonScript(node=bibil_17.Node_dead)  # -> node_out; inputs node: list
# ---------- g_13: Python ----------
node = filter(lambda n: n!=None,node)
if node and node != []:
    node_out = []
    for n in node:
        foo = lambda n: n.grammar.type['label']=='HiResTower2'
        n = n.backtrack_tree(foo,accumulate=False)
        n.grammar.type['freeze'] = False
        n.shape.op_extrude(9)
        node_out.append(n)
# ---------- end g_13 ----------

# ----
g_14 = PythonScript(node=bibil_17.Node_out)  # -> geom; inputs node: list; same code as g_12
number_slider_17 = Slider(7, range=0..10)

# ---- group: SETBACK
miru_19 = PythonScript(Code=file_2, Height_dim=Slider(6, range=0..10), Stepback_dim=Slider(3.5, range=0..10), Run=Toggle(True))

miru_20 = PythonScript(Code=file_2, Height_dim=Slider(0, range=0..10), Stepback_dim=Slider(2.5, range=0..10), Run=Toggle(True))

# ----
data_9 = Data([g_11, g_12])

# ---- group: FILTER_NODES
miru_21 = PythonScript(Code=file_5, Dim4long=number_slider_17, Dim4short=number_slider_17, Run=Toggle(True))

# ---- group: filternull
python_5 = PythonScript(x=[data_9, g_14])  # -> a; inputs x: list
# ---------- python_5: Python ----------
a = filter(lambda n:n!=None,x)
# ---------- end python_5 ----------

# ---- group: SHAPENODE
bibil_19 = PythonScript(Code=file_10, Rule_in=flatten([miru_20, miru_19]), Node_in=flatten(g_13), Run=Toggle(True))  # -> Node_out, Node_dead, Debug

# ----
data_10 = Data([bibil_17.Node_out, bibil_18.Node_out, g_11, bibil_19.Node_out])

# ---- group: SHAPENODE
bibil_20 = PythonScript(Code=file_10, Rule_in=flatten(miru_21), Node_in=flatten(data_10), Run=Toggle(True))  # -> Node_out, Debug

# ----
geo_20 = Geometry(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)

# ---- group: full volumes
g_15 = PythonScript(node=bibil_20.Node_out)  # -> geom; inputs node: list
# ---------- g_15: Python ----------
node = filter(lambda n: n!=None,node)
if node and node != []:
    geom = []
    for n in node:
        if n.shape.geom:
            geom.append(n.shape.geom)
    #print geom
# ---------- end g_15 ----------

# ----
g_16 = PythonScript(node=bibil_19.Node_out)  # -> geom; inputs node: list; same code as g_12
sunion = SolidUnion(Breps=g_15)
fmerge = MergeFaces(Brep=sunion)  # -> Breps, Before, After

# ---- group: ABSTRACT_BEM
miru_22 = PythonScript(Code=file, Bem_tol=Slider(39, range=0..100), Bem_center=geo_20, Run=Toggle(True))

# ----
wires = BrepWireframe(Brep=fmerge.Breps, Density=-1)
swatch_2 = ColourSwatch(SwatchColor=RGB(0, 0, 0))

# ---- group: SHAPENODE
bibil_21 = PythonScript(Code=file_10, Rule_in=flatten(miru_22), Node_in=flatten(bibil_20.Node_out), Run=Toggle(True))  # -> Node_out, Node_dead, Debug

# ----
previewlw_4 = CustomPreviewLineweights(Geometry=wires, Shader=swatch_2, Thickness=Slider(1, range=0..10))
preview_3 = CustomPreview(Geometry=wires, Shader=swatch_2)
g_17 = PythonScript(node=bibil_21.Node_out)  # -> geom; inputs node: list; same code as g_15
g_18 = PythonScript(node=bibil_21.Node_out)  # -> geom; inputs node: list; same code as g_15
geo_21 = Geometry(bibil_21.Debug)
panel_21 = Panel(bibil_21.Debug)
g_19 = PythonScript(node=bibil_21.Node_out)  # -> tolerance; inputs node: list
# ---------- g_19: Python ----------
node = filter(lambda n: n!=None,node)
if node and node != []:
    tolerance = []
    for n in node:
        loc = n.backtrack_tree(lambda n: n.grammar.type.has_key('tolerance_curve'),accumulate=True)
        tolerance.extend(map(lambda n:n.grammar.type['tolerance_curve'],loc))
    if tolerance:
        tolerance = reduce(lambda x,y:x+y,tolerance)
# ---------- end g_19 ----------

# ---- group: change this to come from root find context
g_20 = PythonScript(node=bibil_21.Node_dead)  # -> context; inputs node: list
# ---------- g_20: Python ----------
node = filter(lambda n: n!=None,node)
if node and node != []:
    context = []
   
    for n in node:
        print n.grammar.type
        foo = lambda n: n.grammar.type.has_key('context_geometry')
        loc = n.backtrack_tree(foo,accumulate=True)
        context.extend(map(lambda n:n.grammar.type['context_geometry'],loc))
    print context
# ---------- end g_20 ----------

# ----
previewlw_5 = CustomPreviewLineweights(Geometry=g_19, Shader=ColourSwatch(SwatchColor=RGB(255, 0, 255)), Thickness=Slider(3, range=0..10))

bldgprograms = Honeybee_bldgPrograms({"Office": 0, "Retail": 1, "MidriseApartment": 2, "PrimarySchool": 3, "SecondarySchool": 4, "SmallHotel": 5, "LargeHotel": 6, "Hospital": 7, "Outpatient": 8, "Warehouse": 9, "SuperMarket": 10, "FullServiceRestaurant": 11, "QuickServiceRestaurant": 12}, selected="MidriseApartment")
listzoneprograms = Honeybee_ListZonePrograms(bldgProgram=bldgprograms)  # -> MidriseApartmentZonePrograms; plug-in component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
item = ListItem(List=listzoneprograms, Index="0", Wrap=True)

geo_22 = Geometry(g_18)
callfromepconstrlibrary = Honeybee_CallFromEPConstructionLibrary(keywords="Window")  # -> EPMaterials, EPWindowMaterils, EPConstructions; plug-in component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
callfromepconstrlibrary_2 = Honeybee_CallFromEPConstructionLibrary(keywords="IEAD")  # -> EPMaterials, EPWindowMaterils, EPConstructions; plug-in component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
callfromepconstrlibrary_3 = Honeybee_CallFromEPConstructionLibrary(keywords="steel")  # -> EPMaterials, EPWindowMaterils, EPConstructions; plug-in component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
toggle_4 = BooleanToggle(False)  # disabled
number_slider_18 = Slider(1, range=0..1)  # disabled
geo_23 = Geometry()  # disabled
number_slider_19 = Slider(8, range=0..10)  # disabled
mass2zone = Honeybee_Masses2Zones(zoneMasses=flatten(geo_22), zonePrograms=item, isConditioned=Toggle(True), maxRoofAngle=30, createHBZones=Toggle(True))  # -> readMe, HBZones; plug-in component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
panel_22 = Panel("""0.4
0.0
0.4
0.0""")
gentestpts = Honeybee_GenerateTestPoints(testGeometry=geo_23, gridSize=number_slider_19, distBaseSrf=number_slider_18, moveTestMesh=toggle_4)  # -> readMe, simplify(testPoints), simplify(ptsVectors), simplify(facesArea), simplify(mesh); disabled; plug-in component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
item_2 = ListItem(List=callfromepconstrlibrary_3.EPConstructions, Index="3", Wrap=True)
item_3 = ListItem(List=callfromepconstrlibrary.EPConstructions, Index="10", Wrap=True)
item_4 = ListItem(List=callfromepconstrlibrary_2.EPConstructions, Index="6", Wrap=True)
glazingcreator = Honeybee_GlazingBasedOnRatio(glzRatio=panel_22, breakUpWindow=Toggle(False), runIt=Toggle(True))  # -> readMe, HBObjWGLZ; plug-in component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
faceb = FaceBoundaries(Mesh=gentestpts.mesh)  # disabled
panel_23 = Panel(item_2)
panel_24 = Panel(item_3)
panel_25 = Panel(item_4)
brep = Brep(faceb)  # disabled
sunion_2 = SolidUnion(Breps=brep)  # disabled
geo_24 = Geometry(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)
zoneattributelist = Honeybee_ZoneAttributeList({"Name": "name", "Zone Program": "zoneProgram", "Zone Floor Area": "zoneFloorArea", "Zone Volume": "zoneVolume", "Building Program": "bldgProgram", "Is Conditioned": "isConditioned", "HVAC System Type": "HVACSystem", "Occupancy Schedule": "occupancySchedule", "Occupancy Activity Schedule": "occupancyActivitySch", "Heating SetPoint Schedule": "heatingSetPtSchedule"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}, selected="Name")  # disabled
mass2zone_2 = Honeybee_Masses2Zones(zoneMasses=flatten(geo_24), isConditioned=True, maxRoofAngle=30, createHBZones=Toggle(True))  # -> readMe, HBZones; plug-in component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
soil_type = Panel("4")
setepzonecnstr = Honeybee_SetEPZoneConstruction(HBZones=flatten(mass2zone.HBZones), wallEPConstruction=item_2, windowEPConstruction=item_3, roofEPConstruction=item_4)  # -> simplify(modifiedHBZones); plug-in component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
labelzones = Honeybee_LabelZones(HBZones=flatten(setepzonecnstr), attribute=zoneattributelist)  # -> zoneTxtLabels, labelBasePts, brepTxtLabels, zoneWireFrames; disabled; plug-in component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
createepground = Honeybee_CreateEPGround(HBZones=mass2zone_2.HBZones, soilTypeOrMat=soil_type)  # -> HBGrndZones; plug-in component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
toggle_5 = BooleanToggle(True)
wires_2 = BrepWireframe(Brep=setepzonecnstr, Density=-1)
tag = TextTag(Location=labelzones.labelBasePts, Text=labelzones.zoneTxtLabels)  # disabled
path = FilePath("C:\saeran\master\git\Bibil\src\reference\CAN_ON_Toronto.716240_CWEC\CAN_ON_Toronto.716240_CWEC.epw")
path_2 = FilePath("C:\saeran\master\git\Bibil\src\reference\CAN_ON_Toronto.716240_CWEC\CAN_ON_Toronto.716240_CWEC.stat")

# ---- group: SHAPENODE
bibil_22 = PythonScript(Code=file_10, Node_in=flatten(createepground), Label_="ground_node", Run=Toggle(True))  # -> Node_out, Node_dead, Debug

# ----
makeadiabaticbytype = Honeybee_MakeAdiabaticByType(HBZones=setepzonecnstr, roofs=toggle_5, exposedFloors=toggle_5)  # -> HBZones; plug-in component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
importepw = Ladybug_ImportEpw(epwFile=path)  # -> readMe, latitude, location, dryBulbTemperature, dewPointTemperature, relativeHumidity, windSpeed, windDirection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; plug-in component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
importstat = Ladybug_ImportStat(statFile=path_2)  # -> readMe, ashraeClimateZone, koppenClimateZone, port, heatingDesignTemp, coolingDesignTemp, port_2, extremeHotWeek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; plug-in component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
ladybug = Ladybug_Ladybug()  # -> Vviiiiiiiiiizzz; plug-in component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
honeybee = Honeybee_Honeybee()  # -> Vviiiiiiiiiizzz; plug-in component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
g_21 = PythonScript(node=bibil_22.Node_out)  # -> geom; inputs node: list; same code as g_15
python_6 = PythonScript(x=importepw.dryBulbTemperature)  # -> a; inputs x: list
# ---------- python_6: Python ----------
a = reduce(lambda i,j:i+j,x[7:])/float(len(x[7:]))
# ---------- end python_6 ----------
python_7 = PythonScript(x=importepw.relativeHumidity)  # -> a; inputs x: list; same code as python_6
srfattributelist = Honeybee_SurfaceAttributeList({"Name": "name", "Radiance Material": "RadMaterial", "EnergyPlus Construction": "EPConstruction", "Surface Type": "type", "Boundary Condition": "BC", "Sun Exposure": "sunExposure", "Wind Exposure": "windExposure", "Has Child Surface": "hasChild", "Is Child Surface": "isChild", "Is Planar": "isPlanar", "Srf Type Set By User": "srfTypeByUser", "Boundary Condition Set By User": "srfBCByUser", "Shade Material Name": "shadeMaterialName", "Shading Control Name": "shadingControlName", "Shcading Schedule Name": "shadingSchName"}, selected="Boundary Condition")  # disabled
panel_26 = Panel(importepw.dryBulbTemperature)
panel_27 = Panel(python_6)
panel_28 = Panel(python_7)
labelsurfaces = Honeybee_LabelZoneSurfaces(attribute=srfattributelist)  # -> surfaceTxtLabels, labelBasePts, brepTxtLabels, surfaceWireFrames; disabled; plug-in component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
wires_3 = BrepWireframe(Density=-1)  # disabled
data_11 = Data([makeadiabaticbytype, createepground])
tag_2 = TextTag(Location=labelsurfaces.labelBasePts, Text=labelsurfaces.surfaceTxtLabels)  # disabled
toggle_6 = BooleanToggle(True)
toggle_7 = BooleanToggle(True)
epoutput = Honeybee_GenerateEPOutput(zoneGainsAndLosses="False", zoneComfortMetrics=toggle_7, surfaceTempAnalysis=toggle_7)  # -> report, flatten(simulationOutputs); plug-in component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
data_12 = Data(importstat.typicalHotWeek)
selectandaveragedata = Ladybug_AverageData(annualHourlyData=importepw.dryBulbTemperature, analysisPeriod=data_12)  # -> readMe, selHourlyData, averagedDaily, averagedMonthly, avrMonthlyPerHour, avrAnalysisPeriod; plug-in component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
panel_29 = Panel(selectandaveragedata.avrAnalysisPeriod)
runenergysimulation = Honeybee_RunEnergySimulation(
    epwFile=path,
    analysisPeriod=data_12,
    HBZones=flatten(data_11),
    simulationOutputs=flatten(epoutput.simulationOutputs),
    writeIdf=toggle_6,
    runEnergyPlus=toggle_6)  # -> report, idfFileAddress, htmlReport, resultFileAddress, eioFileAddress; plug-in component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
readepresult = Honeybee_ReadEPResult(resultFileAddress=runenergysimulation.resultFileAddress)  # -> port, port_2, port_3, port_4, port_5, port_6, port_7, port_8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; plug-in component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
colorzones = Honeybee_ColorZonesByEPResult(zoneData=readepresult.meanRadTemperature, HBZones=flatten(data_11), runIt=Toggle(False))  # -> readMe, zoneColoredMesh, zoneWireFrame, legend, legendBasePt, analysisTitle, zoneBreps, zoneColors, zoneValues, port; plug-in component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
readepsrfresult = Honeybee_ReadEPSurfaceResult(resultFileAddress=runenergysimulation.resultFileAddress)  # -> surfaceIndoorTemp, surfaceOutdoorTemp, port, port_2, port_3, port_4, port_5, port_6, port_7, port_8; plug-in component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
toggle_8 = BooleanToggle(True)  # disabled
area_3 = Area(Geometry=colorzones.zoneBreps)  # -> Area, Centroid
tag_3 = TextTag(Location=area_3.Centroid, Text=colorzones.zoneValues)
panel_30 = Panel(readepsrfresult.surfaceOutdoorTemp)
colorsurfaces = Honeybee_ColorSurfacesByEPResult(srfData=readepsrfresult.surfaceOutdoorTemp, HBZones=flatten(data_11), runIt=toggle_8)  # -> readMe, srfColoredMesh, zoneWireFrame, legend, legendBasePt, analysisTitle, srfBreps, srfColors, srfValues, port; disabled; plug-in component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
area_4 = Area(Geometry=colorsurfaces.srfBreps)  # -> Area, Centroid; disabled
number_slider_20 = Slider(15, range=0..100)  # disabled
number_slider_21 = Slider(35, range=0..100)  # disabled
sort = SortList(Keys=colorsurfaces.srfValues)  # -> Keys, ValuesA; disabled
panel_31 = Panel("-1")  # disabled
tag_4 = TextTag(Location=area_4.Centroid, Text=colorsurfaces.srfValues)  # disabled
geo_25 = Geometry(colorsurfaces.srfBreps)  # disabled
item_5 = ListItem(List=sort.Keys, Index=0, Wrap=True)  # disabled
item_6 = ListItem(List=sort.Keys, Index=panel_31, Wrap=True)  # disabled
gradient = Gradient(
    LowerLimit=number_slider_20,
    UpperLimit=number_slider_21,
    Parameter=colorsurfaces.srfValues,
    stops=[0: RGB(255, 0, 64), 0.25: RGB(245, 93, 0), 0.532: RGB(255, 255, 22), 0.75: RGB(93, 177, 249), 1: RGB(0, 44, 169)])  # disabled
geo_26 = Geometry(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)
thermalautonomy = Honeybee_ThermalAutonomyAnalysis()  # -> readMe, port, occTCP_Mtx, TA_Mtx, OverHeatedMtx, UnderHeatedMtx, port_2, occTCP_Result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; plug-in component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

# ---- group: BIBIL2HBZone
python_8 = PythonScript(HBZones=makeadiabaticbytype, BBNodes=bibil_21.Node_out, HBground=createepground, BBground=bibil_22.Node_out)  # -> BBNodes; inputs HBZones: list, BBNodes: list
# ---------- python_8: Python ----------
import scriptcontext as sc
import rhinoscriptsyntax as rs

hb_hive = sc.sticky["honeybee_Hive"]()


def IsList(lst):
    return lst != [None] and lst != []

if IsList(_HBZones) and IsList(_BBNodes):
    #print len(_HBZones)
    #print len(_BBNodes)
    for i in xrange(len(_HBZones)):
        hb = _HBZones[i]
        hb = rs.coercebrep(hb)
        #zone = hb_hive.visualizeFromHoneybeeHive([hb])[0]
        bb = _BBNodes[i]
        bb.grammar.type['HBZone'] = hb
        _BBNodes[i] = bb
    
    if _HBground and _BBground:
        _HBground = rs.coercebrep(_HBground)
        _BBground.grammar.type['HBZone'] = _HBground
        _BBNodes.append(_BBground)
# ---------- end python_8 ----------

# ---- group: EXTRACT_CANYON
miru_23 = PythonScript(
    Code=file_3,
    Canyon_tol=Slider(30, range=0..100),
    Canyon_center=geo_26,
    Srf_data=readepsrfresult.surfaceOutdoorTemp,
    Run=Toggle(True))

# ---- group: INTERPOLATE_VERTICAL
miru_24 = PythonScript(Code=file_4, Run=Toggle(True))

# ----
preview_4 = CustomPreview(Geometry=geo_25, Shader=gradient)  # disabled

# ---- group: SHAPENODE
bibil_23 = PythonScript(Code=file_10, Rule_in=flatten([miru_23, miru_24]), Node_in=flatten(python_8), Run=Toggle(True))  # -> Node_out, Node_dead, Debug

# ----
g_22 = PythonScript(node=bibil_23.Node_out)  # -> geom; inputs node: list; same code as g_12
geo_27 = Geometry(bibil_23.Debug)
data_13 = Data(Slider(27, range=0..100))
data_14 = Data(Slider(18, range=0..100))
vec = VectorXYZ(XComponent=Slider(-6, range=-10..10), YComponent=0, ZComponent=Slider(-3, range=-10..10))  # -> Vector, Length
g_23 = PythonScript(node=bibil_23.Node_out)  # -> inorm; inputs node: list
# ---------- g_23: Python ----------
if node and node != [None]:
    inorm = []
    for n in node:
        if n.grammar.type.has_key('interpolate_srf_normal'):
            srf_data = n.grammar.type['interpolate_srf_normal']
            #print srf_data
            inorm.extend(srf_data)
    
    #print isrf
# ---------- end g_23 ----------
g_24 = PythonScript(node=bibil_23.Node_out)  # -> icpt; inputs node: list
# ---------- g_24: Python ----------
if node and node != [None]:
    icpt = []
    for n in node:
        if n.grammar.type.has_key('interpolate_cpt'):
            srf_data = n.grammar.type['interpolate_cpt']
            #print srf_data
            icpt.extend(srf_data)
    #print cpt
# ---------- end g_24 ----------
g_25 = PythonScript(node=bibil_23.Node_out)  # -> itemp; inputs node: list
# ---------- g_25: Python ----------
import scriptcontext as sc
Bula = sc.sticky['Bula']
B = Bula()

if node and node != [None]:
    itemp = []
    for n in node:
        if n.grammar.type.has_key('interpolate_temperature'):
            srf_data = n.grammar.type['interpolate_temperature']
            #print srf_data
            itemp.extend(srf_data)

#itemp = B.normalize_list(itemp,1.,0.)
#print itemp
# ---------- end g_25 ----------
g_26 = PythonScript(node=bibil_23.Node_out)  # -> pt; inputs node: list
# ---------- g_26: Python ----------
node = filter(lambda n: n!=None,node)
if node and node != []:
    pt = []
    for n in node:
        n = n.backtrack_tree(lambda n: n.grammar.type.has_key('processed_srf_geom'))
        if n:
            srf_data = n.grammar.type['processed_srf_pt']
            #print srf_data
            # print '--'
            pt.extend(srf_data)
    #print pt
# ---------- end g_26 ----------
g_27 = PythonScript(node=bibil_23.Node_out)  # -> temp; inputs node: list
# ---------- g_27: Python ----------
if node and node != [None]:
    temp = []
    for n in node:
        #if n.grammar.type.has_key('processed_srf_data'):
        n = n.backtrack_tree(lambda n: n.grammar.type.has_key('processed_srf_data'))
        if n:
            srf_data = n.grammar.type['processed_srf_data']
            temp.extend(srf_data)
    #print temp
# ---------- end g_27 ----------

# ---- group: facade
sort_2 = SortList(Keys=g_27)  # -> Keys, ValuesA
item_7 = ListItem(List=sort_2.Keys, Index=0, Wrap=True)
item_8 = ListItem(List=sort_2.Keys, Index="-1", Wrap=True)
panel_32 = Panel(item_7)
panel_33 = Panel(item_8)

# ----
g_28 = PythonScript(node=bibil_23.Node_out)  # -> srf; inputs node: list
# ---------- g_28: Python ----------
if node and node != [None]:
    srf = []
    for n in node:
        n = n.backtrack_tree(lambda n: n.grammar.type.has_key('processed_srf_geom'))
        #if n.grammar.type.has_key('processed_srf_geom'):
        if n:
            srf_data = n.grammar.type['processed_srf_geom']
            #print srf_data
            #print '-'
            srf.extend(srf_data)
    #print srf
# ---------- end g_28 ----------
g_29 = PythonScript(node=bibil_23.Node_out)  # -> norm; inputs node: list
# ---------- g_29: Python ----------
node = filter(lambda n: n!=None,node)
if node and node != []:
    norm = []
    for n in node:
        n = n.backtrack_tree(lambda n: n.grammar.type.has_key('processed_srf_normal'))
        if n:
            srf_data = n.grammar.type['processed_srf_normal']
            #print srf_data
            # print '--'
            norm.extend(srf_data)
    #print norm
# ---------- end g_29 ----------
g_30 = PythonScript(node=bibil_23.Node_out)  # -> isrf; inputs node: list
# ---------- g_30: Python ----------
if node and node != [None]:
    isrf = []
    for n in node:
        if n.grammar.type.has_key('interpolate_srf_geom'):
            srf_data = n.grammar.type['interpolate_srf_geom']
            #print srf_data
            isrf.extend(srf_data)
    
    #print isrf
# ---------- end g_30 ----------
g_31 = PythonScript(node=bibil_23.Node_out)  # -> gtemp; inputs node: list
# ---------- g_31: Python ----------
import scriptcontext as sc
Bula = sc.sticky['Bula']
B = Bula()

if node and node != [None]:
    gtemp = []
    for n in node:
        n = n.backtrack_tree(lambda n:n.grammar.type.has_key('ground_srf_data'))
        if n and n.grammar.type.has_key('ground_srf_data'):
            srf_data = n.grammar.type['ground_srf_data']
            #print srf_data
            gtemp.extend(srf_data)

    #print gtemp
# ---------- end g_31 ----------
g_32 = PythonScript(node=bibil_23.Node_out)  # -> gsrf; inputs node: list
# ---------- g_32: Python ----------
if node and node != [None]:
    gsrf = []
    for n in node:
        print n.parent.parent.grammar.type.keys()
        n = n.backtrack_tree(lambda n:n.grammar.type.has_key('ground_srf_geom'))
        if n and n.grammar.type.has_key('ground_srf_geom'):
            srf_data = n.grammar.type['ground_srf_geom']
            #print srf_data
            gsrf.extend(srf_data)
    
    #print gsrf
# ---------- end g_32 ----------
g_33 = PythonScript(node=bibil_23.Node_out)  # -> gcpt; inputs node: list
# ---------- g_33: Python ----------
if node and node != [None]:
    gcpt = []
    for n in node:
        n = n.backtrack_tree(lambda n:n.grammar.type.has_key('ground_srf_pt'))
        if n and n.grammar.type.has_key('ground_srf_pt'):
            srf_data = n.grammar.type['ground_srf_pt']
            #print srf_data
            gcpt.extend(srf_data)
    #print cpt
# ---------- end g_33 ----------
pt = Point([g_26, g_33, g_24])
move = Move(Geometry=pt, Motion=vec.Vector)  # -> Geometry, Transform
swatch_3 = ColourSwatch(SwatchColor=RGB(255, 0, 0))
preview_5 = CustomPreview(Geometry=move.Geometry, Shader=ColourSwatch(SwatchColor=RGB(255, 0, 0)))
python_9 = PythonScript(x=g_25)  # -> a
# ---------- python_9: Python ----------
a = round(x,2)
# ---------- end python_9 ----------
sort_3 = SortList(Keys=g_25)  # -> Keys, ValuesA
python_10 = PythonScript(x=g_31)  # -> a; same code as python_9
python_11 = PythonScript(x=g_27)  # -> a; same code as python_9
item_9 = ListItem(List=sort_3.Keys, Index=0, Wrap=True)
item_10 = ListItem(List=sort_3.Keys, Index="-1", Wrap=True)
sort_4 = SortList(Keys=g_27)  # -> Keys, ValuesA
g_34 = PythonScript(node=bibil_21.Node_out)  # -> crv; inputs node: list
# ---------- g_34: Python ----------
node = filter(lambda n: n!=None,node)
if node and node != []:
    crv = []
    for n in node:
        if n.shape.bottom_crv:
            crv.append(n.shape.bottom_crv)
    #print geom
# ---------- end g_34 ----------
tag_5 = TextTag(Location=g_24, Text=python_9, Colour=swatch_3)
tag_6 = TextTag(Location=g_26, Text=python_11, Colour=swatch_3)
tag_7 = TextTag(Location=g_33, Text=python_10, Colour=swatch_3)
item_11 = ListItem(List=sort_4.Keys, Index=0, Wrap=True)
item_12 = ListItem(List=sort_4.Keys, Index="-1", Wrap=True)
panel_34 = Panel(item_9)
panel_35 = Panel(item_10)
pt_2 = Point(Point(64.4319726, -151.5424582, 0))
panel_36 = Panel(item_11)
panel_37 = Panel(item_12)
move_2 = Move(Geometry=g_28, Motion=g_29)  # -> Geometry, Transform
move_3 = Move(Geometry=g_30, Motion=g_23)  # -> Geometry, Transform
mesh = Mesh(move_2.Geometry)
gradient_2 = Gradient(
    LowerLimit=data_13,
    UpperLimit=data_14,
    Parameter=g_25,
    stops=[0: RGB(255, 0, 64), 0.25: RGB(245, 93, 0), 0.5: RGB(255, 255, 22), 0.75: RGB(93, 177, 249), 1: RGB(0, 44, 169)])
mesh_2 = Mesh(move_3.Geometry)
gradient_3 = Gradient(
    LowerLimit=data_13,
    UpperLimit=data_14,
    Parameter=g_27,
    stops=[0: RGB(255, 0, 64), 0.25: RGB(245, 93, 0), 0.5: RGB(255, 255, 22), 0.75: RGB(93, 177, 249), 1: RGB(0, 44, 169)])
demesh = DeconstructMesh(Mesh=mesh)  # -> Vertices, Faces, Colours, Normals
demesh_2 = DeconstructMesh(Mesh=mesh_2)  # -> Vertices, Faces, Colours, Normals
conmesh = ConstructMesh(Vertices=demesh.Vertices, Faces=demesh.Faces)
conmesh_2 = ConstructMesh(Vertices=demesh_2.Vertices, Faces=demesh_2.Faces)
geo_28 = Geometry([move_2.Geometry, move_3.Geometry])
mcol = MeshColours(Mesh=graft(conmesh), Colours=graft(gradient_3))
sunion_3 = SolidUnion(Breps=geo_28)
mcol_2 = MeshColours(Mesh=graft(conmesh_2), Colours=graft(gradient_2))
fmerge_2 = MergeFaces(Brep=sunion_3)  # -> Breps, Before, After
mesh_3 = Mesh(mcol_2)
mesh_4 = Mesh(mcol)
wires_4 = BrepWireframe(Brep=fmerge_2.Breps, Density=-1)
dash_4 = DashPattern(Curve=wires_4, Pattern=Slider(1.6, range=0..10))  # -> Dashes, Gaps

# ---- group: stb-sb
python_12 = PythonScript(sb=podium_ht.setback_dim, stb=podium_ht.stepback_dim)  # -> a
# ---------- python_12: Python ----------
a = stb - sb
# ---------- end python_12 ----------

# ---- group: + 1.5
python_13 = PythonScript(x=podium_ht.podium_ht)  # -> a
# ---------- python_13: Python ----------
a = x+1.5
# ---------- end python_13 ----------

# ----
python_14 = PythonScript(x=[move_3.Geometry, move_2.Geometry], node_ref=bibil_23.Node_out)  # -> a; inputs x: list, node_ref: list
# ---------- python_14: Python ----------
import rhinoscriptsyntax as rs
import Rhino as rc
import scriptcontext as sc

Shape = sc.sticky['Shape']

if len(x)>0 and len(node_ref)>0:
    #shp = Shape(rs.coercebrep(x[0]),cplane=None)
    ref = node_ref[0]
    cplane = ref.shape.cplane
    
    a = cplane
# ---------- end python_14 ----------
geo_29 = Geometry([move_3.Geometry, move_2.Geometry])
Z = UnitZ(Factor=Slider(623, range=0..1000))
move_4 = Move(Geometry=wires_4, Motion=Z)  # -> Geometry, Transform

# ---- group: dev
data_15 = Data(podium_ht.develop_step)

# ----
group = Group(Objects=geo_29)
previewlw_6 = CustomPreviewLineweights(Geometry=move_4.Geometry, Shader=ColourSwatch(SwatchColor=RGB(255, 255, 255)), Thickness=Slider(0.1, range=0..1))
pt_3 = Point(Point(-73.52861214, -114.8068854, 216.8657781))
bbox = BoundingBox(Content=group, Plane=python_14)  # -> Box, Box_2

# ---- group: SHAPENODE
bibil_24 = PythonScript(Code=file_10, Node_in=flatten(bbox.Box), Label_="bbox", Run=Toggle(True))  # -> Node_out, Node_dead, Debug

# ----
# ASHRAE 55 recommends that floor temperatures stay in the range of 19–29 °C (66–84 °F) in spaces where occupants will be wearing lightweight shoes.
g_35 = PythonScript(node=bibil_24.Node_out)  # -> crv; inputs node: list; same code as g_34
python_15 = PythonScript(srflst=g_32, templst=g_31, boundcrv=g_35, bldcrv=g_34)  # -> srf_out, temp_out, totalArealst, totalTemplst, debug; inputs srflst: list, templst: list, bldcrv: list
# ---------- python_15: Python ----------
import rhinoscriptsyntax as rs
import Rhino as rc
import ghpythonlib as ghlib
import copy

ghenv.Component.Message = 'Bibil'

def check_bld_crv(pt):
    for i in xrange(len(bldcrv)):
        bld = bldcrv[i]
        IsInBld = rs.PointInPlanarClosedCurve(cpt,bld)
        if abs(IsInBld-1.)<0.1:
            return True
        
    return False

debug = []
srf_out, temp_out = [], []
totalTemplst,totalArealst = [], []

if True:
    
    boundcrv = rs.coercecurve(boundcrv)
        
    for i in xrange(len(srflst)):
        srf = srflst[i]
        temp = templst[i]
        
        IsInBld = False
        totalArea = 0
        
        srf = rs.coercebrep(srf)
        
        srflstsplit = ghlib.components.SurfaceSplit(srf,boundcrv)
        if srflstsplit and type(srflstsplit)!=type([]):
            srflstsplit = []#[srflstsplit]
        
        if srflstsplit and len(srflstsplit)> 0.1:
            for s in srflstsplit:
                arealst = ghlib.components.Area(s)
                cpt = arealst[1]
                totalArea += arealst[0]
                IsIn = rs.PointInPlanarClosedCurve(cpt,boundcrv)
                IsInBld = check_bld_crv(cpt)
                if IsInBld ==  True:
                    #debug.append(cpt)
                    temp = -100.0
                if abs(IsIn - 1.0) < 0.1:
                    #is inside
                    srf_out.append(s)
                    temp_out.append(temp)
                
        else:
            arealst = ghlib.components.Area(srf)
            cpt = arealst[1]
            totalArea += arealst[0]
            IsIn = rs.PointInPlanarClosedCurve(cpt,boundcrv)
            IsInBld = check_bld_crv(cpt)
            if IsInBld ==  True:
                temp = -100.0
                #debug.append(cpt)
            if abs(IsIn - 1.0) < 0.1:
                srf_out.append(srf)
                temp_out.append(temp)
        
        if IsInBld==False:
            totalArealst.append(totalArea)
            totalTemplst.append(temp)
            debug.append(srf)

#print srf_out
#print temp_out
# ---------- end python_15 ----------

# ---- group: grnd
sort_5 = SortList(Keys=python_15.temp_out)  # -> Keys, ValuesA
item_13 = ListItem(List=sort_5.Keys, Index=0, Wrap=True)
item_14 = ListItem(List=sort_5.Keys, Index="-1", Wrap=True)
panel_38 = Panel(item_14)
panel_39 = Panel(item_13)

# ----
sort_6 = SortList(Keys=flatten([item_13, item_14, item_9, item_10, item_11, item_12]))  # -> Keys, ValuesA
item_15 = ListItem(List=sort_6.Keys, Index=0, Wrap=True)
item_16 = ListItem(List=sort_6.Keys, Index="-1", Wrap=True)
panel_40 = Panel(item_16)
panel_41 = Panel(item_15)
python_16 = PythonScript(x=flatten([g_31, python_15.totalTemplst, g_27]))  # -> a; inputs x: list
# ---------- python_16: Python ----------
a = filter(lambda i: i > 0.0,x)

a += [18.00]
a += [29.00]
print a
# ---------- end python_16 ----------
createlegend = Ladybug_CreateLegend(
    valuesOrRange=flatten(python_16),
    legendBasePt=pt_2,
    legendTitle="Outside Surface Temp [C]",
    legendSize=Slider(5, range=0..10))  # -> legendMesh, legendTextSrf, legendBasePt, port, textValuesBasePts, legendTextValues, recommendedTextSize; plug-in component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
geo_30 = Geometry(python_15.debug)
mesh_5 = Mesh(python_15.srf_out)
gradient_4 = Gradient(
    LowerLimit=data_13,
    UpperLimit=data_14,
    Parameter=python_15.temp_out,
    stops=[0: RGB(255, 0, 64), 0.25: RGB(245, 93, 0), 0.5: RGB(255, 255, 22), 0.75: RGB(93, 177, 249), 0.984: RGB(0, 44, 169), 1: RGB(255, 255, 255)])
demesh_3 = DeconstructMesh(Mesh=mesh_5)  # -> Vertices, Faces, Colours, Normals
conmesh_3 = ConstructMesh(Vertices=demesh_3.Vertices, Faces=demesh_3.Faces)
mcol_3 = MeshColours(Mesh=graft(conmesh_3), Colours=graft(gradient_4))
mesh_6 = Mesh(mcol_3)
pdecon = Deconstruct(Point=pt_3)  # -> XComponent, YComponent, ZComponent
move_5 = Move(Geometry=[mesh_3, mesh_4, mesh_6], Motion=Z)  # -> Geometry, Transform
wires_5 = BrepWireframe(Brep=bbox.Box, Density=-1)
pt_4 = ConstructPoint(XCoordinate=pdecon.XComponent, YCoordinate=pdecon.YComponent, ZCoordinate=Slider(524, range=0..1000))
pt_5 = ConstructPoint(XCoordinate=pdecon.XComponent, YCoordinate=pdecon.YComponent, ZCoordinate=Slider(77, range=0..1000))
python_17 = PythonScript(x=flatten(move_5.Geometry))  # -> a; inputs x: list
# ---------- python_17: Python ----------
from Rhino import RhinoApp

a = x[-1]

RhinoApp.Wait()
RhinoApp.Wait()
RhinoApp.Wait()
# ---------- end python_17 ----------
move_6 = Move(Geometry=wires_5, Motion=Z)  # -> Geometry, Transform
swatch_4 = ColourSwatch(SwatchColor=RGB(255, 0, 255))

material = CreateMaterial(
    Diffuse=ColourSwatch(SwatchColor=RGB(0, 255, 150)),
    Specular=RGB(255, 255, 255),
    Emission=RGB(0, 0, 0),
    Transparency=0,
    Shine=0)
mesh_7 = Mesh(fmerge.Breps)
preview_6 = CustomPreview(Geometry=mesh_7, Shader=material)

ln = Line(StartPoint=pt_4, EndPoint=pt_5)

# ---- group: envelope_MAX
area_5 = Area(Geometry=g_30)  # -> Area, Centroid
area_6 = Area(Geometry=g_28)  # -> Area, Centroid
python_18 = PythonScript(srf=flatten([area_5.Area, area_6.Area]), tmp=flatten([g_25, g_27]))  # -> avgtemp; inputs srf: list, tmp: list
# ---------- python_18: Python ----------
if True:
    avgtemp_ = 0
    num = 0
    for s,t in zip(srf,tmp):
        avgtemp_ += t
        num += 1
    avgtemp = avgtemp_/num
# ---------- end python_18 ----------
panel_42 = Panel(python_18)

# ----
pt_6 = Point(Point(-12.67837996, 15.97046839, 0))
pt_7 = Point(Point(-137.9979243, -274.8318814, 0))
pt_8 = Point(Point(-205.6347904, -33.44289271, 0))
pt_9 = Point(Point(50.53374915, -204.0062611, 0))
dash_5 = DashPattern(Curve=ln, Pattern=Slider(7.7, range=0..10))  # -> Dashes, Gaps

# ---- group: GFA_MAX
volume = Volume(Geometry=g_15)  # -> Volume, Centroid
ma = MassAddition(Input=volume.Volume)  # -> Result, PartialResults
division = Division(A=ma.Result, B=Slider(3, range=0..10))
panel_43 = Panel(division)

# ---- group: ground_MAX
python_19 = PythonScript(srf=python_15.totalArealst, tmp=python_15.totalTemplst)  # -> avgtemp, grossarea; inputs srf: list, tmp: list
# ---------- python_19: Python ----------
import math

if True:
    avgtemp_ = 0
    num_ = 0
    grossarea_ = 0
    for s,t in zip(srf,tmp):
        #Check in range
        if t>=19 and t<=29:
            avgtemp_ += t 
            num_ += 1
            grossarea_ += s
    avgtemp = avgtemp_/num_
    grossarea = grossarea_
    print avgtemp
    print grossarea_
# ---------- end python_19 ----------
panel_44 = Panel(python_19.avgtemp)

# ----
python_20 = PythonScript(ground=python_19.avgtemp, groundarea=python_19.grossarea, envelope=python_18, gfa=division)  # -> outputs
# ---------- python_20: Python ----------
outputs = ""

outputs += "OUTPUTS" + "\n"
outputs += "GFA: " + str(round(gfa,2)) + "\n"
outputs += "Comfort Ground Temp (Avg): " + str(round(ground,4)) + "\n"
outputs += "Comfort Ground Area (Gross): " + str(round(groundarea,2)) + "\n"
outputs += "Envelope Temp: " + str(round(envelope,4)) + "\n"
# ---------- end python_20 ----------
python_21 = PythonScript(x=bbox.Box, refpt1=pt_6, refpt2=pt_8, refpt3=pt_9, refpt4=pt_7, c=python_14)  # -> a, dirc, ar, farsidept, debug
# ---------- python_21: Python ----------
import rhinoscriptsyntax as rs
import Rhino as rc
import scriptcontext as sc
ghenv.Component.Message = 'Bibil'
Grammar = sc.sticky['Grammar']

bbox = rs.BoundingBox(x,c)
G = Grammar()
minpts = []
maxpts = []
refindex1,refindex2,refindex3, refindex4 = 0, 0, 0, 0
mindist1,mindist2,mindist3, mindist4 = None, None, None, None
minnum = 0
for p in bbox:
    IsZero = G.is_near_zero(p[2])
    if IsZero:
        dist1 = rs.Distance(p,refpt1)
        dist2 = rs.Distance(p,refpt2)
        dist3 = rs.Distance(p,refpt3)
        dist4 = rs.Distance(p,refpt4)
        
        if dist1 < dist2 and dist1 < dist3 and dist1 < dist4:
            refindex1 = minnum
            mindist1 = dist1
        elif dist2 < dist1 and dist2 < dist3 and dist2 < dist4:
            refindex2 = minnum
            mindist2 = dist2
        elif dist3 < dist1 and dist3 < dist2 and dist3 < dist4:
            refindex3 = minnum
            mindist3 = dist4
        else:
            refindex4 = minnum
            mindist4 = dist4
        minpts.append(p)
        minnum += 1
    else:
        maxpts.append(p)

vec = minpts[refindex3] - minpts[refindex1]#direction along short axis
vec.Unitize()
#debug = minpts[refindex3]

a = minpts[refindex4] + vec*10 #direction to push
farsidept = minpts[refindex3] + vec*20 #for pt away from axis

dirc = minpts[refindex1] - minpts[refindex2]

ht = maxpts[0][2] - minpts[0][2]

shortaxis = rs.Distance(minpts[refindex4],minpts[refindex2])
ar = round(ht/shortaxis,2)
# ---------- end python_21 ----------
python_22 = PythonScript(
    x=data_15,
    y=podium_ht.arctype_str,
    z=python_13,
    u=podium_ht.setback_dim,
    v=python_12,
    ar=python_21.ar,
    outputs=python_20)  # -> a, c, b
# ---------- python_22: Python ----------
ghenv.Component.Message = 'Bibil'

L = [x,y,z,u,v]
M = ['dev_','type_','podht_','set_','step_']

strout = ""
for i,j in zip(L,M):
    strout += '---' + j + str(i).replace('.','dot')
    

a = strout

hudviz = ""
hudviz += "INPUTS" + "\n"
hudviz += "Development Iteration: " + str(x) + "\n"
hudviz += "Archetype: " + str(y) + "\n"
hudviz += "Podium Height: " + str(z) + "\n"
hudviz += "Setback: " + str(u) + "\n"
hudviz += "Stepback: " + str(v) + "\n"
hudviz += "\n" + "\n" #"- - -" + "\n"
hudviz += outputs

b = hudviz

c = "Canyon Aspect Ratio: " + str(ar) + "\n"
# ---------- end python_22 ----------
number_slider_22 = Slider(1, range=0..10)  # disabled
preview_7 = CustomPreview(Geometry=[move_6.Geometry, wires_5], Shader=swatch_4)
previewlw_7 = CustomPreviewLineweights(Geometry=dash_5.Dashes, Shader=swatch_4, Thickness=Slider(2, range=0..10))
move_7 = Move(Geometry=python_21.farsidept, Motion=Z)  # -> Geometry, Transform; disabled
pt_10 = ConstructPoint(XCoordinate=Slider(20, range=0..100), YCoordinate=Slider(72, range=0..100), ZCoordinate=0)
number_slider_23 = Slider(10, range=0..10)
northarrow = Ladybug_North(centerPt=move_7.Geometry, scale=number_slider_22)  # -> northSign; disabled; plug-in component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
move_8 = Move(Geometry=python_21.a, Motion=Z)  # -> Geometry, Transform
geo_31 = Geometry(python_21.dirc)

# ---- group: envelope_MAX
area_7 = Area(Geometry=g_28)  # -> Area, Centroid
area_8 = Area(Geometry=g_30)  # -> Area, Centroid
python_23 = PythonScript(srf=flatten([area_8.Area, area_7.Area]), tmp=flatten([g_25, g_27]))  # -> avgtemp; inputs srf: list, tmp: list; same code as python_18
panel_45 = Panel(python_23)

# ----
align = AlignPlane(Plane=move_8.Geometry, Direction=geo_31)  # -> Plane, Angle

# ---- group: ground_MAX
python_24 = PythonScript(srf=python_15.totalArealst, tmp=python_15.totalTemplst)  # -> avgtemp, grossarea; inputs srf: list, tmp: list; same code as python_19
panel_46 = Panel(python_24.avgtemp)

# ---- group: GFA_MAX
volume_2 = Volume(Geometry=g_15)  # -> Volume, Centroid
ma_2 = MassAddition(Input=volume_2.Volume)  # -> Result, PartialResults
division_2 = Division(A=ma_2.Result, B=Slider(3, range=0..10))
panel_47 = Panel(division_2)

# ----
tag_8 = TextTag3D(Location=align.Plane, Text=python_22.c, Size=Slider(5, range=0..10), Colour=swatch_4, Justification=7)
texttoscreen = RenderTextToScreen(
    Text=python_22.b,
    Location=pt_10,
    Size=Slider(19, range=0..100),
    Color=ColourSwatch(SwatchColor=RGB(107, 107, 107)),
    m_scWithvp=False)
preview_8 = CustomPreview(Geometry=northarrow, Shader=swatch_4)  # disabled
python_25 = PythonScript(gfa=division, ground_avg_temp=python_19.avgtemp, ground_gross_area=python_19.grossarea, envelope_avg_temp=python_18)  # -> scalar_value
# ---------- python_25: Python ----------
"""
Between 0 and 1 using xnormalized = (x – xmin)/( xmax - xmin).
Then add them up to get the Value Function.
"""
ghenv.Component.Message = 'Bibil'
def normalize(x,xmax,xmin):
    if xmin > x:
        x = xmin
        print 'low val'
    xnormalized = (x-xmin)/(xmax-xmin)
    return xnormalized

#Set constants
gfa_max,gfa_min = 690000.00,27100.00
grd_max,grd_min = 25.5, 23.5
grd_area_max,grd_area_min = 11000.00,2500.00
env_max,env_min = 25.0, 22.5

#check inputs
#print gfa
#print ground_avg_temp
#print ground_gross_area
#print envelope_avg_temp


#Get norms
gfa_norm = normalize(gfa,gfa_max,gfa_min)
grd_norm = normalize(ground_avg_temp,grd_max,grd_min)
grd_area_norm = normalize(ground_gross_area,grd_area_max,grd_area_min)
env_norm = normalize(envelope_avg_temp,env_max,env_min)

scalar_value = gfa_norm + 0.5*grd_norm + 0.5*grd_area_norm + env_norm
# ---------- end python_25 ----------
panel_48 = Panel(python_25)

# ---- group: dev
rec = DataRecorder(data_15, DataLimit=100000, RecordData=True)

# ---- group: arc
rec_2 = DataRecorder(podium_ht.arctype_str, DataLimit=100000, RecordData=True)

# ---- group: pht
rec_3 = DataRecorder(python_13, DataLimit=100000, RecordData=True)

# ---- group: setback
rec_4 = DataRecorder(python_12, DataLimit=100000, RecordData=True)

# ---- group: stepback
rec_5 = DataRecorder(python_12, DataLimit=100000, RecordData=True)

# ----
rec_6 = DataRecorder(python_19.avgtemp, DataLimit=100000, RecordData=True)
rec_7 = DataRecorder(python_19.grossarea, DataLimit=100000, RecordData=True)
rec_8 = DataRecorder(python_18, DataLimit=100000, RecordData=True)
rec_9 = DataRecorder(division, DataLimit=100000, RecordData=True)
rec_10 = DataRecorder(python_25, DataLimit=100000, RecordData=True)
python_26 = PythonScript(gfa=division_2, ground_avg_temp=python_24.avgtemp, ground_gross_area=python_24.grossarea, envelope_avg_temp=python_23)  # -> scalar_value; same code as python_25
number_slider_24 = Slider(5, range=0..10)
panel_49 = Panel("Development")
panel_50 = Panel("Archetype")
panel_51 = Panel("Setback")
panel_52 = Panel("Stepback")
panel_53 = Panel("Podium Height")
panel_54 = Panel("GFA")
panel_55 = Panel("Ground Temp")
panel_56 = Panel("Envelope Temp")
panel_57 = Panel("Scalar Value")
panel_58 = Panel("Ground Area")
panel_59 = Panel(python_26)
python_27 = PythonScript(x="soln", y=python_22.a)  # -> a
# ---------- python_27: Python ----------
a = x+y

print a
# ---------- end python_27 ----------
data_16 = Data(python_17)
toggle_9 = BooleanToggle(False)
button = Button()
toggle_10 = BooleanToggle(False)
captureview = Ladybug_CaptureView(
    fileName=python_27,
    folder="C:\Users\user\Desktop\lb_fly",
    imageWidth=Slider(1200, range=0..10000),
    imageHeight=Slider(1600, range=0..10000),
    displayMode="aerial_04",
    transparBack=Toggle(True),
    capture=Toggle(False))  # -> imagePath; plug-in component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
panel_60 = Panel(captureview)
