# Grasshopper definition building_envelope_microclimate_000.gh (Grasshopper 0.9.76)
# plug-ins: Python Interpreter

list = ValueList({"dir", "file"}, selected="dir")

# ---- group: find directory
bibil = PythonScript(
    dir=["C:\\Users\\vasanthakumars\\Documents\\GitHub\\bibil\\src", "C:\\saeran\\master\\git\\bibil\\src"],
    type=list,
    run=Toggle(True))  # -> dir; inputs dir: list
# ---------- bibil: Python ----------
import os
import sys

ghenv.Component.Params.Output[0].Name = "null"
ghenv.Component.Params.Output[0].NickName = "null"

#sys.path.append("C:\Program Files\Rhinoceros 5.0 (64-bit)\System")

if run:
    confirm_dir = None
    for d in dir:
        try:
            if type == "file":
                file_ = open(d)
                file_.close()
            else:
                print os.listdir(d)
            confirm_dir = d
            break
        except Exception as e:
            #print str(e)
            continue
    if confirm_dir != None:
        ghenv.Component.Params.Output[0].Name = type
        ghenv.Component.Params.Output[0].NickName = type
        dir = confirm_dir
        file = confirm_dir
null = None
# ---------- end bibil ----------

# ---- group: abstract_bem
python_script = PythonScript(i=bibil)  # -> o
# ---------- python_script: Python ----------
import os

if i:
    o = os.path.join(str(i),"miru\\miru_abstract_bem.py")
# ---------- end python_script ----------
file = ReadFile(File=python_script, PerLineParse=False)

# ---- group: stepback_manual
python_script_2 = PythonScript(i=bibil)  # -> o
# ---------- python_script_2: Python ----------
import os

if i:
    o = os.path.join(str(i),"miru\\miru_stepback_manual.py")
# ---------- end python_script_2 ----------
file_2 = ReadFile(File=python_script_2, PerLineParse=False)

# ---- group: extract_canyon
python_script_3 = PythonScript(i=bibil)  # -> o
# ---------- python_script_3: Python ----------
import os

if i:
    o = os.path.join(str(i),"miru\\miru_extract_canyon.py")
# ---------- end python_script_3 ----------
file_3 = ReadFile(File=python_script_3, PerLineParse=False)

# ---- group: interpolate_vertical
python_script_4 = PythonScript(i=bibil)  # -> o
# ---------- python_script_4: Python ----------
import os

if i:
    o = os.path.join(str(i),"miru\\miru_interpolate_vertical.py")
# ---------- end python_script_4 ----------
file_4 = ReadFile(File=python_script_4, PerLineParse=False)

# ---- group: filter_nodes
python_script_5 = PythonScript(i=bibil)  # -> o
# ---------- python_script_5: Python ----------
import os

if i:
    o = os.path.join(str(i),"miru\\miru_filter_nodes.py")
# ---------- end python_script_5 ----------
file_5 = ReadFile(File=python_script_5, PerLineParse=False)

# ---- group: tree
python_script_6 = PythonScript(i=bibil)  # -> o
# ---------- python_script_6: Python ----------
import os

if i:
    o = os.path.join(str(i),"bibil\\bibil_tree.py")
# ---------- end python_script_6 ----------
file_6 = ReadFile(File=python_script_6, PerLineParse=False)
bibil_2 = PythonScript(Code=file_6)

# ---- group: grammar
python_script_7 = PythonScript(i=bibil)  # -> o
# ---------- python_script_7: Python ----------
import os

if i:
    o = os.path.join(str(i),"bibil\\bibil_grammar.py")
# ---------- end python_script_7 ----------
file_7 = ReadFile(File=python_script_7, PerLineParse=False)
bibil_3 = PythonScript(Code=file_7)

# ---- group: shape
python_script_8 = PythonScript(i=bibil)  # -> o
# ---------- python_script_8: Python ----------
import os

if i:
    o = os.path.join(str(i),"bibil\\bibil_shape.py")
#o = os.path.join(str(i),"research\\bibil_shape_shape_3d_2d.py")
# ---------- end python_script_8 ----------
file_8 = ReadFile(File=python_script_8, PerLineParse=False)
bibil_4 = PythonScript(Code=file_8)

# ---- group: bula
python_script_9 = PythonScript(i=bibil)  # -> o
# ---------- python_script_9: Python ----------
import os

if i:
    o = os.path.join(str(i),"bula\\bula_minimal.py")
# ---------- end python_script_9 ----------
file_9 = ReadFile(File=python_script_9, PerLineParse=False)
bibil_5 = PythonScript(Code=file_9)

# ---- group: UI
python_script_10 = PythonScript(i=bibil)  # -> o
# ---------- python_script_10: Python ----------
import os

if i:
    o = os.path.join(str(i),"bibil\\bibil_UI.py")
# ---------- end python_script_10 ----------
file_10 = ReadFile(File=python_script_10, PerLineParse=False)

# ---- group: grammar_divide
python_script_11 = PythonScript(i=bibil)  # -> o
# ---------- python_script_11: Python ----------
import os

if i:
    o = os.path.join(str(i),"miru\\miru_divide.py")
# ---------- end python_script_11 ----------
file_11 = ReadFile(File=python_script_11, PerLineParse=False)

# ---- group: grammar_courtyard
python_script_12 = PythonScript(i=bibil)  # -> o
# ---------- python_script_12: Python ----------
import os

if i:
    o = os.path.join(str(i),"miru\\miru_court.py")
# ---------- end python_script_12 ----------
file_12 = ReadFile(File=python_script_12, PerLineParse=False)

# ---- group: grammar_tower
python_script_13 = PythonScript(i=bibil)  # -> o
# ---------- python_script_13: Python ----------
import os

if i:
    o = os.path.join(str(i),"miru\\miru_packing.py")
# ---------- end python_script_13 ----------
file_13 = ReadFile(File=python_script_13, PerLineParse=False)

# ---- group: stepback
python_script_14 = PythonScript(i=bibil)  # -> o
# ---------- python_script_14: Python ----------
import os

if i:
    o = os.path.join(str(i),"miru\\miru_stepback.py")
# ---------- end python_script_14 ----------
file_14 = ReadFile(File=python_script_14, PerLineParse=False)

# ---- group: grammar_height
python_script_15 = PythonScript(i=bibil)  # -> o
# ---------- python_script_15: Python ----------
import os

if i:
    o = os.path.join(str(i),"miru\\miru_height.py")
# ---------- end python_script_15 ----------
file_15 = ReadFile(File=python_script_15, PerLineParse=False)

# ---- group: grammar_analysis_pts
python_script_16 = PythonScript(i=bibil)  # -> o
# ---------- python_script_16: Python ----------
import os

if i:
    o = os.path.join(str(i),"miru\\miru_analysis.py")
# ---------- end python_script_16 ----------
file_16 = ReadFile(File=python_script_16, PerLineParse=False)

# ---- group: meta_tree
python_script_17 = PythonScript(i=bibil)  # -> o
# ---------- python_script_17: Python ----------
import os

if i:
    o = os.path.join(str(i),"miru\\miru_meta_tree.py")
# ---------- end python_script_17 ----------
file_17 = ReadFile(File=python_script_17, PerLineParse=False)

# ---- group: land_use
python_script_18 = PythonScript(i=bibil)  # -> o
# ---------- python_script_18: Python ----------
import os

if i:
    o = os.path.join(str(i),"miru\\miru_landuse.py")
# ---------- end python_script_18 ----------
file_18 = ReadFile(File=python_script_18, PerLineParse=False)

# ---- group: shape2height
python_script_19 = PythonScript(i=bibil)  # -> o
# ---------- python_script_19: Python ----------
import os

if i:
    o = os.path.join(str(i),"miru\\miru_shape2height.py")
# ---------- end python_script_19 ----------
file_19 = ReadFile(File=python_script_19, PerLineParse=False)

# ---- group: extract_slice
python_script_20 = PythonScript(i=bibil)  # -> o
# ---------- python_script_20: Python ----------
import os

if i:
    o = os.path.join(str(i),"miru\\miru_extract_slice.py")
# ---------- end python_script_20 ----------
file_20 = ReadFile(File=python_script_20, PerLineParse=False)

# ----
number_slider = Slider(20, range=0..100)  # disabled
number_slider_2 = Slider(0, range=0..100)  # disabled
number_slider_3 = Slider(2, range=0..10)  # disabled
number_slider_4 = Slider(0.5, range=0..1)  # disabled
number_slider_5 = Slider(0, range=0..100)  # disabled
panel = Panel("22.5:6.0")  # disabled
number_slider_6 = Slider(16.5, range=0..100)  # disabled
panel_2 = Panel("-1")  # disabled
panel_3 = Panel("27.0,25.0")  # disabled
panel_4 = Panel("27.0,25.0")  # disabled
list_2 = ValueList({"divide by depth": "subdivide_depth", "divide by same depth": "subdivide_depth_same", "divide by dim": "subdivide_dim"}, selected="divide by same depth")  # disabled
toggle = BooleanToggle(False)  # disabled
toggle_2 = BooleanToggle(False)  # disabled
toggle_3 = BooleanToggle(False)  # disabled
toggle_4 = BooleanToggle(False)  # disabled
toggle_5 = BooleanToggle(False)  # disabled
toggle_6 = BooleanToggle(False)  # disabled
toggle_7 = BooleanToggle(True)  # disabled
toggle_8 = BooleanToggle(False)  # disabled
list_3 = ValueList({"YZ": "NS", "XZ": "EW", "XY": "Z"}, selected="XZ")  # disabled
panel_5 = Panel("0")  # disabled

# ---- group: SETBACK
miru = PythonScript(Code=file_14, Height_stepback=panel, Run=toggle)  # disabled

# ---- group: PACKING
separatedata = Ladybug_SeparateData(Code=file_13, X_keep_omit=panel_4, Y_keep_omit=panel_3, Seperation_ref=panel_2, Run=toggle_8)  # disabled

# ---- group: EXTRACT_SLICE
miru_2 = PythonScript(Code=file_20, Run=toggle_5)  # disabled

# ---- group: DIVIDE
miru_3 = PythonScript(
    Code=file_11,
    Divide_num=number_slider_3,
    Divide_cut=number_slider_5,
    Divide_type=list_2,
    Divide_ratio=number_slider_4,
    Axis=list_3,
    Run=toggle_6)  # disabled

# ---- group: PERIMETER
miru_4 = PythonScript(Code=file_12, Width=number_slider, Cut_width=number_slider_2, Court_ref=panel_5, Run=toggle_3)  # disabled

# ---- group: HEIGHT
miru_5 = PythonScript(Code=file_15, Height=number_slider_6, Run=toggle_7)  # disabled

# ---- group: TREE RULES
miru_6 = PythonScript(Code=file_17, Run=toggle_2)  # disabled

# ---- group: SHAPE2HEIGHT
miru_7 = PythonScript(Code=file_19, Run=toggle_4)  # disabled

# ----
geo = Geometry(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)
vec = VectorXYZ(XComponent=0, YComponent=0, ZComponent=Slider(200, range=0..1000))  # -> Vector, Length
extr = Extrude(Base=geo, Direction=vec.Vector)
capex = CapHolesEx(Brep=extr)  # -> Brep, Caps, Solid

# ---- group: SHAPE2HEIGHT
miru_8 = PythonScript(Code=file_19, Run=Toggle(True))

# ---- group: SHAPENODE
bibil_6 = PythonScript(Code=file_10, Rule_in=flatten(miru_8), Node_in=flatten(capex.Brep), Run=Toggle(True))  # -> Node_out, Debug

# ----
g = PythonScript(node=bibil_6.Node_out)  # -> crv; inputs node: list
# ---------- g: Python ----------
node = filter(lambda n: n!=None,node)
if node and node != []:
    crv = []
    for n in node:
        #print n.shape.geom
        crv.append(n.shape.bottom_crv)
    #print crv
# ---------- end g ----------
vec_2 = VectorXYZ(XComponent=0, YComponent=0, ZComponent=Slider(3, range=0..10))  # -> Vector, Length
extr_2 = Extrude(Base=g, Direction=vec_2.Vector)
capex_2 = CapHolesEx(Brep=extr_2)  # -> Brep, Caps, Solid
wires = BrepWireframe(Brep=capex_2.Brep, Density=-1)
bibil_7 = PythonScript(Code=file_10, Node_in=flatten(capex_2.Brep), Run=Toggle(True))  # -> Node_out, Debug

bldgprograms = Honeybee_bldgPrograms({"Office": 0, "Retail": 1, "MidriseApartment": 2, "PrimarySchool": 3, "SecondarySchool": 4, "SmallHotel": 5, "LargeHotel": 6, "Hospital": 7, "Outpatient": 8, "Warehouse": 9, "SuperMarket": 10, "FullServiceRestaurant": 11, "QuickServiceRestaurant": 12}, selected="MidriseApartment")
listzoneprograms = Honeybee_ListZonePrograms(bldgProgram=bldgprograms)  # -> MidriseApartmentZonePrograms; plug-in component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
item = ListItem(List=listzoneprograms, Index="0", Wrap=True)

geo_2 = Geometry(capex_2.Brep)
callfromepconstrlibrary = Honeybee_CallFromEPConstructionLibrary(keywords="Window")  # -> EPMaterials, EPWindowMaterils, EPConstructions; plug-in component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
callfromepconstrlibrary_2 = Honeybee_CallFromEPConstructionLibrary(keywords="IEAD")  # -> EPMaterials, EPWindowMaterils, EPConstructions; plug-in component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
callfromepconstrlibrary_3 = Honeybee_CallFromEPConstructionLibrary(keywords="steel")  # -> EPMaterials, EPWindowMaterils, EPConstructions; plug-in component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
toggle_9 = BooleanToggle(False)  # disabled
number_slider_7 = Slider(1, range=0..1)  # disabled
geo_3 = Geometry()  # disabled
number_slider_8 = Slider(8, range=0..10)  # disabled
mass2zone = Honeybee_Masses2Zones(zoneMasses=flatten(geo_2), zonePrograms=item, isConditioned=Toggle(True), maxRoofAngle=30, createHBZones=Toggle(True))  # -> readMe, HBZones; plug-in component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
gentestpts = Honeybee_GenerateTestPoints(testGeometry=geo_3, gridSize=number_slider_8, distBaseSrf=number_slider_7, moveTestMesh=toggle_9)  # -> readMe, simplify(testPoints), simplify(ptsVectors), simplify(facesArea), simplify(mesh); disabled; plug-in component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
item_2 = ListItem(List=callfromepconstrlibrary_3.EPConstructions, Index="3", Wrap=True)
item_3 = ListItem(List=callfromepconstrlibrary.EPConstructions, Index="10", Wrap=True)
item_4 = ListItem(List=callfromepconstrlibrary_2.EPConstructions, Index="6", Wrap=True)
faceb = FaceBoundaries(Mesh=gentestpts.mesh)  # disabled
panel_6 = Panel(item_2)
panel_7 = Panel(item_3)
panel_8 = Panel(item_4)
brep = Brep(faceb)  # disabled
sunion = SolidUnion(Breps=brep)  # disabled
geo_4 = Geometry(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)
zoneattributelist = Honeybee_ZoneAttributeList({"Name": "name", "Zone Program": "zoneProgram", "Zone Floor Area": "zoneFloorArea", "Zone Volume": "zoneVolume", "Building Program": "bldgProgram", "Is Conditioned": "isConditioned", "HVAC System Type": "HVACSystem", "Occupancy Schedule": "occupancySchedule", "Occupancy Activity Schedule": "occupancyActivitySch", "Heating SetPoint Schedule": "heatingSetPtSchedule"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}, selected="Name")  # disabled
mass2zone_2 = Honeybee_Masses2Zones(zoneMasses=flatten(geo_4), isConditioned=True, maxRoofAngle=30, createHBZones=Toggle(True))  # -> readMe, HBZones; plug-in component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
soil_type = Panel("4")
setepzonecnstr = Honeybee_SetEPZoneConstruction(HBZones=flatten(mass2zone.HBZones), wallEPConstruction=item_2, windowEPConstruction=item_3, roofEPConstruction=item_4)  # -> simplify(modifiedHBZones); plug-in component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
labelzones = Honeybee_LabelZones(HBZones=flatten(setepzonecnstr), attribute=zoneattributelist)  # -> zoneTxtLabels, labelBasePts, brepTxtLabels, zoneWireFrames; disabled; plug-in component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
createepground = Honeybee_CreateEPGround(HBZones=mass2zone_2.HBZones, soilTypeOrMat=soil_type)  # -> HBGrndZones; plug-in component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
toggle_10 = BooleanToggle(True)
wires_2 = BrepWireframe(Brep=setepzonecnstr, Density=-1)
tag = TextTag(Location=labelzones.labelBasePts, Text=labelzones.zoneTxtLabels)  # disabled
path = FilePath("C:\saeran\master\git\Bibil\src\reference\CAN_ON_Toronto.716240_CWEC\CAN_ON_Toronto.716240_CWEC.epw")
path_2 = FilePath("C:\saeran\master\git\Bibil\src\reference\CAN_ON_Toronto.716240_CWEC\CAN_ON_Toronto.716240_CWEC.stat")

# ---- group: SHAPENODE
bibil_8 = PythonScript(Code=file_10, Node_in=flatten(createepground), Label_="ground_node", Run=Toggle(True))  # -> Node_out, Node_dead, Debug

# ----
makeadiabaticbytype = Honeybee_MakeAdiabaticByType(HBZones=setepzonecnstr, roofs=toggle_10, exposedFloors=toggle_10)  # -> HBZones; plug-in component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
importepw = Ladybug_ImportEpw(epwFile=path)  # -> readMe, latitude, location, dryBulbTemperature, dewPointTemperature, relativeHumidity, windSpeed, windDirection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; plug-in component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
importstat = Ladybug_ImportStat(statFile=path_2)  # -> readMe, ashraeClimateZone, koppenClimateZone, port, heatingDesignTemp, coolingDesignTemp, port_2, extremeHotWeek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; plug-in component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
ladybug = Ladybug_Ladybug()  # -> Vviiiiiiiiiizzz; plug-in component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
honeybee = Honeybee_Honeybee()  # -> Vviiiiiiiiiizzz; plug-in component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
g_2 = PythonScript(node=bibil_8.Node_out)  # -> geom; inputs node: list
# ---------- g_2: Python ----------
node = filter(lambda n: n!=None,node)
if node and node != []:
    geom = []
    for n in node:
        if n.shape.geom:
            geom.append(n.shape.geom)
    #print geom
# ---------- end g_2 ----------
python = PythonScript(x=importepw.dryBulbTemperature)  # -> a; inputs x: list
# ---------- python: Python ----------
a = reduce(lambda i,j:i+j,x[7:])/float(len(x[7:]))
# ---------- end python ----------
python_2 = PythonScript(x=importepw.relativeHumidity)  # -> a; inputs x: list; same code as python
panel_9 = Panel(importepw.dryBulbTemperature)
panel_10 = Panel(python)
panel_11 = Panel(python_2)
srfattributelist = Honeybee_SurfaceAttributeList({"Name": "name", "Radiance Material": "RadMaterial", "EnergyPlus Construction": "EPConstruction", "Surface Type": "type", "Boundary Condition": "BC", "Sun Exposure": "sunExposure", "Wind Exposure": "windExposure", "Has Child Surface": "hasChild", "Is Child Surface": "isChild", "Is Planar": "isPlanar", "Srf Type Set By User": "srfTypeByUser", "Boundary Condition Set By User": "srfBCByUser", "Shade Material Name": "shadeMaterialName", "Shading Control Name": "shadingControlName", "Shcading Schedule Name": "shadingSchName"}, selected="Boundary Condition")  # disabled
labelsurfaces = Honeybee_LabelZoneSurfaces(attribute=srfattributelist)  # -> surfaceTxtLabels, labelBasePts, brepTxtLabels, surfaceWireFrames; disabled; plug-in component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
wires_3 = BrepWireframe(Density=-1)  # disabled
data = Data([makeadiabaticbytype, createepground])
tag_2 = TextTag(Location=labelsurfaces.labelBasePts, Text=labelsurfaces.surfaceTxtLabels)  # disabled
toggle_11 = BooleanToggle(True)
epoutput = Honeybee_GenerateEPOutput(zoneGainsAndLosses="False", zoneComfortMetrics=toggle_11, surfaceTempAnalysis=toggle_11)  # -> report, flatten(simulationOutputs); plug-in component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
# OutputControl:Table:Style,Comma;
# Output:Variable,*,Surface Outside Face Temperature, hourly;
toggle_12 = BooleanToggle(True)
data_2 = Data(importstat.typicalHotWeek)
exporttoopenstudio = Honeybee_ExportToOpenStudio(
    epwWeatherFile=path,
    analysisPeriod=data_2,
    HBZones=flatten(data),
    simulationOutputs=flatten(epoutput.simulationOutputs),
    writeOSM=toggle_12,
    runSimulation=toggle_12)  # -> readMe, osmFileAddress, idfFileAddress, resultsFileAddress, eioFileAddress, rddFileAddress, studyFolder; plug-in component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
readepsrfresult = Honeybee_ReadEPSurfaceResult(resultFileAddress=exporttoopenstudio.resultsFileAddress)  # -> surfaceIndoorTemp, surfaceOutdoorTemp, port, port_2, port_3, port_4, port_5, port_6, port_7, port_8; plug-in component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
panel_12 = Panel(readepsrfresult.surfaceOutdoorTemp)
colorsurfaces = Honeybee_ColorSurfacesByEPResult(srfData=readepsrfresult.surfaceOutdoorTemp, HBZones=flatten(data), runIt=Toggle(True))  # -> readMe, srfColoredMesh, zoneWireFrame, legend, legendBasePt, analysisTitle, srfBreps, srfColors, srfValues, port; plug-in component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
area = Area(Geometry=colorsurfaces.srfBreps)  # -> Area, Centroid
number_slider_9 = Slider(15, range=0..100)
number_slider_10 = Slider(35, range=0..100)
sort = SortList(Keys=colorsurfaces.srfValues)  # -> Keys, ValuesA
tag_3 = TextTag(Location=area.Centroid, Text=colorsurfaces.srfValues)
geo_5 = Geometry(colorsurfaces.srfBreps)
item_5 = ListItem(List=sort.Keys, Index=0, Wrap=True)
item_6 = ListItem(List=sort.Keys, Index="-1", Wrap=True)
gradient = Gradient(
    LowerLimit=item_5,
    UpperLimit=item_6,
    Parameter=colorsurfaces.srfValues,
    stops=[0: RGB(255, 0, 64), 0.25: RGB(245, 93, 0), 0.532: RGB(255, 255, 22), 0.75: RGB(93, 177, 249), 1: RGB(0, 44, 169)])
geo_6 = Geometry(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)

# ---- group: BIBIL2HBZone
python_3 = PythonScript(HBZones=makeadiabaticbytype, BBNodes=bibil_7.Node_out, HBground=createepground, BBground=bibil_8.Node_out)  # -> BBNodes; inputs HBZones: list, BBNodes: list
# ---------- python_3: Python ----------
import scriptcontext as sc
import rhinoscriptsyntax as rs

hb_hive = sc.sticky["honeybee_Hive"]()


def IsList(lst):
    return lst != [None] and lst != []

if IsList(_HBZones) and IsList(_BBNodes):
    #print len(_HBZones)
    #print len(_BBNodes)
    for i in xrange(len(_HBZones)):
        hb = _HBZones[i]
        hb = rs.coercebrep(hb)
        #zone = hb_hive.visualizeFromHoneybeeHive([hb])[0]
        bb = _BBNodes[i]
        bb.grammar.type['HBZone'] = hb
        _BBNodes[i] = bb
    
    if _HBground and _BBground:
        _HBground = rs.coercebrep(_HBground)
        _BBground.grammar.type['HBZone'] = _HBground
        _BBNodes.append(_BBground)
# ---------- end python_3 ----------

# ---- group: EXTRACT_CANYON
miru_9 = PythonScript(
    Code=file_3,
    Canyon_tol=Slider(30, range=0..100),
    Canyon_center=geo_6,
    Srf_data=readepsrfresult.surfaceOutdoorTemp,
    Run=Toggle(True))

# ----
preview = CustomPreview(Geometry=geo_5, Shader=gradient)

# ---- group: SHAPENODE
bibil_9 = PythonScript(Code=file_10, Rule_in=flatten(miru_9), Node_in=flatten(python_3), Run=Toggle(True))  # -> Node_out, Node_dead, Debug

# ----
g_3 = PythonScript(node=bibil_9.Node_out)  # -> pt; inputs node: list
# ---------- g_3: Python ----------
node = filter(lambda n: n!=None,node)
if node and node != []:
    pt = []
    for n in node:
        n = n.backtrack_tree(lambda n: n.grammar.type.has_key('processed_srf_geom'))
        if n:
            srf_data = n.grammar.type['processed_srf_pt']
            #print srf_data
            # print '--'
            pt.extend(srf_data)
    #print pt
# ---------- end g_3 ----------
g_4 = PythonScript(node=bibil_9.Node_out)  # -> temp; inputs node: list
# ---------- g_4: Python ----------
if node and node != [None]:
    temp = []
    for n in node:
        #if n.grammar.type.has_key('processed_srf_data'):
        n = n.backtrack_tree(lambda n: n.grammar.type.has_key('processed_srf_data'))
        if n:
            srf_data = n.grammar.type['processed_srf_data']
            temp.extend(srf_data)
    #print temp
# ---------- end g_4 ----------
g_5 = PythonScript(node=bibil_9.Node_out)  # -> srf; inputs node: list
# ---------- g_5: Python ----------
if node and node != [None]:
    srf = []
    for n in node:
        n = n.backtrack_tree(lambda n: n.grammar.type.has_key('processed_srf_geom'))
        #if n.grammar.type.has_key('processed_srf_geom'):
        if n:
            srf_data = n.grammar.type['processed_srf_geom']
            #print srf_data
            #print '-'
            srf.extend(srf_data)
    #print srf
# ---------- end g_5 ----------
g_6 = PythonScript(node=bibil_9.Node_out)  # -> norm; inputs node: list
# ---------- g_6: Python ----------
node = filter(lambda n: n!=None,node)
if node and node != []:
    norm = []
    for n in node:
        n = n.backtrack_tree(lambda n: n.grammar.type.has_key('processed_srf_normal'))
        if n:
            srf_data = n.grammar.type['processed_srf_normal']
            #print srf_data
            # print '--'
            norm.extend(srf_data)
    #print norm
# ---------- end g_6 ----------
sort_2 = SortList(Keys=g_4)  # -> Keys, ValuesA
item_7 = ListItem(List=sort_2.Keys, Index=0, Wrap=True)
item_8 = ListItem(List=sort_2.Keys, Index="-1", Wrap=True)
panel_13 = Panel(item_7)
panel_14 = Panel(item_8)
move = Move(Geometry=g_5, Motion=g_6)  # -> Geometry, Transform
wires_4 = BrepWireframe(Brep=move.Geometry, Density=-1)

# ---- group: 0
data_3 = Data(item_5)

# ---- group: -1
data_4 = Data(item_6)

# ----
mesh = Mesh(move.Geometry)
preview_2 = CustomPreview(
    Geometry=wires_4,
    Shader={ambient=RGB(0, 0, 0), diffuse=RGB(255, 105, 180), emission=RGB(76, 32, 54), shine=0.5, specular=RGB(255, 255, 255), transparency=0})
gradient_2 = Gradient(
    LowerLimit=data_3,
    UpperLimit=data_4,
    Parameter=g_4,
    stops=[0: RGB(0, 255, 255), 0.502: RGB(255, 255, 0), 1: RGB(255, 0, 138)])
demesh = DeconstructMesh(Mesh=mesh)  # -> Vertices, Faces, Colours, Normals
conmesh = ConstructMesh(Vertices=demesh.Vertices, Faces=demesh.Faces)
mcol = MeshColours(Mesh=graft(conmesh), Colours=graft(gradient_2))
mesh_2 = Mesh(mcol)
