# Grasshopper definition plugin_connector.gh (Grasshopper 0.9.76)
# plug-ins: Python Interpreter

python = PythonScript()  # -> out, HT_PT, GEO3D, PARCEL, iPARCEL
# ---------- python: Python ----------
import Rhino
import rhinoscriptsyntax as rs
import scriptcontext

PARCEL=[]
GEO3D=[]
HT_PT=[]
iPARCEL=[]
scriptcontext.doc=Rhino.RhinoDoc.ActiveDoc
intermediate_parcel_crvs=rs.ObjectsByLayer("_prog_intermediate_parcel")
merged_parcel_list=rs.ObjectsByLayer("_prog_merged_parcel")
parcel_list=rs.ObjectsByLayer("_prog_ori_parcel")
geo_3d_list=rs.ObjectsByLayer("_prog_parcel_3d")
h_pt=[]
for i in geo_3d_list:
    bb=rs.BoundingBox(i)
    pl=rs.AddPolyline([bb[0],bb[1],bb[2],bb[3],bb[0]])
    cen=rs.CurveAreaCentroid(pl)[0]
    h_pt.append([cen[0],cen[1],rs.BoundingBox(i)[4][2]])
    rs.DeleteObject(pl)
k=0
for i in parcel_list:
    #print(str(k)+' )'+str(i))
    PARCEL.append(rs.coercecurve(i))
    k+=1
k=0
for i in merged_parcel_list:
    #print(str(k)+' )'+str(i))
    PARCEL.append(rs.coercecurve(i))
    k+=1
k=0
for i in intermediate_parcel_crvs:
    #print(str(k)+' )'+str(i))
    iPARCEL.append(rs.coercecurve(i))
    k+=1
for i in geo_3d_list:
    GEO3D.append(rs.coercegeometry(i))

for i in h_pt:
    HT_PT.append(rs.coerce3dpoint(i))
scriptcontext.doc=ghdoc
# ---------- end python ----------
Y = UnitY(Factor=Slider(2000, range=0..5000))
move = Move(Geometry=python.HT_PT, Motion=Y)  # -> Geometry, Transform
move_2 = Move(Geometry=python.PARCEL, Motion=Y)  # -> Geometry, Transform
move_3 = Move(Geometry=python.iPARCEL, Motion=Y)  # -> Geometry, Transform
move_4 = Move(Geometry=python.GEO3D, Motion=Y)  # -> Geometry, Transform
