# Grasshopper definition straight_mandlebrot_bulb_1.gh (Grasshopper 0.9.76)
# plug-ins: Python Interpreter

geo = Geometry(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)
geo_2 = Geometry(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)
mandelbrot = PythonScript(crv_lst=geo, run=Toggle(True))  # -> mb, color
# ---------- mandelbrot: Python ----------
import math
import Rhino as rc
import rhinoscriptsyntax as rs

def mandelbrot(z_,c_,n_=40):
    #zn+1 = zn^2 + c
    #c = a + bi (pt on xy plane)
    #If |zn| stays bounded as n -> infinity then c belongs to the Mandelbrot set. 
    #and if n less then 100
    zbound = 1000
    zn1 = reduce(lambda a,b: a*a + c_,range(n_)) 
    if abs(zn1) > zbound:
        return float("nan"),9999
    else:
        return zn1, abs(zn1)

if run:
    #Hypercomplex numbers
    #http://www.fractal.org/Formula-Mandelbulb.pdf
    #http://bugman123.com/Hypercomplex/
    epsilon = 8
    delta = 0.05
    sc = 10.0
    
    ptlst, rgblst = [],[]
    xnumlin = map(lambda a: a * delta, range(-1*epsilon, 1*epsilon))
    ynumlin = map(lambda a: a * delta, range(-1*epsilon, 1*epsilon))
    znumlin = map(lambda a: a * delta, range(-1*epsilon, 1*epsilon))
    
    for i in xrange(len(xnumlin)):
        for j in xrange(len(ynumlin)):
            for k in xrange(len(znumlin)):
                x,y,z = xnumlin[i], ynumlin[j], znumlin[k]
                pt = rc.Geometry.Point3d(x*sc,y*sc,z*sc)
                ptlst.append(pt)
                #xyplane = rc.Geometry.Plane.WorldXY
                #tol = 0.00001
                #IsOutside = rc.Geometry.PointContainment.Outside
                #crv = rs.coercecurve(crv_lst)
                #chkcrv = crv.Contains(pt,xyplane,tol)
                #if chkcrv == IsOutside:
                #    continue
                
                #complex: a + bj (j == i in python)
                """
                c = complex(x,y)
                z,rgb = mandelbrot(0,c,40)
                if not math.isnan(z.real):
                    
                    ptlst.append(pt)
                    if rgb > 10: rgb = 5.0
                    rgblst.append(rgb)
                """
    mb = ptlst
    color = rgblst
# ---------- end mandelbrot ----------
mandelbrot_2 = PythonScript(crv_lst=geo_2, run=Toggle(False))  # -> mb, color
# ---------- mandelbrot_2: Python ----------
import math
import Rhino as rc
import rhinoscriptsyntax as rs

def mandelbrot(z_,c_,n_=40):
    #zn+1 = zn^2 + c
    #c = a + bi (pt on xy plane)
    #If |zn| stays bounded as n -> infinity then c belongs to the Mandelbrot set. 
    #and if n less then 100
    zbound = 1000
    zn1 = reduce(lambda a,b: a*a + c_,range(n_)) 
    if abs(zn1) > zbound:
        return float("nan"),9999
    else:
        return zn1, abs(zn1)

if run:
    ptlst, rgblst = [],[]
    epsilon = 160
    realnumlin = map(lambda a: a * 0.02, range(-1*epsilon, 1*epsilon))
    complexnumlin = map(lambda a: a * 0.02, range(-1*epsilon, 1*epsilon))
    print len(realnumlin), len(complexnumlin)
    for i in xrange(len(realnumlin)):
        for j in xrange(len(complexnumlin)):
            x,y = realnumlin[i], complexnumlin[j]
            
            pt = rc.Geometry.Point3d(x,y,0)
            xyplane = rc.Geometry.Plane.WorldXY
            tol = 0.00001
            IsOutside = rc.Geometry.PointContainment.Outside
            crv = rs.coercecurve(crv_lst)
            chkcrv = crv.Contains(pt,xyplane,tol)
            if chkcrv == IsOutside:
                continue
            #complex: a + bj (j == i in python)
            c = complex(x,y)
            #print 'r:', c.real, 'i:', c.imag
            z,rgb = mandelbrot(0,c,40)
            if not math.isnan(z.real):
                
                ptlst.append(pt)
                if rgb > 10: rgb = 5.0
                rgblst.append(rgb)
            
    mb = ptlst
    color = rgblst
# ---------- end mandelbrot_2 ----------
sort = SortList(Keys=mandelbrot_2.color)  # -> Keys, ValuesA
sort_2 = SortList(Keys=mandelbrot.mb)  # -> Keys, ValuesA
item = ListItem(List=sort.Keys, Index=0, Wrap=True)
item_2 = ListItem(List=sort.Keys, Index="-1", Wrap=True)
item_3 = ListItem(List=sort_2.Keys, Index=0, Wrap=True)
item_4 = ListItem(List=sort_2.Keys, Index="-1", Wrap=True)
panel = Panel(sort.Keys)
gradient = Gradient(
    LowerLimit=item,
    UpperLimit=item_2,
    Parameter=mandelbrot_2.color,
    stops=[0: RGB(255, 0, 138), 0.119: RGB(255, 255, 0), 0.225: RGB(0, 255, 255)])
gradient_2 = Gradient(
    LowerLimit=item_3,
    UpperLimit=item_4,
    Parameter=mandelbrot.color,
    stops=[0: RGB(255, 0, 138), 0.119: RGB(255, 255, 0), 0.225: RGB(0, 255, 255)])
cir = Circle(Plane=mandelbrot_2.mb, Radius="0.001")
cir_2 = Circle(Plane=mandelbrot.mb, Radius="0.1")
preview = CustomPreview(Geometry=cir, Shader=gradient)
preview_2 = CustomPreview(
    Geometry=cir_2,
    Shader={ambient=RGB(0, 0, 0), diffuse=RGB(255, 105, 180), emission=RGB(76, 32, 54), shine=0.5, specular=RGB(255, 255, 255), transparency=0})
