# Grasshopper definition straight_skeleton_algorithm_1.gh (Grasshopper 0.9.76)
# plug-ins: Python Interpreter, HDTReference

list = ValueList({"dir", "file"}, selected="dir")

# ---- group: find directory
bibil = PythonScript(
    dir=["C:\\Users\\vasanthakumars\\Documents\\GitHub\\bibil\\src", "C:\\saeran\\master\\git\\bibil\\src"],
    type=list,
    run=Toggle(True))  # -> dir; inputs dir: list
# ---------- bibil: Python ----------
import os
import sys

ghenv.Component.Params.Output[0].Name = "null"
ghenv.Component.Params.Output[0].NickName = "null"

#sys.path.append("C:\Program Files\Rhinoceros 5.0 (64-bit)\System")

if run:
    confirm_dir = None
    for d in dir:
        try:
            if type == "file":
                file_ = open(d)
                file_.close()
            else:
                print os.listdir(d)
            confirm_dir = d
            break
        except Exception as e:
            #print str(e)
            continue
    if confirm_dir != None:
        ghenv.Component.Params.Output[0].Name = type
        ghenv.Component.Params.Output[0].NickName = type
        dir = confirm_dir
        file = confirm_dir
null = None
# ---------- end bibil ----------

# ---- group: straight_skeleton
python_script = PythonScript(i=bibil)  # -> o
# ---------- python_script: Python ----------
import os

if i:
    o = os.path.join(str(i),"miru\\miru_straight_skeleton.py")
# ---------- end python_script ----------
file = ReadFile(File=python_script, PerLineParse=False)

# ---- group: node_bucket
python_script_2 = PythonScript(i=bibil)  # -> o
# ---------- python_script_2: Python ----------
import os

if i:
    o = os.path.join(str(i),"miru\\miru_shape_bucket.py")
# ---------- end python_script_2 ----------
file_2 = ReadFile(File=python_script_2, PerLineParse=False)

# ---- group: tree
python_script_3 = PythonScript(i=bibil)  # -> o
# ---------- python_script_3: Python ----------
import os

if i:
    o = os.path.join(str(i),"bibil\\bibil_tree.py")
# ---------- end python_script_3 ----------
file_3 = ReadFile(File=python_script_3, PerLineParse=False)
bibil_2 = PythonScript(Code=file_3)

# ---- group: grammar
python_script_4 = PythonScript(i=bibil)  # -> o
# ---------- python_script_4: Python ----------
import os

if i:
    o = os.path.join(str(i),"bibil\\bibil_grammar.py")
# ---------- end python_script_4 ----------
file_4 = ReadFile(File=python_script_4, PerLineParse=False)
bibil_3 = PythonScript(Code=file_4)

# ---- group: shape
python_script_5 = PythonScript(i=bibil)  # -> o
# ---------- python_script_5: Python ----------
import os

if i:
    o = os.path.join(str(i),"bibil\\bibil_shape.py")
#o = os.path.join(str(i),"research\\bibil_shape_shape_3d_2d.py")
# ---------- end python_script_5 ----------
file_5 = ReadFile(File=python_script_5, PerLineParse=False)
bibil_4 = PythonScript(Code=file_5)

# ---- group: UI
python_script_6 = PythonScript(i=bibil)  # -> o
# ---------- python_script_6: Python ----------
import os

if i:
    o = os.path.join(str(i),"bibil\\bibil_UI.py")
# ---------- end python_script_6 ----------
file_6 = ReadFile(File=python_script_6, PerLineParse=False)

# ---- group: grammar_divide
python_script_7 = PythonScript(i=bibil)  # -> o
# ---------- python_script_7: Python ----------
import os

if i:
    o = os.path.join(str(i),"miru\\miru_divide.py")
# ---------- end python_script_7 ----------
file_7 = ReadFile(File=python_script_7, PerLineParse=False)

# ---- group: grammar_courtyard
python_script_8 = PythonScript(i=bibil)  # -> o
# ---------- python_script_8: Python ----------
import os

if i:
    o = os.path.join(str(i),"miru\\miru_court.py")
# ---------- end python_script_8 ----------
file_8 = ReadFile(File=python_script_8, PerLineParse=False)

# ---- group: grammar_tower
python_script_9 = PythonScript(i=bibil)  # -> o
# ---------- python_script_9: Python ----------
import os

if i:
    o = os.path.join(str(i),"miru\\miru_packing.py")
# ---------- end python_script_9 ----------
file_9 = ReadFile(File=python_script_9, PerLineParse=False)

# ---- group: stepback
python_script_10 = PythonScript(i=bibil)  # -> o
# ---------- python_script_10: Python ----------
import os

if i:
    o = os.path.join(str(i),"miru\\miru_stepback.py")
# ---------- end python_script_10 ----------
file_10 = ReadFile(File=python_script_10, PerLineParse=False)

# ---- group: grammar_height
python_script_11 = PythonScript(i=bibil)  # -> o
# ---------- python_script_11: Python ----------
import os

if i:
    o = os.path.join(str(i),"miru\\miru_height.py")
# ---------- end python_script_11 ----------
file_11 = ReadFile(File=python_script_11, PerLineParse=False)

# ---- group: grammar_analysis_pts
python_script_12 = PythonScript(i=bibil)  # -> o
# ---------- python_script_12: Python ----------
import os

if i:
    o = os.path.join(str(i),"miru\\miru_analysis.py")
# ---------- end python_script_12 ----------
file_12 = ReadFile(File=python_script_12, PerLineParse=False)

# ---- group: meta_tree
python_script_13 = PythonScript(i=bibil)  # -> o
# ---------- python_script_13: Python ----------
import os

if i:
    o = os.path.join(str(i),"miru\\miru_meta_tree.py")
# ---------- end python_script_13 ----------
file_13 = ReadFile(File=python_script_13, PerLineParse=False)

# ---- group: land_use
python_script_14 = PythonScript(i=bibil)  # -> o
# ---------- python_script_14: Python ----------
import os

if i:
    o = os.path.join(str(i),"miru\\miru_landuse.py")
# ---------- end python_script_14 ----------
file_14 = ReadFile(File=python_script_14, PerLineParse=False)

# ---- group: shape2height
python_script_15 = PythonScript(i=bibil)  # -> o
# ---------- python_script_15: Python ----------
import os

if i:
    o = os.path.join(str(i),"miru\\miru_shape2height.py")
# ---------- end python_script_15 ----------
file_15 = ReadFile(File=python_script_15, PerLineParse=False)

# ---- group: extract_slice
python_script_16 = PythonScript(i=bibil)  # -> o
# ---------- python_script_16: Python ----------
import os

if i:
    o = os.path.join(str(i),"miru\\miru_extract_slice.py")
# ---------- end python_script_16 ----------
file_16 = ReadFile(File=python_script_16, PerLineParse=False)

# ---- group: pyeuclid
python_script_17 = PythonScript(i=bibil)  # -> o
# ---------- python_script_17: Python ----------
import os

if i:
    o = os.path.join(str(i),"bibil\\pyeuclid.py")
# ---------- end python_script_17 ----------
file_17 = ReadFile(File=python_script_17, PerLineParse=False)
bibil_5 = PythonScript(Code=file_17)

# ---- group: bula
python_script_18 = PythonScript(i=bibil)  # -> o
# ---------- python_script_18: Python ----------
import os

if i:
    o = os.path.join(str(i),"bula\\bula_minimal.py")
# ---------- end python_script_18 ----------
file_18 = ReadFile(File=python_script_18, PerLineParse=False)
bibil_6 = PythonScript(Code=file_18)

# ----
number_slider = Slider(10, range=0..10)  # disabled
list_2 = ValueList({"divide by depth": "subdivide_depth", "divide by same depth": "subdivide_depth_same", "divide by dim": "subdivide_dim"}, selected="divide by same depth")
geo = Geometry()  # disabled
Z = UnitZ(Factor=number_slider)  # disabled
list_3 = ValueList({"YZ": "NS", "XZ": "EW", "XY": "Z"}, selected="XZ")
geo_2 = Geometry(<curve referenced from the Rhino model>)
number_slider_2 = Slider(20, range=0..100)  # disabled
python = PythonScript(x=geo_2)  # -> a
# ---------- python: Python ----------
import rhinoscriptsyntax as rs


P = rs.PolylineVertices(x)

a = P
# ---------- end python ----------
extr = Extrude(Base=geo, Direction=Z)  # disabled

# ---- group: ENERGY_MODEL_BUCKET
miru = PythonScript(Code=file_2, Run=Toggle(True))

# ---- group: SETBACK
miru_2 = PythonScript(Code=file_10, Height_stepback="22.5:6.0", Run=Toggle(False))

# ---- group: PACKING
separatedata = Ladybug_SeparateData(Code=file_9, X_keep_omit="27.0,25.0", Y_keep_omit="27.0,25.0", Seperation_ref="-1", Run=Toggle(False))

# ---- group: EXTRACT_SLICE
miru_3 = PythonScript(Code=file_16, Run=Toggle(False))

# ---- group: DIVIDE
miru_4 = PythonScript(
    Code=file_7,
    Divide_num=Slider(2, range=0..10),
    Divide_cut=Slider(0, range=0..100),
    Divide_type=list_2,
    Divide_ratio=Slider(0.5, range=0..1),
    Axis=list_3,
    Run=Toggle(False))

# ---- group: PERIMETER
miru_5 = PythonScript(Code=file_8, Width=Slider(20, range=0..100), Cut_width=Slider(0, range=0..100), Court_ref="0", Run=Toggle(False))

# ---- group: HEIGHT
miru_6 = PythonScript(Code=file_11, Height=Slider(16.5, range=0..100), Run=Toggle(True))

# ----
honeybee = Honeybee_Honeybee()  # -> Vviiiiiiiiiizzz; disabled; plug-in component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
ladybug = Ladybug_Ladybug()  # -> Vviiiiiiiiiizzz; disabled; plug-in component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

# ---- group: TREE RULES
miru_7 = PythonScript(Code=file_13, Run=Toggle(False))

# ---- group: SHAPE2HEIGHT
miru_8 = PythonScript(Code=file_15, Run=Toggle(False))

# ----
toggle = BooleanToggle(True)  # disabled
cap = CapHoles(Brep=extr)  # disabled
hull = ConvexHull(Points=python, Plane=PlaneXY(0, 0, 0))  # -> Hull, HullZ, Indices

# ---- group: straight_skeleton
miru_9 = PythonScript(Code=file, Run=Toggle(True))

miru_10 = PythonScript(Code=file, Run=Toggle(True))

# ----
geo_3 = Geometry(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)
geo_4 = Geometry(<curve referenced from the Rhino model>)
preview = CustomPreview(
    Geometry=hull.Hull,
    Shader={ambient=RGB(0, 0, 0), diffuse=RGB(255, 105, 180), emission=RGB(76, 32, 54), shine=0.5, specular=RGB(255, 255, 255), transparency=0})
splitmass = Honeybee_SplitBuildingMass(bldgMasses=cap, perimeterZoneDepth=number_slider_2, runIt=toggle)  # -> readMe, splitBldgMasses; disabled; plug-in component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
python_2 = PythonScript()  # -> skel, debug; disabled
# ---------- python_2: Python ----------
# -*- coding: utf-8 -*-

"""
Implementation of the straight skeleton algorithm as described by Felkel and Obdržálek in their 1998 conference paper Straight skeleton implementation.
"""

import logging
import heapq
#from euclid import *
from itertools import *
from collections import namedtuple

log = logging.getLogger("__name__")


#!/usr/bin/env python
#
# euclid graphics maths module
#
# Copyright (c) 2006 Alex Holkner <Alex.Holkner@mail.google.com>
# Copyright (c) 2011 Eugen Zagorodniy <https://github.com/ezag/>
# Copyright (c) 2011 Dov Grobgeld <https://github.com/dov>
# Copyright (c) 2012 Lorenzo Riano <https://github.com/lorenzoriano>
#
# This library is free software; you can redistribute it and/or modify it
# under the terms of the GNU Lesser General Public License as published by the
# Free Software Foundation; either version 2.1 of the License, or (at your
# option) any later version.
# 
# This library is distributed in the hope that it will be useful, but WITHOUT
# ANY WARRANTY; without even the implied warranty of MERCHANTABILITY or
# FITNESS FOR A PARTICULAR PURPOSE.  See the GNU Lesser General Public License
# for more details.
# 
# You should have received a copy of the GNU Lesser General Public License
# along with this library; if not, write to the Free Software Foundation,
# Inc., 51 Franklin Street, Fifth Floor, Boston, MA  02110-1301 USA

'''euclid graphics maths module

Documentation and tests are included in the file "euclid.rst", or online
at https://github.com/ezag/pyeuclid/blob/master/euclid.rst
'''

import scriptcontext as sc

__docformat__ = 'restructuredtext'
__version__ = '$Id$'
__revision__ = '$Revision$'

import math
import operator
import types

try:
    long
except NameError:
    long = int

# Some magic here.  If _use_slots is True, the classes will derive from
# object and will define a __slots__ class variable.  If _use_slots is
# False, classes will be old-style and will not define __slots__.
#
# _use_slots = True:   Memory efficient, probably faster in future versions
#                      of Python, "better".
# _use_slots = False:  Ordinary classes, much faster than slots in current
#                      versions of Python (2.4 and 2.5).
_use_slots = True

# If True, allows components of Vector2 and Vector3 to be set via swizzling;
# e.g.  v.xyz = (1, 2, 3).  This is much, much slower than the more verbose
# v.x = 1; v.y = 2; v.z = 3,  and slows down ordinary element setting as
# well.  Recommended setting is False.
_enable_swizzle_set = False

# Requires class to derive from object.
if _enable_swizzle_set:
    _use_slots = True

# Implement _use_slots magic.
class _EuclidMetaclass(type):
    def __new__(cls, name, bases, dct):
        if '__slots__' in dct:
            dct['__getstate__'] = cls._create_getstate(dct['__slots__'])
            dct['__setstate__'] = cls._create_setstate(dct['__slots__'])
        if _use_slots:
            return type.__new__(cls, name, bases + (object,), dct)
        else:
            if '__slots__' in dct:
                del dct['__slots__']
            return types.ClassType.__new__(types.ClassType, name, bases, dct)

    @classmethod
    def _create_getstate(cls, slots):
        def __getstate__(self):
            d = {}
            for slot in slots:
                d[slot] = getattr(self, slot)
            return d
        return __getstate__

    @classmethod
    def _create_setstate(cls, slots):
        def __setstate__(self, state):
            for name, value in state.items():
                setattr(self, name, value)
        return __setstate__

__metaclass__ = _EuclidMetaclass

class Vector2:
    __slots__ = ['x', 'y']
    __hash__ = None

    def __init__(self, x=0, y=0):
        self.x = x
        self.y = y

    def __copy__(self):
        return self.__class__(self.x, self.y)

    copy = __copy__

    def __repr__(self):
        return 'Vector2(%.2f, %.2f)' % (self.x, self.y)

    def __eq__(self, other):
        if isinstance(other, Vector2):
            return self.x == other.x and \
                   self.y == other.y
        else:
            assert hasattr(other, '__len__') and len(other) == 2
            return self.x == other[0] and \
                   self.y == other[1]

    def __ne__(self, other):
        return not self.__eq__(other)

    def __nonzero__(self):
        return bool(self.x != 0 or self.y != 0)

    def __len__(self):
        return 2

    def __getitem__(self, key):
        return (self.x, self.y)[key]

    def __setitem__(self, key, value):
        l = [self.x, self.y]
        l[key] = value
        self.x, self.y = l

    def __iter__(self):
        return iter((self.x, self.y))

    def __getattr__(self, name):
        try:
            return tuple([(self.x, self.y)['xy'.index(c)] \
                          for c in name])
        except ValueError:
            raise AttributeError(name)

    if _enable_swizzle_set:
        # This has detrimental performance on ordinary setattr as well
        # if enabled
        def __setattr__(self, name, value):
            if len(name) == 1:
                object.__setattr__(self, name, value)
            else:
                try:
                    l = [self.x, self.y]
                    for c, v in map(None, name, value):
                        l['xy'.index(c)] = v
                    self.x, self.y = l
                except ValueError:
                    raise AttributeError(name)

    def __add__(self, other):
        if isinstance(other, Vector2):
            # Vector + Vector -> Vector
            # Vector + Point -> Point
            # Point + Point -> Vector
            if self.__class__ is other.__class__:
                _class = Vector2
            else:
                _class = Point2
            return _class(self.x + other.x,
                          self.y + other.y)
        else:
            assert hasattr(other, '__len__') and len(other) == 2
            return Vector2(self.x + other[0],
                           self.y + other[1])
    __radd__ = __add__

    def __iadd__(self, other):
        if isinstance(other, Vector2):
            self.x += other.x
            self.y += other.y
        else:
            self.x += other[0]
            self.y += other[1]
        return self

    def __sub__(self, other):
        if isinstance(other, Vector2):
            # Vector - Vector -> Vector
            # Vector - Point -> Point
            # Point - Point -> Vector
            if self.__class__ is other.__class__:
                _class = Vector2
            else:
                _class = Point2
            return _class(self.x - other.x,
                          self.y - other.y)
        else:
            assert hasattr(other, '__len__') and len(other) == 2
            return Vector2(self.x - other[0],
                           self.y - other[1])

   
    def __rsub__(self, other):
        if isinstance(other, Vector2):
            return Vector2(other.x - self.x,
                           other.y - self.y)
        else:
            assert hasattr(other, '__len__') and len(other) == 2
            return Vector2(other.x - self[0],
                           other.y - self[1])

    def __mul__(self, other):
        assert type(other) in (int, long, float)
        return Vector2(self.x * other,
                       self.y * other)

    __rmul__ = __mul__

    def __imul__(self, other):
        assert type(other) in (int, long, float)
        self.x *= other
        self.y *= other
        return self

    def __div__(self, other):
        assert type(other) in (int, long, float)
        return Vector2(operator.div(self.x, other),
                       operator.div(self.y, other))


    def __rdiv__(self, other):
        assert type(other) in (int, long, float)
        return Vector2(operator.div(other, self.x),
                       operator.div(other, self.y))

    def __floordiv__(self, other):
        assert type(other) in (int, long, float)
        return Vector2(operator.floordiv(self.x, other),
                       operator.floordiv(self.y, other))


    def __rfloordiv__(self, other):
        assert type(other) in (int, long, float)
        return Vector2(operator.floordiv(other, self.x),
                       operator.floordiv(other, self.y))

    def __truediv__(self, other):
        assert type(other) in (int, long, float)
        return Vector2(operator.truediv(self.x, other),
                       operator.truediv(self.y, other))


    def __rtruediv__(self, other):
        assert type(other) in (int, long, float)
        return Vector2(operator.truediv(other, self.x),
                       operator.truediv(other, self.y))
    
    def __neg__(self):
        return Vector2(-self.x,
                        -self.y)

    __pos__ = __copy__
    
    def __abs__(self):
        return math.sqrt(self.x ** 2 + \
                         self.y ** 2)

    magnitude = __abs__

    def magnitude_squared(self):
        return self.x ** 2 + \
               self.y ** 2

    def normalize(self):
        d = self.magnitude()
        if d:
            self.x /= d
            self.y /= d
        return self

    def normalized(self):
        d = self.magnitude()
        if d:
            return Vector2(self.x / d, 
                           self.y / d)
        return self.copy()

    def dot(self, other):
        assert isinstance(other, Vector2)
        return self.x * other.x + \
               self.y * other.y

    def cross(self):
        return Vector2(self.y, -self.x)

    def reflect(self, normal):
        # assume normal is normalized
        assert isinstance(normal, Vector2)
        d = 2 * (self.x * normal.x + self.y * normal.y)
        return Vector2(self.x - d * normal.x,
                       self.y - d * normal.y)

    def angle(self, other):
        """Return the angle to the vector other"""
        return math.acos(self.dot(other) / (self.magnitude()*other.magnitude()))

    def project(self, other):
        """Return one vector projected on the vector other"""
        n = other.normalized()
        return self.dot(n)*n

class Vector3:
    __slots__ = ['x', 'y', 'z']
    __hash__ = None

    def __init__(self, x=0, y=0, z=0):
        self.x = x
        self.y = y
        self.z = z

    def __copy__(self):
        return self.__class__(self.x, self.y, self.z)

    copy = __copy__

    def __repr__(self):
        return 'Vector3(%.2f, %.2f, %.2f)' % (self.x,
                                              self.y,
                                              self.z)

    def __eq__(self, other):
        if isinstance(other, Vector3):
            return self.x == other.x and \
                   self.y == other.y and \
                   self.z == other.z
        else:
            assert hasattr(other, '__len__') and len(other) == 3
            return self.x == other[0] and \
                   self.y == other[1] and \
                   self.z == other[2]

    def __ne__(self, other):
        return not self.__eq__(other)

    def __nonzero__(self):
        return bool(self.x != 0 or self.y != 0 or self.z != 0)

    def __len__(self):
        return 3

    def __getitem__(self, key):
        return (self.x, self.y, self.z)[key]

    def __setitem__(self, key, value):
        l = [self.x, self.y, self.z]
        l[key] = value
        self.x, self.y, self.z = l

    def __iter__(self):
        return iter((self.x, self.y, self.z))

    def __getattr__(self, name):
        try:
            return tuple([(self.x, self.y, self.z)['xyz'.index(c)] \
                          for c in name])
        except ValueError:
            raise AttributeError(name)

    if _enable_swizzle_set:
        # This has detrimental performance on ordinary setattr as well
        # if enabled
        def __setattr__(self, name, value):
            if len(name) == 1:
                object.__setattr__(self, name, value)
            else:
                try:
                    l = [self.x, self.y, self.z]
                    for c, v in map(None, name, value):
                        l['xyz'.index(c)] = v
                    self.x, self.y, self.z = l
                except ValueError:
                    raise AttributeError(name)


    def __add__(self, other):
        if isinstance(other, Vector3):
            # Vector + Vector -> Vector
            # Vector + Point -> Point
            # Point + Point -> Vector
            if self.__class__ is other.__class__:
                _class = Vector3
            else:
                _class = Point3
            return _class(self.x + other.x,
                          self.y + other.y,
                          self.z + other.z)
        else:
            assert hasattr(other, '__len__') and len(other) == 3
            return Vector3(self.x + other[0],
                           self.y + other[1],
                           self.z + other[2])
    __radd__ = __add__

    def __iadd__(self, other):
        if isinstance(other, Vector3):
            self.x += other.x
            self.y += other.y
            self.z += other.z
        else:
            self.x += other[0]
            self.y += other[1]
            self.z += other[2]
        return self

    def __sub__(self, other):
        if isinstance(other, Vector3):
            # Vector - Vector -> Vector
            # Vector - Point -> Point
            # Point - Point -> Vector
            if self.__class__ is other.__class__:
                _class = Vector3
            else:
                _class = Point3
            return Vector3(self.x - other.x,
                           self.y - other.y,
                           self.z - other.z)
        else:
            assert hasattr(other, '__len__') and len(other) == 3
            return Vector3(self.x - other[0],
                           self.y - other[1],
                           self.z - other[2])

   
    def __rsub__(self, other):
        if isinstance(other, Vector3):
            return Vector3(other.x - self.x,
                           other.y - self.y,
                           other.z - self.z)
        else:
            assert hasattr(other, '__len__') and len(other) == 3
            return Vector3(other.x - self[0],
                           other.y - self[1],
                           other.z - self[2])

    def __mul__(self, other):
        if isinstance(other, Vector3):
            # TODO component-wise mul/div in-place and on Vector2; docs.
            if self.__class__ is Point3 or other.__class__ is Point3:
                _class = Point3
            else:
                _class = Vector3
            return _class(self.x * other.x,
                          self.y * other.y,
                          self.z * other.z)
        else: 
            assert type(other) in (int, long, float)
            return Vector3(self.x * other,
                           self.y * other,
                           self.z * other)

    __rmul__ = __mul__

    def __imul__(self, other):
        assert type(other) in (int, long, float)
        self.x *= other
        self.y *= other
        self.z *= other
        return self

    def __div__(self, other):
        assert type(other) in (int, long, float)
        return Vector3(operator.div(self.x, other),
                       operator.div(self.y, other),
                       operator.div(self.z, other))


    def __rdiv__(self, other):
        assert type(other) in (int, long, float)
        return Vector3(operator.div(other, self.x),
                       operator.div(other, self.y),
                       operator.div(other, self.z))

    def __floordiv__(self, other):
        assert type(other) in (int, long, float)
        return Vector3(operator.floordiv(self.x, other),
                       operator.floordiv(self.y, other),
                       operator.floordiv(self.z, other))


    def __rfloordiv__(self, other):
        assert type(other) in (int, long, float)
        return Vector3(operator.floordiv(other, self.x),
                       operator.floordiv(other, self.y),
                       operator.floordiv(other, self.z))

    def __truediv__(self, other):
        assert type(other) in (int, long, float)
        return Vector3(operator.truediv(self.x, other),
                       operator.truediv(self.y, other),
                       operator.truediv(self.z, other))


    def __rtruediv__(self, other):
        assert type(other) in (int, long, float)
        return Vector3(operator.truediv(other, self.x),
                       operator.truediv(other, self.y),
                       operator.truediv(other, self.z))
    
    def __neg__(self):
        return Vector3(-self.x,
                        -self.y,
                        -self.z)

    __pos__ = __copy__
    
    def __abs__(self):
        return math.sqrt(self.x ** 2 + \
                         self.y ** 2 + \
                         self.z ** 2)

    magnitude = __abs__

    def magnitude_squared(self):
        return self.x ** 2 + \
               self.y ** 2 + \
               self.z ** 2

    def normalize(self):
        d = self.magnitude()
        if d:
            self.x /= d
            self.y /= d
            self.z /= d
        return self

    def normalized(self):
        d = self.magnitude()
        if d:
            return Vector3(self.x / d, 
                           self.y / d, 
                           self.z / d)
        return self.copy()

    def dot(self, other):
        assert isinstance(other, Vector3)
        return self.x * other.x + \
               self.y * other.y + \
               self.z * other.z

    def cross(self, other):
        assert isinstance(other, Vector3)
        return Vector3(self.y * other.z - self.z * other.y,
                       -self.x * other.z + self.z * other.x,
                       self.x * other.y - self.y * other.x)

    def reflect(self, normal):
        # assume normal is normalized
        assert isinstance(normal, Vector3)
        d = 2 * (self.x * normal.x + self.y * normal.y + self.z * normal.z)
        return Vector3(self.x - d * normal.x,
                       self.y - d * normal.y,
                       self.z - d * normal.z)

    def rotate_around(self, axis, theta):
        """Return the vector rotated around axis through angle theta. Right hand rule applies"""

        # Adapted from equations published by Glenn Murray.
        # http://inside.mines.edu/~gmurray/ArbitraryAxisRotation/ArbitraryAxisRotation.html
        x, y, z = self.x, self.y,self.z
        u, v, w = axis.x, axis.y, axis.z

        # Extracted common factors for simplicity and efficiency
        r2 = u**2 + v**2 + w**2
        r = math.sqrt(r2)
        ct = math.cos(theta)
        st = math.sin(theta) / r
        dt = (u*x + v*y + w*z) * (1 - ct) / r2
        return Vector3((u * dt + x * ct + (-w * y + v * z) * st),
                       (v * dt + y * ct + ( w * x - u * z) * st),
                       (w * dt + z * ct + (-v * x + u * y) * st))

    def angle(self, other):
        """Return the angle to the vector other"""
        return math.acos(self.dot(other) / (self.magnitude()*other.magnitude()))

    def project(self, other):
        """Return one vector projected on the vector other"""
        n = other.normalized()
        return self.dot(n)*n

# a b c 
# e f g 
# i j k 

class Matrix3:
    __slots__ = list('abcefgijk')

    def __init__(self):
        self.identity()

    def __copy__(self):
        M = Matrix3()
        M.a = self.a
        M.b = self.b
        M.c = self.c
        M.e = self.e 
        M.f = self.f
        M.g = self.g
        M.i = self.i
        M.j = self.j
        M.k = self.k
        return M

    copy = __copy__
    def __repr__(self):
        return ('Matrix3([% 8.2f % 8.2f % 8.2f\n'  \
                '         % 8.2f % 8.2f % 8.2f\n'  \
                '         % 8.2f % 8.2f % 8.2f])') \
                % (self.a, self.b, self.c,
                   self.e, self.f, self.g,
                   self.i, self.j, self.k)

    def __getitem__(self, key):
        return [self.a, self.e, self.i,
                self.b, self.f, self.j,
                self.c, self.g, self.k][key]

    def __setitem__(self, key, value):
        L = self[:]
        L[key] = value
        (self.a, self.e, self.i,
         self.b, self.f, self.j,
         self.c, self.g, self.k) = L

    def __mul__(self, other):
        if isinstance(other, Matrix3):
            # Caching repeatedly accessed attributes in local variables
            # apparently increases performance by 20%.  Attrib: Will McGugan.
            Aa = self.a
            Ab = self.b
            Ac = self.c
            Ae = self.e
            Af = self.f
            Ag = self.g
            Ai = self.i
            Aj = self.j
            Ak = self.k
            Ba = other.a
            Bb = other.b
            Bc = other.c
            Be = other.e
            Bf = other.f
            Bg = other.g
            Bi = other.i
            Bj = other.j
            Bk = other.k
            C = Matrix3()
            C.a = Aa * Ba + Ab * Be + Ac * Bi
            C.b = Aa * Bb + Ab * Bf + Ac * Bj
            C.c = Aa * Bc + Ab * Bg + Ac * Bk
            C.e = Ae * Ba + Af * Be + Ag * Bi
            C.f = Ae * Bb + Af * Bf + Ag * Bj
            C.g = Ae * Bc + Af * Bg + Ag * Bk
            C.i = Ai * Ba + Aj * Be + Ak * Bi
            C.j = Ai * Bb + Aj * Bf + Ak * Bj
            C.k = Ai * Bc + Aj * Bg + Ak * Bk
            return C
        elif isinstance(other, Point2):
            A = self
            B = other
            P = Point2(0, 0)
            P.x = A.a * B.x + A.b * B.y + A.c
            P.y = A.e * B.x + A.f * B.y + A.g
            return P
        elif isinstance(other, Vector2):
            A = self
            B = other
            V = Vector2(0, 0)
            V.x = A.a * B.x + A.b * B.y 
            V.y = A.e * B.x + A.f * B.y 
            return V
        else:
            other = other.copy()
            other._apply_transform(self)
            return other

    def __imul__(self, other):
        assert isinstance(other, Matrix3)
        # Cache attributes in local vars (see Matrix3.__mul__).
        Aa = self.a
        Ab = self.b
        Ac = self.c
        Ae = self.e
        Af = self.f
        Ag = self.g
        Ai = self.i
        Aj = self.j
        Ak = self.k
        Ba = other.a
        Bb = other.b
        Bc = other.c
        Be = other.e
        Bf = other.f
        Bg = other.g
        Bi = other.i
        Bj = other.j
        Bk = other.k
        self.a = Aa * Ba + Ab * Be + Ac * Bi
        self.b = Aa * Bb + Ab * Bf + Ac * Bj
        self.c = Aa * Bc + Ab * Bg + Ac * Bk
        self.e = Ae * Ba + Af * Be + Ag * Bi
        self.f = Ae * Bb + Af * Bf + Ag * Bj
        self.g = Ae * Bc + Af * Bg + Ag * Bk
        self.i = Ai * Ba + Aj * Be + Ak * Bi
        self.j = Ai * Bb + Aj * Bf + Ak * Bj
        self.k = Ai * Bc + Aj * Bg + Ak * Bk
        return self

    def identity(self):
        self.a = self.f = self.k = 1.
        self.b = self.c = self.e = self.g = self.i = self.j = 0
        return self

    def scale(self, x, y):
        self *= Matrix3.new_scale(x, y)
        return self

    def translate(self, x, y):
        self *= Matrix3.new_translate(x, y)
        return self 

    def rotate(self, angle):
        self *= Matrix3.new_rotate(angle)
        return self

    # Static constructors
    def new_identity(cls):
        self = cls()
        return self
    new_identity = classmethod(new_identity)

    def new_scale(cls, x, y):
        self = cls()
        self.a = x
        self.f = y
        return self
    new_scale = classmethod(new_scale)

    def new_translate(cls, x, y):
        self = cls()
        self.c = x
        self.g = y
        return self
    new_translate = classmethod(new_translate)

    def new_rotate(cls, angle):
        self = cls()
        s = math.sin(angle)
        c = math.cos(angle)
        self.a = self.f = c
        self.b = -s
        self.e = s
        return self
    new_rotate = classmethod(new_rotate)

    def determinant(self):
        return (self.a*self.f*self.k 
                + self.b*self.g*self.i 
                + self.c*self.e*self.j 
                - self.a*self.g*self.j 
                - self.b*self.e*self.k 
                - self.c*self.f*self.i)

    def inverse(self):
        tmp = Matrix3()
        d = self.determinant()

        if abs(d) < 0.001:
            # No inverse, return identity
            return tmp
        else:
            d = 1.0 / d

            tmp.a = d * (self.f*self.k - self.g*self.j)
            tmp.b = d * (self.c*self.j - self.b*self.k)
            tmp.c = d * (self.b*self.g - self.c*self.f)
            tmp.e = d * (self.g*self.i - self.e*self.k)
            tmp.f = d * (self.a*self.k - self.c*self.i)
            tmp.g = d * (self.c*self.e - self.a*self.g)
            tmp.i = d * (self.e*self.j - self.f*self.i)
            tmp.j = d * (self.b*self.i - self.a*self.j)
            tmp.k = d * (self.a*self.f - self.b*self.e)

            return tmp

# a b c d
# e f g h
# i j k l
# m n o p

class Matrix4:
    __slots__ = list('abcdefghijklmnop')

    def __init__(self):
        self.identity()

    def __copy__(self):
        M = Matrix4()
        M.a = self.a
        M.b = self.b
        M.c = self.c
        M.d = self.d
        M.e = self.e 
        M.f = self.f
        M.g = self.g
        M.h = self.h
        M.i = self.i
        M.j = self.j
        M.k = self.k
        M.l = self.l
        M.m = self.m
        M.n = self.n
        M.o = self.o
        M.p = self.p
        return M

    copy = __copy__


    def __repr__(self):
        return ('Matrix4([% 8.2f % 8.2f % 8.2f % 8.2f\n'  \
                '         % 8.2f % 8.2f % 8.2f % 8.2f\n'  \
                '         % 8.2f % 8.2f % 8.2f % 8.2f\n'  \
                '         % 8.2f % 8.2f % 8.2f % 8.2f])') \
                % (self.a, self.b, self.c, self.d,
                   self.e, self.f, self.g, self.h,
                   self.i, self.j, self.k, self.l,
                   self.m, self.n, self.o, self.p)

    def __getitem__(self, key):
        return [self.a, self.e, self.i, self.m,
                self.b, self.f, self.j, self.n,
                self.c, self.g, self.k, self.o,
                self.d, self.h, self.l, self.p][key]

    def __setitem__(self, key, value):
        L = self[:]
        L[key] = value
        (self.a, self.e, self.i, self.m,
         self.b, self.f, self.j, self.n,
         self.c, self.g, self.k, self.o,
         self.d, self.h, self.l, self.p) = L

    def __mul__(self, other):
        if isinstance(other, Matrix4):
            # Cache attributes in local vars (see Matrix3.__mul__).
            Aa = self.a
            Ab = self.b
            Ac = self.c
            Ad = self.d
            Ae = self.e
            Af = self.f
            Ag = self.g
            Ah = self.h
            Ai = self.i
            Aj = self.j
            Ak = self.k
            Al = self.l
            Am = self.m
            An = self.n
            Ao = self.o
            Ap = self.p
            Ba = other.a
            Bb = other.b
            Bc = other.c
            Bd = other.d
            Be = other.e
            Bf = other.f
            Bg = other.g
            Bh = other.h
            Bi = other.i
            Bj = other.j
            Bk = other.k
            Bl = other.l
            Bm = other.m
            Bn = other.n
            Bo = other.o
            Bp = other.p
            C = Matrix4()
            C.a = Aa * Ba + Ab * Be + Ac * Bi + Ad * Bm
            C.b = Aa * Bb + Ab * Bf + Ac * Bj + Ad * Bn
            C.c = Aa * Bc + Ab * Bg + Ac * Bk + Ad * Bo
            C.d = Aa * Bd + Ab * Bh + Ac * Bl + Ad * Bp
            C.e = Ae * Ba + Af * Be + Ag * Bi + Ah * Bm
            C.f = Ae * Bb + Af * Bf + Ag * Bj + Ah * Bn
            C.g = Ae * Bc + Af * Bg + Ag * Bk + Ah * Bo
            C.h = Ae * Bd + Af * Bh + Ag * Bl + Ah * Bp
            C.i = Ai * Ba + Aj * Be + Ak * Bi + Al * Bm
            C.j = Ai * Bb + Aj * Bf + Ak * Bj + Al * Bn
            C.k = Ai * Bc + Aj * Bg + Ak * Bk + Al * Bo
            C.l = Ai * Bd + Aj * Bh + Ak * Bl + Al * Bp
            C.m = Am * Ba + An * Be + Ao * Bi + Ap * Bm
            C.n = Am * Bb + An * Bf + Ao * Bj + Ap * Bn
            C.o = Am * Bc + An * Bg + Ao * Bk + Ap * Bo
            C.p = Am * Bd + An * Bh + Ao * Bl + Ap * Bp
            return C
        elif isinstance(other, Point3):
            A = self
            B = other
            P = Point3(0, 0, 0)
            P.x = A.a * B.x + A.b * B.y + A.c * B.z + A.d
            P.y = A.e * B.x + A.f * B.y + A.g * B.z + A.h
            P.z = A.i * B.x + A.j * B.y + A.k * B.z + A.l
            return P
        elif isinstance(other, Vector3):
            A = self
            B = other
            V = Vector3(0, 0, 0)
            V.x = A.a * B.x + A.b * B.y + A.c * B.z
            V.y = A.e * B.x + A.f * B.y + A.g * B.z
            V.z = A.i * B.x + A.j * B.y + A.k * B.z
            return V
        else:
            other = other.copy()
            other._apply_transform(self)
            return other

    def __imul__(self, other):
        assert isinstance(other, Matrix4)
        # Cache attributes in local vars (see Matrix3.__mul__).
        Aa = self.a
        Ab = self.b
        Ac = self.c
        Ad = self.d
        Ae = self.e
        Af = self.f
        Ag = self.g
        Ah = self.h
        Ai = self.i
        Aj = self.j
        Ak = self.k
        Al = self.l
        Am = self.m
        An = self.n
        Ao = self.o
        Ap = self.p
        Ba = other.a
        Bb = other.b
        Bc = other.c
        Bd = other.d
        Be = other.e
        Bf = other.f
        Bg = other.g
        Bh = other.h
        Bi = other.i
        Bj = other.j
        Bk = other.k
        Bl = other.l
        Bm = other.m
        Bn = other.n
        Bo = other.o
        Bp = other.p
        self.a = Aa * Ba + Ab * Be + Ac * Bi + Ad * Bm
        self.b = Aa * Bb + Ab * Bf + Ac * Bj + Ad * Bn
        self.c = Aa * Bc + Ab * Bg + Ac * Bk + Ad * Bo
        self.d = Aa * Bd + Ab * Bh + Ac * Bl + Ad * Bp
        self.e = Ae * Ba + Af * Be + Ag * Bi + Ah * Bm
        self.f = Ae * Bb + Af * Bf + Ag * Bj + Ah * Bn
        self.g = Ae * Bc + Af * Bg + Ag * Bk + Ah * Bo
        self.h = Ae * Bd + Af * Bh + Ag * Bl + Ah * Bp
        self.i = Ai * Ba + Aj * Be + Ak * Bi + Al * Bm
        self.j = Ai * Bb + Aj * Bf + Ak * Bj + Al * Bn
        self.k = Ai * Bc + Aj * Bg + Ak * Bk + Al * Bo
        self.l = Ai * Bd + Aj * Bh + Ak * Bl + Al * Bp
        self.m = Am * Ba + An * Be + Ao * Bi + Ap * Bm
        self.n = Am * Bb + An * Bf + Ao * Bj + Ap * Bn
        self.o = Am * Bc + An * Bg + Ao * Bk + Ap * Bo
        self.p = Am * Bd + An * Bh + Ao * Bl + Ap * Bp
        return self

    def transform(self, other):
        A = self
        B = other
        P = Point3(0, 0, 0)
        P.x = A.a * B.x + A.b * B.y + A.c * B.z + A.d
        P.y = A.e * B.x + A.f * B.y + A.g * B.z + A.h
        P.z = A.i * B.x + A.j * B.y + A.k * B.z + A.l
        w =   A.m * B.x + A.n * B.y + A.o * B.z + A.p
        if w != 0:
            P.x /= w
            P.y /= w
            P.z /= w
        return P

    def identity(self):
        self.a = self.f = self.k = self.p = 1.
        self.b = self.c = self.d = self.e = self.g = self.h = \
        self.i = self.j = self.l = self.m = self.n = self.o = 0
        return self

    def scale(self, x, y, z):
        self *= Matrix4.new_scale(x, y, z)
        return self

    def translate(self, x, y, z):
        self *= Matrix4.new_translate(x, y, z)
        return self 

    def rotatex(self, angle):
        self *= Matrix4.new_rotatex(angle)
        return self

    def rotatey(self, angle):
        self *= Matrix4.new_rotatey(angle)
        return self

    def rotatez(self, angle):
        self *= Matrix4.new_rotatez(angle)
        return self

    def rotate_axis(self, angle, axis):
        self *= Matrix4.new_rotate_axis(angle, axis)
        return self

    def rotate_euler(self, heading, attitude, bank):
        self *= Matrix4.new_rotate_euler(heading, attitude, bank)
        return self

    def rotate_triple_axis(self, x, y, z):
        self *= Matrix4.new_rotate_triple_axis(x, y, z)
        return self

    def transpose(self):
        (self.a, self.e, self.i, self.m,
         self.b, self.f, self.j, self.n,
         self.c, self.g, self.k, self.o,
         self.d, self.h, self.l, self.p) = \
        (self.a, self.b, self.c, self.d,
         self.e, self.f, self.g, self.h,
         self.i, self.j, self.k, self.l,
         self.m, self.n, self.o, self.p)

    def transposed(self):
        M = self.copy()
        M.transpose()
        return M

    # Static constructors
    def new(cls, *values):
        M = cls()
        M[:] = values
        return M
    new = classmethod(new)

    def new_identity(cls):
        self = cls()
        return self
    new_identity = classmethod(new_identity)

    def new_scale(cls, x, y, z):
        self = cls()
        self.a = x
        self.f = y
        self.k = z
        return self
    new_scale = classmethod(new_scale)

    def new_translate(cls, x, y, z):
        self = cls()
        self.d = x
        self.h = y
        self.l = z
        return self
    new_translate = classmethod(new_translate)

    def new_rotatex(cls, angle):
        self = cls()
        s = math.sin(angle)
        c = math.cos(angle)
        self.f = self.k = c
        self.g = -s
        self.j = s
        return self
    new_rotatex = classmethod(new_rotatex)

    def new_rotatey(cls, angle):
        self = cls()
        s = math.sin(angle)
        c = math.cos(angle)
        self.a = self.k = c
        self.c = s
        self.i = -s
        return self    
    new_rotatey = classmethod(new_rotatey)
    
    def new_rotatez(cls, angle):
        self = cls()
        s = math.sin(angle)
        c = math.cos(angle)
        self.a = self.f = c
        self.b = -s
        self.e = s
        return self
    new_rotatez = classmethod(new_rotatez)

    def new_rotate_axis(cls, angle, axis):
        assert(isinstance(axis, Vector3))
        vector = axis.normalized()
        x = vector.x
        y = vector.y
        z = vector.z

        self = cls()
        s = math.sin(angle)
        c = math.cos(angle)
        c1 = 1. - c
        
        # from the glRotate man page
        self.a = x * x * c1 + c
        self.b = x * y * c1 - z * s
        self.c = x * z * c1 + y * s
        self.e = y * x * c1 + z * s
        self.f = y * y * c1 + c
        self.g = y * z * c1 - x * s
        self.i = x * z * c1 - y * s
        self.j = y * z * c1 + x * s
        self.k = z * z * c1 + c
        return self
    new_rotate_axis = classmethod(new_rotate_axis)

    def new_rotate_euler(cls, heading, attitude, bank):
        # from http://www.euclideanspace.com/
        ch = math.cos(heading)
        sh = math.sin(heading)
        ca = math.cos(attitude)
        sa = math.sin(attitude)
        cb = math.cos(bank)
        sb = math.sin(bank)

        self = cls()
        self.a = ch * ca
        self.b = sh * sb - ch * sa * cb
        self.c = ch * sa * sb + sh * cb
        self.e = sa
        self.f = ca * cb
        self.g = -ca * sb
        self.i = -sh * ca
        self.j = sh * sa * cb + ch * sb
        self.k = -sh * sa * sb + ch * cb
        return self
    new_rotate_euler = classmethod(new_rotate_euler)

    def new_rotate_triple_axis(cls, x, y, z):
      m = cls()
      
      m.a, m.b, m.c = x.x, y.x, z.x
      m.e, m.f, m.g = x.y, y.y, z.y
      m.i, m.j, m.k = x.z, y.z, z.z
      
      return m
    new_rotate_triple_axis = classmethod(new_rotate_triple_axis)

    def new_look_at(cls, eye, at, up):
      z = (eye - at).normalized()
      x = up.cross(z).normalized()
      y = z.cross(x)
      
      m = cls.new_rotate_triple_axis(x, y, z)
      m.transpose()
      m.d, m.h, m.l = -x.dot(eye), -y.dot(eye), -z.dot(eye)
      return m
    new_look_at = classmethod(new_look_at)
    
    def new_perspective(cls, fov_y, aspect, near, far):
        # from the gluPerspective man page
        f = 1 / math.tan(fov_y / 2)
        self = cls()
        assert near != 0.0 and near != far
        self.a = f / aspect
        self.f = f
        self.k = (far + near) / (near - far)
        self.l = 2 * far * near / (near - far)
        self.o = -1
        self.p = 0
        return self
    new_perspective = classmethod(new_perspective)

    def determinant(self):
        return ((self.a * self.f - self.e * self.b)
              * (self.k * self.p - self.o * self.l)
              - (self.a * self.j - self.i * self.b)
              * (self.g * self.p - self.o * self.h)
              + (self.a * self.n - self.m * self.b)
              * (self.g * self.l - self.k * self.h)
              + (self.e * self.j - self.i * self.f)
              * (self.c * self.p - self.o * self.d)
              - (self.e * self.n - self.m * self.f)
              * (self.c * self.l - self.k * self.d)
              + (self.i * self.n - self.m * self.j)
              * (self.c * self.h - self.g * self.d))

    def inverse(self):
        tmp = Matrix4()
        d = self.determinant();

        if abs(d) < 0.001:
            # No inverse, return identity
            return tmp
        else:
            d = 1.0 / d;

            tmp.a = d * (self.f * (self.k * self.p - self.o * self.l) + self.j * (self.o * self.h - self.g * self.p) + self.n * (self.g * self.l - self.k * self.h));
            tmp.e = d * (self.g * (self.i * self.p - self.m * self.l) + self.k * (self.m * self.h - self.e * self.p) + self.o * (self.e * self.l - self.i * self.h));
            tmp.i = d * (self.h * (self.i * self.n - self.m * self.j) + self.l * (self.m * self.f - self.e * self.n) + self.p * (self.e * self.j - self.i * self.f));
            tmp.m = d * (self.e * (self.n * self.k - self.j * self.o) + self.i * (self.f * self.o - self.n * self.g) + self.m * (self.j * self.g - self.f * self.k));
            
            tmp.b = d * (self.j * (self.c * self.p - self.o * self.d) + self.n * (self.k * self.d - self.c * self.l) + self.b * (self.o * self.l - self.k * self.p));
            tmp.f = d * (self.k * (self.a * self.p - self.m * self.d) + self.o * (self.i * self.d - self.a * self.l) + self.c * (self.m * self.l - self.i * self.p));
            tmp.j = d * (self.l * (self.a * self.n - self.m * self.b) + self.p * (self.i * self.b - self.a * self.j) + self.d * (self.m * self.j - self.i * self.n));
            tmp.n = d * (self.i * (self.n * self.c - self.b * self.o) + self.m * (self.b * self.k - self.j * self.c) + self.a * (self.j * self.o - self.n * self.k));
            
            tmp.c = d * (self.n * (self.c * self.h - self.g * self.d) + self.b * (self.g * self.p - self.o * self.h) + self.f * (self.o * self.d - self.c * self.p));
            tmp.g = d * (self.o * (self.a * self.h - self.e * self.d) + self.c * (self.e * self.p - self.m * self.h) + self.g * (self.m * self.d - self.a * self.p));
            tmp.k = d * (self.p * (self.a * self.f - self.e * self.b) + self.d * (self.e * self.n - self.m * self.f) + self.h * (self.m * self.b - self.a * self.n));
            tmp.o = d * (self.m * (self.f * self.c - self.b * self.g) + self.a * (self.n * self.g - self.f * self.o) + self.e * (self.b * self.o - self.n * self.c));
            
            tmp.d = d * (self.b * (self.k * self.h - self.g * self.l) + self.f * (self.c * self.l - self.k * self.d) + self.j * (self.g * self.d - self.c * self.h));
            tmp.h = d * (self.c * (self.i * self.h - self.e * self.l) + self.g * (self.a * self.l - self.i * self.d) + self.k * (self.e * self.d - self.a * self.h));
            tmp.l = d * (self.d * (self.i * self.f - self.e * self.j) + self.h * (self.a * self.j - self.i * self.b) + self.l * (self.e * self.b - self.a * self.f));
            tmp.p = d * (self.a * (self.f * self.k - self.j * self.g) + self.e * (self.j * self.c - self.b * self.k) + self.i * (self.b * self.g - self.f * self.c));

        return tmp;

    def get_quaternion(self):
        """Returns a quaternion representing the rotation part of the matrix.
        Taken from:
        http://web.archive.org/web/20041029003853/http://www.j3d.org/matrix_faq/matrfaq_latest.html#Q55
        """
        trace = self.a + self.f + self.k

        if trace > 0.00000001: #avoid dividing by zero
            s = math.sqrt(1. + trace) * 2
            x = (self.j - self.g) / s
            y = (self.c - self.i) / s
            z = (self.e - self.b) / s
            w = 0.25 * s
        else:
            #this is really convenient to have now
            mat = (self.a, self.b, self.c, self.d, 
                   self.e, self.f, self.g, self.h,
                   self.i, self.j, self.k, self.l,
                   self.m, self.n, self.o, self.p
                  )
            if ( mat[0] > mat[5] and mat[0] > mat[10] ):    #Column 0
                s  = math.sqrt( 1.0 + mat[0] - mat[5] - mat[10] ) * 2
                x = 0.25 * s
                y = (mat[4] + mat[1] ) / s
                z = (mat[2] + mat[8] ) / s
                w = (mat[9] - mat[6] ) / s
            elif ( mat[5] > mat[10] ):                     # Column 1
                s  = math.sqrt( 1.0 + mat[5] - mat[0] - mat[10] ) * 2
                x = (mat[4] + mat[1] ) / s
                y = 0.25 * s
                z = (mat[9] + mat[6] ) / s
                w = (mat[2] - mat[8] ) / s
            else:                                          # Column 2
                s  = math.sqrt( 1.0 + mat[10] - mat[0] - mat[5] ) * 2
                x = (mat[2] + mat[8] ) / s
                y = (mat[9] + mat[6] ) / s
                z = 0.25 * s
                w = (mat[4] - mat[1] ) / s

        return Quaternion(w, x, y, z)

        

class Quaternion:
    # All methods and naming conventions based off 
    # http://www.euclideanspace.com/maths/algebra/realNormedAlgebra/quaternions

    # w is the real part, (x, y, z) are the imaginary parts
    __slots__ = ['w', 'x', 'y', 'z']

    def __init__(self, w=1, x=0, y=0, z=0):
        self.w = w
        self.x = x
        self.y = y
        self.z = z

    def __copy__(self):
        Q = Quaternion()
        Q.w = self.w
        Q.x = self.x
        Q.y = self.y
        Q.z = self.z
        return Q

    copy = __copy__

    def __repr__(self):
        return 'Quaternion(real=%.2f, imag=<%.2f, %.2f, %.2f>)' % \
            (self.w, self.x, self.y, self.z)

    def __mul__(self, other):
        if isinstance(other, Quaternion):
            Ax = self.x
            Ay = self.y
            Az = self.z
            Aw = self.w
            Bx = other.x
            By = other.y
            Bz = other.z
            Bw = other.w
            Q = Quaternion()
            Q.x =  Ax * Bw + Ay * Bz - Az * By + Aw * Bx    
            Q.y = -Ax * Bz + Ay * Bw + Az * Bx + Aw * By
            Q.z =  Ax * By - Ay * Bx + Az * Bw + Aw * Bz
            Q.w = -Ax * Bx - Ay * By - Az * Bz + Aw * Bw
            return Q
        elif isinstance(other, Vector3):
            w = self.w
            x = self.x
            y = self.y
            z = self.z
            Vx = other.x
            Vy = other.y
            Vz = other.z
            ww = w * w
            w2 = w * 2
            wx2 = w2 * x
            wy2 = w2 * y
            wz2 = w2 * z
            xx = x * x
            x2 = x * 2
            xy2 = x2 * y
            xz2 = x2 * z
            yy = y * y
            yz2 = 2 * y * z
            zz = z * z
            return other.__class__(\
               ww * Vx + wy2 * Vz - wz2 * Vy + \
               xx * Vx + xy2 * Vy + xz2 * Vz - \
               zz * Vx - yy * Vx,
               xy2 * Vx + yy * Vy + yz2 * Vz + \
               wz2 * Vx - zz * Vy + ww * Vy - \
               wx2 * Vz - xx * Vy,
               xz2 * Vx + yz2 * Vy + \
               zz * Vz - wy2 * Vx - yy * Vz + \
               wx2 * Vy - xx * Vz + ww * Vz)
        else:
            other = other.copy()
            other._apply_transform(self)
            return other

    def __imul__(self, other):
        assert isinstance(other, Quaternion)
        Ax = self.x
        Ay = self.y
        Az = self.z
        Aw = self.w
        Bx = other.x
        By = other.y
        Bz = other.z
        Bw = other.w
        self.x =  Ax * Bw + Ay * Bz - Az * By + Aw * Bx    
        self.y = -Ax * Bz + Ay * Bw + Az * Bx + Aw * By
        self.z =  Ax * By - Ay * Bx + Az * Bw + Aw * Bz
        self.w = -Ax * Bx - Ay * By - Az * Bz + Aw * Bw
        return self

    def __abs__(self):
        return math.sqrt(self.w ** 2 + \
                         self.x ** 2 + \
                         self.y ** 2 + \
                         self.z ** 2)

    magnitude = __abs__

    def magnitude_squared(self):
        return self.w ** 2 + \
               self.x ** 2 + \
               self.y ** 2 + \
               self.z ** 2 

    def identity(self):
        self.w = 1
        self.x = 0
        self.y = 0
        self.z = 0
        return self

    def rotate_axis(self, angle, axis):
        self *= Quaternion.new_rotate_axis(angle, axis)
        return self

    def rotate_euler(self, heading, attitude, bank):
        self *= Quaternion.new_rotate_euler(heading, attitude, bank)
        return self

    def rotate_matrix(self, m):
        self *= Quaternion.new_rotate_matrix(m)
        return self

    def conjugated(self):
        Q = Quaternion()
        Q.w = self.w
        Q.x = -self.x
        Q.y = -self.y
        Q.z = -self.z
        return Q

    def normalize(self):
        d = self.magnitude()
        if d != 0:
            self.w /= d
            self.x /= d
            self.y /= d
            self.z /= d
        return self

    def normalized(self):
        d = self.magnitude()
        if d != 0:
            Q = Quaternion()
            Q.w = self.w / d
            Q.x = self.x / d
            Q.y = self.y / d
            Q.z = self.z / d
            return Q
        else:
            return self.copy()

    def get_angle_axis(self):
        if self.w > 1:
            self = self.normalized()
        angle = 2 * math.acos(self.w)
        s = math.sqrt(1 - self.w ** 2)
        if s < 0.001:
            return angle, Vector3(1, 0, 0)
        else:
            return angle, Vector3(self.x / s, self.y / s, self.z / s)

    def get_euler(self):
        t = self.x * self.y + self.z * self.w
        if t > 0.4999:
            heading = 2 * math.atan2(self.x, self.w)
            attitude = math.pi / 2
            bank = 0
        elif t < -0.4999:
            heading = -2 * math.atan2(self.x, self.w)
            attitude = -math.pi / 2
            bank = 0
        else:
            sqx = self.x ** 2
            sqy = self.y ** 2
            sqz = self.z ** 2
            heading = math.atan2(2 * self.y * self.w - 2 * self.x * self.z,
                                 1 - 2 * sqy - 2 * sqz)
            attitude = math.asin(2 * t)
            bank = math.atan2(2 * self.x * self.w - 2 * self.y * self.z,
                              1 - 2 * sqx - 2 * sqz)
        return heading, attitude, bank

    def get_matrix(self):
        xx = self.x ** 2
        xy = self.x * self.y
        xz = self.x * self.z
        xw = self.x * self.w
        yy = self.y ** 2
        yz = self.y * self.z
        yw = self.y * self.w
        zz = self.z ** 2
        zw = self.z * self.w
        M = Matrix4()
        M.a = 1 - 2 * (yy + zz)
        M.b = 2 * (xy - zw)
        M.c = 2 * (xz + yw)
        M.e = 2 * (xy + zw)
        M.f = 1 - 2 * (xx + zz)
        M.g = 2 * (yz - xw)
        M.i = 2 * (xz - yw)
        M.j = 2 * (yz + xw)
        M.k = 1 - 2 * (xx + yy)
        return M

    # Static constructors
    def new_identity(cls):
        return cls()
    new_identity = classmethod(new_identity)

    def new_rotate_axis(cls, angle, axis):
        assert(isinstance(axis, Vector3))
        axis = axis.normalized()
        s = math.sin(angle / 2)
        Q = cls()
        Q.w = math.cos(angle / 2)
        Q.x = axis.x * s
        Q.y = axis.y * s
        Q.z = axis.z * s
        return Q
    new_rotate_axis = classmethod(new_rotate_axis)

    def new_rotate_euler(cls, heading, attitude, bank):
        Q = cls()
        c1 = math.cos(heading / 2)
        s1 = math.sin(heading / 2)
        c2 = math.cos(attitude / 2)
        s2 = math.sin(attitude / 2)
        c3 = math.cos(bank / 2)
        s3 = math.sin(bank / 2)

        Q.w = c1 * c2 * c3 - s1 * s2 * s3
        Q.x = s1 * s2 * c3 + c1 * c2 * s3
        Q.y = s1 * c2 * c3 + c1 * s2 * s3
        Q.z = c1 * s2 * c3 - s1 * c2 * s3
        return Q
    new_rotate_euler = classmethod(new_rotate_euler)
    
    def new_rotate_matrix(cls, m):
      if m[0*4 + 0] + m[1*4 + 1] + m[2*4 + 2] > 0.00000001:
        t = m[0*4 + 0] + m[1*4 + 1] + m[2*4 + 2] + 1.0
        s = 0.5/math.sqrt(t)
        
        return cls(
          s*t,
          (m[1*4 + 2] - m[2*4 + 1])*s,
          (m[2*4 + 0] - m[0*4 + 2])*s,
          (m[0*4 + 1] - m[1*4 + 0])*s
          )
        
      elif m[0*4 + 0] > m[1*4 + 1] and m[0*4 + 0] > m[2*4 + 2]:
        t = m[0*4 + 0] - m[1*4 + 1] - m[2*4 + 2] + 1.0
        s = 0.5/math.sqrt(t)
        
        return cls(
          (m[1*4 + 2] - m[2*4 + 1])*s,
          s*t,
          (m[0*4 + 1] + m[1*4 + 0])*s,
          (m[2*4 + 0] + m[0*4 + 2])*s
          )
        
      elif m[1*4 + 1] > m[2*4 + 2]:
        t = -m[0*4 + 0] + m[1*4 + 1] - m[2*4 + 2] + 1.0
        s = 0.5/math.sqrt(t)
        
        return cls(
          (m[2*4 + 0] - m[0*4 + 2])*s,
          (m[0*4 + 1] + m[1*4 + 0])*s,
          s*t,
          (m[1*4 + 2] + m[2*4 + 1])*s
          )
        
      else:
        t = -m[0*4 + 0] - m[1*4 + 1] + m[2*4 + 2] + 1.0
        s = 0.5/math.sqrt(t)
        
        return cls(
          (m[0*4 + 1] - m[1*4 + 0])*s,
          (m[2*4 + 0] + m[0*4 + 2])*s,
          (m[1*4 + 2] + m[2*4 + 1])*s,
          s*t
          )
    new_rotate_matrix = classmethod(new_rotate_matrix)
    
    def new_interpolate(cls, q1, q2, t):
        assert isinstance(q1, Quaternion) and isinstance(q2, Quaternion)
        Q = cls()

        costheta = q1.w * q2.w + q1.x * q2.x + q1.y * q2.y + q1.z * q2.z
        if costheta < 0.:
            costheta = -costheta
            q1 = q1.conjugated()
        elif costheta > 1:
            costheta = 1

        theta = math.acos(costheta)
        if abs(theta) < 0.01:
            Q.w = q2.w
            Q.x = q2.x
            Q.y = q2.y
            Q.z = q2.z
            return Q

        sintheta = math.sqrt(1.0 - costheta * costheta)
        if abs(sintheta) < 0.01:
            Q.w = (q1.w + q2.w) * 0.5
            Q.x = (q1.x + q2.x) * 0.5
            Q.y = (q1.y + q2.y) * 0.5
            Q.z = (q1.z + q2.z) * 0.5
            return Q

        ratio1 = math.sin((1 - t) * theta) / sintheta
        ratio2 = math.sin(t * theta) / sintheta

        Q.w = q1.w * ratio1 + q2.w * ratio2
        Q.x = q1.x * ratio1 + q2.x * ratio2
        Q.y = q1.y * ratio1 + q2.y * ratio2
        Q.z = q1.z * ratio1 + q2.z * ratio2
        return Q
    new_interpolate = classmethod(new_interpolate)

# Geometry
# Much maths thanks to Paul Bourke, http://astronomy.swin.edu.au/~pbourke
# ---------------------------------------------------------------------------

class Geometry:
    def _connect_unimplemented(self, other):
        raise AttributeError('Cannot connect %s to %s' %
                             (self.__class__, other.__class__))

    def _intersect_unimplemented(self, other):
        raise AttributeError('Cannot intersect %s and %s' %
                             (self.__class__, other.__class__))

    _intersect_point2 = _intersect_unimplemented
    _intersect_line2 = _intersect_unimplemented
    _intersect_circle = _intersect_unimplemented
    _connect_point2 = _connect_unimplemented
    _connect_line2 = _connect_unimplemented
    _connect_circle = _connect_unimplemented

    _intersect_point3 = _intersect_unimplemented
    _intersect_line3 = _intersect_unimplemented
    _intersect_sphere = _intersect_unimplemented
    _intersect_plane = _intersect_unimplemented
    _connect_point3 = _connect_unimplemented
    _connect_line3 = _connect_unimplemented
    _connect_sphere = _connect_unimplemented
    _connect_plane = _connect_unimplemented

    def intersect(self, other):
        raise NotImplementedError

    def connect(self, other):
        raise NotImplementedError

    def distance(self, other):
        c = self.connect(other)
        if c:
            return c.length
        return 0.0

def _intersect_point2_circle(P, C):
    return abs(P - C.c) <= C.r
    
def _intersect_line2_line2(A, B):
    d = B.v.y * A.v.x - B.v.x * A.v.y
    if d == 0:
        return None

    dy = A.p.y - B.p.y
    dx = A.p.x - B.p.x
    ua = (B.v.x * dy - B.v.y * dx) / d
    if not A._u_in(ua):
        return None
    ub = (A.v.x * dy - A.v.y * dx) / d
    if not B._u_in(ub):
        return None

    return Point2(A.p.x + ua * A.v.x,
                  A.p.y + ua * A.v.y)

def _intersect_line2_circle(L, C):
    a = L.v.magnitude_squared()
    b = 2 * (L.v.x * (L.p.x - C.c.x) + \
             L.v.y * (L.p.y - C.c.y))
    c = C.c.magnitude_squared() + \
        L.p.magnitude_squared() - \
        2 * C.c.dot(L.p) - \
        C.r ** 2
    det = b ** 2 - 4 * a * c
    if det < 0:
        return None
    sq = math.sqrt(det)
    u1 = (-b + sq) / (2 * a)
    u2 = (-b - sq) / (2 * a)

    if u1 * u2 > 0 and not L._u_in(u1) and not L._u_in(u2):
        return None

    if not L._u_in(u1):
        u1 = max(min(u1, 1.0), 0.0)
    if not L._u_in(u2):
        u2 = max(min(u2, 1.0), 0.0)

    # Tangent
    if u1 == u2:
        return Point2(L.p.x + u1 * L.v.x,
                      L.p.y + u1 * L.v.y)

    return LineSegment2(Point2(L.p.x + u1 * L.v.x,
                               L.p.y + u1 * L.v.y),
                        Point2(L.p.x + u2 * L.v.x,
                               L.p.y + u2 * L.v.y))

def _intersect_circle_circle(A, B):
    d = abs(A.c - B.c)
    s = A.r + B.r
    m = abs(A.r - B.r)
    if d > s or d < m:
        return None
    d2 = d ** 2
    s2 = s ** 2
    m2 = m ** 2
    k = 0.25 * math.sqrt((s2 - d2) * (d2 - m2))
    dr = (A.r ** 2 - B.r ** 2) / d2
    kd = 2 * k / d2
    return (
      Point2(
        0.5 * (A.c.x + B.c.x + (B.c.x - A.c.x) * dr) + (B.c.y - A.c.y) * kd,
        0.5 * (A.c.y + B.c.y + (B.c.y - A.c.y) * dr) - (B.c.x - A.c.x) * kd),
      Point2(
        0.5 * (A.c.x + B.c.x + (B.c.x - A.c.x) * dr) - (B.c.y - A.c.y) * kd,
        0.5 * (A.c.y + B.c.y + (B.c.y - A.c.y) * dr) + (B.c.x - A.c.x) * kd))

def _connect_point2_line2(P, L):
    d = L.v.magnitude_squared()
    assert d != 0
    u = ((P.x - L.p.x) * L.v.x + \
         (P.y - L.p.y) * L.v.y) / d
    if not L._u_in(u):
        u = max(min(u, 1.0), 0.0)
    return LineSegment2(P, 
                        Point2(L.p.x + u * L.v.x,
                               L.p.y + u * L.v.y))

def _connect_point2_circle(P, C):
    v = P - C.c
    v.normalize()
    v *= C.r
    return LineSegment2(P, Point2(C.c.x + v.x, C.c.y + v.y))

def _connect_line2_line2(A, B):
    d = B.v.y * A.v.x - B.v.x * A.v.y
    if d == 0:
        # Parallel, connect an endpoint with a line
        if isinstance(B, Ray2) or isinstance(B, LineSegment2):
            p1, p2 = _connect_point2_line2(B.p, A)
            return p2, p1
        # No endpoint (or endpoint is on A), possibly choose arbitrary point
        # on line.
        return _connect_point2_line2(A.p, B)

    dy = A.p.y - B.p.y
    dx = A.p.x - B.p.x
    ua = (B.v.x * dy - B.v.y * dx) / d
    if not A._u_in(ua):
        ua = max(min(ua, 1.0), 0.0)
    ub = (A.v.x * dy - A.v.y * dx) / d
    if not B._u_in(ub):
        ub = max(min(ub, 1.0), 0.0)

    return LineSegment2(Point2(A.p.x + ua * A.v.x, A.p.y + ua * A.v.y),
                        Point2(B.p.x + ub * B.v.x, B.p.y + ub * B.v.y))

def _connect_circle_line2(C, L):
    d = L.v.magnitude_squared()
    assert d != 0
    u = ((C.c.x - L.p.x) * L.v.x + (C.c.y - L.p.y) * L.v.y) / d
    if not L._u_in(u):
        u = max(min(u, 1.0), 0.0)
    point = Point2(L.p.x + u * L.v.x, L.p.y + u * L.v.y)
    v = (point - C.c)
    v.normalize()
    v *= C.r
    return LineSegment2(Point2(C.c.x + v.x, C.c.y + v.y), point)

def _connect_circle_circle(A, B):
    v = B.c - A.c
    d = v.magnitude()
    if A.r >= B.r and d < A.r:
        #centre B inside A
        s1,s2 = +1, +1
    elif B.r > A.r and d < B.r:
        #centre A inside B
        s1,s2 = -1, -1
    elif d >= A.r and d >= B.r:
        s1,s2 = +1, -1
    v.normalize()
    return LineSegment2(Point2(A.c.x + s1 * v.x * A.r, A.c.y + s1 * v.y * A.r),
                        Point2(B.c.x + s2 * v.x * B.r, B.c.y + s2 * v.y * B.r))


class Point2(Vector2, Geometry):
    def __repr__(self):
        return 'Point2(%.2f, %.2f)' % (self.x, self.y)

    def intersect(self, other):
        return other._intersect_point2(self)

    def _intersect_circle(self, other):
        return _intersect_point2_circle(self, other)

    def connect(self, other):
        return other._connect_point2(self)

    def _connect_point2(self, other):
        return LineSegment2(other, self)
    
    def _connect_line2(self, other):
        c = _connect_point2_line2(self, other)
        if c:
            return c._swap()

    def _connect_circle(self, other):
        c = _connect_point2_circle(self, other)
        if c:
            return c._swap()

class Line2(Geometry):
    __slots__ = ['p', 'v']

    def __init__(self, *args):
        if len(args) == 3:
            assert isinstance(args[0], Point2) and \
                   isinstance(args[1], Vector2) and \
                   type(args[2]) == float
            self.p = args[0].copy()
            self.v = args[1] * args[2] / abs(args[1])
        elif len(args) == 2:
            if isinstance(args[0], Point2) and isinstance(args[1], Point2):
                self.p = args[0].copy()
                self.v = args[1] - args[0]
            elif isinstance(args[0], Point2) and isinstance(args[1], Vector2):
                self.p = args[0].copy()
                self.v = args[1].copy()
            else:
                raise AttributeError('%r' % (args,))
        elif len(args) == 1:
            if isinstance(args[0], Line2):
                self.p = args[0].p.copy()
                self.v = args[0].v.copy()
            else:
                raise AttributeError('%r' % (args,))
        else:
            raise AttributeError('%r' % (args,))
        
        if not self.v:
            raise AttributeError('Line has zero-length vector')

    def __copy__(self):
        return self.__class__(self.p, self.v)

    copy = __copy__

    def __repr__(self):
        return 'Line2(<%.2f, %.2f> + u<%.2f, %.2f>)' % \
            (self.p.x, self.p.y, self.v.x, self.v.y)

    p1 = property(lambda self: self.p)
    p2 = property(lambda self: Point2(self.p.x + self.v.x, 
                                      self.p.y + self.v.y))

    def _apply_transform(self, t):
        self.p = t * self.p
        self.v = t * self.v

    def _u_in(self, u):
        return True

    def intersect(self, other):
        return other._intersect_line2(self)

    def _intersect_line2(self, other):
        return _intersect_line2_line2(self, other)

    def _intersect_circle(self, other):
        return _intersect_line2_circle(self, other)

    def connect(self, other):
        return other._connect_line2(self)

    def _connect_point2(self, other):
        return _connect_point2_line2(other, self)

    def _connect_line2(self, other):
        return _connect_line2_line2(other, self)

    def _connect_circle(self, other):
        return _connect_circle_line2(other, self)

class Ray2(Line2):
    def __repr__(self):
        return 'Ray2(<%.2f, %.2f> + u<%.2f, %.2f>)' % \
            (self.p.x, self.p.y, self.v.x, self.v.y)

    def _u_in(self, u):
        return u >= 0.0

class LineSegment2(Line2):
    def __repr__(self):
        return 'LineSegment2(<%.2f, %.2f> to <%.2f, %.2f>)' % \
            (self.p.x, self.p.y, self.p.x + self.v.x, self.p.y + self.v.y)

    def _u_in(self, u):
        return u >= 0.0 and u <= 1.0

    def __abs__(self):
        return abs(self.v)

    def magnitude_squared(self):
        return self.v.magnitude_squared()

    def _swap(self):
        # used by connect methods to switch order of points
        self.p = self.p2
        self.v *= -1
        return self

    length = property(lambda self: abs(self.v))

class Circle(Geometry):
    __slots__ = ['c', 'r']

    def __init__(self, center, radius):
        assert isinstance(center, Vector2) and type(radius) == float
        self.c = center.copy()
        self.r = radius

    def __copy__(self):
        return self.__class__(self.c, self.r)

    copy = __copy__

    def __repr__(self):
        return 'Circle(<%.2f, %.2f>, radius=%.2f)' % \
            (self.c.x, self.c.y, self.r)

    def _apply_transform(self, t):
        self.c = t * self.c

    def intersect(self, other):
        return other._intersect_circle(self)

    def _intersect_point2(self, other):
        return _intersect_point2_circle(other, self)

    def _intersect_line2(self, other):
        return _intersect_line2_circle(other, self)

    def _intersect_circle(self, other):
        return _intersect_circle_circle(other, self)

    def connect(self, other):
        return other._connect_circle(self)

    def _connect_point2(self, other):
        return _connect_point2_circle(other, self)

    def _connect_line2(self, other):
        c = _connect_circle_line2(self, other)
        if c:
            return c._swap()

    def _connect_circle(self, other):
        return _connect_circle_circle(other, self)

    def tangent_points(self, p):
        m = 0.5 * (self.c + p)
        return self.intersect(Circle(m, abs(p - m)))

# 3D Geometry
# -------------------------------------------------------------------------

def _connect_point3_line3(P, L):
    d = L.v.magnitude_squared()
    assert d != 0
    u = ((P.x - L.p.x) * L.v.x + \
         (P.y - L.p.y) * L.v.y + \
         (P.z - L.p.z) * L.v.z) / d
    if not L._u_in(u):
        u = max(min(u, 1.0), 0.0)
    return LineSegment3(P, Point3(L.p.x + u * L.v.x,
                                  L.p.y + u * L.v.y,
                                  L.p.z + u * L.v.z))

def _connect_point3_sphere(P, S):
    v = P - S.c
    v.normalize()
    v *= S.r
    return LineSegment3(P, Point3(S.c.x + v.x, S.c.y + v.y, S.c.z + v.z))

def _connect_point3_plane(p, plane):
    n = plane.n.normalized()
    d = p.dot(plane.n) - plane.k
    return LineSegment3(p, Point3(p.x - n.x * d, p.y - n.y * d, p.z - n.z * d))

def _connect_line3_line3(A, B):
    assert A.v and B.v
    p13 = A.p - B.p
    d1343 = p13.dot(B.v)
    d4321 = B.v.dot(A.v)
    d1321 = p13.dot(A.v)
    d4343 = B.v.magnitude_squared()
    denom = A.v.magnitude_squared() * d4343 - d4321 ** 2
    if denom == 0:
        # Parallel, connect an endpoint with a line
        if isinstance(B, Ray3) or isinstance(B, LineSegment3):
            return _connect_point3_line3(B.p, A)._swap()
        # No endpoint (or endpoint is on A), possibly choose arbitrary
        # point on line.
        return _connect_point3_line3(A.p, B)

    ua = (d1343 * d4321 - d1321 * d4343) / denom
    if not A._u_in(ua):
        ua = max(min(ua, 1.0), 0.0)
    ub = (d1343 + d4321 * ua) / d4343
    if not B._u_in(ub):
        ub = max(min(ub, 1.0), 0.0)
    return LineSegment3(Point3(A.p.x + ua * A.v.x,
                               A.p.y + ua * A.v.y,
                               A.p.z + ua * A.v.z),
                        Point3(B.p.x + ub * B.v.x,
                               B.p.y + ub * B.v.y,
                               B.p.z + ub * B.v.z))

def _connect_line3_plane(L, P):
    d = P.n.dot(L.v)
    if not d:
        # Parallel, choose an endpoint
        return _connect_point3_plane(L.p, P)
    u = (P.k - P.n.dot(L.p)) / d
    if not L._u_in(u):
        # intersects out of range, choose nearest endpoint
        u = max(min(u, 1.0), 0.0)
        return _connect_point3_plane(Point3(L.p.x + u * L.v.x,
                                            L.p.y + u * L.v.y,
                                            L.p.z + u * L.v.z), P)
    # Intersection
    return None

def _connect_sphere_line3(S, L):
    d = L.v.magnitude_squared()
    assert d != 0
    u = ((S.c.x - L.p.x) * L.v.x + \
         (S.c.y - L.p.y) * L.v.y + \
         (S.c.z - L.p.z) * L.v.z) / d
    if not L._u_in(u):
        u = max(min(u, 1.0), 0.0)
    point = Point3(L.p.x + u * L.v.x, L.p.y + u * L.v.y, L.p.z + u * L.v.z)
    v = (point - S.c)
    v.normalize()
    v *= S.r
    return LineSegment3(Point3(S.c.x + v.x, S.c.y + v.y, S.c.z + v.z), 
                        point)

def _connect_sphere_sphere(A, B):
    v = B.c - A.c
    d = v.magnitude()
    if A.r >= B.r and d < A.r:
        #centre B inside A
        s1,s2 = +1, +1
    elif B.r > A.r and d < B.r:
        #centre A inside B
        s1,s2 = -1, -1
    elif d >= A.r and d >= B.r:
        s1,s2 = +1, -1

    v.normalize()
    return LineSegment3(Point3(A.c.x + s1* v.x * A.r,
                               A.c.y + s1* v.y * A.r,
                               A.c.z + s1* v.z * A.r),
                        Point3(B.c.x + s2* v.x * B.r,
                               B.c.y + s2* v.y * B.r,
                               B.c.z + s2* v.z * B.r))

def _connect_sphere_plane(S, P):
    c = _connect_point3_plane(S.c, P)
    if not c:
        return None
    p2 = c.p2
    v = p2 - S.c
    v.normalize()
    v *= S.r
    return LineSegment3(Point3(S.c.x + v.x, S.c.y + v.y, S.c.z + v.z), 
                        p2)

def _connect_plane_plane(A, B):
    if A.n.cross(B.n):
        # Planes intersect
        return None
    else:
        # Planes are parallel, connect to arbitrary point
        return _connect_point3_plane(A._get_point(), B)

def _intersect_point3_sphere(P, S):
    return abs(P - S.c) <= S.r
    
def _intersect_line3_sphere(L, S):
    a = L.v.magnitude_squared()
    b = 2 * (L.v.x * (L.p.x - S.c.x) + \
             L.v.y * (L.p.y - S.c.y) + \
             L.v.z * (L.p.z - S.c.z))
    c = S.c.magnitude_squared() + \
        L.p.magnitude_squared() - \
        2 * S.c.dot(L.p) - \
        S.r ** 2
    det = b ** 2 - 4 * a * c
    if det < 0:
        return None
    sq = math.sqrt(det)
    u1 = (-b + sq) / (2 * a)
    u2 = (-b - sq) / (2 * a)
    if not L._u_in(u1):
        u1 = max(min(u1, 1.0), 0.0)
    if not L._u_in(u2):
        u2 = max(min(u2, 1.0), 0.0)
    return LineSegment3(Point3(L.p.x + u1 * L.v.x,
                               L.p.y + u1 * L.v.y,
                               L.p.z + u1 * L.v.z),
                        Point3(L.p.x + u2 * L.v.x,
                               L.p.y + u2 * L.v.y,
                               L.p.z + u2 * L.v.z))

def _intersect_line3_plane(L, P):
    d = P.n.dot(L.v)
    if not d:
        # Parallel
        return None
    u = (P.k - P.n.dot(L.p)) / d
    if not L._u_in(u):
        return None
    return Point3(L.p.x + u * L.v.x,
                  L.p.y + u * L.v.y,
                  L.p.z + u * L.v.z)

def _intersect_plane_plane(A, B):
    n1_m = A.n.magnitude_squared()
    n2_m = B.n.magnitude_squared()
    n1d2 = A.n.dot(B.n)
    det = n1_m * n2_m - n1d2 ** 2
    if det == 0:
        # Parallel
        return None
    c1 = (A.k * n2_m - B.k * n1d2) / det
    c2 = (B.k * n1_m - A.k * n1d2) / det
    return Line3(Point3(c1 * A.n.x + c2 * B.n.x,
                        c1 * A.n.y + c2 * B.n.y,
                        c1 * A.n.z + c2 * B.n.z), 
                 A.n.cross(B.n))

class Point3(Vector3, Geometry):
    def __repr__(self):
        return 'Point3(%.2f, %.2f, %.2f)' % (self.x, self.y, self.z)

    def intersect(self, other):
        return other._intersect_point3(self)

    def _intersect_sphere(self, other):
        return _intersect_point3_sphere(self, other)

    def connect(self, other):
        return other._connect_point3(self)

    def _connect_point3(self, other):
        if self != other:
            return LineSegment3(other, self)
        return None

    def _connect_line3(self, other):
        c = _connect_point3_line3(self, other)
        if c:
            return c._swap()
        
    def _connect_sphere(self, other):
        c = _connect_point3_sphere(self, other)
        if c:
            return c._swap()

    def _connect_plane(self, other):
        c = _connect_point3_plane(self, other)
        if c:
            return c._swap()

class Line3:
    __slots__ = ['p', 'v']

    def __init__(self, *args):
        if len(args) == 3:
            assert isinstance(args[0], Point3) and \
                   isinstance(args[1], Vector3) and \
                   type(args[2]) == float
            self.p = args[0].copy()
            self.v = args[1] * args[2] / abs(args[1])
        elif len(args) == 2:
            if isinstance(args[0], Point3) and isinstance(args[1], Point3):
                self.p = args[0].copy()
                self.v = args[1] - args[0]
            elif isinstance(args[0], Point3) and isinstance(args[1], Vector3):
                self.p = args[0].copy()
                self.v = args[1].copy()
            else:
                raise AttributeError('%r' % (args,))
        elif len(args) == 1:
            if isinstance(args[0], Line3):
                self.p = args[0].p.copy()
                self.v = args[0].v.copy()
            else:
                raise AttributeError('%r' % (args,))
        else:
            raise AttributeError('%r' % (args,))
        
        # XXX This is annoying.
        #if not self.v:
        #    raise AttributeError('Line has zero-length vector')

    def __copy__(self):
        return self.__class__(self.p, self.v)

    copy = __copy__

    def __repr__(self):
        return 'Line3(<%.2f, %.2f, %.2f> + u<%.2f, %.2f, %.2f>)' % \
            (self.p.x, self.p.y, self.p.z, self.v.x, self.v.y, self.v.z)

    p1 = property(lambda self: self.p)
    p2 = property(lambda self: Point3(self.p.x + self.v.x, 
                                      self.p.y + self.v.y,
                                      self.p.z + self.v.z))

    def _apply_transform(self, t):
        self.p = t * self.p
        self.v = t * self.v

    def _u_in(self, u):
        return True

    def intersect(self, other):
        return other._intersect_line3(self)

    def _intersect_sphere(self, other):
        return _intersect_line3_sphere(self, other)

    def _intersect_plane(self, other):
        return _intersect_line3_plane(self, other)

    def connect(self, other):
        return other._connect_line3(self)

    def _connect_point3(self, other):
        return _connect_point3_line3(other, self)

    def _connect_line3(self, other):
        return _connect_line3_line3(other, self)

    def _connect_sphere(self, other):
        return _connect_sphere_line3(other, self)

    def _connect_plane(self, other):
        c = _connect_line3_plane(self, other)
        if c:
            return c

class Ray3(Line3):
    def __repr__(self):
        return 'Ray3(<%.2f, %.2f, %.2f> + u<%.2f, %.2f, %.2f>)' % \
            (self.p.x, self.p.y, self.p.z, self.v.x, self.v.y, self.v.z)

    def _u_in(self, u):
        return u >= 0.0

class LineSegment3(Line3):
    def __repr__(self):
        return 'LineSegment3(<%.2f, %.2f, %.2f> to <%.2f, %.2f, %.2f>)' % \
            (self.p.x, self.p.y, self.p.z,
             self.p.x + self.v.x, self.p.y + self.v.y, self.p.z + self.v.z)

    def _u_in(self, u):
        return u >= 0.0 and u <= 1.0

    def __abs__(self):
        return abs(self.v)

    def magnitude_squared(self):
        return self.v.magnitude_squared()

    def _swap(self):
        # used by connect methods to switch order of points
        self.p = self.p2
        self.v *= -1
        return self

    length = property(lambda self: abs(self.v))

class Sphere:
    __slots__ = ['c', 'r']

    def __init__(self, center, radius):
        assert isinstance(center, Vector3) and type(radius) == float
        self.c = center.copy()
        self.r = radius

    def __copy__(self):
        return self.__class__(self.c, self.r)

    copy = __copy__

    def __repr__(self):
        return 'Sphere(<%.2f, %.2f, %.2f>, radius=%.2f)' % \
            (self.c.x, self.c.y, self.c.z, self.r)

    def _apply_transform(self, t):
        self.c = t * self.c

    def intersect(self, other):
        return other._intersect_sphere(self)

    def _intersect_point3(self, other):
        return _intersect_point3_sphere(other, self)

    def _intersect_line3(self, other):
        return _intersect_line3_sphere(other, self)

    def connect(self, other):
        return other._connect_sphere(self)

    def _connect_point3(self, other):
        return _connect_point3_sphere(other, self)

    def _connect_line3(self, other):
        c = _connect_sphere_line3(self, other)
        if c:
            return c._swap()

    def _connect_sphere(self, other):
        return _connect_sphere_sphere(other, self)

    def _connect_plane(self, other):
        c = _connect_sphere_plane(self, other)
        if c:
            return c

class Plane:
    # n.p = k, where n is normal, p is point on plane, k is constant scalar
    __slots__ = ['n', 'k']

    def __init__(self, *args):
        if len(args) == 3:
            assert isinstance(args[0], Point3) and \
                   isinstance(args[1], Point3) and \
                   isinstance(args[2], Point3)
            self.n = (args[1] - args[0]).cross(args[2] - args[0])
            self.n.normalize()
            self.k = self.n.dot(args[0])
        elif len(args) == 2:
            if isinstance(args[0], Point3) and isinstance(args[1], Vector3):
                self.n = args[1].normalized()
                self.k = self.n.dot(args[0])
            elif isinstance(args[0], Vector3) and type(args[1]) == float:
                self.n = args[0].normalized()
                self.k = args[1]
            else:
                raise AttributeError('%r' % (args,))

        else:
            raise AttributeError('%r' % (args,))
        
        if not self.n:
            raise AttributeError('Points on plane are colinear')

    def __copy__(self):
        return self.__class__(self.n, self.k)

    copy = __copy__

    def __repr__(self):
        return 'Plane(<%.2f, %.2f, %.2f>.p = %.2f)' % \
            (self.n.x, self.n.y, self.n.z, self.k)

    def _get_point(self):
        # Return an arbitrary point on the plane
        if self.n.z:
            return Point3(0., 0., self.k / self.n.z)
        elif self.n.y:
            return Point3(0., self.k / self.n.y, 0.)
        else:
            return Point3(self.k / self.n.x, 0., 0.)

    def _apply_transform(self, t):
        p = t * self._get_point()
        self.n = t * self.n
        self.k = self.n.dot(p)

    def intersect(self, other):
        return other._intersect_plane(self)

    def _intersect_line3(self, other):
        return _intersect_line3_plane(other, self)

    def _intersect_plane(self, other):
        return _intersect_plane_plane(self, other)

    def connect(self, other):
        return other._connect_plane(self)

    def _connect_point3(self, other):
        return _connect_point3_plane(other, self)

    def _connect_line3(self, other):
        return _connect_line3_plane(other, self)

    def _connect_sphere(self, other):
        return _connect_sphere_plane(other, self)

    def _connect_plane(self, other):
        return _connect_plane_plane(other, self)

class Debug:
	def __init__(self, image):
		if image is not None:
			self.im = image[0]
			self.draw = image[1]
			self.do = True
		else:
			self.do = False

	def line(self, *args, **kwargs):
		if self.do:
			self.draw.line(*args, **kwargs)

	def rectangle(self, *args, **kwargs):
		if self.do:
			self.draw.rectangle(*args, **kwargs)

	def show(self):
		if self.do:
			self.im.show()

_debug = Debug(None)

def set_debug(image):
	global _debug
	_debug = Debug(image)

def _window(lst):
	prevs, items, nexts = tee(lst, 3)
	prevs = islice(cycle(prevs), len(lst)-1, None)
	nexts = islice(cycle(nexts), 1, None)
	return izip(prevs, items, nexts)

def _cross(a, b):
	res = a.x*b.y - b.x*a.y
	return res

def _approximately_equals(a, b):
	return a==b or (abs(a-b) <= max(abs(a), abs(b)) * 0.001)

def _approximately_same(point_a, point_b):
	return _approximately_equals(point_a.x, point_b.x) and _approximately_equals(point_a.y, point_b.y)

def _normalize_contour(contour):
	contour = [Point2(float(x), float(y)) for (x,y) in contour]
	return [point for prev, point, next in _window(contour) if not (point==next or (point-prev).normalized() == (next-point).normalized())]


class _SplitEvent(namedtuple("_SplitEvent", "distance, intersection_point, vertex, opposite_edge")):
	__slots__ = ()
	def __str__(self):
		return "{} Split event @ {} from {} to {}".format(self.distance, self.intersection_point, self.vertex, self.opposite_edge)

class _EdgeEvent(namedtuple("_EdgeEvent", "distance intersection_point vertex_a vertex_b")):
	__slots__ = ()
	def __str__(self):
		return "{} Edge event @ {} between {} and {}".format(self.distance, self.intersection_point, self.vertex_a, self.vertex_b)

_OriginalEdge = namedtuple("_OriginalEdge", "edge bisector_left, bisector_right")

Subtree = namedtuple("Subtree", "source, height, sinks")

def _side(point, line):
	a = line.p.x
	b = line.p.y

class _LAVertex:
	def __init__(self, point, edge_left, edge_right, direction_vectors=None):
		self.point = point
		self.edge_left = edge_left
		self.edge_right = edge_right
		self.prev = None
		self.next = None
		self.lav = None
		self._valid = True; # this should be handled better. Maybe membership in lav implies validity?

		creator_vectors = (edge_left.v.normalized()*-1, edge_right.v.normalized())
		if direction_vectors is None:
			direction_vectors = creator_vectors

		self._is_reflex = (_cross(*direction_vectors)) < 0
		self._bisector = Ray2(self.point, operator.add(*creator_vectors) * (-1 if self.is_reflex else 1))
		log.info("Created vertex %s", self.__repr__())
		_debug.line((self.bisector.p.x, self.bisector.p.y, self.bisector.p.x+self.bisector.v.x*100, self.bisector.p.y+self.bisector.v.y*100), fill="blue")

	@property
	def bisector(self):
		return self._bisector

	@property
	def is_reflex(self):
		return self._is_reflex

	@property
	def original_edges(self):
		return self.lav._slav._original_edges

	def next_event(self):
		events = []
		if self.is_reflex:
			# a reflex vertex may generate a split event
			# split events happen when a vertex hits an opposite edge, splitting the polygon in two.
			log.debug("looking for split candidates for vertex %s", self)
			for edge in self.original_edges:
				if edge.edge == self.edge_left or edge.edge == self.edge_right:
					continue

				log.debug("\tconsidering EDGE %s", edge)

				# a potential b is at the intersection of between our own bisector and the bisector of the
				# angle between the tested edge and any one of our own edges.

				# we choose the "less parallel" edge (in order to exclude a potentially parallel edge)
				leftdot = abs(self.edge_left.v.normalized().dot(edge.edge.v.normalized()))
				rightdot = abs(self.edge_right.v.normalized().dot(edge.edge.v.normalized()))
				selfedge = self.edge_left if leftdot < rightdot else self.edge_right
				otheredge = self.edge_left if leftdot > rightdot else self.edge_right

				i = Line2(selfedge).intersect(Line2(edge.edge))
				if i is not None and not _approximately_equals(i, self.point):
					#locate candidate b
					linvec = (self.point - i).normalized()
					edvec = edge.edge.v.normalized()
					if linvec.dot(edvec)<0:
						edvec = -edvec

					bisecvec = edvec + linvec
					if abs(bisecvec) == 0:
						continue
					bisector = Line2(i, bisecvec)
					b = bisector.intersect(self.bisector)

					if b is None:
						continue

					#check eligibility of b
					# a valid b should lie within the area limited by the edge and the bisectors of its two vertices:
					xleft =  _cross(edge.bisector_left.v.normalized(), (b - edge.bisector_left.p).normalized())  > 0
					xright = _cross(edge.bisector_right.v.normalized(), (b - edge.bisector_right.p).normalized())  <  0
					xedge =  _cross(edge.edge.v.normalized(), (b - edge.edge.p).normalized()) < 0

					if not (xleft and xright and xedge):
						log.debug("\t\tDiscarded candidate %s (%s-%s-%s)", b, xleft, xright, xedge)
						continue

					log.debug("\t\tFound valid candidate %s", b)
					events.append( _SplitEvent(Line2(edge.edge).distance(b), b, self, edge.edge) )

		i_prev = self.bisector.intersect(self.prev.bisector)
		i_next = self.bisector.intersect(self.next.bisector)
		print self.bisector
		if i_prev is not None:
			events.append(_EdgeEvent(Line2(self.edge_left).distance(i_prev), i_prev, self.prev, self))
		if i_next is not None:
			events.append(_EdgeEvent(Line2(self.edge_right).distance(i_next), i_next, self, self.next))

		if not events:
			return None

		ev = min(events, key=lambda event: self.point.distance(event.intersection_point))

		log.info("Generated new event for %s: %s", self, ev)
		return ev

	def invalidate(self):
		if self.lav is not None:
			self.lav.invalidate(self)
		else:
			self._valid = False

	@property
	def is_valid(self):
		return self._valid

	def __str__(self):
		return "Vertex ({:.2f};{:.2f})".format(self.point.x, self.point.y)

	def __repr__(self):
		return "Vertex ({}) ({:.2f};{:.2f}), bisector {}, edges {} {}".format("reflex" if self.is_reflex else "convex", self.point.x, self.point.y, self.bisector, self.edge_left, self.edge_right)

class _SLAV:
	def __init__(self, polygon, holes):
		contours = [_normalize_contour(polygon)]
		#contours.extend([_normalize_contour(hole) for hole in holes])

		self._lavs = [ _LAV.from_polygon(contour, self) for contour in contours ]

		#store original polygon edges for calculating split events
		self._original_edges = [_OriginalEdge(LineSegment2(vertex.prev.point, vertex.point), vertex.prev.bisector, vertex.bisector) for vertex in chain.from_iterable(self._lavs)]

	def __iter__(self):
		for lav in self._lavs:
			yield lav

	def __len__(self):
		return len(self._lavs)

	def empty(self):
		return len(self._lavs) == 0

	def handle_edge_event(self, event):
		sinks = []
		events = []

		lav = event.vertex_a.lav
		if event.vertex_a.prev == event.vertex_b.next:
			log.info("%.2f Peak event at intersection %s from <%s,%s,%s> in %s", event.distance, event.intersection_point, event.vertex_a, event.vertex_b, event.vertex_a.prev, lav)
			self._lavs.remove(lav)
			for vertex in list(lav):
				sinks.append(vertex.point)
				vertex.invalidate()
		else:
			log.info("%.2f Edge event at intersection %s from <%s,%s> in %s", event.distance, event.intersection_point, event.vertex_a, event.vertex_b,lav)
			new_vertex = lav.unify(event.vertex_a, event.vertex_b, event.intersection_point)
			if lav.head in (event.vertex_a, event.vertex_b):
				lav.head = new_vertex
			sinks.extend((event.vertex_a.point, event.vertex_b.point))
			next_event = new_vertex.next_event()
			if next_event is not None:
				events.append(next_event)

		return (Subtree(event.intersection_point, event.distance, sinks), events)

	def handle_split_event(self, event):
		lav = event.vertex.lav
		log.info("%.2f Split event at intersection %s from vertex %s, for edge %s in %s", event.distance, event.intersection_point, event.vertex, event.opposite_edge, lav)

		sinks = [event.vertex.point]
		vertices = []
		x = None   # right vertex
		y = None   # left vertex
		norm = event.opposite_edge.v.normalized()
		for v in chain.from_iterable(self._lavs):
			log.debug("%s in %s", v, v.lav)
			if norm == v.edge_left.v.normalized() and event.opposite_edge.p == v.edge_left.p:
				x = v
				y = x.prev
			elif norm == v.edge_right.v.normalized() and event.opposite_edge.p == v.edge_right.p:
				y=v
				x=y.next

			if x:
				xleft =  _cross(y.bisector.v.normalized(), (event.intersection_point - y.point).normalized())  >= 0
				xright = _cross(x.bisector.v.normalized(), (event.intersection_point - x.point).normalized())  <=  0
				log.debug("Vertex %s holds edge as %s edge (%s, %s)", v, ("left" if x==v else "right"), xleft, xright)

				if xleft and xright:
					break
				else:
					x = None
					y = None

		if x is None:
			log.info("Failed split event %s (equivalent edge event is expected to follow)", event)
			return (None,[])

		v1 = _LAVertex(event.intersection_point, event.vertex.edge_left, event.opposite_edge)
		v2 = _LAVertex(event.intersection_point, event.opposite_edge, event.vertex.edge_right)

		v1.prev = event.vertex.prev
		v1.next = x
		event.vertex.prev.next = v1
		x.prev = v1

		v2.prev = y
		v2.next = event.vertex.next
		event.vertex.next.prev = v2
		y.next = v2

		new_lavs = None
		self._lavs.remove(lav)
		if lav != x.lav:
			# the split event actually merges two lavs
			self._lavs.remove(x.lav)
			new_lavs = [_LAV.from_chain(v1, self)]
		else:
			new_lavs = [_LAV.from_chain(v1, self), _LAV.from_chain(v2, self)]

		for l in new_lavs:
			log.debug(l)
			if len(l) > 2:
				self._lavs.append(l)
				vertices.append(l.head)
			else:
				log.info("LAV %s has collapsed into the line %s--%s", l, l.head.point, l.head.next.point)
				sinks.append(l.head.next.point)
				for v in list(l):
					v.invalidate()

		events = []
		for vertex in vertices:
			next_event = vertex.next_event()
			if next_event is not None:
				events.append(next_event)

		event.vertex.invalidate()
		return (Subtree(event.intersection_point, event.distance, sinks), events)

class _LAV:
	def __init__(self, slav):
		self.head = None
		self._slav = slav
		self._len = 0
		log.debug("Created LAV %s", self)


	@classmethod
	def from_polygon(cls, polygon, slav):
		lav = cls(slav)
		for prev, point, next in _window(polygon):
			lav._len += 1
			vertex = _LAVertex(point, LineSegment2(prev, point), LineSegment2(point, next))
			vertex.lav = lav
			if lav.head == None:
				lav.head = vertex
				vertex.prev = vertex.next = vertex
			else:
				vertex.next = lav.head
				vertex.prev = lav.head.prev
				vertex.prev.next = vertex
				lav.head.prev = vertex
		return lav

	@classmethod
	def from_chain(cls, head, slav):
		lav = cls(slav)
		lav.head = head
		for vertex in lav:
			lav._len += 1
			vertex.lav = lav
		return lav

	def invalidate(self, vertex):
		assert vertex.lav is self, "Tried to invalidate a vertex that's not mine"
		log.debug("Invalidating %s", vertex)
		vertex._valid = False
		if self.head == vertex:
			self.head = self.head.next
		vertex.lav = None

	def unify(self, vertex_a, vertex_b, point):
		replacement =_LAVertex(point, vertex_a.edge_left, vertex_b.edge_right, (vertex_b.bisector.v.normalized(), vertex_a.bisector.v.normalized()))
		replacement.lav = self

		if self.head in [vertex_a, vertex_b]:
			self.head = replacement

		vertex_a.prev.next = replacement
		vertex_b.next.prev = replacement
		replacement.prev = vertex_a.prev
		replacement.next = vertex_b.next

		vertex_a.invalidate()
		vertex_b.invalidate()

		self._len -= 1
		return replacement

	def __str__(self):
		return "LAV {}".format(id(self))

	def __repr__(self):
		return "{} = {}".format(str(self), [vertex for vertex in self])

	def __len__(self):
		return self._len

	def __iter__(self):
		cur = self.head
		while True:
			yield cur
			cur = cur.next
			if cur == self.head:
				raise StopIteration

	def _show(self):
		cur = self.head
		while True:
			print cur.__repr__()
			cur = cur.next
			if cur == self.head:
				break

class _EventQueue:
	def __init__(self):
		self.__data = []

	def put(self, item):
		if item is not None:
			heapq.heappush(self.__data, item)

	def put_all(self, iterable):
		for item in iterable:
			heapq.heappush(self.__data, item)

	def get(self):
		return heapq.heappop(self.__data)

	def empty(self):
		return len(self.__data)==0

	def peek(self):
		return self.__data[0]

	def show(self):
		for item in self.__data:
			print item

def skeletonize(polygon, holes=None):
	"""
	Compute the straight skeleton of a polygon.

	The polygon should be given as a list of vertices in counter-clockwise order.
	Holes is a list of the contours of the holes, the vertices of which should be in clockwise order.

	Returns the straight skeleton as a list of "subtrees", which are in the form of (source, height, sinks),
	where source is the highest points, height is its height, and sinks are the point connected to the source.
	"""
	slav = _SLAV(polygon, holes)
	output = []
	prioque = _EventQueue()

	for lav in slav:
		for vertex in lav:
			print vertex
			prioque.put(vertex.next_event())
	print prioque.empty()
	while not (prioque.empty() or slav.empty()):
		log.debug("SLAV is %s", [repr(lav) for lav in slav])
		i = prioque.get()
		if isinstance(i, _EdgeEvent):
			if not i.vertex_a.is_valid or not i.vertex_b.is_valid:
				log.info("%.2f Discarded outdated edge event %s", i.distance, i)
				continue

			(arc, events) = slav.handle_edge_event(i)
		elif isinstance(i, _SplitEvent):
			if not i.vertex.is_valid:
				log.info("%.2f Discarded outdated split event %s", i.distance, i)
				continue
			(arc, events) = slav.handle_split_event(i)

		prioque.put_all(events)
		if arc is not None:
			output.append(arc)
			for sink in arc.sinks:
				_debug.line((arc.source.x, arc.source.y, sink.x, sink.y), fill="red")

			_debug.show()
	return output

Shape = sc.sticky['Shape']
Grammar = sc.sticky['Grammar']
G = Grammar()
shapenode = G.helper_geom2node(shape)
polygon = []
for i in xrange(len(shapenode.shape.base_matrix)):
    v = shapenode.shape.base_matrix[i][0]
    #[Point2(float(x), float(y)) for (x,y) in contour]
    pypt = Point2(v.X,v.Y)
    polygon.append(pypt)

ss = skeletonize(polygon)
print ss
# ---------- end python_2 ----------
# ---- group: SHAPENODE
bibil_7 = PythonScript(Code=file_6, Rule_in=flatten(miru_9), Node_in=flatten(geo_2), Run=Toggle(True))  # -> Node_out, Debug

bibil_8 = PythonScript(Code=file_6, Rule_in=flatten(miru_10), Node_in=flatten(geo_4), Run=Toggle(True))  # -> Node_out, Debug

# ----
python_3 = PythonScript()  # -> out, a; disabled
# ---------- python_3: Python ----------
# -*- coding: utf-8 -*-

"""
Implementation of the straight skeleton algorithm as described by Felkel and Obdržálek in their 1998 conference paper Straight skeleton implementation.
"""

import logging
import heapq
from itertools import *
from collections import namedtuple

log = logging.getLogger("__name__")

class Debug:
	def __init__(self, image):
		if image is not None:
			self.im = image[0]
			self.draw = image[1]
			self.do = True
		else:
			self.do = False

	def line(self, *args, **kwargs):
		if self.do:
			self.draw.line(*args, **kwargs)

	def rectangle(self, *args, **kwargs):
		if self.do:
			self.draw.rectangle(*args, **kwargs)

	def show(self):
		if self.do:
			self.im.show()

_debug = Debug(None)

def set_debug(image):
	global _debug
	_debug = Debug(image)

def _window(lst):
	prevs, items, nexts = tee(lst, 3)
	prevs = islice(cycle(prevs), len(lst)-1, None)
	nexts = islice(cycle(nexts), 1, None)
	return izip(prevs, items, nexts)

def _cross(a, b):
	res = a.x*b.y - b.x*a.y
	return res

def _approximately_equals(a, b):
	return a==b or (abs(a-b) <= max(abs(a), abs(b)) * 0.001)

def _approximately_same(point_a, point_b):
	return _approximately_equals(point_a.x, point_b.x) and _approximately_equals(point_a.y, point_b.y)

def _normalize_contour(contour):
	contour = [Point2(float(x), float(y)) for (x,y) in contour]
	return [point for prev, point, next in _window(contour) if not (point==next or (point-prev).normalized() == (next-point).normalized())]


class _SplitEvent(namedtuple("_SplitEvent", "distance, intersection_point, vertex, opposite_edge")):
	__slots__ = ()
	def __str__(self):
		return "{} Split event @ {} from {} to {}".format(self.distance, self.intersection_point, self.vertex, self.opposite_edge)

class _EdgeEvent(namedtuple("_EdgeEvent", "distance intersection_point vertex_a vertex_b")):
	__slots__ = ()
	def __str__(self):
		return "{} Edge event @ {} between {} and {}".format(self.distance, self.intersection_point, self.vertex_a, self.vertex_b)

_OriginalEdge = namedtuple("_OriginalEdge", "edge bisector_left, bisector_right")

Subtree = namedtuple("Subtree", "source, height, sinks")

def _side(point, line):
	a = line.p.x
	b = line.p.y

class _LAVertex:
	def __init__(self, point, edge_left, edge_right, direction_vectors=None):
		self.point = point
		self.edge_left = edge_left
		self.edge_right = edge_right
		self.prev = None
		self.next = None
		self.lav = None
		self._valid = True; # this should be handled better. Maybe membership in lav implies validity?

		creator_vectors = (edge_left.v.normalized()*-1, edge_right.v.normalized())
		if direction_vectors is None:
			direction_vectors = creator_vectors

		self._is_reflex = (_cross(*direction_vectors)) < 0
		self._bisector = Ray2(self.point, operator.add(*creator_vectors) * (-1 if self.is_reflex else 1))
		log.info("Created vertex %s", self.__repr__())
		_debug.line((self.bisector.p.x, self.bisector.p.y, self.bisector.p.x+self.bisector.v.x*100, self.bisector.p.y+self.bisector.v.y*100), fill="blue")

	@property
	def bisector(self):
		return self._bisector

	@property
	def is_reflex(self):
		return self._is_reflex

	@property
	def original_edges(self):
		return self.lav._slav._original_edges

	def next_event(self):
		events = []
		if self.is_reflex:
			# a reflex vertex may generate a split event
			# split events happen when a vertex hits an opposite edge, splitting the polygon in two.
			log.debug("looking for split candidates for vertex %s", self)
			for edge in self.original_edges:
				if edge.edge == self.edge_left or edge.edge == self.edge_right:
					continue

				log.debug("\tconsidering EDGE %s", edge)

				# a potential b is at the intersection of between our own bisector and the bisector of the
				# angle between the tested edge and any one of our own edges.

				# we choose the "less parallel" edge (in order to exclude a potentially parallel edge)
				leftdot = abs(self.edge_left.v.normalized().dot(edge.edge.v.normalized()))
				rightdot = abs(self.edge_right.v.normalized().dot(edge.edge.v.normalized()))
				selfedge = self.edge_left if leftdot < rightdot else self.edge_right
				otheredge = self.edge_left if leftdot > rightdot else self.edge_right

				i = Line2(selfedge).intersect(Line2(edge.edge))
				if i is not None and not _approximately_equals(i, self.point):
					#locate candidate b
					linvec = (self.point - i).normalized()
					edvec = edge.edge.v.normalized()
					if linvec.dot(edvec)<0:
						edvec = -edvec

					bisecvec = edvec + linvec
					if abs(bisecvec) == 0:
						continue
					bisector = Line2(i, bisecvec)
					b = bisector.intersect(self.bisector)

					if b is None:
						continue

					#check eligibility of b
					# a valid b should lie within the area limited by the edge and the bisectors of its two vertices:
					xleft =  _cross(edge.bisector_left.v.normalized(), (b - edge.bisector_left.p).normalized())  > 0
					xright = _cross(edge.bisector_right.v.normalized(), (b - edge.bisector_right.p).normalized())  <  0
					xedge =  _cross(edge.edge.v.normalized(), (b - edge.edge.p).normalized()) < 0

					if not (xleft and xright and xedge):
						log.debug("\t\tDiscarded candidate %s (%s-%s-%s)", b, xleft, xright, xedge)
						continue

					log.debug("\t\tFound valid candidate %s", b)
					events.append( _SplitEvent(Line2(edge.edge).distance(b), b, self, edge.edge) )

		i_prev = self.bisector.intersect(self.prev.bisector)
		i_next = self.bisector.intersect(self.next.bisector)

		if i_prev is not None:
			events.append(_EdgeEvent(Line2(self.edge_left).distance(i_prev), i_prev, self.prev, self))
		if i_next is not None:
			events.append(_EdgeEvent(Line2(self.edge_right).distance(i_next), i_next, self, self.next))

		if not events:
			return None

		ev = min(events, key=lambda event: self.point.distance(event.intersection_point))

		log.info("Generated new event for %s: %s", self, ev)
		return ev

	def invalidate(self):
		if self.lav is not None:
			self.lav.invalidate(self)
		else:
			self._valid = False

	@property
	def is_valid(self):
		return self._valid

	def __str__(self):
		return "Vertex ({:.2f};{:.2f})".format(self.point.x, self.point.y)

	def __repr__(self):
		return "Vertex ({}) ({:.2f};{:.2f}), bisector {}, edges {} {}".format("reflex" if self.is_reflex else "convex", self.point.x, self.point.y, self.bisector, self.edge_left, self.edge_right)

class _SLAV:
	def __init__(self, polygon, holes):
		contours = [_normalize_contour(polygon)]
		contours.extend([_normalize_contour(hole) for hole in holes])

		self._lavs = [ _LAV.from_polygon(contour, self) for contour in contours ]

		#store original polygon edges for calculating split events
		self._original_edges = [_OriginalEdge(LineSegment2(vertex.prev.point, vertex.point), vertex.prev.bisector, vertex.bisector) for vertex in chain.from_iterable(self._lavs)]

	def __iter__(self):
		for lav in self._lavs:
			yield lav

	def __len__(self):
		return len(self._lavs)

	def empty(self):
		return len(self._lavs) == 0

	def handle_edge_event(self, event):
		sinks = []
		events = []

		lav = event.vertex_a.lav
		if event.vertex_a.prev == event.vertex_b.next:
			log.info("%.2f Peak event at intersection %s from <%s,%s,%s> in %s", event.distance, event.intersection_point, event.vertex_a, event.vertex_b, event.vertex_a.prev, lav)
			self._lavs.remove(lav)
			for vertex in list(lav):
				sinks.append(vertex.point)
				vertex.invalidate()
		else:
			log.info("%.2f Edge event at intersection %s from <%s,%s> in %s", event.distance, event.intersection_point, event.vertex_a, event.vertex_b,lav)
			new_vertex = lav.unify(event.vertex_a, event.vertex_b, event.intersection_point)
			if lav.head in (event.vertex_a, event.vertex_b):
				lav.head = new_vertex
			sinks.extend((event.vertex_a.point, event.vertex_b.point))
			next_event = new_vertex.next_event()
			if next_event is not None:
				events.append(next_event)

		return (Subtree(event.intersection_point, event.distance, sinks), events)

	def handle_split_event(self, event):
		lav = event.vertex.lav
		log.info("%.2f Split event at intersection %s from vertex %s, for edge %s in %s", event.distance, event.intersection_point, event.vertex, event.opposite_edge, lav)

		sinks = [event.vertex.point]
		vertices = []
		x = None   # right vertex
		y = None   # left vertex
		norm = event.opposite_edge.v.normalized()
		for v in chain.from_iterable(self._lavs):
			log.debug("%s in %s", v, v.lav)
			if norm == v.edge_left.v.normalized() and event.opposite_edge.p == v.edge_left.p:
				x = v
				y = x.prev
			elif norm == v.edge_right.v.normalized() and event.opposite_edge.p == v.edge_right.p:
				y=v
				x=y.next

			if x:
				xleft =  _cross(y.bisector.v.normalized(), (event.intersection_point - y.point).normalized())  >= 0
				xright = _cross(x.bisector.v.normalized(), (event.intersection_point - x.point).normalized())  <=  0
				log.debug("Vertex %s holds edge as %s edge (%s, %s)", v, ("left" if x==v else "right"), xleft, xright)

				if xleft and xright:
					break
				else:
					x = None
					y = None

		if x is None:
			log.info("Failed split event %s (equivalent edge event is expected to follow)", event)
			return (None,[])

		v1 = _LAVertex(event.intersection_point, event.vertex.edge_left, event.opposite_edge)
		v2 = _LAVertex(event.intersection_point, event.opposite_edge, event.vertex.edge_right)

		v1.prev = event.vertex.prev
		v1.next = x
		event.vertex.prev.next = v1
		x.prev = v1

		v2.prev = y
		v2.next = event.vertex.next
		event.vertex.next.prev = v2
		y.next = v2

		new_lavs = None
		self._lavs.remove(lav)
		if lav != x.lav:
			# the split event actually merges two lavs
			self._lavs.remove(x.lav)
			new_lavs = [_LAV.from_chain(v1, self)]
		else:
			new_lavs = [_LAV.from_chain(v1, self), _LAV.from_chain(v2, self)]

		for l in new_lavs:
			log.debug(l)
			if len(l) > 2:
				self._lavs.append(l)
				vertices.append(l.head)
			else:
				log.info("LAV %s has collapsed into the line %s--%s", l, l.head.point, l.head.next.point)
				sinks.append(l.head.next.point)
				for v in list(l):
					v.invalidate()

		events = []
		for vertex in vertices:
			next_event = vertex.next_event()
			if next_event is not None:
				events.append(next_event)

		event.vertex.invalidate()
		return (Subtree(event.intersection_point, event.distance, sinks), events)

class _LAV:
	def __init__(self, slav):
		self.head = None
		self._slav = slav
		self._len = 0
		log.debug("Created LAV %s", self)


	@classmethod
	def from_polygon(cls, polygon, slav):
		lav = cls(slav)
		for prev, point, next in _window(polygon):
			lav._len += 1
			vertex = _LAVertex(point, LineSegment2(prev, point), LineSegment2(point, next))
			vertex.lav = lav
			if lav.head == None:
				lav.head = vertex
				vertex.prev = vertex.next = vertex
			else:
				vertex.next = lav.head
				vertex.prev = lav.head.prev
				vertex.prev.next = vertex
				lav.head.prev = vertex
		return lav

	@classmethod
	def from_chain(cls, head, slav):
		lav = cls(slav)
		lav.head = head
		for vertex in lav:
			lav._len += 1
			vertex.lav = lav
		return lav

	def invalidate(self, vertex):
		assert vertex.lav is self, "Tried to invalidate a vertex that's not mine"
		log.debug("Invalidating %s", vertex)
		vertex._valid = False
		if self.head == vertex:
			self.head = self.head.next
		vertex.lav = None

	def unify(self, vertex_a, vertex_b, point):
		replacement =_LAVertex(point, vertex_a.edge_left, vertex_b.edge_right, (vertex_b.bisector.v.normalized(), vertex_a.bisector.v.normalized()))
		replacement.lav = self

		if self.head in [vertex_a, vertex_b]:
			self.head = replacement

		vertex_a.prev.next = replacement
		vertex_b.next.prev = replacement
		replacement.prev = vertex_a.prev
		replacement.next = vertex_b.next

		vertex_a.invalidate()
		vertex_b.invalidate()

		self._len -= 1
		return replacement

	def __str__(self):
		return "LAV {}".format(id(self))

	def __repr__(self):
		return "{} = {}".format(str(self), [vertex for vertex in self])

	def __len__(self):
		return self._len

	def __iter__(self):
		cur = self.head
		while True:
			yield cur
			cur = cur.next
			if cur == self.head:
				raise StopIteration

	def _show(self):
		cur = self.head
		while True:
			print cur.__repr__()
			cur = cur.next
			if cur == self.head:
				break

class _EventQueue:
	def __init__(self):
		self.__data = []

	def put(self, item):
		if item is not None:
			heapq.heappush(self.__data, item)

	def put_all(self, iterable):
		for item in iterable:
			heapq.heappush(self.__data, item)

	def get(self):
		return heapq.heappop(self.__data)

	def empty(self):
		return len(self.__data)==0

	def peek(self):
		return self.__data[0]

	def show(self):
		for item in self.__data:
			print item

def skeletonize(polygon, holes=None):
	"""
	Compute the straight skeleton of a polygon.

	The polygon should be given as a list of vertices in counter-clockwise order.
	Holes is a list of the contours of the holes, the vertices of which should be in clockwise order.

	Returns the straight skeleton as a list of "subtrees", which are in the form of (source, height, sinks),
	where source is the highest points, height is its height, and sinks are the point connected to the source.
	"""
	slav = _SLAV(polygon, holes)
	output = []
	prioque = _EventQueue()

	for lav in slav:
		for vertex in lav:
			prioque.put(vertex.next_event())

	while not (prioque.empty() or slav.empty()):
		log.debug("SLAV is %s", [repr(lav) for lav in slav])
		i = prioque.get()
		if isinstance(i, _EdgeEvent):
			if not i.vertex_a.is_valid or not i.vertex_b.is_valid:
				log.info("%.2f Discarded outdated edge event %s", i.distance, i)
				continue

			(arc, events) = slav.handle_edge_event(i)
		elif isinstance(i, _SplitEvent):
			if not i.vertex.is_valid:
				log.info("%.2f Discarded outdated split event %s", i.distance, i)
				continue
			(arc, events) = slav.handle_split_event(i)

		prioque.put_all(events)

		if arc is not None:
			output.append(arc)
			for sink in arc.sinks:
				_debug.line((arc.source.x, arc.source.y, sink.x, sink.y), fill="red")

			_debug.show()
	return output
# ---------- end python_3 ----------
geo_5 = Geometry([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])
python_4 = PythonScript()  # -> a, b; disabled
# ---------- python_4: Python ----------
import rhinoscriptsyntax as rs

P = [(100, 50),\
(150, 150),\
(50,  100),\
(50,  350),\
(350, 350),\
(350, 100),\
(250, 150),\
(300, 50)]
print len(P)
L = []
for pt in P:
    rp = rs.AddPoint(pt[0],pt[1],0)
    L.append(rp)

a = L
b = rs.AddCurve(L+[L[0]],1)
# ---------- end python_4 ----------
preview_2 = CustomPreview(Geometry=geo_5, Shader=ColourSwatch(SwatchColor=RGB(0, 78, 0)))  # disabled
geo_6 = Geometry(splitmass.splitBldgMasses)  # disabled
g = PythonScript(node=bibil_7.Node_out)  # -> geom; inputs node: list
# ---------- g: Python ----------
node = filter(lambda n: n!=None,node)
if node and node != []:
    geom = []
    for n in node:
        if n.shape.z_dist < 1.2:
            geom.append(n.shape.bottom_crv)
        else:
            geom.append(n.shape.geom)
    print geom
# ---------- end g ----------
python_5 = PythonScript()  # -> Out, A
geo_7 = Geometry(bibil_7.Debug)
g_2 = PythonScript(node=bibil_8.Node_out)  # -> geom; inputs node: list; same code as g
geo_8 = Geometry(bibil_8.Debug)
previewlw = CustomPreviewLineweights(
    Geometry=geo_7,
    Shader={ambient=RGB(0, 0, 0), diffuse=RGB(255, 105, 180), emission=RGB(76, 32, 54), shine=0.5, specular=RGB(255, 255, 255), transparency=0},
    Thickness=Slider(2, range=0..10))
python_6 = PythonScript()  # -> out, a
# ---------- python_6: Python ----------
import rhinoscriptsyntax as rs
import math

cp = [0,0,0]
v1 = rs.VectorCreate(cp,[1,0,0])
v2 = rs.VectorCreate(cp,[1,-1,0])

print v1.X * v2.X + v1.Y * v2.Y

print v1 * v2



angle = v1*v2/(rs.VectorLength(v1) * rs.VectorLength(v2))
print math.degrees(math.acos(angle))
print '--'
for i in range(8):
    print i*45, 'angle'
    print math.cos(math.radians(i*45))
    print '--'
# ---------- end python_6 ----------
panel = Panel(geo_7)
geo_9 = Geometry([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])
python_7 = PythonScript()  # -> out, a; disabled
# ---------- python_7: Python ----------
from itertools import cycle


class DLL:
    def __init__(self,dll):
        self.dll
        self.size = len(self.dll)
    def next(self):
        return self.
# ---------- end python_7 ----------
preview_3 = CustomPreview(Geometry=geo_9, Shader=ColourSwatch(SwatchColor=RGB(0, 255, 136)))
