# Grasshopper definition straight_skeleton_algorithm_for_test.gh (Grasshopper 0.9.76)
# plug-ins: Python Interpreter, HDTReference

# ---- group: CHANGE PERIMETER HERE
number_slider = Slider(23, range=0..100)

number_slider_2 = Slider(14, range=0..100)

number_slider_3 = Slider(30, range=0..100)

# ---- group: INPUT SHAPE CURVE
geo = Geometry([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])

geo_2 = Geometry([<curve referenced from the Rhino model> x4])

geo_3 = Geometry([<curve referenced from the Rhino model> x4])

# ----
vec = VectorXYZ(XComponent=0, YComponent=0, ZComponent=Slider(22, range=0..100))  # -> Vector, Length
vec_2 = VectorXYZ(XComponent=0, YComponent=0, ZComponent=Slider(22, range=0..100))  # -> Vector, Length
vec_3 = VectorXYZ(XComponent=0, YComponent=0, ZComponent=Slider(22, range=0..100))  # -> Vector, Length
extr = Extrude(Base=geo, Direction=vec.Vector)
extr_2 = Extrude(Base=geo_2, Direction=vec_2.Vector)
extr_3 = Extrude(Base=geo_3, Direction=vec_3.Vector)
capex = CapHolesEx(Brep=extr)  # -> Brep, Caps, Solid
capex_2 = CapHolesEx(Brep=extr_2)  # -> Brep, Caps, Solid
capex_3 = CapHolesEx(Brep=extr_3)  # -> Brep, Caps, Solid

bibil = PythonScript()  # -> o
# ---------- bibil: Python ----------
"""
Created on Jun 6, 2016
@author: Saeran Vasanthakumar
"""

import rhinoscriptsyntax as rs
import Rhino as rc
import math
import ghpythonlib.components as ghcomp
import copy
import scriptcontext as sc
from itertools import cycle
import heapq
from lib2to3.pytree import Node

TOL = sc.doc.ModelAbsoluteTolerance

class DoubleLinkedList(object):
    #Creates empty doubly linked list
    def __init__(self):
        self.size = 0
        self.head = None
        self.tail = None
    def __str__(self):
        L = []
        curr_node = self.head
        for i in xrange(self.size):
            L.append(curr_node.data)
            curr_node = curr_node.next
        return str(L)
    def IsEmpty(self):
        return self.size == 0
    def __len__(self):
        return self.size
    def append(self,data):
        new_node = DLLNode(data)
        if self.head == None:
            self.head = self.tail = new_node
        else:
            #Add new node to front of list
            new_node.prev = self.tail
            new_node.next = None
            self.tail.next = new_node
            self.tail = new_node
        #Now complete circle
        self.head.prev = self.tail
        self.tail.next = self.head 
        self.size += 1    
    def __getitem__(self, i):
        #Worst case O(n) time. Don't use if not neccessary
        curr_node = self.head
        for j in xrange(self.size):
            if i == j:
                return curr_node
            curr_node = curr_node.next
        return None
    def get_node_index(self,node_ref):
        #Worst case O(n) time. Don't use if not neccessary
        curr_node = self.head
        for j in xrange(self.size):
            if curr_node is node_ref:
                return j
            curr_node = curr_node.next
        return None
class DLLNode(object):
    def __init__(self,data):
        self.data = data
        self.next = None
        self.prev = None
    def __str__(self):
        return str(self.data)
class Vertex(object):
    def __init__(self,vertex,edge_prev=None,edge_next=None):
        self.vertex = vertex
        self.edge_prev = edge_prev
        self.edge_next = edge_next
        self.bisector_ray = None
        self.is_reflex = None
        self.is_processed = False
    def __str__(self):
        return str(self.vertex)
class EdgeEvent(object):
    def __init__(self,int_vertex,int_arc,node_A,node_B,length2edge,currnode4debug):
        self.int_vertex = int_vertex
        self.int_arc = int_arc
        self.node_A = node_A
        self.node_B = node_B
        self.length2edge = length2edge
        self.currnode4debug = currnode4debug
    def __str__(self):
        return str(self.int_vertex)


#Adjacency list class make into own library
class _AdjGraphNode(object):
    #This is a bare bones private class
    def __init__(self,key,value,id,is_out_edge=False,adj_lst=None):
        #adj_lst: ['key1', 'key2' ....  'keyn']
        self.key = key
        self.id = id
        self.value = value
        self.is_out_edge = is_out_edge
        self.adj_lst = adj_lst if adj_lst!=None else []
    def num_neighbor(self):
        return len(self.adj_lst)
    def __repr__(self):
        return "id: " + str(self.id)
    
class AdjGraph(object):
    #Graph as adjacency list
    #Good ref for adj graphs: http://interactivepython.org/runestone/static/pythonds/Graphs/Implementation.html
    #adj_graph is a dict like this: 
    #{key1: _AdjGraphNode.adj_lst = [2,4],
    # key2: _AdjGraphNode.adj_lst = [3,4],
    # key3: _AdjGraphNode.adj_lst = [4],
    # key4: _AdjGraphNode.adj_lst = [1]}
    #
    # 1<--->4
    # |  /  |
    # 2---->3
    #
    def __init__(self,adj_graph=None):
        self.adj_graph = adj_graph if adj_graph != None else {}
        self.num_node = len(self.adj_graph.keys())        
    def vector2hash(self,vector,tol=4):
        #Tolerance set to 4
        myhash = "("
        for i in xrange(len(vector)):
            coordinate = vector[i]
            myhash += str(round(coordinate,tol))
            if i < len(vector)-1: 
                myhash += ","
        myhash += ")"
        return myhash
    def add_node(self,key,value,is_out_edge=False):
        #_AdjGraphNode is a private class
        #Instantiate _AdjGraphNode, we creates key = num_node
        if key in self.adj_graph:
            n = self.adj_graph[key]
            print n.id, ' key already exists in adj_graph!'
            return self.adj_graph[key]
        id = len(self.adj_graph.keys())
        adj_graph_node = _AdjGraphNode(key,value,id,is_out_edge)
        #Now add it to the adj_graph
        self.adj_graph[key] = adj_graph_node
        self.num_node += 1
        return adj_graph_node
    def __getitem__(self,k):
        if k in self.adj_graph:
            return self.adj_graph[k]
        else:
            return None
    def keylst_2_nodelst(self,keylst):
        return map(lambda k: self.adj_graph[k],keylst)
    def add_directed_edge(self,key,key2add):
        #This function will add existing node key to adjacency list of 
        #another node indicating a directed edge
        if key in self.adj_graph and key2add in self.adj_graph:
            node = self.adj_graph[key]
            if key2add in node.adj_lst:
                print 'key2add already in adj list'
                return None
            node.adj_lst.append(key2add)
        else:
            print 'key not in adj graph' 
    def recurse_ccw(self,refn,nextn,lok,cycle):
        def get_ccw_angle(prev_dir,next_dir):
            #FIX THIS LATER: REFLEX CHECKING AND SEPARATE FX
            
            #Input prev_dir vector and next_dir vector
            #Vectors must be facing away from each other!
            #Output CCW angle between them
            
            # Get angle from dot product
            # This will be between 0 and pi
            # b/c -1 < cos theta < 1
            dotprod = rc.Geometry.Vector3d.Multiply(prev_dir,next_dir)
            cos_angle = dotprod/(prev_dir.Length * next_dir.Length)
            #print 'ca', cos_angle
            dotrad = math.acos(cos_angle)
            
            #Use the dot product to find the angle and the sign of the cross product to tell you which side it is. 
            #For storing them in counterclockwise order, positive will be the inner angle
            
            #Check the sign of the cross product to check if inner or outer angle
            #We will take cross of of 2d vector in xy plane
            #If cross is positive (for ccw ordering) then it is the inner angle
            #If cross is negative or zero (for ccw ordering) then it is the outer angle
            #Therefore if cross is negative, then that means dotprod returned outer angle 
            #because it is between 0 and pi. Therefore it is reflex
            #Ref: http://stackoverflow.com/questions/20252845/best-algorithm-for-detecting-interior-and-exterior-angles-of-an-arbitrary-shape
            IsInner = prev_dir[0] * next_dir[1] > prev_dir[1] * next_dir[0]
            if IsInner:
                #if inner angle is a reflex angle subtract with 2pi
                dotrad = 2.*math.pi - dotrad
            return dotrad
        
        if True: pass #weird code folding glitch neccessitatest this
        #Input list of keys
        #output key with most ccw
        #Base case
        #print 'startid, chkid:', cycle[0].id, nextn.id
        cycle.append(nextn)
        cycle_id_lst = map(lambda n: n.id, cycle)
        if nextn.id == cycle_id_lst[0]:
            return cycle
        
        #print 'cycle', cycle_id_lst
        
        
        #reference direction vector
        ref_edge_dir = nextn.value - refn.value
        ref_edge_dir *= -1 #reverse the vector
        
        min_rad = 99999.
        min_node = None
         
        for i in xrange(len(lok)):
            k = lok[i]
            n2chk = self.adj_graph[k]
            #print 'we are chking', refn.id, '-', nextn.id, 'edge to', n2chk.id
            #Make sure we don't backtrack
            if n2chk.id == cycle_id_lst[-2]:
                continue
            chk_edge_dir = n2chk.value - nextn.value
            rad = get_ccw_angle(ref_edge_dir,chk_edge_dir)
            if rad < min_rad:
                min_rad = rad
                min_node = n2chk
        #print 'min is', n2chk.id,':', round(math.degrees(rad),2)
        #print '---'
        alok = min_node.adj_lst
        
        return self.recurse_ccw(nextn,min_node,alok,cycle)
    def find_most_ccw_cycle(self):
        #def helper_most_ccw(lok):
            
        #Input adjacency graph
        #Output loc: listof (listof (listof pts in closed cycle))
        LOC = []
        keylst = self.get_sorted_keylst()
        for i in xrange(len(keylst)):
            key = keylst[i]
            root_node = self.adj_graph[key]
            if not root_node.is_out_edge:
                continue
            
            #Identify the next node on outer edge
            #b/c outer edge vertexes are placed first in adj graph
            #worst complexity <= O(n)
            for i in xrange(root_node.num_neighbor()):
                adj_key = root_node.adj_lst[i]
                neighbor = self.adj_graph[adj_key]
                if neighbor.is_out_edge:
                    next_node = neighbor
                    break
            
            #Now we recursively check most ccw
            n_adj_lst = next_node.adj_lst
            cycle = [root_node]
            cycle = self.recurse_ccw(root_node,next_node,n_adj_lst,cycle)
            #print '-------\n-----FINISHED CYCLE\n', cycle, '---\---\n'
            LOC.append(cycle)
        #print '-'
        return LOC
    def get_sorted_keylst(self):
        valuelst = self.adj_graph.values()
        valuelst.sort(key=lambda v: v.id)
        keylst = map(lambda v: v.key,valuelst)
        return keylst
    def is_near_zero(self,num,eps=1E-10):
        return abs(float(num)) < eps
    def __repr__(self):
        keylst = self.get_sorted_keylst()
        strgraph = ""
        for i in xrange(len(keylst)):
            key = keylst[i]
            node = self.adj_graph[key]
            strgraph += str(node.id) + ': '
            strgraph += str(map(lambda k: self.adj_graph[k].id,node.adj_lst))
            strgraph += '\n'
        return strgraph
    def __contains__(self,key):
        return self.adj_graph.has_key(key)
    
class Shape:
    """
    Parent shape operations and information
    """
    TOL = sc.doc.ModelAbsoluteTolerance

    def __init__(self,geom=None,cplane=None):
        self.geom = geom
        self.cplane = cplane
        self.north = rc.Geometry.Vector3d(0,1,0)#rs.VectorCreate([0,1,0],[0,0,0])
        self.area = None
        self.dimension = '3d'
        self.bottom_crv = None
        self.primary_axis_vector = None
        self.base_matrix = None
        self.normal = rc.Geometry.Vector3d(0,0,1)
        self.UIgeom = None
        if geom == None:
            self.geom = rs.coercebrep(rs.AddBox([[0,0,0],[0,10,0],[-10,10,0],[-10,0,0],\
                                        [0,0,10],[0,10,10],[-10,10,10],[-10,0,10]]))
        else:
            try:
                self.reset(xy_change=True)
            except Exception as e:
                print str(e), "Error at Shape.reset()"
    def reset(self,xy_change=True):
        def get_dim_bbox(b):
            ## counterclockwise, start @ bottom SW
            #      n_wt
            #      -----
            #      |   |
            # w_ht |   | e_ht = y_dist
            #      |   |
            #      -----
            #     s_wt = x_dist
            """    self.s_wt,self.e_ht,self.n_wt,self.w_ht """
            return b[:2],b[1:3],b[2:4],[b[3],b[0]]
        def helper_curve2srf(geom_):
            #check if not guid and is a curve
            curve_guid = None
            #Check and convert to curve_guid if IS CURVE
            if type(geom_) != type(rs.AddPoint(0,0,0)):
                #Check if rc curve
                #If so, convert to guid curve
                points = [rc.Geometry.Point3d(0,0,0),rc.Geometry.Point3d(0,1,0),rc.Geometry.Point3d(1,0,0)]
                curve = rc.Geometry.Curve.CreateControlPointCurve(points,1)
                if geom_.ObjectType == curve.ObjectType:
                    curve_guid = sc.doc.Objects.AddCurve(geom_)
            else:
                if rs.IsCurve(geom_):
                    curve_guid = geom_
            
            if curve_guid:
                srf_guid = rs.AddPlanarSrf(curve_guid)[0]
                rc_brep = rs.coercebrep(srf_guid)
                return rc_brep,rs.coercecurve(curve_guid)
            else:
                return rs.coercebrep(geom_),False
            
        # primary edges
        debug = sc.sticky['debug']
        if xy_change == True:
            self.geom,InputIsCurve = helper_curve2srf(self.geom)
            try:
                if InputIsCurve!=False:
                    self.bottom_crv = InputIsCurve
                else:
                    bbrefpt = self.get_boundingbox(self.geom,None)[0] 
                    self.bottom_crv = self.get_bottom(self.geom,bbrefpt,bottomref=bbrefpt[2])
            except Exception as e:
                #print str(e)##sys.exc_traceback.tb_lineno
                self.bottom_crv = None
            try:
                if self.cplane == None:
                    self.cplane = self.get_cplane_advanced(self.geom)
                self.primary_axis_vector = self.cplane.YAxis

            except Exception as e:
                print str(e)##sys.exc_traceback.tb_lineno
                self.cplane, self.primary_axis_vector = None, None
            try:
                self.bbpts = self.get_boundingbox(self.geom,self.cplane)
                self.s_wt,self.e_ht,self.n_wt,self.w_ht = get_dim_bbox(self.bbpts)
                self.ew_vector = self.n_wt[1]-self.n_wt[0]
                self.ns_vector = self.e_ht[1]-self.e_ht[0]
                """
                print 'check ew'
                print self.primary_axis_vector.IsParallelTo(self.ew_vector)
                print self.primary_axis_vector.IsPerpendicularTo(self.ew_vector)
                print ''
                """
                # x,y,z distances
                self.x_dist = float(rs.Distance(self.s_wt[0],self.s_wt[1]))
                self.y_dist = float(rs.Distance(self.e_ht[0],self.e_ht[1]))
                self.area = None
            except Exception as e:
                #print str(e)
                self.bbpts,self.s_wt,self.e_ht,self.n_wt,self.w_ht = None, None, None, None, None
            try:
                bp = self.bbpts
                self.cpt = rc.Geometry.AreaMassProperties.Compute(self.bottom_crv).Centroid
            except Exception as e:
                #print str(e)#sys.exc_traceback.tb_lineno
                self.cpt = None
        try:# curve profile info
            if xy_change == False:
                self.bbpts = self.get_boundingbox(self.geom,self.cplane)
            self.ht = float(self.bbpts[4][2])
            self.z_dist = float(float(self.bbpts[4][2]) - self.cpt[2])
        except Exception as e:
            #print str(e)#sys.exc_traceback.tb_lineno
            self.ht, self.z_dist = None, None
    def calculate_ratio_from_dist(self,axis,dist,dir_=0.):
        # Direction of cut
        # Long axis: YAxis
        # 1.0 ^
        #     |
        # 0.5 ^ w_ht = y_dist
        #     |
        # 0.0 ->->->->->->->
        #     0.0  0.5   1.0
        #  s_wt = x_dist

        ## dir: 0 = cut dist from bottom
        ## dir: 1 = cut dist from top
        ## test1: 25m/100m
        ## if dir == 0: ratio = 0.25
        ## if dir == 1: ratio = 0.75
        ## test2: 75m/100m
        ## if dir == 0: ratio = 0.75
        ## if dir == 1: ratio = 0.25
        if "NS" in axis:
            total_dist = self.x_dist
        else:# if "EW" in axis
            total_dist = self.y_dist
        # Cut from bottom
        ratio = dist/float(total_dist)
        # Cut from top
        if dir_ > 0.5:
            ratio = 1. - ratio
        return ratio
    def vector2axis(self,ref_vector):
        ## Compare ref_vector with shape axis, and return
        ## closest shape axis
        ew_axis = self.n_wt[1]-self.n_wt[0]
        ns_axis = self.e_ht[1]-self.e_ht[0]
        ## unitize
        ref_vector.Unitize()
        ew_axis.Unitize()
        ns_axis.Unitize()
        ew_dotprod = rc.Geometry.Vector3d.Multiply(ew_axis,ref_vector)
        ns_dotprod = rc.Geometry.Vector3d.Multiply(ns_axis,ref_vector)
        ## Greater the dot product, closer it is to 90
        cutaxis = "NS" if abs(ew_dotprod) < abs(ns_dotprod) else "EW"
        return cutaxis
    def vector2hash(self,vector,tol=4):
        #Tolerance set to 4
        myhash = "("
        for i in xrange(len(vector)):
            coordinate = vector[i]
            myhash += str(round(coordinate,tol))
            if i < len(vector)-1: 
                myhash += ","
        myhash += ")"
        return myhash
    def op_split(self,axis,ratio,deg=0.,split_depth=0,split_line_ref=None):
        """
        op_split: self, ratio -> (list of geom)
        Splits original geom into two
        """
        debug = sc.sticky['debug']
        def helper_make_split_surf_z(ratio_):
            try:
                zht = ratio_ * self.z_dist
                splitptlst = self.bbpts[:4]+[self.bbpts[0]]
                #splitcurve_ = rc.Geometry.Curve.CreateControlPointCurve(splitptlst[:4],1)
                #splitcurve_ = sc.doc.Objects.AddCurve(splitcurve_)
                #debug.append(splitcurve_)
                splitptlst = map(lambda b:rc.Geometry.Point3d(b[0],b[1],b[2]+zht),splitptlst)
                splitcurve = rc.Geometry.Curve.CreateControlPointCurve(splitptlst,1)
                #debug.append(splitcurve)
                split_surf_ = rc.Geometry.Brep.CreatePlanarBreps(splitcurve)[0]
                return split_surf_
            except Exception as e:
                print "Error @ shape.helper_make_split_srf_z"
                print str(e)#sys.exc_traceback.tb_lineno
        def helper_make_split_line_xy(ratio_,degree,ref_shape=None):
            debug = sc.sticky['debug']
            try:
                if ref_shape:
                    s_wt,n_wt = ref_shape.s_wt,ref_shape.n_wt
                    e_ht,w_ht = ref_shape.e_ht,ref_shape.w_ht
                    x_dist,y_dist = ref_shape.x_dist,ref_shape.y_dist
                else:
                    s_wt,n_wt = self.s_wt,self.n_wt
                    e_ht,w_ht = self.e_ht,self.w_ht
                    x_dist,y_dist = self.x_dist,self.y_dist

                if axis == "NS":
                    edge_0, edge_1 = s_wt, n_wt
                    dist = ratio_* x_dist
                else:#if axis == "EW"
                    edge_0, edge_1 = e_ht, w_ht
                    dist = ratio_* y_dist

                ### helper geom that splits box
                line_0 = rs.AddLine(edge_0[0],edge_0[1])
                line_1 = rs.AddLine(edge_1[1],edge_1[0])
                # ^flip because counterclockwise
                mid_0 = rs.DivideCurveLength(line_0,dist,True,True)[1]
                mid_1 = rs.DivideCurveLength(line_1,dist,True,True)[1]
                split_line = rs.AddCurve([mid_0,mid_1],1)
                if float(degree) > 0.5:
                    cpt = rs.DivideCurve(split_line,2,True,True)[1]
                    split_line = rs.RotateObject(split_line,cpt,degree)
                sc_ = 1.5,1.5,1.5
                line_cpt = rs.DivideCurve(split_line,2)[1]
                split_line_sc = rs.ScaleObject(split_line,line_cpt,sc_)
                #split_line_sc = rs.coercecurve(split_line_sc)
                return split_line_sc
            except Exception as e:
                pass#print "Error @ shape.helper_make_split_srf_xy"
                #print str(e)#sys.exc_traceback.tb_lineno
        def helper_make_split_surf(split_line__):
            if self.ht < 1:
                ht = 1.
            else:
                ht = self.ht
            split_path = rs.AddCurve([[0,0,0],[0,0,ht*2]],1)
            if not self.is_guid(split_line__):
                split_line__ = sc.doc.Objects.AddCurve(split_line__)
            split_surf = rs.coercebrep(rs.ExtrudeCurve(split_line__,split_path))
            return split_surf
        def helper_get_split_line_surf(ratio_,axis_,deg_,split_line_ref_):
            split_line_, split_surf_ = None,None
            if split_line_ref_ != None:
                ## Check if Closed curve
                if type(self) == type(split_line_ref_):
                    split_line_ = helper_make_split_line_xy(ratio_,deg_,ref_shape=split_line_ref_)
                else:
                    split_line_ = split_line_ref_
                    if not self.is_guid(split_line_):
                        split_line_ = sc.doc.Objects.AddCurve(split_line_)
                    sc_ = 3,3,3
                    line_cpt = rs.DivideCurve(split_line_,2)[1]
                    split_line_ = rs.ScaleObject(split_line_,line_cpt,sc_)
                #debug.append(split_line_)
                split_surf_ = helper_make_split_surf(split_line_)
            elif axis_ == "Z":
                split_surf_ = helper_make_split_surf_z(ratio_)
            else:
                split_line_ = helper_make_split_line_xy(ratio_,deg_)
                split_line_ = rs.coercecurve(split_line_)
                split_surf_ = helper_make_split_surf(split_line_)

            return split_line_, split_surf_

        rs.EnableRedraw(False)
        lst_child = []
        IsValidCut = True
        split_line,split_surf = helper_get_split_line_surf(ratio,axis,deg,split_line_ref)
        #debug.append(split_surf)
        try:#if True:
            ## For split_depth == 0.
            if split_depth <= 0.1:
                geom = rs.coercebrep(self.geom) if self.is_guid(self.geom) else self.geom
                lst_child = geom.Split(split_surf,TOL)
                #debug.append(lst_child[0])
            ## For split_depth > 0.
            else:
                if self.z_dist < 0.09:
                    print 'not a 3d geom, therefore will not split'
                # vec transformation
                if self.is_guid(split_line):
                    split_line = rs.coercecurve(split_line)
                nc = split_line.ToNurbsCurve()
                end_pts = [nc.Points[i_].Location for i_ in xrange(nc.Points.Count)]
                dir_vector = end_pts[1] - end_pts[0]
                
                z_vector = copy.copy(self.normal)
                z_vector.Reverse()
                # create forward and backwards vector using crossproduct
                normal_f = rs.VectorCrossProduct(dir_vector,z_vector)
                normal_b = rs.VectorCrossProduct(z_vector,dir_vector)

                sc_ = split_depth,split_depth,split_depth

                normal_f.Unitize()
                normal_b.Unitize()
                normal_b_copy = copy.copy(normal_b)
                normal_b = map(lambda v: v*split_depth/2.,normal_b)

                c = rs.AddCurve([rs.AddPoint(0,0,0),rs.AddPoint(normal_f[0],normal_f[1],normal_f[2])],0)
                c = rs.ScaleObject(c,rs.AddPoint(0,0,0),sc_)
                rc_cut = rs.ExtrudeSurface(split_surf,c)
                rc_cut = rs.MoveObject(rc_cut,normal_b)
                
                #Check if split and srf is coplanar
                IsCoPlanar = self.is_near_zero(split_line.PointAtStart[2] - self.cpt[2])
                if IsCoPlanar:
                    rc_cut = rs.MoveObject(rc_cut,z_vector * 0.1)
                #Check region intersection
                split_bottom_crv = self.get_bottom(rc_cut,split_line.PointAtStart)
                if split_bottom_crv and self.bottom_crv:
                    chk_region = self.check_region(split_bottom_crv,self.bottom_crv,realvalue=True,tol=0.01)
                else:
                    chk_region = 0
                """
                Disjoint    0    There is no common area between the two regions.
                Intersect   1    The two curves intersect. There is therefore no full containment relationship either way.
                AInsideB    2    Region bounded by curveA (first curve) is inside of curveB (second curve).
                BInsideA    3    Region bounded by curveB (second curve) is inside of curveA (first curve).
                """
                #if not intersect
                if self.is_near_zero(chk_region):
                    IsValidCut = False
                #if rc_geom is inside rc_cut
                if abs(chk_region - 3.0)<0.01 and IsCoPlanar:     
                    self.geom = None #no children, but also no parent
                    IsValidCut = False
                
                if IsValidCut:    
                    rc_geom,rc_cut = rs.coercebrep(self.geom),rs.coercebrep(rc_cut)
                    #ghcomp.Flip(rc_cut,sc.sticky['surface_ref'])[0]
                    geom_childs = rc.Geometry.Brep.CreateBooleanDifference(rc_geom,rc_cut,TOL)
                    if geom_childs:
                        lst_child.extend(geom_childs)
                    
                else:
                    lst_child = []
                #del rc_cut
                #del nc
                #debug.extend(geom_childs)
        except Exception as e1:
            print "Error @ shape.op_split while splitting"
            print str(e1)#, sys.traceback.tb_lineno

        ## Clean up or rearrange or cap the split child geometries
        try:
            if float(len(lst_child)) < 1. or lst_child == [None] or lst_child == []:
                lst_child = []
            else:
                if not self.is_guid(lst_child[0]):
                    lst_child_ = map(lambda child: sc.doc.Objects.AddBrep(child), lst_child)
                map(lambda child: rs.CapPlanarHoles(child),lst_child_)
                lst_child = map(lambda child: rs.coercebrep(child),lst_child_)
                if axis == "Z":
                    z_0 = rc.Geometry.AreaMassProperties.Compute(lst_child[0]).Centroid[2]
                    z_1 = rc.Geometry.AreaMassProperties.Compute(lst_child[1]).Centroid[2]
                    if z_0 > z_1:
                        tempchild = lst_child.pop(0)
                        lst_child.append(tempchild)
        except Exception as e:
            print "Error @ shape.op_split while formatting children"
            print str(e)#, sys.traceback.tb_lineno

        rs.EnableRedraw(False)
        return lst_child
    def get_boundingbox(self,geom_,cplane_):
        def check_bbpts(b):
            ## check if 3d shape and if first 4 pts at bottom
            if b[0][2] > b[4][2]:
                b_ = b[4:] + b[:4]
                b = b_
            return b
        try:
            bbpts_ = rs.BoundingBox(geom_,cplane_)
            return check_bbpts(bbpts_)
        except Exception as e:
            print "Error @ get_boundingbox"
            #print str(e)#sys.exc_traceback.tb_lineno
    def check_shape_dim(self,axis_,dim_,shape=None,min_or_max=False,tol=0.1):
        ### Checks that the shape dimension is equal to
        if shape==None:
            shape = self
        if "EW" in axis_:
            shapedim = shape.x_dist
        else:
            shapedim = shape.y_dist
        if min_or_max != False:
            ## Check if more than min
            if 'min' in min_or_max:
                IsWidth = (shapedim+tol) >= dim_
            ## Check if less than max
            else:
                IsWidth = shapedim <= (dim_+tol)
        else:
            IsWidth = abs(shapedim-dim_) <= tol
            #print shapedim, dim_
        return IsWidth
    def check_shape_validity(self,dim2chk_tuple,minarea,min_or_max_=False,tol_=None):
        ## Move this to shape class
        ## Flip cut axis to check the resulting dim
        ## EW akways checks x axis, NS always checks y axis
        if not tol_: tol_ = 1.0
        IsEWDim,IsNSDim,IsMinArea = False, False, False
        x_dim = dim2chk_tuple[0]
        y_dim = dim2chk_tuple[1]
        IsEWDim = self.check_shape_dim("EW",x_dim,min_or_max=min_or_max_,tol=tol_)
        IsNSDim = self.check_shape_dim("NS",y_dim,min_or_max=min_or_max_,tol=tol_)
        try:
            IsMinArea = math.abs(self.get_area() - minarea) <= minarea * 0.15
        except:
            IsMinArea = True
        return IsEWDim and IsNSDim# and IsMinArea
    def is_guid(self,geom):
        return type(rs.AddPoint(0,0,0)) == type(geom)
    def convert_rc(self,dim=None):
        # phase this function out
        try:
            if dim==None: dim = self.dimension
            if dim == "2d":
                if self.is_guid(self.crv):
                    self.crv = rs.coercecurve(self.crv)
                if self.is_guid(self.ext):
                    self.ext = rs.coercebrep(self.ext)
            else:
                if self.is_guid(self.bottom_crv):
                    self.bottom_crv = rs.coercecurve(self.bottom_crv)
            if self.is_guid(self.geom):
                self.geom = rs.coercegeometry(self.geom)
        except Exception as e:
            print "Error @ shape.convert_rc"
            print str(e)#sys.exc_traceback.tb_lineno
    def convert_guid(self,dim='2d'):
        # phase this out
        try:
            if dim == "2d":
                if not self.is_guid(self.crv):
                    self.crv = sc.doc.Objects.AddCurve(self.crv)
                if not self.is_guid(self.ext):
                    self.ext = sc.doc.Objects.AddBrep(self.ext)
            else:
                if self.bottom_crv and not self.is_guid(self.bottom_crv):
                    self.bottom_crv = sc.doc.Objects.AddCurve(self.bottom_crv)
            if not self.is_guid(self.geom):
                self.geom = sc.doc.Objects.AddBrep(self.geom)
        except Exception as e:
            print "Error @ shape.convert_guid"
            print str(e)#sys.exc_traceback.tb_lineno
    def get_bottom(self,g,refpt,tol=1.0,bottomref=0.0):
        ## Extract curves from brep according to input cpt lvl
        debug = sc.sticky['debug']
        IsAtGroundPlane = False
        if abs(refpt[2]-bottomref) < 0.1:
            #print 'ground ref at:', refpt[2]
            refpt.Z += 1.0
            IsAtGroundPlane = True
        if g == None: g = self.geom
            #debug.append(g)
        try:
            if g == None: g = self.geom
            #print g
            if self.is_guid(refpt): refpt = rs.coerce3dpoint(refpt)
            if self.is_guid(g): g = rs.coercebrep(g)
            plane = rc.Geometry.Plane(refpt,rc.Geometry.Vector3d(0,0,1))
            
            crv = g.CreateContourCurves(g,plane)[0]
            if IsAtGroundPlane==True:
                crv = sc.doc.Objects.AddCurve(crv)
                move_crv = self.move_geom(crv,rc.Geometry.Vector3d(0,0,-1.))
                crv = rs.coercecurve(move_crv)
            return crv
        except Exception as e:
            #print 'chk', refpt.Z
            #debug.append(refpt)
            print "Error @ shape.get_bottom"
            print str(e)#sys.exc_traceback.tb_lineno
    def move_geom(self,guidobj,dir_vector,copy=False):
        #Moves a geometry
        #Note, you MUST convert to guid and convert back to rc geom    
        xf = rc.Geometry.Transform.Translation(dir_vector)
        xform = rs.coercexform(xf, True)
        guidid = rs.coerceguid(guidobj, False)
        guidid = sc.doc.Objects.Transform(guidid, xform, not copy)
        return guidid
    def is_near_zero(self,num,eps=1E-10):
        return abs(float(num)) < eps
    def check_region(self,crvA,crvB=None,realvalue=False,tol=0.1):
            """
            If disjoint, output 0 else returns 1.
            Disjoint    0    There is no common area between the two regions.
            Intersect   1    The two curves intersect. There is therefore no full containment relationship either way.
            AInsideB    2    Region bounded by curveA (first curve) is inside of curveB (second curve).
            BInsideA    3    Region bounded by curveB (second curve) is inside of curveA (first curve).
            """
            disjoint = rc.Geometry.RegionContainment.Disjoint
            intersect = rc.Geometry.RegionContainment.MutualIntersection
            AInsideB = rc.Geometry.RegionContainment.AInsideB
            BInsideA = rc.Geometry.RegionContainment.BInsideA
            #add the rest
            if crvB == None:
                crvB = self.bottom_crv
            if self.is_guid(crvB):
                crvB = rs.coercecurve(crvB)
            if self.is_guid(crvA):
                crvA = rs.coercecurve(crvA)
            refplane = self.cplane
            try:
                setrel = rc.Geometry.Curve.PlanarClosedCurveRelationship(crvA,crvB,refplane,tol)
            except Exception as e:
                print "Error @ shape.check_region"
                print str(e)#, sys.traceback.tb_lineno
                return 0
            if realvalue==True:
                if disjoint==setrel: return 0
                elif intersect==setrel:return 1
                elif AInsideB==setrel:return 2
                else: return 3
            else:
                if disjoint == setrel:
                    return 0
                elif intersect == setrel:
                    return 2
                else:
                    return 1
    def get_normal_point_inwards(self,refline_,to_outside=False):
        ## Input a reference line or points and self.shape.polygon
        ## Returns the normal vector pointing
        ## into the polygon
        z_vector = self.normal#rs.VectorCreate([0,0,0],[0,0,1])
        ## Make sure the line is CCW, else reverse order
        IsCCW = self.check_vertex_order(refline=refline_)
        #Check to see if reffline is not a list of two points already
        if type(refline_) != type([]):
            end_pts = self.get_endpt4line(refline_)
        else:
            end_pts = refline_
        if not IsCCW:
            end_pts = [end_pts[1],end_pts[0]]
        #To check the CCW dir
        #debug.append(n_.data.shape.get_endpt4line(park_line_)[0])

        # Get direction vector and take cross-product
        dir_vector = end_pts[1] - end_pts[0]
        # Create to_inner vector using crossproduct
        # CCW dir_vector X z_vector = to_inner vector
        to_inner = rs.VectorCrossProduct(z_vector,dir_vector)
        if to_outside == True:
            to_inner.Reverse()
        to_inner.Unitize()
        return to_inner
    def extrude_pt_perpendicular_to_pt(self,basept_,reflineptlst):
        #Input: basept, list of line pts
        #Output: pt that is 90 degrees from that pt
        normvector = self.get_normal_point_inwards(reflineptlst)
        perppt = basept_ + normvector
        return perppt
    def check_vertex_order(self,refline=None):
        ### Check if the shape is counter-clockwise
        ### This is achieved by walking the polygon,
        ### and then summing the crossproduct
        ### of each adjacent vectors. If the resulting crossproduct sum
        ### is positive, then according to the RHR it is CCW else it
        ### is negative. If refline provided, we make a triangle
        ### with refline and cpt
        ### Ref: http://stackoverflow.com/posts/1167206/revisions
        if refline!=None:
            endpts_lst = []
            if type(refline) != type([]):
                linepts = self.get_endpt4line(refline)
            else:
                linepts = refline
            # Make triangle
            endpts_lst.append([self.cpt,linepts[0]])
            endpts_lst.append(linepts)
            endpts_lst.append([linepts[1],self.cpt])
        else:
            #need to test this!
            print 'First time testing the vertex order for polygon'
            print 'double check this at def check_vertex_order'
            endpts_lst = self.set_base_matrix()

        ## Loop through and take the crossproduct of edge
        i = 0
        sum_of_cross_product = 0.
        while i < (len(endpts_lst)-1):
            curr_edgepts = endpts_lst[i]
            next_edgepts = endpts_lst[i+1]
            #Cast to vector3d om case it is point3d
            curr_edgepts = map(lambda p: rc.Geometry.Vector3d(p),curr_edgepts)
            next_edgepts = map(lambda p: rc.Geometry.Vector3d(p),next_edgepts)

            curr_edgevector = curr_edgepts[1]-curr_edgepts[0]
            next_edgevector = next_edgepts[1]-curr_edgepts[0]
            cp = rs.VectorCrossProduct(curr_edgevector,next_edgevector)
            sum_of_cross_product += cp[2]
            i+=1

        #if positive, then according to RHR, vertices are CCW
        if sum_of_cross_product > 0.:
            return True
        else:
            return False
    def rotate_vector_from_axis(self,angle_,lineveclst,movehead=True,to_inside=False):
        def helper_rotate_vector(vector,deg,axis=[0,0,1]):
            axis = rs.coerce3dvector(axis)
            angle_radians = rc.RhinoMath.ToRadians(deg)
            rotvec = rc.Geometry.Vector3d(vector.X, vector.Y, vector.Z)
            rotvec.Rotate(angle_radians, axis)
            return rotvec
        #Rotates the lst of vectors (of line) around axis pt
        #if we are moving the tail, you ahve to flip the vector so rotate vector works
        if movehead==True:
            dir_vec = lineveclst[1]-lineveclst[0]
            refvec4axis = lineveclst[0]
        else:
            dir_vec = lineveclst[0]-lineveclst[1]
            refvec4axis = lineveclst[1]
        #Vectors in rhino want to move inwards (counterwclockwise)
        #However if you are moving the tail then dsire to flip out so reverse vector
        if movehead==False:
            angle_ = angle_ * -1.0
        if to_inside == False:
            angle_ = angle_ * -1.0
        #print rotatehead
        rot_vector = helper_rotate_vector(dir_vec,angle_,axis=[0,0,1])
        rot_vector.Unitize()
        magnitude = dir_vec.Length
        rot_vector = rot_vector * magnitude
        rotated_linept = rot_vector + refvec4axis

        if movehead==True:
            linept_ = [refvec4axis,rotated_linept]
        else:
            linept_ = [rotated_linept,refvec4axis]
        return linept_
    def get_pt_of_intersection(self,line2intersect):
        #Input: list of list of pts for TWO lines
        #Output: pt of intersection and bool of if intersection exist
        linelst4int = map(lambda lpt: rc.Geometry.Curve.CreateControlPointCurve(lpt,0),line2intersect)
        linelst4int = map(lambda crv: rs.coerceline(crv),linelst4int)
        lineA,lineB = linelst4int[0], linelst4int[1]
        IsIntersect,a,b = rc.Geometry.Intersect.Intersection.LineLine(lineA,lineB)
        if IsIntersect:
            a = lineA.PointAt(a)
        return IsIntersect,a
    def get_endpt4line(self,line_):
        if self.is_guid(line_):
            line_ = rs.coercecurve(line_)
        nc = line_.ToNurbsCurve()
        end_pts = [nc.Points[i_].Location for i_ in xrange(nc.Points.Count)]
        return end_pts
    def set_base_matrix(self,crv=None):
        ## Breaks up geometry into:
        ##[ [[vector1a,vector1b],  // line 1
        ##   [vector2a,vector2b],  // line 2
        ##          ....
        ##   [vectorna, vectornb]] // line n
        ## topological ordering preserved
        ## direction counterclockwise
        ## but can start from anywhere!
        #debug = sc.sticky['debug']

        if self.base_matrix == None:
            if crv == None:
                crv = self.bottom_crv
            if not self.is_guid(crv):
                crv = rs.coercecurve(crv)
            segments = crv.DuplicateSegments()
            matrix = []
            for i in xrange(len(segments)):
                segment = segments[i]
                nc = segment.ToNurbsCurve()
                end_pts = [nc.Points[i_].Location for i_ in xrange(nc.Points.Count)]
                matrix.append(end_pts)
            self.base_matrix = matrix
        return self.base_matrix
    def get_midpoint(self,line):
        #Midpoint formula: x1+x2/2, y1+y2/2
        pt1,pt2 = line[0], line[1]
        midpt = (line[0]+line[1])/2. #vector addition and division
        return midpt
    def get_shape_axis(self,crv=None):
        def helper_group_parallel(AL):
            ## Identifies parallel lines and groups them
            lop = []
            CULLDICT = {}
            for i,v in enumerate(AL):
                refdist = rs.Distance(v[0],v[1])
                refdir = v[1] - v[0]
                power_lst = []
                if i < len(AL)-1 and not CULLDICT.has_key(refdist):
                    power_lst.append(refdist)
                    AL_ = AL[i+1:]
                    for v_ in AL_:
                        currdist = rs.Distance(v_[0],v_[1])
                        currdir = v_[1] - v_[0]
                        if currdir.IsParallelTo(refdir) != 0 and not CULLDICT.has_key(currdist):
                            power_lst.append(currdist)
                            CULLDICT[currdist] = True
                if power_lst != []:
                    power_lst.sort(reverse=True)
                    power_num = reduce(lambda x,y: x+y,power_lst)
                else:
                    power_num = 0.
                lop.append(power_num)
            return lop

        ### Purpose: Input 2d planar curve
        ### and return list of vector axis based
        ### on prominence
        debug = sc.sticky['debug']
        try:
            if crv==None:
                crv = self.bottom_crv
            axis_matrix = self.set_base_matrix(crv)
            if axis_matrix != []:
                axis_power_lst = helper_group_parallel(axis_matrix)
                pa_index = axis_power_lst.index(max(axis_power_lst))
                pa_vector = axis_matrix[pa_index][1]-axis_matrix[pa_index][0]
            else:
                #degenerate crv
                pa_vector = None
            self.primary_axis_vector = pa_vector
            return self.primary_axis_vector
        except Exception as e:
            print "Error @ shape.get_shape_axis"
            print str(e)#sys.exc_traceback.tb_lineno
    def get_cplane_advanced(self,g):
        def helper_define_axis_pts(primary_vec):
            ##(origin,x,y)
            o_pt_ = rc.Geometry.Point3d(0,0,0)
            y_pt_ = primary_vec
            z_pt_ = rc.Geometry.Vector3d(0,0,1)
            ## construct x_pt_ using the communitive property of crossproduct
            x_pt_ = rc.Geometry.Vector3d.CrossProduct(y_pt_,z_pt_)
            return o_pt_,x_pt_,y_pt_
        try:
            if self.is_guid(g):
                brep = rs.coercebrep(g)
            else: brep = g
            debug = sc.sticky['debug']
            ## Get primary axis
            nc = self.bottom_crv.ToNurbsCurve()
            planar_pts = [nc.Points[i].Location for i in xrange(nc.Points.Count)]
            primary_axis_vector = self.get_shape_axis(self.bottom_crv)
            if primary_axis_vector:
                o_pt,x_pt,y_pt = helper_define_axis_pts(primary_axis_vector)
            else:
                #degenerate shape
                o_pt = rc.Geometry.Point3d(0,0,0)
                x_pt = rc.Geometry.Point3d(1,0,0)
                y_pt = rc.Geometry.Point3d(0,1,0)
            cplane = rc.Geometry.Plane(o_pt,x_pt,y_pt)
            return cplane
        except Exception as e:
            print "Error @ shape.get_cplane_advanced"
            print str(e)#sys.exc_traceback.tb_lineno
    def check_colinear_pt(self,crv,testpt,tol=0.01):
        ## May need to swap with own method
        dist = ghcomp.CurveClosestPoint(testpt,crv)[2]
        IsColinear = True if abs(dist-0.)<tol else False
        return IsColinear
    def planar_intersect_ray_with_line(self,base_vector,direction_vector,linept1,linept2,refz=0.0):
        #Input: ray (basevector and dirvector), line (two pts)
        #Output: intersection point or else False
        #Will only take place in 2d at defined z ht
        #This function took me half a day to understand!

        r0 = base_vector
        r1 = direction_vector
        a = linept1
        b = linept2

        #For ray: r0,r1; and line: a,b
        #parametric form of ray: r0 + t_1*r1 = pt
        #parametric form of line: a + t_2*b = pt

        #ray: r0 + t * d
        #r0: base point
        #d: direction vector
        #t = scalar parameter t, where 0 <= t < infinity
        #if line segment, then 0 <= t <= 1 is the parametric form of a line.

        #Solve for r0 + t_1*r1 = a + t_2*b; two unknowns t_1, t_2
        #This can result in a lot of algebra, but essentially can
        #simplify to the vector operations below
        #Ref: http://stackoverflow.com/questions/14307158/how-do-you-check-for-intersection-between-a-line-segment-and-a-line-ray-emanatin

        ## This needs to have push/pop/transformation matrix
        ## so that it can work outside of z-axis
        def helper_flatten_z(lst,z):
            return rc.Geometry.Vector3d(lst[0],lst[1],z)

        #debug = sc.sticky['debug']
        z = 0.0 #flatten then unflatten
        a = helper_flatten_z(a,z)
        b = helper_flatten_z(b,z)

        #Correct the ordering of the line segment
        IsCCW = self.check_vertex_order(refline=[a,b])
        if not IsCCW:
            a,b = b,a

        r0 = helper_flatten_z(r0,z)
        r1 = helper_flatten_z(r1,z)
        ray_dir = r0+(r1*5) - r0#(r0+r1) - r0
        #debug.append(rs.AddCurve([r0,ray_dir+r0]))
        #debug.append(b)

        ortho = rc.Geometry.Vector3d(ray_dir.Y*-1.,ray_dir.X,z)
        aToO = r0 - a
        aToB = b - a
        point_intersect = False
        denominator = aToB * ortho
        #Check if zero: Then cos(90) = 0, or ray normal and segment
        #perpendicular therefore no intersection

        if not self.is_near_zero(denominator):
            cross_prod = rc.Geometry.Vector3d.CrossProduct(aToB,aToO)
            dot_prod = ortho * aToO
            t_1 = cross_prod.Length / denominator
            t_2 = dot_prod / denominator

            #t_1 = abs(t_1)
            #t_2 = abs(t_2)
            if (t_2 >= 0. and t_2 <= 1.) and t_1 >= 0.: #t_1 can go to infinity
                #print 't1', t_1
                #print 't2', t_2
                #print '--'
                #debug.append(rs.AddCurve([r0,ray_dir+r0]))
                #Collision detected
                ix,iy = r0.X + (t_1 * ray_dir.X), r0.Y + (t_1 * ray_dir.Y)
                #print t_1
                point_intersect = rc.Geometry.Vector3d(ix,iy,refz)
        #if point_intersect:
            #debug.append(point_intersect)
            #debug.append(rs.AddCurve([r0,point_intersect]))
        return point_intersect
    def intersect_ray_with_line(self,base_vector,direction_vector,linept1,linept2,refz=None):
        #Input: ray (basevector and dirvector), line (two pts)
        #Output: intersection point or else False
        #Same as above but with rhinocommon library

        vertical_tolerance = -5.0
        r0 = base_vector
        r1 = direction_vector
        a = linept1
        b = linept2
        a.Z = a.Z + vertical_tolerance
        b.Z = b.Z + vertical_tolerance
        if refz==None: refz = self.ht
        refz -= vertical_tolerance
        debug = sc.sticky['debug']

        #extrude as surface to check int
        upnormal = self.normal * refz
        upnormalcrv = rc.Geometry.Curve.CreateControlPointCurve([self.cpt,self.cpt + upnormal])
        reflinepath = rc.Geometry.Curve.CreateControlPointCurve([a,b])
        srf2int = rc.Geometry.SumSurface.Create(reflinepath,upnormalcrv)
        ray = rc.Geometry.Ray3d(r0,r1)
        point_intersect_lst = rc.Geometry.Intersect.Intersection.RayShoot(ray,[srf2int],1)
        if point_intersect_lst:
            point_intersect_lst = list(point_intersect_lst)
            #debug.extend(point_intersect_lst)
            #debug.append(self.cpt)
        return point_intersect_lst
    def extend_ray_to_line(self,chk_ray,lineref):
        #ray: (ray_origin (pt), ray_dir (vector)
        #line: control point curve
        #Output: line that is intersected
        chk_line = rc.Geometry.Curve.CreateControlPointCurve([chk_ray[0],chk_ray[0]+chk_ray[1]*2.],0)
        chk_line.SetStartPoint(chk_ray[0])
        #Checking t parameter: 0.0 = ray_origin, 1.0 = ray_endpt
        #b,t = chk_line.ClosestPoint(chk_ray[0],0.001)
        #print t < chk_line.Domain.Mid
        chk_line_end = rc.Geometry.CurveEnd.End
        int_line = chk_line.ExtendByLine(chk_line_end,[lineref])
        return int_line
    def get_parallel_segments(self,lst_edge_,dir_ref_,angle_tol_):
        #Inputs lst of edges, a dir_ref
        #Outputs lst of edges that are parallel w/i tol
        parallel_edges_ = []
        #debug = sc.sticky['debug']
        for i in xrange(len(lst_edge_)):
            edge_pts = lst_edge_[i]
            dir_vec = edge_pts[1]-edge_pts[0]
            #Check for pi/0 (180,0 degrees)
            IsParallel = dir_ref_.IsParallelTo(dir_vec,angle_tol_)
            if not self.is_near_zero(IsParallel):#set this as tolerance in setback
                #yield edge_pts
                parallel_edges_.append(edge_pts)
        return parallel_edges_
    def identify_front_or_back_to_ref_edge(self,ref_edge,edges_to_check,dis_tol,front=True,ht_ref=0.0):
        #Casts a ray from front/back edges2check and sees if intersect with ref_edge
        #If identifies one front edge, then will break loop send back edge
        #Used as a way to see if the edge is back or front from a reference edge
        #ht_ref is problematic. Must get rid of with implementation of push/pop matrix for ray interesction
        debug = sc.sticky['debug']
        front_edges = []
        int_pt = None
        for i in xrange(len(edges_to_check)):
            edge = edges_to_check[i]
            edge = map(lambda pt: rc.Geometry.Point3d(pt[0],pt[1],ht_ref),edge)

            m = self.get_midpoint(edge)
            #Change this for rear stepback
            normal2steprefline = self.get_normal_point_inwards(edge,to_outside=front)
            ray_m,ray_norm = m, normal2steprefline
            line = self.get_endpt4line(ref_edge)
            int_pt = self.intersect_ray_with_line(ray_m,ray_norm,line[0],line[1],ht_ref)
            #debug.append(m)
            #debug.append(m + normal2steprefline*10)
            #debug.append(rs.AddCurve([m,m+normal2steprefline*10],3))
            #debug.append(ref_edge)
            if int_pt:
                int_pt = int_pt[0]
                ray2geom = rc.Geometry.Ray3d(int_pt,normal2steprefline*-1)
                #debug.append(int_pt)
                #debug.append(rs.AddCurve([int_pt,int_pt+normal2steprefline*-5],3))
                pt4front = rc.Geometry.Intersect.Intersection.RayShoot(ray2geom,[self.geom],1)
                if pt4front:    
                    ChkDistTol = dis_tol >= rs.Distance(pt4front[0],int_pt)
                    if ChkDistTol:
                        front_edges.append(edge)
                        #m_ht = rs.AddPoint(m[0],m[1],ht_ref)
                        #dist2front = rs.Distance(pt4front[0],m_ht)
                        #if front==True: and self.is_near_zero(dist2front):
                        #    front_edges.append(edge)
                        #elif front==False: and not self.is_near_zero(dist2front):
                        #    front_edges.append(edge)
        return front_edges
    def match_edges_with_refs(self,lst_edge,lst_refedge,norm_ht=0.0,dist_tol=1.0,angle_tol=15.0,to_front=True):
        #Purpose: Identifying edges from list of edges and ref edge by angle
        #Input: list of edges (list of pts) and list of ref_edge crvs, tolerance
        #Output: list of edges that match angle to ref_edge, given by distance
        #debug = sc.sticky['debug']
        parallel_and_front_edges = []
        angle_tol = math.radians(angle_tol)
        #Get paralllel edges
        #Get front or back edges
        for i in xrange(len(lst_refedge)):
            sbrefedge = lst_refedge[i]
            sbrefpt = self.get_endpt4line(sbrefedge)
            dir_ref = sbrefpt[1] - sbrefpt[0]
            parallel_edges = self.get_parallel_segments(lst_edge,dir_ref,angle_tol)
            #print 'pe', len(parallel_edges)
            parallel_and_front_edges += self.identify_front_or_back_to_ref_edge(sbrefedge,parallel_edges,dist_tol,front=to_front,ht_ref=norm_ht)
            #print 'p&f', len(parallel_and_front_edges)
            #print norm_ht
            #print '---'
        return parallel_and_front_edges
    def offset_perpendicular_from_line(self,ref_line,dist2offset):
        #debug = sc.sticky['debug']
        L = []
        reflineendpts = self.get_endpt4line(ref_line)
        for i in xrange(len(reflineendpts)):
            basept_ = reflineendpts[i]
            normvector = self.get_normal_point_inwards(reflineendpts)
            perppt1 = basept_ + normvector * dist2offset
            perppt2 = basept_ + normvector * -1.0 * dist2offset
            if i%2==0:
                L.append(perppt1)
                L.append(perppt2)
            else:
                L.append(perppt2)
                L.append(perppt1)
        L += [L[0]]
        return L
    def get_inner_angle(self,v_prev,v_next,anglerad):
        #Input: v2,v1 as direction vectors facing away from ref pt, and angle to check
        # True if cross is positive
        # False if negative or zero
        #Ref: http://stackoverflow.com/questions/20252845/best-algorithm-for-detecting-interior-and-exterior-angles-of-an-arbitrary-shape
        IsPositive = v_next[0] * v_prev[1] > v_prev[0] * v_next[1]
        if not IsPositive:
            anglerad = 2.*math.pi - anglerad
        return anglerad
    def convert_shape_to_circular_double_linked_list(self):
        
        LAV = DoubleLinkedList()
        #Add all vertices and incident edges from polygon
        for i in xrange(len(self.base_matrix)):
            v = self.base_matrix[i][0]
            i -= 1
            #swap this for inner angle???
            edge_prev = self.base_matrix[i]
            edge_next = self.base_matrix[i+1]
            vrt = Vertex(v,edge_prev,edge_next)
            LAV.append(vrt)
        
        ##Test
        #dll = DoubleLinkedList()
        #dll.append(1)
        #dll.append(2)
        #dll.append(3)
        #dll.insert(dll[1],DLLNode(1.5))
        #print dll
        
        #Test initialization
        #print 'head', dll.head
        #print 'tail', dll.tail
        #print '== 2', dll.head.next
        #print '== 2', dll.tail.prev
        #print '== 3', dll.head.prev
        #print '== 1', dll.tail.next 
        #print '== 3', dll.head.next.next
        return LAV
    def compute_interior_bisector_vector(self,LAV,angle_index=False):
        #Computes interior bisector ray for all vertices in LAV
        #If single_angle_index == index, will only check that vertice
        debug = sc.sticky['debug']
        for i in xrange(LAV.size):
            curr_node = LAV[i]
            if type(angle_index)==type(1) and not self.is_near_zero(i-angle_index):
                continue
            
            #print 'index:', i
            edge_prev = curr_node.data.edge_prev
            edge_next = curr_node.data.edge_next
            # Get two vectors pointing AWAY from the curr_vertex 
            # i.e <--- v --->
            dir_prev = edge_prev[0]-edge_prev[1]
            dir_next = edge_next[1]-edge_next[0]
            dir_prev.Unitize()
            dir_next.Unitize()
            
            # Get angle / Make this own function?
            dotprod = rc.Geometry.Vector3d.Multiply(dir_next,dir_prev)
            cos_angle = dotprod/(dir_next.Length * dir_prev.Length)
            dotrad = math.acos(cos_angle)
            
            inrad = self.get_inner_angle(dir_prev,dir_next,dotrad)
            
            if inrad > math.pi:
                curr_node.data.is_reflex = True
                #debug.append(curr_node.data.vertex)
                
            #Flip the cross prod if dotprod gave outer angle
            if self.is_near_zero(abs(inrad - dotrad)):
                crossprod = rc.Geometry.Vector3d.CrossProduct(dir_prev,dir_next)
            else:
                crossprod = rc.Geometry.Vector3d.CrossProduct(dir_next,dir_prev)
            
            #Rotate next point CCW by inner_rad
            dir_next.Rotate(-inrad/2.,crossprod)
            
            #Create bisector ray
            ray_origin = curr_node.data.vertex
            ray_dir = dir_next
            #Create ray tuple
            curr_node.data.bisector_ray = (ray_origin,ray_dir)
            
            
        return LAV
    def compute_edge_events_of_polygon(self,LAV,PQ,angle_index=False,cchk=None):
        def distline2pt(v,w,p):
            ##This algorithm returns the minimum distance between 
            ##line segment vw and point p
            ##Modified from http://stackoverflow.com/questions/849211/shortest-distance-between-a-point-and-a-line-segment
            ##This is the explaination from stackoverflow for ref:
            ##Consider the line extending the segment, parameterized as v + t (w - v).
            ##We find projection of point p onto the line. 
            ##It falls where t = [(p-v) . (w-v)] / |w-v|^2
            ##We clamp t from [0,1] to handle points outside the segment vw.
            
            ##Convert to rc geometry
            v = rc.Geometry.Vector3d(v)
            w = rc.Geometry.Vector3d(w)
            p = rc.Geometry.Vector3d(p)
            
            ##Create dir vectors for line and point
            wv = w-v
            pv = p-v
            
            ##Calculate |w-v|^2 w/o costly sqrt
            lsq = wv.SquareLength     
            # Check for zero line segment case: v == w
            if self.is_near_zero(lsq):
                return pv.Length
            
            ##ProjectionPVonWV = (w-v)/|w-v| * (w-v)/|w-v| * (p-v)
            ##simplfiied = projpv = (w-v) * ((p-v) * (w-v))/|w-v|^2
            ##Then: projpv - p == perpendicular line
            
            ##clamp_to_line: ((p-v) * (w-v))/|w-v|^2
            ##(w-v): wv
            ##projpv = clamp_to_line * wv 
            clamp_to_line = (pv * wv)/lsq
            
            ##This is to handle points outside line segment. They will have
            ##obtuse angle so costheta < 0. in that case will clamp_to_line factor == 0.
            ##therefore if obtuse, clamp_to_line turns projpv into a zero vector and
            ##and will return (non perpendicular) distance from point v to p.
            clamp_to_line = max(0., min(1.,clamp_to_line))
            projpv = clamp_to_line * wv
            
            ##Instead of simply subtracting projpv-p, we first add it to v
            ##and then subtract it from p
            ##This is so that if p is outside of line segment, then projpv = 0 vector, so
            ##v - p will be our minimum distance.
            perpvector = (v + projpv) - p
            
            ##Return values
            perpgeom = rs.AddLine(projpv,p)
            perpline = rs.AddLine(v,w)
            perppt = rc.Geometry.Point3d(p)
            return perpvector.Length, (perpgeom,perpline,perppt)
        
        debug = sc.sticky['debug']
        #Create Priotity Queue from Python module
        #Ref: https://docs.python.org/2.7/library/heapq.html#priority-queue-implementation-notes
        
        #hypothenuse = sqrt(a^2 + b^2) = c; to get longest line
        side1 = self.get_long_short_axis()[1]
        side2 = self.get_long_short_axis()[3]
        linedim = math.sqrt(side1*side1 + side2*side2)
        
        debug_minev = None
        
        for i in xrange(LAV.size):
            curr_node = LAV[i]
            if type(angle_index)==type(1) and not self.is_near_zero(i-angle_index):
                continue
            
            curr_ray = curr_node.data.bisector_ray
            prev_ray = curr_node.prev.data.bisector_ray
            next_ray = curr_node.next.data.bisector_ray
            
            #Get intersection
            p_start = curr_ray[0] + (curr_ray[1]*-1) * linedim
            p_end = curr_ray[0]+curr_ray[1]*linedim
            curr_line = rc.Geometry.Curve.CreateControlPointCurve([p_start,p_end],0)
            
            #!!!should check for parallel edge case
            int_prev = self.extend_ray_to_line(prev_ray,curr_line)
            int_next = self.extend_ray_to_line(next_ray,curr_line)
            
            #Get prev/next edges for distance check
            #DO NOT USE THE POINTERS TO PREV/NEXT NODES
            
            pn1,pn2 = curr_node.data.edge_prev[0],curr_node.data.edge_prev[1]
            nn1,nn2 = curr_node.data.edge_next[0],curr_node.data.edge_next[1]
            
            ##--- Debug ---##
            if cchk==-1:#cchk==None and i==3: 
                pdt,g1 = distline2pt(pn1,pn2,int_prev.PointAtEnd)
                ndt,g2 = distline2pt(nn1,nn2,int_next.PointAtEnd)
                
                debug.append(curr_line)
                debug.append(curr_node.prev.data.vertex)
                debug.append(curr_node.data.vertex)
                #debug.append(curr_ray[0]+curr_ray[1]*5)
                debug.append(curr_node.next.data.vertex)
                #debug.append(g1[0])#proj
                debug.append(g1[1])#line
                debug.append(g1[2])#pt
                #debug.append(g2[0])#proj
                debug.append(g2[1])#line
                debug.append(g2[2])#pt
            ##--- Debug ---##
                
            event_tuple = [] 
            ##ref: __init__(self,int_vertex,int_arc,node_A,node_B,length2edge):        
            if int_prev != None:
                #Calculate distance to edge 
                prevdist,g = distline2pt(pn1,pn2,int_prev.PointAtEnd)
                prev_edge_event = EdgeEvent(int_prev.PointAtEnd,int_prev,curr_node.prev,curr_node,prevdist,curr_node)#int_prev.GetLength(),curr_node)
                event_tuple.append(prev_edge_event)
            if int_next != None:
                #Calculate distance to edge 
                nextdist,g = distline2pt(nn1,nn2,int_next.PointAtEnd)
                next_edge_event = EdgeEvent(int_next.PointAtEnd,int_next,curr_node,curr_node.next,nextdist,curr_node)#int_next.GetLength(),curr_node)
                event_tuple.append(next_edge_event)
            if event_tuple:
                min_event = min(event_tuple, key=lambda e: e.length2edge)
                heapq.heappush(PQ,(min_event.length2edge,min_event))
                if angle_index:
                    debug_minev = min_event
        return PQ, debug_minev     
    def shape_to_adj_graph(self):
        #Purpose: converts bottom of polygon into a adjacency list
        #Input: self base_matrix 
        #Output: adjacency list polygon shape as directed cycles
        
        #Add all vertices from polygon
        ##base_matrix: listof (list of edge vertices)
        #Label of vertice is index (may have to change this to coordinates)
        #Instantiate with empty adjancencies
        debug = sc.sticky["debug"]
        adjgraph = AdjGraph()
        for i in xrange(len(self.base_matrix)-1):
            prev_v = self.base_matrix[i-1][0]
            prev_key = adjgraph.vector2hash(prev_v)
            prev_node = adjgraph[prev_key]
                
            #If beggining need to add previous node
            if prev_node == None:
                prev_node = adjgraph.add_node(prev_key,prev_v,is_out_edge=True)
                first_key = prev_node.key
            curr_v = self.base_matrix[i][0]
            #add_node(key,value)
            curr_key = adjgraph.vector2hash(curr_v)
            curr_node = adjgraph.add_node(curr_key,curr_v,is_out_edge=True)
            adjgraph.add_directed_edge(prev_key,curr_key)
        #Make sure to connect last edge back to first edge
        adjgraph.add_directed_edge(curr_key,first_key)        
        return adjgraph
    def update_shape_adj_graph(self,adj_graph_,exist_vertex,new_vertex,twoside=True):
        # Update our adjacency list
        #Get the key by hashing vertex
        exist_key = adj_graph_.vector2hash(exist_vertex)
        new_key = adj_graph_.vector2hash(new_vertex)
        #Get the node with the key
        exist_node = adj_graph_[exist_key]
        
        if new_key in adj_graph_:
            new_node = adj_graph_[new_key]
        else:
            new_node = adj_graph_.add_node(new_key,new_vertex)
            print 'newnode', new_node
        
        #Add new node to graph
        adj_graph_.add_directed_edge(exist_key,new_key)
        if twoside == True:
            adj_graph_.add_directed_edge(new_key,exist_key)
        return adj_graph_  
    def compute_straight_skeleton(self,tnode,perimeter_depth,stepnum):
        debug = sc.sticky["debug"]
        #Move this into its own repo/class
        #call bibil for shape libraries
        #thats how we can transition to HB
            
        ##Initialization of ABN
        #Organize given vertices into LAV in SLAV
        #LAV: doubly linked list (DLL).
        #Initialize List of Active Vertices as Double Linked List
        LAV = self.convert_shape_to_circular_double_linked_list()
        adj_graph = self.shape_to_adj_graph()
        #Compute the vertex angle bisector (ray) bi
        LAV = self.compute_interior_bisector_vector(LAV)
        #Compute bisector intersections and maintain Priority Queue of Edge Events
        #An edge event is when a edge shrinks to point in Straight Skeleton
        PQ,minev = self.compute_edge_events_of_polygon(LAV,[])
        #print 'initialization complete'
        #print ''
        
        copyLAV = copy.deepcopy(LAV)
        
        #Main skeleton algorithm
        ##--- Debug ---##
        print 'length: ', len(PQ), ' vertices'
        count=0
        create_geom = True
        debug_crv = -1#stepnum
        
        ##--- Debug ---##
        
        while len(PQ) > 0:#count<=2:#
            #print 'count: ', count
            #edge_event: int_vertex,int_arc,node_A,node_B,length2edge
            edge_event = heapq.heappop(PQ)[1]
            
            ##--- Debug ---##
            if count==debug_crv:
                curr_node = LAV.head
                LLL=[]
                for i in xrange(LAV.size):
                    LLL.append(curr_node.data.vertex)
                    curr_node = curr_node.next
                LLL += [LLL[0]]
                crv__ = rc.Geometry.Curve.CreateControlPointCurve(LLL,1)
                #debug.append(crv__)
                debug.extend(LLL)
                #print '---'
            ##--- Debug ---##
            
            #if create_geom and debug_crv >= 0 and debug_crv == count:
            #    debug.append(edge_event.node_A.prev.data.vertex)
            #    debug.append(edge_event.node_A.data.vertex)
            #    debug.append(edge_event.node_B.data.vertex)
                
                
            #If not processed this edge will shrink to zero edge
            if edge_event.node_A.data.is_processed or edge_event.node_B.data.is_processed:
                count+=1
                continue
            
            
            Vc_I_arc = None
            #Check for peak of the roof event
            if edge_event.node_A.prev.prev is edge_event.node_B:
                new_int_vertex = edge_event.int_vertex
                A_vertex = edge_event.node_A.data.vertex
                B_vertex = edge_event.node_B.data.vertex
                prev_A_vertex = edge_event.node_A.prev.data.vertex
                
                #Update adjacency graph
                adj_graph = self.update_shape_adj_graph(adj_graph,prev_A_vertex,new_int_vertex)
                adj_graph = self.update_shape_adj_graph(adj_graph,A_vertex,new_int_vertex)
                adj_graph = self.update_shape_adj_graph(adj_graph,B_vertex,new_int_vertex)
            
                Vc_I_arc = rc.Geometry.Curve.CreateControlPointCurve([prev_A_vertex, new_int_vertex])
                Va_I_arc = rc.Geometry.Curve.CreateControlPointCurve([A_vertex, new_int_vertex])
                Vb_I_arc = rc.Geometry.Curve.CreateControlPointCurve([B_vertex, new_int_vertex])
                
                if True:#if create_geom and debug_crv >= 0 and debug_crv == count:
                    #debug.append(Va_I_arc)
                    #debug.append(Vb_I_arc)
                    pass
                if True:#create_geom and Vc_I_arc and debug_crv >= 0 and debug_crv == count: 
                    pass#debug.append(Vc_I_arc)  
                
                edge_event.node_A.data.is_processed = True
                edge_event.node_B.data.is_processed = True
                count += 1
                
                #Update the adjacency list
                #tbd
                continue
            
            new_int_vertex = edge_event.int_vertex
            A_vertex = edge_event.node_A.data.vertex
            B_vertex = edge_event.node_B.data.vertex
            #Update adjacency graph
            adj_graph = self.update_shape_adj_graph(adj_graph,A_vertex,new_int_vertex)
            adj_graph = self.update_shape_adj_graph(adj_graph, B_vertex,new_int_vertex)
        
            Va_I_arc = rc.Geometry.Curve.CreateControlPointCurve([A_vertex, new_int_vertex])
            Vb_I_arc = rc.Geometry.Curve.CreateControlPointCurve([B_vertex, new_int_vertex])
            if create_geom and debug_crv >= 0 and debug_crv == count:
                debug.append(Va_I_arc)
                debug.append(Vb_I_arc)
            
            #Modify the list of active vertices/nodes   
            new_prev_edge = edge_event.node_A.data.edge_prev
            new_next_edge = edge_event.node_B.data.edge_next
            #Create new vertex node
            int_vertex_obj = Vertex(edge_event.int_vertex,new_prev_edge,new_next_edge)
            V = DLLNode(int_vertex_obj)
            
            #Swap node_A, node_B w/ V
            #This would be better as remove/insert function in DLL class
            edge_event.node_A.prev.next = V
            edge_event.node_B.next.prev = V
            V.prev = edge_event.node_A.prev
            V.next = edge_event.node_B.next
                
            #change the head for node_A, node_B
            chkhead = LAV.head in (edge_event.node_A,edge_event.node_B)
            chktail = LAV.tail in (edge_event.node_A,edge_event.node_B)
            if chkhead or chktail:
                LAV.head = V
                LAV.tail = V.prev
            
            #Mark as processed
            edge_event.node_A.data.is_processed = True
            edge_event.node_B.data.is_processed = True 
            
            
            
            #Now compute bisector and edge event for new V node
            V_index = LAV.get_node_index(V)
            LAV = self.compute_interior_bisector_vector(LAV,angle_index=V_index)
            PQ,minev = self.compute_edge_events_of_polygon(LAV,PQ,angle_index=V_index,cchk=count)
            
            ##--- Debug ---##
            if count==-1:
                #edge_event: int_vertex,int_arc,node_A,node_B,length2edge
                #debug.append(edge_event.node_A.data.vertex)
                #debug.append(edge_event.node_B.data.vertex)
                #debug.append(edge_event.currnode4debug.data.vertex)
                #debug.append(edge_event.int_vertex)
                V = minev
                r = LAV[V_index].data.bisector_ray
                #debug.append(r[0] + r[1]*2.0)
                #debug.append(edge_event.int_arc)
                #debug.append(V.int_vertex)
                #debug.append(V.node_A.data.vertex)
                #debug.append(V.node_B.data.vertex)
                if V: print 'length2edged', V.length2edge
            ##--- Debug ---##
            
            count += 1  
        
        
        
        #Take the cycles and create perimeter
        
        #print adj_graph
        
        #loc: listof (listof cycles)
        loc = adj_graph.find_most_ccw_cycle()
        #Get offset
        corner_style = rc.Geometry.CurveOffsetCornerStyle.Sharp
        core_crv_lst = tnode.shape.bottom_crv.Offset(tnode.shape.cpt,\
                                 tnode.shape.normal,perimeter_depth,\
                                 sc.doc.ModelAbsoluteTolerance,corner_style)
        
        debug.extend(core_crv_lst)
        core_brep_lst = []
        if not self.is_near_zero(len(core_crv_lst)):
            for i in xrange(len(core_crv_lst)):
                core_crv_chk = core_crv_lst[i]
                if not core_crv_chk.IsClosed:
                    continue
                core_extrusion = rc.Geometry.Extrusion.Create(core_crv_chk,\
                                                              tnode.shape.ht,True)
                core_brep = core_extrusion.ToBrep()
                core_brep_lst.append(core_brep)
        debug.extend(core_brep_lst)
        if len(core_brep_lst)>1:
            print 'we have multiple cores check the way we are diffing this:',\
             len(core_brep_lst)
        #Make preimeter breps
        for i in xrange(len(loc)):
            cycle = loc[i]
            ptlst = map(lambda n: n.value,cycle)
            per_crv = rc.Geometry.Curve.CreateControlPointCurve(ptlst,1)
            per_extrusion = rc.Geometry.Extrusion.Create(per_crv,tnode.shape.ht,True)
            per_brep = per_extrusion.ToBrep()
            diff_per_lst = []
            if not self.is_near_zero(len(core_brep_lst)):
                for i in xrange(len(core_brep_lst)):
                    core_brep = core_brep_lst[i]
                    diff_per = rc.Geometry.Brep.CreateBooleanDifference(per_brep,\
                                                                        core_brep,sc.doc.ModelAbsoluteTolerance)
                    
                    #If no difference, then just include original zone
                    if diff_per == None or self.is_near_zero(len(diff_per)):
                        diff_per_lst.append(per_brep)
                    else:
                        diff_per_lst.extend(diff_per)
            else:#if no core just include original zone
                diff_per_lst = [per_brep]
            
            debug.extend(diff_per_lst)
   
   
        #For debugging/checkign
        tnode.grammar.type['idlst'] = []
        tnode.grammar.type['ptlst'] = []
        for key in adj_graph.get_sorted_keylst():
            node = adj_graph[key]
            if True:#if node.id == 4:
                #debug.append(node.value)
                tnode.grammar.type['idlst'].append(node.id)
                tnode.grammar.type['ptlst'].append(node.value)
                #adj_node_lst = adj_graph.get_adj_lst_as_node_lst(key)
                #debug.extend(adj_node_lst)
        print 'final count: ', count
        print '--'
        return tnode
            
    def vector_to_transformation_matrix(self,dir_vector):
        #obj: Create transformation matrix
        # For n-dim vector create n x n matrix
        # where pivot variables are vector coordinates
        dim = len(dir_vector)
        matrix = []
        for i in xrange(dim):
            row = [0] * dim
            row[i] = dir_vector[i]
            matrix.append(row)
        return matrix
    def multiply_matrix2matrix(self,basematrix,transform_matrix):
        #Takes every single vector
        #Multiplies by transformation matrix
        #creates polyline out of resulting moved vectors
        #resets base plane
        #resets rule based on base plane
        M = []
        dim = len(basematrix[0][0])
        for i in xrange(len(basematrix)):
            vector = basematrix[i][0]
            movevector = self.vector_matrix_multiply(vector,transform_matrix,dim)
            M.append(movevector)
        return M
    def vector_matrix_multiply(self,vector,transform_matrix,dim):
        #Multiply matrix by vector
        move_vec = []
        for row_i in xrange(dim):
            move_vec_coord = 0.
            for col_i in xrange(dim):
                vector_coord = vector[col_i]
                plane_coefficient = transform_matrix[col_i][row_i]
                #print row_i, col_i
                #print plane_coefficient, ',', vector_coord
                #print ''
                move_vec_coord += vector_coord * plane_coefficient
            move_vec.append(move_vec_coord)
        return move_vec
    def get_area(self):
        try:
            area_crv = self.bottom_crv if self.dimension == '3d' else self.crv
            if self.is_guid(area_crv):area_crv = rs.coercecurve(area_crv)
            try:
                area = rc.Geometry.AreaMassProperties.Compute(area_crv).Area
            except Exception as e:
                print e
                area = self.x_dist * self.y_dist
            self.area = area
            return area
        except Exception as e:
            print "Error @ shape.get_area"
            print str(e)#sys.exc_traceback.tb_lineno
    def get_long_short_axis(self):
        if (self.x_dist > self.y_dist):
            long_dist,short_dist = self.x_dist,self.y_dist
            long_axis,short_axis = 'EW','NS'
        else:
            long_dist,short_dist = self.y_dist,self.x_dist
            long_axis,short_axis = 'NS','EW'
        return long_axis,long_dist,short_axis,short_dist
    def extrude_curve_along_normal(self,z_dist,cpt,crv2extrude):
        pathcrv = rc.Geometry.Curve.CreateControlPointCurve([cpt,cpt+self.normal*z_dist],0)
        srf = rc.Geometry.SumSurface.Create(crv2extrude, pathcrv)
        return srf
    def op_extrude(self,z_dist,curve=None):
        debug = sc.sticky['debug']
        try:
            returnflag = True
            if curve == None:
                curve = rs.coercecurve(self.bottom_crv) if self.is_guid(self.bottom_crv) else self.bottom_crv
                returnflag = True
            ext = rc.Geometry.Extrusion.Create(curve,z_dist,True)
            ## check if extruded correct dir
            refcpt = rc.Geometry.AreaMassProperties.Compute(ext).Centroid
            v = rc.Geometry.Vector3d(0,0,1)
            if z_dist > 0.:
                if refcpt[2] < self.cpt[2]:
                    #print 'move up'
                    ext.Translate(0.,0.,z_dist)
            else:
                if refcpt[2] > self.cpt[2]:
                    #print 'move down'
                    ext.Translate(0.,0.,z_dist*-1)
            brep = ext.ToBrep()
            #if returnflag == False:
            #    return brep
            if True:#else:
                self.geom = brep
                self.reset(xy_change=False)
        except Exception as e:
            print "Error @ Shape.op_extrude"
            print str(e)#sys.exc_traceback.tb_lineno
    def op_offset_crv(self,dim,curve=None,count=0,refcpt=None,corner=1):
        #print 'count: ', count, 'dim: ', dim
        if count > 5. or abs(dim-0.)<=0.1:
            return None
        else:
            try:
                if curve == None:
                    curve = copy.copy(self.bottom_crv)
                if not self.is_guid(curve):
                    curve = sc.doc.Objects.AddCurve(curve)
                if not refcpt:
                    refcpt = rs.CurveAreaCentroid(curve)[0]
                offcurve = rs.OffsetCurve(rs.CopyObject(curve),refcpt,dim,None,corner)
                #print 'offcurve', offcurve
                if not offcurve or len(offcurve) > 1:
                    dim -= 1.
                    count += 1
                    return self.op_offset_crv(dim,curve,count,refcpt,corner)
                else:
                    return offcurve[0]
            except Exception as e:
                print "Error @ Shape.op_offset_crv"
                print str(e)#sys.exc_traceback.tb_lineno
    def op_offset(self,dim,curve,dir="courtyard",useoffcrv=False):
        try:
            rs.EnableRedraw(False)
            shapecurve = self.bottom_crv
            abort = False
            if not self.is_guid(curve):
                curve = sc.doc.Objects.AddCurve(curve)
            if self.is_guid(shapecurve):
                shapecurve = rs.coercegeometry(rs.CopyObject(shapecurve))
            #curve = "let's break this fucker."
            cpt = rs.CurveAreaCentroid(curve)[0]
            #style[opt] = the corner style
            #0 = None, 1 = Sharp, 2 = Round, 3 = Smooth, 4 = Chamfer
            copy_curve = rs.CopyObject(curve)
            if not useoffcrv:
                check_curve = self.op_offset_crv(dim,copy_curve,0,refcpt=cpt)
            else: check_curve = copy_curve

            if check_curve:
                if self.is_guid(check_curve):
                    offcurve = rs.coercecurve(check_curve)
                else:
                    offcurve = check_curve
            else:
                print 'courtyard/terrace offset failed'
                diff_geom = None
                abort = True
            if dir=="courtyard" and not abort:
                ht = self.z_dist * 2.5
                geom = copy.copy(self.geom)
                geom = rs.coercegeometry(geom)
                diff_geom = rc.Geometry.Extrusion.Create(offcurve,ht,True)
                #diff_geom = sc.doc.Objects.AddBrep(rs.coercebrep(ext))
                diff_geom = rs.coercebrep(diff_geom)
            elif dir=="terrace" and not abort:
                ht = self.z_dist+1.
                offgeom = rc.Geometry.Extrusion.Create(offcurve,self.z_dist,True)
                offgeom = sc.doc.Objects.AddBrep(rs.coercebrep(offgeom))
                diff_geom = sc.doc.Objects.AddBrep(rs.coercebrep(ext))
            elif dir=="terrace_3d" and not abort:
                ht = self.z_dist+1.
                offgeom = rc.Geometry.Extrusion.Create(offcurve,self.z_dist,True)
                offgeom = rs.coercebrep(offgeom)
                geom = copy.copy(self.geom)
                geom = rs.coercebrep(geom)
                ext = rc.Geometry.Extrusion.Create(shapecurve,ht,True)
                diff_geom = sc.doc.Objects.AddBrep(rs.coercebrep(ext))
            #if dir == "courtyard":
                #print diff_geom
            if not abort:
                try:
                    #if True:
                    if dir=="courtyard":
                        booldiff = rc.Geometry.Brep.CreateBooleanDifference(geom,diff_geom,TOL)
                        if len(booldiff) > 1:
                            self.geom = booldiff
                        elif len(booldiff) > 0:
                            self.geom = booldiff[0]
                    elif dir=="terrace":
                        booldiff = rs.BooleanIntersection(diff_geom,offgeom,True)
                        #booldiff = map(lambda c: rs.coercegeometry(c),booldiff)
                        if len(booldiff)>0.1:
                            self.geom = booldiff[0]
                    elif dir=="terrace_3d":
                        booldiff = rc.Geometry.Brep.CreateBooleanIntersection(geom,offgeom,TOL)
                        booldiff = map(lambda c: sc.doc.Objects.AddBrep(c),booldiff)
                        diff_geom = offgeom
                        if len(booldiff) > 1:
                            self.geom = booldiff
                        elif len(booldiff)> 0.1:
                            self.geom = booldiff[0]
                    self.reset()
                except Exception,e:
                    print str(e)#sys.exc_traceback.tb_lineno
                    print 'fail op_offset'
            rs.EnableRedraw(True)
            return diff_geom
        except Exception as e:
            print 'Error @ Shape.op_offset'
            print str(e)#sys.exc_traceback.tb_l


if True:
    sc.sticky["Shape"] = Shape
# ---------- end bibil ----------
bibil_2 = PythonScript()  # -> o
# ---------- bibil_2: Python ----------
"""
Created on Jun 25, 2016
@author: Saeran Vasanthakumar
"""

import rhinoscriptsyntax as rs
import Rhino as rc
import scriptcontext as sc
import math
import copy
import itertools

"""
Bula takes in data points (i.e. from GIS, from manhattan distance 
analysis) and uses data to drive form generative methods i.e. height, 
setback distance, tower separation at a high degree of precision. 
Since the data points are normalized, you must set the domain extents
of the data you are working with in order to get sensible data. 
By incrementing the bula.value, you can experiment with densities, 
but the density will always be DIRECTIONALLY DRIVEN by underling point
data.
"""
class Bula:
    def __init__(self,bpt_lst=None,value_lst=None,avg_val=0.):
        #Set defaults for list types
        if bpt_lst == None:
            bpt_lst = []
        if value_lst == None:
            value_lst = []
        #Init
        self.bpt_lst = bpt_lst
        self.value_lst = value_lst
        self.avg_value = avg_val
        self.bpt_viz_lst = copy.copy(bpt_lst)
        self.value_actual = []
        
    def normalize_list(self,lov,hibound,lobound):
        """normalized_val = ( (val-min)*(hibound-lobound) )/(max-min) + lobound"""
        max_ = max(lov)
        min_ = min(lov)
        L = []
        
        for i,v in enumerate(lov):
            if max_-min_ > 0.:
                norm_val = ((hibound-lobound)*(v-min_))/(max_-min_) + lobound
            else: 
                norm_val = 1/float(len(lov))
            L.append(norm_val)
        return L
    def calculate_combination(self,iterable,r):
        # combinations(iterable, r)
        # combinations('ABCD', 2) --> AB AC AD BC BD CD
        return itertools.combinations(iterable,r)
    def ghtree2nestlist(self,tree,nest=True):
        nested_lst = []
        for i in range(tree.BranchCount):
            branchList = tree.Branch(i)
            #change from listobject
            lst = []
            for b in branchList:
                if nest: 
                    lst.append(b)
                else: 
                    nested_lst.append(b)
            if nest: 
                nested_lst.append(lst)
        return nested_lst
    def normalize_cpt_data(self,cpt_lst_):
        ## Normalize points
        cpt_lst_val = map(lambda cpt: cpt[2], cpt_lst_)
        ## temp add lowerbound for height
        norm_lst = self.normalize_list(cpt_lst_val,1.,0.)
        for i,val in enumerate(zip(norm_lst,cpt_lst_)):
            norm,cpt = val[0],val[1]
            cpt[2] = norm
            cpt_lst_[i] = cpt
        return cpt_lst_ 
    def set_node_bula_pt_ref(self,curr_node,bula_node_ref):
        #Purpose: Reference bula pts to curr_node's shape_geom boundaries
        #Input: curr_node,bula_node_ref
        #Output: mutated curr_node w/ bula_data if exists
        buladata = bula_node_ref.grammar.type['bula_data']
        curr_node_lst = [curr_node]
        #Input Point list, Value list
        shape_point_lst = buladata.bpt_lst
        shape_value_lst = buladata.value_lst
        shape_value_lst_actual = buladata.value_actual
        
        #Call getpoints4lst
        lst_bpt_lst_,lst_val_lst_,lst_val_lst_actual_  = buladata.getpoints4lot(curr_node_lst,shape_point_lst,shape_value_lst,shape_value_lst_actual)
        #print 'bula', lst_bpt_lst_, lst_val_lst_
        return lst_bpt_lst_,lst_val_lst_,lst_val_lst_actual_
    def getpoints4lot(self,lots_,cpt_,value_ref_,actual_value_ref_):
        ## Loop through tree lots and add the point_nodes
        ## to each lot; returns lst of (listof points inside each lot)
        ## bpt_lst,lots: listof(listof(point data) 
        debug = sc.sticky['debug']
        lst_bpt_lst_ = []
        lst_val_lst_ = []
        lst_val_lst_actual_ = []

        for j,lot in enumerate(lots_):
            boundary = lot.shape.bottom_crv
            neighbor = []
            neighbor_val= []
            neighbor_val_actual = []
            # look through all cpts from dpts and add to neighborlst
            for i,cp in enumerate(cpt_):
                
                movedist = abs(lot.shape.cpt[2]-cp[2])
                if abs(movedist-0.0)>0.1:
                    if lot.shape.cpt[2] < cp[2]:
                        movedist *= -1
                    vec = rc.Geometry.Vector3d(0,0,movedist)
                else:
                    vec = rc.Geometry.Vector3d(0,0,0)
                if not lot.shape.is_guid(cp):
                    cp = sc.doc.Objects.AddPoint(cp)
                copy_cp = rs.CopyObject(cp,vec)
                #copy_cp = rs.coerce3dpoint() 
                
                #copy_cp = cp
                in_lot = 0
                try:
                    in_lot = int(rs.PointInPlanarClosedCurve(copy_cp,boundary,lot.shape.cplane))
                except:
                    pass
                #0 = point is outside of the curve
                #1 = point is inside of the curve
                #2 = point in on the curve
                if abs(float(in_lot) - 1.) <= 0.1:
                    cp = rs.coerce3dpoint(cp)
                    neighbor.append(cp)#,datalst[i]])
                    neighbor_val.append(value_ref_[i])
                    neighbor_val_actual.append(actual_value_ref_[i])
                    #d = rs.AddPoint(copy_cp[0], copy_cp[1],0)
                    #debug.append(d)
            lst_bpt_lst_.append(neighbor)
            lst_val_lst_.append(neighbor_val)
            lst_val_lst_actual_.append(neighbor_val_actual)
        return lst_bpt_lst_,lst_val_lst_,lst_val_lst_actual_ 
    def generate_bula_point(self,shapes_,lst_bpt_lst_,lst_value_lst,lst_value_lst_actual_):
        ## Loop through shape nodes w/ bula_pts
        for i,shape_node in enumerate(shapes_):
            bpt_lst_ = lst_bpt_lst_[i]
            val_lst = lst_value_lst[i]
            actual_val_lst = lst_value_lst_actual_[i]
            avg_val = reduce(lambda x,y: x+y,val_lst)
            ## Make a bpt for each lot
            bpt = Bula(bpt_lst_,val_lst,avg_val)
            bpt.value_actual = actual_val_lst
            #if shape_node.grammar.type.has_key('bula_data'):
            #    shape_node.grammar.type['bula_data'].append(bpt)
            #else:
            shape_node.grammar.type['bula_data'] = bpt
            shapes_[i] = shape_node
        return shapes_
    def calculate_node_gfa(self,lots_,ref_density):
        ##It would be a lot easier to do all these additions
        ## and operations on lists with numpy!!
        ## Old obselete, will need to rwrite to reflect
        ## lot.grammar.type['bula_pt'] = lot.grammar.type['bula_data']
        ## is a single class not list of bpt classes

        ### This section recalculates density amounts to bring the 
        ### actual density in line with the reference density provided by
        ### the designer while maintaining the exponential or nonexponetial
        ### relationship between different lot FARS.
        lot_num = float(len(lots_))
        lot_area = sum(map(lambda l:l.shape.get_area(),lots_))
        sum_gfa = 0.
        for l in lots_:
            for bpt in l.grammar['bula_pt']:
                sum_gfa += bpt.value
            bula_num = len(l.grammar['bula_pt'])
            sum_gfa += 0 if bula_num < 1 else sum_gfa/float(bula_num)
        ref_gfa = ref_density * lot_area
        ## Calculate difference between reference FAR, and actual FAR
        abs_diff = abs(float(ref_gfa) - sum_gfa)
        abs_diff = abs_diff*-1 if ref_gfa < sum_gfa else abs_diff
        ## Sort lot nodes from lowest to highest FAR
        lots_.sort(key=lambda n: n.grammar.type['bula_pt'].value)
           
        ## Loop through the listof(lots)
        for i,lot in enumerate(lots_):
            ## Neighbor nodes are the fine grain Batty cells, within a lot
            ## used to derive density sim. Not surrounding neighbors. 
            ## Sort the neighbor nodes for each lot from 
            ## lowest to highest by their FAR 
            lot_num = float(len(lot.grammar.type['bula_pt']))
            lot_val = sum(map(lambda bpt: bpt.value,lot.grammar.type['bula_pt']))
            try: 
                lot_gfa = (lot_val/lot_num) * lot.shape.get_area()
                ## Calculate the actual lot FAR / actual total FAR
                ## This fixes the exponential relationship.
                proportion = lot_gfa/sum_gfa
                ## If there is more than one neighbor nodes (or batty cells)
                ## then change FAR to be: the (avg neighbor FAR)
                ## plus the proportional difference between reference and actual 
                ## FAR (abs_diff*proportion)
                if lot_num >= 1.:
                    new_lot_gfa = lot_gfa/lot_num + (abs_diff*proportion)
            except ZeroDivisionError:
                lot_gfa = 1.
                new_lot_gfa
            lot.grammar.type['lot_gfa'] = new_lot_gfa
        return lots_
    def sort_by_bula(self,lots_):
        ## Sort by Bula_data.value, from highest to lowest
        def helper_chk_bula(lot_):
            if lot_.grammar.type.has_key('bula_data'):
                bula_val = lot_.grammar.type['bula_data'].value 
            else: 
                bula_val = 0.
            return bula_val 
        #print map(lambda n: n.grammar.type['bula_data'].value,lots_)
        bula_sort = sorted(lots_,key=lambda n: helper_chk_bula(n),reverse=True)
        #print map(lambda n: n.grammar.type['bula_data'].value,bula_sort)
        return bula_sort
    def apply_formula2points(self,formula_ref_,analysis_pts_):
        def helper_dist2focal_lst(focal_ref_,analysis_pt_lst):
            #Create nested list:
            #lst of Focal pts (len=2): 
            #>> nested lst of distance to focal pt for every analysis pt (len=100)
            apt_lst_in_fpt_lst_ = []
            for i,fpt in enumerate(focal_ref_):
                dist_lst = []
                for j,apt_ in enumerate(analysis_pt_lst):
                    dist2fpt = rs.Distance(fpt,apt_)
                    dist_lst.append(dist2fpt)
                apt_lst_in_fpt_lst_.append(dist_lst)
            return apt_lst_in_fpt_lst_
        def helper_min_dist4apt(apt_lst_in_fpt_lst_,analysis_pt_lst,smooth_factor_): 
            #Purpose: Find the minimum distance for each apt
            #Loop through each apt
            #Then loop through each dist2fpt for each apt
            min_dist_lst_ = []
            min_fptindex_lst_ = []
            smooth_fac_lst_ = []
            for i,apt_ in enumerate(analysis_pt_lst):
                dist4fpts = []
                #lstdist2fot = dist of each analysis_pt to fpt
                for lstofdist2fpt in apt_lst_in_fpt_lst_:
                    dist4fpts.append(lstofdist2fpt[i])
                #Identify the fpt that is closer to the apt
                min_fpt_index = dist4fpts.index(min(dist4fpts))
                min_dist = min(dist4fpts)
                min_fptindex_lst_.append(min_fpt_index)
                min_dist_lst_.append(min_dist)
                
                #Calculate Smoothing factor 
                #Find all combinations of two for each fref pt
                comb_dist = self.calculate_combination(dist4fpts,2)
                #Take sqrt of abs difference btwn each dist2fpt and sum
                smooth_ = 0. 
                for fptdist in comb_dist:
                    smooth_ += math.pow(math.fabs(fptdist[0]-fptdist[1]),smooth_factor_)
                    #print smooth_factor
                smooth_fac_lst_.append(smooth_)
            return min_dist_lst_,min_fptindex_lst_,smooth_fac_lst_
        
        #Purpose: Go through each point and add value based on formula
        formula = formula_ref_[0]
        focal_ref = formula_ref_[1]
        focal_height = formula_ref_[2]
        focal_ht_min = focal_height.pop(-1)
        smooth_factor = formula_ref_[3]
        
        #Set defaults
        if len(focal_height) != len(focal_ref):
            if len(focal_height) == 1 and len(focal_ref) > 1:
                focal_height = focal_height * len(focal_ref)
            else:
                print 'Correct the number of focal_weight inputs'
        
        #Calculate distance from apt to each focal ref       
        apts_in_fpts = helper_dist2focal_lst(focal_ref,analysis_pts_)
        #Make list of the minimum distance to fpt for each apt
        min_dist_lst,min_fptindex_lst,smooth_fac_lst = helper_min_dist4apt(apts_in_fpts,analysis_pts_,smooth_factor)            
        
        #Main function apply formula to min dist of each apt
        #This is ordered by fpt so we can weight it later
        #Careful when adding lists! They are complex objects
        #can unintentionally create odd mutations
        value_lst_by_fpt = []
        for fi in enumerate(focal_ref):
            value_lst_by_fpt.append([])
        for apt_i,dist_data in enumerate(zip(min_dist_lst,min_fptindex_lst)):
            min_dist,fpt_i = dist_data[0],dist_data[1]
            #formula: 1/math.exp(0.1813*dist)
            #print 'f', formula
            #print 'd', min_dist
            #Keep track of which fpt is referenced
            try:
                dist = (min_dist/1000.)*10 #<<< convert to km * 10 for 10 min walk
                val = eval(formula)
            except ZeroDivisionError:
                val = 0.
            #store value, apt index tuple
            value_lst_by_fpt[fpt_i].append((val,apt_i))
        
        #Add weights to each
        maxht = max(focal_height)
        wtlst = map(lambda ht: ht/maxht,focal_height)
        val_actual_flt = [0]*len(value_lst_by_fpt)
        #print 'wtlst', wtlst
        for fi,val_ind_lst in enumerate(value_lst_by_fpt):
            weight = wtlst[fi]*maxht
            
            #Separate value and index
            val_lst = map(lambda v: v[0],val_ind_lst)
            ind_lst = map(lambda v: v[1],val_ind_lst)
            #print 'val', val_lst
            #Calculate weighted value
            #
            val_actual = []
            for v in val_lst:
                val_actual.append(float(v) * 100.0)
            #
            max_bound = weight * max(val_lst)
            min_bound = weight * min(val_lst)
            val_lst = self.normalize_list(val_lst,max_bound,min_bound)
            #Now merge value and index back
            val_ind_lst = map(lambda x:(x[0],x[1]),zip(val_lst,ind_lst))
            
            val_actual = map(lambda x: (x[0],x[1]),zip(val_actual,ind_lst))
            val_actual_flt[fi] = val_actual
            
            value_lst_by_fpt[fi] = val_ind_lst

        #Resort by apt order
        #this is a clever way of handling this problem
        flat_val_ind_lst = reduce(lambda x,y:x+y,value_lst_by_fpt)
        flat_val_ind_lst.sort(key=lambda n:n[1])
        value_lst = map(lambda x: x[0],flat_val_ind_lst)
        
        #Resort by apt order ACTUAL
        flat_val_ind_lst_actual = reduce(lambda x,y:x+y,val_actual_flt)
        flat_val_ind_lst_actual.sort(key=lambda n:n[1])
        value_lst_actual = map(lambda x: x[0],flat_val_ind_lst_actual)
        
        #Add smoothing factor
        if len(focal_ref) > 1:
            smooth_fac_lst = self.normalize_list(smooth_fac_lst, 1, 0.001)
        else:
            smooth_fac_lst = self.normalize_list(value_lst,1, 0.001)
        
        value_lst = map(lambda vs: vs[0]*vs[1], zip(value_lst,smooth_fac_lst))
        #max_wtd_value = max(value_lst)
        for i,wtd_val in enumerate(value_lst):
            sf = smooth_fac_lst[i]
            #wtd_sf_val = wtd_val *sf
            inc = (1.-sf)*focal_ht_min
            #print '---'
            #print 'sf: ', sf
            #print 'inc:', inc
            #print 'ht: ', wtd_val
            #if sf <= 0.999:
            #    if (wtd_val + inc) <= max_wtd_value:
            wtd_val_inc = wtd_val + inc
            value_lst[i] = wtd_val_inc 
            
        #Done!
        return value_lst, value_lst_actual
    def set_bula_height4viz(self,shape_node_lst):
        for shape_node in shape_node_lst:
            buladata = shape_node.grammar.type['bula_data']
            bpt_lst = buladata.bpt_lst
            val_lst =  buladata.value_lst
            for i,bp_tuple in enumerate(zip(bpt_lst,val_lst)):
                bpt,val = bp_tuple[0],bp_tuple[1]
                vizpt = rc.Geometry.Point3d(bpt[0],bpt[1],val)
                buladata.bpt_viz_lst[i] = vizpt
    def set_bula_line4viz(self):
        pass
        """
        #Extract bulapt for each lot and visualize as line graph
        line = []
        newlots = []
        for lot in lots:
            for bula_data in lot.data.type['bula_data']:
                ht = lot.data.type['bula_data'].value
                for bpt in bula_data.bpt_lst: 
                    cp = bpt
                    try:
                        line_ = rs.AddLine([cp[0],cp[1],ht],[cp[0],cp[1],0.])
                        line.append(line_)
                    except:
                        pass
        
        pt = line
        """
if True:
    sc.sticky['Bula'] = Bula
# ---------- end bibil_2 ----------
bibil_3 = PythonScript()  # -> o
# ---------- bibil_3: Python ----------
"""
Created on Jun 6, 2016
@author: Saeran Vasanthakumar
"""

import scriptcontext as sc

class Tree:
    """
    http://stackoverflow.com/questions/14084367/tree-in-python-recursive-children-creating
    http://www.laurentluce.com/posts/binary-search-tree-library-in-python/
    double-linked binary tree
    """
    def __init__(self,shape=None,grammar=None,loc=None,parent=None,sib=None,depth=0):
        self.shape = shape
        self.grammar = grammar
        if loc is None: loc = []
        self.loc = loc
        self.parent = parent
        self.depth = depth
        
    def __repr__(self):
        ret = "nd__" + str(self.grammar.type['label']) \
        + "__%s__%s" % (self.grammar.type['grammar'],self.depth)
        #for child in self.loc:
        #    ret += child.__repr__()
        return ret
    def delete_node(self):
        if self is not None:
            #self.loc = []
            if self.parent:
                for i,pc in enumerate(self.parent.loc):
                    if self.parent.loc[i] is self: 
                        self.parent.loc.pop(i)
                        break
        self = None
        del self
        
    def get_root(self):
        if self.parent ==  None:
            return self
        else:
            return self.parent.get_root()
    
    def backtrack_tree(self,foo,accumulate=False):
        def helper_backtrack_tree(node,foo,accumulator,acc_):
            #tail-end recursion backtracking
            if node == None:
                if acc_ == False:
                    return None
                else:
                    return accumulator    
            elif foo(node):
                if acc_ == False:
                    return node
                else:
                    accumulator.append(node) 
            return helper_backtrack_tree(node.parent,foo,accumulator,acc_)
        """ 
        Backtracks tree, applies function argument to every
        node until parent. Use tail-end recurusion
        """
        return helper_backtrack_tree(self,foo,[],accumulate)
            
    def traverse_tree(self,foo,internal=True):
        """ 
        traverse tree, applies function argument to every
        node, leaf
        """
        if self.loc == []:
            # base case
            return [foo(self)]
        else:
            L = []
            if internal:
                L = [foo(self)] 
            for i,child in enumerate(self.loc):
                if child:
                    L += self.loc[i].traverse_tree(foo,internal)
            return L
            
if True:
    sc.sticky["Tree"] = Tree
# ---------- end bibil_3 ----------
bibil_4 = PythonScript()  # -> o
# ---------- bibil_4: Python ----------
import rhinoscriptsyntax as rs
import Rhino as rc
import random
import scriptcontext as sc
import copy
import math
import ghpythonlib.components as ghcomp
import clr
from Rhino import RhinoApp

clr.AddReference("Grasshopper")
from Grasshopper.Kernel.Data import GH_Path
from Grasshopper import DataTree

#"C:\Users\vasanthakumars\AppData\Local\Temp"

"""import classes"""
Shape = sc.sticky["Shape"]
Tree = sc.sticky["Tree"]
Bula = sc.sticky["Bula"]

sc.sticky['debug'] = []
debug = sc.sticky["debug"]

TOL = sc.doc.ModelAbsoluteTolerance

class Grammar:
    """Grammar """
    def __init__(self):
        self.type = {'label':"x","rule_stack":[],'grammar':"null",\
                     'axis':"NS",'ratio':0.,'freeze':False,'dispose':False}
        #need to move axis, NS, ratio to divide
    def label(self,temp_node_,PD_):
        temp_node_.grammar.type['label'] = PD_['label']
        temp_node_.grammar.type['grammar'] = 'label'
        return temp_node_
    def make_rule_stack(self,node):
        #returns the grammar rules that were applied to this node
        rule_stack = node.backtrack_tree(lambda n:n,accumulate=True)
        rule_stack = map(lambda n: n.grammar.type['grammar_key'],rule_stack)
        return rule_stack
    def helper_geom2node(self,geom,parent_node=None,label="x",grammar="null",cplane_ref=None,UINode=False):
        debug = sc.sticky['debug']
        child_node,child_shape = None, None
        IsDegenerate = False
        tree_depth = 0
        if True:#try:
            if geom:
                if parent_node:
                    cplane_ref = parent_node.shape.cplane
                #try:
                #geom = copy.copy(geom)
                child_shape = Shape(geom,cplane=cplane_ref)
                #except Exception as e:
                #    print 'Bibil has detected a degenerate shape', str(e)
                #    child_shape = Shape(geom,parent_node.shape.cplane)
                IsDegenerate = child_shape.cpt==None or abs(child_shape.x_dist-0.) <= 0.1 or abs(child_shape.y_dist-0.) <= 0.1
            elif parent_node:
                #cloned nodes get link to parent_node.shape
                child_shape = parent_node.shape
            
            if UINode:
                    child_shape.UIgeom = copy.copy(rs.coercebrep(geom))
            
            if parent_node:
                tree_depth = parent_node.depth+1
            if IsDegenerate == False:
                if geom:
                    if child_shape.z_dist!=None and int(child_shape.z_dist) <= 0.0001:
                        child_shape.op_extrude(1.)
                child_grammar = Grammar()
                child_grammar.type["label"] = label
                child_grammar.type["grammar"] = grammar
                child_node = Tree(child_shape,child_grammar,parent=parent_node,depth=tree_depth)
        #except Exception as e:
        #    print "Error at Pattern.helper_geom2node", str(e)
        return child_node
    def helper_clone_node(self,node_,parent_node=None,label="x"):
        #Purpose: Input node, and output new node with same Shape, new Grammar
        return self.helper_geom2node(None,parent_node,label)
    def helper_UI_geom(self,tnode):
        if tnode.shape.UIgeom != None:
            tnode.shape = Shape(tnode.shape.UIgeom,tnode.shape.cplane)
        return tnode
    def is_near_zero(self,num,eps=1E-10):
        return abs(float(num)) < eps
    def solar_envelope_uni(self,node_0,time,seht,stype):
        def helper_get_curve_in_tree(node_,stype_,seht_):
            if stype_ == 3:
                noderoot = node_.get_root()
                basecrv = copy.copy(noderoot.shape.bottom_crv)
                ###debug.append(basecrv)
            else:
                basecrv = copy.copy(node_.shape.bottom_crv)
            # Move up to lot_node height
            rc.Geometry.PolyCurve.Translate(basecrv,0.,0.,seht_)
            return basecrv

        def helper_intersect_solar(se_,node_,seht_):
            nodegeomlst = node_.shape.op_split("Z",seht_/node_.shape.z_dist)
            nodebase,nodetop = nodegeomlst[0],nodegeomlst[1]
            se_intersect =  rc.Geometry.Brep.CreateBooleanIntersection(nodetop,se_,TOL)[0]
            rc.RhinoApp.Wait()
            se_union =  rc.Geometry.Brep.CreateBooleanUnion([se_intersect,nodebase],TOL)[0]
            return se_union

        #debug = sc.sticky["debu
        TOL = sc.doc.ModelAbsoluteTolerance
        start,end = time, abs(time - 12.) + 12.
        debug = sc.sticky['debug']
        try:
            node_0.get_root().traverse_tree(lambda n: n.shape.convert_rc('3d'))
            ## Get correct curve from data tree
            se_crv = helper_get_curve_in_tree(node_0,stype,seht)
            ## Get base and top
            #split_ratio = seht/node_0.shape.z_dist
            #lstchild = node_0.shape.op_split("Z",split_ratio)
            #lot_base,lot_top = lstchild[0],lstchild[1]
            ## Generate solar envelope
            #print 'se_crv', se_crv
            se = node_0.shape.op_solar_envelope(start,end,se_crv)
            sebrep = helper_intersect_solar(se,node_0,seht)
            #print 'solarbrep', sebrep
            ###debug.append(sebrep)
            return sebrep
        except Exception as e:
            print "Error @ solar_env_uni", str(e)
    def solar_envelope_multi(self,temp_node_,solartime_,data,solarht_):
        def helper_solar_envelope_multi(data,time,ht):
            try:
                #debug = sc.sticky["debug"]
                cpt = data.shape.cpt
                #time = [9,10,11,12,13]
                time += random.randint(-3,3)
                start = time
                end = start + 1.
                data.shape.make_top_crv()
                data.shape.convert_guid(dim='3d')
                #curve = top_crv#rs.CopyObject(data.shape.bottom_crv,[0,0,data.shape.ht])
                #g = copy.copy(rs.coercegeometry(data.shape.geom))
                cpt = rs.coerce3dpoint(data.shape.top_cpt)#[cpt[0], cpt[1], data.shape.ht]
                curve = data.shape.top_crv

                se = data.shape.op_solar_envelope(start,end,curve)

                htpt = rs.AddPoint(cpt[0],cpt[1],ht)#data.shape.ht)
                if curve:
                    bottom_crv = curve
                else:
                    if not data.shape.is_guid(data.shape.bottom_crv):
                        tcrv = sc.doc.Objects.AddCurve(data.shape.bottom_crv)
                    else:
                        tcrv = data.shape.bottom_crv
                    tvec = rs.VectorCreate(data.shape.top_cpt, data.shape.cpt)
                    bottom_crv = rs.CopyObject(tcrv,tvec)
                dcpt = data.shape.cpt
                if not data.shape.is_guid(dcpt):
                    dcpt = rs.AddPoint(dcpt[0],dcpt[1], dcpt[2])
                path_ = rs.AddCurve([dcpt,htpt])
                srf = rs.ExtrudeCurve(bottom_crv,path_)
                rs.CapPlanarHoles(srf)
                srf = rs.coercegeometry(srf)
                TOL = sc.doc.ModelAbsoluteTolerance
                ###debug.append(srf)
                try:
                    se =  rc.Geometry.Brep.CreateBooleanIntersection(se,srf,TOL)[0]
                except:
                    print 'error at solar multi helper'
                return se
            except Exception as e:
                print e
        try:
            sublst = temp_node_.traverse_tree(lambda n:n,internal=False)
            for subnode in sublst:
                add_hour = float(random.randint(-2,2))
                if add_hour == 0.: add_hour = 1
                solartime_ += 1/add_hour
                try:
                    se = helper_solar_envelope_multi(subnode.grammar,solartime_,solarht_)
                    geo_brep = rs.coercebrep(rs.CopyObject(subnode.shape.geom))
                    unioned =  rc.Geometry.Brep.CreateBooleanUnion([se,geo_brep],TOL)
                except Exception as e:
                    print "Error at solar_envelope multi"
                    print e
                try:
                    unioned = unioned[0]
                    subnode.shape.geom = unioned
                except:
                    print 'error multi unioning solartypes'
            return temp_node_
        except Exception as e:
            print "Error at pattern solar envelope multi"
            print e
    def abstract_BEM(self,tnode,PD_):
        debug = sc.sticky['debug']
        tnode.grammar.type['grammar'] = 'abstract_bem'
        dist_tol = PD_['bem_tol']
        center = PD_['bem_center']
        #Need to eliminate geoms not in dist_tol
        if not tnode.grammar.type.has_key('tolerance_curve'):
                tnode.grammar.type['tolerance_curve'] = []
        try:
            perppts = tnode.shape.offset_perpendicular_from_line(center,dist_tol)
        except:
            debug.append(tnode.shape.geom)
            return tnode
        canoffcrv = rc.Geometry.Curve.CreateControlPointCurve(perppts,1)
        tnode.grammar.type['tolerance_curve'].append(canoffcrv)
        IsIntersect = tnode.shape.check_region(canoffcrv,realvalue=True)
        #if disjoint==setrel: return 0
        #elif intersect==setrel:return 1
        #elif AInsideB==setrel:return 2
        #else: return 3
        if self.is_near_zero(IsIntersect):
            tnode.grammar.type['context_geometry'] = tnode.shape.geom
            tnode.grammar.type['freeze'] = True
            return tnode
        #debug.append(tnode.shape.geom)
        
        maxht = tnode.shape.ht
        minht = tnode.shape.cpt[2]
        if self.is_near_zero(minht):
            minht = 0.0
        dimz = maxht - minht
        
        bothtpt = copy.copy(tnode.shape.cpt)
        htlst = [bothtpt]
                 
        if dimz > 4.5:
            midhtpt = copy.copy(tnode.shape.cpt)
            tophtpt = copy.copy(tnode.shape.cpt)
            midhtpt.Z = (dimz/2.)-(dimz/2.)%3 + minht
            tophtpt.Z = maxht - 3.
            
            #ugly but short term works
            htlst = [bothtpt,midhtpt,tophtpt]
        
            if (tophtpt.Z - midhtpt.Z)/2. > 9.:
                topmidpt = copy.copy(tnode.shape.cpt)
                topmidpt.Z = ((tophtpt.Z - midhtpt.Z)/2.) - ((tophtpt.Z - midhtpt.Z)/2.)%3 + midhtpt.Z
                htlst = [bothtpt,midhtpt,topmidpt,tophtpt]
            if (midhtpt.Z - bothtpt.Z)/2. > 9.:
                botmidpt = copy.copy(tnode.shape.cpt)
                botmidpt.Z = ((midhtpt.Z - bothtpt.Z)/2.) - ((midhtpt.Z - bothtpt.Z)/2.)%3 + bothtpt.Z
                htlst = [bothtpt,botmidpt,midhtpt,topmidpt,tophtpt]
            
            
        tnode.loc = []
        for i in xrange(len(htlst)): 
            refpt = htlst[i]
            crv = tnode.shape.get_bottom(tnode.shape.geom,refpt,tol=1.0,bottomref=minht)
            zone = self.helper_geom2node(crv,parent_node=tnode,grammar='thermalzone',cplane_ref=tnode.shape.cplane)
            if zone==None:
                refpt.Z += 0.5
                crv = tnode.shape.get_bottom(tnode.shape.geom,refpt,tol=1.0,bottomref=minht)
                zone = self.helper_geom2node(crv,parent_node=tnode,grammar='thermalzone',cplane_ref=tnode.shape.cplane)
            if zone==None:
                return tnode
            flr_ht = 0.0 if self.is_near_zero(zone.shape.cpt.Z,eps=0.1) else zone.shape.cpt.Z
            zone.grammar.type['flr_ht'] = flr_ht
            
            if i==0 or i==len(htlst)-1:
                zone.grammar.type['is_interzone'] = False
            else:
                zone.grammar.type['is_interzone'] = True
            zone.shape.op_extrude(3.0)
            tnode.loc.append(zone)
            
        return tnode
    def extract_canyon(self,tnode,PD_):
        debug = sc.sticky['debug']
        tnode.grammar.type['grammar'] = 'extract_canyon'
        dist_tol = PD_['canyon_tol']
        center = PD_['canyon_center']
        srf_data = PD_['srf_data']
        hb_hive = sc.sticky["honeybee_Hive"]()
        
        if dist_tol == None: dist_tol = 10.0
        angle_tol = 15.0
        
        #Add data to Bibil node
        tnode.grammar.type['processed_srf_data'] = []
        tnode.grammar.type['processed_srf'] = []
        tnode.grammar.type['processed_srf_pt'] = []
        tnode.grammar.type['processed_srf_geom'] = []
        tnode.grammar.type['processed_srf_normal'] = []
        
        #Get HBZone from hive
        hnode = tnode.backtrack_tree(lambda n:n.grammar.type.has_key('HBZone'))
        HZone = hnode.grammar.type['HBZone']
        zone = hb_hive.visualizeFromHoneybeeHive([HZone])[0]
        zone_num = int(zone.name.split('_')[-1])
        
        matrix = tnode.shape.base_matrix
        if not matrix:
            matrix = tnode.shape.set_base_matrix()
        #debug.append(tnode.shape.geom)
        #Get reference matrix
        ht = tnode.shape.cpt[2]
        ref_edge = tnode.shape.match_edges_with_refs(matrix,[center],ht,dist_tol=dist_tol,angle_tol=angle_tol)            
        
        #Match srf normals 
        srf_normal = tnode.shape.get_normal_point_inwards(ref_edge[0],to_outside=True)
        
        #srf_normal.Unitize()
        srf_opaque = None
        srf_glass_lst = []
        srf_num = None
        #Sort srf in zone.surface
        for i in xrange(len(zone.surfaces)):
            srf = zone.surfaces[i]
            srf_opaque = srf
            #print srf.normalVector
            #print srf_normal
            IsEqual = srf.normalVector.IsParallelTo(srf_normal,0.1)
            if IsEqual==1:
                if srf_num == None:
                    srf_num = int(srf.name.split('_')[3])
                srf_glass_lst.append(srf_opaque)
                #if srf.hasChild:
                #    for j in xrange(len(srf.childSrfs)):
                #        childSrf = srf.childSrfs[j]
                #        srf_glass_lst.append(childSrf)
                #        #print srf_glass
                break
        #srfopaquenum = srf_opaque.name.split('_')[-1]
        #print srf_opaque.name
        #print srf_glass.name
        glz_num_lst = []
        #for i in xrange(len(srf_glass_lst)):
        #    #print srf_glass_lst[i].name
        #    glz_num_lst.append(srf_glass_lst[i].name.split('_')[-1])
        
        #%%for opaque wall
        glz_num_lst.append(srf_opaque.name.split('_')[-1])
        
        #Identify srf_index from input srf data
        srfdataindex = []
        #for i in xrange(0,len(srf_data),10):
        for i in xrange(len(srf_data)):
            info4srf = srf_data[i][2]
            if not 'Wall' in info4srf:
                continue
            
            srfdatalst = info4srf.split('_')
            zone_num_chk = int(srfdatalst[1])    
            if zone_num_chk != zone_num:
                continue

            srf_num_chk = int(srfdatalst[3].split(':')[0])
            if srf_num_chk != srf_num:
                continue
            
            #glz_num_chk = srfdatalst[-1].split(':')[0] 
            #if glz_num_chk in glz_num_lst:
            srfdataindex.append(i)
        
        #print len(srfdataindex)
        #print len(srf_glass_lst)
        #print '-'
        for i in xrange(len(srfdataindex)):
            srf_glass = srf_glass_lst[i]
            srfindex = srfdataindex[i]
            #zonesrfname = srf_data[srfindex][2]
            #print zonesrfname
            srf_temp_lst = srf_data[srfindex][7:]
            srf_temp_avg = reduce(lambda x,y:x+y,srf_temp_lst)/float(len(srf_temp_lst))
            tnode.grammar.type['processed_srf_data'].append(srf_temp_avg)
            tnode.grammar.type['processed_srf'].append(srf_glass)
            tnode.grammar.type['processed_srf_pt'].append(srf_glass.cenPt)
            tnode.grammar.type['processed_srf_geom'].append(srf_glass.geometry)
            tnode.grammar.type['processed_srf_normal'].append(srf_normal)
        
            #print srf_temp_avg
            #print '----'
        
        #Use window geom
        if srf_opaque.hasChild:
            tnode.shape.geom = srf_opaque.punchedGeometry
        else:
            tnode.shape.geom = srf_opaque.geometry

        #Loop through ref edges
        #edge = ref_edge[0]
        #if type([])==type(edge):
        #    bld_crv = rc.Geometry.Curve.CreateControlPointCurve(edge,0)
        #else:
        #    bld_crv = rs.MoveObject(sc.doc.Objects.AddCurve(edge),[0,0,ht])
        #    bld_crv = rs.coercecurve(bld_crv)
        #exht = tnode.shape.ht - ht
        #srf = tnode.shape.extrude_curve_along_normal(exht,tnode.shape.cpt,bld_crv)
        #debug.append(srf)
        
        return tnode
    def interpolate_vertical(self,tnode_,PD_):
        debug = sc.sticky['debug']
        tnode_.grammar.type['grammar'] = 'interpolate_vertical'
        
        #Assume thermzones in bem >= 3.
        hnode = tnode_.backtrack_tree(lambda n:n.grammar.type.has_key('HBZone'))
        if 'ground' in hnode.grammar.type['label']:
            return tnode_
        
        foobem = lambda n: n.grammar.type['grammar']=='abstract_bem'
        bemnode = tnode_.backtrack_tree(foobem,accumulate=False)
        thermnode = tnode_.parent.parent
        
        #Sort the therm nodes by height
        therm_node_lst = bemnode.loc
        therm_node_lst = sorted(therm_node_lst,key=lambda n:n.grammar.type['flr_ht'])
        
        #Point of separating this from prior function is that
        # every extract_canyon node is processed yet. So null will exist.
        #for t in therm_node_lst:
        #    print t.loc[0]
        #print '--'
        
        #Locate index of current node
        therm_index = therm_node_lst.index(thermnode)
        
        #Isolate floors from current node to next floor
        #This is your interpolation range
        if therm_index+1 >= len(therm_node_lst):
            return tnode_
        
        node_min = therm_node_lst[therm_index]
        node_max = therm_node_lst[therm_index + 1]
        
        if node_min.loc[0].grammar.type.has_key('IsProcessed'):
            if node_min.loc[0].grammar.type['IsProcessed']==True:
                return tnode_
        
        #Starting at next floor, calculate interpolation values
        xlvl = node_min.grammar.type['flr_ht']
        ylvl = node_max.grammar.type['flr_ht']
        xtemplst = node_min.loc[0].grammar.type['processed_srf_data']
        ytemplst = node_max.loc[0].grammar.type['processed_srf_data']
              
        tnode_.grammar.type['interpolate_temperature']=[]
        tnode_.grammar.type['interpolate_srf_geom']=[]
        tnode_.grammar.type['interpolate_cpt']=[]
        tnode_.grammar.type['interpolate_srf_normal']=[]
        #loop through floors, avoiding top, bottom floors
        floor_quantity = (ylvl - xlvl)-(ylvl - xlvl)%3 / 3.0
        for i in xrange(floor_quantity):
            newflrfromht = 3.*i
            newflrht = 3.*i + xlvl
            IsMax = self.is_near_zero(newflrht - node_max.grammar.type['flr_ht'],1.5)
            IsMin = self.is_near_zero(newflrht - node_min.grammar.type['flr_ht'],1.5)
            if IsMin:
                continue
            if IsMax:
                break
            cptlst = node_min.loc[0].grammar.type['processed_srf_pt']
            srfgeomlst = node_min.loc[0].grammar.type['processed_srf_geom']
            srflst = node_min.loc[0].grammar.type['processed_srf']
            
            for j in xrange(len(cptlst)):
                cpt = cptlst[j]
                srfgeom = srfgeomlst[j]
                int_cpt = copy.copy(cpt)
                int_cpt.Z = int_cpt.Z + newflrfromht #to get center of srf
                
                move_vector_up = int_cpt - cpt
                srfguid = sc.doc.Objects.AddBrep(srfgeom)
                movesrfguid = tnode_.shape.move_geom(srfguid,move_vector_up,True)
                srfgeom = rs.coercegeometry(movesrfguid)
                
                #Make new temp 
                if j < len(ytemplst):
                    ytemp = ytemplst[j]
                else:
                    ytemp = ytemplst[-1]
                xtemp = xtemplst[j]
                
                xtemp = xtemplst[j]
                itemp = ((newflrht - xlvl) / (ylvl-xlvl)) * (ytemp-xtemp) + xtemp
                
                tnode_.grammar.type['interpolate_temperature'].append(itemp)
                tnode_.grammar.type['interpolate_srf_geom'].append(srfgeom)
                tnode_.grammar.type['interpolate_cpt'].append(int_cpt)
                srf_normal = node_min.loc[0].grammar.type['processed_srf_normal'][0]
                tnode_.grammar.type['interpolate_srf_normal'].append(srf_normal)
                #srf = srflst[j]
                
        """    
        #for i in xrange(len(therm_node_lst)):
        #    zone = therm_node_lst[i]
        #    print zone.grammar.type['flr_ht']#['is_interzone']
        print '--'
        """
        """
            if bemnode.grammar.type['is_interzone']:
                #Find ref nodes    
                srflst = srfnode.grammar.type['processed_srf']
                templst = srfnode.grammar.type['processed_srf_data']
                srfcptlst = map(lambda srf: srf.cenPt,srflst)
                debug.extend(srfcptlst)
                
                print bemnode.grammar.type['flr_ht']
        """
        return tnode_
    def filter_nodes(self,tnode,PD_):
        debug = sc.sticky['debug']
        tnode.grammar.type['grammar'] = 'filter_nodes'
        ref_long = PD_['dim_long']
        ref_short = PD_['dim_short']
        flip = PD_['flip']
        tol = PD_['tol']
        
        if ref_long==None: ref_long=False
        if ref_short==None: ref_short=False
        
        longshort = tnode.shape.get_long_short_axis()
        shp_short = longshort[3]
        shp_long = longshort[1]
        
         
        if ref_long: ref_long += tol
        if ref_short: ref_short += tol
        
        ref_short += tol
        if shp_short < ref_short and shp_long < ref_long:
            tnode.grammar.type['freeze'] = True
        elif ref_long and shp_long < ref_long:
            tnode.grammar.type['freeze'] = True
        elif ref_short and shp_short < ref_short:
            tnode.grammar.type['freeze'] = True
        
        if flip==True:
            tnode.grammar.type['freeze'] = not tnode.grammar.type['freeze']
        return tnode
    def stepback(self,tnode,PD_):
        debug = sc.sticky['debug']
        ## Ref: TT['stepback'] = [(ht3,sb3),(ht2,sb2),(ht1,sb1)]
        tnode.grammar.type['grammar'] = 'stepback'
        sb_ref = PD_['stepback_ref']
        sb_data = PD_['stepback_data'] #height:stepback
        sb_random = PD_['stepback_randomize']
        sb_dir = PD_['stepback_dir']
        sb_dist_tol = PD_['stepback_tol']
        if sb_dist_tol == None: sb_dist_tol = 10.0
        sb_ref_tol = 15.0
        IsInsideTol = True
        S = Shape()
        
        #Clean/Define the Inputs

        ##sb_data: [(height,distance),(height,distance)...]     :
        #Parse setback data
        for i,sbd in enumerate(sb_data):
            sb_data[i] = map(lambda s: float(s), sbd.split(':'))
        #Parse setback_randomize
        if sb_random:
            random_bounds = sb_random.split(':')
            for i,rb in enumerate(random_bounds):
                random_bounds[i] = map(lambda r: int(float(r)),rb.split('>'))
            randht_lo,randht_hi = random_bounds[0][0],random_bounds[0][1]
            randsb_lo,randsb_hi = random_bounds[1][0],random_bounds[1][1]

        if sb_dir == "side":
            IsSide = True
            sb_dir = None
        else:
            IsSide = False
        if not sb_dir:sb_dir = False

        #Get data if not geometry
        
        IsSelf = True if sb_ref[0] == -1 else False
        sbg_type = self.helper_get_type(sb_ref[0])
        if sbg_type != "geometry":
            sb_node_ref = self.helper_get_ref_node(sb_ref[0],tnode)
            #print sb_node_ref, sb_ref[0]
            #debug.append(sb_node_ref.shape.geom)
            axis_matrix = sb_node_ref.shape.set_base_matrix()
            line_lst = []
            for vectors in axis_matrix:
                line =  rc.Geometry.Curve.CreateControlPointCurve(vectors,0)
                line_lst.append(line)
            sb_ref = line_lst
        
        ##Check region not work!
        """ 
        #Add a check for street tolerance if geometry
        if sbg_type == "geometry":
            if not tnode.grammar.type.has_key('street_tolerance_curve'):
                tnode.grammar.type['street_tolerance_curve'] = []
            for i in xrange(len(sb_ref)):
                sbrefline = sb_ref[i]
                perppts = tnode.shape.offset_perpendicular_from_line(sbrefline,sb_dist_tol)
                streetoffcrv = rc.Geometry.Curve.CreateControlPointCurve(perppts,1)
                tnode.grammar.type['street_tolerance_curve'].append(streetoffcrv)
                IsIntersect = tnode.shape.check_region(streetoffcrv,realvalue=True)
                #if disjoint==setrel: return 0
                #elif intersect==setrel:return 1
                #elif AInsideB==setrel:return 2
                #else: return 3
                if self.is_near_zero(IsIntersect):
                    IsInsideTol = False
                    break
        """
        
        ## Loop through the height,setback tuples
        #rename tnode
        node2cut = self.helper_UI_geom(tnode)
        
        #Loop through the stepback dimensions
        for sb_index in xrange(len(sb_data)):
            #not IsSelf and not IsInsideTol:
            #    break
            sbd = sb_data[sb_index]
            ht, dist = sbd[0], sbd[1]
            
            IsHighEnough = ht < node2cut.shape.ht
            
            if IsHighEnough and sb_random:
                if not self.is_near_zero(randht_lo) and not self.is_near_zero(randht_hi):
                    ht += random.randrange(randht_lo,randht_hi)
                if not self.is_near_zero(randsb_lo) and not self.is_near_zero(randsb_hi):
                    dist += random.randrange(randsb_lo,randsb_hi)

            ##Now actually implement setback
            sh_top_node = node2cut
            
            if not IsHighEnough:
                break
            
            #Get self matrix to match
            matrix = sh_top_node.shape.base_matrix
            if not matrix:
                matrix = sh_top_node.shape.set_base_matrix()

            if IsSelf:
                if IsSide:
                    mi1 = int(random.randrange(0,len(matrix)))
                    if random.randrange(0,2)==1:
                        if mi1 < len(matrix)-1:
                            mi2 = mi1 + 1
                        else:
                            mi2 = mi1 - 1
                        matrix = [matrix[mi1],matrix[mi2]]
                    else:
                        matrix = [matrix[mi1]]

                matrix = map(lambda ptlst:map(lambda pt:rc.Geometry.Point3d(pt[0],pt[1],ht),ptlst),matrix)
                ref_edge = matrix
                #debug.extend(reduce(lambda x,y:x+y,matrix))
            elif sbg_type == "geometry":##need to rethink this
                ref_edge = sh_top_node.shape.match_edges_with_refs(matrix,sb_ref,ht,dist_tol=sb_dist_tol,angle_tol=sb_ref_tol,to_front=not sb_dir)
            else:
                ref_edge = sb_ref
            
            #loop through steback-data-applied ref edges and cut the input geometry
            for sbg in ref_edge:
                cut_geom = None
                #if self.is_near_zero(ht):
                    
                if type([])==type(sbg):
                    sbref_crv = rc.Geometry.Curve.CreateControlPointCurve(sbg,0)
                else:
                    sbg = rs.MoveObject(sc.doc.Objects.AddCurve(sbg),[0,0,ht])
                    sbg = rs.coercecurve(sbg)
                    sbref_crv = sbg
                
                #Doesn't work for some reason!!
                #ptend,ptstart = copy.copy(sbref_crv.PointAtEnd),copy.copy(sbref_crv.PointAtStart)
                #ptend.Z,ptstart.Z = 0.,0.
                #chkcrv = rc.Geometry.Curve.CreateControlPointCurve([ptend,ptstart],0)
                #Check if refedge interesects the input geometry
                #intcrv = rc.Geometry.Intersect.Intersection.CurveCurve(sh_top_node.shape.bottom_crv,chkcrv,0.01,0.01)
                #if self.is_near_zero(intcrv.Count):
                
                try:
                    cut_geom = sh_top_node.shape.op_split("EW",0.5,deg=0.,\
                                        split_depth=float(dist*2.),split_line_ref=sbref_crv)
                except:
                    pass
                #print len(cut_geom)
                #print '--'
                if cut_geom:
                    IsCut = True
                    sh_top_node.shape.geom = cut_geom[0]
                    sh_top_node.shape.reset(xy_change=True)
            node2cut = sh_top_node
            
        
        return tnode
    def transform(self,temp_node_,PD_):
        debug = sc.sticky['debug']
        temp_node_.grammar.type['grammar'] = 'transform_move'
        move_vector = PD_['transform_move']
        basematrix = temp_node_.shape.base_matrix
        if not basematrix:
            basematrix = self.set_base_matrix()

        transform_matrix = temp_node_.shape.vector_to_transformation_matrix(move_vector)
        moved_pts = temp_node_.shape.multiply_matrix2matrix(basematrix,transform_matrix)
        """
        for t in transform_matrix:
            print t
        print '--'
        for b in basematrix:
            print map(lambda c: round(c,2),b[0])
        print '--'
        for p in moved_pts:
            print map(lambda c: round(c,2),p)
        """
        rule_stack = temp_node_.grammar.make_rule_stack(temp_node_)

        moved_pts = map(lambda v: rc.Geometry.Point3d(v[0],v[1],v[2]),moved_pts)
        moved_pts += [moved_pts[0]]
        new_crv = rc.Geometry.Curve.CreateControlPointCurve(moved_pts,1)
        debug.extend(moved_pts)
        debug.append(new_crv)
        childnode = self.helper_geom2node(new_crv,parent_node=temp_node_,grammar="null")
        temp_node_.loc.append(childnode)
        return temp_node_
    def helper_divide_through_normal(self,temp_node_,dist_):
        #Need to rewrite this so all variables in divide is null
        #and option to orient results vertically exists
        #Divides based on 'height'
        #print 'helperdividethroughnormal chk'
        debug = sc.sticky['debug']
        bottom_shape,top_shape = None, None
        ratio_ = (dist_ - temp_node_.shape.cpt[2])/temp_node_.shape.z_dist
        
        PD = {}
        PD['div_num'] = 1
        PD['div_deg'] = 0.
        PD['div_cut'] = 0.
        PD['div_ratio'] = ratio_
        PD['div_type'] = 'simple_divide'
        PD['axis'] = "Z"
        temp_node_ = self.divide(temp_node_,PD)
        
        if temp_node_.loc:
            ext_pt = temp_node_.shape.cpt + (temp_node_.shape.normal * dist_)
            dist_0 = temp_node_.loc[0].shape.cpt - ext_pt
            dist_1 = temp_node_.loc[1].shape.cpt - ext_pt

            if dist_0.Length > dist_1.Length:
                bottom_shape = temp_node_.loc[0]
                top_shape = temp_node_.loc[1]
            else:
                bottom_shape = temp_node_.loc[1]
                top_shape = temp_node_.loc[0]
            #mark top ##this should be an automatic check in helpergeom2node or clonenodes
            #lst_top_nodes = temp_node_.backtrack_tree(lambda n:n.grammar.type['top'],accumulate=True)
            #for tn in lst_top_nodes: tn.grammar.type['top'] = False
            #top_shape.grammar.type['top'] = True
        return bottom_shape,top_shape
    def divide(self,node,PD_):
        def helper_subdivide_depth(hnode,div,div_depth,ratio_,axis_ref="NS"):
            #print 'divdepth, div', div_depth,',', div
            # stop subdivide
            if int(div_depth) >= int(div) or abs(div-0.) <= 0.01:
                haxis,hratio = axis_ref,0.
            # start subdivide
            elif int(div_depth) == 0 and int(div) > 0:
                haxis,hratio = axis_ref,ratio_
            # alternate subdivide by axis
            elif "NS" in hnode.parent.grammar.type['axis']:
                haxis,hratio = "EW",ratio_
            elif "EW" in hnode.parent.grammar.type['axis']:
                haxis,hratio = "NS",ratio_
            hnode.grammar.type['axis'] = haxis
            hnode.grammar.type['ratio'] = hratio
            return hnode
        def helper_subdivide_depth_same(hnode,div,div_depth,ratio_,axis_ref="NS"):
            # base case: stop subdivide
            if int(div_depth) >= int(div) or abs(div-0.) <= 0.01:
                haxis,hratio = axis_ref,0.
            # alternate subdivide by axis
            elif float(div_depth) < 0.5 and int(div) > 0.01:
                haxis,hratio = axis_ref,ratio_
            # alternate subdivide by axis
            else:
                haxis,hratio = node.parent.grammar.type['axis'],0.5
            hnode.grammar.type['axis'] = haxis
            hnode.grammar.type['ratio'] = hratio
            return hnode
        def helper_subdivide_dim(hnode,div,div_depth,ratio_,axis_ref="NS",tol_=3.):
            def equals(a,b,tol=int(3)):
                return abs(a-b) <= tol
            def greater(a,b,tol=int(3)):
                checktol = abs(a-b) <= tol
                return a >= b and not checktol
            ss = hnode.shape
            tol_ = 2.5
            grid_x, grid_y = float(div[0]), float(div[1])
            #print 'g', grid_x, grid_y
            #print 'gref', ss.y_dist, ss.x_dist

            if greater(ss.y_dist,grid_y,tol_):
                haxis = "EW"
                hratio = grid_y/float(ss.y_dist)
            elif greater(ss.x_dist,grid_x,tol_):
                haxis = "NS"
                hratio = grid_x/float(ss.x_dist)
            else:
                haxis,hratio = axis_ref,0.
            #print haxis, hratio
            #print '--'
            hnode.grammar.type['axis'] = haxis
            hnode.grammar.type['ratio'] = hratio
            return hnode
        def helper_simple_divide(hnode,div_,div_depth_,ratio_,axis_ref="NS"):
            hnode.grammar.type['axis'] = axis_ref
            hnode.grammar.type['ratio'] =ratio_
            return hnode
        def helper_divide_recurse(node_,grid_type_,div_,div_depth_,cwidth_,ratio_,axis_,count):
            ## Split, make a node, and recurse.
            if grid_type == "subdivide_depth":
                node_ = helper_subdivide_depth(node_,div_,div_depth_,ratio_,axis_ref=axis_)
            elif grid_type == "subdivide_depth_same":
                node_ = helper_subdivide_depth_same(node_,div_,div_depth_,ratio_,axis_ref=axis_)
            elif grid_type == "subdivide_dim":
                node_ = helper_subdivide_dim(node_,div_,div_depth_,ratio_,axis_ref=axis_)
            else:#simple_divide
                node_ = helper_simple_divide(node_,div_,div_depth_,ratio_,axis_ref=axis_)

            if count >=200.:
                pass
            elif node_.grammar.type['ratio'] > 0.0001:
                #node_.grammar.type['ratio'] = 1. - node_.grammar.type['ratio']
                #debug.extend(node_.shape.bbpts)
                loc = node_.shape.op_split(node_.grammar.type['axis'],node_.grammar.type['ratio'],0.,split_depth=cwidth_)
                #debug.extend(loc)
                #print len(loc)
                for i,child_geom in enumerate(loc):
                    #print 'child nodes'
                    ###debug.append(child_geom)
                    child_node = self.helper_geom2node(child_geom,node_)
                    #print child_node.shape.x_dist
                    #print child_node.shape.y_dist
                    if child_node: node_.loc.append(child_node)
                
                #node_.grammar.dispose_geom(node_)
                
                #print loc
                #print '----'
                if 'simple_divide' not in grid_type:
                    for nc in node_.loc:
                        helper_divide_recurse(nc,grid_type,div_,div_depth_+1,cwidth_,ratio_,axis_,count+1)

        node.grammar.type['grammar'] = 'divide'
        debug = sc.sticky['debug']
        if type(PD_)==type([]):
            div = PD_[0]
            div_deg = PD_[1]
            cut_width = PD_[2]
            ratio = PD_[3]
            grid_type = PD_[4]
            axis = PD_[5]
        else:
            div = PD_['div_num']
            div_deg = PD_['div_deg']
            cut_width = PD_['div_cut']
            ratio = PD_['div_ratio']
            grid_type = PD_['div_type']
            axis = PD_['axis']
        tree_depth = 0.
        helper_divide_recurse(node,grid_type,div,tree_depth,cut_width,ratio,axis,0)
        return node
    def helper_normal2extsrf(self,temp_node_):
        def get_colinear_line(refnode_,tn_):
            def get_max_magnitude(lst):
                max_index = 0
                max_dist = rs.Distance(lst[0][0],lst[0][1])
                for i,ln in enumerate(lst[1:]):
                    dist = rs.Distance(ln[0],ln[1])
                    if dist > max_dist:
                        max_dist = dist
                        max_index = i+1
                lst = [lst[max_index]]
                return lst
            ## Input refnode, and tn
            ## Outputs the lines of tn that are colinear to refnode
            ## Loop through all lines in refshape
            ## Loop through all lines in tempnode
            ## if colinear line, add to colinear_lst
            ref_base = refnode_.shape.set_base_matrix()
            foo_colinear = refnode_.shape.check_colinear_pt
            colinear_lst = []
            newht = tn_.shape.cpt[2]
            n_matrix = tn_.shape.set_base_matrix()
            check_x = False
            check_y = False
            for line in ref_base:
                newline = map(lambda p: [p[0],p[1],newht],line)
                refcrv = rs.coercecurve(rs.AddLine(newline[0],newline[1]))
                ##debug.append(refcrv)
                for nline in n_matrix:
                    pt_0 = foo_colinear(refcrv,nline[0],tol=0.5)
                    pt_1 = foo_colinear(refcrv,nline[1],tol=0.5)
                    if pt_0 and pt_1:
                        colinear_lst.append(nline)
            if len(colinear_lst) < 1:
                colinear_lst = get_max_magnitude(tn_.shape.base_matrix)
            if len(colinear_lst) > 1:
                colinear_lst = get_max_magnitude(colinear_lst)
            return colinear_lst.pop(0)
        def get_normal_to_exterior_vector(parallel2ext):
            ## Take cross product ccw * [0,0,1] vector
            ## solution vector is inward pointing vector
            ccw_vec = parallel2ext[1] - parallel2ext[0]
            up_vec = rc.Geometry.Vector3d(0,0,1)
            cross = rc.Geometry.Vector3d.CrossProduct(ccw_vec,up_vec)
            return cross

        ## Takes a node and finds the vector perpendicular to the surface
        ## pointing inward, relative to the rootnode surface
        ## This should be abstracted and moved to shape class
        debug = sc.sticky['debug']
        temp_node_.traverse_tree(lambda n: n,internal=False)
        ref_node = temp_node_.get_root()
        parallel2refext = get_colinear_line(ref_node,temp_node_)
        #line = rs.AddLine(parallel2refext[0],parallel2refext[1])
        ##debug.append(line)
        normal2srf = get_normal_to_exterior_vector(parallel2refext)
        return normal2srf
    def separate_by_dist(self,temp_node_,PD_):
        def helper_simple_divide(lstvalidshape_,dimkeep,dimaxis,xkeep,ykeep):
            #Now cut the valid shapes
            #lstvalidshape_ : list of valid shapes
            #dimkeep: dimension we are initially cutting
            #dimaxis: axis we are cutting along (EW or NW)
            #print '---'
            VL = []
            for validshape_index in xrange(len(lstvalidshape_)):
                validshape = lstvalidshape_[validshape_index]
                
                #Check shape dim validity and break if not valid
                min_area = xkeep * ykeep
                dim2chk_xy = (xkeep,ykeep)
                #print round(validshape.shape.x_dist,2), round(validshape.shape.y_dist,2)
                #pv = validshape.shape.primary_axis_vector
                #print validshape.shape.vector2axis(pv)
                #print '--'
                #Remember, xkeep=shortdim, ykeep=longdim
                if validshape.shape.x_dist > validshape.shape.y_dist:
                    dim2chk_xy = (ykeep,xkeep)
                
                IsDimValid = validshape.shape.check_shape_validity(dim2chk_xy,min_area,min_or_max_="min",tol_=1.)
                #print '---'
                #print dimkeep
                #print xkeep,ykeep
                #print round(validshape.shape.x_dist,1),round(validshape.shape.y_dist,1)
                #print IsDimValid
                
                if IsDimValid == False:
                    continue
                
                #Check if we are cutting in dirn of primary axis
                #B/c will use shape-fitting optimization here
                dir_cut = 1           
                vs = validshape.shape
                vsht = vs.cpt[2]
                valid_vec = vs.primary_axis_vector
                valid_axis = vs.vector2axis(valid_vec)
                OUT_LST = []
                
                #Get validshape matrix
                valid_matrix = vs.base_matrix
                if not valid_matrix: valid_matrix = vs.set_base_matrix()
                #Get outerref matrix
                outer_ref = self.helper_get_ref_node(0,validshape)
                outer_matrix = outer_ref.shape.base_matrix
                if not outer_matrix: outer_matrix = outer_ref.shape.set_base_matrix()
                #valid_matrix = n sides
                #outer_matrix = m sides
                outer_crv_lst = []
                for i in xrange(len(outer_matrix)):
                    outer_edge = outer_matrix[i]
                    for j in xrange(len(outer_edge)): outer_edge[j].Z = vsht
                    outer_crv = rc.Geometry.Curve.CreateControlPointCurve(outer_edge)
                    #debug.append(outer_crv)
                    outer_crv_lst.append(outer_crv)
                    
                edge_pts = vs.match_edges_with_refs(valid_matrix,outer_crv_lst,norm_ht=vsht,dist_tol=10.0,angle_tol=5.0,to_front=True)
                if edge_pts:
                    out_vec = edge_pts[0][1] - edge_pts[0][0]
                    edge_crv = rc.Geometry.Line(edge_pts[0][0],edge_pts[0][1])
                    #debug.append(edge_crv)
                    OUT_LST.append((out_vec,edge_crv))
                
                for out in OUT_LST:
                    out_axis = vs.vector2axis(out[0])
                    if out_axis == dimaxis:
                        if dimaxis=="NS":
                            p1,p2 = vs.e_ht[0],vs.e_ht[1]
                        else:
                            p1,p2 = vs.s_wt[0],vs.s_wt[1]
                        closept = rc.Geometry.Line.ClosestPoint(out[1],p1,0.0)
                        if not self.is_near_zero(rs.Distance(closept,p1),1):
                            dir_cut = 0
                #fix this!! THIS IS WHERE BLOCK FACING STREET ERROR IS HAPPENING
                
                if dir_cut<0.5:
                    dir_cut = 1
                else:
                    dir_cut = 0
                
                simple_ratio = validshape.shape.calculate_ratio_from_dist(dimaxis,dimkeep,dir_=dir_cut)
                #print simple_ratio
                #print '---'
                
                
                validshape_param_lst = [1.,0.0,0.,simple_ratio,"simple_divide",dimaxis]
                try:
                    self.divide(validshape,validshape_param_lst)
                except:
                    pass
                validchilds = validshape.traverse_tree(lambda n:n, internal=False)
                VL.extend(validchilds)
            return VL
        def separate_dim(temp_node_topo_,x_keep_omit_,y_keep_omit_,cut_axis,cut_axis_alt):
            #Axis issue:
            #cut_axis: axis that cuts perpendicular to primary axis of shape
            #EW will cut y_dist
            #NS will cut x_dist
            #In bibil - y_axis (cutting EW) is always set as the primary axis.

            #Prep inputs
            #xkeep is always < ykeep
            x_keep_,x_omit_ = x_keep_omit_[0],x_keep_omit_[1]
            y_keep_,y_omit_ = y_keep_omit_[0],y_keep_omit_[1]
            
            #Make first division
            divbydim = (x_keep_+x_omit_,y_keep_+y_omit_)
            dummy_ratio, dummy_axis, dummy_deg = 0.5, "NS", 0.
            param_lst = [divbydim,dummy_deg,0.,dummy_ratio,"subdivide_dim",dummy_axis]
            try:
                self.divide(temp_node_topo_,param_lst)
            except:
                pass
            ##Now recursively divide once for dim keep and check dim...
            shape2keep_lst = []
            shape2omit_lst = []

            #Set inputs for simple divide
            topo_child_lst = temp_node_topo_.traverse_tree(lambda n:n, internal=False)
            #debug.extend(map(lambda n:n.shape.geom,topo_child_lst))
            #EW checks x_dist, NS checks y_dist << THIS SHOULD BE CHANGED TO HAVE SAME NAME
            if "EW" in cut_axis:##then the we are cutting y axis, give y dims
                dimprimekeep = y_keep_
                dimsecondkeep = x_keep_
                
            else:
                dimprimekeep = x_keep_
                dimsecondkeep = y_keep_
            
            lstfirkeepnodes = helper_simple_divide(topo_child_lst,dimprimekeep,cut_axis,x_keep_,y_keep_)
            lstseckeepnodes = helper_simple_divide(lstfirkeepnodes,dimsecondkeep,cut_axis_alt,x_keep_,y_keep_)
            #debug.extend(map(lambda n:n.shape.geom,lstseckeepnodes))
            for i in xrange(len(lstseckeepnodes)):
                final_node = lstseckeepnodes[i]
                min_area = x_keep_ * y_keep_
                div2keep = (x_keep_,y_keep_)
                IsValidDimKeepOmit = final_node.shape.check_shape_validity(div2keep,min_area,tol_=2.)
                chkMin = False
                if final_node.shape.x_dist >= (x_keep_-2.) and final_node.shape.y_dist >= (y_keep_-2.):
                    chkMin = True
                if IsValidDimKeepOmit and chkMin==True:
                    shape2keep_lst.append(final_node)
                else:
                    shape2omit_lst.append(final_node)
            #debug.extend(map(lambda n: n.shape.geom,shape2keep_lst))
            return shape2omit_lst,shape2keep_lst
        def check_base_with_offset(shape2off,GLOBLST):
            # check if interect with tower-seperation list
            IsSeparate_ = True
            for offset in GLOBLST:
                chkoff = rs.coercecurve(offset)
                if chkoff!=None:
                    crvA = chkoff
                    crvB = shape2off.shape.bottom_crv
                    #debug.append(chkoffset)
                    setrel = shape2off.shape.check_region(crvA,crvB,tol=0.1)
                    #If not disjoint
                    #if not abs(setrel-0.)<=0.1:
                    #    debug.append(crvB)
                    #    debug.append(crvA)
                    if not abs(setrel-0.)<=0.001:
                        IsSeparate_ = False
                        break
            return IsSeparate_
        def set_separation_record(shape2record,sep_dist,separation_tol_):
            ## Add some tolerance to separation distance
            sep_dist_tol = (sep_dist - separation_tol_) * -1
            try:
                sep_crv = shape2record.shape.op_offset_crv(sep_dist_tol,corner=3)
            except Exception as e:
                print str(e)
                print 'Error at set_separation_record'
            #debug.append(check_base_separation_.shape.bottom_crv)
            debug.append(sep_crv)
            ## Append crv
            sc.sticky['GLOBAL_COLLISION_LIST'].append(sep_crv)

        debug = sc.sticky['debug']
        temp_node_.grammar.type['grammar'] = 'separate'
        #Extract data
        x_keep_omit = PD_['x_keep_omit']
        y_keep_omit = PD_['y_keep_omit']
        #Check collision detection
        add_collision = PD_['add_collision']
        
        #Parse the data
        x_keep_omit = map(lambda s: float(s), x_keep_omit.split(','))
        y_keep_omit = map(lambda s: float(s), y_keep_omit.split(','))
        
        temp_node_topo = temp_node_#copy.deepcopy(sep_ref_node)

        ## Get normal to exterior srf
        try:
            normal2srf = self.helper_normal2extsrf(temp_node_topo)
            cut_axis = temp_node_topo.shape.vector2axis(normal2srf)
        except:
            cut_axis = "NS"
        noncut_axis = "EW" if "NS" in cut_axis else "NS"

        ## Get cut dimensions
        shapes2omit,shapes2keep = separate_dim(temp_node_topo,x_keep_omit,y_keep_omit,cut_axis,noncut_axis)

        #print temp_node_topo,x_keep_omit,y_keep_omit
        #debug.append(temp_node_topo.shape.geom)

        for i in xrange(len(shapes2omit)):
            omit = shapes2omit[i]
            omit.delete_node()
            del omit

        temp_node_topo.loc = []
        
        if shapes2keep:
            #Flatten tree
            temp_node_topo = self.flatten_node_tree_single_child(shapes2keep,temp_node_topo,grammar="shape2keep",empty_parent=True)
            #temp_node_topo = self.flatten_node_tree_single_child(shapes2omit,temp_node_topo,grammar="shape2omit",empty_parent=False)

            # Make/call global collision list
            if not sc.sticky.has_key('GLOBAL_COLLISION_LIST'):
                sc.sticky['GLOBAL_COLLISION_LIST'] = []
            if add_collision != []:
                sc.sticky['GLOBAL_COLLISION_LIST'].extend(add_collision)
            
            #This needs a rewrite.
            sc.sticky['GLOBAL_COLLISION_LIST'] = []
            #print 'GLOBAL_COLLISION', sc.sticky['GLOBAL_COLLISION_LIST']
            
            offset_dist = x_keep_omit[1]
            seperate_tol = 0.5
            # Check shape separation
            for i,t in enumerate(temp_node_topo.loc):
                if 'keep' in t.grammar.type['grammar']:
                    GLOBAL_LST = sc.sticky['GLOBAL_COLLISION_LIST']
                    GLOBAL_LST = filter(lambda offcrv: offcrv!=None,GLOBAL_LST)
                    isSeperate = check_base_with_offset(t,GLOBAL_LST)
                    if isSeperate == True:
                        #offset_tuple
                        set_separation_record(t,offset_dist,seperate_tol)
                    else:
                        temp_node_topo.loc[i] = None
                        t.delete_node()
                        del t
                        #t.grammar.type['grammar'] = 'omit'
                else:
                    temp_node_topo.loc[i] = None
                    t.delete_node()
                    del t
                    #t.grammar.type['grammar'] = 'omit'
        else:
            temp_node_topo.loc = []

        temp_node_topo.loc = filter(lambda n:n!=None,temp_node_topo.loc)

        ##TEMP4MEETING
        #for i,t in enumerate(temp_node_topo.loc):
        #    if not 'keep' in t.grammar.type['grammar']:
        #        temp_node_topo.loc[i] = None
        #        debug.append(t)
        #temp_node_topo.loc = filter(lambda n:n!=None,temp_node_topo.loc)
        if temp_node_topo.loc == []:
            temp_node_topo.grammar.type['freeze'] = True
        #print 'freeze?', temp_node_topo.grammar.type['freeze']
        return temp_node_topo
    def extract_slice(self,temp_node_,PD_):
        def extract_topo(n_,ht_):
            childn = None
            if ht_ < 0.2:
                n_ = self.helper_UI_geom(n_)
                childn = self.helper_geom2node(n_.shape.bottom_crv,n_,'extracted_slice')
                n_.loc.append(childn)
            try:
                refpt = copy.copy(n_.shape.cpt)
                refpt.Z = ht_ - 1.0
                #refpt = rs.AddPoint(pt[0],pt[1],ht_)
                topcrv = n_.shape.get_bottom(n_.shape.geom,refpt)
                topcrv=sc.doc.Objects.AddCurve(topcrv)
                movetopcrv = n_.shape.move_geom(topcrv,rc.Geometry.Vector3d(0,0,1.))
                movetopcrv = rs.coercecurve(movetopcrv)
                #debug.append(movetopcrv)
                childn = self.helper_geom2node(movetopcrv,n_,'extracted_slice')
                n_.loc.append(childn)
            except:
                pass
            return childn
        temp_node_.grammar.type['grammar'] = 'extract_slice'
        debug = sc.sticky['debug']
        ## Warning: this function will raise height of geom 1m.
        slice_ht = PD_['extract_slice_height']
        #IsTop = False
        #Check inputs
        if type(slice_ht) != type([]): slice_ht = [slice_ht]
        if slice_ht == [] or slice_ht == [None]:
            slice_ht = ['max']
            ##unsure about this but works for now...
            #IsTop = temp_node_.backtrack_tree(lambda n:n.grammar.type['top'])
        if slice_ht:
            if self.helper_get_type(slice_ht[0]) == "string":
                if slice_ht[0] == 'max':
                    slice_ht = [temp_node_.shape.ht]
                else:
                    slice_ht = map(lambda s: float(s),slice_ht)
                
            #Extract topo
            for slht in slice_ht:
                chld = extract_topo(temp_node_,slht)
        return temp_node_
    def set_height(self,temp_node_,PD_):
        def height_from_bula(n_):
            setht = 6. #default ht = midrise
            bula_node_lst = temp_node_.backtrack_tree(lambda n: n.grammar.type['bula'],accumulate=True)
            #temp
            min_bula_node_sum = None
            min_bula_node_index = None

            for bula_ref_index,bula_node in enumerate(bula_node_lst):
                bula_node_sum = 0
                buladata = bula_node.grammar.type['bula_data']
                lpl_,lvl_, lvl_actual = buladata.set_node_bula_pt_ref(temp_node_,bula_node)

                #for vl_ in lvl_:
                bula_node_min = min(reduce(lambda x,y: x+y,lvl_))

                if min_bula_node_sum == None or min_bula_node_sum > bula_node_min:
                    min_bula_node_sum = bula_node_min
                    min_bula_node_index = bula_ref_index
            buladata = bula_node_lst[min_bula_node_index].grammar.type['bula_data']
            lpl_,lvl_,actual_lvl_ = buladata.set_node_bula_pt_ref(temp_node_,bula_node_lst[min_bula_node_index])
            if lpl_ != [[]]:
                n_ = buladata.generate_bula_point([n_],lpl_,lvl_,actual_lvl_)[0]
                val_lst = n_.grammar.type['bula_data'].value_lst
                setht = min(val_lst)#sum(val_lst)/float(len(val_lst))
            return setht
        #print 'We are setting height!'
        temp_node_.grammar.type['grammar'] = 'height'
        debug = sc.sticky['debug']
        ht_ = PD_['height']
        randomize_ht = PD_['height_randomize']
        ht_ref = PD_['height_ref']

        ### If ht_ and ht_ref have values: then ht_ is taken as a maximum!!
        
        if ht_ref:
            ht_type = self.helper_get_type(ht_ref)
            if ht_type != "geometry":
                ht_ref = self.helper_get_ref_node(ht_ref,temp_node_)
            
            ht_ref = self.helper_UI_geom(ht_ref)
            ht_ref_shape = ht_ref.shape
            
            #Check to make sure ref is not the same
            if abs(ht_ref_shape.ht-temp_node_.shape.ht)>1.0:
                ht_w_ref = ht_ref_shape.ht - temp_node_.shape.ht
            else:
                ht_w_ref = temp_node_.shape.ht
            
            #Check if maxht is defined
            ht_copy = copy.copy(ht_)
            if ht_==True:
                ht_ = ht_w_ref
            else:
                ht_ = ht_w_ref if ht_w_ref <= ht_ else ht_copy
            #print ht_, ht_copy, ht_w_ref

        if randomize_ht:
            random_bounds = map(lambda r: int(float(r)),randomize_ht.split('>'))
            randht_lo,randht_hi = random_bounds[0],random_bounds[1]
            ht_ += random.randrange(randht_lo,randht_hi)
        
        
        n_ = self.helper_UI_geom(temp_node_)
        #n_ = temp_node_
        #print 'labelchk', temp_node_.parent.parent.grammar.type['label']
        if type(ht_)==type('') and 'bula' in ht_:
            setht_ = height_from_bula(n_)
        else:
            setht_ = ht_#- n_.shape.cpt[2] 
        n_.shape.op_extrude(setht_)
        #print '---'
        return temp_node_
    def get_solar_zone(self,start_time,end_time,curve=None,zonetype='envelope'):
        try:
            if type(curve) == type(rs.AddPoint(0,0,0)):
                curve = rs.coercecurve(curve)
            if 'envelope' in zonetype:
                se = ghcomp.DIVA.SolarEnvelope(curve,43.65,start_time,end_time)
            else:
                minhr = end_time-start_time
                se = ghcomp.DIVA.SolarFan(curve,43.65,minhr,263,200.)
            return se
        except Exception as e:
            print "P.op_solar_envelope error"
            print e
    def concentric_divide(self,temp_node_,distlst,dellst,ROOTREF):
        def helper_recurse(curr_node_,rootref_,distlst_,dist_acc,dellst_,lst_ring,diffn,count):
            ##base case: fail chk_offset
            if ROOTREF:
                rootshape = ROOTREF
            else:
                rootshape = 0
            if curr_node_ == None or count > 10:
                if diffn!=None:
                    lst_ring.append(diffn.shape.geom)
                return lst_ring
            else:
                try:
                    dist_ = distlst_.pop(1)
                    shgeom = curr_node_.shape.geom
                    curr_node_ = self.helper_geom2node(shgeom,rootref_)
                    #debug.append(curr_node_.shape.geom)
                    try:
                        diff_node = self.court(curr_node_,rootshape,dist_+dist_acc,slice=True)
                        #dl = diff_node.traverse_tree(lambda n:n,internal=False)
                        #debug.extend(map(lambda n:n.shape.geom,dl))
                    except:
                        pass
                    #fig this out: diff_node.parent = curr_node_.get_root()
                    if dist_ not in dellst_:
                        for cn in curr_node_.loc:
                            lst_ring.append(cn.shape.geom)
                    ## Check diff node dimension and store it
                    if diff_node:
                        chk_EW_dim = diff_node.shape.check_shape_dim("EW",dist_,min_or_max='min')
                        chk_NS_dim = diff_node.shape.check_shape_dim("NS",dist_,min_or_max='min')
                        if chk_EW_dim and chk_NS_dim:
                            diffn = diff_node
                    distlst_.insert(0,dist_)
                    ## Change the relationships
                    return helper_recurse(diff_node,rootref_,distlst_,dist_acc+dist_,dellst_,lst_ring,diffn,count+1)
                except Exception as e:
                    pass#print 'error at concentric', str(e)
        debug = sc.sticky['debug']
        lon = temp_node_.traverse_tree(lambda n: n,internal=False)
        rootref = temp_node_.get_root()

        for subdiv in lon:
            ringlst = helper_recurse(subdiv,rootref,distlst,0.,dellst,[],None,0)
            ringlst = filter(lambda n: n!=None,ringlst)
            ##debug.extend(ringlst)
            for ring in ringlst:
                childnode = self.helper_geom2node(ring,subdiv)
                subdiv.loc.append(childnode)
        return temp_node_
    #Abstract this as helper to parse ref geoms
    def helper_get_type(self,type_ref_):
        type_info = None
        N = Tree()
        S = Shape()
        #Check if number reference to index of depth in binary data tree
        if type_ref_ == None:
            type_info = None
        elif type(type_ref_)==type(""):
            type_info = "string"
        elif type(type_ref_) == type(1) or type(type_ref_) == type(1.):
            type_info = "number"
        elif type(type_ref_) == type(N):
            type_info = "tree"
        elif type(type_ref_) == type(S):
            type_info = "shape"
        else:
            type_info = "geometry"
        return type_info
    def helper_get_ref_node(self,shape_ref_,node_):
        ##Checks the input type and outputs the a Node based on reference
        refshape_ = None
        #Base case
        type_info = self.helper_get_type(shape_ref_)
        if type_info == None:
            refshape_ = node_
        else:
            #Check if number reference to index of depth in binary data tree
            if type_info == "string":
                try:
                    shape_ref_ = int(shape_ref_)
                    type_info = "number"
                except ValueError:
                    node_ = node_.backtrack_tree(lambda n:n.grammar.type['label']==shape_ref_,accumulate=False)
                    type_info = "node"

            if type_info == "number":
                shape_ref_ = int(shape_ref_)
                #positive or zero or negative
                if shape_ref_ > -0.5:
                    refdepth = shape_ref_
                else:
                    refdepth = node_.depth + (shape_ref_ + 1)
                refshape_backtrack = node_.backtrack_tree(lambda n:n.depth==refdepth,accumulate=False)
                if refshape_backtrack:
                    refshape_ = refshape_backtrack
            elif type_info == "node":
                #Check if node
                refshape_ = node_
            #Assume geom
            else:
                try:
                    shape_node = self.helper_geom2node(shape_ref_)
                    refshape_ = shape_node
                except:
                    pass
        #check if nothing matches
        if refshape_ == None:
            refshape_ = node_
        refshape_ = self.helper_UI_geom(refshape_)
        return refshape_
    def flatten_node_tree_single_child(self,lstofchild,parent_ref_node,grammar="null",empty_parent=True):
        #Input list of nodes at different depths, a parent, grammar
        #Create flat list of nodes w/ same parent
        def clean_child_nodes(loc):
            #Clean child nodes of links to parent or childs
            for i,c in enumerate(loc):
                for lc in c.loc:
                    try:
                        del lc.shape.geom
                    except:
                        pass
                    del lc
                c.loc = []
                c.parent = None
                loc[i] = c
            return loc
        if empty_parent == True:
            parent_ref_node.loc = []
        lstofchild = clean_child_nodes(lstofchild)
        for i,n in enumerate(lstofchild):
            n.depth = parent_ref_node.depth+1
            n.parent = parent_ref_node
            lstofchild[i] = n
            if grammar != "null":
                n.grammar.type['grammar'] = grammar
        parent_ref_node.loc.extend(lstofchild)
        return parent_ref_node
    def court(self,temp_node_,PD_):
        def court_slice(curr_node,rootshape,width_,cut_width_):
            def recurse_slice(curr_node_,matrice,valid_node_lst,diff,count,count_subdiv,cut_width__):
                #print count, curr_node_
                cmax = 40.
                tol = 2.
                invalid_node = None
                valid_node = None
                #Base case
                if count >= cmax or curr_node_==None:
                    return valid_node_lst,diff
                else:
                    diff = curr_node_
                    #chk_offset_ = rootshape.op_offset_crv(width_+0.1)
                    matrice_max = False
                    #print 'start---'
                    set_rel = -100
                    #debug.append(curr_node_.shape.geom)
                    for i,line in enumerate(matrice):
                        #print i
                        dirvec = line[1]-line[0]
                        # get magnitude of line
                        dist = math.sqrt(sum(map(lambda p: p*p,dirvec)))
                        if dist <= tol:
                            print 'too small to court slice'
                        if dist > tol:
                            split_crv = rs.AddCurve(line,1)
                            midpt = curr_node_.shape.get_midpoint(line)
                            sc_ = 5,5,0
                            split_crv = rs.ScaleObject(split_crv,midpt,sc_)
                            #Check if refedge interesects the input geometry
                            #This is a huge time saver
                            
                            if self.is_near_zero(cut_width__):
                                intcrv = rc.Geometry.Intersect.Intersection.CurveCurve(curr_node_.shape.bottom_crv,rs.coercecurve(split_crv),0.001,0.001)
                                if self.is_near_zero(intcrv.Count):
                                    #debug.append(rs.coercecurve(split_crv))
                                    #debug.append(curr_node_.shape.bottom_crv)
                                    continue
                            
                            if True:#try:
                                split_node_lst = []
                                split_geoms = curr_node_.shape.op_split("NS",0.5,split_depth=cut_width__,split_line_ref=split_crv)
                                for geom in split_geoms:
                                    #if type(geom)!= type(rootshape.shape.geom):
                                    split_node = self.helper_geom2node(geom,None)
                                    if split_node==None:
                                        pass
                                    else:
                                        split_node_lst.append(split_node)
                                        split_crv = split_node.shape.bottom_crv
                                        #Check if this geom intersects with larger offset.
                                        #if so keep cutting
                                        set_rel = curr_node_.shape.check_region(chk_offset,split_crv,realvalue=True,tol=0.1)
                                        #if disjoint==setrel: return 0
                                        #elif intersect==setrel:return 1
                                        #elif AInsideB==setrel:return 2
                                        #else: return 3
                                        #debug.append(chk_offset)
                                        if self.is_near_zero(set_rel):#if disjoint stop splitting
                                            valid_node = split_node
                                            valid_node_lst.append(valid_node)
                                        else:#keep splitting
                                            #print set_rel
                                            invalid_node = split_node
                                            #debug.append(chk_offset)
                                            #debug.append(split_crv)
                                            #debug.append(split_node.shape.geom)
                            #except:        
                            #    pass## Split fail, so test the next line split
                        #Check if reach max of matrice len
                        matrice_max = len(matrice)==i+1
                        #if invalid_node != None and valid_node != None:
                        if valid_node!=None:
                            #valid_node_lst.append(valid_node)
                            matrice.pop(i)
                            break
                    if matrice_max == True and abs(set_rel-1.)<0.1:
                        #debug.append(curr_node_.shape.geom)
                        chk_offset_out = rootshape.op_offset_crv(width_-1.5)
                        for sn in split_node_lst:
                            split_crv = sn.shape.bottom_crv
                            set_rel = curr_node_.shape.check_region(chk_offset_out,split_crv,tol=0.1)
                            if abs(set_rel-2.)<0.1 and count_subdiv < 1.:
                                try:
                                    L_,diff_ = recurse_slice(sn,shape_matrix,[],None,0,count_subdiv+1,cut_width__)
                                    valid_node_lst.extend(L_)
                                    #debug.extend(map(lambda n:n.shape.geom,L_))
                                except:
                                    pass
                                #debug.append(sn.shape.geom)
                # If the node has been split (invalid_node!= None)
                # OR the node has no valid split lines (invalid_node == None)
                # then we send it back into the recurser.
                return recurse_slice(invalid_node,matrice,valid_node_lst,diff,count+1,count_subdiv,cut_width__)

            ### REWRITE AS EXTRUSION OF BASE_MATRIX
            ### O(2n) complexity time
            offset = rootshape.op_offset_crv(width_)
            ###debug.append(rootshape.bottom_crv)
            chk_offset = rootshape.op_offset_crv(width_+0.21)
            diff = None
            if chk_offset:
                off_node = self.helper_geom2node(offset,curr_node)
                shape_matrix = off_node.shape.set_base_matrix()
                #debug.append(curr_node.shape.geom)
                #debug.append(off_node.shape.geom)
                L,diff = recurse_slice(curr_node,shape_matrix,[],None,0,0,cut_width_)
                #debug.extend(map(lambda n:n.shape.geom,L))
                offset = rs.coercecurve(offset)
                IsInside = offset.Contains(diff.shape.cpt,diff.shape.cplane) == rc.Geometry.PointContainment.Inside
                #if IsInside:
                    #debug.append(diff.shape.geom)
                #print diff
                curr_node = self.flatten_node_tree_single_child(L,curr_node,grammar="courtslice")

            else:
                diff = None
            return diff

        #Unpack the parameters

        temp_node_.grammar.type['grammar'] = 'court'
        court_ref = PD_['court_ref']
        court_width = PD_['court_width']
        court_slice_bool = PD_['court_slice']
        court_randomize = PD_['court_randomize']
        cut_width = PD_['court_cut_width']
        if not cut_width:
            cut_width = 0.
        if court_randomize:
            random_bounds = map(lambda r: int(float(r)),court_randomize.split('>'))
            randct_lo,randct_hi = random_bounds[0],random_bounds[1]
            court_width += random.randrange(randct_lo,randct_hi)

        debug = sc.sticky['debug']
        diff = None
        lon = temp_node_.traverse_tree(lambda n: n,internal=False)

        for subdiv in lon:
            subdiv = self.helper_UI_geom(subdiv)
            subdiv.shape.convert_rc('3d')
            refshape_node = self.helper_get_ref_node(court_ref,subdiv)
            refshape = refshape_node.shape
            if court_slice_bool:
                try:
                    diff = court_slice(subdiv,refshape,court_width,cut_width)
                except Exception as e:
                    print 'Error @ court_slice', str(e)
            elif court_width > 0.:
                try:
                    subdiv.shape.op_offset(court_width,refshape.bottom_crv,dir="courtyard")
                except Exception as e:
                    print 'Error @ court', str(e)
        return diff
    def set_bula_point(self,temp_node_,PD_):

        temp_node_.grammar.type['grammar'] = 'bula'
        #Move this back to Bula as main_bula
        B = Bula()
        S = Shape()
        #Get the inputs
        analysis_ref = PD_['bula_point_lst']
        value_ref = PD_['bula_value_lst']

        ##Check to see what are input combo
        chk_apt = filter(lambda x: x!=None,analysis_ref) != []
        chk_val = filter(lambda x: x!=None,value_ref) != []
        value_ref_actual = None
        #Set defaults or add warnings
        if not chk_apt:
            print 'Analysis inputs are missing!'
            chk_apt = False
        if not chk_val:
            val_num = len(analysis_ref)
            value_ref = [0]*val_num
            chk_val = True
        elif chk_val and type(value_ref[0]) == type(''): #should be more explicit
            #If value is a formula
            if chk_apt:
                value_ref,value_ref_actual = B.apply_formula2points(value_ref,analysis_ref)
        if value_ref_actual == None:
                value_ref_actual = copy.copy(value_ref)
        if chk_apt and chk_val:
            #Convert from guid
            if S.is_guid(analysis_ref[0]):
                analysis_pts = map(lambda p: rs.coerce3dpoint(p),analysis_ref)
            #Sort analysis pts into leaf nodes
            shape_leaves = temp_node_.traverse_tree(lambda n: n,internal=False)
            #shape_leaves = [temp_node_]
            lst_plain_pt_lst, lst_value_lst,lst_value_lst_actual = B.getpoints4lot(shape_leaves,analysis_ref,value_ref,value_ref_actual)
            #Make bula point for each lot
            B.generate_bula_point(shape_leaves,lst_plain_pt_lst,lst_value_lst,lst_value_lst_actual)
            B.set_bula_height4viz(shape_leaves)
        print temp_node_.traverse_tree(lambda n:n,internal=False)
    def meta_tree(self,temp_node_,PD_):
        def inc_depth(n):
            if n.parent:
                n.depth = n.parent.depth + 1
            else:
                n.depth = 0

        temp_node_.grammar.type['grammar'] = 'meta_tree'
        meta_node_lst = PD_['meta_node']
        debug = sc.sticky['debug']
        #THIS SHOULD BE DONE IN TREE CLASS
        #print 'label metanode:', meta_node.parent
        #print 'label currnode: ', temp_node_
        for meta_node in meta_node_lst:
            meta_root = meta_node.get_root()
            IsIn = rs.PointInPlanarClosedCurve(temp_node_.shape.cpt,meta_root.shape.bottom_crv)
            if not IsIn:
                continue
            else:
                temp_root = temp_node_.get_root()
                #Check to make sure we haven't already inserted as root
                chklabel = temp_root.grammar.type['label'] != meta_root.grammar.type['label']
                if chklabel:
                    new_child_node = temp_node_.get_root()
                    #Insert and link both ways
                    meta_node.loc.append(new_child_node)
                    #Give a unique id to meta_node to make sure we don't double ref
                    meta_node.grammar.type['label'] += str(random.randrange(1,1000))
                    #Now reference it
                    new_child_node.parent = meta_node
                    #Reset depths
                    root = meta_node.get_root()
                    root.traverse_tree(lambda n:inc_depth(n),internal=True)
    def bucket_shape(self,temp_node_lst_,PD_):
        def helper_sort_val_by_tol(node_lst,grammar2find,func):
            # Input: node, str, tol, function
            # Extract �grammar� and value foo
            # add foo(value/numofleaves / TOL)
            # add to dictionary if key/not key
            # Output: key:tuple of dictionary
            grammar_dict = {}
            #foo = eval(func)
            for node in node_lst:
                key = node.grammar.type[grammar2find]
                if grammar_dict.has_key(key):
                    grammar_dict[key].append(node)
                else:
                    grammar_dict[key] = [node]
            lstofkeyvaltuple = grammar_dict.items()
            return lstofkeyvaltuple

        def pass_grammar_rules(node_lst,grammar2findlst,funclst):
            # pass grammars to helper
            B = []
            for grammar2find,func in zip(grammar2findlst,funclst):
                lstkeyval = helper_sort_val_by_tol(node_lst,grammar2find,func)
                B.append(lstkeyval)
            return B

        ## Purpose: buckets input shapes
        debug = sc.sticky['debug']
        apply2 = PD_['apply2list']
        keys2bucket = PD_['keys2bucket']#'height','primary_axis_vector']
        fx2bucket = PD_['fx2bucket']

        #Apply grammar key
        for i in xrange(len(temp_node_lst_)):
            temp_node_lst_[i].grammar.type['grammar'] = 'bucket_shape'
        nodes2bucket = temp_node_lst_

        ## Bucket: [(grammar_key,{keyval:lstofnode}),(grammar_key,{keyval:lstofnode})]
        ## keys2find = [key1,key2,key3]

        Bucket = pass_grammar_rules(nodes2bucket,keys2bucket,fx2bucket)
        """
        ###This is for energy archetype identification
        #htfoo = lambda n: str(round(n.shape.ht/9.0,2))
        for n in nodes2bucket:
            lstn = n.backtrack_tree(lambda n_:n_.grammar.type.has_key('ratio'),accumulate=True)
            bucket.append(n.shape.bottom_crv)
            for nl in lstn:
                if 'stepback' in nl.grammar.type['grammar']:
                    #print nl
                    stpd = nl.grammar.type['stepback_data']
                    ht = float(stpd[0][0])+3
                    #print stpd
                    pt = n.shape.cpt
                    refpt = rs.AddPoint(pt[0],pt[1],ht)
                    topcrv = n.shape.get_bottom(n.shape.geom,refpt)
                    #print topcrv
                    #tn = self.helper_geom2node(topcrv)
                    bucket.append(topcrv)
        debug.extend(bucket)
        """
        return Bucket
    def shape2height(self,temp_node_,PD_):
        #TBD
        temp_node_.grammar.type['grammar'] = 'shape2height'
        angle = 0.5
        ht_inc = 3.0
        side_inc = 0.1
        ht = temp_node_.shape.ht
        floor_div = int(math.floor(ht/ht_inc))
        input_node = temp_node_
        for i,fdiv in enumerate(range(floor_div)):
            #print 'fdiv', fdiv
            if fdiv > 10.0:
                inc_angle = angle * -1.0
            else:
                inc_angle = angle
            #print 'angle', inc_angle
            try:
                input_node_with_child = self.squeeze_angle(input_node,inc_angle,ht_inc,side_inc)
                input_node = input_node_with_child.loc[0]
            except:
                print 'error at shape2height'
        loc = temp_node_.traverse_tree(lambda n:n,internal=True)
        loc.pop(0)
        temp_node_ = self.flatten_node_tree_single_child(loc,temp_node_)
        return temp_node_
    def squeeze_angle(self,temp_node_,angle,ht_inc,side_inc):
        #Purpose: Input node, angle degree
        #Output a shape2d with angle chagned according to degree

        ## Prep inputs
        debug = sc.sticky['debug']
        #Get base matrix
        base_matrix = temp_node_.shape.set_base_matrix()
        lines2rotate = [base_matrix[0],base_matrix[1]]
        line2intersect = []

        ## Roteate intersection lines outside
        for i,linept_ in enumerate(lines2rotate):
            if i%2==0:
                heta = False
                basept_index = 0
            else:
                heta = True
                basept_index = 1
            toin = False
            linept_ = temp_node_.shape.rotate_vector_from_axis(angle,linept_,movehead=heta,to_inside=toin)

            ## Increment side length
            if not self.is_near_zero(side_inc,eps=1E-10):
                newdirvec = linept_[1] - linept_[0]
                newdirvec.Unitize()
                sideincvec = newdirvec * side_inc
                orig_vec = linept_[1] - linept_[0]
                extended_vec = orig_vec + sideincvec
                linept_[1] = linept_[0] + extended_vec

            lines2rotate[i] = linept_
            newbasept = lines2rotate[i][basept_index]
            #Getting the perp pt for each rotated line
            perppt = temp_node_.shape.extrude_pt_perpendicular_to_pt(newbasept,linept_)
            if i%2==0:
                perp_linept_ = [perppt,newbasept]
            else:
                perp_linept_ = [newbasept,perppt]
            line2intersect.append(perp_linept_)

        ## Intersect the two lines
        #lines2rotate: first two lines that we rotated
        #line2intersect: lines we are going to intersect
        #Intersecting the lines
        IsIntersect,intpt = temp_node_.shape.get_pt_of_intersection(line2intersect)
        if IsIntersect:
            for i,linept in enumerate(line2intersect):
                if i%2==0:
                    line2intersect[i] = [intpt,linept[1]]
                else:
                    line2intersect[i] = [linept[0],intpt]
            # To perserve the ccw order
            line2intersect = [line2intersect[1],line2intersect[0]]
            # Now add everything together and draw the lines
            base_matrix = lines2rotate + line2intersect
            pts4crv = []
            for i,b in enumerate(base_matrix):
                pts4crv.append(b[0])
            pts4crv += [pts4crv[0]]
            shapecrv = rc.Geometry.Curve.CreateControlPointCurve(pts4crv,1)

            ## Increment height
            if not self.is_near_zero(ht_inc,eps=1E-10):
                htvec = rc.Geometry.Vector3d(0,0,ht_inc)
                shapecrv_guid = sc.doc.Objects.AddCurve(shapecrv)
                movevec = temp_node_.shape.move_geom(shapecrv_guid,htvec)
                shapecrv = rs.coercecurve(movevec)
            ## Mutate the node
            temp_node_child = self.helper_geom2node(shapecrv,parent_node=temp_node_,grammar="squeeze_angle")
            temp_node_.loc.append(temp_node_child)
        return temp_node_
    def straight_skeleton(self,temp_node_,PD_):
        temp_node_.grammar.type['grammar'] = 'straight_skeleton'
        stepnum = PD_['step']
        perimeterZoneDepth_ = PD_['perimeterZoneDepth_']
        temp_node_.shape.compute_straight_skeleton(temp_node_,perimeterZoneDepth_,stepnum,)
        return temp_node_
    
    def node2grammar(self,lst_node_,rule_in_,firstUINode=False):
        def helper_type2node(copy_node_,type_):
            #type: list of (dictionary of typology parameters)
            copytype = copy.deepcopy(type_)
            copy_node_.grammar.type.update(copytype)
            return copy_node_
        def helper_clone_node(node_geom,IsUINode=False):
            #Purpose: Create a node from geometry/parent node
            #if geometry, turned into node w/ blank label
            #if node, clone a child node w/ blank label
            if type(T) == type(node_geom):
                # If node create 'clone', new tree, new Grammar, link to same Shape
                childn = self.helper_clone_node(node_geom,parent_node=node_geom)
                node_geom.loc.append(childn)
                n_ = childn
            else:
                n_ = self.helper_geom2node(node_geom,UINode=IsUINode)
            return n_
        ## Purpose: Input list of nodes, applies type
        ## Applies pattern based on types
        ## outputs node
        T = Tree()
        L = []
        DL = []
        #Apply rule to each node
        child_node_lst_ = []
        for i,node_ in enumerate(lst_node_):
            ## Everytime we add a rule, we clone a node.
            ## Every rule mutates the node, or creates child nodes.
            ## If node create 'clone', new tree, new Grammar, link to same Shape
            child_node_ = helper_clone_node(node_,IsUINode=firstUINode)
            if child_node_:
                ## Apply type to node that we will apply rule to
                child_node_ = helper_type2node(child_node_,rule_in_)
                child_node_lst_.append(child_node_)

        ##Check how we apply the rules
        IsApply2Full = rule_in_.has_key('apply2list') and  rule_in_['apply2list'] == True

        #Feed in entire list of nodes
        if IsApply2Full:
            #When we apply full list, we assume we are applying same rule to all nodes
            ParamDict = child_node_lst_[0].grammar.type
            node_out_,dead_node_out_ = self.main_grammar(child_node_lst_,ParamDict)
            RhinoApp.Wait()
            L.extend(node_out_)
            DL.extend(dead_node_out_)
        else:
            for i,child_node_ in enumerate(child_node_lst_):
                ## Apply pattern
                if True:#try:
                    ParamDict = child_node_.grammar.type
                    node_out_,dead_node_out_ = self.main_grammar(child_node_,ParamDict)
                    RhinoApp.Wait()
                    L.extend(node_out_)
                    DL.extend(dead_node_out_)
                #except Exception as e:
                #    print "Error @ node2grammar"


        return L,DL
    def main_grammar(self,temp_node,PD):
        isList = type(temp_node) == type([])

        ## ---- START TEST --- ##
        ## Date 2016 11 30 << if this doesn't pop up delete this check.
        if not isList and temp_node.shape:
            gb = temp_node.shape.geom
            if temp_node.shape.is_guid(gb):
                print 'guid identified in grammar.main_grammar dont delete me!'
                #node.shape.geom = rs.coercebrep(gb)
        ## ---- END TEST --- ##

        if PD.has_key('label_UI') and PD['label_UI'] == True:
            temp_node = self.label(temp_node,PD)
        elif PD.has_key('divide') and PD['divide'] == True:
            temp_node = self.divide(temp_node,PD)
        elif PD.has_key('height') and PD['height']:
            temp_node = self.set_height(temp_node,PD)
        elif PD.has_key('stepback') and PD['stepback'] == True:
            temp_node = self.stepback(temp_node,PD)
        elif PD.has_key('court') and PD['court'] == True:
            self.court(temp_node,PD)
        elif PD.has_key('bula') and PD['bula'] == True:
            self.set_bula_point(temp_node,PD)
        elif PD.has_key('meta_tree') and PD['meta_tree'] == True:
            self.meta_tree(temp_node,PD)
        elif PD.has_key('separate') and PD['separate'] == True:
            temp_node = self.separate_by_dist(temp_node,PD)
        elif PD.has_key('shape2height') and PD['shape2height'] == True:
            temp_node = self.shape2height(temp_node,PD)
        elif PD.has_key('extract_slice') and PD['extract_slice'] == True:
            temp_node = self.extract_slice(temp_node,PD)
        elif PD.has_key('abstract_bem') and PD['abstract_bem'] == True:
            temp_node = self.abstract_BEM(temp_node,PD)
        elif PD.has_key('extract_canyon') and PD['extract_canyon'] == True:
            temp_node = self.extract_canyon(temp_node,PD)
        elif PD.has_key('transform') and PD['transform'] == True:
            temp_node = self.transform(temp_node,PD)
        elif PD.has_key('straight_skeleton') and PD['straight_skeleton'] == True:
            temp_node = self.straight_skeleton(temp_node,PD)
        elif PD.has_key('interpolate_vertical') and PD['interpolate_vertical'] == True:
            temp_node = self.interpolate_vertical(temp_node,PD)
        elif PD.has_key('filter_nodes') and PD['filter_nodes'] == True:
            temp_node = self.filter_nodes(temp_node,PD)
        #Sort out the outputs
        if isList:
            lst_childs = temp_node
        else:
            lst_childs = temp_node.traverse_tree(lambda n:n,internal=False) #change this to based on inoput type
        
        
        ## Check freezing
        dead_lst_childs = filter(lambda n: n.grammar.type['freeze']==True,lst_childs)
        lst_childs = filter(lambda n:n.grammar.type['freeze']==False,lst_childs)
        
        ## Finish
        return lst_childs, dead_lst_childs
    def main_UI(self,node_in_,rule_in_,label__):
        def helper_nest_rules(label_lst_,rule_tree_):
            #Purpose: Extract rules from tree insert nest list of rule dictionaries
            B = Bula()

            #Convert tree to flat list
            #Also we will add label rules to top

            flat_lst = label_lst_
            flat_lst_ = B.ghtree2nestlist(rule_tree_,nest=False)
            flat_lst += flat_lst_

            #Convert flat list to nested list of typology rules
            nest_rdict = []
            rdict = {}#copy.deepcopy(Miru)
            for parselst in flat_lst:
                if parselst[0] != 'end_rule':
                    miru_key,miru_val = parselst[0],parselst[1]
                    rdict[miru_key] = miru_val
                else:
                    nest_rdict.append(rdict)
                    rdict = {}
            #Test
            #for i in nest_rdict:
            #    print 'bula', i['bula']
            #    print 'bula', i['bula_value_lst'][0]
            #    print '---'

            return nest_rdict
        def helper_label2rule(labelin):
            rule_ = []
            if labelin:
                rule_ = [\
                ['label_UI', True],\
                ['label', labelin],\
                ['end_rule']]
            return rule_
        def helper_main_recurse(lst_node_,rule_lst):
            #if no rules/label_rules node is just passed through
            IsFirst = True
            dead_lst_node_ = []
            
            while len(rule_lst) > 0:
                rule_ = rule_lst.pop(0)
                #apply rule to current list of nodes, get child lists flat
                lst_node_leaves, dead_leaves = self.node2grammar(lst_node_,rule_,firstUINode=IsFirst)
                if IsFirst==True:
                    IsFirst = False
                #if len(dead_leaves) > 0.001:
                dead_lst_node_.extend(dead_leaves)
                #if len(lst_node_leaves) > 0.001:
                lst_node_ = lst_node_leaves
                if len(lst_node_leaves) < 0.001:
                    break
            
            for i,ng in enumerate(lst_node_):
                if type(T) != type(ng):
                    ng = self.helper_geom2node(ng)
                    lst_node_[i] = ng
            
            return lst_node_, dead_lst_node_
        T = Tree()
        lst_node_out = []
        dead_node_out = []
        #Check inputs
        chk_input_len = False
        #if node and label are ==
        if abs(len(label__)-len(node_in_)) < 0.5:
            chk_input_len = True
        #if llabel = 1
        elif abs(len(label__)-1.) < 0.5:
            chk_input_len = True
        elif len(label__) <= 0.5:
            chk_input_len = True
        
        #Check if rule has already propogated
        for n in node_in_:
            #If loc exist, then this rule is being reset
            if type(n) == type(T) and len(n.loc) > 0.5:
                for nc in n.loc:
                    nc.delete_node()
                #n.traverse_tree(lambda n:n.delete_node(),internal=True)
                #if n.grammar.type['top'] == None:
                #    n.grammar.type['top'] = True

        if chk_input_len:
            if abs(len(label__)-1.) < 0.5 or abs(len(label__)-0.) < 0.5:
                #label is treated as a rule
                if len(label__) > 0.5:
                    label_rule_ = helper_label2rule(label__[0])
                else:
                    label_rule_ = []
                #nest rules
                nested_rule_dict = helper_nest_rules(label_rule_,rule_in_)
                #make label a rule
                #recursively create a child node derived from parent and apply a grammar rule
                lst_node_out_,dead_node_ = helper_main_recurse(node_in_,nested_rule_dict)   
            
            else:
                #print 'multiple labels'
                #Map label num to label num if multiple labels
                for lab,node_ in zip(label__,node_in_):
                    #label is treated as a rule
                    label_rule_ = helper_label2rule(lab)
                    #nest rules
                    nested_rule_dict = helper_nest_rules(label_rule_,rule_in_)
                    #make label a rule
                    #recursively create a child node derived from parent and apply a grammar rule
                    lst_node_out_,dead_node_ = helper_main_recurse([node_],nested_rule_dict)
            lst_node_out.extend(lst_node_out_)
            dead_node_out.extend(dead_node_)
            
        else:
            print 'Check the length of your inputs'
         
        
        return lst_node_out, dead_node_

if True:
    sc.sticky["Grammar"] = Grammar
# ---------- end bibil_4 ----------
geo_4 = Geometry(capex.Brep)
geo_5 = Geometry(capex_2.Brep)
geo_6 = Geometry(capex_3.Brep)

# ---- group: straight_skeleton
miru = PythonScript(perimeterZoneDepth=number_slider, step=Slider(0, range=0..4), run=Toggle(True))  # -> rule
# ---------- miru: Python ----------
"""----------------
Miru Stepback
----------------""" 
import copy
import scriptcontext as sc
import rhinoscriptsyntax as rs
import clr
Grammar = sc.sticky["Grammar"]

clr.AddReference("Grasshopper")
from Grasshopper.Kernel.Data import GH_Path
from Grasshopper import DataTree

if run:

    rule = DataTree[object]()
    rule_ = [\
    ['straight_skeleton', True],\
    ['step',step],\
    ['perimeterZoneDepth_',perimeterZoneDepth_],\
    ['grammar_key','straight_skeleton'],\
    ['end_rule']]
    
    for i, r in enumerate(rule_):
        rule.Add(r)
else:
    rule = []
# ---------- end miru ----------

miru_2 = PythonScript(perimeterZoneDepth=number_slider_2, step=Slider(0, range=0..4), run=Toggle(True))  # -> rule; same code as miru

# ----
honeybee = Honeybee_Honeybee()  # -> Vviiiiiiiiiizzz; plug-in component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
ladybug = Ladybug_Ladybug()  # -> Vviiiiiiiiiizzz; plug-in component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
splitmass = Honeybee_SplitBuildingMass(bldgMasses=geo_4, perimeterZoneDepth=number_slider, runIt=Toggle(True))  # -> readMe, splitBldgMasses; plug-in component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

# ---- group: straight_skeleton
miru_3 = PythonScript(perimeterZoneDepth=number_slider_3, step=Slider(0, range=0..4), run=Toggle(True))  # -> rule; same code as miru

# ----
honeybee_2 = Honeybee_Honeybee()  # -> Vviiiiiiiiiizzz; plug-in component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
ladybug_2 = Ladybug_Ladybug()  # -> Vviiiiiiiiiizzz; plug-in component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
splitmass_2 = Honeybee_SplitBuildingMass(bldgMasses=geo_5, perimeterZoneDepth=number_slider_2, runIt=Toggle(True))  # -> readMe, splitBldgMasses; plug-in component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
honeybee_3 = Honeybee_Honeybee()  # -> Vviiiiiiiiiizzz; plug-in component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
ladybug_3 = Ladybug_Ladybug()  # -> Vviiiiiiiiiizzz; plug-in component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
splitmass_3 = Honeybee_SplitBuildingMass(bldgMasses=geo_6, perimeterZoneDepth=number_slider_3, runIt=Toggle(True))  # -> readMe, splitBldgMasses; plug-in component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
pt = Point(Point(-431.1114305, 136.9235945, 0))
pt_2 = Point(Point(-563.9556526, 25.81200591, 0))
pt_3 = Point(Point(-431.1114305, 136.9235945, 0))
pt_4 = Point(Point(-563.9556526, 25.81200591, 0))
pt_5 = Point(Point(-431.1114305, 136.9235945, 0))
pt_6 = Point(Point(-563.9556526, 25.81200591, 0))
neg = Negative(Value=Slider(119, range=0..1000))
neg_2 = Negative(Value=Slider(119, range=0..1000))
neg_3 = Negative(Value=Slider(119, range=0..1000))

# ---- group: SHAPENODE
bibil_5 = PythonScript(rule_in=flatten(miru), node_in=flatten(geo_4), run=Toggle(True))  # -> node_out, debug; inputs rule_in: tree, node_in: list, label: list, run: Boolean
# ---------- bibil_5: Python ----------
"""
Trinco UI
"""

import scriptcontext as sc
import clr

Grammar = sc.sticky["Grammar"]
clr.AddReference("Grasshopper")
from Grasshopper.Kernel.Data import GH_Path
from Grasshopper import DataTree

ghenv.Component.Message = 'Bibil'

node_in = filter(lambda n:n!=None,node_in)
if run and node_in != []:
    if rule_in.BranchCount < 0.5:
        rule_in = DataTree[object]()
        rule_ = []
        for i, r in enumerate(rule_):
            rule_in.Add(r)
        
    G = Grammar()
    sc.sticky["debug"] = []
    debug = sc.sticky["debug"]
    node_out,node_dead = G.main_UI(node_in,rule_in,label_)
else:
    print 'Add inputs!'
# ---------- end bibil_5 ----------

# ----
vec_4 = VectorXYZ(XComponent=neg, YComponent=0, ZComponent=0)  # -> Vector, Length
move = Move(Geometry=geo, Motion=vec_4.Vector)  # -> Geometry, Transform
wires = BrepWireframe(Brep=[move.Geometry, geo], Density=-1)
preview = CustomPreview(Geometry=wires, Shader=ColourSwatch(SwatchColor=RGB(0, 0, 0)))

# ---- group: SHAPENODE
bibil_6 = PythonScript(rule_in=flatten(miru_2), node_in=flatten(geo_5), run=Toggle(True))  # -> node_out, debug; inputs rule_in: tree, node_in: list, label: list, run: Boolean; same code as bibil_5

# ----
vec2pt = Vector2Pt(PointA=pt, PointB=pt_2, Unitize=False)  # -> Vector, Length
vec_5 = VectorXYZ(XComponent=neg_2, YComponent=0, ZComponent=0)  # -> Vector, Length
move_2 = Move(Geometry=geo_2, Motion=vec_5.Vector)  # -> Geometry, Transform
wires_2 = BrepWireframe(Brep=[move_2.Geometry, geo_2], Density=-1)
preview_2 = CustomPreview(Geometry=wires_2, Shader=ColourSwatch(SwatchColor=RGB(0, 0, 0)))

# ---- group: SHAPENODE
bibil_7 = PythonScript(rule_in=flatten(miru_3), node_in=flatten(geo_6), run=Toggle(True))  # -> node_out, debug; inputs rule_in: tree, node_in: list, label: list, run: Boolean; same code as bibil_5

# ----
vec2pt_2 = Vector2Pt(PointA=pt_3, PointB=pt_4, Unitize=False)  # -> Vector, Length
vec_6 = VectorXYZ(XComponent=neg_3, YComponent=0, ZComponent=0)  # -> Vector, Length
move_3 = Move(Geometry=geo_3, Motion=vec_6.Vector)  # -> Geometry, Transform
wires_3 = BrepWireframe(Brep=[move_3.Geometry, geo_3], Density=-1)
preview_3 = CustomPreview(Geometry=wires_3, Shader=ColourSwatch(SwatchColor=RGB(0, 0, 0)))
vec2pt_3 = Vector2Pt(PointA=pt_5, PointB=pt_6, Unitize=False)  # -> Vector, Length
move_4 = Move(Geometry=splitmass.splitBldgMasses, Motion=vec_4.Vector)  # -> Geometry, Transform
move_5 = Move(Geometry=splitmass_2.splitBldgMasses, Motion=vec_5.Vector)  # -> Geometry, Transform
move_6 = Move(Geometry=splitmass_3.splitBldgMasses, Motion=vec_6.Vector)  # -> Geometry, Transform
geo_7 = Geometry(move_4.Geometry)
g = PythonScript(node=bibil_5.node_out)  # -> pt, txt; inputs node: list
# ---------- g: Python ----------
node = filter(lambda n: n!=None,node)
if node and node != []:
    pt = []
    txt = []
    for n in node:
        if n.grammar.type.has_key('idlst'):
            txt = n.grammar.type['idlst']
            pt = n.grammar.type['ptlst']
    print txt
# ---------- end g ----------
geo_8 = Geometry(bibil_5.debug)
geo_9 = Geometry(move_5.Geometry)
g_2 = PythonScript(node=bibil_6.node_out)  # -> pt, txt; inputs node: list; same code as g
geo_10 = Geometry(bibil_6.debug)
geo_11 = Geometry(move_6.Geometry)
g_3 = PythonScript(node=bibil_7.node_out)  # -> pt, txt; inputs node: list; same code as g
geo_12 = Geometry(bibil_7.debug)
tag = TextTag3D(
    Location=g.pt,
    Text=g.txt,
    Size=Slider(9, range=0..10),
    Colour=ColourSwatch(SwatchColor=RGB(255, 255, 255)),
    Justification=5)
tag_2 = TextTag3D(
    Location=g_2.pt,
    Text=g_2.txt,
    Size=Slider(9, range=0..10),
    Colour=ColourSwatch(SwatchColor=RGB(255, 255, 255)),
    Justification=5)
preview_4 = CustomPreview(Geometry=[geo_8, geo_7], Shader=ColourSwatch(SwatchColor=RGBA(0, 255, 255, 116)))
tag_3 = TextTag3D(
    Location=g_3.pt,
    Text=g_3.txt,
    Size=Slider(9, range=0..10),
    Colour=ColourSwatch(SwatchColor=RGB(255, 255, 255)),
    Justification=5)
preview_5 = CustomPreview(Geometry=[geo_10, geo_9], Shader=ColourSwatch(SwatchColor=RGBA(0, 255, 255, 116)))
preview_6 = CustomPreview(Geometry=[geo_11, geo_12], Shader=ColourSwatch(SwatchColor=RGBA(0, 255, 255, 116)))
panel = Panel(geo_8)
panel_2 = Panel(geo_10)
panel_3 = Panel(geo_12)
wires_4 = BrepWireframe(Brep=[geo_8, geo_7], Density=-1)
swatch = ColourSwatch(SwatchColor=RGB(0, 0, 0))
wires_5 = BrepWireframe(Brep=[geo_10, geo_9], Density=-1)
wires_6 = BrepWireframe(Brep=[geo_12, geo_11], Density=-1)
preview_7 = CustomPreview(Geometry=wires_4, Shader=ColourSwatch(SwatchColor=RGB(0, 0, 0)))
preview_8 = CustomPreview(Geometry=wires_5, Shader=ColourSwatch(SwatchColor=RGB(0, 0, 0)))
preview_9 = CustomPreview(Geometry=wires_6, Shader=swatch)
previewlw = CustomPreviewLineweights(Geometry=[wires_6, wires_5, wires_4], Shader=swatch, Thickness=Slider(1, range=0..10))
