# Grasshopper definition trinco_tower_twist_test.gh (Grasshopper 0.9.76)
# plug-ins: Python Interpreter

list = ValueList({"dir", "file"}, selected="dir")

# ---- group: find directory
bibil = PythonScript(
    dir=["C:\\Users\\vasanthakumars\\Documents\\GitHub\\bibil\\src", "C:\\saeran\\master\\git\\bibil\\src"],
    type=list,
    run=Toggle(True))  # -> dir; inputs dir: list
# ---------- bibil: Python ----------
import os

ghenv.Component.Params.Output[0].Name = "null"
ghenv.Component.Params.Output[0].NickName = "null"

if run:
    confirm_dir = None
    for d in dir:
        try:
            if type == "file":
                file_ = open(d)
                file_.close()
            else:
                print os.listdir(d)
            confirm_dir = d
            break
        except Exception as e:
            #print str(e)
            continue
    if confirm_dir != None:
        ghenv.Component.Params.Output[0].Name = type
        ghenv.Component.Params.Output[0].NickName = type
        dir = confirm_dir
        file = confirm_dir
null = None
# ---------- end bibil ----------

# ---- group: tree
python_script = PythonScript(i=bibil)  # -> o
# ---------- python_script: Python ----------
import os

if i:
    o = os.path.join(str(i),"bibil\\bibil_tree.py")
# ---------- end python_script ----------
file = ReadFile(File=python_script, PerLineParse=False)
bibil_2 = PythonScript(Code=file)

# ---- group: grammar
python_script_2 = PythonScript(i=bibil)  # -> o
# ---------- python_script_2: Python ----------
import os

if i:
    o = os.path.join(str(i),"bibil\\bibil_grammar.py")
# ---------- end python_script_2 ----------
file_2 = ReadFile(File=python_script_2, PerLineParse=False)
bibil_3 = PythonScript(Code=file_2)

# ---- group: shape
python_script_3 = PythonScript(i=bibil)  # -> o
# ---------- python_script_3: Python ----------
import os

if i:
    o = os.path.join(str(i),"bibil\\bibil_shape.py")
#o = os.path.join(str(i),"research\\bibil_shape_shape_3d_2d.py")
# ---------- end python_script_3 ----------
file_3 = ReadFile(File=python_script_3, PerLineParse=False)
bibil_4 = PythonScript(Code=file_3)

# ---- group: miru
python_script_4 = PythonScript(i=bibil)  # -> o
# ---------- python_script_4: Python ----------
import os

if i:
    o = os.path.join(str(i),"miru\\miru_miru.py")
# ---------- end python_script_4 ----------
file_4 = ReadFile(File=python_script_4, PerLineParse=False)
bibil_5 = PythonScript(Code=file_4)

# ---- group: bula
python_script_5 = PythonScript(i=bibil)  # -> o
# ---------- python_script_5: Python ----------
import os

if i:
    o = os.path.join(str(i),"bula\\bula_minimal.py")
# ---------- end python_script_5 ----------
file_5 = ReadFile(File=python_script_5, PerLineParse=False)
bibil_6 = PythonScript(Code=file_5)

# ---- group: UI
python_script_6 = PythonScript(i=bibil)  # -> o
# ---------- python_script_6: Python ----------
import os

if i:
    o = os.path.join(str(i),"bibil\\bibil_UI.py")
# ---------- end python_script_6 ----------
file_6 = ReadFile(File=python_script_6, PerLineParse=False)

# ---- group: grammar_divide
python_script_7 = PythonScript(i=bibil)  # -> o
# ---------- python_script_7: Python ----------
import os

if i:
    o = os.path.join(str(i),"miru\\miru_divide.py")
# ---------- end python_script_7 ----------
file_7 = ReadFile(File=python_script_7, PerLineParse=False)

# ---- group: grammar_courtyard
python_script_8 = PythonScript(i=bibil)  # -> o
# ---------- python_script_8: Python ----------
import os

if i:
    o = os.path.join(str(i),"miru\\miru_court.py")
# ---------- end python_script_8 ----------
file_8 = ReadFile(File=python_script_8, PerLineParse=False)

# ---- group: grammar_tower
python_script_9 = PythonScript(i=bibil)  # -> o
# ---------- python_script_9: Python ----------
import os

if i:
    o = os.path.join(str(i),"miru\\miru_packing.py")
# ---------- end python_script_9 ----------
file_9 = ReadFile(File=python_script_9, PerLineParse=False)

python_script_10 = PythonScript(i=bibil)  # -> o
# ---------- python_script_10: Python ----------
import os

if i:
    o = os.path.join(str(i),"miru\\miru_stepback.py")
# ---------- end python_script_10 ----------
file_10 = ReadFile(File=python_script_10, PerLineParse=False)

# ---- group: grammar_height
python_script_11 = PythonScript(i=bibil)  # -> o
# ---------- python_script_11: Python ----------
import os

if i:
    o = os.path.join(str(i),"miru\\miru_height.py")
# ---------- end python_script_11 ----------
file_11 = ReadFile(File=python_script_11, PerLineParse=False)

# ---- group: grammar_analysis_pts
python_script_12 = PythonScript(i=bibil)  # -> o
# ---------- python_script_12: Python ----------
import os

if i:
    o = os.path.join(str(i),"miru\\miru_analysis.py")
# ---------- end python_script_12 ----------
file_12 = ReadFile(File=python_script_12, PerLineParse=False)

# ---- group: meta_tree
python_script_13 = PythonScript(i=bibil)  # -> o
# ---------- python_script_13: Python ----------
import os

if i:
    o = os.path.join(str(i),"miru\\miru_meta_tree.py")
# ---------- end python_script_13 ----------
file_13 = ReadFile(File=python_script_13, PerLineParse=False)

# ---- group: land_use
python_script_14 = PythonScript(i=bibil)  # -> o
# ---------- python_script_14: Python ----------
import os

if i:
    o = os.path.join(str(i),"miru\\miru_landuse.py")
# ---------- end python_script_14 ----------
file_14 = ReadFile(File=python_script_14, PerLineParse=False)

# ---- group: shape2height
python_script_15 = PythonScript(i=bibil)  # -> o
# ---------- python_script_15: Python ----------
import os

if i:
    o = os.path.join(str(i),"miru\\miru_shape2height.py")
# ---------- end python_script_15 ----------
file_15 = ReadFile(File=python_script_15, PerLineParse=False)

# ---- group: extract_slice
python_script_16 = PythonScript(i=bibil)  # -> o
# ---------- python_script_16: Python ----------
import os

if i:
    o = os.path.join(str(i),"miru\\miru_extract_slice.py")
# ---------- end python_script_16 ----------
file_16 = ReadFile(File=python_script_16, PerLineParse=False)

# ---- group: GEOREF
# Note: Change this number with caution,
vec = Vector(Vector(-1067.339845, 1063.239109, 0))

# ---- group: CPT
# Increase bounds iterratively.
vec_2 = Vector(Vector(-546071.5172, 3981810.795, 0))

# ---- group: A=pt2move2
subtraction = Subtraction(A=vec_2, B=vec)

# ----
geo = Geometry([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])
move = Move(Geometry=geo, Motion=subtraction)  # -> Geometry, Transform
geo_2 = Geometry(move.Geometry)
list_2 = ValueList({"divide by depth": "subdivide_depth", "divide by same depth": "subdivide_depth_same", "divide by dim": "subdivide_dim"}, selected="divide by same depth")
list_3 = ValueList({"YZ": "NS", "XZ": "EW", "XY": "Z"}, selected="XZ")

# ---- group: DIVIDE
miru = PythonScript(
    Code=file_7,
    Divide_num=Slider(1, range=0..10),
    Divide_cut=Slider(0, range=0..100),
    Divide_type=list_2,
    Divide_ratio=Slider(0.5, range=0..1),
    Axis=list_3,
    Run=Toggle(False))

# ---- group: COURTYARD
miru_2 = PythonScript(Code=file_8, Width=Slider(7, range=0..100), Court_ref="-1", Run=Toggle(False))

# ----
number_slider = Slider(1, range=0..1)
panel = Panel("""7.5:1.5
25.5:3.0""")

# ---- group: SETBACK
miru_3 = PythonScript(Code=file_10, Height_stepback=panel, Run=Toggle(True))

# ---- group: HEIGHT
miru_4 = PythonScript(Code=file_11, Height=Slider(28.5, range=0..100), Run=Toggle(True))

# ----
geo_3 = Geometry(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)
geo_4 = Geometry(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)

# ---- group: SHAPENODE
bibil_7 = PythonScript(Code=file_6, Rule_in=flatten([miru_4, miru_3]), Node_in=flatten(geo_3), Label_="base", Run=Toggle(True))  # -> Node_out, Debug

# ----
g = PythonScript(node=bibil_7.Node_out)  # -> geom; inputs node: list
# ---------- g: Python ----------
node = filter(lambda n: n!=None,node)
if node and node != []:
    geom = []
    for n in node:
        if n.shape.z_dist < 1.2:
            geom.append(n.shape.bottom_crv)
        else:
            geom.append(n.shape.geom)
    print geom
# ---------- end g ----------
g_2 = PythonScript(node=bibil_7.Node_out)  # -> label; inputs node: list
# ---------- g_2: Python ----------
node = filter(lambda n: n!=None,node)
if node and node != []:
    label = []
    if True:#for i,n in enumerate(node):
        #print i
        root = node[0].get_root()
        L = root.traverse_tree(lambda n:n,internal=True) 
        for i in L:
            print i
            label.append(i)
        #label.append('--')
        #print '---'
# ---------- end g_2 ----------
panel_2 = Panel(g_2)
material = CreateMaterial(
    Diffuse=ColourSwatch(SwatchColor=RGB(255, 255, 255)),
    Specular=RGB(255, 255, 255),
    Emission=RGB(0, 0, 0),
    Transparency=Slider(0.6, range=0..1),
    Shine=0)
preview = CustomPreview(Geometry=g, Shader=material)
list_4 = ValueList({"divide by depth": "subdivide_depth", "divide by same depth": "subdivide_depth_same", "divide by dim": "subdivide_dim"}, selected="divide by same depth")
list_5 = ValueList({"YZ": "NS", "XZ": "EW", "XY": "Z"}, selected="XZ")

# ---- group: DIVIDE
miru_5 = PythonScript(
    Code=file_7,
    Divide_num=Slider(1, range=0..10),
    Divide_cut=Slider(0, range=0..100),
    Divide_type=list_4,
    Divide_ratio=Slider(0.5, range=0..1),
    Axis=list_5,
    Run=Toggle(False))

# ---- group: PACKING
separatedata = Ladybug_SeparateData(Code=file_9, X_keep_omit="27.0,25.0", Y_keep_omit="27.0,25.0", Run=Toggle(True))

# ---- group: EXTRACT_SLICE
miru_6 = PythonScript(Code=file_16, Run=Toggle(True))

# ---- group: SHAPENODE
bibil_8 = PythonScript(
    Code=file_6,
    Rule_in=flatten([miru_6, separatedata, miru_5]),
    Node_in=flatten(bibil_7.Node_out),
    Label_="topo",
    Run=Toggle(True))  # -> Node_out, Debug

# ----
g_3 = PythonScript(node=bibil_8.Node_out)  # -> geom; inputs node: list; same code as g
g_4 = PythonScript(node=bibil_8.Node_out)  # -> label; inputs node: list
# ---------- g_4: Python ----------
node = filter(lambda n: n!=None,node)
if node and node != []:
    label = []
    debug = []
    if True:
        root = node[0].get_root()
        L = root.traverse_tree(lambda n:n,internal=True) 
        for index,i in enumerate(L):
            print index
            print 'depth', i.depth
            try:
                print i
                label.append(i)
                debug.append(i.shape.geom)
            except:
                pass
# ---------- end g_4 ----------
panel_3 = Panel(g_4)

number_slider_2 = Slider(100, range=0..100)  # disabled
number_slider_3 = Slider(150, range=0..1000)  # disabled
toggle = BooleanToggle(True)  # disabled
toggle_2 = BooleanToggle(True)  # disabled
panel_4 = Panel("shape4example")  # disabled
toggle_3 = BooleanToggle(True)  # disabled
number_slider_4 = Slider(0.6, range=0..1)  # disabled
swatch = ColourSwatch(SwatchColor=RGB(255, 255, 255))  # disabled
material_2 = CreateMaterial(Diffuse=swatch, Specular=RGB(255, 255, 255), Emission=RGB(0, 0, 0), Transparency=number_slider_4, Shine=0)  # disabled
Z = UnitZ(Factor=1)  # disabled

# ---- group: HEIGHT
miru_7 = PythonScript(Code=file_11, Height=number_slider_3, Run=toggle)  # disabled

# ---- group: SHAPE2HEIGHT
miru_8 = PythonScript(Code=file_15, Run=toggle_2)  # disabled

# ---- group: SHAPENODE
bibil_9 = PythonScript(Code=file_6, Rule_in=flatten([miru_7, miru_8]), Node_in=flatten(bibil_8.Node_out), Label_=panel_4, Run=toggle_3)  # -> Node_out, Debug; disabled

# ----
g_5 = PythonScript(node=bibil_9.Node_out)  # -> geom; inputs node: list; disabled; same code as g
g_6 = PythonScript(node=bibil_9.Node_out)  # -> label; inputs node: list; disabled; same code as g_2
boundary = BoundarySurfaces(Edges=g_5)  # disabled
extr = Extrude(Base=boundary, Direction=Z)  # disabled
sunion = SolidUnion(Breps=extr)  # disabled
fmerge = MergeFaces(Brep=sunion)  # -> Breps, Before, After; disabled
preview_2 = CustomPreview(Geometry=fmerge.Breps, Shader=material_2)  # disabled
panel_5 = Panel(g_6)  # disabled
