# Grasshopper definition trinco_tower_twist_test_11.gh (Grasshopper 0.9.76)
# plug-ins: Python Interpreter

list = ValueList({"dir", "file"}, selected="dir")

# ---- group: find directory
bibil = PythonScript(
    dir=["C:\\Users\\vasanthakumars\\Documents\\GitHub\\bibil\\src", "C:\\saeran\\master\\git\\bibil\\src"],
    type=list,
    run=Toggle(True))  # -> dir; inputs dir: list
# ---------- bibil: Python ----------
import os
import sys

ghenv.Component.Params.Output[0].Name = "null"
ghenv.Component.Params.Output[0].NickName = "null"

#sys.path.append("C:\Program Files\Rhinoceros 5.0 (64-bit)\System")

if run:
    confirm_dir = None
    for d in dir:
        try:
            if type == "file":
                file_ = open(d)
                file_.close()
            else:
                print os.listdir(d)
            confirm_dir = d
            break
        except Exception as e:
            #print str(e)
            continue
    if confirm_dir != None:
        ghenv.Component.Params.Output[0].Name = type
        ghenv.Component.Params.Output[0].NickName = type
        dir = confirm_dir
        file = confirm_dir
null = None
# ---------- end bibil ----------

# ---- group: node_bucket
python_script = PythonScript(i=bibil)  # -> o
# ---------- python_script: Python ----------
import os

if i:
    o = os.path.join(str(i),"miru\\miru_shape_bucket.py")
# ---------- end python_script ----------
file = ReadFile(File=python_script, PerLineParse=False)

# ---- group: tree
python_script_2 = PythonScript(i=bibil)  # -> o
# ---------- python_script_2: Python ----------
import os

if i:
    o = os.path.join(str(i),"bibil\\bibil_tree.py")
# ---------- end python_script_2 ----------
file_2 = ReadFile(File=python_script_2, PerLineParse=False)
bibil_2 = PythonScript(Code=file_2)

# ---- group: grammar
python_script_3 = PythonScript(i=bibil)  # -> o
# ---------- python_script_3: Python ----------
import os

if i:
    o = os.path.join(str(i),"bibil\\bibil_grammar.py")
# ---------- end python_script_3 ----------
file_3 = ReadFile(File=python_script_3, PerLineParse=False)
bibil_3 = PythonScript(Code=file_3)

# ---- group: shape
python_script_4 = PythonScript(i=bibil)  # -> o
# ---------- python_script_4: Python ----------
import os

if i:
    o = os.path.join(str(i),"bibil\\bibil_shape.py")
#o = os.path.join(str(i),"research\\bibil_shape_shape_3d_2d.py")
# ---------- end python_script_4 ----------
file_4 = ReadFile(File=python_script_4, PerLineParse=False)
bibil_4 = PythonScript(Code=file_4)

# ---- group: bula
python_script_5 = PythonScript(i=bibil)  # -> o
# ---------- python_script_5: Python ----------
import os

if i:
    o = os.path.join(str(i),"bula\\bula_minimal.py")
# ---------- end python_script_5 ----------
file_5 = ReadFile(File=python_script_5, PerLineParse=False)
bibil_5 = PythonScript(Code=file_5)

# ---- group: UI
python_script_6 = PythonScript(i=bibil)  # -> o
# ---------- python_script_6: Python ----------
import os

if i:
    o = os.path.join(str(i),"bibil\\bibil_UI.py")
# ---------- end python_script_6 ----------
file_6 = ReadFile(File=python_script_6, PerLineParse=False)

# ---- group: grammar_divide
python_script_7 = PythonScript(i=bibil)  # -> o
# ---------- python_script_7: Python ----------
import os

if i:
    o = os.path.join(str(i),"miru\\miru_divide.py")
# ---------- end python_script_7 ----------
file_7 = ReadFile(File=python_script_7, PerLineParse=False)

# ---- group: grammar_courtyard
python_script_8 = PythonScript(i=bibil)  # -> o
# ---------- python_script_8: Python ----------
import os

if i:
    o = os.path.join(str(i),"miru\\miru_court.py")
# ---------- end python_script_8 ----------
file_8 = ReadFile(File=python_script_8, PerLineParse=False)

# ---- group: grammar_tower
python_script_9 = PythonScript(i=bibil)  # -> o
# ---------- python_script_9: Python ----------
import os

if i:
    o = os.path.join(str(i),"miru\\miru_packing.py")
# ---------- end python_script_9 ----------
file_9 = ReadFile(File=python_script_9, PerLineParse=False)

# ---- group: stepback
python_script_10 = PythonScript(i=bibil)  # -> o
# ---------- python_script_10: Python ----------
import os

if i:
    o = os.path.join(str(i),"miru\\miru_stepback.py")
# ---------- end python_script_10 ----------
file_10 = ReadFile(File=python_script_10, PerLineParse=False)

# ---- group: grammar_height
python_script_11 = PythonScript(i=bibil)  # -> o
# ---------- python_script_11: Python ----------
import os

if i:
    o = os.path.join(str(i),"miru\\miru_height.py")
# ---------- end python_script_11 ----------
file_11 = ReadFile(File=python_script_11, PerLineParse=False)

# ---- group: grammar_analysis_pts
python_script_12 = PythonScript(i=bibil)  # -> o
# ---------- python_script_12: Python ----------
import os

if i:
    o = os.path.join(str(i),"miru\\miru_analysis.py")
# ---------- end python_script_12 ----------
file_12 = ReadFile(File=python_script_12, PerLineParse=False)

# ---- group: meta_tree
python_script_13 = PythonScript(i=bibil)  # -> o
# ---------- python_script_13: Python ----------
import os

if i:
    o = os.path.join(str(i),"miru\\miru_meta_tree.py")
# ---------- end python_script_13 ----------
file_13 = ReadFile(File=python_script_13, PerLineParse=False)

# ---- group: land_use
python_script_14 = PythonScript(i=bibil)  # -> o
# ---------- python_script_14: Python ----------
import os

if i:
    o = os.path.join(str(i),"miru\\miru_landuse.py")
# ---------- end python_script_14 ----------
file_14 = ReadFile(File=python_script_14, PerLineParse=False)

# ---- group: shape2height
python_script_15 = PythonScript(i=bibil)  # -> o
# ---------- python_script_15: Python ----------
import os

if i:
    o = os.path.join(str(i),"miru\\miru_shape2height.py")
# ---------- end python_script_15 ----------
file_15 = ReadFile(File=python_script_15, PerLineParse=False)

# ---- group: extract_slice
python_script_16 = PythonScript(i=bibil)  # -> o
# ---------- python_script_16: Python ----------
import os

if i:
    o = os.path.join(str(i),"miru\\miru_extract_slice.py")
# ---------- end python_script_16 ----------
file_16 = ReadFile(File=python_script_16, PerLineParse=False)

# ----
list_2 = ValueList({"divide by depth": "subdivide_depth", "divide by same depth": "subdivide_depth_same", "divide by dim": "subdivide_dim"}, selected="divide by same depth")
list_3 = ValueList({"YZ": "NS", "XZ": "EW", "XY": "Z"}, selected="XZ")

# ---- group: ENERGY_MODEL_BUCKET
miru = PythonScript(Code=file, Run=Toggle(True))

# ---- group: SETBACK
miru_2 = PythonScript(Code=file_10, Height_stepback="22.5:6.0", Run=Toggle(False))

# ---- group: PACKING
separatedata = Ladybug_SeparateData(Code=file_9, X_keep_omit="27.0,25.0", Y_keep_omit="27.0,25.0", Seperation_ref="-1", Run=Toggle(True))

# ---- group: EXTRACT_SLICE
miru_3 = PythonScript(Code=file_16, Run=Toggle(False))

# ---- group: DIVIDE
miru_4 = PythonScript(
    Code=file_7,
    Divide_num=Slider(2, range=0..10),
    Divide_cut=Slider(0, range=0..100),
    Divide_type=list_2,
    Divide_ratio=Slider(0.5, range=0..1),
    Axis=list_3,
    Run=Toggle(False))

# ---- group: PERIMETER
miru_5 = PythonScript(Code=file_8, Width=Slider(20, range=0..100), Cut_width=Slider(0, range=0..100), Court_ref="0", Run=Toggle(False))

# ---- group: HEIGHT
miru_6 = PythonScript(Code=file_11, Height=Slider(16.5, range=0..100), Run=Toggle(True))

# ---- group: TREE RULES
miru_7 = PythonScript(Code=file_13, Run=Toggle(False))

# ---- group: SHAPE2HEIGHT
miru_8 = PythonScript(Code=file_15, Run=Toggle(False))

# ---- group: cutting obj
geo = Geometry([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])

# ---- group: d10
geo_2 = Geometry([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])

# ---- group: d08
geo_3 = Geometry([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])

# ---- group: d06
geo_4 = Geometry([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])

# ---- group: d04
geo_5 = Geometry([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])

# ---- group: d02
geo_6 = Geometry([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])

# ----
bibil_6 = PythonScript(Code=file_6, Node_in=flatten(geo_5), Label_="d04", Run=Toggle(True))  # -> Node_out, Debug
bibil_7 = PythonScript(Code=file_6, Node_in=flatten(geo_6), Label_="d02", Run=Toggle(False))  # -> Node_out, Debug
bibil_8 = PythonScript(Code=file_6, Node_in=flatten(geo_2), Label_="d10", Run=Toggle(False))  # -> Node_out, Debug
bibil_9 = PythonScript(Code=file_6, Node_in=flatten(geo_4), Label_="d06", Run=Toggle(True))  # -> Node_out, Debug

# ----
# REF CRVS
geo_7 = Geometry([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])

bibil_10 = PythonScript(Code=file_6, Node_in=flatten(geo_3), Label_="d08", Run=Toggle(False))  # -> Node_out, Debug
geo_8 = Geometry([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])
geo_9 = Geometry([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])
genes = GenePool(
    Decimals=6,
    Maximum=10,
    Minimum=-10,
    Value=[0.2287688134, 0.7908089989, -0.105366, 0.03131954847, -0.02291627016, -0.004920398686, -0.01189700341, 0.1267319744, -0.05650187277])
python = PythonScript(
    reslst=geo_8,
    comlst=geo_9,
    init_nodes=[bibil_6.Node_out, bibil_9.Node_out],
    demand_index=Slider(0, range=0..4),
    var_index=Slider(0, range=0..11),
    run=Toggle(True))  # -> hi_res, hi_com, midhi_res, midlo_res, midhi_com, midlo_com, lo_res, lo_com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; inputs reslst: list, comlst: list, init_nodes: list, demand_index: Int32, var_index: Int32
# ---------- python: Python ----------
import random
import scriptcontext as sc
import Rhino as rc
import rhinoscriptsyntax as rs

Bula = sc.sticky['Bula']
Grammar = sc.sticky['Grammar']
sc.sticky['GLOBAL_COLLISION_LIST'] = []

def set_density(parcel):
    #This should be part of the mapping function in Bula
    lo,mid1,mid2,hi = [],[],[],[]
    MIN_HI_DIST = 45.0
    MIN_MID_DIST = 24.0
    for i,p in enumerate(parcel):
        x_dist = p.shape.x_dist
        y_dist = p.shape.y_dist
        demand_ = p.shape.ht
        #print i,': ', round(demand_,2)
        # HIRISE
        if demand_ > 31.5 and x_dist > MIN_HI_DIST and y_dist > MIN_HI_DIST:
            hi.append(p)
        # MIDRISE
        elif demand_ > 7.5 and x_dist > MIN_MID_DIST and y_dist > MIN_MID_DIST:
            if demand_ > 22.5:
                mid2.append(p)
            else:
                mid1.append(p)
        # LOWRISE
        else:
            #lowrise
            lo.append(p)
    print '---'
    return hi,mid2,mid1,lo

def parcel_by_zone(parcel_,zone_):
    #debug = sc.sticky['debug']
    L = []
    cpt = parcel_.shape.cpt
    for j in xrange(len(zone_)):
        zonecrv = zone_[j]
        #debug.append(zonecrv)
        IsIn = rs.PointInPlanarClosedCurve(cpt,zonecrv)
        if IsIn>0.5:
            IsDefined = True
            #debug.append(parcel)
            L.append(parcel)
            break
    return L


def normalize_all_heights(raw_nodes):
    D={}
    max = raw_nodes[0].shape.ht
    min = raw_nodes[0].shape.ht
    htlst = []
    for i in xrange(len(raw_nodes)):
        ht = raw_nodes[i].shape.ht
        if ht>max:
            max = ht
        if ht<min:
            min = ht
        htlst.append(ht)
    #max and min heights
    normlst = B.normalize_list(htlst,191.5,4.5)
    map(lambda nh: nh[0].shape.op_extrude(nh[1]),zip(raw_nodes,normlst))
    
    return raw_nodes
    
if run:
    B = Bula()
    G = Grammar()
    norm_nodes = normalize_all_heights(init_nodes)
    bucket_dict = {"apply2list":True, "keys2bucket":["label"],\
                    "fx2bucket":"lambda n:n.grammar.type['label']"}
    bucketed_lst = G.bucket_shape(norm_nodes,bucket_dict)
    nodelst = bucketed_lst[0]#['label']
    print nodelst
    #nodelst.sort(key=lambda lst:lst[0].grammar.type['label'])
    #parcels = nestedbylabel[demand_index]
    
"""
    res,com = [],[]
    
    lst_res_zone = reslst
    lst_com_zone = comlst
    
    for i in xrange(len(parcels)):
        parcel = parcels[i]
        res += parcel_by_zone(parcel,lst_res_zone)
        com += parcel_by_zone(parcel,lst_com_zone)


if run:
    ###
    steplst = map(lambda i: i*1.5,range(1,4))
    seplst = map(lambda i:20+(2.5*i),range(1,5))
    
    
    indexnum = len(steplst)*len(seplst)
    #print indexnum
    #print len(demand)
    
    count = 0
    L = []
    #for dem in demandlst:
    stp = [steplst[0]]
    sep = [seplst[0]]
    #for stp in steplst:
    #    for sep in seplst:
    
    hir_,mdr_2,mdr_1,lor_,hic_,mdc_2,mdc_1,loc_ = [],[],[],[],[],[],[],[]
    #print 'res'
    hir_,mdr_2,mdr_1,lor_ = set_density(res)
    #print 'com'
    hic_,mdc_2,mdc_1,loc_ = set_density(com)
    L.append((stp,sep,None,hir_,hic_,mdr_2,mdc_2,mdr_1,mdc_1,lor_,loc_))
                
    #print count
    index = var_index
    var_a = L[index][0]
    var_b = L[index][1]
    var_c = L[index][2]
    
    hi_res = L[index][3]
    hi_com = L[index][4]
    midhi_res = L[index][5]
    midhi_com = L[index][6]
    midlo_res = L[index][7]
    midlo_com = L[index][8]
    lo_res = L[index][9]
    lo_com = L[index][10]
    #print lo_com
    print "variables: ", var_a, var_b, var_c
"""
# ---------- end python ----------

# ---- group: GLOBAL COLLISION
python_2 = PythonScript(reset=Toggle(True))  # -> o
# ---------- python_2: Python ----------
import scriptcontext as sc

if reset: sc.sticky['GLOBAL_COLLISION_LIST'] = []

o = sc.sticky['GLOBAL_COLLISION_LIST']
print o
# ---------- end python_2 ----------

# ----
panel = Panel(python_2)
g = PythonScript(node=[python.midhi_res, python.midlo_res, python.lo_res, python.hi_res])  # -> geom; inputs node: list
# ---------- g: Python ----------
node = filter(lambda n: n!=None,node)
if node and node != []:
    geom = []
    for n in node:
        geom.append(n.shape.geom)
    print geom
# ---------- end g ----------
g_2 = PythonScript(node=[python.hi_com, python.lo_com, python.midhi_com, python.midlo_com])  # -> geom; inputs node: list; same code as g
data = Data(python.var_a)
data_2 = Data(python.var_b)
data_3 = Data(python.var_c)
geo_10 = Geometry([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])
geo_11 = Geometry([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])

# ----
# STREETS
number_slider = Slider(33, range=0..100)
geo_12 = Geometry(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)

# ----
# AVENUES
number_slider_2 = Slider(25, range=0..100)
geo_13 = Geometry([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])

# ---- group: META-RES
bibil_11 = PythonScript(Code=file_6, Node_in=flatten(geo_11), Label_="ResRoot", Run=Toggle(True))  # -> Node_out, Debug

bibil_12 = PythonScript(Code=file_6, Node_in=flatten(geo_10), Label_="ComRoot", Run=Toggle(True))  # -> Node_out, Debug

# ----
panel_2 = Panel("""13.5:3.0
19.5:6.0""")
panel_3 = Panel("0.0>0.0:-3.0>3.0")
panel_4 = Panel("""7.5:9.0
13.5:15.0""")
miru_9 = PythonScript(
    Code=file_10,
    Height_stepback=panel_4,
    Stepback_ref=geo_12,
    Stepback_tol=number_slider,
    From_rear=Toggle(True),
    Run=Toggle(False))

# ----
# MID COMMERCIAL
# PODIUM
toggle = BooleanToggle(True)
# HIGH RESIDENTIAL
# PODIUM
toggle_2 = BooleanToggle(True)

# ---- group: SETBACK
miru_10 = PythonScript(Code=file_10, Height_stepback="22.5:6.0", Stepback_ref="0", Stepback_tol=number_slider, Run=Toggle(True))

miru_11 = PythonScript(Code=file_10, Height_stepback="22.5:6.0", Stepback_ref=geo_13, Stepback_tol=number_slider_2, Run=Toggle(False))

miru_12 = PythonScript(Code=file_10, Height_stepback="13.5:3.0", Stepback_ref=geo_12, Stepback_tol=number_slider, Run=Toggle(True))

miru_13 = PythonScript(Code=file_10, Height_stepback=panel_2, Stepback_ref=geo_12, Stepback_tol=number_slider, Run=Toggle(True))

miru_14 = PythonScript(Code=file_10, Height_stepback="19.5:3.0", Stepback_ref=geo_13, Stepback_tol=number_slider_2, Run=Toggle(True))

# ---- group: PERIMETER
miru_15 = PythonScript(Code=file_8, Width=Slider(34, range=0..100), Cut_width=Slider(0, range=0..100), Court_ref="0", Run=Toggle(True))

# ---- group: HEIGHT
miru_16 = PythonScript(Code=file_11, Height=Slider(28.5, range=0..100), Run=Toggle(True))

miru_17 = PythonScript(Code=file_11, Height=Slider(28.5, range=0..100), Randomize="-6.0>6.0", Run=Toggle(True))

# ---- group: TREE RULES
miru_18 = PythonScript(Code=file_13, Node=bibil_11.Node_out, Run=toggle_2)

miru_19 = PythonScript(Code=file_13, Node=bibil_12.Node_out, Run=toggle)

# ----
geo_14 = Geometry([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])
geo_15 = Geometry([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])
geo_16 = Geometry([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])
geo_17 = Geometry([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])
panel_5 = Panel("""13.5:3.0
19.5:6.0""")
panel_6 = Panel("""13.5:3.0
19.5:6.0""")

# ---- group: SHAPENODE
bibil_13 = PythonScript(
    Code=file_6,
    Rule_in=flatten([miru_18, miru_15, miru_16, miru_12, miru_10, miru_11]),
    Node_in=flatten(geo_14),
    Label_="HiRes",
    Run=Toggle(True))  # -> Node_out, Debug

# ----
toggle_3 = BooleanToggle(True)
panel_7 = Panel("""7.5:9.0
13.5:15.0""")
geo_18 = Geometry(<curve referenced from the Rhino model>)
geo_19 = Geometry(<curve referenced from the Rhino model>)

# ---- group: SHAPENODE
bibil_14 = PythonScript(
    Code=file_6,
    Rule_in=flatten([miru_19, miru_17, miru_13, miru_9, miru_14]),
    Node_in=flatten(geo_16),
    Label_="MidComm",
    Run=Toggle(True))  # -> Node_out, Debug

# ----
miru_20 = PythonScript(Code=file_10, Height_stepback=panel_5, Stepback_ref=geo_18, Stepback_tol=number_slider_2, Run=Toggle(True))
miru_21 = PythonScript(
    Code=file_10,
    Height_stepback=panel_6,
    Stepback_ref=geo_19,
    Stepback_tol=number_slider_2,
    From_rear=toggle_3,
    Run=toggle_3)

# ---- group: HEIGHT
miru_22 = PythonScript(Code=file_11, Height=Slider(44.4, range=0..100), Run=Toggle(True))

# ----
g_3 = PythonScript(node=bibil_13.Node_out)  # -> geom; inputs node: list
# ---------- g_3: Python ----------
node = filter(lambda n: n!=None,node)
if node and node != []:
    geom = []
    for n in node:
        if n.shape.z_dist < 1.2:
            geom.append(n.shape.bottom_crv)
        else:
            geom.append(n.shape.geom)
    print geom
# ---------- end g_3 ----------
g_4 = PythonScript(node=bibil_14.Node_out)  # -> geom; inputs node: list; same code as g_3
geo_20 = Geometry(bibil_14.Debug)
geo_21 = Geometry(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)
geo_22 = Geometry([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])

# ---- group: SHAPENODE
bibil_15 = PythonScript(Code=file_6, Rule_in=flatten([miru_22, miru_21, miru_20]), Node_in=flatten(geo_21), Label_="HiRes", Run=Toggle(False))  # -> Node_out, Debug

# ----
g_5 = PythonScript(node=bibil_15.Node_out)  # -> geom; inputs node: list; same code as g_3
# TOWERS
toggle_4 = BooleanToggle(True)

# ---- group: PACKING
separatedata_2 = Ladybug_SeparateData(Code=file_9, X_keep_omit="27.0,20.0", Y_keep_omit="27.0,20.0", Seperation_ref="-1", Run=Toggle(True))

# ---- group: EXTRACT_SLICE
miru_23 = PythonScript(Code=file_16, Run=toggle_4)

# ---- group: HEIGHT
miru_24 = PythonScript(Code=file_11, Height_ref="HiRes", Run=Toggle(True))

# ---- group: SHAPENODE
bibil_16 = PythonScript(Code=file_6, Rule_in=flatten([miru_23, separatedata_2, miru_24]), Node_in=flatten(bibil_13.Node_out), Run=Toggle(True))  # -> Node_out, Debug

# ----
g_6 = PythonScript(node=bibil_16.Node_out)  # -> geom; inputs node: list
# ---------- g_6: Python ----------
node = filter(lambda n: n!=None,node)
if node and node != []:
    geom = []
    for n in node:
        #print n.shape.z_dist
        if n.shape.z_dist > 9.:
            geom.append(n.shape.geom)
    print geom
# ---------- end g_6 ----------
geo_23 = Geometry(bibil_16.Debug)
geo_24 = Geometry([g_3, g_6, g_4])
material = CreateMaterial(
    Diffuse=ColourSwatch(SwatchColor=RGB(129, 255, 255)),
    Specular=RGB(255, 255, 255),
    Emission=RGB(0, 0, 0),
    Transparency=Slider(0, range=0..1),
    Shine=0)
mesh = Mesh(geo_24)
preview = CustomPreview(Geometry=mesh, Shader=material)
