# Grasshopper definition trinco_tower_twist_test_13.gh (Grasshopper 0.9.76)
# plug-ins: Python Interpreter, Octopus

list = ValueList({"dir", "file"}, selected="dir")

# ---- group: find directory
bibil = PythonScript(
    dir=["C:\\Users\\vasanthakumars\\Documents\\GitHub\\bibil\\src", "C:\\saeran\\master\\git\\bibil\\src"],
    type=list,
    run=Toggle(True))  # -> dir; inputs dir: list
# ---------- bibil: Python ----------
import os
import sys

ghenv.Component.Params.Output[0].Name = "null"
ghenv.Component.Params.Output[0].NickName = "null"

#sys.path.append("C:\Program Files\Rhinoceros 5.0 (64-bit)\System")

if run:
    confirm_dir = None
    for d in dir:
        try:
            if type == "file":
                file_ = open(d)
                file_.close()
            else:
                print os.listdir(d)
            confirm_dir = d
            break
        except Exception as e:
            #print str(e)
            continue
    if confirm_dir != None:
        ghenv.Component.Params.Output[0].Name = type
        ghenv.Component.Params.Output[0].NickName = type
        dir = confirm_dir
        file = confirm_dir
null = None
# ---------- end bibil ----------

# ---- group: node_bucket
python_script = PythonScript(i=bibil)  # -> o
# ---------- python_script: Python ----------
import os

if i:
    o = os.path.join(str(i),"miru\\miru_shape_bucket.py")
# ---------- end python_script ----------
file = ReadFile(File=python_script, PerLineParse=False)

# ---- group: collision
python_script_2 = PythonScript(i=bibil)  # -> o
# ---------- python_script_2: Python ----------
import os

if i:
    o = os.path.join(str(i),"miru\\miru_collision_detection.py")
# ---------- end python_script_2 ----------
file_2 = ReadFile(File=python_script_2, PerLineParse=False)

# ---- group: tree
python_script_3 = PythonScript(i=bibil)  # -> o
# ---------- python_script_3: Python ----------
import os

if i:
    o = os.path.join(str(i),"bibil\\bibil_tree.py")
# ---------- end python_script_3 ----------
file_3 = ReadFile(File=python_script_3, PerLineParse=False)
bibil_2 = PythonScript(Code=file_3)

# ---- group: grammar
python_script_4 = PythonScript(i=bibil)  # -> o
# ---------- python_script_4: Python ----------
import os

if i:
    o = os.path.join(str(i),"bibil\\bibil_grammar.py")
# ---------- end python_script_4 ----------
file_4 = ReadFile(File=python_script_4, PerLineParse=False)
bibil_3 = PythonScript(Code=file_4)

# ---- group: shape
python_script_5 = PythonScript(i=bibil)  # -> o
# ---------- python_script_5: Python ----------
import os

if i:
    o = os.path.join(str(i),"bibil\\bibil_shape.py")
#o = os.path.join(str(i),"research\\bibil_shape_shape_3d_2d.py")
# ---------- end python_script_5 ----------
file_5 = ReadFile(File=python_script_5, PerLineParse=False)
bibil_4 = PythonScript(Code=file_5)

# ---- group: bula
python_script_6 = PythonScript(i=bibil)  # -> o
# ---------- python_script_6: Python ----------
import os

if i:
    o = os.path.join(str(i),"bula\\bula_minimal.py")
# ---------- end python_script_6 ----------
file_6 = ReadFile(File=python_script_6, PerLineParse=False)
bibil_5 = PythonScript(Code=file_6)

# ---- group: UI
python_script_7 = PythonScript(i=bibil)  # -> o
# ---------- python_script_7: Python ----------
import os

if i:
    o = os.path.join(str(i),"bibil\\bibil_UI.py")
# ---------- end python_script_7 ----------
file_7 = ReadFile(File=python_script_7, PerLineParse=False)

# ---- group: grammar_divide
python_script_8 = PythonScript(i=bibil)  # -> o
# ---------- python_script_8: Python ----------
import os

if i:
    o = os.path.join(str(i),"miru\\miru_divide.py")
# ---------- end python_script_8 ----------
file_8 = ReadFile(File=python_script_8, PerLineParse=False)

# ---- group: grammar_courtyard
python_script_9 = PythonScript(i=bibil)  # -> o
# ---------- python_script_9: Python ----------
import os

if i:
    o = os.path.join(str(i),"miru\\miru_court.py")
# ---------- end python_script_9 ----------
file_9 = ReadFile(File=python_script_9, PerLineParse=False)

# ---- group: grammar_tower
python_script_10 = PythonScript(i=bibil)  # -> o
# ---------- python_script_10: Python ----------
import os

if i:
    o = os.path.join(str(i),"miru\\miru_packing.py")
# ---------- end python_script_10 ----------
file_10 = ReadFile(File=python_script_10, PerLineParse=False)

# ---- group: stepback
python_script_11 = PythonScript(i=bibil)  # -> o
# ---------- python_script_11: Python ----------
import os

if i:
    o = os.path.join(str(i),"miru\\miru_stepback.py")
# ---------- end python_script_11 ----------
file_11 = ReadFile(File=python_script_11, PerLineParse=False)

# ---- group: grammar_height
python_script_12 = PythonScript(i=bibil)  # -> o
# ---------- python_script_12: Python ----------
import os

if i:
    o = os.path.join(str(i),"miru\\miru_height.py")
# ---------- end python_script_12 ----------
file_12 = ReadFile(File=python_script_12, PerLineParse=False)

# ---- group: grammar_analysis_pts
python_script_13 = PythonScript(i=bibil)  # -> o
# ---------- python_script_13: Python ----------
import os

if i:
    o = os.path.join(str(i),"miru\\miru_analysis.py")
# ---------- end python_script_13 ----------
file_13 = ReadFile(File=python_script_13, PerLineParse=False)

# ---- group: meta_tree
python_script_14 = PythonScript(i=bibil)  # -> o
# ---------- python_script_14: Python ----------
import os

if i:
    o = os.path.join(str(i),"miru\\miru_meta_tree.py")
# ---------- end python_script_14 ----------
file_14 = ReadFile(File=python_script_14, PerLineParse=False)

# ---- group: land_use
python_script_15 = PythonScript(i=bibil)  # -> o
# ---------- python_script_15: Python ----------
import os

if i:
    o = os.path.join(str(i),"miru\\miru_landuse.py")
# ---------- end python_script_15 ----------
file_15 = ReadFile(File=python_script_15, PerLineParse=False)

# ---- group: shape2height
python_script_16 = PythonScript(i=bibil)  # -> o
# ---------- python_script_16: Python ----------
import os

if i:
    o = os.path.join(str(i),"miru\\miru_shape2height.py")
# ---------- end python_script_16 ----------
file_16 = ReadFile(File=python_script_16, PerLineParse=False)

# ---- group: extract_slice
python_script_17 = PythonScript(i=bibil)  # -> o
# ---------- python_script_17: Python ----------
import os

if i:
    o = os.path.join(str(i),"miru\\miru_extract_slice.py")
# ---------- end python_script_17 ----------
file_17 = ReadFile(File=python_script_17, PerLineParse=False)

# ----
list_2 = ValueList({"divide by depth": "subdivide_depth", "divide by same depth": "subdivide_depth_same", "divide by dim": "subdivide_dim"}, selected="divide by same depth")
list_3 = ValueList({"YZ": "NS", "XZ": "EW", "XY": "Z"}, selected="XZ")

# ---- group: ENERGY_MODEL_BUCKET
miru = PythonScript(Code=file, Run=Toggle(True))

# ---- group: SETBACK
miru_2 = PythonScript(Code=file_11, Height_stepback="22.5:6.0", Run=Toggle(False))

# ---- group: PACKING
separatedata = Ladybug_SeparateData(Code=file_10, X_keep_omit="27.0,25.0", Y_keep_omit="27.0,25.0", Seperation_ref="-1", Run=Toggle(True))

# ---- group: EXTRACT_SLICE
miru_3 = PythonScript(Code=file_17, Run=Toggle(False))

# ---- group: DIVIDE
miru_4 = PythonScript(
    Code=file_8,
    Divide_num=Slider(2, range=0..10),
    Divide_cut=Slider(0, range=0..100),
    Divide_type=list_2,
    Divide_ratio=Slider(0.5, range=0..1),
    Axis=list_3,
    Run=Toggle(False))

# ---- group: PERIMETER
miru_5 = PythonScript(Code=file_9, Width=Slider(20, range=0..100), Cut_width=Slider(0, range=0..100), Court_ref="0", Run=Toggle(False))

# ---- group: HEIGHT
miru_6 = PythonScript(Code=file_12, Height=Slider(16.5, range=0..100), Run=Toggle(True))

# ---- group: COLLISION_DETECTION
miru_7 = PythonScript(Code=file_2, Run=Toggle(True))

# ---- group: TREE RULES
miru_8 = PythonScript(Code=file_14, Run=Toggle(False))

# ---- group: SHAPE2HEIGHT
miru_9 = PythonScript(Code=file_16, Run=Toggle(False))

# ----
# SET SITE
# CONSTRAINTS
ladybug = Ladybug_Ladybug()  # -> Vviiiiiiiiiizzz; plug-in component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

# ----
# ZONING BOUNDARIES
toggle = BooleanToggle(True)
geo = Geometry([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])
geo_2 = Geometry([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])

# ---- group: cutting obj
geo_3 = Geometry([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])

# ---- group: d10
geo_4 = Geometry([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])

# ---- group: d04
geo_5 = Geometry([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])

# ---- group: d02
geo_6 = Geometry([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])

# ---- group: d08
geo_7 = Geometry([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])

# ---- group: d06
geo_8 = Geometry([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])

# ----
# SOFT SITES
panel = Panel("d08")
bibil_6 = PythonScript(Code=file_7, Node_in=flatten(geo_4), Label_="d10", Run=Toggle(True))  # -> Node_out, Debug
bibil_7 = PythonScript(Code=file_7, Node_in=flatten(geo_7), Label_=panel, Run=Toggle(True))  # -> Node_out, Debug
bibil_8 = PythonScript(Code=file_7, Node_in=flatten(geo_8), Label_="d06", Run=Toggle(True))  # -> Node_out, Debug
bibil_9 = PythonScript(Code=file_7, Node_in=flatten(geo_5), Label_="d04", Run=Toggle(True))  # -> Node_out, Debug

# ---- group: META-RES
bibil_10 = PythonScript(Code=file_7, Node_in=flatten(geo), Label_="ResRoot", Run=toggle)  # -> Node_out, Debug

# ---- group: META-COM
bibil_11 = PythonScript(Code=file_7, Node_in=flatten(geo_2), Label_="ComRoot", Run=Toggle(True))  # -> Node_out, Debug

# ----
bibil_12 = PythonScript(Code=file_7, Node_in=flatten(geo_6), Label_="d02", Run=Toggle(True))  # -> Node_out, Debug

# ----
# REF CRVS
geo_9 = Geometry([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])

data = Data([bibil_10.Node_out, bibil_11.Node_out])
python = PythonScript(
    init_zones=data,
    init_nodes=[bibil_12.Node_out, bibil_9.Node_out, bibil_8.Node_out, bibil_7.Node_out, bibil_6.Node_out],
    run=Toggle(True))  # -> res_node, com_node; inputs init_zones: list, init_nodes: list
# ---------- python: Python ----------
import random
import scriptcontext as sc
import Rhino as rc
import rhinoscriptsyntax as rs

Bula = sc.sticky['Bula']
Grammar = sc.sticky['Grammar']
sc.sticky['GLOBAL_COLLISION_LIST'] = []

def normalize_all_heights(raw_nodes):
    D={}
    max = raw_nodes[0].shape.ht
    min = raw_nodes[0].shape.ht
    htlst = []
    for i in xrange(len(raw_nodes)):
        ht = raw_nodes[i].shape.ht
        if ht>max:
            max = ht
        if ht<min:
            min = ht
        htlst.append(ht)
    #max and min heights
    normlst = B.normalize_list(htlst,191.5,4.5)
    map(lambda nh: nh[0].shape.op_extrude(nh[1]),zip(raw_nodes,normlst))
    return raw_nodes
def set_parcel_by_zone(parcel_,zone_):
    L = []
    cpt = parcel_.shape.cpt
    for j in xrange(len(zone_)):
        zonecrv = zone_[j]
        #debug.append(zonecrv)
        IsIn = rs.PointInPlanarClosedCurve(cpt,zonecrv)
        if IsIn>0.5:
            IsDefined = True
            #debug.append(parcel)
            L.append(parcel_)
            break
    return L

if run:
    B = Bula()
    G = Grammar()
    # Normalize all heights
    norm_nodes = normalize_all_heights(init_nodes)
    
    # Sort the parcels by res/com boundaries
    # There needs to be a better spatial partiioning algorithm to do this part
    # Time complexity = O(2m) + O(4n)
    
    res_zones = []
    res_parcels,com_parcels = [],[]
    
    for i in xrange(len(init_zones)):
        zone = init_zones[i]
        if 'res' in zone.grammar.type['label'].lower():
            res_zones.append(zone.shape.bottom_crv)
            
    for i in xrange(len(norm_nodes)):
        norm = norm_nodes[i]
        IsInRes = set_parcel_by_zone(norm,res_zones)
        if IsInRes:
            res_parcels.append(norm)
        else:
            com_parcels.append(norm)
    
    zone_lst = [res_parcels, com_parcels]
    
    # Bucket according to density label
    bucket_dict = {"apply2list":True, "keys2bucket":["label"],\
                    "fx2bucket":"lambda n:n.grammar.type['label']"}
    for i in xrange(len(zone_lst)):
        nodesbytype = zone_lst[i]
        bucketed_lst = G.bucket_shape(nodesbytype,bucket_dict)
        nestedbylabel = bucketed_lst[0]
        nestedbylabel.sort(key=lambda tple:tple[0])
        zone_lst[i] = map(lambda l:l[1],nestedbylabel)
    
    res_node = zone_lst[0]
    com_node = zone_lst[1]
# ---------- end python ----------
# SET MASSING
# PARAMETERS
g = PythonScript(node=python.res_node)  # -> flatgeom; inputs node: list
# ---------- g: Python ----------
if type(node[0])==type([]):node = reduce(lambda x,y: x+y,node)
node = filter(lambda n: n!=None,node)
geom = []
if node and node != []:
    for n in node:
        geom.append(n.shape.geom)
flatgeom=geom
# ---------- end g ----------
g_2 = PythonScript(node=python.com_node)  # -> flatgeom; inputs node: list; same code as g

# ---- group: DENSITY_UNIFORMITY
number_slider = Slider(2, range=1..4)

# ---- group: PODIUM HEIGHT
number_slider_2 = Slider(6, range=1..6, expression="(x*3) + 7.5")

# ---- group: SET/STEPBACK
number_slider_3 = Slider(1, range=0..4, expression="x*1.5")

# ----
fly = Ladybug_fly(inputSliders=[number_slider, number_slider_2, number_slider_3], fly=Toggle(False))  # -> Vviiiiiiiiiizzz; plug-in component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

# ---- group: GLOBAL COLLISION
python_2 = PythonScript(reset=[number_slider, number_slider_2, number_slider_3])  # -> o
# ---------- python_2: Python ----------
import scriptcontext as sc

print sc.sticky['GLOBAL_COLLISION_LIST']
if reset!=None: 
    sc.sticky['GLOBAL_COLLISION_LIST'] = []

o = sc.sticky['GLOBAL_COLLISION_LIST']
print o
# ---------- end python_2 ----------

# ----
panel_2 = Panel("""7.5:3.0
19.5:6.0""")
panel_3 = Panel("""7.5:9.0
13.5:15.0""")
multiplication = Multiplication(A=number_slider_3, B=Slider(3, range=0..10))
multiplication_2 = Multiplication(A=number_slider_3, B=Slider(2, range=0..10))
multiplication_3 = Multiplication(A=number_slider_3, B=Slider(3, range=0..10))
multiplication_4 = Multiplication(A=number_slider_3, B=Slider(2, range=0..10))

# ----
# SET/STEPBACK
# PARAMETER
python_3 = PythonScript(inc=number_slider_3, index2inc="1", template="7.5:1.5")  # -> parameter; inputs index2inc: Int32, template: list
# ---------- python_3: Python ----------
def generate_parameter(inc_,index_,template_):
    splt = ":" if ":" in template_[0] else ","
    t = []
    for i in xrange(len(template_)):
        exist_str = template_[i].split(splt)
        param2inc = float(exist_str[index_]) + float(inc_)
        exist_str[index_] = str(param2inc)
        t.append(splt.join(exist_str))
    return t

parameter = generate_parameter(inc,index2inc,template)
#print parameter
# ---------- end python_3 ----------

# ----
# SET/STEPBACK
# PARAMETER
python_4 = PythonScript(inc=multiplication_2, index2inc="1", template="13.5:3.0")  # -> parameter; inputs index2inc: Int32, template: list; same code as python_3

# ----
# SET/STEPBACK
# PARAMETER
python_5 = PythonScript(inc=multiplication, index2inc="1", template="19.5:4.5")  # -> parameter; inputs index2inc: Int32, template: list; same code as python_3

# ----
# FRONT
# SET/STEPBACK
# PARAMETER
python_6 = PythonScript(inc=number_slider_3, index2inc="1", template=panel_2)  # -> parameter; inputs index2inc: Int32, template: list; same code as python_3

# ----
# SIDE
# SET/STEPBACK
# PARAMETER
python_7 = PythonScript(inc=multiplication_4, index2inc="1", template=panel_3)  # -> parameter; inputs index2inc: Int32, template: list; same code as python_3

# ----
# REAR
# SET/STEPBACK
# PARAMETER
python_8 = PythonScript(inc=multiplication_3, index2inc="1", template="19.5:3.0")  # -> parameter; inputs index2inc: Int32, template: list; same code as python_3

# ----
# DEMAND
# PARAMETER
podium_ht = PythonScript(node_in=python.res_node, ht_threshold=number_slider_2, density_index=number_slider)  # -> hi, lo; inputs node_in: list, density_index: Int32
# ---------- podium_ht: Python ----------
def set_density(parcel):
    lo,hi = [],[]
    for i in xrange(len(parcel)):
        pa = parcel[i]
        x_dist = pa.shape.x_dist
        y_dist = pa.shape.y_dist
        demand_ = pa.shape.ht
        
        # HIRISE
        if demand_ > MIN_HI_HT and x_dist > MIN_HI_DIST and y_dist > MIN_HI_DIST:
            hi.append(pa)
        # LOWRISE
        else:
            lo.append(pa)
    return hi,lo

MIN_HI_DIST = 20.0
MIN_HI_HT = ht_threshold
select_node = node_in[density_index]
hi,lo = set_density(select_node)
# ---------- end podium_ht ----------

# ----
# DEMAND
# PARAMETER
podium_ht_2 = PythonScript(node_in=python.com_node, ht_threshold=number_slider_2, density_index=number_slider)  # -> hi, lo; inputs node_in: list, density_index: Int32
# ---------- podium_ht_2: Python ----------
def set_density(parcel):
    lo,hi = [],[]
    for i in xrange(len(parcel)):
        p = parcel[i]
        x_dist = p.shape.x_dist
        y_dist = p.shape.y_dist
        demand_ = p.shape.ht
        # HIRISE
        if demand_ > MIN_HI_HT and x_dist > MIN_HI_DIST and y_dist > MIN_HI_DIST:
            hi.append(p)
        # LOWRISE
        else:
            lo.append(p)
    return hi,lo

MIN_HI_DIST = 20.0
MIN_HI_HT = ht_threshold
select_node = node_in[density_index]
hi,lo = set_density(select_node)
# ---------- end podium_ht_2 ----------

# ----
# PODIUM HT
# PARAMETER
data_2 = Data(number_slider_2)

# ----
# PODIUM HT
# PARAMETER
data_3 = Data(number_slider_2)

panel_4 = Panel(python_4)
panel_5 = Panel(python_3)
panel_6 = Panel(python_5)
g_3 = PythonScript(node=podium_ht.hi)  # -> geom; inputs node: list
# ---------- g_3: Python ----------
node = filter(lambda n: n!=None,node)
if node and node != []:
    geom = []
    for n in node:
        if n.shape.z_dist < 1.2:
            geom.append(n.shape.bottom_crv)
        else:
            geom.append(n.shape.geom)
    print geom
# ---------- end g_3 ----------
g_4 = PythonScript(node=podium_ht.lo)  # -> geom; inputs node: list; same code as g_3
g_5 = PythonScript(node=podium_ht_2.hi)  # -> geom; inputs node: list; same code as g_3
g_6 = PythonScript(node=podium_ht_2.lo)  # -> geom; inputs node: list; same code as g_3

# ----
# AVENUES
number_slider_4 = Slider(25, range=0..100)
geo_10 = Geometry([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])

# ----
# STREETS
number_slider_5 = Slider(26, range=0..100)
geo_11 = Geometry(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)

panel_7 = Panel("HiRes,maxht=200.0")
multiplication_5 = Multiplication(A=number_slider_3, B=Slider(3, range=0..10))
multiplication_6 = Multiplication(A=number_slider_3, B=Slider(2, range=0..10))

# ----
# TOWERS
# SET/STEPBACK
# PARAMETER
python_9 = PythonScript(inc=number_slider_3, index2inc="1", template="0.0:1.5")  # -> parameter; inputs index2inc: Int32, template: list; same code as python_3

# ----
# SET/STEPBACK
# PARAMETER
python_10 = PythonScript(inc=multiplication_6, index2inc="1", template="0.0:3.0")  # -> parameter; inputs index2inc: Int32, template: list; same code as python_3

# ----
# SET/STEPBACK
# PARAMETER
python_11 = PythonScript(inc=multiplication_5, index2inc="1", template="0.0:4.5")  # -> parameter; inputs index2inc: Int32, template: list; same code as python_3

number_slider_6 = Slider(21, range=0..100)
# LOWRISE
number_slider_7 = Slider(30, range=0..100)

panel_8 = Panel(python_6)
panel_9 = Panel("0.0>0.0:-3.0>3.0")
panel_10 = Panel(python_7)
panel_11 = Panel(python_8)
miru_10 = PythonScript(
    Code=file_11,
    Height_stepback=panel_10,
    Stepback_ref=geo_11,
    Stepback_tol=number_slider_5,
    From_rear=Toggle(True),
    Run=Toggle(True))

number_slider_8 = Slider(28.5, range=0..100)

panel_12 = Panel(python_5)
panel_13 = Panel(python_4)
panel_14 = Panel(python_3)

panel_15 = Panel(python_11)
panel_16 = Panel(python_10)
panel_17 = Panel(python_9)

# ----
# COMMERCIAL
# PODIUM
toggle_2 = BooleanToggle(True)
# SET DESIGN
# GRAMMARS
# RESIDENTIAL
# PODIUM
toggle_3 = BooleanToggle(True)
# LOWRISE
toggle_4 = BooleanToggle(True)

# ---- group: SETBACK
miru_11 = PythonScript(Code=file_11, Height_stepback="0.0:2.0", Stepback_ref="-1", Stepback_tol=number_slider_5, Run=Toggle(True))

miru_12 = PythonScript(Code=file_11, Height_stepback=panel_8, Stepback_ref=geo_11, Stepback_tol=number_slider_5, Run=Toggle(True))

miru_13 = PythonScript(Code=file_11, Height_stepback=panel_11, Stepback_ref=geo_10, Stepback_tol=number_slider_4, Run=Toggle(True))

# ---- group: PERIMETER
miru_14 = PythonScript(Code=file_9, Width=number_slider_7, Cut_width=Slider(0, range=0..100), Court_ref="0", Run=Toggle(True))

# ---- group: TREE RULES
miru_15 = PythonScript(Code=file_14, Node=bibil_10.Node_out, Run=Toggle(True))

# ---- group: HEIGHT
miru_16 = PythonScript(Code=file_12, Height=data_2, Randomize="-6.0>6.0", Run=Toggle(True))

# ---- group: SETBACK
miru_17 = PythonScript(Code=file_11, Height_stepback=panel_14, Stepback_ref=geo_11, Stepback_tol=number_slider_5, Run=Toggle(True))

miru_18 = PythonScript(Code=file_11, Height_stepback=panel_13, Stepback_ref="0", Stepback_tol=number_slider_5, Run=Toggle(True))

miru_19 = PythonScript(Code=file_11, Height_stepback=panel_12, Stepback_ref=geo_10, Stepback_tol=number_slider_4, Run=Toggle(True))

# ---- group: TREE RULES
miru_20 = PythonScript(Code=file_14, Node=bibil_11.Node_out, Run=toggle_2)

# ---- group: PERIMETER
miru_21 = PythonScript(Code=file_9, Width=Slider(30, range=0..100), Cut_width=Slider(0, range=0..100), Court_ref="0", Run=Toggle(True))

# ---- group: HEIGHT
miru_22 = PythonScript(Code=file_12, Height=data_3, Run=Toggle(True))

# ---- group: SETBACK
miru_23 = PythonScript(Code=file_11, Height_stepback=panel_17, Stepback_ref=geo_11, Stepback_tol=number_slider_5, Run=Toggle(True))

miru_24 = PythonScript(Code=file_11, Height_stepback=panel_16, Stepback_ref="0", Stepback_tol=number_slider_5, Run=Toggle(True))

miru_25 = PythonScript(Code=file_11, Height_stepback=panel_15, Stepback_ref=geo_10, Stepback_tol=number_slider_4, Run=Toggle(True))

# ---- group: HEIGHT
miru_26 = PythonScript(Code=file_12, Height=Slider(10.5, range=0..100), Randomize="-3.0>3.0", Run=Toggle(True))

# ---- group: TREE RULES
miru_27 = PythonScript(Code=file_14, Node=bibil_10.Node_out, Run=toggle_3)

# ---- group: PERIMETER
miru_28 = PythonScript(Code=file_9, Width=Slider(27.4, range=0..100), Cut_width=Slider(0, range=0..100), Court_ref="0", Run=Toggle(True))

# ---- group: HEIGHT
miru_29 = PythonScript(Code=file_12, Height=Slider(100, range=0..100), Run=Toggle(True))

# ---- group: TREE RULES
miru_30 = PythonScript(Code=file_14, Node=bibil_11.Node_out, Run=toggle_4)

# ----
geo_12 = Geometry([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])
geo_13 = Geometry([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])
geo_14 = Geometry([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])
geo_15 = Geometry([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])
geo_16 = Geometry([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])
geo_17 = Geometry([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])
geo_18 = Geometry([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])
geo_19 = Geometry([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])

# ---- group: SHAPENODE
bibil_13 = PythonScript(
    Code=file_7,
    Rule_in=flatten([miru_27, miru_21, miru_22, miru_17, miru_18, miru_19]),
    Node_in=flatten(g_3),
    Label_="HiRes",
    Run=Toggle(True))  # -> Node_out, Debug

bibil_14 = PythonScript(Code=file_7, Rule_in=flatten([miru_15, miru_14, miru_11]), Node_in=flatten(g_4), Label_="LoRes", Run=Toggle(True))  # -> Node_out, Debug

# ----
geo_20 = Geometry([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])

# ---- group: SHAPENODE
bibil_15 = PythonScript(
    Code=file_7,
    Rule_in=flatten([miru_20, miru_16, miru_12, miru_10, miru_13]),
    Node_in=flatten(g_5),
    Label_="HiComm",
    Run=Toggle(True))  # -> Node_out, Debug

bibil_16 = PythonScript(Code=file_7, Rule_in=flatten([miru_30, miru_26]), Node_in=flatten(g_6), Label_="LoComm", Run=Toggle(True))  # -> Node_out, Debug

# ----
g_7 = PythonScript(node=bibil_14.Node_out)  # -> geom; inputs node: list; same code as g_3
g_8 = PythonScript(node=bibil_14.Node_out)  # -> crv; inputs node: list
# ---------- g_8: Python ----------
node = filter(lambda n: n!=None,node)
if node and node != []:
    crv = []
    for n in node:
        crv.append(n.shape.bottom_crv)
# ---------- end g_8 ----------

# ---- group: PACKING
separatedata_2 = Ladybug_SeparateData(Code=file_10, X_keep_omit="27.4,25.0", Y_keep_omit="27.4,25.0", Seperation_ref="-1", Add_collision=g_8, Run=Toggle(True))

# ---- group: SHAPENODE
bibil_17 = PythonScript(
    Code=file_7,
    Rule_in=flatten([miru_23, miru_24, miru_25, miru_28, separatedata_2, miru_29]),
    Node_in=flatten(geo_20),
    Label_="HiRes",
    Run=Toggle(True))  # -> Node_out, Debug

# ----
geo_21 = Geometry(bibil_14.Debug)
g_9 = PythonScript(node=bibil_15.Node_out)  # -> geom; inputs node: list; same code as g_3
g_10 = PythonScript(node=bibil_13.Node_out)  # -> geom; inputs node: list; same code as g_3
geo_22 = Geometry(bibil_15.Debug)
g_11 = PythonScript(node=bibil_16.Node_out)  # -> geom; inputs node: list; same code as g_3
geo_23 = Geometry(bibil_16.Debug)
geo_24 = Geometry(bibil_17.Debug)
g_12 = PythonScript(node=bibil_17.Node_out)  # -> geom; inputs node: list; same code as g_3
sdiff = SolidDifference(BrepsA=g_12, BrepsB=g_10)
# TOWERS
toggle_5 = BooleanToggle(True)

# ---- group: PACKING
separatedata_3 = Ladybug_SeparateData(Code=file_10, X_keep_omit="24.0,20.0", Y_keep_omit="24.0,20.0", Seperation_ref="-1", Run=Toggle(True))

# ---- group: EXTRACT_SLICE
miru_31 = PythonScript(Code=file_17, Run=toggle_5)

# ---- group: HEIGHT
miru_32 = PythonScript(Code=file_12, Height_ref="HiComm", Run=Toggle(True))

# ---- group: SHAPENODE
bibil_18 = PythonScript(Code=file_7, Rule_in=flatten([miru_31, separatedata_3, miru_32]), Node_in=flatten(bibil_15.Node_out), Run=Toggle(True))  # -> Node_out, Debug

# ----
geo_25 = Geometry(bibil_18.Debug)
g_13 = PythonScript(node=bibil_18.Node_out)  # -> geom; inputs node: list
# ---------- g_13: Python ----------
node = filter(lambda n: n!=None,node)
if node and node != []:
    geom = []
    for n in node:
        #print n.shape.z_dist
        #if n.shape.z_dist > 9.:
        geom.append(n.shape.geom)
    print geom
# ---------- end g_13 ----------
geo_26 = Geometry([g_10, g_9, g_7, g_11, g_13, sdiff])
# RUN
# SIMULATION
panel_19 = Panel("C:\Users\vasanthakumars\Documents\GitHub\bibil\src\reference\CAN_ON_Toronto.716240_CWEC\CAN_ON_Toronto.716240_CWEC.epw")  # disabled
panel_20 = Panel("C:\\saeran\\master\\git\\bibil\\src\reference\CAN_ON_Toronto.716240_CWEC\CAN_ON_Toronto.716240_CWEC.epw")  # disabled
toggle_6 = BooleanToggle(True)  # disabled
list_4 = ValueList({"dir", "file"}, selected="file")  # disabled

# ---- group: find directory
bibil_19 = PythonScript(dir=[panel_19, panel_20], type=list_4, run=toggle_6)  # -> file; inputs dir: list; disabled; same code as bibil

# ----
number_slider_9 = Slider(9, range=0..10)  # disabled
number_slider_10 = Slider(8.25, range=0..100)  # disabled
number_slider_11 = Slider(21, range=0..100)  # disabled
number_slider_12 = Slider(17.25, range=0..100)  # disabled
importepw = Ladybug_ImportEpw(epwFile=bibil_19)  # -> readMe, latitude, location, dryBulbTemperature, dewPointTemperature, relativeHumidity, windSpeed, windDirection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; disabled; plug-in component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
analysisperiod = Ladybug_AnalysisPeriod(
    fromMonth=number_slider_9,
    fromDay=number_slider_11,
    fromHour=number_slider_10,
    toMonth=number_slider_9,
    toDay=number_slider_11,
    toHour=number_slider_12)  # -> readMe, analysisPeriod; disabled; plug-in component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
sunpath = Ladybug_SunPath(
    location=importepw.location,
    hour=12,
    day=21,
    month=12,
    timeStep=1,
    analysisPeriod=analysisperiod.analysisPeriod,
    dailyOrAnnualSunPath=True)  # -> readMe, sunVectors, sunAltitudes, sunAzimuths, port, sunSpheresMesh, sunPathCrvs, legend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; disabled; plug-in component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
number_slider_13 = Slider(16, range=0..100)  # disabled
number_slider_14 = Slider(0, range=0..100)  # disabled
gradientlibrary = Ladybug_GradientLibrary(gradIndex=number_slider_13)  # -> customColors; disabled; plug-in component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
gradientlibrary_2 = Ladybug_GradientLibrary(gradIndex=number_slider_14)  # -> customColors; disabled; plug-in component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
lng = ListLength(List=sunpath.sunVectors)  # disabled
lng_2 = ListLength(List=sunpath.sunVectors)  # disabled
addition = Addition(A=lng, B=1)  # disabled
addition_2 = Addition(A=lng_2, B=1)  # disabled
legendpar = Ladybug_LegendParameters(numSegments=addition, customColors=flatten(gradientlibrary))  # -> legendPar; disabled; plug-in component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
legendpar_2 = Ladybug_LegendParameters(numSegments=addition_2, customColors=flatten(gradientlibrary_2))  # -> legendPar; disabled; plug-in component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
number_slider_15 = Slider(0.001, range=0..0.001)  # disabled
number_slider_16 = Slider(0.001, range=0..0.001)  # disabled
number_slider_17 = Slider(3, range=0..10)  # disabled
number_slider_18 = Slider(1, range=0..10)  # disabled
toggle_7 = BooleanToggle(True)  # disabled
toggle_8 = BooleanToggle(True)  # disabled
toggle_9 = BooleanToggle(False)  # disabled
toggle_10 = BooleanToggle(True)  # disabled
geo_27 = Geometry(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)  # disabled
# BLDG
sunlighthoursanalysis = Ladybug_SunlightHoursAnalysis(
    geometry=flatten(geo_26),
    gridSize=number_slider_17,
    disFromBase=number_slider_15,
    sunVectors=flatten(sunpath.sunVectors),
    timeStep=1,
    legendPar=flatten(legendpar_2),
    parallel=toggle_7,
    runIt=toggle_8)  # -> readMe, contextMesh, analysisMesh, testPts, testVec, port, sunlightHoursResult, sunlightHoursMesh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; disabled; plug-in component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
# GROUND
sunlighthoursanalysis_2 = Ladybug_SunlightHoursAnalysis(
    geometry=flatten(geo_27),
    context=flatten(geo_26),
    gridSize=number_slider_18,
    disFromBase=number_slider_16,
    sunVectors=flatten(sunpath.sunVectors),
    timeStep=1,
    legendPar=flatten(legendpar),
    parallel=toggle_9,
    runIt=toggle_10)  # -> readMe, contextMesh, analysisMesh, testPts, testVec, port, sunlightHoursResult, sunlightHoursMesh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; disabled; plug-in component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
panel_21 = Panel("-1")  # disabled
sort = SortList(Keys=flatten(sunlighthoursanalysis.sunlightHoursResult))  # -> Keys, ValuesA; disabled
item = ListItem(List=sort.Keys, Index=0, Wrap=True)  # disabled
item_2 = ListItem(List=sort.Keys, Index=panel_21, Wrap=True)  # disabled
data_4 = Data(geo_26)  # disabled
number_slider_19 = Slider(0.7, range=0..1)  # disabled
gradient = Gradient(
    LowerLimit=item,
    UpperLimit=item_2,
    Parameter=sunlighthoursanalysis.sunlightHoursResult,
    stops=[0: RGB(234, 38, 0), 0.25: RGB(234, 126, 0), 0.5: RGB(254, 244, 84), 0.75: RGB(173, 203, 249)])  # disabled
swatch = ColourSwatch(SwatchColor=RGB(255, 255, 255))  # disabled
number_slider_20 = Slider(0.8, range=0..1)  # disabled
swatch_2 = ColourSwatch(SwatchColor=RGB(255, 255, 255))  # disabled
material = CreateMaterial(Diffuse=swatch, Specular=RGB(255, 255, 255), Emission=RGB(0, 0, 0), Transparency=number_slider_19, Shine=0)  # disabled
wires = BrepWireframe(Brep=data_4, Density=-1)  # disabled
mesh = Mesh(data_4)  # disabled
mesh_2 = Mesh(sunlighthoursanalysis_2.sunlightHoursMesh)  # disabled
# RUN
# OPTIMIZATION
preview = CustomPreview(Geometry=mesh, Shader=material)  # disabled
preview_2 = CustomPreview(Geometry=wires, Shader=swatch_2)  # disabled
dots = DotDisplay(Point=sunlighthoursanalysis.testPts, Colour=gradient, Size=number_slider_20)  # disabled
volume = Volume(Geometry=geo_26)  # -> Volume, Centroid; disabled
num = Number(3)  # disabled
division = Division(A=volume.Volume, B=num)  # disabled
ma = MassAddition(Input=sunlighthoursanalysis.totalSunlightHours)  # -> Result, PartialResults; disabled
ma_2 = MassAddition(Input=division)  # -> Result, PartialResults; disabled
ma_3 = MassAddition(Input=sunlighthoursanalysis_2.totalSunlightHours)  # -> Result, PartialResults; disabled
panel_22 = Panel("""Unit num
Sunlight hrs
UTCMI
Facade hrs""")  # disabled
octopus = Octopus(
    Phenotype=mesh_2,
    OctopusData_gene=[number_slider_2, number_slider, number_slider_3],
    OctopusData_obj=[num_4, txt, num_2, num_3])  # disabled
neg = Negative(Value=ma_2.Result)  # disabled
neg_2 = Negative(Value=ma.Result)  # disabled
neg_3 = Negative(Value=ma_3.Result)  # disabled
txt = Text(panel_22)  # disabled
num_2 = Number(neg_2)  # disabled
num_3 = Number(neg_3)  # disabled
num_4 = Number(neg)  # disabled
panel_23 = Panel(num_4)  # disabled
panel_24 = Panel(num_2)  # disabled
panel_25 = Panel(num_3)  # disabled
captureview = Ladybug_CaptureView()  # -> imagePath; disabled; plug-in component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
