# Grasshopper definition trinco_tower_twist_test_16_spectest.gh (Grasshopper 0.9.76)
# plug-ins: Python Interpreter, Spectacles.GrasshopperExporter

list = ValueList({"dir", "file"}, selected="dir")

# ---- group: find directory
bibil = PythonScript(
    dir=["C:\\Users\\vasanthakumars\\Documents\\GitHub\\bibil\\src", "C:\\saeran\\master\\git\\bibil\\src"],
    type=list,
    run=Toggle(True))  # -> dir; inputs dir: list
# ---------- bibil: Python ----------
import os
import sys

ghenv.Component.Params.Output[0].Name = "null"
ghenv.Component.Params.Output[0].NickName = "null"

#sys.path.append("C:\Program Files\Rhinoceros 5.0 (64-bit)\System")

if run:
    confirm_dir = None
    for d in dir:
        try:
            if type == "file":
                file_ = open(d)
                file_.close()
            else:
                print os.listdir(d)
            confirm_dir = d
            break
        except Exception as e:
            #print str(e)
            continue
    if confirm_dir != None:
        ghenv.Component.Params.Output[0].Name = type
        ghenv.Component.Params.Output[0].NickName = type
        dir = confirm_dir
        file = confirm_dir
null = None
# ---------- end bibil ----------

# ---- group: node_bucket
python_script = PythonScript(i=bibil)  # -> o
# ---------- python_script: Python ----------
import os

if i:
    o = os.path.join(str(i),"miru\\miru_shape_bucket.py")
# ---------- end python_script ----------
file = ReadFile(File=python_script, PerLineParse=False)

# ---- group: tree
python_script_2 = PythonScript(i=bibil)  # -> o
# ---------- python_script_2: Python ----------
import os

if i:
    o = os.path.join(str(i),"bibil\\bibil_tree.py")
# ---------- end python_script_2 ----------
file_2 = ReadFile(File=python_script_2, PerLineParse=False)
bibil_2 = PythonScript(Code=file_2)

# ---- group: grammar
python_script_3 = PythonScript(i=bibil)  # -> o
# ---------- python_script_3: Python ----------
import os

if i:
    o = os.path.join(str(i),"bibil\\bibil_grammar.py")
# ---------- end python_script_3 ----------
file_3 = ReadFile(File=python_script_3, PerLineParse=False)
bibil_3 = PythonScript(Code=file_3)

# ---- group: shape
python_script_4 = PythonScript(i=bibil)  # -> o
# ---------- python_script_4: Python ----------
import os

if i:
    o = os.path.join(str(i),"bibil\\bibil_shape.py")
#o = os.path.join(str(i),"research\\bibil_shape_shape_3d_2d.py")
# ---------- end python_script_4 ----------
file_4 = ReadFile(File=python_script_4, PerLineParse=False)
bibil_4 = PythonScript(Code=file_4)

# ---- group: bula
python_script_5 = PythonScript(i=bibil)  # -> o
# ---------- python_script_5: Python ----------
import os

if i:
    o = os.path.join(str(i),"bula\\bula_minimal.py")
# ---------- end python_script_5 ----------
file_5 = ReadFile(File=python_script_5, PerLineParse=False)
bibil_5 = PythonScript(Code=file_5)

# ---- group: UI
python_script_6 = PythonScript(i=bibil)  # -> o
# ---------- python_script_6: Python ----------
import os

if i:
    o = os.path.join(str(i),"bibil\\bibil_UI.py")
# ---------- end python_script_6 ----------
file_6 = ReadFile(File=python_script_6, PerLineParse=False)

# ---- group: grammar_divide
python_script_7 = PythonScript(i=bibil)  # -> o
# ---------- python_script_7: Python ----------
import os

if i:
    o = os.path.join(str(i),"miru\\miru_divide.py")
# ---------- end python_script_7 ----------
file_7 = ReadFile(File=python_script_7, PerLineParse=False)

# ---- group: grammar_courtyard
python_script_8 = PythonScript(i=bibil)  # -> o
# ---------- python_script_8: Python ----------
import os

if i:
    o = os.path.join(str(i),"miru\\miru_court.py")
# ---------- end python_script_8 ----------
file_8 = ReadFile(File=python_script_8, PerLineParse=False)

# ---- group: grammar_tower
python_script_9 = PythonScript(i=bibil)  # -> o
# ---------- python_script_9: Python ----------
import os

if i:
    o = os.path.join(str(i),"miru\\miru_packing.py")
# ---------- end python_script_9 ----------
file_9 = ReadFile(File=python_script_9, PerLineParse=False)

# ---- group: stepback
python_script_10 = PythonScript(i=bibil)  # -> o
# ---------- python_script_10: Python ----------
import os

if i:
    o = os.path.join(str(i),"miru\\miru_stepback.py")
# ---------- end python_script_10 ----------
file_10 = ReadFile(File=python_script_10, PerLineParse=False)

# ---- group: grammar_height
python_script_11 = PythonScript(i=bibil)  # -> o
# ---------- python_script_11: Python ----------
import os

if i:
    o = os.path.join(str(i),"miru\\miru_height.py")
# ---------- end python_script_11 ----------
file_11 = ReadFile(File=python_script_11, PerLineParse=False)

# ---- group: grammar_analysis_pts
python_script_12 = PythonScript(i=bibil)  # -> o
# ---------- python_script_12: Python ----------
import os

if i:
    o = os.path.join(str(i),"miru\\miru_analysis.py")
# ---------- end python_script_12 ----------
file_12 = ReadFile(File=python_script_12, PerLineParse=False)

# ---- group: meta_tree
python_script_13 = PythonScript(i=bibil)  # -> o
# ---------- python_script_13: Python ----------
import os

if i:
    o = os.path.join(str(i),"miru\\miru_meta_tree.py")
# ---------- end python_script_13 ----------
file_13 = ReadFile(File=python_script_13, PerLineParse=False)

# ---- group: land_use
python_script_14 = PythonScript(i=bibil)  # -> o
# ---------- python_script_14: Python ----------
import os

if i:
    o = os.path.join(str(i),"miru\\miru_landuse.py")
# ---------- end python_script_14 ----------
file_14 = ReadFile(File=python_script_14, PerLineParse=False)

# ---- group: shape2height
python_script_15 = PythonScript(i=bibil)  # -> o
# ---------- python_script_15: Python ----------
import os

if i:
    o = os.path.join(str(i),"miru\\miru_shape2height.py")
# ---------- end python_script_15 ----------
file_15 = ReadFile(File=python_script_15, PerLineParse=False)

# ---- group: extract_slice
python_script_16 = PythonScript(i=bibil)  # -> o
# ---------- python_script_16: Python ----------
import os

if i:
    o = os.path.join(str(i),"miru\\miru_extract_slice.py")
# ---------- end python_script_16 ----------
file_16 = ReadFile(File=python_script_16, PerLineParse=False)

# ----
list_2 = ValueList({"divide by depth": "subdivide_depth", "divide by same depth": "subdivide_depth_same", "divide by dim": "subdivide_dim"}, selected="divide by same depth")
list_3 = ValueList({"YZ": "NS", "XZ": "EW", "XY": "Z"}, selected="XZ")

# ---- group: ENERGY_MODEL_BUCKET
miru = PythonScript(Code=file, Run=Toggle(True))

# ---- group: SETBACK
miru_2 = PythonScript(Code=file_10, Height_stepback="22.5:6.0", Run=Toggle(False))

# ---- group: PACKING
separatedata = Ladybug_SeparateData(Code=file_9, X_keep_omit="27.0,25.0", Y_keep_omit="27.0,25.0", Seperation_ref="-1", Run=Toggle(False))

# ---- group: EXTRACT_SLICE
miru_3 = PythonScript(Code=file_16, Run=Toggle(False))

# ---- group: DIVIDE
miru_4 = PythonScript(
    Code=file_7,
    Divide_num=Slider(2, range=0..10),
    Divide_cut=Slider(0, range=0..100),
    Divide_type=list_2,
    Divide_ratio=Slider(0.5, range=0..1),
    Axis=list_3,
    Run=Toggle(False))

# ---- group: PERIMETER
miru_5 = PythonScript(Code=file_8, Width=Slider(20, range=0..100), Cut_width=Slider(0, range=0..100), Court_ref="0", Run=Toggle(False))

# ---- group: HEIGHT
miru_6 = PythonScript(Code=file_11, Height=Slider(16.5, range=0..100), Run=Toggle(True))

# ---- group: TREE RULES
miru_7 = PythonScript(Code=file_13, Run=Toggle(False))

# ---- group: SHAPE2HEIGHT
miru_8 = PythonScript(Code=file_15, Run=Toggle(False))

# ----
# SET SITE
# CONSTRAINTS
ladybug = Ladybug_Ladybug()  # -> Vviiiiiiiiiizzz; plug-in component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

# ----
# ZONING BOUNDARIES
toggle = BooleanToggle(True)
geo = Geometry([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])
geo_2 = Geometry([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])

# ---- group: d10
geo_3 = Geometry([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])

# ---- group: d04
geo_4 = Geometry([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])

# ---- group: d02
geo_5 = Geometry([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])

# ---- group: d08
geo_6 = Geometry([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])

# ---- group: d06
geo_7 = Geometry([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])

# ----
# SOFT SITES
panel = Panel("d08")
bibil_6 = PythonScript(Code=file_6, Node_in=flatten(geo_3), Label_="d10", Run=Toggle(True))  # -> Node_out, Debug
bibil_7 = PythonScript(Code=file_6, Node_in=flatten(geo_6), Label_=panel, Run=Toggle(True))  # -> Node_out, Debug
bibil_8 = PythonScript(Code=file_6, Node_in=flatten(geo_7), Label_="d06", Run=Toggle(True))  # -> Node_out, Debug
bibil_9 = PythonScript(Code=file_6, Node_in=flatten(geo_4), Label_="d04", Run=Toggle(True))  # -> Node_out, Debug

# ---- group: META-RES
bibil_10 = PythonScript(Code=file_6, Node_in=flatten(geo), Label_="ResRoot", Run=toggle)  # -> Node_out, Debug

# ---- group: META-COM
bibil_11 = PythonScript(Code=file_6, Node_in=flatten(geo_2), Label_="ComRoot", Run=Toggle(True))  # -> Node_out, Debug

# ----
bibil_12 = PythonScript(Code=file_6, Node_in=flatten(geo_5), Label_="d02", Run=Toggle(True))  # -> Node_out, Debug
data = Data([bibil_10.Node_out, bibil_11.Node_out])

# ---- group: DENSITY_UNIFORMITY
number_slider = Slider(3, range=1..4)

# ---- group: SET/STEPBACK
number_slider_2 = Slider(4, range=0..4, expression="x*1.5")

# ---- group: PODIUM HEIGHT
number_slider_3 = Slider(1, range=1..6, expression="(x*3) + 7.5")

# ----
python = PythonScript(
    init_zones=data,
    init_nodes=[bibil_12.Node_out, bibil_9.Node_out, bibil_8.Node_out, bibil_7.Node_out, bibil_6.Node_out],
    run=Toggle(True))  # -> res_node, com_node; inputs init_zones: list, init_nodes: list
# ---------- python: Python ----------
import random
import scriptcontext as sc
import Rhino as rc
import rhinoscriptsyntax as rs

import Grasshopper
import Grasshopper.Kernel as gh
import scriptcontext as sc
ghenv.Component.Message = 'Bibil_1'

Bula = sc.sticky['Bula']
Grammar = sc.sticky['Grammar']
sc.sticky['GLOBAL_COLLISION_LIST'] = []

def normalize_all_heights(raw_nodes):
    D={}
    max = raw_nodes[0].shape.ht
    min = raw_nodes[0].shape.ht
    htlst = []
    for i in xrange(len(raw_nodes)):
        ht = raw_nodes[i].shape.ht
        if ht>max:
            max = ht
        if ht<min:
            min = ht
        htlst.append(ht)
    #max and min heights
    normlst = B.normalize_list(htlst,121.5,10.5)
    map(lambda nh: nh[0].shape.op_extrude(nh[1]),zip(raw_nodes,normlst))
    return raw_nodes
def set_parcel_by_zone(parcel_,zone_):
    L = []
    cpt = parcel_.shape.cpt
    for j in xrange(len(zone_)):
        zonecrv = zone_[j]
        #debug.append(zonecrv)
        IsIn = rs.PointInPlanarClosedCurve(cpt,zonecrv)
        if IsIn>0.5:
            IsDefined = True
            #debug.append(parcel)
            L.append(parcel_)
            break
    return L

if run:
    B = Bula()
    G = Grammar()
    # Normalize all heights
    norm_nodes = normalize_all_heights(init_nodes)
    
    # Sort the parcels by res/com boundaries
    # There needs to be a better spatial partiioning algorithm to do this part
    # Time complexity = O(2m) + O(4n)
    
    res_zones = []
    res_parcels,com_parcels = [],[]
    
    for i in xrange(len(init_zones)):
        zone = init_zones[i]
        if 'res' in zone.grammar.type['label'].lower():
            res_zones.append(zone.shape.bottom_crv)
            
    for i in xrange(len(norm_nodes)):
        norm = norm_nodes[i]
        IsInRes = set_parcel_by_zone(norm,res_zones)
        if IsInRes:
            res_parcels.append(norm)
        else:
            com_parcels.append(norm)
    
    zone_lst = [res_parcels, com_parcels]
    
    # Bucket according to density label
    bucket_dict = {"apply2list":True, "keys2bucket":["label"],\
                    "fx2bucket":"lambda n:n.grammar.type['label']"}
    for i in xrange(len(zone_lst)):
        nodesbytype = zone_lst[i]
        bucketed_lst = G.bucket_shape(nodesbytype,bucket_dict)
        nestedbylabel = bucketed_lst[0]
        nestedbylabel.sort(key=lambda tple:tple[0])
        zone_lst[i] = map(lambda l:l[1],nestedbylabel)
    
    res_node = zone_lst[0]
    com_node = zone_lst[1]
# ---------- end python ----------
# SET MASSING
# PARAMETERS
g = PythonScript(node=python.res_node)  # -> flatgeom; inputs node: list
# ---------- g: Python ----------
if type(node[0])==type([]):node = reduce(lambda x,y: x+y,node)
node = filter(lambda n: n!=None,node)
geom = []
if node and node != []:
    for n in node:
        geom.append(n.shape.geom)
flatgeom=geom
# ---------- end g ----------
g_2 = PythonScript(node=python.com_node)  # -> flatgeom; inputs node: list; same code as g
fly = Ladybug_fly(inputSliders=[number_slider, number_slider_3, number_slider_2], fly=Toggle(False))  # -> Vviiiiiiiiiizzz; plug-in component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
python_2 = PythonScript(run=Toggle(True))  # -> o
# ---------- python_2: Python ----------
import scriptcontext as sc

if run:
    sc.sticky['counter'] = 0.
# ---------- end python_2 ----------
toggle_2 = BooleanToggle(False)

# ---- group: TRIGGER
data_2 = Data(number_slider_2)

# ---- group: GLOBAL COLLISION
python_3 = PythonScript(reset=data_2)  # -> o
# ---------- python_3: Python ----------
import scriptcontext as sc


if reset!=None: 
    sc.sticky['GLOBAL_COLLISION_LIST'] = []

o = sc.sticky['GLOBAL_COLLISION_LIST']
print o
# ---------- end python_3 ----------

# ---- group: RECOMPUTE
resetsol = PythonScript(reset=data_2)  # -> o; disabled
# ---------- resetsol: Python ----------
"""----------------
Miru Recompute Solution
----------------""" 

import Grasshopper
import Grasshopper.Kernel as gh
import scriptcontext as sc
ghenv.Component.Message = 'Recompute_Soln'



## This is a refence right now, must copy and paste 
## into ghcomponent to work

if reset:
    
    document = ghenv.Component.OnPingDocument()
    
    objects = list(document.Objects)
    for obj in objects:
        #get the ghpython components
        if type(obj)!= type(ghenv.Component):
            pass
        else:
            chk_bug = obj.Name!=None and "Ladybug" in obj.Name
            chk_self = obj.Message!=None and "Recompute_Soln" in obj.Message
            chk_bibil = obj.Message!=None and "Bibil" in obj.Message
            if chk_bug or chk_self:
                pass
            elif chk_bibil:#else:
                obj.ExpireSolution(True)
# ---------- end resetsol ----------

# ----
panel_2 = Panel(resetsol)
data_3 = Data(number_slider_3)
panel_3 = Panel("7.5:1.5")
panel_4 = Panel("13.5:3.0")
panel_5 = Panel("19.5:4.5")
multiplication = Multiplication(A=number_slider_2, B=Slider(3, range=0..10))
multiplication_2 = Multiplication(A=number_slider_2, B=Slider(3, range=0..10))
multiplication_3 = Multiplication(A=number_slider_2, B=Slider(2, range=0..10))
multiplication_4 = Multiplication(A=number_slider_2, B=Slider(2, range=0..10))

# ----
# SET/STEPBACK
# PARAMETER
python_4 = PythonScript(inc=number_slider_2, index2inc="1", template="0.0:1.5", htmax=[Slider(7.5, range=0..10), number_slider_3])  # -> parameter; inputs index2inc: Int32, template: list, htmax: list
# ---------- python_4: Python ----------
def generate_parameter(inc_,index_,template_):
    splt = ":" if ":" in template_[0] else ","
    t = []
    for i in xrange(len(template_)):
        exist_str = template_[i].split(splt)
        param2inc = float(exist_str[index_]) + float(inc_)
        exist_str[index_] = str(param2inc)
        t.append(splt.join(exist_str))
    return t

refht=htmax[0]
actualht=htmax[1]
if refht > actualht:
    parameter = "1000.0:1.5"
else:
    parameter = generate_parameter(inc,index2inc,template)
#print parameter
# ---------- end python_4 ----------

# ----
# SET/STEPBACK
# PARAMETER
python_5 = PythonScript(inc=multiplication_3, index2inc="1", template="0.0:3.0", htmax=[Slider(13.5, range=0..100), data_3])  # -> parameter; inputs index2inc: Int32, template: list, htmax: list; same code as python_4

# ----
# SET/STEPBACK
# PARAMETER
python_6 = PythonScript(inc=multiplication, index2inc="1", template="0.0:4.5", htmax=[Slider(19.5, range=0..100), data_3])  # -> parameter; inputs index2inc: Int32, template: list, htmax: list; same code as python_4

# ----
# SET/STEPBACK
# PARAMETER
python_7 = PythonScript(inc=number_slider_2, index2inc="1", template="7.5:1.5")  # -> parameter; inputs index2inc: Int32, template: list
# ---------- python_7: Python ----------
def generate_parameter(inc_,index_,template_):
    splt = ":" if ":" in template_[0] else ","
    t = []
    for i in xrange(len(template_)):
        exist_str = template_[i].split(splt)
        param2inc = float(exist_str[index_]) + float(inc_)
        exist_str[index_] = str(param2inc)
        t.append(splt.join(exist_str))
    return t

parameter = generate_parameter(inc,index2inc,template)
#print parameter
# ---------- end python_7 ----------

# ----
# SET/STEPBACK
# PARAMETER
python_8 = PythonScript(inc=multiplication_4, index2inc="1", template="13.5:3.0")  # -> parameter; inputs index2inc: Int32, template: list; same code as python_7

# ----
# SET/STEPBACK
# PARAMETER
python_9 = PythonScript(inc=multiplication_2, index2inc="1", template="19.5:4.5")  # -> parameter; inputs index2inc: Int32, template: list; same code as python_7

# ----
# DEMAND
# PARAMETER
podium_ht = PythonScript(node_in=python.res_node, ht_threshold=number_slider_3, density_index=number_slider)  # -> hi, lo; inputs node_in: list, density_index: Int32
# ---------- podium_ht: Python ----------
import Grasshopper
import Grasshopper.Kernel as gh

ghenv.Component.Message = 'Bibil_2'


def set_density(parcel):
    lo,hi = [],[]
    for i in xrange(len(parcel)):
        pa = parcel[i]
        x_dist = pa.shape.x_dist
        y_dist = pa.shape.y_dist
        demand_ = pa.shape.ht
        
        # HIRISE
        if demand_ > MIN_HI_HT and x_dist > MIN_HI_DIST and y_dist > MIN_HI_DIST:
            hi.append(pa)
        # LOWRISE
        else:
            lo.append(pa)
    return hi,lo

MIN_HI_DIST = 20.0
MIN_HI_HT = ht_threshold
select_node = node_in[density_index]
hi,lo = set_density(select_node)
# ---------- end podium_ht ----------

# ----
# PODIUM HT
# PARAMETER
data_4 = Data(number_slider_3)

panel_6 = Panel(python_8)
panel_7 = Panel(python_7)
panel_8 = Panel(python_9)

# ---- group: DON'T PASS NODES
g_3 = PythonScript(node=podium_ht.lo)  # -> geom; inputs node: list
# ---------- g_3: Python ----------
node = filter(lambda n: n!=None,node)
if node and node != []:
    geom = []
    for n in node:
        if n.shape.z_dist < 1.2:
            geom.append(n.shape.bottom_crv)
        else:
            geom.append(n.shape.geom)
    print geom
# ---------- end g_3 ----------
g_4 = PythonScript(node=podium_ht.hi)  # -> geom; inputs node: list; same code as g_3

# ----
# AVENUES
number_slider_4 = Slider(25, range=0..100)
geo_8 = Geometry([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])

# ----
# STREETS
number_slider_5 = Slider(26, range=0..100)
geo_9 = Geometry(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)

number_slider_6 = Slider(18, range=0..100)
# SET DESIGN
# GRAMMARS
# RESIDENTIAL
# LOWRISE
toggle_3 = BooleanToggle(True)
# PODIUM
panel_9 = Panel("-4.5>4.5")
number_slider_7 = Slider(3, range=0..100)
list_4 = ValueList({"divide by depth": "subdivide_depth", "divide by same depth": "subdivide_depth_same", "divide by dim": "subdivide_dim"}, selected="divide by dim")

panel_10 = Panel(python_9)
panel_11 = Panel(python_8)
panel_12 = Panel(python_7)

# ----
# TOWERS
panel_13 = Panel(python_4)
panel_14 = Panel(python_6)
panel_15 = Panel(python_5)

list_5 = ValueList({"YZ": "NS", "XZ": "EW", "XY": "Z"}, selected="XZ")

# ---- group: SETBACK
miru_9 = PythonScript(Code=file_10, Height_stepback="0.0:2.0", Stepback_ref="-1", Stepback_tol=number_slider_5, Run=Toggle(True))

# ---- group: DIVIDE
miru_10 = PythonScript(
    Code=file_7,
    Divide_num=[number_slider_6, Slider(10, range=0..100)],
    Divide_type=list_4,
    Divide_ratio=Slider(0.5, range=0..1),
    Axis=list_5,
    Run=Toggle(True))

# ---- group: PERIMETER
miru_11 = PythonScript(Code=file_8, Width=number_slider_6, Cut_width=Slider(0, range=0..100), Court_ref="0", Run=Toggle(True))

# ---- group: TREE RULES
miru_12 = PythonScript(Code=file_13, Node=bibil_10.Node_out, Run=toggle_3)

# ---- group: HEIGHT
miru_13 = PythonScript(Code=file_11, Height=Slider(10.5, range=0..100), Height_ref="LoRes", Randomize=panel_9, Run=Toggle(True))

# ---- group: SETBACK
miru_14 = PythonScript(Code=file_10, Height_stepback=panel_12, Stepback_ref=geo_9, Stepback_tol=number_slider_5, Run=Toggle(True))

miru_15 = PythonScript(Code=file_10, Height_stepback=panel_11, Stepback_ref="0", Stepback_tol=number_slider_5, Run=Toggle(True))

miru_16 = PythonScript(Code=file_10, Height_stepback=panel_10, Stepback_ref=geo_8, Stepback_tol=number_slider_4, Run=Toggle(True))

miru_17 = PythonScript(Code=file_10, Height_stepback=panel_13, Stepback_ref=geo_9, Stepback_tol=number_slider_5, Run=Toggle(True))

miru_18 = PythonScript(Code=file_10, Height_stepback=panel_15, Stepback_ref="0", Stepback_tol=number_slider_5, Run=Toggle(True))

miru_19 = PythonScript(Code=file_10, Height_stepback=panel_14, Stepback_ref=geo_8, Stepback_tol=number_slider_4, Run=Toggle(True))

# ---- group: HEIGHT
miru_20 = PythonScript(Code=file_11, Height=Slider(200, range=0..1000), Run=Toggle(True))

# ---- group: PERIMETER
miru_21 = PythonScript(Code=file_8, Width=Slider(30, range=0..100), Cut_width=Slider(0, range=0..100), Court_ref="0", Run=Toggle(True))

# ---- group: HEIGHT
miru_22 = PythonScript(Code=file_11, Height=data_4, Height_ref="MidRes", Run=Toggle(True))

# ---- group: TREE RULES
miru_23 = PythonScript(Code=file_13, Node=bibil_10.Node_out, Run=Toggle(True))

# ----
geo_10 = Geometry([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])
geo_11 = Geometry([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])
geo_12 = Geometry([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])
geo_13 = Geometry([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])

# ---- group: SHAPENODE
bibil_13 = PythonScript(
    Code=file_6,
    Rule_in=flatten([miru_12, miru_11, miru_9, miru_10, miru_13]),
    Node_in=flatten(g_3),
    Label_="LoRes",
    Run=Toggle(False))  # -> Node_out, Debug

# ----
geo_14 = Geometry([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])

# ---- group: SHAPENODE
bibil_14 = PythonScript(
    Code=file_6,
    Rule_in=flatten([miru_23, miru_21, miru_22, miru_14, miru_15, miru_16]),
    Node_in=flatten(g_4),
    Label_="MidRes",
    Run=Toggle(True))  # -> Node_out, Debug

# ----
g_5 = PythonScript(node=bibil_13.Node_out)  # -> geom; inputs node: list; same code as g_3
g_6 = PythonScript(node=bibil_13.Node_out)  # -> crv; inputs node: list
# ---------- g_6: Python ----------
node = filter(lambda n: n!=None,node)
if node and node != []:
    crv = []
    for n in node:
        crv.append(n.shape.bottom_crv)
# ---------- end g_6 ----------

# ---- group: SHAPENODE
bibil_15 = PythonScript(
    Code=file_6,
    Rule_in=flatten([miru_17, miru_18, miru_19, miru_20]),
    Node_in=flatten(geo_14),
    Label_="HiResDiff",
    Run=Toggle(True))  # -> Node_out, Debug

# ----
g_7 = PythonScript(node=bibil_14.Node_out)  # -> geom; inputs node: list; same code as g_3
panel_16 = Panel("-1")
panel_17 = Panel("-6.0>6")
panel_18 = Panel("""37.5:3.0
82.5:6.0""")
g_8 = PythonScript(node=bibil_15.Node_out)  # -> geom; inputs node: list
# ---------- g_8: Python ----------
node = filter(lambda n: n!=None,node)
if node and node != []:
    geom = []
    for n in node:
        geom.append(n.shape.bottom_crv)
# ---------- end g_8 ----------

# ---- group: SETBACK
miru_24 = PythonScript(Code=file_10, Height_stepback=panel_18, Randomize="-6.0>6.0:-0.5>0.5", From_rear="side", Run=Toggle(True))

# ---- group: PACKING
separatedata_2 = Ladybug_SeparateData(Code=file_9, X_keep_omit="27.0,25.0", Y_keep_omit="27.0,25.0", Add_collision=g_6, Run=Toggle(True))

# ---- group: HEIGHT
miru_25 = PythonScript(Code=file_11, Height=Slider(121.5, range=0..1000), Height_ref="HiResTower", Run=Toggle(True))

# ---- group: PERIMETER
miru_26 = PythonScript(Code=file_8, Width=Slider(27, range=0..100), Cut_width=Slider(0, range=0..100), Court_ref=g_8, Run=Toggle(True))

# ----
neg = Negative(Value=Slider(5, range=0..10))
g_9 = PythonScript(node=bibil_15.Node_out)  # -> geom; inputs node: list
# ---------- g_9: Python ----------
node = filter(lambda n: n!=None,node)
if node and node != []:
    geom = []
    for n in node:
        geom.append(n.shape.geom)
# ---------- end g_9 ----------
Z = UnitZ(Factor=neg)
move = Move(Geometry=g_9, Motion=Z)  # -> Geometry, Transform
brep = Brep(g_4)
python_10 = PythonScript(x=brep, y=move.Geometry)  # -> a; inputs x: list, y: list
# ---------- python_10: Python ----------
import ghpythonlib.components as ghcomp
import rhinoscriptsyntax as rs

def intersect(x_,y_):
    for i in xrange(len(x_)):
        bld = x_[i]
        for j in xrange(len(y_)):
            ref = y_[j]
            inter = False
            try:
                ref = rs.coercebrep(ref)
                bld = rs.coercebrep(bld)
                inter = ghcomp.SolidIntersection(bld,ref)
            except Exception:
                pass
            if inter:
                yield inter
                break
a = intersect(x,y)
# ---------- end python_10 ----------

# ---- group: SHAPENODE
bibil_16 = PythonScript(
    Code=file_6,
    Rule_in=flatten([miru_26, separatedata_2, miru_25, miru_24]),
    Node_in=flatten(python_10),
    Label_="HiResTower",
    Run=Toggle(True))  # -> Node_out, Debug

# ----
g_10 = PythonScript(node=bibil_16.Node_out)  # -> geom; inputs node: list; same code as g_9
geo_15 = Geometry(bibil_16.Debug)
sdiff = SolidDifference(BrepsA=g_10, BrepsB=g_7)
python_11 = PythonScript(x=[g_5, g_7, sdiff])  # -> a; inputs x: list
# ---------- python_11: Python ----------
a = filter(lambda n:n!=None,x)
# ---------- end python_11 ----------
geo_16 = Geometry(python_11)
dam = DataDam(DataA=geo_16, BufferDelay=10000000, BufferMode=0)
# RUN
# SIMULATION
panel_19 = Panel("C:\Users\vasanthakumars\Documents\GitHub\bibil\src\reference\CAN_ON_Toronto.716240_CWEC\CAN_ON_Toronto.716240_CWEC.epw")
panel_20 = Panel("C:\\saeran\\master\\git\\bibil\\src\reference\CAN_ON_Toronto.716240_CWEC\CAN_ON_Toronto.716240_CWEC.epw")
list_6 = ValueList({"dir", "file"}, selected="file")

# ---- group: find directory
bibil_17 = PythonScript(dir=[panel_19, panel_20], type=list_6, run=Toggle(True))  # -> file; inputs dir: list; same code as bibil

# ----
number_slider_8 = Slider(9, range=0..10)
number_slider_9 = Slider(21, range=0..100)
importepw = Ladybug_ImportEpw(epwFile=bibil_17)  # -> readMe, latitude, location, dryBulbTemperature, dewPointTemperature, relativeHumidity, windSpeed, windDirection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; plug-in component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
analysisperiod = Ladybug_AnalysisPeriod(
    fromMonth=number_slider_8,
    fromDay=number_slider_9,
    fromHour=Slider(8.25, range=0..100),
    toMonth=number_slider_8,
    toDay=number_slider_9,
    toHour=Slider(17.25, range=0..100))  # -> readMe, analysisPeriod; plug-in component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
sunpath = Ladybug_SunPath(
    location=importepw.location,
    hour=12,
    day=21,
    month=12,
    timeStep=1,
    analysisPeriod=analysisperiod.analysisPeriod,
    dailyOrAnnualSunPath=True)  # -> readMe, sunVectors, sunAltitudes, sunAzimuths, port, sunSpheresMesh, sunPathCrvs, legend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; plug-in component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
gradientlibrary = Ladybug_GradientLibrary(gradIndex=Slider(16, range=0..100))  # -> customColors; plug-in component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
gradientlibrary_2 = Ladybug_GradientLibrary(gradIndex=Slider(0, range=0..100))  # -> customColors; plug-in component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
lng = ListLength(List=sunpath.sunVectors)
lng_2 = ListLength(List=sunpath.sunVectors)
addition = Addition(A=lng, B=1)
addition_2 = Addition(A=lng_2, B=1)
legendpar = Ladybug_LegendParameters(numSegments=addition, customColors=flatten(gradientlibrary))  # -> legendPar; plug-in component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
legendpar_2 = Ladybug_LegendParameters(numSegments=addition_2, customColors=flatten(gradientlibrary_2))  # -> legendPar; plug-in component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
geo_17 = Geometry(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)
# BLDG
sunlighthoursanalysis = Ladybug_SunlightHoursAnalysis(
    geometry=flatten(geo_16),
    gridSize=Slider(6, range=0..10),
    disFromBase=Slider(0.001, range=0..0.001),
    sunVectors=flatten(sunpath.sunVectors),
    timeStep=1,
    legendPar=flatten(legendpar_2),
    parallel=Toggle(True),
    runIt=Toggle(True))  # -> readMe, contextMesh, analysisMesh, testPts, testVec, port, flatten(sunlightHoursResult), sunlightHoursMesh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; plug-in component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
# GROUND
sunlighthoursanalysis_2 = Ladybug_SunlightHoursAnalysis(
    geometry=flatten(geo_17),
    context=flatten(geo_16),
    gridSize=Slider(4, range=0..10),
    disFromBase=Slider(0.001, range=0..0.001),
    sunVectors=flatten(sunpath.sunVectors),
    timeStep=1,
    legendPar=flatten(legendpar),
    parallel=Toggle(False),
    runIt=Toggle(True))  # -> readMe, contextMesh, analysisMesh, testPts, testVec, port, sunlightHoursResult, sunlightHoursMesh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; plug-in component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
sort = SortList(Keys=flatten(sunlighthoursanalysis.sunlightHoursResult))  # -> Keys, ValuesA
sort_2 = SortList(Keys=flatten(sunlighthoursanalysis_2.sunlightHoursResult))  # -> Keys, ValuesA
data_5 = Data(geo_16)
item = ListItem(List=sort.Keys, Index=0, Wrap=True)
item_2 = ListItem(List=sort.Keys, Index="-1", Wrap=True)
item_3 = ListItem(List=sort_2.Keys, Index=0, Wrap=True)
item_4 = ListItem(List=sort_2.Keys, Index="-1", Wrap=True)
gradient = Gradient(
    LowerLimit=item,
    UpperLimit=item_2,
    Parameter=sunlighthoursanalysis.sunlightHoursResult,
    stops=[0: RGB(234, 38, 0), 0.25: RGB(234, 126, 0), 0.5: RGB(254, 244, 84), 0.75: RGB(173, 203, 249)])
gradient_2 = Gradient(
    LowerLimit=item_3,
    UpperLimit=item_4,
    Parameter=sunlighthoursanalysis_2.sunlightHoursResult,
    stops=[0: RGB(0, 0, 0), 1: RGB(255, 255, 255)])

number_slider_10 = Slider(0.5, range=0..1)  # disabled
swatch = ColourSwatch(SwatchColor=RGB(255, 255, 255))  # disabled
number_slider_11 = Slider(0.8, range=0..1)  # disabled
material = CreateMaterial(Diffuse=swatch, Specular=RGB(255, 255, 255), Emission=RGB(0, 0, 0), Transparency=number_slider_10, Shine=0)  # disabled
mesh = Mesh(data_5)  # disabled
dots = DotDisplay(Point=sunlighthoursanalysis.testPts, Colour=gradient, Size=number_slider_11)  # disabled
# RUN
# OPTIMIZATION
# RECORD
# IMAGES/DATA/JSON
preview = CustomPreview(Geometry=mesh, Shader=material)  # disabled

pt = ConstructPoint(XCoordinate=0, YCoordinate=0, ZCoordinate=Slider(36, range=0..100))
pt_2 = ConstructPoint(XCoordinate=Slider(50, range=0..100), YCoordinate=0, ZCoordinate=0)

spectacles_linebasicmaterial = Spectacles_LineBasicMaterial(Color=ColourSwatch(SwatchColor=RGB(255, 255, 255)), LineWeight=1)
wires = BrepWireframe(Brep=data_5, Density=-1)
mesh_2 = Mesh(sunlighthoursanalysis.sunlightHoursMesh)

vec2pt = Vector2Pt(PointA=pt_2, PointB=pt, Unitize=False)  # -> Vector, Length

preview_2 = CustomPreview(Geometry=wires, Shader=ColourSwatch(SwatchColor=RGB(255, 255, 255)))

# ---- group: Spectacles Line Element
spectacles_line = Spectacles_Line(Line=wires, LineMaterial=spectacles_linebasicmaterial)

# ----
spectacles_meshcoloredfaces = Spectacles_MeshColoredFaces(Mesh=sunlighthoursanalysis.sunlightHoursMesh, Colors=gradient)
spectacles_meshcoloredfaces_2 = Spectacles_MeshColoredFaces(Mesh=sunlighthoursanalysis_2.sunlightHoursMesh, Colors=gradient_2)

# ---- group: Spectacles view
spectacles_views = Spectacles_Views(EyePosition=pt_2, Target=pt, Name="aerial_02")

# ---- group: Visualize view
vdisex = VectorDisplayEx(Point=pt_2, Vector=vec2pt.Vector, Colour=RGB(0, 0, 0), Width=2)

# ----
export = BooleanToggle(True)
spectacles_scenecompiler = Spectacles_SceneCompiler(
    Write=export,
    FilePath="C:\Users\vasanthakumars\Desktop\spectacles_out\stest.json",
    Elements=flatten([spectacles_views, spectacles_line, spectacles_meshcoloredfaces, spectacles_meshcoloredfaces_2]))
