# Grasshopper definition trinco_tower_twist_test_6.gh (Grasshopper 0.9.76)
# plug-ins: Python Interpreter, LunchBox

list = ValueList({"dir", "file"}, selected="dir")
python = PythonScript()  # -> out, a
# ---------- python: Python ----------
import os

print os.getcwd()
# ---------- end python ----------

# ---- group: find directory
bibil = PythonScript(
    dir=["C:\\Users\\vasanthakumars\\Documents\\GitHub\\bibil\\src", "C:\\saeran\\master\\git\\bibil\\src"],
    type=list,
    run=Toggle(True))  # -> dir; inputs dir: list
# ---------- bibil: Python ----------
import os
import sys

ghenv.Component.Params.Output[0].Name = "null"
ghenv.Component.Params.Output[0].NickName = "null"

#sys.path.append("C:\Program Files\Rhinoceros 5.0 (64-bit)\System")

if run:
    confirm_dir = None
    for d in dir:
        try:
            if type == "file":
                file_ = open(d)
                file_.close()
            else:
                print os.listdir(d)
            confirm_dir = d
            break
        except Exception as e:
            #print str(e)
            continue
    if confirm_dir != None:
        ghenv.Component.Params.Output[0].Name = type
        ghenv.Component.Params.Output[0].NickName = type
        dir = confirm_dir
        file = confirm_dir
null = None
# ---------- end bibil ----------

# ---- group: tree
python_script = PythonScript(i=bibil)  # -> o
# ---------- python_script: Python ----------
import os

if i:
    o = os.path.join(str(i),"bibil\\bibil_tree.py")
# ---------- end python_script ----------
file = ReadFile(File=python_script, PerLineParse=False)
bibil_2 = PythonScript(Code=file)

# ---- group: grammar
python_script_2 = PythonScript(i=bibil)  # -> o
# ---------- python_script_2: Python ----------
import os

if i:
    o = os.path.join(str(i),"bibil\\bibil_grammar.py")
# ---------- end python_script_2 ----------
file_2 = ReadFile(File=python_script_2, PerLineParse=False)
bibil_3 = PythonScript(Code=file_2)

# ---- group: shape
python_script_3 = PythonScript(i=bibil)  # -> o
# ---------- python_script_3: Python ----------
import os

if i:
    o = os.path.join(str(i),"bibil\\bibil_shape.py")
#o = os.path.join(str(i),"research\\bibil_shape_shape_3d_2d.py")
# ---------- end python_script_3 ----------
file_3 = ReadFile(File=python_script_3, PerLineParse=False)
bibil_4 = PythonScript(Code=file_3)

# ---- group: bula
python_script_4 = PythonScript(i=bibil)  # -> o
# ---------- python_script_4: Python ----------
import os

if i:
    o = os.path.join(str(i),"bula\\bula_minimal.py")
# ---------- end python_script_4 ----------
file_4 = ReadFile(File=python_script_4, PerLineParse=False)
bibil_5 = PythonScript(Code=file_4)

# ---- group: UI
python_script_5 = PythonScript(i=bibil)  # -> o
# ---------- python_script_5: Python ----------
import os

if i:
    o = os.path.join(str(i),"bibil\\bibil_UI.py")
# ---------- end python_script_5 ----------
file_5 = ReadFile(File=python_script_5, PerLineParse=False)

# ---- group: grammar_divide
python_script_6 = PythonScript(i=bibil)  # -> o
# ---------- python_script_6: Python ----------
import os

if i:
    o = os.path.join(str(i),"miru\\miru_divide.py")
# ---------- end python_script_6 ----------
file_6 = ReadFile(File=python_script_6, PerLineParse=False)

# ---- group: grammar_courtyard
python_script_7 = PythonScript(i=bibil)  # -> o
# ---------- python_script_7: Python ----------
import os

if i:
    o = os.path.join(str(i),"miru\\miru_court.py")
# ---------- end python_script_7 ----------
file_7 = ReadFile(File=python_script_7, PerLineParse=False)

# ---- group: grammar_tower
python_script_8 = PythonScript(i=bibil)  # -> o
# ---------- python_script_8: Python ----------
import os

if i:
    o = os.path.join(str(i),"miru\\miru_packing.py")
# ---------- end python_script_8 ----------
file_8 = ReadFile(File=python_script_8, PerLineParse=False)

python_script_9 = PythonScript(i=bibil)  # -> o
# ---------- python_script_9: Python ----------
import os

if i:
    o = os.path.join(str(i),"miru\\miru_stepback.py")
# ---------- end python_script_9 ----------
file_9 = ReadFile(File=python_script_9, PerLineParse=False)

# ---- group: grammar_height
python_script_10 = PythonScript(i=bibil)  # -> o
# ---------- python_script_10: Python ----------
import os

if i:
    o = os.path.join(str(i),"miru\\miru_height.py")
# ---------- end python_script_10 ----------
file_10 = ReadFile(File=python_script_10, PerLineParse=False)

# ---- group: grammar_analysis_pts
python_script_11 = PythonScript(i=bibil)  # -> o
# ---------- python_script_11: Python ----------
import os

if i:
    o = os.path.join(str(i),"miru\\miru_analysis.py")
# ---------- end python_script_11 ----------
file_11 = ReadFile(File=python_script_11, PerLineParse=False)

# ---- group: meta_tree
python_script_12 = PythonScript(i=bibil)  # -> o
# ---------- python_script_12: Python ----------
import os

if i:
    o = os.path.join(str(i),"miru\\miru_meta_tree.py")
# ---------- end python_script_12 ----------
file_12 = ReadFile(File=python_script_12, PerLineParse=False)

# ---- group: land_use
python_script_13 = PythonScript(i=bibil)  # -> o
# ---------- python_script_13: Python ----------
import os

if i:
    o = os.path.join(str(i),"miru\\miru_landuse.py")
# ---------- end python_script_13 ----------
file_13 = ReadFile(File=python_script_13, PerLineParse=False)

# ---- group: shape2height
python_script_14 = PythonScript(i=bibil)  # -> o
# ---------- python_script_14: Python ----------
import os

if i:
    o = os.path.join(str(i),"miru\\miru_shape2height.py")
# ---------- end python_script_14 ----------
file_14 = ReadFile(File=python_script_14, PerLineParse=False)

# ---- group: extract_slice
python_script_15 = PythonScript(i=bibil)  # -> o
# ---------- python_script_15: Python ----------
import os

if i:
    o = os.path.join(str(i),"miru\\miru_extract_slice.py")
# ---------- end python_script_15 ----------
file_15 = ReadFile(File=python_script_15, PerLineParse=False)

# ----
vec = VectorXYZ(XComponent=0, YComponent=0, ZComponent=0)  # -> Vector, Length

# ---- group: GEOREF
origin = Vector(Vector(313.1568888, 4834.12019, 0))

# ---- group: CPT
# MediumOffice
# LargeOffice
# RetailStripmall
# MidriseApartment
# HighriseApartment
# 
# **LowriseDetached << does this not exist?
vec_2 = Vector(Vector(-270.3557034, 184.6348583, 0))

# ---- group: A=pt2move2
subtraction = Subtraction(A=vec_2, B=origin)

# ----
geo = Geometry([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])

# ---- group: INPUT HERE
geo_2 = Geometry(geo)

# ----
move = Move(Geometry=geo_2, Motion=subtraction)  # -> Geometry, Transform
geo_3 = Geometry(move.Geometry)
geo_4 = Geometry(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)
geo_5 = Geometry(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)
geo_6 = Geometry([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])  # disabled
geo_7 = Geometry(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)
geo_8 = Geometry([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])  # disabled
geo_9 = Geometry([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])  # disabled
geo_10 = Geometry([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])  # disabled
python_2 = PythonScript(run=Toggle(True))  # -> out, HT_PT, GEO3D, PARCEL
# ---------- python_2: Python ----------
import Rhino
import rhinoscriptsyntax as rs
import scriptcontext


if run:
    PARCEL=[]
    GEO3D=[]
    HT_PT=[]
    scriptcontext.doc=Rhino.RhinoDoc.ActiveDoc
    merged_parcel_list=rs.ObjectsByLayer("_prog_merged_parcel")
    parcel_list=rs.ObjectsByLayer("_prog_ori_parcel")
    geo_3d_list=rs.ObjectsByLayer("_prog_parcel_3d")
    h_pt=[]
    for i in geo_3d_list:
        bb=rs.BoundingBox(i)
        pl=rs.AddPolyline([bb[0],bb[1],bb[2],bb[3],bb[0]])
        cen=rs.CurveAreaCentroid(pl)[0]
        h_pt.append([cen[0],cen[1],rs.BoundingBox(i)[4][2]])
        rs.DeleteObject(pl)
    k=0
    for i in parcel_list:
        #print(str(k)+' )'+str(i))
        PARCEL.append(rs.coercecurve(i))
        k+=1
    k=0
    for i in merged_parcel_list:
        #print(str(k)+' )'+str(i))
        PARCEL.append(rs.coercecurve(i))
        k+=1
    for i in geo_3d_list:
        GEO3D.append(rs.coercegeometry(i))
    
    for i in h_pt:
        HT_PT.append(rs.coerce3dpoint(i))
    scriptcontext.doc=ghdoc
# ---------- end python_2 ----------
devec = DeconstructVector(Vector=python_2.HT_PT)  # -> XComponent, YComponent, ZComponent

# ---- group: VARIABLES
python_3 = PythonScript(res=[geo_4, geo_5, geo_7], com=[geo_6, geo_8, geo_9], demand=devec.ZComponent, var_index=Slider(105, range=0..107))  # -> hi_res, hi_com, midhi_res, midlo_res, midhi_com, midlo_com, lo_com, var_a, var_b, var_c; inputs res: list, com: list, demand: list, var_index: Int32
# ---------- python_3: Python ----------
def set_density(demand_,parcel):
    lo,mid1,mid2,hi = [],[],[],[]
    for p in parcel:
        if demand_ > 25.5:
            #tower
            hi.append(parcel)
        elif demand_ > 10.5:
            #midrise
            if demand_ > 18.5:
                mid2.append(parcel)
            else:
                mid1.append(parcel)
        else:
            #lowrise
            lo.append(parcel)
    return hi,mid2,mid1,lo

if demand and var_index:
    ###
    steplst = map(lambda i: i*1.5,range(1,4))
    seplst = map(lambda i:20+(2.5*i),range(1,5))
    htlst = map(lambda i:i*6,range(2,11))
    demandlst = demand
    
    indexnum = len(steplst)*len(seplst)*len(htlst) * len(demandlst)
    print indexnum
    print demand
    
    count = 0
    L = []
    for dem in demandlst:
        for stp in steplst:
            for sep in seplst:
                for ht in htlst:
                    count += 1
                    hir_,mdr_2,mdr_1,lor_ = set_density(demand,res)
                    hic_,mdc_2,mdc_1,loc_ = set_density(demand,com)
                    
                    L.append((stp,sep,ht,hir_,mdr_2,mdr_1,lor_,hic_,mdc_2,mdc_1, loc_))
                    
                    
    #print count
    index = var_index
    var_a = L[index][0]
    var_b = L[index][1]
    var_c = L[index][2]
    
    hi_res = L[index][3]
    hi_com = L[index][4]
    midhi_res = L[index][5]
    midlo_res = L[index][6]
    midhi_com = L[index][7]
    midlo_com = L[index][8]
    lo_com = L[index][9]
    
    print "variables: ", var_a, var_b, var_c
# ---------- end python_3 ----------

# ----
data = Data(python_3.var_a)  # disabled
data_2 = Data(python_3.var_b)  # disabled
data_3 = Data(python_3.var_c)  # disabled
data_4 = Data(data)  # disabled
number_slider = Slider(4.5, range=0..10)  # disabled
number_slider_2 = Slider(1.5, range=0..10)  # disabled
number_slider_3 = Slider(21.5, range=0..100)  # disabled
number_slider_4 = Slider(13.5, range=0..100)  # disabled
number_slider_5 = Slider(4.5, range=0..10)  # disabled
data_5 = Data(data)  # disabled
data_6 = Data(data)
data_7 = Data(data)  # disabled
addition = Addition(A=data_4, B=number_slider)  # disabled
number_slider_6 = Slider(22.5, range=0..100)  # disabled
number_slider_7 = Slider(13.5, range=0..100)  # disabled
number_slider_8 = Slider(21.5, range=0..100)  # disabled
number_slider_9 = Slider(13.5, range=0..100)  # disabled
addition_2 = Addition(A=data_6, B=Slider(6, range=0..10))
addition_3 = Addition(A=data_5, B=number_slider_2)  # disabled
addition_4 = Addition(A=data_7, B=number_slider_5)  # disabled
python_4 = PythonScript(ht=number_slider_3, stpbck=addition)  # -> stp_str; disabled
# ---------- python_4: Python ----------
stp_str = str(ht) + ":" + str(stpbck)

print stp_str
# ---------- end python_4 ----------
python_5 = PythonScript(ht=number_slider_4, stpbck=data_4)  # -> stp_str; disabled; same code as python_4
python_6 = PythonScript(ht=number_slider_7, stpbck=data_5)  # -> stp_str; disabled; same code as python_4
python_7 = PythonScript(ht=number_slider_8, stpbck=addition_4)  # -> stp_str; disabled; same code as python_4
python_8 = PythonScript(ht=Slider(25.5, range=0..100), stpbck=addition_2)  # -> stp_str; same code as python_4
python_9 = PythonScript(ht=number_slider_9, stpbck=data_7)  # -> stp_str; disabled; same code as python_4
panel = Panel("25.5:9.0")
panel_2 = Panel("13.5:3.0")
python_10 = PythonScript(ht=number_slider_6, stpbck=addition_3)  # -> stp_str; disabled; same code as python_4
python_11 = PythonScript(ht=Slider(13.5, range=0..100), stpbck=data_6)  # -> stp_str; same code as python_4
number_slider_10 = Slider(31.5, range=0..100)
number_slider_11 = Slider(1, range=0..10)  # disabled
number_slider_12 = Slider(0.5, range=0..1)  # disabled
# HI-RESIDENTIAL
number_slider_13 = Slider(1, range=0..10)
number_slider_14 = Slider(0, range=0..100)  # disabled
number_slider_15 = Slider(0.5, range=0..1)  # disabled
number_slider_16 = Slider(25, range=0..100)  # disabled
panel_3 = Panel("-6.0>6")  # disabled
panel_4 = Panel("""13.5:1.5
21.5:6.0""")  # disabled
number_slider_17 = Slider(0, range=0..100)  # disabled
list_2 = ValueList({"divide by depth": "subdivide_depth", "divide by same depth": "subdivide_depth_same", "divide by dim": "subdivide_dim"}, selected="divide by depth")  # disabled
panel_5 = Panel("""7.5:9.0
13.5:12.0""")  # disabled
list_3 = ValueList({"divide by depth": "subdivide_depth", "divide by same depth": "subdivide_depth_same", "divide by dim": "subdivide_dim"}, selected="divide by depth")
toggle = BooleanToggle(True)  # disabled
list_4 = ValueList({"divide by depth": "subdivide_depth", "divide by same depth": "subdivide_depth_same", "divide by dim": "subdivide_dim"}, selected="divide by dim")  # disabled
geo_11 = Geometry(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)  # disabled
toggle_2 = BooleanToggle(True)  # disabled
toggle_3 = BooleanToggle(True)  # disabled
toggle_4 = BooleanToggle(True)  # disabled
geo_12 = Geometry(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)
toggle_5 = BooleanToggle(True)  # disabled
list_5 = ValueList({"YZ": "NS", "XZ": "EW", "XY": "Z"}, selected="XZ")  # disabled
panel_6 = Panel("100")  # disabled
panel_7 = Panel("20")  # disabled
list_6 = ValueList({"YZ": "NS", "XZ": "EW", "XY": "Z"}, selected="XZ")
geo_13 = Geometry(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)  # disabled
geo_14 = Geometry(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)  # disabled
list_7 = ValueList({"YZ": "NS", "XZ": "EW", "XY": "Z"}, selected="XZ")  # disabled
geo_15 = Geometry(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)  # disabled
panel_8 = Panel("0")
# MID-RESIDENTIAL 2
number_slider_18 = Slider(3, range=0..10)
panel_9 = Panel("""7.5:3.0
10.5:4.5
19.5:6.0""")
list_8 = ValueList({"divide by depth": "subdivide_depth", "divide by same depth": "subdivide_depth_same", "divide by dim": "subdivide_dim"}, selected="divide by depth")
number_slider_19 = Slider(31.5, range=0..100)  # disabled
geo_16 = Geometry(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)
number_slider_20 = Slider(31.5, range=0..100)  # disabled
number_slider_21 = Slider(38.5, range=0..100)  # disabled
number_slider_22 = Slider(0.5, range=0..1)  # disabled
# MID-RESIDENTIAL 1
number_slider_23 = Slider(24, range=0..100)
number_slider_24 = Slider(0, range=0..100)  # disabled
panel_10 = Panel("-9.0>9.0")  # disabled
panel_11 = Panel("-1")  # disabled
panel_12 = Panel("""13.5:1.5
25.5:9.0""")  # disabled
geo_17 = Geometry(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)  # disabled

# ---- group: SETBACK
miru = PythonScript(Code=file_9, Height_stepback=[python_5, python_4], Stepback_ref=geo_14, Run=toggle_4)  # disabled

# ----
panel_13 = Panel("""7.5:9.0
18.5:15.0""")  # disabled
panel_14 = Panel("""13.5:3.0
21.5:9.0""")  # disabled
number_slider_25 = Slider(48, range=0..100)  # disabled
panel_15 = Panel("0.0>0.0:-1.5>1.5")  # disabled
# MID-COMM
number_slider_26 = Slider(100, range=0..100)  # disabled
toggle_6 = BooleanToggle(True)  # disabled

# ---- group: SETBACK
miru_2 = PythonScript(Code=file_9, Height_stepback=panel_5, Stepback_ref=geo_11, Run=toggle)  # disabled

# ---- group: DIVIDE
# LOW-COMMERCIAL
miru_3 = PythonScript(
    Code=file_6,
    Divide_num=number_slider_11,
    Divide_cut=number_slider_14,
    Divide_type=list_2,
    Divide_ratio=number_slider_12,
    Axis=list_5,
    Run=toggle_2)  # disabled

# ----
list_9 = ValueList({"divide by depth": "subdivide_depth", "divide by same depth": "subdivide_depth_same", "divide by dim": "subdivide_dim"}, selected="divide by dim")  # disabled
panel_16 = Panel("""7.5:1.5
25.5:6.0""")

# ---- group: DIVIDE
miru_4 = PythonScript(
    Code=file_6,
    Divide_num=[panel_6, panel_7],
    Divide_cut=number_slider_17,
    Divide_type=list_4,
    Divide_ratio=number_slider_15,
    Axis=list_7,
    Run=toggle_5)  # disabled

# ---- group: HEIGHT
miru_5 = PythonScript(Code=file_10, Height=number_slider_16, Randomize=panel_3, Run=toggle_3)  # disabled

# ---- group: SETBACK
miru_6 = PythonScript(Code=file_9, Height_stepback=python_11, Stepback_ref=geo_12, Run=Toggle(True))

miru_7 = PythonScript(Code=file_9, Height_stepback=python_8, Stepback_ref="2", Run=Toggle(True))

# ----
list_10 = ValueList({"YZ": "NS", "XZ": "EW", "XY": "Z"}, selected="XZ")
toggle_7 = BooleanToggle(True)  # disabled
toggle_8 = BooleanToggle(True)  # disabled
toggle_9 = BooleanToggle(True)  # disabled

# ---- group: DIVIDE
miru_8 = PythonScript(
    Code=file_6,
    Divide_num=number_slider_13,
    Divide_cut=Slider(15, range=0..100),
    Divide_type=list_3,
    Divide_ratio=Slider(0.5, range=0..1),
    Axis=list_6,
    Run=Toggle(True))

# ---- group: PERIMETER
miru_9 = PythonScript(Code=file_7, Width=Slider(34, range=0..100), Cut_width=Slider(0, range=0..100), Court_ref="0", Run=Toggle(True))

# ---- group: HEIGHT
miru_10 = PythonScript(Code=file_10, Height=Slider(31.5, range=0..100), Run=Toggle(True))

# ----
toggle_10 = BooleanToggle(True)  # disabled
toggle_11 = BooleanToggle(True)  # disabled
# HI-COMM
toggle_12 = BooleanToggle(True)  # disabled
list_11 = ValueList({"YZ": "NS", "XZ": "EW", "XY": "Z"}, selected="XZ")  # disabled

# ---- group: SETBACK
miru_11 = PythonScript(Code=file_9, Height_stepback=python_6, Stepback_ref=geo_13, Run=toggle_9)  # disabled

miru_12 = PythonScript(Code=file_9, Height_stepback=python_10, Stepback_ref=panel_11, Run=toggle_8)  # disabled

miru_13 = PythonScript(Code=file_9, Height_stepback=[python_9, python_7], Stepback_ref=geo_15, Run=toggle_11)  # disabled

miru_14 = PythonScript(Code=file_9, Height_stepback=panel_13, Randomize=panel_15, Stepback_ref=geo_17, Run=toggle_12)  # disabled

# ---- group: HEIGHT
miru_15 = PythonScript(Code=file_10, Height=number_slider_20, Run=toggle_6)  # disabled

# ---- group: DIVIDE
miru_16 = PythonScript(
    Code=file_6,
    Divide_num=[number_slider_26, number_slider_25],
    Divide_cut=number_slider_24,
    Divide_type=list_9,
    Divide_ratio=number_slider_22,
    Axis=list_11,
    Run=toggle_10)  # disabled

# ---- group: HEIGHT
miru_17 = PythonScript(Code=file_10, Height=number_slider_21, Randomize=panel_10, Run=toggle_7)  # disabled

# ---- group: SETBACK
miru_18 = PythonScript(Code=file_9, Height_stepback=panel_16, Stepback_ref="-1", Run=Toggle(True))

miru_19 = PythonScript(Code=file_9, Height_stepback="7.5:1.5", Stepback_ref="2", Run=Toggle(True))

miru_20 = PythonScript(Code=file_9, Height_stepback=panel_9, Stepback_ref=geo_16, Run=Toggle(True))

# ---- group: DIVIDE
miru_21 = PythonScript(
    Code=file_6,
    Divide_num=number_slider_18,
    Divide_cut=Slider(10, range=0..100),
    Divide_type=list_8,
    Divide_ratio=Slider(0.5, range=0..1),
    Axis=list_10,
    Run=Toggle(True))

# ---- group: PERIMETER
miru_22 = PythonScript(Code=file_7, Width=number_slider_23, Cut_width=Slider(7, range=0..100), Court_ref="-1", Run=Toggle(True))

# ---- group: HEIGHT
miru_23 = PythonScript(Code=file_10, Height=Slider(28.5, range=0..100), Randomize="-6.0>6", Run=Toggle(True))

# ---- group: PERIMETER
miru_24 = PythonScript(Code=file_7, Width=Slider(12.5, range=0..100), Cut_width=Slider(0, range=0..100), Court_ref="2", Run=Toggle(True))

# ---- group: HEIGHT
miru_25 = PythonScript(Code=file_10, Height=Slider(19.5, range=0..100), Randomize="-6.0>6", Run=Toggle(True))

# ----
panel_17 = Panel("comm-low")  # disabled
toggle_13 = BooleanToggle(True)  # disabled
panel_18 = Panel("comm-hi")  # disabled

# ---- group: SHAPENODE
bibil_6 = PythonScript(
    Code=file_5,
    Rule_in=flatten([miru_8, miru_9, miru_10, miru_6, miru_7]),
    Node_in=flatten(geo_7),
    Label_="comm-hi",
    Run=Toggle(True))  # -> Node_out, Debug

# ----
panel_19 = Panel("comm-hi")  # disabled
toggle_14 = BooleanToggle(True)  # disabled
toggle_15 = BooleanToggle(True)  # disabled

# ---- group: SHAPENODE
bibil_7 = PythonScript(
    Code=file_5,
    Rule_in=flatten([miru_3, miru_4, miru_5, miru, miru_2]),
    Node_in=flatten(geo_6),
    Label_=panel_17,
    Run=toggle_13)  # -> Node_out, Debug; disabled

bibil_8 = PythonScript(
    Code=file_5,
    Rule_in=flatten([miru_21, miru_24, miru_25, miru_19, miru_20]),
    Node_in=flatten(geo_5),
    Label_="base",
    Run=Toggle(True))  # -> Node_out, Debug

bibil_9 = PythonScript(Code=file_5, Rule_in=flatten([miru_15, miru_11, miru_12]), Node_in=flatten(geo_9), Label_=panel_18, Run=toggle_14)  # -> Node_out, Debug; disabled

bibil_10 = PythonScript(Code=file_5, Rule_in=flatten([miru_22, miru_23, miru_18]), Node_in=flatten(geo_4), Label_="base", Run=Toggle(True))  # -> Node_out, Debug

bibil_11 = PythonScript(
    Code=file_5,
    Rule_in=flatten([miru_16, miru_17, miru_13, miru_14]),
    Node_in=flatten(geo_8),
    Label_=panel_19,
    Run=toggle_15)  # -> Node_out, Debug; disabled

# ----
python_12 = PythonScript(kp=Slider(27, range=0..100), om=data_2)  # -> stp_str
# ---------- python_12: Python ----------
stp_str = str(kp) + "," + str(om)

print stp_str
# ---------- end python_12 ----------
panel_20 = Panel("27.0,25.0")
g = PythonScript(node=bibil_8.Node_out)  # -> label; inputs node: list
# ---------- g: Python ----------
node = filter(lambda n: n!=None,node)
if node and node != []:
    label = []
    if True:#for i,n in enumerate(node):
        #print i
        root = node[0].get_root()
        L = root.traverse_tree(lambda n:n,internal=True) 
        for i in L:
            print i
            label.append(i)
        #label.append('--')
        #print '---'
# ---------- end g ----------
g_2 = PythonScript(node=bibil_10.Node_out)  # -> label; inputs node: list; same code as g
panel_21 = Panel(python_12)
panel_22 = Panel(g)
panel_23 = Panel(g_2)

# ---- group: PACKING
separatedata = Ladybug_SeparateData(Code=file_8, X_keep_omit=python_12, Y_keep_omit=python_12, Seperation_ref="-1", Run=Toggle(True))

# ---- group: EXTRACT_SLICE
miru_26 = PythonScript(Code=file_15, Run=Toggle(True))

# ---- group: SHAPENODE
bibil_12 = PythonScript(Code=file_5, Rule_in=flatten([miru_26, separatedata]), Node_in=flatten(bibil_6.Node_out), Run=Toggle(True))  # -> Node_out, Debug

# ---- group: PACKING
separatedata_2 = Ladybug_SeparateData(Code=file_8, X_keep_omit="30.0,35.0", Y_keep_omit="30.0,35.0", Seperation_ref="-1", Run=Toggle(True))

# ---- group: EXTRACT_SLICE
miru_27 = PythonScript(Code=file_15, Run=Toggle(True))

# ----
list_12 = ValueList({"divide by depth": "subdivide_depth", "divide by same depth": "subdivide_depth_same", "divide by dim": "subdivide_dim"}, selected="divide by same depth")
list_13 = ValueList({"YZ": "NS", "XZ": "EW", "XY": "Z"}, selected="XZ")

# ---- group: SHAPENODE
bibil_13 = PythonScript(Code=file_5, Rule_in=flatten([miru_27, separatedata_2]), Node_in=flatten(bibil_9.Node_out), Run=Toggle(True))  # -> Node_out, Debug

# ---- group: DIVIDE
miru_28 = PythonScript(
    Code=file_6,
    Divide_num=Slider(1, range=0..10),
    Divide_cut=Slider(0, range=0..100),
    Divide_type=list_12,
    Divide_ratio=Slider(0.5, range=0..1),
    Axis=list_13,
    Run=Toggle(True))

# ---- group: HEIGHT
miru_29 = PythonScript(Code=file_10, Height=Slider(6, range=0..100), Randomize="-3.0>6.0", Run=Toggle(True))

# ----
data_8 = Data(data_3)

# ---- group: HEIGHT
miru_30 = PythonScript(Code=file_10, Height=data_8, Run=Toggle(True))

# ----
addition_5 = Addition(A=data_8, B=Slider(50, range=0..100))

# ---- group: SHAPENODE
bibil_14 = PythonScript(Code=file_5, Rule_in=flatten([miru_28, miru_29]), Node_in=flatten(bibil_12.Debug), Run=Toggle(True))  # -> Node_out, Debug

bibil_15 = PythonScript(Code=file_5, Rule_in=flatten(miru_30), Node_in=flatten(bibil_12.Node_out), Run=Toggle(True))  # -> Node_out, Debug

# ---- group: HEIGHT
miru_31 = PythonScript(Code=file_10, Height=addition_5, Run=Toggle(True))

# ---- group: SHAPENODE
bibil_16 = PythonScript(Code=file_5, Rule_in=flatten(miru_31), Node_in=flatten(bibil_13.Node_out), Run=Toggle(True))  # -> Node_out, Debug

# ----
g_3 = PythonScript(node=bibil_10.Node_out)  # -> geom; inputs node: list
# ---------- g_3: Python ----------
node = filter(lambda n: n!=None,node)
if node and node != []:
    geom = []
    for n in node:
        if n.shape.z_dist < 1.2:
            geom.append(n.shape.bottom_crv)
        else:
            geom.append(n.shape.geom)
    print geom
# ---------- end g_3 ----------
g_4 = PythonScript(node=bibil_8.Node_out)  # -> geom; inputs node: list; same code as g_3
g_5 = PythonScript(node=bibil_7.Node_out)  # -> geom; inputs node: list; same code as g_3
# HI-RESIDENTIAL
g_6 = PythonScript(node=bibil_14.Node_out)  # -> geom; inputs node: list; same code as g_3
g_7 = PythonScript(node=bibil_6.Node_out)  # -> geom; inputs node: list; same code as g_3
g_8 = PythonScript(node=bibil_15.Node_out)  # -> geom; inputs node: list; same code as g_3
g_9 = PythonScript(node=[bibil_9.Node_out, bibil_11.Node_out])  # -> geom; inputs node: list; same code as g_3
g_10 = PythonScript(node=bibil_16.Node_out)  # -> geom; inputs node: list; same code as g_3
# HI-COMMERCIAL
swatch = ColourSwatch(SwatchColor=RGB(255, 255, 255))
# MID-RESIDENTIAL
swatch_2 = ColourSwatch(SwatchColor=RGB(255, 255, 255))
material = CreateMaterial(Diffuse=swatch, Specular=RGB(255, 255, 255), Emission=RGB(0, 0, 0), Transparency=Slider(0.2, range=0..1), Shine=0)
# LOW-COMMERCIAL
swatch_3 = ColourSwatch(SwatchColor=RGB(255, 255, 255))
material_2 = CreateMaterial(Diffuse=swatch_2, Specular=RGB(255, 255, 255), Emission=RGB(0, 0, 0), Transparency=Slider(0.2, range=0..1), Shine=0)
material_3 = CreateMaterial(Diffuse=swatch_3, Specular=RGB(255, 255, 255), Emission=RGB(0, 0, 0), Transparency=Slider(0.2, range=0..1), Shine=0)
preview = CustomPreview(Geometry=[g_9, g_10], Shader=material)
material_4 = CreateMaterial(
    Diffuse=ColourSwatch(SwatchColor=RGB(255, 255, 255)),
    Specular=RGB(255, 255, 255),
    Emission=RGB(0, 0, 0),
    Transparency=Slider(0.2, range=0..1),
    Shine=0)
preview_2 = CustomPreview(Geometry=[g_4, g_3], Shader=material_2)
preview_3 = CustomPreview(Geometry=g_5, Shader=material_3)
preview_4 = CustomPreview(Geometry=[g_6, g_8, g_7], Shader=material_4)
panel_24 = Panel("https://www.energyplus.net/weather-download/north_and_central_america_wmo_region_4/USA/CA/USA_CA_San.Francisco.Intl.AP.724940_TMY3/all")
number_slider_27 = Slider(9, range=0..10)
number_slider_28 = Slider(21, range=0..100)
epw_stat = Ladybug_OpenEPWAndSTATWeatherFiles(weatherFileURL=panel_24)  # -> epwFile, statFile; plug-in component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
ladybug = Ladybug_Ladybug()  # -> Vviiiiiiiiiizzz; plug-in component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
honeybee = Honeybee_Honeybee()  # -> Vviiiiiiiiiizzz; plug-in component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
analysisperiod = Ladybug_AnalysisPeriod(
    fromMonth=number_slider_27,
    fromDay=number_slider_28,
    fromHour=Slider(8.25, range=0..10),
    toMonth=number_slider_27,
    toDay=number_slider_28,
    toHour=Slider(17.25, range=0..100))  # -> readMe, analysisPeriod; plug-in component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
mesh = Mesh([g_3, g_4, g_5, g_6, g_7, g_9, g_10, g_8])
geo_18 = Geometry([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])
importlocation = Ladybug_ImportLocation(epwFile=epw_stat.epwFile)  # -> location; plug-in component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
material_5 = CreateMaterial(
    Diffuse=ColourSwatch(SwatchColor=RGB(255, 255, 255)),
    Specular=RGB(255, 255, 255),
    Emission=RGB(0, 0, 0),
    Transparency=Slider(0, range=0..1),
    Shine=0)
sunpath = Ladybug_SunPath(
    location=importlocation,
    hour=12,
    day=21,
    month=12,
    timeStep=1,
    analysisPeriod=analysisperiod.analysisPeriod,
    dailyOrAnnualSunPath=True)  # -> readMe, sunVectors, sunAltitudes, sunAzimuths, port, sunSpheresMesh, sunPathCrvs, legend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; plug-in component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
preview_5 = CustomPreview(Geometry=mesh, Shader=material_5)
number_slider_29 = Slider(13, range=0..100)
gradientlibrary = Ladybug_GradientLibrary(gradIndex=Slider(6, range=0..10))  # -> customColors; plug-in component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

# ---- group: set up number of legend segments based on number of vectors
lng = ListLength(List=sunpath.sunVectors)
addition_6 = Addition(A=lng, B=1)
legendpar = Ladybug_LegendParameters(numSegments=addition_6, customColors=flatten(gradientlibrary))  # -> legendPar; plug-in component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

# ----
geo_19 = Geometry([g_3, g_4, g_5, g_6, g_8, g_7, g_9, g_10])

# ---- group: SHAPENODE
bibil_17 = PythonScript(node_in=flatten(geo_19), label="buildings4analysis", run=Toggle(True))  # -> node_out, debug; inputs rule_in: tree, node_in: list, label: list, run: Boolean
# ---------- bibil_17: Python ----------
"""
Trinco UI
"""

import scriptcontext as sc
import clr

Grammar = sc.sticky["Grammar"]
clr.AddReference("Grasshopper")
from Grasshopper.Kernel.Data import GH_Path
from Grasshopper import DataTree

if run and node_in != []:
    node_in = filter(lambda n: n!=None,node_in)
    if rule_in.BranchCount < 0.5:
        rule_in = DataTree[object]()
        rule_ = []
        for i, r in enumerate(rule_):
            rule_in.Add(r)
        
    G = Grammar()
    sc.sticky["debug"] = []
    debug = sc.sticky["debug"]
    node_out = G.main_UI(node_in,rule_in,label_)
else:
    print 'Add inputs!'
# ---------- end bibil_17 ----------

# ----
g_11 = PythonScript(node=bibil_17.node_out)  # -> label; inputs node: list; same code as g
number_slider_30 = Slider(3, range=0..10)
toggle_16 = BooleanToggle(True)

# ---- group: ANALYSIS
miru_32 = PythonScript(
    node_in=bibil_17.node_out,
    groundFloor_ht=number_slider_30,
    restFloor_ht=number_slider_30,
    height=toggle_16,
    GFA=toggle_16)  # -> ReadMe, geom_out, pt_out, label_out, analysis_out, debug; inputs node_in: list
# ---------- miru_32: Python ----------
import rhinoscriptsyntax as rs
import Rhino as rc
import random
import scriptcontext as sc
import copy
import math
import ghpythonlib.components as ghcomp

"""import classes"""
Shape = sc.sticky["Shape"]
Tree = sc.sticky["Tree"]

sc.sticky['debug'] = []
debug = sc.sticky["debug"]

TOL = sc.doc.ModelAbsoluteTolerance

def get_label(n):
    label_ = []
    root = n[0].get_root()
    L = root.traverse_tree(lambda n:n,internal=True) 
    for nl in L:
        #print nl
        label_.append(nl)
    return label_

def make_analysis(nodelen,pd):
    ## Input: dictionary of parameter key, list of data value 
    ## Output: Filtered list of str: with keys and value
    L = [""] * nodelen
    if pd.has_key('height'):
        for i,ht in enumerate(pd['height']):
            valstr = 'height: %s' % (ht)
            L[i] += valstr
    if pd.has_key('GFA'):
        for i,gfa in enumerate(pd['GFA']):
            valstr = '\nGFA: %s' % (gfa)
            L[i] += valstr
    return L

def get_ht(node_):
    L = []
    for n_ in node_:
        storey = str(round(n_.shape.ht,1))
        L.append(storey)
    return L

def get_GFA(node_,ght,rht):
    def helper_by_floor_div(n__,groundht):
        ratio = groundht/n__.shape.ht
        PD = {}
        PD['div_num'] = 1
        PD['div_deg'] = 0.
        PD['div_cut'] = 0.
        PD['div_ratio'] = ratio
        PD['div_type'] = 'simple_divide'
        PD['axis'] = "Z"
        divnode = n__.grammar.divide(n_,PD)
        
        if abs(divnode.loc[0].shape.ht - groundht) < 0.01:
            groundfloor = divnode.loc[0]
            restfloor = divnode.loc[1]
        else:
            groundfloor = divnode.loc[1]
            restfloor = divnode.loc[0]
        return groundfloor,restfloor
    def helper_by_floor_calc(n__,htdiv):
        n__.shape.geom = ghcomp.CapHolesEx(n__.shape.geom)[0]
        shapevol = rc.Geometry.VolumeMassProperties.Compute(n__.shape.geom).Volume
        shapegfa = shapevol/htdiv
        return shapegfa
        
    debug = sc.sticky['debug']
    ReadMe_ = ""
    L = []
    for n_ in node_:
        if abs(ght-rht)<0.1:
            gfacalc = helper_by_floor_calc(n_,rht)
        else:
            try:
                grndshape,rstshape = helper_by_floor_div(n_,ght)
                grndgfa = grndshape.shape.get_area()
                rstgfa = helper_by_floor_calc(rstshape,rht)
                gfacalc = grndgfa + rstgfa
            except:
                ReadMe_ = "Calculating by specific floor heights has failed, probably because the geometry was too complicated. GFA is now based on restfloorht."
                gfacalc = helper_by_floor_calc(rstshape,3.)
        #debug.extend(map(lambda n:n.shape.geom,divnode.loc))
        L.append(str(round(abs(gfacalc),1)))
    return L,ReadMe_

node = filter(lambda n: n!=None,node_in)
if node and node != []:
    node = map(lambda n: copy.deepcopy(n),node)
    sc.sticky['debug'] = []
    debug = sc.sticky['debug']
    ReadMe = ""
    
    #These always appear by default
    label_out = get_label(node)
    geom_out = map(lambda n:n.shape.geom,node)
    pt_out = map(lambda n:n.shape.cpt,node)
    #Analysis paramaters
    param_dict = {}
    if height==True:
        ht_out = get_ht(node)
        param_dict['height'] = ht_out
    if GFA == True:
        if not groundFloor_ht:
            groundFloor_ht = 3.0
        if not restFloor_ht:
            restFloor_ht = 3.0
        gfa_out,readmegfa = get_GFA(node,groundFloor_ht,restFloor_ht)
        param_dict['GFA'] = gfa_out
        ReadMe += readmegfa
    analysis_out = make_analysis(len(node),param_dict)
    if not ReadMe:
        ReadMe = "Successfully calculated"
# ---------- end miru_32 ----------

# ----
panel_25 = Panel(miru_32.analysis_out)
panel_26 = Panel(miru_32.ReadMe)

# ---- group: ground
geo_20 = Geometry(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)

# ----
mesh_2 = Mesh([g_3, g_4, g_5, g_6, g_8, g_7, g_9, g_10])
sunlighthoursanalysis = Ladybug_SunlightHoursAnalysis(
    geometry=flatten(geo_20),
    context=flatten(mesh_2),
    gridSize="1",
    disFromBase=Slider(0.001, range=0..0.001),
    sunVectors=flatten(sunpath.sunVectors),
    timeStep=1,
    legendPar=flatten(legendpar),
    parallel=Toggle(True),
    runIt=Toggle(False))  # -> readMe, contextMesh, analysisMesh, testPts, testVec, port, sunlightHoursResult, sunlightHoursMesh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; plug-in component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
python_13 = PythonScript(analysis_in=miru_32.analysis_out)  # -> GFA; inputs analysis_in: list
# ---------- python_13: Python ----------
analysis_in = filter(lambda n: n!=None,analysis_in)

if analysis_in:
    ID,GFA,HT = [],[],[]
    for an in analysis_in:
        lst = an.split('\n')
        ID.append('null')
        ht = float(lst[0].split(": ")[-1])
        gfa = float(lst[1].split(": ")[-1])
        HT.append(ht)
        GFA.append(gfa)
        #print '--'
# ---------- end python_13 ----------
panel_27 = Panel(sunlighthoursanalysis.totalSunlightHours)
ma = MassAddition(Input=python_13)  # -> Result, PartialResults
rec = DataRecorder(ma.Result, DataLimit=1000, RecordData=True)
panel_28 = Panel(ma.Result)
mesh_3 = Mesh(sunlighthoursanalysis.sunlightHoursMesh)
g_12 = PythonScript(node=[bibil_8.Node_out, bibil_10.Node_out, bibil_7.Node_out, bibil_15.Node_out, bibil_14.Node_out, bibil_6.Node_out, bibil_11.Node_out, bibil_9.Node_out, bibil_16.Node_out])  # -> gfa; inputs node: list
# ---------- g_12: Python ----------
import rhinoscriptsyntax as rs
import Rhino as rc

node = filter(lambda n: n!=None,node)
if node and node != []:
    shapegfa = []
    for n in node:
        htdiv = 3.0
        shapevol = rc.Geometry.VolumeMassProperties.Compute(n.shape.geom).Volume
        shapegfa.append(shapevol/htdiv)
    gfa = sum(shapegfa)
    print gfa
# ---------- end g_12 ----------
# maxbld gfa: 561415.2
# minbld gfa: 421682.2
# maxbld sun: 368381.6
# minbld sun: 391561.2
python_14 = PythonScript(gfa=g_12, sun=sunlighthoursanalysis.totalSunlightHours)  # -> normgfa, normsun
# ---------- python_14: Python ----------
#import scriptcontext as sc
#Bula = sc.sticky['Bula']
#B = Bula()
#B.normalize_list(lov,hibound,lobound)

def norm(v,min_,max_):
    #norm_val = ((hibound-lobound)*(v-min_))/(max_-min_) + lobound
    return ((10.-0.01)*(v-min_))/(max_-min_) + 0.01


maxgfa = 561415.2
mingfa = 421682.2

#maxsun = 391561.2
#minsun = 368381.6

normgfa = norm(gfa,maxgfa,mingfa)
#normsun = norm(sun,maxsun,minsun)
print normgfa
# ---------- end python_14 ----------
toggle_17 = BooleanToggle(False)
rec_2 = DataRecorder(python_3.var_a, DataLimit=10000, RecordData=True)
rec_3 = DataRecorder(python_3.var_b, DataLimit=10000, RecordData=True)
rec_4 = DataRecorder(python_3.var_c, DataLimit=10000, RecordData=True)
rec_5 = DataRecorder(python_14.normgfa, DataLimit=10000, RecordData=True)
rec_6 = DataRecorder(python_14.normsun, DataLimit=10000, RecordData=True)
excelwrite = ExcelWriteLEGACY(
    WriteToggle=toggle_17,
    WriteHeading=toggle_17,
    ClearSheet=Toggle(False),
    Worksheet=1,
    ColumnStart=1,
    RowStart=1,
    ColumnHeadings=["STEP_INCREMENT", "SEPERATION", "HEIGHT_INCREMENT", "GFA", "SUN"],
    Column1=rec_2,
    Column2=rec_3,
    Column3=rec_4,
    Column4=rec_5,
    Column5=rec_6)
