# Grasshopper definition trinco_tower_twist_test_7.gh (Grasshopper 0.9.76)
# plug-ins: Python Interpreter, LunchBox

list = ValueList({"dir", "file"}, selected="dir")
python = PythonScript()  # -> out, a
# ---------- python: Python ----------
import os

print os.getcwd()
# ---------- end python ----------

# ---- group: find directory
bibil = PythonScript(
    dir=["C:\\Users\\vasanthakumars\\Documents\\GitHub\\bibil\\src", "C:\\saeran\\master\\git\\bibil\\src"],
    type=list,
    run=Toggle(True))  # -> dir; inputs dir: list
# ---------- bibil: Python ----------
import os
import sys

ghenv.Component.Params.Output[0].Name = "null"
ghenv.Component.Params.Output[0].NickName = "null"

#sys.path.append("C:\Program Files\Rhinoceros 5.0 (64-bit)\System")

if run:
    confirm_dir = None
    for d in dir:
        try:
            if type == "file":
                file_ = open(d)
                file_.close()
            else:
                print os.listdir(d)
            confirm_dir = d
            break
        except Exception as e:
            #print str(e)
            continue
    if confirm_dir != None:
        ghenv.Component.Params.Output[0].Name = type
        ghenv.Component.Params.Output[0].NickName = type
        dir = confirm_dir
        file = confirm_dir
null = None
# ---------- end bibil ----------

# ---- group: tree
python_script = PythonScript(i=bibil)  # -> o
# ---------- python_script: Python ----------
import os

if i:
    o = os.path.join(str(i),"bibil\\bibil_tree.py")
# ---------- end python_script ----------
file = ReadFile(File=python_script, PerLineParse=False)
bibil_2 = PythonScript(Code=file)

# ---- group: grammar
python_script_2 = PythonScript(i=bibil)  # -> o
# ---------- python_script_2: Python ----------
import os

if i:
    o = os.path.join(str(i),"bibil\\bibil_grammar.py")
# ---------- end python_script_2 ----------
file_2 = ReadFile(File=python_script_2, PerLineParse=False)
bibil_3 = PythonScript(Code=file_2)

# ---- group: shape
python_script_3 = PythonScript(i=bibil)  # -> o
# ---------- python_script_3: Python ----------
import os

if i:
    o = os.path.join(str(i),"bibil\\bibil_shape.py")
#o = os.path.join(str(i),"research\\bibil_shape_shape_3d_2d.py")
# ---------- end python_script_3 ----------
file_3 = ReadFile(File=python_script_3, PerLineParse=False)
bibil_4 = PythonScript(Code=file_3)

# ---- group: bula
python_script_4 = PythonScript(i=bibil)  # -> o
# ---------- python_script_4: Python ----------
import os

if i:
    o = os.path.join(str(i),"bula\\bula_minimal.py")
# ---------- end python_script_4 ----------
file_4 = ReadFile(File=python_script_4, PerLineParse=False)
bibil_5 = PythonScript(Code=file_4)

# ---- group: UI
python_script_5 = PythonScript(i=bibil)  # -> o
# ---------- python_script_5: Python ----------
import os

if i:
    o = os.path.join(str(i),"bibil\\bibil_UI.py")
# ---------- end python_script_5 ----------
file_5 = ReadFile(File=python_script_5, PerLineParse=False)

# ---- group: grammar_divide
python_script_6 = PythonScript(i=bibil)  # -> o
# ---------- python_script_6: Python ----------
import os

if i:
    o = os.path.join(str(i),"miru\\miru_divide.py")
# ---------- end python_script_6 ----------
file_6 = ReadFile(File=python_script_6, PerLineParse=False)

# ---- group: grammar_courtyard
python_script_7 = PythonScript(i=bibil)  # -> o
# ---------- python_script_7: Python ----------
import os

if i:
    o = os.path.join(str(i),"miru\\miru_court.py")
# ---------- end python_script_7 ----------
file_7 = ReadFile(File=python_script_7, PerLineParse=False)

# ---- group: grammar_tower
python_script_8 = PythonScript(i=bibil)  # -> o
# ---------- python_script_8: Python ----------
import os

if i:
    o = os.path.join(str(i),"miru\\miru_packing.py")
# ---------- end python_script_8 ----------
file_8 = ReadFile(File=python_script_8, PerLineParse=False)

python_script_9 = PythonScript(i=bibil)  # -> o
# ---------- python_script_9: Python ----------
import os

if i:
    o = os.path.join(str(i),"miru\\miru_stepback.py")
# ---------- end python_script_9 ----------
file_9 = ReadFile(File=python_script_9, PerLineParse=False)

# ---- group: grammar_height
python_script_10 = PythonScript(i=bibil)  # -> o
# ---------- python_script_10: Python ----------
import os

if i:
    o = os.path.join(str(i),"miru\\miru_height.py")
# ---------- end python_script_10 ----------
file_10 = ReadFile(File=python_script_10, PerLineParse=False)

# ---- group: grammar_analysis_pts
python_script_11 = PythonScript(i=bibil)  # -> o
# ---------- python_script_11: Python ----------
import os

if i:
    o = os.path.join(str(i),"miru\\miru_analysis.py")
# ---------- end python_script_11 ----------
file_11 = ReadFile(File=python_script_11, PerLineParse=False)

# ---- group: meta_tree
python_script_12 = PythonScript(i=bibil)  # -> o
# ---------- python_script_12: Python ----------
import os

if i:
    o = os.path.join(str(i),"miru\\miru_meta_tree.py")
# ---------- end python_script_12 ----------
file_12 = ReadFile(File=python_script_12, PerLineParse=False)

# ---- group: land_use
python_script_13 = PythonScript(i=bibil)  # -> o
# ---------- python_script_13: Python ----------
import os

if i:
    o = os.path.join(str(i),"miru\\miru_landuse.py")
# ---------- end python_script_13 ----------
file_13 = ReadFile(File=python_script_13, PerLineParse=False)

# ---- group: shape2height
python_script_14 = PythonScript(i=bibil)  # -> o
# ---------- python_script_14: Python ----------
import os

if i:
    o = os.path.join(str(i),"miru\\miru_shape2height.py")
# ---------- end python_script_14 ----------
file_14 = ReadFile(File=python_script_14, PerLineParse=False)

# ---- group: extract_slice
python_script_15 = PythonScript(i=bibil)  # -> o
# ---------- python_script_15: Python ----------
import os

if i:
    o = os.path.join(str(i),"miru\\miru_extract_slice.py")
# ---------- end python_script_15 ----------
file_15 = ReadFile(File=python_script_15, PerLineParse=False)

# ----
vec = VectorXYZ(XComponent=0, YComponent=0, ZComponent=0)  # -> Vector, Length

# ---- group: GEOREF
origin = Vector(Vector(313.1568888, 4834.12019, 0))

# ---- group: CPT
vec_2 = Vector(Vector(-270.3557034, 184.6348583, 0))

# ----
list_2 = ValueList({"divide by depth": "subdivide_depth", "divide by same depth": "subdivide_depth_same", "divide by dim": "subdivide_dim"}, selected="divide by same depth")

# ---- group: A=pt2move2
subtraction = Subtraction(A=vec_2, B=origin)

# ----
list_3 = ValueList({"YZ": "NS", "XZ": "EW", "XY": "Z"}, selected="XZ")
geo = Geometry([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])

# ---- group: INPUT HERE
geo_2 = Geometry(geo)

# ---- group: PACKING
separatedata = Ladybug_SeparateData(Code=file_8, X_keep_omit="27.0,25.0", Y_keep_omit="27.0,25.0", Seperation_ref="-1", Run=Toggle(True))

# ---- group: EXTRACT_SLICE
miru = PythonScript(Code=file_15, Run=Toggle(False))

# ---- group: DIVIDE
miru_2 = PythonScript(
    Code=file_6,
    Divide_num=Slider(2, range=0..10),
    Divide_cut=Slider(0, range=0..100),
    Divide_type=list_2,
    Divide_ratio=Slider(0.5, range=0..1),
    Axis=list_3,
    Run=Toggle(False))

# ---- group: PERIMETER
miru_3 = PythonScript(Code=file_7, Width=Slider(20, range=0..100), Cut_width=Slider(0, range=0..100), Court_ref="0", Run=Toggle(False))

# ---- group: HEIGHT
miru_4 = PythonScript(Code=file_10, Height=Slider(16.5, range=0..100), Run=Toggle(True))

# ---- group: TREE RULES
miru_5 = PythonScript(Code=file_12, Run=Toggle(False))

# ---- group: SHAPE2HEIGHT
miru_6 = PythonScript(Code=file_14, Run=Toggle(False))

# ----
move = Move(Geometry=geo_2, Motion=subtraction)  # -> Geometry, Transform
# 1. DEMAND CALCULATION
geo_3 = Geometry(move.Geometry)

# ---- group: crv
geo_4 = Geometry([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])

# ----
geo_5 = Geometry([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])
bibil_6 = PythonScript(Code=file_5, Node_in=flatten(geo_5), Label_="parcel", Run=Toggle(True))  # -> Node_out, Debug
geo_6 = Geometry([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])
geo_7 = Geometry([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])
python_2 = PythonScript(reslst=geo_6, comlst=geo_7, parcels=bibil_6.Node_out, run=Toggle(True))  # -> res, com, debug; inputs reslst: list, comlst: list, parcels: list
# ---------- python_2: Python ----------
import Rhino as rc
import rhinoscriptsyntax as rs
import scriptcontext as sc

sc.sticky['debug'] = []
def parcel_by_zone(parcel_,zone_):
    debug = sc.sticky['debug']
    L = []
    cpt = parcel_.shape.cpt
    for j in xrange(len(zone_)):
        zonecrv = zone_[j]
        #debug.append(zonecrv)
        IsIn = rs.PointInPlanarClosedCurve(cpt,zonecrv)
        if IsIn>0.5:
            IsDefined = True
            debug.append(parcel)
            L.append(parcel)
            break
    return L

if run and parcels:
    res,com = [],[]
    
    #sc.doc = rc.RhinoDoc.ActiveDoc
    #lst_res_zone = rs.ObjectsByLayer("_rule_residential")
    #lst_com_zone = rs.ObjectsByLayer("_rule_commercial")
    lst_res_zone = reslst
    lst_com_zone = comlst
    
    for i in xrange(len(parcels)):
        parcel = parcels[i]
        res += parcel_by_zone(parcel,lst_res_zone)
        com += parcel_by_zone(parcel,lst_com_zone)
    
debug = sc.sticky['debug']
# ---------- end python_2 ----------
devec = DeconstructVector(Vector=bibil_6.Node_out)  # -> XComponent, YComponent, ZComponent

# ---- group: Building Types
panel = Panel("""MediumOffice
LargeOffice
RetailStripmall
MidriseApartment
HighriseApartment

**LowriseDetached << does this not exist?""")

# ----
# 2. MAPPING FUNCTION
geo_8 = Geometry([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])
g = PythonScript(node=[python_2.com, python_2.res])  # -> geom; inputs node: list
# ---------- g: Python ----------
node = filter(lambda n: n!=None,node)
if node and node != []:
    geom = []
    for n in node:
        geom.append(n.shape.bottom_crv)
    print geom
# ---------- end g ----------
geo_9 = Geometry([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])

# ---- group: VARIABLES
python_3 = PythonScript(res=python_2.res, com=python_2.com, var_index=Slider(105, range=0..107), run=Toggle(True))  # -> hi_res, hi_com, midhi_res, midlo_res, midhi_com, midlo_com, lo_com, var_a, var_b, var_c; inputs res: list, com: list, var_index: Int32
# ---------- python_3: Python ----------
import random
import scriptcontext as sc

Bula = sc.sticky['Bula']

def set_density(demand_,parcel):
    #This should be part of the mapping function in Bula
    lo,mid1,mid2,hi = [],[],[],[]
    for p in parcel:
        x_dist = p.shape.x_dist
        y_dist = p.shape.y_dist
        
        # HIRISE
        if demand_ > 25.5:
            hi.append(p)
        # MIDRISE
        elif demand_ > 10.5:
            if demand_ > 18.5:
                mid2.append(p)
            else:
                mid1.append(p)
        # LOWRISE
        else:
            #lowrise
            lo.append(p)
    return hi,mid2,mid1,lo

if run:
    ###
    steplst = map(lambda i: i*1.5,range(1,4))
    seplst = map(lambda i:20+(2.5*i),range(1,5))
    htlst = map(lambda i:i*6,range(2,11))
    
    
    indexnum = len(steplst)*len(seplst)*len(htlst) #* len(demandlst)
    #print indexnum
    #print len(demand)
    
    
    count = 0
    L = []
    #for dem in demandlst:
    for stp in steplst:
        for sep in seplst:
            for ht in htlst:
                count += 1
                hir_,mdr_2,mdr_1,lor_,hic_,mdc_2,mdc_1,loc_ = [],[],[],[],[],[],[],[]
                for res_ in res:
                    demand = res_.shape.ht * 4 #+ random.randint(-5,5)
                    print demand
                    hir_,mdr_2,mdr_1,lor_ = set_density(demand,res)
                for com_ in com:
                    demand = com_.shape.ht* 4 #+ random.randint(-5,5)
                    #print demand
                    hic_,mdc_2,mdc_1,loc_ = set_density(demand,com)
                    #print loc_
                L.append((stp,sep,ht,hir_,mdr_2,mdr_1,lor_,hic_,mdc_2,mdc_1, loc_))
                
    #print count
    index = var_index
    var_a = L[index][0]
    var_b = L[index][1]
    var_c = L[index][2]
    
    hi_res = L[index][3]
    hi_com = L[index][4]
    midhi_res = L[index][5]
    midlo_res = L[index][6]
    midhi_com = L[index][7]
    midlo_com = L[index][8]
    lo_com = L[index][9]
    
    print "variables: ", var_a, var_b, var_c
# ---------- end python_3 ----------

# ---- group: META-RES
bibil_7 = PythonScript(Code=file_5, Node_in=flatten(geo_8), Run=Toggle(True))  # -> Node_out, Debug

# ---- group: META-COM
bibil_8 = PythonScript(Code=file_5, Node_in=flatten(geo_9), Run=Toggle(False))  # -> Node_out, Debug

# ----
bula = PythonScript(
    Code=file_11,
    Analysis_ref=bibil_6.Node_out,
    Value_ref=devec.ZComponent,
    Height_bounds="400.,30.",
    Scale=Slider(1, range=0..10),
    Run=Toggle(True))

# ---- group: TYPE
miru_7 = PythonScript(Code=file_10, Height=panel, Run=Toggle(True))

# ----
data = Data(python_3.var_a)
data_2 = Data(python_3.var_b)
data_3 = Data(python_3.var_c)

# ---- group: SHAPENODE
bibil_9 = PythonScript(Code=file_5, Rule_in=flatten([bula, miru_7]), Run=Toggle(True))  # -> Node_out, Debug

# ----
data_4 = Data(data)
data_5 = Data(data)
data_6 = Data(data)
addition = Addition(A=data_4, B=Slider(1.5, range=0..10))
addition_2 = Addition(A=data_5, B=Slider(4.5, range=0..10))
data_7 = Data(data)
addition_3 = Addition(A=data_6, B=Slider(4.5, range=0..10))
python_4 = PythonScript(ht=Slider(13.5, range=0..100), stpbck=data_4)  # -> stp_str
# ---------- python_4: Python ----------
stp_str = str(ht) + ":" + str(stpbck)

print stp_str
# ---------- end python_4 ----------
python_5 = PythonScript(ht=Slider(21.5, range=0..100), stpbck=addition_2)  # -> stp_str; same code as python_4
python_6 = PythonScript(ht=Slider(13.5, range=0..100), stpbck=data_5)  # -> stp_str; same code as python_4
python_7 = PythonScript(ht=Slider(22.5, range=0..100), stpbck=addition)  # -> stp_str; same code as python_4
addition_4 = Addition(A=data_7, B=Slider(6, range=0..10))
python_8 = PythonScript(ht=Slider(21.5, range=0..100), stpbck=addition_3)  # -> stp_str; same code as python_4
python_9 = PythonScript(ht=Slider(13.5, range=0..100), stpbck=data_6)  # -> stp_str; same code as python_4
geo_10 = Geometry(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)
geo_11 = Geometry(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)
# MID-RESIDENTIAL 2
number_slider = Slider(3, range=0..10)
panel_2 = Panel("""7.5:3.0
10.5:4.5
19.5:6.0""")
list_4 = ValueList({"divide by depth": "subdivide_depth", "divide by same depth": "subdivide_depth_same", "divide by dim": "subdivide_dim"}, selected="divide by depth")
number_slider_2 = Slider(31.5, range=0..100)
# LOW-COMMERCIAL
toggle = BooleanToggle(True)
geo_12 = Geometry(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)
python_10 = PythonScript(ht=Slider(25.5, range=0..100), stpbck=addition_4)  # -> stp_str; same code as python_4
panel_3 = Panel("25.5:9.0")
panel_4 = Panel("13.5:3.0")
python_11 = PythonScript(ht=Slider(13.5, range=0..100), stpbck=data_7)  # -> stp_str; same code as python_4
# MID-RESIDENTIAL 1
number_slider_3 = Slider(30, range=0..100)
number_slider_4 = Slider(14, range=0..100)
panel_5 = Panel("""13.5:1.5
25.5:9.0""")
number_slider_5 = Slider(31.5, range=0..100)
geo_13 = Geometry(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)
# HI-RESIDENTIAL
number_slider_6 = Slider(1, range=0..10)
panel_6 = Panel("""7.5:9.0
18.5:15.0""")
panel_7 = Panel("""13.5:3.0
21.5:9.0""")
# MID-COMM
number_slider_7 = Slider(100, range=0..100)
list_5 = ValueList({"divide by depth": "subdivide_depth", "divide by same depth": "subdivide_depth_same", "divide by dim": "subdivide_dim"}, selected="divide by dim")
panel_8 = Panel("""7.5:1.5
25.5:6.0""")
list_6 = ValueList({"YZ": "NS", "XZ": "EW", "XY": "Z"}, selected="XZ")
panel_9 = Panel("""13.5:1.5
21.5:6.0""")
panel_10 = Panel("""7.5:9.0
13.5:12.0""")
list_7 = ValueList({"divide by depth": "subdivide_depth", "divide by same depth": "subdivide_depth_same", "divide by dim": "subdivide_dim"}, selected="divide by depth")
# HI-COMM
toggle_2 = BooleanToggle(True)
geo_14 = Geometry(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)
geo_15 = Geometry(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)
geo_16 = Geometry(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)
list_8 = ValueList({"YZ": "NS", "XZ": "EW", "XY": "Z"}, selected="XZ")
list_9 = ValueList({"YZ": "NS", "XZ": "EW", "XY": "Z"}, selected="XZ")
geo_17 = Geometry(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)
geo_18 = Geometry(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)
# 3. SET TYPOLOGIES
toggle_3 = BooleanToggle(True)
panel_11 = Panel("0")

# ---- group: SETBACK
miru_8 = PythonScript(Code=file_9, Height_stepback=python_4, Stepback_ref=geo_10, Run=Toggle(True))

miru_9 = PythonScript(Code=file_9, Height_stepback=python_7, Stepback_ref="-1", Run=Toggle(True))

miru_10 = PythonScript(Code=file_9, Height_stepback=[python_6, python_5], Stepback_ref=geo_11, Run=Toggle(True))

miru_11 = PythonScript(Code=file_9, Height_stepback=panel_6, Randomize="0.0>0.0:-1.5>1.5", Stepback_ref=geo_13, Run=toggle_2)

# ---- group: HEIGHT
miru_12 = PythonScript(Code=file_10, Height=Slider(31.5, range=0..100), Run=Toggle(True))

# ---- group: DIVIDE
miru_13 = PythonScript(
    Code=file_6,
    Divide_num=[number_slider_7, Slider(48, range=0..100)],
    Divide_cut=Slider(0, range=0..100),
    Divide_type=list_5,
    Divide_ratio=Slider(0.5, range=0..1),
    Axis=list_8,
    Run=Toggle(True))

# ---- group: SETBACK
miru_14 = PythonScript(Code=file_9, Height_stepback=[python_9, python_8], Stepback_ref=[geo_17, geo_18], Run=Toggle(True))

# ---- group: HEIGHT
miru_15 = PythonScript(Code=file_10, Height=Slider(38.5, range=0..100), Randomize="-9.0>9.0", Run=Toggle(True))

# ---- group: SETBACK
miru_16 = PythonScript(Code=file_9, Height_stepback=panel_10, Stepback_ref=[geo_14, geo_15], Run=Toggle(True))

# ---- group: HEIGHT
miru_17 = PythonScript(Code=file_10, Height=Slider(25, range=0..100), Randomize="-6.0>6", Run=Toggle(True))

# ---- group: SETBACK
miru_18 = PythonScript(Code=file_9, Height_stepback=python_11, Stepback_ref=geo_16, Run=Toggle(True))

miru_19 = PythonScript(Code=file_9, Height_stepback=python_10, Stepback_ref="2", Run=Toggle(True))

miru_20 = PythonScript(Code=file_9, Height_stepback=panel_8, Stepback_ref="0", Run=Toggle(True))

miru_21 = PythonScript(Code=file_9, Height_stepback="7.5:1.5", Stepback_ref="2", Run=Toggle(True))

miru_22 = PythonScript(Code=file_9, Height_stepback=panel_2, Stepback_ref=geo_12, Run=toggle)

# ---- group: DIVIDE
miru_23 = PythonScript(
    Code=file_6,
    Divide_num=number_slider_6,
    Divide_cut=Slider(15, range=0..100),
    Divide_type=list_7,
    Divide_ratio=Slider(0.5, range=0..1),
    Axis=list_9,
    Run=Toggle(True))

# ---- group: PERIMETER
miru_24 = PythonScript(Code=file_7, Width=Slider(34, range=0..100), Cut_width=Slider(0, range=0..100), Court_ref="0", Run=Toggle(True))

# ---- group: HEIGHT
miru_25 = PythonScript(Code=file_10, Height=Slider(31.5, range=0..100), Run=Toggle(True))

# ---- group: DIVIDE
miru_26 = PythonScript(
    Code=file_6,
    Divide_num=number_slider,
    Divide_cut=Slider(10, range=0..100),
    Divide_type=list_4,
    Divide_ratio=Slider(0.5, range=0..1),
    Axis=list_6,
    Run=Toggle(False))

# ---- group: PERIMETER
miru_27 = PythonScript(Code=file_7, Width=number_slider_3, Cut_width=Slider(0, range=0..100), Court_ref="0", Run=Toggle(True))

# ---- group: HEIGHT
miru_28 = PythonScript(Code=file_10, Height=Slider(28.5, range=0..100), Randomize="-6.0>6", Run=Toggle(True))

# ---- group: PERIMETER
miru_29 = PythonScript(Code=file_7, Width=Slider(12.5, range=0..100), Cut_width=Slider(0, range=0..100), Court_ref="2", Run=Toggle(True))

# ---- group: HEIGHT
miru_30 = PythonScript(Code=file_10, Height=Slider(19.5, range=0..100), Randomize="-6.0>6", Run=Toggle(True))

# ---- group: TREE RULES
miru_31 = PythonScript(Code=file_12, Node=bibil_7.Node_out, Run=toggle_3)

# ----
geo_19 = Geometry([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])

# ---- group: SHAPENODE
bibil_10 = PythonScript(
    Code=file_5,
    Rule_in=flatten([miru_12, miru_8, miru_9]),
    Node_in=flatten(python_3.hi_com),
    Label_="comm-hi",
    Run=Toggle(True))  # -> Node_out, Debug

bibil_11 = PythonScript(
    Code=file_5,
    Rule_in=flatten([miru_13, miru_15, miru_10, miru_11]),
    Node_in=flatten(python_3.midhi_com),
    Label_="comm-hi",
    Run=Toggle(True))  # -> Node_out, Debug

bibil_12 = PythonScript(
    Code=file_5,
    Rule_in=flatten([miru_31, miru_27, miru_28, miru_20]),
    Node_in=flatten(geo_19),
    Label_="base",
    Run=Toggle(False))  # -> Node_out, Debug

bibil_13 = PythonScript(
    Code=file_5,
    Rule_in=flatten([miru_26, miru_29, miru_30, miru_21, miru_22]),
    Node_in=flatten(python_3.midlo_res),
    Label_="base",
    Run=Toggle(False))  # -> Node_out, Debug

bibil_14 = PythonScript(
    Code=file_5,
    Rule_in=flatten([miru_17, miru_14, miru_16]),
    Node_in=flatten(python_3.lo_com),
    Label_="comm-low",
    Run=Toggle(False))  # -> Node_out, Debug

bibil_15 = PythonScript(
    Code=file_5,
    Rule_in=flatten([miru_23, miru_24, miru_25, miru_18, miru_19]),
    Node_in=flatten(python_3.hi_res),
    Label_="comm-hi",
    Run=Toggle(False))  # -> Node_out, Debug

# ----
g_2 = PythonScript(node=bibil_14.Node_out)  # -> geom; inputs node: list
# ---------- g_2: Python ----------
node = filter(lambda n: n!=None,node)
if node and node != []:
    geom = []
    for n in node:
        if n.shape.z_dist < 1.2:
            geom.append(n.shape.bottom_crv)
        else:
            geom.append(n.shape.geom)
    print geom
# ---------- end g_2 ----------
python_12 = PythonScript(kp=Slider(27, range=0..100), om=data_2)  # -> stp_str
# ---------- python_12: Python ----------
stp_str = str(kp) + "," + str(om)

print stp_str
# ---------- end python_12 ----------
g_3 = PythonScript(node=bibil_13.Node_out)  # -> label; inputs node: list
# ---------- g_3: Python ----------
node = filter(lambda n: n!=None,node)
if node and node != []:
    label = []
    if True:#for i,n in enumerate(node):
        #print i
        root = node[0].get_root()
        L = root.traverse_tree(lambda n:n,internal=True) 
        for i in L:
            print i
            label.append(i)
        #label.append('--')
        #print '---'
# ---------- end g_3 ----------
panel_12 = Panel("27.0,25.0")
g_4 = PythonScript(node=bibil_12.Node_out)  # -> geom; inputs node: list; same code as g_2
panel_13 = Panel(python_12)
panel_14 = Panel(g_3)

# ---- group: PACKING
separatedata_2 = Ladybug_SeparateData(Code=file_8, X_keep_omit=python_12, Y_keep_omit=python_12, Seperation_ref="-1", Run=Toggle(True))

# ---- group: EXTRACT_SLICE
miru_32 = PythonScript(Code=file_15, Run=Toggle(True))

# ---- group: PACKING
separatedata_3 = Ladybug_SeparateData(Code=file_8, X_keep_omit="30.0,35.0", Y_keep_omit="30.0,35.0", Seperation_ref="-1", Run=Toggle(True))

# ---- group: EXTRACT_SLICE
miru_33 = PythonScript(Code=file_15, Run=Toggle(True))

# ---- group: SHAPENODE
bibil_16 = PythonScript(Code=file_5, Rule_in=flatten([miru_32, separatedata_2]), Node_in=flatten(bibil_15.Node_out), Run=Toggle(True))  # -> Node_out, Debug

bibil_17 = PythonScript(Code=file_5, Rule_in=flatten([miru_33, separatedata_3]), Node_in=flatten(bibil_10.Node_out), Run=Toggle(True))  # -> Node_out, Debug

# ----
list_10 = ValueList({"divide by depth": "subdivide_depth", "divide by same depth": "subdivide_depth_same", "divide by dim": "subdivide_dim"}, selected="divide by same depth")
list_11 = ValueList({"YZ": "NS", "XZ": "EW", "XY": "Z"}, selected="XZ")

# ---- group: DIVIDE
miru_34 = PythonScript(
    Code=file_6,
    Divide_num=Slider(1, range=0..10),
    Divide_cut=Slider(0, range=0..100),
    Divide_type=list_10,
    Divide_ratio=Slider(0.5, range=0..1),
    Axis=list_11,
    Run=Toggle(True))

# ---- group: HEIGHT
miru_35 = PythonScript(Code=file_10, Height=Slider(6, range=0..100), Randomize="-3.0>6.0", Run=Toggle(True))

# ----
data_8 = Data(data_3)
addition_5 = Addition(A=data_8, B=Slider(50, range=0..100))

# ---- group: HEIGHT
miru_36 = PythonScript(Code=file_10, Height=data_8, Run=Toggle(True))

miru_37 = PythonScript(Code=file_10, Height=addition_5, Run=Toggle(True))

# ---- group: SHAPENODE
bibil_18 = PythonScript(Code=file_5, Rule_in=flatten([miru_34, miru_35]), Node_in=flatten(bibil_16.Debug), Run=Toggle(True))  # -> Node_out, Debug

bibil_19 = PythonScript(Code=file_5, Rule_in=flatten(miru_36), Node_in=flatten(bibil_16.Node_out), Run=Toggle(True))  # -> Node_out, Debug

bibil_20 = PythonScript(Code=file_5, Rule_in=flatten(miru_37), Node_in=flatten(bibil_17.Node_out), Run=Toggle(True))  # -> Node_out, Debug

# ----
g_5 = PythonScript(node=bibil_13.Node_out)  # -> geom; inputs node: list; same code as g_2
g_6 = PythonScript(node=bibil_14.Node_out)  # -> geom; inputs node: list; same code as g_2
g_7 = PythonScript(node=bibil_18.Node_out)  # -> geom; inputs node: list; same code as g_2
g_8 = PythonScript(node=bibil_19.Node_out)  # -> geom; inputs node: list; same code as g_2
g_9 = PythonScript(node=bibil_15.Node_out)  # -> geom; inputs node: list; same code as g_2
g_10 = PythonScript(node=[bibil_10.Node_out, bibil_11.Node_out])  # -> geom; inputs node: list; same code as g_2
g_11 = PythonScript(node=bibil_20.Node_out)  # -> geom; inputs node: list; same code as g_2
g_12 = PythonScript(node=bibil_12.Node_out)  # -> geom; inputs node: list; same code as g_2
# HI-COMMERCIAL
swatch = ColourSwatch(SwatchColor=RGB(255, 255, 255))
# MID-RESIDENTIAL
swatch_2 = ColourSwatch(SwatchColor=RGB(255, 255, 255))
material = CreateMaterial(Diffuse=swatch, Specular=RGB(255, 255, 255), Emission=RGB(0, 0, 0), Transparency=Slider(0.2, range=0..1), Shine=0)
# LOW-COMMERCIAL
swatch_3 = ColourSwatch(SwatchColor=RGB(255, 255, 255))
# HI-RESIDENTIAL
swatch_4 = ColourSwatch(SwatchColor=RGB(255, 255, 255))
material_2 = CreateMaterial(Diffuse=swatch_2, Specular=RGB(255, 255, 255), Emission=RGB(0, 0, 0), Transparency=Slider(0.2, range=0..1), Shine=0)
material_3 = CreateMaterial(Diffuse=swatch_3, Specular=RGB(255, 255, 255), Emission=RGB(0, 0, 0), Transparency=Slider(0.2, range=0..1), Shine=0)
preview = CustomPreview(Geometry=[g_10, g_11], Shader=material)
material_4 = CreateMaterial(Diffuse=swatch_4, Specular=RGB(255, 255, 255), Emission=RGB(0, 0, 0), Transparency=Slider(0.2, range=0..1), Shine=0)
preview_2 = CustomPreview(Geometry=[g_5, g_12], Shader=material_2)
preview_3 = CustomPreview(Geometry=g_6, Shader=material_3)
preview_4 = CustomPreview(Geometry=[g_7, g_8, g_9], Shader=material_4)
panel_15 = Panel("https://www.energyplus.net/weather-download/north_and_central_america_wmo_region_4/USA/CA/USA_CA_San.Francisco.Intl.AP.724940_TMY3/all")
number_slider_8 = Slider(9, range=0..10)
number_slider_9 = Slider(21, range=0..100)
epw_stat = Ladybug_OpenEPWAndSTATWeatherFiles(weatherFileURL=panel_15)  # -> epwFile, statFile; plug-in component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
ladybug = Ladybug_Ladybug()  # -> Vviiiiiiiiiizzz; plug-in component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
honeybee = Honeybee_Honeybee()  # -> Vviiiiiiiiiizzz; plug-in component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
analysisperiod = Ladybug_AnalysisPeriod(
    fromMonth=number_slider_8,
    fromDay=number_slider_9,
    fromHour=Slider(8.25, range=0..10),
    toMonth=number_slider_8,
    toDay=number_slider_9,
    toHour=Slider(17.25, range=0..100))  # -> readMe, analysisPeriod; plug-in component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
mesh = Mesh([g_12, g_5, g_6, g_7, g_9, g_10, g_11, g_8])
geo_20 = Geometry([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])
importlocation = Ladybug_ImportLocation(epwFile=epw_stat.epwFile)  # -> location; plug-in component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
material_5 = CreateMaterial(
    Diffuse=ColourSwatch(SwatchColor=RGB(255, 255, 255)),
    Specular=RGB(255, 255, 255),
    Emission=RGB(0, 0, 0),
    Transparency=Slider(0.4, range=0..1),
    Shine=0)
sunpath = Ladybug_SunPath(
    location=importlocation,
    hour=12,
    day=21,
    month=12,
    timeStep=1,
    analysisPeriod=analysisperiod.analysisPeriod,
    dailyOrAnnualSunPath=True)  # -> readMe, sunVectors, sunAltitudes, sunAzimuths, port, sunSpheresMesh, sunPathCrvs, legend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; plug-in component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
preview_5 = CustomPreview(Geometry=mesh, Shader=material_5)
number_slider_10 = Slider(13, range=0..100)
gradientlibrary = Ladybug_GradientLibrary(gradIndex=Slider(6, range=0..10))  # -> customColors; plug-in component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

# ---- group: set up number of legend segments based on number of vectors
lng = ListLength(List=sunpath.sunVectors)
addition_6 = Addition(A=lng, B=1)
legendpar = Ladybug_LegendParameters(numSegments=addition_6, customColors=flatten(gradientlibrary))  # -> legendPar; plug-in component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

# ----
geo_21 = Geometry([g_12, g_5, g_6, g_7, g_8, g_9, g_10, g_11])

# ---- group: SHAPENODE
bibil_21 = PythonScript(node_in=flatten(geo_21), label="buildings4analysis", run=Toggle(True))  # -> node_out, debug; inputs rule_in: tree, node_in: list, label: list, run: Boolean
# ---------- bibil_21: Python ----------
"""
Trinco UI
"""

import scriptcontext as sc
import clr

Grammar = sc.sticky["Grammar"]
clr.AddReference("Grasshopper")
from Grasshopper.Kernel.Data import GH_Path
from Grasshopper import DataTree

if run and node_in != []:
    node_in = filter(lambda n: n!=None,node_in)
    if rule_in.BranchCount < 0.5:
        rule_in = DataTree[object]()
        rule_ = []
        for i, r in enumerate(rule_):
            rule_in.Add(r)
        
    G = Grammar()
    sc.sticky["debug"] = []
    debug = sc.sticky["debug"]
    node_out = G.main_UI(node_in,rule_in,label_)
else:
    print 'Add inputs!'
# ---------- end bibil_21 ----------

# ----
g_13 = PythonScript(node=bibil_21.node_out)  # -> label; inputs node: list; same code as g_3
number_slider_11 = Slider(3, range=0..10)
toggle_4 = BooleanToggle(True)

# ---- group: ANALYSIS
miru_38 = PythonScript(node_in=bibil_21.node_out, groundFloor_ht=number_slider_11, restFloor_ht=number_slider_11, height=toggle_4, GFA=toggle_4)  # -> ReadMe, geom_out, pt_out, label_out, analysis_out, debug; inputs node_in: list
# ---------- miru_38: Python ----------
import rhinoscriptsyntax as rs
import Rhino as rc
import random
import scriptcontext as sc
import copy
import math
import ghpythonlib.components as ghcomp

"""import classes"""
Shape = sc.sticky["Shape"]
Tree = sc.sticky["Tree"]

sc.sticky['debug'] = []
debug = sc.sticky["debug"]

TOL = sc.doc.ModelAbsoluteTolerance

def get_label(n):
    label_ = []
    root = n[0].get_root()
    L = root.traverse_tree(lambda n:n,internal=True) 
    for nl in L:
        #print nl
        label_.append(nl)
    return label_

def make_analysis(nodelen,pd):
    ## Input: dictionary of parameter key, list of data value 
    ## Output: Filtered list of str: with keys and value
    L = [""] * nodelen
    if pd.has_key('height'):
        for i,ht in enumerate(pd['height']):
            valstr = 'height: %s' % (ht)
            L[i] += valstr
    if pd.has_key('GFA'):
        for i,gfa in enumerate(pd['GFA']):
            valstr = '\nGFA: %s' % (gfa)
            L[i] += valstr
    return L

def get_ht(node_):
    L = []
    for n_ in node_:
        storey = str(round(n_.shape.ht,1))
        L.append(storey)
    return L

def get_GFA(node_,ght,rht):
    def helper_by_floor_div(n__,groundht):
        ratio = groundht/n__.shape.ht
        PD = {}
        PD['div_num'] = 1
        PD['div_deg'] = 0.
        PD['div_cut'] = 0.
        PD['div_ratio'] = ratio
        PD['div_type'] = 'simple_divide'
        PD['axis'] = "Z"
        divnode = n__.grammar.divide(n_,PD)
        
        if abs(divnode.loc[0].shape.ht - groundht) < 0.01:
            groundfloor = divnode.loc[0]
            restfloor = divnode.loc[1]
        else:
            groundfloor = divnode.loc[1]
            restfloor = divnode.loc[0]
        return groundfloor,restfloor
    def helper_by_floor_calc(n__,htdiv):
        n__.shape.geom = ghcomp.CapHolesEx(n__.shape.geom)[0]
        shapevol = rc.Geometry.VolumeMassProperties.Compute(n__.shape.geom).Volume
        shapegfa = shapevol/htdiv
        return shapegfa
        
    debug = sc.sticky['debug']
    ReadMe_ = ""
    L = []
    for n_ in node_:
        if abs(ght-rht)<0.1:
            gfacalc = helper_by_floor_calc(n_,rht)
        else:
            try:
                grndshape,rstshape = helper_by_floor_div(n_,ght)
                grndgfa = grndshape.shape.get_area()
                rstgfa = helper_by_floor_calc(rstshape,rht)
                gfacalc = grndgfa + rstgfa
            except:
                ReadMe_ = "Calculating by specific floor heights has failed, probably because the geometry was too complicated. GFA is now based on restfloorht."
                gfacalc = helper_by_floor_calc(rstshape,3.)
        #debug.extend(map(lambda n:n.shape.geom,divnode.loc))
        L.append(str(round(abs(gfacalc),1)))
    return L,ReadMe_

node = filter(lambda n: n!=None,node_in)
if node and node != []:
    node = map(lambda n: copy.deepcopy(n),node)
    sc.sticky['debug'] = []
    debug = sc.sticky['debug']
    ReadMe = ""
    
    #These always appear by default
    label_out = get_label(node)
    geom_out = map(lambda n:n.shape.geom,node)
    pt_out = map(lambda n:n.shape.cpt,node)
    #Analysis paramaters
    param_dict = {}
    if height==True:
        ht_out = get_ht(node)
        param_dict['height'] = ht_out
    if GFA == True:
        if not groundFloor_ht:
            groundFloor_ht = 3.0
        if not restFloor_ht:
            restFloor_ht = 3.0
        gfa_out,readmegfa = get_GFA(node,groundFloor_ht,restFloor_ht)
        param_dict['GFA'] = gfa_out
        ReadMe += readmegfa
    analysis_out = make_analysis(len(node),param_dict)
    if not ReadMe:
        ReadMe = "Successfully calculated"
# ---------- end miru_38 ----------

# ----
panel_16 = Panel(miru_38.analysis_out)
panel_17 = Panel(miru_38.ReadMe)

# ---- group: ground
geo_22 = Geometry(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)

# ----
mesh_2 = Mesh([g_12, g_5, g_6, g_7, g_8, g_9, g_10, g_11])
sunlighthoursanalysis = Ladybug_SunlightHoursAnalysis(
    geometry=flatten(geo_22),
    context=flatten(mesh_2),
    gridSize="1",
    disFromBase=Slider(0.001, range=0..0.001),
    sunVectors=flatten(sunpath.sunVectors),
    timeStep=1,
    legendPar=flatten(legendpar),
    parallel=Toggle(True),
    runIt=Toggle(False))  # -> readMe, contextMesh, analysisMesh, testPts, testVec, port, sunlightHoursResult, sunlightHoursMesh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; plug-in component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
python_13 = PythonScript(analysis_in=miru_38.analysis_out)  # -> GFA; inputs analysis_in: list
# ---------- python_13: Python ----------
analysis_in = filter(lambda n: n!=None,analysis_in)

if analysis_in:
    ID,GFA,HT = [],[],[]
    for an in analysis_in:
        lst = an.split('\n')
        ID.append('null')
        ht = float(lst[0].split(": ")[-1])
        gfa = float(lst[1].split(": ")[-1])
        HT.append(ht)
        GFA.append(gfa)
        #print '--'
# ---------- end python_13 ----------
panel_18 = Panel(sunlighthoursanalysis.totalSunlightHours)
ma = MassAddition(Input=python_13)  # -> Result, PartialResults
rec = DataRecorder(ma.Result, DataLimit=1000, RecordData=True)
panel_19 = Panel(ma.Result)
mesh_3 = Mesh(sunlighthoursanalysis.sunlightHoursMesh)
g_14 = PythonScript(node=[bibil_13.Node_out, bibil_12.Node_out, bibil_14.Node_out, bibil_19.Node_out, bibil_18.Node_out, bibil_15.Node_out, bibil_11.Node_out, bibil_10.Node_out, bibil_20.Node_out])  # -> gfa; inputs node: list
# ---------- g_14: Python ----------
import rhinoscriptsyntax as rs
import Rhino as rc

node = filter(lambda n: n!=None,node)
if node and node != []:
    shapegfa = []
    for n in node:
        htdiv = 3.0
        shapevol = rc.Geometry.VolumeMassProperties.Compute(n.shape.geom).Volume
        shapegfa.append(shapevol/htdiv)
    gfa = sum(shapegfa)
    print gfa
# ---------- end g_14 ----------
# maxbld gfa: 561415.2
# minbld gfa: 421682.2
# maxbld sun: 368381.6
# minbld sun: 391561.2
python_14 = PythonScript(gfa=g_14, sun=sunlighthoursanalysis.totalSunlightHours)  # -> normgfa, normsun
# ---------- python_14: Python ----------
#import scriptcontext as sc
#Bula = sc.sticky['Bula']
#B = Bula()
#B.normalize_list(lov,hibound,lobound)

def norm(v,min_,max_):
    #norm_val = ((hibound-lobound)*(v-min_))/(max_-min_) + lobound
    return ((10.-0.01)*(v-min_))/(max_-min_) + 0.01


maxgfa = 561415.2
mingfa = 421682.2

#maxsun = 391561.2
#minsun = 368381.6

normgfa = norm(gfa,maxgfa,mingfa)
#normsun = norm(sun,maxsun,minsun)
print normgfa
# ---------- end python_14 ----------
toggle_5 = BooleanToggle(False)
rec_2 = DataRecorder(python_3.var_a, DataLimit=10000, RecordData=True)
rec_3 = DataRecorder(python_3.var_b, DataLimit=10000, RecordData=True)
rec_4 = DataRecorder(python_3.var_c, DataLimit=10000, RecordData=True)
rec_5 = DataRecorder(python_14.normgfa, DataLimit=10000, RecordData=True)
rec_6 = DataRecorder(python_14.normsun, DataLimit=10000, RecordData=True)
excelwrite = ExcelWriteLEGACY(
    WriteToggle=toggle_5,
    WriteHeading=toggle_5,
    ClearSheet=Toggle(False),
    Worksheet=1,
    ColumnStart=1,
    RowStart=1,
    ColumnHeadings=["STEP_INCREMENT", "SEPERATION", "HEIGHT_INCREMENT", "GFA", "SUN"],
    Column1=rec_2,
    Column2=rec_3,
    Column3=rec_4,
    Column4=rec_5,
    Column5=rec_6)
