# Grasshopper definition trinco_tower_twist_test_9.gh (Grasshopper 0.9.76)
# plug-ins: Python Interpreter, LunchBox

list = ValueList({"dir", "file"}, selected="dir")
python = PythonScript()  # -> out, a
# ---------- python: Python ----------
import os

print os.getcwd()
# ---------- end python ----------

# ---- group: find directory
bibil = PythonScript(
    dir=["C:\\Users\\vasanthakumars\\Documents\\GitHub\\bibil\\src", "C:\\saeran\\master\\git\\bibil\\src"],
    type=list,
    run=Toggle(True))  # -> dir; inputs dir: list
# ---------- bibil: Python ----------
import os
import sys

ghenv.Component.Params.Output[0].Name = "null"
ghenv.Component.Params.Output[0].NickName = "null"

#sys.path.append("C:\Program Files\Rhinoceros 5.0 (64-bit)\System")

if run:
    confirm_dir = None
    for d in dir:
        try:
            if type == "file":
                file_ = open(d)
                file_.close()
            else:
                print os.listdir(d)
            confirm_dir = d
            break
        except Exception as e:
            #print str(e)
            continue
    if confirm_dir != None:
        ghenv.Component.Params.Output[0].Name = type
        ghenv.Component.Params.Output[0].NickName = type
        dir = confirm_dir
        file = confirm_dir
null = None
# ---------- end bibil ----------

# ---- group: tree
python_script = PythonScript(i=bibil)  # -> o
# ---------- python_script: Python ----------
import os

if i:
    o = os.path.join(str(i),"bibil\\bibil_tree.py")
# ---------- end python_script ----------
file = ReadFile(File=python_script, PerLineParse=False)
bibil_2 = PythonScript(Code=file)

# ---- group: grammar
python_script_2 = PythonScript(i=bibil)  # -> o
# ---------- python_script_2: Python ----------
import os

if i:
    o = os.path.join(str(i),"bibil\\bibil_grammar.py")
# ---------- end python_script_2 ----------
file_2 = ReadFile(File=python_script_2, PerLineParse=False)
bibil_3 = PythonScript(Code=file_2)

# ---- group: shape
python_script_3 = PythonScript(i=bibil)  # -> o
# ---------- python_script_3: Python ----------
import os

if i:
    o = os.path.join(str(i),"bibil\\bibil_shape.py")
#o = os.path.join(str(i),"research\\bibil_shape_shape_3d_2d.py")
# ---------- end python_script_3 ----------
file_3 = ReadFile(File=python_script_3, PerLineParse=False)
bibil_4 = PythonScript(Code=file_3)

# ---- group: bula
python_script_4 = PythonScript(i=bibil)  # -> o
# ---------- python_script_4: Python ----------
import os

if i:
    o = os.path.join(str(i),"bula\\bula_minimal.py")
# ---------- end python_script_4 ----------
file_4 = ReadFile(File=python_script_4, PerLineParse=False)
bibil_5 = PythonScript(Code=file_4)

# ---- group: UI
python_script_5 = PythonScript(i=bibil)  # -> o
# ---------- python_script_5: Python ----------
import os

if i:
    o = os.path.join(str(i),"bibil\\bibil_UI.py")
# ---------- end python_script_5 ----------
file_5 = ReadFile(File=python_script_5, PerLineParse=False)

# ---- group: grammar_divide
python_script_6 = PythonScript(i=bibil)  # -> o
# ---------- python_script_6: Python ----------
import os

if i:
    o = os.path.join(str(i),"miru\\miru_divide.py")
# ---------- end python_script_6 ----------
file_6 = ReadFile(File=python_script_6, PerLineParse=False)

# ---- group: grammar_courtyard
python_script_7 = PythonScript(i=bibil)  # -> o
# ---------- python_script_7: Python ----------
import os

if i:
    o = os.path.join(str(i),"miru\\miru_court.py")
# ---------- end python_script_7 ----------
file_7 = ReadFile(File=python_script_7, PerLineParse=False)

# ---- group: grammar_tower
python_script_8 = PythonScript(i=bibil)  # -> o
# ---------- python_script_8: Python ----------
import os

if i:
    o = os.path.join(str(i),"miru\\miru_packing.py")
# ---------- end python_script_8 ----------
file_8 = ReadFile(File=python_script_8, PerLineParse=False)

# ---- group: stepback
python_script_9 = PythonScript(i=bibil)  # -> o
# ---------- python_script_9: Python ----------
import os

if i:
    o = os.path.join(str(i),"miru\\miru_stepback.py")
# ---------- end python_script_9 ----------
file_9 = ReadFile(File=python_script_9, PerLineParse=False)

# ---- group: grammar_height
python_script_10 = PythonScript(i=bibil)  # -> o
# ---------- python_script_10: Python ----------
import os

if i:
    o = os.path.join(str(i),"miru\\miru_height.py")
# ---------- end python_script_10 ----------
file_10 = ReadFile(File=python_script_10, PerLineParse=False)

# ---- group: grammar_analysis_pts
python_script_11 = PythonScript(i=bibil)  # -> o
# ---------- python_script_11: Python ----------
import os

if i:
    o = os.path.join(str(i),"miru\\miru_analysis.py")
# ---------- end python_script_11 ----------
file_11 = ReadFile(File=python_script_11, PerLineParse=False)

# ---- group: meta_tree
python_script_12 = PythonScript(i=bibil)  # -> o
# ---------- python_script_12: Python ----------
import os

if i:
    o = os.path.join(str(i),"miru\\miru_meta_tree.py")
# ---------- end python_script_12 ----------
file_12 = ReadFile(File=python_script_12, PerLineParse=False)

# ---- group: land_use
python_script_13 = PythonScript(i=bibil)  # -> o
# ---------- python_script_13: Python ----------
import os

if i:
    o = os.path.join(str(i),"miru\\miru_landuse.py")
# ---------- end python_script_13 ----------
file_13 = ReadFile(File=python_script_13, PerLineParse=False)

# ---- group: shape2height
python_script_14 = PythonScript(i=bibil)  # -> o
# ---------- python_script_14: Python ----------
import os

if i:
    o = os.path.join(str(i),"miru\\miru_shape2height.py")
# ---------- end python_script_14 ----------
file_14 = ReadFile(File=python_script_14, PerLineParse=False)

# ---- group: extract_slice
python_script_15 = PythonScript(i=bibil)  # -> o
# ---------- python_script_15: Python ----------
import os

if i:
    o = os.path.join(str(i),"miru\\miru_extract_slice.py")
# ---------- end python_script_15 ----------
file_15 = ReadFile(File=python_script_15, PerLineParse=False)

# ----
vec = VectorXYZ(XComponent=0, YComponent=0, ZComponent=0)  # -> Vector, Length

# ---- group: GEOREF
origin = Vector(Vector(313.1568888, 4834.12019, 0))

# ---- group: CPT
vec_2 = Vector(Vector(-270.3557034, 184.6348583, 0))

# ----
list_2 = ValueList({"divide by depth": "subdivide_depth", "divide by same depth": "subdivide_depth_same", "divide by dim": "subdivide_dim"}, selected="divide by same depth")

# ---- group: A=pt2move2
subtraction = Subtraction(A=vec_2, B=origin)

# ----
list_3 = ValueList({"YZ": "NS", "XZ": "EW", "XY": "Z"}, selected="XZ")
geo = Geometry([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])

# ---- group: INPUT HERE
geo_2 = Geometry(geo)

# ---- group: PACKING
separatedata = Ladybug_SeparateData(Code=file_8, X_keep_omit="27.0,25.0", Y_keep_omit="27.0,25.0", Seperation_ref="-1", Run=Toggle(True))

# ---- group: EXTRACT_SLICE
miru = PythonScript(Code=file_15, Run=Toggle(False))

# ---- group: DIVIDE
miru_2 = PythonScript(
    Code=file_6,
    Divide_num=Slider(2, range=0..10),
    Divide_cut=Slider(0, range=0..100),
    Divide_type=list_2,
    Divide_ratio=Slider(0.5, range=0..1),
    Axis=list_3,
    Run=Toggle(False))

# ---- group: PERIMETER
miru_3 = PythonScript(Code=file_7, Width=Slider(20, range=0..100), Cut_width=Slider(0, range=0..100), Court_ref="0", Run=Toggle(False))

# ---- group: HEIGHT
miru_4 = PythonScript(Code=file_10, Height=Slider(16.5, range=0..100), Run=Toggle(True))

# ---- group: TREE RULES
miru_5 = PythonScript(Code=file_12, Run=Toggle(False))

# ---- group: SHAPE2HEIGHT
miru_6 = PythonScript(Code=file_14, Run=Toggle(False))

# ----
move = Move(Geometry=geo_2, Motion=subtraction)  # -> Geometry, Transform
# 1. DEMAND CALCULATION
geo_3 = Geometry(move.Geometry)

# ---- group: d08
geo_4 = Geometry([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])

# ---- group: d06
geo_5 = Geometry([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])

# ---- group: d04
geo_6 = Geometry([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])

# ---- group: d02
geo_7 = Geometry([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])

# ---- group: d10
geo_8 = Geometry([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])

# ----
bibil_6 = PythonScript(Code=file_5, Node_in=flatten(geo_7), Label_="d02", Run=Toggle(True))  # -> Node_out, Debug
bibil_7 = PythonScript(Code=file_5, Node_in=flatten(geo_8), Label_="d10", Run=Toggle(True))  # -> Node_out, Debug
bibil_8 = PythonScript(Code=file_5, Node_in=flatten(geo_4), Label_="d08", Run=Toggle(True))  # -> Node_out, Debug
bibil_9 = PythonScript(Code=file_5, Node_in=flatten(geo_5), Label_="d06", Run=Toggle(True))  # -> Node_out, Debug
bibil_10 = PythonScript(Code=file_5, Node_in=flatten(geo_6), Label_="d04", Run=Toggle(True))  # -> Node_out, Debug

# ---- group: crv
geo_9 = Geometry([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])

# ----
geo_10 = Geometry([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])
geo_11 = Geometry([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])
python_2 = PythonScript(
    demand_in=[bibil_6.Node_out, bibil_10.Node_out, bibil_9.Node_out, bibil_8.Node_out, bibil_7.Node_out],
    index=Slider(0, range=0..4))  # -> demand_out; inputs demand_in: list, index: Int32
# ---------- python_2: Python ----------
import scriptcontext as sc
Bula = sc.sticky["Bula"]

sc.sticky['GLOBAL_COLLISION_LIST'] = []

#B = Bula()
#nest = B.ghtree2nestlist(demand_in)

D={}
max = 0.
min = 100.

htlst = []
for n in demand_in:
    ht = n.shape.ht
    if ht>max:
        max = ht
    if ht<min:
        min = ht
    htlst.append(ht)
B = Bula()

normlst = B.normalize_list(htlst,191.5,4.5)


for i,n in enumerate(demand_in):
    n.shape.op_extrude(normlst[i])
    label = n.grammar.type['label']
    if D.has_key(label):
        D[label].append(n)
    else:
        D[label] = [n]
    



L = D.values()
L.sort(key=lambda lst:lst[0].grammar.type['label'])



demand_out = L[index]
#print demand_out
# ---------- end python_2 ----------
wires = BrepWireframe(Brep=geo_6, Density=-1)
g = PythonScript(node=python_2)  # -> geom; inputs node: list
# ---------- g: Python ----------
node = filter(lambda n: n!=None,node)
if node and node != []:
    geom = []
    for n in node:
        geom.append(n.shape.geom)
    print geom
# ---------- end g ----------
preview = CustomPreview(
    Geometry=wires,
    Shader={ambient=RGB(0, 0, 0), diffuse=RGB(255, 105, 180), emission=RGB(76, 32, 54), shine=0.5, specular=RGB(255, 255, 255), transparency=0})
bibil_11 = PythonScript(Code=file_5, Node_in=flatten(python_2), Label_="parcel", Run=Toggle(True))  # -> Node_out, Debug
# MediumOffice
# LargeOffice
# RetailStripmall
# MidriseApartment
# HighriseApartment
# 
# **LowriseDetached << does this not exist?
python_3 = PythonScript(reslst=geo_11, comlst=geo_10, parcels=bibil_11.Node_out, run=Toggle(True))  # -> res, com, debug; inputs reslst: list, comlst: list, parcels: list
# ---------- python_3: Python ----------
import Rhino as rc
import rhinoscriptsyntax as rs
import scriptcontext as sc

sc.sticky['debug'] = []
def parcel_by_zone(parcel_,zone_):
    debug = sc.sticky['debug']
    L = []
    cpt = parcel_.shape.cpt
    for j in xrange(len(zone_)):
        zonecrv = zone_[j]
        #debug.append(zonecrv)
        IsIn = rs.PointInPlanarClosedCurve(cpt,zonecrv)
        if IsIn>0.5:
            IsDefined = True
            debug.append(parcel)
            L.append(parcel)
            break
    return L

if run and parcels:
    res,com = [],[]
    
    #sc.doc = rc.RhinoDoc.ActiveDoc
    #lst_res_zone = rs.ObjectsByLayer("_rule_residential")
    #lst_com_zone = rs.ObjectsByLayer("_rule_commercial")
    lst_res_zone = reslst
    lst_com_zone = comlst
    
    for i in xrange(len(parcels)):
        parcel = parcels[i]
        res += parcel_by_zone(parcel,lst_res_zone)
        com += parcel_by_zone(parcel,lst_com_zone)
    
debug = sc.sticky['debug']
# ---------- end python_3 ----------
# 2. MAPPING FUNCTION
toggle = BooleanToggle(True)

# ---- group: VARIABLES
python_4 = PythonScript(res=python_3.res, com=python_3.com, var_index=Slider(0, range=0..11), run=Toggle(False))  # -> hi_res, hi_com, midhi_res, midlo_res, midhi_com, midlo_com, lo_res, lo_com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; inputs res: list, com: list, var_index: Int32
# ---------- python_4: Python ----------
import random
import scriptcontext as sc

Bula = sc.sticky['Bula']

def set_density(parcel):
    #This should be part of the mapping function in Bula
    lo,mid1,mid2,hi = [],[],[],[]
    MIN_HI_DIST = 45.0
    MIN_MID_DIST = 24.0
    for i,p in enumerate(parcel):
        x_dist = p.shape.x_dist
        y_dist = p.shape.y_dist
        demand_ = p.shape.ht
        #print i,': ', round(demand_,2)
        # HIRISE
        if demand_ > 31.5 and x_dist > MIN_HI_DIST and y_dist > MIN_HI_DIST:
            hi.append(p)
        # MIDRISE
        elif demand_ > 7.5 and x_dist > MIN_MID_DIST and y_dist > MIN_MID_DIST:
            if demand_ > 22.5:
                mid2.append(p)
            else:
                mid1.append(p)
        # LOWRISE
        else:
            #lowrise
            lo.append(p)
    print '---'
    return hi,mid2,mid1,lo

if run:
    ###
    steplst = map(lambda i: i*1.5,range(1,4))
    seplst = map(lambda i:20+(2.5*i),range(1,5))
    
    
    indexnum = len(steplst)*len(seplst)
    #print indexnum
    #print len(demand)
    
    count = 0
    L = []
    #for dem in demandlst:
    stp = [steplst[0]]
    sep = [seplst[0]]
    #for stp in steplst:
    #    for sep in seplst:
    
    hir_,mdr_2,mdr_1,lor_,hic_,mdc_2,mdc_1,loc_ = [],[],[],[],[],[],[],[]
    #print 'res'
    hir_,mdr_2,mdr_1,lor_ = set_density(res)
    #print 'com'
    #hic_,mdc_2,mdc_1,loc_ = set_density(com)
    L.append((stp,sep,None,hir_,hic_,mdr_2,mdc_2,mdr_1,mdc_1,lor_,loc_))
                
    #print count
    index = var_index
    var_a = L[index][0]
    var_b = L[index][1]
    var_c = L[index][2]
    
    hi_res = L[index][3]
    hi_com = L[index][4]
    midhi_res = L[index][5]
    midhi_com = L[index][6]
    midlo_res = L[index][7]
    midlo_com = L[index][8]
    lo_res = L[index][9]
    lo_com = L[index][10]
    #print lo_com
    print "variables: ", var_a, var_b, var_c
# ---------- end python_4 ----------

# ---- group: META-RES
bibil_12 = PythonScript(Code=file_5, Node_in=flatten(geo_11), Run=toggle)  # -> Node_out, Debug

# ---- group: META-COM
bibil_13 = PythonScript(Code=file_5, Node_in=flatten(geo_10), Run=Toggle(False))  # -> Node_out, Debug

# ----
g_2 = PythonScript(node=python_4.midhi_res)  # -> geom; inputs node: list; same code as g
data = Data(python_4.var_c)
data_2 = Data(python_4.var_a)
data_3 = Data(python_4.var_b)
data_4 = Data(data_2)
data_5 = Data(data_2)
data_6 = Data(data_2)
addition = Addition(A=data_5, B=Slider(4.5, range=0..10))

# ---- group: TREE RULES
miru_7 = PythonScript(Code=file_12, Node=bibil_12.Node_out, Run=Toggle(True))

# ----
addition_2 = Addition(A=data_6, B=Slider(1.5, range=0..10))
panel = Panel("""7.5:4.5
22.5:6.0""")
addition_3 = Addition(A=data_4, B=Slider(4.5, range=0..10))
python_5 = PythonScript(ht=Slider(21.5, range=0..100), stpbck=addition)  # -> stp_str
# ---------- python_5: Python ----------
stp_str = str(ht) + ":" + str(stpbck)

print stp_str
# ---------- end python_5 ----------
data_7 = Data(data_2)
python_6 = PythonScript(ht=Slider(13.5, range=0..100), stpbck=data_5)  # -> stp_str; same code as python_5
python_7 = PythonScript(ht=Slider(13.5, range=0..100), stpbck=data_6)  # -> stp_str; same code as python_5
python_8 = PythonScript(ht=Slider(22.5, range=0..100), stpbck=addition_2)  # -> stp_str; same code as python_5
python_9 = PythonScript(ht=Slider(21.5, range=0..100), stpbck=addition_3)  # -> stp_str; same code as python_5
addition_4 = Addition(A=data_7, B=Slider(6, range=0..10))
python_10 = PythonScript(ht=Slider(13.5, range=0..100), stpbck=data_4)  # -> stp_str; same code as python_5
geo_12 = Geometry([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])
list_4 = ValueList({"divide by depth": "subdivide_depth", "divide by same depth": "subdivide_depth_same", "divide by dim": "subdivide_dim"}, selected="divide by dim")
geo_13 = Geometry(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)
geo_14 = Geometry([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])
number_slider = Slider(14, range=0..100)
panel_2 = Panel("-9.0>9.0")
# MID-RESIDENTIAL 2
number_slider_2 = Slider(3, range=0..10)
panel_3 = Panel("25.5:9.0")
number_slider_3 = Slider(1, range=0..100)
python_11 = PythonScript(ht=Slider(25.5, range=0..100), stpbck=addition_4)  # -> stp_str; same code as python_5
number_slider_4 = Slider(31.5, range=0..100)
# LOW RISE RES
toggle_2 = BooleanToggle(True)
list_5 = ValueList({"YZ": "NS", "XZ": "EW", "XY": "Z"}, selected="XZ")
panel_4 = Panel("13.5:3.0")
python_12 = PythonScript(ht=Slider(13.5, range=0..100), stpbck=data_7)  # -> stp_str; same code as python_5
# LOW-COMMERCIAL
number_slider_5 = Slider(25, range=0..100)
panel_5 = Panel("""13.5:1.5
21.5:6.0""")
panel_6 = Panel("""7.5:9.0
18.5:15.0""")
panel_7 = Panel("""13.5:3.0
21.5:9.0""")
panel_8 = Panel("""0.0:3.0
7.5:4.5""")
# MID-COMM
number_slider_6 = Slider(100, range=0..100)
panel_9 = Panel("""7.5:9.0
13.5:12.0""")
list_6 = ValueList({"divide by depth": "subdivide_depth", "divide by same depth": "subdivide_depth_same", "divide by dim": "subdivide_dim"}, selected="divide by dim")
list_7 = ValueList({"divide by depth": "subdivide_depth", "divide by same depth": "subdivide_depth_same", "divide by dim": "subdivide_dim"}, selected="divide by depth")
number_slider_7 = Slider(31.5, range=0..100)
panel_10 = Panel("""13.5:1.5
25.5:9.0""")
# MID-RESIDENTIAL 1
panel_11 = Panel("0:3.0")
geo_15 = Geometry(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)
geo_16 = Geometry(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)
# HI-COMM
toggle_3 = BooleanToggle(True)
list_8 = ValueList({"YZ": "NS", "XZ": "EW", "XY": "Z"}, selected="XZ")
list_9 = ValueList({"YZ": "NS", "XZ": "EW", "XY": "Z"}, selected="XZ")
geo_17 = Geometry(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)
geo_18 = Geometry(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)
# HI-RESIDENTIAL
toggle_4 = BooleanToggle(True)

# ---- group: SETBACK
miru_8 = PythonScript(Code=file_9, Height_stepback="0.0:3.0", Stepback_ref=Slider(0, range=0..100), Run=Toggle(True))

# ----
geo_19 = Geometry(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)

# ---- group: DIVIDE
miru_9 = PythonScript(
    Code=file_6,
    Divide_num=[Slider(14, range=0..100), Slider(8, range=0..10)],
    Divide_cut=Slider(3, range=0..100),
    Divide_type=list_4,
    Divide_ratio=Slider(0.5, range=0..1),
    Axis=list_5,
    Run=Toggle(True))

# ---- group: PERIMETER
miru_10 = PythonScript(Code=file_7, Width=Slider(12.5, range=0..100), Cut_width=Slider(0, range=0..100), Court_ref="0", Run=Toggle(True))

# ---- group: TREE RULES
miru_11 = PythonScript(Code=file_12, Node=bibil_12.Node_out, Run=toggle_2)

# ---- group: SETBACK
miru_12 = PythonScript(Code=file_9, Height_stepback=[python_10, python_9], Stepback_ref=[geo_17, geo_18], Run=Toggle(True))

miru_13 = PythonScript(Code=file_9, Height_stepback=[python_6, python_5], Stepback_ref=geo_12, Run=Toggle(True))

miru_14 = PythonScript(Code=file_9, Height_stepback=panel_6, Randomize="0.0>0.0:-1.5>1.5", Stepback_ref=geo_14, Run=toggle_3)

miru_15 = PythonScript(Code=file_9, Height_stepback=panel_9, Stepback_ref=[geo_15, geo_16], Run=Toggle(True))

# ---- group: DIVIDE
miru_16 = PythonScript(
    Code=file_6,
    Divide_num=[number_slider_6, Slider(48, range=0..100)],
    Divide_cut=Slider(0, range=0..100),
    Divide_type=list_6,
    Divide_ratio=Slider(0.5, range=0..1),
    Axis=list_8,
    Run=Toggle(True))

# ---- group: HEIGHT
miru_17 = PythonScript(Code=file_10, Height=number_slider_5, Randomize="-6.0>6", Run=Toggle(True))

# ---- group: SETBACK
miru_18 = PythonScript(Code=file_9, Height_stepback=python_7, Stepback_ref=geo_13, Run=Toggle(True))

# ---- group: HEIGHT
miru_19 = PythonScript(Code=file_10, Height=Slider(38.5, range=0..100), Run=Toggle(True))

# ---- group: SETBACK
miru_20 = PythonScript(Code=file_9, Height_stepback=python_8, Stepback_ref="-1", Run=Toggle(True))

miru_21 = PythonScript(Code=file_9, Height_stepback=panel_8, Run=Toggle(True))

# ---- group: HEIGHT
miru_22 = PythonScript(Code=file_10, Height=Slider(31.5, range=0..100), Run=Toggle(True))

# ---- group: PERIMETER
miru_23 = PythonScript(Code=file_7, Width=Slider(34, range=0..100), Cut_width=Slider(0, range=0..100), Court_ref="0", Run=Toggle(True))

# ---- group: SETBACK
miru_24 = PythonScript(Code=file_9, Height_stepback="0:3.0", Run=Toggle(True))

miru_25 = PythonScript(Code=file_9, Height_stepback=panel, Stepback_ref=Slider(0, range=0..10), Run=Toggle(True))

# ---- group: DIVIDE
miru_26 = PythonScript(
    Code=file_6,
    Divide_num=number_slider_2,
    Divide_cut=Slider(10, range=0..100),
    Divide_type=list_7,
    Divide_ratio=Slider(0.5, range=0..1),
    Axis=list_9,
    Run=Toggle(False))

# ---- group: PERIMETER
miru_27 = PythonScript(Code=file_7, Width=Slider(25, range=0..100), Cut_width=Slider(0, range=0..100), Court_ref="0", Run=Toggle(True))

# ---- group: SETBACK
miru_28 = PythonScript(Code=file_9, Height_stepback=python_12, Stepback_ref=geo_19, Run=Toggle(True))

miru_29 = PythonScript(Code=file_9, Height_stepback=panel, Stepback_ref="0", Run=Toggle(True))

miru_30 = PythonScript(Code=file_9, Height_stepback=panel_11, Run=Toggle(True))

# ---- group: HEIGHT
miru_31 = PythonScript(Code=file_10, Randomize="-6.0>6", Run=Toggle(False))

# ---- group: PERIMETER
miru_32 = PythonScript(Code=file_7, Width=Slider(34, range=0..100), Cut_width=Slider(0, range=0..100), Court_ref="0", Run=Toggle(True))

# ---- group: HEIGHT
miru_33 = PythonScript(Code=file_10, Height=Slider(31.5, range=0..100), Run=Toggle(False))

# ---- group: TREE RULES
# 3. SET TYPOLOGIES
miru_34 = PythonScript(Code=file_12, Node=bibil_12.Node_out, Run=toggle_4)

# ---- group: SHAPENODE
bibil_14 = PythonScript(
    Code=file_5,
    Rule_in=flatten([miru_11, miru_10, miru_9]),
    Node_in=flatten(python_4.lo_res),
    Label_="base",
    Run=Toggle(True))  # -> Node_out, Debug

# ----
miru_35 = PythonScript(Height_stepback=python_12, Stepback_ref=geo_19, Run=Toggle(True))

# ---- group: SHAPENODE
bibil_15 = PythonScript(
    Code=file_5,
    Rule_in=flatten([miru_34, miru_32, miru_33, miru_28, miru_29, miru_30]),
    Node_in=flatten(python_4.hi_res),
    Label_="comm-hi",
    Run=Toggle(True))  # -> Node_out, Debug

bibil_16 = PythonScript(
    Code=file_5,
    Rule_in=flatten([miru_17, miru_12, miru_15]),
    Node_in=flatten(python_4.lo_com),
    Label_="comm-low",
    Run=Toggle(True))  # -> Node_out, Debug

bibil_17 = PythonScript(
    Code=file_5,
    Rule_in=flatten([miru_7, miru_26, miru_27, miru_21]),
    Node_in=flatten(python_4.midlo_res),
    Label_="base",
    Run=Toggle(True))  # -> Node_out, Debug

bibil_18 = PythonScript(
    Code=file_5,
    Rule_in=flatten([miru_7, miru_31, miru_25, miru_24, miru_23]),
    Node_in=flatten(python_4.midhi_res),
    Label_="base",
    Run=Toggle(True))  # -> Node_out, Debug

bibil_19 = PythonScript(
    Code=file_5,
    Rule_in=flatten([miru_16, miru_19, miru_13, miru_14]),
    Node_in=flatten([python_4.midhi_com, python_4.midlo_com]),
    Label_="comm-hi",
    Run=Toggle(True))  # -> Node_out, Debug

bibil_20 = PythonScript(
    Code=file_5,
    Rule_in=flatten([miru_22, miru_18, miru_20]),
    Node_in=flatten(python_4.hi_com),
    Label_="comm-hi",
    Run=Toggle(True))  # -> Node_out, Debug

# ----
g_3 = PythonScript(node=bibil_16.Node_out)  # -> geom; inputs node: list
# ---------- g_3: Python ----------
node = filter(lambda n: n!=None,node)
if node and node != []:
    geom = []
    for n in node:
        if n.shape.z_dist < 1.2:
            geom.append(n.shape.bottom_crv)
        else:
            geom.append(n.shape.geom)
    print geom
# ---------- end g_3 ----------
g_4 = PythonScript(node=bibil_14.Node_out)  # -> geom; inputs node: list; same code as g_3
g_5 = PythonScript(node=bibil_15.Node_out)  # -> geom; inputs node: list; same code as g_3
g_6 = PythonScript(node=bibil_19.Node_out)  # -> geom; inputs node: list; same code as g_3
python_13 = PythonScript(kp=Slider(27, range=0..100), om=data_3)  # -> stp_str
# ---------- python_13: Python ----------
stp_str = str(kp) + "," + str(om)

print stp_str
# ---------- end python_13 ----------
g_7 = PythonScript(node=bibil_17.Node_out)  # -> geom; inputs node: list; same code as g_3
panel_12 = Panel("27.0,25.0")
g_8 = PythonScript(node=bibil_18.Node_out)  # -> geom; inputs node: list; same code as g_3
panel_13 = Panel(python_13)

# ---- group: PACKING
separatedata_2 = Ladybug_SeparateData(Code=file_8, X_keep_omit=python_13, Y_keep_omit=python_13, Seperation_ref="-1", Run=Toggle(True))

# ---- group: EXTRACT_SLICE
miru_36 = PythonScript(Code=file_15, Run=Toggle(True))

# ---- group: PACKING
separatedata_3 = Ladybug_SeparateData(Code=file_8, X_keep_omit="30.0,35.0", Y_keep_omit="30.0,35.0", Seperation_ref="-1", Run=Toggle(True))

# ---- group: EXTRACT_SLICE
miru_37 = PythonScript(Code=file_15, Run=Toggle(True))

# ---- group: SHAPENODE
bibil_21 = PythonScript(Code=file_5, Rule_in=flatten([miru_36, separatedata_2]), Node_in=flatten(bibil_15.Node_out), Run=Toggle(True))  # -> Node_out, Debug

# ----
g_9 = PythonScript(node=bibil_21.Node_out)  # -> nodekeep, nodeomit; inputs node: list
# ---------- g_9: Python ----------
node = filter(lambda n: n!=None,node)
if node and node != []:
    nodekeep,nodeomit = [],[]
    for i,n in enumerate(node):
        if 'keep' in n.grammar.type['grammar']:
            nodekeep.append(n)
        else:
            nodeomit.append(n)
# ---------- end g_9 ----------
list_10 = ValueList({"divide by depth": "subdivide_depth", "divide by same depth": "subdivide_depth_same", "divide by dim": "subdivide_dim"}, selected="divide by same depth")

# ---- group: SHAPENODE
bibil_22 = PythonScript(Code=file_5, Rule_in=flatten([miru_37, separatedata_3]), Node_in=flatten(bibil_20.Node_out), Run=Toggle(True))  # -> Node_out, Debug

# ----
list_11 = ValueList({"YZ": "NS", "XZ": "EW", "XY": "Z"}, selected="XZ")
g_10 = PythonScript(node=g_9.nodeomit)  # -> geom; inputs node: list; same code as g_3

# ---- group: DIVIDE
miru_38 = PythonScript(
    Code=file_6,
    Divide_num=Slider(1, range=0..10),
    Divide_cut=Slider(0, range=0..100),
    Divide_type=list_10,
    Divide_ratio=Slider(0.5, range=0..1),
    Axis=list_11,
    Run=Toggle(False))

# ---- group: HEIGHT
miru_39 = PythonScript(Code=file_10, Height=Slider(6, range=0..100), Randomize="-3.0>6.0", Run=Toggle(True))

miru_40 = PythonScript(Code=file_10, Height=Slider(100, range=0..100), Run=Toggle(True))

miru_41 = PythonScript(Code=file_10, Run=Toggle(False))

# ---- group: SHAPENODE
bibil_23 = PythonScript(Code=file_5, Rule_in=flatten(miru_40), Node_in=flatten(g_9.nodekeep), Run=Toggle(True))  # -> Node_out, Debug

bibil_24 = PythonScript(Code=file_5, Rule_in=flatten([miru_38, miru_39]), Node_in=flatten(g_9.nodeomit), Run=Toggle(True))  # -> Node_out, Debug

bibil_25 = PythonScript(Code=file_5, Rule_in=flatten(miru_41), Node_in=flatten(bibil_22.Node_out), Run=Toggle(True))  # -> Node_out, Debug

# ----
g_11 = PythonScript(node=bibil_23.Node_out)  # -> geom; inputs node: list; same code as g
g_12 = PythonScript(node=bibil_24.Node_out)  # -> geom; inputs node: list; same code as g_3
g_13 = PythonScript(node=bibil_23.Node_out)  # -> geom; inputs node: list; same code as g_3
g_14 = PythonScript(node=bibil_15.Node_out)  # -> geom; inputs node: list; same code as g_3
g_15 = PythonScript(node=bibil_16.Node_out)  # -> geom; inputs node: list; same code as g_3
g_16 = PythonScript(node=[bibil_17.Node_out, bibil_14.Node_out])  # -> geom; inputs node: list; same code as g_3
g_17 = PythonScript(node=[bibil_20.Node_out, bibil_19.Node_out])  # -> geom; inputs node: list; same code as g_3
g_18 = PythonScript(node=bibil_25.Node_out)  # -> geom; inputs node: list; same code as g_3
g_19 = PythonScript(node=bibil_18.Node_out)  # -> geom; inputs node: list; same code as g_3
# LOW-COMMERCIAL
number_slider_8 = Slider(0.2, range=0..1)
# HI-COMMERCIAL
swatch = ColourSwatch(SwatchColor=RGB(255, 255, 255))
# MID-RESIDENTIAL
swatch_2 = ColourSwatch(SwatchColor=RGB(255, 255, 255))
material = CreateMaterial(Diffuse=swatch, Specular=RGB(255, 255, 255), Emission=RGB(0, 0, 0), Transparency=number_slider_8, Shine=0)
# HI-RESIDENTIAL
swatch_3 = ColourSwatch(SwatchColor=RGB(255, 255, 255))
material_2 = CreateMaterial(Diffuse=swatch_2, Specular=RGB(255, 255, 255), Emission=RGB(0, 0, 0), Transparency=Slider(0.2, range=0..1), Shine=0)
material_3 = CreateMaterial(
    Diffuse=ColourSwatch(SwatchColor=RGB(255, 255, 255)),
    Specular=RGB(255, 255, 255),
    Emission=RGB(0, 0, 0),
    Transparency=Slider(0.2, range=0..1),
    Shine=0)
preview_2 = CustomPreview(Geometry=[g_17, g_18], Shader=material)
material_4 = CreateMaterial(Diffuse=swatch_3, Specular=RGB(255, 255, 255), Emission=RGB(0, 0, 0), Transparency=Slider(0.2, range=0..1), Shine=0)
preview_3 = CustomPreview(Geometry=[g_16, g_19], Shader=material_2)
preview_4 = CustomPreview(Geometry=g_15, Shader=material_3)
preview_5 = CustomPreview(Geometry=[g_12, g_13, g_14], Shader=material_4)
panel_14 = Panel("https://www.energyplus.net/weather-download/north_and_central_america_wmo_region_4/USA/CA/USA_CA_San.Francisco.Intl.AP.724940_TMY3/all")
number_slider_9 = Slider(9, range=0..10)
number_slider_10 = Slider(21, range=0..100)
epw_stat = Ladybug_OpenEPWAndSTATWeatherFiles(weatherFileURL=panel_14)  # -> epwFile, statFile; plug-in component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
ladybug = Ladybug_Ladybug()  # -> Vviiiiiiiiiizzz; plug-in component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
honeybee = Honeybee_Honeybee()  # -> Vviiiiiiiiiizzz; plug-in component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
analysisperiod = Ladybug_AnalysisPeriod(
    fromMonth=number_slider_9,
    fromDay=number_slider_10,
    fromHour=Slider(8.25, range=0..10),
    toMonth=number_slider_9,
    toDay=number_slider_10,
    toHour=Slider(17.25, range=0..100))  # -> readMe, analysisPeriod; plug-in component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
mesh = Mesh([g_19, g_16, g_15, g_12, g_14, g_17, g_18, g_13])
geo_20 = Geometry([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])
importlocation = Ladybug_ImportLocation(epwFile=epw_stat.epwFile)  # -> location; plug-in component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
material_5 = CreateMaterial(
    Diffuse=ColourSwatch(SwatchColor=RGB(255, 255, 255)),
    Specular=RGB(255, 255, 255),
    Emission=RGB(0, 0, 0),
    Transparency=Slider(0.4, range=0..1),
    Shine=0)
sunpath = Ladybug_SunPath(
    location=importlocation,
    hour=12,
    day=21,
    month=12,
    timeStep=1,
    analysisPeriod=analysisperiod.analysisPeriod,
    dailyOrAnnualSunPath=True)  # -> readMe, sunVectors, sunAltitudes, sunAzimuths, port, sunSpheresMesh, sunPathCrvs, legend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; plug-in component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
preview_6 = CustomPreview(Geometry=mesh, Shader=material_5)
number_slider_11 = Slider(13, range=0..100)
gradientlibrary = Ladybug_GradientLibrary(gradIndex=Slider(6, range=0..10))  # -> customColors; plug-in component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

# ---- group: set up number of legend segments based on number of vectors
lng = ListLength(List=sunpath.sunVectors)
addition_5 = Addition(A=lng, B=1)
legendpar = Ladybug_LegendParameters(numSegments=addition_5, customColors=flatten(gradientlibrary))  # -> legendPar; plug-in component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

# ----
geo_21 = Geometry([g_19, g_16, g_15, g_12, g_13, g_14, g_17, g_18])

# ---- group: SHAPENODE
bibil_26 = PythonScript(node_in=flatten(geo_21), label="buildings4analysis", run=Toggle(True))  # -> node_out, debug; inputs rule_in: tree, node_in: list, label: list, run: Boolean
# ---------- bibil_26: Python ----------
"""
Trinco UI
"""

import scriptcontext as sc
import clr

Grammar = sc.sticky["Grammar"]
clr.AddReference("Grasshopper")
from Grasshopper.Kernel.Data import GH_Path
from Grasshopper import DataTree

if run and node_in != []:
    node_in = filter(lambda n: n!=None,node_in)
    if rule_in.BranchCount < 0.5:
        rule_in = DataTree[object]()
        rule_ = []
        for i, r in enumerate(rule_):
            rule_in.Add(r)
        
    G = Grammar()
    sc.sticky["debug"] = []
    debug = sc.sticky["debug"]
    node_out = G.main_UI(node_in,rule_in,label_)
else:
    print 'Add inputs!'
# ---------- end bibil_26 ----------

# ----
g_20 = PythonScript(node=bibil_26.node_out)  # -> label; inputs node: list
# ---------- g_20: Python ----------
node = filter(lambda n: n!=None,node)
if node and node != []:
    label = []
    if True:#for i,n in enumerate(node):
        #print i
        root = node[0].get_root()
        L = root.traverse_tree(lambda n:n,internal=True) 
        for i in L:
            print i
            label.append(i)
        #label.append('--')
        #print '---'
# ---------- end g_20 ----------
number_slider_12 = Slider(3, range=0..10)
toggle_5 = BooleanToggle(True)

# ---- group: ANALYSIS
miru_42 = PythonScript(node_in=bibil_26.node_out, groundFloor_ht=number_slider_12, restFloor_ht=number_slider_12, height=toggle_5, GFA=toggle_5)  # -> ReadMe, geom_out, pt_out, label_out, analysis_out, debug; inputs node_in: list
# ---------- miru_42: Python ----------
import rhinoscriptsyntax as rs
import Rhino as rc
import random
import scriptcontext as sc
import copy
import math
import ghpythonlib.components as ghcomp

"""import classes"""
Shape = sc.sticky["Shape"]
Tree = sc.sticky["Tree"]

sc.sticky['debug'] = []
debug = sc.sticky["debug"]

TOL = sc.doc.ModelAbsoluteTolerance

def get_label(n):
    label_ = []
    root = n[0].get_root()
    L = root.traverse_tree(lambda n:n,internal=True) 
    for nl in L:
        #print nl
        label_.append(nl)
    return label_

def make_analysis(nodelen,pd):
    ## Input: dictionary of parameter key, list of data value 
    ## Output: Filtered list of str: with keys and value
    L = [""] * nodelen
    if pd.has_key('height'):
        for i,ht in enumerate(pd['height']):
            valstr = 'height: %s' % (ht)
            L[i] += valstr
    if pd.has_key('GFA'):
        for i,gfa in enumerate(pd['GFA']):
            valstr = '\nGFA: %s' % (gfa)
            L[i] += valstr
    return L

def get_ht(node_):
    L = []
    for n_ in node_:
        storey = str(round(n_.shape.ht,1))
        L.append(storey)
    return L

def get_GFA(node_,ght,rht):
    def helper_by_floor_div(n__,groundht):
        ratio = groundht/n__.shape.ht
        PD = {}
        PD['div_num'] = 1
        PD['div_deg'] = 0.
        PD['div_cut'] = 0.
        PD['div_ratio'] = ratio
        PD['div_type'] = 'simple_divide'
        PD['axis'] = "Z"
        divnode = n__.grammar.divide(n_,PD)
        
        if abs(divnode.loc[0].shape.ht - groundht) < 0.01:
            groundfloor = divnode.loc[0]
            restfloor = divnode.loc[1]
        else:
            groundfloor = divnode.loc[1]
            restfloor = divnode.loc[0]
        return groundfloor,restfloor
    def helper_by_floor_calc(n__,htdiv):
        n__.shape.geom = ghcomp.CapHolesEx(n__.shape.geom)[0]
        shapevol = rc.Geometry.VolumeMassProperties.Compute(n__.shape.geom).Volume
        shapegfa = shapevol/htdiv
        return shapegfa
        
    debug = sc.sticky['debug']
    ReadMe_ = ""
    L = []
    for n_ in node_:
        if abs(ght-rht)<0.1:
            gfacalc = helper_by_floor_calc(n_,rht)
        else:
            try:
                grndshape,rstshape = helper_by_floor_div(n_,ght)
                grndgfa = grndshape.shape.get_area()
                rstgfa = helper_by_floor_calc(rstshape,rht)
                gfacalc = grndgfa + rstgfa
            except:
                ReadMe_ = "Calculating by specific floor heights has failed, probably because the geometry was too complicated. GFA is now based on restfloorht."
                gfacalc = helper_by_floor_calc(rstshape,3.)
        #debug.extend(map(lambda n:n.shape.geom,divnode.loc))
        L.append(str(round(abs(gfacalc),1)))
    return L,ReadMe_

node = filter(lambda n: n!=None,node_in)
if node and node != []:
    node = map(lambda n: copy.deepcopy(n),node)
    sc.sticky['debug'] = []
    debug = sc.sticky['debug']
    ReadMe = ""
    
    #These always appear by default
    label_out = get_label(node)
    geom_out = map(lambda n:n.shape.geom,node)
    pt_out = map(lambda n:n.shape.cpt,node)
    #Analysis paramaters
    param_dict = {}
    if height==True:
        ht_out = get_ht(node)
        param_dict['height'] = ht_out
    if GFA == True:
        if not groundFloor_ht:
            groundFloor_ht = 3.0
        if not restFloor_ht:
            restFloor_ht = 3.0
        gfa_out,readmegfa = get_GFA(node,groundFloor_ht,restFloor_ht)
        param_dict['GFA'] = gfa_out
        ReadMe += readmegfa
    analysis_out = make_analysis(len(node),param_dict)
    if not ReadMe:
        ReadMe = "Successfully calculated"
# ---------- end miru_42 ----------

# ----
panel_15 = Panel(miru_42.analysis_out)
panel_16 = Panel(miru_42.ReadMe)

# ---- group: ground
geo_22 = Geometry(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)

# ----
mesh_2 = Mesh([g_19, g_16, g_15, g_12, g_13, g_14, g_17, g_18])
sunlighthoursanalysis = Ladybug_SunlightHoursAnalysis(
    geometry=flatten(geo_22),
    context=flatten(mesh_2),
    gridSize="1",
    disFromBase=Slider(0.001, range=0..0.001),
    sunVectors=flatten(sunpath.sunVectors),
    timeStep=1,
    legendPar=flatten(legendpar),
    parallel=Toggle(True),
    runIt=Toggle(False))  # -> readMe, contextMesh, analysisMesh, testPts, testVec, port, sunlightHoursResult, sunlightHoursMesh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; plug-in component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
python_14 = PythonScript(analysis_in=miru_42.analysis_out)  # -> GFA; inputs analysis_in: list
# ---------- python_14: Python ----------
analysis_in = filter(lambda n: n!=None,analysis_in)

if analysis_in:
    ID,GFA,HT = [],[],[]
    for an in analysis_in:
        lst = an.split('\n')
        ID.append('null')
        ht = float(lst[0].split(": ")[-1])
        gfa = float(lst[1].split(": ")[-1])
        HT.append(ht)
        GFA.append(gfa)
        #print '--'
# ---------- end python_14 ----------
panel_17 = Panel(sunlighthoursanalysis.totalSunlightHours)
ma = MassAddition(Input=python_14)  # -> Result, PartialResults
rec = DataRecorder(ma.Result, DataLimit=1000, RecordData=True)
panel_18 = Panel(ma.Result)
mesh_3 = Mesh(sunlighthoursanalysis.sunlightHoursMesh)
g_21 = PythonScript(node=[bibil_17.Node_out, bibil_18.Node_out, bibil_16.Node_out, bibil_23.Node_out, bibil_24.Node_out, bibil_15.Node_out, bibil_19.Node_out, bibil_20.Node_out, bibil_25.Node_out])  # -> gfa; inputs node: list
# ---------- g_21: Python ----------
import rhinoscriptsyntax as rs
import Rhino as rc

node = filter(lambda n: n!=None,node)
if node and node != []:
    shapegfa = []
    for n in node:
        htdiv = 3.0
        shapevol = rc.Geometry.VolumeMassProperties.Compute(n.shape.geom).Volume
        shapegfa.append(shapevol/htdiv)
    gfa = sum(shapegfa)
    print gfa
# ---------- end g_21 ----------
# maxbld gfa: 561415.2
# minbld gfa: 421682.2
# maxbld sun: 368381.6
# minbld sun: 391561.2
python_15 = PythonScript(gfa=g_21, sun=sunlighthoursanalysis.totalSunlightHours)  # -> normgfa, normsun
# ---------- python_15: Python ----------
#import scriptcontext as sc
#Bula = sc.sticky['Bula']
#B = Bula()
#B.normalize_list(lov,hibound,lobound)

def norm(v,min_,max_):
    #norm_val = ((hibound-lobound)*(v-min_))/(max_-min_) + lobound
    return ((10.-0.01)*(v-min_))/(max_-min_) + 0.01


maxgfa = 561415.2
mingfa = 421682.2

#maxsun = 391561.2
#minsun = 368381.6

normgfa = norm(gfa,maxgfa,mingfa)
#normsun = norm(sun,maxsun,minsun)
print normgfa
# ---------- end python_15 ----------
toggle_6 = BooleanToggle(False)
rec_2 = DataRecorder(python_4.var_a, DataLimit=10000, RecordData=True)
rec_3 = DataRecorder(python_4.var_b, DataLimit=10000, RecordData=True)
rec_4 = DataRecorder(python_4.var_c, DataLimit=10000, RecordData=True)
rec_5 = DataRecorder(python_15.normgfa, DataLimit=10000, RecordData=True)
rec_6 = DataRecorder(python_15.normsun, DataLimit=10000, RecordData=True)
excelwrite = ExcelWriteLEGACY(
    WriteToggle=toggle_6,
    WriteHeading=toggle_6,
    ClearSheet=Toggle(False),
    Worksheet=1,
    ColumnStart=1,
    RowStart=1,
    ColumnHeadings=["STEP_INCREMENT", "SEPERATION", "HEIGHT_INCREMENT", "GFA", "SUN"],
    Column1=rec_2,
    Column2=rec_3,
    Column3=rec_4,
    Column4=rec_5,
    Column5=rec_6)
