# Grasshopper definition bibil_social_data_collection.gh (Grasshopper 0.9.76)
# plug-ins: Python Interpreter, SonicDownloadImage, LunchBox, Mosquito

twitter = SonicTweet(User="PaulKulig_TO", useIDs=Toggle(False), GetFollow=Toggle(True))  # -> User, Name, Location, Info, Followers, Created, TimeZone, Language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
location = SonicLocation(Location="64 Madison Avenue, Toronto, Ontario")  # -> Address, Points, Type
python = PythonScript(pt=location.Points)  # -> lat, lon; inputs pt: list; disabled
# ---------- python: Python ----------
import rhinoscriptsyntax as rs
import Rhino as rc

if type(pt)==type([]):
    pt = pt[0]
pt = rs.coerce3dpoint(pt)
lon = str(pt[0])
lat = str(pt[1])
# ---------- end python ----------
panel = Panel(location.Address)
panel_2 = Panel(location.Points)
geo = Geometry(location.Points)
user = Panel(twitter.User)
users_name = Panel(twitter.Name)
users_location = Panel(twitter.Location)
followers = Panel(twitter.Followers)
user_creation_date = Panel(twitter.Created)
timezone = Panel(twitter.TimeZone)
user_language = Panel(twitter.Language)
users_self_description = Panel(twitter.Info)
user_id = Panel(twitter.UserID)
panel_3 = Panel("43.6716149")
panel_4 = Panel("-79.4237128")
panel_5 = Panel("\"Yonge Eglinton\"")
panel_6 = Panel("\"680NEWS\"")
followers_2 = Panel(twitter.FollowerID)
current_user_status = Panel(twitter.StatusMsg)
date_of_status = Panel(twitter.StatusDate)
timer = Timer(TimerInterval=10000, Target=[twitter_2, excelwrite])  # disabled
twitter_2 = SonicTweet(Search="\"#geobibil\"", GeoLat=python.lat, GeoLon=python.lon, GeoRadius="4", nResults="100")  # -> Message, fromUser, toUser, Date, Location, hasGeo, ProfilePic, Followers, ID
multiplication = Multiplication(A="4", B=Slider(1000, range=0..1000))
toggle = BooleanToggle(False)
circle = CircleCNR(Center=location.Points, Normal=Vector(0, 0, 1), Radius=multiplication)
lng = ListLength(List=twitter_2.Message)
panel_7 = Panel(lng)
twitter_3 = SonicTweet(User=followers_2, useIDs=Toggle(True))  # -> User, Name, Location, Info, Followers, Created, TimeZone, Language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
follower_names = Panel(twitter_3.User)
date = Panel(twitter_2.Location)
date_2 = Panel(twitter_2.Date)
recorder = StringRecorder(List=twitter_2.Message, Index=Slider(0, range=0..100), Reset=toggle)
recorder_2 = StringRecorder(List=twitter_2.fromUser, Index=Slider(0, range=0..100), Reset=toggle)
recorder_3 = StringRecorder(List=twitter_2.Date, Index=Slider(0, range=0..100), Reset=toggle)
recorder_4 = StringRecorder(List=twitter_2.Location, Index=Slider(0, range=0..100), Reset=toggle)
panel_8 = Panel(recorder)
panel_9 = Panel(recorder_2)
panel_10 = Panel(recorder_3)
panel_11 = Panel(recorder_4)
has_geo = Panel(twitter_2.hasGeo)
python_2 = PythonScript(x=twitter_2.Location)  # -> a; inputs x: list
# ---------- python_2: Python ----------
import rhinoscriptsyntax as rs
import Rhino as rc


L = []

for loc in x:
    strlst = loc.split(',')
    try:#if len(strlst)>1:
        lat = strlst[0]
        lon = strlst[1]
        lat = float(lat)
        lon = float(lon)
        cpt = rs.AddPoint(lat,lon,0.)
        L.append(cpt)
    except:
        pass#cpt = rs.AddPoint(0,0,0)
    

latlst = []
lonlst = []
LP = []
for i,c in enumerate(L):
    pt = rs.coerce3dpoint(c)
    latlst.append(pt[0])
    lonlst.append(pt[1])

def normalize_list(lov,hibound,lobound):
    """normalized_val = ( (val-min)*(hibound-lobound) )/(max-min) + lobound"""
    max_ = max(lov)
    min_ = min(lov)
    L = []
    
    for i,v in enumerate(lov):
        if max_-min_ > 0.:
            norm_val = ((hibound-lobound)*(v-min_))/(max_-min_) + lobound
        else: 
            norm_val = 1/float(len(lov))
        L.append(norm_val)
    return L

norm_lat = normalize_list(latlst,100.,0.)
norm_lon = normalize_list(lonlst,100.,0.)

L = []
for lat,lon in zip(norm_lat,norm_lon):
    pt = rc.Geometry.Point3d(lat,lon,0.)
    L.append(pt)

a = L
# ---------- end python_2 ----------
senders_name = Panel(twitter_2.fromUser)
geo_2 = Geometry(python_2)
tag = TextTag(Location=python_2, Text=twitter_2.fromUser)
recepients_name = Panel(twitter_2.toUser)
excelwrite = ExcelWriteLEGACY(
    WriteToggle=Toggle(True),
    WriteHeading=Toggle(True),
    ClearSheet=toggle,
    Worksheet=1,
    ColumnStart=1,
    RowStart=1,
    ColumnHeadings=["Date", "GeoLocation", "Tweet", "User"],
    Column1=recorder_3,
    Column2=recorder_4,
    Column3=recorder,
    Column4=recorder_2)
message = Panel(twitter_2.Message)
python_3 = PythonScript(tweet=twitter_2.Message)  # -> file; inputs tweet: list
# ---------- python_3: Python ----------
L = []
for t in tweet:
    if "https" in t:
        tlst = t.split(' ')
        link = tlst[-1]
        L.append(link)

file = L[0]
print file
# ---------- end python_3 ----------
imagedl = DownloadImages(ImageURL=python_3, Name="geobibil", Directory="C:\saeran\master\git\bibil\src\reference\img_files", Reload=Toggle(True))
geo_3 = Geometry(<curve referenced from the Rhino model>)
number_slider = Slider(27, range=0..100)
img = ImportImage(File=imagedl, Rectangle=geo_3)
path = FilePath("C:\Users\user\Desktop\ye_sim_test\Frame_40000.png")
geo_4 = Geometry(<curve referenced from the Rhino model>)
geo_5 = Geometry(img)
img_2 = ImportImage(File=path, Rectangle=geo_4, XSamples=number_slider, YSamples=number_slider)
