# Grasshopper definition bibil_social_data_collection_001.gh (Grasshopper 0.9.76)
# plug-ins: Python Interpreter, LunchBox, Mosquito

twitter = SonicTweet(User="PaulKulig_TO", useIDs=Toggle(False), GetFollow=Toggle(True))  # -> User, Name, Location, Info, Followers, Created, TimeZone, Language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
location = SonicLocation(Location="64 Madison Avenue, Toronto, Ontario")  # -> Address, Points, Type
python = PythonScript(pt=location.Points)  # -> lat, lon; inputs pt: list; disabled
# ---------- python: Python ----------
import rhinoscriptsyntax as rs
import Rhino as rc

if type(pt)==type([]):
    pt = pt[0]
pt = rs.coerce3dpoint(pt)
lon = str(pt[0])
lat = str(pt[1])
# ---------- end python ----------
panel = Panel(location.Address)
panel_2 = Panel(location.Points)
geo = Geometry(location.Points)
user = Panel(twitter.User)
users_name = Panel(twitter.Name)
users_location = Panel(twitter.Location)
followers = Panel(twitter.Followers)
user_creation_date = Panel(twitter.Created)
timezone = Panel(twitter.TimeZone)
user_language = Panel(twitter.Language)
users_self_description = Panel(twitter.Info)
user_id = Panel(twitter.UserID)
panel_3 = Panel("43.6716149")
panel_4 = Panel("-79.4237128")
panel_5 = Panel("\"680NEWStraffic\"")
panel_6 = Panel("\"tofire\"")
followers_2 = Panel(twitter.FollowerID)
current_user_status = Panel(twitter.StatusMsg)
date_of_status = Panel(twitter.StatusDate)
twitter_2 = SonicTweet(Search="\"#geobibil\"", GeoLat=python.lat, GeoLon=python.lon, GeoRadius="6", nResults="100")  # -> Message, fromUser, toUser, Date, Location, hasGeo, ProfilePic, Followers, ID
timer = Timer(TimerInterval=10000, Target=[twitter_2, excelwrite])  # disabled
multiplication = Multiplication(A="6", B=Slider(1000, range=0..1000))
toggle = BooleanToggle(False)
circle = CircleCNR(Center=location.Points, Normal=Vector(0, 0, 1), Radius=multiplication)
lng = ListLength(List=twitter_2.Message)
panel_7 = Panel(lng)
twitter_3 = SonicTweet(User=followers_2, useIDs=Toggle(True))  # -> User, Name, Location, Info, Followers, Created, TimeZone, Language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
follower_names = Panel(twitter_3.User)
date = Panel(twitter_2.Date)
date_2 = Panel(twitter_2.Location)
recorder = StringRecorder(List=twitter_2.Message, Index=Slider(0, range=0..100), Reset=toggle)
recorder_2 = StringRecorder(List=twitter_2.fromUser, Index=Slider(0, range=0..100), Reset=toggle)
recorder_3 = StringRecorder(List=twitter_2.Date, Index=Slider(0, range=0..100), Reset=toggle)
recorder_4 = StringRecorder(List=twitter_2.Location, Index=Slider(0, range=0..100), Reset=toggle)
panel_8 = Panel(recorder)
panel_9 = Panel(recorder_2)
panel_10 = Panel(recorder_3)
panel_11 = Panel(recorder_4)
has_geo = Panel(twitter_2.hasGeo)
geo_2 = Geometry(Point(-79.4042324, 43.6701074, 0))
senders_name = Panel(twitter_2.fromUser)
python_2 = PythonScript(x=twitter_2.Location, tweet=twitter_2.Message, refpt=geo_2)  # -> loc, textloc; inputs x: list, tweet: list
# ---------- python_2: Python ----------
import rhinoscriptsyntax as rs
import Rhino as rc
#import ghpythonlib.components as ghcomp

L = []
textloc = []
for loc,t in zip(x,tweet):
    strlst = loc.split(',')
    try:#if len(strlst)>1:
        lat = strlst[0]
        lon = strlst[1]
        lat = float(lat)
        lon = float(lon)
        cpt = rs.AddPoint(lat,lon,0.)
        L.append(cpt)
    except:
        strlst = t.split(" ")
        strlst = strlst[1:-1]
        if 'and' in strlst:
            loc = ""
            for word in strlst:
                loc += word + " "
            textloc.append(loc + ", Toronto, Ontario")


loc = L
# ---------- end python_2 ----------
location_2 = SonicLocation(Location=python_2.textloc)  # -> Address, Points, Type
recepients_name = Panel(twitter_2.toUser)
excelwrite = ExcelWriteLEGACY(
    WriteToggle=Toggle(True),
    WriteHeading=Toggle(True),
    ClearSheet=toggle,
    Worksheet=1,
    ColumnStart=1,
    RowStart=1,
    ColumnHeadings=["Date", "GeoLocation", "Tweet", "User"],
    Column1=recorder_3,
    Column2=recorder_4,
    Column3=recorder,
    Column4=recorder_2)
panel_12 = Panel(location_2.Points)
python_3 = PythonScript(raw_points=flatten([python_2.loc, location_2.Points]))  # -> norm_points; inputs raw_points: list
# ---------- python_3: Python ----------
import rhinoscriptsyntax as rs
import Rhino as rc

latlst = []
lonlst = []
LP = []

L = raw_points
print L

for i,c in enumerate(L):
    pt = rs.coerce3dpoint(c)
    latlst.append(pt[0])
    lonlst.append(pt[1])

def normalize_list(lov,hibound,lobound):
    #normalized_val = ( (val-min)*(hibound-lobound) )/(max-min) + lobound
    max_ = max(lov)
    min_ = min(lov)
    L = []
    
    for i,v in enumerate(lov):
        if max_-min_ > 0.:
            norm_val = ((hibound-lobound)*(v-min_))/(max_-min_) + lobound
        else: 
            norm_val = 1/float(len(lov))
        L.append(norm_val)
    return L

norm_lat = normalize_list(latlst,4000.,-4000.)
norm_lon = normalize_list(lonlst,4000.,-4000.)

L = []
for lat,lon in zip(norm_lat,norm_lon):
    pt = rc.Geometry.Point3d(lat,lon,0.)
    L.append(pt)

norm_points = L
# ---------- end python_3 ----------
message = Panel(twitter_2.Message)
panel_13 = Panel("C:\Users\vasanthakumars\Documents\GitHub\bibil\src\reference\img_files\")
panel_14 = Panel("C:\saeran\master\git\bibil\src\reference\img_files\")  # disabled
geo_3 = Geometry(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)
number_slider = Slider(100, range=0..100)
python_4 = PythonScript(fileref=panel_13, tweet=twitter_2.Message, refrect=geo_3, geopt=python_3)  # -> file, rect; inputs tweet: list, geopt: list
# ---------- python_4: Python ----------
import rhinoscriptsyntax as rs
import Rhino as rc
import scriptcontext as sc

"""
TL = []
for t in tweet:
    if "https" in t:
        tlst = t.split(' ')
        link = tlst[-1]
        TL.append(link)
"""

img4 = "CqVjyOJUsAA6kt6_04.jpg"
img5 = "CqVjyOJUsAA6kt6_05.jpg"
img6 = "CqVjyOJUsAA6kt6_06.jpg"
img7 = "CqVjyOJUsAA6kt6_07.jpg"

LI = [img4,img5,img6,img7]
LI = map(lambda i: fileref+i,LI)

refrect = rs.coercecurve(refrect)
refcpt = rc.Geometry.AreaMassProperties.Compute(refrect).Centroid
refrect = sc.doc.Objects.AddCurve(refrect)

#rc.Geometry.AreaMassProperties.Centroid
#refcpt = rs.CurveAreaCentroid(refrect)
#refcpt = rs.coerce3dpoint(refcpt)

LR = []
for gpt in geopt:
    gpt = rs.coerce3dpoint(gpt)
    dir_vec = gpt-refcpt
    copyrect = rs.CopyObject(refrect,dir_vec)
    LR.append(copyrect)
    
file = LI
rect = LR
# ---------- end python_4 ----------
img = ImportImage(File=python_4.file, Rectangle=python_4.rect, XSamples=number_slider, YSamples=number_slider)
geo_4 = Geometry(python_3)
tag = TextTag(Location=python_3, Text=twitter_2.Message)
