# Grasshopper definition bibil_social_data_collection_002_internalized.gh (Grasshopper 0.9.76)
# plug-ins: Python Interpreter, Human, LunchBox, Mosquito

panel = Panel("43.66861,-79.41294")  # disabled
# Enter a city or suburb:
panel_2 = Panel("Toronto Ontario")  # disabled
# New York Central Park United States
panel_3 = Panel("Andorra la vella")  # disabled
python = PythonScript()  # -> out, a; disabled
# ---------- python: Python ----------
import rhinoscriptsyntax as rs

a = rs.AddPoint(43.6681,-79.41294,0.0)
# ---------- end python ----------
location = MosquitoLocation(Location=panel_2)  # -> Address, Points, Type; disabled

# ----
# Note: Change this number with caution,
# Increase bounds iterratively.
panel_4 = Panel("0.016")  # disabled

panel_5 = Panel("natural=coastline")  # disabled
item = ListItem(List=location.Points, Index=0, Wrap=True)  # disabled
toggle = BooleanToggle(True)  # disabled
toggle_2 = BooleanToggle(True)  # disabled
toggle_3 = BooleanToggle(True)  # disabled
toggle_4 = BooleanToggle(True)  # disabled
circle = CircleCNR(Center=item, Normal=Vector(0, 0, 1), Radius=panel_4)  # disabled
vector_maps = VectorMaps(Area=circle, AllRoads=toggle_2, Buildings=toggle_3, ReProject=toggle_4, CenterToWorld=toggle)  # -> RoadLines, RoadInfo, BuildingLines, BuildingInfo, BuildingHeights, AmenityLines, AmenityInfo, AmenityPoints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; disabled
geo = Geometry(Tree({0}: [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], {1}: [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], {2}: [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], {3}: [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], {4}: [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], {5}: [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]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))
panel_6 = Panel("\"680NEWStraffic\"")
panel_7 = Panel("43.6716149")
panel_8 = Panel("\"tofire\"")
panel_9 = Panel("-79.4237128")
twitter = SonicTweet(Search="\"#geobibil\"", GeoRadius="1", nResults="100")  # -> Message, fromUser, toUser, Date, Location, hasGeo, ProfilePic, Followers, ID
timer = Timer(TimerInterval=10000, Target=[twitter, excelwrite])  # disabled
lng = ListLength(List=twitter.Message)
panel_10 = Panel(lng)
date = Panel(twitter.Date)
senders_name = Panel(twitter.fromUser)
message = Panel(twitter.Message)
has_geo = Panel(twitter.hasGeo)
date_2 = Panel(twitter.Location)
python_2 = PythonScript(
    x=["", "43.6560234,-79.3992577", "43.653832,-79.3988178", "", "", "", "", "43.6666263,-79.4040525", ""],
    tweet=["#geobibil harbord and spadina https://t.co/AoFvWHX3Yi", "#geobibil spadina and Nassau Street https://t.co/MJa2RJxF3n", "#geobibil spadina and glen baille https://t.co/o8vxnPXFra", "#geobibil spadina and dundas https://t.co/8tjjMKnkRn", "#geobibil Sullivan Street and spadina https://t.co/deSbw8oij5", "#geobibil queen Street and tecumseh https://t.co/m3lXEW5JX3", "#geobibil Bloor and Walmer https://t.co/iHdhH8Coqr", "#geobibil spadina and bloor https://t.co/ItDK2buOLy", "#geobibil lowther and spadina https://t.co/Vhl8wLLkgS"])  # -> loc, textloc, tweetlst; inputs x: list, tweet: list
# ---------- python_2: Python ----------
import rhinoscriptsyntax as rs
import Rhino as rc
import copy

L = []
textloc = []
tweetlst = []

for loc,t in zip(x,tweet):
    tcopy = copy.copy(t)
    strlst = loc.split(',')
    tlst = t.split(' ')
    if len(tlst) > 2:
        #print t
        try:#if len(strlst)>1:
            lat = strlst[0]
            lon = strlst[1]
            lat = float(lat)
            lon = float(lon)
            cpt = rs.AddPoint(lat,lon,0.)
            L.append(cpt)
            tweetlst.append(tcopy)
        except:
            strlst = t.split(" ")
            strlst = strlst[1:-1]
            if 'and' in strlst and strlst[0]!='and':
                loc = ""
                for word in strlst:
                    loc += word + " "
                textloc.append(loc + ", Toronto, Ontario")
                tweetlst.append(tcopy)
                L.append(None)
        

loc = L
# ---------- end python_2 ----------
location_2 = SonicLocation(Location=python_2.textloc)  # -> Address, Points, Type
toggle_5 = BooleanToggle(False)
python_3 = PythonScript(raw_points=flatten(python_2.loc), process_points=flatten(location_2.Points))  # -> norm_points; inputs raw_points: list, process_points: list
# ---------- python_3: Python ----------
import rhinoscriptsyntax as rs
import Rhino as rc

L = []

for i,rawpt in enumerate(raw_points):
    if rawpt != None:
        pt = rs.coerce3dpoint(rawpt)
        L.append(pt)
    else:
        if len(process_points) > 0:
            newpt = process_points.pop(0)
            L.append(newpt)
norm_points = L
# ---------- end python_3 ----------
location_3 = SonicLocation(Location="Spadina and Harbord, Toronto, Ontario")  # -> Address, Points, Type
location_4 = SonicLocation(Location="64 Madison Avenue, Toronto, Ontario")  # -> Address, Points, Type
pt = Point(Point(1219.347912, -2410.299065, 0))
pt_2 = Point(Point(1363.008044, -3171.765819, 0))
recorder = StringRecorder(List=twitter.Message, Index=Slider(0, range=0..100), Reset=toggle_5)
recorder_2 = StringRecorder(List=twitter.fromUser, Index=Slider(0, range=0..100), Reset=toggle_5)
recorder_3 = StringRecorder(List=twitter.Date, Index=Slider(0, range=0..100), Reset=toggle_5)
recorder_4 = StringRecorder(List=twitter.Location, Index=Slider(0, range=0..100), Reset=toggle_5)

# ---- group: Project
python_4 = PythonScript(refpt_OSM_1=location_4.Points, refpt_OSM_2=location_3.Points, refpt_model_1=pt, refpt_model_2=pt_2)  # -> dir_vec, scale_factor; inputs refpt_OSM_1: list, refpt_OSM_2: list
# ---------- python_4: Python ----------
import rhinoscriptsyntax as rs
import Rhino as rc


## convert to rhino common
if type(refpt_OSM_1)==type([]):
    refpt_OSM_1 = refpt_OSM_1[0]
if type(refpt_OSM_2)==type([]):
    refpt_OSM_2 = refpt_OSM_2[0]
refpt_OSM_1 = rs.coerce3dpoint(refpt_OSM_1)
refpt_OSM_2 = rs.coerce3dpoint(refpt_OSM_2)
refpt_model_1 = rs.coerce3dpoint(refpt_model_1)
refpt_model_2 = rs.coerce3dpoint(refpt_model_2)

# dir_vec: is vector from center pt of model to
# the center point of Map Vector 
dir_vec = refpt_model_1 - refpt_OSM_1

# Get the distances between our respective ref pts
OSM_dist = refpt_OSM_1.DistanceTo(refpt_OSM_2)
model_dist = refpt_model_1.DistanceTo(refpt_model_2)

# scale factor is number we need to scale up our
# OSM numbers by
scale_factor = model_dist/float(OSM_dist)
print scale_factor
# ---------- end python_4 ----------

# ----
panel_11 = Panel(recorder)
panel_12 = Panel(recorder_2)
panel_13 = Panel(recorder_3)
panel_14 = Panel(recorder_4)
move = Move(Geometry=python_3, Motion=python_4.dir_vec)  # -> Geometry, Transform
scale = Scale(Geometry=move.Geometry, Center=pt, Factor=python_4.scale_factor)  # -> Geometry, Transform
Z = UnitZ(Factor=Slider(2000, range=0..10000))
excelwrite = ExcelWriteLEGACY(
    WriteToggle=Toggle(False),
    WriteHeading=Toggle(True),
    ClearSheet=toggle_5,
    Worksheet=1,
    ColumnStart=1,
    RowStart=1,
    ColumnHeadings=["Date", "GeoLocation", "Tweet", "User"],
    Column1=recorder_3,
    Column2=recorder_4,
    Column3=recorder,
    Column4=recorder_2)
data = Data(scale.Geometry)
geo_2 = Geometry(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)
area = Area(Geometry=geo_2)  # -> Area, Centroid
panel_15 = Panel("C:\Users\vasanthakumars\Documents\GitHub\bibil\src\reference\img_files\")
panel_16 = Panel("C:\saeran\master\git\bibil\src\reference\img_files\")  # disabled
move_2 = Move(Geometry=data, Motion=Z)  # -> Geometry, Transform
scale_2 = Scale(Geometry=geo_2, Center=area.Centroid, Factor=Slider(7, range=0..10))  # -> Geometry, Transform

# ---- group: z_pt
data_2 = Data(move_2.Geometry)

# ----
python_5 = PythonScript(fileref=panel_15)  # -> imglink
# ---------- python_5: Python ----------
img1 = "CqV8YL8UAAACMGV_00.jpg"
img1 = "CqV1yeAUIAAfLNS_01.jpg"
img2 = "CqV1yeAUIAAfLNS_02.jpg"
img3 = "CqVyPeRUIAAhz1l_03.jpg"
img4 = "CqVjyOJUsAA6kt6_04.jpg"
img5 = "CqVjyOJUsAA6kt6_05.jpg"
img6 = "CqVjyOJUsAA6kt6_06.jpg"
img7 = "CqVjyOJUsAA6kt6_07.jpg"
img8 = "CqVjyOJUsAA6kt6_08.jpg"


LI = [img1,img2,img3,img4,img5,img6,img7,img8]
LI = map(lambda i: fileref+i,LI)
#LI.reverse()
imglink = LI
# ---------- end python_5 ----------
python_6 = PythonScript(
    image_link=python_5,
    tweet=["#geobibil harbord and spadina https://t.co/AoFvWHX3Yi", "#geobibil spadina and Nassau Street https://t.co/MJa2RJxF3n", "#geobibil spadina and glen baille https://t.co/o8vxnPXFra", "#geobibil spadina and dundas https://t.co/8tjjMKnkRn", "#geobibil Sullivan Street and spadina https://t.co/deSbw8oij5", "#geobibil queen Street and tecumseh https://t.co/m3lXEW5JX3", "#geobibil Bloor and Walmer https://t.co/iHdhH8Coqr", "#geobibil spadina and bloor https://t.co/ItDK2buOLy", "#geobibil lowther and spadina https://t.co/Vhl8wLLkgS"],
    refrect=scale_2.Geometry,
    geopt=data)  # -> file, rect; inputs image_link: list, tweet: list, geopt: list
# ---------- python_6: Python ----------
import rhinoscriptsyntax as rs
import Rhino as rc
import scriptcontext as sc

"""
TL = []
for t in tweet:
    if "https" in t:
        tlst = t.split(' ')
        link = tlst[-1]
        TL.append(link)
"""

refrect = rs.coercecurve(refrect)
refcpt = rc.Geometry.AreaMassProperties.Compute(refrect).Centroid
refrect = sc.doc.Objects.AddCurve(refrect)

LR = []
for gpt in geopt:
    gpt = rs.coerce3dpoint(gpt)
    dir_vec = gpt-refcpt
    copyrect = rs.CopyObject(refrect,dir_vec)
    LR.append(copyrect)

file = image_link
rect = LR
# ---------- end python_6 ----------
swatch = ColourSwatch(SwatchColor=RGB(0, 0, 255))
ln = Line(StartPoint=data_2, EndPoint=data)
number_slider = Slider(200, range=0..1000)
Z_2 = UnitZ(Factor=Slider(10, range=0..10))
move_3 = Move(Geometry=python_6.rect, Motion=Z_2)  # -> Geometry, Transform
img = ImportImage(File=python_6.file, Rectangle=move_3.Geometry, XSamples=number_slider, YSamples=number_slider)
preview = CustomPreview(Geometry=ln, Shader=swatch)
screentext = ScreenOrientedText(
    Text=python_2.tweetlst,
    Justification=5,
    Location=data_2,
    SizeFactor=Slider(10, range=0..10),
    Color=swatch,
    Depth=0,
    Absolute=False)
