# Grasshopper definition bibil_trial_034.gh (Grasshopper 0.9.76)
# plug-ins: Python Interpreter

panel = Panel("C:\\saeran\\master\\git\\bibil\\src")
# BIBIL TRIAL
# Copyright (C) Saeran Vasanthakumar - All Rights Reserved
# Unauthorized copying of this file, via any medium is strictly prohibited
# Proprietary and confidential
# Written by Saeran Vasanthakumar <saeranv@gmail.com>, May 2016
# BIBIL_BIBIL
panel_2 = Panel("C:\\Users\\vasanthakumars\\Documents\\GitHub\\bibil\\src")
panel_3 = Panel(panel_2)
python_script = PythonScript(i=panel_3)  # -> o
# ---------- python_script: Python ----------
import os

o = os.path.join(str(i),"bibil\\bibil_tree.py")
# ---------- end python_script ----------
file = ReadFile(File=python_script, PerLineParse=False)
python_script_2 = PythonScript(i=panel_3)  # -> o
# ---------- python_script_2: Python ----------
import os

o = os.path.join(str(i),"bibil\\bibil_shape.py")
#o = os.path.join(str(i),"research\\bibil_shape_shape_3d_2d.py")
# ---------- end python_script_2 ----------
file_2 = ReadFile(File=python_script_2, PerLineParse=False)
python_script_3 = PythonScript(i=panel_3)  # -> o
# ---------- python_script_3: Python ----------
import os

o = os.path.join(str(i),"bibil\\bibil_rule.py")
# ---------- end python_script_3 ----------
file_3 = ReadFile(File=python_script_3, PerLineParse=False)
bibil = PythonScript(Code=file)
bibil_2 = PythonScript(Code=file_3)
bibil_3 = PythonScript(Code=file_2)
python_script_4 = PythonScript(i=panel_3)  # -> o
# ---------- python_script_4: Python ----------
import os

o = os.path.join(str(i),"koku\\koku_vector.py")
# ---------- end python_script_4 ----------
file_4 = ReadFile(File=python_script_4, PerLineParse=False)
python_script_5 = PythonScript(i=panel_3)  # -> o
# ---------- python_script_5: Python ----------
import os

o = os.path.join(str(i),"bibil\\bibil_pattern.py")
# ---------- end python_script_5 ----------
file_5 = ReadFile(File=python_script_5, PerLineParse=False)
bibil_4 = PythonScript(Code=file_5)
bibil_5 = PythonScript(Code=file_4)

python_script_6 = PythonScript(i=panel_3)  # -> o; disabled
# ---------- python_script_6: Python ----------
import os

o = os.path.join(str(i),"koku\\koku_plane.py")
# ---------- end python_script_6 ----------
python_script_7 = PythonScript(i=panel_3)  # -> o; disabled
# ---------- python_script_7: Python ----------
import os

o = os.path.join(str(i),"koku\\koku_line.py")
# ---------- end python_script_7 ----------
file_6 = ReadFile(File=python_script_6, PerLineParse=False)  # disabled
file_7 = ReadFile(File=python_script_7, PerLineParse=False)  # disabled
bibil_6 = PythonScript(Code=file_6)  # disabled
bibil_7 = PythonScript(Code=file_7)  # disabled

# ----
# BIBIL_KOKU
# Notes: How resolve import/scriptcontext issue to
# allow for integration for native Pydev and rhino
# testing?
python_script_8 = PythonScript(i=panel_3)  # -> o; same code as python_script_4
file_8 = ReadFile(File=python_script_8, PerLineParse=False)
bibil_8 = PythonScript(Code=file_8)

# ---- group: INPUT GEO
geo = Geometry()

# ----
toggle = BooleanToggle(False)

# ---- group: FAR_35
geo_2 = Geometry([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])

# ----
volume = Volume(Geometry=geo_2)  # -> Volume, Centroid

# ---- group: override
plain_bibil = PythonScript(crv=geo, cut_num=Slider(0, range=0..10), cut_dim=Slider(0, range=0..10), label="override", run=Toggle(True))  # -> node, debug; inputs crv: list, cut_num: Int32, run: Boolean
# ---------- plain_bibil: Python ----------
"""
Created on Jun 19, 2016
author: Saeran Vasanthakumar
"""

import rhinoscriptsyntax as rs
import Rhino as rc
import scriptcontext as sc

"""import classes"""
Shape_3D = sc.sticky["Shape_3D"]
Pattern = sc.sticky["Pattern"]

def make_node_lst(block_in_,label_): 
    L = []
    P = Pattern()
    for lot_geom in block_in_:
        n_ = P.helper_geom2node(lot_geom,None,label=label_)
        L.append(n_)
    return L
def split_node_lst(node_lst_,cut_num_,cut_dim_,cut_flip_):
    P = Pattern()
    for lot_node in node_lst_:
        lot_node = P.pattern_divide(lot_node,"subdivide_depth",cut_num_,cut_width=cut_dim_)
        #lot_node.make_tree_3D("subdivide_depth_same",depth,axis=axis_,cut_width=street_dim)
        #lot_node.make_tree_3D("subdivide_dim",(18,18),axis=axis_,random_tol=0,cut_width=street_dim)
        yield lot_node.traverse_tree(lambda n:n,internal=False)
    
def main(lot_in_,label_,cut_num_,cut_dim_,cut_flip_):
    ### Grid_Subdivide: (listof node) int int -> (listof node))
    ### Purpose: This component consumes a list of node lots and two int and 
    ###generates a list of mutated nodes, with the lots subdivided according
    ###to the int int dimensions.     
    lst_node = make_node_lst(lot_in_,label_)
    split_nodes = split_node_lst(lst_node,cut_num_,cut_dim_,cut_flip_)
    split_nodes = reduce(lambda x,y: x+y,split_nodes)
    return split_nodes

if run and crv!=[None] and crv!=None:
    sc.sticky["debug"] = []
    debug = sc.sticky["debug"]
    if not label:
        label = ''
    if not cut_dim:
        cut_dim = 0.
    if not cut_num:
        cut_num = 0
    if not cut_flip:
        cut_flip = False
    node = main(crv,label,cut_num,cut_dim,cut_flip)
else:
    print 'Add inputs!'
# ---------- end plain_bibil ----------

# ----
python = PythonScript(x=volume.Volume)  # -> out, a; inputs x: list
# ---------- python: Python ----------
x = sum(x)
a = (x/float(3.))/1000.

a = str(round(a,2)) + 'k'
print a
# ---------- end python ----------
g = PythonScript(node=plain_bibil.node)  # -> geom
# ---------- g: Python ----------
if node:
    geom = []
    lot_lst = node.traverse_tree(lambda n:n,internal=False)
    for n in lot_lst:
        geom.append(n.data.shape.bottom_crv)
    print geom
# ---------- end g ----------
panel_4 = Panel(python.a)
