# Grasshopper definition bibil_trial_063.gh (Grasshopper 0.9.76)
# plug-ins: Python Interpreter, LunchBox

# TEST LOT
panel = Panel("tower_in_podium")
geo = Geometry(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)
geo_2 = Geometry([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])
geo_3 = Geometry(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)
geo_4 = Geometry(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)
geo_5 = Geometry([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])
geo_6 = Geometry([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])
# SMALL NORTH
refroot_2 = Curve(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)
parcel_2 = Curve(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)
# LARGE INTERIOR LOT
geo_7 = Geometry(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)

# ---- group: lot_2
geo_8 = Geometry(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)

# ---- group: setback
geo_9 = Geometry(geo_2)
geo_10 = Geometry(geo_2)
geo_11 = Geometry(geo_2)

# ---- group: lot_3
refroot_3 = Curve(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)

# ---- group: lot_1
refroot_3_2 = Curve(geo_3)

# ---- group: refblock
refroot_3_3 = Curve(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)

# ----
parcel_3 = Curve(geo_4)
geo_12 = Geometry([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])
# LARGE NORTH
refroot_3_4 = Curve(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)
parcel_3_2 = Curve(geo)
geo_13 = Geometry([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])
refroot_3_5 = Curve(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)
geo_14 = Geometry(geo_5)
setbacks = Geometry(geo_5)
refroot_2_2 = Curve(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)
parcel_2_2 = Curve(geo_7)
plots = Geometry(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)
refroot_2_3 = Curve(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)
number_slider = Slider(0, range=0..10)
number_slider_2 = Slider(0, range=0..100)
panel_2 = Panel("lot")
# ALONG
# EGLINTON
parcel_0 = Curve([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])
toggle = BooleanToggle(False)
parcel_1 = Curve([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])
number_slider_3 = Slider(0, range=0..10)
number_slider_4 = Slider(0, range=0..100)
number_slider_5 = Slider(0, range=0..10)
number_slider_6 = Slider(0, range=0..100)
number_slider_7 = Slider(0, range=0..10)
number_slider_8 = Slider(0, range=0..100)
number_slider_9 = Slider(0, range=0..10)
number_slider_10 = Slider(0, range=0..100)
parcel_0_2 = Curve(parcel_0)
geo_15 = Geometry([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])
geo_16 = Geometry([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])
parcel_1_2 = Curve(parcel_1)
refroot_0 = Curve(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)
toggle_2 = BooleanToggle(False)
refroot_1 = Curve(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)
toggle_3 = BooleanToggle(False)
toggle_4 = BooleanToggle(False)
toggle_5 = BooleanToggle(False)
number_slider_11 = Slider(0, range=0..10)
number_slider_12 = Slider(0, range=0..100)
number_slider_13 = Slider(0, range=0..10)
number_slider_14 = Slider(0, range=0..100)
toggle_6 = BooleanToggle(False)
toggle_7 = BooleanToggle(False)
panel_6 = Panel("C:\\saeran\\master\\git\\bibil\\src")
# BIBIL TRIAL
# Copyright (C) Saeran Vasanthakumar - All Rights Reserved
# Unauthorized copying of this file, via any medium is strictly prohibited
# Proprietary and confidential
# Written by Saeran Vasanthakumar <saeranv@gmail.com>, May 2016
# BIBIL_BIBIL
panel_7 = Panel("C:\\Users\\vasanthakumars\\Documents\\GitHub\\bibil\\src")
toggle_8 = BooleanToggle(True)
panel_8 = Panel(panel_7)
python_script = PythonScript(i=panel_8)  # -> o
# ---------- python_script: Python ----------
import os

o = os.path.join(str(i),"trinco\\trinco_block_component.py")
# ---------- end python_script ----------
file = ReadFile(File=python_script, PerLineParse=False)
python_script_2 = PythonScript(i=panel_8)  # -> o
# ---------- python_script_2: Python ----------
import os

o = os.path.join(str(i),"bibil\\bibil_tree.py")
# ---------- end python_script_2 ----------
# BIBIL_TRINCO
# Notes: Sets streetgrid via blocks, and building lot layouts.
file_2 = ReadFile(File=python_script_2, PerLineParse=False)
python_script_3 = PythonScript(i=panel_8)  # -> o
# ---------- python_script_3: Python ----------
import os

o = os.path.join(str(i),"bibil\\bibil_shape.py")
#o = os.path.join(str(i),"research\\bibil_shape_shape_3d_2d.py")
# ---------- end python_script_3 ----------
file_3 = ReadFile(File=python_script_3, PerLineParse=False)
python_script_4 = PythonScript(i=panel_8)  # -> o
# ---------- python_script_4: Python ----------
import os

o = os.path.join(str(i),"bibil\\bibil_rule.py")
# ---------- end python_script_4 ----------
file_4 = ReadFile(File=python_script_4, PerLineParse=False)
bibil = PythonScript(Code=file_2)
bibil_2 = PythonScript(Code=file_4)
bibil_3 = PythonScript(Code=file_3)

python_script_5 = PythonScript(i=panel_8)  # -> o
# ---------- python_script_5: Python ----------
import os

o = os.path.join(str(i),"miru\\miru_pattern_component.py")
# ---------- end python_script_5 ----------
file_5 = ReadFile(File=python_script_5, PerLineParse=False)

python_script_6 = PythonScript(i=panel_8)  # -> o
# ---------- python_script_6: Python ----------
import os

o = os.path.join(str(i),"koku\\koku_vector.py")
# ---------- end python_script_6 ----------
file_6 = ReadFile(File=python_script_6, PerLineParse=False)
python_script_7 = PythonScript(i=panel_8)  # -> o; same code as python_script_6
file_7 = ReadFile(File=python_script_7, PerLineParse=False)
python_script_8 = PythonScript(i=panel_8)  # -> o
# ---------- python_script_8: Python ----------
import os

o = os.path.join(str(i),"bibil\\bibil_pattern.py")
# ---------- end python_script_8 ----------
file_8 = ReadFile(File=python_script_8, PerLineParse=False)
bibil_4 = PythonScript(Code=file_6)
bibil_5 = PythonScript(Code=file_8)
bibil_6 = PythonScript(Code=file_7)
python_editor = PythonScript()
# ---------- python_editor: Python ----------
import rhinoscriptsyntax as rs
import ghpythonlib.components as ghcomp
import Rhino as rc
import scriptcontext as sc
import math
import random 

#print abs(-1)
#rc.Geometry.Vector3d.VectorAngle(anglea,angleb)

#print rc.Geometry.Plane.WorldXY
#rc.Geometry.Point3d(
#rc.Geometry.Plane(
#sc.doc.Objects.Add
L = [(3,1),(4,6),(78,2)]
V = sorted(L,key=lambda n: n[1],reverse=True)
#L.sort()#
#print L
#print V

#print 'envelope' in 'helloenvelope'

def foo(test):
    a = test*1
    b = test*2
    return a,b
 

print foo(5)


#sc.doc.Objects.AddCurve()
#rc.Geometry.Vector3d(x,y,z)
#ghcomp.Flip(surface,sc.sticky['surface_ref'])
#rs.ScaleObject(objectid,origin,scale)

#L = [1,2,3]
#ghcomp.DIVA.SolarFan(crv,lat,minhours,firstfrost,dist)
#rc.Geometry.Point3d(

#print random.randrange(1,10)

"""
crv = rs.coercecurve(y)
testpt = rs.coerce3dpoint(x)
val = crv.ClosestPoint(testpt)
print val

ghval = ghcomp.CurveClosestPoint(testpt,crv)
print ghval[2]
"""
# ---------- end python_editor ----------
python_script_9 = PythonScript(i=panel_8)  # -> o
# ---------- python_script_9: Python ----------
import os

o = os.path.join(str(i),"bibil\\bibil_plain.py")
# ---------- end python_script_9 ----------
file_9 = ReadFile(File=python_script_9, PerLineParse=False)

# ---- group: ANIMATE
toggle_9 = BooleanToggle(False)

# ---- group: EXCEL
toggle_10 = BooleanToggle(True)

# ----
toggle_11 = BooleanToggle(True)
geo_17 = Geometry(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)

# ---- group: SIMULATE
toggle_12 = BooleanToggle(False)

# ----
geo_18 = Geometry(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)
trinco_park = PythonScript(
    Code=file_9,
    Lot_in=geo_18,
    Depth=Slider(3, range=0..100),
    Street_dim=Slider(20, range=0..100),
    Label_="no sugar no additives!",
    Run=Toggle(False))  # -> Node_out, Debug
number_slider_15 = Slider(7, range=0..10)  # disabled
number_slider_16 = Slider(0, range=0..100)  # disabled
# BIBIL_BULA
# Notes:Remember to only plug in one refroot, or
# else you will get lots of dupllicates.
number_slider_17 = Slider(4, range=0..10)
pt = Point([Point(-545784.4028, 3982087.267, 0), Point(-545789.7348, 3982106.236, 0), Point(-545795.0667, 3982125.206, 0), Point(-545800.3987, 3982144.176, 0), Point(-545779.0708, 3982068.297, 0), Point(-545797.8895, 3982083.476, 0)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])
pt_2 = Point([Point(-545528.1544, 3982159.293, 0), Point(-545541.6412, 3982155.502, 0), Point(-545555.1279, 3982151.711, 0), Point(-545568.6147, 3982147.921, 0), Point(-545582.1014, 3982144.13, 0), Point(-545595.5882, 3982140.339, 0)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])
pt_3 = Point([Point(-545979.8034, 3981643.445, 0), Point(-545966.3167, 3981647.235, 0), Point(-545952.8299, 3981651.026, 0), Point(-545939.3432, 3981654.817, 0), Point(-545925.8564, 3981658.608, 0), Point(-545912.3697, 3981662.399, 0)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])
toggle_13 = BooleanToggle(False)  # disabled
toggle_14 = BooleanToggle(False)  # disabled
transit_dpt = Point(Point(-545356.282, 3981726.697, 0))
transit_dpt_2 = Point(Point(-546019.3338, 3981540.172, 0))
geo_19 = Geometry()  # disabled
g = PythonScript(node=trinco_park.Node_out)  # -> geom
# ---------- g: Python ----------
if node:
    geom = []
    lot_lst = node.traverse_tree(lambda n:n,internal=False)
    for n in lot_lst:
        geom.append(n.data.shape.geom)
    print geom
# ---------- end g ----------
x10 = PythonScript(x=number_slider_17)  # -> a
# ---------- x10: Python ----------
a = x/5.
# ---------- end x10 ----------
block_depth = PythonScript(lot_in=geo_19, depth=number_slider_15, street_dim=number_slider_16, flip_axis=toggle_13, run=toggle_14)  # -> geo_out, debug; inputs lot_in: list, depth: Int32, run: Boolean; disabled
# ---------- block_depth: Python ----------
import rhinoscriptsyntax as rs
import Rhino as rc
import scriptcontext as sc
import copy

"""import classes"""
Shape_3D = sc.sticky["Shape_3D"]
Fabric_Grammar = sc.sticky["Fabric_Grammar"]
Fabric_Tree = sc.sticky["Fabric_Tree"]


def make_node_lst(copy_lot_in_): 
    for lot_node in copy_lot_in_:
        if rs.IsCurve(lot_node):
            lot_curve = rs.CopyObject(lot_node)
            lot_curve = rs.coercecurve(lot_curve)
            lot_node = rs.AddPlanarSrf(lot_node)[0]
        lot_shape = Shape_3D(lot_node,None)
        if int(lot_shape.z_dist) == 0:
            lot_shape.op_extrude(6.)
        lot_grammar = Fabric_Grammar([],lot_shape,0)
        lot_grammar.label = "block"
        lot_node = Fabric_Tree(lot_grammar,parent=None,depth=0)
        
        yield lot_node
        

def split_node_lst(node_lst_):
    for lot_node in node_lst_:
        axis_,dist_,saxis_,sdist_ = lot_node.data.shape.get_long_short_axis()
        if flip_axis: axis_ = saxis_
        lot_node.make_tree_3D("subdivide_depth",depth,axis=axis_,cut_width=street_dim)
        #lot_node.make_tree_3D("subdivide_depth_same",depth,axis=axis_,cut_width=street_dim)
        #lot_node.make_tree_3D("subdivide_dim",(12,12),axis=axis_,random_tol=0,cut_width=street_dim)
        yield lot_node.traverse_tree(lambda n:n,internal=False)

def main(lot_in_):
    ### Grid_Subdivide: (listof node) int int -> (listof node))
    ### Purpose: This component consumes a list of node lots and two int and 
    ###generates a list of mutated nodes, with the lots subdivided according
    ###to the int int dimensions.     
    
    lst_node = make_node_lst(lot_in_)
    split_nodes = split_node_lst(lst_node)
    generator = reduce(lambda x,y: x+y, split_nodes)
    return generator


if run and lot_in!=[None]:
    #sc.sticky["debug"] = []
    #debug = sc.sticky["debug"]
    geo_out = main(lot_in)
else:
    print 'Add inputs!'
# ---------- end block_depth ----------
geo_20 = Geometry(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)
num = Number(1)
cir = Circle(Plane=transit_dpt_2, Radius=Slider(250, range=0..1000))
python_script_10 = PythonScript(i=panel_8)  # -> o
# ---------- python_script_10: Python ----------
import os

o = os.path.join(str(i),"bula\\bula_point.py")
# ---------- end python_script_10 ----------
file_10 = ReadFile(File=python_script_10, PerLineParse=False)
quick_ca_abm = PythonScript(pts=pt, dpt_major=transit_dpt_2, dpt_minor=transit_dpt, power=num, boundary=geo_20, iterate=x10)  # -> line, cpt, txt; inputs pts: list, dpt_major: Point3d, power: Int32, iterate: list
# ---------- quick_ca_abm: Python ----------
"""
Copyright (C) Saeran Vasanthakumar - All Rights Reserved
Unauthorized copying of this file, via any medium is strictly prohibited
Proprietary and confidential
Written by Saeran Vasanthakumar <saeranv@gmail.com>, May 2016
"""

import rhinoscriptsyntax as rs
import math

def normalize_list(lov,lobound,hibound):
    ### normalized_val = ( (val-min)*(hibound-lobound) )/(max-min) + lobound
    max_ = max(lov)
    min_ = min(lov)
    L = []
    for i,v in enumerate(lov):
        norm_val = ((hibound-lobound)*(v-min_))/(max_-min_) + lobound
        L.append(norm_val)
    return L
def get_distance(pts_,dpt_major,dpt_minor):
    YEL = []
    MPL = []#parallel list of which points is chosen
    for pt in pts_:
        dlst = []
        distmajor = rs.Distance(pt,dpt_major)
        distminor = rs.Distance(pt,dpt_minor)
        YEL.append(distmajor)
        MPL.append(distminor)
    return YEL,MPL
    
def get_uniformity(YL,ML,iterate_,power_):
    val_lst = [] 
    norm_dist_yonge = normalize_list(YL,0.,1.0)
    norm_dist_mount = normalize_list(ML,0.,3.0)
    #YL = normalize_list(YL,0.,20.)
    #ML = normalize_list(ML,0.,20.)
    for it in iterate_:
        #print 'iterate', it
        for i,dist in enumerate(zip(YL,ML)):
            y = dist[0]
            m = dist[1]
            divfact = 75.
            powfact = 1.1
            factor = factor =  math.pow(abs(y-m)/divfact,powfact)
            if y<m:
                try:
                    y = norm_dist_yonge[i]
                    z = y#25 * (1/math.pow(y,it))
                    z = 25 * (1/math.pow(y,it))
                except ZeroDivisionError:
                    z = 0.
            else:
                try:
                    m = norm_dist_mount[i]
                    #z = m#25 * (1/math.pow(m,it))
                    z = 25 * (1/math.pow(m,it))
                except ZeroDivisionError:
                    z = 0.
            z *= factor/6.
            #z += 0.
            """
            try:
                factor = 
                z = 25 * (1/math.pow(factor,it))
            except ZeroDivisionError:
                z = 0.
            """
            val_lst.append(z)
            #25 multiplier stretches it out
            ##old
            #z = 10./math.pow(float(d),float(it)/2.)
            # stretched out more when 10 outside
            #z = math.pow(10./float(d),float(it)/2.)
    return val_lst

def check_point_in_crv(crv,pt):
    rel = rs.PointInPlanarClosedCurve(pt,crv)
    if rel == 1: # inside curve
        return True
    else:
        return False
    
def make_line(zlst,ptlst):
    line_ = []
    for z,pt in zip(zlst,ptlst):
        rel = check_point_in_crv(boundary,pt)
       
        if rel == True:
            pt = rs.coerce3dpoint(pt)
            pt = rs.AddPoint(pt[0],pt[1],0)
            pt = rs.coerce3dpoint(pt)
            #if z < 0.001: z= 0.001
            toppt = rs.AddPoint(pt[0], pt[1], z)
            ln = rs.AddLine(pt,toppt)
            line_.append(rs.coerceline(ln))
    return line_
if True:
    
    YL,ML = get_distance(pts,dpt_major,dpt_minor)
    zdist = get_uniformity(YL,ML,iterate,power)
    line = make_line(zdist,pts)
# ---------- end quick_ca_abm ----------
g_2 = PythonScript(node=block_depth.geo_out)  # -> geom; inputs node: list; disabled
# ---------- g_2: Python ----------
if node and node!=[None]:
    geom = []
    
    for n in node:
        geom.append(n.data.shape.cpt)
        #geom.append(n.data.shape.bottom_crv)
    print geom
# ---------- end g_2 ----------
geo_21 = Geometry(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)
geo_22 = Geometry(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)
end = EndPoints(Curve=quick_ca_abm.line)  # -> Start, End
geo_23 = Geometry(end.Start)
geo_24 = Geometry(end.Start)
number_slider_18 = Slider(1.5, range=0..10)
python = PythonScript(x=end.Start, y=end.End)  # -> a
# ---------- python: Python ----------
import rhinoscriptsyntax as rs
import scriptcontext as sc

y = rs.coerce3dpoint(y)
radius = y[2]
if radius < 0.1:
    radius = 0.1
a = rs.AddCircle(x,radius/2.5)
# ---------- end python ----------
python_2 = PythonScript(pts=geo_24, brep=geo_22, run=Toggle(True))  # -> project; inputs pts: list
# ---------- python_2: Python ----------
import rhinoscriptsyntax as rs
import Rhino as rc
import scriptcontext as sc

if run:
    debug = []
    dir = rc.Geometry.Vector3d(0,0,1) 
    tol = sc.doc.ModelAbsoluteTolerance
    env = [rs.coercebrep(brep)]
    ptlst = map(lambda p: rs.coerce3dpoint(p),pts)
    
    projlst = rc.Geometry.Intersect.Intersection.ProjectPointsToBreps(env,ptlst,dir,tol)
    #print projlst
    #projlst = filter(lambda pt:abs(pt[2]-200.)>0.5,projlst)
    projlst = filter(lambda p: abs(p[2]-0)>1.,projlst)
    
    if projlst:
        debug.extend(projlst)
        #min_index = projlst.index(min(projlst,key=lambda p:p[2]))
        #min_pt = projlst[min_index]
        #envht = min_pt[2]
    project = debug
# ---------- end python_2 ----------
python_3 = PythonScript(pts=geo_23, brep=geo_21, run=Toggle(True))  # -> project; inputs pts: list; same code as python_2
geometry = Geometry(python_3)
geometry_2 = Geometry(python_2)
geo_25 = Geometry(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)
boundary = BoundarySurfaces(Edges=geo_25)
preview = CustomPreview(Geometry=boundary, Shader=ColourSwatch(SwatchColor=RGBA(255, 90, 255, 177)))

# ----
# BIBIL_MIRU
# Notes: For pydev integration, make sure to disable
# and enable solver while saving new changes.
# Keep Toggle off when you start while the Python
# modules load.
python_script_11 = PythonScript(i=panel_8)  # -> o; same code as python_script_5
file_11 = ReadFile(File=python_script_11, PerLineParse=False)

# ---- group: override
plain_bibil = PythonScript(
    crv=geo_25,
    cut_num=Slider(0, range=0..10),
    cut_dim=Slider(0, range=0..10),
    label="override_park_street",
    run=Toggle(True))  # -> node, debug; inputs crv: list, cut_num: Int32, run: Boolean
# ---------- plain_bibil: Python ----------
"""
Created on Jun 19, 2016
author: Saeran Vasanthakumar
"""

import rhinoscriptsyntax as rs
import Rhino as rc
import scriptcontext as sc

"""import classes"""
Shape_3D = sc.sticky["Shape_3D"]
Pattern = sc.sticky["Pattern"]

def make_node_lst(block_in_,label_): 
    L = []
    P = Pattern()
    for lot_geom in block_in_:
        n_ = P.helper_geom2node(lot_geom,None,label=label_)
        L.append(n_)
    return L
def split_node_lst(node_lst_,cut_num_,cut_dim_,cut_flip_):
    P = Pattern()
    for lot_node in node_lst_:
        lot_node = P.pattern_divide(lot_node,"subdivide_depth",cut_num_,cut_width=cut_dim_)
        #lot_node.make_tree_3D("subdivide_depth_same",depth,axis=axis_,cut_width=street_dim)
        #lot_node.make_tree_3D("subdivide_dim",(18,18),axis=axis_,random_tol=0,cut_width=street_dim)
        yield lot_node.traverse_tree(lambda n:n,internal=False)
    
def main(lot_in_,label_,cut_num_,cut_dim_,cut_flip_):
    ### Grid_Subdivide: (listof node) int int -> (listof node))
    ### Purpose: This component consumes a list of node lots and two int and 
    ###generates a list of mutated nodes, with the lots subdivided according
    ###to the int int dimensions.     
    lst_node = make_node_lst(lot_in_,label_)
    split_nodes = split_node_lst(lst_node,cut_num_,cut_dim_,cut_flip_)
    split_nodes = reduce(lambda x,y: x+y,split_nodes)
    return split_nodes

if run and crv!=[None] and crv!=None:
    sc.sticky["debug"] = []
    debug = sc.sticky["debug"]
    if not label:
        label = ''
    if not cut_dim:
        cut_dim = 0.
    if not cut_num:
        cut_num = 0
    if not cut_flip:
        cut_flip = False
    node = main(crv,label,cut_num,cut_dim,cut_flip)
else:
    print 'Add inputs!'
# ---------- end plain_bibil ----------

# ----
# MIRU PATTERN LIBRARY
data = Data(toggle_11)
block_depth_2 = PythonScript(
    Code=file,
    Ref_block_in=refroot_2,
    Lot_in=parcel_2,
    Depth=number_slider,
    Street_dim=number_slider_2,
    Setback_line=geo_6,
    Label_=panel,
    Flip_axis=toggle,
    Run=data)  # -> Geo_out, Debug
block_depth_3 = PythonScript(
    Code=file,
    Ref_block_in=refroot_3_4,
    Lot_in=parcel_3,
    Depth=number_slider_7,
    Street_dim=number_slider_8,
    Setback_line=geo_12,
    Label_=panel,
    Flip_axis=toggle_4,
    Run=data)  # -> Geo_out, Debug
block_depth_4 = PythonScript(
    Code=file,
    Ref_block_in=refroot_3_5,
    Lot_in=parcel_3_2,
    Depth=number_slider_9,
    Street_dim=number_slider_10,
    Setback_line=geo_13,
    Label_=panel,
    Flip_axis=toggle_5,
    Run=data)  # -> Geo_out, Debug
block_depth_5 = PythonScript(
    Code=file,
    Ref_block_in=refroot_3_3,
    Lot_in=refroot_3_2,
    Depth=Slider(0, range=0..10),
    Street_dim=Slider(0, range=0..100),
    Setback_line=geo_9,
    Label_=panel,
    Flip_axis=Toggle(False),
    Run=data)  # -> Geo_out, Debug
block_depth_6 = PythonScript(
    Code=file,
    Ref_block_in=refroot_3_3,
    Lot_in=geo_8,
    Depth=Slider(0, range=0..10),
    Street_dim=Slider(0, range=0..100),
    Setback_line=geo_10,
    Label_=panel,
    Flip_axis=Toggle(False),
    Run=data)  # -> Geo_out, Debug
block_depth_7 = PythonScript(
    Code=file,
    Ref_block_in=refroot_3_3,
    Lot_in=refroot_3,
    Depth=Slider(0, range=0..10),
    Street_dim=Slider(0, range=0..100),
    Setback_line=geo_11,
    Label_=panel,
    Flip_axis=Toggle(False),
    Run=data)  # -> Geo_out, Debug
block_depth_8 = PythonScript(
    Code=file,
    Ref_block_in=refroot_2_2,
    Lot_in=parcel_2_2,
    Depth=number_slider_3,
    Street_dim=number_slider_4,
    Setback_line=geo_14,
    Label_=panel,
    Flip_axis=toggle_2,
    Run=data)  # -> Geo_out, Debug
block_depth_9 = PythonScript(
    Code=file,
    Ref_block_in=refroot_2_3,
    Lot_in=plots,
    Depth=number_slider_5,
    Street_dim=number_slider_6,
    Setback_line=setbacks,
    Label_=panel,
    Flip_axis=toggle_3,
    Run=data)  # -> Geo_out, Debug
block_depth_10 = PythonScript(
    Code=file,
    Ref_block_in=refroot_0,
    Lot_in=parcel_0_2,
    Depth=number_slider_11,
    Street_dim=number_slider_12,
    Setback_line=geo_15,
    Label_=panel,
    Flip_axis=toggle_7,
    Run=data)  # -> Geo_out, Debug
block_depth_11 = PythonScript(
    Code=file,
    Ref_block_in=refroot_1,
    Lot_in=parcel_1_2,
    Depth=number_slider_13,
    Street_dim=number_slider_14,
    Setback_line=geo_16,
    Label_=panel,
    Flip_axis=toggle_6,
    Run=data)  # -> Geo_out, Debug
block_depth_12 = PythonScript(
    Code=file,
    Ref_block_in=refroot_2,
    Lot_in=parcel_2,
    Depth=number_slider,
    Street_dim=number_slider_2,
    Setback_line=geo_6,
    Label_="tower_in_park",
    Flip_axis=toggle,
    Run=data)  # -> Geo_out, Debug
block_depth_13 = PythonScript(
    Code=file,
    Ref_block_in=refroot_3_4,
    Lot_in=parcel_3,
    Depth=number_slider_7,
    Street_dim=number_slider_8,
    Setback_line=geo_12,
    Label_="tower_in_park",
    Flip_axis=toggle_4,
    Run=data)  # -> Geo_out, Debug
block_depth_14 = PythonScript(
    Code=file,
    Ref_block_in=refroot_3_5,
    Lot_in=parcel_3_2,
    Depth=number_slider_9,
    Street_dim=number_slider_10,
    Setback_line=geo_13,
    Label_="tower_in_park",
    Flip_axis=toggle_5,
    Run=data)  # -> Geo_out, Debug
block_depth_15 = PythonScript(
    Code=file,
    Ref_block_in=refroot_2_2,
    Lot_in=parcel_2_2,
    Depth=number_slider_3,
    Street_dim=number_slider_4,
    Setback_line=geo_14,
    Label_="tower_in_park",
    Flip_axis=toggle_2,
    Run=data)  # -> Geo_out, Debug
block_depth_16 = PythonScript(
    Code=file,
    Ref_block_in=refroot_2_3,
    Lot_in=plots,
    Depth=number_slider_5,
    Street_dim=number_slider_6,
    Setback_line=setbacks,
    Label_="tower_in_park",
    Flip_axis=toggle_3,
    Run=data)  # -> Geo_out, Debug
block_depth_17 = PythonScript(
    Code=file,
    Ref_block_in=refroot_0,
    Lot_in=parcel_0_2,
    Depth=number_slider_11,
    Street_dim=number_slider_12,
    Setback_line=geo_15,
    Label_="tower_in_park",
    Flip_axis=toggle_7,
    Run=data)  # -> Geo_out, Debug
block_depth_18 = PythonScript(
    Code=file,
    Ref_block_in=refroot_1,
    Lot_in=parcel_1_2,
    Depth=number_slider_13,
    Street_dim=number_slider_14,
    Setback_line=geo_16,
    Label_="tower_in_park",
    Flip_axis=toggle_6,
    Run=data)  # -> Geo_out, Debug
geo_26 = Geometry(block_depth_12.Debug)
geo_27 = Geometry(block_depth_2.Debug)
g_3 = PythonScript(node=block_depth_12.Geo_out)  # -> geom; same code as g
g_4 = PythonScript(node=block_depth_2.Geo_out)  # -> geom; same code as g
g_5 = PythonScript(node=block_depth_13.Geo_out)  # -> geom; same code as g
geo_28 = Geometry(block_depth_13.Debug)
g_6 = PythonScript(node=block_depth_3.Geo_out)  # -> geom; same code as g
geo_29 = Geometry(block_depth_3.Debug)
g_7 = PythonScript(node=block_depth_14.Geo_out)  # -> geom; same code as g
geo_30 = Geometry(block_depth_14.Debug)
g_8 = PythonScript(node=block_depth_4.Geo_out)  # -> geom; same code as g
geo_31 = Geometry(block_depth_4.Debug)
g_9 = PythonScript(node=block_depth_5.Geo_out)  # -> geom
# ---------- g_9: Python ----------
if node:
    geom = []
    lot_lst = node.traverse_tree(lambda n:n,internal=False)
    for n in lot_lst:
        geom.append(n.data.shape.bottom_crv)
    print geom
# ---------- end g_9 ----------
g_10 = PythonScript(node=block_depth_6.Geo_out)  # -> geom; same code as g_9
g_11 = PythonScript(node=block_depth_7.Geo_out)  # -> geom; same code as g_9
geo_32 = Geometry(block_depth_5.Debug)
geo_33 = Geometry(block_depth_6.Debug)
geo_34 = Geometry(block_depth_7.Debug)
g_12 = PythonScript(node=block_depth_8.Geo_out)  # -> geom; same code as g
geo_35 = Geometry(block_depth_8.Debug)
g_13 = PythonScript(node=block_depth_15.Geo_out)  # -> geom; same code as g
geo_36 = Geometry(block_depth_15.Debug)
g_14 = PythonScript(node=block_depth_11.Geo_out)  # -> geom; same code as g
g_15 = PythonScript(node=block_depth_10.Geo_out)  # -> geom; same code as g
geo_37 = Geometry(block_depth_9.Debug)
geo_38 = Geometry(block_depth_10.Debug)
geo_39 = Geometry(block_depth_11.Debug)
g_16 = PythonScript(node=block_depth_17.Geo_out)  # -> geom; same code as g
geo_40 = Geometry(block_depth_17.Debug)
g_17 = PythonScript(node=block_depth_18.Geo_out)  # -> geom; same code as g
geo_41 = Geometry(block_depth_18.Debug)
g_18 = PythonScript(node=block_depth_9.Geo_out)  # -> geom; same code as g
geo_42 = Geometry(block_depth_16.Debug)
g_19 = PythonScript(node=block_depth_16.Geo_out)  # -> geom; same code as g
g_20 = PythonScript(node=plain_bibil.node)  # -> geom; same code as g
python_script_12 = PythonScript(i=panel_8)  # -> o
# ---------- python_script_12: Python ----------
import os

o = os.path.join(str(i),"trinco\\trinco_pattern_library.py")
# ---------- end python_script_12 ----------
file_12 = ReadFile(File=python_script_12, PerLineParse=False)
number_slider_19 = Slider(1, range=0..10)
python_script_13 = PythonScript(i=panel_8)  # -> o
# ---------- python_script_13: Python ----------
import os

o = os.path.join(str(i),"miru\\miru_pattern_library.py")
# ---------- end python_script_13 ----------
file_13 = ReadFile(File=python_script_13, PerLineParse=False)
north = Slider(61.5, range=0..1000)
vec = VectorXYZ(XComponent=0, YComponent=0, ZComponent=north)  # -> Vector, Length
move = Move(Geometry=end.End, Motion=vec.Vector)  # -> Geometry, Transform
ln = Line(StartPoint=end.Start, EndPoint=move.Geometry)
geometry_3 = Geometry(move.Geometry)
yonge = Slider(211.5, range=0..1000)
mtpleasant = Slider(90, range=0..1000)
sb_acc = Slider(0, range=0..10)

# ---- group: Skyline
value_list = ValueList({"Transit topo": 0, "Solar topo": 1, "Angle topo": 2, "Intersection topo": 3}, selected="Transit topo")

# ---- group: Park Srf
number_slider_20 = Slider(0, range=0..4, expression="25+x*5")

# ---- group: TOWER SEPARATION
new_tower = Slider(20, range=20..30)

# ----
number_slider_21 = Slider(5, range=0..5)
sb_13_5 = Slider(3, range=3..9)
podium_ht = Slider(5, range=0..5, expression="16.5  + 3*x")

# ---- group: ga_loop
# INPUTS/OUTPUTS
python_4 = PythonScript()  # -> L, size
# ---------- python_4: Python ----------
#Get lists
podium = []
for p in range(6):
    podium.append(16.5  + 3*p)
seperation = []
for p in range(11):
    seperation.append(20+p)
stepback = [3,6,9]

L = []
for pod in podium:
    for sep in seperation:
        for ste in stepback:
            L.append([pod,sep,ste])
size = len(L)
# ---------- end python_4 ----------

# ----
python_5 = PythonScript(L=python_4.L, i=Slider(0, range=0..197))  # -> podium, seperation, stepback; inputs L: list, i: Int32
# ---------- python_5: Python ----------
if True:
    podium = L[i][0]
    seperation = L[i][1]
    stepback = L[i][2]
    print L[i]
# ---------- end python_5 ----------
data_2 = Data(python_5.seperation)
data_3 = Data(python_5.stepback)
bibil_7 = PythonScript(Code=file_12, Stepback=data_3, Stepback_acc=sb_acc, New_separation=data_2)
panel_9 = Panel(python_5.stepback)
panel_10 = Panel(python_5.podium)
panel_11 = Panel(python_5.seperation)

# ---- group: CLEAR
toggle_15 = BooleanToggle(False)

# ----
number_slider_22 = Slider(1.8, range=0..10)
boundaries = ColourSwatch(SwatchColor=RGB(255, 0, 0))
swatch = ColourSwatch(SwatchColor=RGB(0, 255, 221))
# VIZ
transit_circles = Geometry(python)
existing = Data(ColourSwatch(SwatchColor=RGBA(150, 255, 205, 209)))
tower = Data(ColourSwatch(SwatchColor=RGBA(42, 255, 149, 169)))
circles = Data(ColourSwatch(SwatchColor=RGBA(12, 181, 0, 240)))
preview_2 = CustomPreview(Geometry=python, Shader=ColourSwatch(SwatchColor=RGBA(87, 98, 42, 0)))
dots = DotDisplay(Point=python_3, Colour=ColourSwatch(SwatchColor=RGB(255, 212, 0)), Size=number_slider_22)
preview_3 = CustomPreview(Geometry=transit_circles, Shader=swatch)
dots_2 = DotDisplay(Point=move.Geometry, Colour=swatch, Size=number_slider_22)
dots_3 = DotDisplay(Point=python_2, Colour=ColourSwatch(SwatchColor=RGB(255, 0, 157)), Size=number_slider_22)
number_slider_23 = Slider(3, range=0..10)
swatch_2 = ColourSwatch(SwatchColor=RGB(255, 0, 102))
Z = UnitZ(Factor=1)
softsitereal = Geometry([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])
geo_43 = Geometry(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)
move_2 = Move(Geometry=geo_43, Motion=Z)  # -> Geometry, Transform

# ---- group: boundary
preview_4 = CustomPreview(Geometry=move_2.Geometry, Shader=ColourSwatch(SwatchColor=RGB(255, 0, 0)))

# ----
Z_2 = UnitZ(Factor=Slider(54, range=0..100))
pt_4 = Point(Point(-545461.1578, 3982110.298, 0))
Z_3 = UnitZ(Factor=north)
pt_5 = Point(Point(-545647.6286, 3982155.069, 0))
geo_44 = Geometry([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])
transit_dpt_3 = Point(Point(-546019.3338, 3981540.172, 0))
transit_dpt_4 = Point(Point(-545356.282, 3981726.697, 0))
park = Geometry(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)
move_3 = Move(Geometry=pt_4, Motion=Z_2)  # -> Geometry, Transform
geo_45 = Geometry(geo_44)
swatch_3 = ColourSwatch(SwatchColor=RGB(51, 255, 0))
move_4 = Move(Geometry=pt_5, Motion=Z_3)  # -> Geometry, Transform

geo_46 = Geometry([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])
geo_47 = Geometry([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])
geo_48 = Geometry([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])
geo_49 = Geometry(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)

geo_50 = Geometry()
data_4 = Data()  # disabled
Z_4 = UnitZ(Factor=Slider(4, range=0..10))
ln_2 = Line(StartPoint=pt_4, EndPoint=move_3.Geometry)
boundary_2 = BoundarySurfaces(Edges=geo_45)

# ---- group: softsites
preview_5 = CustomPreview(
    Geometry=boundary_2,
    Shader={ambient=RGB(0, 0, 0), diffuse=RGB(255, 105, 180), emission=RGB(76, 32, 54), shine=0.5, specular=RGB(255, 255, 255), transparency=0})

# ----
area = Area(Geometry=geo_45)  # -> Area, Centroid
ln_3 = Line(StartPoint=pt_5, EndPoint=move_4.Geometry)
Z_5 = UnitZ(Factor=Slider(0.1, range=0..0.1))
move_5 = Move(Geometry=geo_50, Motion=Z_4)  # -> Geometry, Transform
sum = PythonScript(x=area.Area)  # -> a; inputs x: list
# ---------- sum: Python ----------
a = 0.
for i in x:
    a += i
    
    
print a
# ---------- end sum ----------
Z_6 = UnitZ(Factor=mtpleasant)
Z_7 = UnitZ(Factor=yonge)

# ---- group: approved
preview_6 = CustomPreview(Geometry=[geo_47, geo_46], Shader=existing)

# ---- group: existing
preview_7 = CustomPreview(Geometry=[geo_48, geo_49], Shader=existing)

# ---- group: Park
preview_8 = CustomPreview(Geometry=move_5.Geometry, Shader=swatch_3)

# ----
move_6 = Move(Geometry=transit_dpt_4, Motion=Z_6)  # -> Geometry, Transform
move_7 = Move(Geometry=transit_dpt_3, Motion=Z_7)  # -> Geometry, Transform
ln_4 = Line(StartPoint=transit_dpt_3, EndPoint=move_7.Geometry)
ln_5 = Line(StartPoint=transit_dpt_4, EndPoint=move_6.Geometry)
# Existing
# context.
crs_for_offset = Geometry([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])
offset = Offset(Curve=crs_for_offset, Distance=data_2, Plane=PlaneXY(0, 0, 0), Corners=Slider(2, range=0..10))  # -> flatten(Curve)
bibil_8 = PythonScript(
    Code=file_13,
    Override_crvs=plain_bibil.node,
    Solar_srfs=geo_22,
    Angle_srf=geo_21,
    Override_sep=offset,
    Dpt_yonge=transit_dpt_2,
    Dpt_mount=transit_dpt,
    Max_yonge=yonge,
    Max_mount=mtpleasant,
    Max_north=north,
    Ht_podium=python_5.podium,
    Stepback=data_3,
    Stepback_acc=sb_acc,
    New_separation=data_2,
    Sky_topo=value_list,
    Run=toggle_11)
block_depth_19 = PythonScript(
    Code=file,
    Ref_block_in=refroot_3_3,
    Lot_in=refroot_3_2,
    Depth=Slider(0, range=0..10),
    Street_dim=Slider(0, range=0..100),
    Setback_line=geo_9,
    Label_="tower_in_park",
    Run=bibil_8)  # -> Geo_out, Debug
block_depth_20 = PythonScript(
    Code=file,
    Ref_block_in=refroot_3_3,
    Lot_in=geo_8,
    Depth=Slider(0, range=0..10),
    Street_dim=Slider(0, range=0..100),
    Setback_line=geo_10,
    Label_="tower_in_park",
    Run=bibil_8)  # -> Geo_out, Debug
block_depth_21 = PythonScript(
    Code=file,
    Ref_block_in=refroot_3_3,
    Lot_in=refroot_3,
    Depth=Slider(0, range=0..10),
    Street_dim=Slider(0, range=0..100),
    Setback_line=geo_11,
    Label_="tower_in_park",
    Run=bibil_8)  # -> Geo_out, Debug
g_21 = PythonScript(node=block_depth_19.Geo_out)  # -> geom; same code as g
g_22 = PythonScript(node=block_depth_20.Geo_out)  # -> geom; same code as g
g_23 = PythonScript(node=block_depth_21.Geo_out)  # -> geom; same code as g
geo_51 = Geometry(block_depth_19.Debug)
geo_52 = Geometry(block_depth_20.Debug)
geo_53 = Geometry(block_depth_21.Debug)

# ---- group: should be one bibil component
pattern = PythonScript(
    Code=file_5,
    Node_in_lst=[block_depth_5.Geo_out, block_depth_19.Geo_out, block_depth_3.Geo_out, block_depth_13.Geo_out, block_depth_18.Geo_out, block_depth_11.Geo_out, block_depth_10.Geo_out, block_depth_17.Geo_out, block_depth_8.Debug, block_depth_9.Geo_out, block_depth_16.Geo_out, block_depth_2.Geo_out, block_depth_12.Geo_out, block_depth_15.Geo_out, block_depth_8.Geo_out, block_depth_20.Geo_out, block_depth_21.Geo_out, block_depth_6.Geo_out, block_depth_7.Geo_out, block_depth_14.Geo_out, block_depth_4.Geo_out],
    Bibil="trinco",
    Run=Toggle(True))  # -> Geo_out_lst, Debug

# ----
b = PythonScript(node=pattern.Geo_out_lst)  # -> geomlst; inputs node: list
# ---------- b: Python ----------
if node and node!=[None]:
    geomlst = []
    for node_ in node:
        lon = node_.traverse_tree(lambda n:n,internal=False) 
        lon = filter(lambda n: n!=None,lon)
        glst = map(lambda n: n.data.shape.geom,lon)
        geomlst.extend(glst)
    print geomlst
# ---------- end b ----------
preview_9 = CustomPreview(Geometry=b, Shader=ColourSwatch(SwatchColor=RGBA(0, 255, 137, 148)))
geo_54 = Geometry(pattern.Debug)
cc = PythonScript(x=pattern.Geo_out_lst)  # -> a; inputs x: tree
# ---------- cc: Python ----------
def concatenate_tree(tree):
    L = []
    for branch in tree.Branches:
        L.append(list(branch))
    return L

if True:
    
    l = reduce(lambda x,y: x+y, concatenate_tree(x))
    a = filter(lambda g: g != None, l)
# ---------- end cc ----------
bula = PythonScript(Code=file_10, Lstx=ln, Oldlots=flatten(cc))  # -> Lst_lots, Line, Debug
geo_55 = Geometry(bula.Debug)
g_24 = PythonScript(node=flatten(bula.Lst_lots))  # -> geom; inputs node: list
# ---------- g_24: Python ----------
if node and node!=[None]:
    geom = []
    #lot_lst = node.traverse_tree(lambda n:n,internal=False)
    #node = node[0]
    for n in node:
        geom.append(n.data.shape.geom)
        #print n.data.density.GFA
    print len(geom)
# ---------- end g_24 ----------
preview_10 = CustomPreview(Geometry=bula.Line, Shader=ColourSwatch(SwatchColor=RGB(0, 255, 238)))
cc_2 = PythonScript(x=bula.Lst_lots)  # -> a; inputs x: tree
# ---------- cc_2: Python ----------
a = x
# ---------- end cc_2 ----------
pattern_2 = PythonScript(Code=file_11, Node_in_lst=cc_2, Bibil="miru", Run=Toggle(True))  # -> Geo_out_lst, Debug

toggle_16 = BooleanToggle(False)  # disabled
toggle_17 = BooleanToggle(False)  # disabled
cut_floors = PythonScript(node_in_lst=pattern_2.Geo_out_lst, run=toggle_16)  # -> node_out_lst, debug; inputs node_in_lst: list, run: Boolean; disabled
# ---------- cut_floors: Python ----------
import rhinoscriptsyntax as rs
import Rhino as rc
import math
import random
import scriptcontext as sc
import ghpythonlib.components as ghcomp
import ghpythonlib
import Grasshopper.Kernel as gh
import copy

"""import classes"""
Shape_2D = sc.sticky["Shape_2D"]
Shape_3D = sc.sticky["Shape_3D"]
Tree = sc.sticky["Tree"]
Grammar = sc.sticky["Grammar"]
Fabric_Tree = sc.sticky["Fabric_Tree"] 
Fabric_Grammar = sc.sticky["Fabric_Grammar"]
Pattern = sc.sticky["Pattern"]

def split_helper(gb,cplane,ht,netht,srf_,log): 
    if netht - ht < 2.:
        #print 'finish', ht, 'netht: ', netht 
        log.append(gb)
        return log ###
    else:
        base,top = None, None
        shape = None
        try:
            shape = Shape_3D(gb,cplane)
            shape.convert_rc('3d')
        except: 
            pass
        try:
            base, top = pattern.split_brep_zaxis(shape,ht,splitsrf=srf_,geom=gb,cplane=cplane)
        except: print 'fail at', ht
        #print 'log: ', len(log), 'ht: ', ht, 'netht: ', netht
        #print 'geoms', base, top
        #print '  '
        if base:
            log.append(base)
            return split_helper(top,cplane,ht+FLOOR_HT,netht,srf_,log) ###
        else: 
            print 'fail'
            return log ###
#print node_in

node_out = []
if run and node_in_lst and node_in_lst!=[None]:
    debug = sc.sticky['debug']
    pattern = Pattern()
    PODIUM_HT = 6.
    FLOOR_HT = 3.

    #print 'BATCH CHECK'
    #for i,n in enumerate(node_in_lst):
    #    print i
    #    print n
    
    node_out_lst = []
    for node_in in node_in_lst:
        L = []
        
        for i, lot_node in enumerate(node_in):
            print 'buildnum:', i, "label:", lot_node.data.label
            if True:#try:
                for subn in lot_node.loc:
                    geom_ = subn.data.shape.geom
                    flst = []
                    log_ = []
                    podium = geom_
                    cplane = subn.data.shape.cplane
                    shape = Shape_3D(geom_,cplane)
                    
                    srf = rs.AddPlanarSrf([rs.CopyObject(shape.bottom_crv)])[0]
                    netht = shape.ht #- 6
                    if shape.ht > PODIUM_HT:
                        podium, buildbrep = pattern.split_brep_zaxis(shape,PODIUM_HT,splitsrf=srf,geom=None,cplane=None)
                        if (shape.ht > (PODIUM_HT + FLOOR_HT)):
                            log_ = split_helper(buildbrep,shape.cplane,PODIUM_HT+FLOOR_HT,netht,srf,[])
                        else:
                            log_ = [buildbrep]
                    flst.append(podium)
                    flst.extend(log_)
                    flst = map(lambda g: rs.coercegeometry(g), flst)
                    flst_ = []
                    for i,f in enumerate(flst):
                        #debug.append(f)
                        area = rs.Area(sc.doc.Objects.AddBrep(f))
                        print area
                        if True:#area >= 40:
                            try:
                                fshape = Shape_3D(f,shape.cplane)
                            except:
                                fshape = Shape_3D(f,shape.cplane,reset=False)
                                fshape.bottom_crv = None
                                fshape.top_crv = None
                                fshape.cpt = None
                                fshape.ht = None
                                fshape.top_cpt = None
                                fshape.z_dist = None 
        
                            fgrammar = Fabric_Grammar([],fshape,0)
                            fgrammar.label = "floor"
                            fnode = Fabric_Tree(fgrammar,parent=subn,depth=subn.depth+1)
                        flst_.append(fnode)
                    subn.loc = flst_
            #except:
            #    print 'fail'
            rc.RhinoApp.Wait()
        """
        # find max floor levels
        max_floor = max(map(lambda lst: len(lst), L))
        lolof = [None] * max_floor
        # go through each floor level of empty list
        for i,level_lst in enumerate(lolof):
            level_geoms = []
            for bldsect in L:
                if len(bldsect)-1 >= i:
                    level_geoms.append(bldsect[i])
            lolof[i] = level_geoms
        """
        #for node in node_in:
        #    node.get_root().traverse_tree(lambda n: n.data.shape.convert_rc('3d'))
        if node_in:
            print ' '
            print 'num of lots:', len(node_in[0].loc)
            print 'num of subbuild:', len(node_in[0].loc)
            print 'num of floors:', len(node_in[0].loc[0].loc)
            print 'anything beyond:', len(node_in[0].loc[0].loc[0].loc)
            map(lambda n: n.get_root().traverse_tree(lambda n: n.data.shape.convert_rc('3d')), node_in)
            node_out = node_in
        node_out_lst.append(node_out)
    
    #print '\nBATCH CHECK'
    #for i,n in enumerate(node_out_lst):
    #    print i
    #    print n
# ---------- end cut_floors ----------
far = PythonScript(node_in_lst=cut_floors.node_out_lst, run=toggle_17)  # -> node_out_lst, g_lst, floor_area_lst, debug; inputs node_in_lst: list, run: Boolean; disabled
# ---------- far: Python ----------
import rhinoscriptsyntax as rs
import Rhino as rc
import math
import random
import scriptcontext as sc
import ghpythonlib.components as ghcomp
import ghpythonlib
import Grasshopper.Kernel as gh
import copy

"""import classes"""
Shape_2D = sc.sticky["Shape_2D"]
Shape_3D = sc.sticky["Shape_3D"]
Tree = sc.sticky["Tree"]
Grammar = sc.sticky["Grammar"]
Fabric_Tree = sc.sticky["Fabric_Tree"] 
Fabric_Grammar = sc.sticky["Fabric_Grammar"]
Pattern = sc.sticky["Pattern"]

def get_label(n):
    if n.data.label == 'lot':
        return n
    elif n.parent:
        return get_label(n.parent)
    else:
        return None

if node_in_lst and run and node_in_lst!=[None]:
    sc.sticky['debug'] = []
    debug = sc.sticky['debug']
    floor_area_lst = []
    node_out_lst = [] 
    g_lst = []
    
    far_lst = []
    type_lst = [] #listof (geoms-by-type)
    
    ## Loop through all batches
    for batchindex,node_in in enumerate(node_in_lst):
    
        b,g = [],[]
        floor_area = 0.
        node_out = []
        
        ## Loop through all nodes and calculate reference GFA
        ref_total_GFA = 0.
        for n in node_in:
            ref_total_GFA += n.data.density.GFA
        block_area = node_in[0].get_root().data.shape.get_area()
        # additional_GFA: GFA that is added onto next build if previous build didn't
        # meet GFA requirements. This ensures you don't lose density.
        additional_GFA = 0.
            
        # Loop through all nodes
        for buildindex,lot_node in enumerate(node_in):
            print 'BUILDINDEX', buildindex
            #root_ = lot_node.get_root().traverse_tree(lambda n: n.get_label('lot'),internal=True)[0]
            #root_.data.hi = 0

            GFA_achieved = False
            GFA = additional_GFA
            ref_GFA = lot_node.data.density.GFA
            reflotarea = lot_node.data.density.lot_area
            
            
            """ Make this into functions as some point. Too messy."""
            
            ## Traverse lotnode and make list of all subbuilds
            ## Subbuilds are subdivs w/i one lot
            losb = lot_node.traverse_tree(lambda n__:n__.get_label("subbuild"),internal=True)
            losb = filter(lambda sb: sb!=None,losb)
            #print 'num of subbuild: ', len(losb)
            
            ## Loop through all subbuilds, traverse each subbuilds to make listof floors
            ## append listof floors to make: listof (listof floors)
            lolof = [] # list of (list of floors (by subbuild)) 
            for sb_node in losb:
                ## Loop throug subbuild, add by level to lolof
                lof = sb_node.traverse_tree(lambda n__:n__.get_label("floor"),internal=True)
                lof = filter(lambda sb: sb!=None,lof)
                lolof.append(lof)
            
            
            ## To understand what lolof is, play around with this.
            #if buildindex == 6:
                #debug.append(lolof[0][2].data.shape.geom)
                #debug.extend(map(lambda n: n.data.shape.geom,lolof[0]))
            
            ## Make a empty list of lists, corresponding to max floor numbers in lot
            # lolof: listof listof floors, by subbuild
            max_lvl = max(map(lambda lst: len(lst), lolof))
            lvl_lst = [None] * max_lvl #lst of floors (by building)
            
            ## Loop through each empty list and insert the appropriate floor from the lolof
            for fi in range(max_lvl):
                #print 'floor index', fi
                lvl_lst[fi] = []
                for si, lof in enumerate(lolof):
                    #si = subbuild index
                    #lof = list of floors 
                    #print 'fi:', fi, 'lenof floors:', len(lolof[si])
                    try:
                        #print len(lvl_lst[fi])
                        lvl_lst[fi].append(lolof[si][fi])
                    except:
                        # list index does not exist
                        pass

            ## Loop through all floors, in each building and sum up floor area into lvl areas
            for fi,fs in enumerate(lvl_lst):
                # fs = list of all floorsection nodes
                #print 'floor level: ',  fi
                #print 'has FAR achieved', far_achieved
                levelarea = 0
                if not GFA_achieved:
                    if True:#not 'type_tower' in type:
                        for fsi, f in enumerate(fs):
                            lot_node = get_label(f)
                            type = lot_node.data.type['type_id']
                            f.data.type = lot_node.data.type
                            #lvl_lst[fi][fsi].data.shape.convert_guid('3d')
                            #print 'geom', lvl_lst[fi][fsi].data.shape.geom
                            try:
                                area = lvl_lst[fi][fsi].data.shape.get_area()
                            except:
                                print 'fail to compute'
                                try:
                                    if fi > 0:
                                        area = lvl_lst[fi-1][fsi].data.shape.get_area()
                                    else: 
                                        area = 0
                                except:
                                    area = 0
                            levelarea += area
                    else:
                        for fsi, f in enumerate(fs):
                            f.data.type = lot_node.data.type
                
                    ## Sort the appropriate nodes into the floor list
                    ## and geom list
                    if fi == 0:
                        g.extend(fs)
                        floor_area = levelarea
                    else:
                        b.extend(fs)
                    
                    ## levelarea: area of one level in lot
                    ## GFA: summed area of all levels so far
                    
                    GFA += levelarea
                    floor_area_lst.append(levelarea)
                    rc.RhinoApp.Wait()
                    
                    print 'buildindex', buildindex, 'floor index: ', fi, '/', len(lvl_lst)-1
                    print 'GFA/ref_GFA: ', round(GFA,2), '/', ref_GFA
                    print 'ref_GFA - GFA: ', round(ref_GFA - GFA,2)
                    
                    ## Check to see if GFA is within ref_GFA or at final level
                    if GFA >= ref_GFA or abs(GFA-ref_GFA) <= (reflotarea*.5) or fi==(len(lvl_lst)-1):
                        GFA_achieved = True
                        if (ref_GFA - GFA) > 0.:
                            additional_GFA = ref_GFA-GFA
                        else:
                            additional_GFA = 0.
                        print 'GFA achieved!'
                        """
                        for fs_ in fs:
                            fs_.data.label += "last"
                            fs_.data.GFA = levelarea
                            if True:
                                fs_.data.actual_FAR = FAR
                            fs_.data.floor_index = fi
                        """
                        #far_lst_.append(FAR)
                    print '---'
            
        node_out = b
        node_out_lst.append(node_out)
        g_lst.append(g) 
        #floor_area_lst.extend(floor_area_lst_)
        
    #print '/nBATCH CHECK'
    #for i,n in enumerate(node_out_lst):
        #print '\nindex', i
        #print n
        #print g_lst[i]
        #print floor_area_lst[i]
        #print far_lst[i]
        #print floor_area_lst[i]
# ---------- end far ----------
area_2 = Area()  # -> Area, Centroid; disabled
sum_2 = PythonScript(x=area_2.Area)  # -> a; inputs x: list; disabled; same code as sum
b_2 = PythonScript(node=cut_floors.node_out_lst)  # -> geomlst; inputs node: list; disabled
# ---------- b_2: Python ----------
import scriptcontext as sc

"""import classes"""
Shape_2D = sc.sticky["Shape_2D"]
Shape_3D = sc.sticky["Shape_3D"]
Tree = sc.sticky["Tree"]
Grammar = sc.sticky["Grammar"]

if node and node!=[None]:
    geomlst = []
    for node_ in node:
        geom = []
        for n in node_:
            lon = n.traverse_tree(lambda n:n.get_label("floor"),internal=True)
            lon = filter(lambda n: n!= None, lon)
            geom.extend(map(lambda n: n.data.shape.geom, lon))
        geomlst.append(geom)
     
    #for i,g in enumerate(geomlst):
    #    print i
    #    print g
# ---------- end b_2 ----------
b_3 = PythonScript(node=far.node_out_lst)  # -> geomlst; inputs node: list; disabled
# ---------- b_3: Python ----------
import scriptcontext as sc

"""import classes"""
Shape_2D = sc.sticky["Shape_2D"]
Shape_3D = sc.sticky["Shape_3D"]
Tree = sc.sticky["Tree"]
Grammar = sc.sticky["Grammar"]

if node and node!=[None]:
    geomlst = []
    for node_ in node:
        geom = []
        for n in node_:
            geom.append(n.data.shape.geom)
        geomlst.append(geom)
     
    for i,g in enumerate(geomlst):
        print i
        print g
# ---------- end b_3 ----------
b_4 = PythonScript(node=far.g_lst)  # -> geomlst; inputs node: list; disabled
# ---------- b_4: Python ----------
import scriptcontext as sc

"""import classes"""
Shape_2D = sc.sticky["Shape_2D"]
Shape_3D = sc.sticky["Shape_3D"]
Tree = sc.sticky["Tree"]
Grammar = sc.sticky["Grammar"]

if node and node!=[None]:
    geomlst = []
    for i,n in enumerate(node):
        print i
        geom = []
        for n_ in n:
            geom.append(n_.data.shape.geom)
        geomlst.append(geom)
# ---------- end b_4 ----------
cc_3 = PythonScript(x=b_2)  # -> a; inputs x: list; disabled
# ---------- cc_3: Python ----------
def concatenate_tree(tree):
    L = []
    for branch in tree.Branches:
        L.append(list(branch))
    return L

if x and x!=[None]:
    #x = [x[1]]
    l = reduce(lambda i,j: i+j, x)
    a = filter(lambda g: g != None, l)
# ---------- end cc_3 ----------
cc_4 = PythonScript(x=b_3)  # -> a; inputs x: list; disabled
# ---------- cc_4: Python ----------
def concatenate_tree(tree):
    L = []
    for branch in tree.Branches:
        L.append(list(branch))
    return L

if x and x!=[None]:
    l = reduce(lambda i,j: i+j, x)
    a = filter(lambda g: g != None, l)
    print len(a)
    splitindex = int(len(a)/2)
    #
# ---------- end cc_4 ----------
cc_5 = PythonScript(x=flatten(b_4))  # -> a; inputs x: list; disabled
# ---------- cc_5: Python ----------
def concatenate_tree(tree):
    L = []
    for branch in tree.Branches:
        L.append(list(branch))
    return L

if x and x!=[None]:
    l = reduce(lambda i,j: i+j, x)
    a = filter(lambda g: g != None, l)
# ---------- end cc_5 ----------

# ---- group: ACTUAL_FAR
area_3 = Area()  # -> Area, Centroid; disabled
division = Division(A=sum_2, B=area_3.Area)  # disabled

# ----
b_5 = PythonScript(node=pattern_2.Geo_out_lst)  # -> flatten(geomlst); inputs node: list
# ---------- b_5: Python ----------
import scriptcontext as sc
Pattern = sc.sticky['Pattern']
P = Pattern()

if node and node!=[None]:
    geomlst = []
    for node_ in node:
        if node_:
            lon = node_.traverse_tree(lambda n: P.print_node(n)) 
            lon = filter(lambda n: n!=None,lon)
            glst = map(lambda n: n.data.shape.geom,lon)
            geomlst.extend(glst)
    print geomlst
# ---------- end b_5 ----------
g_25 = PythonScript(node=pattern_2.Geo_out_lst)  # -> geom; disabled; same code as g
geo_56 = Geometry(pattern_2.Debug)
preview_11 = CustomPreview(Geometry=b_5, Shader=ColourSwatch(SwatchColor=RGBA(0, 255, 137, 148)))
geo_57 = Geometry([cc_4, cc_5])  # disabled

number_slider_24 = Slider(1, range=0..10)  # disabled
number_slider_25 = Slider(0, range=0..100)  # disabled
# BIBIL_KAYTS
toggle_18 = BooleanToggle(True)  # disabled
toggle_19 = BooleanToggle(True)  # disabled
toggle_20 = BooleanToggle(True)  # disabled
toggle_21 = BooleanToggle(False)  # disabled
toggle_22 = BooleanToggle(False)  # disabled
toggle_23 = BooleanToggle(False)  # disabled
toggle_24 = BooleanToggle(True)  # disabled
bibil_9 = PythonScript(run=toggle_18)  # -> o; inputs run: Boolean; disabled
# ---------- bibil_9: Python ----------
import rhinoscriptsyntax as rs
import Rhino as rc
import math
import random
import scriptcontext as sc
import ghpythonlib.components as ghcomp
import ghpythonlib
import Grasshopper.Kernel as gh
import copy

"""import classes"""
Shape_2D = sc.sticky["Shape_2D"]
Shape_3D = sc.sticky["Shape_3D"]
Tree = sc.sticky["Tree"]
Grammar = sc.sticky["Grammar"]
Fabric_Tree = sc.sticky["Fabric_Tree"] 
Fabric_Grammar = sc.sticky["Fabric_Grammar"] 



class Facade:
    def __init__(self):
        self.low = []
        self.loe = []

    def get_facade(self,n):
        loe,low=[],[] #list of envelope/windows
        try:
            n.data.shape.construct_faces()
            lof = n.data.shape.face_lst
        except: pass
        
        # no windows
        
        """
        if lof:
            facade_ht = n.data.shape.z_dist
            print facade_ht
            for face_shape in lof:
                face_grammar = Facade_Grammar([],face_shape,0,facade_ht)
                face_root = Facade_Tree(face_grammar)
                face_root.make_tree_2D()
                lol = face_root.traverse_tree(lambda n: n.data.label,internal=False)
                leaves = face_root.traverse_tree(lambda n: n.data.shape.geom,internal=False)
                for label,leaf in zip(lol,leaves):
                    #print label, leaf
                    if label == "envelope":
                        loe.append(leaf)
                    elif label == "window":
                        low.append(leaf)
        """
        #loew = [loe,low]
        return lof#loew
    def get_floor(self,n):
        # no need to turn into grammars at this stage
        return n.data.shape.face_bottom
    def get_ceiling(self,n):
        return n.data.shape.face_top

class Facade_Grammar(Grammar):
    """Facade Shape Grammar"""
    PANEL_X_DIST = 3.#1.2# param = G panel of material, stud spacing 0.4
    WINDOW_Y_DIST = 3.
    WINDOW_X_DIST = 2.8
    def __init__(self,rule,shape,deg,facade_ht,axis="EW",ratio=None):
        Grammar.__init__(self,rule,shape,deg,axis,ratio)
        self.facade_ht = facade_ht
    def make_label(self,pg):
        """make_label: self -> None"""
        """ Cn+1 = (Cn - t(g(A))) + t(g(B))))"""
        ## pg = parent Grammar
        ss = self.shape
        PY = self.facade_ht
        PX = self.PANEL_X_DIST
        WY = self.WINDOW_Y_DIST
        WX = self.WINDOW_X_DIST
        
        def eq(a,b,tol=0.1):
            return abs(a-b) <= 0.3
        # if panels not constructed subdivide along NS axis
        if pg and (pg.label == "window" or pg.label == "envelope"):
            label = None
        #elif ss.x_dist > PX:
        #    label = "panel"
        else:
            # if total panel, subdivide
            if eq(ss.y_dist,PY):
                label = "subpanel"+str(0.3)#6/float(ss.y_dist*10))
            elif pg and pg.label[:8] == "subpanel" and (PY/2.)<ss.y_dist<PY:
                window_ht = str(0.5)
                label = "window_subpanel"+window_ht
            elif pg and pg.label[:15] == "window_subpanel":
                label = "window"
            else:
                label = "envelope"
        self.label = label
        
    def make_grammar(self,label):
        """ make_grammar: self -> None """
        ## subpanel is a empty wall panel
        ##      - divide to determine bottom of window
        ## subpanel_window is the larger vertically subdivide panel
        ##      - divide to determine window and header
        if label == "window" or "envelope":
            axis,ratio,degree = "NS",0,0
        if "window_subpanel" in label:
            dim = float(label[15:])
            dim = 1.-round(dim,1)
            axis,ratio,degree = "EW",dim,0
        elif "subpanel" in label:
            dim = float(label[8:])
            axis,ratio,degree = "EW",dim,0
        elif "panel" in label:
            axis,ratio,degree = "NS",0.5,0
        
        cut_width = 0
        self.axis = axis
        self.ratio = ratio
        self.degree = degree
        child_rule = []
        self.rule += [["split",self.axis,self.ratio,self.degree,cut_width,child_rule]]

class Facade_Tree(Tree):
    """Facade Tree"""
    def __init__(self,data,loc=None,parent=None,sib=None,depth=0):
        Tree.__init__(self,data,loc,parent,sib,depth)
    def make_tree_2D(self):
        if self.depth >=100:
            self.data.label = "deleted"
            self.delete_node()
        else:
            if self.parent: pg = self.parent.data  
            else: pg = None
            self.data.make_label(pg)
            #print self.data.label
            if not self.data.label:
                self.delete_node()
            else:
                #print self.data.label
                self.data.make_grammar(self.data.label)
                loc,locr = self.data.make_shape(self.data.rule)
                facade_ht = self.data.facade_ht
                for i,child in enumerate(loc):
                    child_shape = Shape_2D(child,self.data.shape.cplane) 
                    child_grammar = Facade_Grammar(locr[i],child_shape,0,facade_ht)
                    child_node = Facade_Tree(child_grammar,parent=self,depth=self.depth+1)
                    self.loc.append(child_node)
                for i,c in enumerate(self.loc):
                    #try:
                    self.loc[i].make_tree_2D()
                    #except:
                        #self.data.label = "window"
                    #    self.loc.pop(i)
                        
TOL = sc.doc.ModelAbsoluteTolerance
if run:
    sc.sticky["Facade"] = Facade
    sc.sticky["Facade_Grammar"] = Facade_Grammar
    sc.sticky["Facade_Tree"] = Facade_Tree
# ---------- end bibil_9 ----------
bibil_10 = PythonScript(run=toggle_19)  # -> o; inputs run: Boolean; disabled
# ---------- bibil_10: Python ----------
import rhinoscriptsyntax as rs
import Rhino as rc
import math
import random
import scriptcontext as sc
import sys
import copy
#import ghpythonlib.components as ghcomp
import Grasshopper as gh

"""import classes"""
Shape = sc.sticky["Shape"]
Shape_3D = sc.sticky["Shape_3D"]
Shape_2D = sc.sticky["Shape_2D"]
Grammar = sc.sticky["Grammar"]
Tree = sc.sticky["Tree"]
#Fabric_Tree = sc.sticky["Fabric_Tree"] 
#Fabric_Grammar = sc.sticky["Fabric_Grammar"]

class City:
    """
    City: aggregation of Bldg objects.
    """    
    def __init__(self):
        self.build_lst = []
        self.tower = []
        

        
class Build:
    """
    Build: aggregation of "midrise" or 
    "hirise" nodes.
    Each build is the root node of a building.
    """
    def __init__(self,node):
        self.node = node
        self.mass_geom = None
        self.build_geom = None # by floor
        self.lot_node = node.data.lot_node
        self.reset()
    def reset(self):
        def foo_ht(n):
            return n.data.shape.ht
        def foo_geom(n):
            n.data.shape.convert_rc('3d')
            if n.data.label == "street":
                return ("street", n)#.data.shape.geom)
            elif n.data.label == "midrise":
                return ("midrise", n)#.data.shape.geom)
            elif n.data.label == "tower":
                return ("tower", n)#.data.shape.geom)
            else:
                print "label @ line 135", n.data.label
        debug = sc.sticky["debug"]
        self.node.traverse_tree(lambda n: n.data.shape.reset())
        self.build_ht = self.node.traverse_tree(foo_ht)[-1]
        self.build_geom = self.node.traverse_tree(foo_geom)
        if self.build_ht > 21.: self.label = "tower"
        elif self.build_ht > 9.: self.label = "midrise"
        else: self.label = "street"
        #label_lst = self.node.traverse_tree(lambda n:n.data.label)
        #label_lst = filter(lambda l: l != None, label_lst)
        #lot = filter(lambda label: label=="tower",label_lst)
        #self.label = label_lst[-1]
    def get_build_geom(self):
        bldg = []
        try:self.reset()
        except:pass
        #self.node.traverse_tree(lambda n: n.data.shape.convert_rc('3d'))
        self.build_geom = filter(lambda x: x!=None,self.build_geom)
        for log in self.build_geom:
            label = log[0]
            floornode_ = log[1]
            #g = rs.coercegeometry(g)
            bldg.append(floornode_)
        self.build_geom = bldg
        
        
class Building_Grammar(Grammar):
    """ Building Shape Grammar"""
    def __init__(self,rule,shape,max_ht,deg,lot_node,axis="EW",ratio=None):
        self.max_ht = max_ht
        self.lot_node = lot_node
        Grammar.__init__(self,rule,shape,deg,"EW",ratio)
    def make_label(self,parent_label):
        """
        context_grammar: Shape -> string
        This function consumes a Shape object, checks it
        and labels it. If the object is too small or too high,
        it will kill it.
        """
        STREET_HT,TOWER_BASE,MIDRISE_MAX = 9., 21., 21.  #14.0, 30
        STREET_DIST,MIDRISE_DIST,TOWER_DIST = 40.,8.,8.0
        label = parent_label
        if self.shape.is_guid(self.shape.cpt):
            #print self.shape.cpt
            cptrc = rs.coerce3dvector(self.shape.cpt)
            #print cptrc, cptrc
        z = int(round(self.shape.cpt[2],2))
        x_d,y_d, = self.shape.x_dist,self.shape.y_dist
        #print z
        def equals(a,b):
            return abs(a-b) <= 1
        def check_z_dist(label_ht,z_cpt):
            """
            This method will label any floor above tower_base into 
            tower. It is up to the proximity check to convert it into
            midrise when appropriate.
            """
            if z_cpt >= self.max_ht: label_ht = None
            elif z_cpt >= TOWER_BASE: label_ht = "tower"
            elif z_cpt > STREET_HT: label_ht = "midrise"
            else: label_ht = "street"
            return  label_ht
        def check_xy_dist(label_,x_dist,y_dist,z_cpt):
            if label_ == "tower":
                if x_dist <= TOWER_DIST or y_dist <= TOWER_DIST: # lowerbound
                    label_ = "midrise"
                if x_dist > 40 or y_dist > 40: # upperbound
                    label = "midrise"
            if label_ == "midrise":
                label_ = None
                if x_dist > MIDRISE_DIST and y_dist > MIDRISE_DIST: 
                    if z_cpt < MIDRISE_MAX:
                        label_ = "midrise"
            
            return label_
        #print self.max_ht, z
        label = check_z_dist(label,z)
        label = check_xy_dist(label,x_d,y_d,z)
        
        """
        if parent_label != "tower" and label == "tower":
            proximity = city.context_near("tower",self.shape)
            if float(proximity) > 0.0:
                label = check_xy_dist("midrise",x_d,y_d,z)
        """
        if parent_label == "tower" and label == "midrise":
                #for edge case of space between TOWER_BASE and MIDRISE_HT
                label = None
        self.label = label
    def make_grammar(self,self_label,p_z_dist,p_deg,p_axis,p_ratio,depth,p_cpt,type):
        """
        make_grammar: self -> None
        Note: need to make that enormous list of inputs into its own object.
        Purpose: Mutates self.rule with shape_grammar rules.
        C(n+1) = Cn - t(g(A)) + t(g(B)), n>0
        """
        
        """ set variables """
        MIDRISE_HT = 30
        TOWER_BASE = 18.0
        MID_TOL = MIDRISE_HT - TOWER_BASE 
        z = int(round(self.shape.cpt[2],2))
        ht_ = None
        
        #print 'new grammar, @', z
        
        def add_torque(crv,r,z,cpt):
            cp = r.data.shape.cplane
            s = Shape_2D(rs.AddPlanarSrf([crv])[0],cp)

            d_ = 0.#random.randint(-10,10)
            if d_ < 5 and d_ > 0: d_ += 3
            elif d_ > -5 and d_ < 0: d_ -= 3
            if int(cpt[0])%2==0:
                axis_short = "EW"
            else: 
                axis_short = "NS"
            
            if abs(z-18)<=1.:
                if int(cpt[0])%2==0:
                    ratio_, axis = 0.51, "EW"
                else:
                    ratio_, axis = 0.49, "EW"
            elif abs(z-21)<=1.:
                if int(cpt[0])%2==0:
                    ratio_, axis = 0.51, axis_short
                else:
                    ratio_, axis = 0.49, axis_short
            
            elif abs(z-90)<=2.:
                if int(cpt[0])%2==0:
                    ratio_, axis = 0.9, "EW"
                else:
                    ratio_, axis = 0.1, "EW"
            else:
                if int(cpt[0])%2==0:
                    ratio_,axis = 0.8, "NS"
                else:
                    ratio_,axis = 0.2, "NS"
            try:
                glst = s.op_split(axis,ratio_,d_)
                slst = map(lambda g: Shape_2D(g,cp),glst)
                glst = map(lambda j: j.crv, slst)            
                crv = glst[0] if rs.Area(glst[0]) > rs.Area(glst[1]) else glst[1]
                return crv
            except: 
                return None
        
        """ set choke points """
        midrise_choke = [9,18,21]#21]#,12,18,30]
        tower_choke = [90]

        if int(z) in midrise_choke + tower_choke:
            root = self.lot_node.get_root()
            if z < 19:
                print 'z', root.data.shape.bottom_crv
                copyroot = rc.Geometry.Curve.DuplicateCurve(root.data.shape.bottom_crv)
                id = sc.doc.Objects.AddCurve(copyroot)
                crv = rs.CopyObject(id,[0,0,self.shape.cpt[2]])
            else:
                crv = rs.CopyObject(self.shape.bottom_crv)
            
            terr = 0
            
            if int(z) == 9: terr = 4.2#1.5
            #elif int(z) == 12: terr = 5.5
            #elif int(z) == 18: terr = 4
            #elif int(z) == 30: terr = 0.01
            #elif int(z) == 60: terr = 0.01
            #elif int(z) == 90: terr = 0.01
            else: terr = 0.01
            
            if int(z) < 21:
                terr += type['solarht']
            
            if int(z) >= 15:
                crv = add_torque(crv,root,z,self.shape.cpt)
            
            self.rule += [["offset",terr,crv,"terrace"]]
            
            print 'terrace at z: ', z, 'floornum: ',  z/3.
            print 'terr: ', terr
            print '--'
        
        """ make grammar """
        if self_label == "street":
            if int(z) < 5:
                axis,ratio,degree,ht = "NS",0.0,0,6.0
            else:
                axis,ratio,degree,ht = "NS",0.0,0,3.0
        elif self_label == "midrise":
            axis,ratio,degree,ht = "NS",0.,0,3.
        elif self_label == "tower":
            axis,ratio,degree,ht,rot = "NS",0,0,3.,0
        
        self.axis = axis
        if not self_label == "tower": self.ratio = ratio
        self.degree = degree
        if ht_: ht = ht_
        if abs(p_z_dist - ht) >= 0.1: #tolerance for height diff
            self.rule += [["extrude",ht]]
        child_rule = ["move",0,0,ht]
        self.rule += [["split",axis,ratio,degree,0,child_rule]]
            
class Building_Tree(Tree):
     def __init__(self,data,loc=None,parent=None,sib=None,depth=0):
        Tree.__init__(self,data,loc,parent,sib,depth)
     def make_tree(self):
        """
        Make_tree: junk -> None
        Purpose: parses grammar rules, and replaces non-terminal shapes.
        Currently this method is cluttered with specifics relating to the
        Building_Grammar class. That needs to be moved into the Build class
        or Grammar class, eventually - because this should deal with both the Building
        Grammar and the Envelope_Grammar.
        ### <- indicates code that needs to be moved to the Build_Grammar or Build class
        """
        """import classes - make these into object globals"""
        
        if self.depth >= 60:
            self.delete_node()
        else:
            d = self.data
            loc = []
            if self.parent:###
                parent_label = self.parent.data.label###
                p_bottom_crv = self.parent.data.shape.bottom_crv###
                parent = self.parent
            else:##
                parent_label, p_bottom_crv = None, None###
                parent = None
            self.data.make_label(parent_label)
            if not self.data.label:
                print 'label=None'
                #if self.parent: self.parent.match_ht()###
                self.delete_node()
            else:
                #print self
                
                # can I do this in the main pattern? test w/2d
                if not self.parent:###
                    bld = Build(self)### 
                    city.build_lst.append(bld)###
                type = d.type
                self.data.make_grammar(d.label,d.shape.z_dist,d.degree,d.axis,d.ratio,self.depth,d.shape.cpt,type)
                # this should be label ^
                try:
                    loc,locr = self.data.make_shape(self.data.rule)
                except:
                    print 'error making shape @ depth:', self.depth, sys.exc_info()
                if loc == []:
                    self.delete_node()
                self.data.shape.reset(xy_change=False)
                
                for i,child in enumerate(loc):
                    if child:
                        child_shape = Shape_3D(child,self.data.shape.cplane)###
                        child_grammar = Building_Grammar(locr[i],child_shape,d.max_ht,d.degree,d.lot_node,d.axis,d.ratio)###
                        child_grammar.type = type
                        child_node = Building_Tree(child_grammar,parent=self,depth=self.depth+1)
                        self.loc.append(child_node)
                for i in range(len(self.loc)):
                    self.loc[i].make_tree()
                    #'print fail make_tree' 
                    #debug.append(self.loc[i].data.shape.geom)
"""--------------------------------------------"""

def calc_area(n,d):
    return round(n.data.shape.x_dist * n.data.shape.y_dist,2)

if run:
    TOL = sc.doc.ModelAbsoluteTolerance
    sc.sticky["debug"] = []
    debug = sc.sticky["debug"]
    """export classes"""
    sc.sticky["Build"] = Build
    sc.sticky["Building_Grammar"] = Building_Grammar
    
if False:
    hi_tree_lst = []
    for _box in lst_box:
        #print 'box', _box
        box_lst = filter(lambda b: b!=None,_box)
        city = City()
        sc.sticky["city"] = city
        hi_tree, mid_tree = [], []
        box_lst_ = map(lambda n: copy.deepcopy(n), box_lst)
        nlst = []
        for n in box_lst_:
            lon = n.traverse_tree(lambda n:n.get_label("lot"),internal=True)
            lon = filter(lambda n: n!= None, lon)
            nlst.extend(lon)

            for node in nlst:
                shape = copy.deepcopy(node.data.shape)
                #print '--ht--', shape.ht
        
            SG = Building_Grammar([],shape,shape.ht,0,node)
            SG.type = node.data.type
            root = Building_Tree(SG)
            root.make_tree()
            #except: 'try except make_tree fail'
        da = []
    
        map(lambda b:b.get_build_geom(),city.build_lst)
        map(lambda b: b.lot_node.get_root().traverse_tree(lambda n: n.data.shape.convert_rc('3d')),city.build_lst)
        hi_tree = city.build_lst
        
        hi_tree_lst.append(hi_tree)
    
    #for hi_tree in hi_tree_lst:
    #    print hi_tree
# ---------- end bibil_10 ----------
facade_pattern = PythonScript(box=flatten(geo_57), run=toggle_20)  # -> wall, z, floor, ceiling, debug; inputs box: list, run: Boolean; disabled
# ---------- facade_pattern: Python ----------
import rhinoscriptsyntax as rs
import Rhino as rc
import math
import random
import scriptcontext as sc
import ghpythonlib.components as ghcomp
import ghpythonlib
import sys
import Grasshopper.Kernel as gh
import copy


"""import classes"""
Shape = sc.sticky["Shape"]
Shape_3D = sc.sticky["Shape_3D"]
Shape_2D = sc.sticky["Shape_2D"]
Grammar = sc.sticky["Grammar"]
Building_Grammar = sc.sticky["Building_Grammar"]
Tree = sc.sticky["Tree"]
Facade = sc.sticky["Facade"] 
Facade_Grammar = sc.sticky["Facade_Grammar"] 
Facade_Tree = sc.sticky["Facade_Tree"] 


if _box and run:
    sc.sticky["debug"] = []
    debug = sc.sticky["debug"]
    facade = Facade()
    wall,window,floor,ceiling = [],[],[],[]
    wall_lst, window_lst, floor_lst, ceiling_lst = [],[],[],[] 
    z = []
    
    _box = map(lambda n: copy.deepcopy(n), _box)
    for init_box in _box:
        rs.EnableRedraw(False)
        if init_box:
            shape = Shape_3D(init_box)
            print shape.z_dist
            SG = Building_Grammar([],shape,shape.ht,0,None)
            root = Facade_Tree(SG)
            wall_lst.append(shape.bottom_crv)
            if (shape.cpt[2]-0.)<2.:
                z.append(6.)
            else:
                z.append(3.)
            
            if True:#try:
                loew = root.traverse_tree(facade.get_facade)
                wall_lst = reduce(lambda x,y: x+y,loew)
                #wall_lst,window_lst = loew[0], loew[1]
                floor_lst = root.traverse_tree(facade.get_floor)
                #print wall_lst
                #ceiling_lst = root.traverse_tree(facade.get_ceiling)
            #except:
            #    pass
            
            #print 'testlabel', wall_lst
            wall.extend(wall_lst)
            window.extend(window_lst)
            floor.extend(floor_lst)
            ceiling.extend(ceiling_lst)
            
        rs.EnableRedraw(True)
        rc.RhinoApp.Wait()
# ---------- end facade_pattern ----------
delete_partitions = PythonScript(shape_in=facade_pattern.wall, run=toggle_21)  # -> ext_shape_out, int_shape_out, debug; inputs shape_in: list, run: Boolean; disabled
# ---------- delete_partitions: Python ----------
import rhinoscriptsyntax as rs
import Rhino as rc
import math
import random
import scriptcontext as sc
import ghpythonlib.components as ghcomp
import ghpythonlib
import Grasshopper.Kernel as gh
import copy


"""import classes"""
Shape_2D = sc.sticky["Shape_2D"]
Shape_3D = sc.sticky["Shape_3D"]
Tree = sc.sticky["Tree"]
Grammar = sc.sticky["Grammar"]
Fabric_Grammar = sc.sticky["Fabric_Grammar"]
Fabric_Tree = sc.sticky["Fabric_Tree"]
"""--------------------------------------------"""
"""
Grid_Subdivide: (listof node) int int -> (listof node))
Purpose: This component consumes a list of node lots and two int and 
generates a list of mutated nodes, with the lots subdivided according
to the int int dimensions.     
"""

def delete_partitions(node_lst):
    int_geom,ext_geom = [],[]
    shape_lst,cpt,cpl = [],[],[]
    debug = []
    for n in node_lst:
        lot_lst = n.traverse_tree(lambda j:j,internal=False)
        for i,n_ in enumerate(lot_lst):
            srf = n_.data.shape.geom
            srf = sc.doc.Objects.AddBrep(srf)
            shape = Shape_2D(srf,n_.data.shape.cplane)
            shape_lst.append(shape)
            cpt.append(shape.cpt)
            cpl.append(shape.cplane)
            #geom.append(shape.geom)
    
    for i,shape in enumerate(shape_lst):
        curve = shape.crv
        #print '---'
        ptlst = []
        for cpt_,cpl_ in zip(cpt,cpl):
            in_wall = int(rs.PointInPlanarClosedCurve(cpt_,curve,cpl_))
            #0 = point is outside of the curve
            #1 = point is inside of the curve
            #2 = point in on the curve
            #print in_wall,',',
            if int(in_wall) == 1 or int(in_wall) == 2:
                ptlst.append(cpt_)
                #if i == 7:
                #    debug.append(curve)
                #    debug.append(cpt_)
                #    debug.append(cpl_)
        #print '\ncount', count
        refpt = shape.cpt
        count = 0
        for checkpt in ptlst:
            if rs.Distance(refpt,checkpt) < 7.:
                count += 1
        if count == 1:
            ext_geom.append(shape)
        else:
            int_geom.append(shape)
    return ext_geom,int_geom # return interior partitions

if run and shape_in and shape_in != [None]:
    TOL = sc.doc.ModelAbsoluteTolerance
    sc.sticky["debug"] = []
    debug = sc.sticky["debug"]
    lot_lst = []
    ext_shape_out = []
    int_shape_out = []
    
    #lot_in = reduce(lambda i,j: i+j,lot_in)
    for index, lot_shape in enumerate(shape_in):
        lot_grammar = Fabric_Grammar([],lot_shape,0)
        lot_node = Fabric_Tree(lot_grammar,parent=None,depth=0)
        lot_lst.append(lot_node)
        for lot in lot_lst: lot.get_root().traverse_tree(lambda n: n.data.shape.convert_rc())
        
    ext_shape_out,int_shape_out = delete_partitions(lot_lst)
    #for i,n_ in enumerate(lot_lst):
    #    srf = n_.data.shape.geom
    #    srf = sc.doc.Objects.AddBrep(srf)
    #    shape = Shape_2D(srf,n_.data.shape.cplane)
    #    lot_lst[i] = shape
# ---------- end delete_partitions ----------
block_depth_segmented = PythonScript(
    lot_in=delete_partitions.ext_shape_out,
    depth=number_slider_24,
    street_dim=number_slider_25,
    flip_axis=toggle_22,
    run=toggle_23)  # -> geo_out, debug; inputs lot_in: list, depth: Int32, run: Boolean; disabled
# ---------- block_depth_segmented: Python ----------
import rhinoscriptsyntax as rs
import Rhino as rc
import math
import random
import scriptcontext as sc
import ghpythonlib.components as ghcomp
import ghpythonlib
import Grasshopper.Kernel as gh
import copy


"""import classes"""
Shape_2D = sc.sticky["Shape_2D"]
Shape_3D = sc.sticky["Shape_3D"]
Tree = sc.sticky["Tree"]
Grammar = sc.sticky["Grammar"]
Fabric_Grammar = sc.sticky["Fabric_Grammar"]
Fabric_Tree = sc.sticky["Fabric_Tree"]
"""--------------------------------------------"""
"""
Grid_Subdivide: (listof node) int int -> (listof node))
Purpose: This component consumes a list of node lots and two int and 
generates a list of mutated nodes, with the lots subdivided according
to the int int dimensions.     
"""

if run and lot_in:
    TOL = sc.doc.ModelAbsoluteTolerance
    sc.sticky["debug"] = []
    debug = sc.sticky["debug"]
    lot_lst = []
    #lot_in = reduce(lambda i,j: i+j,lot_in)
    for index, lot_shape in enumerate(lot_in):
        lot_lst_ = []
        lot_grammar = Fabric_Grammar([],lot_shape,0)
        lot_node = Fabric_Tree(lot_grammar,parent=None,depth=0)
        if not lot_node.data.shape.is_guid('2d'):
            lot_node.data.shape.convert_guid()
            
        axis_ = "NS"
        lot_node.make_tree_3D("subdivide_depth",depth,axis=axis_,cut_width=street_dim)
        #lot_node.make_tree_3D("subdivide_depth_same",depth,axis=axis_,cut_width=street_dim)
        lot_lst_ = lot_node.traverse_tree(lambda n:n,internal=False)
        for lot_node_ in lot_lst_:
            x_dim = 9.
            #y_dim = 1.
            y_dim = lot_node.data.shape.ht/3.
            lot_node_.make_tree_3D("subdivide_dim",(x_dim,y_dim),axis=axis_,random_tol=0,cut_width=street_dim)
            lot_lst__ = lot_node_.traverse_tree(lambda n:n,internal=False)
            for lot in lot_lst__: lot.get_root().traverse_tree(lambda n: n.data.shape.convert_rc())
            lot_lst.extend(lot_lst__)
                
    #print len(lot_lst)
    #clean failed geoms from subdiv operation
    for i,n in enumerate(lot_lst):
        geom = n.data.shape.geom
        geom = sc.doc.Objects.AddBrep(geom)
        lot_shape = Shape_2D(geom,n.data.shape.cplane)
        lot_grammar = Fabric_Grammar([],lot_shape,0)
        # make sure all the references to parents and children are correct
        lot_node = Fabric_Tree(lot_grammar,parent=n.parent,depth=n.depth)
        if n.sib == 1:lot_node.parent.loc[0] = lot_node
        else: lot_node.parent.loc[1] = lot_node
        lot_lst[i] = lot_node
    
    geo_out = lot_lst
# ---------- end block_depth_segmented ----------
make_window = PythonScript(node_in=block_depth_segmented.geo_out, run=toggle_24)  # -> window, wall, debug; inputs node_in: list; disabled
# ---------- make_window: Python ----------
import rhinoscriptsyntax as rs
import Rhino as rc
import math
import random
import scriptcontext as sc
import ghpythonlib.components as ghcomp
import ghpythonlib
import Grasshopper.Kernel as gh
import copy
import System

"""import classes"""
Shape_2D = sc.sticky["Shape_2D"]
Shape_3D = sc.sticky["Shape_3D"]
Tree = sc.sticky["Tree"]
Grammar = sc.sticky["Grammar"]
Fabric_Grammar = sc.sticky["Fabric_Grammar"]
Fabric_Tree = sc.sticky["Fabric_Tree"]
"""--------------------------------------------"""

if run and node_in and node_in != [None]:
    ### Purpose: Inputs subdivided wall nodes, calculates
    ### center panel and outputs split window/wall
    ### node_in: listof subdivided wall panels
    
    def get_wall_nodes(node_in_):
        ### Purpose: identify relevant parent nodes
        parent_dic = {}
        for i,n_ in enumerate(node_in_):
            parent_node = n_.parent.parent
            #if i==1: debug.append(n_.parent.parent.data.shape.geom)
            is_double = parent_dic.has_key(parent_node)
            depth = parent_node.depth
            if not is_double and depth != 0:
                parent_dic[parent_node] = None
        parent_nodes = parent_dic.keys()
        return parent_nodes
    def brep2curve(parent_node_in):
        ### Purpose: loop thorugh parent list and convert to curves
        for i,pn in enumerate(parent_node_in):
            brep = pn.data.shape.geom
            cpt = rc.Geometry.AreaMassProperties.Compute(brep).Centroid
            pn.data.shape.cpt = cpt
            crv_lst = pn.data.shape.geom.GetWireframe(1)
            crv = rc.Geometry.Curve.JoinCurves(crv_lst)[0]
            crv = pn.data.shape.clean_curve(crv)
            pn.data.shape.bottom_crv = crv
        return parent_node_in
    def get_window_node(parent_node_lst_):
        ### Purpose: Input listof parent nodes
        ### then check if parent cpt lies in panel curve
        ### if True output listof panel node
        
        ## node_in_: listof segmented wall nodes
        ## parent_crv_lst: listof tuple (unit wall crvs, cplane)
        window_node_lst = []
        wall_node_lst = []
        for i,pn in enumerate(parent_node_lst):
            pn_cpt = pn.data.shape.cpt
            cn_lst = pn.traverse_tree(lambda n:n,internal=False)
            for cn in cn_lst:
                #cn.data.shape.convert_guid()
                cn_cpl = cn.data.shape.cplane
                cn_crv = cn.data.shape.crv
                in_lot = int(rs.PointInPlanarClosedCurve(pn_cpt,cn_crv,cn_cpl))
                #0 = point is outside of the curve
                #1 = point is inside of the curve
                #2 = point in on the curve
                if int(in_lot) == 1:
                    window_node_lst.append(cn)
                else:
                    wall_node_lst.append(cn)
        return window_node_lst,wall_node_lst
    def offset_window(window_node_lst_):
        off_crv_lst = []
        for wn in window_node_lst_:
            wn_cpt = wn.data.shape.cpt
            wn_crv = wn.data.shape.crv
            dist = 0.1
            normal = sc.doc.Views.ActiveView.ActiveViewport.ConstructionPlane().Normal
            style = System.Enum.ToObject(rc.Geometry.CurveOffsetCornerStyle,1)
            offset = rc.Geometry.Curve.Offset(wn_crv,wn_cpt,normal,dist,TOL,style)
            off_crv_lst.append(offset[0])
        return off_crv_lst
    def split_surf(offset_lst_,window_node_lst_):
        window_lst = []
        wall_lst = []
        for offset,wn in zip(offset_lst_,window_node_lst_):
            panel_srf = wn.data.shape.geom
            off_crv = offset
            trim_lst = ghcomp.SurfaceSplit(panel_srf,off_crv)
            window_lst.append(trim_lst[1])
            wall_lst.append(trim_lst[0])
        return window_lst, wall_lst
    
    sc.sticky['debug'] = []
    debug = sc.sticky['debug']
    TOL = sc.doc.ModelAbsoluteTolerance
    parent_node_lst_ = get_wall_nodes(node_in)
    parent_node_lst = brep2curve(parent_node_lst_)
    window_node_lst,wall_node_lst = get_window_node(parent_node_lst)
    offset_lst = offset_window(window_node_lst)
    window,wall = split_surf(offset_lst,window_node_lst)
    
    wall += map(lambda n:n.data.shape.geom,wall_node_lst)
# ---------- end make_window ----------
desk_hight = Slider(0, range=0..1)  # disabled
g_26 = PythonScript(node=block_depth_segmented.geo_out)  # -> geom; inputs node: list; disabled
# ---------- g_26: Python ----------
import scriptcontext as sc

"""import classes"""
Shape_2D = sc.sticky["Shape_2D"]
Shape_3D = sc.sticky["Shape_3D"]
Tree = sc.sticky["Tree"]
Grammar = sc.sticky["Grammar"]

if node:
    geom = []
    for n in node:
        lot_lst = n.traverse_tree(lambda j:j,internal=False)
        for n_ in lot_lst:
            geom.append(n_.data.shape.crv)
    print geom
# ---------- end g_26 ----------
geo_58 = Geometry(block_depth_segmented.debug)  # disabled
geo_59 = Geometry(make_window.wall)  # disabled
swatch_4 = ColourSwatch(SwatchColor=RGBA(204, 204, 204, 232))  # disabled
addition = Addition(A=facade_pattern.z, B=desk_hight)  # disabled
Z_8 = UnitZ(Factor=addition)  # disabled
floor = Geometry(facade_pattern.floor)  # disabled
geo_60 = Geometry(make_window.wall)  # disabled
preview_12 = CustomPreview(Geometry=geo_59, Shader=swatch_4)  # disabled
srf = Surface(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)  # disabled

# ---- group: envelope
g_27 = PythonScript(shape=delete_partitions.ext_shape_out)  # -> geom; inputs shape: list; disabled
# ---------- g_27: Python ----------
import scriptcontext as sc

"""import classes"""
Shape_2D = sc.sticky["Shape_2D"]
Shape_3D = sc.sticky["Shape_3D"]
Tree = sc.sticky["Tree"]
Grammar = sc.sticky["Grammar"]

if shape and shape != [None]:
    geom = []
    for n in shape:
        geom.append(n.geom)
    #print geom
# ---------- end g_27 ----------

# ---- group: interior
g_28 = PythonScript(shape=delete_partitions.int_shape_out)  # -> geom; inputs shape: list; disabled; same code as g_27

# ---- group: floor
flip = Flip(Surface=floor, Guide=srf)  # -> Surface, Result; disabled

# ---- group: celing
move_8 = Move(Geometry=flip.Surface, Motion=Z_8)  # -> Geometry, Transform; disabled

# ----
# CALCULATE
volume = Volume(Geometry=b_5)  # -> Volume, Centroid
area_4 = Area(Geometry=b_5)  # -> Area, Centroid
geo_61 = Geometry([pattern_2.Debug, offset])
traverse = PythonScript(x=pattern_2.Geo_out_lst)  # -> a
# ---------- traverse: Python ----------
if x:
    a = x.traverse_tree(lambda n:n,internal=False)
    a = filter(lambda n: n!=None,a)
# ---------- end traverse ----------
sum_3 = PythonScript(x=area_4.Area)  # -> a; inputs x: list; same code as sum
sum_4 = PythonScript(x=volume.Volume)  # -> a; inputs x: list; same code as sum
division_2 = Division(A=sum_4, B=Slider(3, range=0..10))
preview_13 = CustomPreview(Geometry=b_5, Shader=tower)
preview_14 = CustomPreview(Geometry=[geo_61, offset], Shader=circles)
analyse = PythonScript(node=traverse, ht=Toggle(True), gfa=Toggle(True), run=Toggle(True))  # -> cpt, data, line; inputs node: list
# ---------- analyse: Python ----------
import rhinoscriptsyntax as rs


if node and run:
    cpt = []
    data = []
    line = []
    for n in node:
        IsTower = 'park' in n.get_root().data.type['label']
        IsPrint = n.data.type['print']
        if IsTower and IsPrint:
            try:
                bcpt = n.data.shape.cpt
                cpt_ = rs.AddPoint(bcpt[0],bcpt[1],220.)
                line_ = rs.AddLine(bcpt,cpt_)
                data_ = 'ht: '
                if ht:
                    n.data.shape.reset()
                    data_ += str(int(n.data.shape.ht))
                if gfa:
                    
                    try:
                        mass = sc.doc.Objects.AddBrep(n.data.shape.geom)
                        area = rs.Volume(mass)/3.
                        print area
                        data_ += str(int(area))
                    except Exception as e:
                        print str(e)
                print data_
                cpt.append(cpt_)
                line.append(line_)
                data.append(data_)
            except Exception as e:
                print 'error', str(e)
# ---------- end analyse ----------
python_6 = PythonScript(grossfloor=division_2, lotarea=sum)  # -> gfa
# ---------- python_6: Python ----------
if grossfloor and lotarea:
    
    
    gfa = round(grossfloor / 1000.0) * 1000.0
    print gfa
    
    #far = round(gfa/float(lotarea),1000) * 1000.
    # print far
# ---------- end python_6 ----------
number_slider_26 = Slider(0.5, range=0..1)
cir_2 = Circle(Plane=[transit_dpt_3, transit_dpt_4], Radius=Slider(500, range=0..1000))  # disabled
number_slider_27 = Slider(2, range=0..10)
pt_6 = Point(<point referenced from the Rhino model>)
panel_12 = Panel(python_6)

# ---- group: Height Viz
number_slider_28 = Slider(1, range=0..10)
swatch_5 = ColourSwatch(SwatchColor=RGB(255, 255, 255))
Z_9 = UnitZ(Factor=40)
move_9 = Move(Geometry=analyse.cpt, Motion=Z_9)  # -> Geometry, Transform
tag = TextTag(Location=move_9.Geometry, Text=analyse.data, Colour=swatch_5)
tag_2 = TextTag3D(Location=analyse.cpt, Text=analyse.data, Size=Slider(12, range=0..100), Colour=swatch_5, Justification=5)

# ----
preview_15 = CustomPreview(
    Geometry=[ln_4, transit_dpt_3, move_7.Geometry, ln_5, move_6.Geometry, transit_dpt_4, ln_3, pt_5, move_4.Geometry, ln_2, move_3.Geometry, pt_4],
    Shader=boundaries)

# ---- group: PROPOSED
geo_62 = Geometry([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])

# ----
solar = Geometry(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)
preview_16 = CustomPreview(Geometry=geo_62, Shader=ColourSwatch(SwatchColor=RGB(250, 248, 12)))
number_slider_29 = Slider(9, range=0..10)
panel_13 = Panel("C:\Users\vasanthakumars\Desktop\simulation4ladybug3")
number_slider_30 = Slider(21, range=0..100)
renders_new = Panel("Renders_New")
# SIMULATE
ladybug = Ladybug_Ladybug()  # -> out; plug-in component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
path = FilePath("C:\saeran\master\git\bibil\src\reference\CAN_ON_Toronto.716240_CWEC\CAN_ON_Toronto.716240_CWEC.epw")
path_2 = FilePath("C:\Users\vasanthakumars\Documents\GitHub\bibil\src\reference\CAN_ON_Toronto.716240_CWEC\CAN_ON_Toronto.716240_CWEC.epw")
analysisperiod = Ladybug_AnalysisPeriod(
    fromMonth=number_slider_29,
    fromDay=number_slider_30,
    fromHour=Slider(11.25, range=0..100),
    toMonth=number_slider_29,
    toDay=number_slider_30,
    toHour=Slider(16.25, range=0..100))  # -> readMe, analysisPeriod; plug-in component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
gencumulativeskymtx = Ladybug_GenCumulativeSkyMtx(epwFile=path, skyDensity=0, workingDir="C:\Users\user\Desktop\simtest", useOldRes=Toggle(True), runIt=toggle_12)  # -> out, cumulativeSkyMtx; plug-in component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
geo_63 = Geometry(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)

# ---- group: ground
geo_64 = Geometry(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)  # disabled

# ----
swatch_6 = ColourSwatch(SwatchColor=RGB(255, 0, 0))  # disabled

# ---- group: circles
bakeattributes = CSharpScript(obj=geo_61, layer="Renders", color=circles, material=circles, activate=toggle_9)  # -> out; inputs obj: GeometryBase, name: String, layer: String, color: Color, pWidth: Double, wires: Int32, activate: Boolean; disabled
# ---------- bakeattributes: C# ----------
    //Inserts geometry into the Rhino document, with custom attributes
    //Written by Giulio Piacentino
    //Version written 2010 11 21 - for Grasshopper 0.8.002

    if (activate)
    {
      if(obj == null)
      {
        Print("No object to bake");
        return;
      }

      //Make new attribute to set name
      Rhino.DocObjects.ObjectAttributes att = new Rhino.DocObjects.ObjectAttributes();

      //Set object name
      if(!string.IsNullOrEmpty(name))
      {
        att.Name = name;
      }

      //Set color
      if(!color.IsEmpty)
      {
        att.ColorSource = Rhino.DocObjects.ObjectColorSource.ColorFromObject; //Make the color type "by object"
        att.ObjectColor = color;

        att.PlotColorSource = Rhino.DocObjects.ObjectPlotColorSource.PlotColorFromObject; //Make the plot color type "by object"
        att.PlotColor = color;
      }

      //Set layer
      if(!string.IsNullOrEmpty(layer) && Rhino.DocObjects.Layer.IsValidName(layer))
      {
        //Get the current layer index
        Rhino.DocObjects.Tables.LayerTable layerTable = doc.Layers;
        int layerIndex = layerTable.Find(layer, true);

        if(layerIndex < 0) //This layer does not exist, we add it
        {
          Rhino.DocObjects.Layer onlayer = new Rhino.DocObjects.Layer(); //Make a new layer
          onlayer.Name = layer;

          layerIndex = layerTable.Add(onlayer); //Add the layer to the layer table
          if (layerIndex > -1) //We manged to add layer!
          {
            att.LayerIndex = layerIndex;
            Print("Added new layer to the document at position " + layerIndex + " named " + layer + ". ");
          } else
            Print("Layer did not add. Try cleaning up your layers."); //This never happened to me.
        }
        else
          att.LayerIndex = layerIndex; //We simply add to the existing layer
      }


      //Set plotweight
      if(pWidth > 0)
      {
        att.PlotWeightSource = Rhino.DocObjects.ObjectPlotWeightSource.PlotWeightFromObject;
        att.PlotWeight = pWidth;
      }


      //Set material
      bool materialByName = !string.IsNullOrEmpty(material as string);
      Rhino.Display.DisplayMaterial inMaterial = material as Rhino.Display.DisplayMaterial;
      if(material is Color)
      {
        inMaterial = new Rhino.Display.DisplayMaterial((Color) material);
      }
      if(material != null && inMaterial == null && !materialByName)
      {
        if(!(material is string))
        {
          try //We also resort to try with IConvertible
          {
            inMaterial = (Rhino.Display.DisplayMaterial) Convert.ChangeType(material, typeof(Rhino.Display.DisplayMaterial));
          }
          catch(InvalidCastException)
          {
          }
        }
      }
      if(inMaterial != null || materialByName)
      {
        string matName;

        if(!materialByName)
        {
          matName = string.Format("A:{0}-D:{1}-E:{2}-S:{3},{4}-T:{5}",
            Format(inMaterial.Ambient),
            Format(inMaterial.Diffuse),
            Format(inMaterial.Emission),
            Format(inMaterial.Specular),
            inMaterial.Shine.ToString(),
            inMaterial.Transparency.ToString()
            );
        }
        else
        {
          matName = (string) material;
        }

        int materialIndex = doc.Materials.Find(matName, true);
        if(materialIndex < 0 && !materialByName) //Material does not exist and we have its specs
        {
          materialIndex = doc.Materials.Add(); //Let's add it
          if(materialIndex > -1)
          {
            Print("Added new material at position " + materialIndex + " named \"" + matName + "\". ");
            Rhino.DocObjects.Material m = doc.Materials[materialIndex];
            m.Name = matName;
            m.AmbientColor = inMaterial.Ambient;
            m.DiffuseColor = inMaterial.Diffuse;
            m.EmissionColor = inMaterial.Emission;
            //m.ReflectionColor = no equivalent
            m.SpecularColor = inMaterial.Specular;
            m.Shine = inMaterial.Shine;
            m.Transparency = inMaterial.Transparency;
            //m.TransparentColor = no equivalent
            m.CommitChanges();

            att.MaterialSource = Rhino.DocObjects.ObjectMaterialSource.MaterialFromObject;
            att.MaterialIndex = materialIndex;
          }
          else
            Print("Material did not add. Try cleaning up your materials."); //This never happened to me.
        }
        else if(materialIndex < 0 && materialByName) //Material does not exist and we do not have its specs. We do nothing
        {
          Print("Warning: material name not found. I cannot set the source to this material name. Add a material with name: " + matName);
        }
        else
        {
          //If this material exists, we do not replace it!
          att.MaterialSource = Rhino.DocObjects.ObjectMaterialSource.MaterialFromObject;
          att.MaterialIndex = materialIndex;
        }
      }


      //Set wire density
      if(wires == -1 || wires > 0)
      {
        att.WireDensity = wires;
      }


      //Bake to the right type of object
      switch(obj.ObjectType)
      {
        case Rhino.DocObjects.ObjectType.Brep:
          doc.Objects.AddBrep(obj as Brep, att);
          break;
        case Rhino.DocObjects.ObjectType.Curve:
          doc.Objects.AddCurve(obj as Curve, att);
          break;
        case Rhino.DocObjects.ObjectType.Point:
          doc.Objects.AddPoint((obj as Rhino.Geometry.Point).Location, att);
          break;
        case Rhino.DocObjects.ObjectType.Surface:
          doc.Objects.AddSurface(obj as Surface, att);
          break;
        case Rhino.DocObjects.ObjectType.Mesh:
          doc.Objects.AddMesh(obj as Mesh, att);
          break;
        case Rhino.DocObjects.ObjectType.Extrusion:
          typeof(Rhino.DocObjects.Tables.ObjectTable).InvokeMember("AddExtrusion", BindingFlags.Instance | BindingFlags.InvokeMethod, null, doc.Objects, new object[]{obj, att});
          break;
        case Rhino.DocObjects.ObjectType.PointSet:
          doc.Objects.AddPointCloud(obj as Rhino.Geometry.PointCloud, att); //This is a speculative entry
          break;
        default:
          Print("The script does not know how to handle this type of geometry: " + obj.GetType().FullName);
          break;
      }
      Print("Added " + obj.GetType().Name);

    }
    else
    {
      Print("Inactive");
    }
# ---------- bakeattributes: C# additional code ----------
  static string Format(Color c)
  {
    return (new System.Text.StringBuilder("A")).Append(c.A.ToString()).Append("R").Append(c.R.ToString()).Append("G")
      .Append(c.G.ToString()).Append("B").Append(c.B.ToString()).ToString();
  }
# ---------- end bakeattributes ----------

# ----
swatch_7 = ColourSwatch(SwatchColor=RGB(255, 255, 255))  # disabled

# ---- group: new growth
bakeattributes_2 = CSharpScript(obj=b_5, layer=renders_new, color=tower, material=tower, activate=toggle_9)  # -> out; inputs obj: GeometryBase, name: String, layer: String, color: Color, pWidth: Double, wires: Int32, activate: Boolean; disabled; same code as bakeattributes

# ---- group: Existing2
bakeattributes_3 = CSharpScript(obj=[geo_47, geo_46], layer="Renders", color=existing, material=existing, activate=toggle_9)  # -> out; inputs obj: GeometryBase, name: String, layer: String, color: Color, pWidth: Double, wires: Int32, activate: Boolean; disabled; same code as bakeattributes

# ---- group: Parks
# VIZ RENDER
bakeattributes_4 = CSharpScript(obj=geo_50, layer="Renders", color=swatch_3, material=swatch_3, activate=toggle_9)  # -> out; inputs obj: GeometryBase, name: String, layer: String, color: Color, pWidth: Double, wires: Int32, activate: Boolean; same code as bakeattributes

# ---- group: Existing Context
bakeattributes_5 = CSharpScript(obj=[geo_48, geo_49], layer="Renders", color=existing, material=existing, activate=toggle_9)  # -> out; inputs obj: GeometryBase, name: String, layer: String, color: Color, pWidth: Double, wires: Int32, activate: Boolean; disabled; same code as bakeattributes

# ----
selectskymtx = Ladybug_selectSkyMtx(
    cumulativeSkyMtx=gencumulativeskymtx.cumulativeSkyMtx,
    analysisPeriod=analysisperiod.analysisPeriod,
    removeDiffuse=False,
    removeDirect=False)  # -> out, selectedSkyMtx; plug-in component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

# ---- group: automated_geoms
data_5 = Data([geo_48, geo_46, geo_47, b_5])

# ---- group: existing
geo_65 = Geometry([geo_46, geo_47, geo_48, geo_49])

# ---- group: preferred
geo_66 = Geometry([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])

# ----
geo_67 = Geometry([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])
legendpar = Ladybug_LegendParameters(numSegments=Slider(2, range=0..10), customColors=flatten([swatch_6, swatch_7]))  # -> legendPar; plug-in component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
toggle_25 = BooleanToggle(False)
toggle_26 = BooleanToggle(False)

# ---- group: existing+approive
geo_68 = Geometry([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])

# ---- group: manual_override_geoms
geo_69 = Geometry([data_5, geo_65])

# ----
swatch_8 = ColourSwatch(SwatchColor=RGB(38, 38, 38))
bakeattributes_6 = CSharpScript(obj=geo_69, layer="Renders", color=swatch_8, material=swatch_8, activate=toggle_9)  # -> out; inputs obj: GeometryBase, name: String, layer: String, color: Color, pWidth: Double, wires: Int32, activate: Boolean; same code as bakeattributes
radiationanalysis = Ladybug_RadiationAnalysis(
    north=0,
    geometry=flatten(geo_63),
    context=flatten(geo_69),
    gridSize=Slider(12, range=0..100),
    disFromBase=Slider(1, range=0..1),
    selectedSkyMtx=flatten(selectskymtx.selectedSkyMtx),
    legendPar=flatten(legendpar),
    runIt=toggle_12)  # -> out, contextMesh, analysisMesh, testPts, testVec, port, radiationResult, radiationMesh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; plug-in component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

# ---- group: solar
geo_70 = Geometry(radiationanalysis.radiationMesh)

# ----
mesh = Mesh(radiationanalysis.radiationMesh)
swatch_9 = ColourSwatch(SwatchColor=RGB(255, 255, 255))
python_7 = PythonScript(x=radiationanalysis.radiationResult)  # -> a
# ---------- python_7: Python ----------
if x:
    a = int(x*1000)
# ---------- end python_7 ----------

# ---- group: existing+approive
geo_71 = Geometry([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])

# ----
tag_3 = TextTag3D(Location=radiationanalysis.testPts, Text=python_7, Size=Slider(1, range=0..10), Colour=swatch_9, Justification=7)

# ---- group: preferred
geo_72 = Geometry([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])

# ----
gradient = Gradient(
    LowerLimit=Slider(1.2, range=0..10),
    UpperLimit=Slider(0, range=0..100),
    Parameter=radiationanalysis.radiationResult,
    stops=[0: RGB(234, 38, 0), 0.25: RGB(234, 126, 0), 0.5: RGB(254, 244, 84), 0.75: RGB(173, 203, 249), 1: RGB(75, 107, 169)])
sort = SortList(Keys=radiationanalysis.radiationResult)  # -> Keys, ValuesA
tag_4 = TextTag(Location=radiationanalysis.testPts, Text=radiationanalysis.radiationResult, Colour=swatch_9)
panel_14 = Panel(sort.Keys)
geo_73 = Geometry(radiationanalysis.testPts)
geo_74 = Geometry(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)
python_8 = PythonScript(pt=geo_73, crv=geo_74, color=gradient, rad=radiationanalysis.radiationResult)  # -> pt_out, color_out, rad_out; inputs pt: list, color: list, rad: list
# ---------- python_8: Python ----------
import rhinoscriptsyntax as rs


if pt and crv:
    pt_out = []
    color_out = []
    sum_rad = 0.
    for p,c,r in zip(pt,color,rad):
        InCrv = rs.PointInPlanarClosedCurve(p,crv)
        if abs(InCrv-1.) <= 0.1:
            pt_out.append(p)
            color_out.append(c)
            sum_rad += r*1000
            
    rad_out = sum_rad/float(len(rad))
# ---------- end python_8 ----------
printexcel = PythonScript(
    HT_YONGE=yonge,
    HT_MT=mtpleasant,
    HT_NORTH=north,
    HT_PODIUM=python_5.podium,
    STEPBACK=python_5.stepback,
    SEPERATION=python_5.seperation,
    GFA=python_6,
    insolation=python_8.rad_out,
    run=toggle_10)  # -> HT_YONGE, STEPBACK, HT_PODIUM, SEPERATION, GFA, insolation
# ---------- printexcel: Python ----------
if run:
    STEPBACK_ = STEPBACK
    SEPERATION_ = SEPERATION
    GFA_ = GFA
    FAR_ = FAR
    HT_PODIUM_ = HT_PODIUM
    insolation_ = insolation
# ---------- end printexcel ----------
panel_15 = Panel(printexcel.insolation)

# ---- group: GFA
rec = DataRecorder(printexcel.GFA, DataLimit=-10, RecordData=False)

# ---- group: wh/m2
rec_2 = DataRecorder(printexcel.insolation, DataLimit=-10, RecordData=False)

# ---- group: SEPERATION
rec_3 = DataRecorder(printexcel.SEPERATION, DataLimit=1000000000, RecordData=False)

# ---- group: STEPBACK
rec_4 = DataRecorder(printexcel.STEPBACK, DataLimit=1000000000, RecordData=False)

# ---- group: PODIUM
rec_5 = DataRecorder(printexcel.HT_PODIUM, DataLimit=1000000000, RecordData=False)

# ----
n = PythonScript(x=rec_2)  # -> a; inputs x: list
# ---------- n: Python ----------
a = filter(lambda n:n!=None,x)
# ---------- end n ----------
n_2 = PythonScript(x=rec)  # -> a; inputs x: list; same code as n
n_3 = PythonScript(x=rec_5)  # -> a; inputs x: list; same code as n
n_4 = PythonScript(x=rec_4)  # -> a; inputs x: list; same code as n
n_5 = PythonScript(x=rec_3)  # -> a; inputs x: list; same code as n
excelwrite = ExcelWriteLEGACY(
    WriteToggle=Toggle(False),
    WriteHeading=Toggle(False),
    ClearSheet=toggle_15,
    Worksheet=1,
    ColumnStart=1,
    RowStart=1,
    ColumnHeadings=["TOWER SEPERATION", "PODIUM HT", "STEPBACK", "GFA", "INSOLATION"],
    Column1=n_5,
    Column2=n_3,
    Column3=n_4,
    Column4=n_2,
    Column5=n)
str = PythonScript(x=printexcel.STEPBACK)  # -> a
# ---------- str: Python ----------
txt = 'stepback' + str(x)


a = txt
# ---------- end str ----------
tag_5 = TextTag3D(Location=pt_6, Text=str, Size=Slider(25, range=0..100), Justification=7)
panel_16 = Panel(python_8.rad_out)
preview_17 = CustomPreview(Geometry=python_8.pt_out, Shader=python_8.color_out)
