# Grasshopper definition bibil_trial_063_plain_bibil.gh (Grasshopper 0.9.76)
# plug-ins: Python Interpreter

# BIBIL_MODULES
panel = Panel("C:\\Users\\vasanthakumars\\Documents\\GitHub\\bibil\\src")
txt = Text("C:\\saeran\\master\\git\\bibil\\src")
python_script = PythonScript(i=txt)  # -> o
# ---------- python_script: Python ----------
import os

o = os.path.join(str(i),"bibil\\bibil_rule.py")
# ---------- end python_script ----------
python_script_2 = PythonScript(i=txt)  # -> o
# ---------- python_script_2: Python ----------
import os

o = os.path.join(str(i),"bibil\\bibil_pattern.py")
# ---------- end python_script_2 ----------
python_script_3 = PythonScript(i=txt)  # -> o
# ---------- python_script_3: Python ----------
import os

o = os.path.join(str(i),"koku\\koku_vector.py")
# ---------- end python_script_3 ----------
python_script_4 = PythonScript(i=txt)  # -> o
# ---------- python_script_4: Python ----------
import os

o = os.path.join(str(i),"bibil\\bibil_shape.py")
#o = os.path.join(str(i),"research\\bibil_shape_shape_3d_2d.py")
# ---------- end python_script_4 ----------
python_script_5 = PythonScript(i=txt)  # -> o; same code as python_script_3
python_script_6 = PythonScript(i=txt)  # -> o
# ---------- python_script_6: Python ----------
import os

o = os.path.join(str(i),"bibil\\bibil_tree.py")
# ---------- end python_script_6 ----------
python_script_7 = PythonScript(i=txt)  # -> o
# ---------- python_script_7: Python ----------
import os

o = os.path.join(str(i),"bibil\\bibil_plain.py")
# ---------- end python_script_7 ----------
python_script_8 = PythonScript(i=txt)  # -> o
# ---------- python_script_8: Python ----------
import os

o = os.path.join(str(i),"miru\\miru_plain.py")
# ---------- end python_script_8 ----------
file = ReadFile(File=python_script, PerLineParse=False)
file_2 = ReadFile(File=python_script_2, PerLineParse=False)
file_3 = ReadFile(File=python_script_3, PerLineParse=False)
file_4 = ReadFile(File=python_script_4, PerLineParse=False)
file_5 = ReadFile(File=python_script_5, PerLineParse=False)
file_6 = ReadFile(File=python_script_6, PerLineParse=False)
file_7 = ReadFile(File=python_script_7, PerLineParse=False)
file_8 = ReadFile(File=python_script_8, PerLineParse=False)
pt = Point(Point(-545327.8536, 3981919.907, 0))
refroot_3 = Curve(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)
bibil = PythonScript(Code=file_8, Bula_pt=pt, Ref_block=refroot_3)
geo = Geometry(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)
trinco_park = PythonScript(Code=file_7, Grammar_in=bibil, Node_in=geo, Label_="block", Run=Toggle(True))  # -> Node_out, Debug
g = PythonScript(node=trinco_park.Node_out)  # -> geom
# ---------- g: Python ----------
if node:
    geom = []
    lot_lst = node.traverse_tree(lambda n:n,internal=False)
    for n in lot_lst:
        geom.append(n.data.shape.geom)
    print geom
# ---------- end g ----------
