# Grasshopper definition bibil_trial_sim_test.gh (Grasshopper 0.9.76)
# plug-ins: DIVA.ForGrasshopper, Python Interpreter

# ---- group: box
geo = Geometry(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)

# ----
geo_2 = Geometry(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)
ladybug = Ladybug_Ladybug()  # -> out; plug-in component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
path = FilePath("C:\Users\vasanthakumars\Documents\GitHub\bibil\src\reference\CAN_ON_Toronto.716240_CWEC\CAN_ON_Toronto.716240_CWEC.epw")
gencumulativeskymtx = Ladybug_GenCumulativeSkyMtx(
    epwFile=path,
    skyDensity=0,
    workingDir="C:\Users\vasanthakumars\Desktop\simulation4ladybug",
    useOldRes=Toggle(True),
    runIt=Toggle(False))  # -> out, cumulativeSkyMtx; plug-in component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
selectskymtx = Ladybug_selectSkyMtx(cumulativeSkyMtx=gencumulativeskymtx.cumulativeSkyMtx, removeDiffuse=False, removeDirect=False)  # -> out, selectedSkyMtx; plug-in component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
scale_factor = Slider(0.95, range=0..1)
desk_hight = Slider(1, range=-1..1)
radiationanalysis = Ladybug_RadiationAnalysis(
    north=0,
    geometry=flatten(geo_2),
    context=flatten(geo),
    gridSize=Slider(6, range=0..10),
    disFromBase=Slider(1, range=0..1),
    selectedSkyMtx=flatten(selectskymtx.selectedSkyMtx),
    runIt=Toggle(False))  # -> out, contextMesh, analysisMesh, testPts, testVec, port, radiationResult, radiationMesh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; plug-in component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
area = Area(Geometry=geo_2)  # -> Area, Centroid
scale = Scale(Geometry=geo_2, Center=area.Centroid, Factor=scale_factor)  # -> Geometry, Transform
Z = UnitZ(Factor=desk_hight)
geo_3 = Geometry(radiationanalysis.testPts)
geo_4 = Geometry(radiationanalysis.radiationMesh)
move = Move(Geometry=scale.Geometry, Motion=Z)  # -> Geometry, Transform
toggle = BooleanToggle(False)
grid = AnalysisGrid(AnalysisGrid=move.Geometry, GridSize=Slider(6, range=0..100))  # -> AnalysisMeshes, AnalysisNodes, AnalysisVectors
number_slider = Slider(9, range=0..10)
number_slider_2 = Slider(21, range=0..100)
M = Material(Geometry=geo, Geometry_2=geo, Material="OutsideFacade_30")  # -> GeometryWithMaterialAssigned, GeometryWithMaterialAssigned_2
M_2 = Material(Geometry=geo_2, Geometry_2=geo_2, Material="OutsideGround_20")  # -> GeometryWithMaterialAssigned, GeometryWithMaterialAssigned_2
python = PythonScript()  # -> a
# ---------- python: Python ----------
a = [11.25,12.25,13.25,14.25,15.25,16.25]
# ---------- end python ----------
diva_daylight = DIVADaylightAnalysisForGH(
    ProjectName="Temp",
    GeometryWithRadianceMaterialReference=[M.GeometryWithMaterialAssigned_2, M_2.GeometryWithMaterialAssigned_2],
    AnalysisNodes=grid.AnalysisNodes,
    AnalysisDirection=grid.AnalysisVectors,
    WriteOnly=False,
    RunSimulation=toggle,
    Month=number_slider,
    Day=number_slider_2,
    Hour=12,
    ProjectName_2="Temp",
    GeometryWithRadianceMaterialReference_2=[M.GeometryWithMaterialAssigned_2, M_2.GeometryWithMaterialAssigned_2],
    AnalysisNodes_2=grid.AnalysisNodes,
    AnalysisDirection_2=grid.AnalysisVectors,
    WriteOnly_2=False,
    RunSimulation_2=toggle,
    Month_2=number_slider,
    Day_2=number_slider_2,
    Hour_2=12,
    Climate_Occ=0,
    Climate_RadParam="-ab 2 -ad 1000 -as 20 -ar 300 -aa 0.1",
    DF_RadParam="-ab 2 -ad 1000 -as 20 -ar 300 -aa 0.1",
    DimIrr=200,
    DirIrr=800,
    Ill_RadParam="-ab 2 -ad 1000 -as 20 -ar 300 -aa 0.1",
    Insol_CustomDates=False,
    Insol_EndDay=30,
    Insol_EndMonth=11,
    Insol_RadParam="-ab 2 -ad 1000 -as 20 -ar 300 -aa 0.1",
    Insol_StartDay=0,
    Insol_StartMonth=0,
    Insol_Vis_RadParam="-ab 2 -ad 1000 -as 20 -ar 300 -aa 0.1",
    InsolationPeriod=0,
    Irr_FC_legend_max="auto",
    Light_Operation=3,
    Lighting_Param="-W 250.0 -Set 300 -Loss 20 -Standby 0.0",
    Location="USA_CA_San.Francisco.Intl.AP.724940_TMY3.epw",
    Lum_FC_legend_max="auto",
    MDH_Input=True,
    MinIll=300,
    OutputStates=True,
    Quality=0,
    Rhino_Include=False,
    SimulationType=3,
    SkyCond=0,
    StartDay=20,
    StartHour=11,
    StartMonth=8,
    Vis_RadParam="-ps 8 -pt .15 -pj .6 -dj 0 -ds .5 -dt .5 -dc .25 -dr 0 -dp 64 -st .85 -ab 2 -aa .25 -ar 16 -ad 512 -as 128 -lr 4 -lw .05 -av 0 0 0",
    X_Resolution=600,
    Y_Resolution=400)  # -> OutputMessage, MetricIlluminance, OutputMessage_2, MetricIlluminance_2
number_slider_3 = Slider(0, range=0..100)
number_slider_4 = Slider(47208, range=0..100000)
number_slider_5 = Slider(1700, range=0..10000)
number_slider_6 = Slider(63480, range=0..100000)
legend = Legend(
    Toggle=toggle,
    LowerBoundOfLegend=number_slider_4,
    UpperBoundOfLegend=number_slider_6,
    Toggle_2=toggle,
    LowerBoundOfLegend_2=number_slider_4,
    UpperBoundOfLegend_2=number_slider_6,
    GetMetric=1)  # -> LegendPanelGeometry, LegendValues, LegendTextLocation, LegendText, LegendPanelGeometry_2, LegendValues_2, LegendTextLocation_2, LegendText_2
tag = TextTag(Location=legend.LegendTextLocation_2, Text=legend.LegendText_2)
python_2 = PythonScript(IL=diva_daylight.MetricIlluminance_2, period=Slider(3, range=0..10), nodes=grid.AnalysisNodes)  # -> t; inputs IL: list, nodes: list
# ---------- python_2: Python ----------
if nodes != [] and IL != None:
    L = []
    len_nodes = len(nodes)
    for i in range(len_nodes):
        index = int(i+(len_nodes*period))
        L.append(IL[index])
    
    t = L
# ---------- end python_2 ----------
sort = SortList(Keys=python_2)  # -> Keys, ValuesA
panel = Panel(sort.Keys)
gradient = Gradient(
    LowerLimit=number_slider_4,
    UpperLimit=number_slider_6,
    Parameter=python_2,
    stops=[0: RGB(255, 255, 255), 1: RGB(0, 102, 255)])
preview = CustomPreview(Geometry=grid.AnalysisMeshes, Shader=gradient)
