# Grasshopper definition gh_template_energy_health_005_SV.gh (Grasshopper 0.9.76)
# plug-ins: Python Interpreter

# ----
# Set ASHRAE, Building Program
ashrae_standard = ValueList({"ASHRAE 90.1-2013(I-P)": "ASHRAE 90.1", "ASHRAE 188-2015": 2, "ASHRAE 189.1-2014": 3}, selected="ASHRAE 90.1-2013(I-P)")
bldgprograms = Honeybee_bldgPrograms({"Office": 0, "Retail": 1, "MidriseApartment": 2, "PrimarySchool": 3, "SecondarySchool": 4, "SmallHotel": 5, "LargeHotel": 6, "Hospital": 7, "Outpatient": 8, "Warehouse": 9, "SuperMarket": 10, "FullServiceRestaurant": 11, "QuickServiceRestaurant": 12}, selected="PrimarySchool")

# ----
# Bld Parameters
classroom_rotation = Slider(228, range=0..360)
# Sprout Space Relocatable Classroom
# This definition generates a Sprout Space Classroom massing with
# the required DSC challenge outputs for Daylight and Energy Analysis.
# This definition is work in progress.
classroom_width = Slider(17.026, range=10..24)
classroom_height = Slider(10, range=10..15)
classroom_length = Slider(42, range=32..42)
classroom_offset = Slider(28, range=0..80)

# ----
# MATERIAL FOR ENERGY
# EPW file url
panel = Panel("https://www.energyplus.net/weather-download/north_and_central_america_wmo_region_4/USA/PA/USA_PA_Philadelphia.Intl.AP.724080_TMY3/all")

# ----
# Roof Parameters
roof_angle = Slider(16, range=0..30)
overhang_depth = Slider(2, range=0..2)
roof_facia = Slider(0.556, range=0..2)

# ----
# Cler Parameters
clerestory_spacing = Slider(0.686, range=0..1)
number_of_panes = Slider(7, range=1..12)
clerestory_width = Slider(4, range=0..6)
clerestory_height = ValueList({"10%": 10, "15%": 15, "20%": 20, "25%": 25, "30%": 30, "35%": 35, "40%": 40, "45%": 45, "50%": 50, "55%": 55, "60%": 60, "65%": 65, "70%": 70, "75%": 75}, selected="40%")

# ----
# Wall Parameters
wwr_front = Slider(0.791, range=0.1..1)
wwr_right = Slider(0.44, range=0.1..1)
wwr_left = Slider(0.793, range=0.1..1)
wwr_back = Slider(0.648, range=0.1..1)

sprout_space_generator = SPROUTSPACEGENERATOR(
    classroom_width=classroom_width,
    classroom_length=classroom_length,
    classroom_height=classroom_height,
    classroom_offset=classroom_offset,
    classroom_rotation=classroom_rotation,
    wwr_front=wwr_front,
    wwr_back=wwr_back,
    wwr_left=wwr_left,
    wwr_right=wwr_right,
    roof_angle=roof_angle,
    overhang_depth=overhang_depth,
    facia_height=roof_facia,
    B=clerestory_width,
    V=clerestory_height,
    B_2=clerestory_spacing,
    C=number_of_panes)  # -> wwr_front_2, wwr_back_2, wwr_left_2, wwr_right_2, wwr_total, front_angle_from_north, building_depth, building_length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
panel_2 = Panel(sprout_space_generator.wwr_front_2)
panel_3 = Panel(sprout_space_generator.wwr_back_2)
panel_4 = Panel(sprout_space_generator.wwr_left_2)
panel_5 = Panel(sprout_space_generator.wwr_right_2)
panel_6 = Panel(sprout_space_generator.wwr_total)
panel_7 = Panel(sprout_space_generator.front_angle_from_north)
panel_8 = Panel(sprout_space_generator.building_depth)
panel_9 = Panel(sprout_space_generator.building_length)
panel_10 = Panel(sprout_space_generator.buliding_height)
geometry = Geometry(sprout_space_generator.geometry)
wires = BrepWireframe(Brep=geometry, Density=-1)
geo = Geometry(sprout_space_generator.floor_surface_3)
geo_2 = Geometry(sprout_space_generator.all_windows_4)
preview = CustomPreview(Geometry=geo_2, Shader=ColourSwatch(SwatchColor=RGBA(165, 235, 255, 67)))
preview_2 = CustomPreview(Geometry=wires, Shader=ColourSwatch(SwatchColor=RGB(255, 255, 255)))

# ----
# MATERIAL HEALTH
# Weight the Health
# Endpoints/Hazards
number_slider = Slider(0, range=0..100)
number_slider_2 = Slider(0, range=0..100)

open_epw_stat = Ladybug_OpenEPWAndSTATWeatherFiles(weatherFileURL=panel)  # -> epwFile, statFile; plug-in component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
ladybug = Ladybug_Ladybug()  # -> Vviiiiiiiiiizzz; plug-in component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
honeybee = Honeybee_Honeybee()  # -> Vviiiiiiiiiizzz; plug-in component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
stat2zone = PythonScript(statFile=open_epw_stat.statFile, run=Toggle(True))  # -> climateZone
# ---------- stat2zone: Python ----------
if run:
    f = open(statFile,'r')
    L = f.readlines()
    f.close()
    
    climateZone = None
    for i,line in enumerate(L):
        if "Climate type" in line and "ASHRAE" in line:
            climateZone = "ClimateZone "+ line.split(" ")[4][1:3]
    
    print climateZone
# ---------- end stat2zone ----------
endpoint_ranking = PythonScript(
    Cancer=number_slider_2,
    Developmental=number_slider,
    Endocrine=number_slider_2,
    EyeIrritation=number_slider_2,
    Mammalian=number_slider_2,
    Mutagenicity=number_slider_2,
    Neurotoxicity=number_slider_2,
    OrganToxicant=number_slider_2,
    Reproductive=number_slider_2,
    SkinIrritation=number_slider_2,
    SkinSensitization=number_slider_2,
    CancerOccupationOnly=number_slider_2,
    PBT=number_slider_2,
    Respiratory=Slider(100, range=0..100))  # -> EndPointRank
# ---------- endpoint_ranking: Python ----------
def normalize_list(lov,hibound,lobound):
        """normalized_val = ( (val-min)*(hibound-lobound) )/(max-min) + lobound"""
        max_ = max(lov)
        min_ = min(lov)
        L = []
        
        for i,v in enumerate(lov):
            norm_val = ((hibound-lobound)*(v-min_))/(max_-min_) + lobound
            L.append(norm_val)
        return L

L = [Cancer,Developmental,Endocrine,EyeIrritation,Mammalian,Mutagenicity,Neurotoxicity,OrganToxicant,Reproductive,SkinIrritation,SkinSensitization,CancerOccupationOnly,PBT,Respiratory]
L = map(lambda e: e/100.,L)
EndPointRank = L#normalize_list(L,1.,0)
print L
# ---------- end endpoint_ranking ----------

# ----
# Calculate Weighted
# Material Selection
health_interface = PythonScript(
    AllWindows=sprout_space_generator.all_windows_4,
    AllWalls=sprout_space_generator.all_walls_4,
    RoofPlane=sprout_space_generator.roof_plane_bottom,
    FloorSurface=sprout_space_generator.floor_surface_4,
    InteriorPartition=sprout_space_generator.interior_partition_2,
    EndPointRank=endpoint_ranking,
    run=Toggle(True))  # -> pie, txt; inputs AllWindows: list, AllWalls: list, RoofPlane: list, FloorSurface: list, InteriorPartition: list, EndPointRank: list
# ---------- health_interface: Python ----------
import rhinoscriptsyntax as rs
import ghpythonlib.components as ghcomp


def hazard4material(material_lst,ranklst):
    dev_weight = ranklst[1]
    resp_weight = ranklst[13]
    option_lst = []
    for material_pct in material_lst:
        dev_num = material_pct[1] * dev_weight
        resp_num = material_pct[2] * resp_weight
        hazard4material = dev_num + resp_num
        option_lst.append(hazard4material)
        print material_pct[0],':', hazard4material
        print dev_num, ' ', resp_num
    index_of_minimum_option = option_lst.index(min(option_lst))
    return index_of_minimum_option

def volume_geoms(lstofgeoms):
    areasum = 0.
    #cptlst = []
    for geom in lstofgeoms:
        geom = rs.coercebrep(geom)
        sol = ghcomp.Area(geom)
        areasum += sol[0]
        #cptlst.append(sol[1])
    return areasum#, cptlst

def generate_txtlst(dev,res):
    L = []
    for d in range(int(dev)):
        L.append("Development")
    for r in range(int(res)):
        L.append("Respiratory")
    return L

LstWoodSheath = [["Oriented strandboard",0.03750,0.03750],["Medium Density Fiberboard (MDF)",1,1]]
LstWaterProof = [["Vapor Barrier",0.01030,0.0983]]
LstFlooring =[["Acrylic Flooring Adhesive",0.03750,0.05750],["Epoxy flooring adhesive",0.02750,0.04750],["Polyurethane flooring adhesive",0.05750,0.00750]]

LstJointSealant = [["IGU Silicone Sealant",0.03,0.01]]
LstGlassGlazing = [["Double Pane IGU",0.039,0.08660],["Laminated Glass",0.115,0.0136]]

LstFloor = [LstWoodSheath,LstWaterProof,LstFlooring]
LstWindow = [LstJointSealant,LstGlassGlazing]

if run:
    #health_ratio: material_pct * (1 - health_profile_rank/100.) * volume
    
    development = 0.
    respiratory = 0.
    hazard_lst = []
    selection_str = ''
    
    ### Floor
    sumfloor = volume_geoms(FloorSurface)
    hstr_floor = ''
    for lstfloorcomp in LstFloor:
        min_index = hazard4material(lstfloorcomp,EndPointRank)
        development += lstfloorcomp[min_index][1] * sumfloor
        respiratory += lstfloorcomp[min_index][2] * sumfloor
        print '---'
        print 'selection:', lstfloorcomp[min_index][0]
        print ''
        hstr_floor += '\n' + lstfloorcomp[min_index][0] + \
        '\n \t \tD: ' + str(lstfloorcomp[min_index][1]) + \
        '\n \t \tR: ' + str(lstfloorcomp[min_index][2])
    
    
    ###Window
    sumwindow = volume_geoms(AllWindows)
    hstr_window = ''
    for lstwindowcomp in LstWindow:
        min_index = hazard4material(lstwindowcomp,EndPointRank)
        development += lstwindowcomp[min_index][1] * sumwindow
        respiratory += lstwindowcomp[min_index][2] * sumwindow
        print '---'
        print 'selection:', lstwindowcomp[min_index][0]
        print ''
        hstr_window += '\n' + lstwindowcomp[min_index][0] + \
        '\n \t \tD: ' + str(lstwindowcomp[min_index][1]) + \
        '\n \t \tR: ' + str(lstwindowcomp[min_index][2])
    
    
    
    
    selection_str += "FLOORSURFACE MATERIALS:"
    selection_str += hstr_floor
    selection_str += "\n\nALLWINDOW MATERIALS:"
    selection_str += hstr_window
    hazard_lst.append(selection_str)

    pie = generate_txtlst(development,respiratory)
    txt = hazard_lst
# ---------- end health_interface ----------

panel_11 = Panel(health_interface.txt)
pie = PieChart(health_interface.pie)
bldgprograms_2 = Honeybee_bldgPrograms({"Office": 0, "Retail": 1, "MidriseApartment": 2, "PrimarySchool": 3, "SecondarySchool": 4, "SmallHotel": 5, "LargeHotel": 6, "Hospital": 7, "Outpatient": 8, "Warehouse": 9, "SuperMarket": 10, "FullServiceRestaurant": 11, "QuickServiceRestaurant": 12}, selected="PrimarySchool")
panel_12 = Panel("EXTROOF ATTICFLOOR")
# Set Bld Materials by Zones and ASHRAE Standards
# Inputs: EPW, ASHRAE Standard, Program
# Outputs: EnergyPlus Construction, Program Zones
panel_13 = Panel(stat2zone)
listzoneprograms = Honeybee_ListZonePrograms(bldgProgram=bldgprograms)  # -> PrimarySchoolZonePrograms; plug-in component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
# This component will extract Energy Plus Construction Material from OpenStudio_Standards.json
callfromepconstrlibrary = Honeybee_CallFromEPConstructionLibrary(ClimateZone=[panel_13, ashrae_standard], ASHRAEStandard="ASHRAE 90.1", BuildingProgram=bldgprograms_2)  # -> WALL, UndergroundWall, ROOF, UndergroundCeiling, FLOOR, UndergroundSlab, SlabOnGrade, ExposedFloor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; plug-in component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
callfromlibrary = Honeybee_CallFromRadianceLibrary(keywords="Exterior_Wall")  # -> materials; plug-in component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
item = ListItem(List=listzoneprograms, Index=Slider(6, range=0..10), Wrap=True)
panel_14 = Panel(item)
panel_15 = Panel(listzoneprograms)

# ----
# Create HBSurfs
panel_16 = Panel("3")
createhbsrfs = Honeybee_createHBSrfs(srfType="2", EPConstruction=callfromlibrary)  # -> readMe, simplify(HBSurface); inputs geometry: GeometryBase
#   port geometry: List of Breps
# ---------- createhbsrfs: Python ----------
print ''
# ---------- end createhbsrfs ----------
createhbsrfs_2 = Honeybee_createHBSrfs(geometry=flatten(sprout_space_generator.interior_partition_2), srfType="4")  # -> readMe, simplify(HBSurface); plug-in component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
createhbsrfs_3 = Honeybee_createHBSrfs(geometry=sprout_space_generator.roof_plane_bottom, srfType=panel_16)  # -> readMe, simplify(HBSurface); plug-in component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
createhbsrfs_4 = Honeybee_createHBSrfs(geometry=sprout_space_generator.all_walls_4, srfType="0", EPConstruction=callfromlibrary)  # -> readMe, simplify(HBSurface); inputs geometry: GeometryBase
#   port geometry: List of Breps
# ---------- createhbsrfs_4: Python ----------
print 'wip'
# ---------- end createhbsrfs_4 ----------
addhbglz = Honeybee_addHBGlz(HBObj=createhbsrfs_4.HBSurface, childSurfaces=flatten(sprout_space_generator.all_windows_4))  # -> simplify(HBObjWGLZ); plug-in component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

brep = Brep(flatten([createhbsrfs_2.HBSurface, createhbsrfs.HBSurface, createhbsrfs_3.HBSurface, addhbglz, createhbsrfs_4.HBSurface]))
createhbzones = Honeybee_createHBZones(name="sproutspace", zoneProgram=item, HBSurfaces=flatten(brep), isConditioned=True)  # -> readMe, HBZone; disabled; plug-in component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

# ----
# ENERGY ANALYSIS
toggle = BooleanToggle(False)  # disabled
epoutput = Honeybee_GenerateEPOutput(
    zoneEnergyUse=toggle,
    zoneGainsAndLosses="False",
    zoneComfortMetrics="False",
    surfaceTempAnalysis="False",
    timestep="monthly")  # -> report, flatten(simulationOutputs); disabled; plug-in component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
toggle_2 = BooleanToggle(False)  # disabled
runenergysimulation = Honeybee_RunEnergySimulation(
    epwFile=open_epw_stat.epwFile,
    HBZones=flatten(createhbzones.HBZone),
    simulationOutputs=flatten(epoutput.simulationOutputs),
    writeIdf=toggle_2,
    runEnergyPlus=toggle_2)  # -> report, idfFileAddress, resultFileAddress; disabled; plug-in component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
readepresult = Honeybee_ReadEPResult(resultFileAddress=runenergysimulation.resultFileAddress)  # -> totalThermalEnergy, thermalEnergyBalance, cooling, heating, electricLight, electricEquip, fanElectric, pumpElectric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; disabled; plug-in component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

# ----
# DATA VISUALIZATION:
# ENERGY
panel_17 = Panel("""Cooling, Heating
& Lighting Loads""")  # disabled
panel_18 = Panel("20, 0, 0")  # disabled
separatedata = Ladybug_SeparateData(inputList=flatten(readepresult.heating))  # -> numbers, strings; disabled; plug-in component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
number_slider_3 = Slider(0.5, range=0..1)  # disabled
separatedata_2 = Ladybug_SeparateData(inputList=flatten(readepresult.cooling))  # -> numbers, strings; disabled; plug-in component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
number_slider_4 = Slider(0.7, range=0..1)  # disabled
ma = MassAddition(Input=separatedata_2.numbers)  # -> Result, PartialResults; disabled
ma_2 = MassAddition(Input=separatedata.numbers)  # -> Result, PartialResults; disabled
barchart = Ladybug_MonthlyBarChart(
    inputData=flatten([readepresult.cooling, readepresult.electricLight, readepresult.heating]),
    altYAxisTitle=panel_17,
    basePoint=panel_18,
    xScale=number_slider_3,
    yScale=number_slider_4)  # -> readMe, dataMesh, dataCurves, dataCrvColors, graphAxes, graphLabels, title, titleBasePt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; disabled; plug-in component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
total_cooling = Panel(ma.Result)  # disabled
total_heating = Panel(ma_2.Result)  # disabled

# ==== cluster SPROUTSPACEGENERATOR
classroom_width = ClusterInput()
classroom_length = ClusterInput()
classroom_height = ClusterInput()
classroom_offset = ClusterInput()
classroom_rotation = ClusterInput()
wwr_front = ClusterInput()
wwr_back = ClusterInput()
wwr_left = ClusterInput()
wwr_right = ClusterInput()
roof_angle = ClusterInput()
overhang_depth = ClusterInput()
facia_height = ClusterInput()
B = ClusterInput()
V = ClusterInput()
B_2 = ClusterInput()
C = ClusterInput()
num = Number(classroom_length)
num_2 = Number(classroom_rotation)

pt = ConstructPoint(XCoordinate=0, YCoordinate=0, ZCoordinate=0)
pt_2 = ConstructPoint(XCoordinate=classroom_width, YCoordinate=num, ZCoordinate=classroom_height)

box = Box2Pt(PointA=pt, PointB=pt_2, Plane=PlaneXY(0, 0, 0))
debrep = DeconstructBrep(Brep=box)  # -> Faces, Edges, Vertices
bottom = ListItem(List=debrep.Faces, Index=4, Wrap=True)
top = ListItem(List=debrep.Faces, Index=5, Wrap=True)
front = ListItem(List=debrep.Faces, Index=1, Wrap=True)
back = ListItem(List=debrep.Faces, Index=3, Wrap=True)
left = ListItem(List=debrep.Faces, Index=0, Wrap=True)
right = ListItem(List=debrep.Faces, Index=2, Wrap=True)
area = Area(Geometry=front)  # -> Area, Centroid
area_2 = Area(Geometry=back)  # -> Area, Centroid
area_3 = Area(Geometry=left)  # -> Area, Centroid
area_4 = Area(Geometry=right)  # -> Area, Centroid
scale = Scale(Geometry=front, Center=area.Centroid, Factor=wwr_front)  # -> Geometry, Transform
scale_2 = Scale(Geometry=back, Center=area_2.Centroid, Factor=wwr_back)  # -> Geometry, Transform
scale_3 = Scale(Geometry=left, Center=area_3.Centroid, Factor=wwr_left)  # -> Geometry, Transform
scale_4 = Scale(Geometry=right, Center=area_4.Centroid, Factor=wwr_right)  # -> Geometry, Transform
debrep_2 = DeconstructBrep(Brep=top)  # -> Faces, Edges, Vertices
remap = RemapNumbers(Value=roof_angle, Source=Domain(0, 30), Target=Domain(0, 6.928))  # -> Mapped, Clipped
Z = UnitZ(Factor=remap.Mapped)
pt_3 = Point(debrep_2.Vertices)
item = ListItem(List=debrep_2.Edges, Index=3, Wrap=True)
item_2 = ListItem(List=debrep_2.Vertices, Index=[2, 1], Wrap=True)
front_wall_line = ListItem(List=debrep_2.Edges, Index=1, Wrap=True)
right_wall_line = ListItem(List=debrep_2.Edges, Index=2, Wrap=True)
left_wall_line = ListItem(List=debrep_2.Edges, Index=4, Wrap=True)
move = Move(Geometry=item_2, Motion=Z)  # -> Geometry, Transform
item_3 = ListItem(List=pt_3, Index=2, Wrap=True)
item_4 = ListItem(List=pt_3, Index=1, Wrap=True)
end = EndPoints(Curve=item)  # -> Start, End
fline = FitLine(Points=move.Geometry)
end_2 = EndPoints(Curve=fline)  # -> Start, End
ln = Line(StartPoint=end_2.Start, EndPoint=end.Start)
ln_2 = Line(StartPoint=end.End, EndPoint=end_2.End)
merge = Merge(Data1=ln, Data2=fline, Data3=ln_2)
join = JoinCurves(Curves=merge, Preserve=False)
Z_2 = UnitZ(Factor=1)
offset = Offset(Curve=join, Distance=overhang_depth, Plane=PlaneXY(0, 0, 0), Corners=1)

project = ProjectPoint(Point=item_2, Direction=Z_2, Geometry=join)  # -> Point, Index
item_5 = ListItem(List=project.Point, Index=0, Wrap=True)
item_6 = ListItem(List=project.Point, Index=1, Wrap=True)
ln_3 = Line(StartPoint=item_3, EndPoint=item_5)
ln_4 = Line(StartPoint=item_6, EndPoint=item_4)
ln_5 = Line(StartPoint=item_5, EndPoint=item_6)
join_2 = JoinCurves(Curves=[ln, right_wall_line, ln_3], Preserve=False)
join_3 = JoinCurves(Curves=[ln_5, front_wall_line, ln_4, ln_3], Preserve=False)
join_4 = JoinCurves(Curves=[ln_4, ln_2, left_wall_line], Preserve=False)
left_cleristory = BoundarySurfaces(Edges=join_4)
right_cleristory = BoundarySurfaces(Edges=join_2)
front_cleristory = BoundarySurfaces(Edges=join_3)

end_3 = EndPoints(Curve=offset)  # -> Start, End
ln_6 = Line(StartPoint=end_3.Start, EndPoint=end_3.End)
join_5 = JoinCurves(Curves=[ln_6, offset], Preserve=False)
Z_3 = UnitZ(Factor=facia_height)
boundary = BoundarySurfaces(Edges=join_5)
roof_surface = Move(Geometry=boundary, Motion=Z_3)  # -> Geometry, Transform
parapet = Extrude(Base=join_5, Direction=Z_3)
roof = Merge(Data1=boundary, Data2=roof_surface.Geometry, Data3=parapet)

eval = EvaluateCurve(Curve=ln_4, Parameter=0.5)  # -> Point, Tangent, Angle
addition = Addition(A=B, B=B_2)
len = Length(Curve=ln_4)
dist = Distance(PointA=item_4, PointB=eval.Point)
remap_2 = RemapNumbers(Value=V, Source=Domain(0, 75), Target=Domain(0, 0.75))  # -> Mapped, Clipped
multiplication = Multiplication(A=len, B=remap_2.Mapped)
division = Division(A=dist, B=2)
vec = VectorXYZ(XComponent=0, YComponent=B, ZComponent=multiplication)  # -> Vector, Length
move_2 = Move(Geometry=item_4, Motion=vec.Vector)  # -> Geometry, Transform
yz = YZPlane(Origin=item_3)
rec_2pt = Rectangle2Pt(Plane=yz, PointA=item_4, PointB=move_2.Geometry, Radius=0)  # -> Rectangle, Length
boundary_2 = BoundarySurfaces(Edges=rec_2pt.Rectangle)
Z_4 = UnitZ(Factor=division)
move_3 = Move(Geometry=boundary_2, Motion=Z_4)  # -> Geometry, Transform
series = Series(Start=0, Step=addition, Count=C)
Y = UnitY(Factor=series)
move_4 = Move(Geometry=move_3.Geometry, Motion=Y)  # -> Geometry, Transform
lng = ListLength(List=series)
group = Group(Objects=move_4.Geometry)
item_7 = ListItem(List=series, Index=expr("X-1", lng), Wrap=True)
addition_2 = Addition(A=item_7, B=B)
subtraction = Subtraction(A=classroom_length, B=addition_2)
Y_2 = UnitY(Factor=expr("X/2", subtraction))
move_5 = Move(Geometry=group, Motion=Y_2)  # -> Geometry, Transform
panel = Panel(Y_2)

number_slider = Slider(180, range=0..180)
merge_2 = Merge(Data1=scale.Geometry, Data2=scale_3.Geometry, Data3=scale_4.Geometry, Data4=move_5.Geometry)
merge_3 = Merge(
    Data1=left_cleristory,
    Data2=right_cleristory,
    Data3=front_cleristory,
    Data4=roof,
    Data5=front,
    Data6=back,
    Data7=left,
    Data8=right)
geo = Geometry([merge_3, merge_2])
Y_3 = UnitY(Factor=classroom_offset)
rotate = Rotate(Geometry=geo, Angle=degrees(number_slider), Plane=PlaneXY(0, 0, 0))  # -> Geometry, Transform
move_6 = Move(Geometry=rotate.Geometry, Motion=Y_3)  # -> Geometry, Transform
merge_4 = Merge(Data1=geo, Data2=move_6.Geometry)  # -> flatten(Result)

# ----
# Bounding Box and Center Plane
group_2 = Group(Objects=flatten(merge_4))
bbox = BoundingBox(Content=group_2, Plane=PlaneXY(0, 0, 0))  # -> Box, Box_2
volume = Volume(Geometry=bbox.Box)  # -> Volume, Centroid
debrep_3 = DeconstructBrep(Brep=bbox.Box)  # -> Faces, Edges, Vertices
xy = XYPlane(Origin=volume.Centroid)

all_walls = ListItem(List=merge_4, Index=[0, 1, 2, 3, 7, 8, 9, 10, 16, 17, 19, 20, 18, 21], Wrap=True)
bld_2_walls = ListItem(List=all_walls, Index=[4, 5, 6, 7, 10, 11, 13], Wrap=True)
bld_1_walls = ListItem(List=all_walls, Index=[0, 1, 2, 3, 8, 9, 12], Wrap=True)
item_8 = ListItem(List=bld_1_walls, Index=Slider(1, range=0..20), Wrap=True)
item_9 = ListItem(List=bld_2_walls, Index=Slider(1, range=0..20), Wrap=True)
debrep_4 = DeconstructBrep(Brep=item_8)  # -> Faces, Edges, Vertices
debrep_5 = DeconstructBrep(Brep=item_9)  # -> Faces, Edges, Vertices
join_6 = JoinCurves(Curves=debrep_4.Edges, Preserve=False)
join_7 = JoinCurves(Curves=debrep_5.Edges, Preserve=False)
rint = RegionIntersection(CurvesA=join_6, CurvesB=join_7)
srfsplit = SurfaceSplit(Surface=[bld_1_walls, item_9], Curves=rint)  # -> flatten(Fragments)
item_10 = ListItem(List=srfsplit, Index=Slider(9, range=0..20), Wrap=True)
item_11 = ListItem(List=srfsplit, Index=Slider(14, range=0..20), Wrap=True)
bld_2_walls_2 = ListItem(List=all_walls, Index=[4, 6, 7, 10, 11, 13], Wrap=True)
bld_1_walls_2 = ListItem(List=all_walls, Index=[0, 2, 3, 8, 9, 12], Wrap=True)

# ----
# Front Angle from North
X = UnitX(Factor=num)
move_7 = Move(Geometry=volume.Centroid, Motion=X)  # -> Geometry, Transform
vec2pt = Vector2Pt(PointA=volume.Centroid, PointB=move_7.Geometry, Unitize=False)  # -> Vector, Length
moving_vector = Rotate(Geometry=vec2pt.Vector, Angle=degrees(num_2), Plane=xy)  # -> Geometry, Transform
fixed_vector = Vector2Pt(PointA=volume.Centroid, PointB=move_7.Geometry, Unitize=False)  # -> Vector, Length
angle = Angle(VectorA=moving_vector.Geometry, VectorB=fixed_vector.Vector)  # -> Angle, Reflex
deg = Degrees(Radians=angle.Angle)

# ----
# Floor Planes
rotate_2 = Rotate(Geometry=bottom, Angle=degrees(num_2), Plane=xy)  # -> Geometry, Transform
rotate_3 = Rotate(Geometry=rotate_2.Geometry, Angle=degrees(number_slider), Plane=PlaneXY(0, 0, 0))  # -> Geometry, Transform
move_8 = Move(Geometry=rotate_3.Geometry, Motion=Y_3)  # -> Geometry, Transform
merge_5 = Merge(Data1=rotate_2.Geometry, Data2=move_8.Geometry)

# ----
# Dimensions
item_12 = ListItem(List=debrep_3.Edges, Index=0, Wrap=True)
item_13 = ListItem(List=debrep_3.Edges, Index=1, Wrap=True)
item_14 = ListItem(List=debrep_3.Edges, Index=9, Wrap=True)
len_2 = Length(Curve=item_12)
len_3 = Length(Curve=item_13)
len_4 = Length(Curve=item_14)

# ----
# All Walls
bld_2_walls_3 = Merge(Data1=item_10, Data2=bld_2_walls_2)
# Building Geometry
bld_1_walls_3 = Merge(Data1=item_11, Data2=bld_1_walls_2)
all_walls_2 = Merge(Data1=bld_1_walls_3, Data2=bld_2_walls_3)
front_walls = ListItem(List=all_walls_2, Index=[1, 6, 7], Wrap=True)
left_walls = ListItem(List=all_walls_2, Index=[2, 10, 4, 12], Wrap=True)
back_walls = ListItem(List=all_walls_2, Index=[8, 13, 14], Wrap=True)
right_walls = ListItem(List=all_walls_2, Index=[3, 9, 5, 11], Wrap=True)

# ----
# All Windows
all_windows = ListItem(List=merge_4, Index=[4, 5, 6, 11, 12, 13, 14, 15], Wrap=True)
bld_2_windw = ListItem(List=all_windows, Index=[3, 4, 5, 7], Wrap=True)
bld_1_windw = ListItem(List=all_windows, Index=[0, 1, 2, 6], Wrap=True)
all_windows_2 = Merge(Data1=bld_1_windw, Data2=bld_2_windw)
right_wndws = ListItem(List=all_windows_2, Index=[2, 5], Wrap=True)
left_wndws = ListItem(List=all_windows_2, Index=[6, 9], Wrap=True)
back_wndws = ListItem(List=all_windows_2, Index=[12, 15], Wrap=True)
front_wndws = ListItem(List=all_windows_2, Index=[0, 11], Wrap=True)

# ----
# All Roof
all_roof = ListItem(List=merge_4, Index=[22, 23, 24, 25, 26, 27], Wrap=True)
item_15 = ListItem(List=all_roof, Index=[0, 1, 2], Wrap=True)
item_16 = ListItem(List=all_roof, Index=[3, 4, 5], Wrap=True)
roof_1 = BrepJoin(Breps=item_15)  # -> Breps, Closed
roof_2 = BrepJoin(Breps=item_16)  # -> Breps, Closed

merge_6 = Merge(
    Data1=front_walls,
    Data2=back_walls,
    Data3=left_walls,
    Data4=right_walls,
    Data5=front_wndws,
    Data6=back_wndws,
    Data7=left_wndws,
    Data8=right_wndws,
    Data9=item_15,
    Data10=item_16)

# ----
# WWR Calculation_Right
ungroup = Ungroup(Group=right_wndws)
area_5 = Area(Geometry=right_walls)  # -> flatten(Area), Centroid
area_6 = Area(Geometry=ungroup)  # -> flatten(Area), Centroid
wall_area = MassAddition(Input=area_5.Area)  # -> Result, PartialResults
wndw_area = MassAddition(Input=area_6.Area)  # -> Result, PartialResults
division_2 = Division(A=wndw_area.Result, B=wall_area.Result)

# ----
# WWR Calculation_Left
ungroup_2 = Ungroup(Group=left_wndws)
area_7 = Area(Geometry=left_walls)  # -> flatten(Area), Centroid
area_8 = Area(Geometry=ungroup_2)  # -> flatten(Area), Centroid
wall_area_2 = MassAddition(Input=area_7.Area)  # -> Result, PartialResults
wndw_area_2 = MassAddition(Input=area_8.Area)  # -> Result, PartialResults
division_3 = Division(A=wndw_area_2.Result, B=wall_area_2.Result)

# ----
# WWR Calculation_Back
ungroup_3 = Ungroup(Group=back_wndws)
area_9 = Area(Geometry=back_walls)  # -> flatten(Area), Centroid
area_10 = Area(Geometry=ungroup_3)  # -> flatten(Area), Centroid
wall_area_3 = MassAddition(Input=area_9.Area)  # -> Result, PartialResults
wndw_area_3 = MassAddition(Input=area_10.Area)  # -> Result, PartialResults
division_4 = Division(A=wndw_area_3.Result, B=wall_area_3.Result)

# ----
# WWR Calculation
# WWR Calculation_Front
ungroup_4 = Ungroup(Group=front_wndws)
area_11 = Area(Geometry=front_walls)  # -> flatten(Area), Centroid
area_12 = Area(Geometry=ungroup_4)  # -> flatten(Area), Centroid
wall_area_4 = MassAddition(Input=area_11.Area)  # -> Result, PartialResults
wndw_area_4 = MassAddition(Input=area_12.Area)  # -> Result, PartialResults
division_5 = Division(A=wndw_area_4.Result, B=wall_area_4.Result)

# ----
# WWR Calculation_TOTAL
ungroup_5 = Ungroup(Group=all_windows_2)
area_13 = Area(Geometry=ungroup_5)  # -> flatten(Area), Centroid
area_14 = Area(Geometry=all_walls_2)  # -> flatten(Area), Centroid
total_wall = MassAddition(Input=area_14.Area)  # -> Result, PartialResults
total_wndw = MassAddition(Input=area_13.Area)  # -> Result, PartialResults
division_6 = Division(A=total_wndw.Result, B=total_wall.Result)

item_17 = ListItem(List=srfsplit, Index=2, Wrap=True)
rotate_4 = Rotate(Geometry=merge_6, Angle=degrees(num_2), Plane=xy)  # -> Geometry, Transform
rotate_5 = Rotate(Geometry=item_17, Angle=degrees(num_2), Plane=xy)  # -> Geometry, Transform
join_8 = BrepJoin(Breps=merge_5)  # -> Breps, Closed
range = Range(Domain=Domain(0, 13), Steps=14)
range_2 = Range(Domain=Domain(14, 21), Steps=8)
interior_partition = Geometry(rotate_5.Geometry)
v_spectral_outputs_v = Data()
offset_windows = Geometry()
floor_surface = Geometry(merge_5)
room_volume_1 = Geometry()
room_volume_2 = Geometry()
floor_surface_2 = Geometry(join_8.Breps)
v_energy_outputs_v = Data()
roof_bottom_plane = ListItem(List=rotate_4.Geometry, Index=[22, 25], Wrap=True)
all_walls_3 = ListItem(List=rotate_4.Geometry, Index=range, Wrap=True)
all_windows_3 = ListItem(List=rotate_4.Geometry, Index=range_2, Wrap=True)
ungroup_6 = Ungroup(Group=all_windows_3)  # -> flatten(Objects)
interior_partition_2 = ClusterOutput(interior_partition)
v_spectral_outputs_v_2 = ClusterOutput(v_spectral_outputs_v)
offset_windows_2 = ClusterOutput(offset_windows)
floor_surface_3 = ClusterOutput(floor_surface)
room_volume_1_2 = ClusterOutput(room_volume_1)
room_volume_2_2 = ClusterOutput(room_volume_2)
floor_surface_4 = ClusterOutput(floor_surface_2)
wwr_front_2 = ClusterOutput(division_5)
wwr_back_2 = ClusterOutput(division_4)
wwr_left_2 = ClusterOutput(division_3)
wwr_right_2 = ClusterOutput(division_2)
wwr_total = ClusterOutput(division_6)
front_angle_from_north = ClusterOutput(classroom_rotation)
building_depth = ClusterOutput(len_2)
building_length = ClusterOutput(len_3)
buliding_height = ClusterOutput(len_4)
geometry = ClusterOutput(rotate_4.Geometry)
v_energy_outputs_v_2 = ClusterOutput(v_energy_outputs_v)
all_walls_4 = ClusterOutput(all_walls_3)
roof_plane_bottom = ClusterOutput(roof_bottom_plane)
all_windows_4 = ClusterOutput(ungroup_6)
