# Grasshopper definition split_bldg_mass_000.gh (Grasshopper 0.9.76)
# plug-ins: Python Interpreter

honeybee = Honeybee_Honeybee()  # -> Vviiiiiiiiiizzz; plug-in component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
ladybug = Ladybug_Ladybug()  # -> Vviiiiiiiiiizzz; plug-in component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
panel = Panel("C:\\Users\\vasanthakumars\\Documents\\GitHub\\Honeybee\\src")
geo = Geometry(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)
vec = VectorXYZ(XComponent=0, YComponent=0, ZComponent=Slider(12, range=0..100))  # -> Vector, Length
boundary = BoundarySurfaces(Edges=geo)
list = ValueList({"dir", "file"}, selected="dir")
list_2 = ValueList({"dir", "file"}, selected="dir")

# ---- group: find directory
bibil = PythonScript(dir=[panel, "C:\\saeran\\master\\git\\Honeybee\\src"], type=list, run=Toggle(True))  # -> dir; inputs dir: list
# ---------- bibil: Python ----------
import os

ghenv.Component.Params.Output[0].Name = "null"
ghenv.Component.Params.Output[0].NickName = "null"

if run:
    confirm_dir = None
    for d in dir:
        try:
            if type == "file":
                file_ = open(d)
                file_.close()
            else:
                print os.listdir(d)
            confirm_dir = d
            break
        except Exception as e:
            #print str(e)
            continue
    if confirm_dir != None:
        ghenv.Component.Params.Output[0].Name = type
        ghenv.Component.Params.Output[0].NickName = type
        dir = confirm_dir
        file = confirm_dir
null = None
# ---------- end bibil ----------

# ----
extr = Extrude(Base=boundary, Direction=vec.Vector)

# ---- group: find directory
bibil_2 = PythonScript(
    dir=["C:\\Users\\vasanthakumars\\Documents\\GitHub\\bibil\\src", "C:\\saeran\\master\\git\\bibil\\src"],
    type=list_2,
    run=Toggle(True))  # -> dir; inputs dir: list; same code as bibil

# ----
python_script = PythonScript(i=bibil)  # -> o
# ---------- python_script: Python ----------
import os

if i:
    o = os.path.join(str(i),"Honeybee_SplitBuildingMass.py")
# ---------- end python_script ----------

# ---- group: 2 floors
geo_2 = Geometry(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)

# ----
python_script_2 = PythonScript(i=bibil_2)  # -> o
# ---------- python_script_2: Python ----------
import os

if i:
    o = os.path.join(str(i),"reference\\python_files\\Honeybee_SplitZones.py")
# ---------- end python_script_2 ----------

# ---- group: grasshope
geo_3 = Geometry([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])

# ----
python_script_3 = PythonScript(i=bibil_2)  # -> o
# ---------- python_script_3: Python ----------
import os

if i:
    o = os.path.join(str(i),"reference\\python_files\\Honeybee_SplitBuildingMass_Ref.py")
# ---------- end python_script_3 ----------

# ---- group: 2 bldgs
geo_4 = Geometry([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])

# ----
geo_5 = Geometry([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])
data = Data("@3")
file = ReadFile(File=python_script, PerLineParse=False)
file_2 = ReadFile(File=python_script_2, PerLineParse=False)
file_3 = ReadFile(File=python_script_3, PerLineParse=False)
data_2 = Data(extr)
wires = BrepWireframe(Brep=data_2, Density=-1)
splitmass = Honeybee_SplitBuildingMass(Code=file, _bldgMasses=data_2, BldgsFlr2FloorHeights_="3@1 @3", _runIt=Toggle(True))  # -> ReadMe, SplitBldgMasses
geo_6 = Geometry(splitmass.SplitBldgMasses)
python = PythonScript(Code=file_2, _bldgMasses=flatten(splitmass.SplitBldgMasses), PerimeterZoneDepth_="@6", _runIt=Toggle(True))  # -> ReadMe, SplitBldgMasses, Debug
panel_2 = Panel(splitmass.SplitBldgMasses)
splitmass_2 = Honeybee_SplitBuildingMass(Code=file_3, _bldgMasses=data_2, BldgsFlr2FloorHeights_="3@1 @3", PerimeterZoneDepth_="@6", _runIt=Toggle(True))  # -> ReadMe, SplitBldgMasses, Debug
geo_7 = Geometry(splitmass_2.Debug)
geo_8 = Geometry(python.Debug)
geo_9 = Geometry(python.SplitBldgMasses)
panel_3 = Panel(python.SplitBldgMasses)
geo_10 = Geometry(splitmass_2.SplitBldgMasses)
panel_4 = Panel(python.Debug)
panel_5 = Panel(splitmass_2.Debug)
