# Grasshopper definition nirvik_tower_seperation_debugging.gh (Grasshopper 0.9.76)
# plug-ins: Python Interpreter

# ---- group: footprint
geo = Geometry(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)

# ---- group: site
geo_2 = Geometry(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)

# ---- group: Total Grid for reference/practise
geo_3 = Geometry([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])

# ---- group: htsrf
geo_4 = Geometry(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)

# ---- group: refsite
geo_5 = Geometry(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)

# ----
python = PythonScript(x=geo_2, y=geo, z=geo_4)  # -> a, c, debug; inputs y: list
# ---------- python: Python ----------
import rhinoscriptsyntax as rs
import math
import operator
import random
import scriptcontext as sc

def eq_dis_tower(crv, a, b, block_dis):
    bb=rs.BoundingBox(crv)
    rs.EnableRedraw(False)
    bb_crv=rs.AddPolyline([bb[0],bb[1],bb[2],bb[3],bb[0]])
    srf=rs.AddPlanarSrf(bb_crv)
    srfUdom=rs.SurfaceDomain(srf,0)
    srfVdom=rs.SurfaceDomain(srf,1)
    umax=srfUdom[1]
    umin=srfUdom[0]
    print block_dis, a, b
    m=((umax-umin)/(a+block_dis))
    ustep=(umax-umin)/m
    vmax=srfVdom[1]
    vmin=srfVdom[0]
    n=((vmax-vmin)/(b+block_dis))
    vstep=((vmax-vmin)/n)
    print m,n
    srf_pts=[]
    cen_pts=[]
    temp_pts=[]
    i=umin
    while(i<umax):
        j=vmin
        while(j<vmax):
            pl=[]
            pts=[]
            pts.append(rs.EvaluateSurface(srf, i, j))
            pts.append(rs.EvaluateSurface(srf, i+ustep, j))
            pts.append(rs.EvaluateSurface(srf, i+ustep, j+vstep))
            pts.append(rs.EvaluateSurface(srf, i, j+vstep))
            pts.append(rs.EvaluateSurface(srf, i, j))
            pl=rs.AddPolyline(pts)
            crvCen=rs.CurveAreaCentroid(pl)[0]
            temp_pts.append(crvCen)
            x=crvCen[0]
            y=crvCen[1]
            srf_pts.append([x,y,0])
            rs.DeleteObject(pl)
            j+=vstep
        i+=ustep
    new_pts=[]
    
    cirs=[]
    for pt in temp_pts:
        m=rs.PointInPlanarClosedCurve(pt, crv)
        if(m==1):
            cen_pts.append(pt)
    rs.DeleteObject(srf)
    rs.DeleteObject(bb_crv)
    rs.EnableRedraw(True)
    return cen_pts


def process_pts(cen_pts, guide_srf):
    debug = sc.sticky['debug']
    delpt=[]
    f_pts=[]
    cir_lst = []
    planeX=srf_tri_func(guide_srf)
    print("len = "+str(len(planeX)))
    for pt in cen_pts:
        if(pt not in delpt):        
            fpt=find_z(pt,planeX)
            if(fpt != None):
                z=fpt[0][2]
            #print(str(z)+" - final")
            #r=random.randint(70,175)  # use this to check #
            r=z                        # condition for tower separation  #
            cirX=rs.AddCircle(pt,r)
            cir_lst.append(cirX)
            x0=pt[0]
            y0=pt[1]
            f_pts.append([x0,y0,z])
            for ptx in cen_pts:
                d=rs.Distance(ptx,pt)
                m=rs.PointInPlanarClosedCurve(ptx,cirX)
                if(d>0 and m!=0):
                    delpt.append(ptx)
        #rs.DeleteObject(cirX)
    return f_pts, cir_lst

def srf_tri_func(srf):
    srfUdom=rs.SurfaceDomain(srf,0)
    srfVdom=rs.SurfaceDomain(srf,1)
    umax=srfUdom[1]
    umin=srfUdom[0]
    m=25.
    vmax=srfVdom[1]
    vmin=srfVdom[0]
    n=25.
    ustep=(umax-umin)/m
    vstep=(vmax-vmin)/n
    planeX=[]
    i=umin
    while i<umax:
        j=vmin
        while j<vmax:
            pt0=rs.EvaluateSurface(srf, i, j)
            planeX.append([pt0, ustep, vstep])
            j+=vstep
        i+=ustep
    return planeX

def find_z(pt,planeX):
    fpt=[]
    for arr in planeX:
        ptx=arr[0][0]
        pty=arr[0][1]
        ptz=arr[0][2]
        ustep=arr[1]
        vstep=arr[2]
        if(pt[0]>ptx and pt[0]<ptx+ustep):
            if(pt[1]>pty and pt[1]<pty+vstep):
                fpt.append([pt[0],pt[1],ptz])
                #rs.AddPoint(fpt)
                #rs.AddLine(pt,fpt)
    return fpt


def findSides(crvs):
    i=0
    n=len(crvs)    
    crv_li=[]
    for crv in crvs:
        bb=rs.BoundingBox(crv)
        dX=rs.Distance(bb[0], bb[1])
        dY=rs.Distance(bb[1], bb[2])
        crv_li.append([dX, dY, i])
        i+=1
    crv_li_X=sorted(crv_li, key=operator.itemgetter(0))
    crv_li_X.reverse()
    crv_li_Y=sorted(crv_li, key=operator.itemgetter(1))
    crv_li_Y.reverse()
    final_dim=[]
    final_dim.append([crv_li_X[0][0], crv_li_Y[0][1]])
    return final_dim

def place_tower(f_pts, block_crvs):
    footprint_crv=[]
    for pt in f_pts:
        r=random.randrange(0,len(block_crvs))
        bb=rs.BoundingBox(block_crvs[r])
        pl=rs.AddPolyline([bb[0],bb[1],bb[2],bb[3],bb[0]])
        ptx=rs.CurveAreaCentroid(pl)[0]
        v0=[pt[0],pt[1],0]
        v1=[ptx[0],ptx[1],0]
        e=[pt[0],pt[1],pt[2]]
        vec=rs.VectorSubtract(v0,v1)
        block_crv_dup=rs.CopyObject(block_crvs[r], vec)
        #footprint_crv.append(block_crv_dup)
        lext=rs.AddLine(v0,e)
        footprint_crv.append(rs.ExtrudeCurve(block_crv_dup, lext)) # simply extrude curve
        #develop_floor_plate(block_crv_dup, pt[2]) # copy floor plates every 3m
        #rs.DeleteObject(tower_crv)
        rs.DeleteObject(pl)
    return footprint_crv


def develop_floor_plate(crv, lext):
    for i in range(0, int(lext), 3):
        srf=rs.AddPlanarSrf(crv)[0]
        cen=rs.CurveAreaCentroid(crv)[0]
        vec1=[cen[0],cen[1],i]
        rs.CopyObject(srf,vec1)


    sw=street_width/2
    st_offset=[]
    for crv in street_pl:
        crvpl=rs.AddPolyline(crv)
        crvpl_cen=rs.CurveAreaCentroid(crvpl)[0]
        crvx=rs.OffsetCurve(crvpl,crvpl_cen,sw)
        st_offset.append(crvx)
        rs.DeleteObject(crvpl)

    rs.DeleteObject(srf)
    rs.DeleteObject(bb_crv)
    rs.EnableRedraw(True)








#################
#   Main Loop   #
#################


sc.sticky['debug'] = []


site_crv=x#rs.GetObjects("Pick the site")
#block_dis=rs.GetReal("Enter the tower distance",50,10,100)
block_dis=5
block_crvs=y#rs.GetObjects("Select the patterns of tower footprint")
guide_srf=z#rs.GetObject("Select guide surface for height")

a=findSides(block_crvs)[0][0]
b=findSides(block_crvs)[0][1]
cen_pts=eq_dis_tower(site_crv, a, b, block_dis)
f_pts,c=process_pts(cen_pts, guide_srf)


footprint_crvs=place_tower(f_pts, block_crvs)
a = footprint_crvs

#street_sys(site_crv, a, b, block_dis,street_width)

debug = sc.sticky['debug']
# ---------- end python ----------
geo_6 = Geometry(python.a)
geo_7 = Geometry(python.debug)
geo_8 = Geometry(python.c)
