# Grasshopper definition Basic_Solar_Fan_Envelope.gh (Grasshopper 0.9.76)
# plug-ins: Python Interpreter

ladybug = Ladybug_Ladybug()  # -> Vviiiiiiiiiizzz; plug-in component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
constructlocation = Ladybug_ConstructLocation(locationName="unknown_Location", latitude=Slider(42, range=0..100), longitude=0, timeZone=0, elevation=0)  # -> location; plug-in component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
number_slider = Slider(2, range=0..10)
number_slider_2 = Slider(0, range=0..100)
crv = Curve(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)
geo = Geometry(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)
solarfanbasic = Ladybug_SolarFanBasic(
    boundary=geo,
    location=constructlocation,
    requiredHours=number_slider,
    height=Slider(100, range=0..100),
    monthRange=number_slider_2)  # -> readMe, solarFan; plug-in component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
solarenvelopebasic = Ladybug_SolarEnvelopeBasic(boundary=crv, location=constructlocation, requiredHours=number_slider, monthRange=number_slider_2)  # -> readMe, solarEnvelope; plug-in component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
geo_2 = Geometry(solarenvelopebasic.solarEnvelope)
geo_3 = Geometry(solarfanbasic.solarFan)
wires = BrepWireframe(Brep=[geo_3, geo_2], Density=-1)
preview = CustomPreview(Geometry=[geo_3, geo_2], Shader=ColourSwatch(SwatchColor=RGB(255, 203, 61)))
