# Grasshopper definition Solar_Fan_Envelope_Basic.gh (Grasshopper 0.9.76)
# plug-ins: Python Interpreter

panel = Panel("""This file shows how to quickly generate a Solar Fan and Envelope with minimum input data.

The solar envelope is used to ensure that its adjacent neighbors (defined as anything outside of the chosen boundary curve) will receive a specified minimum hours of direct solar access for each day in a specified month range of the year.

The solar fan is used to ensure that a given property within a boundary curve is guarenteed a specified minimum hours of direct solar access for each day in a specified month range of the year.""")
panel_2 = Panel("""LBExampleFiles
Ladybug
Solar Fan
Solar Envelope
Solar access
Solar vectors
Basic""")
ladybug = Ladybug_Ladybug()  # -> Vviiiiiiiiiizzz; plug-in component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
exporthydra = Hydra_ExportFile(fileName="Solar_Fan_Envelope_Basic", fileDescription=panel, changeLog="1", fileTags=panel_2, export=Toggle(False))  # -> readMe; inputs fileDescription: list, changeLog: list, fileTags: list, includeRhino: Boolean, GHForThumb: Boolean, additionalImgs: list, export: Boolean; plug-in component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
constructlocation = Ladybug_ConstructLocation(locationName="unknown_Location", latitude=Slider(42, range=0..100), longitude=0, timeZone=0, elevation=0)  # -> location; plug-in component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
number_slider = Slider(2, range=0..10)
number_slider_2 = Slider(0, range=0..100)
crv = Curve(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)
geo = Geometry(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)
solarenvelopebasic = Ladybug_SolarEnvelopeBasic(boundary=crv, location=constructlocation, requiredHours=number_slider, monthRange=number_slider_2)  # -> readMe, solarEnvelope; plug-in component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
solarfanbasic = Ladybug_SolarFanBasic(
    boundary=geo,
    location=constructlocation,
    requiredHours=number_slider,
    height=Slider(100, range=0..100),
    monthRange=number_slider_2)  # -> readMe, solarFan; plug-in component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
geo_2 = Geometry(solarenvelopebasic.solarEnvelope)
geo_3 = Geometry(solarfanbasic.solarFan)
wires = BrepWireframe(Brep=[geo_3, geo_2], Density=-1)
preview = CustomPreview(Geometry=[geo_3, geo_2], Shader=ColourSwatch(SwatchColor=RGB(255, 203, 61)))
