# Grasshopper definition Shadow_Range_analysis.gh (Grasshopper 0.9.76)
# plug-ins: Python Interpreter

panel = Panel("https://www.energyplus.net/weather-download/north_and_central_america_wmo_region_4/USA/CA/USA_CA_San.Francisco.Intl.AP.724940_TMY3/all")
panel_2 = Panel("This file shows how to set up a shadow range analysis with ladybug. This example is set for 21 December. Change input of sun-path for differnt hours of the year")
panel_3 = Panel("""Grasshopper
Shadow Range
Ladybug
LBExampleFiles""")
ladybug = Ladybug_Ladybug()  # -> Vviiiiiiiiiizzz; plug-in component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
epw_stat = Ladybug_OpenEPWAndSTATWeatherFiles(weatherFileURL=panel)  # -> epwFile, statFile; plug-in component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
test_surface = Brep(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)
brep = Brep([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])
exporthydra = Hydra_ExportFile(
    fileName="Shadow Range analysis",
    fileDescription=panel_2,
    fileTags=panel_3,
    targetFolder="C:\Users\Administrator\Documents\GitHub\hydra_1",
    export=Toggle(False))  # -> readMe; inputs fileDescription: list, changeLog: list, fileTags: list, includeRhino: Boolean, GHForThumb: Boolean, additionalImgs: list, export: Boolean; plug-in component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
# All hours during 21 DEC
panel_4 = Panel("24")
mesh = Mesh(brep)
importlocation = Ladybug_ImportLocation(epwFile=epw_stat.epwFile)  # -> location; plug-in component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
series = Series(Start="1", Step=1, Count=panel_4)
wires = BrepWireframe(Brep=brep, Density=-1)
preview = CustomPreview(Geometry=mesh, Shader=ColourSwatch(SwatchColor=RGB(255, 255, 255)))
preview_2 = CustomPreview(Geometry=test_surface, Shader=ColourSwatch(SwatchColor=RGBA(255, 255, 255, 223)))
# Draw Sun-path
sunpath = Ladybug_SunPath(location=importlocation, hour=series, day="21", month="12", timeStep=1, dailyOrAnnualSunPath=True)  # -> readMe, sunVectors, sunAltitudes, sunAzimuths, port, sunSpheresMesh, sunPathCrvs, legend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; plug-in component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

# ---- group: set up number of legend segments based on number of vectors
lng = ListLength(List=sunpath.sunVectors)
addition = Addition(A=lng, B=1)
legendpar = Ladybug_LegendParameters(numSegments=addition)  # -> legendPar; plug-in component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

# ----
sunlighthoursanalysis = Ladybug_SunlightHoursAnalysis(
    geometry=flatten(test_surface),
    context=flatten(mesh),
    gridSize="20",
    disFromBase=Slider(0.001, range=0..0.001),
    sunVectors=flatten(sunpath.sunVectors),
    timeStep=1,
    legendPar=flatten(legendpar),
    parallel=Toggle(True),
    runIt=Toggle(True))  # -> readMe, contextMesh, analysisMesh, testPts, testVec, port, sunlightHoursResult, sunlightHoursMesh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; plug-in component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
