# Grasshopper definition Energy_Shade_Benefit_site_14_geom.gh (Grasshopper 0.9.76)
# plug-ins: Python Interpreter

list = ValueList({"dir", "file"}, selected="dir")

# ---- group: find directory
bibil = PythonScript(
    dir=["C:\\Users\\vasanthakumars\\Documents\\GitHub\\bibil\\src", "C:\\saeran\\master\\git\\bibil\\src"],
    type=list,
    run=Toggle(True))  # -> dir; inputs dir: list
# ---------- bibil: Python ----------
import os

ghenv.Component.Params.Output[0].Name = "null"
ghenv.Component.Params.Output[0].NickName = "null"

if run:
    confirm_dir = None
    for d in dir:
        try:
            if type == "file":
                file_ = open(d)
                file_.close()
            else:
                print os.listdir(d)
            confirm_dir = d
            break
        except Exception as e:
            #print str(e)
            continue
    if confirm_dir != None:
        ghenv.Component.Params.Output[0].Name = type
        ghenv.Component.Params.Output[0].NickName = type
        dir = confirm_dir
        file = confirm_dir
null = None
# ---------- end bibil ----------

# ---- group: miru
# BIBIL_CLASSES
python_script = PythonScript(i=bibil)  # -> o
# ---------- python_script: Python ----------
import os

if i:
    o = os.path.join(str(i),"miru\\miru_miru.py")
# ---------- end python_script ----------
file = ReadFile(File=python_script, PerLineParse=False)
bibil_2 = PythonScript(Code=file)

# ---- group: grammar
python_script_2 = PythonScript(i=bibil)  # -> o
# ---------- python_script_2: Python ----------
import os

if i:
    o = os.path.join(str(i),"bibil\\bibil_rule.py")
# ---------- end python_script_2 ----------
file_2 = ReadFile(File=python_script_2, PerLineParse=False)
bibil_3 = PythonScript(Code=file_2)

# ---- group: pattern
python_script_3 = PythonScript(i=bibil)  # -> o
# ---------- python_script_3: Python ----------
import os

if i:
    o = os.path.join(str(i),"bibil\\bibil_pattern.py")
# ---------- end python_script_3 ----------
file_3 = ReadFile(File=python_script_3, PerLineParse=False)
bibil_4 = PythonScript(Code=file_3)

# ---- group: shape
python_script_4 = PythonScript(i=bibil)  # -> o
# ---------- python_script_4: Python ----------
import os

if i:
    o = os.path.join(str(i),"bibil\\bibil_shape.py")
#o = os.path.join(str(i),"research\\bibil_shape_shape_3d_2d.py")
# ---------- end python_script_4 ----------
file_4 = ReadFile(File=python_script_4, PerLineParse=False)
bibil_5 = PythonScript(Code=file_4)

# ---- group: tree
python_script_5 = PythonScript(i=bibil)  # -> o
# ---------- python_script_5: Python ----------
import os

if i:
    o = os.path.join(str(i),"bibil\\bibil_tree.py")
# ---------- end python_script_5 ----------
file_5 = ReadFile(File=python_script_5, PerLineParse=False)
bibil_6 = PythonScript(Code=file_5)

# ---- group: bula
python_script_6 = PythonScript(i=bibil)  # -> o
# ---------- python_script_6: Python ----------
import os

if i:
    o = os.path.join(str(i),"bula\\bula_minimal.py")
# ---------- end python_script_6 ----------
file_6 = ReadFile(File=python_script_6, PerLineParse=False)

# ---- group: node_comp
python_script_7 = PythonScript(i=bibil)  # -> o
# ---------- python_script_7: Python ----------
import os

if i:
    o = os.path.join(str(i),"bibil\\bibil_UI.py")
# ---------- end python_script_7 ----------
file_7 = ReadFile(File=python_script_7, PerLineParse=False)

# ---- group: grammar_divide
python_script_8 = PythonScript(i=bibil)  # -> o
# ---------- python_script_8: Python ----------
import os

if i:
    o = os.path.join(str(i),"miru\\miru_divide.py")
# ---------- end python_script_8 ----------
file_8 = ReadFile(File=python_script_8, PerLineParse=False)

# ---- group: grammar_courtyard
python_script_9 = PythonScript(i=bibil)  # -> o
# ---------- python_script_9: Python ----------
import os

if i:
    o = os.path.join(str(i),"miru\\miru_court.py")
# ---------- end python_script_9 ----------
file_9 = ReadFile(File=python_script_9, PerLineParse=False)

# ---- group: grammar_tower
python_script_10 = PythonScript(i=bibil)  # -> o
# ---------- python_script_10: Python ----------
import os

if i:
    o = os.path.join(str(i),"miru\\miru_packing.py")
# ---------- end python_script_10 ----------
file_10 = ReadFile(File=python_script_10, PerLineParse=False)

python_script_11 = PythonScript(i=bibil)  # -> o
# ---------- python_script_11: Python ----------
import os

if i:
    o = os.path.join(str(i),"miru\\miru_stepback.py")
# ---------- end python_script_11 ----------
file_11 = ReadFile(File=python_script_11, PerLineParse=False)

# ---- group: grammar_height
python_script_12 = PythonScript(i=bibil)  # -> o
# ---------- python_script_12: Python ----------
import os

if i:
    o = os.path.join(str(i),"miru\\miru_height.py")
# ---------- end python_script_12 ----------
file_12 = ReadFile(File=python_script_12, PerLineParse=False)

# ----
list_2 = ValueList({"divide by depth": "subdivide_depth", "divide by same depth": "subdivide_depth_same", "divide by dim": "subdivide_dim"}, selected="divide by same depth")
list_3 = ValueList({"YZ": "NS", "XZ": "EW", "XY": "Z"}, selected="YZ")
bibil_7 = PythonScript(
    Code=file_8,
    Divide_num=Slider(1, range=0..10),
    Divide_cut=Slider(3.5, range=0..10),
    Divide_type=list_2,
    Divide_ratio=Slider(0.62, range=0..1),
    Axis=list_3,
    Run=Toggle(True))

# ---- group: COURTYARD
miru = PythonScript(Code=file_9, Podium_depth=Slider(3, range=0..100), Node_depth=Slider(1, range=-1..1), Run=Toggle(True))

# ----
geo = Geometry(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)
bibil_8 = PythonScript(Code=file_7, Rule_in=bibil_7, Child_node_in=geo, Label_="floor", Run=Toggle(True))  # -> Node_out, Debug
g = PythonScript(node=bibil_8.Node_out)  # -> geom
# ---------- g: Python ----------
if node:
    geom = []
    lot_lst = node.traverse_tree(lambda n:n,internal=False)
    for n in lot_lst:
        geom.append(n.data.shape.geom)
    print geom
# ---------- end g ----------
bibil_9 = PythonScript(Code=file_7, Rule_in=miru, Child_node_in=bibil_8.Node_out, Label_="floor", Run=Toggle(True))  # -> Node_out, Debug
g_2 = PythonScript(node=bibil_9.Node_out)  # -> geom; same code as g
geo_2 = Geometry(bibil_9.Debug)
ladybug = Ladybug_Ladybug()  # -> Vviiiiiiiiiizzz; plug-in component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
honeybee = Honeybee_Honeybee()  # -> Vviiiiiiiiiizzz; plug-in component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
sdiff = SolidDifference(BrepsA=geo, BrepsB=flatten(g_2))
geo_3 = Geometry([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])
geo_4 = Geometry(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)
createhbsrfs = Honeybee_createHBSrfs(geometry=geo_4)  # -> readMe, simplify(HBSurface); plug-in component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
createhbzones = Honeybee_createHBZones(isConditioned=True)  # -> readMe, HBZone; plug-in component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
geo_5 = Geometry(flatten([g_2, geo_3]))
geo_6 = Geometry(createhbsrfs.HBSurface)
mass2zone = Honeybee_Masses2Zones(zoneMasses=flatten(geo_5), isConditioned=True, maxRoofAngle=30, createHBZones=Toggle(True))  # -> readMe, HBZones; plug-in component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
solveadjc = Honeybee_SolveAdjacencies(HBZones=flatten(mass2zone.HBZones), removeCurrentAdjc=False, findAdjc=Toggle(False))  # -> readMe, HBZonesWADJ; plug-in component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
glazingcreator = Honeybee_GlazingBasedOnRatio(HBObjects=solveadjc.HBZonesWADJ, glzRatio=".9", breakUpWindow=Toggle(False), runIt=Toggle(True))  # -> readMe, HBObjWGLZ; plug-in component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
number_slider = Slider(24, range=22..28)
number_slider_2 = Slider(19, range=16..20)
toggle = BooleanToggle(True)
epoutput = Honeybee_GenerateEPOutput(
    zoneEnergyUse=toggle,
    zoneGainsAndLosses="False",
    zoneComfortMetrics="False",
    surfaceTempAnalysis="False",
    surfaceEnergyAnalysis=toggle,
    glazingSolarAnalysis=toggle,
    timestep="hourly")  # -> report, flatten(simulationOutputs); plug-in component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
setepzonethresholds = Honeybee_SetEnergyPlusZoneThresholds(
    HBZones=glazingcreator.HBObjWGLZ,
    coolingSetPt=number_slider,
    coolingSetback=number_slider,
    heatingSetPt=number_slider_2,
    heatingSetback=number_slider_2)  # -> readMe, HBZones; plug-in component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

# ----
# Visualize the Zones
decomposebytype = Honeybee_DecomposeBasedOnType(HBZone=setepzonethresholds.HBZones)  # -> walls, interiorWalls, airWalls, windows, interiorWindows, skylights, roofs, ceilings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; plug-in component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
preview = CustomPreview(Geometry=decomposebytype.windows, Shader=ColourSwatch(SwatchColor=RGBA(178, 232, 255, 108)))
preview_2 = CustomPreview(Geometry=decomposebytype.walls, Shader=ColourSwatch(SwatchColor=RGB(255, 252, 178)))
preview_3 = CustomPreview(Geometry=[decomposebytype.groundFloors, decomposebytype.floors], Shader=ColourSwatch(SwatchColor=RGB(214, 131, 131)))
preview_4 = CustomPreview(Geometry=decomposebytype.roofs, Shader=ColourSwatch(SwatchColor=RGB(128, 128, 128)))

# ----
# 2
toggle_2 = BooleanToggle(False)
geo_7 = Geometry([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])

panel = Panel("C:\\Users\\vasanthakumars\\Documents\\GitHub\\bibil\\src\\reference\\CAN_ON_Toronto.716240_CWEC\\CAN_ON_Toronto.716240_CWEC.epw")
panel_2 = Panel("C:\saeran\master\git\bibil\src\reference\CAN_ON_Toronto.716240_CWEC\CAN_ON_Toronto.716240_CWEC.epw")
# Run the Energy Simulation + Get Results
toggle_3 = BooleanToggle(True)
list_4 = ValueList({"dir", "file"}, selected="file")

# ---- group: find directory
bibil_10 = PythonScript(dir=[panel_2, panel], type=list_4, run=toggle_3)  # -> file; inputs dir: list; same code as bibil

# ----
data = Data(bibil_10)

importlocation = Ladybug_ImportLocation(epwFile=data)  # -> location; plug-in component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

# ----
# Run the Simulation
# 1
toggle_4 = BooleanToggle(False)

runenergysimulation = Honeybee_RunEnergySimulation(
    epwFile=data,
    HBZones=flatten(setepzonethresholds.HBZones),
    simulationOutputs=flatten(epoutput.simulationOutputs),
    writeIdf=toggle_4,
    runEnergyPlus=toggle_4,
    idfFileName="test_idf_3")  # -> report, idfFileAddress, resultFileAddress; plug-in component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

readepsrfresult = Honeybee_ReadEPSurfaceResult(resultFileAddress=runenergysimulation.resultFileAddress)  # -> surfaceIndoorTemp, surfaceOutdoorTemp, surfaceEnergyFlow, opaqueEnergyFlow, glazEnergyFlow, windowTotalSolarEnergy, windowBeamEnergy, windowDiffEnergy, windowTransmissivity, otherSurfaceData; plug-in component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
readepresult = Honeybee_ReadEPResult(resultFileAddress=runenergysimulation.resultFileAddress)  # -> totalThermalEnergy, thermalEnergyBalance, cooling, heating, electricLight, electricEquip, fanElectric, pumpElectric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; plug-in component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

# ----
# Create Shades
epwindowshades = Honeybee_EnergyPlusWindowShadeGenerator(
    HBObjects=setepzonethresholds.HBZones,
    depth=Slider(3, range=0..10),
    numOfShds="1",
    horOrVertical=Toggle(True),
    runIt=toggle_2,
    zoneData1=readepresult.cooling,
    zoneData2=readepresult.heating,
    zoneData3=readepsrfresult.windowBeamEnergy)  # -> readMe, debug, HBObjWShades, port, windowBreps, shadeBreps, port_2, zoneData1Tree, zoneData2Tree, zoneData3Tree; plug-in component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
geo_8 = Geometry(epwindowshades.shadeBreps)
geo_9 = Geometry(epwindowshades.debug)

panel_3 = Panel(".25")
# 3
toggle_5 = BooleanToggle(False)
# Shade Benefit Analysis
energyshadebenefit = Honeybee_EnergyShadeBenefitEvaluator(
    location=importlocation,
    coolingLoad=epwindowshades.zoneData1Tree,
    heatingLoad=epwindowshades.zoneData2Tree,
    beamGain=epwindowshades.zoneData3Tree,
    testShades=epwindowshades.shadeBreps,
    testWindow=epwindowshades.windowBreps,
    gridSize="0.5",
    delNonIntersect=False,
    parallel=Toggle(True),
    runIt=toggle_5)  # -> readMe, port, sunVectors, windowTestPts, shadeMesh, legend, legendBasePoint, port_2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; plug-in component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
preview_5 = CustomPreview(Geometry=[energyshadebenefit.legend, energyshadebenefit.shadeMesh], Shader=ColourSwatch(SwatchColor=RGB(0, 0, 0)))

# ----
# Select Out The Parts of Shades To Keep
number_slider_3 = Slider(7, range=0..100)
shadecreator = Honeybee_OptimalShadeCreator(shadeMesh=energyshadebenefit.shadeMesh, shadeNetEffect=energyshadebenefit.shadeNetEffect, levelOfPerform=number_slider_3)  # -> readMe, energySavedByShade, areaOfShade, newColoredMesh, newShadeBrep; plug-in component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
edges = BrepEdges(Brep=shadecreator.newShadeBrep)  # -> Naked, Interior, NonManifold
data_2 = Data(flatten(shadecreator.areaOfShade))
data_3 = Data(flatten(shadecreator.energySavedByShade))
ma = MassAddition(Input=data_2)  # -> Result, PartialResults
ma_2 = MassAddition(Input=data_3)  # -> Result, PartialResults
preview_6 = CustomPreview(Geometry=edges.Naked, Shader=ColourSwatch(SwatchColor=RGB(0, 0, 0)))
panel_4 = Panel(ma.Result)
panel_5 = Panel(ma_2.Result)
