# Grasshopper definition Energy_Shade_Benefit_site_14_geom_002.gh (Grasshopper 0.9.76)
# plug-ins: Python Interpreter

list = ValueList({"dir", "file"}, selected="dir")

# ---- group: find directory
bibil = PythonScript(
    dir=["C:\\Users\\vasanthakumars\\Documents\\GitHub\\bibil\\src", "C:\\saeran\\master\\git\\bibil\\src"],
    type=list,
    run=Toggle(True))  # -> dir; inputs dir: list
# ---------- bibil: Python ----------
import os

ghenv.Component.Params.Output[0].Name = "null"
ghenv.Component.Params.Output[0].NickName = "null"

if run:
    confirm_dir = None
    for d in dir:
        try:
            if type == "file":
                file_ = open(d)
                file_.close()
            else:
                print os.listdir(d)
            confirm_dir = d
            break
        except Exception as e:
            #print str(e)
            continue
    if confirm_dir != None:
        ghenv.Component.Params.Output[0].Name = type
        ghenv.Component.Params.Output[0].NickName = type
        dir = confirm_dir
        file = confirm_dir
null = None
# ---------- end bibil ----------

# ---- group: miru
# BIBIL_CLASSES
python_script = PythonScript(i=bibil)  # -> o
# ---------- python_script: Python ----------
import os

if i:
    o = os.path.join(str(i),"miru\\miru_miru.py")
# ---------- end python_script ----------
file = ReadFile(File=python_script, PerLineParse=False)
bibil_2 = PythonScript(Code=file)

# ---- group: grammar
python_script_2 = PythonScript(i=bibil)  # -> o
# ---------- python_script_2: Python ----------
import os

if i:
    o = os.path.join(str(i),"bibil\\bibil_rule.py")
# ---------- end python_script_2 ----------
file_2 = ReadFile(File=python_script_2, PerLineParse=False)
bibil_3 = PythonScript(Code=file_2)

# ---- group: pattern
python_script_3 = PythonScript(i=bibil)  # -> o
# ---------- python_script_3: Python ----------
import os

if i:
    o = os.path.join(str(i),"bibil\\bibil_pattern.py")
# ---------- end python_script_3 ----------
file_3 = ReadFile(File=python_script_3, PerLineParse=False)
bibil_4 = PythonScript(Code=file_3)

# ---- group: shape
python_script_4 = PythonScript(i=bibil)  # -> o
# ---------- python_script_4: Python ----------
import os

if i:
    o = os.path.join(str(i),"bibil\\bibil_shape.py")
#o = os.path.join(str(i),"research\\bibil_shape_shape_3d_2d.py")
# ---------- end python_script_4 ----------
file_4 = ReadFile(File=python_script_4, PerLineParse=False)
bibil_5 = PythonScript(Code=file_4)

# ---- group: tree
python_script_5 = PythonScript(i=bibil)  # -> o
# ---------- python_script_5: Python ----------
import os

if i:
    o = os.path.join(str(i),"bibil\\bibil_tree.py")
# ---------- end python_script_5 ----------
file_5 = ReadFile(File=python_script_5, PerLineParse=False)
bibil_6 = PythonScript(Code=file_5)

# ---- group: bula
python_script_6 = PythonScript(i=bibil)  # -> o
# ---------- python_script_6: Python ----------
import os

if i:
    o = os.path.join(str(i),"bula\\bula_minimal.py")
# ---------- end python_script_6 ----------
file_6 = ReadFile(File=python_script_6, PerLineParse=False)

# ---- group: node_comp
python_script_7 = PythonScript(i=bibil)  # -> o
# ---------- python_script_7: Python ----------
import os

if i:
    o = os.path.join(str(i),"bibil\\bibil_UI.py")
# ---------- end python_script_7 ----------
file_7 = ReadFile(File=python_script_7, PerLineParse=False)

# ---- group: grammar_divide
python_script_8 = PythonScript(i=bibil)  # -> o
# ---------- python_script_8: Python ----------
import os

if i:
    o = os.path.join(str(i),"miru\\miru_divide.py")
# ---------- end python_script_8 ----------
file_8 = ReadFile(File=python_script_8, PerLineParse=False)

# ---- group: grammar_courtyard
python_script_9 = PythonScript(i=bibil)  # -> o
# ---------- python_script_9: Python ----------
import os

if i:
    o = os.path.join(str(i),"miru\\miru_court.py")
# ---------- end python_script_9 ----------
file_9 = ReadFile(File=python_script_9, PerLineParse=False)

# ---- group: grammar_tower
python_script_10 = PythonScript(i=bibil)  # -> o
# ---------- python_script_10: Python ----------
import os

if i:
    o = os.path.join(str(i),"miru\\miru_packing.py")
# ---------- end python_script_10 ----------
file_10 = ReadFile(File=python_script_10, PerLineParse=False)

python_script_11 = PythonScript(i=bibil)  # -> o
# ---------- python_script_11: Python ----------
import os

if i:
    o = os.path.join(str(i),"miru\\miru_stepback.py")
# ---------- end python_script_11 ----------
file_11 = ReadFile(File=python_script_11, PerLineParse=False)

# ---- group: grammar_height
python_script_12 = PythonScript(i=bibil)  # -> o
# ---------- python_script_12: Python ----------
import os

if i:
    o = os.path.join(str(i),"miru\\miru_height.py")
# ---------- end python_script_12 ----------
file_12 = ReadFile(File=python_script_12, PerLineParse=False)

# ----
bldgprograms = Honeybee_bldgPrograms({"Office": 0, "Retail": 1, "MidriseApartment": 2, "PrimarySchool": 3, "SecondarySchool": 4, "SmallHotel": 5, "LargeHotel": 6, "Hospital": 7, "Outpatient": 8, "Warehouse": 9, "SuperMarket": 10, "FullServiceRestaurant": 11, "QuickServiceRestaurant": 12}, selected="Office")
listzoneprograms = Honeybee_ListZonePrograms(bldgProgram=bldgprograms)  # -> OfficeZonePrograms; plug-in component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
panel = Panel(listzoneprograms)
item = ListItem(List=listzoneprograms, Index="3", Wrap=True)
item_2 = ListItem(List=listzoneprograms, Index="3", Wrap=True)
item_3 = ListItem(List=listzoneprograms, Index="5", Wrap=True)
item_4 = ListItem(List=listzoneprograms, Index="11", Wrap=True)
item_5 = ListItem(List=listzoneprograms, Index="5", Wrap=True)
geo = Geometry([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])
geo_2 = Geometry([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])
geo_3 = Geometry(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)
geo_4 = Geometry(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)
geo_5 = Geometry([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])
ladybug = Ladybug_Ladybug()  # -> Vviiiiiiiiiizzz; plug-in component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

# ---- group: East
mass2zone = Honeybee_Masses2Zones(zoneMasses=flatten(geo_2), zonePrograms=item_2, isConditioned=Toggle(True), maxRoofAngle=30, createHBZones=Toggle(True))  # -> readMe, HBZones; plug-in component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

# ----
mass2zone_2 = Honeybee_Masses2Zones(zoneMasses=flatten(geo_3), zonePrograms=item_3, isConditioned=Toggle(True), maxRoofAngle=30, createHBZones=Toggle(True))  # -> readMe, HBZones; plug-in component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
honeybee = Honeybee_Honeybee()  # -> Vviiiiiiiiiizzz; plug-in component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

# ---- group: West
mass2zone_3 = Honeybee_Masses2Zones(zoneMasses=flatten(geo), zonePrograms=item, isConditioned=Toggle(True), maxRoofAngle=30, createHBZones=Toggle(True))  # -> readMe, HBZones; plug-in component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

# ----
mass2zone_4 = Honeybee_Masses2Zones(zoneMasses=flatten(geo_4), zonePrograms=item_4, isConditioned=Toggle(True), maxRoofAngle=30, createHBZones=Toggle(True))  # -> readMe, HBZones; plug-in component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
mass2zone_5 = Honeybee_Masses2Zones(zoneMasses=flatten(geo_5), zonePrograms=item_5, isConditioned=Toggle(True), maxRoofAngle=30, createHBZones=Toggle(True))  # -> readMe, HBZones; plug-in component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
geo_6 = Geometry(mass2zone_4.HBZones)
geo_7 = Geometry(mass2zone_2.HBZones)
geo_8 = Geometry(mass2zone_3.HBZones)
geo_9 = Geometry(mass2zone.HBZones)
geo_10 = Geometry(mass2zone_5.HBZones)
solveadjc = Honeybee_SolveAdjacencies(
    HBZones=flatten([mass2zone.HBZones, mass2zone_4.HBZones, mass2zone_2.HBZones]),
    removeCurrentAdjc=False,
    findAdjc=Toggle(True))  # -> readMe, HBZonesWADJ; plug-in component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
solveadjc_2 = Honeybee_SolveAdjacencies(HBZones=flatten([mass2zone_5.HBZones, mass2zone_3.HBZones]), removeCurrentAdjc=False, findAdjc=Toggle(True))  # -> readMe, HBZonesWADJ; plug-in component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
solveadjc_3 = Honeybee_SolveAdjacencies(HBZones=flatten([solveadjc_2.HBZonesWADJ, solveadjc.HBZonesWADJ]), removeCurrentAdjc=False, findAdjc=Toggle(True))  # -> readMe, HBZonesWADJ; plug-in component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
toggle = BooleanToggle(False)
toggle_2 = BooleanToggle(True)
glzparamlist = Honeybee_GlazingParametersList(northGlzParam=toggle, westGlzParam=toggle_2, southGlzParam=toggle, eastGlzParam=toggle_2)  # -> glzParamList; plug-in component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
glzparamlist_2 = Honeybee_GlazingParametersList(northGlzParam="0.9", westGlzParam="0.5", southGlzParam="0.9", eastGlzParam="0.5")  # -> glzParamList; plug-in component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
glazingcreator = Honeybee_GlazingBasedOnRatio(HBObjects=solveadjc_3.HBZonesWADJ, glzRatio=glzparamlist_2, breakUpWindow=glzparamlist, runIt=Toggle(True))  # -> readMe, HBObjWGLZ; plug-in component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
number_slider = Slider(24, range=22..28)
number_slider_2 = Slider(19, range=16..20)
toggle_3 = BooleanToggle(True)
epoutput = Honeybee_GenerateEPOutput(
    zoneEnergyUse=toggle_3,
    zoneGainsAndLosses="False",
    zoneComfortMetrics="False",
    surfaceTempAnalysis="False",
    surfaceEnergyAnalysis=toggle_3,
    glazingSolarAnalysis=toggle_3,
    timestep="hourly")  # -> report, flatten(simulationOutputs); plug-in component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
setepzonethresholds = Honeybee_SetEnergyPlusZoneThresholds(
    HBZones=glazingcreator.HBObjWGLZ,
    coolingSetPt=number_slider,
    coolingSetback=number_slider,
    heatingSetPt=number_slider_2,
    heatingSetback=number_slider_2)  # -> readMe, HBZones; plug-in component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

decomposebytype = Honeybee_DecomposeBasedOnType(HBZone=setepzonethresholds.HBZones)  # -> walls, interiorWalls, airWalls, windows, interiorWindows, skylights, roofs, ceilings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; plug-in component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
preview = CustomPreview(Geometry=decomposebytype.windows, Shader=ColourSwatch(SwatchColor=RGBA(178, 232, 255, 108)))
preview_2 = CustomPreview(Geometry=decomposebytype.walls, Shader=ColourSwatch(SwatchColor=RGB(255, 252, 178)))
preview_3 = CustomPreview(Geometry=[decomposebytype.groundFloors, decomposebytype.floors], Shader=ColourSwatch(SwatchColor=RGB(214, 131, 131)))
preview_4 = CustomPreview(
    Geometry=[decomposebytype.roofs, decomposebytype.floors, decomposebytype.exposedFloors],
    Shader=ColourSwatch(SwatchColor=RGB(128, 128, 128)))

separatezonesbyprogram = Honeybee_SeparateZonesByProgram(HBZones=flatten(setepzonethresholds.HBZones))  # -> zonePrograms, HBZones; plug-in component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
number_slider_3 = Slider(2, range=0..10)
toggle_4 = BooleanToggle(True)
toggle_5 = BooleanToggle(True)
panel_2 = Panel(".25")
data = Data("0.5")
data_2 = Data(Tree({0;0}: [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], {1;0}: [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], {2;0}: [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], {3;0}: [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], {4;0}: [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], {5;0}: [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]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))
data_3 = Data([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])
data_4 = Data(Tree({0;0}: [18.02684974, 44.97155593, 44.49754397, 44.67305151, 46.12961546, 44.11163982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], {1;0}: [18.67764477, 47.53085754, 48.28251817, 49.5073936, 51.45041833, 49.62054799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], {2;0}: [43.56542521, 66.72054532, 66.35301286, 71.02286689, 76.03490489, 75.07876143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], {3;0}: [-0.2104801501, -0.09847806994, 0.7158589458, 1.210642777, 1.276519816, 1.806732404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], {4;0}: [38.38485634, 46.99936189, 29.5565895, 32.40102231, 29.75232914, 17.87688977, 25.12078017, 24.99329271, 14.30777572, 9.973999697, 11.77094356, 4.109498168], {5;0}: [16.95355396, 35.73425439, 36.88196926, 41.92035721, 36.61721271, 34.98236446, 13.19349624, 39.44832106, 39.45150278, 39.17812322, 40.07467064, 33.22735519, 8.224833331, 24.49896658, 30.49940514, 27.96966526, 23.57916394, 23.41445966, 9.389841383, 22.66315255, 29.73842918, 23.68785067, 23.24559511, 19.30034546]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))
data_5 = Data(Tree({0;0}: [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], {0;1}: [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], {0;2}: [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], {0;3}: [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], {0;4}: [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], {0;5}: [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]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))
data_6 = Data(Tree({0;0}: [3.823636442, 3.823585618, 3.823585618, 1.911818221, 1.924932958, 1.924907372, 1.924907372, 0.962466479, 3.363429399, 3.363384692, 2.194183195, 0.1996521878, 3.626375483, 3.626327281, 2.207515611, 0.5102818145], {0;1}: [-5.175900071, -4.454400192, -2.918942255, -1.502548993, 8.819786668, 5.282462989, 2.398481277, -0.3432424223, 2.333016506, 0.5709750818, 0.5842376528, 1.476879668e-05, 3.790414482, 0.5970345644, -0.1971021264, 0.02559270073], {0;2}: [8.605920672, 9.387879191, 11.32123406, 6.407116732, 2.153277079, 2.186234821, -1.481681387, -0.2628760093, 1.371220364, 0.2122120921, 1.160031539, 0.03564757609, -0.8421333588, -0.4136302734, -0.4312311279, -0.1040138218], {0;3}: [5.756517927, 6.514360466, 7.301475251, 4.255210381, 3.520431143, 2.739826934, 0.02515355392, 0.127872334, 0.4459977609, 0.007191710978, 0.9189425395, -0.04007096381, -1.010734348, -0.5549813449, -0.2215349656, -0.1128329224], {0;4}: [-0.3041572973, 0.9182555003, 2.49394256, 1.494936783, 4.898015776, 5.510450358, 2.745019657, 0.2208168717, 3.659199094, 1.100291506, 0.6383288142, 0.06917935115, 0.07164648326, 0.8453999159, 0.3942422038, -0.1333162285], {0;5}: [-2.539277721, -1.413607563, 0.7055742172, -1.544747514, 2.364070295, 3.108683484, 1.754268654, 0.7475044327, 6.380077491, 2.725353368, 0.05249392796, 0.01201713692, 1.899996897, 2.387295063, 0.7887949263, -0.09304975301]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))
preview_5 = CustomPreview(Geometry=data_5, Shader=ColourSwatch(SwatchColor=RGB(0, 0, 0)))
preview_6 = CustomPreview(Geometry=[data_3, data_2], Shader=ColourSwatch(SwatchColor=RGB(0, 0, 0)))
number_slider_4 = Slider(10, range=0..100)
# Select Out The Parts of Shades To Keep
shadecreator = Honeybee_OptimalShadeCreator(shadeMesh=data_5, shadeNetEffect=data_6, levelOfPerform=number_slider_4)  # -> readMe, energySavedByShade, areaOfShade, newColoredMesh, newShadeBrep; plug-in component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
# Select Out The Parts of Shades To Keep
shadecreator_2 = Honeybee_OptimalShadeCreator(shadeMesh=data_2, shadeNetEffect=data_4, levelOfPerform=number_slider_4)  # -> readMe, energySavedByShade, areaOfShade, newColoredMesh, newShadeBrep; plug-in component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
geo_11 = Geometry([shadecreator.newShadeBrep, shadecreator_2.newShadeBrep])
edges = BrepEdges(Brep=shadecreator_2.newShadeBrep)  # -> Naked, Interior, NonManifold
edges_2 = BrepEdges(Brep=shadecreator.newShadeBrep)  # -> Naked, Interior, NonManifold
data_7 = Data(flatten(shadecreator.areaOfShade))
data_8 = Data(flatten(shadecreator.energySavedByShade))
data_9 = Data(flatten(shadecreator_2.areaOfShade))
data_10 = Data(flatten(shadecreator_2.energySavedByShade))
ma = MassAddition(Input=data_7)  # -> Result, PartialResults
ma_2 = MassAddition(Input=data_8)  # -> Result, PartialResults
ma_3 = MassAddition(Input=data_9)  # -> Result, PartialResults
ma_4 = MassAddition(Input=data_10)  # -> Result, PartialResults
preview_7 = CustomPreview(Geometry=edges.Naked, Shader=ColourSwatch(SwatchColor=RGB(0, 0, 0)))
preview_8 = CustomPreview(Geometry=edges_2.Naked, Shader=ColourSwatch(SwatchColor=RGB(0, 0, 0)))
panel_3 = Panel(ma.Result)
panel_4 = Panel(ma_2.Result)
panel_5 = Panel(ma_3.Result)
panel_6 = Panel(ma_4.Result)

panel_7 = Panel("C:\\Users\\vasanthakumars\\Documents\\GitHub\\bibil\\src\\reference\\CAN_ON_Toronto.716240_CWEC\\CAN_ON_Toronto.716240_CWEC.epw")
panel_8 = Panel("C:\saeran\master\git\bibil\src\reference\CAN_ON_Toronto.716240_CWEC\CAN_ON_Toronto.716240_CWEC.epw")
# Run the Energy Simulation + Get Results
toggle_6 = BooleanToggle(True)
list_2 = ValueList({"dir", "file"}, selected="file")

# ---- group: find directory
bibil_7 = PythonScript(dir=[panel_8, panel_7], type=list_2, run=toggle_6)  # -> file; inputs dir: list; same code as bibil

# ----
data_11 = Data(bibil_7)

# ----
# Run the Simulation
panel_9 = Panel("test_idf_3")
toggle_7 = BooleanToggle(False)
runenergysimulation = Honeybee_RunEnergySimulation(
    epwFile=data_11,
    HBZones=flatten(setepzonethresholds.HBZones),
    simulationOutputs=flatten(epoutput.simulationOutputs),
    writeIdf=toggle_7,
    runEnergyPlus=toggle_7,
    idfFileName=panel_9)  # -> report, idfFileAddress, resultFileAddress; plug-in component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
readepsrfresult = Honeybee_ReadEPSurfaceResult(resultFileAddress=runenergysimulation.resultFileAddress)  # -> surfaceIndoorTemp, surfaceOutdoorTemp, surfaceEnergyFlow, opaqueEnergyFlow, glazEnergyFlow, windowTotalSolarEnergy, windowBeamEnergy, windowDiffEnergy, windowTransmissivity, otherSurfaceData; plug-in component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
readepresult = Honeybee_ReadEPResult(resultFileAddress=runenergysimulation.resultFileAddress)  # -> totalThermalEnergy, thermalEnergyBalance, cooling, heating, electricLight, electricEquip, fanElectric, pumpElectric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; plug-in component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

importlocation = Ladybug_ImportLocation(epwFile=data_11)  # -> location; plug-in component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
# Create Shades
epwindowshades = Honeybee_EnergyPlusWindowShadeGenerator(
    HBObjects=setepzonethresholds.HBZones,
    distToGlass=Slider(0, range=0..1),
    depth=number_slider_3,
    distBetween="3.2",
    horOrVertical=Toggle(False),
    runIt=toggle_4,
    zoneData1=readepresult.cooling,
    zoneData2=readepresult.heating,
    zoneData3=readepsrfresult.windowBeamEnergy)  # -> readMe, debug, HBObjWShades, port, windowBreps, shadeBreps, port_2, zoneData1Tree, zoneData2Tree, zoneData3Tree; plug-in component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
# Create Shades
epwindowshades_2 = Honeybee_EnergyPlusWindowShadeGenerator(
    HBObjects=setepzonethresholds.HBZones,
    distToGlass=Slider(0, range=0..1),
    depth=number_slider_3,
    numOfShds="1",
    horOrVertical=Toggle(True),
    runIt=toggle_4,
    zoneData1=readepresult.cooling,
    zoneData2=readepresult.heating,
    zoneData3=readepsrfresult.windowBeamEnergy)  # -> readMe, debug, HBObjWShades, port, windowBreps, shadeBreps, port_2, zoneData1Tree, zoneData2Tree, zoneData3Tree; plug-in component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
geo_12 = Geometry(epwindowshades.shadeBreps)
geo_13 = Geometry(epwindowshades.debug)
geo_14 = Geometry(epwindowshades_2.shadeBreps)
geo_15 = Geometry(epwindowshades_2.debug)
# Shade Benefit Analysis
energyshadebenefit = Honeybee_EnergyShadeBenefitEvaluator(
    location=importlocation,
    coolingLoad=epwindowshades.zoneData1Tree,
    heatingLoad=epwindowshades.zoneData2Tree,
    beamGain=epwindowshades.zoneData3Tree,
    testShades=epwindowshades.shadeBreps,
    testWindow=epwindowshades.windowBreps,
    gridSize=data,
    delNonIntersect=False,
    parallel=Toggle(False),
    runIt=toggle_5)  # -> readMe, port, sunVectors, windowTestPts, shadeMesh, legend, legendBasePoint, port_2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; disabled; plug-in component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
# Shade Benefit Analysis
energyshadebenefit_2 = Honeybee_EnergyShadeBenefitEvaluator(
    location=importlocation,
    coolingLoad=epwindowshades_2.zoneData1Tree,
    heatingLoad=epwindowshades_2.zoneData2Tree,
    beamGain=epwindowshades_2.zoneData3Tree,
    testShades=epwindowshades_2.shadeBreps,
    testWindow=epwindowshades_2.windowBreps,
    gridSize=data,
    delNonIntersect=False,
    parallel=Toggle(True),
    runIt=toggle_5)  # -> readMe, port, sunVectors, windowTestPts, shadeMesh, legend, legendBasePoint, port_2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; disabled; plug-in component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
