# Grasshopper definition Energy_Shade_Benefit_site_14_geom_002_internalized.gh (Grasshopper 0.9.76)
# plug-ins: Python Interpreter

bldgprograms = Honeybee_bldgPrograms({"Office": 0, "Retail": 1, "MidriseApartment": 2, "PrimarySchool": 3, "SecondarySchool": 4, "SmallHotel": 5, "LargeHotel": 6, "Hospital": 7, "Outpatient": 8, "Warehouse": 9, "SuperMarket": 10, "FullServiceRestaurant": 11, "QuickServiceRestaurant": 12}, selected="Office")
listzoneprograms = Honeybee_ListZonePrograms(bldgProgram=bldgprograms)  # -> OfficeZonePrograms; plug-in component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
list = ValueList({"dir", "file"}, selected="dir")

# ---- group: find directory
bibil = PythonScript(
    dir=["C:\\Users\\vasanthakumars\\Documents\\GitHub\\bibil\\src", "C:\\saeran\\master\\git\\bibil\\src"],
    type=list,
    run=Toggle(True))  # -> dir; inputs dir: list
# ---------- bibil: Python ----------
import os

ghenv.Component.Params.Output[0].Name = "null"
ghenv.Component.Params.Output[0].NickName = "null"

if run:
    confirm_dir = None
    for d in dir:
        try:
            if type == "file":
                file_ = open(d)
                file_.close()
            else:
                print os.listdir(d)
            confirm_dir = d
            break
        except Exception as e:
            #print str(e)
            continue
    if confirm_dir != None:
        ghenv.Component.Params.Output[0].Name = type
        ghenv.Component.Params.Output[0].NickName = type
        dir = confirm_dir
        file = confirm_dir
null = None
# ---------- end bibil ----------

# ----
panel = Panel(listzoneprograms)

# ---- group: miru
# BIBIL_CLASSES
python_script = PythonScript(i=bibil)  # -> o
# ---------- python_script: Python ----------
import os

if i:
    o = os.path.join(str(i),"miru\\miru_miru.py")
# ---------- end python_script ----------
file = ReadFile(File=python_script, PerLineParse=False)
bibil_2 = PythonScript(Code=file)

# ---- group: grammar
python_script_2 = PythonScript(i=bibil)  # -> o
# ---------- python_script_2: Python ----------
import os

if i:
    o = os.path.join(str(i),"bibil\\bibil_rule.py")
# ---------- end python_script_2 ----------
file_2 = ReadFile(File=python_script_2, PerLineParse=False)
bibil_3 = PythonScript(Code=file_2)

# ---- group: pattern
python_script_3 = PythonScript(i=bibil)  # -> o
# ---------- python_script_3: Python ----------
import os

if i:
    o = os.path.join(str(i),"bibil\\bibil_pattern.py")
# ---------- end python_script_3 ----------
file_3 = ReadFile(File=python_script_3, PerLineParse=False)
bibil_4 = PythonScript(Code=file_3)

# ---- group: shape
python_script_4 = PythonScript(i=bibil)  # -> o
# ---------- python_script_4: Python ----------
import os

if i:
    o = os.path.join(str(i),"bibil\\bibil_shape.py")
#o = os.path.join(str(i),"research\\bibil_shape_shape_3d_2d.py")
# ---------- end python_script_4 ----------
file_4 = ReadFile(File=python_script_4, PerLineParse=False)
bibil_5 = PythonScript(Code=file_4)

# ---- group: tree
python_script_5 = PythonScript(i=bibil)  # -> o
# ---------- python_script_5: Python ----------
import os

if i:
    o = os.path.join(str(i),"bibil\\bibil_tree.py")
# ---------- end python_script_5 ----------
file_5 = ReadFile(File=python_script_5, PerLineParse=False)
bibil_6 = PythonScript(Code=file_5)

# ---- group: bula
python_script_6 = PythonScript(i=bibil)  # -> o
# ---------- python_script_6: Python ----------
import os

if i:
    o = os.path.join(str(i),"bula\\bula_minimal.py")
# ---------- end python_script_6 ----------
file_6 = ReadFile(File=python_script_6, PerLineParse=False)

# ---- group: node_comp
python_script_7 = PythonScript(i=bibil)  # -> o
# ---------- python_script_7: Python ----------
import os

if i:
    o = os.path.join(str(i),"bibil\\bibil_UI.py")
# ---------- end python_script_7 ----------
file_7 = ReadFile(File=python_script_7, PerLineParse=False)

# ---- group: grammar_divide
python_script_8 = PythonScript(i=bibil)  # -> o
# ---------- python_script_8: Python ----------
import os

if i:
    o = os.path.join(str(i),"miru\\miru_divide.py")
# ---------- end python_script_8 ----------
file_8 = ReadFile(File=python_script_8, PerLineParse=False)

# ---- group: grammar_courtyard
python_script_9 = PythonScript(i=bibil)  # -> o
# ---------- python_script_9: Python ----------
import os

if i:
    o = os.path.join(str(i),"miru\\miru_court.py")
# ---------- end python_script_9 ----------
file_9 = ReadFile(File=python_script_9, PerLineParse=False)

# ---- group: grammar_tower
python_script_10 = PythonScript(i=bibil)  # -> o
# ---------- python_script_10: Python ----------
import os

if i:
    o = os.path.join(str(i),"miru\\miru_packing.py")
# ---------- end python_script_10 ----------
file_10 = ReadFile(File=python_script_10, PerLineParse=False)

python_script_11 = PythonScript(i=bibil)  # -> o
# ---------- python_script_11: Python ----------
import os

if i:
    o = os.path.join(str(i),"miru\\miru_stepback.py")
# ---------- end python_script_11 ----------
file_11 = ReadFile(File=python_script_11, PerLineParse=False)

# ---- group: grammar_height
python_script_12 = PythonScript(i=bibil)  # -> o
# ---------- python_script_12: Python ----------
import os

if i:
    o = os.path.join(str(i),"miru\\miru_height.py")
# ---------- end python_script_12 ----------
file_12 = ReadFile(File=python_script_12, PerLineParse=False)

# ----
toggle = BooleanToggle(False)
geo = Geometry([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])
geo_2 = Geometry(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)
geo_3 = Geometry(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)
geo_4 = Geometry([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])
geo_5 = Geometry([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])
geo_6 = Geometry([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])
geo_7 = Geometry([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])
geo_8 = Geometry(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)
geo_9 = Geometry([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])
geo_10 = Geometry(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)
labelzones = Honeybee_LabelZones(HBZones=geo, num="2", run=toggle)  # -> vizHBZones; plug-in component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
# CORE
labelzones_2 = Honeybee_LabelZones(HBZones=geo_2, num="2", run=toggle)  # -> vizHBZones; plug-in component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
labelzones_3 = Honeybee_LabelZones(HBZones=geo_3, num="2", run=toggle)  # -> vizHBZones; plug-in component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
# WEST
labelzones_4 = Honeybee_LabelZones(HBZones=geo_4, num="2", run=toggle)  # -> vizHBZones; plug-in component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
labelzones_5 = Honeybee_LabelZones(HBZones=geo_5, num="2", run=toggle)  # -> vizHBZones; plug-in component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
# NORTH
labelzones_6 = Honeybee_LabelZones(HBZones=geo_6, num="2", run=toggle)  # -> vizHBZones; plug-in component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
# EAST
labelzones_7 = Honeybee_LabelZones(HBZones=geo_7, num="2", run=toggle)  # -> vizHBZones; plug-in component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
labelzones_8 = Honeybee_LabelZones(HBZones=geo_8, num="2", run=toggle)  # -> vizHBZones; plug-in component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
# SOUTH
labelzones_9 = Honeybee_LabelZones(HBZones=geo_9, num="2", run=toggle)  # -> vizHBZones; plug-in component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
labelzones_10 = Honeybee_LabelZones(HBZones=geo_10, num="2", run=toggle)  # -> vizHBZones; plug-in component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
item = ListItem(List=listzoneprograms, Index="3", Wrap=True)
item_2 = ListItem(List=listzoneprograms, Index="3", Wrap=True)
item_3 = ListItem(List=listzoneprograms, Index="3", Wrap=True)
item_4 = ListItem(List=listzoneprograms, Index="5", Wrap=True)
item_5 = ListItem(List=listzoneprograms, Index="5", Wrap=True)
item_6 = ListItem(List=listzoneprograms, Index="11", Wrap=True)
item_7 = ListItem(List=listzoneprograms, Index="3", Wrap=True)
mass2zone = Honeybee_Masses2Zones(
    zoneMasses=flatten(labelzones),
    zonePrograms=item_5,
    isConditioned=Toggle(True),
    maxRoofAngle=30,
    createHBZones=Toggle(True))  # -> readMe, HBZones; plug-in component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
mass2zone_2 = Honeybee_Masses2Zones(
    zoneMasses=flatten(labelzones_2),
    zonePrograms=item_4,
    isConditioned=Toggle(True),
    maxRoofAngle=30,
    createHBZones=Toggle(True))  # -> readMe, HBZones; plug-in component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
ladybug = Ladybug_Ladybug()  # -> Vviiiiiiiiiizzz; plug-in component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
mass2zone_3 = Honeybee_Masses2Zones(
    zoneMasses=flatten(labelzones_3),
    zonePrograms=item_6,
    isConditioned=Toggle(True),
    maxRoofAngle=30,
    createHBZones=Toggle(True))  # -> readMe, HBZones; plug-in component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
honeybee = Honeybee_Honeybee()  # -> Vviiiiiiiiiizzz; plug-in component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

# ---- group: west w/ glazing
mass2zone_4 = Honeybee_Masses2Zones(
    zoneMasses=flatten(labelzones_4),
    zonePrograms=item_2,
    isConditioned=Toggle(True),
    maxRoofAngle=30,
    createHBZones=Toggle(True))  # -> readMe, HBZones; plug-in component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

# ---- group: north w/ glazing
mass2zone_5 = Honeybee_Masses2Zones(
    zoneMasses=flatten(labelzones_6),
    zonePrograms=item_3,
    isConditioned=Toggle(True),
    maxRoofAngle=30,
    createHBZones=Toggle(True))  # -> readMe, HBZones; plug-in component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

# ---- group: west w/o glazing
mass2zone_6 = Honeybee_Masses2Zones(
    zoneMasses=flatten(labelzones_5),
    zonePrograms=item_2,
    isConditioned=Toggle(True),
    maxRoofAngle=30,
    createHBZones=Toggle(True))  # -> readMe, HBZones; plug-in component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

# ---- group: north w/o glazing
mass2zone_7 = Honeybee_Masses2Zones(
    zoneMasses=flatten(labelzones_8),
    zonePrograms=item_3,
    isConditioned=Toggle(True),
    maxRoofAngle=30,
    createHBZones=Toggle(True))  # -> readMe, HBZones; plug-in component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

# ---- group: east w/ glazing
mass2zone_8 = Honeybee_Masses2Zones(
    zoneMasses=flatten(labelzones_7),
    zonePrograms=item,
    isConditioned=Toggle(True),
    maxRoofAngle=30,
    createHBZones=Toggle(True))  # -> readMe, HBZones; plug-in component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

# ---- group: south w/ glazing
mass2zone_9 = Honeybee_Masses2Zones(
    zoneMasses=flatten(labelzones_9),
    zonePrograms=item_7,
    isConditioned=Toggle(True),
    maxRoofAngle=30,
    createHBZones=Toggle(True))  # -> readMe, HBZones; plug-in component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

# ---- group: south w/o glazing
mass2zone_10 = Honeybee_Masses2Zones(
    zoneMasses=flatten(labelzones_10),
    zonePrograms=item_7,
    isConditioned=Toggle(True),
    maxRoofAngle=30,
    createHBZones=Toggle(True))  # -> readMe, HBZones; plug-in component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

# ----
geo_11 = Geometry(mass2zone_3.HBZones)
geo_12 = Geometry(mass2zone_2.HBZones)
geo_13 = Geometry(mass2zone_8.HBZones)
geo_14 = Geometry(mass2zone_5.HBZones)
geo_15 = Geometry(mass2zone_7.HBZones)
geo_16 = Geometry(mass2zone_9.HBZones)
geo_17 = Geometry(mass2zone_4.HBZones)
geo_18 = Geometry(mass2zone_6.HBZones)
geo_19 = Geometry(mass2zone_10.HBZones)
geo_20 = Geometry(mass2zone.HBZones)
zoneattributelist = Honeybee_ZoneAttributeList({"Name": "name", "Zone Program": "zoneProgram", "Zone Floor Area": "zoneFloorArea", "Zone Volume": "zoneVolume", "Building Program": "bldgProgram", "Is Conditioned": "isConditioned", "HVAC System Type": "HVACSystem", "Occupancy Schedule": "occupancySchedule", "Occupancy Activity Schedule": "occupancyActivitySch", "Heating SetPoint Schedule": "heatingSetPtSchedule"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}, selected="Name")
zoneattributelist_2 = Honeybee_ZoneAttributeList({"Name": "name", "Zone Program": "zoneProgram", "Zone Floor Area": "zoneFloorArea", "Zone Volume": "zoneVolume", "Building Program": "bldgProgram", "Is Conditioned": "isConditioned", "HVAC System Type": "HVACSystem", "Occupancy Schedule": "occupancySchedule", "Occupancy Activity Schedule": "occupancyActivitySch", "Heating SetPoint Schedule": "heatingSetPtSchedule"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}, selected="Name")
zoneattributelist_3 = Honeybee_ZoneAttributeList({"Name": "name", "Zone Program": "zoneProgram", "Zone Floor Area": "zoneFloorArea", "Zone Volume": "zoneVolume", "Building Program": "bldgProgram", "Is Conditioned": "isConditioned", "HVAC System Type": "HVACSystem", "Occupancy Schedule": "occupancySchedule", "Occupancy Activity Schedule": "occupancyActivitySch", "Heating SetPoint Schedule": "heatingSetPtSchedule"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}, selected="Name")
data = Data(mass2zone_8.HBZones)
data_2 = Data([mass2zone_9.HBZones, mass2zone_10.HBZones])
data_3 = Data([mass2zone_6.HBZones, mass2zone_4.HBZones])
data_4 = Data([mass2zone.HBZones, mass2zone_3.HBZones, mass2zone_2.HBZones])
data_5 = Data([mass2zone_5.HBZones, mass2zone_7.HBZones])
labelzones_11 = Honeybee_LabelZones(HBZones=flatten(mass2zone_6.HBZones), attribute=zoneattributelist, textHeight=Slider(5, range=0..10))  # -> zoneTxtLabels, labelBasePts, brepTxtLabels, zoneWireFrames; plug-in component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
labelzones_12 = Honeybee_LabelZones(HBZones=flatten(mass2zone_7.HBZones), attribute=zoneattributelist_2, textHeight=Slider(5, range=0..10))  # -> zoneTxtLabels, labelBasePts, brepTxtLabels, zoneWireFrames; plug-in component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
labelzones_13 = Honeybee_LabelZones(HBZones=flatten(mass2zone_10.HBZones), attribute=zoneattributelist_3, textHeight=Slider(5, range=0..10))  # -> zoneTxtLabels, labelBasePts, brepTxtLabels, zoneWireFrames; plug-in component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
solveadjc = Honeybee_SolveAdjacencies(HBZones=flatten([data_4, data_5, data, data_2, data_3]), removeCurrentAdjc=False, findAdjc=Toggle(True))  # -> readMe, HBZonesWADJ; plug-in component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
zoneattributelist_4 = Honeybee_ZoneAttributeList({"Name": "name", "Zone Program": "zoneProgram", "Zone Floor Area": "zoneFloorArea", "Zone Volume": "zoneVolume", "Building Program": "bldgProgram", "Is Conditioned": "isConditioned", "HVAC System Type": "HVACSystem", "Occupancy Schedule": "occupancySchedule", "Occupancy Activity Schedule": "occupancyActivitySch", "Heating SetPoint Schedule": "heatingSetPtSchedule"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}, selected="Name")
labelzones_14 = Honeybee_LabelZones(HBZones=flatten(solveadjc.HBZonesWADJ), attribute=zoneattributelist_4, textHeight=Slider(5, range=0..10))  # -> zoneTxtLabels, labelBasePts, brepTxtLabels, zoneWireFrames; plug-in component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
toggle_2 = BooleanToggle(False)
toggle_3 = BooleanToggle(True)
X = UnitX(Factor="17")
Z = UnitZ(Factor="5")
glzparamlist = Honeybee_GlazingParametersList(northGlzParam=toggle_2, westGlzParam=toggle_3, southGlzParam=toggle_2, eastGlzParam=toggle_3)  # -> glzParamList; plug-in component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
glzparamlist_2 = Honeybee_GlazingParametersList(northGlzParam="0.9", westGlzParam="0.5", southGlzParam="0.9", eastGlzParam="0.5")  # -> glzParamList; plug-in component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
move = Move(Geometry=labelzones_14.labelBasePts, Motion=Z)  # -> Geometry, Transform
move_2 = Move(Geometry=labelzones_14.labelBasePts, Motion=X)  # -> Geometry, Transform
python = PythonScript(
    HBZones=solveadjc.HBZonesWADJ,
    ref_index=flatten([labelzones_11.zoneTxtLabels, labelzones_12.zoneTxtLabels, labelzones_13.zoneTxtLabels]),
    total_index=flatten(labelzones_14.zoneTxtLabels))  # -> other_HBZones, index_HBZones; inputs HBZones: list, ref_index: list, total_index: list
# ---------- python: Python ----------
if HBZones and ref_index and total_index:
    other_HBZones = []
    index_HBZones = []
    
    """
    for ti_,tindex in enumerate(total_index);
        strlst = tindex.split('_')
        total_index[ti_] = strlst[1]
        
    for ri_,index in enumerate(ref_index):
        strlst = index.split('_')
        ref_index[ri_] = strlst[1]
    """
    
    #Loop through zones
    for hlbl,hbz in zip(total_index,HBZones):
        if hlbl not in ref_index:
            other_HBZones.append(hbz)
        else:
            index_HBZones.append(hbz)
    

print index_HBZones
print other_HBZones
# ---------- end python ----------
X_2 = UnitX(Factor="17")
move_3 = Move(Geometry=move.Geometry, Motion=X_2)  # -> Geometry, Transform
ln = Line(StartPoint=move_3.Geometry, EndPoint=move_2.Geometry)
swatch = ColourSwatch(SwatchColor=RGB(0, 0, 0))
data_6 = Data(data_5)
zoneattributelist_5 = Honeybee_ZoneAttributeList({"Name": "name", "Zone Program": "zoneProgram", "Zone Floor Area": "zoneFloorArea", "Zone Volume": "zoneVolume", "Building Program": "bldgProgram", "Is Conditioned": "isConditioned", "HVAC System Type": "HVACSystem", "Occupancy Schedule": "occupancySchedule", "Occupancy Activity Schedule": "occupancyActivitySch", "Heating SetPoint Schedule": "heatingSetPtSchedule"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}, selected="Name")
data_7 = Data(data)
zoneattributelist_6 = Honeybee_ZoneAttributeList({"Name": "name", "Zone Program": "zoneProgram", "Zone Floor Area": "zoneFloorArea", "Zone Volume": "zoneVolume", "Building Program": "bldgProgram", "Is Conditioned": "isConditioned", "HVAC System Type": "HVACSystem", "Occupancy Schedule": "occupancySchedule", "Occupancy Activity Schedule": "occupancyActivitySch", "Heating SetPoint Schedule": "heatingSetPtSchedule"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}, selected="Name")
data_8 = Data(data_2)
zoneattributelist_7 = Honeybee_ZoneAttributeList({"Name": "name", "Zone Program": "zoneProgram", "Zone Floor Area": "zoneFloorArea", "Zone Volume": "zoneVolume", "Building Program": "bldgProgram", "Is Conditioned": "isConditioned", "HVAC System Type": "HVACSystem", "Occupancy Schedule": "occupancySchedule", "Occupancy Activity Schedule": "occupancyActivitySch", "Heating SetPoint Schedule": "heatingSetPtSchedule"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}, selected="Name")
data_9 = Data(data_3)
zoneattributelist_8 = Honeybee_ZoneAttributeList({"Name": "name", "Zone Program": "zoneProgram", "Zone Floor Area": "zoneFloorArea", "Zone Volume": "zoneVolume", "Building Program": "bldgProgram", "Is Conditioned": "isConditioned", "HVAC System Type": "HVACSystem", "Occupancy Schedule": "occupancySchedule", "Occupancy Activity Schedule": "occupancyActivitySch", "Heating SetPoint Schedule": "heatingSetPtSchedule"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}, selected="Name")
preview = CustomPreview(Geometry=[ln, move_2.Geometry], Shader=swatch)
tag = TextTag3D(Location=move_3.Geometry, Text=labelzones_14.zoneTxtLabels, Size=1, Colour=swatch, Justification=7)
glazingcreator = Honeybee_GlazingBasedOnRatio(HBObjects=python.other_HBZones, glzRatio=glzparamlist_2, breakUpWindow=glzparamlist, runIt=Toggle(True))  # -> readMe, HBObjWGLZ; plug-in component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
# NORTH
labelzones_15 = Honeybee_LabelZones(HBZones=flatten(data_6), attribute=zoneattributelist_5)  # -> zoneTxtLabels, labelBasePts, brepTxtLabels, zoneWireFrames; plug-in component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
# EAST
labelzones_16 = Honeybee_LabelZones(HBZones=flatten(data_7), attribute=zoneattributelist_6)  # -> zoneTxtLabels, labelBasePts, brepTxtLabels, zoneWireFrames; plug-in component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
# SOUTH
labelzones_17 = Honeybee_LabelZones(HBZones=flatten(data_8), attribute=zoneattributelist_7)  # -> zoneTxtLabels, labelBasePts, brepTxtLabels, zoneWireFrames; plug-in component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
# WEST
labelzones_18 = Honeybee_LabelZones(HBZones=flatten(data_9), attribute=zoneattributelist_8)  # -> zoneTxtLabels, labelBasePts, brepTxtLabels, zoneWireFrames; plug-in component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
number_slider = Slider(24, range=22..28)
number_slider_2 = Slider(19, range=16..20)
toggle_4 = BooleanToggle(True)
setepzonethresholds = Honeybee_SetEnergyPlusZoneThresholds(
    HBZones=flatten([glazingcreator.HBObjWGLZ, python.index_HBZones]),
    coolingSetPt=number_slider,
    coolingSetback=number_slider,
    heatingSetPt=number_slider_2,
    heatingSetback=number_slider_2)  # -> readMe, HBZones; plug-in component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
separatezonesbyfloor = Honeybee_SeparateZonesByFloor(HBZones=flatten(setepzonethresholds.HBZones))  # -> floorHeights, HBZones; plug-in component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
panel_2 = Panel(separatezonesbyfloor.HBZones)
panel_3 = Panel(separatezonesbyfloor.floorHeights)
zoneattributelist_9 = Honeybee_ZoneAttributeList({"Name": "name", "Zone Program": "zoneProgram", "Zone Floor Area": "zoneFloorArea", "Zone Volume": "zoneVolume", "Building Program": "bldgProgram", "Is Conditioned": "isConditioned", "HVAC System Type": "HVACSystem", "Occupancy Schedule": "occupancySchedule", "Occupancy Activity Schedule": "occupancyActivitySch", "Heating SetPoint Schedule": "heatingSetPtSchedule"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}, selected="Name")
epoutput = Honeybee_GenerateEPOutput(
    zoneEnergyUse=toggle_4,
    zoneGainsAndLosses="False",
    zoneComfortMetrics="False",
    surfaceTempAnalysis="False",
    surfaceEnergyAnalysis=toggle_4,
    glazingSolarAnalysis=toggle_4,
    timestep="hourly")  # -> report, flatten(simulationOutputs); plug-in component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

decomposebytype = Honeybee_DecomposeBasedOnType(HBZone=setepzonethresholds.HBZones)  # -> walls, interiorWalls, airWalls, windows, interiorWindows, skylights, roofs, ceilings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; plug-in component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
preview_2 = CustomPreview(Geometry=decomposebytype.windows, Shader=ColourSwatch(SwatchColor=RGBA(178, 232, 255, 108)))
preview_3 = CustomPreview(Geometry=decomposebytype.walls, Shader=ColourSwatch(SwatchColor=RGB(219, 219, 217)))
preview_4 = CustomPreview(Geometry=[decomposebytype.groundFloors, decomposebytype.floors], Shader=ColourSwatch(SwatchColor=RGB(214, 131, 131)))
preview_5 = CustomPreview(
    Geometry=[decomposebytype.roofs, decomposebytype.floors, decomposebytype.exposedFloors],
    Shader=ColourSwatch(SwatchColor=RGB(128, 128, 128)))

labelzones_19 = Honeybee_LabelZones(HBZones=flatten(setepzonethresholds.HBZones), attribute=zoneattributelist_9)  # -> zoneTxtLabels, labelBasePts, brepTxtLabels, zoneWireFrames; plug-in component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
data_10 = Data(labelzones_19.zoneTxtLabels)

# ---- group: NORTH
python_2 = PythonScript(HBZones=data_6, ref_index=flatten(labelzones_15.zoneTxtLabels), total_index=flatten(data_10))  # -> other_HBZones, index_HBZones; inputs HBZones: list, ref_index: list, total_index: list; same code as python

# ---- group: EAST
python_3 = PythonScript(HBZones=data_7, ref_index=flatten(labelzones_16.zoneTxtLabels), total_index=flatten(data_10))  # -> other_HBZones, index_HBZones; inputs HBZones: list, ref_index: list, total_index: list; same code as python

# ---- group: SOUTH
python_4 = PythonScript(HBZones=data_8, ref_index=flatten(labelzones_17.zoneTxtLabels), total_index=flatten(data_10))  # -> other_HBZones, index_HBZones; inputs HBZones: list, ref_index: list, total_index: list; same code as python

python_5 = PythonScript(HBZones=data_9, ref_index=flatten(labelzones_18.zoneTxtLabels), total_index=flatten(data_10))  # -> other_HBZones, index_HBZones; inputs HBZones: list, ref_index: list, total_index: list; same code as python

# ----
separatezonesbyorientation = Honeybee_SeparateZonesByOrientation(HBZones=flatten(setepzonethresholds.HBZones), onlyWGlz=Toggle(True))  # -> orientations, HBZones; plug-in component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
toggle_5 = BooleanToggle(True)
toggle_6 = BooleanToggle(False)
zoneattributelist_10 = Honeybee_ZoneAttributeList({"Name": "name", "Zone Program": "zoneProgram", "Zone Floor Area": "zoneFloorArea", "Zone Volume": "zoneVolume", "Building Program": "bldgProgram", "Is Conditioned": "isConditioned", "HVAC System Type": "HVACSystem", "Occupancy Schedule": "occupancySchedule", "Occupancy Activity Schedule": "occupancyActivitySch", "Heating SetPoint Schedule": "heatingSetPtSchedule"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}, selected="Name")
toggle_7 = BooleanToggle(True)
panel_4 = Panel(separatezonesbyorientation.HBZones)
glzparamlist_3 = Honeybee_GlazingParametersList(northGlzParam="1", westGlzParam="0.0", southGlzParam="1", eastGlzParam="0.0")  # -> glzParamList; plug-in component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
glzparamlist_4 = Honeybee_GlazingParametersList(northGlzParam="0.0", westGlzParam="3.2", southGlzParam="0.0", eastGlzParam="3.2")  # -> glzParamList; plug-in component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
glzparamlist_5 = Honeybee_GlazingParametersList(northGlzParam=toggle_5, westGlzParam=toggle_6, southGlzParam=toggle_5, eastGlzParam=toggle_6)  # -> glzParamList; plug-in component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
labelzones_20 = Honeybee_LabelZones(HBZones=separatezonesbyorientation.HBZones, attribute=zoneattributelist_10)  # -> zoneTxtLabels, labelBasePts, brepTxtLabels, zoneWireFrames; plug-in component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
panel_5 = Panel(labelzones_20.zoneTxtLabels)
panel_6 = Panel(".25")
data_11 = Data("0.5")
data_12 = Data(Tree({0;0}: [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], {1;0}: [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], {2;0}: [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], {2;1}: [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], {2;2}: [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], {2;3}: [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]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))
data_13 = Data([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])
data_14 = Data(Tree({0;0}: [4.045796904, 3.578795698, 3.822958538, 3.62282769, 3.703723973, 4.009096521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], {1;0}: [-0.2116718511, -0.1029661702, 0.6922074681, 1.177736361, 1.232591716, 1.756550823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], {2;0}: [0.919507112, 0.9194948899, 0.9194948899, 0.459753556, -0.06677269448, -0.06677180693, -0.06677180693, -0.03339123008, 0.0505243029, 0.05052363133, 0.05052363133, 0.04457591954, 0.5099113403, 0.5099045626, 0.1916655621, -0.1704644319], {2;1}: [-7.200741337, -7.2608376, -8.241070406, -4.224794971, -8.563524489, -9.559896672, -9.763583728, -3.391530824, -5.657008296, -8.964871554, -8.454791677, -1.880013466, -8.45670632, -8.940808102, -5.50698522, -1.245602937], {2;2}: [-5.498073291, -5.473619165, -6.183728666, -3.206785866, -8.452673462, -9.443725114, -10.55250995, -2.804784639, -8.685781843, -9.647811955, -8.19633166, -1.942145096, -7.697403342, -9.101923139, -5.422625861, -1.257616749], {2;3}: [-5.196749705, -5.158085345, -6.026106543, -2.478082351, -8.244513873, -9.122279864, -10.45666242, -2.832913494, -9.137201377, -8.893102494, -7.092535501, -2.006685394, -8.781157667, -10.4336704, -6.266108196, -1.213022327]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))
preview_6 = CustomPreview(Geometry=[data_13, data_12], Shader=ColourSwatch(SwatchColor=RGB(0, 0, 0)))
# Select Out The Parts of Shades To Keep
shadecreator = Honeybee_OptimalShadeCreator(shadeMesh=data_12, shadeNetEffect=data_14, levelOfPerform=Slider(5, range=0..100))  # -> readMe, energySavedByShade, areaOfShade, newColoredMesh, newShadeBrep; plug-in component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
data_15 = Data(flatten(shadecreator.areaOfShade))
data_16 = Data(flatten(shadecreator.energySavedByShade))
edges = BrepEdges(Brep=shadecreator.newShadeBrep)  # -> Naked, Interior, NonManifold
geo_21 = Geometry(shadecreator.newShadeBrep)
ma = MassAddition(Input=data_15)  # -> Result, PartialResults
ma_2 = MassAddition(Input=data_16)  # -> Result, PartialResults
preview_7 = CustomPreview(Geometry=edges.Naked, Shader=ColourSwatch(SwatchColor=RGB(0, 0, 0)))
panel_7 = Panel(ma.Result)
panel_8 = Panel(ma_2.Result)

panel_9 = Panel("C:\\Users\\vasanthakumars\\Documents\\GitHub\\bibil\\src\\reference\\CAN_ON_Toronto.716240_CWEC\\CAN_ON_Toronto.716240_CWEC.epw")
panel_10 = Panel("C:\saeran\master\git\bibil\src\reference\CAN_ON_Toronto.716240_CWEC\CAN_ON_Toronto.716240_CWEC.epw")
# Run the Energy Simulation + Get Results
toggle_8 = BooleanToggle(True)
list_2 = ValueList({"dir", "file"}, selected="file")

# ---- group: find directory
bibil_7 = PythonScript(dir=[panel_10, panel_9], type=list_2, run=toggle_8)  # -> file; inputs dir: list; same code as bibil

# ----
data_17 = Data(bibil_7)

# ----
# Run the Simulation
panel_11 = Panel("test_idf_3")
toggle_9 = BooleanToggle(True)
runenergysimulation = Honeybee_RunEnergySimulation(
    epwFile=data_17,
    HBZones=flatten(setepzonethresholds.HBZones),
    simulationOutputs=flatten(epoutput.simulationOutputs),
    writeIdf=toggle_9,
    runEnergyPlus=toggle_9,
    idfFileName=panel_11)  # -> report, idfFileAddress, resultFileAddress; plug-in component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
readepsrfresult = Honeybee_ReadEPSurfaceResult(resultFileAddress="c:\ladybug\test_idf_3\EnergyPlus\test_idf_3.csv")  # -> port, port_2, surfaceEnergyFlow, opaqueEnergyFlow, glazEnergyFlow, windowTotalSolarEnergy, windowBeamEnergy, windowDiffEnergy, port_3, port_4; plug-in component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
readepresult = Honeybee_ReadEPResult(resultFileAddress="c:\ladybug\test_idf_3\EnergyPlus\test_idf_3.csv")  # -> totalThermalEnergy, thermalEnergyBalance, cooling, heating, electricLight, electricEquip, port, port_2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; plug-in component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

panel_12 = Panel(readepresult.cooling)
python_6 = PythonScript(
    tree_orient=separatezonesbyorientation.orientations,
    tree_HBZ=separatezonesbyorientation.HBZones,
    tree_cooling=readepresult.cooling)  # -> heating, cooling; inputs tree_orient: tree, tree_HBZ: tree, tree_cooling: tree
# ---------- python_6: Python ----------
def tree2nest(tree):
    nested_lst = []
    for i in range(tree.BranchCount):
        branchList = tree.Branch(i)
        nested_lst.append(branchList)
    return nested_lst

orient = tree2nest(tree_orient)
cool = tree2nest(tree_cooling)
HBZ = tree2nest(tree_HBZ)

i = 0
print cool[i][2]
print
# ---------- end python_6 ----------
importlocation = Ladybug_ImportLocation(epwFile=data_17)  # -> location; plug-in component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
colorzones = Honeybee_ColorZonesByEPResult(
    zoneData=readepresult.cooling,
    HBZones=flatten(setepzonethresholds.HBZones),
    normalizeByFloorArea=Toggle(True),
    runIt=Toggle(True))  # -> readMe, zoneColoredMesh, zoneWireFrame, legend, legendBasePt, analysisTitle, zoneBreps, zoneColors, zoneValues, floorNormZoneData; plug-in component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
# Create Shades
epwindowshades = Honeybee_EnergyPlusWindowShadeGenerator(
    HBObjects=setepzonethresholds.HBZones,
    distToGlass=Slider(0, range=0..1),
    depth=Slider(2, range=0..10),
    numOfShds=glzparamlist_3,
    distBetween=glzparamlist_4,
    horOrVertical=glzparamlist_5,
    runIt=Toggle(True),
    zoneData1=readepresult.cooling,
    zoneData2=readepresult.heating,
    zoneData3=readepsrfresult.windowBeamEnergy)  # -> readMe, debug, HBObjWShades, port, windowBreps, shadeBreps, port_2, zoneData1Tree, zoneData2Tree, zoneData3Tree; plug-in component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
geo_22 = Geometry(colorzones.zoneBreps)
preview_8 = CustomPreview(Geometry=colorzones.zoneBreps, Shader=colorzones.zoneColors)
geo_23 = Geometry(epwindowshades.shadeBreps)
geo_24 = Geometry(epwindowshades.debug)
wires = BrepWireframe(Brep=geo_23, Density=-1)
# Shade Benefit Analysis
energyshadebenefit = Honeybee_EnergyShadeBenefitEvaluator(
    location=importlocation,
    coolingLoad=epwindowshades.zoneData1Tree,
    heatingLoad=epwindowshades.zoneData2Tree,
    beamGain=epwindowshades.zoneData3Tree,
    testShades=epwindowshades.shadeBreps,
    testWindow=epwindowshades.windowBreps,
    gridSize=data_11,
    delNonIntersect=False,
    parallel=Toggle(True),
    runIt=Toggle(True))  # -> readMe, port, sunVectors, windowTestPts, shadeMesh, legend, legendBasePoint, port_2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; plug-in component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
