# Grasshopper definition Energy_Shade_Benefit_site_14_geom_004_.gh (Grasshopper 0.9.76)
# plug-ins: Python Interpreter

list = ValueList({"dir", "file"}, selected="dir")

# ---- group: find directory
bibil = PythonScript(
    dir=["C:\\Users\\vasanthakumars\\Documents\\GitHub\\bibil\\src", "C:\\saeran\\master\\git\\bibil\\src"],
    type=list,
    run=Toggle(True))  # -> dir; inputs dir: list
# ---------- bibil: Python ----------
import os

ghenv.Component.Params.Output[0].Name = "null"
ghenv.Component.Params.Output[0].NickName = "null"

if run:
    confirm_dir = None
    for d in dir:
        try:
            if type == "file":
                file_ = open(d)
                file_.close()
            else:
                print os.listdir(d)
            confirm_dir = d
            break
        except Exception as e:
            #print str(e)
            continue
    if confirm_dir != None:
        ghenv.Component.Params.Output[0].Name = type
        ghenv.Component.Params.Output[0].NickName = type
        dir = confirm_dir
        file = confirm_dir
null = None
# ---------- end bibil ----------

# ---- group: miru
# BIBIL_CLASSES
python_script = PythonScript(i=bibil)  # -> o
# ---------- python_script: Python ----------
import os

if i:
    o = os.path.join(str(i),"miru\\miru_miru.py")
# ---------- end python_script ----------
file = ReadFile(File=python_script, PerLineParse=False)
bibil_2 = PythonScript(Code=file)

# ---- group: grammar
python_script_2 = PythonScript(i=bibil)  # -> o
# ---------- python_script_2: Python ----------
import os

if i:
    o = os.path.join(str(i),"bibil\\bibil_rule.py")
# ---------- end python_script_2 ----------
file_2 = ReadFile(File=python_script_2, PerLineParse=False)
bibil_3 = PythonScript(Code=file_2)

# ---- group: pattern
python_script_3 = PythonScript(i=bibil)  # -> o
# ---------- python_script_3: Python ----------
import os

if i:
    o = os.path.join(str(i),"bibil\\bibil_pattern.py")
# ---------- end python_script_3 ----------
file_3 = ReadFile(File=python_script_3, PerLineParse=False)
bibil_4 = PythonScript(Code=file_3)

# ---- group: shape
python_script_4 = PythonScript(i=bibil)  # -> o
# ---------- python_script_4: Python ----------
import os

if i:
    o = os.path.join(str(i),"bibil\\bibil_shape.py")
#o = os.path.join(str(i),"research\\bibil_shape_shape_3d_2d.py")
# ---------- end python_script_4 ----------
file_4 = ReadFile(File=python_script_4, PerLineParse=False)
bibil_5 = PythonScript(Code=file_4)

# ---- group: tree
python_script_5 = PythonScript(i=bibil)  # -> o
# ---------- python_script_5: Python ----------
import os

if i:
    o = os.path.join(str(i),"bibil\\bibil_tree.py")
# ---------- end python_script_5 ----------
file_5 = ReadFile(File=python_script_5, PerLineParse=False)
bibil_6 = PythonScript(Code=file_5)

# ---- group: bula
python_script_6 = PythonScript(i=bibil)  # -> o
# ---------- python_script_6: Python ----------
import os

if i:
    o = os.path.join(str(i),"bula\\bula_minimal.py")
# ---------- end python_script_6 ----------
file_6 = ReadFile(File=python_script_6, PerLineParse=False)

# ---- group: node_comp
python_script_7 = PythonScript(i=bibil)  # -> o
# ---------- python_script_7: Python ----------
import os

if i:
    o = os.path.join(str(i),"bibil\\bibil_UI.py")
# ---------- end python_script_7 ----------
file_7 = ReadFile(File=python_script_7, PerLineParse=False)

# ---- group: grammar_divide
python_script_8 = PythonScript(i=bibil)  # -> o
# ---------- python_script_8: Python ----------
import os

if i:
    o = os.path.join(str(i),"miru\\miru_divide.py")
# ---------- end python_script_8 ----------
file_8 = ReadFile(File=python_script_8, PerLineParse=False)

# ---- group: grammar_courtyard
python_script_9 = PythonScript(i=bibil)  # -> o
# ---------- python_script_9: Python ----------
import os

if i:
    o = os.path.join(str(i),"miru\\miru_court.py")
# ---------- end python_script_9 ----------
file_9 = ReadFile(File=python_script_9, PerLineParse=False)

# ---- group: grammar_tower
python_script_10 = PythonScript(i=bibil)  # -> o
# ---------- python_script_10: Python ----------
import os

if i:
    o = os.path.join(str(i),"miru\\miru_packing.py")
# ---------- end python_script_10 ----------
file_10 = ReadFile(File=python_script_10, PerLineParse=False)

python_script_11 = PythonScript(i=bibil)  # -> o
# ---------- python_script_11: Python ----------
import os

if i:
    o = os.path.join(str(i),"miru\\miru_stepback.py")
# ---------- end python_script_11 ----------
file_11 = ReadFile(File=python_script_11, PerLineParse=False)

# ---- group: grammar_height
python_script_12 = PythonScript(i=bibil)  # -> o
# ---------- python_script_12: Python ----------
import os

if i:
    o = os.path.join(str(i),"miru\\miru_height.py")
# ---------- end python_script_12 ----------
file_12 = ReadFile(File=python_script_12, PerLineParse=False)

# ----
bldgprograms = Honeybee_bldgPrograms({"Office": 0, "Retail": 1, "MidriseApartment": 2, "PrimarySchool": 3, "SecondarySchool": 4, "SmallHotel": 5, "LargeHotel": 6, "Hospital": 7, "Outpatient": 8, "Warehouse": 9, "SuperMarket": 10, "FullServiceRestaurant": 11, "QuickServiceRestaurant": 12}, selected="Office")
listzoneprograms = Honeybee_ListZonePrograms(bldgProgram=bldgprograms)  # -> OfficeZonePrograms; plug-in component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
ladybug = Ladybug_Ladybug()  # -> Vviiiiiiiiiizzz; plug-in component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
honeybee = Honeybee_Honeybee()  # -> Vviiiiiiiiiizzz; plug-in component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
panel = Panel(listzoneprograms)
item = ListItem(List=listzoneprograms, Index="3", Wrap=True)
geo = Geometry(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)
geo_2 = Geometry(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)
splitmass = Honeybee_SplitBuildingMass(bldgMasses=geo, bldgsFlr2FloorHeights="@4.5", runIt=Toggle(True))  # -> readMe, splitBldgMasses; plug-in component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
geo_3 = Geometry(splitmass.splitBldgMasses)

# ---- group: south w/ glazing
mass2zone = Honeybee_Masses2Zones(
    zoneMasses=flatten(splitmass.splitBldgMasses),
    zonePrograms=item,
    isConditioned=Toggle(True),
    maxRoofAngle=30,
    createHBZones=Toggle(True))  # -> readMe, HBZones; plug-in component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

# ----
geo_4 = Geometry(mass2zone.HBZones)
solveadjc = Honeybee_SolveAdjacencies(HBZones=flatten(mass2zone.HBZones), removeCurrentAdjc=False, findAdjc=Toggle(True))  # -> readMe, HBZonesWADJ; plug-in component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
glzparamlist = Honeybee_GlazingParametersList(northGlzParam="0.9", westGlzParam="0.5", southGlzParam="0.9", eastGlzParam="0.5")  # -> glzParamList; plug-in component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
data = Data()
glazingcreator = Honeybee_GlazingBasedOnRatio(HBObjects=solveadjc.HBZonesWADJ, glzRatio=glzparamlist, runIt=Toggle(True))  # -> readMe, HBObjWGLZ; plug-in component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
data_2 = Data()
zoneattributelist = Honeybee_ZoneAttributeList({"Name": "name", "Zone Program": "zoneProgram", "Zone Floor Area": "zoneFloorArea", "Zone Volume": "zoneVolume", "Building Program": "bldgProgram", "Is Conditioned": "isConditioned", "HVAC System Type": "HVACSystem", "Occupancy Schedule": "occupancySchedule", "Occupancy Activity Schedule": "occupancyActivitySch", "Heating SetPoint Schedule": "heatingSetPtSchedule"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}, selected="Name")
data_3 = Data()
zoneattributelist_2 = Honeybee_ZoneAttributeList({"Name": "name", "Zone Program": "zoneProgram", "Zone Floor Area": "zoneFloorArea", "Zone Volume": "zoneVolume", "Building Program": "bldgProgram", "Is Conditioned": "isConditioned", "HVAC System Type": "HVACSystem", "Occupancy Schedule": "occupancySchedule", "Occupancy Activity Schedule": "occupancyActivitySch", "Heating SetPoint Schedule": "heatingSetPtSchedule"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}, selected="Name")
data_4 = Data()
zoneattributelist_3 = Honeybee_ZoneAttributeList({"Name": "name", "Zone Program": "zoneProgram", "Zone Floor Area": "zoneFloorArea", "Zone Volume": "zoneVolume", "Building Program": "bldgProgram", "Is Conditioned": "isConditioned", "HVAC System Type": "HVACSystem", "Occupancy Schedule": "occupancySchedule", "Occupancy Activity Schedule": "occupancyActivitySch", "Heating SetPoint Schedule": "heatingSetPtSchedule"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}, selected="Name")
data_5 = Data()
zoneattributelist_4 = Honeybee_ZoneAttributeList({"Name": "name", "Zone Program": "zoneProgram", "Zone Floor Area": "zoneFloorArea", "Zone Volume": "zoneVolume", "Building Program": "bldgProgram", "Is Conditioned": "isConditioned", "HVAC System Type": "HVACSystem", "Occupancy Schedule": "occupancySchedule", "Occupancy Activity Schedule": "occupancyActivitySch", "Heating SetPoint Schedule": "heatingSetPtSchedule"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}, selected="Name")
number_slider = Slider(24, range=22..28)
number_slider_2 = Slider(19, range=16..20)
# NORTH
labelzones = Honeybee_LabelZones(HBZones=flatten(data_2), attribute=zoneattributelist)  # -> zoneTxtLabels, labelBasePts, brepTxtLabels, zoneWireFrames; plug-in component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
# EAST
labelzones_2 = Honeybee_LabelZones(HBZones=flatten(data_3), attribute=zoneattributelist_2)  # -> zoneTxtLabels, labelBasePts, brepTxtLabels, zoneWireFrames; plug-in component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
# SOUTH
labelzones_3 = Honeybee_LabelZones(HBZones=flatten(data_4), attribute=zoneattributelist_3)  # -> zoneTxtLabels, labelBasePts, brepTxtLabels, zoneWireFrames; plug-in component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
# WEST
labelzones_4 = Honeybee_LabelZones(HBZones=flatten(data_5), attribute=zoneattributelist_4)  # -> zoneTxtLabels, labelBasePts, brepTxtLabels, zoneWireFrames; plug-in component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
separatezonesbyfloor = Honeybee_SeparateZonesByFloor()  # -> floorHeights, HBZones; plug-in component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
setepzonethresholds = Honeybee_SetEnergyPlusZoneThresholds(
    HBZones=flatten(glazingcreator.HBObjWGLZ),
    coolingSetPt=number_slider,
    coolingSetback=number_slider,
    heatingSetPt=number_slider_2,
    heatingSetback=number_slider_2)  # -> readMe, HBZones; plug-in component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

# ---- group: NORTH
python = PythonScript(HBZones=data_2, ref_index=flatten(labelzones.zoneTxtLabels), total_index=flatten(data))  # -> other_HBZones, index_HBZones; inputs HBZones: list, ref_index: list, total_index: list
# ---------- python: Python ----------
if HBZones and ref_index and total_index:
    other_HBZones = []
    index_HBZones = []
    
    """
    for ti_,tindex in enumerate(total_index);
        strlst = tindex.split('_')
        total_index[ti_] = strlst[1]
        
    for ri_,index in enumerate(ref_index):
        strlst = index.split('_')
        ref_index[ri_] = strlst[1]
    """
    
    #Loop through zones
    for hlbl,hbz in zip(total_index,HBZones):
        if hlbl not in ref_index:
            other_HBZones.append(hbz)
        else:
            index_HBZones.append(hbz)
    

print index_HBZones
print other_HBZones
# ---------- end python ----------

# ---- group: EAST
python_2 = PythonScript(HBZones=data_3, ref_index=flatten(labelzones_2.zoneTxtLabels), total_index=flatten(data))  # -> other_HBZones, index_HBZones; inputs HBZones: list, ref_index: list, total_index: list; same code as python

# ---- group: SOUTH
python_3 = PythonScript(HBZones=data_4, ref_index=flatten(labelzones_3.zoneTxtLabels), total_index=flatten(data))  # -> other_HBZones, index_HBZones; inputs HBZones: list, ref_index: list, total_index: list; same code as python

python_4 = PythonScript(HBZones=data_5, ref_index=flatten(labelzones_4.zoneTxtLabels), total_index=flatten(data))  # -> other_HBZones, index_HBZones; inputs HBZones: list, ref_index: list, total_index: list; same code as python

# ----
toggle = BooleanToggle(True)
zoneattributelist_5 = Honeybee_ZoneAttributeList({"Name": "name", "Zone Program": "zoneProgram", "Zone Floor Area": "zoneFloorArea", "Zone Volume": "zoneVolume", "Building Program": "bldgProgram", "Is Conditioned": "isConditioned", "HVAC System Type": "HVACSystem", "Occupancy Schedule": "occupancySchedule", "Occupancy Activity Schedule": "occupancyActivitySch", "Heating SetPoint Schedule": "heatingSetPtSchedule"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}, selected="Name")
panel_2 = Panel(separatezonesbyfloor.HBZones)
panel_3 = Panel(separatezonesbyfloor.floorHeights)

decomposebytype = Honeybee_DecomposeBasedOnType(HBZone=setepzonethresholds.HBZones)  # -> walls, interiorWalls, airWalls, windows, interiorWindows, skylights, roofs, ceilings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; plug-in component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
preview = CustomPreview(Geometry=decomposebytype.windows, Shader=ColourSwatch(SwatchColor=RGBA(178, 232, 255, 108)))
preview_2 = CustomPreview(Geometry=decomposebytype.walls, Shader=ColourSwatch(SwatchColor=RGB(255, 255, 255)))
preview_3 = CustomPreview(Geometry=[decomposebytype.groundFloors, decomposebytype.floors], Shader=ColourSwatch(SwatchColor=RGB(214, 131, 131)))
preview_4 = CustomPreview(
    Geometry=[decomposebytype.roofs, decomposebytype.floors, decomposebytype.exposedFloors],
    Shader=ColourSwatch(SwatchColor=RGB(128, 128, 128)))

epoutput = Honeybee_GenerateEPOutput(
    zoneEnergyUse=toggle,
    zoneGainsAndLosses="False",
    zoneComfortMetrics=toggle,
    surfaceTempAnalysis="False",
    surfaceEnergyAnalysis=toggle,
    glazingSolarAnalysis=toggle,
    timestep="hourly")  # -> report, flatten(simulationOutputs); plug-in component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
labelzones_5 = Honeybee_LabelZones(HBZones=flatten(setepzonethresholds.HBZones), attribute=zoneattributelist_5)  # -> zoneTxtLabels, labelBasePts, brepTxtLabels, zoneWireFrames; plug-in component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
path = FilePath("U:\pw_research\UofT_Site_14\uoft_analysis_001\test_idf_5\EnergyPlus\test_idf_5.csv")
toggle_2 = BooleanToggle(True)
toggle_3 = BooleanToggle(False)
toggle_4 = BooleanToggle(True)
glzparamlist_2 = Honeybee_GlazingParametersList(northGlzParam="1", westGlzParam="0.0", southGlzParam="1", eastGlzParam="0.0")  # -> glzParamList; plug-in component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
glzparamlist_3 = Honeybee_GlazingParametersList(northGlzParam="0.0", westGlzParam="3.2", southGlzParam="0.0", eastGlzParam="3.2")  # -> glzParamList; plug-in component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
glzparamlist_4 = Honeybee_GlazingParametersList(northGlzParam=toggle_2, westGlzParam=toggle_3, southGlzParam=toggle_2, eastGlzParam=toggle_3)  # -> glzParamList; plug-in component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
panel_4 = Panel(".25")
data_6 = Data("0.5")

panel_5 = Panel("C:\\Users\\vasanthakumars\\Documents\\GitHub\\bibil\\src\\reference\\CAN_ON_Toronto.716240_CWEC\\CAN_ON_Toronto.716240_CWEC.epw")
panel_6 = Panel("C:\saeran\master\git\bibil\src\reference\CAN_ON_Toronto.716240_CWEC\CAN_ON_Toronto.716240_CWEC.epw")
# Run the Energy Simulation + Get Results
toggle_5 = BooleanToggle(True)
list_2 = ValueList({"dir", "file"}, selected="file")

# ---- group: find directory
bibil_7 = PythonScript(dir=[panel_6, panel_5], type=list_2, run=toggle_5)  # -> file; inputs dir: list; same code as bibil

# ----
data_7 = Data(bibil_7)

# ----
# Run the Simulation
panel_7 = Panel("test_idf_5")
toggle_6 = BooleanToggle(False)
runenergysimulation = Honeybee_RunEnergySimulation(
    epwFile=data_7,
    HBZones=flatten(setepzonethresholds.HBZones),
    simulationOutputs=flatten(epoutput.simulationOutputs),
    writeIdf=toggle_6,
    runEnergyPlus=toggle_6,
    idfFileName=panel_7)  # -> report, idfFileAddress, resultFileAddress; plug-in component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
readepsrfresult = Honeybee_ReadEPSurfaceResult(resultFileAddress=runenergysimulation.resultFileAddress)  # -> surfaceIndoorTemp, surfaceOutdoorTemp, surfaceEnergyFlow, opaqueEnergyFlow, glazEnergyFlow, windowTotalSolarEnergy, windowBeamEnergy, windowDiffEnergy, windowTransmissivity, otherSurfaceData; disabled; plug-in component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
readepresult = Honeybee_ReadEPResult(resultFileAddress=path)  # -> totalThermalEnergy, thermalEnergyBalance, cooling, heating, electricLight, electricEquip, port, port_2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; plug-in component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

panel_8 = Panel(readepresult.cooling)
importlocation = Ladybug_ImportLocation(epwFile=data_7)  # -> location; plug-in component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
colorzones = Honeybee_ColorZonesByEPResult(
    zoneData=readepresult.heating,
    HBZones=flatten(setepzonethresholds.HBZones),
    normalizeByFloorArea=Toggle(False),
    runIt=Toggle(True))  # -> readMe, zoneColoredMesh, zoneWireFrame, legend, legendBasePt, analysisTitle, zoneBreps, zoneColors, zoneValues, floorNormZoneData; plug-in component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
# Create Shades
epwindowshades = Honeybee_EnergyPlusWindowShadeGenerator(
    HBObjects=setepzonethresholds.HBZones,
    distToGlass=Slider(0, range=0..1),
    depth=Slider(2, range=0..10),
    numOfShds=glzparamlist_2,
    distBetween=glzparamlist_3,
    horOrVertical=glzparamlist_4,
    runIt=Toggle(False),
    zoneData1=readepresult.cooling,
    zoneData2=readepresult.heating,
    zoneData3=readepsrfresult.windowBeamEnergy)  # -> readMe, debug, HBObjWShades, port, windowBreps, shadeBreps, port_2, zoneData1Tree, zoneData2Tree, zoneData3Tree; disabled; plug-in component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
geo_5 = Geometry(epwindowshades.debug)
wires = BrepWireframe(Brep=epwindowshades.shadeBreps, Density=-1)
geo_6 = Geometry(epwindowshades.shadeBreps)
preview_5 = CustomPreview(Geometry=geo_6, Shader=ColourSwatch(SwatchColor=RGB(255, 255, 255)))
preview_6 = CustomPreview(Geometry=wires, Shader=ColourSwatch(SwatchColor=RGB(0, 0, 0)))
# Shade Benefit Analysis
energyshadebenefit = Honeybee_EnergyShadeBenefitEvaluator(
    location=importlocation,
    coolingLoad=epwindowshades.zoneData1Tree,
    heatingLoad=epwindowshades.zoneData2Tree,
    beamGain=epwindowshades.zoneData3Tree,
    testShades=epwindowshades.shadeBreps,
    testWindow=epwindowshades.windowBreps,
    gridSize=data_6,
    delNonIntersect=False,
    parallel=Toggle(True),
    runIt=Toggle(False))  # -> readMe, port, sunVectors, windowTestPts, shadeMesh, legend, legendBasePoint, port_2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; plug-in component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
data_8 = Data(energyshadebenefit.shadeMesh)
data_9 = Data(energyshadebenefit.legend)
data_10 = Data(energyshadebenefit.shadeNetEffect)
preview_7 = CustomPreview(Geometry=[data_9, data_8], Shader=ColourSwatch(SwatchColor=RGB(0, 0, 0)))
# Select Out The Parts of Shades To Keep
shadecreator = Honeybee_OptimalShadeCreator(shadeMesh=data_8, shadeNetEffect=data_10, levelOfPerform=Slider(10, range=0..100))  # -> readMe, energySavedByShade, areaOfShade, newColoredMesh, newShadeBrep; plug-in component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
data_11 = Data(flatten(shadecreator.areaOfShade))
data_12 = Data(flatten(shadecreator.energySavedByShade))
edges = BrepEdges(Brep=shadecreator.newShadeBrep)  # -> Naked, Interior, NonManifold
geo_7 = Geometry(shadecreator.newShadeBrep)
ma = MassAddition(Input=data_11)  # -> Result, PartialResults
ma_2 = MassAddition(Input=data_12)  # -> Result, PartialResults
preview_8 = CustomPreview(Geometry=edges.Naked, Shader=ColourSwatch(SwatchColor=RGB(0, 0, 0)))
panel_9 = Panel(ma.Result)
panel_10 = Panel(ma_2.Result)
