# Grasshopper definition bibil_energy_001.gh (Grasshopper 0.9.76)
# plug-ins: Python Interpreter

# ---- group: MATERIAL
concat = Concatenate(FragmentA="2")
concat_2 = Concatenate(FragmentA="2", FragmentB="window", JoinSeparator=" ")
callfromepconstrlibrary = Honeybee_CallFromEPConstructionLibrary(keywords=concat)  # -> ThermMaterials, EPMaterials, EPWindowMaterials, EPConstructions; plug-in component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
callfromepconstrlibrary_2 = Honeybee_CallFromEPConstructionLibrary(keywords=concat_2)  # -> ThermMaterials, EPMaterials, EPWindowMaterials, EPConstructions; plug-in component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
item = ListItem(List=callfromepconstrlibrary_2.EPConstructions, Index=44, Wrap=True)
item_2 = ListItem(List=callfromepconstrlibrary.EPConstructions, Index=198, Wrap=True)
panel = Panel(item_2)
panel_2 = Panel(item)

# ----
honeybee = Honeybee_Honeybee()  # -> Vviiiiiiiiiizzz; plug-in component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
ladybug = Ladybug_Ladybug()  # -> Vviiiiiiiiiizzz; plug-in component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

# ---- group: ZONING
listzoneprograms = Honeybee_ListZonePrograms(bldgProgram=Slider(0, range=0..100))  # -> OfficeZonePrograms; plug-in component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
toggle = BooleanToggle(True)
item_3 = ListItem(List=listzoneprograms, Index=0, Wrap=True)

# ----
open_weather_file = Ladybug_OpenEPWWeatherFile(open=Toggle(True))  # -> epwFile; plug-in component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
geo = Geometry([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])

# ---- group: ref
geo_2 = Geometry([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])

# ---- group: mass_rect
geo_3 = Geometry(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)

# ----
geo_4 = Geometry(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)

# ---- group: mass_rect
geo_5 = Geometry(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)

# ----
hb_epcontextsrf = HoneybeeEPContextSurfaces(shdSurfaces=flatten(geo))  # -> HBContext; inputs shdSurfaces: list of Brep, justBoundingBox: Boolean
# ---------- hb_epcontextsrf: Python ----------
"""
prepare shading/context geometries

    Args:
        northVectorOrRotation: A vector that shows North or a number that shows
                               the rotation of the North from the Y axis
        bldgMasses: List of closed Breps as thermal zones.
    Returns:
        report: ...
        thermalZones: Thermal zone's geometries for visualiza
"""

ghenv.Component.Name = 'Honeybee EP context Surfaces'
ghenv.Component.NickName = 'HB_EPContextSrf'
ghenv.Component.Message = 'VER 0.0.60\nAUG_10_2016'
ghenv.Component.IconDisplayMode = ghenv.Component.IconDisplayMode.application
ghenv.Component.Category = "Honeybee"
ghenv.Component.SubCategory = "10 | Energy | Energy"
#compatibleHBVersion = VER 0.0.57\nNOV_01_2015
#compatibleLBVersion = VER 0.0.59\nFEB_01_2015
ghenv.Component.AdditionalHelpFromDocStrings = "2"

import rhinoscriptsyntax as rs
import Rhino as rc
import scriptcontext as sc
import os
import System
import Grasshopper.Kernel as gh
import uuid

tolerance = sc.doc.ModelAbsoluteTolerance
import math


def main(shdSurfaces, EPTransSchedule, meshingSettings, justBoundingBox):
    
    # import the classes
    if sc.sticky.has_key('honeybee_release'):

        try:
            if not sc.sticky['honeybee_release'].isCompatible(ghenv.Component): return -1
            if sc.sticky['honeybee_release'].isInputMissing(ghenv.Component): return -1
        except:
            warning = "You need a newer version of Honeybee to use this compoent." + \
            " Use updateHoneybee component to update userObjects.\n" + \
            "If you have already updated userObjects drag Honeybee_Honeybee component " + \
            "into canvas and try again."
            w = gh.GH_RuntimeMessageLevel.Warning
            ghenv.Component.AddRuntimeMessage(w, warning)
            return -1
        
        # don't customize this part
        hb_EPSrf = sc.sticky["honeybee_EPSurface"]
        hb_EPSHDSurface = sc.sticky["honeybee_EPShdSurface"]
        hb_RADMaterialAUX = sc.sticky["honeybee_RADMaterialAUX"]
        hb_EPObjectsAux = sc.sticky["honeybee_EPObjectsAUX"]()
        HBScheduleList = sc.sticky["honeybee_ScheduleLib"].keys()

        ########################################################################
        #----------------------------------------------------------------------#
        shdBreps = []
        # create bounding box of shading geometries
        if justBoundingBox:
            for brep in shdSurfaces:
                if brep.Faces.Count>1 or not brep.Faces[0].IsPlanar(sc.doc.ModelAbsoluteTolerance):
                    shdBreps.append(brep.GetBoundingBox(True).ToBrep())
                else:
                    shdBreps.append(brep)
        else:
            shdBreps = shdSurfaces
        
        shadingClasses = []
        shadingMeshPreview = []
        
        if meshingSettings == None:
            mp = rc.Geometry.MeshingParameters.Minimal
            mp.SimplePlanes = True
        else:
            mp = meshingSettings
        
        def getRadMaterialName(radMaterial):
            nameStr = radMaterial.split(" ")[2]
            name =  nameStr.split("\n")[0]
            return name
        
        for brepCount, brep in enumerate(shdBreps):
            if brep != None:
                isPlanar = True
                # check planarity
                for face in brep.Faces:
                    if not face.IsPlanar(tolerance):
                        isPlanar = False
                        break
                
                shadingBreps = []
                if not isPlanar:
                    meshArray = rc.Geometry.Mesh.CreateFromBrep(brep, mp)
                    for mesh in meshArray:
                        for meshFace in range(mesh.Faces.Count):
                            vertices = list(mesh.Faces.GetFaceVertices(meshFace))[1:]
                            vertices = vertices + [sc.doc.ModelAbsoluteTolerance]
                            # create the brep from mesh
                            shdBrep = rc.Geometry.Brep.CreateFromCornerPoints(*vertices)
                            shadingBreps.append(shdBrep)
                else:
                    for face in brep.Faces:
                        shadingBreps.append(face.DuplicateFace(False))
                
                for faceCount, shdBrep in enumerate(shadingBreps):
                        thisShading = hb_EPSHDSurface(shdBrep, 1000*brepCount + faceCount, 'shdSrf_' + `brepCount` + '_' + `faceCount` + "_" + str(uuid.uuid4()))
                        
                        # add transmittance schedule if any
                        if EPTransSchedule!=None:
                            schedule= EPTransSchedule.upper()
                            if schedule!=None and not schedule.lower().endswith(".csv") and schedule not in HBScheduleList:
                                msg = "Cannot find " + schedule + " in Honeybee schedule library."
                                print msg
                                ghenv.Component.AddRuntimeMessage(gh.GH_RuntimeMessageLevel.Warning, msg)
                                return -1
                            elif schedule!=None and schedule.lower().endswith(".csv"):
                                # check if csv file is existed
                                if not os.path.isfile(schedule):
                                    msg = "Cannot find the shchedule file: " + schedule
                                    print msg
                                    ghenv.Component.AddRuntimeMessage(gh.GH_RuntimeMessageLevel.Warning, msg)
                                    return -1
                            
                            thisShading.TransmittanceSCH = schedule
                        
                        # add the Rad Material if any
                        if RADMaterial!=None:
                            # if it is just the name of the material make sure it is already defined
                            if len(RADMaterial.split(" ")) == 1:
                                # if the material is not in the library add it to the library
                                if not hb_RADMaterialAUX.isMatrialExistInLibrary(RADMaterial):
                                    warningMsg = "Can't find " + RADMaterial + " in RAD Material Library.\n" + \
                                                "Add the material to the library and try again."
                                    ghenv.Component.AddRuntimeMessage(gh.GH_RuntimeMessageLevel.Warning, warningMsg)
                                    return
                                
                                try:
                                    thisShading.setRADMaterial(RADMaterial)
                                except Exception, e:
                                    print e
                                    warningMsg = "You are using an old version of Honeybee_Honeybee! Update your files and try again."
                                    print warningMsg
                                    ghenv.Component.AddRuntimeMessage(gh.GH_RuntimeMessageLevel.Warning, warningMsg)
                                    return
                                
                                addedToLib = True
                            else:
                                
                                # try to add the material to the library
                                addedToLib, thisShading.RadMaterial = hb_RADMaterialAUX.analyseRadMaterials(RADMaterial, True)
                                
                            if addedToLib==False:
                                warningMsg = "Failed to add " + RADMaterial + " to the Library."
                                ghenv.Component.AddRuntimeMessage(gh.GH_RuntimeMessageLevel.Warning, warningMsg)
                                return
                        
                        # add shading to the list
                        shadingClasses.append(thisShading)
                
        # add to the hive
        hb_hive = sc.sticky["honeybee_Hive"]()
        HBContext  = hb_hive.addToHoneybeeHive(shadingClasses, ghenv.Component.InstanceGuid.ToString())
        return HBContext
        ################################################################################################
    else:
        print "You should first let Honeybee to fly..."
        w = gh.GH_RuntimeMessageLevel.Warning
        ghenv.Component.AddRuntimeMessage(w, "You should first let Honeybee to fly...")
        return -1
        

if _shdSurfaces and _shdSurfaces[0]!=None:
    # add cleaning function
    result= main(_shdSurfaces, EPTransSchedule_, meshingSettings_, justBoundingBox_)
    
    if result != -1: HBContext = result
# ---------- end hb_epcontextsrf ----------

# ---- group: mass_slope_shape
geo_6 = Geometry(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)

# ----
splitmass = Honeybee_SplitBuildingMass(bldgMasses=[geo_3, geo_4], bldgsFlr2FloorHeights="@4.5", runIt=Toggle(True))  # -> readMe, splitBldgMasses; plug-in component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
splitmass_2 = Honeybee_SplitBuildingMass(bldgMasses=geo_5, bldgsFlr2FloorHeights="@4.5", runIt=Toggle(True))  # -> readMe, splitBldgMasses; plug-in component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
glzparamlist = Honeybee_GlazingParametersList(northGlzParam=0, westGlzParam="0.4", southGlzParam="0.4", eastGlzParam=0)  # -> glzParamList; plug-in component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
glzparamlist_2 = Honeybee_GlazingParametersList(northGlzParam="0.4", westGlzParam="0.4", southGlzParam=0, eastGlzParam=0)  # -> glzParamList; plug-in component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
splitmass_3 = Honeybee_SplitBuildingMass(bldgMasses=geo_6, bldgsFlr2FloorHeights="@4.5", runIt=Toggle(True))  # -> readMe, splitBldgMasses; plug-in component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
glzparamlist_3 = Honeybee_GlazingParametersList(northGlzParam="0.4", westGlzParam=0, southGlzParam="0.4", eastGlzParam="0.4")  # -> glzParamList; plug-in component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
mass2zone = Honeybee_Masses2Zones(
    zoneMasses=flatten(splitmass.splitBldgMasses),
    zonePrograms=item_3,
    isConditioned=True,
    maxRoofAngle=30,
    createHBZones=toggle)  # -> readMe, HBZones; plug-in component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
mass2zone_2 = Honeybee_Masses2Zones(
    zoneMasses=flatten(splitmass_2.splitBldgMasses),
    zonePrograms=item_3,
    isConditioned=True,
    maxRoofAngle=30,
    createHBZones=toggle)  # -> readMe, HBZones; plug-in component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
glazingcreator = Honeybee_GlazingBasedOnRatio(HBObjects=mass2zone.HBZones, glzRatio=glzparamlist, breakUpWindow=Toggle(True), runIt=Toggle(True))  # -> readMe, HBObjWGLZ; disabled; plug-in component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
glazingcreator_2 = Honeybee_GlazingBasedOnRatio(HBObjects=mass2zone_2.HBZones, glzRatio=glzparamlist_2, breakUpWindow=Toggle(False), runIt=Toggle(True))  # -> readMe, HBObjWGLZ; plug-in component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
mass2zone_3 = Honeybee_Masses2Zones(
    zoneMasses=flatten(splitmass_3.splitBldgMasses),
    zonePrograms=item_3,
    isConditioned=True,
    maxRoofAngle=30,
    createHBZones=toggle)  # -> readMe, HBZones; plug-in component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
glazingcreator_3 = Honeybee_GlazingBasedOnRatio(HBObjects=mass2zone_3.HBZones, glzRatio=glzparamlist_3, breakUpWindow=Toggle(True), runIt=Toggle(True))  # -> readMe, HBObjWGLZ; disabled; plug-in component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
geo_7 = Geometry(glazingcreator_2.HBObjWGLZ)
decomposebytype = Honeybee_DecomposeBasedOnType(HBZone=[glazingcreator.HBObjWGLZ, glazingcreator_3.HBObjWGLZ, glazingcreator_2.HBObjWGLZ])  # -> walls, interiorWalls, airWalls, flatten(windows), interiorWindows, skylights, roofs, ceilings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; plug-in component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
setepzonecnstr = Honeybee_SetEPZoneConstruction(HBZone=glazingcreator_2.HBObjWGLZ, wallEPConstruction=item_2, windowEPConstruction=item)  # -> simplify(modifiedHBZone); plug-in component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
wires = BrepWireframe(
    Brep=[decomposebytype.exposedFloors, decomposebytype.groundFloors, decomposebytype.floors, decomposebytype.ceilings, decomposebytype.roofs, decomposebytype.walls, decomposebytype.windows],
    Density=-1)
preview = CustomPreview(Geometry=decomposebytype.windows, Shader=ColourSwatch(SwatchColor=RGBA(84, 218, 255, 126)))
toggle_2 = BooleanToggle(True)
epoutput = Honeybee_GenerateEPOutput(
    zoneEnergyUse=toggle_2,
    zoneGainsAndLosses=toggle_2,
    zoneComfortMetrics="False",
    surfaceTempAnalysis="False",
    timestep="annual")  # -> report, flatten(simulationOutputs); plug-in component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
pt = Point(Point(35.5695892, 0.3614646311, 0))
toggle_3 = BooleanToggle(True)
northarrow = Ladybug_North(north="0", centerPt=pt, scale="2")  # -> northSign; plug-in component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
exporttoopenstudio = Honeybee_ExportToOpenStudio(
    north="0",
    epwWeatherFile=open_weather_file,
    HBZones=flatten(setepzonecnstr),
    HBContext=flatten(hb_epcontextsrf),
    simulationOutputs=flatten(epoutput.simulationOutputs),
    writeOSM=toggle_3,
    runSimulation=toggle_3,
    workingDir="C:\Users\vasanthakumars\Desktop\temp_folder")  # -> readMe, osmFileAddress, idfFileAddress, resultsFileAddress, rddFileAddress, studyFolder; plug-in component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
geo_8 = Geometry(northarrow)
panel_3 = Panel(exporttoopenstudio.readMe)
readepresult = Honeybee_ReadEPResult(resultFileAddress=exporttoopenstudio.resultsFileAddress)  # -> totalThermalLoad, thermalLoadBalance, cooling, heating, electricLight, electricEquip, port, port_2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; plug-in component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
readepsrfresult = Honeybee_ReadEPSurfaceResult(resultFileAddress=exporttoopenstudio.resultsFileAddress)  # -> surfaceIndoorTemp, surfaceOutdoorTemp, surfaceEnergyFlow, opaqueEnergyFlow, glazEnergyFlow, windowTotalSolarEnergy, windowBeamEnergy, windowDiffEnergy, windowTransmissivity, port; disabled; plug-in component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
toggle_4 = BooleanToggle(True)  # disabled
colorsurfaces = Honeybee_ColorSurfacesByEPResult(srfData=readepsrfresult.surfaceIndoorTemp, HBZones=flatten(mass2zone.HBZones), runIt=toggle_4)  # -> readMe, srfColoredMesh, zoneWireFrame, legend, legendBasePt, analysisTitle, srfBreps, srfColors, srfValues, port; disabled; plug-in component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
flrnorm = Honeybee_NormalizeDataByFloorArea(simData=readepresult.cooling, HBZones=flatten(glazingcreator.HBObjWGLZ))  # -> totNormData, zoneNormData; plug-in component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
mesh = Mesh(colorsurfaces.srfColoredMesh)  # disabled
colorzones = Honeybee_ColorZonesByEPResult(
    zoneData=readepresult.totalSolarGain,
    HBZones=flatten(glazingcreator.HBObjWGLZ),
    normalizeByFloorArea=Toggle(False),
    runIt=Toggle(True))  # -> readMe, zoneColoredMesh, zoneWireFrame, legend, legendBasePt, analysisTitle, zoneBreps, zoneColors, zoneValues, floorNormZoneData; plug-in component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
panel_4 = Panel(flrnorm.totNormData)
preview_2 = CustomPreview(Geometry=colorzones.zoneWireFrame, Shader=colorzones.zoneColors)
