# Grasshopper definition bibil_energy_subdiv_004.gh (Grasshopper 0.9.76)
# plug-ins: Python Interpreter, LunchBox

ladybug = Ladybug_Ladybug()  # -> Vviiiiiiiiiizzz; plug-in component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
honeybee = Honeybee_Honeybee()  # -> Vviiiiiiiiiizzz; plug-in component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
toggle = BooleanToggle(True)
toggle_2 = BooleanToggle(True)
toggle_3 = BooleanToggle(True)

listzoneprograms = Honeybee_ListZonePrograms(bldgProgram=Slider(0, range=0..100))  # -> OfficeZonePrograms; plug-in component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
item = ListItem(List=listzoneprograms, Index=0, Wrap=True)

panel = Panel("WWR ref: 7.7/14.4 = 53%")
toggle_4 = BooleanToggle(True)

# ---- group: NW_Vol
geo = Geometry(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)

# ---- group: SW_Vol
geo_2 = Geometry([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])

# ---- group: E_Vol
geo_3 = Geometry(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)

# ---- group: Context
geo_4 = Geometry([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])

# ---- group: Small context
geo_5 = Geometry([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])

# ---- group: Core
geo_6 = Geometry([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])

# ---- group: Ground
geo_7 = Geometry(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)

# ----
createhbsrfs = Honeybee_createHBSrfs(geometry=geo_7)  # -> readMe, simplify(HBSurface); plug-in component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
# CONTEXT GEOMETRY
hb_epcontextsrf = HoneybeeEPContextSurfaces(shdSurfaces=flatten(geo_4))  # -> HBContext; inputs shdSurfaces: list of Brep, justBoundingBox: Boolean
# ---------- hb_epcontextsrf: Python ----------
"""
prepare shading/context geometries

    Args:
        northVectorOrRotation: A vector that shows North or a number that shows
                               the rotation of the North from the Y axis
        bldgMasses: List of closed Breps as thermal zones.
    Returns:
        report: ...
        thermalZones: Thermal zone's geometries for visualiza
"""

ghenv.Component.Name = 'Honeybee EP context Surfaces'
ghenv.Component.NickName = 'HB_EPContextSrf'
ghenv.Component.Message = 'VER 0.0.60\nAUG_10_2016'
ghenv.Component.IconDisplayMode = ghenv.Component.IconDisplayMode.application
ghenv.Component.Category = "Honeybee"
ghenv.Component.SubCategory = "10 | Energy | Energy"
#compatibleHBVersion = VER 0.0.57\nNOV_01_2015
#compatibleLBVersion = VER 0.0.59\nFEB_01_2015
ghenv.Component.AdditionalHelpFromDocStrings = "2"

import rhinoscriptsyntax as rs
import Rhino as rc
import scriptcontext as sc
import os
import System
import Grasshopper.Kernel as gh
import uuid

tolerance = sc.doc.ModelAbsoluteTolerance
import math


def main(shdSurfaces, EPTransSchedule, meshingSettings, justBoundingBox):
    
    # import the classes
    if sc.sticky.has_key('honeybee_release'):

        try:
            if not sc.sticky['honeybee_release'].isCompatible(ghenv.Component): return -1
            if sc.sticky['honeybee_release'].isInputMissing(ghenv.Component): return -1
        except:
            warning = "You need a newer version of Honeybee to use this compoent." + \
            " Use updateHoneybee component to update userObjects.\n" + \
            "If you have already updated userObjects drag Honeybee_Honeybee component " + \
            "into canvas and try again."
            w = gh.GH_RuntimeMessageLevel.Warning
            ghenv.Component.AddRuntimeMessage(w, warning)
            return -1
        
        # don't customize this part
        hb_EPSrf = sc.sticky["honeybee_EPSurface"]
        hb_EPSHDSurface = sc.sticky["honeybee_EPShdSurface"]
        hb_RADMaterialAUX = sc.sticky["honeybee_RADMaterialAUX"]
        hb_EPObjectsAux = sc.sticky["honeybee_EPObjectsAUX"]()
        HBScheduleList = sc.sticky["honeybee_ScheduleLib"].keys()

        ########################################################################
        #----------------------------------------------------------------------#
        shdBreps = []
        # create bounding box of shading geometries
        if justBoundingBox:
            for brep in shdSurfaces:
                if brep.Faces.Count>1 or not brep.Faces[0].IsPlanar(sc.doc.ModelAbsoluteTolerance):
                    shdBreps.append(brep.GetBoundingBox(True).ToBrep())
                else:
                    shdBreps.append(brep)
        else:
            shdBreps = shdSurfaces
        
        shadingClasses = []
        shadingMeshPreview = []
        
        if meshingSettings == None:
            mp = rc.Geometry.MeshingParameters.Minimal
            mp.SimplePlanes = True
        else:
            mp = meshingSettings
        
        def getRadMaterialName(radMaterial):
            nameStr = radMaterial.split(" ")[2]
            name =  nameStr.split("\n")[0]
            return name
        
        for brepCount, brep in enumerate(shdBreps):
            if brep != None:
                isPlanar = True
                # check planarity
                for face in brep.Faces:
                    if not face.IsPlanar(tolerance):
                        isPlanar = False
                        break
                
                shadingBreps = []
                if not isPlanar:
                    meshArray = rc.Geometry.Mesh.CreateFromBrep(brep, mp)
                    for mesh in meshArray:
                        for meshFace in range(mesh.Faces.Count):
                            vertices = list(mesh.Faces.GetFaceVertices(meshFace))[1:]
                            vertices = vertices + [sc.doc.ModelAbsoluteTolerance]
                            # create the brep from mesh
                            shdBrep = rc.Geometry.Brep.CreateFromCornerPoints(*vertices)
                            shadingBreps.append(shdBrep)
                else:
                    for face in brep.Faces:
                        shadingBreps.append(face.DuplicateFace(False))
                
                for faceCount, shdBrep in enumerate(shadingBreps):
                        thisShading = hb_EPSHDSurface(shdBrep, 1000*brepCount + faceCount, 'shdSrf_' + `brepCount` + '_' + `faceCount` + "_" + str(uuid.uuid4()))
                        
                        # add transmittance schedule if any
                        if EPTransSchedule!=None:
                            schedule= EPTransSchedule.upper()
                            if schedule!=None and not schedule.lower().endswith(".csv") and schedule not in HBScheduleList:
                                msg = "Cannot find " + schedule + " in Honeybee schedule library."
                                print msg
                                ghenv.Component.AddRuntimeMessage(gh.GH_RuntimeMessageLevel.Warning, msg)
                                return -1
                            elif schedule!=None and schedule.lower().endswith(".csv"):
                                # check if csv file is existed
                                if not os.path.isfile(schedule):
                                    msg = "Cannot find the shchedule file: " + schedule
                                    print msg
                                    ghenv.Component.AddRuntimeMessage(gh.GH_RuntimeMessageLevel.Warning, msg)
                                    return -1
                            
                            thisShading.TransmittanceSCH = schedule
                        
                        # add the Rad Material if any
                        if RADMaterial!=None:
                            # if it is just the name of the material make sure it is already defined
                            if len(RADMaterial.split(" ")) == 1:
                                # if the material is not in the library add it to the library
                                if not hb_RADMaterialAUX.isMatrialExistInLibrary(RADMaterial):
                                    warningMsg = "Can't find " + RADMaterial + " in RAD Material Library.\n" + \
                                                "Add the material to the library and try again."
                                    ghenv.Component.AddRuntimeMessage(gh.GH_RuntimeMessageLevel.Warning, warningMsg)
                                    return
                                
                                try:
                                    thisShading.setRADMaterial(RADMaterial)
                                except Exception, e:
                                    print e
                                    warningMsg = "You are using an old version of Honeybee_Honeybee! Update your files and try again."
                                    print warningMsg
                                    ghenv.Component.AddRuntimeMessage(gh.GH_RuntimeMessageLevel.Warning, warningMsg)
                                    return
                                
                                addedToLib = True
                            else:
                                
                                # try to add the material to the library
                                addedToLib, thisShading.RadMaterial = hb_RADMaterialAUX.analyseRadMaterials(RADMaterial, True)
                                
                            if addedToLib==False:
                                warningMsg = "Failed to add " + RADMaterial + " to the Library."
                                ghenv.Component.AddRuntimeMessage(gh.GH_RuntimeMessageLevel.Warning, warningMsg)
                                return
                        
                        # add shading to the list
                        shadingClasses.append(thisShading)
                
        # add to the hive
        hb_hive = sc.sticky["honeybee_Hive"]()
        HBContext  = hb_hive.addToHoneybeeHive(shadingClasses, ghenv.Component.InstanceGuid.ToString())
        return HBContext
        ################################################################################################
    else:
        print "You should first let Honeybee to fly..."
        w = gh.GH_RuntimeMessageLevel.Warning
        ghenv.Component.AddRuntimeMessage(w, "You should first let Honeybee to fly...")
        return -1
        

if _shdSurfaces and _shdSurfaces[0]!=None:
    # add cleaning function
    result= main(_shdSurfaces, EPTransSchedule_, meshingSettings_, justBoundingBox_)
    
    if result != -1: HBContext = result
# ---------- end hb_epcontextsrf ----------
hb_epcontextsrf_2 = HoneybeeEPContextSurfaces(shdSurfaces=flatten(geo_6))  # -> HBContext; inputs shdSurfaces: list of Brep, justBoundingBox: Boolean; same code as hb_epcontextsrf
createhbzones = Honeybee_createHBZones(name="Ground", HBSurfaces=flatten(createhbsrfs.HBSurface), isConditioned=Toggle(False))  # -> readMe, HBZone; plug-in component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
createepground = Honeybee_CreateEPGround(HBZones=createhbzones.HBZone, soilTypeOrMat="4")  # -> HBGrndZones; plug-in component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

# ---- group: SW
splitmass = Honeybee_SplitBuildingMass(bldgMasses=geo_2, bldgsFlr2FloorHeights="@4.5", runIt=toggle_3)  # -> readMe, splitBldgMasses; plug-in component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
glzparamlist = Honeybee_GlazingParametersList(northGlzParam=0, westGlzParam="0.43", southGlzParam="0.43", eastGlzParam=0)  # -> glzParamList; plug-in component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
mass2zone = Honeybee_Masses2Zones(zoneMasses=flatten(splitmass.splitBldgMasses), isConditioned=True, maxRoofAngle=30, createHBZones=toggle_4)  # -> readMe, HBZones; plug-in component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
glazingcreator = Honeybee_GlazingBasedOnRatio(HBObjects=mass2zone.HBZones, glzRatio=glzparamlist, breakUpWindow=toggle_2, runIt=toggle)  # -> readMe, HBObjWGLZ; plug-in component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

# ---- group: NW
splitmass_2 = Honeybee_SplitBuildingMass(bldgMasses=geo, bldgsFlr2FloorHeights="@4.5", runIt=toggle_3)  # -> readMe, splitBldgMasses; plug-in component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
mass2zone_2 = Honeybee_Masses2Zones(zoneMasses=flatten(splitmass_2.splitBldgMasses), isConditioned=True, maxRoofAngle=30, createHBZones=toggle_4)  # -> readMe, HBZones; plug-in component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
glzparamlist_2 = Honeybee_GlazingParametersList(northGlzParam="0.43", westGlzParam="0.43", southGlzParam=0, eastGlzParam=0)  # -> glzParamList; plug-in component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
glazingcreator_2 = Honeybee_GlazingBasedOnRatio(HBObjects=mass2zone_2.HBZones, glzRatio=glzparamlist_2, breakUpWindow=toggle_2, runIt=toggle)  # -> readMe, HBObjWGLZ; plug-in component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

# ---- group: E
splitmass_3 = Honeybee_SplitBuildingMass(bldgMasses=geo_3, bldgsFlr2FloorHeights="@4.5", runIt=toggle_3)  # -> readMe, splitBldgMasses; plug-in component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
mass2zone_3 = Honeybee_Masses2Zones(zoneMasses=flatten(splitmass_3.splitBldgMasses), isConditioned=True, maxRoofAngle=30, createHBZones=toggle_4)  # -> readMe, HBZones; plug-in component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
glzparamlist_3 = Honeybee_GlazingParametersList(northGlzParam="0.43", westGlzParam=0, southGlzParam="0.43", eastGlzParam="0.43")  # -> glzParamList; plug-in component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
glazingcreator_3 = Honeybee_GlazingBasedOnRatio(HBObjects=mass2zone_3.HBZones, glzRatio=glzparamlist_3, breakUpWindow=toggle_2, runIt=toggle)  # -> readMe, HBObjWGLZ; plug-in component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

# ---- group: MATERIAL
concat = Concatenate(FragmentA="2")
concat_2 = Concatenate(FragmentA="2", FragmentB="window", JoinSeparator=" ")
callfromepconstrlibrary = Honeybee_CallFromEPConstructionLibrary(keywords=concat)  # -> ThermMaterials, EPMaterials, EPWindowMaterials, EPConstructions; plug-in component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
callfromepconstrlibrary_2 = Honeybee_CallFromEPConstructionLibrary(keywords=concat_2)  # -> ThermMaterials, EPMaterials, EPWindowMaterials, EPConstructions; plug-in component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
item_2 = ListItem(List=callfromepconstrlibrary_2.EPConstructions, Index=44, Wrap=True)
item_3 = ListItem(List=callfromepconstrlibrary.EPConstructions, Index=198, Wrap=True)
panel_2 = Panel(item_3)
panel_3 = Panel(item_2)

# ---- group: GridSize
number_slider = Slider(2, range=0..10)

# ----
toggle_5 = BooleanToggle(False)
toggle_6 = BooleanToggle(False)

# ---- group: EPW
# COOLING
# PERIOD
path = FilePath("C:\saeran\master\git\bibil\src\reference\CAN_ON_Toronto.716240_CWEC\CAN_ON_Toronto.716240_CWEC.epw")

# ---- group: HBZones2Context
data = Data([hb_epcontextsrf, hb_epcontextsrf_2, createepground])

# ----
# Summer defined by hydroone: May1-Oct31
# 
# http://www.hydroone.com/tou/pages/frequentlyaskedquestions.aspx
panel_4 = Panel("5")
analysisperiod = Ladybug_AnalysisPeriod(fromMonth=panel_4, fromDay="1", fromHour="1", toMonth="10", toDay="31", toHour="24")  # -> readMe, analysisPeriod; plug-in component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

gencumsky = Honeybee_GenerateCumulativeSky(weatherFile=path, analysisPeriod=analysisperiod.analysisPeriod, generateSky=Toggle(True))  # -> skyFilePath; plug-in component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

# ---- group: ref
geo_8 = Geometry([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])  # disabled

# ---- group: Window
geo_9 = Geometry(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)  # disabled

# ---- group: floor
geo_10 = Geometry(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)  # disabled

# ---- group: Exterior wall
geo_11 = Geometry(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)  # disabled

# ----
number_slider_2 = Slider(18, range=0..100)  # disabled
number_slider_3 = Slider(-3000, range=-3000..3000)  # disabled
ceiling = Geometry(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)  # disabled
panel_5 = Panel("y")  # disabled
python = PythonScript(g=[geo_11, geo_9], num=number_slider_2, dim=number_slider_3, axis=panel_5)  # -> a; disabled
# ---------- python: Python ----------
import rhinoscriptsyntax as rs


L = []
L.append(g)
dim_ = dim
for i in range(int(num)):
    if axis == 'y':
        g_ = rs.CopyObject(g,[0,dim_,0])
    else:
        g_ = rs.CopyObject(g,[0,0,dim_])
    L.append(g_)
    dim_ += dim

a = L
# ---------- end python ----------
number_slider_4 = Slider(26, range=0..100)  # disabled
number_slider_5 = Slider(4500, range=-4500..10000)  # disabled
panel_6 = Panel("z")  # disabled
python_2 = PythonScript(g=[python, geo_10, ceiling], num=number_slider_4, dim=number_slider_5, axis=panel_6)  # -> a; disabled; same code as python
geo_12 = Geometry([python, python_2])  # disabled

genclimatebasedsky = Honeybee_GenerateClimateBasedSky(weatherFile=path, month="6", day="21", hour="9")  # -> radiationValues, skyFilePath; disabled; plug-in component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
python_3 = PythonScript()  # -> a; inputs x: list; disabled
# ---------- python_3: Python ----------
div = len(x)/period_num
L = []
lstval = []
for i in range(len(x)):
    lstval.append(x[i])
    if i%div==0 and i>0:
        L.append(lstval)
        #print len(lstval)
        lstval = []

M = []
#loop through all div num (252)
for i in range(int(div)):
    indexsum = 0.
    #get index from each bucet
    for j in range(len(L)):
        radvalatindex = L[j][i]
        indexsum += float(radvalatindex) 
    M.append(indexsum/float(len(L)))
    
a = M
# ---------- end python_3 ----------
python_4 = PythonScript()  # -> o; disabled
# ---------- python_4: Python ----------
o = range(6,12)
print o
# ---------- end python_4 ----------

number_slider_6 = Slider(0.5, range=0..1)

wires = BrepWireframe(Brep=[geo_2, geo, geo_3], Density=-1)
wires_2 = BrepWireframe(Brep=geo_4, Density=-1)  # disabled
preview = CustomPreview(Geometry=[hb_epcontextsrf_2, wires, wires_2], Shader=ColourSwatch(SwatchColor=RGB(115, 115, 115)))

toggle_7 = BooleanToggle(True)
toggle_8 = BooleanToggle(False)
toggle_9 = BooleanToggle(True)
geo_13 = Geometry([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])

# ----
# NW VOLUME
setepzonecnstr = Honeybee_SetEPZoneConstruction(HBZone=glazingcreator_2.HBObjWGLZ, wallEPConstruction=item_3, windowEPConstruction=item_2)  # -> simplify(modifiedHBZone); plug-in component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
number_slider_7 = Slider(225, range=0..1000)

# ---- group: HBZones2Simulate
hbzone = Data(setepzonecnstr)

# ---- group: HBZonesTotal
data_2 = Data([hbzone, data])

# ----
genhbzonetestpts = Honeybee_GenerateZoneTestPoints(HBZone=hbzone, gridSize=number_slider, distBaseSrf=Slider(1, range=0..1000), moveTestMesh=True)  # -> readMe, simplify(testPoints), simplify(ptsVectors), simplify(facesArea), simplify(mesh); plug-in component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
gridbasedsimulation = Honeybee_GridBasedSimulation(
    skyFile=gencumsky,
    testPoints=genhbzonetestpts.testPoints,
    ptsVectors=genhbzonetestpts.ptsVectors,
    testMesh=genhbzonetestpts.mesh,
    simulationType=Slider(1, range=0..1))  # -> analysisRecipe; plug-in component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
rundaylightanalysis = Honeybee_RunDaylightSimulation(
    HBObjects=flatten(data_2),
    analysisRecipe=gridbasedsimulation,
    writeRad=toggle_5,
    runRad=toggle_5,
    radFileName="sim_uoft_000",
    overwriteResults=toggle_6)  # -> readMe, analysisType, resultsUnit, results, testPts, resultFiles, radGeoFile, studyFolder, done; plug-in component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
python_5 = PythonScript(lst=rundaylightanalysis.results)  # -> lo, hi, srtlst; inputs lst: list
# ---------- python_5: Python ----------
lst.sort(key=lambda n: float(n))
hi = lst[-1]
lo = lst[0]
srtlst = lst
for i in lst: print i
# ---------- end python_5 ----------
panel_7 = Panel(python_5.srtlst)
legendpar = Ladybug_LegendParameters(lowBound=python_5.lo, highBound=Slider(150, range=0..1000), numSegments=7)  # -> legendPar; plug-in component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
decomposebytype = Honeybee_DecomposeBasedOnType(HBZone=hbzone)  # -> walls, interiorWalls, airWalls, flatten(windows), interiorWindows, skylights, roofs, ceilings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; plug-in component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
recolormesh = Ladybug_RecolorMesh(
    analysisResult=rundaylightanalysis.results,
    inputMesh=genhbzonetestpts.mesh,
    heightDomain="0",
    legendPar=legendpar,
    analysisTitle="Annual solar radiation inside building Kwh")  # -> readMe, newMesh, newLegend, legendBasePt, meshColors, legendColors; plug-in component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

tag = TextTag3D(
    Location=rundaylightanalysis.testPts,
    Text=rundaylightanalysis.results,
    Size=number_slider_6,
    Colour=ColourSwatch(SwatchColor=RGB(0, 0, 0)),
    Justification=5)

# ---- group: NW
python_6 = PythonScript(rad_lst=flatten(rundaylightanalysis.results), pt_lst=flatten(rundaylightanalysis.testPts))  # -> rad_avg, keylst; inputs rad_lst: list, pt_lst: list
# ---------- python_6: Python ----------
import rhinoscriptsyntax as rs
import Rhino as rc

if rad_lst and pt_lst:
    # Traverse list of points
    # Check z ht
    # If unique ht, add to dictionary
    # else append to list
    # then extract list
    D = {}
    #print len(pt_lst), len(rad_lst)
    for pt,rad in zip(pt_lst,rad_lst):
        pt = rs.coerce3dpoint(pt) 
        refz = str(round(pt[2]))
        if D.has_key(refz):
            D[refz].append(rad)
        else:
            D[refz] = [rad]
    
    #print dir(D)
    
    keylst = D.keys()
    keylst.sort(key=lambda n: float(n))
    L = []
    
    for key in keylst:
        subkeylst = map(lambda n: float(n),D[key])
        avg = sum(subkeylst)/float(len(subkeylst))
        L.append(avg)
        print 'sum', sum(subkeylst), 'len', len(subkeylst), ',avg', avg
        print '--', key
        for i in D[key]:
            print i
        
    
    rad_avg = L
# ---------- end python_6 ----------

# ----
preview_2 = CustomPreview(Geometry=rundaylightanalysis.testPts, Shader=recolormesh.meshColors)

# ----
# E VOLUME
setepzonecnstr_2 = Honeybee_SetEPZoneConstruction(HBZone=glazingcreator_3.HBObjWGLZ, wallEPConstruction=item_3, windowEPConstruction=item_2)  # -> simplify(modifiedHBZone); plug-in component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
number_slider_8 = Slider(225, range=0..1000)

# ---- group: HBZones2Simulate
hbzone_2 = Data(setepzonecnstr_2)

# ---- group: HBZonesTotal
data_3 = Data([hbzone_2, data])

# ----
genhbzonetestpts_2 = Honeybee_GenerateZoneTestPoints(HBZone=hbzone_2, gridSize=number_slider, distBaseSrf=Slider(1, range=0..1000), moveTestMesh=True)  # -> readMe, simplify(testPoints), simplify(ptsVectors), simplify(facesArea), simplify(mesh); plug-in component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
gridbasedsimulation_2 = Honeybee_GridBasedSimulation(
    skyFile=gencumsky,
    testPoints=genhbzonetestpts_2.testPoints,
    ptsVectors=genhbzonetestpts_2.ptsVectors,
    testMesh=genhbzonetestpts_2.mesh,
    simulationType=Slider(1, range=0..1))  # -> analysisRecipe; plug-in component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
rundaylightanalysis_2 = Honeybee_RunDaylightSimulation(
    HBObjects=flatten(data_3),
    analysisRecipe=gridbasedsimulation_2,
    writeRad=toggle_5,
    runRad=toggle_5,
    radFileName="sim_uoft_000",
    overwriteResults=toggle_6)  # -> readMe, analysisType, resultsUnit, results, testPts, resultFiles, radGeoFile, studyFolder, done; plug-in component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
python_7 = PythonScript(lst=rundaylightanalysis_2.results)  # -> lo, hi, srtlst; inputs lst: list; same code as python_5
legendpar_2 = Ladybug_LegendParameters(lowBound=python_7.lo, highBound=Slider(150, range=0..1000), numSegments=7)  # -> legendPar; plug-in component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
panel_8 = Panel(python_7.srtlst)
decomposebytype_2 = Honeybee_DecomposeBasedOnType(HBZone=hbzone_2)  # -> walls, interiorWalls, airWalls, flatten(windows), interiorWindows, skylights, roofs, ceilings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; plug-in component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
recolormesh_2 = Ladybug_RecolorMesh(
    analysisResult=rundaylightanalysis_2.results,
    inputMesh=genhbzonetestpts_2.mesh,
    heightDomain="0",
    legendPar=legendpar_2,
    analysisTitle="Annual solar radiation inside building Kwh")  # -> readMe, newMesh, newLegend, legendBasePt, meshColors, legendColors; plug-in component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

# ---- group: E
python_8 = PythonScript(rad_lst=flatten(rundaylightanalysis_2.results), pt_lst=flatten(rundaylightanalysis_2.testPts))  # -> rad_avg, keylst; inputs rad_lst: list, pt_lst: list; same code as python_6

# ----
tag_2 = TextTag3D(
    Location=rundaylightanalysis_2.testPts,
    Text=rundaylightanalysis_2.results,
    Size=number_slider_6,
    Colour=ColourSwatch(SwatchColor=RGB(0, 0, 0)),
    Justification=5)
excelwrite = ExcelWriteLEGACY(
    WriteToggle=toggle_7,
    WriteHeading=toggle_9,
    ClearSheet=toggle_8,
    Worksheet=1,
    ColumnStart=Slider(5, range=0..10),
    RowStart=1,
    ColumnHeadings=["E_Flr_Num", "E_Volume"],
    Column1=python_8.keylst,
    Column2=python_8.rad_avg)
preview_3 = CustomPreview(Geometry=rundaylightanalysis_2.testPts, Shader=recolormesh_2.meshColors)

# ----
# SW VOLUME
setepzonecnstr_3 = Honeybee_SetEPZoneConstruction(HBZone=glazingcreator.HBObjWGLZ, wallEPConstruction=item_3, windowEPConstruction=item_2)  # -> simplify(modifiedHBZone); plug-in component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
number_slider_9 = Slider(225, range=0..1000)

# ---- group: HBZones2Simulate
hbzone_3 = Data(setepzonecnstr_3)

# ---- group: HBZonesTotal
data_4 = Data([hbzone_3, data])

# ----
genhbzonetestpts_3 = Honeybee_GenerateZoneTestPoints(HBZone=hbzone_3, gridSize=number_slider, distBaseSrf=Slider(1, range=0..1000), moveTestMesh=True)  # -> readMe, simplify(testPoints), simplify(ptsVectors), simplify(facesArea), simplify(mesh); plug-in component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
gridbasedsimulation_3 = Honeybee_GridBasedSimulation(
    skyFile=gencumsky,
    testPoints=genhbzonetestpts_3.testPoints,
    ptsVectors=genhbzonetestpts_3.ptsVectors,
    testMesh=genhbzonetestpts_3.mesh,
    simulationType=Slider(1, range=0..1))  # -> analysisRecipe; plug-in component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
rundaylightanalysis_3 = Honeybee_RunDaylightSimulation(
    HBObjects=flatten(data_4),
    analysisRecipe=gridbasedsimulation_3,
    writeRad=toggle_5,
    runRad=toggle_5,
    radFileName="sim_uoft_000",
    overwriteResults=toggle_6)  # -> readMe, analysisType, resultsUnit, results, testPts, resultFiles, radGeoFile, studyFolder, done; plug-in component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
python_9 = PythonScript(lst=rundaylightanalysis_3.results)  # -> lo, hi, srtlst; inputs lst: list; same code as python_5
legendpar_3 = Ladybug_LegendParameters(lowBound=python_9.lo, highBound=Slider(150, range=0..1000), numSegments=11)  # -> legendPar; plug-in component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
panel_9 = Panel(python_9.srtlst)
decomposebytype_3 = Honeybee_DecomposeBasedOnType(HBZone=hbzone_3)  # -> walls, interiorWalls, airWalls, flatten(windows), interiorWindows, skylights, roofs, ceilings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; plug-in component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
recolormesh_3 = Ladybug_RecolorMesh(
    analysisResult=rundaylightanalysis_3.results,
    inputMesh=genhbzonetestpts_3.mesh,
    heightDomain="0",
    legendPar=legendpar_3,
    analysisTitle="Annual solar radiation inside building Kwh")  # -> readMe, newMesh, newLegend, legendBasePt, meshColors, legendColors; plug-in component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

separatezonesbyfloor = Honeybee_SeparateZonesByFloor(HBZones=flatten(setepzonecnstr_3))  # -> floorHeights, HBZones; plug-in component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
tag_3 = TextTag3D(
    Location=rundaylightanalysis_3.testPts,
    Text=rundaylightanalysis_3.results,
    Size=number_slider_6,
    Colour=ColourSwatch(SwatchColor=RGB(0, 0, 0)),
    Justification=5)

# ---- group: SW
python_10 = PythonScript(rad_lst=flatten(rundaylightanalysis_3.results), pt_lst=flatten(rundaylightanalysis_3.testPts))  # -> rad_avg, keylst; inputs rad_lst: list, pt_lst: list; same code as python_6

# ----
wires_3 = BrepWireframe(Brep=[decomposebytype_3.windows, decomposebytype.windows, decomposebytype_2.windows], Density=-1)
mesh = Mesh([recolormesh_3.newMesh, recolormesh.newMesh, recolormesh_2.newMesh])
preview_4 = CustomPreview(Geometry=wires_3, Shader=ColourSwatch(SwatchColor=RGB(135, 135, 135)))
dots = DotDisplay(
    Point=[genhbzonetestpts_3.testPoints, genhbzonetestpts.testPoints, genhbzonetestpts_2.testPoints],
    Colour=[recolormesh_3.meshColors, recolormesh.meshColors, recolormesh_2.meshColors],
    Size=Slider(0.5, range=0..1))
excelwrite_2 = ExcelWriteLEGACY(
    WriteToggle=toggle_7,
    WriteHeading=toggle_9,
    ClearSheet=toggle_8,
    Worksheet=1,
    ColumnStart=1,
    RowStart=1,
    ColumnHeadings=["SW_Flr_Num", "SW_Volume", "NW_Flr_Num", "NW_Volume"],
    Column1=python_10.keylst,
    Column2=python_10.rad_avg,
    Column3=python_6.keylst,
    Column4=python_6.rad_avg)
preview_5 = CustomPreview(Geometry=rundaylightanalysis_3.testPts, Shader=recolormesh_3.meshColors)
