# Grasshopper definition bibil_trial_energy_001.gh (Grasshopper 0.9.76)
# plug-ins: Python Interpreter

# ---- group: 1/2 lot
geometry = Geometry([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])

# ----
geo = Geometry([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])
splitmass = Honeybee_SplitBuildingMass(bldgMasses=geometry, bldgsFlr2FloorHeights="@4.2", runIt=Toggle(False))  # -> readMe, splitBldgMasses; plug-in component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
honeybee = Honeybee_Honeybee()  # -> Vviiiiiiiiiizzz; plug-in component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
geometry_2 = Geometry(splitmass.splitBldgMasses)
intersectmass = Honeybee_IntersectMasses()  # -> bldgMassesAfter; plug-in component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

# ---- group: Filter
python_script = PythonScript(x=splitmass.splitBldgMasses)  # -> a; inputs x: list
# ---------- python_script: Python ----------
a = filter(lambda n: n!=None,x)

print x
print a
# ---------- end python_script ----------

# ----
ladybug = Ladybug_Ladybug()  # -> Vviiiiiiiiiizzz; plug-in component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
mass2zone = Honeybee_Masses2Zones(zoneMasses=flatten(python_script), isConditioned=True, maxRoofAngle=30, createHBZones=Toggle(True))  # -> readMe, HBZones; plug-in component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
concat = Concatenate(FragmentA="2")
concat_2 = Concatenate(FragmentA="2", FragmentB="window", JoinSeparator=" ")
callfromepconstrlibrary = Honeybee_CallFromEPConstructionLibrary(keywords=concat)  # -> ThermMaterials, EPMaterials, EPWindowMaterials, EPConstructions; plug-in component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
callfromepconstrlibrary_2 = Honeybee_CallFromEPConstructionLibrary(keywords=concat_2)  # -> ThermMaterials, EPMaterials, EPWindowMaterials, EPConstructions; plug-in component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
glazingcreator = Honeybee_GlazingBasedOnRatio(HBObjects=mass2zone.HBZones, glzRatio="0.5", runIt=Toggle(True))  # -> readMe, HBObjWGLZ; plug-in component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
panel = Panel(callfromepconstrlibrary.EPConstructions)
panel_2 = Panel(callfromepconstrlibrary_2.EPConstructions)
item = ListItem(List=callfromepconstrlibrary_2.EPConstructions, Index=44, Wrap=True)
item_2 = ListItem(List=callfromepconstrlibrary.EPConstructions, Index=198, Wrap=True)

# ---- group: tower
geometry_3 = Geometry(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)

# ----
splitmass_2 = Honeybee_SplitBuildingMass(bldgMasses=geometry_3, bldgsFlr2FloorHeights="@4.2", runIt=Toggle(True))  # -> readMe, splitBldgMasses; plug-in component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
decomposebytype = Honeybee_DecomposeBasedOnType(HBZone=glazingcreator.HBObjWGLZ)  # -> walls, interiorWalls, airWalls, flatten(windows), interiorWindows, skylights, roofs, ceilings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; plug-in component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
openstudiohvacsystemslist = Honeybee_OpenStudioHVACSystemsList({"0. Ideal Air Loads": 0, "1. PTAC | Residential": 1, "2. PTHP | Residential": 2, "3. PSZ-AC": 3, "4. PSZ-HP": 4, "5. Packaged VAV w/ Reheat": 5, "6. Packaged VAV w/ PFP Boxes": 6, "7. VAV w/ Reheat": 7, "8. VAV w/ PFP Boxes": 8, "9. Warm Air Furnace - Gas Fired": 9, "10.Warm Air Furnace - Electric": 10}, selected="5. Packaged VAV w/ Reheat")
geometry_4 = Geometry(splitmass_2.splitBldgMasses)
python_script_2 = PythonScript(x=splitmass_2.splitBldgMasses)  # -> out, a; inputs x: list; same code as python_script
setepzonecnstr = Honeybee_SetEPZoneConstruction(HBZone=glazingcreator.HBObjWGLZ, wallEPConstruction=item_2, windowEPConstruction=item)  # -> simplify(modifiedHBZone); plug-in component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
wires = BrepWireframe(
    Brep=[decomposebytype.exposedFloors, decomposebytype.groundFloors, decomposebytype.floors, decomposebytype.ceilings, decomposebytype.roofs, decomposebytype.walls, decomposebytype.windows],
    Density=-1)
preview = CustomPreview(Geometry=decomposebytype.windows, Shader=ColourSwatch(SwatchColor=RGBA(84, 218, 255, 126)))
mass2zone_2 = Honeybee_Masses2Zones(zoneMasses=flatten(python_script_2.a), isConditioned=True, maxRoofAngle=30, createHBZones=Toggle(True))  # -> readMe, HBZones; plug-in component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
open_weather_file = Ladybug_OpenEPWWeatherFile(open=Toggle(True))  # -> epwFile; plug-in component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
airhandlerdetails = Honeybee_OpenStudioAirHandlerDetail(HVACSystemID=openstudiohvacsystemslist, coolingCoil="Grasshopper.Kernel.Types.GH_ObjectWrapper")  # -> out, airHandlerDetail; plug-in component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
epluscentralplant = Honeybee_OpenStudioCentralPlantOrchestrator(HVACSystemID=openstudiohvacsystemslist)  # -> out, plantDetails; plug-in component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
setepzonecnstr_2 = Honeybee_SetEPZoneConstruction(HBZone=mass2zone_2.HBZones, wallEPConstruction=item_2, windowEPConstruction=item)  # -> simplify(modifiedHBZone); plug-in component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
oshvacsystems = Honeybee_OpenStudioSystems(
    HBZones=setepzonecnstr_2,
    HVACSystems=openstudiohvacsystemslist,
    airSideDetails=airhandlerdetails.airHandlerDetail,
    plantDetails=epluscentralplant.plantDetails,
    seeHVACDesc=Toggle(True))  # -> readMe, HBZones; plug-in component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
open_weather_file_2 = Ladybug_OpenEPWWeatherFile(open=Toggle(True))  # -> epwFile; plug-in component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
toggle = BooleanToggle(True)
boolean_toggle = BooleanToggle(True)
epoutput = Honeybee_GenerateEPOutput(
    zoneEnergyUse=toggle,
    zoneGainsAndLosses=toggle,
    zoneComfortMetrics=toggle,
    comfortMapVariables=toggle,
    zoneHVACParams=toggle,
    surfaceTempAnalysis=toggle,
    surfaceEnergyAnalysis=toggle,
    glazingSolarAnalysis=toggle,
    timestep="annual")  # -> report, flatten(simulationOutputs); plug-in component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
exporttoopenstudio = Honeybee_ExportToOpenStudio(
    north="18.75",
    epwWeatherFile=open_weather_file_2,
    HBZones=flatten(oshvacsystems.HBZones),
    simulationOutputs=flatten(epoutput.simulationOutputs),
    writeOSM=boolean_toggle,
    runSimulation=boolean_toggle,
    workingDir="C:\Users\vasanthakumars\Desktop\temp_folder")  # -> readMe, osmFileAddress, idfFileAddress, resultsFileAddress, eioFileAddress, rddFileAddress, studyFolder; plug-in component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
toggle_2 = BooleanToggle(True)
northarrow = Ladybug_North(north="18.75", scale="3")  # -> northSign; plug-in component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
exporttoopenstudio_2 = Honeybee_ExportToOpenStudio(
    north="18.75",
    epwWeatherFile=open_weather_file,
    HBZones=flatten(setepzonecnstr),
    simulationOutputs=flatten(epoutput.simulationOutputs),
    writeOSM=toggle_2,
    runSimulation=toggle_2,
    workingDir="C:\Users\vasanthakumars\Desktop\temp_folder")  # -> readMe, osmFileAddress, idfFileAddress, resultsFileAddress, rddFileAddress, studyFolder; plug-in component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
panel_3 = Panel(exporttoopenstudio.osmFileAddress)
readepresult = Honeybee_ReadEPResult(resultFileAddress=exporttoopenstudio_2.resultsFileAddress)  # -> totalThermalLoad, thermalLoadBalance, cooling, heating, electricLight, electricEquip, fanElectric, pumpElectric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; plug-in component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
readepsrfresult = Honeybee_ReadEPSurfaceResult(resultFileAddress=exporttoopenstudio_2.resultsFileAddress)  # -> surfaceIndoorTemp, surfaceOutdoorTemp, surfaceEnergyFlow, opaqueEnergyFlow, glazEnergyFlow, windowTotalSolarEnergy, windowBeamEnergy, windowDiffEnergy, windowTransmissivity, port; disabled; plug-in component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
toggle_3 = BooleanToggle(True)  # disabled
colorsurfaces = Honeybee_ColorSurfacesByEPResult(srfData=readepsrfresult.surfaceIndoorTemp, HBZones=flatten(mass2zone.HBZones), runIt=toggle_3)  # -> readMe, srfColoredMesh, zoneWireFrame, legend, legendBasePt, analysisTitle, srfBreps, srfColors, srfValues, port; disabled; plug-in component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
flrnorm = Honeybee_NormalizeDataByFloorArea(simData=readepresult.cooling, HBZones=flatten(glazingcreator.HBObjWGLZ))  # -> totNormData, zoneNormData; plug-in component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
mesh = Mesh(colorsurfaces.srfColoredMesh)  # disabled
colorzones = Honeybee_ColorZonesByEPResult(
    zoneData=readepresult.totalThermalLoad,
    HBZones=flatten(glazingcreator.HBObjWGLZ),
    normalizeByFloorArea=Toggle(True),
    runIt=Toggle(True))  # -> readMe, zoneColoredMesh, zoneWireFrame, legend, legendBasePt, analysisTitle, zoneBreps, zoneColors, zoneValues, floorNormZoneData; plug-in component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
panel_4 = Panel(flrnorm.totNormData)
preview_2 = CustomPreview(Geometry=colorzones.zoneWireFrame, Shader=colorzones.zoneColors)
