# Grasshopper definition bibil_trial_energy_002.gh (Grasshopper 0.9.76)
# plug-ins: Python Interpreter

# ---- group: Exterior wall
geo = Geometry(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)

# ---- group: Window
geo_2 = Geometry(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)

# ---- group: floor
geo_3 = Geometry(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)

# ----
ceiling = Geometry(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)

# ---- group: MATERIAL
concat = Concatenate(FragmentA="2")
concat_2 = Concatenate(FragmentA="2", FragmentB="window", JoinSeparator=" ")
callfromepconstrlibrary = Honeybee_CallFromEPConstructionLibrary(keywords=concat)  # -> ThermMaterials, EPMaterials, EPWindowMaterials, EPConstructions; plug-in component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
callfromepconstrlibrary_2 = Honeybee_CallFromEPConstructionLibrary(keywords=concat_2)  # -> ThermMaterials, EPMaterials, EPWindowMaterials, EPConstructions; plug-in component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
item = ListItem(List=callfromepconstrlibrary_2.EPConstructions, Index=44, Wrap=True)
item_2 = ListItem(List=callfromepconstrlibrary.EPConstructions, Index=198, Wrap=True)
panel = Panel(item_2)
panel_2 = Panel(item)

# ----
python = PythonScript(g=[geo, geo_2], num=Slider(18, range=0..100), dim=Slider(-3000, range=-3000..3000), axis="y")  # -> a
# ---------- python: Python ----------
import rhinoscriptsyntax as rs


L = []
L.append(g)
dim_ = dim
for i in range(int(num)):
    if axis == 'y':
        g_ = rs.CopyObject(g,[0,dim_,0])
    else:
        g_ = rs.CopyObject(g,[0,0,dim_])
    L.append(g_)
    dim_ += dim

a = L
# ---------- end python ----------
python_2 = PythonScript(g=[python, geo_3, ceiling], num=Slider(26, range=0..100), dim=Slider(4500, range=-4500..10000), axis="z")  # -> a; same code as python

# ---- group: ZONING
listzoneprograms = Honeybee_ListZonePrograms(bldgProgram=Slider(0, range=0..100))  # -> OfficeZonePrograms; plug-in component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
toggle = BooleanToggle(True)
item_3 = ListItem(List=listzoneprograms, Index=0, Wrap=True)

# ----
geo_4 = Geometry([python, python_2])
ladybug = Ladybug_Ladybug()  # -> Vviiiiiiiiiizzz; plug-in component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
honeybee = Honeybee_Honeybee()  # -> Vviiiiiiiiiizzz; plug-in component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
listzoneprograms_2 = Honeybee_ListZonePrograms(bldgProgram=Slider(0, range=0..100))  # -> OfficeZonePrograms; plug-in component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
geo_5 = Geometry(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)
glzparamlist = Honeybee_GlazingParametersList(northGlzParam="0.6", westGlzParam="0.6", southGlzParam="0.6", eastGlzParam="0.6")  # -> glzParamList; plug-in component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
item_4 = ListItem(List=listzoneprograms_2, Index=0, Wrap=True)

# ----
# Zone to analyze
toggle_2 = BooleanToggle(True)
geo_6 = Geometry(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)
mass2zone = Honeybee_Masses2Zones(zoneMasses=flatten(geo_5), zonePrograms=item_4, isConditioned=True, maxRoofAngle=30, createHBZones=toggle_2)  # -> readMe, HBZones; plug-in component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

geo_7 = Geometry([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])

# ---- group: ref
geo_8 = Geometry([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])

# ----
geo_9 = Geometry(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)

# ---- group: mass_rect
geo_10 = Geometry(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)

geo_11 = Geometry(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)

# ----
hb_epcontextsrf = HoneybeeEPContextSurfaces(shdSurfaces=flatten(geo_7))  # -> HBContext; inputs shdSurfaces: list of Brep, justBoundingBox: Boolean
# ---------- hb_epcontextsrf: Python ----------
"""
prepare shading/context geometries

    Args:
        northVectorOrRotation: A vector that shows North or a number that shows
                               the rotation of the North from the Y axis
        bldgMasses: List of closed Breps as thermal zones.
    Returns:
        report: ...
        thermalZones: Thermal zone's geometries for visualiza
"""

ghenv.Component.Name = 'Honeybee EP context Surfaces'
ghenv.Component.NickName = 'HB_EPContextSrf'
ghenv.Component.Message = 'VER 0.0.60\nAUG_10_2016'
ghenv.Component.IconDisplayMode = ghenv.Component.IconDisplayMode.application
ghenv.Component.Category = "Honeybee"
ghenv.Component.SubCategory = "10 | Energy | Energy"
#compatibleHBVersion = VER 0.0.57\nNOV_01_2015
#compatibleLBVersion = VER 0.0.59\nFEB_01_2015
ghenv.Component.AdditionalHelpFromDocStrings = "2"

import rhinoscriptsyntax as rs
import Rhino as rc
import scriptcontext as sc
import os
import System
import Grasshopper.Kernel as gh
import uuid

tolerance = sc.doc.ModelAbsoluteTolerance
import math


def main(shdSurfaces, EPTransSchedule, meshingSettings, justBoundingBox):
    
    # import the classes
    if sc.sticky.has_key('honeybee_release'):

        try:
            if not sc.sticky['honeybee_release'].isCompatible(ghenv.Component): return -1
            if sc.sticky['honeybee_release'].isInputMissing(ghenv.Component): return -1
        except:
            warning = "You need a newer version of Honeybee to use this compoent." + \
            " Use updateHoneybee component to update userObjects.\n" + \
            "If you have already updated userObjects drag Honeybee_Honeybee component " + \
            "into canvas and try again."
            w = gh.GH_RuntimeMessageLevel.Warning
            ghenv.Component.AddRuntimeMessage(w, warning)
            return -1
        
        # don't customize this part
        hb_EPSrf = sc.sticky["honeybee_EPSurface"]
        hb_EPSHDSurface = sc.sticky["honeybee_EPShdSurface"]
        hb_RADMaterialAUX = sc.sticky["honeybee_RADMaterialAUX"]
        hb_EPObjectsAux = sc.sticky["honeybee_EPObjectsAUX"]()
        HBScheduleList = sc.sticky["honeybee_ScheduleLib"].keys()

        ########################################################################
        #----------------------------------------------------------------------#
        shdBreps = []
        # create bounding box of shading geometries
        if justBoundingBox:
            for brep in shdSurfaces:
                if brep.Faces.Count>1 or not brep.Faces[0].IsPlanar(sc.doc.ModelAbsoluteTolerance):
                    shdBreps.append(brep.GetBoundingBox(True).ToBrep())
                else:
                    shdBreps.append(brep)
        else:
            shdBreps = shdSurfaces
        
        shadingClasses = []
        shadingMeshPreview = []
        
        if meshingSettings == None:
            mp = rc.Geometry.MeshingParameters.Minimal
            mp.SimplePlanes = True
        else:
            mp = meshingSettings
        
        def getRadMaterialName(radMaterial):
            nameStr = radMaterial.split(" ")[2]
            name =  nameStr.split("\n")[0]
            return name
        
        for brepCount, brep in enumerate(shdBreps):
            if brep != None:
                isPlanar = True
                # check planarity
                for face in brep.Faces:
                    if not face.IsPlanar(tolerance):
                        isPlanar = False
                        break
                
                shadingBreps = []
                if not isPlanar:
                    meshArray = rc.Geometry.Mesh.CreateFromBrep(brep, mp)
                    for mesh in meshArray:
                        for meshFace in range(mesh.Faces.Count):
                            vertices = list(mesh.Faces.GetFaceVertices(meshFace))[1:]
                            vertices = vertices + [sc.doc.ModelAbsoluteTolerance]
                            # create the brep from mesh
                            shdBrep = rc.Geometry.Brep.CreateFromCornerPoints(*vertices)
                            shadingBreps.append(shdBrep)
                else:
                    for face in brep.Faces:
                        shadingBreps.append(face.DuplicateFace(False))
                
                for faceCount, shdBrep in enumerate(shadingBreps):
                        thisShading = hb_EPSHDSurface(shdBrep, 1000*brepCount + faceCount, 'shdSrf_' + `brepCount` + '_' + `faceCount` + "_" + str(uuid.uuid4()))
                        
                        # add transmittance schedule if any
                        if EPTransSchedule!=None:
                            schedule= EPTransSchedule.upper()
                            if schedule!=None and not schedule.lower().endswith(".csv") and schedule not in HBScheduleList:
                                msg = "Cannot find " + schedule + " in Honeybee schedule library."
                                print msg
                                ghenv.Component.AddRuntimeMessage(gh.GH_RuntimeMessageLevel.Warning, msg)
                                return -1
                            elif schedule!=None and schedule.lower().endswith(".csv"):
                                # check if csv file is existed
                                if not os.path.isfile(schedule):
                                    msg = "Cannot find the shchedule file: " + schedule
                                    print msg
                                    ghenv.Component.AddRuntimeMessage(gh.GH_RuntimeMessageLevel.Warning, msg)
                                    return -1
                            
                            thisShading.TransmittanceSCH = schedule
                        
                        # add the Rad Material if any
                        if RADMaterial!=None:
                            # if it is just the name of the material make sure it is already defined
                            if len(RADMaterial.split(" ")) == 1:
                                # if the material is not in the library add it to the library
                                if not hb_RADMaterialAUX.isMatrialExistInLibrary(RADMaterial):
                                    warningMsg = "Can't find " + RADMaterial + " in RAD Material Library.\n" + \
                                                "Add the material to the library and try again."
                                    ghenv.Component.AddRuntimeMessage(gh.GH_RuntimeMessageLevel.Warning, warningMsg)
                                    return
                                
                                try:
                                    thisShading.setRADMaterial(RADMaterial)
                                except Exception, e:
                                    print e
                                    warningMsg = "You are using an old version of Honeybee_Honeybee! Update your files and try again."
                                    print warningMsg
                                    ghenv.Component.AddRuntimeMessage(gh.GH_RuntimeMessageLevel.Warning, warningMsg)
                                    return
                                
                                addedToLib = True
                            else:
                                
                                # try to add the material to the library
                                addedToLib, thisShading.RadMaterial = hb_RADMaterialAUX.analyseRadMaterials(RADMaterial, True)
                                
                            if addedToLib==False:
                                warningMsg = "Failed to add " + RADMaterial + " to the Library."
                                ghenv.Component.AddRuntimeMessage(gh.GH_RuntimeMessageLevel.Warning, warningMsg)
                                return
                        
                        # add shading to the list
                        shadingClasses.append(thisShading)
                
        # add to the hive
        hb_hive = sc.sticky["honeybee_Hive"]()
        HBContext  = hb_hive.addToHoneybeeHive(shadingClasses, ghenv.Component.InstanceGuid.ToString())
        return HBContext
        ################################################################################################
    else:
        print "You should first let Honeybee to fly..."
        w = gh.GH_RuntimeMessageLevel.Warning
        ghenv.Component.AddRuntimeMessage(w, "You should first let Honeybee to fly...")
        return -1
        

if _shdSurfaces and _shdSurfaces[0]!=None:
    # add cleaning function
    result= main(_shdSurfaces, EPTransSchedule_, meshingSettings_, justBoundingBox_)
    
    if result != -1: HBContext = result
# ---------- end hb_epcontextsrf ----------
labelzones = Honeybee_LabelZones(HBZones=flatten(mass2zone.HBZones), textHeight=Slider(3, range=0..10))  # -> zoneTxtLabels, labelBasePts, brepTxtLabels, zoneWireFrames; plug-in component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

# ----
# Create glazing
toggle_3 = BooleanToggle(True)
glazingcreator = Honeybee_GlazingBasedOnRatio(HBObjects=mass2zone.HBZones, glzRatio=glzparamlist, breakUpWindow=Toggle(False), runIt=toggle_3)  # -> readMe, HBObjWGLZ; plug-in component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

# ---- group: mass_slope_shape
geo_12 = Geometry(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)

# ----
wires = BrepWireframe(Brep=[geo_10, geo_9, geo_11, geo_12], Density=-1)
preview = CustomPreview(Geometry=[hb_epcontextsrf, wires], Shader=ColourSwatch(SwatchColor=RGB(138, 138, 138)))
splitmass = Honeybee_SplitBuildingMass(bldgMasses=[geo_10, geo_9], bldgsFlr2FloorHeights="@4.5", runIt=Toggle(True))  # -> readMe, splitBldgMasses; plug-in component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
splitmass_2 = Honeybee_SplitBuildingMass(bldgMasses=geo_11, bldgsFlr2FloorHeights="@4.5", runIt=Toggle(True))  # -> readMe, splitBldgMasses; plug-in component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
glzparamlist_2 = Honeybee_GlazingParametersList(northGlzParam=0, westGlzParam="0.4", southGlzParam="0.4", eastGlzParam=0)  # -> glzParamList; plug-in component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
glzparamlist_3 = Honeybee_GlazingParametersList(northGlzParam="0.4", westGlzParam="0.4", southGlzParam=0, eastGlzParam=0)  # -> glzParamList; plug-in component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
splitmass_3 = Honeybee_SplitBuildingMass(bldgMasses=geo_12, bldgsFlr2FloorHeights="@4.5", runIt=Toggle(True))  # -> readMe, splitBldgMasses; plug-in component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

# ----
# Create test grid!!!
genhbzonetestpts = Honeybee_GenerateZoneTestPoints(
    HBZone=glazingcreator.HBObjWGLZ,
    gridSize=Slider(2, range=0..10000),
    distBaseSrf=Slider(1, range=0..1000),
    moveTestMesh=True)  # -> readMe, simplify(testPoints), simplify(ptsVectors), simplify(facesArea), simplify(mesh); plug-in component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

glzparamlist_4 = Honeybee_GlazingParametersList(northGlzParam="0.4", westGlzParam=0, southGlzParam="0.4", eastGlzParam="0.4")  # -> glzParamList; plug-in component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

# ---- group: EPW file
# Generate sky file
path = FilePath("C:\saeran\master\git\bibil\src\reference\CAN_ON_Toronto.716240_CWEC\CAN_ON_Toronto.716240_CWEC.epw")

# ----
geo_13 = Geometry(genhbzonetestpts.testPoints)
mass2zone_2 = Honeybee_Masses2Zones(
    zoneMasses=flatten(splitmass.splitBldgMasses),
    zonePrograms=item_3,
    isConditioned=True,
    maxRoofAngle=30,
    createHBZones=toggle)  # -> readMe, HBZones; plug-in component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
python_3 = PythonScript()  # -> o
# ---------- python_3: Python ----------
o = range(6,12)
print o
# ---------- end python_3 ----------
mass2zone_3 = Honeybee_Masses2Zones(
    zoneMasses=flatten(splitmass_2.splitBldgMasses),
    zonePrograms=item_3,
    isConditioned=True,
    maxRoofAngle=30,
    createHBZones=toggle)  # -> readMe, HBZones; plug-in component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
glazingcreator_2 = Honeybee_GlazingBasedOnRatio(HBObjects=mass2zone_2.HBZones, glzRatio=glzparamlist_2, breakUpWindow=Toggle(True), runIt=Toggle(True))  # -> readMe, HBObjWGLZ; plug-in component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
glazingcreator_3 = Honeybee_GlazingBasedOnRatio(HBObjects=mass2zone_3.HBZones, glzRatio=glzparamlist_3, breakUpWindow=Toggle(False), runIt=Toggle(True))  # -> readMe, HBObjWGLZ; plug-in component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

# ----
# Visualize
decomposebytype = Honeybee_DecomposeBasedOnType(HBZone=glazingcreator.HBObjWGLZ)  # -> walls, interiorWalls, airWalls, windows, interiorWindows, skylights, roofs, ceilings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; plug-in component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
preview_2 = CustomPreview(Geometry=decomposebytype.walls, Shader=ColourSwatch(SwatchColor=RGB(255, 241, 112)))
preview_3 = CustomPreview(Geometry=decomposebytype.windows, Shader=ColourSwatch(SwatchColor=RGBA(176, 233, 255, 153)))

mass2zone_4 = Honeybee_Masses2Zones(
    zoneMasses=flatten(splitmass_3.splitBldgMasses),
    zonePrograms=item_3,
    isConditioned=True,
    maxRoofAngle=30,
    createHBZones=toggle)  # -> readMe, HBZones; plug-in component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
genclimatebasedsky = Honeybee_GenerateClimateBasedSky(weatherFile=path, month="6", day="21", hour="9")  # -> radiationValues, skyFilePath; plug-in component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
glazingcreator_4 = Honeybee_GlazingBasedOnRatio(HBObjects=mass2zone_4.HBZones, glzRatio=glzparamlist_4, breakUpWindow=Toggle(True), runIt=Toggle(True))  # -> readMe, HBObjWGLZ; plug-in component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
geo_14 = Geometry(glazingcreator_3.HBObjWGLZ)
gencumsky = Honeybee_GenerateCumulativeSky(weatherFile=path, generateSky=Toggle(True))  # -> skyFilePath; plug-in component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
gridbasedsimulation = Honeybee_GridBasedSimulation(
    skyFile=gencumsky,
    testPoints=genhbzonetestpts.testPoints,
    ptsVectors=genhbzonetestpts.ptsVectors,
    testMesh=genhbzonetestpts.mesh,
    simulationType=Slider(1, range=0..1))  # -> analysisRecipe; plug-in component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
toggle_4 = BooleanToggle(True)
panel_3 = Panel(gencumsky)
rundaylightanalysis = Honeybee_RunDaylightSimulation(
    HBObjects=flatten(glazingcreator.HBObjWGLZ),
    analysisRecipe=gridbasedsimulation,
    writeRad=toggle_4,
    runRad=toggle_4,
    overwriteResults=True)  # -> readMe, analysisType, resultsUnit, cumulative_radiation_values, testPts, cumulative_radiation_files, radGeoFile, studyFolder, done; plug-in component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
number_slider = Slider(1, range=0..10)  # disabled
panel_4 = Panel(rundaylightanalysis.readMe)
python_4 = PythonScript(x=rundaylightanalysis.cumulative_radiation_values, period_num=number_slider)  # -> a; inputs x: list; disabled
# ---------- python_4: Python ----------
div = len(x)/period_num
L = []
lstval = []
for i in range(len(x)):
    lstval.append(x[i])
    if i%div==0 and i>0:
        L.append(lstval)
        #print len(lstval)
        lstval = []

M = []
#loop through all div num (252)
for i in range(int(div)):
    indexsum = 0.
    #get index from each bucet
    for j in range(len(L)):
        radvalatindex = L[j][i]
        indexsum += float(radvalatindex) 
    M.append(indexsum/float(len(L)))
    
a = M
# ---------- end python_4 ----------
setepzonecnstr = Honeybee_SetEPZoneConstruction(
    HBZone=[glazingcreator_2.HBObjWGLZ, glazingcreator_3.HBObjWGLZ, glazingcreator_4.HBObjWGLZ],
    wallEPConstruction=item_2,
    windowEPConstruction=item)  # -> simplify(modifiedHBZone); plug-in component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
decomposebytype_2 = Honeybee_DecomposeBasedOnType(HBZone=setepzonecnstr)  # -> walls, interiorWalls, airWalls, flatten(windows), interiorWindows, skylights, roofs, ceilings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; plug-in component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
number_slider_2 = Slider(225, range=0..1000)
wires_2 = BrepWireframe(Brep=decomposebytype_2.floors, Density=-1)
preview_4 = CustomPreview(Geometry=decomposebytype_2.windows, Shader=ColourSwatch(SwatchColor=RGBA(191, 238, 255, 0)))
sort = SortList(Keys=rundaylightanalysis.cumulative_radiation_values)  # -> Keys, ValuesA
preview_5 = CustomPreview(Geometry=wires_2, Shader=ColourSwatch(SwatchColor=RGB(255, 0, 0)))
legendpar = Ladybug_LegendParameters(
    lowBound=Slider(0, range=0..100),
    highBound=Slider(15, range=0..100),
    numSegments=7,
    customColors=flatten([ColourSwatch(SwatchColor=RGB(0, 0, 255)), ColourSwatch(SwatchColor=RGB(255, 0, 255))]))  # -> legendPar; plug-in component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
# Annual solar radiation inside building Kwh
panel_5 = Panel(sort.Keys)

# ----
# Visualize
panel_6 = Panel("Annual solar radiation inside building Kwh")
recolormesh = Ladybug_RecolorMesh(
    analysisResult=rundaylightanalysis.cumulative_radiation_values,
    inputMesh=genhbzonetestpts.mesh,
    heightDomain="0",
    legendPar=legendpar,
    analysisTitle=panel_6)  # -> readMe, newMesh, newLegend, legendBasePt, meshColors, legendColors; plug-in component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

swatch = ColourSwatch(SwatchColor=RGB(255, 208, 0))
swatch_2 = ColourSwatch(SwatchColor=RGB(115, 0, 255))
mesh = Mesh(recolormesh.newMesh)
