# Grasshopper definition hb_radiation_internal.gh (Grasshopper 0.9.76)
# plug-ins: Python Interpreter

honeybee = Honeybee_Honeybee()  # -> Vviiiiiiiiiizzz; plug-in component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
ladybug = Ladybug_Ladybug()  # -> Vviiiiiiiiiizzz; plug-in component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
listzoneprograms = Honeybee_ListZonePrograms(bldgProgram=Slider(0, range=0..100))  # -> OfficeZonePrograms; plug-in component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

# ---- group: Exterior wall
geo = Geometry(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)

# ---- group: Window
geo_2 = Geometry(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)

# ---- group: floor
geo_3 = Geometry(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)

# ----
ceiling = Geometry(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)
glzparamlist = Honeybee_GlazingParametersList(northGlzParam="0.6", westGlzParam="0.6", southGlzParam="0.6", eastGlzParam="0.6")  # -> glzParamList; plug-in component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
item = ListItem(List=listzoneprograms, Index=0, Wrap=True)

# ----
# Zone to analyze
toggle = BooleanToggle(True)
geo_4 = Geometry(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)
mass2zone = Honeybee_Masses2Zones(zoneMasses=flatten(geo_4), zonePrograms=item, isConditioned=True, maxRoofAngle=30, createHBZones=toggle)  # -> readMe, HBZones; plug-in component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

python = PythonScript(g=[geo, geo_2], num=Slider(18, range=0..100), dim=Slider(-3000, range=-3000..3000), axis="y")  # -> a
# ---------- python: Python ----------
import rhinoscriptsyntax as rs


L = []
L.append(g)
dim_ = dim
for i in range(int(num)):
    if axis == 'y':
        g_ = rs.CopyObject(g,[0,dim_,0])
    else:
        g_ = rs.CopyObject(g,[0,0,dim_])
    L.append(g_)
    dim_ += dim

a = L
# ---------- end python ----------
python_2 = PythonScript(g=[python, geo_3, ceiling], num=Slider(26, range=0..100), dim=Slider(4500, range=-4500..10000), axis="z")  # -> a; same code as python
labelzones = Honeybee_LabelZones(HBZones=flatten(mass2zone.HBZones), textHeight=Slider(3, range=0..10))  # -> zoneTxtLabels, labelBasePts, brepTxtLabels, zoneWireFrames; plug-in component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

# ----
# Create glazing
toggle_2 = BooleanToggle(True)
glazingcreator = Honeybee_GlazingBasedOnRatio(HBObjects=mass2zone.HBZones, glzRatio=glzparamlist, breakUpWindow=Toggle(False), runIt=toggle_2)  # -> readMe, HBObjWGLZ; plug-in component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

geo_5 = Geometry([python, python_2])
genhbzonetestpts = Honeybee_GenerateZoneTestPoints(
    HBZone=glazingcreator.HBObjWGLZ,
    gridSize=Slider(2, range=0..10000),
    distBaseSrf=Slider(1, range=0..1000),
    moveTestMesh=True)  # -> readMe, simplify(testPoints), simplify(ptsVectors), simplify(facesArea), simplify(mesh); plug-in component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
# Generate sky file
open_weather_file = Ladybug_OpenEPWWeatherFile(open=Toggle(True))  # -> epwFile; plug-in component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
geo_6 = Geometry(genhbzonetestpts.testPoints)

# ----
# Visualize
decomposebytype = Honeybee_DecomposeBasedOnType(HBZone=glazingcreator.HBObjWGLZ)  # -> walls, interiorWalls, airWalls, windows, interiorWindows, skylights, roofs, ceilings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; plug-in component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
preview = CustomPreview(Geometry=decomposebytype.walls, Shader=ColourSwatch(SwatchColor=RGB(255, 241, 112)))
preview_2 = CustomPreview(Geometry=decomposebytype.windows, Shader=ColourSwatch(SwatchColor=RGBA(176, 233, 255, 153)))

panel = Panel("C:\Users\vasanthakumars\Documents\GitHub\bibil\src\reference\gh_files\toronto_site_14\Toron\cumulativeSky_1_1_1_12_31_24.sky")
gencumsky = Honeybee_GenerateCumulativeSky(weatherFile=open_weather_file, generateSky=Toggle(True))  # -> skyFilePath; plug-in component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
gridbasedsimulation = Honeybee_GridBasedSimulation(
    skyFile=panel,
    testPoints=genhbzonetestpts.testPoints,
    ptsVectors=genhbzonetestpts.ptsVectors,
    testMesh=genhbzonetestpts.mesh,
    simulationType=Slider(1, range=0..1))  # -> analysisRecipe; plug-in component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
panel_2 = Panel("C:\Users\vasanthakumars\Desktop\temp_folder\simulation4ladybug")
toggle_3 = BooleanToggle(False)
panel_3 = Panel(gencumsky)
rundaylightanalysis = Honeybee_RunDaylightSimulation(
    HBObjects=flatten(glazingcreator.HBObjWGLZ),
    analysisRecipe=gridbasedsimulation,
    writeRad=toggle_3,
    runRad=toggle_3,
    workingDir=panel_2,
    radFileName="temp",
    overwriteResults=True)  # -> readMe, analysisType, resultsUnit, results, testPts, resultFiles, radGeoFile, studyFolder, done; plug-in component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
panel_4 = Panel(rundaylightanalysis.readMe)
sort = SortList(Keys=rundaylightanalysis.results)  # -> Keys, ValuesA
legendpar = Ladybug_LegendParameters(lowBound=Slider(0, range=0..100), highBound=Slider(50, range=0..100), numSegments=7)  # -> legendPar; plug-in component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
# Annual solar radiation inside building Kwh
panel_5 = Panel(sort.Keys)

# ----
# Visualize
panel_6 = Panel("Annual solar radiation inside building Kwh")
recolormesh = Ladybug_RecolorMesh(
    analysisResult=rundaylightanalysis.results,
    inputMesh=genhbzonetestpts.mesh,
    heightDomain="0",
    legendPar=legendpar,
    analysisTitle=panel_6)  # -> readMe, newMesh, newLegend, legendBasePt, meshColors, legendColors; plug-in component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

swatch = ColourSwatch(SwatchColor=RGB(255, 208, 0))
swatch_2 = ColourSwatch(SwatchColor=RGB(115, 0, 255))
