# Grasshopper definition hbsurf_glz_test.gh (Grasshopper 0.9.76)
# plug-ins: Python Interpreter

honeybee = Honeybee_Honeybee()  # -> Vviiiiiiiiiizzz; plug-in component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
geo = Geometry([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])
geo_2 = Geometry([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])

# ---- group: Floor
createhbsrfs = Honeybee_createHBSrfs(geometry=geo_2)  # -> readMe, simplify(HBSurface); plug-in component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

# ---- group: Wall
createhbsrfs_2 = Honeybee_createHBSrfs(geometry=geo)  # -> readMe, simplify(HBSurface); plug-in component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

# ----
bldgprograms = Honeybee_bldgPrograms({"Office": 0, "Retail": 1, "MidriseApartment": 2, "PrimarySchool": 3, "SecondarySchool": 4, "SmallHotel": 5, "LargeHotel": 6, "Hospital": 7, "Outpatient": 8, "Warehouse": 9, "SuperMarket": 10, "FullServiceRestaurant": 11, "QuickServiceRestaurant": 12}, selected="Office")
listzoneprograms = Honeybee_ListZonePrograms(bldgProgram=bldgprograms)  # -> OfficeZonePrograms; plug-in component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
item = ListItem(List=listzoneprograms, Index=0, Wrap=True)
createhbzones = Honeybee_createHBZones(
    name="test",
    zoneProgram=item,
    HBSurfaces=flatten([createhbsrfs.HBSurface, createhbsrfs_2.HBSurface]),
    isConditioned=Toggle(True))  # -> readMe, HBZone; plug-in component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
geo_3 = Geometry(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)
addhbglz = Honeybee_addHBGlz(HBObj=createhbzones.HBZone, childSurfaces=flatten(geo_3))  # -> HBObjWGLZ; plug-in component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
