# Grasshopper definition 10_ArchsimMultiZone_test.gh (Grasshopper 0.9.76)
# plug-ins: Python Interpreter, ArchsimGH

honeybee = Honeybee_Honeybee()  # -> Vviiiiiiiiiizzz; plug-in component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
ladybug = Ladybug_Ladybug()  # -> Vviiiiiiiiiizzz; plug-in component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

# ---- group: res_tower
geo = Geometry([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])

# ---- group: comm_podium
geo_2 = Geometry([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])

# ----
splitmass = Honeybee_SplitBuildingMass(bldgMasses=geo_2, bldgsFlr2FloorHeights="@3", perimeterZoneDepth="@3", runIt=Toggle(True))  # -> readMe, splitBldgMasses; plug-in component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
mass2zone = Honeybee_Masses2Zones(zoneMasses=flatten(splitmass.splitBldgMasses), isConditioned=Toggle(False), maxRoofAngle=30, createHBZones=Toggle(True))  # -> readMe, HBZones; plug-in component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
geo_3 = Geometry(splitmass.splitBldgMasses)
solveadjc = Honeybee_SolveAdjacencies(HBZones=flatten(mass2zone.HBZones), removeCurrentAdjc=False, findAdjc=Toggle(True))  # -> readMe, HBZonesWADJ; plug-in component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
perimetercore = Honeybee_PerimeterCoreZoning(HBZones=flatten(solveadjc.HBZonesWADJ))  # -> perimeters, interiors; plug-in component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
addhbglz = Honeybee_addHBGlz()  # -> HBObjWGLZ; plug-in component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
glazingcreator = Honeybee_GlazingBasedOnRatio(HBObjects=solveadjc.HBZonesWADJ, glzRatio="0.3", breakUpWindow=Toggle(False), runIt=Toggle(True))  # -> readMe, HBObjWGLZ; plug-in component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
geo_4 = Geometry(perimetercore.perimeters)
geo_5 = Geometry(perimetercore.interiors)
decomposebytype = Honeybee_DecomposeBasedOnType(HBZone=glazingcreator.HBObjWGLZ)  # -> walls, interiorWalls, airWalls, windows, interiorWindows, skylights, roofs, ceilings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; plug-in component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
brep = Brep([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])
zone = ThermalZone(
    ThermalZoneGeometry=perimetercore.perimeters,
    Name="Perimeter",
    SettingsAsFormatedString="-NoSelection-",
    Library="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",
    Settings="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")  # -> ThermalZones, SettingsAsFormatedString
zone_2 = ThermalZone(
    ThermalZoneGeometry=perimetercore.interiors,
    Name="Core",
    SettingsAsFormatedString="-NoSelection-",
    Library="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",
    Settings="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")  # -> ThermalZones, SettingsAsFormatedString
geo_6 = Geometry(decomposebytype.windows)
window = Window(
    WindowGeometry=brep,
    Library="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",
    Settings="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")  # -> Window, SettingsAsFormatedString
networker = ZoneConnectivityNetwork(ThermalZoneCollection=[zone.ThermalZones, zone_2.ThermalZones], Windows=window.Window)
surfaceanalysis = SurfaceAnalysis(ThermalModel=networker)  # -> Facade, Partition, Ceiling, Roof, ExternalFloor, Floor, Window, FaceID, IDLocation
run_e = TakesThermalModelAndRunsEnergyPlus(
    ThermalModel=networker,
    ProjectName="MultiZone",
    WorkingDirectory="C:\ArchsimResults\MultiZone",
    WeatherFile="USA_MA_Boston-Logan.Intl.AP.725090_TMY3",
    StartsTheSimulation=Button(),
    settings="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")  # -> ThermalModel, SettingsAsFormatedString
brep_2 = Brep([surfaceanalysis.Window, surfaceanalysis.Facade, surfaceanalysis.Floor, surfaceanalysis.ExternalFloor])
intersector = Intersector()
zone_loads = ZoneLoads(
    Name="noName",
    Peop=True,
    Pden=0.2,
    Occ="AllOn",
    Equip=True,
    Eden=8,
    Esched="AllOn",
    Light=True,
    Lden=6,
    Dim="Off",
    Ill=500,
    Lsched="AllOn")
load_zone_results = LoadZoneResults(ThermalModel=run_e.ThermalModel, Toggle=Toggle(True), settings="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")  # -> flatten(ZoneGeometry), ResultsPerZone, Labels, Guid, Name
ma = MassAddition(Input=load_zone_results.ResultsPerZone)  # -> flatten(Result), PartialResults
bnd = Bounds(Numbers=ma.Result)
dedomain = DeconstructDomain(Domain=bnd)  # -> Start, End
panel = Panel(load_zone_results.ResultsPerZone)
gradient = Gradient(
    LowerLimit=dedomain.End,
    UpperLimit=dedomain.Start,
    Parameter=ma.Result,
    stops=[0: RGB(234, 38, 0), 0.25: RGB(234, 126, 0), 0.5: RGB(254, 244, 84), 0.75: RGB(173, 203, 249), 1: RGB(75, 107, 169)])
panel_2 = Panel(load_zone_results.ZoneGeometry)
panel_3 = Panel(ma.Result)
preview = CustomPreview(Geometry=load_zone_results.ZoneGeometry, Shader=gradient)

panel_4 = Panel("C:\\Users\\vasanthakumars\\Documents\\GitHub\\bibil\\src\\reference\\honeybee_work\\Honeybee_SplitZone.py")  # disabled
panel_5 = Panel("C:\\saeran\\master\\git\\bibil\\src\\reference\\honeybee_work\\Honeybee_SplitZone.py")  # disabled
panel_6 = Panel("C:\\Users\\vasanthakumars\\Documents\\GitHub\\bibil\\src\\reference\\honeybee_work\\Honeybee_SplitBuildingMass.py")  # disabled
panel_7 = Panel("C:\\saeran\\master\\git\\bibil\\src\\reference\\honeybee_work\\Honeybee_SplitBuildingMass.py")  # disabled
toggle = BooleanToggle(True)  # disabled
toggle_2 = BooleanToggle(True)  # disabled
list = ValueList({"dir", "file"}, selected="file")  # disabled
list_2 = ValueList({"dir", "file"}, selected="file")  # disabled
panel_8 = Panel("@3")  # disabled
toggle_3 = BooleanToggle(True)  # disabled
panel_9 = Panel("@3")  # disabled

# ---- group: find directory
bibil = PythonScript(dir=[panel_5, panel_4], type=list, run=toggle)  # -> file; inputs dir: list; disabled
# ---------- bibil: Python ----------
import os

ghenv.Component.Params.Output[0].Name = "null"
ghenv.Component.Params.Output[0].NickName = "null"

if run:
    confirm_dir = None
    for d in dir:
        try:
            if type == "file":
                file_ = open(d)
                file_.close()
            else:
                print os.listdir(d)
            confirm_dir = d
            break
        except Exception as e:
            #print str(e)
            continue
    if confirm_dir != None:
        ghenv.Component.Params.Output[0].Name = type
        ghenv.Component.Params.Output[0].NickName = type
        dir = confirm_dir
        file = confirm_dir
null = None
# ---------- end bibil ----------

bibil_2 = PythonScript(dir=[panel_7, panel_6], type=list_2, run=toggle_2)  # -> file; inputs dir: list; disabled; same code as bibil

# ----
file = ReadFile(File=bibil_2, PerLineParse=False)  # disabled
file_2 = ReadFile(File=bibil, PerLineParse=False)  # disabled
splitmass_2 = Honeybee_SplitBuildingMass(Code=file, BldgsFlr2FloorHeights_=panel_8)  # -> ReadMe, SplitBldgMasses; disabled
geo_7 = Geometry(splitmass_2.SplitBldgMasses)  # disabled
python = PythonScript(Code=file_2, _bldgMasses=flatten(splitmass_2.SplitBldgMasses), PerimeterZoneDepth_=panel_9, _runIt=toggle_3)  # -> ReadMe, SplitBldgMasses, Debug; disabled
wires = BrepWireframe(Brep=geo_7, Density=-1)  # disabled
preview_2 = CustomPreview(
    Geometry=wires,
    Shader={ambient=RGB(0, 0, 0), diffuse=RGB(255, 105, 180), emission=RGB(76, 32, 54), shine=0.5, specular=RGB(255, 255, 255), transparency=0})  # disabled
geo_8 = Geometry(python.Debug)  # disabled
geo_9 = Geometry(python.SplitBldgMasses)  # disabled
