# Grasshopper definition UD_error_sample.gh (Grasshopper 0.9.76)
# plug-ins: Python Interpreter

# ---- group: START
# Note: Change this number with caution,
# Increase bounds iterratively.
toggle = BooleanToggle(True)

# ---- group: podium_for_context
geo = Geometry(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)

# ---- group: tower
geo_2 = Geometry(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)

# ----
listzoneprograms = Honeybee_ListZonePrograms(bldgProgram=Slider(0, range=0..100))  # -> OfficeZonePrograms; plug-in component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
splitmass = Honeybee_SplitBuildingMass(bldgMasses=geo_2, bldgsFlr2FloorHeights="@3", perimeterZoneDepth="@3", runIt=toggle)  # -> readMe, splitBldgMasses; plug-in component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
num = Number(9)
item = ListItem(List=listzoneprograms, Index=num, Wrap=True)
mass2zone = Honeybee_Masses2Zones(
    zoneMasses=flatten(splitmass.splitBldgMasses),
    zonePrograms=item,
    isConditioned=True,
    maxRoofAngle=30,
    createHBZones=Toggle(True))  # -> readMe, HBZones; plug-in component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

# ---- group: WILL CRASH
toggle_2 = BooleanToggle(False)

# ----
solveadjc = Honeybee_SolveAdjacencies(HBZones=flatten(mass2zone.HBZones), removeCurrentAdjc=False, findAdjc=Toggle(True))  # -> readMe, HBZonesWADJ; plug-in component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
glzparamlist = Honeybee_GlazingParametersList(northGlzParam="0.3", westGlzParam="0.3", southGlzParam="0.3", eastGlzParam="0.3")  # -> glzParamList; plug-in component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
geo_3 = Geometry(solveadjc.HBZonesWADJ)
glazingcreator = Honeybee_GlazingBasedOnRatio(HBObjects=solveadjc.HBZonesWADJ, glzRatio=glzparamlist, breakUpWindow=Toggle(False), runIt=toggle_2)  # -> readMe, HBObjWGLZ; plug-in component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
setepzonecnstr = Honeybee_SetEPZoneConstruction(HBZone=glazingcreator.HBObjWGLZ)  # -> simplify(modifiedHBZone); plug-in component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
ladybug = Ladybug_Ladybug()  # -> Vviiiiiiiiiizzz; plug-in component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
honeybee = Honeybee_Honeybee()  # -> Vviiiiiiiiiizzz; plug-in component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
updatehoneybee = Honeybee_UpdateHoneybee(updateThisFile=Toggle(False))  # -> out; plug-in component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
panel = Panel(updatehoneybee)
geo_4 = Geometry(setepzonecnstr)
