# Grasshopper definition bibil_trial_063.gh (Grasshopper 0.9.76)
# plug-ins: Python Interpreter, LunchBox

# TEST LOT
panel = Panel("tower_in_podium")
geo = Geometry(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)
geo_2 = Geometry([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])
geo_3 = Geometry(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)
geo_4 = Geometry(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)
geo_5 = Geometry([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])
geo_6 = Geometry([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])
# SMALL NORTH
refroot_2 = Curve(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)
parcel_2 = Curve(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)
# LARGE INTERIOR LOT
geo_7 = Geometry(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)

# ---- group: lot_2
geo_8 = Geometry(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)

# ---- group: setback
geo_9 = Geometry(geo_2)
geo_10 = Geometry(geo_2)
geo_11 = Geometry(geo_2)

# ---- group: lot_3
refroot_3 = Curve(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)

# ---- group: lot_1
refroot_3_2 = Curve(geo_3)

# ---- group: refblock
refroot_3_3 = Curve(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)

# ----
parcel_3 = Curve(geo_4)
geo_12 = Geometry([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])
# LARGE NORTH
refroot_3_4 = Curve(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)
parcel_3_2 = Curve(geo)
geo_13 = Geometry([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])
refroot_3_5 = Curve(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)
geo_14 = Geometry(geo_5)
setbacks = Geometry(geo_5)
refroot_2_2 = Curve(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)
parcel_2_2 = Curve(geo_7)
plots = Geometry(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)
refroot_2_3 = Curve(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)
number_slider = Slider(0, range=0..10)
number_slider_2 = Slider(0, range=0..100)
panel_2 = Panel("lot")
# ALONG
# EGLINTON
parcel_0 = Curve([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])
toggle = BooleanToggle(False)
parcel_1 = Curve([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])
number_slider_3 = Slider(0, range=0..10)
number_slider_4 = Slider(0, range=0..100)
number_slider_5 = Slider(0, range=0..10)
number_slider_6 = Slider(0, range=0..100)
number_slider_7 = Slider(0, range=0..10)
number_slider_8 = Slider(0, range=0..100)
number_slider_9 = Slider(0, range=0..10)
number_slider_10 = Slider(0, range=0..100)
parcel_0_2 = Curve(parcel_0)
geo_15 = Geometry([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])
geo_16 = Geometry([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])
parcel_1_2 = Curve(parcel_1)
refroot_0 = Curve(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)
toggle_2 = BooleanToggle(False)
refroot_1 = Curve(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)
toggle_3 = BooleanToggle(False)
toggle_4 = BooleanToggle(False)
toggle_5 = BooleanToggle(False)
number_slider_11 = Slider(0, range=0..10)
number_slider_12 = Slider(0, range=0..100)
number_slider_13 = Slider(0, range=0..10)
number_slider_14 = Slider(0, range=0..100)
toggle_6 = BooleanToggle(False)
toggle_7 = BooleanToggle(False)
toggle_8 = BooleanToggle(True)

# ---- group: find directory
bibil = PythonScript(
    dir=["C:\\Users\\vasanthakumars\\Documents\\GitHub\\bibil\\src", "C:\\Users\\user\\Desktop\\bibil_backup\\src"],
    run=Toggle(True))  # -> dir; inputs dir: list
# ---------- bibil: Python ----------
import os

ghenv.Component.Params.Output[0].Name = "null"
ghenv.Component.Params.Output[0].NickName = "null"

if run:
    confirm_dir = None
    for d in dir:
        try:
            print os.listdir(d)
            confirm_dir = d
            break
        except:
            continue
    ghenv.Component.Params.Output[0].Name = "dir"
    ghenv.Component.Params.Output[0].NickName = "dir"
    dir = confirm_dir
null = None
# ---------- end bibil ----------

# ----
panel_6 = Panel(bibil)
python_script = PythonScript(i=panel_6)  # -> o
# ---------- python_script: Python ----------
import os

o = os.path.join(str(i),"trinco\\trinco_block_component.py")
# ---------- end python_script ----------
file = ReadFile(File=python_script, PerLineParse=False)

python_script_2 = PythonScript(i=panel_6)  # -> o
# ---------- python_script_2: Python ----------
import os

o = os.path.join(str(i),"miru\\miru_pattern_component.py")
# ---------- end python_script_2 ----------
file_2 = ReadFile(File=python_script_2, PerLineParse=False)

python_script_3 = PythonScript(i=panel_6)  # -> o
# ---------- python_script_3: Python ----------
import os

o = os.path.join(str(i),"bibil\\bibil_tree.py")
# ---------- end python_script_3 ----------
file_3 = ReadFile(File=python_script_3, PerLineParse=False)
python_script_4 = PythonScript(i=panel_6)  # -> o
# ---------- python_script_4: Python ----------
import os

o = os.path.join(str(i),"bibil\\bibil_shape.py")
#o = os.path.join(str(i),"research\\bibil_shape_shape_3d_2d.py")
# ---------- end python_script_4 ----------
file_4 = ReadFile(File=python_script_4, PerLineParse=False)
python_script_5 = PythonScript(i=panel_6)  # -> o
# ---------- python_script_5: Python ----------
import os

o = os.path.join(str(i),"bibil\\bibil_rule.py")
# ---------- end python_script_5 ----------
file_5 = ReadFile(File=python_script_5, PerLineParse=False)
bibil_2 = PythonScript(Code=file_3)
bibil_3 = PythonScript(Code=file_5)
bibil_4 = PythonScript(Code=file_4)
python_script_6 = PythonScript(i=panel_6)  # -> o
# ---------- python_script_6: Python ----------
import os

o = os.path.join(str(i),"koku\\koku_vector.py")
# ---------- end python_script_6 ----------
file_6 = ReadFile(File=python_script_6, PerLineParse=False)
python_script_7 = PythonScript(i=panel_6)  # -> o; same code as python_script_6
file_7 = ReadFile(File=python_script_7, PerLineParse=False)
python_script_8 = PythonScript(i=panel_6)  # -> o
# ---------- python_script_8: Python ----------
import os

o = os.path.join(str(i),"bibil\\bibil_pattern.py")
# ---------- end python_script_8 ----------
file_8 = ReadFile(File=python_script_8, PerLineParse=False)
bibil_5 = PythonScript(Code=file_8)
bibil_6 = PythonScript(Code=file_6)
bibil_7 = PythonScript(Code=file_7)
python_editor = PythonScript()
# ---------- python_editor: Python ----------
import rhinoscriptsyntax as rs
import ghpythonlib.components as ghcomp
import Rhino as rc
import scriptcontext as sc
import math
import random 

#print abs(-1)
#rc.Geometry.Vector3d.VectorAngle(anglea,angleb)

#print rc.Geometry.Plane.WorldXY
#rc.Geometry.Point3d(
#rc.Geometry.Plane(
#sc.doc.Objects.Add
L = [(3,1),(4,6),(78,2)]
V = sorted(L,key=lambda n: n[1],reverse=True)
#L.sort()#
#print L
#print V

#print 'envelope' in 'helloenvelope'

def foo(test):
    a = test*1
    b = test*2
    return a,b
 

print foo(5)


#sc.doc.Objects.AddCurve()
#rc.Geometry.Vector3d(x,y,z)
#ghcomp.Flip(surface,sc.sticky['surface_ref'])
#rs.ScaleObject(objectid,origin,scale)

#L = [1,2,3]
#ghcomp.DIVA.SolarFan(crv,lat,minhours,firstfrost,dist)
#rc.Geometry.Point3d(

#print random.randrange(1,10)

"""
crv = rs.coercecurve(y)
testpt = rs.coerce3dpoint(x)
val = crv.ClosestPoint(testpt)
print val

ghval = ghcomp.CurveClosestPoint(testpt,crv)
print ghval[2]
"""
# ---------- end python_editor ----------

# ---- group: ANIMATE
toggle_9 = BooleanToggle(False)

# ---- group: EXCEL
toggle_10 = BooleanToggle(True)

# ----
toggle_11 = BooleanToggle(True)

# ---- group: SIMULATE
toggle_12 = BooleanToggle(False)

# ----
pt = Point([Point(-545784.4028, 3982087.267, 0), Point(-545789.7348, 3982106.236, 0), Point(-545795.0667, 3982125.206, 0), Point(-545800.3987, 3982144.176, 0), Point(-545779.0708, 3982068.297, 0), Point(-545797.8895, 3982083.476, 0)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])
pt_2 = Point([Point(-545528.1544, 3982159.293, 0), Point(-545541.6412, 3982155.502, 0), Point(-545555.1279, 3982151.711, 0), Point(-545568.6147, 3982147.921, 0), Point(-545582.1014, 3982144.13, 0), Point(-545595.5882, 3982140.339, 0)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])
pt_3 = Point([Point(-545979.8034, 3981643.445, 0), Point(-545966.3167, 3981647.235, 0), Point(-545952.8299, 3981651.026, 0), Point(-545939.3432, 3981654.817, 0), Point(-545925.8564, 3981658.608, 0), Point(-545912.3697, 3981662.399, 0)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])
transit_dpt = Point(Point(-545356.282, 3981726.697, 0))
transit_dpt_2 = Point(Point(-546019.3338, 3981540.172, 0))
x10 = PythonScript(x=Slider(4, range=0..10))  # -> a
# ---------- x10: Python ----------
a = x/5.
# ---------- end x10 ----------
geo_17 = Geometry(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)
num = Number(1)
cir = Circle(Plane=transit_dpt_2, Radius=Slider(250, range=0..1000))
python_script_9 = PythonScript(i=panel_6)  # -> o
# ---------- python_script_9: Python ----------
import os

o = os.path.join(str(i),"bula\\bula_point.py")
# ---------- end python_script_9 ----------
file_9 = ReadFile(File=python_script_9, PerLineParse=False)
quick_ca_abm = PythonScript(pts=pt, dpt_major=transit_dpt_2, dpt_minor=transit_dpt, power=num, boundary=geo_17, iterate=x10)  # -> line, cpt, txt; inputs pts: list, dpt_major: Point3d, power: Int32, iterate: list
# ---------- quick_ca_abm: Python ----------
"""
Copyright (C) Saeran Vasanthakumar - All Rights Reserved
Unauthorized copying of this file, via any medium is strictly prohibited
Proprietary and confidential
Written by Saeran Vasanthakumar <saeranv@gmail.com>, May 2016
"""

import rhinoscriptsyntax as rs
import math

def normalize_list(lov,lobound,hibound):
    ### normalized_val = ( (val-min)*(hibound-lobound) )/(max-min) + lobound
    max_ = max(lov)
    min_ = min(lov)
    L = []
    for i,v in enumerate(lov):
        norm_val = ((hibound-lobound)*(v-min_))/(max_-min_) + lobound
        L.append(norm_val)
    return L
def get_distance(pts_,dpt_major,dpt_minor):
    YEL = []
    MPL = []#parallel list of which points is chosen
    for pt in pts_:
        dlst = []
        distmajor = rs.Distance(pt,dpt_major)
        distminor = rs.Distance(pt,dpt_minor)
        YEL.append(distmajor)
        MPL.append(distminor)
    return YEL,MPL
    
def get_uniformity(YL,ML,iterate_,power_):
    val_lst = [] 
    norm_dist_yonge = normalize_list(YL,0.,1.0)
    norm_dist_mount = normalize_list(ML,0.,3.0)
    #YL = normalize_list(YL,0.,20.)
    #ML = normalize_list(ML,0.,20.)
    for it in iterate_:
        #print 'iterate', it
        for i,dist in enumerate(zip(YL,ML)):
            y = dist[0]
            m = dist[1]
            divfact = 75.
            powfact = 1.1
            factor = factor =  math.pow(abs(y-m)/divfact,powfact)
            if y<m:
                try:
                    y = norm_dist_yonge[i]
                    z = y#25 * (1/math.pow(y,it))
                    z = 25 * (1/math.pow(y,it))
                except ZeroDivisionError:
                    z = 0.
            else:
                try:
                    m = norm_dist_mount[i]
                    #z = m#25 * (1/math.pow(m,it))
                    z = 25 * (1/math.pow(m,it))
                except ZeroDivisionError:
                    z = 0.
            z *= factor/6.
            #z += 0.
            """
            try:
                factor = 
                z = 25 * (1/math.pow(factor,it))
            except ZeroDivisionError:
                z = 0.
            """
            val_lst.append(z)
            #25 multiplier stretches it out
            ##old
            #z = 10./math.pow(float(d),float(it)/2.)
            # stretched out more when 10 outside
            #z = math.pow(10./float(d),float(it)/2.)
    return val_lst

def check_point_in_crv(crv,pt):
    rel = rs.PointInPlanarClosedCurve(pt,crv)
    if rel == 1: # inside curve
        return True
    else:
        return False
    
def make_line(zlst,ptlst):
    line_ = []
    for z,pt in zip(zlst,ptlst):
        rel = check_point_in_crv(boundary,pt)
       
        if rel == True:
            pt = rs.coerce3dpoint(pt)
            pt = rs.AddPoint(pt[0],pt[1],0)
            pt = rs.coerce3dpoint(pt)
            #if z < 0.001: z= 0.001
            toppt = rs.AddPoint(pt[0], pt[1], z)
            ln = rs.AddLine(pt,toppt)
            line_.append(rs.coerceline(ln))
    return line_
if True:
    
    YL,ML = get_distance(pts,dpt_major,dpt_minor)
    zdist = get_uniformity(YL,ML,iterate,power)
    line = make_line(zdist,pts)
# ---------- end quick_ca_abm ----------
geo_18 = Geometry(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)
geo_19 = Geometry(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)
end = EndPoints(Curve=quick_ca_abm.line)  # -> Start, End
geo_20 = Geometry(end.Start)
geo_21 = Geometry(end.Start)
python = PythonScript(x=end.Start, y=end.End)  # -> a
# ---------- python: Python ----------
import rhinoscriptsyntax as rs
import scriptcontext as sc

y = rs.coerce3dpoint(y)
radius = y[2]
if radius < 0.1:
    radius = 0.1
a = rs.AddCircle(x,radius/2.5)
# ---------- end python ----------
python_2 = PythonScript(pts=geo_21, brep=geo_19, run=Toggle(True))  # -> project; inputs pts: list
# ---------- python_2: Python ----------
import rhinoscriptsyntax as rs
import Rhino as rc
import scriptcontext as sc

if run:
    debug = []
    dir = rc.Geometry.Vector3d(0,0,1) 
    tol = sc.doc.ModelAbsoluteTolerance
    env = [rs.coercebrep(brep)]
    ptlst = map(lambda p: rs.coerce3dpoint(p),pts)
    
    projlst = rc.Geometry.Intersect.Intersection.ProjectPointsToBreps(env,ptlst,dir,tol)
    #print projlst
    #projlst = filter(lambda pt:abs(pt[2]-200.)>0.5,projlst)
    projlst = filter(lambda p: abs(p[2]-0)>1.,projlst)
    
    if projlst:
        debug.extend(projlst)
        #min_index = projlst.index(min(projlst,key=lambda p:p[2]))
        #min_pt = projlst[min_index]
        #envht = min_pt[2]
    project = debug
# ---------- end python_2 ----------
python_3 = PythonScript(pts=geo_20, brep=geo_18, run=Toggle(True))  # -> project; inputs pts: list; same code as python_2
geometry = Geometry(python_3)
geometry_2 = Geometry(python_2)
geo_22 = Geometry(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)
boundary = BoundarySurfaces(Edges=geo_22)
preview = CustomPreview(Geometry=boundary, Shader=ColourSwatch(SwatchColor=RGBA(255, 90, 255, 177)))

python_script_10 = PythonScript(i=panel_6)  # -> o; same code as python_script_2
file_10 = ReadFile(File=python_script_10, PerLineParse=False)

# ---- group: override
plain_bibil = PythonScript(
    crv=geo_22,
    cut_num=Slider(0, range=0..10),
    cut_dim=Slider(0, range=0..10),
    label="override_park_street",
    run=Toggle(True))  # -> node, debug; inputs crv: list, cut_num: Int32, run: Boolean
# ---------- plain_bibil: Python ----------
"""
Created on Jun 19, 2016
author: Saeran Vasanthakumar
"""

import rhinoscriptsyntax as rs
import Rhino as rc
import scriptcontext as sc

"""import classes"""
Shape_3D = sc.sticky["Shape_3D"]
Pattern = sc.sticky["Pattern"]

def make_node_lst(block_in_,label_): 
    L = []
    P = Pattern()
    for lot_geom in block_in_:
        n_ = P.helper_geom2node(lot_geom,None,label=label_)
        L.append(n_)
    return L
def split_node_lst(node_lst_,cut_num_,cut_dim_,cut_flip_):
    P = Pattern()
    for lot_node in node_lst_:
        lot_node = P.pattern_divide(lot_node,"subdivide_depth",cut_num_,cut_width=cut_dim_)
        #lot_node.make_tree_3D("subdivide_depth_same",depth,axis=axis_,cut_width=street_dim)
        #lot_node.make_tree_3D("subdivide_dim",(18,18),axis=axis_,random_tol=0,cut_width=street_dim)
        yield lot_node.traverse_tree(lambda n:n,internal=False)
    
def main(lot_in_,label_,cut_num_,cut_dim_,cut_flip_):
    ### Grid_Subdivide: (listof node) int int -> (listof node))
    ### Purpose: This component consumes a list of node lots and two int and 
    ###generates a list of mutated nodes, with the lots subdivided according
    ###to the int int dimensions.     
    lst_node = make_node_lst(lot_in_,label_)
    split_nodes = split_node_lst(lst_node,cut_num_,cut_dim_,cut_flip_)
    split_nodes = reduce(lambda x,y: x+y,split_nodes)
    return split_nodes

if run and crv!=[None] and crv!=None:
    sc.sticky["debug"] = []
    debug = sc.sticky["debug"]
    if not label:
        label = ''
    if not cut_dim:
        cut_dim = 0.
    if not cut_num:
        cut_num = 0
    if not cut_flip:
        cut_flip = False
    node = main(crv,label,cut_num,cut_dim,cut_flip)
else:
    print 'Add inputs!'
# ---------- end plain_bibil ----------

# ----
# MIRU PATTERN LIBRARY
data = Data(toggle_11)
block_depth = PythonScript(
    Code=file,
    Ref_block_in=refroot_2,
    Lot_in=parcel_2,
    Depth=number_slider,
    Street_dim=number_slider_2,
    Setback_line=geo_6,
    Label_=panel,
    Flip_axis=toggle,
    Run=data)  # -> Geo_out, Debug
block_depth_2 = PythonScript(
    Code=file,
    Ref_block_in=refroot_3_4,
    Lot_in=parcel_3,
    Depth=number_slider_7,
    Street_dim=number_slider_8,
    Setback_line=geo_12,
    Label_=panel,
    Flip_axis=toggle_4,
    Run=data)  # -> Geo_out, Debug
block_depth_3 = PythonScript(
    Code=file,
    Ref_block_in=refroot_3_5,
    Lot_in=parcel_3_2,
    Depth=number_slider_9,
    Street_dim=number_slider_10,
    Setback_line=geo_13,
    Label_=panel,
    Flip_axis=toggle_5,
    Run=data)  # -> Geo_out, Debug
block_depth_4 = PythonScript(
    Code=file,
    Ref_block_in=refroot_3_3,
    Lot_in=refroot_3_2,
    Depth=Slider(0, range=0..10),
    Street_dim=Slider(0, range=0..100),
    Setback_line=geo_9,
    Label_=panel,
    Flip_axis=Toggle(False),
    Run=data)  # -> Geo_out, Debug
block_depth_5 = PythonScript(
    Code=file,
    Ref_block_in=refroot_3_3,
    Lot_in=geo_8,
    Depth=Slider(0, range=0..10),
    Street_dim=Slider(0, range=0..100),
    Setback_line=geo_10,
    Label_=panel,
    Flip_axis=Toggle(False),
    Run=data)  # -> Geo_out, Debug
block_depth_6 = PythonScript(
    Code=file,
    Ref_block_in=refroot_3_3,
    Lot_in=refroot_3,
    Depth=Slider(0, range=0..10),
    Street_dim=Slider(0, range=0..100),
    Setback_line=geo_11,
    Label_=panel,
    Flip_axis=Toggle(False),
    Run=data)  # -> Geo_out, Debug
block_depth_7 = PythonScript(
    Code=file,
    Ref_block_in=refroot_2_2,
    Lot_in=parcel_2_2,
    Depth=number_slider_3,
    Street_dim=number_slider_4,
    Setback_line=geo_14,
    Label_=panel,
    Flip_axis=toggle_2,
    Run=data)  # -> Geo_out, Debug
block_depth_8 = PythonScript(
    Code=file,
    Ref_block_in=refroot_2_3,
    Lot_in=plots,
    Depth=number_slider_5,
    Street_dim=number_slider_6,
    Setback_line=setbacks,
    Label_=panel,
    Flip_axis=toggle_3,
    Run=data)  # -> Geo_out, Debug
block_depth_9 = PythonScript(
    Code=file,
    Ref_block_in=refroot_0,
    Lot_in=parcel_0_2,
    Depth=number_slider_11,
    Street_dim=number_slider_12,
    Setback_line=geo_15,
    Label_=panel,
    Flip_axis=toggle_7,
    Run=data)  # -> Geo_out, Debug
block_depth_10 = PythonScript(
    Code=file,
    Ref_block_in=refroot_1,
    Lot_in=parcel_1_2,
    Depth=number_slider_13,
    Street_dim=number_slider_14,
    Setback_line=geo_16,
    Label_=panel,
    Flip_axis=toggle_6,
    Run=data)  # -> Geo_out, Debug
block_depth_11 = PythonScript(
    Code=file,
    Ref_block_in=refroot_2,
    Lot_in=parcel_2,
    Depth=number_slider,
    Street_dim=number_slider_2,
    Setback_line=geo_6,
    Label_="tower_in_park",
    Flip_axis=toggle,
    Run=data)  # -> Geo_out, Debug
block_depth_12 = PythonScript(
    Code=file,
    Ref_block_in=refroot_3_4,
    Lot_in=parcel_3,
    Depth=number_slider_7,
    Street_dim=number_slider_8,
    Setback_line=geo_12,
    Label_="tower_in_park",
    Flip_axis=toggle_4,
    Run=data)  # -> Geo_out, Debug
block_depth_13 = PythonScript(
    Code=file,
    Ref_block_in=refroot_3_5,
    Lot_in=parcel_3_2,
    Depth=number_slider_9,
    Street_dim=number_slider_10,
    Setback_line=geo_13,
    Label_="tower_in_park",
    Flip_axis=toggle_5,
    Run=data)  # -> Geo_out, Debug
block_depth_14 = PythonScript(
    Code=file,
    Ref_block_in=refroot_2_2,
    Lot_in=parcel_2_2,
    Depth=number_slider_3,
    Street_dim=number_slider_4,
    Setback_line=geo_14,
    Label_="tower_in_park",
    Flip_axis=toggle_2,
    Run=data)  # -> Geo_out, Debug
block_depth_15 = PythonScript(
    Code=file,
    Ref_block_in=refroot_2_3,
    Lot_in=plots,
    Depth=number_slider_5,
    Street_dim=number_slider_6,
    Setback_line=setbacks,
    Label_="tower_in_park",
    Flip_axis=toggle_3,
    Run=data)  # -> Geo_out, Debug
block_depth_16 = PythonScript(
    Code=file,
    Ref_block_in=refroot_0,
    Lot_in=parcel_0_2,
    Depth=number_slider_11,
    Street_dim=number_slider_12,
    Setback_line=geo_15,
    Label_="tower_in_park",
    Flip_axis=toggle_7,
    Run=data)  # -> Geo_out, Debug
block_depth_17 = PythonScript(
    Code=file,
    Ref_block_in=refroot_1,
    Lot_in=parcel_1_2,
    Depth=number_slider_13,
    Street_dim=number_slider_14,
    Setback_line=geo_16,
    Label_="tower_in_park",
    Flip_axis=toggle_6,
    Run=data)  # -> Geo_out, Debug
geo_23 = Geometry(block_depth_11.Debug)
geo_24 = Geometry(block_depth.Debug)
g = PythonScript(node=block_depth_11.Geo_out)  # -> geom
# ---------- g: Python ----------
if node:
    geom = []
    lot_lst = node.traverse_tree(lambda n:n,internal=False)
    for n in lot_lst:
        geom.append(n.data.shape.geom)
    print geom
# ---------- end g ----------
g_2 = PythonScript(node=block_depth.Geo_out)  # -> geom; same code as g
g_3 = PythonScript(node=block_depth_12.Geo_out)  # -> geom; same code as g
geo_25 = Geometry(block_depth_12.Debug)
g_4 = PythonScript(node=block_depth_2.Geo_out)  # -> geom; same code as g
geo_26 = Geometry(block_depth_2.Debug)
g_5 = PythonScript(node=block_depth_13.Geo_out)  # -> geom; same code as g
geo_27 = Geometry(block_depth_13.Debug)
g_6 = PythonScript(node=block_depth_3.Geo_out)  # -> geom; same code as g
geo_28 = Geometry(block_depth_3.Debug)
g_7 = PythonScript(node=block_depth_4.Geo_out)  # -> geom
# ---------- g_7: Python ----------
if node:
    geom = []
    lot_lst = node.traverse_tree(lambda n:n,internal=False)
    for n in lot_lst:
        geom.append(n.data.shape.bottom_crv)
    print geom
# ---------- end g_7 ----------
g_8 = PythonScript(node=block_depth_5.Geo_out)  # -> geom; same code as g_7
g_9 = PythonScript(node=block_depth_6.Geo_out)  # -> geom; same code as g_7
geo_29 = Geometry(block_depth_4.Debug)
geo_30 = Geometry(block_depth_5.Debug)
geo_31 = Geometry(block_depth_6.Debug)
g_10 = PythonScript(node=block_depth_7.Geo_out)  # -> geom; same code as g
geo_32 = Geometry(block_depth_7.Debug)
g_11 = PythonScript(node=block_depth_14.Geo_out)  # -> geom; same code as g
geo_33 = Geometry(block_depth_14.Debug)
g_12 = PythonScript(node=block_depth_10.Geo_out)  # -> geom; same code as g
g_13 = PythonScript(node=block_depth_9.Geo_out)  # -> geom; same code as g
geo_34 = Geometry(block_depth_8.Debug)
geo_35 = Geometry(block_depth_9.Debug)
geo_36 = Geometry(block_depth_10.Debug)
g_14 = PythonScript(node=block_depth_16.Geo_out)  # -> geom; same code as g
geo_37 = Geometry(block_depth_16.Debug)
g_15 = PythonScript(node=block_depth_17.Geo_out)  # -> geom; same code as g
geo_38 = Geometry(block_depth_17.Debug)
g_16 = PythonScript(node=block_depth_8.Geo_out)  # -> geom; same code as g
geo_39 = Geometry(block_depth_15.Debug)
g_17 = PythonScript(node=block_depth_15.Geo_out)  # -> geom; same code as g
g_18 = PythonScript(node=plain_bibil.node)  # -> geom; same code as g
python_script_11 = PythonScript(i=panel_6)  # -> o
# ---------- python_script_11: Python ----------
import os

o = os.path.join(str(i),"trinco\\trinco_pattern_library.py")
# ---------- end python_script_11 ----------
file_11 = ReadFile(File=python_script_11, PerLineParse=False)
number_slider_15 = Slider(1, range=0..10)
python_script_12 = PythonScript(i=panel_6)  # -> o
# ---------- python_script_12: Python ----------
import os

o = os.path.join(str(i),"miru\\miru_pattern_library.py")
# ---------- end python_script_12 ----------
file_12 = ReadFile(File=python_script_12, PerLineParse=False)
north = Slider(61.5, range=0..1000)
vec = VectorXYZ(XComponent=0, YComponent=0, ZComponent=north)  # -> Vector, Length
move = Move(Geometry=end.End, Motion=vec.Vector)  # -> Geometry, Transform
ln = Line(StartPoint=end.Start, EndPoint=move.Geometry)
geometry_3 = Geometry(move.Geometry)
yonge = Slider(211.5, range=0..1000)
mtpleasant = Slider(90, range=0..1000)
sb_acc = Slider(0, range=0..10)

# ---- group: Skyline
value_list = ValueList({"Transit topo": 0, "Solar topo": 1, "Angle topo": 2, "Intersection topo": 3}, selected="Transit topo")

# ---- group: Park Srf
number_slider_16 = Slider(0, range=0..4, expression="25+x*5")

# ---- group: TOWER SEPARATION
new_tower = Slider(20, range=20..30)

# ----
number_slider_17 = Slider(5, range=0..5)
sb_13_5 = Slider(3, range=3..9)
podium_ht = Slider(5, range=0..5, expression="16.5  + 3*x")

# ---- group: ga_loop
# INPUTS/OUTPUTS
python_4 = PythonScript()  # -> L, size
# ---------- python_4: Python ----------
#Get lists
podium = []
for p in range(6):
    podium.append(16.5  + 3*p)
seperation = []
for p in range(11):
    seperation.append(20+p)
stepback = [3,6,9]

L = []
for pod in podium:
    for sep in seperation:
        for ste in stepback:
            L.append([pod,sep,ste])
size = len(L)
# ---------- end python_4 ----------

# ----
python_5 = PythonScript(L=python_4.L, i=Slider(0, range=0..197))  # -> podium, seperation, stepback; inputs L: list, i: Int32
# ---------- python_5: Python ----------
if True:
    podium = L[i][0]
    seperation = L[i][1]
    stepback = L[i][2]
    print L[i]
# ---------- end python_5 ----------
data_2 = Data(python_5.seperation)
data_3 = Data(python_5.stepback)
bibil_8 = PythonScript(Code=file_11, Stepback=data_3, Stepback_acc=sb_acc, New_separation=data_2)
panel_7 = Panel(python_5.stepback)
panel_8 = Panel(python_5.podium)
panel_9 = Panel(python_5.seperation)

# ---- group: CLEAR
toggle_13 = BooleanToggle(False)

# ----
number_slider_18 = Slider(1.8, range=0..10)
boundaries = ColourSwatch(SwatchColor=RGB(255, 0, 0))
swatch = ColourSwatch(SwatchColor=RGB(0, 255, 221))
# VIZ
transit_circles = Geometry(python)
existing = Data(ColourSwatch(SwatchColor=RGBA(150, 255, 205, 209)))
tower = Data(ColourSwatch(SwatchColor=RGBA(42, 255, 149, 169)))
circles = Data(ColourSwatch(SwatchColor=RGBA(12, 181, 0, 240)))
preview_2 = CustomPreview(Geometry=python, Shader=ColourSwatch(SwatchColor=RGBA(87, 98, 42, 0)))
dots = DotDisplay(Point=python_3, Colour=ColourSwatch(SwatchColor=RGB(255, 212, 0)), Size=number_slider_18)
preview_3 = CustomPreview(Geometry=transit_circles, Shader=swatch)
dots_2 = DotDisplay(Point=move.Geometry, Colour=swatch, Size=number_slider_18)
dots_3 = DotDisplay(Point=python_2, Colour=ColourSwatch(SwatchColor=RGB(255, 0, 157)), Size=number_slider_18)
number_slider_19 = Slider(3, range=0..10)
swatch_2 = ColourSwatch(SwatchColor=RGB(255, 0, 102))
Z = UnitZ(Factor=1)
softsitereal = Geometry([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])
geo_40 = Geometry(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)
move_2 = Move(Geometry=geo_40, Motion=Z)  # -> Geometry, Transform

# ---- group: boundary
preview_4 = CustomPreview(Geometry=move_2.Geometry, Shader=ColourSwatch(SwatchColor=RGB(255, 0, 0)))

# ----
Z_2 = UnitZ(Factor=Slider(54, range=0..100))
pt_4 = Point(Point(-545461.1578, 3982110.298, 0))
Z_3 = UnitZ(Factor=north)
pt_5 = Point(Point(-545647.6286, 3982155.069, 0))
geo_41 = Geometry([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])
transit_dpt_3 = Point(Point(-546019.3338, 3981540.172, 0))
transit_dpt_4 = Point(Point(-545356.282, 3981726.697, 0))
park = Geometry(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)
move_3 = Move(Geometry=pt_4, Motion=Z_2)  # -> Geometry, Transform
geo_42 = Geometry(geo_41)
move_4 = Move(Geometry=pt_5, Motion=Z_3)  # -> Geometry, Transform

geo_43 = Geometry([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])
geo_44 = Geometry([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])
geo_45 = Geometry([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])
geo_46 = Geometry(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)

ln_2 = Line(StartPoint=pt_4, EndPoint=move_3.Geometry)
boundary_2 = BoundarySurfaces(Edges=geo_42)

# ---- group: softsites
preview_5 = CustomPreview(
    Geometry=boundary_2,
    Shader={ambient=RGB(0, 0, 0), diffuse=RGB(255, 105, 180), emission=RGB(76, 32, 54), shine=0.5, specular=RGB(255, 255, 255), transparency=0})

# ----
area = Area(Geometry=geo_42)  # -> Area, Centroid
ln_3 = Line(StartPoint=pt_5, EndPoint=move_4.Geometry)
Z_4 = UnitZ(Factor=Slider(0.1, range=0..0.1))
sum = PythonScript(x=area.Area)  # -> a; inputs x: list
# ---------- sum: Python ----------
a = 0.
for i in x:
    a += i
    
    
print a
# ---------- end sum ----------
Z_5 = UnitZ(Factor=mtpleasant)
Z_6 = UnitZ(Factor=yonge)

# ---- group: approved
preview_6 = CustomPreview(Geometry=[geo_44, geo_43], Shader=existing)

# ---- group: existing
preview_7 = CustomPreview(Geometry=[geo_45, geo_46], Shader=existing)

# ----
move_5 = Move(Geometry=transit_dpt_4, Motion=Z_5)  # -> Geometry, Transform
move_6 = Move(Geometry=transit_dpt_3, Motion=Z_6)  # -> Geometry, Transform
ln_4 = Line(StartPoint=transit_dpt_3, EndPoint=move_6.Geometry)
ln_5 = Line(StartPoint=transit_dpt_4, EndPoint=move_5.Geometry)
# Existing
# context.
crs_for_offset = Geometry([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])
offset = Offset(Curve=crs_for_offset, Distance=data_2, Plane=PlaneXY(0, 0, 0), Corners=Slider(2, range=0..10))  # -> flatten(Curve)
bibil_9 = PythonScript(
    Code=file_12,
    Override_crvs=plain_bibil.node,
    Solar_srfs=geo_19,
    Angle_srf=geo_18,
    Override_sep=offset,
    Dpt_yonge=transit_dpt_2,
    Dpt_mount=transit_dpt,
    Max_yonge=yonge,
    Max_mount=mtpleasant,
    Max_north=north,
    Ht_podium=python_5.podium,
    Stepback=data_3,
    Stepback_acc=sb_acc,
    New_separation=data_2,
    Sky_topo=value_list,
    Run=toggle_11)
block_depth_18 = PythonScript(
    Code=file,
    Ref_block_in=refroot_3_3,
    Lot_in=refroot_3_2,
    Depth=Slider(0, range=0..10),
    Street_dim=Slider(0, range=0..100),
    Setback_line=geo_9,
    Label_="tower_in_park",
    Run=bibil_9)  # -> Geo_out, Debug
block_depth_19 = PythonScript(
    Code=file,
    Ref_block_in=refroot_3_3,
    Lot_in=geo_8,
    Depth=Slider(0, range=0..10),
    Street_dim=Slider(0, range=0..100),
    Setback_line=geo_10,
    Label_="tower_in_park",
    Run=bibil_9)  # -> Geo_out, Debug
block_depth_20 = PythonScript(
    Code=file,
    Ref_block_in=refroot_3_3,
    Lot_in=refroot_3,
    Depth=Slider(0, range=0..10),
    Street_dim=Slider(0, range=0..100),
    Setback_line=geo_11,
    Label_="tower_in_park",
    Run=bibil_9)  # -> Geo_out, Debug
g_19 = PythonScript(node=block_depth_18.Geo_out)  # -> geom; same code as g
g_20 = PythonScript(node=block_depth_19.Geo_out)  # -> geom; same code as g
g_21 = PythonScript(node=block_depth_20.Geo_out)  # -> geom; same code as g
geo_47 = Geometry(block_depth_18.Debug)
geo_48 = Geometry(block_depth_19.Debug)
geo_49 = Geometry(block_depth_20.Debug)

# ---- group: should be one bibil component
pattern = PythonScript(
    Code=file_2,
    Node_in_lst=[block_depth_4.Geo_out, block_depth_18.Geo_out, block_depth_2.Geo_out, block_depth_12.Geo_out, block_depth_17.Geo_out, block_depth_10.Geo_out, block_depth_9.Geo_out, block_depth_16.Geo_out, block_depth_7.Debug, block_depth_8.Geo_out, block_depth_15.Geo_out, block_depth.Geo_out, block_depth_11.Geo_out, block_depth_14.Geo_out, block_depth_7.Geo_out, block_depth_19.Geo_out, block_depth_20.Geo_out, block_depth_5.Geo_out, block_depth_6.Geo_out, block_depth_13.Geo_out, block_depth_3.Geo_out],
    Bibil="trinco",
    Run=Toggle(True))  # -> Geo_out_lst, Debug

# ----
b = PythonScript(node=pattern.Geo_out_lst)  # -> geomlst; inputs node: list
# ---------- b: Python ----------
if node and node!=[None]:
    geomlst = []
    for node_ in node:
        lon = node_.traverse_tree(lambda n:n,internal=False) 
        lon = filter(lambda n: n!=None,lon)
        glst = map(lambda n: n.data.shape.geom,lon)
        geomlst.extend(glst)
    print geomlst
# ---------- end b ----------
preview_8 = CustomPreview(Geometry=b, Shader=ColourSwatch(SwatchColor=RGBA(0, 255, 137, 148)))
geo_50 = Geometry(pattern.Debug)
cc = PythonScript(x=pattern.Geo_out_lst)  # -> a; inputs x: tree
# ---------- cc: Python ----------
def concatenate_tree(tree):
    L = []
    for branch in tree.Branches:
        L.append(list(branch))
    return L

if True:
    
    l = reduce(lambda x,y: x+y, concatenate_tree(x))
    a = filter(lambda g: g != None, l)
# ---------- end cc ----------
bula = PythonScript(Code=file_9, Lstx=ln, Oldlots=flatten(cc))  # -> Lst_lots, Line, Debug
geo_51 = Geometry(bula.Debug)
g_22 = PythonScript(node=flatten(bula.Lst_lots))  # -> geom; inputs node: list
# ---------- g_22: Python ----------
if node and node!=[None]:
    geom = []
    #lot_lst = node.traverse_tree(lambda n:n,internal=False)
    #node = node[0]
    for n in node:
        geom.append(n.data.shape.geom)
        #print n.data.density.GFA
    print len(geom)
# ---------- end g_22 ----------
preview_9 = CustomPreview(Geometry=bula.Line, Shader=ColourSwatch(SwatchColor=RGB(0, 255, 238)))
cc_2 = PythonScript(x=bula.Lst_lots)  # -> a; inputs x: tree
# ---------- cc_2: Python ----------
a = x
# ---------- end cc_2 ----------
pattern_2 = PythonScript(Code=file_10, Node_in_lst=cc_2, Bibil="miru", Run=Toggle(True))  # -> Geo_out_lst, Debug
b_2 = PythonScript(node=pattern_2.Geo_out_lst)  # -> flatten(geomlst); inputs node: list
# ---------- b_2: Python ----------
import scriptcontext as sc
Pattern = sc.sticky['Pattern']
P = Pattern()

if node and node!=[None]:
    geomlst = []
    for node_ in node:
        if node_:
            lon = node_.traverse_tree(lambda n: P.print_node(n)) 
            lon = filter(lambda n: n!=None,lon)
            glst = map(lambda n: n.data.shape.geom,lon)
            geomlst.extend(glst)
    print geomlst
# ---------- end b_2 ----------
g_23 = PythonScript(node=pattern_2.Geo_out_lst)  # -> geom; disabled; same code as g
geo_52 = Geometry(pattern_2.Debug)
preview_10 = CustomPreview(Geometry=b_2, Shader=ColourSwatch(SwatchColor=RGBA(0, 255, 137, 148)))
# CALCULATE
volume = Volume(Geometry=b_2)  # -> Volume, Centroid
area_2 = Area(Geometry=b_2)  # -> Area, Centroid
geo_53 = Geometry([pattern_2.Debug, offset])
traverse = PythonScript(x=pattern_2.Geo_out_lst)  # -> a
# ---------- traverse: Python ----------
if x:
    a = x.traverse_tree(lambda n:n,internal=False)
    a = filter(lambda n: n!=None,a)
# ---------- end traverse ----------
sum_2 = PythonScript(x=area_2.Area)  # -> a; inputs x: list; same code as sum
sum_3 = PythonScript(x=volume.Volume)  # -> a; inputs x: list; same code as sum
division = Division(A=sum_3, B=Slider(3, range=0..10))
preview_11 = CustomPreview(Geometry=b_2, Shader=tower)
preview_12 = CustomPreview(Geometry=[geo_53, offset], Shader=circles)
analyse = PythonScript(node=traverse, ht=Toggle(True), gfa=Toggle(True), run=Toggle(True))  # -> cpt, data, line; inputs node: list
# ---------- analyse: Python ----------
import rhinoscriptsyntax as rs


if node and run:
    cpt = []
    data = []
    line = []
    for n in node:
        IsTower = 'park' in n.get_root().data.type['label']
        IsPrint = n.data.type['print']
        if IsTower and IsPrint:
            try:
                bcpt = n.data.shape.cpt
                cpt_ = rs.AddPoint(bcpt[0],bcpt[1],220.)
                line_ = rs.AddLine(bcpt,cpt_)
                data_ = 'ht: '
                if ht:
                    n.data.shape.reset()
                    data_ += str(int(n.data.shape.ht))
                if gfa:
                    
                    try:
                        mass = sc.doc.Objects.AddBrep(n.data.shape.geom)
                        area = rs.Volume(mass)/3.
                        print area
                        data_ += str(int(area))
                    except Exception as e:
                        print str(e)
                print data_
                cpt.append(cpt_)
                line.append(line_)
                data.append(data_)
            except Exception as e:
                print 'error', str(e)
# ---------- end analyse ----------
python_6 = PythonScript(grossfloor=division, lotarea=sum)  # -> gfa
# ---------- python_6: Python ----------
if grossfloor and lotarea:
    
    
    gfa = round(grossfloor / 1000.0) * 1000.0
    print gfa
    
    #far = round(gfa/float(lotarea),1000) * 1000.
    # print far
# ---------- end python_6 ----------
number_slider_20 = Slider(0.5, range=0..1)
cir_2 = Circle(Plane=[transit_dpt_3, transit_dpt_4], Radius=Slider(500, range=0..1000))  # disabled
number_slider_21 = Slider(2, range=0..10)
pt_6 = Point(<point referenced from the Rhino model>)
panel_10 = Panel(python_6)

# ---- group: Height Viz
number_slider_22 = Slider(1, range=0..10)
swatch_3 = ColourSwatch(SwatchColor=RGB(255, 255, 255))
Z_7 = UnitZ(Factor=40)
move_7 = Move(Geometry=analyse.cpt, Motion=Z_7)  # -> Geometry, Transform
tag = TextTag(Location=move_7.Geometry, Text=analyse.data, Colour=swatch_3)
tag_2 = TextTag3D(Location=analyse.cpt, Text=analyse.data, Size=Slider(12, range=0..100), Colour=swatch_3, Justification=5)

# ----
preview_13 = CustomPreview(
    Geometry=[ln_4, transit_dpt_3, move_6.Geometry, ln_5, move_5.Geometry, transit_dpt_4, ln_3, pt_5, move_4.Geometry, ln_2, move_3.Geometry, pt_4],
    Shader=boundaries)

# ---- group: PROPOSED
geo_54 = Geometry([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])

# ----
solar = Geometry(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)
preview_14 = CustomPreview(Geometry=geo_54, Shader=ColourSwatch(SwatchColor=RGB(250, 248, 12)))
number_slider_23 = Slider(9, range=0..10)
panel_11 = Panel("C:\Users\vasanthakumars\Desktop\simulation4ladybug3")
number_slider_24 = Slider(21, range=0..100)
renders_new = Panel("Renders_New")
# SIMULATE
ladybug = Ladybug_Ladybug()  # -> out; plug-in component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
path = FilePath("C:\Users\vasanthakumars\Documents\GitHub\bibil\src\reference\CAN_ON_Toronto.716240_CWEC\CAN_ON_Toronto.716240_CWEC.epw")
path_2 = FilePath("C:\saeran\master\git\bibil\src\reference\CAN_ON_Toronto.716240_CWEC\CAN_ON_Toronto.716240_CWEC.epw")
analysisperiod = Ladybug_AnalysisPeriod(
    fromMonth=number_slider_23,
    fromDay=number_slider_24,
    fromHour=Slider(11.25, range=0..100),
    toMonth=number_slider_23,
    toDay=number_slider_24,
    toHour=Slider(16.25, range=0..100))  # -> readMe, analysisPeriod; plug-in component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
gencumulativeskymtx = Ladybug_GenCumulativeSkyMtx(epwFile=path_2, skyDensity=0, workingDir="C:\Users\user\Desktop\simtest", useOldRes=Toggle(False), runIt=toggle_12)  # -> out, cumulativeSkyMtx; plug-in component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
geo_55 = Geometry(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)

# ---- group: ground
geo_56 = Geometry(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)  # disabled

# ----
swatch_4 = ColourSwatch(SwatchColor=RGB(255, 0, 0))  # disabled

# ---- group: circles
bakeattributes = CSharpScript(obj=geo_53, layer="Renders", color=circles, material=circles, activate=toggle_9)  # -> out; inputs obj: GeometryBase, name: String, layer: String, color: Color, pWidth: Double, wires: Int32, activate: Boolean; disabled
# ---------- bakeattributes: C# ----------
    //Inserts geometry into the Rhino document, with custom attributes
    //Written by Giulio Piacentino
    //Version written 2010 11 21 - for Grasshopper 0.8.002

    if (activate)
    {
      if(obj == null)
      {
        Print("No object to bake");
        return;
      }

      //Make new attribute to set name
      Rhino.DocObjects.ObjectAttributes att = new Rhino.DocObjects.ObjectAttributes();

      //Set object name
      if(!string.IsNullOrEmpty(name))
      {
        att.Name = name;
      }

      //Set color
      if(!color.IsEmpty)
      {
        att.ColorSource = Rhino.DocObjects.ObjectColorSource.ColorFromObject; //Make the color type "by object"
        att.ObjectColor = color;

        att.PlotColorSource = Rhino.DocObjects.ObjectPlotColorSource.PlotColorFromObject; //Make the plot color type "by object"
        att.PlotColor = color;
      }

      //Set layer
      if(!string.IsNullOrEmpty(layer) && Rhino.DocObjects.Layer.IsValidName(layer))
      {
        //Get the current layer index
        Rhino.DocObjects.Tables.LayerTable layerTable = doc.Layers;
        int layerIndex = layerTable.Find(layer, true);

        if(layerIndex < 0) //This layer does not exist, we add it
        {
          Rhino.DocObjects.Layer onlayer = new Rhino.DocObjects.Layer(); //Make a new layer
          onlayer.Name = layer;

          layerIndex = layerTable.Add(onlayer); //Add the layer to the layer table
          if (layerIndex > -1) //We manged to add layer!
          {
            att.LayerIndex = layerIndex;
            Print("Added new layer to the document at position " + layerIndex + " named " + layer + ". ");
          } else
            Print("Layer did not add. Try cleaning up your layers."); //This never happened to me.
        }
        else
          att.LayerIndex = layerIndex; //We simply add to the existing layer
      }


      //Set plotweight
      if(pWidth > 0)
      {
        att.PlotWeightSource = Rhino.DocObjects.ObjectPlotWeightSource.PlotWeightFromObject;
        att.PlotWeight = pWidth;
      }


      //Set material
      bool materialByName = !string.IsNullOrEmpty(material as string);
      Rhino.Display.DisplayMaterial inMaterial = material as Rhino.Display.DisplayMaterial;
      if(material is Color)
      {
        inMaterial = new Rhino.Display.DisplayMaterial((Color) material);
      }
      if(material != null && inMaterial == null && !materialByName)
      {
        if(!(material is string))
        {
          try //We also resort to try with IConvertible
          {
            inMaterial = (Rhino.Display.DisplayMaterial) Convert.ChangeType(material, typeof(Rhino.Display.DisplayMaterial));
          }
          catch(InvalidCastException)
          {
          }
        }
      }
      if(inMaterial != null || materialByName)
      {
        string matName;

        if(!materialByName)
        {
          matName = string.Format("A:{0}-D:{1}-E:{2}-S:{3},{4}-T:{5}",
            Format(inMaterial.Ambient),
            Format(inMaterial.Diffuse),
            Format(inMaterial.Emission),
            Format(inMaterial.Specular),
            inMaterial.Shine.ToString(),
            inMaterial.Transparency.ToString()
            );
        }
        else
        {
          matName = (string) material;
        }

        int materialIndex = doc.Materials.Find(matName, true);
        if(materialIndex < 0 && !materialByName) //Material does not exist and we have its specs
        {
          materialIndex = doc.Materials.Add(); //Let's add it
          if(materialIndex > -1)
          {
            Print("Added new material at position " + materialIndex + " named \"" + matName + "\". ");
            Rhino.DocObjects.Material m = doc.Materials[materialIndex];
            m.Name = matName;
            m.AmbientColor = inMaterial.Ambient;
            m.DiffuseColor = inMaterial.Diffuse;
            m.EmissionColor = inMaterial.Emission;
            //m.ReflectionColor = no equivalent
            m.SpecularColor = inMaterial.Specular;
            m.Shine = inMaterial.Shine;
            m.Transparency = inMaterial.Transparency;
            //m.TransparentColor = no equivalent
            m.CommitChanges();

            att.MaterialSource = Rhino.DocObjects.ObjectMaterialSource.MaterialFromObject;
            att.MaterialIndex = materialIndex;
          }
          else
            Print("Material did not add. Try cleaning up your materials."); //This never happened to me.
        }
        else if(materialIndex < 0 && materialByName) //Material does not exist and we do not have its specs. We do nothing
        {
          Print("Warning: material name not found. I cannot set the source to this material name. Add a material with name: " + matName);
        }
        else
        {
          //If this material exists, we do not replace it!
          att.MaterialSource = Rhino.DocObjects.ObjectMaterialSource.MaterialFromObject;
          att.MaterialIndex = materialIndex;
        }
      }


      //Set wire density
      if(wires == -1 || wires > 0)
      {
        att.WireDensity = wires;
      }


      //Bake to the right type of object
      switch(obj.ObjectType)
      {
        case Rhino.DocObjects.ObjectType.Brep:
          doc.Objects.AddBrep(obj as Brep, att);
          break;
        case Rhino.DocObjects.ObjectType.Curve:
          doc.Objects.AddCurve(obj as Curve, att);
          break;
        case Rhino.DocObjects.ObjectType.Point:
          doc.Objects.AddPoint((obj as Rhino.Geometry.Point).Location, att);
          break;
        case Rhino.DocObjects.ObjectType.Surface:
          doc.Objects.AddSurface(obj as Surface, att);
          break;
        case Rhino.DocObjects.ObjectType.Mesh:
          doc.Objects.AddMesh(obj as Mesh, att);
          break;
        case Rhino.DocObjects.ObjectType.Extrusion:
          typeof(Rhino.DocObjects.Tables.ObjectTable).InvokeMember("AddExtrusion", BindingFlags.Instance | BindingFlags.InvokeMethod, null, doc.Objects, new object[]{obj, att});
          break;
        case Rhino.DocObjects.ObjectType.PointSet:
          doc.Objects.AddPointCloud(obj as Rhino.Geometry.PointCloud, att); //This is a speculative entry
          break;
        default:
          Print("The script does not know how to handle this type of geometry: " + obj.GetType().FullName);
          break;
      }
      Print("Added " + obj.GetType().Name);

    }
    else
    {
      Print("Inactive");
    }
# ---------- bakeattributes: C# additional code ----------
  static string Format(Color c)
  {
    return (new System.Text.StringBuilder("A")).Append(c.A.ToString()).Append("R").Append(c.R.ToString()).Append("G")
      .Append(c.G.ToString()).Append("B").Append(c.B.ToString()).ToString();
  }
# ---------- end bakeattributes ----------

# ----
swatch_5 = ColourSwatch(SwatchColor=RGB(255, 255, 255))  # disabled

# ---- group: new growth
bakeattributes_2 = CSharpScript(obj=b_2, layer=renders_new, color=tower, material=tower, activate=toggle_9)  # -> out; inputs obj: GeometryBase, name: String, layer: String, color: Color, pWidth: Double, wires: Int32, activate: Boolean; disabled; same code as bakeattributes

# ---- group: Existing2
bakeattributes_3 = CSharpScript(obj=[geo_44, geo_43], layer="Renders", color=existing, material=existing, activate=toggle_9)  # -> out; inputs obj: GeometryBase, name: String, layer: String, color: Color, pWidth: Double, wires: Int32, activate: Boolean; disabled; same code as bakeattributes

# ---- group: Existing Context
# VIZ RENDER
bakeattributes_4 = CSharpScript(obj=[geo_45, geo_46], layer="Renders", color=existing, material=existing, activate=toggle_9)  # -> out; inputs obj: GeometryBase, name: String, layer: String, color: Color, pWidth: Double, wires: Int32, activate: Boolean; disabled; same code as bakeattributes

# ----
selectskymtx = Ladybug_selectSkyMtx(
    cumulativeSkyMtx=gencumulativeskymtx.cumulativeSkyMtx,
    analysisPeriod=analysisperiod.analysisPeriod,
    removeDiffuse=False,
    removeDirect=False)  # -> out, selectedSkyMtx; plug-in component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

# ---- group: automated_geoms
data_4 = Data([geo_45, geo_43, geo_44, b_2])

# ---- group: existing
geo_57 = Geometry([geo_43, geo_44, geo_45, geo_46])

# ---- group: preferred
geo_58 = Geometry([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])

# ----
geo_59 = Geometry([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])
legendpar = Ladybug_LegendParameters(numSegments=Slider(2, range=0..10), customColors=flatten([swatch_4, swatch_5]))  # -> legendPar; plug-in component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
toggle_14 = BooleanToggle(False)
toggle_15 = BooleanToggle(False)

# ---- group: existing+approive
geo_60 = Geometry([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])

# ---- group: manual_override_geoms
geo_61 = Geometry([data_4, geo_57])

# ----
swatch_6 = ColourSwatch(SwatchColor=RGB(38, 38, 38))
bakeattributes_5 = CSharpScript(obj=geo_61, layer="Renders", color=swatch_6, material=swatch_6, activate=toggle_9)  # -> out; inputs obj: GeometryBase, name: String, layer: String, color: Color, pWidth: Double, wires: Int32, activate: Boolean; same code as bakeattributes
radiationanalysis = Ladybug_RadiationAnalysis(
    north=0,
    geometry=flatten(geo_55),
    context=flatten(geo_61),
    gridSize=Slider(12, range=0..100),
    disFromBase=Slider(1, range=0..1),
    selectedSkyMtx=flatten(selectskymtx.selectedSkyMtx),
    legendPar=flatten(legendpar),
    runIt=toggle_12)  # -> out, contextMesh, analysisMesh, testPts, testVec, port, radiationResult, radiationMesh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; plug-in component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

# ---- group: solar
geo_62 = Geometry(radiationanalysis.radiationMesh)

# ----
mesh = Mesh(radiationanalysis.radiationMesh)
swatch_7 = ColourSwatch(SwatchColor=RGB(255, 255, 255))
python_7 = PythonScript(x=radiationanalysis.radiationResult)  # -> a
# ---------- python_7: Python ----------
if x:
    a = int(x*1000)
# ---------- end python_7 ----------

# ---- group: existing+approive
geo_63 = Geometry([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])

# ----
tag_3 = TextTag3D(Location=radiationanalysis.testPts, Text=python_7, Size=Slider(1, range=0..10), Colour=swatch_7, Justification=7)

# ---- group: preferred
geo_64 = Geometry([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])

# ----
gradient = Gradient(
    LowerLimit=Slider(1.2, range=0..10),
    UpperLimit=Slider(0, range=0..100),
    Parameter=radiationanalysis.radiationResult,
    stops=[0: RGB(234, 38, 0), 0.25: RGB(234, 126, 0), 0.5: RGB(254, 244, 84), 0.75: RGB(173, 203, 249), 1: RGB(75, 107, 169)])
sort = SortList(Keys=radiationanalysis.radiationResult)  # -> Keys, ValuesA
tag_4 = TextTag(Location=radiationanalysis.testPts, Text=radiationanalysis.radiationResult, Colour=swatch_7)
panel_12 = Panel(sort.Keys)
geo_65 = Geometry(radiationanalysis.testPts)
geo_66 = Geometry(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)
python_8 = PythonScript(pt=geo_65, crv=geo_66, color=gradient, rad=radiationanalysis.radiationResult)  # -> pt_out, color_out, rad_out; inputs pt: list, color: list, rad: list
# ---------- python_8: Python ----------
import rhinoscriptsyntax as rs


if pt and crv:
    pt_out = []
    color_out = []
    sum_rad = 0.
    for p,c,r in zip(pt,color,rad):
        InCrv = rs.PointInPlanarClosedCurve(p,crv)
        if abs(InCrv-1.) <= 0.1:
            pt_out.append(p)
            color_out.append(c)
            sum_rad += r*1000
            
    rad_out = sum_rad/float(len(rad))
# ---------- end python_8 ----------
printexcel = PythonScript(
    HT_YONGE=yonge,
    HT_MT=mtpleasant,
    HT_NORTH=north,
    HT_PODIUM=python_5.podium,
    STEPBACK=python_5.stepback,
    SEPERATION=python_5.seperation,
    GFA=python_6,
    insolation=python_8.rad_out,
    run=toggle_10)  # -> HT_YONGE, STEPBACK, HT_PODIUM, SEPERATION, GFA, insolation
# ---------- printexcel: Python ----------
if run:
    STEPBACK_ = STEPBACK
    SEPERATION_ = SEPERATION
    GFA_ = GFA
    FAR_ = FAR
    HT_PODIUM_ = HT_PODIUM
    insolation_ = insolation
# ---------- end printexcel ----------
panel_13 = Panel(printexcel.insolation)

# ---- group: GFA
rec = DataRecorder(printexcel.GFA, DataLimit=-10, RecordData=False)

# ---- group: wh/m2
rec_2 = DataRecorder(printexcel.insolation, DataLimit=-10, RecordData=False)

# ---- group: SEPERATION
rec_3 = DataRecorder(printexcel.SEPERATION, DataLimit=1000000000, RecordData=False)

# ---- group: STEPBACK
rec_4 = DataRecorder(printexcel.STEPBACK, DataLimit=1000000000, RecordData=False)

# ---- group: PODIUM
rec_5 = DataRecorder(printexcel.HT_PODIUM, DataLimit=1000000000, RecordData=False)

# ----
n = PythonScript(x=rec_2)  # -> a; inputs x: list
# ---------- n: Python ----------
a = filter(lambda n:n!=None,x)
# ---------- end n ----------
n_2 = PythonScript(x=rec)  # -> a; inputs x: list; same code as n
n_3 = PythonScript(x=rec_5)  # -> a; inputs x: list; same code as n
n_4 = PythonScript(x=rec_4)  # -> a; inputs x: list; same code as n
n_5 = PythonScript(x=rec_3)  # -> a; inputs x: list; same code as n
excelwrite = ExcelWriteLEGACY(
    WriteToggle=Toggle(False),
    WriteHeading=Toggle(False),
    ClearSheet=toggle_13,
    Worksheet=1,
    ColumnStart=1,
    RowStart=1,
    ColumnHeadings=["TOWER SEPERATION", "PODIUM HT", "STEPBACK", "GFA", "INSOLATION"],
    Column1=n_5,
    Column2=n_3,
    Column3=n_4,
    Column4=n_2,
    Column5=n)
str = PythonScript(x=printexcel.STEPBACK)  # -> a
# ---------- str: Python ----------
txt = 'stepback' + str(x)


a = txt
# ---------- end str ----------
tag_5 = TextTag3D(Location=pt_6, Text=str, Size=Slider(25, range=0..100), Justification=7)
panel_14 = Panel(python_8.rad_out)
preview_15 = CustomPreview(Geometry=python_8.pt_out, Shader=python_8.color_out)
