# Grasshopper definition bibil_trial_066.gh (Grasshopper 0.9.76)
# plug-ins: Python Interpreter

# ---- group: find directory
bibil = PythonScript(run=Toggle(True))  # -> dir
# ---------- bibil: Python ----------
import os

ghenv.Component.Params.Output[0].Name = "null"
ghenv.Component.Params.Output[0].NickName = "null"

if run:
    try:
        directory = "C:\\Users\\vasanthakumars\\Documents\\GitHub\\bibil\\src"
        print os.listdir(directory)
    except:
        directory = "C:\\saeran\\master\\git\\bibil\\src"
        print os.listdir(directory)
    ghenv.Component.Params.Output[0].Name = "dir"
    ghenv.Component.Params.Output[0].NickName = "dir"
    dir = directory
null = None
# ---------- end bibil ----------

# ---- group: miru
# BIBIL_CLASSES
python_script = PythonScript(i=bibil)  # -> o
# ---------- python_script: Python ----------
import os

if i:
    o = os.path.join(str(i),"miru\\miru_miru.py")
# ---------- end python_script ----------
file = ReadFile(File=python_script, PerLineParse=False)
bibil_2 = PythonScript(Code=file)

# ---- group: grammar
python_script_2 = PythonScript(i=bibil)  # -> o
# ---------- python_script_2: Python ----------
import os

if i:
    o = os.path.join(str(i),"bibil\\bibil_rule.py")
# ---------- end python_script_2 ----------
file_2 = ReadFile(File=python_script_2, PerLineParse=False)
bibil_3 = PythonScript(Code=file_2)

# ---- group: pattern
python_script_3 = PythonScript(i=bibil)  # -> o
# ---------- python_script_3: Python ----------
import os

if i:
    o = os.path.join(str(i),"bibil\\bibil_pattern.py")
# ---------- end python_script_3 ----------
file_3 = ReadFile(File=python_script_3, PerLineParse=False)
bibil_4 = PythonScript(Code=file_3)

# ---- group: shape
python_script_4 = PythonScript(i=bibil)  # -> o
# ---------- python_script_4: Python ----------
import os

if i:
    o = os.path.join(str(i),"bibil\\bibil_shape.py")
#o = os.path.join(str(i),"research\\bibil_shape_shape_3d_2d.py")
# ---------- end python_script_4 ----------
file_4 = ReadFile(File=python_script_4, PerLineParse=False)
bibil_5 = PythonScript(Code=file_4)

# ---- group: tree
python_script_5 = PythonScript(i=bibil)  # -> o
# ---------- python_script_5: Python ----------
import os

if i:
    o = os.path.join(str(i),"bibil\\bibil_tree.py")
# ---------- end python_script_5 ----------
file_5 = ReadFile(File=python_script_5, PerLineParse=False)
bibil_6 = PythonScript(Code=file_5)

# ---- group: node_comp
python_script_6 = PythonScript(i=bibil)  # -> o
# ---------- python_script_6: Python ----------
import os

if i:
    o = os.path.join(str(i),"bibil\\bibil_plain.py")
# ---------- end python_script_6 ----------
file_6 = ReadFile(File=python_script_6, PerLineParse=False)

# ---- group: grammar_divide
python_script_7 = PythonScript(i=bibil)  # -> o
# ---------- python_script_7: Python ----------
import os

if i:
    o = os.path.join(str(i),"miru\\miru_divide.py")
# ---------- end python_script_7 ----------
file_7 = ReadFile(File=python_script_7, PerLineParse=False)

# ---- group: grammar_tower
python_script_8 = PythonScript(i=bibil)  # -> o
# ---------- python_script_8: Python ----------
import os

if i:
    o = os.path.join(str(i),"miru\\miru_packing.py")
# ---------- end python_script_8 ----------
file_8 = ReadFile(File=python_script_8, PerLineParse=False)

# ---- group: grammar_courtyard
python_script_9 = PythonScript(i=bibil)  # -> o
# ---------- python_script_9: Python ----------
import os

if i:
    o = os.path.join(str(i),"miru\\miru_court.py")
# ---------- end python_script_9 ----------
file_9 = ReadFile(File=python_script_9, PerLineParse=False)

# ---- group: grammar_tower
python_script_10 = PythonScript(i=bibil)  # -> o
# ---------- python_script_10: Python ----------
import os

if i:
    o = os.path.join(str(i),"miru\\miru_stepback.py")
# ---------- end python_script_10 ----------
file_10 = ReadFile(File=python_script_10, PerLineParse=False)

# ---- group: grammar_height
python_script_11 = PythonScript(i=bibil)  # -> o
# ---------- python_script_11: Python ----------
import os

if i:
    o = os.path.join(str(i),"miru\\miru_height.py")
# ---------- end python_script_11 ----------
file_11 = ReadFile(File=python_script_11, PerLineParse=False)

# ----
geo = Geometry(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)
geo_2 = Geometry(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)
geo_3 = Geometry(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)
# LOT GRAMMAR
number_slider = Slider(1, range=0..10)
list = ValueList({"divide by depth": "subdivide_depth", "divide by same depth": "subdivide_depth_same", "divide by dim": "subdivide_dim"}, selected="divide by same depth")
list_2 = ValueList({"YZ": "NS", "XZ": "EW", "XY": "Z"}, selected="XZ")

# ---- group: DIVIDE
bibil_7 = PythonScript(
    Code=file_7,
    Divide_num=number_slider,
    Divide_cut=Slider(9, range=0..100),
    Divide_type=list,
    Divide_ratio=Slider(0.5, range=0..1),
    Axis=list_2,
    Run=Toggle(False))

# ----
geo_4 = Geometry(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)
trinco_park = PythonScript(Code=file_6, Rule_in=bibil_7, Node_in=geo_4, Label_="street", Run=Toggle(True))  # -> Node_out, Debug
g = PythonScript(node=trinco_park.Node_out)  # -> geom; inputs node: list
# ---------- g: Python ----------
if node and node != []:
    geom = []
    #lot_lst = node.traverse_tree(lambda n:n,internal=False)
    for n in node:
        geom.append(n.data.shape.bottom_crv)
    print geom
# ---------- end g ----------
number_slider_2 = Slider(21, range=0..100)  # disabled
number_slider_3 = Slider(1, range=-1..1)  # disabled
number_slider_4 = Slider(9.1, range=0..100)  # disabled
number_slider_5 = Slider(3, range=0..100)  # disabled
# BUILDING GRAMMAR
number_slider_6 = Slider(24, range=0..100)  # disabled
number_slider_7 = Slider(30, range=0..100)  # disabled
number_slider_8 = Slider(1, range=-1..1)  # disabled
# DEMO GRAMMAR
number_slider_9 = Slider(35.8, range=0..100)  # disabled
number_slider_10 = Slider(3, range=0..10)  # disabled
# CONTEXT GEOMETRY
number_slider_11 = Slider(6, range=0..10)  # disabled
number_slider_12 = Slider(1, range=-1..1)  # disabled
number_slider_13 = Slider(1, range=-1..1)  # disabled
number_slider_14 = Slider(3, range=0..10)  # disabled
number_slider_15 = Slider(9, range=0..10)  # disabled
number_slider_16 = Slider(15, range=0..100)  # disabled
number_slider_17 = Slider(0.5, range=0..1)  # disabled
number_slider_18 = Slider(3, range=0..100)  # disabled
list_3 = ValueList({"divide by depth": "subdivide_depth", "divide by same depth": "subdivide_depth_same", "divide by dim": "subdivide_dim"}, selected="divide by same depth")  # disabled
toggle = BooleanToggle(True)  # disabled
toggle_2 = BooleanToggle(True)  # disabled
toggle_3 = BooleanToggle(True)  # disabled
toggle_4 = BooleanToggle(True)  # disabled
toggle_5 = BooleanToggle(True)  # disabled
toggle_6 = BooleanToggle(True)  # disabled
createhbsrfs = Honeybee_createHBSrfs()  # -> readMe, simplify(HBSurface); plug-in component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
toggle_7 = BooleanToggle(True)  # disabled
toggle_8 = BooleanToggle(True)  # disabled
toggle_9 = BooleanToggle(False)  # disabled
geo_5 = Geometry([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])  # disabled
panel = Panel("-1")  # disabled
panel_2 = Panel("-1")  # disabled
# TOWER GRAMMAR
toggle_10 = BooleanToggle(False)
list_4 = ValueList({"YZ": "NS", "XZ": "EW", "XY": "Z"}, selected="XZ")  # disabled

# ---- group: COURTYARD
miru = PythonScript(Code=file_9, Podium_depth=number_slider_2, Node_depth=number_slider_3, Run=toggle_2)  # disabled

miru_2 = PythonScript(Code=file_9, Podium_depth=number_slider_4, Node_depth=number_slider_8, Run=toggle_6)  # disabled

miru_3 = PythonScript(Code=file_9, Podium_depth=number_slider_5, Node_depth=number_slider_12, Run=toggle_7)  # disabled

miru_4 = PythonScript(Code=file_9, Podium_depth=number_slider_7, Node_depth=number_slider_13, Run=toggle_8)  # disabled

# ---- group: SETBACK/STEPBACK
miru_5 = PythonScript(Code=file_10, Height=number_slider_16, Distance=number_slider_11, Geom_ref=geo_5, Node_ref=panel_2, Run=toggle_4)  # disabled

miru_6 = PythonScript(Code=file_10, Height=number_slider_15, Distance=number_slider_10, Geom_ref=geo_5, Node_ref=panel, Run=toggle_3)  # disabled

# ---- group: HEIGHT
miru_7 = PythonScript(Code=file_11, Height=number_slider_6, Run=toggle)  # disabled

miru_8 = PythonScript(Code=file_11, Height=number_slider_9, Run=toggle_5)  # disabled

# ---- group: PACKING
bibil_8 = PythonScript(Code=file_8, Run=toggle_10)

# ---- group: DIVIDE
bibil_9 = PythonScript(
    Code=file_7,
    Divide_num=number_slider_14,
    Divide_cut=number_slider_18,
    Divide_type=list_3,
    Divide_ratio=number_slider_17,
    Axis=list_4,
    Run=toggle_9)  # disabled

# ----
hb_epcontextsrf = HoneybeeEPContextSurfaces()  # -> HBContext; inputs shdSurfaces: list of Brep, justBoundingBox: Boolean
# ---------- hb_epcontextsrf: Python ----------
"""
prepare shading/context geometries

    Args:
        northVectorOrRotation: A vector that shows North or a number that shows
                               the rotation of the North from the Y axis
        bldgMasses: List of closed Breps as thermal zones.
    Returns:
        report: ...
        thermalZones: Thermal zone's geometries for visualiza
"""

ghenv.Component.Name = 'Honeybee EP context Surfaces'
ghenv.Component.NickName = 'HB_EPContextSrf'
ghenv.Component.Message = 'VER 0.0.60\nAUG_10_2016'
ghenv.Component.IconDisplayMode = ghenv.Component.IconDisplayMode.application
ghenv.Component.Category = "Honeybee"
ghenv.Component.SubCategory = "10 | Energy | Energy"
#compatibleHBVersion = VER 0.0.57\nNOV_01_2015
#compatibleLBVersion = VER 0.0.59\nFEB_01_2015
ghenv.Component.AdditionalHelpFromDocStrings = "2"

import rhinoscriptsyntax as rs
import Rhino as rc
import scriptcontext as sc
import os
import System
import Grasshopper.Kernel as gh
import uuid

tolerance = sc.doc.ModelAbsoluteTolerance
import math


def main(shdSurfaces, EPTransSchedule, meshingSettings, justBoundingBox):
    
    # import the classes
    if sc.sticky.has_key('honeybee_release'):

        try:
            if not sc.sticky['honeybee_release'].isCompatible(ghenv.Component): return -1
            if sc.sticky['honeybee_release'].isInputMissing(ghenv.Component): return -1
        except:
            warning = "You need a newer version of Honeybee to use this compoent." + \
            " Use updateHoneybee component to update userObjects.\n" + \
            "If you have already updated userObjects drag Honeybee_Honeybee component " + \
            "into canvas and try again."
            w = gh.GH_RuntimeMessageLevel.Warning
            ghenv.Component.AddRuntimeMessage(w, warning)
            return -1
        
        # don't customize this part
        hb_EPSrf = sc.sticky["honeybee_EPSurface"]
        hb_EPSHDSurface = sc.sticky["honeybee_EPShdSurface"]
        hb_RADMaterialAUX = sc.sticky["honeybee_RADMaterialAUX"]
        hb_EPObjectsAux = sc.sticky["honeybee_EPObjectsAUX"]()
        HBScheduleList = sc.sticky["honeybee_ScheduleLib"].keys()

        ########################################################################
        #----------------------------------------------------------------------#
        shdBreps = []
        # create bounding box of shading geometries
        if justBoundingBox:
            for brep in shdSurfaces:
                if brep.Faces.Count>1 or not brep.Faces[0].IsPlanar(sc.doc.ModelAbsoluteTolerance):
                    shdBreps.append(brep.GetBoundingBox(True).ToBrep())
                else:
                    shdBreps.append(brep)
        else:
            shdBreps = shdSurfaces
        
        shadingClasses = []
        shadingMeshPreview = []
        
        if meshingSettings == None:
            mp = rc.Geometry.MeshingParameters.Minimal
            mp.SimplePlanes = True
        else:
            mp = meshingSettings
        
        def getRadMaterialName(radMaterial):
            nameStr = radMaterial.split(" ")[2]
            name =  nameStr.split("\n")[0]
            return name
        
        for brepCount, brep in enumerate(shdBreps):
            if brep != None:
                isPlanar = True
                # check planarity
                for face in brep.Faces:
                    if not face.IsPlanar(tolerance):
                        isPlanar = False
                        break
                
                shadingBreps = []
                if not isPlanar:
                    meshArray = rc.Geometry.Mesh.CreateFromBrep(brep, mp)
                    for mesh in meshArray:
                        for meshFace in range(mesh.Faces.Count):
                            vertices = list(mesh.Faces.GetFaceVertices(meshFace))[1:]
                            vertices = vertices + [sc.doc.ModelAbsoluteTolerance]
                            # create the brep from mesh
                            shdBrep = rc.Geometry.Brep.CreateFromCornerPoints(*vertices)
                            shadingBreps.append(shdBrep)
                else:
                    for face in brep.Faces:
                        shadingBreps.append(face.DuplicateFace(False))
                
                for faceCount, shdBrep in enumerate(shadingBreps):
                        thisShading = hb_EPSHDSurface(shdBrep, 1000*brepCount + faceCount, 'shdSrf_' + `brepCount` + '_' + `faceCount` + "_" + str(uuid.uuid4()))
                        
                        # add transmittance schedule if any
                        if EPTransSchedule!=None:
                            schedule= EPTransSchedule.upper()
                            if schedule!=None and not schedule.lower().endswith(".csv") and schedule not in HBScheduleList:
                                msg = "Cannot find " + schedule + " in Honeybee schedule library."
                                print msg
                                ghenv.Component.AddRuntimeMessage(gh.GH_RuntimeMessageLevel.Warning, msg)
                                return -1
                            elif schedule!=None and schedule.lower().endswith(".csv"):
                                # check if csv file is existed
                                if not os.path.isfile(schedule):
                                    msg = "Cannot find the shchedule file: " + schedule
                                    print msg
                                    ghenv.Component.AddRuntimeMessage(gh.GH_RuntimeMessageLevel.Warning, msg)
                                    return -1
                            
                            thisShading.TransmittanceSCH = schedule
                        
                        # add the Rad Material if any
                        if RADMaterial!=None:
                            # if it is just the name of the material make sure it is already defined
                            if len(RADMaterial.split(" ")) == 1:
                                # if the material is not in the library add it to the library
                                if not hb_RADMaterialAUX.isMatrialExistInLibrary(RADMaterial):
                                    warningMsg = "Can't find " + RADMaterial + " in RAD Material Library.\n" + \
                                                "Add the material to the library and try again."
                                    ghenv.Component.AddRuntimeMessage(gh.GH_RuntimeMessageLevel.Warning, warningMsg)
                                    return
                                
                                try:
                                    thisShading.setRADMaterial(RADMaterial)
                                except Exception, e:
                                    print e
                                    warningMsg = "You are using an old version of Honeybee_Honeybee! Update your files and try again."
                                    print warningMsg
                                    ghenv.Component.AddRuntimeMessage(gh.GH_RuntimeMessageLevel.Warning, warningMsg)
                                    return
                                
                                addedToLib = True
                            else:
                                
                                # try to add the material to the library
                                addedToLib, thisShading.RadMaterial = hb_RADMaterialAUX.analyseRadMaterials(RADMaterial, True)
                                
                            if addedToLib==False:
                                warningMsg = "Failed to add " + RADMaterial + " to the Library."
                                ghenv.Component.AddRuntimeMessage(gh.GH_RuntimeMessageLevel.Warning, warningMsg)
                                return
                        
                        # add shading to the list
                        shadingClasses.append(thisShading)
                
        # add to the hive
        hb_hive = sc.sticky["honeybee_Hive"]()
        HBContext  = hb_hive.addToHoneybeeHive(shadingClasses, ghenv.Component.InstanceGuid.ToString())
        return HBContext
        ################################################################################################
    else:
        print "You should first let Honeybee to fly..."
        w = gh.GH_RuntimeMessageLevel.Warning
        ghenv.Component.AddRuntimeMessage(w, "You should first let Honeybee to fly...")
        return -1
        

if _shdSurfaces and _shdSurfaces[0]!=None:
    # add cleaning function
    result= main(_shdSurfaces, EPTransSchedule_, meshingSettings_, justBoundingBox_)
    
    if result != -1: HBContext = result
# ---------- end hb_epcontextsrf ----------
hb_epcontextsrf_2 = HoneybeeEPContextSurfaces()  # -> HBContext; inputs shdSurfaces: list of Brep, justBoundingBox: Boolean; same code as hb_epcontextsrf
createhbzones = Honeybee_createHBZones(name="Ground", HBSurfaces=flatten(createhbsrfs.HBSurface), isConditioned=Toggle(False))  # -> readMe, HBZone; plug-in component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
toggle_11 = BooleanToggle(True)  # disabled
panel_3 = Panel("podium")  # disabled
toggle_12 = BooleanToggle(True)  # disabled
panel_4 = Panel("podium")  # disabled
bibil_10 = PythonScript(Code=file_6, Rule_in=[miru_7, miru, miru_6, miru_5], Node_in=trinco_park.Node_out, Label_=panel_3, Run=toggle_11)  # -> Node_out, Debug; disabled
bibil_11 = PythonScript(Code=file_6, Rule_in=[miru_8, miru_4, miru_2, miru_3], Node_in=trinco_park.Node_out, Label_=panel_4, Run=toggle_12)  # -> Node_out, Debug; disabled
createepground = Honeybee_CreateEPGround(HBZones=createhbzones.HBZone, soilTypeOrMat="4")  # -> HBGrndZones; plug-in component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
g_2 = PythonScript(node=bibil_10.Node_out)  # -> geom; disabled
# ---------- g_2: Python ----------
if node:
    geom = []
    lot_lst = node.traverse_tree(lambda n:n,internal=False)
    for n in lot_lst:
        geom.append(n.data.shape.geom)
    print geom
# ---------- end g_2 ----------
g_3 = PythonScript(node=bibil_11.Node_out)  # -> geom; disabled; same code as g_2
ladybug = Ladybug_Ladybug()  # -> Vviiiiiiiiiizzz; plug-in component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
honeybee = Honeybee_Honeybee()  # -> Vviiiiiiiiiizzz; plug-in component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
listzoneprograms = Honeybee_ListZonePrograms(bldgProgram=Slider(0, range=0..100))  # -> OfficeZonePrograms; plug-in component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
geo_6 = Geometry([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])
geo_7 = Geometry([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])
listzoneprograms_2 = Honeybee_ListZonePrograms(bldgProgram=Slider(0, range=0..100))  # -> OfficeZonePrograms; plug-in component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
splitmass = Honeybee_SplitBuildingMass(bldgMasses=geo_7, bldgsFlr2FloorHeights="@4", runIt=Toggle(True))  # -> readMe, splitBldgMasses; plug-in component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
splitmass_2 = Honeybee_SplitBuildingMass(bldgMasses=geo_6, bldgsFlr2FloorHeights="@4", runIt=Toggle(True))  # -> readMe, splitBldgMasses; plug-in component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
item = ListItem(List=listzoneprograms, Index=0, Wrap=True)
item_2 = ListItem(List=listzoneprograms_2, Index=0, Wrap=True)
toggle_13 = BooleanToggle(True)
number_slider_19 = Slider(0.3, range=0..1)
toggle_14 = BooleanToggle(True)
number_slider_20 = Slider(0.3, range=0..1)
geo_8 = Geometry(splitmass.splitBldgMasses)
geo_9 = Geometry(splitmass_2.splitBldgMasses)
glzparamlist = Honeybee_GlazingParametersList(
    northGlzParam=number_slider_19,
    westGlzParam=number_slider_19,
    southGlzParam=number_slider_19,
    eastGlzParam=number_slider_19)  # -> glzParamList; plug-in component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
mass2zone = Honeybee_Masses2Zones(
    zoneMasses=flatten(splitmass.splitBldgMasses),
    zonePrograms=item,
    isConditioned=True,
    maxRoofAngle=30,
    createHBZones=toggle_13)  # -> readMe, HBZones; plug-in component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
concat = Concatenate(FragmentA="2")
concat_2 = Concatenate(FragmentA="2", FragmentB="window", JoinSeparator=" ")
glzparamlist_2 = Honeybee_GlazingParametersList(
    northGlzParam=number_slider_20,
    westGlzParam=number_slider_20,
    southGlzParam=number_slider_20,
    eastGlzParam=number_slider_20)  # -> glzParamList; plug-in component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
mass2zone_2 = Honeybee_Masses2Zones(
    zoneMasses=flatten(splitmass_2.splitBldgMasses),
    zonePrograms=item_2,
    isConditioned=True,
    maxRoofAngle=30,
    createHBZones=toggle_14)  # -> readMe, HBZones; plug-in component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
concat_3 = Concatenate(FragmentA="2")
concat_4 = Concatenate(FragmentA="2", FragmentB="window", JoinSeparator=" ")
callfromepconstrlibrary = Honeybee_CallFromEPConstructionLibrary(keywords=concat)  # -> ThermMaterials, EPMaterials, EPWindowMaterials, EPConstructions; plug-in component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
callfromepconstrlibrary_2 = Honeybee_CallFromEPConstructionLibrary(keywords=concat_2)  # -> ThermMaterials, EPMaterials, EPWindowMaterials, EPConstructions; plug-in component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
callfromepconstrlibrary_3 = Honeybee_CallFromEPConstructionLibrary(keywords=concat_3)  # -> ThermMaterials, EPMaterials, EPWindowMaterials, EPConstructions; plug-in component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
callfromepconstrlibrary_4 = Honeybee_CallFromEPConstructionLibrary(keywords=concat_4)  # -> ThermMaterials, EPMaterials, EPWindowMaterials, EPConstructions; plug-in component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
glazingcreator = Honeybee_GlazingBasedOnRatio(HBObjects=mass2zone.HBZones, glzRatio=glzparamlist, breakUpWindow=Toggle(False), runIt=toggle_13)  # -> readMe, HBObjWGLZ; plug-in component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
glazingcreator_2 = Honeybee_GlazingBasedOnRatio(HBObjects=mass2zone_2.HBZones, glzRatio=glzparamlist_2, breakUpWindow=Toggle(False), runIt=toggle_14)  # -> readMe, HBObjWGLZ; plug-in component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
item_3 = ListItem(List=callfromepconstrlibrary.EPConstructions, Index=198, Wrap=True)
item_4 = ListItem(List=callfromepconstrlibrary_2.EPConstructions, Index=44, Wrap=True)
item_5 = ListItem(List=callfromepconstrlibrary_3.EPConstructions, Index=198, Wrap=True)
item_6 = ListItem(List=callfromepconstrlibrary_4.EPConstructions, Index=44, Wrap=True)
panel_5 = Panel(item_4)
panel_6 = Panel(item_3)
panel_7 = Panel(item_6)
panel_8 = Panel(item_5)
setepzonecnstr = Honeybee_SetEPZoneConstruction(HBZone=glazingcreator.HBObjWGLZ, wallEPConstruction=item_3, windowEPConstruction=item_4)  # -> simplify(modifiedHBZone); plug-in component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
setepzonecnstr_2 = Honeybee_SetEPZoneConstruction(HBZone=glazingcreator_2.HBObjWGLZ, wallEPConstruction=item_5, windowEPConstruction=item_6)  # -> simplify(modifiedHBZone); plug-in component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
toggle_15 = BooleanToggle(True)
geo_10 = Geometry(setepzonecnstr)
epoutput = Honeybee_GenerateEPOutput(
    zoneEnergyUse=toggle_15,
    zoneGainsAndLosses=toggle_15,
    zoneComfortMetrics="False",
    comfortMapVariables=toggle_15,
    zoneHVACParams=toggle_15,
    surfaceTempAnalysis=toggle_15,
    surfaceEnergyAnalysis=toggle_15,
    glazingSolarAnalysis=toggle_15,
    timestep="annual")  # -> report, flatten(simulationOutputs); plug-in component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
geo_11 = Geometry(setepzonecnstr_2)
panel_9 = Panel(setepzonecnstr_2)
open_weather_file = Ladybug_OpenEPWWeatherFile(open=Toggle(True))  # -> epwFile; plug-in component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
panel_10 = Panel("C:\Users\vasanthakumars\Desktop\temp_folder")
toggle_16 = BooleanToggle(True)
exporttoopenstudio = Honeybee_ExportToOpenStudio(
    epwWeatherFile=open_weather_file,
    HBZones=flatten(setepzonecnstr_2),
    simulationOutputs=flatten(epoutput.simulationOutputs),
    writeOSM=toggle_16,
    runSimulation=toggle_16)  # -> readMe, osmFileAddress, idfFileAddress, resultsFileAddress, rddFileAddress, studyFolder; plug-in component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
panel_11 = Panel(exporttoopenstudio.readMe)
readepresult = Honeybee_ReadEPResult(resultFileAddress=exporttoopenstudio.resultsFileAddress)  # -> totalThermalLoad, thermalLoadBalance, cooling, heating, electricLight, electricEquip, port, port_2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; plug-in component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
readepsrfresult = Honeybee_ReadEPSurfaceResult(resultFileAddress=exporttoopenstudio.resultsFileAddress)  # -> surfaceIndoorTemp, surfaceOutdoorTemp, surfaceEnergyFlow, opaqueEnergyFlow, glazEnergyFlow, windowTotalSolarEnergy, windowBeamEnergy, windowDiffEnergy, windowTransmissivity, port; plug-in component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
data = Data(setepzonecnstr)
data_2 = Data(setepzonecnstr_2)
decomposebytype = Honeybee_DecomposeBasedOnType(HBZone=data)  # -> walls, interiorWalls, airWalls, flatten(windows), interiorWindows, skylights, roofs, ceilings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; plug-in component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
decomposebytype_2 = Honeybee_DecomposeBasedOnType(HBZone=data_2)  # -> walls, interiorWalls, airWalls, flatten(windows), interiorWindows, skylights, roofs, ceilings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; plug-in component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
colorzones = Honeybee_ColorZonesByEPResult(zoneData=readepresult.cooling, HBZones=flatten(data_2), normalizeByFloorArea=Toggle(True), runIt=Toggle(True))  # -> readMe, zoneColoredMesh, zoneWireFrame, legend, legendBasePt, analysisTitle, zoneBreps, zoneColors, zoneValues, floorNormZoneData; plug-in component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
wires = BrepWireframe(Brep=decomposebytype.walls, Density=-1)
wires_2 = BrepWireframe(Brep=decomposebytype.roofs, Density=-1)
wires_3 = BrepWireframe(Brep=decomposebytype_2.walls, Density=-1)
preview = CustomPreview(Geometry=decomposebytype.roofs, Shader=ColourSwatch(SwatchColor=RGBA(135, 135, 135, 122)))
mesh = Mesh(colorzones.zoneColoredMesh)
preview_2 = CustomPreview(Geometry=decomposebytype.windows, Shader=ColourSwatch(SwatchColor=RGB(0, 255, 255)))
preview_3 = CustomPreview(Geometry=wires, Shader=ColourSwatch(SwatchColor=RGBA(255, 255, 0, 122)))
preview_4 = CustomPreview(Geometry=decomposebytype_2.windows, Shader=ColourSwatch(SwatchColor=RGB(0, 255, 255)))
preview_5 = CustomPreview(Geometry=wires_3, Shader=ColourSwatch(SwatchColor=RGBA(255, 255, 0, 122)))
geo_12 = Geometry([colorzones.analysisTitle, colorzones.legend])
preview_6 = CustomPreview(Geometry=colorzones.zoneWireFrame, Shader=colorzones.zoneColors)
