# Grasshopper definition bibil_trial_067_2.gh (Grasshopper 0.9.76)
# plug-ins: Python Interpreter

# BIBIL_CLASSES
panel = Panel("C:\\Users\\vasanthakumars\\Documents\\GitHub\\bibil\\src")

# ---- group: find directory
bibil = PythonScript(dir=[panel, "C:\\saeran\\master\\git\\bibil\\src"], run=Toggle(True))  # -> dir; inputs dir: list
# ---------- bibil: Python ----------
import os

ghenv.Component.Params.Output[0].Name = "null"
ghenv.Component.Params.Output[0].NickName = "null"

if run:
    confirm_dir = None
    for d in dir:
        try:
            print os.listdir(d)
            confirm_dir = d
            break
        except:
            continue
    ghenv.Component.Params.Output[0].Name = "dir"
    ghenv.Component.Params.Output[0].NickName = "dir"
    dir = confirm_dir
null = None
# ---------- end bibil ----------

# ---- group: miru
python_script = PythonScript(i=bibil)  # -> o
# ---------- python_script: Python ----------
import os

if i:
    o = os.path.join(str(i),"miru\\miru_miru.py")
# ---------- end python_script ----------
file = ReadFile(File=python_script, PerLineParse=False)
bibil_2 = PythonScript(Code=file)

# ---- group: grammar
python_script_2 = PythonScript(i=bibil)  # -> o
# ---------- python_script_2: Python ----------
import os

if i:
    o = os.path.join(str(i),"bibil\\bibil_rule.py")
# ---------- end python_script_2 ----------
file_2 = ReadFile(File=python_script_2, PerLineParse=False)
bibil_3 = PythonScript(Code=file_2)

# ---- group: pattern
python_script_3 = PythonScript(i=bibil)  # -> o
# ---------- python_script_3: Python ----------
import os

if i:
    o = os.path.join(str(i),"bibil\\bibil_pattern.py")
# ---------- end python_script_3 ----------
file_3 = ReadFile(File=python_script_3, PerLineParse=False)
bibil_4 = PythonScript(Code=file_3)

# ---- group: shape
python_script_4 = PythonScript(i=bibil)  # -> o
# ---------- python_script_4: Python ----------
import os

if i:
    o = os.path.join(str(i),"bibil\\bibil_shape.py")
#o = os.path.join(str(i),"research\\bibil_shape_shape_3d_2d.py")
# ---------- end python_script_4 ----------
file_4 = ReadFile(File=python_script_4, PerLineParse=False)
bibil_5 = PythonScript(Code=file_4)

# ---- group: tree
python_script_5 = PythonScript(i=bibil)  # -> o
# ---------- python_script_5: Python ----------
import os

if i:
    o = os.path.join(str(i),"bibil\\bibil_tree.py")
# ---------- end python_script_5 ----------
file_5 = ReadFile(File=python_script_5, PerLineParse=False)
bibil_6 = PythonScript(Code=file_5)

# ---- group: node_comp
python_script_6 = PythonScript(i=bibil)  # -> o
# ---------- python_script_6: Python ----------
import os

if i:
    o = os.path.join(str(i),"bibil\\bibil_plain.py")
# ---------- end python_script_6 ----------
file_6 = ReadFile(File=python_script_6, PerLineParse=False)

# ---- group: grammar_divide
python_script_7 = PythonScript(i=bibil)  # -> o
# ---------- python_script_7: Python ----------
import os

if i:
    o = os.path.join(str(i),"miru\\miru_divide.py")
# ---------- end python_script_7 ----------
file_7 = ReadFile(File=python_script_7, PerLineParse=False)

# ---- group: grammar_tower
python_script_8 = PythonScript(i=bibil)  # -> o
# ---------- python_script_8: Python ----------
import os

if i:
    o = os.path.join(str(i),"miru\\miru_packing.py")
# ---------- end python_script_8 ----------
file_8 = ReadFile(File=python_script_8, PerLineParse=False)

# ---- group: grammar_courtyard
python_script_9 = PythonScript(i=bibil)  # -> o
# ---------- python_script_9: Python ----------
import os

if i:
    o = os.path.join(str(i),"miru\\miru_court.py")
# ---------- end python_script_9 ----------
file_9 = ReadFile(File=python_script_9, PerLineParse=False)

# ---- group: grammar_tower
python_script_10 = PythonScript(i=bibil)  # -> o
# ---------- python_script_10: Python ----------
import os

if i:
    o = os.path.join(str(i),"miru\\miru_stepback.py")
# ---------- end python_script_10 ----------
file_10 = ReadFile(File=python_script_10, PerLineParse=False)

# ---- group: grammar_height
python_script_11 = PythonScript(i=bibil)  # -> o
# ---------- python_script_11: Python ----------
import os

if i:
    o = os.path.join(str(i),"miru\\miru_height.py")
# ---------- end python_script_11 ----------
file_11 = ReadFile(File=python_script_11, PerLineParse=False)

# ----
# LOT GRAMMAR
number_slider = Slider(1, range=0..10)
list = ValueList({"divide by depth": "subdivide_depth", "divide by same depth": "subdivide_depth_same", "divide by dim": "subdivide_dim"}, selected="divide by same depth")
list_2 = ValueList({"YZ": "NS", "XZ": "EW", "XY": "Z"}, selected="XZ")

# ---- group: DIVIDE
bibil_7 = PythonScript(
    Code=file_7,
    Divide_num=number_slider,
    Divide_cut=Slider(9, range=0..100),
    Divide_type=list,
    Divide_ratio=Slider(0.5, range=0..1),
    Axis=list_2,
    Run=Toggle(True))

# ----
geo = Geometry(<curve referenced from the Rhino model>)
trinco_park = PythonScript(Code=file_6, Rule_in=bibil_7, Child_node_in=geo, Label_="street", Run=Toggle(True))  # -> Node_out, Debug
g = PythonScript(node=trinco_park.Node_out)  # -> geom; inputs node: list
# ---------- g: Python ----------
if node and node != []:
    geom = []
    #lot_lst = node.traverse_tree(lambda n:n,internal=False)
    for n in node:
        geom.append(n.data.shape.bottom_crv)
    print geom
# ---------- end g ----------
explode = Explode(Curve=geo, Recursive=True)  # -> Segments, Vertices
geo_2 = Geometry(explode.Segments)
# BUILDING GRAMMAR
number_slider_2 = Slider(24, range=0..100)
createhbsrfs = Honeybee_createHBSrfs()  # -> readMe, simplify(HBSurface); plug-in component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
# CONTEXT GEOMETRY
panel_2 = Panel("Ground")
# TOWER GRAMMAR
toggle = BooleanToggle(False)

# ---- group: COURTYARD
miru = PythonScript(Code=file_9, Podium_depth=Slider(21, range=0..100), Node_depth=Slider(1, range=-1..1), Run=Toggle(False))

# ---- group: PACKING
bibil_8 = PythonScript(Code=file_8, Run=toggle)

# ---- group: SETBACK/STEPBACK
miru_2 = PythonScript(
    Code=file_10,
    Height=Slider(15, range=0..100),
    Distance=Slider(6, range=0..10),
    Geom_ref=geo_2,
    Node_ref="-1",
    Run=Toggle(True))

# ---- group: HEIGHT
miru_3 = PythonScript(Code=file_11, Height=number_slider_2, Run=Toggle(True))

# ---- group: SETBACK/STEPBACK
miru_4 = PythonScript(
    Code=file_10,
    Height=Slider(9, range=0..10),
    Distance=Slider(3, range=0..10),
    Geom_ref=geo_2,
    Node_ref="-1",
    Run=Toggle(True))

# ----
hb_epcontextsrf = HoneybeeEPContextSurfaces()  # -> HBContext; inputs shdSurfaces: list of Brep, justBoundingBox: Boolean
# ---------- hb_epcontextsrf: Python ----------
"""
prepare shading/context geometries

    Args:
        northVectorOrRotation: A vector that shows North or a number that shows
                               the rotation of the North from the Y axis
        bldgMasses: List of closed Breps as thermal zones.
    Returns:
        report: ...
        thermalZones: Thermal zone's geometries for visualiza
"""

ghenv.Component.Name = 'Honeybee EP context Surfaces'
ghenv.Component.NickName = 'HB_EPContextSrf'
ghenv.Component.Message = 'VER 0.0.60\nAUG_10_2016'
ghenv.Component.IconDisplayMode = ghenv.Component.IconDisplayMode.application
ghenv.Component.Category = "Honeybee"
ghenv.Component.SubCategory = "10 | Energy | Energy"
#compatibleHBVersion = VER 0.0.57\nNOV_01_2015
#compatibleLBVersion = VER 0.0.59\nFEB_01_2015
ghenv.Component.AdditionalHelpFromDocStrings = "2"

import rhinoscriptsyntax as rs
import Rhino as rc
import scriptcontext as sc
import os
import System
import Grasshopper.Kernel as gh
import uuid

tolerance = sc.doc.ModelAbsoluteTolerance
import math


def main(shdSurfaces, EPTransSchedule, meshingSettings, justBoundingBox):
    
    # import the classes
    if sc.sticky.has_key('honeybee_release'):

        try:
            if not sc.sticky['honeybee_release'].isCompatible(ghenv.Component): return -1
            if sc.sticky['honeybee_release'].isInputMissing(ghenv.Component): return -1
        except:
            warning = "You need a newer version of Honeybee to use this compoent." + \
            " Use updateHoneybee component to update userObjects.\n" + \
            "If you have already updated userObjects drag Honeybee_Honeybee component " + \
            "into canvas and try again."
            w = gh.GH_RuntimeMessageLevel.Warning
            ghenv.Component.AddRuntimeMessage(w, warning)
            return -1
        
        # don't customize this part
        hb_EPSrf = sc.sticky["honeybee_EPSurface"]
        hb_EPSHDSurface = sc.sticky["honeybee_EPShdSurface"]
        hb_RADMaterialAUX = sc.sticky["honeybee_RADMaterialAUX"]
        hb_EPObjectsAux = sc.sticky["honeybee_EPObjectsAUX"]()
        HBScheduleList = sc.sticky["honeybee_ScheduleLib"].keys()

        ########################################################################
        #----------------------------------------------------------------------#
        shdBreps = []
        # create bounding box of shading geometries
        if justBoundingBox:
            for brep in shdSurfaces:
                if brep.Faces.Count>1 or not brep.Faces[0].IsPlanar(sc.doc.ModelAbsoluteTolerance):
                    shdBreps.append(brep.GetBoundingBox(True).ToBrep())
                else:
                    shdBreps.append(brep)
        else:
            shdBreps = shdSurfaces
        
        shadingClasses = []
        shadingMeshPreview = []
        
        if meshingSettings == None:
            mp = rc.Geometry.MeshingParameters.Minimal
            mp.SimplePlanes = True
        else:
            mp = meshingSettings
        
        def getRadMaterialName(radMaterial):
            nameStr = radMaterial.split(" ")[2]
            name =  nameStr.split("\n")[0]
            return name
        
        for brepCount, brep in enumerate(shdBreps):
            if brep != None:
                isPlanar = True
                # check planarity
                for face in brep.Faces:
                    if not face.IsPlanar(tolerance):
                        isPlanar = False
                        break
                
                shadingBreps = []
                if not isPlanar:
                    meshArray = rc.Geometry.Mesh.CreateFromBrep(brep, mp)
                    for mesh in meshArray:
                        for meshFace in range(mesh.Faces.Count):
                            vertices = list(mesh.Faces.GetFaceVertices(meshFace))[1:]
                            vertices = vertices + [sc.doc.ModelAbsoluteTolerance]
                            # create the brep from mesh
                            shdBrep = rc.Geometry.Brep.CreateFromCornerPoints(*vertices)
                            shadingBreps.append(shdBrep)
                else:
                    for face in brep.Faces:
                        shadingBreps.append(face.DuplicateFace(False))
                
                for faceCount, shdBrep in enumerate(shadingBreps):
                        thisShading = hb_EPSHDSurface(shdBrep, 1000*brepCount + faceCount, 'shdSrf_' + `brepCount` + '_' + `faceCount` + "_" + str(uuid.uuid4()))
                        
                        # add transmittance schedule if any
                        if EPTransSchedule!=None:
                            schedule= EPTransSchedule.upper()
                            if schedule!=None and not schedule.lower().endswith(".csv") and schedule not in HBScheduleList:
                                msg = "Cannot find " + schedule + " in Honeybee schedule library."
                                print msg
                                ghenv.Component.AddRuntimeMessage(gh.GH_RuntimeMessageLevel.Warning, msg)
                                return -1
                            elif schedule!=None and schedule.lower().endswith(".csv"):
                                # check if csv file is existed
                                if not os.path.isfile(schedule):
                                    msg = "Cannot find the shchedule file: " + schedule
                                    print msg
                                    ghenv.Component.AddRuntimeMessage(gh.GH_RuntimeMessageLevel.Warning, msg)
                                    return -1
                            
                            thisShading.TransmittanceSCH = schedule
                        
                        # add the Rad Material if any
                        if RADMaterial!=None:
                            # if it is just the name of the material make sure it is already defined
                            if len(RADMaterial.split(" ")) == 1:
                                # if the material is not in the library add it to the library
                                if not hb_RADMaterialAUX.isMatrialExistInLibrary(RADMaterial):
                                    warningMsg = "Can't find " + RADMaterial + " in RAD Material Library.\n" + \
                                                "Add the material to the library and try again."
                                    ghenv.Component.AddRuntimeMessage(gh.GH_RuntimeMessageLevel.Warning, warningMsg)
                                    return
                                
                                try:
                                    thisShading.setRADMaterial(RADMaterial)
                                except Exception, e:
                                    print e
                                    warningMsg = "You are using an old version of Honeybee_Honeybee! Update your files and try again."
                                    print warningMsg
                                    ghenv.Component.AddRuntimeMessage(gh.GH_RuntimeMessageLevel.Warning, warningMsg)
                                    return
                                
                                addedToLib = True
                            else:
                                
                                # try to add the material to the library
                                addedToLib, thisShading.RadMaterial = hb_RADMaterialAUX.analyseRadMaterials(RADMaterial, True)
                                
                            if addedToLib==False:
                                warningMsg = "Failed to add " + RADMaterial + " to the Library."
                                ghenv.Component.AddRuntimeMessage(gh.GH_RuntimeMessageLevel.Warning, warningMsg)
                                return
                        
                        # add shading to the list
                        shadingClasses.append(thisShading)
                
        # add to the hive
        hb_hive = sc.sticky["honeybee_Hive"]()
        HBContext  = hb_hive.addToHoneybeeHive(shadingClasses, ghenv.Component.InstanceGuid.ToString())
        return HBContext
        ################################################################################################
    else:
        print "You should first let Honeybee to fly..."
        w = gh.GH_RuntimeMessageLevel.Warning
        ghenv.Component.AddRuntimeMessage(w, "You should first let Honeybee to fly...")
        return -1
        

if _shdSurfaces and _shdSurfaces[0]!=None:
    # add cleaning function
    result= main(_shdSurfaces, EPTransSchedule_, meshingSettings_, justBoundingBox_)
    
    if result != -1: HBContext = result
# ---------- end hb_epcontextsrf ----------
hb_epcontextsrf_2 = HoneybeeEPContextSurfaces()  # -> HBContext; inputs shdSurfaces: list of Brep, justBoundingBox: Boolean; same code as hb_epcontextsrf
createhbzones = Honeybee_createHBZones(name=panel_2, HBSurfaces=flatten(createhbsrfs.HBSurface), isConditioned=Toggle(False))  # -> readMe, HBZone; plug-in component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
bibil_9 = PythonScript(
    Code=file_6,
    Rule_in=[miru_3, miru, miru_4, miru_2],
    Child_node_in=trinco_park.Node_out,
    Label_="podium",
    Run=Toggle(True))  # -> Node_out, Debug
createepground = Honeybee_CreateEPGround(HBZones=createhbzones.HBZone, soilTypeOrMat="4")  # -> HBGrndZones; plug-in component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
g_2 = PythonScript(node=bibil_9.Node_out)  # -> geom
# ---------- g_2: Python ----------
if node:
    geom = []
    lot_lst = node.traverse_tree(lambda n:n,internal=False)
    for n in lot_lst:
        geom.append(n.data.shape.geom)
    print geom
# ---------- end g_2 ----------
sunion = SolidUnion(Breps=flatten(g_2))
fmerge = MergeFaces(Brep=sunion)  # -> Breps, Before, After
list_3 = ValueList({"divide by depth": "subdivide_depth", "divide by same depth": "subdivide_depth_same", "divide by dim": "subdivide_dim"}, selected="divide by same depth")
list_4 = ValueList({"YZ": "NS", "XZ": "EW", "XY": "Z"}, selected="XY")

# ---- group: DIVIDE
bibil_10 = PythonScript(
    Code=file_7,
    Divide_num=Slider(2, range=0..10),
    Divide_cut=Slider(0, range=0..100),
    Divide_type=list_3,
    Divide_ratio=Slider(0.5, range=0..1),
    Axis=list_4,
    Run=Toggle(True))

# ----
bibil_11 = PythonScript(Code=file_6, Rule_in=bibil_10, Child_node_in=fmerge.Breps, Label_="floor", Run=Toggle(False))  # -> Node_out, Debug
g_3 = PythonScript(node=bibil_11.Node_out)  # -> geom; same code as g_2
ladybug = Ladybug_Ladybug()  # -> Vviiiiiiiiiizzz; plug-in component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
honeybee = Honeybee_Honeybee()  # -> Vviiiiiiiiiizzz; plug-in component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
listzoneprograms = Honeybee_ListZonePrograms(bldgProgram=Slider(0, range=0..100))  # -> OfficeZonePrograms; plug-in component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
item = ListItem(List=listzoneprograms, Index=0, Wrap=True)
toggle_2 = BooleanToggle(True)
data = Data(g_3)
mass2zone = Honeybee_Masses2Zones(zoneMasses=flatten(data), zonePrograms=item, isConditioned=True, maxRoofAngle=30, createHBZones=toggle_2)  # -> readMe, HBZones; plug-in component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
concat = Concatenate(FragmentA="2")
concat_2 = Concatenate(FragmentA="2", FragmentB="window", JoinSeparator=" ")
callfromepconstrlibrary = Honeybee_CallFromEPConstructionLibrary(keywords=concat)  # -> ThermMaterials, EPMaterials, EPWindowMaterials, EPConstructions; plug-in component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
callfromepconstrlibrary_2 = Honeybee_CallFromEPConstructionLibrary(keywords=concat_2)  # -> ThermMaterials, EPMaterials, EPWindowMaterials, EPConstructions; plug-in component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
solveadjc = Honeybee_SolveAdjacencies(HBZones=flatten(mass2zone.HBZones), removeCurrentAdjc=False, findAdjc=Toggle(True))  # -> readMe, HBZonesWADJ; plug-in component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
glzparamlist = Honeybee_GlazingParametersList(northGlzParam=Slider(0, range=0..1), westGlzParam=0, southGlzParam=0, eastGlzParam=0)  # -> glzParamList; plug-in component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
item_2 = ListItem(List=callfromepconstrlibrary.EPConstructions, Index=198, Wrap=True)
item_3 = ListItem(List=callfromepconstrlibrary_2.EPConstructions, Index=44, Wrap=True)
panel_3 = Panel(item_3)
panel_4 = Panel(item_2)
glazingcreator = Honeybee_GlazingBasedOnRatio(HBObjects=solveadjc.HBZonesWADJ, glzRatio=glzparamlist, breakUpWindow=Toggle(False), runIt=toggle_2)  # -> readMe, HBObjWGLZ; plug-in component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
toggle_3 = BooleanToggle(True)
setepzonecnstr = Honeybee_SetEPZoneConstruction(HBZone=glazingcreator.HBObjWGLZ, wallEPConstruction=item_2, windowEPConstruction=item_3)  # -> simplify(modifiedHBZone); plug-in component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
epoutput = Honeybee_GenerateEPOutput(
    zoneEnergyUse=toggle_3,
    zoneGainsAndLosses=toggle_3,
    zoneComfortMetrics="False",
    comfortMapVariables=toggle_3,
    zoneHVACParams=toggle_3,
    surfaceTempAnalysis=toggle_3,
    surfaceEnergyAnalysis=toggle_3,
    glazingSolarAnalysis=toggle_3,
    timestep="annual")  # -> report, flatten(simulationOutputs); plug-in component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
open_weather_file = Ladybug_OpenEPWWeatherFile(open=Toggle(True))  # -> epwFile; plug-in component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
geo_3 = Geometry(setepzonecnstr)
panel_5 = Panel("C:\Users\vasanthakumars\Desktop\temp_folder")
toggle_4 = BooleanToggle(True)
exporttoopenstudio = Honeybee_ExportToOpenStudio(
    epwWeatherFile=open_weather_file,
    HBZones=flatten(setepzonecnstr),
    simulationOutputs=flatten(epoutput.simulationOutputs),
    writeOSM=toggle_4,
    runSimulation=toggle_4)  # -> readMe, osmFileAddress, idfFileAddress, resultsFileAddress, rddFileAddress, studyFolder; plug-in component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
readepresult = Honeybee_ReadEPResult(resultFileAddress=exporttoopenstudio.resultsFileAddress)  # -> totalThermalLoad, thermalLoadBalance, cooling, heating, electricLight, electricEquip, fanElectric, pumpElectric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; plug-in component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
readepsrfresult = Honeybee_ReadEPSurfaceResult(resultFileAddress=exporttoopenstudio.resultsFileAddress)  # -> surfaceIndoorTemp, surfaceOutdoorTemp, surfaceEnergyFlow, opaqueEnergyFlow, glazEnergyFlow, windowTotalSolarEnergy, windowBeamEnergy, windowDiffEnergy, windowTransmissivity, otherSurfaceData; plug-in component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
data_2 = Data(setepzonecnstr)
decomposebytype = Honeybee_DecomposeBasedOnType(HBZone=data_2)  # -> walls, interiorWalls, airWalls, flatten(windows), interiorWindows, skylights, roofs, ceilings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; plug-in component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
colorzones = Honeybee_ColorZonesByEPResult(zoneData=readepresult.cooling, HBZones=flatten(data_2), normalizeByFloorArea=Toggle(True), runIt=Toggle(True))  # -> readMe, zoneColoredMesh, zoneWireFrame, legend, legendBasePt, analysisTitle, zoneBreps, zoneColors, zoneValues, floorNormZoneData; plug-in component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
wires = BrepWireframe(Brep=decomposebytype.walls, Density=-1)
mesh = Mesh(colorzones.zoneColoredMesh)
preview = CustomPreview(Geometry=decomposebytype.windows, Shader=ColourSwatch(SwatchColor=RGB(0, 255, 255)))
preview_2 = CustomPreview(Geometry=wires, Shader=ColourSwatch(SwatchColor=RGBA(255, 255, 0, 122)))
geo_4 = Geometry([colorzones.analysisTitle, colorzones.legend])
preview_3 = CustomPreview(Geometry=colorzones.zoneWireFrame, Shader=colorzones.zoneColors)
