# Grasshopper definition bibil_trial_068.gh (Grasshopper 0.9.76)
# plug-ins: Python Interpreter, Mosquito

list = ValueList({"dir", "file"}, selected="dir")

# ---- group: find directory
bibil = PythonScript(
    dir=["C:\\Users\\vasanthakumars\\Documents\\GitHub\\bibil\\src", "C:\\saeran\\master\\git\\bibil\\src"],
    type=list,
    run=Toggle(True))  # -> dir; inputs dir: list
# ---------- bibil: Python ----------
import os

ghenv.Component.Params.Output[0].Name = "null"
ghenv.Component.Params.Output[0].NickName = "null"

if run:
    confirm_dir = None
    for d in dir:
        try:
            if type == "file":
                print open(d)
            else:
                print os.listdir(d)
            confirm_dir = d
            break
        except Exception as e:
            #print str(e)
            continue
    if confirm_dir != None:
        ghenv.Component.Params.Output[0].Name = type
        ghenv.Component.Params.Output[0].NickName = type
        dir = confirm_dir
null = None
# ---------- end bibil ----------

# ---- group: miru
# BIBIL_CLASSES
python_script = PythonScript(i=bibil)  # -> o
# ---------- python_script: Python ----------
import os

if i:
    o = os.path.join(str(i),"miru\\miru_miru.py")
# ---------- end python_script ----------
file = ReadFile(File=python_script, PerLineParse=False)
bibil_2 = PythonScript(Code=file)

# ---- group: grammar
python_script_2 = PythonScript(i=bibil)  # -> o
# ---------- python_script_2: Python ----------
import os

if i:
    o = os.path.join(str(i),"bibil\\bibil_rule.py")
# ---------- end python_script_2 ----------
file_2 = ReadFile(File=python_script_2, PerLineParse=False)
bibil_3 = PythonScript(Code=file_2)

# ---- group: pattern
python_script_3 = PythonScript(i=bibil)  # -> o
# ---------- python_script_3: Python ----------
import os

if i:
    o = os.path.join(str(i),"bibil\\bibil_pattern.py")
# ---------- end python_script_3 ----------
file_3 = ReadFile(File=python_script_3, PerLineParse=False)
bibil_4 = PythonScript(Code=file_3)

# ---- group: shape
python_script_4 = PythonScript(i=bibil)  # -> o
# ---------- python_script_4: Python ----------
import os

if i:
    o = os.path.join(str(i),"bibil\\bibil_shape.py")
#o = os.path.join(str(i),"research\\bibil_shape_shape_3d_2d.py")
# ---------- end python_script_4 ----------
file_4 = ReadFile(File=python_script_4, PerLineParse=False)
bibil_5 = PythonScript(Code=file_4)

# ---- group: tree
python_script_5 = PythonScript(i=bibil)  # -> o
# ---------- python_script_5: Python ----------
import os

if i:
    o = os.path.join(str(i),"bibil\\bibil_tree.py")
# ---------- end python_script_5 ----------
file_5 = ReadFile(File=python_script_5, PerLineParse=False)
bibil_6 = PythonScript(Code=file_5)

# ---- group: node_comp
python_script_6 = PythonScript(i=bibil)  # -> o
# ---------- python_script_6: Python ----------
import os

if i:
    o = os.path.join(str(i),"bibil\\bibil_plain.py")
# ---------- end python_script_6 ----------
file_6 = ReadFile(File=python_script_6, PerLineParse=False)

# ---- group: grammar_divide
python_script_7 = PythonScript(i=bibil)  # -> o
# ---------- python_script_7: Python ----------
import os

if i:
    o = os.path.join(str(i),"miru\\miru_divide.py")
# ---------- end python_script_7 ----------
file_7 = ReadFile(File=python_script_7, PerLineParse=False)

# ---- group: grammar_courtyard
python_script_8 = PythonScript(i=bibil)  # -> o
# ---------- python_script_8: Python ----------
import os

if i:
    o = os.path.join(str(i),"miru\\miru_court.py")
# ---------- end python_script_8 ----------
file_8 = ReadFile(File=python_script_8, PerLineParse=False)

# ---- group: grammar_tower
python_script_9 = PythonScript(i=bibil)  # -> o
# ---------- python_script_9: Python ----------
import os

if i:
    o = os.path.join(str(i),"miru\\miru_packing.py")
# ---------- end python_script_9 ----------
file_9 = ReadFile(File=python_script_9, PerLineParse=False)

python_script_10 = PythonScript(i=bibil)  # -> o
# ---------- python_script_10: Python ----------
import os

if i:
    o = os.path.join(str(i),"miru\\miru_stepback.py")
# ---------- end python_script_10 ----------
file_10 = ReadFile(File=python_script_10, PerLineParse=False)

# ---- group: grammar_height
python_script_11 = PythonScript(i=bibil)  # -> o
# ---------- python_script_11: Python ----------
import os

if i:
    o = os.path.join(str(i),"miru\\miru_height.py")
# ---------- end python_script_11 ----------
file_11 = ReadFile(File=python_script_11, PerLineParse=False)

# ----
# Note: Change this number with caution,
# Increase bounds iterratively.
panel = Panel("0.004")  # disabled

panel_2 = Panel("Yonge and Eglinton")  # disabled
panel_3 = Panel("Redpath Avenue and Roehampton Avenue")  # disabled
location = MosquitoLocation(Location=panel_3)  # -> Address, Points, Type; disabled
item = ListItem(List=location.Points, Index=0, Wrap=True)  # disabled
toggle = BooleanToggle(True)  # disabled
toggle_2 = BooleanToggle(True)  # disabled
toggle_3 = BooleanToggle(True)  # disabled
toggle_4 = BooleanToggle(True)  # disabled
circle = CircleCNR(Center=item, Normal=Vector(0, 0, 1), Radius=panel)  # disabled
vector_maps = VectorMaps(Area=circle, AllRoads=toggle, Buildings=toggle_2, ReProject=toggle_3, CenterToWorld=toggle_4)  # -> RoadLines, RoadInfo, BuildingLines, BuildingInfo, BuildingHeights, AmenityLines, AmenityInfo, AmenityPoints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; disabled
swatch = ColourSwatch(SwatchColor=RGB(0, 0, 0))  # disabled
geo = Geometry([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])  # disabled
geo_2 = Geometry([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])  # disabled
geo_3 = Geometry(Tree({0}: [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], {1}: [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], {2}: [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], {3}: [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], {4}: [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], {5}: [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]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))  # disabled
geo_4 = Geometry([vector_maps.BuildingLines, vector_maps.RoadLines, vector_maps.AmenityLines])  # disabled
preview = CustomPreview(Geometry=[geo_3, geo_2, geo], Shader=swatch)  # disabled

geo_5 = Geometry([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])
geo_6 = Geometry([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])
geo_7 = Geometry([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])
preview_2 = CustomPreview(
    Geometry=geo_7,
    Shader={ambient=RGB(0, 0, 0), diffuse=RGB(255, 105, 180), emission=RGB(76, 32, 54), shine=0.5, specular=RGB(255, 255, 255), transparency=0})
preview_3 = CustomPreview(Geometry=[geo_6, geo_5], Shader=ColourSwatch(SwatchColor=RGB(0, 0, 0)))

# ----
# LOT GRAMMAR
number_slider = Slider(1, range=0..10)
list_2 = ValueList({"divide by depth": "subdivide_depth", "divide by same depth": "subdivide_depth_same", "divide by dim": "subdivide_dim"}, selected="divide by same depth")
list_3 = ValueList({"YZ": "NS", "XZ": "EW", "XY": "Z"}, selected="XZ")

# ---- group: DIVIDE
bibil_7 = PythonScript(
    Code=file_7,
    Divide_num=number_slider,
    Divide_cut=Slider(9, range=0..100),
    Divide_type=list_2,
    Divide_ratio=Slider(0.5, range=0..1),
    Axis=list_3,
    Run=Toggle(False))

# ----
geo_8 = Geometry(<curve referenced from the Rhino model>)
trinco_park = PythonScript(Code=file_6, Rule_in=bibil_7, Child_node_in=geo_8, Label_="street", Run=Toggle(True))  # -> Node_out, Debug
g = PythonScript(node=trinco_park.Node_out)  # -> geom; inputs node: list
# ---------- g: Python ----------
if node and node != []:
    geom = []
    #lot_lst = node.traverse_tree(lambda n:n,internal=False)
    for n in node:
        geom.append(n.data.shape.bottom_crv)
    print geom
# ---------- end g ----------
explode = Explode(Curve=geo_8, Recursive=True)  # -> Segments, Vertices
geo_9 = Geometry(explode.Segments)
# BUILDING GRAMMAR
number_slider_2 = Slider(24, range=0..100)
# TOWER GRAMMAR
toggle_5 = BooleanToggle(False)

# ---- group: COURTYARD
miru = PythonScript(Code=file_8, Podium_depth=Slider(21, range=0..100), Node_depth=Slider(1, range=-1..1), Run=Toggle(False))

# ---- group: PACKING
bibil_8 = PythonScript(Code=file_9, Run=toggle_5)

# ---- group: SETBACK/STEPBACK
miru_2 = PythonScript(
    Code=file_10,
    Height=Slider(15, range=0..100),
    Distance=Slider(6, range=0..10),
    Geom_ref=geo_9,
    Node_ref="-1",
    Run=Toggle(True))

# ---- group: HEIGHT
miru_3 = PythonScript(Code=file_11, Height=number_slider_2, Run=Toggle(True))

# ---- group: SETBACK/STEPBACK
miru_4 = PythonScript(
    Code=file_10,
    Height=Slider(9, range=0..10),
    Distance=Slider(3, range=0..10),
    Geom_ref=geo_9,
    Node_ref="-1",
    Run=Toggle(True))

# ----
bibil_9 = PythonScript(
    Code=file_6,
    Rule_in=[miru_3, miru, miru_4, miru_2],
    Child_node_in=trinco_park.Node_out,
    Label_="podium",
    Run=Toggle(False))  # -> Node_out, Debug
g_2 = PythonScript(node=bibil_9.Node_out)  # -> geom
# ---------- g_2: Python ----------
if node:
    geom = []
    lot_lst = node.traverse_tree(lambda n:n,internal=False)
    for n in lot_lst:
        geom.append(n.data.shape.geom)
    print geom
# ---------- end g_2 ----------
list_4 = ValueList({"divide by depth": "subdivide_depth", "divide by same depth": "subdivide_depth_same", "divide by dim": "subdivide_dim"}, selected="divide by depth")
list_5 = ValueList({"YZ": "NS", "XZ": "EW", "XY": "Z"}, selected="XZ")
geo_10 = Geometry([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])

# ---- group: DIVIDE
bibil_10 = PythonScript(
    Code=file_7,
    Divide_num=Slider(1, range=0..10),
    Divide_cut=Slider(0, range=0..100),
    Divide_type=list_4,
    Divide_ratio=Slider(0.5, range=0..1),
    Axis=list_5,
    Run=Toggle(True))

# ----
geo_11 = Geometry(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)
bibil_11 = PythonScript(Code=file_6, Rule_in=bibil_10, Child_node_in=geo_10, Label_="floor", Run=Toggle(True))  # -> Node_out, Debug
geo_12 = Geometry(bibil_11.Debug)
g_3 = PythonScript(node=bibil_11.Node_out)  # -> geom; same code as g_2
wires = BrepWireframe(Brep=g_3, Density=-1)
number_slider_3 = Slider(2, range=0..100)  # disabled
number_slider_4 = Slider(1, range=0..100)  # disabled
geo_13 = Geometry([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])  # disabled
geo_14 = Geometry([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])  # disabled
geo_15 = Geometry([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])  # disabled
ladybug = Ladybug_Ladybug()  # -> Vviiiiiiiiiizzz; disabled; plug-in component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
honeybee = Honeybee_Honeybee()  # -> Vviiiiiiiiiizzz; disabled; plug-in component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
createhbsrfs = Honeybee_createHBSrfs()  # -> readMe, simplify(HBSurface); disabled; plug-in component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
panel_4 = Panel("Ground")  # disabled
toggle_6 = BooleanToggle(False)  # disabled
listzoneprograms = Honeybee_ListZonePrograms(bldgProgram=number_slider_3)  # -> MidriseApartmentZonePrograms; disabled; plug-in component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
listzoneprograms_2 = Honeybee_ListZonePrograms(bldgProgram=number_slider_4)  # -> RetailZonePrograms; disabled; plug-in component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
hb_epcontextsrf = HoneybeeEPContextSurfaces()  # -> HBContext; inputs shdSurfaces: list of Brep, justBoundingBox: Boolean; disabled
# ---------- hb_epcontextsrf: Python ----------
"""
prepare shading/context geometries

    Args:
        northVectorOrRotation: A vector that shows North or a number that shows
                               the rotation of the North from the Y axis
        bldgMasses: List of closed Breps as thermal zones.
    Returns:
        report: ...
        thermalZones: Thermal zone's geometries for visualiza
"""

ghenv.Component.Name = 'Honeybee EP context Surfaces'
ghenv.Component.NickName = 'HB_EPContextSrf'
ghenv.Component.Message = 'VER 0.0.60\nAUG_10_2016'
ghenv.Component.IconDisplayMode = ghenv.Component.IconDisplayMode.application
ghenv.Component.Category = "Honeybee"
ghenv.Component.SubCategory = "10 | Energy | Energy"
#compatibleHBVersion = VER 0.0.57\nNOV_01_2015
#compatibleLBVersion = VER 0.0.59\nFEB_01_2015
ghenv.Component.AdditionalHelpFromDocStrings = "2"

import rhinoscriptsyntax as rs
import Rhino as rc
import scriptcontext as sc
import os
import System
import Grasshopper.Kernel as gh
import uuid

tolerance = sc.doc.ModelAbsoluteTolerance
import math


def main(shdSurfaces, EPTransSchedule, meshingSettings, justBoundingBox):
    
    # import the classes
    if sc.sticky.has_key('honeybee_release'):

        try:
            if not sc.sticky['honeybee_release'].isCompatible(ghenv.Component): return -1
            if sc.sticky['honeybee_release'].isInputMissing(ghenv.Component): return -1
        except:
            warning = "You need a newer version of Honeybee to use this compoent." + \
            " Use updateHoneybee component to update userObjects.\n" + \
            "If you have already updated userObjects drag Honeybee_Honeybee component " + \
            "into canvas and try again."
            w = gh.GH_RuntimeMessageLevel.Warning
            ghenv.Component.AddRuntimeMessage(w, warning)
            return -1
        
        # don't customize this part
        hb_EPSrf = sc.sticky["honeybee_EPSurface"]
        hb_EPSHDSurface = sc.sticky["honeybee_EPShdSurface"]
        hb_RADMaterialAUX = sc.sticky["honeybee_RADMaterialAUX"]
        hb_EPObjectsAux = sc.sticky["honeybee_EPObjectsAUX"]()
        HBScheduleList = sc.sticky["honeybee_ScheduleLib"].keys()

        ########################################################################
        #----------------------------------------------------------------------#
        shdBreps = []
        # create bounding box of shading geometries
        if justBoundingBox:
            for brep in shdSurfaces:
                if brep.Faces.Count>1 or not brep.Faces[0].IsPlanar(sc.doc.ModelAbsoluteTolerance):
                    shdBreps.append(brep.GetBoundingBox(True).ToBrep())
                else:
                    shdBreps.append(brep)
        else:
            shdBreps = shdSurfaces
        
        shadingClasses = []
        shadingMeshPreview = []
        
        if meshingSettings == None:
            mp = rc.Geometry.MeshingParameters.Minimal
            mp.SimplePlanes = True
        else:
            mp = meshingSettings
        
        def getRadMaterialName(radMaterial):
            nameStr = radMaterial.split(" ")[2]
            name =  nameStr.split("\n")[0]
            return name
        
        for brepCount, brep in enumerate(shdBreps):
            if brep != None:
                isPlanar = True
                # check planarity
                for face in brep.Faces:
                    if not face.IsPlanar(tolerance):
                        isPlanar = False
                        break
                
                shadingBreps = []
                if not isPlanar:
                    meshArray = rc.Geometry.Mesh.CreateFromBrep(brep, mp)
                    for mesh in meshArray:
                        for meshFace in range(mesh.Faces.Count):
                            vertices = list(mesh.Faces.GetFaceVertices(meshFace))[1:]
                            vertices = vertices + [sc.doc.ModelAbsoluteTolerance]
                            # create the brep from mesh
                            shdBrep = rc.Geometry.Brep.CreateFromCornerPoints(*vertices)
                            shadingBreps.append(shdBrep)
                else:
                    for face in brep.Faces:
                        shadingBreps.append(face.DuplicateFace(False))
                
                for faceCount, shdBrep in enumerate(shadingBreps):
                        thisShading = hb_EPSHDSurface(shdBrep, 1000*brepCount + faceCount, 'shdSrf_' + `brepCount` + '_' + `faceCount` + "_" + str(uuid.uuid4()))
                        
                        # add transmittance schedule if any
                        if EPTransSchedule!=None:
                            schedule= EPTransSchedule.upper()
                            if schedule!=None and not schedule.lower().endswith(".csv") and schedule not in HBScheduleList:
                                msg = "Cannot find " + schedule + " in Honeybee schedule library."
                                print msg
                                ghenv.Component.AddRuntimeMessage(gh.GH_RuntimeMessageLevel.Warning, msg)
                                return -1
                            elif schedule!=None and schedule.lower().endswith(".csv"):
                                # check if csv file is existed
                                if not os.path.isfile(schedule):
                                    msg = "Cannot find the shchedule file: " + schedule
                                    print msg
                                    ghenv.Component.AddRuntimeMessage(gh.GH_RuntimeMessageLevel.Warning, msg)
                                    return -1
                            
                            thisShading.TransmittanceSCH = schedule
                        
                        # add the Rad Material if any
                        if RADMaterial!=None:
                            # if it is just the name of the material make sure it is already defined
                            if len(RADMaterial.split(" ")) == 1:
                                # if the material is not in the library add it to the library
                                if not hb_RADMaterialAUX.isMatrialExistInLibrary(RADMaterial):
                                    warningMsg = "Can't find " + RADMaterial + " in RAD Material Library.\n" + \
                                                "Add the material to the library and try again."
                                    ghenv.Component.AddRuntimeMessage(gh.GH_RuntimeMessageLevel.Warning, warningMsg)
                                    return
                                
                                try:
                                    thisShading.setRADMaterial(RADMaterial)
                                except Exception, e:
                                    print e
                                    warningMsg = "You are using an old version of Honeybee_Honeybee! Update your files and try again."
                                    print warningMsg
                                    ghenv.Component.AddRuntimeMessage(gh.GH_RuntimeMessageLevel.Warning, warningMsg)
                                    return
                                
                                addedToLib = True
                            else:
                                
                                # try to add the material to the library
                                addedToLib, thisShading.RadMaterial = hb_RADMaterialAUX.analyseRadMaterials(RADMaterial, True)
                                
                            if addedToLib==False:
                                warningMsg = "Failed to add " + RADMaterial + " to the Library."
                                ghenv.Component.AddRuntimeMessage(gh.GH_RuntimeMessageLevel.Warning, warningMsg)
                                return
                        
                        # add shading to the list
                        shadingClasses.append(thisShading)
                
        # add to the hive
        hb_hive = sc.sticky["honeybee_Hive"]()
        HBContext  = hb_hive.addToHoneybeeHive(shadingClasses, ghenv.Component.InstanceGuid.ToString())
        return HBContext
        ################################################################################################
    else:
        print "You should first let Honeybee to fly..."
        w = gh.GH_RuntimeMessageLevel.Warning
        ghenv.Component.AddRuntimeMessage(w, "You should first let Honeybee to fly...")
        return -1
        

if _shdSurfaces and _shdSurfaces[0]!=None:
    # add cleaning function
    result= main(_shdSurfaces, EPTransSchedule_, meshingSettings_, justBoundingBox_)
    
    if result != -1: HBContext = result
# ---------- end hb_epcontextsrf ----------
hb_epcontextsrf_2 = HoneybeeEPContextSurfaces()  # -> HBContext; inputs shdSurfaces: list of Brep, justBoundingBox: Boolean; disabled; same code as hb_epcontextsrf
createhbzones = Honeybee_createHBZones(name=panel_4, HBSurfaces=flatten(createhbsrfs.HBSurface), isConditioned=toggle_6)  # -> readMe, HBZone; disabled; plug-in component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
num = Number(3)  # disabled
num_2 = Number(9)  # disabled
item_2 = ListItem(List=listzoneprograms, Index=num_2, Wrap=True)  # disabled
item_3 = ListItem(List=listzoneprograms_2, Index=num, Wrap=True)  # disabled

# ---- group: Residential
data = Data()  # disabled

# ---- group: Retail
data_2 = Data()  # disabled

# ----
panel_5 = Panel("4")  # disabled

# ---- group: Office
data_3 = Data()  # disabled

number_slider_5 = Slider(0, range=0..100)  # disabled
listzoneprograms_3 = Honeybee_ListZonePrograms(bldgProgram=number_slider_5)  # -> OfficeZonePrograms; disabled; plug-in component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
num_3 = Number(4)  # disabled
item_4 = ListItem(List=listzoneprograms_3, Index=num_3, Wrap=True)  # disabled
toggle_7 = BooleanToggle(True)  # disabled
panel_6 = Panel("2")  # disabled
panel_7 = Panel("2")  # disabled
panel_8 = Panel("window")  # disabled
mass2zone = Honeybee_Masses2Zones(zoneMasses=flatten(data_3), zonePrograms=item_4, isConditioned=True, maxRoofAngle=30, createHBZones=toggle_7)  # -> readMe, HBZones; disabled; plug-in component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
concat = Concatenate(FragmentA=panel_7, FragmentB=panel_8, JoinSeparator=" ")  # disabled
concat_2 = Concatenate(FragmentA=panel_6)  # disabled
toggle_8 = BooleanToggle(True)  # disabled
panel_9 = Panel("0.3")  # disabled
callfromepconstrlibrary = Honeybee_CallFromEPConstructionLibrary(keywords=concat_2)  # -> ThermMaterials, EPMaterials, EPWindowMaterials, EPConstructions; disabled; plug-in component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
callfromepconstrlibrary_2 = Honeybee_CallFromEPConstructionLibrary(keywords=concat)  # -> ThermMaterials, EPMaterials, EPWindowMaterials, EPConstructions; disabled; plug-in component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
solveadjc = Honeybee_SolveAdjacencies(HBZones=flatten(mass2zone.HBZones), removeCurrentAdjc=False, findAdjc=toggle_8)  # -> readMe, HBZonesWADJ; disabled; plug-in component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
glzparamlist = Honeybee_GlazingParametersList(northGlzParam=panel_9, westGlzParam=panel_9, southGlzParam=panel_9, eastGlzParam=panel_9)  # -> glzParamList; disabled; plug-in component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
toggle_9 = BooleanToggle(False)  # disabled
item_5 = ListItem(List=callfromepconstrlibrary.EPConstructions, Index=198, Wrap=True)  # disabled
item_6 = ListItem(List=callfromepconstrlibrary_2.EPConstructions, Index=44, Wrap=True)  # disabled
panel_10 = Panel(item_6)  # disabled
panel_11 = Panel(item_5)  # disabled
glazingcreator = Honeybee_GlazingBasedOnRatio(HBObjects=solveadjc.HBZonesWADJ, glzRatio=glzparamlist, breakUpWindow=toggle_9, runIt=toggle_7)  # -> readMe, HBObjWGLZ; disabled; plug-in component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
setepzonecnstr = Honeybee_SetEPZoneConstruction(HBZone=glazingcreator.HBObjWGLZ, wallEPConstruction=item_5, windowEPConstruction=item_6)  # -> simplify(modifiedHBZone); disabled; plug-in component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
geo_16 = Geometry(setepzonecnstr)  # disabled

# ----
createepground = Honeybee_CreateEPGround(HBZones=createhbzones.HBZone, soilTypeOrMat=panel_5)  # -> HBGrndZones; disabled; plug-in component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
panel_12 = Panel("annual")  # disabled
toggle_10 = BooleanToggle(True)  # disabled
epoutput = Honeybee_GenerateEPOutput(
    zoneEnergyUse=toggle_10,
    zoneGainsAndLosses=toggle_10,
    zoneComfortMetrics="False",
    comfortMapVariables=toggle_10,
    zoneHVACParams=toggle_10,
    surfaceTempAnalysis=toggle_10,
    surfaceEnergyAnalysis=toggle_10,
    glazingSolarAnalysis=toggle_10,
    timestep=panel_12)  # -> report, flatten(simulationOutputs); disabled; plug-in component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
panel_13 = Panel("C:\Users\vasanthakumars\Desktop\temp_folder")  # disabled
toggle_11 = BooleanToggle(True)  # disabled
data_4 = Data(setepzonecnstr)  # disabled
toggle_12 = BooleanToggle(True)  # disabled
toggle_13 = BooleanToggle(True)  # disabled
decomposebytype = Honeybee_DecomposeBasedOnType(HBZone=data_4)  # -> walls, interiorWalls, airWalls, flatten(windows), interiorWindows, skylights, roofs, ceilings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; disabled; plug-in component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
swatch_2 = ColourSwatch(SwatchColor=RGB(0, 255, 255))  # disabled
swatch_3 = ColourSwatch(SwatchColor=RGBA(255, 255, 0, 122))  # disabled
wires_2 = BrepWireframe(Brep=decomposebytype.walls, Density=-1)  # disabled
preview_4 = CustomPreview(Geometry=decomposebytype.windows, Shader=swatch_2)  # disabled
preview_5 = CustomPreview(Geometry=wires_2, Shader=swatch_3)  # disabled

panel_14 = Panel("C:\\Users\\vasanthakumars\\Documents\\GitHub\\bibil\\src\\reference\\CAN_ON_Toronto.716240_CWEC\\CAN_ON_Toronto.716240_CWEC.epw")  # disabled
panel_15 = Panel("C:\\saeran\\master\\git\\bibil\\src\\reference\\CAN_ON_Toronto.716240_CWEC\\CAN_ON_Toronto.716240_CWEC.epw")  # disabled
toggle_14 = BooleanToggle(True)  # disabled
list_6 = ValueList({"dir", "file"}, selected="file")  # disabled

# ---- group: find directory
bibil_12 = PythonScript(dir=[panel_14, panel_15], type=list_6, run=toggle_14)  # -> file; inputs dir: list; disabled; same code as bibil

# ----
data_5 = Data(bibil_12)  # disabled

exporttoopenstudio = Honeybee_ExportToOpenStudio(
    epwWeatherFile=data_5,
    HBZones=flatten(setepzonecnstr),
    simulationOutputs=flatten(epoutput.simulationOutputs),
    writeOSM=toggle_11,
    runSimulation=toggle_11)  # -> readMe, osmFileAddress, idfFileAddress, resultsFileAddress, rddFileAddress, studyFolder; disabled; plug-in component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
readepsrfresult = Honeybee_ReadEPSurfaceResult(resultFileAddress=exporttoopenstudio.resultsFileAddress)  # -> surfaceIndoorTemp, surfaceOutdoorTemp, surfaceEnergyFlow, opaqueEnergyFlow, glazEnergyFlow, windowTotalSolarEnergy, windowBeamEnergy, windowDiffEnergy, windowTransmissivity, otherSurfaceData; disabled; plug-in component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
readepresult = Honeybee_ReadEPResult(resultFileAddress=exporttoopenstudio.resultsFileAddress)  # -> totalThermalLoad, thermalLoadBalance, cooling, heating, electricLight, electricEquip, fanElectric, pumpElectric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; disabled; plug-in component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
colorzones = Honeybee_ColorZonesByEPResult(zoneData=readepresult.cooling, HBZones=flatten(data_4), normalizeByFloorArea=toggle_12, runIt=toggle_13)  # -> readMe, zoneColoredMesh, zoneWireFrame, legend, legendBasePt, analysisTitle, zoneBreps, zoneColors, zoneValues, floorNormZoneData; disabled; plug-in component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
mesh = Mesh(colorzones.zoneColoredMesh)  # disabled
geo_17 = Geometry([colorzones.analysisTitle, colorzones.legend])  # disabled
preview_6 = CustomPreview(Geometry=colorzones.zoneWireFrame, Shader=colorzones.zoneColors)  # disabled
