# Grasshopper definition bibil_trial_069.gh (Grasshopper 0.9.76)
# plug-ins: Python Interpreter, Mosquito

list = ValueList({"dir", "file"}, selected="dir")

# ---- group: find directory
bibil = PythonScript(
    dir=["C:\\Users\\vasanthakumars\\Documents\\GitHub\\bibil\\src", "C:\\saeran\\master\\git\\bibil\\src"],
    type=list,
    run=Toggle(True))  # -> dir; inputs dir: list
# ---------- bibil: Python ----------
import os

ghenv.Component.Params.Output[0].Name = "null"
ghenv.Component.Params.Output[0].NickName = "null"

if run:
    confirm_dir = None
    for d in dir:
        try:
            if type == "file":
                file_ = open(d)
                file_.close()
            else:
                print os.listdir(d)
            confirm_dir = d
            break
        except Exception as e:
            #print str(e)
            continue
    if confirm_dir != None:
        ghenv.Component.Params.Output[0].Name = type
        ghenv.Component.Params.Output[0].NickName = type
        dir = confirm_dir
        file = confirm_dir
null = None
# ---------- end bibil ----------

# ---- group: miru
# BIBIL_CLASSES
python_script = PythonScript(i=bibil)  # -> o
# ---------- python_script: Python ----------
import os

if i:
    o = os.path.join(str(i),"miru\\miru_miru.py")
# ---------- end python_script ----------
file = ReadFile(File=python_script, PerLineParse=False)
bibil_2 = PythonScript(Code=file)

# ---- group: grammar
python_script_2 = PythonScript(i=bibil)  # -> o
# ---------- python_script_2: Python ----------
import os

if i:
    o = os.path.join(str(i),"bibil\\bibil_rule.py")
# ---------- end python_script_2 ----------
file_2 = ReadFile(File=python_script_2, PerLineParse=False)
bibil_3 = PythonScript(Code=file_2)

# ---- group: pattern
python_script_3 = PythonScript(i=bibil)  # -> o
# ---------- python_script_3: Python ----------
import os

if i:
    o = os.path.join(str(i),"bibil\\bibil_pattern.py")
# ---------- end python_script_3 ----------
file_3 = ReadFile(File=python_script_3, PerLineParse=False)
bibil_4 = PythonScript(Code=file_3)

# ---- group: shape
python_script_4 = PythonScript(i=bibil)  # -> o
# ---------- python_script_4: Python ----------
import os

if i:
    o = os.path.join(str(i),"bibil\\bibil_shape.py")
#o = os.path.join(str(i),"research\\bibil_shape_shape_3d_2d.py")
# ---------- end python_script_4 ----------
file_4 = ReadFile(File=python_script_4, PerLineParse=False)
bibil_5 = PythonScript(Code=file_4)

# ---- group: tree
python_script_5 = PythonScript(i=bibil)  # -> o
# ---------- python_script_5: Python ----------
import os

if i:
    o = os.path.join(str(i),"bibil\\bibil_tree.py")
# ---------- end python_script_5 ----------
file_5 = ReadFile(File=python_script_5, PerLineParse=False)
bibil_6 = PythonScript(Code=file_5)

# ---- group: bula
python_script_6 = PythonScript(i=bibil)  # -> o
# ---------- python_script_6: Python ----------
import os

if i:
    o = os.path.join(str(i),"bula\\bula_minimal.py")
# ---------- end python_script_6 ----------
file_6 = ReadFile(File=python_script_6, PerLineParse=False)

# ---- group: node_comp
python_script_7 = PythonScript(i=bibil)  # -> o
# ---------- python_script_7: Python ----------
import os

if i:
    o = os.path.join(str(i),"bibil\\bibil_plain.py")
# ---------- end python_script_7 ----------
file_7 = ReadFile(File=python_script_7, PerLineParse=False)

# ---- group: grammar_divide
python_script_8 = PythonScript(i=bibil)  # -> o
# ---------- python_script_8: Python ----------
import os

if i:
    o = os.path.join(str(i),"miru\\miru_divide.py")
# ---------- end python_script_8 ----------
file_8 = ReadFile(File=python_script_8, PerLineParse=False)

# ---- group: grammar_courtyard
python_script_9 = PythonScript(i=bibil)  # -> o
# ---------- python_script_9: Python ----------
import os

if i:
    o = os.path.join(str(i),"miru\\miru_court.py")
# ---------- end python_script_9 ----------
file_9 = ReadFile(File=python_script_9, PerLineParse=False)

# ---- group: grammar_tower
python_script_10 = PythonScript(i=bibil)  # -> o
# ---------- python_script_10: Python ----------
import os

if i:
    o = os.path.join(str(i),"miru\\miru_packing.py")
# ---------- end python_script_10 ----------
file_10 = ReadFile(File=python_script_10, PerLineParse=False)

python_script_11 = PythonScript(i=bibil)  # -> o
# ---------- python_script_11: Python ----------
import os

if i:
    o = os.path.join(str(i),"miru\\miru_stepback.py")
# ---------- end python_script_11 ----------
file_11 = ReadFile(File=python_script_11, PerLineParse=False)

# ---- group: grammar_height
python_script_12 = PythonScript(i=bibil)  # -> o
# ---------- python_script_12: Python ----------
import os

if i:
    o = os.path.join(str(i),"miru\\miru_height.py")
# ---------- end python_script_12 ----------
file_12 = ReadFile(File=python_script_12, PerLineParse=False)

# ----
# Note: Change this number with caution,
# Increase bounds iterratively.
panel = Panel("0.004")  # disabled

panel_2 = Panel("Yonge and Eglinton")  # disabled
panel_3 = Panel("Redpath Avenue and Roehampton Avenue")  # disabled
location = MosquitoLocation(Location=panel_3)  # -> Address, Points, Type; disabled
item = ListItem(List=location.Points, Index=0, Wrap=True)  # disabled
toggle = BooleanToggle(True)  # disabled
toggle_2 = BooleanToggle(True)  # disabled
toggle_3 = BooleanToggle(True)  # disabled
toggle_4 = BooleanToggle(True)  # disabled
circle = CircleCNR(Center=item, Normal=Vector(0, 0, 1), Radius=panel)  # disabled
vector_maps = VectorMaps(Area=circle, AllRoads=toggle, Buildings=toggle_2, ReProject=toggle_3, CenterToWorld=toggle_4)  # -> RoadLines, RoadInfo, BuildingLines, BuildingInfo, BuildingHeights, AmenityLines, AmenityInfo, AmenityPoints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; disabled
swatch = ColourSwatch(SwatchColor=RGB(0, 0, 0))  # disabled
geo = Geometry([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])  # disabled
geo_2 = Geometry([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])  # disabled
geo_3 = Geometry(Tree({0}: [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], {1}: [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], {2}: [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], {3}: [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], {4}: [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], {5}: [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]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))  # disabled
geo_4 = Geometry([vector_maps.BuildingLines, vector_maps.RoadLines, vector_maps.AmenityLines])  # disabled
preview = CustomPreview(Geometry=[geo_3, geo_2, geo], Shader=swatch)  # disabled

swatch_2 = ColourSwatch(SwatchColor=RGB(0, 0, 0))  # disabled
geo_5 = Geometry([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])  # disabled
geo_6 = Geometry([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])  # disabled
geo_7 = Geometry([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])  # disabled
preview_2 = CustomPreview(
    Geometry=geo_7,
    Shader={ambient=RGB(0, 0, 0), diffuse=RGB(255, 105, 180), emission=RGB(76, 32, 54), shine=0.5, specular=RGB(255, 255, 255), transparency=0})  # disabled
preview_3 = CustomPreview(Geometry=[geo_6, geo_5], Shader=swatch_2)  # disabled

# ----
# LOT GRAMMAR
number_slider = Slider(1, range=0..10)  # disabled
number_slider_2 = Slider(0.5, range=0..1)  # disabled
number_slider_3 = Slider(9, range=0..100)  # disabled
list_2 = ValueList({"divide by depth": "subdivide_depth", "divide by same depth": "subdivide_depth_same", "divide by dim": "subdivide_dim"}, selected="divide by same depth")  # disabled
toggle_5 = BooleanToggle(False)  # disabled
list_3 = ValueList({"YZ": "NS", "XZ": "EW", "XY": "Z"}, selected="XZ")  # disabled

# ---- group: DIVIDE
bibil_7 = PythonScript(
    Code=file_8,
    Divide_num=number_slider,
    Divide_cut=number_slider_3,
    Divide_type=list_2,
    Divide_ratio=number_slider_2,
    Axis=list_3,
    Run=toggle_5)  # disabled

# ----
panel_4 = Panel("street")  # disabled
toggle_6 = BooleanToggle(True)  # disabled
geo_8 = Geometry(<curve referenced from the Rhino model>)  # disabled
trinco_park = PythonScript(Code=file_7, Rule_in=bibil_7, Child_node_in=geo_8, Label_=panel_4, Run=toggle_6)  # -> Node_out, Debug; disabled
g = PythonScript(node=trinco_park.Node_out)  # -> geom; inputs node: list; disabled
# ---------- g: Python ----------
if node and node != []:
    geom = []
    #lot_lst = node.traverse_tree(lambda n:n,internal=False)
    for n in node:
        geom.append(n.data.shape.bottom_crv)
    print geom
# ---------- end g ----------
explode = Explode(Curve=geo_8, Recursive=True)  # -> Segments, Vertices; disabled
geo_9 = Geometry(explode.Segments)  # disabled
number_slider_4 = Slider(21, range=0..100)  # disabled
number_slider_5 = Slider(1, range=-1..1)  # disabled
# BUILDING GRAMMAR
number_slider_6 = Slider(24, range=0..100)  # disabled
number_slider_7 = Slider(6, range=0..10)  # disabled
number_slider_8 = Slider(3, range=0..10)  # disabled
number_slider_9 = Slider(9, range=0..10)  # disabled
number_slider_10 = Slider(15, range=0..100)  # disabled
toggle_7 = BooleanToggle(True)  # disabled
toggle_8 = BooleanToggle(False)  # disabled
toggle_9 = BooleanToggle(True)  # disabled
toggle_10 = BooleanToggle(True)  # disabled
# TOWER GRAMMAR
toggle_11 = BooleanToggle(False)  # disabled
panel_5 = Panel("-1")  # disabled
panel_6 = Panel("-1")  # disabled

# ---- group: COURTYARD
miru = PythonScript(Code=file_9, Podium_depth=number_slider_4, Node_depth=number_slider_5, Run=toggle_8)  # disabled

# ---- group: PACKING
bibil_8 = PythonScript(Code=file_10, Run=toggle_11)  # disabled

# ---- group: SETBACK/STEPBACK
miru_2 = PythonScript(Code=file_11, Height=number_slider_10, Distance=number_slider_7, Geom_ref=geo_9, Node_ref=panel_5, Run=toggle_10)  # disabled

# ---- group: HEIGHT
miru_3 = PythonScript(Code=file_12, Height=number_slider_6, Run=toggle_7)  # disabled

# ---- group: SETBACK/STEPBACK
miru_4 = PythonScript(Code=file_11, Height=number_slider_9, Distance=number_slider_8, Geom_ref=geo_9, Node_ref=panel_6, Run=toggle_9)  # disabled

# ----
panel_7 = Panel("podium")  # disabled
toggle_12 = BooleanToggle(False)  # disabled
bibil_9 = PythonScript(Code=file_7, Rule_in=[miru_3, miru, miru_4, miru_2], Child_node_in=trinco_park.Node_out, Label_=panel_7, Run=toggle_12)  # -> Node_out, Debug; disabled
g_2 = PythonScript(node=bibil_9.Node_out)  # -> geom; disabled
# ---------- g_2: Python ----------
if node:
    geom = []
    lot_lst = node.traverse_tree(lambda n:n,internal=False)
    for n in lot_lst:
        geom.append(n.data.shape.geom)
    print geom
# ---------- end g_2 ----------
toggle_13 = BooleanToggle(True)  # disabled
panel_8 = Panel("floor")  # disabled
geo_10 = Geometry([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])  # disabled
bibil_10 = PythonScript(Code=file_7, Child_node_in=geo_10, Label_=panel_8, Run=toggle_13)  # -> Node_out, Debug; disabled
g_3 = PythonScript(node=bibil_10.Node_out)  # -> geom; disabled
# ---------- g_3: Python ----------
if node:
    geom = []
    lot_lst = node.traverse_tree(lambda n:n,internal=False)
    for n in lot_lst:
        geom.append(n.data.shape.bottom_crv)
    #print geom
# ---------- end g_3 ----------
g_4 = PythonScript(node=bibil_10.Node_out)  # -> ht; disabled
# ---------- g_4: Python ----------
if node:
    ht = []
    lot_lst = node.traverse_tree(lambda n:n,internal=False)
    for n in lot_lst:
        ht.append(n.data.shape.ht)
    print ht
# ---------- end g_4 ----------
Z = UnitZ(Factor=g_4)  # disabled
boundary = BoundarySurfaces(Edges=g_3)  # disabled
number_slider_11 = Slider(1, range=0..10)  # disabled
number_slider_12 = Slider(0.5, range=0..1)  # disabled
number_slider_13 = Slider(0, range=0..100)  # disabled
list_4 = ValueList({"divide by depth": "subdivide_depth", "divide by same depth": "subdivide_depth_same", "divide by dim": "subdivide_dim"}, selected="divide by depth")  # disabled
extr = Extrude(Base=boundary, Direction=Z)  # disabled
toggle_14 = BooleanToggle(False)  # disabled
list_5 = ValueList({"YZ": "NS", "XZ": "EW", "XY": "Z"}, selected="XZ")  # disabled

# ---- group: DIVIDE
bibil_11 = PythonScript(
    Code=file_8,
    Divide_num=number_slider_11,
    Divide_cut=number_slider_13,
    Divide_type=list_4,
    Divide_ratio=number_slider_12,
    Axis=list_5,
    Run=toggle_14)  # disabled

# ----
number_slider_14 = Slider(1, range=0..100)  # disabled
geo_11 = Geometry([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])  # disabled
ladybug = Ladybug_Ladybug()  # -> Vviiiiiiiiiizzz; disabled; plug-in component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
number_slider_15 = Slider(0, range=0..100)  # disabled
honeybee = Honeybee_Honeybee()  # -> Vviiiiiiiiiizzz; disabled; plug-in component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

# ---- group: Office
geo_12 = Geometry([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])  # disabled

# ----
createhbsrfs = Honeybee_createHBSrfs()  # -> readMe, simplify(HBSurface); disabled; plug-in component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
panel_9 = Panel("Ground")  # disabled
toggle_15 = BooleanToggle(False)  # disabled
listzoneprograms = Honeybee_ListZonePrograms(bldgProgram=number_slider_14)  # -> RetailZonePrograms; disabled; plug-in component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
number_slider_16 = Slider(3, range=0..10)  # disabled
listzoneprograms_2 = Honeybee_ListZonePrograms(bldgProgram=number_slider_15)  # -> OfficeZonePrograms; disabled; plug-in component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
number_slider_17 = Slider(2, range=0..100)  # disabled
hb_epcontextsrf = HoneybeeEPContextSurfaces()  # -> HBContext; inputs shdSurfaces: list of Brep, justBoundingBox: Boolean; disabled
# ---------- hb_epcontextsrf: Python ----------
"""
prepare shading/context geometries

    Args:
        northVectorOrRotation: A vector that shows North or a number that shows
                               the rotation of the North from the Y axis
        bldgMasses: List of closed Breps as thermal zones.
    Returns:
        report: ...
        thermalZones: Thermal zone's geometries for visualiza
"""

ghenv.Component.Name = 'Honeybee EP context Surfaces'
ghenv.Component.NickName = 'HB_EPContextSrf'
ghenv.Component.Message = 'VER 0.0.60\nAUG_10_2016'
ghenv.Component.IconDisplayMode = ghenv.Component.IconDisplayMode.application
ghenv.Component.Category = "Honeybee"
ghenv.Component.SubCategory = "10 | Energy | Energy"
#compatibleHBVersion = VER 0.0.57\nNOV_01_2015
#compatibleLBVersion = VER 0.0.59\nFEB_01_2015
ghenv.Component.AdditionalHelpFromDocStrings = "2"

import rhinoscriptsyntax as rs
import Rhino as rc
import scriptcontext as sc
import os
import System
import Grasshopper.Kernel as gh
import uuid

tolerance = sc.doc.ModelAbsoluteTolerance
import math


def main(shdSurfaces, EPTransSchedule, meshingSettings, justBoundingBox):
    
    # import the classes
    if sc.sticky.has_key('honeybee_release'):

        try:
            if not sc.sticky['honeybee_release'].isCompatible(ghenv.Component): return -1
            if sc.sticky['honeybee_release'].isInputMissing(ghenv.Component): return -1
        except:
            warning = "You need a newer version of Honeybee to use this compoent." + \
            " Use updateHoneybee component to update userObjects.\n" + \
            "If you have already updated userObjects drag Honeybee_Honeybee component " + \
            "into canvas and try again."
            w = gh.GH_RuntimeMessageLevel.Warning
            ghenv.Component.AddRuntimeMessage(w, warning)
            return -1
        
        # don't customize this part
        hb_EPSrf = sc.sticky["honeybee_EPSurface"]
        hb_EPSHDSurface = sc.sticky["honeybee_EPShdSurface"]
        hb_RADMaterialAUX = sc.sticky["honeybee_RADMaterialAUX"]
        hb_EPObjectsAux = sc.sticky["honeybee_EPObjectsAUX"]()
        HBScheduleList = sc.sticky["honeybee_ScheduleLib"].keys()

        ########################################################################
        #----------------------------------------------------------------------#
        shdBreps = []
        # create bounding box of shading geometries
        if justBoundingBox:
            for brep in shdSurfaces:
                if brep.Faces.Count>1 or not brep.Faces[0].IsPlanar(sc.doc.ModelAbsoluteTolerance):
                    shdBreps.append(brep.GetBoundingBox(True).ToBrep())
                else:
                    shdBreps.append(brep)
        else:
            shdBreps = shdSurfaces
        
        shadingClasses = []
        shadingMeshPreview = []
        
        if meshingSettings == None:
            mp = rc.Geometry.MeshingParameters.Minimal
            mp.SimplePlanes = True
        else:
            mp = meshingSettings
        
        def getRadMaterialName(radMaterial):
            nameStr = radMaterial.split(" ")[2]
            name =  nameStr.split("\n")[0]
            return name
        
        for brepCount, brep in enumerate(shdBreps):
            if brep != None:
                isPlanar = True
                # check planarity
                for face in brep.Faces:
                    if not face.IsPlanar(tolerance):
                        isPlanar = False
                        break
                
                shadingBreps = []
                if not isPlanar:
                    meshArray = rc.Geometry.Mesh.CreateFromBrep(brep, mp)
                    for mesh in meshArray:
                        for meshFace in range(mesh.Faces.Count):
                            vertices = list(mesh.Faces.GetFaceVertices(meshFace))[1:]
                            vertices = vertices + [sc.doc.ModelAbsoluteTolerance]
                            # create the brep from mesh
                            shdBrep = rc.Geometry.Brep.CreateFromCornerPoints(*vertices)
                            shadingBreps.append(shdBrep)
                else:
                    for face in brep.Faces:
                        shadingBreps.append(face.DuplicateFace(False))
                
                for faceCount, shdBrep in enumerate(shadingBreps):
                        thisShading = hb_EPSHDSurface(shdBrep, 1000*brepCount + faceCount, 'shdSrf_' + `brepCount` + '_' + `faceCount` + "_" + str(uuid.uuid4()))
                        
                        # add transmittance schedule if any
                        if EPTransSchedule!=None:
                            schedule= EPTransSchedule.upper()
                            if schedule!=None and not schedule.lower().endswith(".csv") and schedule not in HBScheduleList:
                                msg = "Cannot find " + schedule + " in Honeybee schedule library."
                                print msg
                                ghenv.Component.AddRuntimeMessage(gh.GH_RuntimeMessageLevel.Warning, msg)
                                return -1
                            elif schedule!=None and schedule.lower().endswith(".csv"):
                                # check if csv file is existed
                                if not os.path.isfile(schedule):
                                    msg = "Cannot find the shchedule file: " + schedule
                                    print msg
                                    ghenv.Component.AddRuntimeMessage(gh.GH_RuntimeMessageLevel.Warning, msg)
                                    return -1
                            
                            thisShading.TransmittanceSCH = schedule
                        
                        # add the Rad Material if any
                        if RADMaterial!=None:
                            # if it is just the name of the material make sure it is already defined
                            if len(RADMaterial.split(" ")) == 1:
                                # if the material is not in the library add it to the library
                                if not hb_RADMaterialAUX.isMatrialExistInLibrary(RADMaterial):
                                    warningMsg = "Can't find " + RADMaterial + " in RAD Material Library.\n" + \
                                                "Add the material to the library and try again."
                                    ghenv.Component.AddRuntimeMessage(gh.GH_RuntimeMessageLevel.Warning, warningMsg)
                                    return
                                
                                try:
                                    thisShading.setRADMaterial(RADMaterial)
                                except Exception, e:
                                    print e
                                    warningMsg = "You are using an old version of Honeybee_Honeybee! Update your files and try again."
                                    print warningMsg
                                    ghenv.Component.AddRuntimeMessage(gh.GH_RuntimeMessageLevel.Warning, warningMsg)
                                    return
                                
                                addedToLib = True
                            else:
                                
                                # try to add the material to the library
                                addedToLib, thisShading.RadMaterial = hb_RADMaterialAUX.analyseRadMaterials(RADMaterial, True)
                                
                            if addedToLib==False:
                                warningMsg = "Failed to add " + RADMaterial + " to the Library."
                                ghenv.Component.AddRuntimeMessage(gh.GH_RuntimeMessageLevel.Warning, warningMsg)
                                return
                        
                        # add shading to the list
                        shadingClasses.append(thisShading)
                
        # add to the hive
        hb_hive = sc.sticky["honeybee_Hive"]()
        HBContext  = hb_hive.addToHoneybeeHive(shadingClasses, ghenv.Component.InstanceGuid.ToString())
        return HBContext
        ################################################################################################
    else:
        print "You should first let Honeybee to fly..."
        w = gh.GH_RuntimeMessageLevel.Warning
        ghenv.Component.AddRuntimeMessage(w, "You should first let Honeybee to fly...")
        return -1
        

if _shdSurfaces and _shdSurfaces[0]!=None:
    # add cleaning function
    result= main(_shdSurfaces, EPTransSchedule_, meshingSettings_, justBoundingBox_)
    
    if result != -1: HBContext = result
# ---------- end hb_epcontextsrf ----------
hb_epcontextsrf_2 = HoneybeeEPContextSurfaces()  # -> HBContext; inputs shdSurfaces: list of Brep, justBoundingBox: Boolean; disabled; same code as hb_epcontextsrf
toggle_16 = BooleanToggle(True)  # disabled
createhbzones = Honeybee_createHBZones(name=panel_9, HBSurfaces=flatten(createhbsrfs.HBSurface), isConditioned=toggle_15)  # -> readMe, HBZone; disabled; plug-in component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
panel_10 = Panel("@3")  # disabled

# ---- group: Residential
geo_13 = Geometry([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])  # disabled

# ----
num = Number(3)  # disabled
listzoneprograms_3 = Honeybee_ListZonePrograms(bldgProgram=number_slider_17)  # -> MidriseApartmentZonePrograms; disabled; plug-in component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
splitmass = Honeybee_SplitBuildingMass(bldgMasses=extr, bldgsFlr2FloorHeights=panel_10, runIt=toggle_16)  # -> readMe, splitBldgMasses; disabled; plug-in component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
num_2 = Number(4)  # disabled
item_2 = ListItem(List=listzoneprograms, Index=num, Wrap=True)  # disabled

# ---- group: Retail
data = Data()  # disabled

# ----
panel_11 = Panel("4")  # disabled
item_3 = ListItem(List=listzoneprograms_2, Index=num_2, Wrap=True)  # disabled

# ---- group: Office
data_2 = Data()  # disabled

# ----
createepground = Honeybee_CreateEPGround(HBZones=createhbzones.HBZone, soilTypeOrMat=panel_11)  # -> HBGrndZones; disabled; plug-in component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
num_3 = Number(9)  # disabled
geo_14 = Geometry(splitmass.splitBldgMasses)  # disabled
item_4 = ListItem(List=listzoneprograms_3, Index=num_3, Wrap=True)  # disabled
toggle_17 = BooleanToggle(True)  # disabled
toggle_18 = BooleanToggle(True)  # disabled
panel_12 = Panel("2")  # disabled
panel_13 = Panel("2")  # disabled
panel_14 = Panel("window")  # disabled
panel_15 = Panel("2")  # disabled
panel_16 = Panel("2")  # disabled
panel_17 = Panel("window")  # disabled
mass2zone = Honeybee_Masses2Zones(zoneMasses=flatten(data_2), zonePrograms=item_3, isConditioned=True, maxRoofAngle=30, createHBZones=toggle_17)  # -> readMe, HBZones; disabled; plug-in component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
mass2zone_2 = Honeybee_Masses2Zones(
    zoneMasses=flatten(splitmass.splitBldgMasses),
    zonePrograms=item_4,
    isConditioned=True,
    maxRoofAngle=30,
    createHBZones=toggle_18)  # -> readMe, HBZones; disabled; plug-in component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
concat = Concatenate(FragmentA=panel_13, FragmentB=panel_14, JoinSeparator=" ")  # disabled
concat_2 = Concatenate(FragmentA=panel_12)  # disabled
concat_3 = Concatenate(FragmentA=panel_16, FragmentB=panel_17, JoinSeparator=" ")  # disabled
concat_4 = Concatenate(FragmentA=panel_15)  # disabled
toggle_19 = BooleanToggle(True)  # disabled
toggle_20 = BooleanToggle(True)  # disabled
panel_18 = Panel("0.3")  # disabled
callfromepconstrlibrary = Honeybee_CallFromEPConstructionLibrary(keywords=concat_2)  # -> ThermMaterials, EPMaterials, EPWindowMaterials, EPConstructions; disabled; plug-in component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
callfromepconstrlibrary_2 = Honeybee_CallFromEPConstructionLibrary(keywords=concat)  # -> ThermMaterials, EPMaterials, EPWindowMaterials, EPConstructions; disabled; plug-in component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
panel_19 = Panel("0.3")  # disabled
callfromepconstrlibrary_3 = Honeybee_CallFromEPConstructionLibrary(keywords=concat_4)  # -> ThermMaterials, EPMaterials, EPWindowMaterials, EPConstructions; disabled; plug-in component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
callfromepconstrlibrary_4 = Honeybee_CallFromEPConstructionLibrary(keywords=concat_3)  # -> ThermMaterials, EPMaterials, EPWindowMaterials, EPConstructions; disabled; plug-in component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
solveadjc = Honeybee_SolveAdjacencies(HBZones=flatten(mass2zone.HBZones), removeCurrentAdjc=False, findAdjc=toggle_19)  # -> readMe, HBZonesWADJ; disabled; plug-in component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
solveadjc_2 = Honeybee_SolveAdjacencies(HBZones=flatten(mass2zone_2.HBZones), removeCurrentAdjc=False, findAdjc=toggle_20)  # -> readMe, HBZonesWADJ; disabled; plug-in component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
glzparamlist = Honeybee_GlazingParametersList(northGlzParam=panel_18, westGlzParam=panel_18, southGlzParam=panel_18, eastGlzParam=panel_18)  # -> glzParamList; disabled; plug-in component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
glzparamlist_2 = Honeybee_GlazingParametersList(northGlzParam=panel_19, westGlzParam=panel_19, southGlzParam=panel_19, eastGlzParam=panel_19)  # -> glzParamList; disabled; plug-in component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
toggle_21 = BooleanToggle(False)  # disabled
toggle_22 = BooleanToggle(False)  # disabled
item_5 = ListItem(List=callfromepconstrlibrary.EPConstructions, Index=198, Wrap=True)  # disabled
item_6 = ListItem(List=callfromepconstrlibrary_2.EPConstructions, Index=44, Wrap=True)  # disabled
item_7 = ListItem(List=callfromepconstrlibrary_3.EPConstructions, Index=198, Wrap=True)  # disabled
item_8 = ListItem(List=callfromepconstrlibrary_4.EPConstructions, Index=44, Wrap=True)  # disabled
panel_20 = Panel(item_6)  # disabled
panel_21 = Panel(item_5)  # disabled
panel_22 = Panel(item_8)  # disabled
panel_23 = Panel(item_7)  # disabled
glazingcreator = Honeybee_GlazingBasedOnRatio(HBObjects=solveadjc.HBZonesWADJ, glzRatio=glzparamlist, breakUpWindow=toggle_21, runIt=toggle_17)  # -> readMe, HBObjWGLZ; disabled; plug-in component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
glazingcreator_2 = Honeybee_GlazingBasedOnRatio(HBObjects=solveadjc_2.HBZonesWADJ, glzRatio=glzparamlist_2, breakUpWindow=toggle_22, runIt=toggle_18)  # -> readMe, HBObjWGLZ; disabled; plug-in component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
setepzonecnstr = Honeybee_SetEPZoneConstruction(HBZone=glazingcreator.HBObjWGLZ, wallEPConstruction=item_5, windowEPConstruction=item_6)  # -> simplify(modifiedHBZone); disabled; plug-in component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
setepzonecnstr_2 = Honeybee_SetEPZoneConstruction(HBZone=glazingcreator_2.HBObjWGLZ, wallEPConstruction=item_7, windowEPConstruction=item_8)  # -> simplify(modifiedHBZone); disabled; plug-in component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
geo_15 = Geometry(setepzonecnstr)  # disabled
geo_16 = Geometry(setepzonecnstr_2)  # disabled
data_3 = Data(setepzonecnstr_2)  # disabled
panel_24 = Panel("annual")  # disabled
toggle_23 = BooleanToggle(True)  # disabled
epoutput = Honeybee_GenerateEPOutput(
    zoneEnergyUse=toggle_23,
    zoneGainsAndLosses=toggle_23,
    zoneComfortMetrics="False",
    comfortMapVariables=toggle_23,
    zoneHVACParams=toggle_23,
    surfaceTempAnalysis=toggle_23,
    surfaceEnergyAnalysis=toggle_23,
    glazingSolarAnalysis=toggle_23,
    timestep=panel_24)  # -> report, flatten(simulationOutputs); disabled; plug-in component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
panel_25 = Panel("section_test")  # disabled
panel_26 = Panel("C:\Users\vasanthakumars\Desktop\temp_folder")  # disabled
toggle_24 = BooleanToggle(True)  # disabled
path = FilePath("c:\ladybug\section_test\OpenStudio\section_test\ModelToIdf\in.csv")  # disabled
toggle_25 = BooleanToggle(False)  # disabled
toggle_26 = BooleanToggle(True)  # disabled
decomposebytype = Honeybee_DecomposeBasedOnType(HBZone=data_3)  # -> walls, interiorWalls, airWalls, flatten(windows), interiorWindows, skylights, roofs, ceilings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; disabled; plug-in component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
swatch_3 = ColourSwatch(SwatchColor=RGB(158, 255, 255))  # disabled
swatch_4 = ColourSwatch(SwatchColor=RGBA(0, 0, 0, 122))  # disabled
wires = BrepWireframe(Brep=[decomposebytype.walls, decomposebytype.floors, decomposebytype.ceilings], Density=-1)  # disabled
geo_17 = Geometry(decomposebytype.floors)  # disabled
swatch_5 = ColourSwatch(SwatchColor=RGBA(181, 181, 181, 122))  # disabled
swatch_6 = ColourSwatch(SwatchColor=RGB(0, 0, 0))  # disabled
preview_4 = CustomPreview(Geometry=decomposebytype.windows, Shader=swatch_3)  # disabled
preview_5 = CustomPreview(Geometry=wires, Shader=swatch_4)  # disabled
preview_6 = CustomPreview(Geometry=geo_17, Shader=swatch_5)  # disabled
number_slider_18 = Slider(15, range=0..100)  # disabled
number_slider_19 = Slider(15, range=0..100)  # disabled
number_slider_20 = Slider(0.5, range=0..1)  # disabled
number_slider_21 = Slider(0, range=0..100)  # disabled
list_6 = ValueList({"divide by depth": "subdivide_depth", "divide by same depth": "subdivide_depth_same", "divide by dim": "subdivide_dim"}, selected="divide by dim")  # disabled
toggle_27 = BooleanToggle(True)  # disabled
list_7 = ValueList({"YZ": "NS", "XZ": "EW", "XY": "Z"}, selected="YZ")  # disabled

# ---- group: DIVIDE
bibil_12 = PythonScript(
    Code=file_8,
    Divide_num=[number_slider_19, number_slider_18],
    Divide_cut=number_slider_21,
    Divide_type=list_6,
    Divide_ratio=number_slider_20,
    Axis=list_7,
    Run=toggle_27)  # disabled

# ----
toggle_28 = BooleanToggle(True)  # disabled
panel_27 = Panel("bula")  # disabled
panel_28 = Panel("zones")  # disabled
toggle_29 = BooleanToggle(True)  # disabled
geo_18 = Geometry(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)  # disabled
trinco_park_2 = PythonScript(Code=file_7, Rule_in=bibil_12, Child_node_in=geo_18, Label_=panel_27, Run=toggle_28)  # -> Node_out, Debug; disabled
bibil_13 = PythonScript(Code=file_7, Rule_in=[miru_3, miru, miru_4, miru_2], Child_node_in=data_3, Label_=panel_28, Run=toggle_29)  # -> Node_out, Debug; disabled
g_5 = PythonScript(node=trinco_park_2.Node_out)  # -> geom; inputs node: list; disabled
# ---------- g_5: Python ----------
if node and node != []:
    geom = []
    #lot_lst = node.traverse_tree(lambda n:n,internal=False)
    for n in node:
        geom.append(n.data.shape.cpt)
    print len(geom)
    #print type(geom[0])
# ---------- end g_5 ----------
g_6 = PythonScript(node=trinco_park_2.Node_out)  # -> geom; inputs node: list; disabled; same code as g
g_7 = PythonScript(node=bibil_13.Node_out)  # -> geom; disabled; same code as g_2
toggle_30 = BooleanToggle(True)  # disabled

panel_29 = Panel("C:\saeran\master\git\bibil\src\reference\CAN_ON_Toronto.716240_CWEC\CAN_ON_Toronto.716240_CWEC.epw")  # disabled
panel_30 = Panel("C:\\saeran\\master\\git\\bibil\\src\\reference\\CAN_ON_Toronto.716240_CWEC\\CAN_ON_Toronto.716240_CWEC.epw")  # disabled
toggle_31 = BooleanToggle(True)  # disabled
list_8 = ValueList({"dir", "file"}, selected="file")  # disabled

# ---- group: find directory
bibil_14 = PythonScript(dir=[panel_29, panel_30], type=list_8, run=toggle_31)  # -> null; inputs dir: list; same code as bibil

# ----
data_4 = Data(bibil_14)  # disabled

exporttoopenstudio = Honeybee_ExportToOpenStudio(
    epwWeatherFile=panel_29,
    HBZones=flatten(data_3),
    simulationOutputs=flatten(epoutput.simulationOutputs),
    writeOSM=toggle_24,
    runSimulation=toggle_24,
    fileName=panel_25)  # -> readMe, osmFileAddress, idfFileAddress, resultsFileAddress, rddFileAddress, studyFolder; disabled; plug-in component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
path_2 = FilePath(exporttoopenstudio.resultsFileAddress)  # disabled
readepsrfresult = Honeybee_ReadEPSurfaceResult(resultFileAddress=path_2)  # -> surfaceIndoorTemp, surfaceOutdoorTemp, surfaceEnergyFlow, opaqueEnergyFlow, glazEnergyFlow, windowTotalSolarEnergy, windowBeamEnergy, windowDiffEnergy, windowTransmissivity, otherSurfaceData; disabled; plug-in component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
readepresult = Honeybee_ReadEPResult(resultFileAddress=path_2)  # -> totalThermalLoad, thermalLoadBalance, cooling, heating, electricLight, electricEquip, fanElectric, pumpElectric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; disabled; plug-in component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

# ---- group: thermal_balance
data_5 = Data(readepresult.thermalLoadBalance)  # disabled

# ----
colorzones = Honeybee_ColorZonesByEPResult(zoneData=readepresult.thermalLoadBalance, HBZones=flatten(data_3), normalizeByFloorArea=toggle_25, runIt=toggle_26)  # -> readMe, zoneColoredMesh, zoneWireFrame, legend, legendBasePt, analysisTitle, zoneBreps, zoneColors, zoneValues, floorNormZoneData; disabled; plug-in component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
panel_31 = Panel(colorzones.zoneValues)  # disabled
geo_19 = Geometry(colorzones.zoneColoredMesh)  # disabled
geo_20 = Geometry([colorzones.analysisTitle, colorzones.legend])  # disabled
preview_7 = CustomPreview(Geometry=colorzones.zoneWireFrame, Shader=swatch_6)  # disabled
python = PythonScript(val=data_5)  # -> val; inputs val: tree; disabled
# ---------- python: Python ----------
import scriptcontext as sc

Bula_Data = sc.sticky['BulaData']

if val:
    Bula = Bula_Data()
    val = Bula.ghtree2nestlist(val)
    val = map(lambda v: v[7],val)

print val
# ---------- end python ----------
panel_32 = Panel(data_5)  # disabled

# ---- group: Norm_Thermal
python_2 = PythonScript(Code=file_6, Cpt=g_5, Values=python, Zones=flatten(bibil_13.Node_out), Run=toggle_30)  # -> Line, Debug; disabled

# ----
geo_21 = Geometry(python_2.Debug)  # disabled
geo_22 = Geometry(python_2.Line)  # disabled
