# Grasshopper definition bibil_trial_077.gh (Grasshopper 0.9.76)
# plug-ins: Python Interpreter, Mosquito

list = ValueList({"dir", "file"}, selected="dir")

# ---- group: find directory
bibil = PythonScript(
    dir=["C:\\Users\\vasanthakumars\\Documents\\GitHub\\bibil\\src", "C:\\saeran\\master\\git\\bibil\\src"],
    type=list,
    run=Toggle(True))  # -> dir; inputs dir: list
# ---------- bibil: Python ----------
import os

ghenv.Component.Params.Output[0].Name = "null"
ghenv.Component.Params.Output[0].NickName = "null"

if run:
    confirm_dir = None
    for d in dir:
        try:
            if type == "file":
                file_ = open(d)
                file_.close()
            else:
                print os.listdir(d)
            confirm_dir = d
            break
        except Exception as e:
            #print str(e)
            continue
    if confirm_dir != None:
        ghenv.Component.Params.Output[0].Name = type
        ghenv.Component.Params.Output[0].NickName = type
        dir = confirm_dir
        file = confirm_dir
null = None
# ---------- end bibil ----------

# ---- group: tree
python_script = PythonScript(i=bibil)  # -> o
# ---------- python_script: Python ----------
import os

if i:
    o = os.path.join(str(i),"bibil\\bibil_tree.py")
# ---------- end python_script ----------
file = ReadFile(File=python_script, PerLineParse=False)
bibil_2 = PythonScript(Code=file)

# ---- group: grammar
python_script_2 = PythonScript(i=bibil)  # -> o
# ---------- python_script_2: Python ----------
import os

if i:
    o = os.path.join(str(i),"bibil\\bibil_grammar.py")
# ---------- end python_script_2 ----------
file_2 = ReadFile(File=python_script_2, PerLineParse=False)
bibil_3 = PythonScript(Code=file_2)

# ---- group: shape
python_script_3 = PythonScript(i=bibil)  # -> o
# ---------- python_script_3: Python ----------
import os

if i:
    o = os.path.join(str(i),"bibil\\bibil_shape.py")
#o = os.path.join(str(i),"research\\bibil_shape_shape_3d_2d.py")
# ---------- end python_script_3 ----------
file_3 = ReadFile(File=python_script_3, PerLineParse=False)
bibil_4 = PythonScript(Code=file_3)

# ---- group: miru
python_script_4 = PythonScript(i=bibil)  # -> o
# ---------- python_script_4: Python ----------
import os

if i:
    o = os.path.join(str(i),"miru\\miru_miru.py")
# ---------- end python_script_4 ----------
file_4 = ReadFile(File=python_script_4, PerLineParse=False)
bibil_5 = PythonScript(Code=file_4)

# ---- group: bula
python_script_5 = PythonScript(i=bibil)  # -> o
# ---------- python_script_5: Python ----------
import os

if i:
    o = os.path.join(str(i),"bula\\bula_minimal.py")
# ---------- end python_script_5 ----------
file_5 = ReadFile(File=python_script_5, PerLineParse=False)
bibil_6 = PythonScript(Code=file_5)

# ---- group: UI
python_script_6 = PythonScript(i=bibil)  # -> o
# ---------- python_script_6: Python ----------
import os

if i:
    o = os.path.join(str(i),"bibil\\bibil_UI.py")
# ---------- end python_script_6 ----------
file_6 = ReadFile(File=python_script_6, PerLineParse=False)

# ---- group: grammar_divide
python_script_7 = PythonScript(i=bibil)  # -> o
# ---------- python_script_7: Python ----------
import os

if i:
    o = os.path.join(str(i),"miru\\miru_divide.py")
# ---------- end python_script_7 ----------
file_7 = ReadFile(File=python_script_7, PerLineParse=False)

# ---- group: grammar_courtyard
python_script_8 = PythonScript(i=bibil)  # -> o
# ---------- python_script_8: Python ----------
import os

if i:
    o = os.path.join(str(i),"miru\\miru_court.py")
# ---------- end python_script_8 ----------
file_8 = ReadFile(File=python_script_8, PerLineParse=False)

# ---- group: grammar_tower
python_script_9 = PythonScript(i=bibil)  # -> o
# ---------- python_script_9: Python ----------
import os

if i:
    o = os.path.join(str(i),"miru\\miru_packing.py")
# ---------- end python_script_9 ----------
file_9 = ReadFile(File=python_script_9, PerLineParse=False)

python_script_10 = PythonScript(i=bibil)  # -> o
# ---------- python_script_10: Python ----------
import os

if i:
    o = os.path.join(str(i),"miru\\miru_stepback.py")
# ---------- end python_script_10 ----------
file_10 = ReadFile(File=python_script_10, PerLineParse=False)

# ---- group: grammar_height
python_script_11 = PythonScript(i=bibil)  # -> o
# ---------- python_script_11: Python ----------
import os

if i:
    o = os.path.join(str(i),"miru\\miru_height.py")
# ---------- end python_script_11 ----------
file_11 = ReadFile(File=python_script_11, PerLineParse=False)

# ---- group: grammar_analysis_pts
python_script_12 = PythonScript(i=bibil)  # -> o
# ---------- python_script_12: Python ----------
import os

if i:
    o = os.path.join(str(i),"miru\\miru_analysis.py")
# ---------- end python_script_12 ----------
file_12 = ReadFile(File=python_script_12, PerLineParse=False)

# ----
# Note: Change this number with caution,
# Increase bounds iterratively.
panel = Panel("0.004")  # disabled

panel_2 = Panel("Yonge and Eglinton")  # disabled
panel_3 = Panel("Redpath Avenue and Roehampton Avenue")  # disabled
location = MosquitoLocation(Location=panel_3)  # -> Address, Points, Type; disabled
item = ListItem(List=location.Points, Index=0, Wrap=True)  # disabled
toggle = BooleanToggle(True)  # disabled
toggle_2 = BooleanToggle(True)  # disabled
toggle_3 = BooleanToggle(True)  # disabled
toggle_4 = BooleanToggle(True)  # disabled
circle = CircleCNR(Center=item, Normal=Vector(0, 0, 1), Radius=panel)  # disabled
vector_maps = VectorMaps(Area=circle, AllRoads=toggle, Buildings=toggle_2, ReProject=toggle_3, CenterToWorld=toggle_4)  # -> RoadLines, RoadInfo, BuildingLines, BuildingInfo, BuildingHeights, AmenityLines, AmenityInfo, AmenityPoints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; disabled
swatch = ColourSwatch(SwatchColor=RGB(0, 0, 0))  # disabled
geo = Geometry([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])  # disabled
geo_2 = Geometry([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])  # disabled
geo_3 = Geometry(Tree({0}: [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], {1}: [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], {2}: [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], {3}: [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], {4}: [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], {5}: [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]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))  # disabled
geo_4 = Geometry([vector_maps.BuildingLines, vector_maps.RoadLines, vector_maps.AmenityLines])  # disabled
preview = CustomPreview(Geometry=[geo_3, geo_2, geo], Shader=swatch)  # disabled

geo_5 = Geometry([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])
geo_6 = Geometry([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])
geo_7 = Geometry([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])
preview_2 = CustomPreview(
    Geometry=geo_7,
    Shader={ambient=RGB(0, 0, 0), diffuse=RGB(255, 105, 180), emission=RGB(76, 32, 54), shine=0.5, specular=RGB(255, 255, 255), transparency=0})
preview_3 = CustomPreview(Geometry=geo_6, Shader=ColourSwatch(SwatchColor=RGB(0, 0, 0)))

# ---- group: TREE RULES
miru = PythonScript(Code=file_8, Run=Toggle(False))  # disabled

# ----
# SITE ANALYSIS SETUP
number_slider = Slider(1, range=0..10)
list_2 = ValueList({"divide by depth": "subdivide_depth", "divide by same depth": "subdivide_depth_same", "divide by dim": "subdivide_dim"}, selected="divide by depth")
list_3 = ValueList({"YZ": "NS", "XZ": "EW", "XY": "Z"}, selected="XZ")
pt = Point(Point(-38.01376635, 994.9472126, 0))
pt_2 = Point(Point(-607.3095526, 828.8831498, 0))
geo_8 = Geometry(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)
circle_2 = CircleCNR(Center=[pt, pt_2], Normal=Vector(0, 0, 1), Radius=Slider(1000, range=0..1000))
geo_9 = Geometry(geo_8)
gentestpts = Honeybee_GenerateTestPoints(testGeometry=geo_9, gridSize="20", distBaseSrf="1", moveTestMesh=True)  # -> readMe, simplify(testPoints), simplify(ptsVectors), simplify(facesArea), simplify(mesh); plug-in component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
geo_10 = Geometry(geo_8)

# ---- group: FORMULA
python = PythonScript(formula="1 / math.exp(0.1813*dist)", focal_ref=[pt, pt_2], focal_weight="1,0.5")  # -> value_ref; inputs focal_ref: list
# ---------- python: Python ----------
"""
Bula Formula
"""
import rhinoscriptsyntax as rs

#Formula handling
#dist = 10.
#val = eval(formula)

focal_ref = map(lambda fr: rs.coerce3dpoint(fr),focal_ref)
focal_weight = map(lambda fw: float(fw), focal_weight.split(','))

value_ref = [formula,focal_ref,focal_weight]
# ---------- end python ----------

# ---- group: DIVIDE
bibil_7 = PythonScript(
    Code=file_7,
    Divide_num=number_slider,
    Divide_cut=Slider(10, range=0..100),
    Divide_type=list_2,
    Divide_ratio=Slider(0.5, range=0..1),
    Axis=list_3,
    Run=Toggle(False))

# ----
geo_11 = Geometry(gentestpts.testPoints)

# ---- group: SITE
geo_12 = Geometry(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)

# ----
bula = PythonScript(
    Code=file_12,
    Analysis_ref=gentestpts.testPoints,
    Value_ref=python,
    Height_bounds="400.,30.",
    Scale=Slider(1, range=0..10),
    Run=Toggle(True))
trinco_park = PythonScript(Code=file_6, Rule_in=[bibil_7, bula], Node_in=geo_10, Label_="site", Run=Toggle(True))  # -> Node_out, Debug
g = PythonScript(node=trinco_park.Node_out)  # -> geom; inputs node: list
# ---------- g: Python ----------
if node and node != []:
    geom = []
    #lot_lst = node.traverse_tree(lambda n:n,internal=False)
    for n in node:
        geom.append(n.shape.bottom_crv)
    print geom
# ---------- end g ----------
g_2 = PythonScript(node=trinco_park.Node_out)  # -> data; inputs node: list
# ---------- g_2: Python ----------
if node and node != []:
    L = []
    #lot_lst = node.traverse_tree(lambda n:n,internal=False)
    #n = node[0].get_root()
    for n in node:
        print n.grammar.type['label']
        print n.grammar.type['bula']
        L.extend(n.grammar.type['bula'].value_lst)
    data = map(lambda d: str(round(d,2))+'%',L)
   
    print data
# ---------- end g_2 ----------
g_3 = PythonScript(node=trinco_park.Node_out)  # -> bula; inputs node: list
# ---------- g_3: Python ----------
if node and node != []:
    geom = []
    #lot_lst = node.traverse_tree(lambda n:n,internal=False)
    #n = node[0].get_root()
    for n in node:
        print n.grammar.type['label']
        print n.grammar.type['bula']
        geom.extend(n.grammar.type['bula'].bpt_viz_lst)
    bula = geom
# ---------- end g_3 ----------
explode = Explode(Curve=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, Recursive=True)  # -> Segments, Vertices
tag = TextTag(Location=g_3, Text=g_2)
dots = DotDisplay(Point=g_3, Colour=ColourSwatch(SwatchColor=RGB(255, 0, 0)), Size=Slider(1, range=0..1))
# BUILDING TYPOLOGY
toggle_5 = BooleanToggle(False)

# ---- group: COURTYARD
miru_2 = PythonScript(Code=file_8, Parent_ref="0", Podium_depth=Slider(21, range=0..100), Node_depth=Slider(1, range=-1..1), Run=Toggle(False))  # disabled

# ---- group: SETBACK
miru_3 = PythonScript(
    Code=file_10,
    Height=Slider(9, range=0..10),
    Distance=Slider(3, range=0..10),
    Geom_ref=explode.Segments,
    Node_ref="-1",
    Run=Toggle(True))

miru_4 = PythonScript(
    Code=file_10,
    Height=Slider(15, range=0..100),
    Distance=Slider(6, range=0..10),
    Geom_ref=explode.Segments,
    Node_ref="-1",
    Run=Toggle(False))

# ---- group: HEIGHT
miru_5 = PythonScript(Code=file_11, Height=Slider(24, range=0..100), Run=Toggle(True))

# ---- group: PACKING
bibil_8 = PythonScript(Code=file_9, Run=toggle_5)

# ----
bibil_9 = PythonScript(
    Code=file_6,
    Rule_in=[miru_5, miru_2, miru_3, miru_4],
    Node_in=trinco_park.Node_out,
    Label_="building",
    Run=Toggle(False))  # -> Node_out, Debug
g_4 = PythonScript(node=bibil_9.Node_out)  # -> geom; inputs node: list
# ---------- g_4: Python ----------
node = filter(lambda n: n!=None,node)
if node and node != []:
    geom = []
    #lot_lst = node.traverse_tree(lambda n:n,internal=False)
    for n in node:
        geom.append(n.shape.geom)
    print geom
# ---------- end g_4 ----------
