# Grasshopper definition bibil_trial_079_MontgomerySquare_4.gh (Grasshopper 0.9.76)
# plug-ins: Python Interpreter, Human, DIVA Daylight, Mosquito

list = ValueList({"dir", "file"}, selected="dir")

# ---- group: find directory
bibil = PythonScript(
    dir=["C:\\Users\\vasanthakumars\\Documents\\GitHub\\bibil\\src", "C:\\saeran\\master\\git\\bibil\\src"],
    type=list,
    run=Toggle(True))  # -> dir; inputs dir: list
# ---------- bibil: Python ----------
import os

ghenv.Component.Params.Output[0].Name = "null"
ghenv.Component.Params.Output[0].NickName = "null"

if run:
    confirm_dir = None
    for d in dir:
        try:
            if type == "file":
                file_ = open(d)
                file_.close()
            else:
                print os.listdir(d)
            confirm_dir = d
            break
        except Exception as e:
            #print str(e)
            continue
    if confirm_dir != None:
        ghenv.Component.Params.Output[0].Name = type
        ghenv.Component.Params.Output[0].NickName = type
        dir = confirm_dir
        file = confirm_dir
null = None
# ---------- end bibil ----------

# ---- group: tree
python_script = PythonScript(i=bibil)  # -> o
# ---------- python_script: Python ----------
import os

if i:
    o = os.path.join(str(i),"bibil\\bibil_tree.py")
# ---------- end python_script ----------
file = ReadFile(File=python_script, PerLineParse=False)
bibil_2 = PythonScript(Code=file)

# ---- group: grammar
python_script_2 = PythonScript(i=bibil)  # -> o
# ---------- python_script_2: Python ----------
import os

if i:
    o = os.path.join(str(i),"bibil\\bibil_grammar.py")
# ---------- end python_script_2 ----------
file_2 = ReadFile(File=python_script_2, PerLineParse=False)
bibil_3 = PythonScript(Code=file_2)

# ---- group: shape
python_script_3 = PythonScript(i=bibil)  # -> o
# ---------- python_script_3: Python ----------
import os

if i:
    o = os.path.join(str(i),"bibil\\bibil_shape.py")
#o = os.path.join(str(i),"research\\bibil_shape_shape_3d_2d.py")
# ---------- end python_script_3 ----------
file_3 = ReadFile(File=python_script_3, PerLineParse=False)
bibil_4 = PythonScript(Code=file_3)

# ---- group: miru
python_script_4 = PythonScript(i=bibil)  # -> o
# ---------- python_script_4: Python ----------
import os

if i:
    o = os.path.join(str(i),"miru\\miru_miru.py")
# ---------- end python_script_4 ----------
file_4 = ReadFile(File=python_script_4, PerLineParse=False)
bibil_5 = PythonScript(Code=file_4)

# ---- group: bula
python_script_5 = PythonScript(i=bibil)  # -> o
# ---------- python_script_5: Python ----------
import os

if i:
    o = os.path.join(str(i),"bula\\bula_minimal.py")
# ---------- end python_script_5 ----------
file_5 = ReadFile(File=python_script_5, PerLineParse=False)
bibil_6 = PythonScript(Code=file_5)

# ---- group: UI
python_script_6 = PythonScript(i=bibil)  # -> o
# ---------- python_script_6: Python ----------
import os

if i:
    o = os.path.join(str(i),"bibil\\bibil_UI.py")
# ---------- end python_script_6 ----------
file_6 = ReadFile(File=python_script_6, PerLineParse=False)

# ---- group: grammar_divide
python_script_7 = PythonScript(i=bibil)  # -> o
# ---------- python_script_7: Python ----------
import os

if i:
    o = os.path.join(str(i),"miru\\miru_divide.py")
# ---------- end python_script_7 ----------
file_7 = ReadFile(File=python_script_7, PerLineParse=False)

# ---- group: grammar_courtyard
python_script_8 = PythonScript(i=bibil)  # -> o
# ---------- python_script_8: Python ----------
import os

if i:
    o = os.path.join(str(i),"miru\\miru_court.py")
# ---------- end python_script_8 ----------
file_8 = ReadFile(File=python_script_8, PerLineParse=False)

# ---- group: grammar_tower
python_script_9 = PythonScript(i=bibil)  # -> o
# ---------- python_script_9: Python ----------
import os

if i:
    o = os.path.join(str(i),"miru\\miru_packing.py")
# ---------- end python_script_9 ----------
file_9 = ReadFile(File=python_script_9, PerLineParse=False)

python_script_10 = PythonScript(i=bibil)  # -> o
# ---------- python_script_10: Python ----------
import os

if i:
    o = os.path.join(str(i),"miru\\miru_stepback.py")
# ---------- end python_script_10 ----------
file_10 = ReadFile(File=python_script_10, PerLineParse=False)

# ---- group: grammar_height
python_script_11 = PythonScript(i=bibil)  # -> o
# ---------- python_script_11: Python ----------
import os

if i:
    o = os.path.join(str(i),"miru\\miru_height.py")
# ---------- end python_script_11 ----------
file_11 = ReadFile(File=python_script_11, PerLineParse=False)

# ---- group: grammar_analysis_pts
python_script_12 = PythonScript(i=bibil)  # -> o
# ---------- python_script_12: Python ----------
import os

if i:
    o = os.path.join(str(i),"miru\\miru_analysis.py")
# ---------- end python_script_12 ----------
file_12 = ReadFile(File=python_script_12, PerLineParse=False)

# ---- group: meta_tree
python_script_13 = PythonScript(i=bibil)  # -> o
# ---------- python_script_13: Python ----------
import os

if i:
    o = os.path.join(str(i),"miru\\miru_meta_tree.py")
# ---------- end python_script_13 ----------
file_13 = ReadFile(File=python_script_13, PerLineParse=False)

# ---- group: OPTION 2
geo = Geometry([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])

# ---- group: OPTION 1
geo_2 = Geometry([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])

# ----
# Note: Change this number with caution,
# Increase bounds iterratively.
panel = Panel("0.004")  # disabled

panel_2 = Panel("Yonge and Eglinton")  # disabled
panel_3 = Panel("Redpath Avenue and Roehampton Avenue")  # disabled
location = MosquitoLocation(Location=panel_3)  # -> Address, Points, Type; disabled
item = ListItem(List=location.Points, Index=0, Wrap=True)  # disabled
toggle = BooleanToggle(True)  # disabled
toggle_2 = BooleanToggle(True)  # disabled
toggle_3 = BooleanToggle(True)  # disabled
toggle_4 = BooleanToggle(True)  # disabled
circle = CircleCNR(Center=item, Normal=Vector(0, 0, 1), Radius=panel)  # disabled
vector_maps = VectorMaps(Area=circle, AllRoads=toggle, Buildings=toggle_2, ReProject=toggle_3, CenterToWorld=toggle_4)  # -> RoadLines, RoadInfo, BuildingLines, BuildingInfo, BuildingHeights, AmenityLines, AmenityInfo, AmenityPoints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; disabled
swatch = ColourSwatch(SwatchColor=RGB(0, 0, 0))  # disabled
geo_3 = Geometry([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])  # disabled
geo_4 = Geometry([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])  # disabled
geo_5 = Geometry(Tree({0}: [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], {1}: [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], {2}: [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], {3}: [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], {4}: [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], {5}: [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]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))  # disabled
geo_6 = Geometry([vector_maps.BuildingLines, vector_maps.RoadLines, vector_maps.AmenityLines])  # disabled
preview = CustomPreview(Geometry=[geo_5, geo_4, geo_3], Shader=swatch)  # disabled

list_2 = ValueList({"divide by depth": "subdivide_depth", "divide by same depth": "subdivide_depth_same", "divide by dim": "subdivide_dim"}, selected="divide by depth")

# ---- group: cpt
vec = Vector(Vector(-545550.1884, 3982019.542, 0))

# ---- group: refYEvec
vec_2 = Vector(Vector(-545759.5384, 3981844.461, 0))

# ---- group: GEOREF
vec_3 = Vector(Vector(-546054.4782, 3981714.967, 0))

# ---- group: CPT
vec_4 = Vector(Vector(10.25901059, -146.005907, 0))

# ----
list_3 = ValueList({"YZ": "NS", "XZ": "EW", "XY": "Z"}, selected="XZ")

# ---- group: dir2cpt
subtraction = Subtraction(A=vec, B=vec_2)

# ----
toggle_5 = BooleanToggle(False)  # disabled

# ---- group: A=pt2move2
subtraction_2 = Subtraction(A=vec_3, B=vec_4)

# ---- group: COURTYARD
miru = PythonScript(Code=file_8, Podium_depth=Slider(21, range=0..100), Node_depth=Slider(1, range=-1..1), Run=Toggle(True))  # disabled

# ----
geo_7 = Geometry([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])

# ---- group: DIVIDE
bibil_7 = PythonScript(
    Code=file_7,
    Divide_num=Slider(1, range=0..10),
    Divide_cut=Slider(10, range=0..100),
    Divide_type=list_2,
    Divide_ratio=Slider(0.5, range=0..1),
    Axis=list_3,
    Run=Toggle(False))  # disabled

# ---- group: PACKING
bibil_8 = PythonScript(Code=file_9, Run=toggle_5)  # disabled

# ----
move = Move(Motion=subtraction)  # -> Geometry, Transform
move_2 = Move(Geometry=geo_7, Motion=subtraction_2)  # -> Geometry, Transform
geo_8 = Geometry(move_2.Geometry)

# ---- group: SITE BOUNDARY
geo_9 = Geometry(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)

# ----
boundary = BoundarySurfaces(Edges=geo_9)
pt = Point(Point(-546015.9294, 3981548.423, 0))
gentestpts = Honeybee_GenerateTestPoints(testGeometry=boundary, gridSize="10", distBaseSrf="1", moveTestMesh=True)  # -> readMe, simplify(testPoints), simplify(ptsVectors), simplify(facesArea), simplify(mesh); plug-in component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

# ---- group: FORMULA
python = PythonScript(formula="1 / math.exp(0.1813*dist)", focal_ref=pt, height_ref="112.5", smooth=Slider(1, range=0..5))  # -> value_ref; inputs focal_ref: list
# ---------- python: Python ----------
"""
Bula Formula
"""
import rhinoscriptsyntax as rs

#Formula handling
#dist = 10.
#val = eval(formula)

focal_ref = map(lambda fr: rs.coerce3dpoint(fr),focal_ref)
focal_heights = map(lambda fw: float(fw), height_ref.split(','))
smooth_factor = smooth 
value_ref = [formula,focal_ref,focal_heights,smooth_factor]
# ---------- end python ----------

# ----
bula = PythonScript(Code=file_12, Analysis_ref=gentestpts.testPoints, Value_ref=python, Run=Toggle(True))
number_slider = Slider(2, range=0..10)  # disabled
number_slider_2 = Slider(0.5, range=0..1)  # disabled
number_slider_3 = Slider(10, range=0..100)  # disabled
list_4 = ValueList({"divide by depth": "subdivide_depth", "divide by same depth": "subdivide_depth_same", "divide by dim": "subdivide_dim"}, selected="divide by depth")  # disabled
trinco_park = PythonScript(Code=file_6, Rule_in=flatten(bula), Node_in=flatten(boundary), Label_="pedestrianBulaRef", Run=Toggle(True))  # -> Node_out, Debug
# SITE ANALYSIS SETUP
toggle_6 = BooleanToggle(True)  # disabled
list_5 = ValueList({"YZ": "NS", "XZ": "EW", "XY": "Z"}, selected="YZ")  # disabled
g = PythonScript(node=trinco_park.Node_out)  # -> geom; inputs node: list
# ---------- g: Python ----------
if node and node != []:
    geom = []
    #lot_lst = node.traverse_tree(lambda n:n,internal=False)
    for n in node:
        #print n.grammar.type.has_key('bula')
        print n
        print n.parent
        #print n.grammar.type['bula']
        geom.append(n.shape.bottom_crv)
    #print geom
# ---------- end g ----------
g_2 = PythonScript(node=trinco_park.Node_out)  # -> bula; inputs node: list
# ---------- g_2: Python ----------
if node and node != []:
    geom = []
    #lot_lst = node.traverse_tree(lambda n:n,internal=False)
    #n = node[0].get_root()
    for n in node:
        
        print n.grammar.type['label']
        print n.grammar.type['bula']
        if n.grammar.type['bula'] == True:
            geom.extend(n.grammar.type['bula_data'].bpt_viz_lst)
    bula = geom
# ---------- end g_2 ----------
g_3 = PythonScript(node=trinco_park.Node_out)  # -> data; inputs node: list
# ---------- g_3: Python ----------
if node and node != []:
    L = []
    #lot_lst = node.traverse_tree(lambda n:n,internal=False)
    #n = node[0].get_root()
    for n in node:
        print n.grammar.type['label']
        if n.grammar.type['bula']:
            L.extend(n.grammar.type['bula_data'].value_lst)
    data = map(lambda d: str(round(d,2))+'%',L)
   
    print data
# ---------- end g_3 ----------

# ---- group: DIVIDE
bibil_9 = PythonScript(
    Code=file_7,
    Divide_num=number_slider,
    Divide_cut=number_slider_3,
    Divide_type=list_4,
    Divide_ratio=number_slider_2,
    Axis=list_5,
    Run=toggle_6)  # disabled

# ----
toggle_7 = BooleanToggle(True)  # disabled
panel_4 = Panel("roottest")  # disabled
tag = TextTag(Location=g_2, Text=g_3)
geo_10 = Geometry(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)  # disabled
trinco_park_2 = PythonScript(Code=file_6, Rule_in=bibil_9, Node_in=geo_10, Label_=panel_4, Run=toggle_7)  # -> Node_out, Debug; disabled
g_4 = PythonScript(node=trinco_park_2.Node_out)  # -> geom; inputs node: list; disabled
# ---------- g_4: Python ----------
if node and node != []:
    geom = []
    for n in node:
        #lot_lst = n.traverse_tree(lambda n:n.shape.geom,internal=False)
        geom.append(n.shape.geom)#lot_lst)
    print geom
# ---------- end g_4 ----------

# ---- group: root test
# BUILDING TYPOLOGY
# BUILDING TYPOLOGY
g_5 = PythonScript(node=trinco_park_2.Node_out)  # -> geom; inputs node: list; disabled
# ---------- g_5: Python ----------
if node and node != []:
    geom = []
    for n in node:
        #print 'label: ', n.parent.grammar.type['label']
        geom.append(n.shape.geom)
    
    node[0].grammar.type['label'] = 'leaftest'
    
    print '----'
    root = node[0].get_root()
    #print root.grammar.type['label']
    lstleaf = root.traverse_tree(lambda n: n,internal=False)
    for leaf in lstleaf:
        print leaf.grammar.type['label']
    print '----'
    
    
    node[0].grammar.type['label'] = 'revisedleaftest'
    node[1].grammar.type['label'] = 'revisedtest'
    
    lstleaf = root.traverse_tree(lambda n: n,internal=False)
    for leaf in lstleaf:
        print leaf.grammar.type['label']
    print '----'
# ---------- end g_5 ----------

# ---- group: plane_angle
number_slider_4 = Slider(-45, range=-100..100)

# ----
path = FilePath("C:\Users\vasanthakumars\Documents\GitHub\bibil\src\reference\CAN_ON_Toronto.716240_CWEC\CAN_ON_Toronto.716240_CWEC.epw")

# ---- group: PLANE 1
geo_11 = Geometry(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)

# ---- group: PLANE 2
geo_12 = Geometry(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)

# ---- group: SETBACKS LINES
geo_13 = Geometry([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])

# ---- group: PODIUM CURVES
# MIDRISE 2
geo_14 = Geometry([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])

# ----
# MIDRISE 1
number_slider_5 = Slider(15, range=0..100)

# ---- group: SETBACKS LINES
geo_15 = Geometry([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])

# ---- group: PODIUM CURVES
geo_16 = Geometry([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])

# ----
importepw = Ladybug_ImportEpw(epwFile=path)  # -> readMe, latitude, location, dryBulbTemperature, dewPointTemperature, relativeHumidity, windSpeed, windDirection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; plug-in component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
ladybug = Ladybug_Ladybug()  # -> Vviiiiiiiiiizzz; plug-in component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
geo_17 = Geometry(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)
rad = Radians(Degrees=number_slider_4)
geo_18 = Geometry(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)
rad_2 = Radians(Degrees=number_slider_4)

# ---- group: SETBACK
miru_2 = PythonScript(
    Code=file_10,
    Height=Slider(12, range=0..100),
    Distance=Slider(6, range=0..10),
    Geom_ref=geo_15,
    Node_ref="-1",
    Run=Toggle(True))

# ---- group: HEIGHT
miru_3 = PythonScript(Code=file_11, Height=number_slider_5, Run=Toggle(True))

# ----
number_slider_6 = Slider(9, range=0..10)
number_slider_7 = Slider(21, range=0..100)

# ---- group: HEIGHT
miru_4 = PythonScript(Code=file_11, Height=Slider(15, range=0..100), Run=Toggle(True))

# ---- group: SETBACK
miru_5 = PythonScript(Code=file_10, Height=["6", "12"], Distance=["6", "12"], Geom_ref=geo_13, Node_ref="-1", Run=Toggle(True))

# ----
rotax = RotateAxis(Geometry=geo_11, Angle=rad, Axis=geo_17)  # -> Geometry, Transform
rotax_2 = RotateAxis(Geometry=geo_18, Angle=rad_2, Axis=geo_12)  # -> Geometry, Transform

sun_pos = SunPosition(
    Location=path,
    Month=number_slider_6,
    Day=number_slider_7,
    Hour=12,
    BooleanValue_0=False,
    BooleanValue_1=False,
    BooleanValue_2=False,
    BooleanValue_3=False,
    BooleanValue_4=False,
    BooleanValue_5=False,
    BooleanValue_6=False,
    BooleanValue_7=False,
    Color_0=RGBA(0, 0, 0, 0),
    Color_1=RGBA(0, 0, 0, 0),
    Color_2=RGBA(0, 0, 0, 0),
    Color_3=RGBA(0, 0, 0, 0),
    Color_4=RGBA(0, 0, 0, 0),
    Color_5=RGBA(0, 0, 0, 0),
    Color_6=RGBA(0, 0, 0, 0),
    Color_7=RGBA(0, 0, 0, 0),
    Hidden_0=False,
    Hidden_1=True,
    Hidden_2=True,
    Hidden_3=True,
    Hidden_4=True,
    Hidden_5=False,
    Hidden_6=False,
    Hidden_7=False,
    IntegerValue_0=-2147483648,
    IntegerValue_1=-2147483648,
    IntegerValue_2=-2147483648,
    IntegerValue_3=-2147483648,
    IntegerValue_4=-2147483648,
    IntegerValue_5=9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)  # -> SolarVector, Azimuth, Altitude
sun_pos_2 = SunPosition(
    Location=path,
    Month=number_slider_6,
    Day=number_slider_7,
    Hour=12,
    BooleanValue_0=False,
    BooleanValue_1=False,
    BooleanValue_2=False,
    BooleanValue_3=False,
    BooleanValue_4=False,
    BooleanValue_5=False,
    BooleanValue_6=False,
    BooleanValue_7=False,
    Color_0=RGBA(0, 0, 0, 0),
    Color_1=RGBA(0, 0, 0, 0),
    Color_2=RGBA(0, 0, 0, 0),
    Color_3=RGBA(0, 0, 0, 0),
    Color_4=RGBA(0, 0, 0, 0),
    Color_5=RGBA(0, 0, 0, 0),
    Color_6=RGBA(0, 0, 0, 0),
    Color_7=RGBA(0, 0, 0, 0),
    Hidden_0=False,
    Hidden_1=True,
    Hidden_2=True,
    Hidden_3=True,
    Hidden_4=True,
    Hidden_5=False,
    Hidden_6=False,
    Hidden_7=False,
    IntegerValue_0=-2147483648,
    IntegerValue_1=-2147483648,
    IntegerValue_2=-2147483648,
    IntegerValue_3=-2147483648,
    IntegerValue_4=-2147483648,
    IntegerValue_5=9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)  # -> SolarVector, Azimuth, Altitude
multiplication = Multiplication(A=[sun_pos.SolarVector, sun_pos_2.SolarVector], B=Slider(300, range=0..1000))
pt_2 = Point(multiplication)
pt_3 = Point([Point(-17.89049319, 160.9898411, 0), Point(-39.04381231, 157.7749922, 0), Point(12.64935323, -173.781392, 0), Point(33.26248411, -169.6865549, 0)])
ln = Line(StartPoint=pt_3, EndPoint=multiplication)

# ---- group: solar input curve
geo_19 = Geometry(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)

# ----
analysisperiod = Ladybug_AnalysisPeriod(
    fromMonth=number_slider_6,
    fromDay=number_slider_7,
    fromHour=Slider(11.25, range=0..100),
    toMonth=number_slider_6,
    toDay=number_slider_7,
    toHour=Slider(14.25, range=0..100))  # -> readMe, analysisPeriod; plug-in component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
wires = BrepWireframe(Brep=[rotax.Geometry, rotax_2.Geometry], Density=-1)
toggle_8 = BooleanToggle(True)
toggle_9 = BooleanToggle(True)
list_6 = ValueList({"root"}, selected="root")
material = CreateMaterial(
    Diffuse=ColourSwatch(SwatchColor=RGB(114, 145, 107)),
    Specular=RGB(255, 255, 255),
    Emission=RGB(0, 0, 0),
    Transparency=Slider(0.8, range=0..1),
    Shine=0)
list_7 = ValueList({"root"}, selected="root")
solarfanbasic = Ladybug_SolarFanBasic(
    boundary=geo_19,
    location=importepw.location,
    requiredHours=Slider(1, range=0..10),
    height=Slider(175, range=0..1000),
    analysisPeriod=analysisperiod.analysisPeriod)  # -> readMe, solarFan; plug-in component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
solarfan = Ladybug_SolarFan()  # -> readMe, solarFan; plug-in component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

# ---- group: TREE RULES
miru_6 = PythonScript(Code=file_13, Node=trinco_park.Node_out, Relation=list_6, Insert=toggle_8, Run=toggle_8)

# ----
geometry = Geometry(g_2)

# ---- group: TREE RULES
miru_7 = PythonScript(Code=file_13, Node=trinco_park.Node_out, Relation=list_7, Insert=toggle_9, Run=toggle_9)

# ----
geo_20 = Geometry(solarfanbasic.solarFan)

# ---- group: SOLAER
geo_21 = Geometry(geo_20)

# ----
python_2 = PythonScript(pts=gentestpts.testPoints, brep=[rotax.Geometry, rotax_2.Geometry, geo_21], run=Toggle(True))  # -> flatten(project); inputs pts: list
# ---------- python_2: Python ----------
import rhinoscriptsyntax as rs
import Rhino as rc
import scriptcontext as sc

if run:
    debug = []
    dir = rc.Geometry.Vector3d(0,0,1) 
    tol = sc.doc.ModelAbsoluteTolerance
    env = [rs.coercebrep(brep)]
    ptlst = map(lambda p: rs.coerce3dpoint(p),pts)
    
    projlst = rc.Geometry.Intersect.Intersection.ProjectPointsToBreps(env,ptlst,dir,tol)
    #print projlst
    #projlst = filter(lambda pt:abs(pt[2]-200.)>0.5,projlst)
    projlst = filter(lambda p: abs(p[2]-0)>1.,projlst)
    
    if projlst:
        debug.extend(projlst)
        #min_index = projlst.index(min(projlst,key=lambda p:p[2]))
        #min_pt = projlst[min_index]
        #envht = min_pt[2]
    project = debug
# ---------- end python_2 ----------
devec = DeconstructVector(Vector=flatten(python_2))  # -> XComponent, YComponent, ZComponent
geo_22 = Geometry(python_2)
preview_2 = CustomPreview(Geometry=[geo_21, rotax_2.Geometry, rotax.Geometry], Shader=material)
dots = DotDisplay(Point=[geometry, geo_22], Colour=RGB(0, 0, 0), Size=Slider(1, range=0..10))

# ---- group: MIDRISE
bibil_10 = PythonScript(
    Code=file_6,
    Rule_in=flatten([miru_6, miru_3, miru_2]),
    Node_in=flatten(geo_16),
    Label_="midrise_podium",
    Run=Toggle(True))  # -> Node_out, Debug

# ----
material_2 = CreateMaterial(
    Diffuse=ColourSwatch(SwatchColor=RGB(0, 255, 107)),
    Specular=RGB(255, 255, 255),
    Emission=RGB(0, 0, 0),
    Transparency=Slider(0.75, range=0..1),
    Shine=0)

# ---- group: MIDRISE
bibil_11 = PythonScript(
    Code=file_6,
    Rule_in=flatten([miru_7, miru_4, miru_5]),
    Node_in=flatten(geo_14),
    Label_="midrise_podium",
    Run=Toggle(True))  # -> Node_out, Debug

# ----
preview_3 = CustomPreview(Geometry=solarfanbasic.solarFan, Shader=material_2)

# ---- group: TOWER SEP
panel_5 = Panel("25")

# ---- group: EXISTING TOWERS
geo_23 = Geometry([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])

# ---- group: TOWER CURVES
geo_24 = Geometry([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])

# ----
toggle_10 = BooleanToggle(True)
list_8 = ValueList({"root"}, selected="root")
bula_2 = PythonScript(Code=file_12, Analysis_ref=flatten(python_2), Value_ref=flatten(devec.ZComponent), Run=Toggle(True))

# ---- group: TREE RULES
miru_8 = PythonScript(Code=file_13, Node=trinco_park.Node_out, Relation=list_8, Insert=toggle_10, Run=toggle_10)

# ---- group: HEIGHT
miru_9 = PythonScript(Code=file_11, Height="bula", Run=Toggle(True))

# ---- group: MIDRISE
g_6 = PythonScript(node=[bibil_10.Node_out, bibil_11.Node_out])  # -> geom; inputs node: list
# ---------- g_6: Python ----------
node = filter(lambda n: n!=None,node)
if node and node != []:
    geom = []
    for n in node:
        print n.get_root()
        print n.parent.parent
        print n
        geom.append(n.shape.geom)
    print geom
# ---------- end g_6 ----------

# ---- group: EXISTING TOWERS
bibil_12 = PythonScript(Code=file_6, Node_in=flatten(geo_23), Label_="exist_tower", Run=Toggle(True))  # -> Node_out, Debug

# ---- group: Block outlines
geo_25 = Geometry([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])

# ---- group: Soft Sites ref
geo_26 = Geometry([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])

# ---- group: TOWERS
bibil_13 = PythonScript(Code=file_6, Rule_in=flatten([miru_8, bula_2, miru_9]), Node_in=flatten(geo_24), Label_="hiriseType", Run=Toggle(True))  # -> Node_out, Debug

# ---- group: HIGHRISE
g_7 = PythonScript(node=bibil_13.Node_out)  # -> geom; inputs node: list
# ---------- g_7: Python ----------
node = filter(lambda n: n!=None,node)
if node and node != []:
    geom = []
    for n in node:
        #print n.get_root()
        print n
        print n.parent
        #print n.parent.parent
        #print n.parent.parent.parent
        #print n.parent.parent.parent.parent
        #print '---'
        geom.append(n.shape.geom)
    #print geom
# ---------- end g_7 ----------

# ----
g_8 = PythonScript(node=bibil_12.Node_out)  # -> geom; inputs node: list
# ---------- g_8: Python ----------
import rhinoscriptsyntax as rs
import scriptcontext as sc
node = filter(lambda n: n!=None,node)
if node and node != []:
    geom = []
    for n in node:
        #print n.get_root()
        #print n.parent
        crv = n.shape.bottom_crv
        if n.shape.cpt[2] > 0.0:
            crv = sc.doc.Objects.AddCurve(crv)
            crv = rs.MoveObject(crv,[0,0,n.shape.cpt[2]*-1])
        geom.append(crv)
        
    #print geom
# ---------- end g_8 ----------
preview_4 = CustomPreview(Geometry=[geo_26, geo_25], Shader=ColourSwatch(SwatchColor=RGB(51, 51, 51)))
g_9 = PythonScript(node=bibil_13.Node_out)  # -> geom; inputs node: list
# ---------- g_9: Python ----------
node = filter(lambda n: n!=None,node)
if node and node != []:
    geom = []
    for n in node:
        #print n.get_root()
        print n
        print n.parent
        #print n.parent.parent
        #print n.parent.parent.parent
        #print n.parent.parent.parent.parent
        #print '---'
        geom.append(n.shape.bottom_crv)
    #print geom
# ---------- end g_9 ----------
material_3 = CreateMaterial(
    Diffuse=ColourSwatch(SwatchColor=RGB(56, 56, 56)),
    Specular=RGB(255, 255, 255),
    Emission=RGB(0, 0, 0),
    Transparency=Slider(0.5, range=0..1),
    Shine=0)
offset = Offset(Curve=g_9, Distance=panel_5, Plane=PlaneXY(0, 0, 0), Corners="2")
offset_2 = Offset(Curve=g_8, Distance=panel_5, Plane=PlaneXY(0, 0, 0), Corners="2")
boundary_2 = BoundarySurfaces(Edges=[offset, offset_2])
preview_5 = CustomPreview(Geometry=[g_6, g_7], Shader=material_3)
material_4 = CreateMaterial(
    Diffuse=RGB(255, 105, 180),
    Specular=RGB(255, 255, 255),
    Emission=RGB(0, 0, 0),
    Transparency=Slider(0.8, range=0..1),
    Shine=0)
preview_6 = CustomPreview(Geometry=boundary_2, Shader=material_4)
# 4VIZ
previewlw = CustomPreviewLineweights(
    Geometry=[offset, offset_2],
    Shader={ambient=RGB(0, 0, 0), diffuse=RGB(255, 105, 180), emission=RGB(76, 32, 54), shine=0.5, specular=RGB(255, 255, 255), transparency=0},
    Thickness=Slider(5, range=0..10),
    Absolute=False)
