# Grasshopper definition bibil_trial_080_Davisville.gh (Grasshopper 0.9.76)
# plug-ins: Python Interpreter, Mosquito

list = ValueList({"dir", "file"}, selected="dir")

# ---- group: find directory
bibil = PythonScript(
    dir=["C:\\Users\\vasanthakumars\\Documents\\GitHub\\bibil\\src", "C:\\saeran\\master\\git\\bibil\\src"],
    type=list,
    run=Toggle(True))  # -> dir; inputs dir: list
# ---------- bibil: Python ----------
import os

ghenv.Component.Params.Output[0].Name = "null"
ghenv.Component.Params.Output[0].NickName = "null"

if run:
    confirm_dir = None
    for d in dir:
        try:
            if type == "file":
                file_ = open(d)
                file_.close()
            else:
                print os.listdir(d)
            confirm_dir = d
            break
        except Exception as e:
            #print str(e)
            continue
    if confirm_dir != None:
        ghenv.Component.Params.Output[0].Name = type
        ghenv.Component.Params.Output[0].NickName = type
        dir = confirm_dir
        file = confirm_dir
null = None
# ---------- end bibil ----------

# ---- group: tree
python_script = PythonScript(i=bibil)  # -> o
# ---------- python_script: Python ----------
import os

if i:
    o = os.path.join(str(i),"bibil\\bibil_tree.py")
# ---------- end python_script ----------
file = ReadFile(File=python_script, PerLineParse=False)
bibil_2 = PythonScript(Code=file)

# ---- group: grammar
python_script_2 = PythonScript(i=bibil)  # -> o
# ---------- python_script_2: Python ----------
import os

if i:
    o = os.path.join(str(i),"bibil\\bibil_grammar.py")
# ---------- end python_script_2 ----------
file_2 = ReadFile(File=python_script_2, PerLineParse=False)
bibil_3 = PythonScript(Code=file_2)

# ---- group: shape
python_script_3 = PythonScript(i=bibil)  # -> o
# ---------- python_script_3: Python ----------
import os

if i:
    o = os.path.join(str(i),"bibil\\bibil_shape.py")
#o = os.path.join(str(i),"research\\bibil_shape_shape_3d_2d.py")
# ---------- end python_script_3 ----------
file_3 = ReadFile(File=python_script_3, PerLineParse=False)
bibil_4 = PythonScript(Code=file_3)

# ---- group: miru
python_script_4 = PythonScript(i=bibil)  # -> o
# ---------- python_script_4: Python ----------
import os

if i:
    o = os.path.join(str(i),"miru\\miru_miru.py")
# ---------- end python_script_4 ----------
file_4 = ReadFile(File=python_script_4, PerLineParse=False)
bibil_5 = PythonScript(Code=file_4)

# ---- group: bula
python_script_5 = PythonScript(i=bibil)  # -> o
# ---------- python_script_5: Python ----------
import os

if i:
    o = os.path.join(str(i),"bula\\bula_minimal.py")
# ---------- end python_script_5 ----------
file_5 = ReadFile(File=python_script_5, PerLineParse=False)
bibil_6 = PythonScript(Code=file_5)

# ---- group: UI
python_script_6 = PythonScript(i=bibil)  # -> o
# ---------- python_script_6: Python ----------
import os

if i:
    o = os.path.join(str(i),"bibil\\bibil_UI.py")
# ---------- end python_script_6 ----------
file_6 = ReadFile(File=python_script_6, PerLineParse=False)

# ---- group: grammar_divide
python_script_7 = PythonScript(i=bibil)  # -> o
# ---------- python_script_7: Python ----------
import os

if i:
    o = os.path.join(str(i),"miru\\miru_divide.py")
# ---------- end python_script_7 ----------
file_7 = ReadFile(File=python_script_7, PerLineParse=False)

# ---- group: grammar_courtyard
python_script_8 = PythonScript(i=bibil)  # -> o
# ---------- python_script_8: Python ----------
import os

if i:
    o = os.path.join(str(i),"miru\\miru_court.py")
# ---------- end python_script_8 ----------
file_8 = ReadFile(File=python_script_8, PerLineParse=False)

# ---- group: grammar_tower
python_script_9 = PythonScript(i=bibil)  # -> o
# ---------- python_script_9: Python ----------
import os

if i:
    o = os.path.join(str(i),"miru\\miru_packing.py")
# ---------- end python_script_9 ----------
file_9 = ReadFile(File=python_script_9, PerLineParse=False)

python_script_10 = PythonScript(i=bibil)  # -> o
# ---------- python_script_10: Python ----------
import os

if i:
    o = os.path.join(str(i),"miru\\miru_stepback.py")
# ---------- end python_script_10 ----------
file_10 = ReadFile(File=python_script_10, PerLineParse=False)

# ---- group: grammar_height
python_script_11 = PythonScript(i=bibil)  # -> o
# ---------- python_script_11: Python ----------
import os

if i:
    o = os.path.join(str(i),"miru\\miru_height.py")
# ---------- end python_script_11 ----------
file_11 = ReadFile(File=python_script_11, PerLineParse=False)

# ---- group: grammar_analysis_pts
python_script_12 = PythonScript(i=bibil)  # -> o
# ---------- python_script_12: Python ----------
import os

if i:
    o = os.path.join(str(i),"miru\\miru_analysis.py")
# ---------- end python_script_12 ----------
file_12 = ReadFile(File=python_script_12, PerLineParse=False)

# ----
# Note: Change this number with caution,
# Increase bounds iterratively.
panel = Panel("0.004")  # disabled

panel_2 = Panel("Yonge and Eglinton")  # disabled
panel_3 = Panel("Redpath Avenue and Roehampton Avenue")  # disabled
location = MosquitoLocation(Location=panel_3)  # -> Address, Points, Type; disabled
item = ListItem(List=location.Points, Index=0, Wrap=True)  # disabled
toggle = BooleanToggle(True)  # disabled
toggle_2 = BooleanToggle(True)  # disabled
toggle_3 = BooleanToggle(True)  # disabled
toggle_4 = BooleanToggle(True)  # disabled
circle = CircleCNR(Center=item, Normal=Vector(0, 0, 1), Radius=panel)  # disabled
vector_maps = VectorMaps(Area=circle, AllRoads=toggle, Buildings=toggle_2, ReProject=toggle_3, CenterToWorld=toggle_4)  # -> RoadLines, RoadInfo, BuildingLines, BuildingInfo, BuildingHeights, AmenityLines, AmenityInfo, AmenityPoints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; disabled
swatch = ColourSwatch(SwatchColor=RGB(0, 0, 0))  # disabled
geo = Geometry([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])  # disabled
geo_2 = Geometry([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])  # disabled
geo_3 = Geometry(Tree({0}: [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], {1}: [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], {2}: [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], {3}: [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], {4}: [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], {5}: [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]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))  # disabled
geo_4 = Geometry([vector_maps.BuildingLines, vector_maps.RoadLines, vector_maps.AmenityLines])  # disabled
preview = CustomPreview(Geometry=[geo_3, geo_2, geo], Shader=swatch)  # disabled

# ---- group: cpt
vec = Vector(Vector(-545550.1884, 3982019.542, 0))

# ---- group: refYEvec
vec_2 = Vector(Vector(-545759.5384, 3981844.461, 0))

# ---- group: dir2cpt
subtraction = Subtraction(A=vec, B=vec_2)

# ----
move = Move(Motion=subtraction)  # -> Geometry, Transform
list_2 = ValueList({"divide by depth": "subdivide_depth", "divide by same depth": "subdivide_depth_same", "divide by dim": "subdivide_dim"}, selected="divide by depth")
list_3 = ValueList({"YZ": "NS", "XZ": "EW", "XY": "Z"}, selected="XZ")
toggle_5 = BooleanToggle(False)  # disabled

# ---- group: DIVIDE
# ANALYSIS
bibil_7 = PythonScript(
    Code=file_7,
    Divide_num=Slider(1, range=0..10),
    Divide_cut=Slider(10, range=0..100),
    Divide_type=list_2,
    Divide_ratio=Slider(0.5, range=0..1),
    Axis=list_3,
    Run=Toggle(False))  # disabled

# ---- group: TREE RULES
miru = PythonScript(Code=file_8, Run=Toggle(False))  # disabled

# ---- group: PACKING
bibil_8 = PythonScript(Code=file_9, Run=toggle_5)  # disabled

# ---- group: GIS REF
# SITE REFERENCES
swatch_2 = ColourSwatch(SwatchColor=RGB(31, 102, 52))
geo_5 = Geometry([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])
preview_2 = CustomPreview(Geometry=geo_5, Shader=swatch_2)

# ---- group: BLOCK PERIMETER
geo_6 = Geometry([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])

# ---- group: TOWER_BO_REF
geo_7 = Geometry([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])

# ---- group: REF_SOFTSITE
geo_8 = Geometry([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])

# ---- group: PROPOSED
geo_9 = Geometry([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])

# ---- group: APPROVED
geo_10 = Geometry([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])

# ---- group: EXISTING
geo_11 = Geometry([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])

# ----
boundary = BoundarySurfaces(Edges=geo_8)

boundary_2 = BoundarySurfaces(Edges=geo_6)
preview_3 = CustomPreview(
    Geometry=boundary_2,
    Shader={ambient=RGB(0, 0, 0), diffuse=RGB(255, 105, 180), emission=RGB(76, 32, 54), shine=0.5, specular=RGB(255, 255, 255), transparency=0})

path = FilePath("C:\Users\vasanthakumars\Documents\GitHub\bibil\src\reference\CAN_ON_Toronto.716240_CWEC\CAN_ON_Toronto.716240_CWEC.epw")  # disabled
number_slider = Slider(9, range=0..10)  # disabled

# ---- group: SITE BOUNDARY
geo_12 = Geometry(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)

# ----
# ANALYSIS
number_slider_2 = Slider(6, range=0..10)
offset = Offset(Curve=geo_12, Distance=number_slider_2, Plane=PlaneXY(0, 0, 0), Corners=1)
boundary_3 = BoundarySurfaces(Edges=geo_12)
preview_4 = CustomPreview(
    Geometry=[offset, geo_12],
    Shader={ambient=RGB(0, 0, 0), diffuse=RGB(255, 105, 180), emission=RGB(76, 32, 54), shine=0.5, specular=RGB(255, 255, 255), transparency=0})

number_slider_3 = Slider(9.25, range=0..10)  # disabled
preview_5 = CustomPreview(
    Geometry=geo_9,
    Shader={ambient=RGB(0, 0, 0), diffuse=RGB(255, 105, 180), emission=RGB(76, 32, 54), shine=0.5, specular=RGB(255, 255, 255), transparency=0})
number_slider_4 = Slider(21, range=0..100)  # disabled
geo_13 = Geometry([geo_10, geo_11])
number_slider_5 = Slider(18.25, range=0..100)  # disabled
wires = BrepWireframe(Brep=[geo_10, geo_11], Density=-1)
preview_6 = CustomPreview(Geometry=geo_13, Shader=ColourSwatch(SwatchColor=RGB(0, 255, 238)))
importepw = Ladybug_ImportEpw(epwFile=path)  # -> readMe, latitude, location, dryBulbTemperature, dewPointTemperature, relativeHumidity, windSpeed, windDirection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; disabled; plug-in component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

# ---- group: 1 KM TEST
geo_14 = Geometry(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)

# ----
analysisperiod = Ladybug_AnalysisPeriod(
    fromMonth=number_slider,
    fromDay=number_slider_4,
    fromHour=number_slider_3,
    toMonth=number_slider,
    toDay=number_slider_4,
    toHour=number_slider_5)  # -> readMe, analysisPeriod; disabled; plug-in component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

# ---- group: INPUT CA BOUNDARY
geo_15 = Geometry(boundary_3)

# ----
vec2pt = Vector2Pt(PointA=Point(-546024.6442, 3981714.058, 0), PointB=Point(-546023.36, 3981804.878, 0), Unitize=False)  # -> Vector, Length; disabled
pt = Point(Point(-545862.2817, 3980575.689, 0))
# SITE ANALYSIS SETUP
panel_4 = Panel("20")
pt_2 = Point(Point(-545244.6301, 3980882.419, 0))  # disabled
circle_2 = CircleCNR(Center=pt, Normal=Vector(0, 0, 1), Radius=Slider(1000, range=0..1000))
ladybug = Ladybug_Ladybug()  # -> Vviiiiiiiiiizzz; plug-in component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
gentestpts = Honeybee_GenerateTestPoints(testGeometry=geo_15, gridSize=panel_4, distBaseSrf="1", moveTestMesh=True)  # -> readMe, simplify(testPoints), simplify(ptsVectors), simplify(facesArea), simplify(mesh); plug-in component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
sunpath = Ladybug_SunPath(
    north=vec2pt.Vector,
    location=importepw.location,
    hour=12,
    day=21,
    month=12,
    timeStep=1,
    analysisPeriod=analysisperiod.analysisPeriod,
    centerPt=pt_2,
    dailyOrAnnualSunPath=True)  # -> readMe, sunVectors, sunAltitudes, sunAzimuths, port, sunSpheresMesh, sunPathCrvs, legend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; disabled; plug-in component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

# ---- group: FORMULA
python = PythonScript(formula="1 / math.exp(0.1813*dist)", focal_ref=pt, focal_weight="1")  # -> value_ref; inputs focal_ref: list
# ---------- python: Python ----------
"""
Bula Formula
"""
import rhinoscriptsyntax as rs

#Formula handling
#dist = 10.
#val = eval(formula)

focal_ref = map(lambda fr: rs.coerce3dpoint(fr),focal_ref)
focal_weight = map(lambda fw: float(fw), focal_weight.split(','))

value_ref = [formula,focal_ref,focal_weight]
# ---------- end python ----------

# ----
geo_16 = Geometry(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)  # disabled
boundary_4 = BoundarySurfaces(Edges=geo_16)  # disabled
geo_17 = Geometry(gentestpts.testPoints)
toggle_6 = BooleanToggle(True)  # disabled
bula = PythonScript(
    Code=file_12,
    Analysis_ref=gentestpts.testPoints,
    Value_ref=python,
    Height_bounds="400.",
    Scale=Slider(1, range=0..10),
    Run=Toggle(True))
solarfan = Ladybug_SolarFan(baseSrf=boundary_4, sunVectors=flatten(sunpath.sunVectors), runIt=toggle_6)  # -> readMe, solarFan; disabled; plug-in component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
rad = Radians(Degrees=Slider(45, range=-100..100))
rad_2 = Radians(Degrees=Slider(-45, range=-100..100))
geo_18 = Geometry(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)
geo_19 = Geometry(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)
geo_20 = Geometry(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)
geo_21 = Geometry(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)
rotax = RotateAxis(Geometry=geo_18, Angle=rad, Axis=geo_20)  # -> Geometry, Transform

# ---- group: SOLAR
geo_22 = Geometry(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)

# ----
rotax_2 = RotateAxis(Geometry=geo_19, Angle=rad_2, Axis=geo_21)  # -> Geometry, Transform
trinco_park = PythonScript(Code=file_6, Rule_in=bula, Node_in=geo_15, Label_="site", Run=Toggle(True))  # -> Node_out, Debug
geo_23 = Geometry(rotax.Geometry)
geo_24 = Geometry(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)
g = PythonScript(node=trinco_park.Node_out)  # -> data; inputs node: list
# ---------- g: Python ----------
if node and node != []:
    L = []
    #lot_lst = node.traverse_tree(lambda n:n,internal=False)
    #n = node[0].get_root()
    for n in node:
        print n.grammar.type['label']
        print n.grammar.type['bula']
        L.extend(n.grammar.type['bula'].value_lst)
    data = map(lambda d: str(round(d,2))+'%',L)
   
    print data
# ---------- end g ----------
g_2 = PythonScript(node=trinco_park.Node_out)  # -> bula; inputs node: list
# ---------- g_2: Python ----------
if node and node != []:
    geom = []
    #lot_lst = node.traverse_tree(lambda n:n,internal=False)
    #n = node[0].get_root()
    for n in node:
        print n.grammar.type['label']
        print n.grammar.type['bula']
        geom.extend(n.grammar.type['bula'].bpt_viz_lst)
    bula = geom
# ---------- end g_2 ----------
g_3 = PythonScript(node=trinco_park.Node_out)  # -> geom; inputs node: list
# ---------- g_3: Python ----------
if node and node != []:
    geom = []
    #lot_lst = node.traverse_tree(lambda n:n,internal=False)
    for n in node:
        geom.append(n.shape.bottom_crv)
    print geom
# ---------- end g_3 ----------
python_2 = PythonScript(pts=gentestpts.testPoints, brep=[geo_22, rotax_2.Geometry, rotax.Geometry], run=Toggle(True))  # -> project; inputs pts: list
# ---------- python_2: Python ----------
import rhinoscriptsyntax as rs
import Rhino as rc
import scriptcontext as sc

if run:
    debug = []
    dir = rc.Geometry.Vector3d(0,0,1) 
    tol = sc.doc.ModelAbsoluteTolerance
    env = [rs.coercebrep(brep)]
    ptlst = map(lambda p: rs.coerce3dpoint(p),pts)
    
    projlst = rc.Geometry.Intersect.Intersection.ProjectPointsToBreps(env,ptlst,dir,tol)
    #print projlst
    #projlst = filter(lambda pt:abs(pt[2]-200.)>0.5,projlst)
    projlst = filter(lambda p: abs(p[2]-0)>1.,projlst)
    
    if projlst:
        debug.extend(projlst)
        #min_index = projlst.index(min(projlst,key=lambda p:p[2]))
        #min_pt = projlst[min_index]
        #envht = min_pt[2]
    project = debug
# ---------- end python_2 ----------
tag = TextTag(Location=g_2, Text=g)
geo_25 = Geometry(python_2)
geometry = Geometry([python_2, g_2])
dots = DotDisplay(Point=[g_2, python_2], Colour=ColourSwatch(SwatchColor=RGB(255, 0, 0)), Size=Slider(2, range=0..10))

# ---- group: SETBACKS_REF
geo_26 = Geometry([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])

# ----
# BUILDING TYPOLOGY
preview_7 = CustomPreview(
    Geometry=geo_26,
    Shader={ambient=RGB(0, 0, 0), diffuse=RGB(255, 105, 180), emission=RGB(76, 32, 54), shine=0.5, specular=RGB(255, 255, 255), transparency=0})

# ---- group: SETBACKS
geo_27 = Geometry([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])

# ----
geo_28 = Geometry([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])
geo_29 = Geometry([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])

# ---- group: HEIGHT
miru_2 = PythonScript(Code=file_11, Height=Slider(13.5, range=0..100), Run=Toggle(True))

# ----
boundary_5 = BoundarySurfaces(Edges=geo_28)
preview_8 = CustomPreview(
    Geometry=geo_28,
    Shader={ambient=RGB(0, 0, 0), diffuse=RGB(255, 105, 180), emission=RGB(76, 32, 54), shine=0.5, specular=RGB(255, 255, 255), transparency=0})
preview_9 = CustomPreview(
    Geometry=geo_29,
    Shader={ambient=RGB(0, 0, 0), diffuse=RGB(255, 105, 180), emission=RGB(76, 32, 54), shine=0.5, specular=RGB(255, 255, 255), transparency=0})
trinco_park_2 = PythonScript(Code=file_6, Node_in=geo_29, Label_="exist_tower", Run=Toggle(True))  # -> Node_out, Debug

# ---- group: TOWER INPUT
geo_30 = Geometry([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])

# ----
g_4 = PythonScript(node=trinco_park_2.Node_out)  # -> geom; inputs node: list; same code as g_3
boundary_6 = BoundarySurfaces(Edges=geo_30)

# ---- group: SETBACK
miru_3 = PythonScript(
    Code=file_10,
    Height=Slider(10.5, range=0..100),
    Distance=Slider(6, range=0..10),
    Geom_ref=geo_27,
    Node_ref="-1",
    Run=Toggle(True))

# ---- group: HEIGHT
miru_4 = PythonScript(Code=file_11, Height=Slider(150, range=0..1000), Run=Toggle(True))

# ----
offset_2 = Offset(Curve=g_4, Distance="30", Plane=PlaneXY(0, 0, 0), Corners="2")
offset_3 = Offset(Curve=geo_30, Distance="30", Plane=PlaneXY(0, 0, 0), Corners="2")
geo_31 = Geometry([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])

# ---- group: NORTH SOFT SITES W/ COURT
geo_32 = Geometry([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])

# ----
boundary_7 = BoundarySurfaces(Edges=geo_32)
bibil_9 = PythonScript(Code=file_6, Rule_in=[miru_2, miru_3], Node_in=geo_32, Label_="midrise_bld", Run=Toggle(True))  # -> Node_out, Debug
bibil_10 = PythonScript(Code=file_6, Rule_in=miru_4, Node_in=geo_30, Label_="hirise_bld", Run=Toggle(False))  # -> Node_out, Debug
g_5 = PythonScript(node=bibil_9.Node_out)  # -> geom; inputs node: list
# ---------- g_5: Python ----------
node = filter(lambda n: n!=None,node)
if node and node != []:
    geom = []
    #lot_lst = node.traverse_tree(lambda n:n,internal=False)
    for n in node:
        geom.append(n.shape.geom)
    print geom
# ---------- end g_5 ----------
g_6 = PythonScript(node=bibil_10.Node_out)  # -> geom; inputs node: list; same code as g_5
