# Grasshopper definition bibil_trial_083.gh (Grasshopper 0.9.76)
# plug-ins: Python Interpreter, Human, Mosquito

list = ValueList({"dir", "file"}, selected="dir")

# ---- group: find directory
bibil = PythonScript(
    dir=["C:\\Users\\vasanthakumars\\Documents\\GitHub\\bibil\\src", "C:\\saeran\\master\\git\\bibil\\src"],
    type=list,
    run=Toggle(True))  # -> dir; inputs dir: list
# ---------- bibil: Python ----------
import os

ghenv.Component.Params.Output[0].Name = "null"
ghenv.Component.Params.Output[0].NickName = "null"

if run:
    confirm_dir = None
    for d in dir:
        try:
            if type == "file":
                file_ = open(d)
                file_.close()
            else:
                print os.listdir(d)
            confirm_dir = d
            break
        except Exception as e:
            #print str(e)
            continue
    if confirm_dir != None:
        ghenv.Component.Params.Output[0].Name = type
        ghenv.Component.Params.Output[0].NickName = type
        dir = confirm_dir
        file = confirm_dir
null = None
# ---------- end bibil ----------

# ---- group: tree
python_script = PythonScript(i=bibil)  # -> o
# ---------- python_script: Python ----------
import os

if i:
    o = os.path.join(str(i),"bibil\\bibil_tree.py")
# ---------- end python_script ----------
file = ReadFile(File=python_script, PerLineParse=False)
bibil_2 = PythonScript(Code=file)

# ---- group: grammar
python_script_2 = PythonScript(i=bibil)  # -> o
# ---------- python_script_2: Python ----------
import os

if i:
    o = os.path.join(str(i),"bibil\\bibil_grammar.py")
# ---------- end python_script_2 ----------
file_2 = ReadFile(File=python_script_2, PerLineParse=False)
bibil_3 = PythonScript(Code=file_2)

# ---- group: shape
python_script_3 = PythonScript(i=bibil)  # -> o
# ---------- python_script_3: Python ----------
import os

if i:
    o = os.path.join(str(i),"bibil\\bibil_shape.py")
#o = os.path.join(str(i),"research\\bibil_shape_shape_3d_2d.py")
# ---------- end python_script_3 ----------
file_3 = ReadFile(File=python_script_3, PerLineParse=False)
bibil_4 = PythonScript(Code=file_3)

# ---- group: miru
python_script_4 = PythonScript(i=bibil)  # -> o
# ---------- python_script_4: Python ----------
import os

if i:
    o = os.path.join(str(i),"miru\\miru_miru.py")
# ---------- end python_script_4 ----------
file_4 = ReadFile(File=python_script_4, PerLineParse=False)
bibil_5 = PythonScript(Code=file_4)

# ---- group: bula
python_script_5 = PythonScript(i=bibil)  # -> o
# ---------- python_script_5: Python ----------
import os

if i:
    o = os.path.join(str(i),"bula\\bula_minimal.py")
# ---------- end python_script_5 ----------
file_5 = ReadFile(File=python_script_5, PerLineParse=False)
bibil_6 = PythonScript(Code=file_5)

# ---- group: UI
python_script_6 = PythonScript(i=bibil)  # -> o
# ---------- python_script_6: Python ----------
import os

if i:
    o = os.path.join(str(i),"bibil\\bibil_UI.py")
# ---------- end python_script_6 ----------
file_6 = ReadFile(File=python_script_6, PerLineParse=False)

# ---- group: grammar_divide
python_script_7 = PythonScript(i=bibil)  # -> o
# ---------- python_script_7: Python ----------
import os

if i:
    o = os.path.join(str(i),"miru\\miru_divide.py")
# ---------- end python_script_7 ----------
file_7 = ReadFile(File=python_script_7, PerLineParse=False)

# ---- group: grammar_courtyard
python_script_8 = PythonScript(i=bibil)  # -> o
# ---------- python_script_8: Python ----------
import os

if i:
    o = os.path.join(str(i),"miru\\miru_court.py")
# ---------- end python_script_8 ----------
file_8 = ReadFile(File=python_script_8, PerLineParse=False)

# ---- group: grammar_tower
python_script_9 = PythonScript(i=bibil)  # -> o
# ---------- python_script_9: Python ----------
import os

if i:
    o = os.path.join(str(i),"miru\\miru_packing.py")
# ---------- end python_script_9 ----------
file_9 = ReadFile(File=python_script_9, PerLineParse=False)

python_script_10 = PythonScript(i=bibil)  # -> o
# ---------- python_script_10: Python ----------
import os

if i:
    o = os.path.join(str(i),"miru\\miru_stepback.py")
# ---------- end python_script_10 ----------
file_10 = ReadFile(File=python_script_10, PerLineParse=False)

# ---- group: grammar_height
python_script_11 = PythonScript(i=bibil)  # -> o
# ---------- python_script_11: Python ----------
import os

if i:
    o = os.path.join(str(i),"miru\\miru_height.py")
# ---------- end python_script_11 ----------
file_11 = ReadFile(File=python_script_11, PerLineParse=False)

# ---- group: grammar_analysis_pts
python_script_12 = PythonScript(i=bibil)  # -> o
# ---------- python_script_12: Python ----------
import os

if i:
    o = os.path.join(str(i),"miru\\miru_analysis.py")
# ---------- end python_script_12 ----------
file_12 = ReadFile(File=python_script_12, PerLineParse=False)

# ---- group: meta_tree
python_script_13 = PythonScript(i=bibil)  # -> o
# ---------- python_script_13: Python ----------
import os

if i:
    o = os.path.join(str(i),"miru\\miru_meta_tree.py")
# ---------- end python_script_13 ----------
file_13 = ReadFile(File=python_script_13, PerLineParse=False)

# ----
# Note: Change this number with caution,
# Increase bounds iterratively.
panel = Panel("0.004")  # disabled

panel_2 = Panel("Yonge and Eglinton")  # disabled
panel_3 = Panel("Redpath Avenue and Roehampton Avenue")  # disabled
location = MosquitoLocation(Location=panel_3)  # -> Address, Points, Type; disabled
item = ListItem(List=location.Points, Index=0, Wrap=True)  # disabled
toggle = BooleanToggle(True)  # disabled
toggle_2 = BooleanToggle(True)  # disabled
toggle_3 = BooleanToggle(True)  # disabled
toggle_4 = BooleanToggle(True)  # disabled
circle = CircleCNR(Center=item, Normal=Vector(0, 0, 1), Radius=panel)  # disabled
vector_maps = VectorMaps(Area=circle, AllRoads=toggle, Buildings=toggle_2, ReProject=toggle_3, CenterToWorld=toggle_4)  # -> RoadLines, RoadInfo, BuildingLines, BuildingInfo, BuildingHeights, AmenityLines, AmenityInfo, AmenityPoints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; disabled
swatch = ColourSwatch(SwatchColor=RGB(0, 0, 0))  # disabled
geo = Geometry([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])  # disabled
geo_2 = Geometry([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])  # disabled
geo_3 = Geometry(Tree({0}: [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], {1}: [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], {2}: [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], {3}: [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], {4}: [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], {5}: [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]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))  # disabled
geo_4 = Geometry([vector_maps.BuildingLines, vector_maps.RoadLines, vector_maps.AmenityLines])  # disabled
preview = CustomPreview(Geometry=[geo_3, geo_2, geo], Shader=swatch)  # disabled

list_2 = ValueList({"divide by depth": "subdivide_depth", "divide by same depth": "subdivide_depth_same", "divide by dim": "subdivide_dim"}, selected="divide by depth")

# ---- group: cpt
vec = Vector(Vector(-545550.1884, 3982019.542, 0))

# ---- group: refYEvec
vec_2 = Vector(Vector(-545759.5384, 3981844.461, 0))

# ----
list_3 = ValueList({"YZ": "NS", "XZ": "EW", "XY": "Z"}, selected="XZ")

# ---- group: dir2cpt
subtraction = Subtraction(A=vec, B=vec_2)

# ----
toggle_5 = BooleanToggle(False)  # disabled

# ---- group: COURTYARD
miru = PythonScript(Code=file_8, Podium_depth=Slider(21, range=0..100), Node_depth=Slider(1, range=-1..1), Run=Toggle(True))  # disabled

# ---- group: DIVIDE
bibil_7 = PythonScript(
    Code=file_7,
    Divide_num=Slider(1, range=0..10),
    Divide_cut=Slider(10, range=0..100),
    Divide_type=list_2,
    Divide_ratio=Slider(0.5, range=0..1),
    Axis=list_3,
    Run=Toggle(False))  # disabled

# ---- group: PACKING
bibil_8 = PythonScript(Code=file_9, Run=toggle_5)  # disabled

# ----
move = Move(Motion=subtraction)  # -> Geometry, Transform

# ---- group: SITE BOUNDARY
geo_5 = Geometry(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)

# ----
boundary = BoundarySurfaces(Edges=geo_5)
geo_6 = Geometry(boundary)
pt = Point(Point(-546034.6363, 3981515.595, 0))
number_slider = Slider(-22.5, range=-100..100)
circle_2 = CircleCNR(Center=pt, Normal=Vector(0, 0, 1), Radius=Slider(1000, range=0..1000))
# SITE ANALYSIS SETUP
gentestpts = Honeybee_GenerateTestPoints(testGeometry=geo_6, gridSize="20", distBaseSrf="1", moveTestMesh=True)  # -> readMe, simplify(testPoints), simplify(ptsVectors), simplify(facesArea), simplify(mesh); plug-in component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

# ---- group: FORMULA
python = PythonScript(formula="1 / math.exp(0.1813*dist)", focal_ref=pt, focal_weight="1")  # -> value_ref; inputs focal_ref: list
# ---------- python: Python ----------
"""
Bula Formula
"""
import rhinoscriptsyntax as rs

#Formula handling
#dist = 10.
#val = eval(formula)

focal_ref = map(lambda fr: rs.coerce3dpoint(fr),focal_ref)
focal_weight = map(lambda fw: float(fw), focal_weight.split(','))

value_ref = [formula,focal_ref,focal_weight]
# ---------- end python ----------

# ----
rad = Radians(Degrees=number_slider)
rad_2 = Radians(Degrees=number_slider)
geo_7 = Geometry(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)
geo_8 = Geometry(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)
geo_9 = Geometry(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)
geo_10 = Geometry(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)
number_slider_2 = Slider(2, range=0..10)  # disabled
number_slider_3 = Slider(0.5, range=0..1)  # disabled
number_slider_4 = Slider(10, range=0..100)  # disabled
geo_11 = Geometry(gentestpts.testPoints)
list_4 = ValueList({"divide by depth": "subdivide_depth", "divide by same depth": "subdivide_depth_same", "divide by dim": "subdivide_dim"}, selected="divide by depth")  # disabled
rotax = RotateAxis(Geometry=geo_9, Angle=rad_2, Axis=geo_10)  # -> Geometry, Transform
rotax_2 = RotateAxis(Geometry=geo_7, Angle=rad, Axis=geo_8)  # -> Geometry, Transform
toggle_6 = BooleanToggle(True)  # disabled
list_5 = ValueList({"YZ": "NS", "XZ": "EW", "XY": "Z"}, selected="YZ")  # disabled
bula = PythonScript(
    Code=file_12,
    Analysis_ref=gentestpts.testPoints,
    Value_ref=python,
    Height_bounds="400.",
    Scale=Slider(1, range=0..10),
    Run=Toggle(True))
python_2 = PythonScript(pts=gentestpts.testPoints, brep=[rotax_2.Geometry, rotax.Geometry], run=Toggle(False))  # -> project; inputs pts: list
# ---------- python_2: Python ----------
import rhinoscriptsyntax as rs
import Rhino as rc
import scriptcontext as sc

if run:
    debug = []
    dir = rc.Geometry.Vector3d(0,0,1) 
    tol = sc.doc.ModelAbsoluteTolerance
    env = [rs.coercebrep(brep)]
    ptlst = map(lambda p: rs.coerce3dpoint(p),pts)
    
    projlst = rc.Geometry.Intersect.Intersection.ProjectPointsToBreps(env,ptlst,dir,tol)
    #print projlst
    #projlst = filter(lambda pt:abs(pt[2]-200.)>0.5,projlst)
    projlst = filter(lambda p: abs(p[2]-0)>1.,projlst)
    
    if projlst:
        debug.extend(projlst)
        #min_index = projlst.index(min(projlst,key=lambda p:p[2]))
        #min_pt = projlst[min_index]
        #envht = min_pt[2]
    project = debug
# ---------- end python_2 ----------
wires = BrepWireframe(Brep=[rotax_2.Geometry, rotax.Geometry], Density=-1)

# ---- group: DIVIDE
bibil_9 = PythonScript(
    Code=file_7,
    Divide_num=number_slider_2,
    Divide_cut=number_slider_4,
    Divide_type=list_4,
    Divide_ratio=number_slider_3,
    Axis=list_5,
    Run=toggle_6)  # disabled

# ----
toggle_7 = BooleanToggle(True)  # disabled
panel_4 = Panel("roottest")  # disabled
trinco_park = PythonScript(Code=file_6, Rule_in=flatten(bula), Node_in=flatten(geo_6), Label_="site", Run=Toggle(True))  # -> Node_out, Debug
geo_12 = Geometry(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)  # disabled
trinco_park_2 = PythonScript(Code=file_6, Rule_in=bibil_9, Node_in=geo_12, Label_=panel_4, Run=toggle_7)  # -> Node_out, Debug; disabled
g = PythonScript(node=trinco_park.Node_out)  # -> geom; inputs node: list
# ---------- g: Python ----------
if node and node != []:
    geom = []
    #lot_lst = node.traverse_tree(lambda n:n,internal=False)
    for n in node:
        #print n.grammar.type.has_key('bula')
        print n.parent
        geom.append(n.shape.bottom_crv)
    print geom
# ---------- end g ----------
g_2 = PythonScript(node=trinco_park.Node_out)  # -> bula; inputs node: list
# ---------- g_2: Python ----------
if node and node != []:
    geom = []
    #lot_lst = node.traverse_tree(lambda n:n,internal=False)
    #n = node[0].get_root()
    for n in node:
        print n.grammar.type['label']
        print n.grammar.type['bula']
        geom.extend(n.grammar.type['bula_data'].bpt_viz_lst)
    bula = geom
# ---------- end g_2 ----------
g_3 = PythonScript(node=trinco_park.Node_out)  # -> data; inputs node: list
# ---------- g_3: Python ----------
if node and node != []:
    L = []
    #lot_lst = node.traverse_tree(lambda n:n,internal=False)
    #n = node[0].get_root()
    for n in node:
        print n.grammar.type['label']
        print n.grammar.type['bula']
        L.extend(n.grammar.type['bula_data'].value_lst)
    data = map(lambda d: str(round(d,2))+'%',L)
   
    print data
# ---------- end g_3 ----------
g_4 = PythonScript(node=trinco_park_2.Node_out)  # -> geom; inputs node: list; disabled
# ---------- g_4: Python ----------
if node and node != []:
    geom = []
    for n in node:
        #lot_lst = n.traverse_tree(lambda n:n.shape.geom,internal=False)
        geom.append(n.shape.geom)#lot_lst)
    print geom
# ---------- end g_4 ----------

# ---- group: root test
# BUILDING TYPOLOGY
g_5 = PythonScript(node=trinco_park_2.Node_out)  # -> geom; inputs node: list; disabled
# ---------- g_5: Python ----------
if node and node != []:
    geom = []
    for n in node:
        #print 'label: ', n.parent.grammar.type['label']
        geom.append(n.shape.geom)
    
    node[0].grammar.type['label'] = 'leaftest'
    
    print '----'
    root = node[0].get_root()
    #print root.grammar.type['label']
    lstleaf = root.traverse_tree(lambda n: n,internal=False)
    for leaf in lstleaf:
        print leaf.grammar.type['label']
    print '----'
    
    
    node[0].grammar.type['label'] = 'revisedleaftest'
    node[1].grammar.type['label'] = 'revisedtest'
    
    lstleaf = root.traverse_tree(lambda n: n,internal=False)
    for leaf in lstleaf:
        print leaf.grammar.type['label']
    print '----'
# ---------- end g_5 ----------

# ----
geometry = Geometry(g_2)
tag = TextTag(Location=g_2, Text=g_3)

# ---- group: Block outlines
geo_13 = Geometry([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])

# ---- group: Soft Sites ref
geo_14 = Geometry([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])

# ---- group: Setbacks
geo_15 = Geometry([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])

# ----
preview_2 = CustomPreview(Geometry=[geo_14, geo_13], Shader=ColourSwatch(SwatchColor=RGB(0, 0, 0)))

# ---- group: Soft Sites
geo_16 = Geometry([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])

# ----
toggle_8 = BooleanToggle(True)
list_6 = ValueList({"root"}, selected="root")
toggle_9 = BooleanToggle(True)
list_7 = ValueList({"root"}, selected="root")

# ---- group: SETBACK
miru_2 = PythonScript(
    Code=file_10,
    Height=Slider(12, range=0..100),
    Distance=Slider(6, range=0..10),
    Geom_ref=geo_15,
    Node_ref="-1",
    Run=Toggle(True))

# ---- group: TREE RULES
miru_3 = PythonScript(Code=file_13, Node=trinco_park.Node_out, Relation=list_6, Insert=toggle_8, Run=toggle_8)

miru_4 = PythonScript(Code=file_13, Node=trinco_park.Node_out, Relation=list_7, Insert=toggle_9, Run=toggle_9)

# ---- group: HEIGHT
miru_5 = PythonScript(Code=file_11, Height="bula", Run=Toggle(True))

miru_6 = PythonScript(Code=file_11, Height=Slider(18, range=0..100), Run=Toggle(True))

# ----
geo_17 = Geometry([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])
bibil_10 = PythonScript(Code=file_6, Rule_in=flatten([miru_3, miru_5]), Node_in=flatten(geo_17), Label_="hirise_bld", Run=Toggle(True))  # -> Node_out, Debug
bibil_11 = PythonScript(
    Code=file_6,
    Rule_in=flatten([miru_4, miru_6, miru_2]),
    Node_in=flatten(geo_16),
    Label_="midrise_podium",
    Run=Toggle(True))  # -> Node_out, Debug
g_6 = PythonScript(node=bibil_11.Node_out)  # -> geom; inputs node: list
# ---------- g_6: Python ----------
node = filter(lambda n: n!=None,node)
if node and node != []:
    geom = []
    for n in node:
        print n.get_root()
        print n.parent.parent
        print n
        geom.append(n.shape.geom)
    print geom
# ---------- end g_6 ----------
g_7 = PythonScript(node=bibil_10.Node_out)  # -> geom; inputs node: list; same code as g_6

# ---- group: Type_Commercial_Midrise
geo_18 = Geometry([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])

# ---- group: Type_Res_Tower
geo_19 = Geometry([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])

# ---- group: Type_Res_low_rise
geo_20 = Geometry([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])

# ----
geo_21 = Geometry([geo_19, g_7])
geo_22 = Geometry([g_6, geo_18])
preview_3 = CustomPreview(
    Geometry=[geo_21, geo_20],
    Shader={ambient=RGB(0, 0, 0), diffuse=RGB(255, 105, 180), emission=RGB(76, 32, 54), shine=0.5, specular=RGB(255, 255, 255), transparency=0})
data = Data(geo_22)
geo_23 = Geometry([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])
panel_5 = Panel("C:\\Users\\vasanthakumars\\Documents\\GitHub\\Honeybee\\src")
# ENERGY ARCHETYPE SETUP
honeybee = Honeybee_Honeybee()  # -> Vviiiiiiiiiizzz; plug-in component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
ladybug = Ladybug_Ladybug()  # -> Vviiiiiiiiiizzz; plug-in component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
list_8 = ValueList({"dir", "file"}, selected="dir")
list_9 = ValueList({"dir", "file"}, selected="dir")

# ---- group: find directory
bibil_12 = PythonScript(dir=[panel_5, "C:\\saeran\\master\\git\\Honeybee\\src"], type=list_8, run=Toggle(True))  # -> dir; inputs dir: list; same code as bibil

bibil_13 = PythonScript(
    dir=["C:\\Users\\vasanthakumars\\Documents\\GitHub\\bibil\\src", "C:\\saeran\\master\\git\\bibil\\src"],
    type=list_9,
    run=Toggle(True))  # -> dir; inputs dir: list; same code as bibil

# ----
listzoneprograms = Honeybee_ListZonePrograms(bldgProgram=Slider(2, range=0..100))  # -> MidriseApartmentZonePrograms; plug-in component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
python_script_14 = PythonScript(i=bibil_12)  # -> o
# ---------- python_script_14: Python ----------
import os

if i:
    o = os.path.join(str(i),"Honeybee_SplitBuildingMass.py")
# ---------- end python_script_14 ----------
python_script_15 = PythonScript(i=bibil_13)  # -> o
# ---------- python_script_15: Python ----------
import os

if i:
    o = os.path.join(str(i),"reference\\python_files\\Honeybee_SplitZones.py")
# ---------- end python_script_15 ----------
python_script_16 = PythonScript(i=bibil_13)  # -> o
# ---------- python_script_16: Python ----------
import os

if i:
    o = os.path.join(str(i),"reference\\python_files\\Honeybee_SplitBuildingMass_Ref.py")
# ---------- end python_script_16 ----------
file_14 = ReadFile(File=python_script_14, PerLineParse=False)
splitmass = Honeybee_SplitBuildingMass(Code=file_14, _bldgMasses=geo_23, BldgsFlr2FloorHeights_="@3", _runIt=Toggle(False))  # -> ReadMe, SplitBldgMasses
geo_24 = Geometry(splitmass.SplitBldgMasses)
wires_2 = BrepWireframe(Brep=geo_24, Density=-1)
file_15 = ReadFile(File=python_script_15, PerLineParse=False)
python_3 = PythonScript(Code=file_15, _bldgMasses=flatten(splitmass.SplitBldgMasses), PerimeterZoneDepth_="@3", _runIt=Toggle(False))  # -> ReadMe, SplitBldgMasses, Debug
file_16 = ReadFile(File=python_script_16, PerLineParse=False)
num = Number(9)
preview_4 = CustomPreview(
    Geometry=wires_2,
    Shader={ambient=RGB(0, 0, 0), diffuse=RGB(255, 105, 180), emission=RGB(76, 32, 54), shine=0.5, specular=RGB(255, 255, 255), transparency=0})
item_2 = ListItem(List=listzoneprograms, Index=num, Wrap=True)
geo_25 = Geometry(python_3.Debug)
geo_26 = Geometry(python_3.SplitBldgMasses)
toggle_10 = BooleanToggle(True)  # disabled
mass2zone = Honeybee_Masses2Zones(
    zoneMasses=flatten(python_3.SplitBldgMasses),
    zonePrograms=item_2,
    isConditioned=True,
    maxRoofAngle=30,
    createHBZones=toggle_10)  # -> readMe, HBZones; disabled; plug-in component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
panel_6 = Panel("2")  # disabled
panel_7 = Panel("2")  # disabled
panel_8 = Panel("window")  # disabled
toggle_11 = BooleanToggle(True)  # disabled
concat = Concatenate(FragmentA=panel_7, FragmentB=panel_8, JoinSeparator=" ")  # disabled
concat_2 = Concatenate(FragmentA=panel_6)  # disabled
panel_9 = Panel("0.3")  # disabled
solveadjc = Honeybee_SolveAdjacencies(HBZones=flatten(mass2zone.HBZones), removeCurrentAdjc=False, findAdjc=toggle_11)  # -> readMe, HBZonesWADJ; disabled; plug-in component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
glzparamlist = Honeybee_GlazingParametersList(northGlzParam=panel_9, westGlzParam=panel_9, southGlzParam=panel_9, eastGlzParam=panel_9)  # -> glzParamList; disabled; plug-in component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
callfromepconstrlibrary = Honeybee_CallFromEPConstructionLibrary(keywords=concat_2)  # -> ThermMaterials, EPMaterials, EPWindowMaterials, EPConstructions; disabled; plug-in component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
callfromepconstrlibrary_2 = Honeybee_CallFromEPConstructionLibrary(keywords=concat)  # -> ThermMaterials, EPMaterials, EPWindowMaterials, EPConstructions; disabled; plug-in component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
toggle_12 = BooleanToggle(False)  # disabled
item_3 = ListItem(List=callfromepconstrlibrary.EPConstructions, Index=198, Wrap=True)  # disabled
item_4 = ListItem(List=callfromepconstrlibrary_2.EPConstructions, Index=44, Wrap=True)  # disabled
glazingcreator = Honeybee_GlazingBasedOnRatio(HBObjects=solveadjc.HBZonesWADJ, glzRatio=glzparamlist, breakUpWindow=toggle_12, runIt=toggle_10)  # -> readMe, HBObjWGLZ; disabled; plug-in component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
panel_10 = Panel(item_4)  # disabled
panel_11 = Panel(item_3)  # disabled
setepzonecnstr = Honeybee_SetEPZoneConstruction(HBZone=glazingcreator.HBObjWGLZ, wallEPConstruction=item_3, windowEPConstruction=item_4)  # -> simplify(modifiedHBZone); disabled; plug-in component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
geo_27 = Geometry(setepzonecnstr)  # disabled
panel_12 = Panel("annual")  # disabled
toggle_13 = BooleanToggle(True)  # disabled
epoutput = Honeybee_GenerateEPOutput(
    zoneEnergyUse=toggle_13,
    zoneGainsAndLosses=toggle_13,
    zoneComfortMetrics="False",
    comfortMapVariables=toggle_13,
    zoneHVACParams=toggle_13,
    surfaceTempAnalysis=toggle_13,
    surfaceEnergyAnalysis=toggle_13,
    glazingSolarAnalysis=toggle_13,
    timestep=panel_12)  # -> report, flatten(simulationOutputs); disabled; plug-in component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
panel_13 = Panel("section_test")  # disabled
panel_14 = Panel("C:\Users\vasanthakumars\Desktop\temp_folder")  # disabled
toggle_14 = BooleanToggle(False)  # disabled
data_2 = Data(flatten(setepzonecnstr))  # disabled
toggle_15 = BooleanToggle(True)  # disabled
toggle_16 = BooleanToggle(True)  # disabled
toggle_17 = BooleanToggle(True)  # disabled
toggle_18 = BooleanToggle(True)  # disabled
decomposebytype = Honeybee_DecomposeBasedOnType(HBZone=data_2)  # -> walls, interiorWalls, airWalls, flatten(windows), interiorWindows, skylights, roofs, ceilings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; disabled; plug-in component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
wires_3 = BrepWireframe(Brep=[decomposebytype.walls, decomposebytype.floors, decomposebytype.ceilings], Density=-1)  # disabled
swatch_2 = ColourSwatch(SwatchColor=RGBA(0, 0, 0, 122))  # disabled
swatch_3 = ColourSwatch(SwatchColor=RGB(158, 255, 255))  # disabled
geo_28 = Geometry(decomposebytype.floors)  # disabled
swatch_4 = ColourSwatch(SwatchColor=RGBA(181, 181, 181, 122))  # disabled
swatch_5 = ColourSwatch(SwatchColor=RGB(0, 0, 0))  # disabled
swatch_6 = ColourSwatch(SwatchColor=RGB(0, 0, 0))  # disabled
preview_5 = CustomPreview(Geometry=decomposebytype.windows, Shader=swatch_3)  # disabled
preview_6 = CustomPreview(Geometry=wires_3, Shader=swatch_2)  # disabled
preview_7 = CustomPreview(Geometry=geo_28, Shader=swatch_4)  # disabled
number_slider_5 = Slider(0.5, range=0..1)  # disabled
number_slider_6 = Slider(0, range=0..100)  # disabled
# ENERGY ANALYSIS/VISUALISATION
number_slider_7 = Slider(100000, range=0..100000)  # disabled
number_slider_8 = Slider(30, range=0..100000)  # disabled
list_10 = ValueList({"divide by depth": "subdivide_depth", "divide by same depth": "subdivide_depth_same", "divide by dim": "subdivide_dim"}, selected="divide by dim")  # disabled
toggle_19 = BooleanToggle(True)  # disabled
list_11 = ValueList({"YZ": "NS", "XZ": "EW", "XY": "Z"}, selected="YZ")  # disabled

# ---- group: DIVIDE
bibil_14 = PythonScript(
    Code=file_7,
    Divide_num=[number_slider_8, number_slider_7],
    Divide_cut=number_slider_6,
    Divide_type=list_10,
    Divide_ratio=number_slider_5,
    Axis=list_11,
    Run=toggle_19)  # disabled

# ----
toggle_20 = BooleanToggle(True)  # disabled
panel_15 = Panel("root")  # disabled
geo_29 = Geometry(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)  # disabled
trinco_park_3 = PythonScript(Code=file_6, Rule_in=bibil_14, Child_node_in=geo_29, Label_=panel_15, Run=toggle_20)  # -> Node_out, Debug; disabled
number_slider_9 = Slider(100, range=0..100)  # disabled
number_slider_10 = Slider(6, range=0..100)  # disabled
number_slider_11 = Slider(0.5, range=0..1)  # disabled
number_slider_12 = Slider(0, range=0..100)  # disabled
g_8 = PythonScript(node=trinco_park_3.Node_out)  # -> geom; inputs node: list; disabled
# ---------- g_8: Python ----------
if node and node != []:
    geom = []
    #lot_lst = node.traverse_tree(lambda n:n,internal=False)
    for n in node:
        geom.append(n.data.shape.bottom_crv)
    print geom
# ---------- end g_8 ----------
g_9 = PythonScript(node=trinco_park_3.Node_out)  # -> geom; inputs node: list; disabled
# ---------- g_9: Python ----------
if node and node != []:
    geom = []
    #lot_lst = node.traverse_tree(lambda n:n,internal=False)
    for n in node:
        geom.append(n.data.shape.cpt)
    print len(geom)
    #print type(geom[0])
# ---------- end g_9 ----------
g_10 = PythonScript(node=trinco_park_3.Node_out)  # -> lst; inputs node: list; disabled
# ---------- g_10: Python ----------
if node and node != []:
    lst = []
    #lot_lst = node.traverse_tree(lambda n:n,internal=False)
    for n in node:
        lst.append([n])
    print len(lst)
    #print type(geom[0])
# ---------- end g_10 ----------
list_12 = ValueList({"divide by depth": "subdivide_depth", "divide by same depth": "subdivide_depth_same", "divide by dim": "subdivide_dim"}, selected="divide by dim")  # disabled
toggle_21 = BooleanToggle(True)  # disabled
list_13 = ValueList({"YZ": "NS", "XZ": "EW", "XY": "Z"}, selected="YZ")  # disabled

# ---- group: DIVIDE
bibil_15 = PythonScript(
    Code=file_7,
    Divide_num=[number_slider_9, number_slider_10],
    Divide_cut=number_slider_12,
    Divide_type=list_12,
    Divide_ratio=number_slider_11,
    Axis=list_13,
    Run=toggle_21)  # disabled

# ----
toggle_22 = BooleanToggle(True)  # disabled
panel_16 = Panel("bula")  # disabled
trinco_park_4 = PythonScript(Code=file_6, Rule_in=bibil_15, Child_node_in=g_8, Label_=panel_16, Run=toggle_22)  # -> Node_out, Debug; disabled
g_11 = PythonScript(node=trinco_park_4.Node_out)  # -> geom; inputs node: list; disabled; same code as g_8

# ---- group: Section_List
sectionlst = PythonScript(node=trinco_park_4.Node_out)  # -> analysis_pts; inputs node: list; disabled
# ---------- sectionlst: Python ----------
import rhinoscriptsyntax as rs
import Rhino as rc
from Rhino import RhinoApp
import scriptcontext as sc
import copy

## Import classes
Pattern = sc.sticky["Pattern"]
Shape_3D = sc.sticky["Shape_3D"]
Tree = sc.sticky["Tree"] 
Grammar = sc.sticky["Grammar"]

chk_dic = {}
for n in node:
    root = n.get_root()
    cp = root.data.shape.cpt
    chk_str = str(int(cp[0])) + str(int(cp[1]))
    if not chk_dic.has_key(chk_str):
        chk_dic[chk_str] = [n.data.shape.cpt]
    else:
        chk_dic[chk_str].append(n.data.shape.cpt)

sectionlst = chk_dic.values()
analysis_pts = sectionlst
# ---------- end sectionlst ----------

# ----
toggle_23 = BooleanToggle(True)  # disabled
toggle_24 = BooleanToggle(True)  # disabled
panel_17 = Panel("zones")  # disabled
panel_18 = Panel("mass")  # disabled
bibil_16 = PythonScript(Code=file_6, Child_node_in=data_2, Label_=panel_17, Run=toggle_23)  # -> Node_out, Debug; disabled
bibil_17 = PythonScript(Code=file_6, Label_=panel_18, Run=toggle_24)  # -> Node_out, Debug; disabled
g_12 = PythonScript(node=bibil_17.Node_out)  # -> geom; disabled
# ---------- g_12: Python ----------
import rhinoscriptsyntax as rs
if node:
    geom = []
    lot_lst = node.traverse_tree(lambda n:n,internal=False)
    for n in lot_lst:
        geom.append(n.data.shape.geom)
    print geom
# ---------- end g_12 ----------
g_13 = PythonScript(node=bibil_16.Node_out)  # -> geom; disabled
# ---------- g_13: Python ----------
if node:
    geom = []
    lot_lst = node.traverse_tree(lambda n:n,internal=False)
    for n in lot_lst:
        geom.append(n.data.shape.geom)
    print geom
# ---------- end g_13 ----------
panel_19 = Panel(bibil_17.Node_out)  # disabled
panel_20 = Panel(bibil_16.Node_out)  # disabled
number_slider_13 = Slider(10, range=0..100)  # disabled
toggle_25 = BooleanToggle(True)  # disabled
toggle_26 = BooleanToggle(True)  # disabled
number_slider_14 = Slider(3, range=0..10)  # disabled
number_slider_15 = Slider(3, range=0..10)  # disabled
Z = UnitZ(Factor=number_slider_14)  # disabled
swatch_7 = ColourSwatch(SwatchColor=RGB(255, 0, 255))  # disabled
swatch_8 = ColourSwatch(SwatchColor=RGB(0, 255, 255))  # disabled

panel_21 = Panel("C:\\Users\\vasanthakumars\\Documents\\GitHub\\bibil\\src\\reference\\CAN_ON_Toronto.716240_CWEC\\CAN_ON_Toronto.716240_CWEC.epw")  # disabled
# ENERGY SIMULATION
panel_22 = Panel("C:\saeran\master\git\bibil\src\reference\CAN_ON_Toronto.716240_CWEC\CAN_ON_Toronto.716240_CWEC.epw")  # disabled
toggle_27 = BooleanToggle(True)  # disabled
list_14 = ValueList({"dir", "file"}, selected="file")  # disabled

# ---- group: find directory
bibil_18 = PythonScript(dir=[panel_22, panel_21], type=list_14, run=toggle_27)  # -> file; inputs dir: list; disabled; same code as bibil

# ----
data_3 = Data(bibil_18)  # disabled

exporttoopenstudio = Honeybee_ExportToOpenStudio(
    epwWeatherFile=bibil_18,
    HBZones=flatten(data_2),
    simulationOutputs=flatten(epoutput.simulationOutputs),
    writeOSM=toggle_14,
    runSimulation=toggle_14,
    fileName=panel_13)  # -> readMe, osmFileAddress, idfFileAddress, resultsFileAddress, rddFileAddress, studyFolder; disabled; plug-in component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
path = FilePath(exporttoopenstudio.resultsFileAddress)  # disabled
readepsrfresult = Honeybee_ReadEPSurfaceResult(resultFileAddress=path)  # -> surfaceIndoorTemp, surfaceOutdoorTemp, surfaceEnergyFlow, opaqueEnergyFlow, glazEnergyFlow, windowTotalSolarEnergy, windowBeamEnergy, windowDiffEnergy, windowTransmissivity, otherSurfaceData; disabled; plug-in component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
readepresult = Honeybee_ReadEPResult(resultFileAddress=path)  # -> totalThermalLoad, thermalLoadBalance, cooling, heating, electricLight, electricEquip, fanElectric, pumpElectric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; disabled; plug-in component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
colorzones = Honeybee_ColorZonesByEPResult(zoneData=readepresult.thermalLoadBalance, HBZones=flatten(data_2), normalizeByFloorArea=toggle_15, runIt=toggle_16)  # -> readMe, zoneColoredMesh, zoneWireFrame, legend, legendBasePt, analysisTitle, zoneBreps, zoneColors, zoneValues, floorNormZoneData; disabled; plug-in component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
colorzones_2 = Honeybee_ColorZonesByEPResult(zoneData=readepresult.totalSolarGain, HBZones=flatten(data_2), normalizeByFloorArea=toggle_17, runIt=toggle_18)  # -> readMe, zoneColoredMesh, zoneWireFrame, legend, legendBasePt, analysisTitle, zoneBreps, zoneColors, zoneValues, floorNormZoneData; disabled; plug-in component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
panel_23 = Panel(colorzones.floorNormZoneData)  # disabled
panel_24 = Panel(colorzones_2.floorNormZoneData)  # disabled
geo_30 = Geometry(colorzones_2.zoneColoredMesh)  # disabled
preview_8 = CustomPreview(Geometry=colorzones_2.zoneWireFrame, Shader=swatch_5)  # disabled
geo_31 = Geometry([colorzones_2.analysisTitle, colorzones_2.legend])  # disabled
geo_32 = Geometry(colorzones.zoneColoredMesh)  # disabled
preview_9 = CustomPreview(Geometry=colorzones.zoneWireFrame, Shader=swatch_6)  # disabled
geo_33 = Geometry([colorzones.analysisTitle, colorzones.legend])  # disabled

# ---- group: thermal_balance
data_4 = Data(colorzones.floorNormZoneData)  # disabled

# ---- group: solar_gain
data_5 = Data(colorzones_2.floorNormZoneData)  # disabled

# ---- group: unnest
python_4 = PythonScript(val=data_4)  # -> val; inputs val: tree; disabled
# ---------- python_4: Python ----------
import scriptcontext as sc

Bula_Data = sc.sticky['BulaData']

if val:
    Bula = Bula_Data()
    val = Bula.ghtree2nestlist(val)
    val = map(lambda v: v[7],val)

print val
# ---------- end python_4 ----------

python_5 = PythonScript(val=data_5)  # -> val; inputs val: tree; disabled; same code as python_4

# ----
panel_25 = Panel(python_4)  # disabled

# ---- group: Norm_Thermal
python_6 = PythonScript(Code=file_5, Analysis_pts=sectionlst, Values=python_4, Node_in=bibil_16.Node_out, Scale_=number_slider_13, Run=toggle_25)  # -> Viz, Debug; disabled

# ---- group: Solar_Gain
python_7 = PythonScript(Code=file_5, Analysis_pts=sectionlst, Values=python_5, Node_in=bibil_16.Node_out, Scale_=number_slider_13, Run=toggle_26)  # -> Viz, Debug; disabled

# ----
geo_34 = Geometry(python_6.Viz)  # disabled
geo_35 = Geometry(python_7.Viz)  # disabled
move_2 = Move(Geometry=python_7.Viz, Motion=Z)  # -> Geometry, Transform; disabled
previewlw = CustomPreviewLineweights(Geometry=python_6.Viz, Shader=swatch_7, Thickness=number_slider_15, Absolute=False)  # disabled
previewlw_2 = CustomPreviewLineweights(Geometry=move_2.Geometry, Shader=swatch_8, Thickness=number_slider_15, Absolute=False)  # disabled
