# Grasshopper definition bibil_trial_083_energy.gh (Grasshopper 0.9.76)
# plug-ins: Python Interpreter, Mosquito

list = ValueList({"dir", "file"}, selected="dir")

# ---- group: find directory
bibil = PythonScript(
    dir=["C:\\Users\\vasanthakumars\\Documents\\GitHub\\bibil\\src", "C:\\saeran\\master\\git\\bibil\\src"],
    type=list,
    run=Toggle(True))  # -> dir; inputs dir: list
# ---------- bibil: Python ----------
import os

ghenv.Component.Params.Output[0].Name = "null"
ghenv.Component.Params.Output[0].NickName = "null"

if run:
    confirm_dir = None
    for d in dir:
        try:
            if type == "file":
                file_ = open(d)
                file_.close()
            else:
                print os.listdir(d)
            confirm_dir = d
            break
        except Exception as e:
            #print str(e)
            continue
    if confirm_dir != None:
        ghenv.Component.Params.Output[0].Name = type
        ghenv.Component.Params.Output[0].NickName = type
        dir = confirm_dir
        file = confirm_dir
null = None
# ---------- end bibil ----------

# ---- group: tree
python_script = PythonScript(i=bibil)  # -> o
# ---------- python_script: Python ----------
import os

if i:
    o = os.path.join(str(i),"bibil\\bibil_tree.py")
# ---------- end python_script ----------
file = ReadFile(File=python_script, PerLineParse=False)
bibil_2 = PythonScript(Code=file)

# ---- group: grammar
python_script_2 = PythonScript(i=bibil)  # -> o
# ---------- python_script_2: Python ----------
import os

if i:
    o = os.path.join(str(i),"bibil\\bibil_grammar.py")
# ---------- end python_script_2 ----------
file_2 = ReadFile(File=python_script_2, PerLineParse=False)
bibil_3 = PythonScript(Code=file_2)

# ---- group: shape
python_script_3 = PythonScript(i=bibil)  # -> o
# ---------- python_script_3: Python ----------
import os

if i:
    o = os.path.join(str(i),"bibil\\bibil_shape.py")
#o = os.path.join(str(i),"research\\bibil_shape_shape_3d_2d.py")
# ---------- end python_script_3 ----------
file_3 = ReadFile(File=python_script_3, PerLineParse=False)
bibil_4 = PythonScript(Code=file_3)

# ---- group: miru
python_script_4 = PythonScript(i=bibil)  # -> o
# ---------- python_script_4: Python ----------
import os

if i:
    o = os.path.join(str(i),"miru\\miru_miru.py")
# ---------- end python_script_4 ----------
file_4 = ReadFile(File=python_script_4, PerLineParse=False)
bibil_5 = PythonScript(Code=file_4)

# ---- group: bula
python_script_5 = PythonScript(i=bibil)  # -> o
# ---------- python_script_5: Python ----------
import os

if i:
    o = os.path.join(str(i),"bula\\bula_minimal.py")
# ---------- end python_script_5 ----------
file_5 = ReadFile(File=python_script_5, PerLineParse=False)
bibil_6 = PythonScript(Code=file_5)

# ---- group: UI
python_script_6 = PythonScript(i=bibil)  # -> o
# ---------- python_script_6: Python ----------
import os

if i:
    o = os.path.join(str(i),"bibil\\bibil_UI.py")
# ---------- end python_script_6 ----------
file_6 = ReadFile(File=python_script_6, PerLineParse=False)

# ---- group: grammar_divide
python_script_7 = PythonScript(i=bibil)  # -> o
# ---------- python_script_7: Python ----------
import os

if i:
    o = os.path.join(str(i),"miru\\miru_divide.py")
# ---------- end python_script_7 ----------
file_7 = ReadFile(File=python_script_7, PerLineParse=False)

# ---- group: grammar_courtyard
python_script_8 = PythonScript(i=bibil)  # -> o
# ---------- python_script_8: Python ----------
import os

if i:
    o = os.path.join(str(i),"miru\\miru_court.py")
# ---------- end python_script_8 ----------
file_8 = ReadFile(File=python_script_8, PerLineParse=False)

# ---- group: grammar_tower
python_script_9 = PythonScript(i=bibil)  # -> o
# ---------- python_script_9: Python ----------
import os

if i:
    o = os.path.join(str(i),"miru\\miru_packing.py")
# ---------- end python_script_9 ----------
file_9 = ReadFile(File=python_script_9, PerLineParse=False)

python_script_10 = PythonScript(i=bibil)  # -> o
# ---------- python_script_10: Python ----------
import os

if i:
    o = os.path.join(str(i),"miru\\miru_stepback.py")
# ---------- end python_script_10 ----------
file_10 = ReadFile(File=python_script_10, PerLineParse=False)

# ---- group: grammar_height
python_script_11 = PythonScript(i=bibil)  # -> o
# ---------- python_script_11: Python ----------
import os

if i:
    o = os.path.join(str(i),"miru\\miru_height.py")
# ---------- end python_script_11 ----------
file_11 = ReadFile(File=python_script_11, PerLineParse=False)

# ---- group: grammar_analysis_pts
python_script_12 = PythonScript(i=bibil)  # -> o
# ---------- python_script_12: Python ----------
import os

if i:
    o = os.path.join(str(i),"miru\\miru_analysis.py")
# ---------- end python_script_12 ----------
file_12 = ReadFile(File=python_script_12, PerLineParse=False)

# ---- group: meta_tree
python_script_13 = PythonScript(i=bibil)  # -> o
# ---------- python_script_13: Python ----------
import os

if i:
    o = os.path.join(str(i),"miru\\miru_meta_tree.py")
# ---------- end python_script_13 ----------
file_13 = ReadFile(File=python_script_13, PerLineParse=False)

# ----
# Note: Change this number with caution,
# Increase bounds iterratively.
panel = Panel("0.004")  # disabled

panel_2 = Panel("Yonge and Eglinton")  # disabled
panel_3 = Panel("Redpath Avenue and Roehampton Avenue")  # disabled
location = MosquitoLocation(Location=panel_3)  # -> Address, Points, Type; disabled
item = ListItem(List=location.Points, Index=0, Wrap=True)  # disabled
toggle = BooleanToggle(True)  # disabled
toggle_2 = BooleanToggle(True)  # disabled
toggle_3 = BooleanToggle(True)  # disabled
toggle_4 = BooleanToggle(True)  # disabled
circle = CircleCNR(Center=item, Normal=Vector(0, 0, 1), Radius=panel)  # disabled
vector_maps = VectorMaps(Area=circle, AllRoads=toggle, Buildings=toggle_2, ReProject=toggle_3, CenterToWorld=toggle_4)  # -> RoadLines, RoadInfo, BuildingLines, BuildingInfo, BuildingHeights, AmenityLines, AmenityInfo, AmenityPoints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; disabled
swatch = ColourSwatch(SwatchColor=RGB(0, 0, 0))  # disabled
geo = Geometry([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])  # disabled
geo_2 = Geometry([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])  # disabled
geo_3 = Geometry(Tree({0}: [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], {1}: [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], {2}: [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], {3}: [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], {4}: [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], {5}: [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]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))  # disabled
geo_4 = Geometry([vector_maps.BuildingLines, vector_maps.RoadLines, vector_maps.AmenityLines])  # disabled
preview = CustomPreview(Geometry=[geo_3, geo_2, geo], Shader=swatch)  # disabled

list_2 = ValueList({"divide by depth": "subdivide_depth", "divide by same depth": "subdivide_depth_same", "divide by dim": "subdivide_dim"}, selected="divide by depth")

# ---- group: cpt
vec = Vector(Vector(-545550.1884, 3982019.542, 0))

# ---- group: refYEvec
vec_2 = Vector(Vector(-545759.5384, 3981844.461, 0))

# ----
list_3 = ValueList({"YZ": "NS", "XZ": "EW", "XY": "Z"}, selected="XZ")

# ---- group: dir2cpt
subtraction = Subtraction(A=vec, B=vec_2)

# ----
toggle_5 = BooleanToggle(False)  # disabled

# ---- group: COURTYARD
miru = PythonScript(Code=file_8, Podium_depth=Slider(21, range=0..100), Node_depth=Slider(1, range=-1..1), Run=Toggle(True))  # disabled

# ---- group: DIVIDE
bibil_7 = PythonScript(
    Code=file_7,
    Divide_num=Slider(1, range=0..10),
    Divide_cut=Slider(10, range=0..100),
    Divide_type=list_2,
    Divide_ratio=Slider(0.5, range=0..1),
    Axis=list_3,
    Run=Toggle(False))  # disabled

# ---- group: PACKING
bibil_8 = PythonScript(Code=file_9, Run=toggle_5)  # disabled

# ----
move = Move(Motion=subtraction)  # -> Geometry, Transform

# ---- group: SITE BOUNDARY
geo_5 = Geometry(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)

# ----
boundary = BoundarySurfaces(Edges=geo_5)
geo_6 = Geometry(boundary)
pt = Point(Point(39.14606686, -228.3594019, 0))
circle_2 = CircleCNR(Center=pt, Normal=Vector(0, 0, 1), Radius=Slider(1000, range=0..1000))
# SITE ANALYSIS SETUP
gentestpts = Honeybee_GenerateTestPoints(testGeometry=geo_6, gridSize="20", distBaseSrf="1", moveTestMesh=True)  # -> readMe, simplify(testPoints), simplify(ptsVectors), simplify(facesArea), simplify(mesh); plug-in component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

# ---- group: FORMULA
python = PythonScript(formula="1 / math.exp(0.1813*dist)", focal_ref=pt, focal_weight="1")  # -> value_ref; inputs focal_ref: list
# ---------- python: Python ----------
"""
Bula Formula
"""
import rhinoscriptsyntax as rs

#Formula handling
#dist = 10.
#val = eval(formula)

focal_ref = map(lambda fr: rs.coerce3dpoint(fr),focal_ref)
focal_weight = map(lambda fw: float(fw), focal_weight.split(','))

value_ref = [formula,focal_ref,focal_weight]
# ---------- end python ----------

# ----
number_slider = Slider(2, range=0..10)  # disabled
number_slider_2 = Slider(0.5, range=0..1)  # disabled
number_slider_3 = Slider(10, range=0..100)  # disabled
geo_7 = Geometry(gentestpts.testPoints)
list_4 = ValueList({"divide by depth": "subdivide_depth", "divide by same depth": "subdivide_depth_same", "divide by dim": "subdivide_dim"}, selected="divide by depth")  # disabled
toggle_6 = BooleanToggle(True)  # disabled
list_5 = ValueList({"YZ": "NS", "XZ": "EW", "XY": "Z"}, selected="YZ")  # disabled
bula = PythonScript(
    Code=file_12,
    Analysis_ref=gentestpts.testPoints,
    Value_ref=python,
    Height_bounds="400.",
    Scale=Slider(1, range=0..10),
    Run=Toggle(True))

# ---- group: DIVIDE
bibil_9 = PythonScript(
    Code=file_7,
    Divide_num=number_slider,
    Divide_cut=number_slider_3,
    Divide_type=list_4,
    Divide_ratio=number_slider_2,
    Axis=list_5,
    Run=toggle_6)  # disabled

# ----
toggle_7 = BooleanToggle(True)  # disabled
panel_4 = Panel("roottest")  # disabled
trinco_park = PythonScript(Code=file_6, Rule_in=flatten(bula), Node_in=flatten(geo_6), Label_="site", Run=Toggle(True))  # -> Node_out, Debug
geo_8 = Geometry(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)  # disabled
trinco_park_2 = PythonScript(Code=file_6, Rule_in=bibil_9, Node_in=geo_8, Label_=panel_4, Run=toggle_7)  # -> Node_out, Debug; disabled
g = PythonScript(node=trinco_park.Node_out)  # -> geom; inputs node: list
# ---------- g: Python ----------
if node and node != []:
    geom = []
    #lot_lst = node.traverse_tree(lambda n:n,internal=False)
    for n in node:
        #print n.grammar.type.has_key('bula')
        print n.parent
        geom.append(n.shape.bottom_crv)
    print geom
# ---------- end g ----------
g_2 = PythonScript(node=trinco_park.Node_out)  # -> bula; inputs node: list
# ---------- g_2: Python ----------
if node and node != []:
    geom = []
    #lot_lst = node.traverse_tree(lambda n:n,internal=False)
    #n = node[0].get_root()
    for n in node:
        print n.grammar.type['label']
        print n.grammar.type['bula']
        geom.extend(n.grammar.type['bula_data'].bpt_viz_lst)
    bula = geom
# ---------- end g_2 ----------
g_3 = PythonScript(node=trinco_park.Node_out)  # -> data; inputs node: list
# ---------- g_3: Python ----------
if node and node != []:
    L = []
    #lot_lst = node.traverse_tree(lambda n:n,internal=False)
    #n = node[0].get_root()
    for n in node:
        print n.grammar.type['label']
        print n.grammar.type['bula']
        L.extend(n.grammar.type['bula_data'].value_lst)
    data = map(lambda d: str(round(d,2))+'%',L)
   
    print data
# ---------- end g_3 ----------
g_4 = PythonScript(node=trinco_park_2.Node_out)  # -> geom; inputs node: list; disabled
# ---------- g_4: Python ----------
if node and node != []:
    geom = []
    for n in node:
        #lot_lst = n.traverse_tree(lambda n:n.shape.geom,internal=False)
        geom.append(n.shape.geom)#lot_lst)
    print geom
# ---------- end g_4 ----------

# ---- group: root test
# BUILDING TYPOLOGY
g_5 = PythonScript(node=trinco_park_2.Node_out)  # -> geom; inputs node: list; disabled
# ---------- g_5: Python ----------
if node and node != []:
    geom = []
    for n in node:
        #print 'label: ', n.parent.grammar.type['label']
        geom.append(n.shape.geom)
    
    node[0].grammar.type['label'] = 'leaftest'
    
    print '----'
    root = node[0].get_root()
    #print root.grammar.type['label']
    lstleaf = root.traverse_tree(lambda n: n,internal=False)
    for leaf in lstleaf:
        print leaf.grammar.type['label']
    print '----'
    
    
    node[0].grammar.type['label'] = 'revisedleaftest'
    node[1].grammar.type['label'] = 'revisedtest'
    
    lstleaf = root.traverse_tree(lambda n: n,internal=False)
    for leaf in lstleaf:
        print leaf.grammar.type['label']
    print '----'
# ---------- end g_5 ----------

# ----
geometry = Geometry(g_2)
tag = TextTag(Location=g_2, Text=g_3)

# ---- group: ptref / Block outlines
geo_9 = Geometry([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])

# ---- group: ptref / Soft Sites ref
geo_10 = Geometry([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])

# ---- group: ptref
geo_11 = Geometry(Point(-546064.7372, 3981860.973, 0))
preview_2 = CustomPreview(Geometry=[geo_10, geo_9], Shader=ColourSwatch(SwatchColor=RGB(51, 51, 51)))

# ---- group: ptref / Setbacks
geo_12 = Geometry([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])

# ---- group: ptref / Soft Sites
geo_13 = Geometry([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])

# ----
number_slider_4 = Slider(12, range=0..100)
toggle_8 = BooleanToggle(True)
toggle_9 = BooleanToggle(True)
list_6 = ValueList({"root"}, selected="root")
list_7 = ValueList({"root"}, selected="root")
panel_5 = Panel("C:\\Users\\vasanthakumars\\Documents\\GitHub\\bibil\\src\\reference\\honeybee_work\\Honeybee_SplitZone.py")
panel_6 = Panel("C:\\saeran\\master\\git\\bibil\\src\\reference\\honeybee_work\\Honeybee_SplitZone.py")
panel_7 = Panel("C:\\Users\\vasanthakumars\\Documents\\GitHub\\bibil\\src\\reference\\honeybee_work\\Honeybee_SplitBuildingMass.py")
panel_8 = Panel("C:\\saeran\\master\\git\\bibil\\src\\reference\\honeybee_work\\Honeybee_SplitBuildingMass.py")

# ---- group: SETBACK
miru_2 = PythonScript(Code=file_10, Height=number_slider_4, Distance=Slider(6, range=0..10), Geom_ref=geo_12, Node_ref="-1", Run=Toggle(True))

# ---- group: TREE RULES
miru_3 = PythonScript(Code=file_13, Node=trinco_park.Node_out, Relation=list_6, Insert=toggle_8, Run=toggle_8)

miru_4 = PythonScript(Code=file_13, Node=trinco_park.Node_out, Relation=list_7, Insert=toggle_9, Run=toggle_9)

# ---- group: HEIGHT
miru_5 = PythonScript(Code=file_11, Height="bula", Run=Toggle(True))

miru_6 = PythonScript(Code=file_11, Height=Slider(18, range=0..100), Run=Toggle(True))

# ----
list_8 = ValueList({"dir", "file"}, selected="file")
list_9 = ValueList({"dir", "file"}, selected="file")

# ---- group: find directory
bibil_10 = PythonScript(dir=[panel_6, panel_5], type=list_8, run=Toggle(True))  # -> file; inputs dir: list; same code as bibil

bibil_11 = PythonScript(dir=[panel_8, panel_7], type=list_9, run=Toggle(True))  # -> file; inputs dir: list; same code as bibil

# ----
geo_14 = Geometry([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])
file_14 = ReadFile(File=bibil_11, PerLineParse=False)
file_15 = ReadFile(File=bibil_10, PerLineParse=False)
bibil_12 = PythonScript(Code=file_6, Rule_in=flatten([miru_3, miru_5]), Node_in=flatten(geo_14), Label_="hirise_bld", Run=Toggle(True))  # -> Node_out, Debug
bibil_13 = PythonScript(
    Code=file_6,
    Rule_in=flatten([miru_4, miru_6, miru_2]),
    Node_in=flatten(geo_13),
    Label_="midrise_podium",
    Run=Toggle(True))  # -> Node_out, Debug
geo_15 = Geometry(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)
Z = UnitZ(Factor=number_slider_4)
g_6 = PythonScript(node=bibil_12.Node_out)  # -> geom; inputs node: list
# ---------- g_6: Python ----------
node = filter(lambda n: n!=None,node)
if node and node != []:
    geom = []
    for n in node:
        print n.get_root()
        print n.parent.parent
        print n
        geom.append(n.shape.geom)
    print geom
# ---------- end g_6 ----------
g_7 = PythonScript(node=bibil_13.Node_out)  # -> geom; inputs node: list; same code as g_6

# ---- group: Type_Office
geo_16 = Geometry(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)

# ---- group: Type_Res_Tower
geo_17 = Geometry(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)

# ---- group: Type_Commercial_Midrise
geo_18 = Geometry([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])

# ----
move_2 = Move(Geometry=geo_15, Motion=Z)  # -> Geometry, Transform
split = SplitBrep(Brep=g_7, Cutter=move_2.Geometry)
capex = CapHolesEx(Brep=split)  # -> Brep, Caps, Solid
geo_19 = Geometry([geo_17, g_6])
python_2 = PythonScript(x=flatten(capex.Brep))  # -> a; inputs x: list
# ---------- python_2: Python ----------
import rhinoscriptsyntax as rs
import Rhino as rc

L = []
for x_ in x:
    geom = rs.coercegeometry(x_)
    bbBox = geom.GetBoundingBox(rc.Geometry.Plane.WorldXY)
    maxHeights = bbBox.Max.Z
    minHeights = bbBox.Min.Z
    zdist = maxHeights - minHeights
    if zdist >= 2.:
        L.append(geom)
    
a = L
# ---------- end python_2 ----------
geo_20 = Geometry([python_2, geo_18])
preview_3 = CustomPreview(Geometry=geo_16, Shader=ColourSwatch(SwatchColor=RGB(0, 151, 255)))
preview_4 = CustomPreview(
    Geometry=geo_19,
    Shader={ambient=RGB(0, 0, 0), diffuse=RGB(255, 105, 180), emission=RGB(76, 32, 54), shine=0.5, specular=RGB(255, 255, 255), transparency=0})
preview_5 = CustomPreview(Geometry=geo_20, Shader=ColourSwatch(SwatchColor=RGB(255, 0, 228)))
data = Data(geo_20)
ladybug = Ladybug_Ladybug()  # -> Vviiiiiiiiiizzz; plug-in component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
# ENERGY ARCHETYPE SETUP
honeybee = Honeybee_Honeybee()  # -> Vviiiiiiiiiizzz; plug-in component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
# RESIDENTIAL
splitmass = Honeybee_SplitBuildingMass(Code=file_14, _bldgMasses=geo_17, BldgsFlr2FloorHeights_="@3", _runIt=Toggle(False))  # -> ReadMe, SplitBldgMasses
updatehoneybee = Honeybee_UpdateHoneybee(updateThisFile=Toggle(False))  # -> out; plug-in component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
# COMMERCIAL: OFFICE
splitmass_2 = Honeybee_SplitBuildingMass(Code=file_14, _bldgMasses=geo_16, BldgsFlr2FloorHeights_="@3", _runIt=Toggle(True))  # -> ReadMe, SplitBldgMasses
# COMMERCIAL: RETAIL
splitmass_3 = Honeybee_SplitBuildingMass(Code=file_14, _bldgMasses=data, BldgsFlr2FloorHeights_="@3", _runIt=Toggle(False))  # -> ReadMe, SplitBldgMasses
panel_9 = Panel(updatehoneybee)
listzoneprograms = Honeybee_ListZonePrograms(bldgProgram=Slider(2, range=0..100))  # -> MidriseApartmentZonePrograms; plug-in component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
geo_21 = Geometry(splitmass.SplitBldgMasses)
listzoneprograms_2 = Honeybee_ListZonePrograms(bldgProgram=Slider(0, range=0..100))  # -> OfficeZonePrograms; plug-in component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
geo_22 = Geometry(splitmass_2.SplitBldgMasses)
listzoneprograms_3 = Honeybee_ListZonePrograms(bldgProgram=Slider(1, range=0..100))  # -> RetailZonePrograms; plug-in component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
geo_23 = Geometry(splitmass_3.SplitBldgMasses)
python_3 = PythonScript(Code=file_15, _bldgMasses=flatten(splitmass.SplitBldgMasses), PerimeterZoneDepth_="@3", _runIt=Toggle(True))  # -> ReadMe, SplitBldgMasses, Debug
python_4 = PythonScript(Code=file_15, _bldgMasses=flatten(splitmass_2.SplitBldgMasses), PerimeterZoneDepth_="@3", _runIt=Toggle(True))  # -> ReadMe, SplitBldgMasses, Debug
wires = BrepWireframe(Brep=geo_21, Density=-1)
python_5 = PythonScript(Code=file_15, _bldgMasses=flatten(splitmass_3.SplitBldgMasses), PerimeterZoneDepth_="@3", _runIt=Toggle(True))  # -> ReadMe, SplitBldgMasses, Debug
wires_2 = BrepWireframe(Brep=geo_22, Density=-1)
wires_3 = BrepWireframe(Brep=geo_23, Density=-1)
preview_6 = CustomPreview(
    Geometry=wires,
    Shader={ambient=RGB(0, 0, 0), diffuse=RGB(255, 105, 180), emission=RGB(76, 32, 54), shine=0.5, specular=RGB(255, 255, 255), transparency=0})
preview_7 = CustomPreview(
    Geometry=wires_3,
    Shader={ambient=RGB(0, 0, 0), diffuse=RGB(255, 105, 180), emission=RGB(76, 32, 54), shine=0.5, specular=RGB(255, 255, 255), transparency=0})
preview_8 = CustomPreview(
    Geometry=wires_2,
    Shader={ambient=RGB(0, 0, 0), diffuse=RGB(255, 105, 180), emission=RGB(76, 32, 54), shine=0.5, specular=RGB(255, 255, 255), transparency=0})
num = Number(9)
num_2 = Number(9)
num_3 = Number(9)
item_2 = ListItem(List=listzoneprograms, Index=num, Wrap=True)
geo_24 = Geometry(python_3.Debug)
geo_25 = Geometry(python_3.SplitBldgMasses)
item_3 = ListItem(List=listzoneprograms_2, Index=num_2, Wrap=True)
geo_26 = Geometry(python_4.Debug)
geo_27 = Geometry(python_4.SplitBldgMasses)
item_4 = ListItem(List=listzoneprograms_3, Index=num_3, Wrap=True)
geo_28 = Geometry(python_5.Debug)
geo_29 = Geometry(python_5.SplitBldgMasses)
toggle_10 = BooleanToggle(True)
toggle_11 = BooleanToggle(False)
toggle_12 = BooleanToggle(True)
mass2zone = Honeybee_Masses2Zones(
    zoneMasses=flatten(python_3.SplitBldgMasses),
    zonePrograms=item_2,
    isConditioned=True,
    maxRoofAngle=30,
    createHBZones=toggle_10)  # -> readMe, HBZones; plug-in component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
mass2zone_2 = Honeybee_Masses2Zones(
    zoneMasses=flatten(python_4.SplitBldgMasses),
    zonePrograms=item_3,
    isConditioned=True,
    maxRoofAngle=30,
    createHBZones=toggle_11)  # -> readMe, HBZones; plug-in component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
mass2zone_3 = Honeybee_Masses2Zones(
    zoneMasses=flatten(python_5.SplitBldgMasses),
    zonePrograms=item_4,
    isConditioned=True,
    maxRoofAngle=30,
    createHBZones=toggle_12)  # -> readMe, HBZones; plug-in component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
concat = Concatenate(FragmentA="2", FragmentB="window", JoinSeparator=" ")
concat_2 = Concatenate(FragmentA="2")
solveadjc = Honeybee_SolveAdjacencies(HBZones=flatten(mass2zone.HBZones), removeCurrentAdjc=False, findAdjc=Toggle(True))  # -> readMe, HBZonesWADJ; plug-in component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
concat_3 = Concatenate(FragmentA="2", FragmentB="window", JoinSeparator=" ")
concat_4 = Concatenate(FragmentA="2")
concat_5 = Concatenate(FragmentA="2", FragmentB="window", JoinSeparator=" ")
concat_6 = Concatenate(FragmentA="2")
glzparamlist = Honeybee_GlazingParametersList(northGlzParam="0.3", westGlzParam="0.3", southGlzParam="0.3", eastGlzParam="0.3")  # -> glzParamList; plug-in component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
solveadjc_2 = Honeybee_SolveAdjacencies(HBZones=flatten(mass2zone_2.HBZones), removeCurrentAdjc=False, findAdjc=Toggle(True))  # -> readMe, HBZonesWADJ; plug-in component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
solveadjc_3 = Honeybee_SolveAdjacencies(HBZones=flatten(mass2zone_3.HBZones), removeCurrentAdjc=False, findAdjc=Toggle(True))  # -> readMe, HBZonesWADJ; plug-in component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
glzparamlist_2 = Honeybee_GlazingParametersList(northGlzParam="0.3", westGlzParam="0.3", southGlzParam="0.3", eastGlzParam="0.3")  # -> glzParamList; plug-in component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
glzparamlist_3 = Honeybee_GlazingParametersList(northGlzParam="0.3", westGlzParam="0.3", southGlzParam="0.3", eastGlzParam="0.3")  # -> glzParamList; plug-in component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
callfromepconstrlibrary = Honeybee_CallFromEPConstructionLibrary(keywords=concat_2)  # -> ThermMaterials, EPMaterials, EPWindowMaterials, EPConstructions; plug-in component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
callfromepconstrlibrary_2 = Honeybee_CallFromEPConstructionLibrary(keywords=concat)  # -> ThermMaterials, EPMaterials, EPWindowMaterials, EPConstructions; plug-in component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
callfromepconstrlibrary_3 = Honeybee_CallFromEPConstructionLibrary(keywords=concat_4)  # -> ThermMaterials, EPMaterials, EPWindowMaterials, EPConstructions; plug-in component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
callfromepconstrlibrary_4 = Honeybee_CallFromEPConstructionLibrary(keywords=concat_3)  # -> ThermMaterials, EPMaterials, EPWindowMaterials, EPConstructions; plug-in component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
callfromepconstrlibrary_5 = Honeybee_CallFromEPConstructionLibrary(keywords=concat_6)  # -> ThermMaterials, EPMaterials, EPWindowMaterials, EPConstructions; plug-in component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
callfromepconstrlibrary_6 = Honeybee_CallFromEPConstructionLibrary(keywords=concat_5)  # -> ThermMaterials, EPMaterials, EPWindowMaterials, EPConstructions; plug-in component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
glazingcreator = Honeybee_GlazingBasedOnRatio(HBObjects=solveadjc.HBZonesWADJ, glzRatio=glzparamlist, breakUpWindow=Toggle(False), runIt=toggle_10)  # -> readMe, HBObjWGLZ; plug-in component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
item_5 = ListItem(List=callfromepconstrlibrary.EPConstructions, Index=198, Wrap=True)
item_6 = ListItem(List=callfromepconstrlibrary_2.EPConstructions, Index=44, Wrap=True)
glazingcreator_2 = Honeybee_GlazingBasedOnRatio(HBObjects=solveadjc_2.HBZonesWADJ, glzRatio=glzparamlist_2, breakUpWindow=Toggle(False), runIt=toggle_11)  # -> readMe, HBObjWGLZ; plug-in component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
glazingcreator_3 = Honeybee_GlazingBasedOnRatio(HBObjects=solveadjc_3.HBZonesWADJ, glzRatio=glzparamlist_3, breakUpWindow=Toggle(False), runIt=toggle_12)  # -> readMe, HBObjWGLZ; plug-in component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
item_7 = ListItem(List=callfromepconstrlibrary_3.EPConstructions, Index=198, Wrap=True)
item_8 = ListItem(List=callfromepconstrlibrary_4.EPConstructions, Index=44, Wrap=True)
item_9 = ListItem(List=callfromepconstrlibrary_5.EPConstructions, Index=198, Wrap=True)
item_10 = ListItem(List=callfromepconstrlibrary_6.EPConstructions, Index=44, Wrap=True)
panel_10 = Panel(item_6)
panel_11 = Panel(item_5)
panel_12 = Panel(item_8)
panel_13 = Panel(item_7)
panel_14 = Panel(item_10)
panel_15 = Panel(item_9)
setepzonecnstr = Honeybee_SetEPZoneConstruction(HBZone=glazingcreator.HBObjWGLZ, wallEPConstruction=item_5, windowEPConstruction=item_6)  # -> simplify(modifiedHBZone); plug-in component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
setepzonecnstr_2 = Honeybee_SetEPZoneConstruction(HBZone=glazingcreator_2.HBObjWGLZ, wallEPConstruction=item_7, windowEPConstruction=item_8)  # -> simplify(modifiedHBZone); plug-in component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
setepzonecnstr_3 = Honeybee_SetEPZoneConstruction(HBZone=glazingcreator_3.HBObjWGLZ, wallEPConstruction=item_9, windowEPConstruction=item_10)  # -> simplify(modifiedHBZone); plug-in component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
geo_30 = Geometry(setepzonecnstr)
solveadjc_4 = Honeybee_SolveAdjacencies(HBZones=flatten([setepzonecnstr_3, setepzonecnstr_2]), removeCurrentAdjc=False)  # -> readMe, HBZonesWADJ; disabled; plug-in component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
geo_31 = Geometry(setepzonecnstr_2)
geo_32 = Geometry(setepzonecnstr_3)
data_2 = Data(flatten(setepzonecnstr_2))
toggle_13 = BooleanToggle(True)
epoutput = Honeybee_GenerateEPOutput(
    zoneEnergyUse=toggle_13,
    zoneGainsAndLosses=toggle_13,
    zoneComfortMetrics="False",
    comfortMapVariables=toggle_13,
    zoneHVACParams=toggle_13,
    surfaceTempAnalysis=toggle_13,
    surfaceEnergyAnalysis=toggle_13,
    glazingSolarAnalysis=toggle_13,
    timestep="hourly")  # -> report, flatten(simulationOutputs); plug-in component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
analysisperiod = Ladybug_AnalysisPeriod(fromMonth="12", fromDay="21", fromHour="1", toMonth="12", toDay="21", toHour="24")  # -> readMe, analysisPeriod; plug-in component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
toggle_14 = BooleanToggle(False)
decomposebytype = Honeybee_DecomposeBasedOnType(HBZone=data_2)  # -> walls, interiorWalls, airWalls, flatten(windows), interiorWindows, skylights, roofs, ceilings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; plug-in component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
wires_4 = BrepWireframe(Brep=[decomposebytype.walls, decomposebytype.floors, decomposebytype.ceilings], Density=-1)
geo_33 = Geometry(decomposebytype.floors)
preview_9 = CustomPreview(Geometry=decomposebytype.windows, Shader=ColourSwatch(SwatchColor=RGB(158, 255, 255)))
preview_10 = CustomPreview(Geometry=wires_4, Shader=ColourSwatch(SwatchColor=RGBA(0, 0, 0, 122)))
preview_11 = CustomPreview(Geometry=geo_33, Shader=ColourSwatch(SwatchColor=RGBA(181, 181, 181, 122)))

panel_16 = Panel("C:\\Users\\vasanthakumars\\Documents\\GitHub\\bibil\\src\\reference\\CAN_ON_Toronto.716240_CWEC\\CAN_ON_Toronto.716240_CWEC.epw")
# ENERGY SIMULATION
panel_17 = Panel("C:\saeran\master\git\bibil\src\reference\CAN_ON_Toronto.716240_CWEC\CAN_ON_Toronto.716240_CWEC.epw")
list_10 = ValueList({"dir", "file"}, selected="file")

# ---- group: find directory
bibil_14 = PythonScript(dir=[panel_17, panel_16], type=list_10, run=Toggle(True))  # -> file; inputs dir: list; same code as bibil

# ----
data_3 = Data(bibil_14)

exporttoopenstudio = Honeybee_ExportToOpenStudio(
    epwWeatherFile=bibil_14,
    analysisPeriod=analysisperiod.analysisPeriod,
    energySimPar=epoutput.simulationOutputs,
    HBZones=flatten(data_2),
    writeOSM=toggle_14,
    runSimulation=toggle_14,
    fileName="energy_analysis_montgomery")  # -> readMe, osmFileAddress, idfFileAddress, resultsFileAddress, eioFileAddress, rddFileAddress, studyFolder; plug-in component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
path = FilePath(exporttoopenstudio.resultsFileAddress)
readepsrfresult = Honeybee_ReadEPSurfaceResult(resultFileAddress=path)  # -> surfaceIndoorTemp, surfaceOutdoorTemp, surfaceEnergyFlow, opaqueEnergyFlow, glazEnergyFlow, windowTotalSolarEnergy, windowBeamEnergy, windowDiffEnergy, windowTransmissivity, otherSurfaceData; plug-in component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
readepresult = Honeybee_ReadEPResult(resultFileAddress=path)  # -> totalThermalLoad, thermalLoadBalance, cooling, heating, electricLight, electricEquip, fanElectric, pumpElectric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; plug-in component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
colorzones = Honeybee_ColorZonesByEPResult(zoneData=readepresult.thermalLoadBalance, HBZones=flatten(data_2), normalizeByFloorArea=Toggle(True), runIt=Toggle(True))  # -> readMe, zoneColoredMesh, zoneWireFrame, legend, legendBasePt, analysisTitle, zoneBreps, zoneColors, zoneValues, floorNormZoneData; plug-in component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
colorzones_2 = Honeybee_ColorZonesByEPResult(zoneData=readepresult.totalSolarGain, HBZones=flatten(data_2), normalizeByFloorArea=Toggle(True), runIt=Toggle(True))  # -> readMe, zoneColoredMesh, zoneWireFrame, legend, legendBasePt, analysisTitle, zoneBreps, zoneColors, zoneValues, floorNormZoneData; plug-in component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
panel_18 = Panel(colorzones.floorNormZoneData)
panel_19 = Panel(colorzones_2.floorNormZoneData)
geo_34 = Geometry(colorzones_2.zoneColoredMesh)
preview_12 = CustomPreview(Geometry=colorzones_2.zoneWireFrame, Shader=ColourSwatch(SwatchColor=RGB(0, 0, 0)))
geo_35 = Geometry([colorzones_2.analysisTitle, colorzones_2.legend])
# ENERGY ANALYSIS/VISUALISATION
geo_36 = Geometry(colorzones.zoneColoredMesh)
preview_13 = CustomPreview(Geometry=colorzones.zoneWireFrame, Shader=ColourSwatch(SwatchColor=RGB(0, 0, 0)))
geo_37 = Geometry([colorzones.analysisTitle, colorzones.legend])

# ---- group: thermal_balance
data_4 = Data(colorzones.floorNormZoneData)

# ---- group: solar_gain
data_5 = Data(colorzones_2.floorNormZoneData)
