# Grasshopper definition bibil_trial_084_energy.gh (Grasshopper 0.9.76)
# plug-ins: Python Interpreter, LunchBox, Mosquito

list = ValueList({"dir", "file"}, selected="dir")

# ---- group: find directory
bibil = PythonScript(
    dir=["C:\\Users\\vasanthakumars\\Documents\\GitHub\\bibil\\src", "C:\\saeran\\master\\git\\bibil\\src"],
    type=list,
    run=Toggle(True))  # -> dir; inputs dir: list
# ---------- bibil: Python ----------
import os

ghenv.Component.Params.Output[0].Name = "null"
ghenv.Component.Params.Output[0].NickName = "null"

if run:
    confirm_dir = None
    for d in dir:
        try:
            if type == "file":
                file_ = open(d)
                file_.close()
            else:
                print os.listdir(d)
            confirm_dir = d
            break
        except Exception as e:
            #print str(e)
            continue
    if confirm_dir != None:
        ghenv.Component.Params.Output[0].Name = type
        ghenv.Component.Params.Output[0].NickName = type
        dir = confirm_dir
        file = confirm_dir
null = None
# ---------- end bibil ----------

# ---- group: tree
python_script = PythonScript(i=bibil)  # -> o
# ---------- python_script: Python ----------
import os

if i:
    o = os.path.join(str(i),"bibil\\bibil_tree.py")
# ---------- end python_script ----------
file = ReadFile(File=python_script, PerLineParse=False)
bibil_2 = PythonScript(Code=file)

# ---- group: grammar
python_script_2 = PythonScript(i=bibil)  # -> o
# ---------- python_script_2: Python ----------
import os

if i:
    o = os.path.join(str(i),"bibil\\bibil_grammar.py")
# ---------- end python_script_2 ----------
file_2 = ReadFile(File=python_script_2, PerLineParse=False)
bibil_3 = PythonScript(Code=file_2)

# ---- group: shape
python_script_3 = PythonScript(i=bibil)  # -> o
# ---------- python_script_3: Python ----------
import os

if i:
    o = os.path.join(str(i),"bibil\\bibil_shape.py")
#o = os.path.join(str(i),"research\\bibil_shape_shape_3d_2d.py")
# ---------- end python_script_3 ----------
file_3 = ReadFile(File=python_script_3, PerLineParse=False)
bibil_4 = PythonScript(Code=file_3)

# ---- group: miru
python_script_4 = PythonScript(i=bibil)  # -> o
# ---------- python_script_4: Python ----------
import os

if i:
    o = os.path.join(str(i),"miru\\miru_miru.py")
# ---------- end python_script_4 ----------
file_4 = ReadFile(File=python_script_4, PerLineParse=False)
bibil_5 = PythonScript(Code=file_4)

# ---- group: bula
python_script_5 = PythonScript(i=bibil)  # -> o
# ---------- python_script_5: Python ----------
import os

if i:
    o = os.path.join(str(i),"bula\\bula_minimal.py")
# ---------- end python_script_5 ----------
file_5 = ReadFile(File=python_script_5, PerLineParse=False)
bibil_6 = PythonScript(Code=file_5)

# ---- group: UI
python_script_6 = PythonScript(i=bibil)  # -> o
# ---------- python_script_6: Python ----------
import os

if i:
    o = os.path.join(str(i),"bibil\\bibil_UI.py")
# ---------- end python_script_6 ----------
file_6 = ReadFile(File=python_script_6, PerLineParse=False)

# ---- group: grammar_divide
python_script_7 = PythonScript(i=bibil)  # -> o
# ---------- python_script_7: Python ----------
import os

if i:
    o = os.path.join(str(i),"miru\\miru_divide.py")
# ---------- end python_script_7 ----------
file_7 = ReadFile(File=python_script_7, PerLineParse=False)

# ---- group: grammar_courtyard
python_script_8 = PythonScript(i=bibil)  # -> o
# ---------- python_script_8: Python ----------
import os

if i:
    o = os.path.join(str(i),"miru\\miru_court.py")
# ---------- end python_script_8 ----------
file_8 = ReadFile(File=python_script_8, PerLineParse=False)

# ---- group: grammar_tower
python_script_9 = PythonScript(i=bibil)  # -> o
# ---------- python_script_9: Python ----------
import os

if i:
    o = os.path.join(str(i),"miru\\miru_packing.py")
# ---------- end python_script_9 ----------
file_9 = ReadFile(File=python_script_9, PerLineParse=False)

python_script_10 = PythonScript(i=bibil)  # -> o
# ---------- python_script_10: Python ----------
import os

if i:
    o = os.path.join(str(i),"miru\\miru_stepback.py")
# ---------- end python_script_10 ----------
file_10 = ReadFile(File=python_script_10, PerLineParse=False)

# ---- group: grammar_height
python_script_11 = PythonScript(i=bibil)  # -> o
# ---------- python_script_11: Python ----------
import os

if i:
    o = os.path.join(str(i),"miru\\miru_height.py")
# ---------- end python_script_11 ----------
file_11 = ReadFile(File=python_script_11, PerLineParse=False)

# ---- group: grammar_analysis_pts
python_script_12 = PythonScript(i=bibil)  # -> o
# ---------- python_script_12: Python ----------
import os

if i:
    o = os.path.join(str(i),"miru\\miru_analysis.py")
# ---------- end python_script_12 ----------
file_12 = ReadFile(File=python_script_12, PerLineParse=False)

# ---- group: meta_tree
python_script_13 = PythonScript(i=bibil)  # -> o
# ---------- python_script_13: Python ----------
import os

if i:
    o = os.path.join(str(i),"miru\\miru_meta_tree.py")
# ---------- end python_script_13 ----------
file_13 = ReadFile(File=python_script_13, PerLineParse=False)

# ----
# Note: Change this number with caution,
# Increase bounds iterratively.
panel = Panel("0.004")  # disabled

panel_2 = Panel("Yonge and Eglinton")  # disabled
panel_3 = Panel("Redpath Avenue and Roehampton Avenue")  # disabled
location = MosquitoLocation(Location=panel_3)  # -> Address, Points, Type; disabled
item = ListItem(List=location.Points, Index=0, Wrap=True)  # disabled
toggle = BooleanToggle(True)  # disabled
toggle_2 = BooleanToggle(True)  # disabled
toggle_3 = BooleanToggle(True)  # disabled
toggle_4 = BooleanToggle(True)  # disabled
circle = CircleCNR(Center=item, Normal=Vector(0, 0, 1), Radius=panel)  # disabled
vector_maps = VectorMaps(Area=circle, AllRoads=toggle, Buildings=toggle_2, ReProject=toggle_3, CenterToWorld=toggle_4)  # -> RoadLines, RoadInfo, BuildingLines, BuildingInfo, BuildingHeights, AmenityLines, AmenityInfo, AmenityPoints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; disabled
swatch = ColourSwatch(SwatchColor=RGB(0, 0, 0))  # disabled
geo = Geometry([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])  # disabled
geo_2 = Geometry([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])  # disabled
geo_3 = Geometry(Tree({0}: [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], {1}: [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], {2}: [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], {3}: [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], {4}: [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], {5}: [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]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))  # disabled
geo_4 = Geometry([vector_maps.BuildingLines, vector_maps.RoadLines, vector_maps.AmenityLines])  # disabled
preview = CustomPreview(Geometry=[geo_3, geo_2, geo], Shader=swatch)  # disabled

list_2 = ValueList({"divide by depth": "subdivide_depth", "divide by same depth": "subdivide_depth_same", "divide by dim": "subdivide_dim"}, selected="divide by depth")

# ---- group: cpt
vec = Vector(Vector(-545550.1884, 3982019.542, 0))

# ---- group: refYEvec
vec_2 = Vector(Vector(-545759.5384, 3981844.461, 0))

# ----
list_3 = ValueList({"YZ": "NS", "XZ": "EW", "XY": "Z"}, selected="XZ")

# ---- group: dir2cpt
subtraction = Subtraction(A=vec, B=vec_2)

# ----
toggle_5 = BooleanToggle(False)  # disabled

# ---- group: COURTYARD
miru = PythonScript(Code=file_8, Podium_depth=Slider(21, range=0..100), Node_depth=Slider(1, range=-1..1), Run=Toggle(True))  # disabled

# ---- group: DIVIDE
bibil_7 = PythonScript(
    Code=file_7,
    Divide_num=Slider(1, range=0..10),
    Divide_cut=Slider(10, range=0..100),
    Divide_type=list_2,
    Divide_ratio=Slider(0.5, range=0..1),
    Axis=list_3,
    Run=Toggle(False))  # disabled

# ---- group: PACKING
bibil_8 = PythonScript(Code=file_9, Run=toggle_5)  # disabled

# ----
move = Move(Motion=subtraction)  # -> Geometry, Transform

# ---- group: SITE BOUNDARY
geo_5 = Geometry(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)

# ----
boundary = BoundarySurfaces(Edges=geo_5)
geo_6 = Geometry(boundary)
pt = Point(Point(39.14606686, -228.3594019, 0))
circle_2 = CircleCNR(Center=pt, Normal=Vector(0, 0, 1), Radius=Slider(1000, range=0..1000))
# SITE ANALYSIS SETUP
gentestpts = Honeybee_GenerateTestPoints(testGeometry=geo_6, gridSize="20", distBaseSrf="1", moveTestMesh=True)  # -> readMe, simplify(testPoints), simplify(ptsVectors), simplify(facesArea), simplify(mesh); plug-in component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

# ---- group: FORMULA
python = PythonScript(formula="1 / math.exp(0.1813*dist)", focal_ref=pt, focal_weight="1")  # -> value_ref; inputs focal_ref: list
# ---------- python: Python ----------
"""
Bula Formula
"""
import rhinoscriptsyntax as rs

#Formula handling
#dist = 10.
#val = eval(formula)

focal_ref = map(lambda fr: rs.coerce3dpoint(fr),focal_ref)
focal_weight = map(lambda fw: float(fw), focal_weight.split(','))

value_ref = [formula,focal_ref,focal_weight]
# ---------- end python ----------

# ----
number_slider = Slider(2, range=0..10)  # disabled
number_slider_2 = Slider(0.5, range=0..1)  # disabled
number_slider_3 = Slider(10, range=0..100)  # disabled
geo_7 = Geometry(gentestpts.testPoints)
list_4 = ValueList({"divide by depth": "subdivide_depth", "divide by same depth": "subdivide_depth_same", "divide by dim": "subdivide_dim"}, selected="divide by depth")  # disabled
toggle_6 = BooleanToggle(True)  # disabled
list_5 = ValueList({"YZ": "NS", "XZ": "EW", "XY": "Z"}, selected="YZ")  # disabled
bula = PythonScript(
    Code=file_12,
    Analysis_ref=gentestpts.testPoints,
    Value_ref=python,
    Height_bounds="400.",
    Scale=Slider(1, range=0..10),
    Run=Toggle(True))

# ---- group: DIVIDE
bibil_9 = PythonScript(
    Code=file_7,
    Divide_num=number_slider,
    Divide_cut=number_slider_3,
    Divide_type=list_4,
    Divide_ratio=number_slider_2,
    Axis=list_5,
    Run=toggle_6)  # disabled

# ----
toggle_7 = BooleanToggle(True)  # disabled
panel_4 = Panel("roottest")  # disabled
trinco_park = PythonScript(Code=file_6, Rule_in=flatten(bula), Node_in=flatten(geo_6), Label_="site", Run=Toggle(True))  # -> Node_out, Debug
geo_8 = Geometry(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)  # disabled
trinco_park_2 = PythonScript(Code=file_6, Rule_in=bibil_9, Node_in=geo_8, Label_=panel_4, Run=toggle_7)  # -> Node_out, Debug; disabled
g = PythonScript(node=trinco_park.Node_out)  # -> geom; inputs node: list
# ---------- g: Python ----------
if node and node != []:
    geom = []
    #lot_lst = node.traverse_tree(lambda n:n,internal=False)
    for n in node:
        #print n.grammar.type.has_key('bula')
        print n.parent
        geom.append(n.shape.bottom_crv)
    print geom
# ---------- end g ----------
g_2 = PythonScript(node=trinco_park.Node_out)  # -> bula; inputs node: list
# ---------- g_2: Python ----------
if node and node != []:
    geom = []
    #lot_lst = node.traverse_tree(lambda n:n,internal=False)
    #n = node[0].get_root()
    for n in node:
        print n.grammar.type['label']
        print n.grammar.type['bula']
        geom.extend(n.grammar.type['bula_data'].bpt_viz_lst)
    bula = geom
# ---------- end g_2 ----------
g_3 = PythonScript(node=trinco_park.Node_out)  # -> data; inputs node: list
# ---------- g_3: Python ----------
if node and node != []:
    L = []
    #lot_lst = node.traverse_tree(lambda n:n,internal=False)
    #n = node[0].get_root()
    for n in node:
        print n.grammar.type['label']
        print n.grammar.type['bula']
        L.extend(n.grammar.type['bula_data'].value_lst)
    data = map(lambda d: str(round(d,2))+'%',L)
   
    print data
# ---------- end g_3 ----------
g_4 = PythonScript(node=trinco_park_2.Node_out)  # -> geom; inputs node: list; disabled
# ---------- g_4: Python ----------
if node and node != []:
    geom = []
    for n in node:
        #lot_lst = n.traverse_tree(lambda n:n.shape.geom,internal=False)
        geom.append(n.shape.geom)#lot_lst)
    print geom
# ---------- end g_4 ----------

# ---- group: root test
# BUILDING TYPOLOGY
g_5 = PythonScript(node=trinco_park_2.Node_out)  # -> geom; inputs node: list; disabled
# ---------- g_5: Python ----------
if node and node != []:
    geom = []
    for n in node:
        #print 'label: ', n.parent.grammar.type['label']
        geom.append(n.shape.geom)
    
    node[0].grammar.type['label'] = 'leaftest'
    
    print '----'
    root = node[0].get_root()
    #print root.grammar.type['label']
    lstleaf = root.traverse_tree(lambda n: n,internal=False)
    for leaf in lstleaf:
        print leaf.grammar.type['label']
    print '----'
    
    
    node[0].grammar.type['label'] = 'revisedleaftest'
    node[1].grammar.type['label'] = 'revisedtest'
    
    lstleaf = root.traverse_tree(lambda n: n,internal=False)
    for leaf in lstleaf:
        print leaf.grammar.type['label']
    print '----'
# ---------- end g_5 ----------

# ----
geometry = Geometry(g_2)
tag = TextTag(Location=g_2, Text=g_3)

# ---- group: ptref / Block outlines
geo_9 = Geometry([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])

# ---- group: ptref
geo_10 = Geometry(Point(-546064.7372, 3981860.973, 0))
preview_2 = CustomPreview(Geometry=geo_9, Shader=ColourSwatch(SwatchColor=RGB(51, 51, 51)))

# ---- group: ptref / Setbacks
geo_11 = Geometry([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])

# ---- group: ptref / Soft Sites
geo_12 = Geometry([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])

# ----
number_slider_4 = Slider(12, range=0..100)
number_slider_5 = Slider(18, range=0..100)
toggle_8 = BooleanToggle(True)  # disabled
toggle_9 = BooleanToggle(True)  # disabled
panel_5 = Panel("bula")  # disabled
toggle_10 = BooleanToggle(True)
list_6 = ValueList({"root"}, selected="root")  # disabled
list_7 = ValueList({"root"}, selected="root")
panel_6 = Panel("C:\\Users\\vasanthakumars\\Documents\\GitHub\\bibil\\src\\reference\\honeybee_work\\Honeybee_SplitZone.py")
panel_7 = Panel("C:\\saeran\\master\\git\\bibil\\src\\reference\\honeybee_work\\Honeybee_SplitZone.py")
panel_8 = Panel("C:\\Users\\vasanthakumars\\Documents\\GitHub\\bibil\\src\\reference\\honeybee_work\\Honeybee_SplitBuildingMass.py")
panel_9 = Panel("C:\\saeran\\master\\git\\bibil\\src\\reference\\honeybee_work\\Honeybee_SplitBuildingMass.py")

# ---- group: SETBACK
miru_2 = PythonScript(Code=file_10, Height=number_slider_4, Distance=Slider(6, range=0..10), Geom_ref=geo_11, Node_ref="-1", Run=Toggle(True))

# ---- group: TREE RULES
miru_3 = PythonScript(Code=file_13, Node=trinco_park.Node_out, Relation=list_6, Insert=toggle_8, Run=toggle_8)  # disabled

miru_4 = PythonScript(Code=file_13, Node=trinco_park.Node_out, Relation=list_7, Insert=toggle_10, Run=toggle_10)

# ---- group: HEIGHT
miru_5 = PythonScript(Code=file_11, Height=panel_5, Run=toggle_9)  # disabled

miru_6 = PythonScript(Code=file_11, Height=number_slider_5, Run=Toggle(True))

# ----
list_8 = ValueList({"dir", "file"}, selected="file")
list_9 = ValueList({"dir", "file"}, selected="file")

# ---- group: find directory
bibil_10 = PythonScript(dir=[panel_7, panel_6], type=list_8, run=Toggle(True))  # -> file; inputs dir: list; same code as bibil

bibil_11 = PythonScript(dir=[panel_9, panel_8], type=list_9, run=Toggle(True))  # -> file; inputs dir: list; same code as bibil

# ----
geo_13 = Geometry([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])  # disabled
toggle_11 = BooleanToggle(True)  # disabled
panel_10 = Panel("hirise_bld")  # disabled
file_14 = ReadFile(File=bibil_11, PerLineParse=False)
file_15 = ReadFile(File=bibil_10, PerLineParse=False)
bibil_12 = PythonScript(Code=file_6, Rule_in=flatten([miru_3, miru_5]), Node_in=flatten(geo_13), Label_=panel_10, Run=toggle_11)  # -> Node_out, Debug; disabled
bibil_13 = PythonScript(
    Code=file_6,
    Rule_in=flatten([miru_4, miru_6, miru_2]),
    Node_in=flatten(geo_12),
    Label_="midrise_podium",
    Run=Toggle(True))  # -> Node_out, Debug
g_6 = PythonScript(node=bibil_12.Node_out)  # -> geom; inputs node: list; disabled
# ---------- g_6: Python ----------
node = filter(lambda n: n!=None,node)
if node and node != []:
    geom = []
    for n in node:
        print n.get_root()
        print n.parent.parent
        print n
        geom.append(n.shape.geom)
    print geom
# ---------- end g_6 ----------
geo_14 = Geometry(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)  # disabled
Z = UnitZ(Factor=number_slider_5)  # disabled
geo_15 = Geometry(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)
Z_2 = UnitZ(Factor=number_slider_4)
move_2 = Move(Geometry=geo_14, Motion=Z)  # -> Geometry, Transform; disabled
g_7 = PythonScript(node=bibil_13.Node_out)  # -> geom; inputs node: list; same code as g_6
move_3 = Move(Geometry=geo_15, Motion=Z_2)  # -> Geometry, Transform
split = SplitBrep(Brep=g_6, Cutter=move_2.Geometry)  # disabled
split_2 = SplitBrep(Brep=g_7, Cutter=move_3.Geometry)
capex = CapHolesEx(Brep=split)  # -> Brep, Caps, Solid; disabled
number_slider_6 = Slider(1, range=0..1)  # disabled
capex_2 = CapHolesEx(Brep=split_2)  # -> Brep, Caps, Solid
python_2 = PythonScript(x=flatten(capex.Brep))  # -> base, tower; inputs x: list; disabled
# ---------- python_2: Python ----------
import rhinoscriptsyntax as rs
import Rhino as rc

base,tower = [],[]
for x_ in x:
    geom = rs.coercegeometry(x_)
    bbBox = geom.GetBoundingBox(rc.Geometry.Plane.WorldXY)
    maxHeights = bbBox.Max.Z
    minHeights = bbBox.Min.Z
    zdist = maxHeights - minHeights
    if zdist >= 2.:
        if minHeights <= 1.:
            base.append(geom)
        else:
            tower.append(geom)
# ---------- end python_2 ----------
Z_3 = UnitZ(Factor=number_slider_6)  # disabled
python_3 = PythonScript(x=flatten(capex_2.Brep))  # -> base, tower; inputs x: list; same code as python_2
Z_4 = UnitZ(Factor=Slider(0.25, range=0..1))
geo_16 = Geometry(python_2.base)  # disabled
move_4 = Move(Geometry=python_2.tower, Motion=Z_3)  # -> Geometry, Transform; disabled
geo_17 = Geometry(python_3.base)
move_5 = Move(Geometry=python_3.tower, Motion=Z_4)  # -> Geometry, Transform
panel_11 = Panel("@3")  # disabled
ladybug = Ladybug_Ladybug()  # -> Vviiiiiiiiiizzz; plug-in component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
# ENERGY ARCHETYPE SETUP
honeybee = Honeybee_Honeybee()  # -> Vviiiiiiiiiizzz; plug-in component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
# RESIDENTIAL
splitmass = Honeybee_SplitBuildingMass(Code=file_14, _bldgMasses=move_4.Geometry, BldgsFlr2FloorHeights_=panel_11, _runIt=Toggle(False))  # -> ReadMe, SplitBldgMasses; disabled
updatehoneybee = Honeybee_UpdateHoneybee(updateThisFile=Toggle(False))  # -> out; plug-in component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
# COMMERCIAL: OFFICE
splitmass_2 = Honeybee_SplitBuildingMass(Code=file_14, _bldgMasses=[python_3.base, move_5.Geometry], BldgsFlr2FloorHeights_="@3", _runIt=Toggle(True))  # -> ReadMe, SplitBldgMasses
number_slider_7 = Slider(2, range=0..100)  # disabled
panel_12 = Panel(updatehoneybee)
panel_13 = Panel("@3")  # disabled
toggle_12 = BooleanToggle(True)  # disabled
listzoneprograms = Honeybee_ListZonePrograms(bldgProgram=number_slider_7)  # -> MidriseApartmentZonePrograms; disabled; plug-in component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
geo_18 = Geometry(splitmass.SplitBldgMasses)  # disabled
listzoneprograms_2 = Honeybee_ListZonePrograms(bldgProgram=Slider(2, range=0..100))  # -> MidriseApartmentZonePrograms; plug-in component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
geo_19 = Geometry(splitmass_2.SplitBldgMasses)
python_4 = PythonScript(Code=file_15, _bldgMasses=flatten(splitmass.SplitBldgMasses), PerimeterZoneDepth_=panel_13, _runIt=toggle_12)  # -> ReadMe, SplitBldgMasses, Debug; disabled
python_5 = PythonScript(Code=file_15, _bldgMasses=flatten(splitmass_2.SplitBldgMasses), PerimeterZoneDepth_="@3", _runIt=Toggle(True))  # -> ReadMe, SplitBldgMasses, Debug
wires = BrepWireframe(Brep=geo_18, Density=-1)  # disabled
wires_2 = BrepWireframe(Brep=geo_19, Density=-1)
preview_3 = CustomPreview(
    Geometry=wires,
    Shader={ambient=RGB(0, 0, 0), diffuse=RGB(255, 105, 180), emission=RGB(76, 32, 54), shine=0.5, specular=RGB(255, 255, 255), transparency=0})  # disabled
preview_4 = CustomPreview(
    Geometry=wires_2,
    Shader={ambient=RGB(0, 0, 0), diffuse=RGB(255, 105, 180), emission=RGB(76, 32, 54), shine=0.5, specular=RGB(255, 255, 255), transparency=0})
num = Number(9)  # disabled
num_2 = Number(9)
item_2 = ListItem(List=listzoneprograms, Index=num, Wrap=True)  # disabled
geo_20 = Geometry(python_4.Debug)  # disabled
geo_21 = Geometry(python_4.SplitBldgMasses)  # disabled
item_3 = ListItem(List=listzoneprograms_2, Index=num_2, Wrap=True)
geo_22 = Geometry(python_5.Debug)
geo_23 = Geometry(python_5.SplitBldgMasses)
toggle_13 = BooleanToggle(False)  # disabled
mass2zone = Honeybee_Masses2Zones(
    zoneMasses=flatten(python_4.SplitBldgMasses),
    zonePrograms=item_2,
    isConditioned=True,
    maxRoofAngle=30,
    createHBZones=toggle_13)  # -> readMe, HBZones; disabled; plug-in component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
mass2zone_2 = Honeybee_Masses2Zones(
    zoneMasses=flatten(python_5.SplitBldgMasses),
    zonePrograms=item_3,
    isConditioned=True,
    maxRoofAngle=30,
    createHBZones=Toggle(True))  # -> readMe, HBZones; plug-in component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
toggle_14 = BooleanToggle(False)  # disabled
panel_14 = Panel("2")  # disabled
panel_15 = Panel("2")  # disabled
panel_16 = Panel("window")  # disabled
solveadjc = Honeybee_SolveAdjacencies(HBZones=flatten(mass2zone_2.HBZones), removeCurrentAdjc=False, findAdjc=Toggle(True))  # -> readMe, HBZonesWADJ; plug-in component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
solveadjc_2 = Honeybee_SolveAdjacencies(HBZones=flatten(mass2zone.HBZones), removeCurrentAdjc=False, findAdjc=toggle_14)  # -> readMe, HBZonesWADJ; disabled; plug-in component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
panel_17 = Panel("0.3")  # disabled
concat = Concatenate(FragmentA="2", FragmentB="window", JoinSeparator=" ")
concat_2 = Concatenate(FragmentA="2")
concat_3 = Concatenate(FragmentA=panel_15, FragmentB=panel_16, JoinSeparator=" ")  # disabled
concat_4 = Concatenate(FragmentA=panel_14)  # disabled
glzparamlist = Honeybee_GlazingParametersList(northGlzParam="0.3", westGlzParam="0.3", southGlzParam="0.3", eastGlzParam="0.3")  # -> glzParamList; plug-in component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
glzparamlist_2 = Honeybee_GlazingParametersList(northGlzParam=panel_17, westGlzParam=panel_17, southGlzParam=panel_17, eastGlzParam=panel_17)  # -> glzParamList; disabled; plug-in component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
callfromepconstrlibrary = Honeybee_CallFromEPConstructionLibrary(keywords=concat_2)  # -> ThermMaterials, EPMaterials, EPWindowMaterials, EPConstructions; plug-in component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
callfromepconstrlibrary_2 = Honeybee_CallFromEPConstructionLibrary(keywords=concat)  # -> ThermMaterials, EPMaterials, EPWindowMaterials, EPConstructions; plug-in component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
callfromepconstrlibrary_3 = Honeybee_CallFromEPConstructionLibrary(keywords=concat_4)  # -> ThermMaterials, EPMaterials, EPWindowMaterials, EPConstructions; disabled; plug-in component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
callfromepconstrlibrary_4 = Honeybee_CallFromEPConstructionLibrary(keywords=concat_3)  # -> ThermMaterials, EPMaterials, EPWindowMaterials, EPConstructions; disabled; plug-in component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
toggle_15 = BooleanToggle(True)  # disabled
toggle_16 = BooleanToggle(False)  # disabled
glazingcreator = Honeybee_GlazingBasedOnRatio(HBObjects=solveadjc.HBZonesWADJ, glzRatio=glzparamlist, breakUpWindow=Toggle(False), runIt=Toggle(True))  # -> readMe, HBObjWGLZ; plug-in component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
glazingcreator_2 = Honeybee_GlazingBasedOnRatio(HBObjects=solveadjc_2.HBZonesWADJ, glzRatio=glzparamlist_2, breakUpWindow=toggle_16, runIt=toggle_15)  # -> readMe, HBObjWGLZ; disabled; plug-in component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
item_4 = ListItem(List=callfromepconstrlibrary.EPConstructions, Index=198, Wrap=True)
item_5 = ListItem(List=callfromepconstrlibrary_2.EPConstructions, Index=44, Wrap=True)
item_6 = ListItem(List=callfromepconstrlibrary_3.EPConstructions, Index=198, Wrap=True)  # disabled
item_7 = ListItem(List=callfromepconstrlibrary_4.EPConstructions, Index=44, Wrap=True)  # disabled
panel_18 = Panel(item_5)
panel_19 = Panel(item_4)
panel_20 = Panel(item_7)  # disabled
panel_21 = Panel(item_6)  # disabled
setepzonecnstr = Honeybee_SetEPZoneConstruction(HBZone=glazingcreator.HBObjWGLZ, wallEPConstruction=item_4, windowEPConstruction=item_5)  # -> simplify(modifiedHBZone); plug-in component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
setepzonecnstr_2 = Honeybee_SetEPZoneConstruction(HBZone=glazingcreator_2.HBObjWGLZ, wallEPConstruction=item_6, windowEPConstruction=item_7)  # -> simplify(modifiedHBZone); disabled; plug-in component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
geo_24 = Geometry(setepzonecnstr)
data = Data(flatten(setepzonecnstr))
toggle_17 = BooleanToggle(True)

geo_25 = Geometry([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])
hb_epcontextsrf = HoneybeeEPContextSurfaces(shdSurfaces=flatten(geo_25), justBoundingBox=Toggle(False))  # -> HBContext; inputs shdSurfaces: list of Brep, justBoundingBox: Boolean
# ---------- hb_epcontextsrf: Python ----------
"""
prepare shading/context geometries

    Args:
        northVectorOrRotation: A vector that shows North or a number that shows
                               the rotation of the North from the Y axis
        bldgMasses: List of closed Breps as thermal zones.
    Returns:
        report: ...
        thermalZones: Thermal zone's geometries for visualiza
"""

ghenv.Component.Name = 'Honeybee EP context Surfaces'
ghenv.Component.NickName = 'HB_EPContextSrf'
ghenv.Component.Message = 'VER 0.0.60\nAUG_10_2016'
ghenv.Component.IconDisplayMode = ghenv.Component.IconDisplayMode.application
ghenv.Component.Category = "Honeybee"
ghenv.Component.SubCategory = "10 | Energy | Energy"
#compatibleHBVersion = VER 0.0.57\nNOV_01_2015
#compatibleLBVersion = VER 0.0.59\nFEB_01_2015
ghenv.Component.AdditionalHelpFromDocStrings = "2"

import rhinoscriptsyntax as rs
import Rhino as rc
import scriptcontext as sc
import os
import System
import Grasshopper.Kernel as gh
import uuid

tolerance = sc.doc.ModelAbsoluteTolerance
import math


def main(shdSurfaces, EPTransSchedule, meshingSettings, justBoundingBox):
    
    # import the classes
    if sc.sticky.has_key('honeybee_release'):

        try:
            if not sc.sticky['honeybee_release'].isCompatible(ghenv.Component): return -1
            if sc.sticky['honeybee_release'].isInputMissing(ghenv.Component): return -1
        except:
            warning = "You need a newer version of Honeybee to use this compoent." + \
            " Use updateHoneybee component to update userObjects.\n" + \
            "If you have already updated userObjects drag Honeybee_Honeybee component " + \
            "into canvas and try again."
            w = gh.GH_RuntimeMessageLevel.Warning
            ghenv.Component.AddRuntimeMessage(w, warning)
            return -1
        
        # don't customize this part
        hb_EPSrf = sc.sticky["honeybee_EPSurface"]
        hb_EPSHDSurface = sc.sticky["honeybee_EPShdSurface"]
        hb_RADMaterialAUX = sc.sticky["honeybee_RADMaterialAUX"]
        hb_EPObjectsAux = sc.sticky["honeybee_EPObjectsAUX"]()
        HBScheduleList = sc.sticky["honeybee_ScheduleLib"].keys()

        ########################################################################
        #----------------------------------------------------------------------#
        shdBreps = []
        # create bounding box of shading geometries
        if justBoundingBox:
            for brep in shdSurfaces:
                if brep.Faces.Count>1 or not brep.Faces[0].IsPlanar(sc.doc.ModelAbsoluteTolerance):
                    shdBreps.append(brep.GetBoundingBox(True).ToBrep())
                else:
                    shdBreps.append(brep)
        else:
            shdBreps = shdSurfaces
        
        shadingClasses = []
        shadingMeshPreview = []
        
        if meshingSettings == None:
            mp = rc.Geometry.MeshingParameters.Minimal
            mp.SimplePlanes = True
        else:
            mp = meshingSettings
        
        def getRadMaterialName(radMaterial):
            nameStr = radMaterial.split(" ")[2]
            name =  nameStr.split("\n")[0]
            return name
        
        for brepCount, brep in enumerate(shdBreps):
            if brep != None:
                isPlanar = True
                # check planarity
                for face in brep.Faces:
                    if not face.IsPlanar(tolerance):
                        isPlanar = False
                        break
                
                shadingBreps = []
                if not isPlanar:
                    meshArray = rc.Geometry.Mesh.CreateFromBrep(brep, mp)
                    for mesh in meshArray:
                        for meshFace in range(mesh.Faces.Count):
                            vertices = list(mesh.Faces.GetFaceVertices(meshFace))[1:]
                            vertices = vertices + [sc.doc.ModelAbsoluteTolerance]
                            # create the brep from mesh
                            shdBrep = rc.Geometry.Brep.CreateFromCornerPoints(*vertices)
                            shadingBreps.append(shdBrep)
                else:
                    for face in brep.Faces:
                        shadingBreps.append(face.DuplicateFace(False))
                
                for faceCount, shdBrep in enumerate(shadingBreps):
                        thisShading = hb_EPSHDSurface(shdBrep, 1000*brepCount + faceCount, 'shdSrf_' + `brepCount` + '_' + `faceCount` + "_" + str(uuid.uuid4()))
                        
                        # add transmittance schedule if any
                        if EPTransSchedule!=None:
                            schedule= EPTransSchedule.upper()
                            if schedule!=None and not schedule.lower().endswith(".csv") and schedule not in HBScheduleList:
                                msg = "Cannot find " + schedule + " in Honeybee schedule library."
                                print msg
                                ghenv.Component.AddRuntimeMessage(gh.GH_RuntimeMessageLevel.Warning, msg)
                                return -1
                            elif schedule!=None and schedule.lower().endswith(".csv"):
                                # check if csv file is existed
                                if not os.path.isfile(schedule):
                                    msg = "Cannot find the shchedule file: " + schedule
                                    print msg
                                    ghenv.Component.AddRuntimeMessage(gh.GH_RuntimeMessageLevel.Warning, msg)
                                    return -1
                            
                            thisShading.TransmittanceSCH = schedule
                        
                        # add the Rad Material if any
                        if RADMaterial!=None:
                            # if it is just the name of the material make sure it is already defined
                            if len(RADMaterial.split(" ")) == 1:
                                # if the material is not in the library add it to the library
                                if not hb_RADMaterialAUX.isMatrialExistInLibrary(RADMaterial):
                                    warningMsg = "Can't find " + RADMaterial + " in RAD Material Library.\n" + \
                                                "Add the material to the library and try again."
                                    ghenv.Component.AddRuntimeMessage(gh.GH_RuntimeMessageLevel.Warning, warningMsg)
                                    return
                                
                                try:
                                    thisShading.setRADMaterial(RADMaterial)
                                except Exception, e:
                                    print e
                                    warningMsg = "You are using an old version of Honeybee_Honeybee! Update your files and try again."
                                    print warningMsg
                                    ghenv.Component.AddRuntimeMessage(gh.GH_RuntimeMessageLevel.Warning, warningMsg)
                                    return
                                
                                addedToLib = True
                            else:
                                
                                # try to add the material to the library
                                addedToLib, thisShading.RadMaterial = hb_RADMaterialAUX.analyseRadMaterials(RADMaterial, True)
                                
                            if addedToLib==False:
                                warningMsg = "Failed to add " + RADMaterial + " to the Library."
                                ghenv.Component.AddRuntimeMessage(gh.GH_RuntimeMessageLevel.Warning, warningMsg)
                                return
                        
                        # add shading to the list
                        shadingClasses.append(thisShading)
                
        # add to the hive
        hb_hive = sc.sticky["honeybee_Hive"]()
        HBContext  = hb_hive.addToHoneybeeHive(shadingClasses, ghenv.Component.InstanceGuid.ToString())
        return HBContext
        ################################################################################################
    else:
        print "You should first let Honeybee to fly..."
        w = gh.GH_RuntimeMessageLevel.Warning
        ghenv.Component.AddRuntimeMessage(w, "You should first let Honeybee to fly...")
        return -1
        

if _shdSurfaces and _shdSurfaces[0]!=None:
    # add cleaning function
    result= main(_shdSurfaces, EPTransSchedule_, meshingSettings_, justBoundingBox_)
    
    if result != -1: HBContext = result
# ---------- end hb_epcontextsrf ----------

epoutput = Honeybee_GenerateEPOutput(
    zoneEnergyUse=toggle_17,
    zoneGainsAndLosses=toggle_17,
    zoneComfortMetrics="False",
    comfortMapVariables=toggle_17,
    zoneHVACParams=toggle_17,
    surfaceTempAnalysis=toggle_17,
    surfaceEnergyAnalysis=toggle_17,
    glazingSolarAnalysis=toggle_17,
    timestep="hourly")  # -> report, flatten(simulationOutputs); plug-in component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
analysisperiod = Ladybug_AnalysisPeriod(fromMonth="12", fromDay="21", fromHour="1", toMonth="12", toDay="21", toHour="24")  # -> readMe, analysisPeriod; plug-in component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
toggle_18 = BooleanToggle(True)
decomposebytype = Honeybee_DecomposeBasedOnType(HBZone=data)  # -> walls, interiorWalls, airWalls, flatten(windows), interiorWindows, skylights, roofs, ceilings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; plug-in component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
geo_26 = Geometry(hb_epcontextsrf)
preview_5 = CustomPreview(Geometry=geo_26, Shader=ColourSwatch(SwatchColor=RGB(138, 138, 138)))
wires_3 = BrepWireframe(Brep=g_7, Density=-1)
wires_4 = BrepWireframe(Brep=[decomposebytype.walls, decomposebytype.floors, decomposebytype.ceilings], Density=-1)
preview_6 = CustomPreview(Geometry=wires_3, Shader=ColourSwatch(SwatchColor=RGB(43, 43, 43)))
preview_7 = CustomPreview(Geometry=decomposebytype.windows, Shader=ColourSwatch(SwatchColor=RGB(158, 255, 255)))
preview_8 = CustomPreview(Geometry=wires_4, Shader=ColourSwatch(SwatchColor=RGBA(0, 0, 0, 122)))
panel_22 = Panel("19")  # disabled
gradientlibrary = Ladybug_GradientLibrary(gradIndex=panel_22)  # -> customColors; disabled; plug-in component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
panel_23 = Panel("-4000")  # disabled
panel_24 = Panel("4000")  # disabled
toggle_19 = BooleanToggle(True)  # disabled
toggle_20 = BooleanToggle(False)
toggle_21 = BooleanToggle(True)
legendpar = Ladybug_LegendParameters(lowBound=panel_23, highBound=panel_24, customColors=flatten(gradientlibrary))  # -> legendPar; disabled; plug-in component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
toggle_22 = BooleanToggle(True)
panel_25 = Panel("Y+E Energy Balance")  # disabled
panel_26 = Panel("Energy (kWh)")  # disabled
toggle_23 = BooleanToggle(True)  # disabled
pt_2 = Point(Point(113.4954235, -63.70216216, 0))  # disabled

panel_27 = Panel("C:\\Users\\vasanthakumars\\Documents\\GitHub\\bibil\\src\\reference\\CAN_ON_Toronto.716240_CWEC\\CAN_ON_Toronto.716240_CWEC.epw")
# ENERGY SIMULATION
panel_28 = Panel("C:\saeran\master\git\bibil\src\reference\CAN_ON_Toronto.716240_CWEC\CAN_ON_Toronto.716240_CWEC.epw")
list_10 = ValueList({"dir", "file"}, selected="file")

# ---- group: find directory
bibil_14 = PythonScript(dir=[panel_28, panel_27], type=list_10, run=Toggle(True))  # -> file; inputs dir: list; same code as bibil

# ----
data_2 = Data(bibil_14)

runenergysimulation = Honeybee_RunEnergySimulation(
    epwFile=bibil_14,
    analysisPeriod=analysisperiod.analysisPeriod,
    HBZones=flatten(data),
    HBContext=flatten(hb_epcontextsrf),
    simulationOutputs=flatten(epoutput.simulationOutputs),
    writeIdf=toggle_18,
    runEnergyPlus=toggle_18,
    idfFileName="energy_analysis_montgomery")  # -> report, idfFileAddress, resultFileAddress; plug-in component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
path = FilePath(runenergysimulation.resultFileAddress)
readepsrfresult = Honeybee_ReadEPSurfaceResult(resultFileAddress=path)  # -> surfaceIndoorTemp, surfaceOutdoorTemp, surfaceEnergyFlow, opaqueEnergyFlow, glazEnergyFlow, windowTotalSolarEnergy, windowBeamEnergy, windowDiffEnergy, windowTransmissivity, port; plug-in component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
readepresult = Honeybee_ReadEPResult(resultFileAddress=path)  # -> totalThermalLoad, thermalLoadBalance, cooling, heating, electricLight, electricEquip, port, port_2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; plug-in component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
colorzones = Honeybee_ColorZonesByEPResult(zoneData=readepresult.heating, HBZones=flatten(data), normalizeByFloorArea=Toggle(True), runIt=Toggle(True))  # -> readMe, zoneColoredMesh, zoneWireFrame, legend, legendBasePt, analysisTitle, zoneBreps, zoneColors, zoneValues, floorNormZoneData; plug-in component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
colorzones_2 = Honeybee_ColorZonesByEPResult(zoneData=readepresult.totalSolarGain, HBZones=flatten(data), normalizeByFloorArea=Toggle(True), runIt=Toggle(True))  # -> readMe, zoneColoredMesh, zoneWireFrame, legend, legendBasePt, analysisTitle, zoneBreps, zoneColors, zoneValues, floorNormZoneData; plug-in component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
panel_29 = Panel(colorzones.floorNormZoneData)
panel_30 = Panel(colorzones_2.floorNormZoneData)
geo_27 = Geometry(colorzones_2.zoneColoredMesh)
preview_9 = CustomPreview(Geometry=colorzones_2.zoneWireFrame, Shader=ColourSwatch(SwatchColor=RGB(0, 0, 0)))
geo_28 = Geometry([colorzones_2.analysisTitle, colorzones_2.legend])
# ENERGY ANALYSIS/VISUALISATION
geo_29 = Geometry(colorzones.zoneColoredMesh)
preview_10 = CustomPreview(Geometry=colorzones.zoneWireFrame, Shader=ColourSwatch(SwatchColor=RGB(0, 0, 0)))
geo_30 = Geometry([colorzones.analysisTitle, colorzones.legend])

# ---- group: thermal_balance
data_3 = Data(colorzones.floorNormZoneData)

# ---- group: solar_gain
data_4 = Data(colorzones_2.floorNormZoneData)

# ----
energybalance = Honeybee_ConstructEnergyBalance(
    HBZones=flatten(data),
    cooling=readepresult.cooling,
    heating=readepresult.heating,
    electricLight=readepresult.electricLight,
    electricEquip=readepresult.electricEquip,
    peopleGains=readepresult.peopleGains,
    totalSolarGain=readepresult.totalSolarGain,
    infiltrationEnergy=readepresult.infiltrationEnergy,
    mechVentilationEnergy=readepresult.mechVentilationEnergy,
    surfaceEnergyFlow=readepsrfresult.surfaceEnergyFlow)  # -> readMe, port, flrNormEnergyBal, flrNormBalWStorage, port_2, modelEnergyBalance, energyBalWithStorage; plug-in component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
python_6 = PythonScript(x=energybalance.flrNormEnergyBal)  # -> heat, solar, equip, light, people, infil, mech_vent, opaque_conduct, glaze_conduct, cool; inputs x: tree
# ---------- python_6: Python ----------
heat = []
solar = []
cool = []
equip = []
light = []
people = []
infil = []
mech_vent = []
opaque_conduct = []
glaze_conduct = []
cool = [] 
for i in range(x.BranchCount):
    data = list(x.Branch(i))
    #print data[2],data[3]
    #print data[7:]
    #print '--'
    if i == 0:
        heat.extend(data[7:])
    elif i == 1:
        solar.extend(data[7:])
    elif i == 2:
        cool.extend(data[7:])
    elif i == 3:
        equip.extend(data[7:])
    elif i == 4:
        light.extend(data[7:])
    elif i == 5:
        people.extend(data[7:])
    elif i == 6:
        infil.extend(data[7:])
    elif i == 7:
        mech_vent.extend(data[7:])
    elif i == 8:
        opaque_conduct.extend(data[7:])
    elif i == 9:
        glaze_conduct.extend(data[7:])
    else:
        cool.extend(data[7:])
# ---------- end python_6 ----------
selectandaveragedata = Ladybug_AverageData(annualHourlyData=energybalance.flrNormEnergyBal, analysisPeriod=analysisperiod.analysisPeriod, totalOrAverage=toggle_19)  # -> readMe, selHourlyData, totaledDaily, totaledMonthly, totMonthlyPerHour, totAnalysisPeriod; disabled; plug-in component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
excelwrite = ExcelWriteLEGACY(
    WriteToggle=toggle_21,
    WriteHeading=toggle_22,
    ClearSheet=toggle_20,
    Worksheet=1,
    ColumnStart=Slider(6, range=0..10),
    RowStart=1,
    ColumnHeadings=["Infiltration", "Mech_Vent", "Opaque Conduction", "Glazing Conduction", "Cool"],
    Column1=python_6.infil,
    Column2=python_6.mech_vent,
    Column3=python_6.opaque_conduct,
    Column4=python_6.glaze_conduct,
    Column5=python_6.cool)
excelwrite_2 = ExcelWriteLEGACY(
    WriteToggle=toggle_21,
    WriteHeading=toggle_22,
    ClearSheet=toggle_20,
    Worksheet=1,
    ColumnStart=Slider(1, range=0..1),
    RowStart=1,
    ColumnHeadings=["Heating", "Solar", "Equipment", "Lighting", "People"],
    Column1=python_6.heat,
    Column2=python_6.solar,
    Column3=python_6.equip,
    Column4=python_6.light,
    Column5=python_6.people)
barchart = Ladybug_MonthlyBarChart(
    inputData=flatten(selectandaveragedata.totaledDaily),
    stackValues=toggle_23,
    altTitle=panel_25,
    altYAxisTitle=panel_26,
    basePoint=pt_2,
    legendPar=legendpar)  # -> readMe, dataMesh, dataCurves, dataCrvColors, graphAxes, graphLabels, title, titleBasePt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; disabled; plug-in component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
preview_11 = CustomPreview(Geometry=barchart.graphAxes, Shader=ColourSwatch(SwatchColor=RGB(0, 0, 0)))
