# Grasshopper definition bibil_trial_086.gh (Grasshopper 0.9.76)
# plug-ins: Python Interpreter, Human, ArchsimGH, Mosquito

list = ValueList({"dir", "file"}, selected="dir")

# ---- group: find directory
bibil = PythonScript(
    dir=["C:\\Users\\vasanthakumars\\Documents\\GitHub\\bibil\\src", "C:\\saeran\\master\\git\\bibil\\src"],
    type=list,
    run=Toggle(True))  # -> dir; inputs dir: list
# ---------- bibil: Python ----------
import os

ghenv.Component.Params.Output[0].Name = "null"
ghenv.Component.Params.Output[0].NickName = "null"

if run:
    confirm_dir = None
    for d in dir:
        try:
            if type == "file":
                file_ = open(d)
                file_.close()
            else:
                print os.listdir(d)
            confirm_dir = d
            break
        except Exception as e:
            #print str(e)
            continue
    if confirm_dir != None:
        ghenv.Component.Params.Output[0].Name = type
        ghenv.Component.Params.Output[0].NickName = type
        dir = confirm_dir
        file = confirm_dir
null = None
# ---------- end bibil ----------

# ---- group: tree
python_script = PythonScript(i=bibil)  # -> o
# ---------- python_script: Python ----------
import os

if i:
    o = os.path.join(str(i),"bibil\\bibil_tree.py")
# ---------- end python_script ----------
file = ReadFile(File=python_script, PerLineParse=False)
bibil_2 = PythonScript(Code=file)

# ---- group: grammar
python_script_2 = PythonScript(i=bibil)  # -> o
# ---------- python_script_2: Python ----------
import os

if i:
    o = os.path.join(str(i),"bibil\\bibil_grammar.py")
# ---------- end python_script_2 ----------
file_2 = ReadFile(File=python_script_2, PerLineParse=False)
bibil_3 = PythonScript(Code=file_2)

# ---- group: shape
python_script_3 = PythonScript(i=bibil)  # -> o
# ---------- python_script_3: Python ----------
import os

if i:
    o = os.path.join(str(i),"bibil\\bibil_shape.py")
#o = os.path.join(str(i),"research\\bibil_shape_shape_3d_2d.py")
# ---------- end python_script_3 ----------
file_3 = ReadFile(File=python_script_3, PerLineParse=False)
bibil_4 = PythonScript(Code=file_3)

# ---- group: miru
python_script_4 = PythonScript(i=bibil)  # -> o
# ---------- python_script_4: Python ----------
import os

if i:
    o = os.path.join(str(i),"miru\\miru_miru.py")
# ---------- end python_script_4 ----------
file_4 = ReadFile(File=python_script_4, PerLineParse=False)
bibil_5 = PythonScript(Code=file_4)

# ---- group: bula
python_script_5 = PythonScript(i=bibil)  # -> o
# ---------- python_script_5: Python ----------
import os

if i:
    o = os.path.join(str(i),"bula\\bula_minimal.py")
# ---------- end python_script_5 ----------
file_5 = ReadFile(File=python_script_5, PerLineParse=False)
bibil_6 = PythonScript(Code=file_5)

# ---- group: UI
python_script_6 = PythonScript(i=bibil)  # -> o
# ---------- python_script_6: Python ----------
import os

if i:
    o = os.path.join(str(i),"bibil\\bibil_UI.py")
# ---------- end python_script_6 ----------
file_6 = ReadFile(File=python_script_6, PerLineParse=False)

# ---- group: grammar_divide
python_script_7 = PythonScript(i=bibil)  # -> o
# ---------- python_script_7: Python ----------
import os

if i:
    o = os.path.join(str(i),"miru\\miru_divide.py")
# ---------- end python_script_7 ----------
file_7 = ReadFile(File=python_script_7, PerLineParse=False)

# ---- group: grammar_courtyard
python_script_8 = PythonScript(i=bibil)  # -> o
# ---------- python_script_8: Python ----------
import os

if i:
    o = os.path.join(str(i),"miru\\miru_court.py")
# ---------- end python_script_8 ----------
file_8 = ReadFile(File=python_script_8, PerLineParse=False)

# ---- group: grammar_tower
python_script_9 = PythonScript(i=bibil)  # -> o
# ---------- python_script_9: Python ----------
import os

if i:
    o = os.path.join(str(i),"miru\\miru_packing.py")
# ---------- end python_script_9 ----------
file_9 = ReadFile(File=python_script_9, PerLineParse=False)

python_script_10 = PythonScript(i=bibil)  # -> o
# ---------- python_script_10: Python ----------
import os

if i:
    o = os.path.join(str(i),"miru\\miru_stepback.py")
# ---------- end python_script_10 ----------
file_10 = ReadFile(File=python_script_10, PerLineParse=False)

# ---- group: grammar_height
python_script_11 = PythonScript(i=bibil)  # -> o
# ---------- python_script_11: Python ----------
import os

if i:
    o = os.path.join(str(i),"miru\\miru_height.py")
# ---------- end python_script_11 ----------
file_11 = ReadFile(File=python_script_11, PerLineParse=False)

# ---- group: grammar_analysis_pts
python_script_12 = PythonScript(i=bibil)  # -> o
# ---------- python_script_12: Python ----------
import os

if i:
    o = os.path.join(str(i),"miru\\miru_analysis.py")
# ---------- end python_script_12 ----------
file_12 = ReadFile(File=python_script_12, PerLineParse=False)

# ---- group: meta_tree
python_script_13 = PythonScript(i=bibil)  # -> o
# ---------- python_script_13: Python ----------
import os

if i:
    o = os.path.join(str(i),"miru\\miru_meta_tree.py")
# ---------- end python_script_13 ----------
file_13 = ReadFile(File=python_script_13, PerLineParse=False)

# ----
# Note: Change this number with caution,
# Increase bounds iterratively.
panel = Panel("0.004")  # disabled

panel_2 = Panel("Yonge and Eglinton")  # disabled
panel_3 = Panel("Redpath Avenue and Roehampton Avenue")  # disabled
location = MosquitoLocation(Location=panel_3)  # -> Address, Points, Type; disabled
item = ListItem(List=location.Points, Index=0, Wrap=True)  # disabled
toggle = BooleanToggle(True)  # disabled
toggle_2 = BooleanToggle(True)  # disabled
toggle_3 = BooleanToggle(True)  # disabled
toggle_4 = BooleanToggle(True)  # disabled
circle = CircleCNR(Center=item, Normal=Vector(0, 0, 1), Radius=panel)  # disabled
vector_maps = VectorMaps(Area=circle, AllRoads=toggle, Buildings=toggle_2, ReProject=toggle_3, CenterToWorld=toggle_4)  # -> RoadLines, RoadInfo, BuildingLines, BuildingInfo, BuildingHeights, AmenityLines, AmenityInfo, AmenityPoints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; disabled
swatch = ColourSwatch(SwatchColor=RGB(0, 0, 0))  # disabled
geo = Geometry([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])  # disabled
geo_2 = Geometry([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])  # disabled
geo_3 = Geometry(Tree({0}: [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], {1}: [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], {2}: [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], {3}: [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], {4}: [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], {5}: [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]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))  # disabled
geo_4 = Geometry([vector_maps.BuildingLines, vector_maps.RoadLines, vector_maps.AmenityLines])  # disabled
preview = CustomPreview(Geometry=[geo_3, geo_2, geo], Shader=swatch)  # disabled

list_2 = ValueList({"divide by depth": "subdivide_depth", "divide by same depth": "subdivide_depth_same", "divide by dim": "subdivide_dim"}, selected="divide by depth")

# ---- group: cpt
vec = Vector(Vector(-545550.1884, 3982019.542, 0))

# ---- group: refYEvec
vec_2 = Vector(Vector(-545759.5384, 3981844.461, 0))

# ----
list_3 = ValueList({"YZ": "NS", "XZ": "EW", "XY": "Z"}, selected="XZ")

# ---- group: dir2cpt
subtraction = Subtraction(A=vec, B=vec_2)

# ----
toggle_5 = BooleanToggle(False)  # disabled

# ---- group: COURTYARD
miru = PythonScript(Code=file_8, Podium_depth=Slider(21, range=0..100), Node_depth=Slider(1, range=-1..1), Run=Toggle(True))  # disabled

# ---- group: DIVIDE
bibil_7 = PythonScript(
    Code=file_7,
    Divide_num=Slider(1, range=0..10),
    Divide_cut=Slider(10, range=0..100),
    Divide_type=list_2,
    Divide_ratio=Slider(0.5, range=0..1),
    Axis=list_3,
    Run=Toggle(False))  # disabled

# ---- group: PACKING
bibil_8 = PythonScript(Code=file_9, Run=toggle_5)  # disabled

# ----
move = Move(Motion=subtraction)  # -> Geometry, Transform

# ---- group: SITE BOUNDARY
geo_5 = Geometry(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)

# ----
boundary = BoundarySurfaces(Edges=geo_5)
geo_6 = Geometry(boundary)
pt = Point(Point(39.14606686, -228.3594019, 0))
circle_2 = CircleCNR(Center=pt, Normal=Vector(0, 0, 1), Radius=Slider(1000, range=0..1000))
# SITE ANALYSIS SETUP
gentestpts = Honeybee_GenerateTestPoints(testGeometry=geo_6, gridSize="20", distBaseSrf="1", moveTestMesh=True)  # -> readMe, simplify(testPoints), simplify(ptsVectors), simplify(facesArea), simplify(mesh); plug-in component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

# ---- group: FORMULA
python = PythonScript(formula="1 / math.exp(0.1813*dist)", focal_ref=pt, focal_weight="1")  # -> value_ref; inputs focal_ref: list
# ---------- python: Python ----------
"""
Bula Formula
"""
import rhinoscriptsyntax as rs

#Formula handling
#dist = 10.
#val = eval(formula)

focal_ref = map(lambda fr: rs.coerce3dpoint(fr),focal_ref)
focal_weight = map(lambda fw: float(fw), focal_weight.split(','))

value_ref = [formula,focal_ref,focal_weight]
# ---------- end python ----------

# ----
number_slider = Slider(2, range=0..10)  # disabled
number_slider_2 = Slider(0.5, range=0..1)  # disabled
number_slider_3 = Slider(10, range=0..100)  # disabled
geo_7 = Geometry(gentestpts.testPoints)
list_4 = ValueList({"divide by depth": "subdivide_depth", "divide by same depth": "subdivide_depth_same", "divide by dim": "subdivide_dim"}, selected="divide by depth")  # disabled
toggle_6 = BooleanToggle(True)  # disabled
list_5 = ValueList({"YZ": "NS", "XZ": "EW", "XY": "Z"}, selected="YZ")  # disabled
bula = PythonScript(
    Code=file_12,
    Analysis_ref=gentestpts.testPoints,
    Value_ref=python,
    Height_bounds="400.",
    Scale=Slider(1, range=0..10),
    Run=Toggle(True))

# ---- group: DIVIDE
bibil_9 = PythonScript(
    Code=file_7,
    Divide_num=number_slider,
    Divide_cut=number_slider_3,
    Divide_type=list_4,
    Divide_ratio=number_slider_2,
    Axis=list_5,
    Run=toggle_6)  # disabled

# ----
toggle_7 = BooleanToggle(True)  # disabled
panel_4 = Panel("roottest")  # disabled
trinco_park = PythonScript(Code=file_6, Rule_in=flatten(bula), Node_in=flatten(geo_6), Label_="site", Run=Toggle(True))  # -> Node_out, Debug
geo_8 = Geometry(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)  # disabled
trinco_park_2 = PythonScript(Code=file_6, Rule_in=bibil_9, Node_in=geo_8, Label_=panel_4, Run=toggle_7)  # -> Node_out, Debug; disabled
g = PythonScript(node=trinco_park.Node_out)  # -> geom; inputs node: list
# ---------- g: Python ----------
if node and node != []:
    geom = []
    #lot_lst = node.traverse_tree(lambda n:n,internal=False)
    for n in node:
        #print n.grammar.type.has_key('bula')
        print n.parent
        geom.append(n.shape.bottom_crv)
    print geom
# ---------- end g ----------
g_2 = PythonScript(node=trinco_park.Node_out)  # -> bula; inputs node: list
# ---------- g_2: Python ----------
if node and node != []:
    geom = []
    #lot_lst = node.traverse_tree(lambda n:n,internal=False)
    #n = node[0].get_root()
    for n in node:
        print n.grammar.type['label']
        print n.grammar.type['bula']
        geom.extend(n.grammar.type['bula_data'].bpt_viz_lst)
    bula = geom
# ---------- end g_2 ----------
g_3 = PythonScript(node=trinco_park.Node_out)  # -> data; inputs node: list
# ---------- g_3: Python ----------
if node and node != []:
    L = []
    #lot_lst = node.traverse_tree(lambda n:n,internal=False)
    #n = node[0].get_root()
    for n in node:
        print n.grammar.type['label']
        print n.grammar.type['bula']
        L.extend(n.grammar.type['bula_data'].value_lst)
    data = map(lambda d: str(round(d,2))+'%',L)
   
    print data
# ---------- end g_3 ----------
g_4 = PythonScript(node=trinco_park_2.Node_out)  # -> geom; inputs node: list; disabled
# ---------- g_4: Python ----------
if node and node != []:
    geom = []
    for n in node:
        #lot_lst = n.traverse_tree(lambda n:n.shape.geom,internal=False)
        geom.append(n.shape.geom)#lot_lst)
    print geom
# ---------- end g_4 ----------

# ---- group: root test
g_5 = PythonScript(node=trinco_park_2.Node_out)  # -> geom; inputs node: list; disabled
# ---------- g_5: Python ----------
if node and node != []:
    geom = []
    for n in node:
        #print 'label: ', n.parent.grammar.type['label']
        geom.append(n.shape.geom)
    
    node[0].grammar.type['label'] = 'leaftest'
    
    print '----'
    root = node[0].get_root()
    #print root.grammar.type['label']
    lstleaf = root.traverse_tree(lambda n: n,internal=False)
    for leaf in lstleaf:
        print leaf.grammar.type['label']
    print '----'
    
    
    node[0].grammar.type['label'] = 'revisedleaftest'
    node[1].grammar.type['label'] = 'revisedtest'
    
    lstleaf = root.traverse_tree(lambda n: n,internal=False)
    for leaf in lstleaf:
        print leaf.grammar.type['label']
    print '----'
# ---------- end g_5 ----------

# ----
geometry = Geometry(g_2)
tag = TextTag(Location=g_2, Text=g_3)

# ---- group: ptref / Block outlines
geo_9 = Geometry([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])

# ---- group: ptref / Soft Sites ref
geo_10 = Geometry([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])

# ---- group: ptref
geo_11 = Geometry(Point(-546064.7372, 3981860.973, 0))
preview_2 = CustomPreview(Geometry=[geo_10, geo_9], Shader=ColourSwatch(SwatchColor=RGB(51, 51, 51)))

# ---- group: ptref / Setbacks
geo_12 = Geometry([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])

# ---- group: ptref / Soft Sites
geo_13 = Geometry([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])

# ----
number_slider_4 = Slider(12, range=0..100)
number_slider_5 = Slider(18, range=0..100)
toggle_8 = BooleanToggle(True)
toggle_9 = BooleanToggle(True)
list_6 = ValueList({"root"}, selected="root")
list_7 = ValueList({"root"}, selected="root")

# ---- group: SETBACK
miru_2 = PythonScript(Code=file_10, Height=number_slider_4, Distance=Slider(6, range=0..10), Geom_ref=geo_12, Node_ref="-1", Run=Toggle(True))

# ---- group: TREE RULES
miru_3 = PythonScript(Code=file_13, Node=trinco_park.Node_out, Relation=list_6, Insert=toggle_8, Run=toggle_8)

miru_4 = PythonScript(Code=file_13, Node=trinco_park.Node_out, Relation=list_7, Insert=toggle_9, Run=toggle_9)

# ---- group: HEIGHT
miru_5 = PythonScript(Code=file_11, Height="bula", Run=Toggle(True))

miru_6 = PythonScript(Code=file_11, Height=number_slider_5, Run=Toggle(True))

# ----
geo_14 = Geometry([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])
bibil_10 = PythonScript(Code=file_6, Rule_in=flatten([miru_3, miru_5]), Node_in=flatten(geo_14), Label_="hirise_bld", Run=Toggle(True))  # -> Node_out, Debug
bibil_11 = PythonScript(
    Code=file_6,
    Rule_in=flatten([miru_4, miru_6, miru_2]),
    Node_in=flatten(geo_13),
    Label_="midrise_podium",
    Run=Toggle(True))  # -> Node_out, Debug
geo_15 = Geometry(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)
Z = UnitZ(Factor=number_slider_4)
g_6 = PythonScript(node=bibil_10.Node_out)  # -> geom; inputs node: list
# ---------- g_6: Python ----------
node = filter(lambda n: n!=None,node)
if node and node != []:
    geom = []
    for n in node:
        print n.get_root()
        print n.parent.parent
        print n
        geom.append(n.shape.geom)
    print geom
# ---------- end g_6 ----------
g_7 = PythonScript(node=bibil_11.Node_out)  # -> geom; inputs node: list; same code as g_6
move_2 = Move(Geometry=geo_15, Motion=Z)  # -> Geometry, Transform
geo_16 = Geometry(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)
geo_17 = Geometry(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)
split = SplitBrep(Brep=g_7, Cutter=move_2.Geometry)
geo_18 = Geometry([g_6, geo_17, geo_16])
Z_2 = UnitZ(Factor=number_slider_5)
geo_19 = Geometry(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)
capex = CapHolesEx(Brep=split)  # -> Brep, Caps, Solid
move_3 = Move(Geometry=geo_19, Motion=Z_2)  # -> Geometry, Transform
python_2 = PythonScript(x=flatten(capex.Brep))  # -> a; inputs x: list
# ---------- python_2: Python ----------
import rhinoscriptsyntax as rs
import Rhino as rc

L = []
for x_ in x:
    geom = rs.coercegeometry(x_)
    bbBox = geom.GetBoundingBox(rc.Geometry.Plane.WorldXY)
    maxHeights = bbBox.Max.Z
    minHeights = bbBox.Min.Z
    zdist = maxHeights - minHeights
    if zdist >= 2.:
        L.append(geom)
    
a = L
# ---------- end python_2 ----------
geo_20 = Geometry([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])
split_2 = SplitBrep(Brep=simplify(flatten(geo_18)), Cutter=move_3.Geometry)
capex_2 = CapHolesEx(Brep=split_2)  # -> Brep, Caps, Solid
Z_3 = UnitZ(Factor=0.25)
python_3 = PythonScript(x=flatten(capex_2.Brep))  # -> a; inputs x: list
# ---------- python_3: Python ----------
import rhinoscriptsyntax as rs
import Rhino as rc

L = []
for x_ in x:
    geom = rs.coercegeometry(x_)
    bbBox = geom.GetBoundingBox(rc.Geometry.Plane.WorldXY)
    maxHeights = bbBox.Max.Z
    minHeights = bbBox.Min.Z
    #zdist = maxHeights - minHeights
    if minHeights >= 2.:
        L.append(geom)
    
a = L
# ---------- end python_3 ----------
move_4 = Move(Geometry=python_3, Motion=Z_3)  # -> Geometry, Transform
# ENERGY ARCHETYPE SETUP
honeybee = Honeybee_Honeybee()  # -> Vviiiiiiiiiizzz; plug-in component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
ladybug = Ladybug_Ladybug()  # -> Vviiiiiiiiiizzz; plug-in component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

# ---- group: Commercial
geo_21 = Geometry([python_2, geo_20])

# ---- group: Residential
geo_22 = Geometry(move_4.Geometry)

# ----
updatehoneybee = Honeybee_UpdateHoneybee(updateThisFile=Toggle(False))  # -> out; plug-in component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
panel_5 = Panel(updatehoneybee)

# ---- group: shade4res
geo_23 = Geometry(geo_21)

# ---- group: shade4com
geo_24 = Geometry(geo_22)

# ----
Z_4 = UnitZ(Factor=Slider(3, range=0..10))
Z_5 = UnitZ(Factor=Slider(3, range=0..10))
button = Button()
data = Data()
toggle_10 = BooleanToggle(True)
epoutput = Honeybee_GenerateEPOutput(
    zoneEnergyUse=toggle_10,
    zoneGainsAndLosses=toggle_10,
    zoneComfortMetrics="False",
    comfortMapVariables=toggle_10,
    zoneHVACParams=toggle_10,
    surfaceTempAnalysis=toggle_10,
    surfaceEnergyAnalysis=toggle_10,
    glazingSolarAnalysis=toggle_10,
    timestep="hourly")  # -> report, flatten(simulationOutputs); plug-in component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
decomposebytype = Honeybee_DecomposeBasedOnType(HBZone=data)  # -> walls, interiorWalls, airWalls, flatten(windows), interiorWindows, skylights, roofs, ceilings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; plug-in component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
analysisperiod = Ladybug_AnalysisPeriod(fromMonth="12", fromDay="21", fromHour="1", toMonth="12", toDay="21", toHour="24")  # -> readMe, analysisPeriod; plug-in component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
wires = BrepWireframe(Brep=[decomposebytype.walls, decomposebytype.floors, decomposebytype.ceilings], Density=-1)
toggle_11 = BooleanToggle(False)
geo_25 = Geometry(decomposebytype.floors)
preview_3 = CustomPreview(Geometry=decomposebytype.windows, Shader=ColourSwatch(SwatchColor=RGB(158, 255, 255)))
preview_4 = CustomPreview(Geometry=wires, Shader=ColourSwatch(SwatchColor=RGBA(0, 0, 0, 122)))
preview_5 = CustomPreview(Geometry=geo_25, Shader=ColourSwatch(SwatchColor=RGBA(181, 181, 181, 122)))

panel_6 = Panel("C:\\Users\\vasanthakumars\\Documents\\GitHub\\bibil\\src\\reference\\honeybee_work\\Honeybee_SplitZone.py")
panel_7 = Panel("C:\\saeran\\master\\git\\bibil\\src\\reference\\honeybee_work\\Honeybee_SplitZone.py")
# BUILDING TYPOLOGY
panel_8 = Panel("C:\\Users\\vasanthakumars\\Documents\\GitHub\\bibil\\src\\reference\\honeybee_work\\Honeybee_SplitBuildingMass.py")
panel_9 = Panel("C:\\saeran\\master\\git\\bibil\\src\\reference\\honeybee_work\\Honeybee_SplitBuildingMass.py")
list_8 = ValueList({"dir", "file"}, selected="file")
list_9 = ValueList({"dir", "file"}, selected="file")

# ---- group: find directory
bibil_12 = PythonScript(dir=[panel_7, panel_6], type=list_8, run=Toggle(True))  # -> file; inputs dir: list; same code as bibil

bibil_13 = PythonScript(dir=[panel_9, panel_8], type=list_9, run=Toggle(True))  # -> file; inputs dir: list; same code as bibil

# ----
file_14 = ReadFile(File=bibil_13, PerLineParse=False)
file_15 = ReadFile(File=bibil_12, PerLineParse=False)

# ----
# RESIDENTIAL
splitmass = Honeybee_SplitBuildingMass(Code=file_14, _bldgMasses=geo_22, BldgsFlr2FloorHeights_="@3", _runIt=Toggle(True))  # -> ReadMe, SplitBldgMasses
# COMMERCIAL
splitmass_2 = Honeybee_SplitBuildingMass(Code=file_14, _bldgMasses=geo_21, BldgsFlr2FloorHeights_="@3", _runIt=Toggle(True))  # -> ReadMe, SplitBldgMasses
geo_26 = Geometry(splitmass.SplitBldgMasses)
geo_27 = Geometry(splitmass_2.SplitBldgMasses)
python_4 = PythonScript(Code=file_15, _bldgMasses=flatten(splitmass.SplitBldgMasses), PerimeterZoneDepth_="@3", _runIt=Toggle(True))  # -> ReadMe, SplitBldgMasses, Debug
python_5 = PythonScript(Code=file_15, _bldgMasses=flatten(splitmass_2.SplitBldgMasses), PerimeterZoneDepth_="@3", _runIt=Toggle(True))  # -> ReadMe, SplitBldgMasses, Debug
wires_2 = BrepWireframe(Brep=geo_26, Density=-1)
wires_3 = BrepWireframe(Brep=geo_27, Density=-1)
preview_6 = CustomPreview(
    Geometry=wires_2,
    Shader={ambient=RGB(0, 0, 0), diffuse=RGB(255, 105, 180), emission=RGB(76, 32, 54), shine=0.5, specular=RGB(255, 255, 255), transparency=0})
preview_7 = CustomPreview(
    Geometry=wires_3,
    Shader={ambient=RGB(0, 0, 0), diffuse=RGB(255, 105, 180), emission=RGB(76, 32, 54), shine=0.5, specular=RGB(255, 255, 255), transparency=0})
geo_28 = Geometry(python_4.SplitBldgMasses)
geo_29 = Geometry(python_5.SplitBldgMasses)
bibil_14 = PythonScript(Code=file_6, Node_in=flatten(python_4.SplitBldgMasses), Label_="hirise_bld", Run=Toggle(True))  # -> Node_out, Debug
bibil_15 = PythonScript(Code=file_6, Node_in=flatten(python_5.SplitBldgMasses), Label_="hirise_bld", Run=Toggle(True))  # -> Node_out, Debug
g_8 = PythonScript(node=bibil_14.Node_out)  # -> geom; inputs node: list
# ---------- g_8: Python ----------
import rhinoscriptsyntax as rs
node = filter(lambda n: n!=None,node)
if node and node != []:
    geom = []
    for n in node:
        geom_ = n.shape.bottom_crv
        print geom_
        geom.append(geom_)
# ---------- end g_8 ----------
g_9 = PythonScript(node=bibil_15.Node_out)  # -> geom; inputs node: list; same code as g_8
bibil_16 = PythonScript(Code=file_6, Node_in=flatten(splitmass.SplitBldgMasses), Label_="hirise_bld", Run=Toggle(True))  # -> Node_out, Debug
bibil_17 = PythonScript(Code=file_6, Node_in=flatten(splitmass_2.SplitBldgMasses), Label_="hirise_bld", Run=Toggle(True))  # -> Node_out, Debug
g_10 = PythonScript(node=bibil_16.Node_out)  # -> geom; inputs node: list; same code as g_8
g_11 = PythonScript(node=bibil_17.Node_out)  # -> geom; inputs node: list; same code as g_8
explode = Explode(Curve=g_10, Recursive=True)  # -> Segments, Vertices
explode_2 = Explode(Curve=g_11, Recursive=True)  # -> Segments, Vertices
extr = Extrude(Base=explode.Segments, Direction=Z_4)
area = Area(Geometry=g_10)  # -> Area, Centroid
extr_2 = Extrude(Base=explode_2.Segments, Direction=Z_5)
area_2 = Area(Geometry=g_11)  # -> Area, Centroid
wires_4 = BrepWireframe(Brep=extr, Density=-1)
edges = BrepEdges(Brep=extr)  # -> Naked, Interior, NonManifold
wires_5 = BrepWireframe(Brep=extr_2, Density=-1)
edges_2 = BrepEdges(Brep=extr_2)  # -> Naked, Interior, NonManifold
python_6 = PythonScript(zones=python_5.SplitBldgMasses, zones_crv=g_9, base=g_11, ptlst=area_2.Centroid, run=Toggle(True))  # -> P, C; inputs zones: tree, zones_crv: list, base: list, ptlst: list
# ---------- python_6: Python ----------
import rhinoscriptsyntax as rs

P = []
C = []


if run:
    zonecount = 0
    for i in range(zones.BranchCount):
        zonelst = zones.Branch(i)
        offset = rs.OffsetCurve(base[i],ptlst[i],3.)[0]
        for j,zone in enumerate(zonelst):
            zonecrv = zones_crv[int(zonecount)]
            zonecount+=1
            IsCore = rs.PointInPlanarClosedCurve(ptlst[i],zonecrv)
            if IsCore:
                C.append(zone)
            else:
                P.append(zone)
        print '---'
        #L.append(offset)
# ---------- end python_6 ----------
area_3 = Area(Geometry=extr)  # -> Area, Centroid
python_7 = PythonScript(zones=python_4.SplitBldgMasses, zones_crv=g_8, base=g_10, ptlst=area.Centroid, run=Toggle(True))  # -> P, C; inputs zones: tree, zones_crv: list, base: list, ptlst: list; same code as python_6
area_4 = Area(Geometry=extr_2)  # -> Area, Centroid
python_8 = PythonScript(x=edges.Naked, pt=flatten(area_3.Centroid))  # -> a; inputs x: tree, pt: list
# ---------- python_8: Python ----------
import rhinoscriptsyntax as rs
L = []

for i in range(x.BranchCount):
    edgelst = x.Branch(i)
    edge = rs.JoinCurves(edgelst,delete_input=True)
    edge = rs.coercecurve(edge)
    offset = rs.OffsetCurve(edge,pt[i],1.)[0]
    L.append(offset)
    
a = L
# ---------- end python_8 ----------
python_9 = PythonScript(x=edges_2.Naked, pt=flatten(area_4.Centroid))  # -> a; inputs x: tree, pt: list; same code as python_8
geo_30 = Geometry(python_6.P)
geo_31 = Geometry(python_6.C)
boundary_2 = BoundarySurfaces(Edges=python_9)
boundary_3 = BoundarySurfaces(Edges=python_8)
wires_6 = BrepWireframe(Brep=[splitmass_2.SplitBldgMasses, boundary_2, splitmass.SplitBldgMasses, boundary_3], Density=-1)
geo_32 = Geometry(python_7.P)
geo_33 = Geometry(python_7.C)
previewlw = CustomPreviewLineweights(Geometry=wires_6, Shader=ColourSwatch(SwatchColor=RGB(0, 0, 0)), Thickness=Slider(0.5, range=0..1), Absolute=False)

# ---- group: OFFICE
zone = ThermalZone(
    ThermalZoneGeometry=python_6.P,
    Name="Perimeter",
    SettingsAsFormatedString="-NoSelection-",
    Library="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",
    Settings="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")  # -> ThermalZones, SettingsAsFormatedString
zone_2 = ThermalZone(
    ThermalZoneGeometry=python_6.C,
    Name="Core",
    SettingsAsFormatedString="-NoSelection-",
    Library="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",
    Settings="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")  # -> ThermalZones, SettingsAsFormatedString
window = Window(
    WindowGeometry=boundary_2,
    Library="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",
    Settings="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")  # -> Window, SettingsAsFormatedString

# ---- group: RESIDENTIAL
# ENERGY SIMULATION
zone_3 = ThermalZone(
    ThermalZoneGeometry=python_7.P,
    Name="Perimeter",
    SettingsAsFormatedString="-NoSelection-",
    Library="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",
    Settings="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")  # -> ThermalZones, SettingsAsFormatedString
zone_4 = ThermalZone(
    ThermalZoneGeometry=python_7.C,
    Name="Core",
    SettingsAsFormatedString="-NoSelection-",
    Library="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",
    Settings="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")  # -> ThermalZones, SettingsAsFormatedString
window_2 = Window(
    WindowGeometry=boundary_3,
    Library="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",
    Settings="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")  # -> Window, SettingsAsFormatedString

# ----
networker = ZoneConnectivityNetwork(ThermalZoneCollection=[zone.ThermalZones, zone_2.ThermalZones], Windows=window.Window, ShadingGeometryCollection=geo_24)
surfaceanalysis = SurfaceAnalysis(ThermalModel=networker)  # -> Facade, Partition, Ceiling, Roof, ExternalFloor, Floor, Window, FaceID, IDLocation
networker_2 = ZoneConnectivityNetwork(
    ThermalZoneCollection=[zone_3.ThermalZones, zone_4.ThermalZones],
    Windows=window_2.Window,
    ShadingGeometryCollection=geo_23)
surfaceanalysis_2 = SurfaceAnalysis(ThermalModel=networker_2)  # -> Facade, Partition, Ceiling, Roof, ExternalFloor, Floor, Window, FaceID, IDLocation
brep = Brep([surfaceanalysis.Window, surfaceanalysis.Facade, surfaceanalysis.Floor, surfaceanalysis.ExternalFloor])
brep_2 = Brep([surfaceanalysis_2.Window, surfaceanalysis_2.Facade, surfaceanalysis_2.Floor, surfaceanalysis_2.ExternalFloor])
run_e = TakesThermalModelAndRunsEnergyPlus(
    ThermalModel=networker_2,
    ProjectName="MultiZone2",
    WorkingDirectory="C:\ArchsimResults\MultiZone",
    WeatherFile="USA_NY_New.York-LaGuardia.AP.725030_TMY3",
    StartsTheSimulation=button,
    settings="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")  # -> ThermalModel, SettingsAsFormatedString
run_e_2 = TakesThermalModelAndRunsEnergyPlus(
    ThermalModel=networker,
    ProjectName="MultiZone3",
    WorkingDirectory="C:\ArchsimResults\MultiZone",
    WeatherFile="USA_NY_New.York-LaGuardia.AP.725030_TMY3",
    StartsTheSimulation=button,
    settings="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")  # -> ThermalModel, SettingsAsFormatedString
load_zone_results = LoadZoneResults(ThermalModel=run_e.ThermalModel, Toggle=Toggle(True), settings="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")  # -> flatten(ZoneGeometry), ResultsPerZone, Labels, Guid, Name
area_5 = Area(Geometry=python_4.SplitBldgMasses)  # -> Area, Centroid
load_zone_results_2 = LoadZoneResults(ThermalModel=run_e_2.ThermalModel, Toggle=Toggle(True), settings="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")  # -> flatten(ZoneGeometry), ResultsPerZone, Labels, Guid, Name
tag_2 = TextTag(Location=area_5.Centroid, Text=load_zone_results.Labels)
ma = MassAddition(Input=load_zone_results.ResultsPerZone)  # -> flatten(Result), PartialResults
bnd = Bounds(Numbers=ma.Result)
panel_10 = Panel(load_zone_results.ResultsPerZone)
ma_2 = MassAddition(Input=load_zone_results_2.ResultsPerZone)  # -> flatten(Result), PartialResults
bnd_2 = Bounds(Numbers=ma_2.Result)
dedomain = DeconstructDomain(Domain=bnd)  # -> Start, End
dedomain_2 = DeconstructDomain(Domain=bnd_2)  # -> Start, End
panel_11 = Panel(load_zone_results.ZoneGeometry)
panel_12 = Panel(ma.Result)
gradient = Gradient(
    LowerLimit=dedomain.Start,
    UpperLimit=dedomain.End,
    Parameter=ma.Result,
    stops=[0: RGB(234, 38, 0), 0.146: RGB(234, 126, 0), 0.358: RGB(254, 244, 84), 0.75: RGB(173, 203, 249), 1: RGB(75, 107, 169)])
gradient_2 = Gradient(
    LowerLimit=dedomain_2.Start,
    UpperLimit=dedomain_2.End,
    Parameter=ma_2.Result,
    stops=[0: RGB(234, 38, 0), 0.154: RGB(234, 126, 0), 0.337: RGB(254, 244, 84), 0.75: RGB(173, 203, 249), 1: RGB(75, 107, 169)])
sort = SortList(Keys=ma_2.Result)  # -> Keys, ValuesA
sort_2 = SortList(Keys=ma.Result)  # -> Keys, ValuesA
preview_8 = CustomPreview(Geometry=load_zone_results.ZoneGeometry, Shader=gradient)
preview_9 = CustomPreview(Geometry=load_zone_results_2.ZoneGeometry, Shader=gradient_2)
panel_13 = Panel(sort_2.Keys)
panel_14 = Panel(sort.Keys)

panel_15 = Panel("C:\\Users\\vasanthakumars\\Documents\\GitHub\\bibil\\src\\reference\\CAN_ON_Toronto.716240_CWEC\\CAN_ON_Toronto.716240_CWEC.epw")
# ENERGY ANALYSIS/VISUALISATION
panel_16 = Panel("C:\saeran\master\git\bibil\src\reference\CAN_ON_Toronto.716240_CWEC\CAN_ON_Toronto.716240_CWEC.epw")
list_10 = ValueList({"dir", "file"}, selected="file")

# ---- group: find directory
bibil_18 = PythonScript(dir=[panel_16, panel_15], type=list_10, run=Toggle(True))  # -> file; inputs dir: list; same code as bibil

# ----
data_2 = Data(bibil_18)

exporttoopenstudio = Honeybee_ExportToOpenStudio(
    epwWeatherFile=bibil_18,
    analysisPeriod=analysisperiod.analysisPeriod,
    energySimPar=epoutput.simulationOutputs,
    HBZones=flatten(data),
    writeOSM=toggle_11,
    runSimulation=toggle_11,
    fileName="energy_analysis_montgomery")  # -> readMe, osmFileAddress, idfFileAddress, resultsFileAddress, eioFileAddress, rddFileAddress, studyFolder; plug-in component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
path = FilePath(exporttoopenstudio.resultsFileAddress)
readepsrfresult = Honeybee_ReadEPSurfaceResult(resultFileAddress=path)  # -> surfaceIndoorTemp, surfaceOutdoorTemp, surfaceEnergyFlow, opaqueEnergyFlow, glazEnergyFlow, windowTotalSolarEnergy, windowBeamEnergy, windowDiffEnergy, windowTransmissivity, otherSurfaceData; plug-in component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
readepresult = Honeybee_ReadEPResult(resultFileAddress=path)  # -> totalThermalLoad, thermalLoadBalance, cooling, heating, electricLight, electricEquip, fanElectric, pumpElectric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; plug-in component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
colorzones = Honeybee_ColorZonesByEPResult(zoneData=readepresult.thermalLoadBalance, HBZones=flatten(data), normalizeByFloorArea=Toggle(True), runIt=Toggle(True))  # -> readMe, zoneColoredMesh, zoneWireFrame, legend, legendBasePt, analysisTitle, zoneBreps, zoneColors, zoneValues, floorNormZoneData; plug-in component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
panel_17 = Panel(colorzones.floorNormZoneData)
preview_10 = CustomPreview(Geometry=colorzones.zoneWireFrame, Shader=ColourSwatch(SwatchColor=RGB(0, 0, 0)))
geo_34 = Geometry(colorzones.zoneColoredMesh)
geo_35 = Geometry([colorzones.analysisTitle, colorzones.legend])
