# Grasshopper definition bibil_trial_090_quick_generation.gh (Grasshopper 0.9.76)
# plug-ins: Python Interpreter, Human, DIVA Daylight, Mosquito

list = ValueList({"dir", "file"}, selected="dir")

# ---- group: find directory
bibil = PythonScript(
    dir=["C:\\Users\\vasanthakumars\\Documents\\GitHub\\bibil\\src", "C:\\saeran\\master\\git\\bibil\\src"],
    type=list,
    run=Toggle(True))  # -> dir; inputs dir: list
# ---------- bibil: Python ----------
import os

ghenv.Component.Params.Output[0].Name = "null"
ghenv.Component.Params.Output[0].NickName = "null"

if run:
    confirm_dir = None
    for d in dir:
        try:
            if type == "file":
                file_ = open(d)
                file_.close()
            else:
                print os.listdir(d)
            confirm_dir = d
            break
        except Exception as e:
            #print str(e)
            continue
    if confirm_dir != None:
        ghenv.Component.Params.Output[0].Name = type
        ghenv.Component.Params.Output[0].NickName = type
        dir = confirm_dir
        file = confirm_dir
null = None
# ---------- end bibil ----------

# ---- group: tree
python_script = PythonScript(i=bibil)  # -> o
# ---------- python_script: Python ----------
import os

if i:
    o = os.path.join(str(i),"bibil\\bibil_tree.py")
# ---------- end python_script ----------
file = ReadFile(File=python_script, PerLineParse=False)
bibil_2 = PythonScript(Code=file)

# ---- group: grammar
python_script_2 = PythonScript(i=bibil)  # -> o
# ---------- python_script_2: Python ----------
import os

if i:
    o = os.path.join(str(i),"bibil\\bibil_grammar.py")
# ---------- end python_script_2 ----------
file_2 = ReadFile(File=python_script_2, PerLineParse=False)
bibil_3 = PythonScript(Code=file_2)

# ---- group: shape
python_script_3 = PythonScript(i=bibil)  # -> o
# ---------- python_script_3: Python ----------
import os

if i:
    o = os.path.join(str(i),"bibil\\bibil_shape.py")
#o = os.path.join(str(i),"research\\bibil_shape_shape_3d_2d.py")
# ---------- end python_script_3 ----------
file_3 = ReadFile(File=python_script_3, PerLineParse=False)
bibil_4 = PythonScript(Code=file_3)

# ---- group: miru
python_script_4 = PythonScript(i=bibil)  # -> o
# ---------- python_script_4: Python ----------
import os

if i:
    o = os.path.join(str(i),"miru\\miru_miru.py")
# ---------- end python_script_4 ----------
file_4 = ReadFile(File=python_script_4, PerLineParse=False)
bibil_5 = PythonScript(Code=file_4)

# ---- group: bula
python_script_5 = PythonScript(i=bibil)  # -> o
# ---------- python_script_5: Python ----------
import os

if i:
    o = os.path.join(str(i),"bula\\bula_minimal.py")
# ---------- end python_script_5 ----------
file_5 = ReadFile(File=python_script_5, PerLineParse=False)
bibil_6 = PythonScript(Code=file_5)

# ---- group: UI
python_script_6 = PythonScript(i=bibil)  # -> o
# ---------- python_script_6: Python ----------
import os

if i:
    o = os.path.join(str(i),"bibil\\bibil_UI.py")
# ---------- end python_script_6 ----------
file_6 = ReadFile(File=python_script_6, PerLineParse=False)

# ---- group: grammar_divide
python_script_7 = PythonScript(i=bibil)  # -> o
# ---------- python_script_7: Python ----------
import os

if i:
    o = os.path.join(str(i),"miru\\miru_divide.py")
# ---------- end python_script_7 ----------
file_7 = ReadFile(File=python_script_7, PerLineParse=False)

# ---- group: grammar_courtyard
python_script_8 = PythonScript(i=bibil)  # -> o
# ---------- python_script_8: Python ----------
import os

if i:
    o = os.path.join(str(i),"miru\\miru_court.py")
# ---------- end python_script_8 ----------
file_8 = ReadFile(File=python_script_8, PerLineParse=False)

# ---- group: grammar_tower
python_script_9 = PythonScript(i=bibil)  # -> o
# ---------- python_script_9: Python ----------
import os

if i:
    o = os.path.join(str(i),"miru\\miru_packing.py")
# ---------- end python_script_9 ----------
file_9 = ReadFile(File=python_script_9, PerLineParse=False)

python_script_10 = PythonScript(i=bibil)  # -> o
# ---------- python_script_10: Python ----------
import os

if i:
    o = os.path.join(str(i),"miru\\miru_stepback.py")
# ---------- end python_script_10 ----------
file_10 = ReadFile(File=python_script_10, PerLineParse=False)

# ---- group: grammar_height
python_script_11 = PythonScript(i=bibil)  # -> o
# ---------- python_script_11: Python ----------
import os

if i:
    o = os.path.join(str(i),"miru\\miru_height.py")
# ---------- end python_script_11 ----------
file_11 = ReadFile(File=python_script_11, PerLineParse=False)

# ---- group: grammar_analysis_pts
python_script_12 = PythonScript(i=bibil)  # -> o
# ---------- python_script_12: Python ----------
import os

if i:
    o = os.path.join(str(i),"miru\\miru_analysis.py")
# ---------- end python_script_12 ----------
file_12 = ReadFile(File=python_script_12, PerLineParse=False)

# ---- group: meta_tree
python_script_13 = PythonScript(i=bibil)  # -> o
# ---------- python_script_13: Python ----------
import os

if i:
    o = os.path.join(str(i),"miru\\miru_meta_tree.py")
# ---------- end python_script_13 ----------
file_13 = ReadFile(File=python_script_13, PerLineParse=False)

# ----
# Note: Change this number with caution,
# Increase bounds iterratively.
panel = Panel("0.004")  # disabled

panel_2 = Panel("Yonge and Eglinton")  # disabled
panel_3 = Panel("Redpath Avenue and Roehampton Avenue")  # disabled
location = MosquitoLocation(Location=panel_3)  # -> Address, Points, Type; disabled
item = ListItem(List=location.Points, Index=0, Wrap=True)  # disabled
toggle = BooleanToggle(True)  # disabled
toggle_2 = BooleanToggle(True)  # disabled
toggle_3 = BooleanToggle(True)  # disabled
toggle_4 = BooleanToggle(True)  # disabled
circle = CircleCNR(Center=item, Normal=Vector(0, 0, 1), Radius=panel)  # disabled
vector_maps = VectorMaps(Area=circle, AllRoads=toggle, Buildings=toggle_2, ReProject=toggle_3, CenterToWorld=toggle_4)  # -> RoadLines, RoadInfo, BuildingLines, BuildingInfo, BuildingHeights, AmenityLines, AmenityInfo, AmenityPoints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; disabled
swatch = ColourSwatch(SwatchColor=RGB(0, 0, 0))  # disabled
geo = Geometry([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])  # disabled
geo_2 = Geometry([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])  # disabled
geo_3 = Geometry(Tree({0}: [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], {1}: [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], {2}: [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], {3}: [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], {4}: [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], {5}: [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]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))  # disabled
geo_4 = Geometry([vector_maps.BuildingLines, vector_maps.RoadLines, vector_maps.AmenityLines])  # disabled
preview = CustomPreview(Geometry=[geo_3, geo_2, geo], Shader=swatch)  # disabled

list_2 = ValueList({"divide by depth": "subdivide_depth", "divide by same depth": "subdivide_depth_same", "divide by dim": "subdivide_dim"}, selected="divide by depth")
list_3 = ValueList({"YZ": "NS", "XZ": "EW", "XY": "Z"}, selected="XZ")
toggle_5 = BooleanToggle(False)  # disabled

# ---- group: COURTYARD
miru = PythonScript(Code=file_8, Podium_depth=Slider(21, range=0..100), Node_depth=Slider(1, range=-1..1), Run=Toggle(True))  # disabled

# ---- group: DIVIDE
bibil_7 = PythonScript(
    Code=file_7,
    Divide_num=Slider(1, range=0..10),
    Divide_cut=Slider(10, range=0..100),
    Divide_type=list_2,
    Divide_ratio=Slider(0.5, range=0..1),
    Axis=list_3,
    Run=Toggle(False))  # disabled

# ---- group: PACKING
bibil_8 = PythonScript(Code=file_9, Run=toggle_5)  # disabled

# ---- group: SITE BOUNDARY
geo_5 = Geometry(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)

# ----
boundary = BoundarySurfaces(Edges=geo_5)
path = FilePath("C:\Users\vasanthakumars\Documents\GitHub\bibil\src\reference\CAN_ON_Toronto.716240_CWEC\CAN_ON_Toronto.716240_CWEC.epw")  # disabled

# ---- group: plane_angle
number_slider = Slider(-45, range=-100..100)

# ----
pt = Point(Point(-546015.9294, 3981548.423, 0))
pt_2 = Point(Point(-546056.4775, 3982009.405, 0))
gentestpts = Honeybee_GenerateTestPoints(testGeometry=boundary, gridSize="10", distBaseSrf="1", moveTestMesh=True)  # -> readMe, simplify(testPoints), simplify(ptsVectors), simplify(facesArea), simplify(mesh); plug-in component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

# ---- group: PLANE 1
geo_6 = Geometry(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)

# ---- group: PLANE 2
geo_7 = Geometry(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)

# ---- group: FORMULA
python = PythonScript(formula="1 / math.exp(0.1813*dist)", focal_ref=[pt, pt_2], height_ref="112.5,90.0,6.0", smooth=Slider(1, range=0..5))  # -> value_ref; inputs focal_ref: list
# ---------- python: Python ----------
"""
Bula Formula
"""
import rhinoscriptsyntax as rs

#Formula handling
#dist = 10.
#val = eval(formula)

focal_ref = map(lambda fr: rs.coerce3dpoint(fr),focal_ref)
focal_heights = map(lambda fw: float(fw), height_ref.split(','))
smooth_factor = smooth 
value_ref = [formula,focal_ref,focal_heights,smooth_factor]
# ---------- end python ----------

# ----
importepw = Ladybug_ImportEpw(epwFile=path)  # -> readMe, latitude, location, dryBulbTemperature, dewPointTemperature, relativeHumidity, windSpeed, windDirection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; disabled; plug-in component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
ladybug = Ladybug_Ladybug()  # -> Vviiiiiiiiiizzz; disabled; plug-in component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
number_slider_2 = Slider(9, range=0..10)  # disabled
number_slider_3 = Slider(11.25, range=0..100)  # disabled
number_slider_4 = Slider(21, range=0..100)  # disabled
number_slider_5 = Slider(14.25, range=0..100)  # disabled
bula = PythonScript(Code=file_12, Analysis_ref=gentestpts.testPoints, Value_ref=python, Run=Toggle(True))

sun_pos = SunPosition(
    Location=path,
    Month=number_slider_2,
    Day=number_slider_4,
    Hour=12,
    BooleanValue_0=False,
    BooleanValue_1=False,
    BooleanValue_2=False,
    BooleanValue_3=False,
    BooleanValue_4=False,
    BooleanValue_5=False,
    BooleanValue_6=False,
    BooleanValue_7=False,
    Color_0=RGBA(0, 0, 0, 0),
    Color_1=RGBA(0, 0, 0, 0),
    Color_2=RGBA(0, 0, 0, 0),
    Color_3=RGBA(0, 0, 0, 0),
    Color_4=RGBA(0, 0, 0, 0),
    Color_5=RGBA(0, 0, 0, 0),
    Color_6=RGBA(0, 0, 0, 0),
    Color_7=RGBA(0, 0, 0, 0),
    Hidden_0=False,
    Hidden_1=True,
    Hidden_2=True,
    Hidden_3=True,
    Hidden_4=True,
    Hidden_5=False,
    Hidden_6=False,
    Hidden_7=False,
    IntegerValue_0=-2147483648,
    IntegerValue_1=-2147483648,
    IntegerValue_2=-2147483648,
    IntegerValue_3=-2147483648,
    IntegerValue_4=-2147483648,
    IntegerValue_5=9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)  # -> SolarVector, Azimuth, Altitude; disabled
sun_pos_2 = SunPosition(
    Location=path,
    Month=number_slider_2,
    Day=number_slider_4,
    Hour=12,
    BooleanValue_0=False,
    BooleanValue_1=False,
    BooleanValue_2=False,
    BooleanValue_3=False,
    BooleanValue_4=False,
    BooleanValue_5=False,
    BooleanValue_6=False,
    BooleanValue_7=False,
    Color_0=RGBA(0, 0, 0, 0),
    Color_1=RGBA(0, 0, 0, 0),
    Color_2=RGBA(0, 0, 0, 0),
    Color_3=RGBA(0, 0, 0, 0),
    Color_4=RGBA(0, 0, 0, 0),
    Color_5=RGBA(0, 0, 0, 0),
    Color_6=RGBA(0, 0, 0, 0),
    Color_7=RGBA(0, 0, 0, 0),
    Hidden_0=False,
    Hidden_1=True,
    Hidden_2=True,
    Hidden_3=True,
    Hidden_4=True,
    Hidden_5=False,
    Hidden_6=False,
    Hidden_7=False,
    IntegerValue_0=-2147483648,
    IntegerValue_1=-2147483648,
    IntegerValue_2=-2147483648,
    IntegerValue_3=-2147483648,
    IntegerValue_4=-2147483648,
    IntegerValue_5=9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)  # -> SolarVector, Azimuth, Altitude; disabled
number_slider_6 = Slider(300, range=0..1000)  # disabled
multiplication = Multiplication(A=[sun_pos.SolarVector, sun_pos_2.SolarVector], B=number_slider_6)  # disabled
pt_3 = Point(multiplication)  # disabled
pt_4 = Point([Point(-17.89049319, 160.9898411, 0), Point(-39.04381231, 157.7749922, 0), Point(12.64935323, -173.781392, 0), Point(33.26248411, -169.6865549, 0)])  # disabled
ln = Line(StartPoint=pt_4, EndPoint=multiplication)  # disabled

geo_8 = Geometry(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)
rad = Radians(Degrees=number_slider)
geo_9 = Geometry(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)
rad_2 = Radians(Degrees=number_slider)
number_slider_7 = Slider(1, range=0..10)  # disabled

# ---- group: solar input curve
geo_10 = Geometry(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)  # disabled

# ----
number_slider_8 = Slider(175, range=0..1000)  # disabled
analysisperiod = Ladybug_AnalysisPeriod(
    fromMonth=number_slider_2,
    fromDay=number_slider_4,
    fromHour=number_slider_3,
    toMonth=number_slider_2,
    toDay=number_slider_4,
    toHour=number_slider_5)  # -> readMe, analysisPeriod; disabled; plug-in component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
rotax = RotateAxis(Geometry=geo_6, Angle=rad, Axis=geo_8)  # -> Geometry, Transform
rotax_2 = RotateAxis(Geometry=geo_9, Angle=rad_2, Axis=geo_7)  # -> Geometry, Transform

# ---- group: GEOREF
vec = Vector(Vector(-546054.4782, 3981714.967, 0))

# ---- group: CPT
vec_2 = Vector(Vector(10.25901059, -146.005907, 0))

# ---- group: A=pt2move2
subtraction = Subtraction(A=vec, B=vec_2)

# ----
number_slider_9 = Slider(2, range=0..10)  # disabled
number_slider_10 = Slider(0.5, range=0..1)  # disabled
number_slider_11 = Slider(10, range=0..100)  # disabled
solarfanbasic = Ladybug_SolarFanBasic(
    boundary=geo_10,
    location=importepw.location,
    requiredHours=number_slider_7,
    height=number_slider_8,
    analysisPeriod=analysisperiod.analysisPeriod)  # -> readMe, solarFan; disabled; plug-in component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
list_4 = ValueList({"divide by depth": "subdivide_depth", "divide by same depth": "subdivide_depth_same", "divide by dim": "subdivide_dim"}, selected="divide by depth")  # disabled
ladybug_2 = Ladybug_Ladybug()  # -> Vviiiiiiiiiizzz; plug-in component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
trinco_park = PythonScript(Code=file_6, Rule_in=flatten(bula), Node_in=flatten(boundary), Label_="pedestrianBulaRef", Run=Toggle(True))  # -> Node_out, Debug
# SITE ANALYSIS SETUP
toggle_6 = BooleanToggle(True)  # disabled
wires = BrepWireframe(Brep=[rotax.Geometry, rotax_2.Geometry], Density=-1)
list_5 = ValueList({"YZ": "NS", "XZ": "EW", "XY": "Z"}, selected="YZ")  # disabled
geo_11 = Geometry([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])
move = Move(Geometry=geo_11, Motion=subtraction)  # -> Geometry, Transform
g = PythonScript(node=trinco_park.Node_out)  # -> geom; inputs node: list
# ---------- g: Python ----------
if node and node != []:
    geom = []
    #lot_lst = node.traverse_tree(lambda n:n,internal=False)
    for n in node:
        #print n.grammar.type.has_key('bula')
        print n
        print n.parent
        #print n.grammar.type['bula']
        geom.append(n.shape.bottom_crv)
    #print geom
# ---------- end g ----------
g_2 = PythonScript(node=trinco_park.Node_out)  # -> bula; inputs node: list
# ---------- g_2: Python ----------
if node and node != []:
    geom = []
    #lot_lst = node.traverse_tree(lambda n:n,internal=False)
    #n = node[0].get_root()
    for n in node:
        
        print n.grammar.type['label']
        print n.grammar.type['bula']
        if n.grammar.type['bula'] == True:
            geom.extend(n.grammar.type['bula_data'].bpt_viz_lst)
    bula = geom
# ---------- end g_2 ----------
g_3 = PythonScript(node=trinco_park.Node_out)  # -> data; inputs node: list
# ---------- g_3: Python ----------
if node and node != []:
    L = []
    #lot_lst = node.traverse_tree(lambda n:n,internal=False)
    #n = node[0].get_root()
    for n in node:
        print n.grammar.type['label']
        if n.grammar.type['bula']:
            for a,v in zip(n.grammar.type['bula_data'].value_actual, n.grammar.type['bula_data'].value_lst):
                print a
                print v
                print ''
            print '--'
            L.extend(n.grammar.type['bula_data'].value_actual)
    data = map(lambda d: str(round(d,2))+'%',L)
   
    print data
# ---------- end g_3 ----------
geo_12 = Geometry(solarfanbasic.solarFan)  # disabled

# ---- group: SOLAER
geo_13 = Geometry(geo_12)

# ----
python_2 = PythonScript(pts=gentestpts.testPoints, brep=[rotax.Geometry, rotax_2.Geometry, geo_13], run=Toggle(True))  # -> flatten(project); inputs pts: list
# ---------- python_2: Python ----------
import rhinoscriptsyntax as rs
import Rhino as rc
import scriptcontext as sc

if run:
    debug = []
    dir = rc.Geometry.Vector3d(0,0,1) 
    tol = sc.doc.ModelAbsoluteTolerance
    env = [rs.coercebrep(brep)]
    ptlst = map(lambda p: rs.coerce3dpoint(p),pts)
    
    projlst = rc.Geometry.Intersect.Intersection.ProjectPointsToBreps(env,ptlst,dir,tol)
    #print projlst
    #projlst = filter(lambda pt:abs(pt[2]-200.)>0.5,projlst)
    projlst = filter(lambda p: abs(p[2]-0)>1.,projlst)
    
    if projlst:
        debug.extend(projlst)
        #min_index = projlst.index(min(projlst,key=lambda p:p[2]))
        #min_pt = projlst[min_index]
        #envht = min_pt[2]
    project = debug
# ---------- end python_2 ----------
devec = DeconstructVector(Vector=flatten(python_2))  # -> XComponent, YComponent, ZComponent

# ---- group: DIVIDE
bibil_9 = PythonScript(
    Code=file_7,
    Divide_num=number_slider_9,
    Divide_cut=number_slider_11,
    Divide_type=list_4,
    Divide_ratio=number_slider_10,
    Axis=list_5,
    Run=toggle_6)  # disabled

# ----
geo_14 = Geometry(move.Geometry)
sunpath = Ladybug_SunPath(hour=12, day=21, month=12, timeStep=1, dailyOrAnnualSunPath=True)  # -> readMe, sunVectors, sunAltitudes, sunAzimuths, port, sunSpheresMesh, sunPathCrvs, legend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; plug-in component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
toggle_7 = BooleanToggle(True)  # disabled
panel_4 = Panel("roottest")  # disabled
tag = TextTag(Location=g_2, Text=g_3)
geo_15 = Geometry(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)  # disabled
trinco_park_2 = PythonScript(Code=file_6, Rule_in=bibil_9, Node_in=geo_15, Label_=panel_4, Run=toggle_7)  # -> Node_out, Debug; disabled
g_4 = PythonScript(node=trinco_park_2.Node_out)  # -> geom; inputs node: list; disabled
# ---------- g_4: Python ----------
if node and node != []:
    geom = []
    for n in node:
        #lot_lst = n.traverse_tree(lambda n:n.shape.geom,internal=False)
        geom.append(n.shape.geom)#lot_lst)
    print geom
# ---------- end g_4 ----------

# ---- group: root test
# BUILDING TYPOLOGY
g_5 = PythonScript(node=trinco_park_2.Node_out)  # -> geom; inputs node: list; disabled
# ---------- g_5: Python ----------
if node and node != []:
    geom = []
    for n in node:
        #print 'label: ', n.parent.grammar.type['label']
        geom.append(n.shape.geom)
    
    node[0].grammar.type['label'] = 'leaftest'
    
    print '----'
    root = node[0].get_root()
    #print root.grammar.type['label']
    lstleaf = root.traverse_tree(lambda n: n,internal=False)
    for leaf in lstleaf:
        print leaf.grammar.type['label']
    print '----'
    
    
    node[0].grammar.type['label'] = 'revisedleaftest'
    node[1].grammar.type['label'] = 'revisedtest'
    
    lstleaf = root.traverse_tree(lambda n: n,internal=False)
    for leaf in lstleaf:
        print leaf.grammar.type['label']
    print '----'
# ---------- end g_5 ----------

# ----
# MIDRISE 1
list_6 = ValueList({"root"}, selected="root")  # disabled
toggle_8 = BooleanToggle(True)  # disabled
number_slider_12 = Slider(15, range=0..100)  # disabled
toggle_9 = BooleanToggle(True)  # disabled
number_slider_13 = Slider(12, range=0..100)  # disabled
number_slider_14 = Slider(6, range=0..10)  # disabled
toggle_10 = BooleanToggle(True)  # disabled
panel_5 = Panel("-1")  # disabled

# ---- group: SETBACKS LINES
geo_16 = Geometry([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])  # disabled

# ----
# MIDRISE 2
list_7 = ValueList({"root"}, selected="root")  # disabled
toggle_11 = BooleanToggle(True)  # disabled
number_slider_15 = Slider(15, range=0..100)  # disabled
toggle_12 = BooleanToggle(True)  # disabled

# ---- group: PODIUM CURVES
geo_17 = Geometry([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])  # disabled

# ----
panel_6 = Panel("6")  # disabled
panel_7 = Panel("12")  # disabled
panel_8 = Panel("6")  # disabled
panel_9 = Panel("12")  # disabled

# ---- group: SETBACKS LINES
geo_18 = Geometry([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])  # disabled

# ----
toggle_13 = BooleanToggle(True)  # disabled
panel_10 = Panel("-1")  # disabled
# HIGH RISE
list_8 = ValueList({"root"}, selected="root")  # disabled
toggle_14 = BooleanToggle(True)  # disabled
toggle_15 = BooleanToggle(True)  # disabled
panel_11 = Panel("bula")  # disabled
toggle_16 = BooleanToggle(True)  # disabled

# ---- group: PODIUM CURVES
geo_19 = Geometry([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])  # disabled

# ---- group: TREE RULES
miru_2 = PythonScript(Code=file_13, Node=trinco_park.Node_out, Relation=list_7, Insert=toggle_11, Run=toggle_11)  # disabled

# ---- group: HEIGHT
miru_3 = PythonScript(Code=file_11, Height=number_slider_15, Run=toggle_12)  # disabled

# ---- group: SETBACK
miru_4 = PythonScript(Code=file_10, Height=[panel_6, panel_7], Distance=[panel_8, panel_9], Geom_ref=geo_18, Node_ref=panel_10, Run=toggle_13)  # disabled

# ---- group: TREE RULES
miru_5 = PythonScript(Code=file_13, Node=trinco_park.Node_out, Relation=list_8, Insert=toggle_14, Run=toggle_14)  # disabled

# ----
bula_2 = PythonScript(Code=file_12, Analysis_ref=flatten(python_2), Value_ref=flatten(devec.ZComponent), Run=toggle_15)  # disabled

# ---- group: HEIGHT
miru_6 = PythonScript(Code=file_11, Height=panel_11, Run=toggle_16)  # disabled

# ---- group: TREE RULES
miru_7 = PythonScript(Code=file_13, Node=trinco_park.Node_out, Relation=list_6, Insert=toggle_8, Run=toggle_8)  # disabled

# ---- group: HEIGHT
miru_8 = PythonScript(Code=file_11, Height=number_slider_12, Run=toggle_9)  # disabled

# ---- group: SETBACK
miru_9 = PythonScript(Code=file_10, Height=number_slider_13, Distance=number_slider_14, Geom_ref=geo_16, Node_ref=panel_5, Run=toggle_10)  # disabled

# ---- group: TOWER SEP
panel_12 = Panel("25")  # disabled

# ---- group: EXISTING TOWERS
geo_20 = Geometry([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])  # disabled

# ---- group: TOWER CURVES
geo_21 = Geometry([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])  # disabled

# ----
panel_13 = Panel("hiriseType")  # disabled
toggle_17 = BooleanToggle(True)  # disabled
toggle_18 = BooleanToggle(True)  # disabled
panel_14 = Panel("midrise_podium")  # disabled
toggle_19 = BooleanToggle(True)  # disabled
panel_15 = Panel("midrise_podium")  # disabled

# ---- group: MIDRISE
# VISUALIZATION
bibil_10 = PythonScript(Code=file_6, Rule_in=flatten([miru_7, miru_8, miru_9]), Node_in=flatten(geo_19), Label_=panel_14, Run=toggle_18)  # -> Node_out, Debug; disabled

bibil_11 = PythonScript(Code=file_6, Rule_in=flatten([miru_2, miru_3, miru_4]), Node_in=flatten(geo_17), Label_=panel_15, Run=toggle_19)  # -> Node_out, Debug; disabled

# ---- group: TOWERS
bibil_12 = PythonScript(Code=file_6, Rule_in=flatten([miru_5, bula_2, miru_6]), Node_in=flatten(geo_21), Label_=panel_13, Run=toggle_17)  # -> Node_out, Debug; disabled

# ---- group: HIGHRISE
g_6 = PythonScript(node=bibil_12.Node_out)  # -> geom; inputs node: list; disabled
# ---------- g_6: Python ----------
node = filter(lambda n: n!=None,node)
if node and node != []:
    geom = []
    for n in node:
        #print n.get_root()
        print n
        print n.parent
        #print n.parent.parent
        #print n.parent.parent.parent
        #print n.parent.parent.parent.parent
        #print '---'
        geom.append(n.shape.geom)
    #print geom
# ---------- end g_6 ----------

# ---- group: MIDRISE
g_7 = PythonScript(node=[bibil_10.Node_out, bibil_11.Node_out])  # -> geom; inputs node: list; disabled
# ---------- g_7: Python ----------
node = filter(lambda n: n!=None,node)
if node and node != []:
    geom = []
    for n in node:
        print n.get_root()
        print n.parent.parent
        print n
        geom.append(n.shape.geom)
    print geom
# ---------- end g_7 ----------

# ----
g_8 = PythonScript(node=bibil_12.Node_out)  # -> geom; inputs node: list; disabled
# ---------- g_8: Python ----------
node = filter(lambda n: n!=None,node)
if node and node != []:
    geom = []
    for n in node:
        #print n.get_root()
        print n
        print n.parent
        #print n.parent.parent
        #print n.parent.parent.parent
        #print n.parent.parent.parent.parent
        #print '---'
        geom.append(n.shape.bottom_crv)
    #print geom
# ---------- end g_8 ----------
toggle_20 = BooleanToggle(True)  # disabled
panel_16 = Panel("exist_tower")  # disabled

# ---- group: EXISTING TOWERS
bibil_13 = PythonScript(Code=file_6, Node_in=flatten(geo_20), Label_=panel_16, Run=toggle_20)  # -> Node_out, Debug; disabled

# ---- group: Block outlines
geo_22 = Geometry([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])  # disabled

# ---- group: Soft Sites ref
geo_23 = Geometry([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])  # disabled

# ----
g_9 = PythonScript(node=bibil_13.Node_out)  # -> geom; inputs node: list; disabled
# ---------- g_9: Python ----------
import rhinoscriptsyntax as rs
import scriptcontext as sc
node = filter(lambda n: n!=None,node)
if node and node != []:
    geom = []
    for n in node:
        #print n.get_root()
        #print n.parent
        crv = n.shape.bottom_crv
        if n.shape.cpt[2] > 0.0:
            crv = sc.doc.Objects.AddCurve(crv)
            crv = rs.MoveObject(crv,[0,0,n.shape.cpt[2]*-1])
        geom.append(crv)
        
    #print geom
# ---------- end g_9 ----------
swatch_2 = ColourSwatch(SwatchColor=RGB(51, 51, 51))  # disabled
panel_17 = Panel("2")  # disabled
number_slider_16 = Slider(0.5, range=0..1)  # disabled
number_slider_17 = Slider(0.8, range=0..1)  # disabled
preview_2 = CustomPreview(Geometry=[geo_23, geo_22], Shader=swatch_2)  # disabled
number_slider_18 = Slider(0.8, range=0..1)  # disabled
swatch_3 = ColourSwatch(SwatchColor=RGB(114, 145, 107))  # disabled
offset = Offset(Curve=g_8, Distance=panel_12, Plane=PlaneXY(0, 0, 0), Corners=panel_17)  # disabled
number_slider_19 = Slider(1, range=0..10)  # disabled
offset_2 = Offset(Curve=g_9, Distance=panel_12, Plane=PlaneXY(0, 0, 0), Corners=panel_17)  # disabled
swatch_4 = ColourSwatch(SwatchColor=RGB(56, 56, 56))  # disabled
material = CreateMaterial(Diffuse=swatch_3, Specular=RGB(255, 255, 255), Emission=RGB(0, 0, 0), Transparency=number_slider_17, Shine=0)  # disabled
geometry = Geometry(g_2)  # disabled
geo_24 = Geometry(python_2)  # disabled
number_slider_20 = Slider(2, range=0..10)  # disabled
boundary_2 = BoundarySurfaces(Edges=[offset, offset_2])  # disabled
material_2 = CreateMaterial(Diffuse=swatch_4, Specular=RGB(255, 255, 255), Emission=RGB(0, 0, 0), Transparency=number_slider_16, Shine=0)  # disabled
material_3 = CreateMaterial(Diffuse=RGB(255, 105, 180), Specular=RGB(255, 255, 255), Emission=RGB(0, 0, 0), Transparency=number_slider_18, Shine=0)  # disabled
preview_3 = CustomPreview(Geometry=[geo_13, rotax_2.Geometry, rotax.Geometry], Shader=material)  # disabled
dots = DotDisplay(Point=[geometry, geo_24], Colour=RGB(0, 0, 0), Size=number_slider_19)  # disabled
preview_4 = CustomPreview(Geometry=boundary_2, Shader=material_3)  # disabled
# 4VIZ
previewlw = CustomPreviewLineweights(
    Geometry=[offset, offset_2],
    Shader={ambient=RGB(0, 0, 0), diffuse=RGB(255, 105, 180), emission=RGB(76, 32, 54), shine=0.5, specular=RGB(255, 255, 255), transparency=0},
    Thickness=number_slider_20,
    Absolute=False)  # disabled
preview_5 = CustomPreview(Geometry=[g_7, g_6], Shader=material_2)  # disabled
