# Grasshopper definition bibil_trial_091_tocore_master_file.gh (Grasshopper 0.9.76)
# plug-ins: Python Interpreter, Human, DIVA Daylight, ArchsimGH, Mosquito

list = ValueList({"dir", "file"}, selected="dir")

# ---- group: find directory
bibil = PythonScript(
    dir=["C:\\Users\\vasanthakumars\\Documents\\GitHub\\bibil\\src", "C:\\saeran\\master\\git\\bibil\\src"],
    type=list,
    run=Toggle(True))  # -> dir; inputs dir: list
# ---------- bibil: Python ----------
import os

ghenv.Component.Params.Output[0].Name = "null"
ghenv.Component.Params.Output[0].NickName = "null"

if run:
    confirm_dir = None
    for d in dir:
        try:
            if type == "file":
                file_ = open(d)
                file_.close()
            else:
                print os.listdir(d)
            confirm_dir = d
            break
        except Exception as e:
            #print str(e)
            continue
    if confirm_dir != None:
        ghenv.Component.Params.Output[0].Name = type
        ghenv.Component.Params.Output[0].NickName = type
        dir = confirm_dir
        file = confirm_dir
null = None
# ---------- end bibil ----------

# ---- group: tree
python_script = PythonScript(i=bibil)  # -> o
# ---------- python_script: Python ----------
import os

if i:
    o = os.path.join(str(i),"bibil\\bibil_tree.py")
# ---------- end python_script ----------
file = ReadFile(File=python_script, PerLineParse=False)
bibil_2 = PythonScript(Code=file)

# ---- group: grammar
python_script_2 = PythonScript(i=bibil)  # -> o
# ---------- python_script_2: Python ----------
import os

if i:
    o = os.path.join(str(i),"bibil\\bibil_grammar.py")
# ---------- end python_script_2 ----------
file_2 = ReadFile(File=python_script_2, PerLineParse=False)
bibil_3 = PythonScript(Code=file_2)

# ---- group: shape
python_script_3 = PythonScript(i=bibil)  # -> o
# ---------- python_script_3: Python ----------
import os

if i:
    o = os.path.join(str(i),"bibil\\bibil_shape.py")
#o = os.path.join(str(i),"research\\bibil_shape_shape_3d_2d.py")
# ---------- end python_script_3 ----------
file_3 = ReadFile(File=python_script_3, PerLineParse=False)
bibil_4 = PythonScript(Code=file_3)

# ---- group: miru
python_script_4 = PythonScript(i=bibil)  # -> o
# ---------- python_script_4: Python ----------
import os

if i:
    o = os.path.join(str(i),"miru\\miru_miru.py")
# ---------- end python_script_4 ----------
file_4 = ReadFile(File=python_script_4, PerLineParse=False)
bibil_5 = PythonScript(Code=file_4)

# ---- group: bula
python_script_5 = PythonScript(i=bibil)  # -> o
# ---------- python_script_5: Python ----------
import os

if i:
    o = os.path.join(str(i),"bula\\bula_minimal.py")
# ---------- end python_script_5 ----------
file_5 = ReadFile(File=python_script_5, PerLineParse=False)
bibil_6 = PythonScript(Code=file_5)

# ---- group: UI
python_script_6 = PythonScript(i=bibil)  # -> o
# ---------- python_script_6: Python ----------
import os

if i:
    o = os.path.join(str(i),"bibil\\bibil_UI.py")
# ---------- end python_script_6 ----------
file_6 = ReadFile(File=python_script_6, PerLineParse=False)

# ---- group: grammar_divide
python_script_7 = PythonScript(i=bibil)  # -> o
# ---------- python_script_7: Python ----------
import os

if i:
    o = os.path.join(str(i),"miru\\miru_divide.py")
# ---------- end python_script_7 ----------
file_7 = ReadFile(File=python_script_7, PerLineParse=False)

# ---- group: grammar_courtyard
python_script_8 = PythonScript(i=bibil)  # -> o
# ---------- python_script_8: Python ----------
import os

if i:
    o = os.path.join(str(i),"miru\\miru_court.py")
# ---------- end python_script_8 ----------
file_8 = ReadFile(File=python_script_8, PerLineParse=False)

# ---- group: grammar_tower
python_script_9 = PythonScript(i=bibil)  # -> o
# ---------- python_script_9: Python ----------
import os

if i:
    o = os.path.join(str(i),"miru\\miru_packing.py")
# ---------- end python_script_9 ----------
file_9 = ReadFile(File=python_script_9, PerLineParse=False)

python_script_10 = PythonScript(i=bibil)  # -> o
# ---------- python_script_10: Python ----------
import os

if i:
    o = os.path.join(str(i),"miru\\miru_stepback.py")
# ---------- end python_script_10 ----------
file_10 = ReadFile(File=python_script_10, PerLineParse=False)

# ---- group: grammar_height
python_script_11 = PythonScript(i=bibil)  # -> o
# ---------- python_script_11: Python ----------
import os

if i:
    o = os.path.join(str(i),"miru\\miru_height.py")
# ---------- end python_script_11 ----------
file_11 = ReadFile(File=python_script_11, PerLineParse=False)

# ---- group: grammar_analysis_pts
python_script_12 = PythonScript(i=bibil)  # -> o
# ---------- python_script_12: Python ----------
import os

if i:
    o = os.path.join(str(i),"miru\\miru_analysis.py")
# ---------- end python_script_12 ----------
file_12 = ReadFile(File=python_script_12, PerLineParse=False)

# ---- group: meta_tree
python_script_13 = PythonScript(i=bibil)  # -> o
# ---------- python_script_13: Python ----------
import os

if i:
    o = os.path.join(str(i),"miru\\miru_meta_tree.py")
# ---------- end python_script_13 ----------
file_13 = ReadFile(File=python_script_13, PerLineParse=False)

# ----
# Note: Change this number with caution,
# Increase bounds iterratively.
panel = Panel("0.004")  # disabled

panel_2 = Panel("Yonge and Eglinton")  # disabled
panel_3 = Panel("Redpath Avenue and Roehampton Avenue")  # disabled
location = MosquitoLocation(Location=panel_3)  # -> Address, Points, Type; disabled
item = ListItem(List=location.Points, Index=0, Wrap=True)  # disabled
toggle = BooleanToggle(True)  # disabled
toggle_2 = BooleanToggle(True)  # disabled
toggle_3 = BooleanToggle(True)  # disabled
toggle_4 = BooleanToggle(True)  # disabled
circle = CircleCNR(Center=item, Normal=Vector(0, 0, 1), Radius=panel)  # disabled
vector_maps = VectorMaps(Area=circle, AllRoads=toggle, Buildings=toggle_2, ReProject=toggle_3, CenterToWorld=toggle_4)  # -> RoadLines, RoadInfo, BuildingLines, BuildingInfo, BuildingHeights, AmenityLines, AmenityInfo, AmenityPoints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; disabled
swatch = ColourSwatch(SwatchColor=RGB(0, 0, 0))  # disabled
geo = Geometry([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])  # disabled
geo_2 = Geometry([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])  # disabled
geo_3 = Geometry(Tree({0}: [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], {1}: [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], {2}: [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], {3}: [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], {4}: [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], {5}: [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]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))  # disabled
geo_4 = Geometry([vector_maps.BuildingLines, vector_maps.RoadLines, vector_maps.AmenityLines])  # disabled
preview = CustomPreview(Geometry=[geo_3, geo_2, geo], Shader=swatch)  # disabled

list_2 = ValueList({"divide by depth": "subdivide_depth", "divide by same depth": "subdivide_depth_same", "divide by dim": "subdivide_dim"}, selected="divide by depth")
list_3 = ValueList({"YZ": "NS", "XZ": "EW", "XY": "Z"}, selected="XZ")
toggle_5 = BooleanToggle(False)  # disabled

# ---- group: COURTYARD
miru = PythonScript(Code=file_8, Podium_depth=Slider(21, range=0..100), Node_depth=Slider(1, range=-1..1), Run=Toggle(True))  # disabled

# ---- group: DIVIDE
bibil_7 = PythonScript(
    Code=file_7,
    Divide_num=Slider(1, range=0..10),
    Divide_cut=Slider(10, range=0..100),
    Divide_type=list_2,
    Divide_ratio=Slider(0.5, range=0..1),
    Axis=list_3,
    Run=Toggle(False))  # disabled

# ---- group: PACKING
bibil_8 = PythonScript(Code=file_9, Run=toggle_5)  # disabled

# ---- group: SITE BOUNDARY
geo_5 = Geometry(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)

# ----
boundary = BoundarySurfaces(Edges=geo_5)
path = FilePath("C:\Users\vasanthakumars\Documents\GitHub\bibil\src\reference\CAN_ON_Toronto.716240_CWEC\CAN_ON_Toronto.716240_CWEC.epw")

# ---- group: plane_angle
number_slider = Slider(-45, range=-100..100)

# ----
pt = Point(Point(-546015.9294, 3981548.423, 0))
pt_2 = Point(Point(-546056.4775, 3982009.405, 0))
gentestpts = Honeybee_GenerateTestPoints(testGeometry=boundary, gridSize="5", distBaseSrf="1", moveTestMesh=True)  # -> readMe, simplify(testPoints), simplify(ptsVectors), simplify(facesArea), simplify(mesh); plug-in component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

# ---- group: PLANE 1
geo_6 = Geometry(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)

# ---- group: PLANE 2
geo_7 = Geometry(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)

# ---- group: FORMULA
python = PythonScript(formula="1 / math.exp(0.1813*dist)", focal_ref=[pt, pt_2], height_ref="300.5,90.0,50.0", smooth=Slider(1.5, range=0..5))  # -> value_ref; inputs focal_ref: list
# ---------- python: Python ----------
"""
Bula Formula
"""
import rhinoscriptsyntax as rs

#Formula handling
#dist = 10.
#val = eval(formula)

focal_ref = map(lambda fr: rs.coerce3dpoint(fr),focal_ref)
focal_heights = map(lambda fw: float(fw), height_ref.split(','))
smooth_factor = smooth 
value_ref = [formula,focal_ref,focal_heights,smooth_factor]
# ---------- end python ----------

# ----
importepw = Ladybug_ImportEpw(epwFile=path)  # -> readMe, latitude, location, dryBulbTemperature, dewPointTemperature, relativeHumidity, windSpeed, windDirection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; plug-in component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
ladybug = Ladybug_Ladybug()  # -> Vviiiiiiiiiizzz; plug-in component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
number_slider_2 = Slider(9, range=0..10)
number_slider_3 = Slider(21, range=0..100)
bula = PythonScript(Code=file_12, Analysis_ref=gentestpts.testPoints, Value_ref=python, Run=Toggle(True))
number_slider_4 = Slider(9, range=0..10)
number_slider_5 = Slider(21, range=0..100)

# ---- group: solar input curve
geo_8 = Geometry(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)

# ----
sun_pos = SunPosition(
    Location=path,
    Month=number_slider_2,
    Day=number_slider_3,
    Hour=12,
    BooleanValue_0=False,
    BooleanValue_1=False,
    BooleanValue_2=False,
    BooleanValue_3=False,
    BooleanValue_4=False,
    BooleanValue_5=False,
    BooleanValue_6=False,
    BooleanValue_7=False,
    Color_0=RGBA(0, 0, 0, 0),
    Color_1=RGBA(0, 0, 0, 0),
    Color_2=RGBA(0, 0, 0, 0),
    Color_3=RGBA(0, 0, 0, 0),
    Color_4=RGBA(0, 0, 0, 0),
    Color_5=RGBA(0, 0, 0, 0),
    Color_6=RGBA(0, 0, 0, 0),
    Color_7=RGBA(0, 0, 0, 0),
    Hidden_0=False,
    Hidden_1=True,
    Hidden_2=True,
    Hidden_3=True,
    Hidden_4=True,
    Hidden_5=False,
    Hidden_6=False,
    Hidden_7=False,
    IntegerValue_0=-2147483648,
    IntegerValue_1=-2147483648,
    IntegerValue_2=-2147483648,
    IntegerValue_3=-2147483648,
    IntegerValue_4=-2147483648,
    IntegerValue_5=9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)  # -> SolarVector, Azimuth, Altitude
sun_pos_2 = SunPosition(
    Location=path,
    Month=number_slider_2,
    Day=number_slider_3,
    Hour=12,
    BooleanValue_0=False,
    BooleanValue_1=False,
    BooleanValue_2=False,
    BooleanValue_3=False,
    BooleanValue_4=False,
    BooleanValue_5=False,
    BooleanValue_6=False,
    BooleanValue_7=False,
    Color_0=RGBA(0, 0, 0, 0),
    Color_1=RGBA(0, 0, 0, 0),
    Color_2=RGBA(0, 0, 0, 0),
    Color_3=RGBA(0, 0, 0, 0),
    Color_4=RGBA(0, 0, 0, 0),
    Color_5=RGBA(0, 0, 0, 0),
    Color_6=RGBA(0, 0, 0, 0),
    Color_7=RGBA(0, 0, 0, 0),
    Hidden_0=False,
    Hidden_1=True,
    Hidden_2=True,
    Hidden_3=True,
    Hidden_4=True,
    Hidden_5=False,
    Hidden_6=False,
    Hidden_7=False,
    IntegerValue_0=-2147483648,
    IntegerValue_1=-2147483648,
    IntegerValue_2=-2147483648,
    IntegerValue_3=-2147483648,
    IntegerValue_4=-2147483648,
    IntegerValue_5=9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)  # -> SolarVector, Azimuth, Altitude
multiplication = Multiplication(A=[sun_pos.SolarVector, sun_pos_2.SolarVector], B=Slider(300, range=0..1000))
pt_3 = Point(multiplication)
pt_4 = Point([Point(-17.89049319, 160.9898411, 0), Point(-39.04381231, 157.7749922, 0), Point(12.64935323, -173.781392, 0), Point(33.26248411, -169.6865549, 0)])
ln = Line(StartPoint=pt_4, EndPoint=multiplication)

# ---- group: GEOREF
# SITE ANALYSIS SETUP
vec = Vector(Vector(-546054.4782, 3981714.967, 0))

# ---- group: CPT
vec_2 = Vector(Vector(10.25901059, -146.005907, 0))

# ----
geo_9 = Geometry(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)
rad = Radians(Degrees=number_slider)
geo_10 = Geometry(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)
rad_2 = Radians(Degrees=number_slider)

# ---- group: solar input curve
geo_11 = Geometry(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)

# ----
analysisperiod = Ladybug_AnalysisPeriod(
    fromMonth=number_slider_2,
    fromDay=number_slider_3,
    fromHour=Slider(11.25, range=0..100),
    toMonth=number_slider_2,
    toDay=number_slider_3,
    toHour=Slider(12.25, range=0..100))  # -> readMe, analysisPeriod; plug-in component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

# ---- group: A=pt2move2
subtraction = Subtraction(A=vec, B=vec_2)

# ----
rotax = RotateAxis(Geometry=geo_6, Angle=rad, Axis=geo_9)  # -> Geometry, Transform
rotax_2 = RotateAxis(Geometry=geo_10, Angle=rad_2, Axis=geo_7)  # -> Geometry, Transform
analysisperiod_2 = Ladybug_AnalysisPeriod(
    fromMonth=number_slider_4,
    fromDay=number_slider_5,
    fromHour=Slider(12.25, range=0..100),
    toMonth=number_slider_4,
    toDay=number_slider_5,
    toHour=Slider(13.25, range=0..100))  # -> readMe, analysisPeriod; plug-in component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
geo_12 = Geometry([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])
number_slider_6 = Slider(2, range=0..10)  # disabled
number_slider_7 = Slider(0.5, range=0..1)  # disabled
number_slider_8 = Slider(10, range=0..100)  # disabled
solarfanbasic = Ladybug_SolarFanBasic(
    boundary=geo_11,
    location=importepw.location,
    requiredHours=Slider(1, range=0..10),
    height=Slider(225, range=0..1000),
    analysisPeriod=analysisperiod.analysisPeriod)  # -> readMe, solarFan; plug-in component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
move = Move(Geometry=geo_12, Motion=subtraction)  # -> Geometry, Transform
list_4 = ValueList({"divide by depth": "subdivide_depth", "divide by same depth": "subdivide_depth_same", "divide by dim": "subdivide_dim"}, selected="divide by depth")  # disabled
trinco_park = PythonScript(Code=file_6, Rule_in=flatten(bula), Node_in=flatten(boundary), Label_="pedestrianBulaRef", Run=Toggle(True))  # -> Node_out, Debug
toggle_6 = BooleanToggle(True)  # disabled
solarfanbasic_2 = Ladybug_SolarFanBasic(
    boundary=geo_8,
    location=importepw.location,
    requiredHours=Slider(1, range=0..10),
    height=Slider(175, range=0..1000),
    analysisPeriod=analysisperiod_2.analysisPeriod)  # -> readMe, solarFan; plug-in component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
list_5 = ValueList({"YZ": "NS", "XZ": "EW", "XY": "Z"}, selected="YZ")  # disabled
geo_13 = Geometry(move.Geometry)
g = PythonScript(node=trinco_park.Node_out)  # -> geom; inputs node: list
# ---------- g: Python ----------
if node and node != []:
    geom = []
    #lot_lst = node.traverse_tree(lambda n:n,internal=False)
    for n in node:
        #print n.grammar.type.has_key('bula')
        print n
        print n.parent
        #print n.grammar.type['bula']
        geom.append(n.shape.bottom_crv)
    #print geom
# ---------- end g ----------
g_2 = PythonScript(node=trinco_park.Node_out)  # -> bula; inputs node: list
# ---------- g_2: Python ----------
if node and node != []:
    geom = []
    #lot_lst = node.traverse_tree(lambda n:n,internal=False)
    #n = node[0].get_root()
    for n in node:
        
        print n.grammar.type['label']
        print n.grammar.type['bula']
        if n.grammar.type['bula'] == True:
            geom.extend(n.grammar.type['bula_data'].bpt_viz_lst)
    bula = geom
# ---------- end g_2 ----------
g_3 = PythonScript(node=trinco_park.Node_out)  # -> data; inputs node: list
# ---------- g_3: Python ----------
if node and node != []:
    L = []
    #lot_lst = node.traverse_tree(lambda n:n,internal=False)
    #n = node[0].get_root()
    for n in node:
        print n.grammar.type['label']
        if n.grammar.type['bula']:
            for a,v in zip(n.grammar.type['bula_data'].value_actual, n.grammar.type['bula_data'].value_lst):
                pass
                #print a
                #print v
                #print ''
            print '--'
            L.extend(n.grammar.type['bula_data'].value_actual[0])
    for i in L:
        print i
    data = map(lambda d: str(round(d,2))+'%',L)
   
    #print data
# ---------- end g_3 ----------
geo_14 = Geometry(solarfanbasic.solarFan)

# ---- group: SOLAER
geo_15 = Geometry([solarfanbasic_2.solarFan, geo_14])

# ----
python_2 = PythonScript(pts=gentestpts.testPoints, brep=[rotax.Geometry, rotax_2.Geometry, geo_15], run=Toggle(True))  # -> flatten(project); inputs pts: list
# ---------- python_2: Python ----------
import rhinoscriptsyntax as rs
import Rhino as rc
import scriptcontext as sc

if run:
    debug = []
    dir = rc.Geometry.Vector3d(0,0,1) 
    tol = sc.doc.ModelAbsoluteTolerance
    env = [rs.coercebrep(brep)]
    ptlst = map(lambda p: rs.coerce3dpoint(p),pts)
    
    projlst = rc.Geometry.Intersect.Intersection.ProjectPointsToBreps(env,ptlst,dir,tol)
    #print projlst
    #projlst = filter(lambda pt:abs(pt[2]-200.)>0.5,projlst)
    projlst = filter(lambda p: abs(p[2]-0)>1.,projlst)
    
    if projlst:
        debug.extend(projlst)
        #min_index = projlst.index(min(projlst,key=lambda p:p[2]))
        #min_pt = projlst[min_index]
        #envht = min_pt[2]
    project = debug
# ---------- end python_2 ----------
devec = DeconstructVector(Vector=flatten(python_2))  # -> XComponent, YComponent, ZComponent

# ---- group: DIVIDE
bibil_9 = PythonScript(
    Code=file_7,
    Divide_num=number_slider_6,
    Divide_cut=number_slider_8,
    Divide_type=list_4,
    Divide_ratio=number_slider_7,
    Axis=list_5,
    Run=toggle_6)  # disabled

# ----
wires = BrepWireframe(Brep=[rotax.Geometry, rotax_2.Geometry], Density=-1)
geo_16 = Geometry(solarfanbasic_2.solarFan)
toggle_7 = BooleanToggle(True)  # disabled
panel_4 = Panel("roottest")  # disabled
geo_17 = Geometry(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)  # disabled
material = CreateMaterial(
    Diffuse=ColourSwatch(SwatchColor=RGB(114, 145, 107)),
    Specular=RGB(255, 255, 255),
    Emission=RGB(0, 0, 0),
    Transparency=Slider(0.8, range=0..1),
    Shine=0)
geo_18 = Geometry(python_2)
tag = TextTag(Location=g_2, Text=g_3)
geometry = Geometry(g_2)
geo_19 = Geometry(python_2)
trinco_park_2 = PythonScript(Code=file_6, Rule_in=bibil_9, Node_in=geo_17, Label_=panel_4, Run=toggle_7)  # -> Node_out, Debug; disabled
preview_2 = CustomPreview(Geometry=[geo_15, rotax_2.Geometry, rotax.Geometry], Shader=material)
dots = DotDisplay(Point=[geometry, geo_19], Colour=RGB(0, 0, 0), Size=Slider(1, range=0..10))
g_4 = PythonScript(node=trinco_park_2.Node_out)  # -> geom; inputs node: list; disabled
# ---------- g_4: Python ----------
if node and node != []:
    geom = []
    for n in node:
        #lot_lst = n.traverse_tree(lambda n:n.shape.geom,internal=False)
        geom.append(n.shape.geom)#lot_lst)
    print geom
# ---------- end g_4 ----------

# ---- group: root test
# STREET/BLOCK GENERATOR
g_5 = PythonScript(node=trinco_park_2.Node_out)  # -> geom; inputs node: list; disabled
# ---------- g_5: Python ----------
if node and node != []:
    geom = []
    for n in node:
        #print 'label: ', n.parent.grammar.type['label']
        geom.append(n.shape.geom)
    
    node[0].grammar.type['label'] = 'leaftest'
    
    print '----'
    root = node[0].get_root()
    #print root.grammar.type['label']
    lstleaf = root.traverse_tree(lambda n: n,internal=False)
    for leaf in lstleaf:
        print leaf.grammar.type['label']
    print '----'
    
    
    node[0].grammar.type['label'] = 'revisedleaftest'
    node[1].grammar.type['label'] = 'revisedtest'
    
    lstleaf = root.traverse_tree(lambda n: n,internal=False)
    for leaf in lstleaf:
        print leaf.grammar.type['label']
    print '----'
# ---------- end g_5 ----------

# ----
number_slider_9 = Slider(7.5, range=0..100)
# BUILDING TYPOLOGY
# MIDRISE 1
list_6 = ValueList({"root"}, selected="root")
toggle_8 = BooleanToggle(True)
# MIDRISE 2
list_7 = ValueList({"root"}, selected="root")
toggle_9 = BooleanToggle(True)
# HIGH RISE
list_8 = ValueList({"root"}, selected="root")
toggle_10 = BooleanToggle(True)

# ---- group: SETBACKS LINES
geo_20 = Geometry([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])

# ---- group: PODIUM CURVES
geo_21 = Geometry([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])

# ---- group: SETBACKS LINES
geo_22 = Geometry([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])

# ---- group: PODIUM CURVES
geo_23 = Geometry([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])

# ---- group: TREE RULES
miru_2 = PythonScript(Code=file_13, Node=trinco_park.Node_out, Relation=list_7, Insert=toggle_9, Run=toggle_9)

# ---- group: HEIGHT
miru_3 = PythonScript(Code=file_11, Height=Slider(10.5, range=0..100), Run=Toggle(True))

# ---- group: SETBACK
miru_4 = PythonScript(Code=file_10, Height=number_slider_9, Distance="6", Geom_ref=geo_22, Node_ref="-1", Run=Toggle(True))

# ---- group: TREE RULES
miru_5 = PythonScript(Code=file_13, Node=trinco_park.Node_out, Relation=list_8, Insert=toggle_10, Run=toggle_10)

# ----
bula_2 = PythonScript(Code=file_12, Analysis_ref=flatten(python_2), Value_ref=flatten(devec.ZComponent), Run=Toggle(True))

# ---- group: HEIGHT
miru_6 = PythonScript(Code=file_11, Height="bula", Run=Toggle(True))

# ---- group: TREE RULES
miru_7 = PythonScript(Code=file_13, Node=trinco_park.Node_out, Relation=list_6, Insert=toggle_8, Run=toggle_8)

# ---- group: HEIGHT
miru_8 = PythonScript(Code=file_11, Height=Slider(13.5, range=0..100), Run=Toggle(True))

# ---- group: SETBACK
miru_9 = PythonScript(Code=file_10, Height=number_slider_9, Distance=Slider(6, range=0..10), Geom_ref=geo_20, Node_ref="-1", Run=Toggle(True))

# ---- group: TOWER SEP
panel_5 = Panel("25")

# ---- group: EXISTING TOWERS
geo_24 = Geometry([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])

# ---- group: TOWER CURVES
geo_25 = Geometry([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])

# ---- group: MIDRISE
bibil_10 = PythonScript(
    Code=file_6,
    Rule_in=flatten([miru_7, miru_8, miru_9]),
    Node_in=flatten(geo_23),
    Label_="midrise_podium",
    Run=Toggle(True))  # -> Node_out, Debug

bibil_11 = PythonScript(
    Code=file_6,
    Rule_in=flatten([miru_2, miru_3, miru_4]),
    Node_in=flatten(geo_21),
    Label_="midrise_podium",
    Run=Toggle(True))  # -> Node_out, Debug

# ---- group: TOWERS
bibil_12 = PythonScript(Code=file_6, Rule_in=flatten([miru_5, bula_2, miru_6]), Node_in=flatten(geo_25), Label_="hiriseType", Run=Toggle(True))  # -> Node_out, Debug

# ----
g_6 = PythonScript(node=bibil_10.Node_out)  # -> geom; inputs node: list
# ---------- g_6: Python ----------
node = filter(lambda n: n!=None,node)
if node and node != []:
    geom = []
    for n in node:
        print n.get_root()
        print n.parent.parent
        print n
        geom.append(n.shape.geom)
    print geom
# ---------- end g_6 ----------
g_7 = PythonScript(node=bibil_11.Node_out)  # -> geom; inputs node: list; same code as g_6
g_8 = PythonScript(node=bibil_12.Node_out)  # -> geom; inputs node: list
# ---------- g_8: Python ----------
node = filter(lambda n: n!=None,node)
if node and node != []:
    geom = []
    for n in node:
        #print n.get_root()
        print n
        print n.parent
        #print n.parent.parent
        #print n.parent.parent.parent
        #print n.parent.parent.parent.parent
        #print '---'
        geom.append(n.shape.bottom_crv)
    #print geom
# ---------- end g_8 ----------

# ---- group: traverse_example
g_9 = PythonScript(node=bibil_12.Node_out)  # -> geom; inputs node: list
# ---------- g_9: Python ----------
node = filter(lambda n: n!=None,node)
if node and node != []:
    geom = []
    for n in node:
        geom.append(n.shape.geom)
    
    root = node[0].get_root()
    L = root.traverse_tree(lambda n:n,internal=True)
    for i in L:
        print i
# ---------- end g_9 ----------

# ---- group: HIGHRISE
g_10 = PythonScript(node=bibil_12.Node_out)  # -> geom; inputs node: list
# ---------- g_10: Python ----------
node = filter(lambda n: n!=None,node)
if node and node != []:
    geom = []
    for n in node:
        #print n.get_root()
        print n
        print n.parent
        #print n.parent.parent
        #print n.parent.parent.parent
        #print n.parent.parent.parent.parent
        #print '---'
        geom.append(n.shape.geom)
    #print geom
# ---------- end g_10 ----------

# ---- group: MIDRISE
g_11 = PythonScript(node=[bibil_10.Node_out, bibil_11.Node_out])  # -> geom; inputs node: list; same code as g_6

# ---- group: EXISTING TOWERS
bibil_13 = PythonScript(Code=file_6, Node_in=flatten(geo_24), Label_="exist_tower", Run=Toggle(True))  # -> Node_out, Debug

# ---- group: Soft Sites ref
geo_26 = Geometry([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])

# ---- group: Block outlines
geo_27 = Geometry([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])

# ----
g_12 = PythonScript(node=bibil_13.Node_out)  # -> geom; inputs node: list
# ---------- g_12: Python ----------
import rhinoscriptsyntax as rs
import scriptcontext as sc
node = filter(lambda n: n!=None,node)
if node and node != []:
    geom = []
    for n in node:
        #print n.get_root()
        #print n.parent
        crv = n.shape.bottom_crv
        if n.shape.cpt[2] > 0.0:
            crv = sc.doc.Objects.AddCurve(crv)
            crv = rs.MoveObject(crv,[0,0,n.shape.cpt[2]*-1])
        geom.append(crv)
        
    #print geom
# ---------- end g_12 ----------
number_slider_10 = Slider(0, range=0..1)
preview_3 = CustomPreview(Geometry=geo_27, Shader=ColourSwatch(SwatchColor=RGB(0, 0, 0)))
# VISUALIZATION
preview_4 = CustomPreview(Geometry=[geo_26, geo_27], Shader=ColourSwatch(SwatchColor=RGB(0, 251, 255)))
offset = Offset(Curve=g_8, Distance=panel_5, Plane=PlaneXY(0, 0, 0), Corners="2")
offset_2 = Offset(Curve=g_12, Distance=panel_5, Plane=PlaneXY(0, 0, 0), Corners="2")

# ---- group: Bldg Ref
geo_28 = Geometry([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])

# ----
boundary_2 = BoundarySurfaces(Edges=[offset, offset_2])
material_2 = CreateMaterial(
    Diffuse=ColourSwatch(SwatchColor=RGB(255, 0, 56)),
    Specular=RGB(255, 255, 255),
    Emission=RGB(0, 0, 0),
    Transparency=number_slider_10,
    Shine=0)
material_3 = CreateMaterial(
    Diffuse=RGB(255, 105, 180),
    Specular=RGB(255, 255, 255),
    Emission=RGB(0, 0, 0),
    Transparency=Slider(0.8, range=0..1),
    Shine=0)
material_4 = CreateMaterial(
    Diffuse=ColourSwatch(SwatchColor=RGB(71, 71, 71)),
    Specular=RGB(255, 255, 255),
    Emission=RGB(0, 0, 0),
    Transparency=number_slider_10,
    Shine=0)
preview_5 = CustomPreview(Geometry=boundary_2, Shader=material_3)
previewlw = CustomPreviewLineweights(
    Geometry=[offset, offset_2],
    Shader={ambient=RGB(0, 0, 0), diffuse=RGB(255, 105, 180), emission=RGB(76, 32, 54), shine=0.5, specular=RGB(255, 255, 255), transparency=0},
    Thickness=Slider(2, range=0..10),
    Absolute=False)
preview_6 = CustomPreview(Geometry=[g_11, g_10], Shader=material_2)
preview_7 = CustomPreview(Geometry=geo_28, Shader=material_4)
geo_29 = Geometry(geo_5)  # disabled
boundary_3 = BoundarySurfaces(Edges=geo_29)  # disabled
Z = UnitZ(Factor=number_slider_9)  # disabled
g_13 = PythonScript(node=bibil_12.Node_out)  # -> geom; inputs node: list; disabled; same code as g_6
g_14 = PythonScript(node=[bibil_10.Node_out, bibil_11.Node_out])  # -> geom; inputs node: list; disabled; same code as g_6
move_2 = Move(Geometry=boundary_3, Motion=Z)  # -> Geometry, Transform; disabled
split = SplitBrep(Brep=g_14, Cutter=move_2.Geometry)  # disabled
geo_30 = Geometry(g_13)  # disabled
boundary_4 = BoundarySurfaces(Edges=geo_29)  # disabled
Z_2 = UnitZ(Factor=number_slider_9)  # disabled
capex = CapHolesEx(Brep=split)  # -> Brep, Caps, Solid; disabled
move_3 = Move(Geometry=boundary_4, Motion=Z_2)  # -> Geometry, Transform; disabled
python_3 = PythonScript(x=flatten(capex.Brep))  # -> a; inputs x: list; disabled
# ---------- python_3: Python ----------
import rhinoscriptsyntax as rs
import Rhino as rc

L = []
for x_ in x:
    geom = rs.coercegeometry(x_)
    bbBox = geom.GetBoundingBox(rc.Geometry.Plane.WorldXY)
    maxHeights = bbBox.Max.Z
    minHeights = bbBox.Min.Z
    zdist = maxHeights - minHeights
    if zdist >= 2.:
        L.append(geom)
    
a = L
# ---------- end python_3 ----------
geo_31 = Geometry([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])  # disabled
split_2 = SplitBrep(Brep=simplify(flatten(geo_30)), Cutter=move_3.Geometry)  # disabled
capex_2 = CapHolesEx(Brep=split_2)  # -> Brep, Caps, Solid; disabled
Z_3 = UnitZ(Factor=0.25)  # disabled
python_4 = PythonScript(x=flatten(capex_2.Brep))  # -> a; inputs x: list; disabled
# ---------- python_4: Python ----------
import rhinoscriptsyntax as rs
import Rhino as rc

L = []
for x_ in x:
    geom = rs.coercegeometry(x_)
    bbBox = geom.GetBoundingBox(rc.Geometry.Plane.WorldXY)
    maxHeights = bbBox.Max.Z
    minHeights = bbBox.Min.Z
    #zdist = maxHeights - minHeights
    if minHeights >= 2.:
        L.append(geom)
    
a = L
# ---------- end python_4 ----------
toggle_11 = BooleanToggle(False)  # disabled
move_4 = Move(Geometry=python_4, Motion=Z_3)  # -> Geometry, Transform; disabled
# ARCH2ANALYSIS: ENERGY ARCHETYPE SETUP
honeybee = Honeybee_Honeybee()  # -> Vviiiiiiiiiizzz; disabled; plug-in component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
ladybug_2 = Ladybug_Ladybug()  # -> Vviiiiiiiiiizzz; disabled; plug-in component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

# ---- group: Commercial
geo_32 = Geometry([python_3, geo_31])  # disabled

# ---- group: Residential
geo_33 = Geometry(move_4.Geometry)  # disabled

# ----
updatehoneybee = Honeybee_UpdateHoneybee(updateThisFile=toggle_11)  # -> out; disabled; plug-in component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
toggle_12 = BooleanToggle(True)  # disabled
toggle_13 = BooleanToggle(True)  # disabled
panel_6 = Panel("@3")  # disabled
capex_3 = CapHolesEx(Brep=geo_33)  # -> Brep, Caps, Solid; disabled
panel_7 = Panel("@3")  # disabled
capex_4 = CapHolesEx(Brep=geo_32)  # -> Brep, Caps, Solid; disabled
panel_8 = Panel(updatehoneybee)  # disabled
preview_8 = CustomPreview(
    Geometry=[geo_32, geo_33],
    Shader={ambient=RGB(0, 0, 0), diffuse=RGB(255, 105, 180), emission=RGB(76, 32, 54), shine=0.5, specular=RGB(255, 255, 255), transparency=0})  # disabled

# ---- group: shade4res
geo_34 = Geometry(geo_32)  # disabled

# ---- group: shade4com
geo_35 = Geometry(geo_33)  # disabled

# ----
toggle_14 = BooleanToggle(True)  # disabled
# 4VIZ
toggle_15 = BooleanToggle(True)  # disabled
panel_9 = Panel("hirise_bld")  # disabled
panel_10 = Panel("hirise_bld")  # disabled
number_slider_11 = Slider(3, range=0..10)  # disabled
number_slider_12 = Slider(3, range=0..10)  # disabled
Z_4 = UnitZ(Factor=number_slider_11)  # disabled
Z_5 = UnitZ(Factor=number_slider_12)  # disabled
toggle_16 = BooleanToggle(False)  # disabled
button = Button()  # disabled
panel_11 = Panel("C:\ArchsimResults\MultiZone")  # disabled
panel_12 = Panel("MultiZone2")  # disabled
panel_13 = Panel("C:\ArchsimResults\MultiZone")  # disabled
panel_14 = Panel("MultiZone3")  # disabled
toggle_17 = BooleanToggle(True)  # disabled
toggle_18 = BooleanToggle(True)  # disabled

panel_15 = Panel("C:\\Users\\vasanthakumars\\Documents\\GitHub\\bibil\\src\\reference\\honeybee_work\\Honeybee_SplitZone.py")  # disabled
panel_16 = Panel("C:\\saeran\\master\\git\\bibil\\src\\reference\\honeybee_work\\Honeybee_SplitZone.py")  # disabled
panel_17 = Panel("C:\\Users\\vasanthakumars\\Documents\\GitHub\\bibil\\src\\reference\\honeybee_work\\Honeybee_SplitBuildingMass.py")  # disabled
panel_18 = Panel("C:\\saeran\\master\\git\\bibil\\src\\reference\\honeybee_work\\Honeybee_SplitBuildingMass.py")  # disabled
toggle_19 = BooleanToggle(True)  # disabled
toggle_20 = BooleanToggle(True)  # disabled
list_9 = ValueList({"dir", "file"}, selected="file")  # disabled
list_10 = ValueList({"dir", "file"}, selected="file")  # disabled

# ---- group: find directory
bibil_14 = PythonScript(dir=[panel_16, panel_15], type=list_9, run=toggle_19)  # -> file; inputs dir: list; disabled; same code as bibil

bibil_15 = PythonScript(dir=[panel_18, panel_17], type=list_10, run=toggle_20)  # -> file; inputs dir: list; disabled; same code as bibil

# ----
file_14 = ReadFile(File=bibil_15, PerLineParse=False)  # disabled
file_15 = ReadFile(File=bibil_14, PerLineParse=False)  # disabled

# ----
# RESIDENTIAL
splitmass = Honeybee_SplitBuildingMass(Code=file_14, _bldgMasses=capex_3.Brep, BldgsFlr2FloorHeights_=panel_6, _runIt=toggle_12)  # -> ReadMe, flatten(SplitBldgMasses); disabled
# COMMERCIAL
splitmass_2 = Honeybee_SplitBuildingMass(Code=file_14, _bldgMasses=capex_4.Brep, BldgsFlr2FloorHeights_=panel_7, _runIt=toggle_13)  # -> ReadMe, flatten(SplitBldgMasses); disabled
geo_36 = Geometry(splitmass.SplitBldgMasses)  # disabled
geo_37 = Geometry(splitmass_2.SplitBldgMasses)  # disabled
wires_2 = BrepWireframe(Brep=geo_36, Density=-1)  # disabled
wires_3 = BrepWireframe(Brep=geo_37, Density=-1)  # disabled
preview_9 = CustomPreview(
    Geometry=wires_2,
    Shader={ambient=RGB(0, 0, 0), diffuse=RGB(255, 105, 180), emission=RGB(76, 32, 54), shine=0.5, specular=RGB(255, 255, 255), transparency=0})  # disabled
bibil_16 = PythonScript(Code=file_6, Node_in=flatten(splitmass.SplitBldgMasses), Label_=panel_9, Run=toggle_14)  # -> Node_out, Debug; disabled
bibil_17 = PythonScript(Code=file_6, Node_in=flatten(splitmass_2.SplitBldgMasses), Label_=panel_10, Run=toggle_15)  # -> Node_out, Debug; disabled
g_15 = PythonScript(node=bibil_16.Node_out)  # -> geom; inputs node: list; disabled
# ---------- g_15: Python ----------
import rhinoscriptsyntax as rs
node = filter(lambda n: n!=None,node)
if node and node != []:
    geom = []
    for n in node:
        geom_ = n.shape.bottom_crv
        print geom_
        geom.append(geom_)
# ---------- end g_15 ----------
g_16 = PythonScript(node=bibil_17.Node_out)  # -> geom; inputs node: list; disabled; same code as g_15
explode = Explode(Curve=g_15, Recursive=True)  # -> Segments, Vertices; disabled
explode_2 = Explode(Curve=g_16, Recursive=True)  # -> Segments, Vertices; disabled
extr = Extrude(Base=explode.Segments, Direction=Z_4)  # disabled
area = Area(Geometry=g_15)  # -> Area, Centroid; disabled
extr_2 = Extrude(Base=explode_2.Segments, Direction=Z_5)  # disabled
wires_4 = BrepWireframe(Brep=extr, Density=-1)  # disabled
edges = BrepEdges(Brep=extr)  # -> Naked, Interior, NonManifold; disabled
wires_5 = BrepWireframe(Brep=extr_2, Density=-1)  # disabled
edges_2 = BrepEdges(Brep=extr_2)  # -> Naked, Interior, NonManifold; disabled
area_2 = Area(Geometry=extr)  # -> Area, Centroid; disabled
python_5 = PythonScript(base=g_15, ptlst=area.Centroid, run=toggle_16)  # -> P, C; inputs zones: tree, zones_crv: list, base: list, ptlst: list; disabled
# ---------- python_5: Python ----------
import rhinoscriptsyntax as rs

P = []
C = []


if run:
    zonecount = 0
    for i in range(zones.BranchCount):
        zonelst = zones.Branch(i)
        offset = rs.OffsetCurve(base[i],ptlst[i],3.)[0]
        for j,zone in enumerate(zonelst):
            zonecrv = zones_crv[int(zonecount)]
            zonecount+=1
            IsCore = rs.PointInPlanarClosedCurve(ptlst[i],zonecrv)
            if IsCore:
                C.append(zone)
            else:
                P.append(zone)
        print '---'
        #L.append(offset)
# ---------- end python_5 ----------
area_3 = Area(Geometry=extr_2)  # -> Area, Centroid; disabled
python_6 = PythonScript(x=edges_2.Naked, pt=flatten(area_3.Centroid))  # -> flatten(a); inputs x: tree, pt: list; disabled
# ---------- python_6: Python ----------
import rhinoscriptsyntax as rs
L = []

for i in range(x.BranchCount):
    edgelst = x.Branch(i)
    edge = rs.JoinCurves(edgelst,delete_input=True)
    edge = rs.coercecurve(edge)
    offset = rs.OffsetCurve(edge,pt[i],1.)[0]
    offset = rs.AddPlanarSrf(offset)[0]
    L.append(offset)
    
a = L
# ---------- end python_6 ----------
python_7 = PythonScript(x=edges.Naked, pt=flatten(area_2.Centroid))  # -> a; inputs x: tree, pt: list; disabled; same code as python_6
geo_38 = Geometry(python_5.P)  # disabled
geo_39 = Geometry(python_5.C)  # disabled

# ---- group: OFFICE
panel_19 = Panel("Perimeter")  # disabled
zone = ThermalZone(
    ThermalZoneGeometry=splitmass_2.SplitBldgMasses,
    Name=panel_19,
    SettingsAsFormatedString="-NoSelection-",
    Library="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",
    Settings="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")  # -> ThermalZones, SettingsAsFormatedString; disabled
window = Window(
    WindowGeometry=python_6,
    Library="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",
    Settings="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")  # -> Window, SettingsAsFormatedString; disabled

# ----
# ENERGY SIMULATION
zone_2 = ThermalZone(
    ThermalZoneGeometry=splitmass.SplitBldgMasses,
    SettingsAsFormatedString="-NoSelection-",
    Library="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",
    Settings="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")  # -> ThermalZones, SettingsAsFormatedString; disabled
window_2 = Window(
    WindowGeometry=python_7,
    Library="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",
    Settings="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")  # -> Window, SettingsAsFormatedString; disabled

networker = ZoneConnectivityNetwork(ThermalZoneCollection=zone.ThermalZones, Windows=window.Window, ShadingGeometryCollection=geo_35)  # disabled
surfaceanalysis = SurfaceAnalysis(ThermalModel=networker)  # -> Facade, Partition, Ceiling, Roof, ExternalFloor, Floor, Window, FaceID, IDLocation; disabled
networker_2 = ZoneConnectivityNetwork(ThermalZoneCollection=zone_2.ThermalZones, Windows=window_2.Window, ShadingGeometryCollection=geo_34)  # disabled
surfaceanalysis_2 = SurfaceAnalysis(ThermalModel=networker_2)  # -> Facade, Partition, Ceiling, Roof, ExternalFloor, Floor, Window, FaceID, IDLocation; disabled
brep = Brep([surfaceanalysis.Window, surfaceanalysis.Facade, surfaceanalysis.Floor, surfaceanalysis.ExternalFloor])  # disabled
brep_2 = Brep([surfaceanalysis_2.Window, surfaceanalysis_2.Facade, surfaceanalysis_2.Floor, surfaceanalysis_2.ExternalFloor])  # disabled
run_e = TakesThermalModelAndRunsEnergyPlus(
    ThermalModel=networker_2,
    ProjectName=panel_12,
    WorkingDirectory=panel_11,
    WeatherFile="USA_NY_New.York-LaGuardia.AP.725030_TMY3",
    StartsTheSimulation=button,
    settings="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")  # -> ThermalModel, SettingsAsFormatedString; disabled
run_e_2 = TakesThermalModelAndRunsEnergyPlus(
    ThermalModel=networker,
    ProjectName=panel_14,
    WorkingDirectory=panel_13,
    WeatherFile="USA_NY_New.York-LaGuardia.AP.725030_TMY3",
    StartsTheSimulation=button,
    settings="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")  # -> ThermalModel, SettingsAsFormatedString; disabled
load_zone_results = LoadZoneResults(ThermalModel=run_e.ThermalModel, Toggle=toggle_18, settings="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")  # -> flatten(ZoneGeometry), ResultsPerZone, Labels, Guid, Name; disabled
load_zone_results_2 = LoadZoneResults(ThermalModel=run_e_2.ThermalModel, Toggle=toggle_17, settings="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")  # -> flatten(ZoneGeometry), ResultsPerZone, Labels, Guid, Name; disabled
panel_20 = Panel(load_zone_results.ResultsPerZone)  # disabled
ma = MassAddition(Input=load_zone_results_2.ResultsPerZone)  # -> flatten(Result), PartialResults; disabled
ma_2 = MassAddition(Input=load_zone_results.ResultsPerZone)  # -> flatten(Result), PartialResults; disabled
bnd = Bounds(Numbers=ma_2.Result)  # disabled
dedomain = DeconstructDomain(Domain=bnd)  # -> Start, End; disabled
bnd_2 = Bounds(Numbers=ma.Result)  # disabled
dedomain_2 = DeconstructDomain(Domain=bnd_2)  # -> Start, End; disabled
panel_21 = Panel(load_zone_results.ZoneGeometry)  # disabled
panel_22 = Panel(ma_2.Result)  # disabled
gradient = Gradient(
    LowerLimit=dedomain.End,
    UpperLimit=dedomain.Start,
    Parameter=ma_2.Result,
    stops=[0: RGB(234, 38, 0), 0.25: RGB(234, 126, 0), 0.5: RGB(254, 244, 84), 0.75: RGB(173, 203, 249), 1: RGB(75, 107, 169)])  # disabled
gradient_2 = Gradient(
    LowerLimit=dedomain_2.End,
    UpperLimit=dedomain_2.Start,
    Parameter=ma.Result,
    stops=[0: RGB(234, 38, 0), 0.25: RGB(234, 126, 0), 0.5: RGB(254, 244, 84), 0.75: RGB(173, 203, 249), 1: RGB(75, 107, 169)])  # disabled
sort = SortList(Keys=ma.Result)  # -> Keys, ValuesA; disabled
sort_2 = SortList(Keys=ma_2.Result)  # -> Keys, ValuesA; disabled
preview_10 = CustomPreview(Geometry=load_zone_results.ZoneGeometry, Shader=gradient)  # disabled
preview_11 = CustomPreview(Geometry=load_zone_results_2.ZoneGeometry, Shader=gradient_2)  # disabled
panel_23 = Panel(sort_2.Keys)  # disabled
panel_24 = Panel(sort.Keys)  # disabled
