# Grasshopper definition bibil_trial_094_tocore_master_file_minimal.gh (Grasshopper 0.9.76)
# plug-ins: Python Interpreter, DIVA Daylight, ArchsimGH, Mosquito

list = ValueList({"dir", "file"}, selected="dir")

# ---- group: find directory
bibil = PythonScript(
    dir=["C:\\Users\\vasanthakumars\\Documents\\GitHub\\bibil\\src", "C:\\saeran\\master\\git\\bibil\\src"],
    type=list,
    run=Toggle(True))  # -> dir; inputs dir: list
# ---------- bibil: Python ----------
import os

ghenv.Component.Params.Output[0].Name = "null"
ghenv.Component.Params.Output[0].NickName = "null"

if run:
    confirm_dir = None
    for d in dir:
        try:
            if type == "file":
                file_ = open(d)
                file_.close()
            else:
                print os.listdir(d)
            confirm_dir = d
            break
        except Exception as e:
            #print str(e)
            continue
    if confirm_dir != None:
        ghenv.Component.Params.Output[0].Name = type
        ghenv.Component.Params.Output[0].NickName = type
        dir = confirm_dir
        file = confirm_dir
null = None
# ---------- end bibil ----------

# ---- group: tree
python_script = PythonScript(i=bibil)  # -> o
# ---------- python_script: Python ----------
import os

if i:
    o = os.path.join(str(i),"bibil\\bibil_tree.py")
# ---------- end python_script ----------
file = ReadFile(File=python_script, PerLineParse=False)
bibil_2 = PythonScript(Code=file)

# ---- group: grammar
python_script_2 = PythonScript(i=bibil)  # -> o
# ---------- python_script_2: Python ----------
import os

if i:
    o = os.path.join(str(i),"bibil\\bibil_grammar.py")
# ---------- end python_script_2 ----------
file_2 = ReadFile(File=python_script_2, PerLineParse=False)
bibil_3 = PythonScript(Code=file_2)

# ---- group: shape
python_script_3 = PythonScript(i=bibil)  # -> o
# ---------- python_script_3: Python ----------
import os

if i:
    o = os.path.join(str(i),"bibil\\bibil_shape.py")
#o = os.path.join(str(i),"research\\bibil_shape_shape_3d_2d.py")
# ---------- end python_script_3 ----------
file_3 = ReadFile(File=python_script_3, PerLineParse=False)
bibil_4 = PythonScript(Code=file_3)

# ---- group: miru
python_script_4 = PythonScript(i=bibil)  # -> o
# ---------- python_script_4: Python ----------
import os

if i:
    o = os.path.join(str(i),"miru\\miru_miru.py")
# ---------- end python_script_4 ----------
file_4 = ReadFile(File=python_script_4, PerLineParse=False)
bibil_5 = PythonScript(Code=file_4)

# ---- group: bula
python_script_5 = PythonScript(i=bibil)  # -> o
# ---------- python_script_5: Python ----------
import os

if i:
    o = os.path.join(str(i),"bula\\bula_minimal.py")
# ---------- end python_script_5 ----------
file_5 = ReadFile(File=python_script_5, PerLineParse=False)
bibil_6 = PythonScript(Code=file_5)

# ---- group: UI
python_script_6 = PythonScript(i=bibil)  # -> o
# ---------- python_script_6: Python ----------
import os

if i:
    o = os.path.join(str(i),"bibil\\bibil_UI.py")
# ---------- end python_script_6 ----------
file_6 = ReadFile(File=python_script_6, PerLineParse=False)

# ---- group: grammar_divide
python_script_7 = PythonScript(i=bibil)  # -> o
# ---------- python_script_7: Python ----------
import os

if i:
    o = os.path.join(str(i),"miru\\miru_divide.py")
# ---------- end python_script_7 ----------
file_7 = ReadFile(File=python_script_7, PerLineParse=False)

# ---- group: grammar_courtyard
python_script_8 = PythonScript(i=bibil)  # -> o
# ---------- python_script_8: Python ----------
import os

if i:
    o = os.path.join(str(i),"miru\\miru_court.py")
# ---------- end python_script_8 ----------
file_8 = ReadFile(File=python_script_8, PerLineParse=False)

# ---- group: grammar_tower
python_script_9 = PythonScript(i=bibil)  # -> o
# ---------- python_script_9: Python ----------
import os

if i:
    o = os.path.join(str(i),"miru\\miru_packing.py")
# ---------- end python_script_9 ----------
file_9 = ReadFile(File=python_script_9, PerLineParse=False)

python_script_10 = PythonScript(i=bibil)  # -> o
# ---------- python_script_10: Python ----------
import os

if i:
    o = os.path.join(str(i),"miru\\miru_stepback.py")
# ---------- end python_script_10 ----------
file_10 = ReadFile(File=python_script_10, PerLineParse=False)

# ---- group: grammar_height
python_script_11 = PythonScript(i=bibil)  # -> o
# ---------- python_script_11: Python ----------
import os

if i:
    o = os.path.join(str(i),"miru\\miru_height.py")
# ---------- end python_script_11 ----------
file_11 = ReadFile(File=python_script_11, PerLineParse=False)

# ---- group: grammar_analysis_pts
python_script_12 = PythonScript(i=bibil)  # -> o
# ---------- python_script_12: Python ----------
import os

if i:
    o = os.path.join(str(i),"miru\\miru_analysis.py")
# ---------- end python_script_12 ----------
file_12 = ReadFile(File=python_script_12, PerLineParse=False)

# ---- group: meta_tree
python_script_13 = PythonScript(i=bibil)  # -> o
# ---------- python_script_13: Python ----------
import os

if i:
    o = os.path.join(str(i),"miru\\miru_meta_tree.py")
# ---------- end python_script_13 ----------
file_13 = ReadFile(File=python_script_13, PerLineParse=False)

# ---- group: land_use
python_script_14 = PythonScript(i=bibil)  # -> o
# ---------- python_script_14: Python ----------
import os

if i:
    o = os.path.join(str(i),"miru\\miru_landuse.py")
# ---------- end python_script_14 ----------
file_14 = ReadFile(File=python_script_14, PerLineParse=False)

# ----
# Note: Change this number with caution,
# Increase bounds iterratively.
panel = Panel("0.008")  # disabled

panel_2 = Panel("Yonge and Eglinton")  # disabled
panel_3 = Panel("Montgomery Square and Yonge Street")  # disabled
location = MosquitoLocation(Location=panel_3)  # -> Address, Points, Type; disabled
item = ListItem(List=location.Points, Index=0, Wrap=True)  # disabled
toggle = BooleanToggle(True)  # disabled
toggle_2 = BooleanToggle(True)  # disabled
toggle_3 = BooleanToggle(True)  # disabled
toggle_4 = BooleanToggle(True)  # disabled
circle = CircleCNR(Center=item, Normal=Vector(0, 0, 1), Radius=panel)  # disabled
vector_maps = VectorMaps(Area=circle, AllRoads=toggle, Buildings=toggle_2, ReProject=toggle_3, CenterToWorld=toggle_4)  # -> RoadLines, RoadInfo, BuildingLines, BuildingInfo, BuildingHeights, AmenityLines, AmenityInfo, AmenityPoints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; disabled
swatch = ColourSwatch(SwatchColor=RGB(0, 0, 0))  # disabled
geo = Geometry([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])  # disabled
geo_2 = Geometry([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])  # disabled
geo_3 = Geometry(Tree({0}: [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], {1}: [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], {2}: [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], {3}: [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], {4}: [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], {5}: [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]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))  # disabled
geo_4 = Geometry([vector_maps.BuildingLines, vector_maps.RoadLines, vector_maps.AmenityLines])  # disabled
preview = CustomPreview(Geometry=[geo_3, geo_2, geo], Shader=swatch)  # disabled

list_2 = ValueList({"divide by depth": "subdivide_depth", "divide by same depth": "subdivide_depth_same", "divide by dim": "subdivide_dim"}, selected="divide by depth")
list_3 = ValueList({"YZ": "NS", "XZ": "EW", "XY": "Z"}, selected="XZ")

# ---- group: COURTYARD
miru = PythonScript(Code=file_8, Podium_depth=Slider(21, range=0..100), Node_depth=Slider(1, range=-1..1), Run=Toggle(True))  # disabled

# ---- group: DIVIDE
bibil_7 = PythonScript(
    Code=file_7,
    Divide_num=Slider(1, range=0..10),
    Divide_cut=Slider(10, range=0..100),
    Divide_type=list_2,
    Divide_ratio=Slider(0.5, range=0..1),
    Axis=list_3,
    Run=Toggle(False))  # disabled

# ---- group: SITE BOUNDARY
geo_5 = Geometry(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)

# ----
boundary = BoundarySurfaces(Edges=geo_5)
pt = Point(Point(-546056.4775, 3982009.405, 0))
pt_2 = Point(Point(-546214.5571, 3981659.038, 0))
gentestpts = Honeybee_GenerateTestPoints(testGeometry=boundary, gridSize="10", distBaseSrf="1", moveTestMesh=True)  # -> readMe, simplify(testPoints), simplify(ptsVectors), simplify(facesArea), simplify(mesh); plug-in component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

# ---- group: FORMULA
python = PythonScript(formula="1 / math.exp(0.1813*dist)", focal_ref=[pt_2, pt], height_ref="112.5,89.5,40.0", smooth=Slider(1.5, range=0..5))  # -> value_ref; inputs focal_ref: list
# ---------- python: Python ----------
"""
Bula Formula
"""
import rhinoscriptsyntax as rs

#Formula handling
#dist = 10.
#val = eval(formula)

focal_ref = map(lambda fr: rs.coerce3dpoint(fr),focal_ref)
focal_heights = map(lambda fw: float(fw), height_ref.split(','))
smooth_factor = smooth 
value_ref = [formula,focal_ref,focal_heights,smooth_factor]
# ---------- end python ----------

# ----
bula = PythonScript(Code=file_12, Analysis_ref=gentestpts.testPoints, Value_ref=python, Run=Toggle(True))

# ---- group: GEOREF
vec = Vector(Vector(-1067.339845, 1063.239109, 0))

# ---- group: CPT
vec_2 = Vector(Vector(-546071.5172, 3981810.795, 0))

# ---- group: A=pt2move2
subtraction = Subtraction(A=vec_2, B=vec)

# ----
geo_6 = Geometry([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])
number_slider = Slider(2, range=0..10)  # disabled
number_slider_2 = Slider(0.5, range=0..1)  # disabled
number_slider_3 = Slider(10, range=0..100)  # disabled
move = Move(Geometry=geo_6, Motion=subtraction)  # -> Geometry, Transform
list_4 = ValueList({"divide by depth": "subdivide_depth", "divide by same depth": "subdivide_depth_same", "divide by dim": "subdivide_dim"}, selected="divide by depth")  # disabled
trinco_park = PythonScript(Code=file_6, Rule_in=flatten(bula), Node_in=flatten(boundary), Label_="pedestrianBulaRef", Run=Toggle(True))  # -> Node_out, Debug
# SITE ANALYSIS SETUP
toggle_5 = BooleanToggle(True)  # disabled
geo_7 = Geometry(move.Geometry)
list_5 = ValueList({"YZ": "NS", "XZ": "EW", "XY": "Z"}, selected="YZ")  # disabled
g = PythonScript(node=trinco_park.Node_out)  # -> geom; inputs node: list
# ---------- g: Python ----------
if node and node != []:
    geom = []
    #lot_lst = node.traverse_tree(lambda n:n,internal=False)
    for n in node:
        #print n.grammar.type.has_key('bula')
        print n
        print n.parent
        #print n.grammar.type['bula']
        geom.append(n.shape.bottom_crv)
    #print geom
# ---------- end g ----------
g_2 = PythonScript(node=trinco_park.Node_out)  # -> data; inputs node: list
# ---------- g_2: Python ----------
if node and node != []:
    L = []
    #lot_lst = node.traverse_tree(lambda n:n,internal=False)
    #n = node[0].get_root()
    for n in node:
        print n.grammar.type['label']
        if n.grammar.type['bula']:
            for a,v in zip(n.grammar.type['bula_data'].value_actual, n.grammar.type['bula_data'].value_lst):
                pass
                #print a
                #print v
                #print ''
            print '--'
            L.extend(n.grammar.type['bula_data'].value_actual)
    for i in L:
        print i
    data = map(lambda d: str(round(d,2))+'%',L)
   
    #print data
# ---------- end g_2 ----------
g_3 = PythonScript(node=trinco_park.Node_out)  # -> bula; inputs node: list
# ---------- g_3: Python ----------
if node and node != []:
    geom = []
    #lot_lst = node.traverse_tree(lambda n:n,internal=False)
    #n = node[0].get_root()
    for n in node:
        
        print n.grammar.type['label']
        print n.grammar.type['bula']
        if n.grammar.type['bula'] == True:
            geom.extend(n.grammar.type['bula_data'].bpt_viz_lst)
    bula = geom
# ---------- end g_3 ----------

# ---- group: DIVIDE
bibil_8 = PythonScript(
    Code=file_7,
    Divide_num=number_slider,
    Divide_cut=number_slider_3,
    Divide_type=list_4,
    Divide_ratio=number_slider_2,
    Axis=list_5,
    Run=toggle_5)  # disabled

# ----
toggle_6 = BooleanToggle(True)  # disabled
panel_4 = Panel("roottest")  # disabled
geo_8 = Geometry(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)  # disabled
tag = TextTag(Location=g_3, Text=g_2)
trinco_park_2 = PythonScript(Code=file_6, Rule_in=bibil_8, Node_in=geo_8, Label_=panel_4, Run=toggle_6)  # -> Node_out, Debug; disabled
g_4 = PythonScript(node=trinco_park_2.Node_out)  # -> geom; inputs node: list; disabled
# ---------- g_4: Python ----------
if node and node != []:
    geom = []
    for n in node:
        #lot_lst = n.traverse_tree(lambda n:n.shape.geom,internal=False)
        geom.append(n.shape.geom)#lot_lst)
    print geom
# ---------- end g_4 ----------

# ---- group: root test
# STREET/BLOCK GENERATOR
g_5 = PythonScript(node=trinco_park_2.Node_out)  # -> geom; inputs node: list; disabled
# ---------- g_5: Python ----------
if node and node != []:
    geom = []
    for n in node:
        #print 'label: ', n.parent.grammar.type['label']
        geom.append(n.shape.geom)
    
    node[0].grammar.type['label'] = 'leaftest'
    
    print '----'
    root = node[0].get_root()
    #print root.grammar.type['label']
    lstleaf = root.traverse_tree(lambda n: n,internal=False)
    for leaf in lstleaf:
        print leaf.grammar.type['label']
    print '----'
    
    
    node[0].grammar.type['label'] = 'revisedleaftest'
    node[1].grammar.type['label'] = 'revisedtest'
    
    lstleaf = root.traverse_tree(lambda n: n,internal=False)
    for leaf in lstleaf:
        print leaf.grammar.type['label']
    print '----'
# ---------- end g_5 ----------

# ----
list_6 = ValueList({"divide by depth": "subdivide_depth", "divide by same depth": "subdivide_depth_same", "divide by dim": "subdivide_dim"}, selected="divide by same depth")
list_7 = ValueList({"divide by depth": "subdivide_depth", "divide by same depth": "subdivide_depth_same", "divide by dim": "subdivide_dim"}, selected="divide by dim")
panel_5 = Panel("0>3:0>0")  # disabled
panel_6 = Panel("""7.5:1.5
19.5:3.0
25.5:6.0""")
panel_7 = Panel("0>6")  # disabled
list_8 = ValueList({"YZ": "NS", "XZ": "EW", "XY": "Z"}, selected="XZ")
list_9 = ValueList({"YZ": "NS", "XZ": "EW", "XY": "Z"}, selected="XZ")
# PODIUM
toggle_7 = BooleanToggle(True)

# ---- group: DIVIDE
bibil_9 = PythonScript(
    Code=file_7,
    Divide_num=Slider(2, range=0..10),
    Divide_cut=Slider(0, range=0..100),
    Divide_type=list_6,
    Divide_ratio=Slider(0.5, range=0..1),
    Axis=list_8,
    Run=Toggle(True))

# ---- group: HEIGHT
miru_2 = PythonScript(Code=file_11, Height=Slider(25, range=0..100), Randomize="-6>6", Run=Toggle(True))

# ---- group: COURTYARD
miru_3 = PythonScript(Code=file_8, Width=Slider(25, range=0..100), Court_ref="-1", Run=Toggle(True))

# ---- group: DIVIDE
bibil_10 = PythonScript(
    Code=file_7,
    Divide_num=["100", "25"],
    Divide_cut=Slider(0, range=0..100),
    Divide_type=list_7,
    Divide_ratio=Slider(0.5, range=0..1),
    Axis=list_9,
    Run=Toggle(False))

# ---- group: HEIGHT
miru_4 = PythonScript(Code=file_11, Height=Slider(7.5, range=0..100), Randomize=panel_7, Run=Toggle(True))

# ---- group: COURTYARD
miru_5 = PythonScript(Code=file_8, Width=Slider(27, range=0..100), Court_ref="-1", Run=Toggle(True))

# ---- group: TREE RULES
miru_6 = PythonScript(Code=file_13, Node=trinco_park.Node_out, Run=toggle_7)

# ----
geo_9 = Geometry(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)
geo_10 = Geometry([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])
geo_11 = Geometry(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)

# ---- group: MIDRISE
bibil_11 = PythonScript(Code=file_6, Rule_in=flatten([miru_6, miru_5, miru_4]), Node_in=flatten(geo_10), Label_="midrisetest", Run=Toggle(True))  # -> Node_out, Debug

# ----
# EXTRACT FOOTPRINTS
g_6 = PythonScript(node=bibil_11.Node_out)  # -> geom; inputs node: list
# ---------- g_6: Python ----------
node = filter(lambda n: n!=None,node)
if node and node != []:
    geom = []
    for n in node:
        geom.append(n.shape.geom)
    print geom
# ---------- end g_6 ----------
g_7 = PythonScript(node=bibil_11.Node_out)  # -> label; inputs node: list
# ---------- g_7: Python ----------
node = filter(lambda n: n!=None,node)
if node and node != []:
    label = []
    for i,n in enumerate(node):
        print i
        root = n.get_root()
        L = root.traverse_tree(lambda n:n,internal=True)
        for i in L:
            print i
            label.append(i) 
        label.append('--')
        print '---'
# ---------- end g_7 ----------

# ---- group: PACKING
bibil_12 = PythonScript(Code=file_9, Dim2keep="25.0,25.0", Dim2delete="20.0,20.0", Seperation_ref="-1", Run=Toggle(True))

# ----
number_slider_4 = Slider(0.2, range=0..1)

# ---- group: MIDRISE
bibil_13 = PythonScript(Code=file_6, Rule_in=flatten(bibil_12), Node_in=flatten(bibil_11.Node_out), Label_="towertest", Run=Toggle(True))  # -> Node_out, Debug

# ----
g_8 = PythonScript(node=bibil_13.Debug)  # -> geom; inputs node: list
# ---------- g_8: Python ----------
node = filter(lambda n: n!=None,node)
if node and node != []:
    geom = []
    for n in node:
        geom.append(n.shape.bottom_crv)
    print geom
# ---------- end g_8 ----------
g_9 = PythonScript(node=bibil_13.Node_out)  # -> geom; inputs node: list; same code as g_8
material = CreateMaterial(
    Diffuse=ColourSwatch(SwatchColor=RGB(23, 51, 197)),
    Specular=RGB(255, 255, 255),
    Emission=RGB(0, 0, 0),
    Transparency=number_slider_4,
    Shine=0)
material_2 = CreateMaterial(
    Diffuse=ColourSwatch(SwatchColor=RGB(84, 84, 84)),
    Specular=RGB(255, 255, 255),
    Emission=RGB(0, 0, 0),
    Transparency=number_slider_4,
    Shine=0)
preview_2 = CustomPreview(Geometry=g_9, Shader=material)
preview_3 = CustomPreview(Geometry=g_6, Shader=material_2)
panel_8 = Panel("0>3:0>0")  # disabled
panel_9 = Panel("""7.5:3.0
19.5:6.0
25.5:9.0""")
panel_10 = Panel("""7.5:1.5
19.5:3.0""")
geo_12 = Geometry([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])

# ---- group: SETBACK
miru_7 = PythonScript(Code=file_10, Height_stepback=panel_6, Randomize=panel_5, Stepback_ref="2", Run=Toggle(True))

# ---- group: MIDRISE
bibil_14 = PythonScript(
    Code=file_6,
    Rule_in=flatten([miru_3, bibil_9, miru_2, miru_7]),
    Node_in=flatten(geo_9),
    Label_="shape4processlab",
    Run=Toggle(True))  # -> Node_out, Debug

# ----
g_10 = PythonScript(node=bibil_14.Node_out)  # -> geom; inputs node: list; same code as g_6
g_11 = PythonScript(node=bibil_14.Node_out)  # -> label; inputs node: list
# ---------- g_11: Python ----------
node = filter(lambda n: n!=None,node)
if node and node != []:
    label = []
    if True:#for i,n in enumerate(node):
        #print i
        root = node[0].get_root()
        L = root.traverse_tree(lambda n:n,internal=True) 
        for i in L:
            print i
            label.append(i)
        #label.append('--')
        #print '---'
# ---------- end g_11 ----------
panel_11 = Panel(g_11)

# ---- group: SETBACK
miru_8 = PythonScript(Code=file_10, Height_stepback=panel_9, Randomize=panel_8, Stepback_ref=geo_12, Run=Toggle(True))

# ----
panel_12 = Panel("-6>6")  # disabled
# BUILDING TYPOLOGY
# TOWERS
panel_13 = Panel("bula")
# MIDRISE
panel_14 = Panel("""7.5:1.5
19.5:3.0
25.5:6.0""")
panel_15 = Panel("0>3:0>0")  # disabled
panel_16 = Panel("0>3:0>0")  # disabled

# ---- group: SETBACK
miru_9 = PythonScript(Code=file_10, Height_stepback=panel_10, Randomize=panel_16, Stepback_ref="2", Run=Toggle(True))

miru_10 = PythonScript(Code=file_10, Height_stepback=panel_14, Randomize=panel_15, Stepback_ref="2", Run=Toggle(True))

# ---- group: HEIGHT
miru_11 = PythonScript(Code=file_11, Height=panel_13, Randomize=panel_12, Run=Toggle(True))

miru_12 = PythonScript(Code=file_11, Height=Slider(21, range=0..100), Randomize="-6>6", Run=Toggle(True))

# ---- group: MIDRISE
bibil_15 = PythonScript(
    Code=file_6,
    Rule_in=flatten([miru_12, miru_10, miru_8]),
    Node_in=flatten(bibil_13.Debug),
    Label_="midriselots",
    Run=Toggle(True))  # -> Node_out, Debug

bibil_16 = PythonScript(
    Code=file_6,
    Rule_in=flatten([miru_11, miru_9, miru_8]),
    Node_in=flatten(bibil_13.Node_out),
    Label_="midriselots",
    Run=Toggle(True))  # -> Node_out, Debug

# ----
g_12 = PythonScript(node=bibil_15.Node_out)  # -> geom; inputs node: list; same code as g_6
g_13 = PythonScript(node=bibil_15.Node_out)  # -> label; inputs node: list; same code as g_7
g_14 = PythonScript(node=bibil_16.Node_out)  # -> geom; inputs node: list; same code as g_6
g_15 = PythonScript(node=bibil_16.Node_out)  # -> label; inputs node: list; same code as g_7
swatch_2 = ColourSwatch(SwatchColor=RGB(66, 66, 66))
material_3 = CreateMaterial(Diffuse=swatch_2, Specular=RGB(255, 255, 255), Emission=RGB(0, 0, 0), Transparency=0, Shine=0)
material_4 = CreateMaterial(Diffuse=swatch_2, Specular=RGB(255, 255, 255), Emission=RGB(0, 0, 0), Transparency=0, Shine=0)
preview_4 = CustomPreview(Geometry=g_14, Shader=material_4)
preview_5 = CustomPreview(Geometry=g_12, Shader=material_3)
panel_17 = Panel(g_15)
panel_18 = Panel(g_13)
geo_13 = Geometry(Tree({0}: [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], {1}: [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], {2}: [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], {3}: [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], {4}: [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], {5}: [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]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))
material_5 = CreateMaterial(
    Diffuse=ColourSwatch(SwatchColor=RGB(43, 43, 43)),
    Specular=RGB(255, 255, 255),
    Emission=RGB(0, 0, 0),
    Transparency=0,
    Shine=0)
preview_6 = CustomPreview(Geometry=geo_13, Shader=material_5)
panel_19 = Panel("""Midrise,Commercial
Highrise,Residential""")
geo_14 = Geometry([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])

# ---- group: SET LANDUSE
bibil_17 = PythonScript(Code=file_6, Node_in=flatten(geo_14), Label_=panel_19, Run=Toggle(True))  # -> Node_out, Debug

# ----
g_16 = PythonScript(node=bibil_17.Node_out)  # -> label; inputs node: list
# ---------- g_16: Python ----------
node = filter(lambda n: n!=None,node)
if node and node != []:
    label = []
    for i,n in enumerate(node):
        print i
        root = n.get_root()
        L = root.traverse_tree(lambda n:n,internal=True)
        for i in L:
            label.append(i) 
        print '---'
# ---------- end g_16 ----------
geo_15 = Geometry([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])
panel_20 = Panel(g_16)

# ---- group: SET PARCELS
bibil_18 = PythonScript(Code=file_6, Node_in=flatten(geo_15), Label_="Parcel", Run=Toggle(True))  # -> Node_out, Debug

# ----
path = FilePath("C:\Users\vasanthakumars\Documents\GitHub\bibil\src\reference\img_files\land-use.JPG")
# VISUALIZATION
# LAND USE ZONING
image_viewer = ImageViewer(ImagePath=path, Scale=1)

# ---- group: BUCKET_BY_SPACE
miru_13 = PythonScript(Code=file_14, Nodes2bucket=bibil_18.Node_out, Run=Toggle(True))

# ---- group: TREE RULES
miru_14 = PythonScript(Code=file_13, Node=trinco_park.Node_out, Run=Toggle(True))

# ---- group: LANDUSE
bibil_19 = PythonScript(Code=file_6, Rule_in=flatten(miru_13), Node_in=flatten(bibil_17.Node_out), Label_="landUse", Run=Toggle(True))  # -> Node_out, Debug

# ----
g_17 = PythonScript(node=bibil_19.Node_out)  # -> label; inputs node: list; same code as g_7
g_18 = PythonScript(node=bibil_19.Node_out)  # -> geom; inputs node: list
# ---------- g_18: Python ----------
node = filter(lambda n: n!=None,node)
if node and node != []:
    geom = []
    for n in node:
        #print n.get_root()
        print n
        print n.parent
        #print n.parent.parent
        #print n.parent.parent.parent
        #print n.parent.parent.parent.parent
        #print '---'
        geom.append(n.shape.bottom_crv)
    #print geom
# ---------- end g_18 ----------
panel_21 = Panel(g_17)
geo_16 = Geometry(<curve referenced from the Rhino model>)  # disabled
boundary_2 = BoundarySurfaces(Edges=geo_16)  # disabled
Z = UnitZ(Factor=1)  # disabled
g_19 = PythonScript()  # -> geom; inputs node: list; disabled
# ---------- g_19: Python ----------
node = filter(lambda n: n!=None,node)
if node and node != []:
    geom = []
    for n in node:
        print n.get_root()
        print n.parent.parent
        print n
        geom.append(n.shape.geom)
    print geom
# ---------- end g_19 ----------
g_20 = PythonScript()  # -> geom; inputs node: list; disabled; same code as g_19
move_2 = Move(Geometry=boundary_2, Motion=Z)  # -> Geometry, Transform; disabled
split = SplitBrep(Brep=g_20, Cutter=move_2.Geometry)  # disabled
geo_17 = Geometry(g_19)  # disabled
boundary_3 = BoundarySurfaces(Edges=geo_16)  # disabled
Z_2 = UnitZ(Factor=1)  # disabled
capex = CapHolesEx(Brep=split)  # -> Brep, Caps, Solid; disabled
move_3 = Move(Geometry=boundary_3, Motion=Z_2)  # -> Geometry, Transform; disabled
python_2 = PythonScript(x=flatten(capex.Brep))  # -> a; inputs x: list; disabled
# ---------- python_2: Python ----------
import rhinoscriptsyntax as rs
import Rhino as rc

L = []
for x_ in x:
    geom = rs.coercegeometry(x_)
    bbBox = geom.GetBoundingBox(rc.Geometry.Plane.WorldXY)
    maxHeights = bbBox.Max.Z
    minHeights = bbBox.Min.Z
    zdist = maxHeights - minHeights
    if zdist >= 2.:
        L.append(geom)
    
a = L
# ---------- end python_2 ----------
geo_18 = Geometry([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])  # disabled
split_2 = SplitBrep(Brep=simplify(flatten(geo_17)), Cutter=move_3.Geometry)  # disabled
capex_2 = CapHolesEx(Brep=split_2)  # -> Brep, Caps, Solid; disabled
Z_3 = UnitZ(Factor=0.25)  # disabled
python_3 = PythonScript(x=flatten(capex_2.Brep))  # -> a; inputs x: list; disabled
# ---------- python_3: Python ----------
import rhinoscriptsyntax as rs
import Rhino as rc

L = []
for x_ in x:
    geom = rs.coercegeometry(x_)
    bbBox = geom.GetBoundingBox(rc.Geometry.Plane.WorldXY)
    maxHeights = bbBox.Max.Z
    minHeights = bbBox.Min.Z
    #zdist = maxHeights - minHeights
    if minHeights >= 2.:
        L.append(geom)
    
a = L
# ---------- end python_3 ----------
toggle_8 = BooleanToggle(False)  # disabled
move_4 = Move(Geometry=python_3, Motion=Z_3)  # -> Geometry, Transform; disabled
# ARCH2ANALYSIS: ENERGY ARCHETYPE SETUP
honeybee = Honeybee_Honeybee()  # -> Vviiiiiiiiiizzz; disabled; plug-in component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
ladybug = Ladybug_Ladybug()  # -> Vviiiiiiiiiizzz; disabled; plug-in component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

# ---- group: Commercial
geo_19 = Geometry([python_2, geo_18])  # disabled

# ---- group: Residential
geo_20 = Geometry(move_4.Geometry)  # disabled

# ----
updatehoneybee = Honeybee_UpdateHoneybee(updateThisFile=toggle_8)  # -> out; disabled; plug-in component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
toggle_9 = BooleanToggle(True)  # disabled
toggle_10 = BooleanToggle(True)  # disabled
panel_22 = Panel("@3")  # disabled
capex_3 = CapHolesEx(Brep=geo_20)  # -> Brep, Caps, Solid; disabled
panel_23 = Panel("@3")  # disabled
capex_4 = CapHolesEx(Brep=geo_19)  # -> Brep, Caps, Solid; disabled
panel_24 = Panel(updatehoneybee)  # disabled
preview_7 = CustomPreview(
    Geometry=[geo_19, geo_20],
    Shader={ambient=RGB(0, 0, 0), diffuse=RGB(255, 105, 180), emission=RGB(76, 32, 54), shine=0.5, specular=RGB(255, 255, 255), transparency=0})  # disabled

# ---- group: shade4res
geo_21 = Geometry(geo_19)  # disabled

# ---- group: shade4com
geo_22 = Geometry(geo_20)  # disabled

# ----
toggle_11 = BooleanToggle(True)  # disabled
toggle_12 = BooleanToggle(True)  # disabled
panel_25 = Panel("hirise_bld")  # disabled
panel_26 = Panel("hirise_bld")  # disabled
number_slider_5 = Slider(3, range=0..10)  # disabled
number_slider_6 = Slider(3, range=0..10)  # disabled
Z_4 = UnitZ(Factor=number_slider_5)  # disabled
Z_5 = UnitZ(Factor=number_slider_6)  # disabled
toggle_13 = BooleanToggle(False)  # disabled
button = Button()  # disabled
panel_27 = Panel("C:\ArchsimResults\MultiZone")  # disabled
panel_28 = Panel("MultiZone2")  # disabled
panel_29 = Panel("C:\ArchsimResults\MultiZone")  # disabled
panel_30 = Panel("MultiZone3")  # disabled
toggle_14 = BooleanToggle(True)  # disabled
toggle_15 = BooleanToggle(True)  # disabled

panel_31 = Panel("C:\\Users\\vasanthakumars\\Documents\\GitHub\\bibil\\src\\reference\\honeybee_work\\Honeybee_SplitZone.py")  # disabled
panel_32 = Panel("C:\\saeran\\master\\git\\bibil\\src\\reference\\honeybee_work\\Honeybee_SplitZone.py")  # disabled
panel_33 = Panel("C:\\Users\\vasanthakumars\\Documents\\GitHub\\bibil\\src\\reference\\honeybee_work\\Honeybee_SplitBuildingMass.py")  # disabled
panel_34 = Panel("C:\\saeran\\master\\git\\bibil\\src\\reference\\honeybee_work\\Honeybee_SplitBuildingMass.py")  # disabled
toggle_16 = BooleanToggle(True)  # disabled
toggle_17 = BooleanToggle(True)  # disabled
list_10 = ValueList({"dir", "file"}, selected="file")  # disabled
list_11 = ValueList({"dir", "file"}, selected="file")  # disabled

# ---- group: find directory
bibil_20 = PythonScript(dir=[panel_32, panel_31], type=list_10, run=toggle_16)  # -> file; inputs dir: list; disabled; same code as bibil

bibil_21 = PythonScript(dir=[panel_34, panel_33], type=list_11, run=toggle_17)  # -> file; inputs dir: list; disabled; same code as bibil

# ----
file_15 = ReadFile(File=bibil_21, PerLineParse=False)  # disabled
file_16 = ReadFile(File=bibil_20, PerLineParse=False)  # disabled

splitmass = Honeybee_SplitBuildingMass(Code=file_15, _bldgMasses=capex_3.Brep, BldgsFlr2FloorHeights_=panel_22, _runIt=toggle_9)  # -> ReadMe, flatten(SplitBldgMasses); disabled
splitmass_2 = Honeybee_SplitBuildingMass(Code=file_15, _bldgMasses=capex_4.Brep, BldgsFlr2FloorHeights_=panel_23, _runIt=toggle_10)  # -> ReadMe, flatten(SplitBldgMasses); disabled
geo_23 = Geometry(splitmass.SplitBldgMasses)  # disabled
geo_24 = Geometry(splitmass_2.SplitBldgMasses)  # disabled
wires = BrepWireframe(Brep=geo_23, Density=-1)  # disabled
wires_2 = BrepWireframe(Brep=geo_24, Density=-1)  # disabled
preview_8 = CustomPreview(
    Geometry=wires,
    Shader={ambient=RGB(0, 0, 0), diffuse=RGB(255, 105, 180), emission=RGB(76, 32, 54), shine=0.5, specular=RGB(255, 255, 255), transparency=0})  # disabled
bibil_22 = PythonScript(Code=file_6, Node_in=flatten(splitmass.SplitBldgMasses), Label_=panel_25, Run=toggle_11)  # -> Node_out, Debug; disabled
bibil_23 = PythonScript(Code=file_6, Node_in=flatten(splitmass_2.SplitBldgMasses), Label_=panel_26, Run=toggle_12)  # -> Node_out, Debug; disabled
g_21 = PythonScript(node=bibil_22.Node_out)  # -> geom; inputs node: list; disabled
# ---------- g_21: Python ----------
import rhinoscriptsyntax as rs
node = filter(lambda n: n!=None,node)
if node and node != []:
    geom = []
    for n in node:
        geom_ = n.shape.bottom_crv
        print geom_
        geom.append(geom_)
# ---------- end g_21 ----------
g_22 = PythonScript(node=bibil_23.Node_out)  # -> geom; inputs node: list; disabled; same code as g_21
explode = Explode(Curve=g_21, Recursive=True)  # -> Segments, Vertices; disabled
explode_2 = Explode(Curve=g_22, Recursive=True)  # -> Segments, Vertices; disabled
extr = Extrude(Base=explode.Segments, Direction=Z_4)  # disabled
area = Area(Geometry=g_21)  # -> Area, Centroid; disabled
extr_2 = Extrude(Base=explode_2.Segments, Direction=Z_5)  # disabled
wires_3 = BrepWireframe(Brep=extr, Density=-1)  # disabled
edges = BrepEdges(Brep=extr)  # -> Naked, Interior, NonManifold; disabled
wires_4 = BrepWireframe(Brep=extr_2, Density=-1)  # disabled
edges_2 = BrepEdges(Brep=extr_2)  # -> Naked, Interior, NonManifold; disabled
area_2 = Area(Geometry=extr)  # -> Area, Centroid; disabled
python_4 = PythonScript(base=g_21, ptlst=area.Centroid, run=toggle_13)  # -> P, C; inputs zones: tree, zones_crv: list, base: list, ptlst: list; disabled
# ---------- python_4: Python ----------
import rhinoscriptsyntax as rs

P = []
C = []


if run:
    zonecount = 0
    for i in range(zones.BranchCount):
        zonelst = zones.Branch(i)
        offset = rs.OffsetCurve(base[i],ptlst[i],3.)[0]
        for j,zone in enumerate(zonelst):
            zonecrv = zones_crv[int(zonecount)]
            zonecount+=1
            IsCore = rs.PointInPlanarClosedCurve(ptlst[i],zonecrv)
            if IsCore:
                C.append(zone)
            else:
                P.append(zone)
        print '---'
        #L.append(offset)
# ---------- end python_4 ----------
area_3 = Area(Geometry=extr_2)  # -> Area, Centroid; disabled
python_5 = PythonScript(x=edges_2.Naked, pt=flatten(area_3.Centroid))  # -> flatten(a); inputs x: tree, pt: list; disabled
# ---------- python_5: Python ----------
import rhinoscriptsyntax as rs
L = []

for i in range(x.BranchCount):
    edgelst = x.Branch(i)
    edge = rs.JoinCurves(edgelst,delete_input=True)
    edge = rs.coercecurve(edge)
    offset = rs.OffsetCurve(edge,pt[i],1.)[0]
    offset = rs.AddPlanarSrf(offset)[0]
    L.append(offset)
    
a = L
# ---------- end python_5 ----------
python_6 = PythonScript(x=edges.Naked, pt=flatten(area_2.Centroid))  # -> a; inputs x: tree, pt: list; disabled; same code as python_5
geo_25 = Geometry(python_4.P)  # disabled
geo_26 = Geometry(python_4.C)  # disabled

# ---- group: OFFICE
panel_35 = Panel("Perimeter")  # disabled
zone = ThermalZone(
    ThermalZoneGeometry=splitmass_2.SplitBldgMasses,
    Name=panel_35,
    SettingsAsFormatedString="-NoSelection-",
    Library="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",
    Settings="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")  # -> ThermalZones, SettingsAsFormatedString; disabled
window = Window(
    WindowGeometry=python_5,
    Library="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",
    Settings="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")  # -> Window, SettingsAsFormatedString; disabled

# ----
# ENERGY SIMULATION
zone_2 = ThermalZone(
    ThermalZoneGeometry=splitmass.SplitBldgMasses,
    SettingsAsFormatedString="-NoSelection-",
    Library="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",
    Settings="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")  # -> ThermalZones, SettingsAsFormatedString; disabled
window_2 = Window(
    WindowGeometry=python_6,
    Library="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",
    Settings="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")  # -> Window, SettingsAsFormatedString; disabled

networker = ZoneConnectivityNetwork(ThermalZoneCollection=zone.ThermalZones, Windows=window.Window, ShadingGeometryCollection=geo_22)  # disabled
surfaceanalysis = SurfaceAnalysis(ThermalModel=networker)  # -> Facade, Partition, Ceiling, Roof, ExternalFloor, Floor, Window, FaceID, IDLocation; disabled
networker_2 = ZoneConnectivityNetwork(ThermalZoneCollection=zone_2.ThermalZones, Windows=window_2.Window, ShadingGeometryCollection=geo_21)  # disabled
surfaceanalysis_2 = SurfaceAnalysis(ThermalModel=networker_2)  # -> Facade, Partition, Ceiling, Roof, ExternalFloor, Floor, Window, FaceID, IDLocation; disabled
brep = Brep([surfaceanalysis.Window, surfaceanalysis.Facade, surfaceanalysis.Floor, surfaceanalysis.ExternalFloor])  # disabled
brep_2 = Brep([surfaceanalysis_2.Window, surfaceanalysis_2.Facade, surfaceanalysis_2.Floor, surfaceanalysis_2.ExternalFloor])  # disabled
run_e = TakesThermalModelAndRunsEnergyPlus(
    ThermalModel=networker_2,
    ProjectName=panel_28,
    WorkingDirectory=panel_27,
    WeatherFile="USA_NY_New.York-LaGuardia.AP.725030_TMY3",
    StartsTheSimulation=button,
    settings="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")  # -> ThermalModel, SettingsAsFormatedString; disabled
run_e_2 = TakesThermalModelAndRunsEnergyPlus(
    ThermalModel=networker,
    ProjectName=panel_30,
    WorkingDirectory=panel_29,
    WeatherFile="USA_NY_New.York-LaGuardia.AP.725030_TMY3",
    StartsTheSimulation=button,
    settings="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")  # -> ThermalModel, SettingsAsFormatedString; disabled
load_zone_results = LoadZoneResults(ThermalModel=run_e.ThermalModel, Toggle=toggle_15, settings="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")  # -> flatten(ZoneGeometry), ResultsPerZone, Labels, Guid, Name; disabled
load_zone_results_2 = LoadZoneResults(ThermalModel=run_e_2.ThermalModel, Toggle=toggle_14, settings="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")  # -> flatten(ZoneGeometry), ResultsPerZone, Labels, Guid, Name; disabled
panel_36 = Panel(load_zone_results.ResultsPerZone)  # disabled
ma = MassAddition(Input=load_zone_results_2.ResultsPerZone)  # -> flatten(Result), PartialResults; disabled
ma_2 = MassAddition(Input=load_zone_results.ResultsPerZone)  # -> flatten(Result), PartialResults; disabled
bnd = Bounds(Numbers=ma_2.Result)  # disabled
dedomain = DeconstructDomain(Domain=bnd)  # -> Start, End; disabled
bnd_2 = Bounds(Numbers=ma.Result)  # disabled
dedomain_2 = DeconstructDomain(Domain=bnd_2)  # -> Start, End; disabled
panel_37 = Panel(load_zone_results.ZoneGeometry)  # disabled
panel_38 = Panel(ma_2.Result)  # disabled
gradient = Gradient(
    LowerLimit=dedomain.End,
    UpperLimit=dedomain.Start,
    Parameter=ma_2.Result,
    stops=[0: RGB(234, 38, 0), 0.25: RGB(234, 126, 0), 0.5: RGB(254, 244, 84), 0.75: RGB(173, 203, 249), 1: RGB(75, 107, 169)])  # disabled
gradient_2 = Gradient(
    LowerLimit=dedomain_2.End,
    UpperLimit=dedomain_2.Start,
    Parameter=ma.Result,
    stops=[0: RGB(234, 38, 0), 0.25: RGB(234, 126, 0), 0.5: RGB(254, 244, 84), 0.75: RGB(173, 203, 249), 1: RGB(75, 107, 169)])  # disabled
sort = SortList(Keys=ma.Result)  # -> Keys, ValuesA; disabled
sort_2 = SortList(Keys=ma_2.Result)  # -> Keys, ValuesA; disabled
preview_9 = CustomPreview(Geometry=load_zone_results.ZoneGeometry, Shader=gradient)  # disabled
preview_10 = CustomPreview(Geometry=load_zone_results_2.ZoneGeometry, Shader=gradient_2)  # disabled
panel_39 = Panel(sort_2.Keys)  # disabled
panel_40 = Panel(sort.Keys)  # disabled
