# Grasshopper definition bibil_trial_098_Montgomery_Square.gh (Grasshopper 0.9.76)
# plug-ins: Python Interpreter, Human, DIVA Daylight, Mosquito

list = ValueList({"dir", "file"}, selected="dir")

# ---- group: find directory
bibil = PythonScript(
    dir=["C:\\Users\\vasanthakumars\\Documents\\GitHub\\bibil\\src", "C:\\saeran\\master\\git\\bibil\\src"],
    type=list,
    run=Toggle(True))  # -> dir; inputs dir: list
# ---------- bibil: Python ----------
import os

ghenv.Component.Params.Output[0].Name = "null"
ghenv.Component.Params.Output[0].NickName = "null"

if run:
    confirm_dir = None
    for d in dir:
        try:
            if type == "file":
                file_ = open(d)
                file_.close()
            else:
                print os.listdir(d)
            confirm_dir = d
            break
        except Exception as e:
            #print str(e)
            continue
    if confirm_dir != None:
        ghenv.Component.Params.Output[0].Name = type
        ghenv.Component.Params.Output[0].NickName = type
        dir = confirm_dir
        file = confirm_dir
null = None
# ---------- end bibil ----------

# ---- group: OPTION 2
geo = Geometry([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])

# ---- group: OPTION 1
geo_2 = Geometry([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])

# ---- group: tree
python_script = PythonScript(i=bibil)  # -> o
# ---------- python_script: Python ----------
import os

if i:
    o = os.path.join(str(i),"bibil\\bibil_tree.py")
# ---------- end python_script ----------
file = ReadFile(File=python_script, PerLineParse=False)
bibil_2 = PythonScript(Code=file)

# ---- group: grammar
python_script_2 = PythonScript(i=bibil)  # -> o
# ---------- python_script_2: Python ----------
import os

if i:
    o = os.path.join(str(i),"bibil\\bibil_grammar.py")
# ---------- end python_script_2 ----------
file_2 = ReadFile(File=python_script_2, PerLineParse=False)
bibil_3 = PythonScript(Code=file_2)

# ---- group: shape
python_script_3 = PythonScript(i=bibil)  # -> o
# ---------- python_script_3: Python ----------
import os

if i:
    o = os.path.join(str(i),"bibil\\bibil_shape.py")
#o = os.path.join(str(i),"research\\bibil_shape_shape_3d_2d.py")
# ---------- end python_script_3 ----------
file_3 = ReadFile(File=python_script_3, PerLineParse=False)
bibil_4 = PythonScript(Code=file_3)

# ---- group: miru
python_script_4 = PythonScript(i=bibil)  # -> o
# ---------- python_script_4: Python ----------
import os

if i:
    o = os.path.join(str(i),"miru\\miru_miru.py")
# ---------- end python_script_4 ----------
file_4 = ReadFile(File=python_script_4, PerLineParse=False)
bibil_5 = PythonScript(Code=file_4)

# ---- group: bula
python_script_5 = PythonScript(i=bibil)  # -> o
# ---------- python_script_5: Python ----------
import os

if i:
    o = os.path.join(str(i),"bula\\bula_minimal.py")
# ---------- end python_script_5 ----------
file_5 = ReadFile(File=python_script_5, PerLineParse=False)
bibil_6 = PythonScript(Code=file_5)

# ---- group: UI
python_script_6 = PythonScript(i=bibil)  # -> o
# ---------- python_script_6: Python ----------
import os

if i:
    o = os.path.join(str(i),"bibil\\bibil_UI.py")
# ---------- end python_script_6 ----------
file_6 = ReadFile(File=python_script_6, PerLineParse=False)

# ---- group: grammar_divide
python_script_7 = PythonScript(i=bibil)  # -> o
# ---------- python_script_7: Python ----------
import os

if i:
    o = os.path.join(str(i),"miru\\miru_divide.py")
# ---------- end python_script_7 ----------
file_7 = ReadFile(File=python_script_7, PerLineParse=False)

# ---- group: grammar_courtyard
python_script_8 = PythonScript(i=bibil)  # -> o
# ---------- python_script_8: Python ----------
import os

if i:
    o = os.path.join(str(i),"miru\\miru_court.py")
# ---------- end python_script_8 ----------
file_8 = ReadFile(File=python_script_8, PerLineParse=False)

# ---- group: grammar_tower
python_script_9 = PythonScript(i=bibil)  # -> o
# ---------- python_script_9: Python ----------
import os

if i:
    o = os.path.join(str(i),"miru\\miru_packing.py")
# ---------- end python_script_9 ----------
file_9 = ReadFile(File=python_script_9, PerLineParse=False)

python_script_10 = PythonScript(i=bibil)  # -> o
# ---------- python_script_10: Python ----------
import os

if i:
    o = os.path.join(str(i),"miru\\miru_stepback.py")
# ---------- end python_script_10 ----------
file_10 = ReadFile(File=python_script_10, PerLineParse=False)

# ---- group: grammar_height
python_script_11 = PythonScript(i=bibil)  # -> o
# ---------- python_script_11: Python ----------
import os

if i:
    o = os.path.join(str(i),"miru\\miru_height.py")
# ---------- end python_script_11 ----------
file_11 = ReadFile(File=python_script_11, PerLineParse=False)

# ---- group: grammar_analysis_pts
python_script_12 = PythonScript(i=bibil)  # -> o
# ---------- python_script_12: Python ----------
import os

if i:
    o = os.path.join(str(i),"miru\\miru_analysis.py")
# ---------- end python_script_12 ----------
file_12 = ReadFile(File=python_script_12, PerLineParse=False)

# ---- group: meta_tree
python_script_13 = PythonScript(i=bibil)  # -> o
# ---------- python_script_13: Python ----------
import os

if i:
    o = os.path.join(str(i),"miru\\miru_meta_tree.py")
# ---------- end python_script_13 ----------
file_13 = ReadFile(File=python_script_13, PerLineParse=False)

# ----
# Note: Change this number with caution,
# Increase bounds iterratively.
panel = Panel("0.004")  # disabled

panel_2 = Panel("Yonge and Eglinton")  # disabled
panel_3 = Panel("Redpath Avenue and Roehampton Avenue")  # disabled
location = MosquitoLocation(Location=panel_3)  # -> Address, Points, Type; disabled
item = ListItem(List=location.Points, Index=0, Wrap=True)  # disabled
toggle = BooleanToggle(True)  # disabled
toggle_2 = BooleanToggle(True)  # disabled
toggle_3 = BooleanToggle(True)  # disabled
toggle_4 = BooleanToggle(True)  # disabled
circle = CircleCNR(Center=item, Normal=Vector(0, 0, 1), Radius=panel)  # disabled
vector_maps = VectorMaps(Area=circle, AllRoads=toggle, Buildings=toggle_2, ReProject=toggle_3, CenterToWorld=toggle_4)  # -> RoadLines, RoadInfo, BuildingLines, BuildingInfo, BuildingHeights, AmenityLines, AmenityInfo, AmenityPoints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; disabled
swatch = ColourSwatch(SwatchColor=RGB(0, 0, 0))  # disabled
geo_3 = Geometry([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])  # disabled
geo_4 = Geometry([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])  # disabled
geo_5 = Geometry(Tree({0}: [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], {1}: [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], {2}: [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], {3}: [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], {4}: [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], {5}: [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]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))  # disabled
geo_6 = Geometry([vector_maps.BuildingLines, vector_maps.RoadLines, vector_maps.AmenityLines])  # disabled
preview = CustomPreview(Geometry=[geo_5, geo_4, geo_3], Shader=swatch)  # disabled

list_2 = ValueList({"divide by depth": "subdivide_depth", "divide by same depth": "subdivide_depth_same", "divide by dim": "subdivide_dim"}, selected="divide by depth")

# ---- group: cpt
vec = Vector(Vector(-545550.1884, 3982019.542, 0))

# ---- group: refYEvec
vec_2 = Vector(Vector(-545759.5384, 3981844.461, 0))

# ---- group: GEOREF
vec_3 = Vector(Vector(-546054.4782, 3981714.967, 0))

# ---- group: CPT
vec_4 = Vector(Vector(10.25901059, -146.005907, 0))

# ----
list_3 = ValueList({"YZ": "NS", "XZ": "EW", "XY": "Z"}, selected="XZ")

# ---- group: dir2cpt
subtraction = Subtraction(A=vec, B=vec_2)

# ----
toggle_5 = BooleanToggle(False)  # disabled
geo_7 = Geometry(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)

# ---- group: A=pt2move2
subtraction_2 = Subtraction(A=vec_3, B=vec_4)

# ---- group: COURTYARD
miru = PythonScript(Code=file_8, Podium_depth=Slider(21, range=0..100), Node_depth=Slider(1, range=-1..1), Run=Toggle(True))  # disabled

# ----
geo_8 = Geometry([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])
Z = UnitZ(Factor=Slider(59, range=0..100))
geo_9 = Geometry(geo_7)

# ---- group: DIVIDE
bibil_7 = PythonScript(
    Code=file_7,
    Divide_num=Slider(1, range=0..10),
    Divide_cut=Slider(10, range=0..100),
    Divide_type=list_2,
    Divide_ratio=Slider(0.5, range=0..1),
    Axis=list_3,
    Run=Toggle(False))  # disabled

# ---- group: PACKING
bibil_8 = PythonScript(Code=file_9, Run=toggle_5)  # disabled

# ----
move = Move(Motion=subtraction)  # -> Geometry, Transform
move_2 = Move(Geometry=geo_8, Motion=subtraction_2)  # -> Geometry, Transform
rad = Radians(Degrees=Slider(-45, range=-45..100))
extr = Extrude(Base=geo_9, Direction=Z)
geo_10 = Geometry(move_2.Geometry)
rotax = RotateAxis(Geometry=extr, Angle=rad, Axis=geo_9)  # -> Geometry, Transform
Z_2 = UnitZ(Factor=Slider(19.5, range=0..100))
move_3 = Move(Geometry=rotax.Geometry, Motion=Z_2)  # -> Geometry, Transform

# ---- group: DEEP_LOTS_REAR
panel_4 = Panel("""0.0:7.5
7.5:10.5
10.5:13.5
13.5:16.5
16.5:19.5""")

# ---- group: SHALLOW_LOTS_REAR
panel_5 = Panel("""0.0:7.5
10.5:10.5
13.5:13.5
16.5:16.5
19.5:19.5""")

# ----
number_slider = Slider(37.5, range=0..100)

# ---- group: FRONT STEPBACK
panel_6 = Panel("""4.5:3.0
16.5:6.0
25.5:9.0
28.5:12.0
31.5:15.0
34.5:18.0""")

# ----
panel_7 = Panel("""0.0:7.5
7.5:10.5
10.5:13.5
13.5:16.5
16.5:19.5""")
panel_8 = Panel("""0.0:7.5
10.5:10.5
13.5:13.5
16.5:16.5
19.5:19.5""")
panel_9 = Panel("""0.0:7.5
10.5:10.5
13.5:13.5
16.5:16.5
19.5:19.5""")
geo_11 = Geometry(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)
# SHALLOW
toggle_6 = BooleanToggle(False)
# DEEP
toggle_7 = BooleanToggle(True)
geo_12 = Geometry(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)
# SHALLOW
toggle_8 = BooleanToggle(True)
geo_13 = Geometry(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)

# ---- group: FRONT SETBACK
miru_2 = PythonScript(Code=file_10, Height_stepback=panel_6, Stepback_ref=geo_7, Run=Toggle(True))

# ---- group: REAR SETBACK
miru_3 = PythonScript(Code=file_10, Height_stepback=panel_7, Stepback_ref=geo_13, Run=toggle_6)

# ---- group: FRONT SETBACK
miru_4 = PythonScript(Code=file_10, Height_stepback=panel_6, Stepback_ref=geo_7, Run=Toggle(True))

# ---- group: REAR SETBACK
miru_5 = PythonScript(Code=file_10, Height_stepback=panel_8, Stepback_ref=geo_11, Run=Toggle(False))

# ---- group: HEIGHT
miru_6 = PythonScript(Code=file_11, Height=number_slider, Run=toggle_7)

miru_7 = PythonScript(Code=file_11, Height=number_slider, Run=toggle_8)

# ---- group: FRONT SETBACK
miru_8 = PythonScript(Code=file_10, Height_stepback=panel_6, Stepback_ref=geo_7, Run=Toggle(True))

# ---- group: REAR SETBACK
miru_9 = PythonScript(Code=file_10, Height_stepback=panel_9, Stepback_ref=geo_12, Run=Toggle(False))

# ---- group: HEIGHT
miru_10 = PythonScript(Code=file_11, Height=number_slider, Run=Toggle(True))

# ----
path = FilePath("C:\Users\vasanthakumars\Documents\GitHub\bibil\src\reference\CAN_ON_Toronto.716240_CWEC\CAN_ON_Toronto.716240_CWEC.epw")
geo_14 = Geometry(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)
geo_15 = Geometry(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)
geo_16 = Geometry(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)
number_slider_2 = Slider(2, range=0..10)  # disabled
number_slider_3 = Slider(0.5, range=0..1)  # disabled
number_slider_4 = Slider(10, range=0..100)  # disabled
list_4 = ValueList({"divide by depth": "subdivide_depth", "divide by same depth": "subdivide_depth_same", "divide by dim": "subdivide_dim"}, selected="divide by depth")  # disabled
importepw = Ladybug_ImportEpw(epwFile=path)  # -> readMe, latitude, location, dryBulbTemperature, dewPointTemperature, relativeHumidity, windSpeed, windDirection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; plug-in component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
ladybug = Ladybug_Ladybug()  # -> Vviiiiiiiiiizzz; plug-in component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
toggle_9 = BooleanToggle(True)  # disabled
number_slider_5 = Slider(9, range=0..10)
number_slider_6 = Slider(9, range=0..10)
number_slider_7 = Slider(21, range=0..100)

# ---- group: SHAPENODE
# volume of east office:
# 7068 m3
bibil_9 = PythonScript(Code=file_6, Rule_in=flatten([miru_6, miru_2, miru_3]), Node_in=flatten(geo_14), Run=Toggle(True))  # -> Node_out, Debug

# ----
list_5 = ValueList({"YZ": "NS", "XZ": "EW", "XY": "Z"}, selected="YZ")  # disabled

# ---- group: SHAPENODE
# volume of west office:
# 124911 m3
bibil_10 = PythonScript(Code=file_6, Rule_in=flatten([miru_7, miru_4, miru_5]), Node_in=flatten(geo_15), Run=Toggle(True))  # -> Node_out, Debug

# volume of west office:
# 124911 m3
bibil_11 = PythonScript(Code=file_6, Rule_in=flatten([miru_10, miru_8, miru_9]), Node_in=flatten(geo_16), Run=Toggle(True))  # -> Node_out, Debug

# ---- group: DIVIDE
bibil_12 = PythonScript(
    Code=file_7,
    Divide_num=number_slider_2,
    Divide_cut=number_slider_4,
    Divide_type=list_4,
    Divide_ratio=number_slider_3,
    Axis=list_5,
    Run=toggle_9)  # disabled

# ----
number_slider_8 = Slider(21, range=0..100)

# ---- group: solar input curve
geo_17 = Geometry(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)

# ----
sun_pos = SunPosition(
    Location=path,
    Month=number_slider_6,
    Day=number_slider_7,
    Hour=12,
    BooleanValue_0=False,
    BooleanValue_1=False,
    BooleanValue_2=False,
    BooleanValue_3=False,
    BooleanValue_4=False,
    BooleanValue_5=False,
    BooleanValue_6=False,
    BooleanValue_7=False,
    Color_0=RGBA(0, 0, 0, 0),
    Color_1=RGBA(0, 0, 0, 0),
    Color_2=RGBA(0, 0, 0, 0),
    Color_3=RGBA(0, 0, 0, 0),
    Color_4=RGBA(0, 0, 0, 0),
    Color_5=RGBA(0, 0, 0, 0),
    Color_6=RGBA(0, 0, 0, 0),
    Color_7=RGBA(0, 0, 0, 0),
    Hidden_0=False,
    Hidden_1=True,
    Hidden_2=True,
    Hidden_3=True,
    Hidden_4=True,
    Hidden_5=False,
    Hidden_6=False,
    Hidden_7=False,
    IntegerValue_0=-2147483648,
    IntegerValue_1=-2147483648,
    IntegerValue_2=-2147483648,
    IntegerValue_3=-2147483648,
    IntegerValue_4=-2147483648,
    IntegerValue_5=9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)  # -> SolarVector, Azimuth, Altitude
sun_pos_2 = SunPosition(
    Location=path,
    Month=number_slider_6,
    Day=number_slider_7,
    Hour=12,
    BooleanValue_0=False,
    BooleanValue_1=False,
    BooleanValue_2=False,
    BooleanValue_3=False,
    BooleanValue_4=False,
    BooleanValue_5=False,
    BooleanValue_6=False,
    BooleanValue_7=False,
    Color_0=RGBA(0, 0, 0, 0),
    Color_1=RGBA(0, 0, 0, 0),
    Color_2=RGBA(0, 0, 0, 0),
    Color_3=RGBA(0, 0, 0, 0),
    Color_4=RGBA(0, 0, 0, 0),
    Color_5=RGBA(0, 0, 0, 0),
    Color_6=RGBA(0, 0, 0, 0),
    Color_7=RGBA(0, 0, 0, 0),
    Hidden_0=False,
    Hidden_1=True,
    Hidden_2=True,
    Hidden_3=True,
    Hidden_4=True,
    Hidden_5=False,
    Hidden_6=False,
    Hidden_7=False,
    IntegerValue_0=-2147483648,
    IntegerValue_1=-2147483648,
    IntegerValue_2=-2147483648,
    IntegerValue_3=-2147483648,
    IntegerValue_4=-2147483648,
    IntegerValue_5=9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)  # -> SolarVector, Azimuth, Altitude
multiplication = Multiplication(A=[sun_pos.SolarVector, sun_pos_2.SolarVector], B=Slider(300, range=0..1000))
pt = Point(multiplication)
pt_2 = Point([Point(-17.89049319, 160.9898411, 0), Point(-39.04381231, 157.7749922, 0), Point(12.64935323, -173.781392, 0), Point(33.26248411, -169.6865549, 0)])
ln = Line(StartPoint=pt_2, EndPoint=multiplication)

g = PythonScript(node=bibil_9.Node_out)  # -> geom; inputs node: list
# ---------- g: Python ----------
node = filter(lambda n: n!=None,node)
if node and node != []:
    geom = []
    for n in node:
        if n.shape.z_dist < 1.2:
            geom.append(n.shape.bottom_crv)
        else:
            geom.append(n.shape.geom)
    print geom
# ---------- end g ----------
g_2 = PythonScript(node=bibil_10.Node_out)  # -> geom; inputs node: list; same code as g
toggle_10 = BooleanToggle(True)  # disabled
panel_10 = Panel("roottest")  # disabled

# ---- group: solar input curve
geo_18 = Geometry(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)

# ----
g_3 = PythonScript(node=bibil_11.Node_out)  # -> geom; inputs node: list; same code as g
geo_19 = Geometry(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)  # disabled
analysisperiod = Ladybug_AnalysisPeriod(
    fromMonth=number_slider_6,
    fromDay=number_slider_7,
    fromHour=Slider(10.25, range=0..100),
    toMonth=number_slider_6,
    toDay=number_slider_7,
    toHour=Slider(11.25, range=0..100))  # -> readMe, analysisPeriod; plug-in component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
analysisperiod_2 = Ladybug_AnalysisPeriod(
    fromMonth=number_slider_5,
    fromDay=number_slider_8,
    fromHour=Slider(11.25, range=0..100),
    toMonth=number_slider_5,
    toDay=number_slider_8,
    toHour=Slider(13.25, range=0..100))  # -> readMe, analysisPeriod; plug-in component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
trinco_park = PythonScript(Code=file_6, Rule_in=bibil_12, Node_in=geo_19, Label_=panel_10, Run=toggle_10)  # -> Node_out, Debug; disabled
solarfanbasic = Ladybug_SolarFanBasic(
    boundary=geo_18,
    location=importepw.location,
    requiredHours=Slider(1, range=0..10),
    height=Slider(225, range=0..1000),
    analysisPeriod=analysisperiod.analysisPeriod)  # -> readMe, solarFan; plug-in component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
solarfanbasic_2 = Ladybug_SolarFanBasic(
    boundary=geo_17,
    location=importepw.location,
    requiredHours=Slider(1, range=0..10),
    height=Slider(175, range=0..1000),
    analysisPeriod=analysisperiod_2.analysisPeriod)  # -> readMe, solarFan; plug-in component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
g_4 = PythonScript(node=trinco_park.Node_out)  # -> geom; inputs node: list; disabled
# ---------- g_4: Python ----------
if node and node != []:
    geom = []
    for n in node:
        #lot_lst = n.traverse_tree(lambda n:n.shape.geom,internal=False)
        geom.append(n.shape.geom)#lot_lst)
    print geom
# ---------- end g_4 ----------

# ---- group: root test
g_5 = PythonScript(node=trinco_park.Node_out)  # -> geom; inputs node: list; disabled
# ---------- g_5: Python ----------
if node and node != []:
    geom = []
    for n in node:
        #print 'label: ', n.parent.grammar.type['label']
        geom.append(n.shape.geom)
    
    node[0].grammar.type['label'] = 'leaftest'
    
    print '----'
    root = node[0].get_root()
    #print root.grammar.type['label']
    lstleaf = root.traverse_tree(lambda n: n,internal=False)
    for leaf in lstleaf:
        print leaf.grammar.type['label']
    print '----'
    
    
    node[0].grammar.type['label'] = 'revisedleaftest'
    node[1].grammar.type['label'] = 'revisedtest'
    
    lstleaf = root.traverse_tree(lambda n: n,internal=False)
    for leaf in lstleaf:
        print leaf.grammar.type['label']
    print '----'
# ---------- end g_5 ----------

# ----
panel_11 = Panel(solarfanbasic.readMe)
# TOWER
number_slider_9 = Slider(25.5, range=0..100)
number_slider_10 = Slider(61.5, range=0..100)
# TOWER
number_slider_11 = Slider(16.4, range=0..100)
number_slider_12 = Slider(61.5, range=0..100)
geo_20 = Geometry(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)
# TOWER
number_slider_13 = Slider(34.5, range=0..100)
number_slider_14 = Slider(61.5, range=0..100)
geo_21 = Geometry([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])
geo_22 = Geometry(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)

# ---- group: plane_angle
number_slider_15 = Slider(-45, range=-100..100)  # disabled

# ----
geo_23 = Geometry(solarfanbasic.solarFan)
geo_24 = Geometry(solarfanbasic_2.solarFan)
offset = Offset(Curve=geo_20, Distance=Slider(25, range=0..100), Plane=PlaneXY(0, 0, 0), Corners=Slider(3, range=0..10))
offset_2 = Offset(Curve=geo_21, Distance=Slider(25, range=0..100), Plane=PlaneXY(0, 0, 0), Corners=Slider(3, range=0..10))

# ---- group: HEIGHT
miru_11 = PythonScript(Code=file_11, Height=number_slider_9, Run=Toggle(True))

miru_12 = PythonScript(Code=file_11, Height=number_slider_11, Run=Toggle(True))

# ---- group: PLANE 1
geo_25 = Geometry(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)  # disabled

# ---- group: PLANE 2
geo_26 = Geometry(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)  # disabled

# ----
offset_3 = Offset(Curve=geo_22, Distance=Slider(25, range=0..100), Plane=PlaneXY(0, 0, 0), Corners=Slider(3, range=0..10))

# ---- group: HEIGHT
miru_13 = PythonScript(Code=file_11, Height=number_slider_13, Run=Toggle(True))

# ---- group: FRONT STEPBACK
panel_14 = Panel("""7.5:3.0
22.5:6.0
25.5:9.0
28.5:12.0
31.5:15.0
34.5:18.0""")

# ----
panel_15 = Panel("""0.0:7.5
7.5:10.5
10.5:13.5
13.5:16.5
16.5:19.5
19.5:22.5
22.5:25.5""")
geo_27 = Geometry(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)

# ---- group: SITE BOUNDARY
geo_28 = Geometry(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)  # disabled

# ----
panel_16 = Panel("""0.0:7.5
7.5:10.5
10.5:13.5
13.5:16.5
16.5:19.5
19.5:22.5
22.5:25.5
25.5:28.5
28.5:31.5
31.5:34.5
34.5:37.5""")
panel_17 = Panel("""0.0:7.5
10.5:10.5
13.5:13.5
16.5:16.5
19.5:19.5
22.5:22.5
25.5:25.5""")
bibil_13 = PythonScript(Code=file_6, Rule_in=flatten(miru_11), Node_in=flatten(geo_20), Run=Toggle(False))  # -> Node_out, Debug
bibil_14 = PythonScript(Code=file_6, Rule_in=flatten(miru_12), Node_in=flatten(geo_21), Run=Toggle(False))  # -> Node_out, Debug
bibil_15 = PythonScript(Code=file_6, Rule_in=flatten(miru_13), Node_in=flatten(geo_22), Run=Toggle(False))  # -> Node_out, Debug
boundary = BoundarySurfaces(Edges=geo_28)  # disabled
panel_18 = Panel("5")  # disabled
panel_19 = Panel("1")  # disabled
geo_29 = Geometry(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)  # disabled
rad_2 = Radians(Degrees=number_slider_15)  # disabled
geo_30 = Geometry(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)  # disabled
rad_3 = Radians(Degrees=number_slider_15)  # disabled
g_6 = PythonScript(node=bibil_13.Node_out)  # -> geom; inputs node: list; same code as g
gentestpts = Honeybee_GenerateTestPoints(testGeometry=boundary, gridSize=panel_18, distBaseSrf=panel_19, moveTestMesh=True)  # -> readMe, simplify(testPoints), simplify(ptsVectors), simplify(facesArea), simplify(mesh); disabled; plug-in component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
g_7 = PythonScript(node=bibil_14.Node_out)  # -> geom; inputs node: list; same code as g

# ---- group: SOLAR
geo_31 = Geometry([geo_23, geo_24])

# ----
g_8 = PythonScript(node=bibil_15.Node_out)  # -> geom; inputs node: list; same code as g
rotax_2 = RotateAxis(Geometry=geo_25, Angle=rad_2, Axis=geo_29)  # -> Geometry, Transform; disabled
rotax_3 = RotateAxis(Geometry=geo_30, Angle=rad_3, Axis=geo_26)  # -> Geometry, Transform; disabled
geo_32 = Geometry(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)
# DEEP
number_slider_16 = Slider(34.5, range=0..100)
# DEEP
toggle_11 = BooleanToggle(True)
Z_3 = UnitZ(Factor=Slider(59, range=0..100))
geo_33 = Geometry(geo_27)
Z_4 = UnitZ(Factor=Slider(73, range=0..100))
geo_34 = Geometry(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)
geo_35 = Geometry([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])
geo_36 = Geometry(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)
toggle_12 = BooleanToggle(True)  # disabled
wires = BrepWireframe(Brep=geo_31, Density=-1)
rad_4 = Radians(Degrees=Slider(-45, range=-45..100))
extr_2 = Extrude(Base=geo_33, Direction=Z_3)
# SHALLOW
number_slider_17 = Slider(19.5, range=0..100)
number_slider_18 = Slider(0.8, range=0..1)  # disabled
rad_5 = Radians(Degrees=Slider(-45, range=-45..100))
extr_3 = Extrude(Base=geo_35, Direction=Z_4)
geo_37 = Geometry([rotax_2.Geometry, rotax_3.Geometry])  # disabled

# ---- group: FRONT SETBACK
miru_14 = PythonScript(Code=file_10, Height_stepback=panel_14, Stepback_ref=geo_27, Run=Toggle(True))

# ---- group: REAR SETBACK
miru_15 = PythonScript(Code=file_10, Height_stepback=panel_16, Stepback_ref=geo_34, Run=toggle_11)

# ---- group: FRONT SETBACK
miru_16 = PythonScript(Code=file_10, Height_stepback=panel_14, Stepback_ref=geo_27, Run=Toggle(True))

# ---- group: REAR SETBACK
miru_17 = PythonScript(Code=file_10, Height_stepback=panel_15, Stepback_ref=geo_36, Run=Toggle(True))

# ----
preview_2 = CustomPreview(
    Geometry=wires,
    Shader={ambient=RGB(0, 0, 0), diffuse=RGB(255, 105, 180), emission=RGB(76, 32, 54), shine=0.5, specular=RGB(255, 255, 255), transparency=0})

# ---- group: FRONT SETBACK
miru_18 = PythonScript(Code=file_10, Height_stepback=panel_14, Stepback_ref=geo_27, Run=Toggle(True))

# ---- group: REAR SETBACK
miru_19 = PythonScript(Code=file_10, Height_stepback=panel_17, Stepback_ref=geo_32, Run=Toggle(False))

# ---- group: HEIGHT
miru_20 = PythonScript(Code=file_11, Height=number_slider_16, Run=Toggle(True))

# ----
python = PythonScript(pts=gentestpts.testPoints, brep=[rotax_2.Geometry, rotax_3.Geometry, geo_31], run=toggle_12)  # -> flatten(project); inputs pts: list; disabled
# ---------- python: Python ----------
import rhinoscriptsyntax as rs
import Rhino as rc
import scriptcontext as sc

if run:
    debug = []
    dir = rc.Geometry.Vector3d(0,0,1) 
    tol = sc.doc.ModelAbsoluteTolerance
    env = [rs.coercebrep(brep)]
    ptlst = map(lambda p: rs.coerce3dpoint(p),pts)
    
    projlst = rc.Geometry.Intersect.Intersection.ProjectPointsToBreps(env,ptlst,dir,tol)
    #print projlst
    #projlst = filter(lambda pt:abs(pt[2]-200.)>0.5,projlst)
    projlst = filter(lambda p: abs(p[2]-0)>1.,projlst)
    
    if projlst:
        debug.extend(projlst)
        #min_index = projlst.index(min(projlst,key=lambda p:p[2]))
        #min_pt = projlst[min_index]
        #envht = min_pt[2]
    project = debug
# ---------- end python ----------

# ---- group: HEIGHT
miru_21 = PythonScript(Code=file_11, Height=Slider(22.5, range=0..100), Run=Toggle(True))

# ----
wires_2 = BrepWireframe(Brep=[rotax_2.Geometry, rotax_3.Geometry], Density=-1)  # disabled

# ---- group: HEIGHT
miru_22 = PythonScript(Code=file_11, Height=Slider(37.5, range=0..100), Run=Toggle(True))

# ----
swatch_2 = ColourSwatch(SwatchColor=RGB(114, 145, 107))  # disabled
rotax_4 = RotateAxis(Geometry=extr_2, Angle=rad_4, Axis=geo_33)  # -> Geometry, Transform
rotax_5 = RotateAxis(Geometry=extr_3, Angle=rad_5, Axis=geo_35)  # -> Geometry, Transform
Z_5 = UnitZ(Factor=number_slider_17)
Z_6 = UnitZ(Factor=Slider(0, range=0..100))
material = CreateMaterial(Diffuse=swatch_2, Specular=RGB(255, 255, 255), Emission=RGB(0, 0, 0), Transparency=number_slider_18, Shine=0)  # disabled
devec = DeconstructVector(Vector=flatten(python))  # -> XComponent, YComponent, ZComponent; disabled
number_slider_19 = Slider(1, range=0..10)  # disabled
geo_38 = Geometry(python)  # disabled
geo_39 = Geometry(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)
geo_40 = Geometry(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)
move_4 = Move(Geometry=rotax_4.Geometry, Motion=Z_5)  # -> Geometry, Transform
preview_3 = CustomPreview(Geometry=[geo_31, rotax_3.Geometry, rotax_2.Geometry], Shader=material)  # disabled
move_5 = Move(Geometry=rotax_5.Geometry, Motion=Z_6)  # -> Geometry, Transform
geo_41 = Geometry(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)
dots = DotDisplay(Point=geo_38, Colour=RGB(0, 0, 0), Size=number_slider_19)  # disabled
toggle_13 = BooleanToggle(False)  # disabled

# ---- group: SHAPENODE
# volume of west office:
# 124911 m3
bibil_16 = PythonScript(Code=file_6, Rule_in=flatten([miru_22, miru_18, miru_19]), Node_in=flatten(geo_40), Run=Toggle(True))  # -> Node_out, Debug

# volume of east office:
# 7068 m3
bibil_17 = PythonScript(Code=file_6, Rule_in=flatten([miru_20, miru_14, miru_15]), Node_in=flatten(geo_39), Run=Toggle(True))  # -> Node_out, Debug

# volume of east office:
# 7068 m3
bibil_18 = PythonScript(Code=file_6, Rule_in=flatten([miru_21, miru_16, miru_17]), Node_in=flatten(geo_41), Run=Toggle(True))  # -> Node_out, Debug

# ----
bula = PythonScript(Code=file_12, Analysis_ref=python, Value_ref=devec.ZComponent, Run=toggle_13)  # disabled
g_9 = PythonScript(node=bibil_16.Node_out)  # -> geom; inputs node: list; same code as g
g_10 = PythonScript(node=bibil_17.Node_out)  # -> geom; inputs node: list; same code as g
g_11 = PythonScript(node=bibil_18.Node_out)  # -> geom; inputs node: list; same code as g
panel_20 = Panel("pedestrianBulaRef")  # disabled
toggle_14 = BooleanToggle(True)  # disabled
trinco_park_2 = PythonScript(Code=file_6, Rule_in=flatten(bula), Node_in=flatten(boundary), Label_=panel_20, Run=toggle_14)  # -> Node_out, Debug; disabled
g_12 = PythonScript(node=trinco_park_2.Node_out)  # -> geom; inputs node: list; disabled
# ---------- g_12: Python ----------
if node and node != []:
    geom = []
    #lot_lst = node.traverse_tree(lambda n:n,internal=False)
    for n in node:
        #print n.grammar.type.has_key('bula')
        print n
        print n.parent
        #print n.grammar.type['bula']
        geom.append(n.shape.bottom_crv)
    #print geom
# ---------- end g_12 ----------
g_13 = PythonScript(node=trinco_park_2.Node_out)  # -> data; inputs node: list; disabled
# ---------- g_13: Python ----------
if node and node != []:
    L = []
    #lot_lst = node.traverse_tree(lambda n:n,internal=False)
    #n = node[0].get_root()
    for n in node:
        print n.grammar.type['label']
        if n.grammar.type['bula']:
            for a,v in zip(n.grammar.type['bula_data'].value_actual, n.grammar.type['bula_data'].value_lst):
                pass
                #print a
                #print v
                #print ''
            print '--'
            L.extend(n.grammar.type['bula_data'].value_actual)
    for i in L:
        print i
    data = map(lambda d: str(round(d,2))+'%',L)
   
    #print data
# ---------- end g_13 ----------
g_14 = PythonScript(node=trinco_park_2.Node_out)  # -> bula; inputs node: list; disabled
# ---------- g_14: Python ----------
if node and node != []:
    geom = []
    #lot_lst = node.traverse_tree(lambda n:n,internal=False)
    #n = node[0].get_root()
    for n in node:
        
        print n.grammar.type['label']
        print n.grammar.type['bula']
        if n.grammar.type['bula'] == True:
            geom.extend(n.grammar.type['bula_data'].bpt_viz_lst)
    bula = geom
# ---------- end g_14 ----------
tag = TextTag(Location=g_14, Text=g_13)  # disabled

# ---- group: EXISTING TOWERS
geo_42 = Geometry([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])

bibil_19 = PythonScript(Code=file_6, Node_in=flatten(geo_42), Run=Toggle(True))  # -> Node_out, Debug

# ----
g_15 = PythonScript(node=bibil_19.Node_out)  # -> label; inputs node: list
# ---------- g_15: Python ----------
node = filter(lambda n: n!=None,node)
if node and node != []:
    label = []
    for i,n in enumerate(node):
        print i
        root = n.get_root()
        L = root.traverse_tree(lambda n:n,internal=True)
        for i in L:
            print i
            label.append(i) 
        label.append('--')
        print '---'
# ---------- end g_15 ----------
g_16 = PythonScript(node=bibil_19.Node_out)  # -> geom; inputs node: list
# ---------- g_16: Python ----------
import rhinoscriptsyntax as rs
import scriptcontext as sc
node = filter(lambda n: n!=None,node)
if node and node != []:
    geom = []
    for n in node:
        #print n.get_root()
        #print n.parent
        crv = n.shape.bottom_crv
        if n.shape.cpt[2] > 0.0:
            crv = sc.doc.Objects.AddCurve(crv)
            crv = rs.MoveObject(crv,[0,0,n.shape.cpt[2]*-1])
        geom.append(crv)
        
    #print geom
# ---------- end g_16 ----------

# ---- group: TOWER SEP
panel_21 = Panel("25")

# ----
panel_22 = Panel(g_15)
offset_4 = Offset(Curve=g_16, Distance=panel_21, Plane=PlaneXY(0, 0, 0), Corners="2")
boundary_2 = BoundarySurfaces(Edges=offset_4)
material_2 = CreateMaterial(
    Diffuse=RGB(255, 105, 180),
    Specular=RGB(255, 255, 255),
    Emission=RGB(0, 0, 0),
    Transparency=Slider(0.8, range=0..1),
    Shine=0)
preview_4 = CustomPreview(Geometry=boundary_2, Shader=material_2)
# 4VIZ
previewlw = CustomPreviewLineweights(
    Geometry=offset_4,
    Shader={ambient=RGB(0, 0, 0), diffuse=RGB(255, 105, 180), emission=RGB(76, 32, 54), shine=0.5, specular=RGB(255, 255, 255), transparency=0},
    Thickness=Slider(5, range=0..10),
    Absolute=False)
