# Grasshopper definition bibil_trial_099_Davisville_Station.gh (Grasshopper 0.9.76)
# plug-ins: Python Interpreter, Human

list = ValueList({"dir", "file"}, selected="dir")

# ---- group: find directory
bibil = PythonScript(
    dir=["C:\\Users\\vasanthakumars\\Documents\\GitHub\\bibil\\src", "C:\\saeran\\master\\git\\bibil\\src"],
    type=list,
    run=Toggle(True))  # -> dir; inputs dir: list
# ---------- bibil: Python ----------
import os

ghenv.Component.Params.Output[0].Name = "null"
ghenv.Component.Params.Output[0].NickName = "null"

if run:
    confirm_dir = None
    for d in dir:
        try:
            if type == "file":
                file_ = open(d)
                file_.close()
            else:
                print os.listdir(d)
            confirm_dir = d
            break
        except Exception as e:
            #print str(e)
            continue
    if confirm_dir != None:
        ghenv.Component.Params.Output[0].Name = type
        ghenv.Component.Params.Output[0].NickName = type
        dir = confirm_dir
        file = confirm_dir
null = None
# ---------- end bibil ----------

# ---- group: tree
python_script = PythonScript(i=bibil)  # -> o
# ---------- python_script: Python ----------
import os

if i:
    o = os.path.join(str(i),"bibil\\bibil_tree.py")
# ---------- end python_script ----------
file = ReadFile(File=python_script, PerLineParse=False)
bibil_2 = PythonScript(Code=file)

# ---- group: grammar
python_script_2 = PythonScript(i=bibil)  # -> o
# ---------- python_script_2: Python ----------
import os

if i:
    o = os.path.join(str(i),"bibil\\bibil_grammar.py")
# ---------- end python_script_2 ----------
file_2 = ReadFile(File=python_script_2, PerLineParse=False)
bibil_3 = PythonScript(Code=file_2)

# ---- group: shape
python_script_3 = PythonScript(i=bibil)  # -> o
# ---------- python_script_3: Python ----------
import os

if i:
    o = os.path.join(str(i),"bibil\\bibil_shape.py")
#o = os.path.join(str(i),"research\\bibil_shape_shape_3d_2d.py")
# ---------- end python_script_3 ----------
file_3 = ReadFile(File=python_script_3, PerLineParse=False)
bibil_4 = PythonScript(Code=file_3)

# ---- group: miru
python_script_4 = PythonScript(i=bibil)  # -> o
# ---------- python_script_4: Python ----------
import os

if i:
    o = os.path.join(str(i),"miru\\miru_miru.py")
# ---------- end python_script_4 ----------
file_4 = ReadFile(File=python_script_4, PerLineParse=False)
bibil_5 = PythonScript(Code=file_4)

# ---- group: bula
python_script_5 = PythonScript(i=bibil)  # -> o
# ---------- python_script_5: Python ----------
import os

if i:
    o = os.path.join(str(i),"bula\\bula_minimal.py")
# ---------- end python_script_5 ----------
file_5 = ReadFile(File=python_script_5, PerLineParse=False)
bibil_6 = PythonScript(Code=file_5)

# ---- group: UI
python_script_6 = PythonScript(i=bibil)  # -> o
# ---------- python_script_6: Python ----------
import os

if i:
    o = os.path.join(str(i),"bibil\\bibil_UI.py")
# ---------- end python_script_6 ----------
file_6 = ReadFile(File=python_script_6, PerLineParse=False)

# ---- group: grammar_divide
python_script_7 = PythonScript(i=bibil)  # -> o
# ---------- python_script_7: Python ----------
import os

if i:
    o = os.path.join(str(i),"miru\\miru_divide.py")
# ---------- end python_script_7 ----------
file_7 = ReadFile(File=python_script_7, PerLineParse=False)

# ---- group: grammar_courtyard
python_script_8 = PythonScript(i=bibil)  # -> o
# ---------- python_script_8: Python ----------
import os

if i:
    o = os.path.join(str(i),"miru\\miru_court.py")
# ---------- end python_script_8 ----------
file_8 = ReadFile(File=python_script_8, PerLineParse=False)

# ---- group: grammar_tower
python_script_9 = PythonScript(i=bibil)  # -> o
# ---------- python_script_9: Python ----------
import os

if i:
    o = os.path.join(str(i),"miru\\miru_packing.py")
# ---------- end python_script_9 ----------
file_9 = ReadFile(File=python_script_9, PerLineParse=False)

python_script_10 = PythonScript(i=bibil)  # -> o
# ---------- python_script_10: Python ----------
import os

if i:
    o = os.path.join(str(i),"miru\\miru_stepback.py")
# ---------- end python_script_10 ----------
file_10 = ReadFile(File=python_script_10, PerLineParse=False)

# ---- group: grammar_height
python_script_11 = PythonScript(i=bibil)  # -> o
# ---------- python_script_11: Python ----------
import os

if i:
    o = os.path.join(str(i),"miru\\miru_height.py")
# ---------- end python_script_11 ----------
file_11 = ReadFile(File=python_script_11, PerLineParse=False)

# ---- group: grammar_analysis_pts
python_script_12 = PythonScript(i=bibil)  # -> o
# ---------- python_script_12: Python ----------
import os

if i:
    o = os.path.join(str(i),"miru\\miru_analysis.py")
# ---------- end python_script_12 ----------
file_12 = ReadFile(File=python_script_12, PerLineParse=False)

# ---- group: meta_tree
python_script_13 = PythonScript(i=bibil)  # -> o
# ---------- python_script_13: Python ----------
import os

if i:
    o = os.path.join(str(i),"miru\\miru_meta_tree.py")
# ---------- end python_script_13 ----------
file_13 = ReadFile(File=python_script_13, PerLineParse=False)

# ---- group: land_use
python_script_14 = PythonScript(i=bibil)  # -> o
# ---------- python_script_14: Python ----------
import os

if i:
    o = os.path.join(str(i),"miru\\miru_landuse.py")
# ---------- end python_script_14 ----------
file_14 = ReadFile(File=python_script_14, PerLineParse=False)

# ---- group: shape2height
python_script_15 = PythonScript(i=bibil)  # -> o
# ---------- python_script_15: Python ----------
import os

if i:
    o = os.path.join(str(i),"miru\\miru_shape2height.py")
# ---------- end python_script_15 ----------
file_15 = ReadFile(File=python_script_15, PerLineParse=False)

# ---- group: extract_slice
python_script_16 = PythonScript(i=bibil)  # -> o
# ---------- python_script_16: Python ----------
import os

if i:
    o = os.path.join(str(i),"miru\\miru_extract_slice.py")
# ---------- end python_script_16 ----------
file_16 = ReadFile(File=python_script_16, PerLineParse=False)

# ----
list_2 = ValueList({"divide by depth": "subdivide_depth", "divide by same depth": "subdivide_depth_same", "divide by dim": "subdivide_dim"}, selected="divide by same depth")

# ---- group: GEOREF
# Note: Change this number with caution,
vec = Vector(Vector(-545901.6391, 3981870.516, 0))  # disabled

# ---- group: CPT
# Increase bounds iterratively.
vec_2 = Vector(Vector(0, 3981920.861, 0))  # disabled

# ----
list_3 = ValueList({"YZ": "NS", "XZ": "EW", "XY": "Z"}, selected="XZ")

# ---- group: A=pt2move2
subtraction = Subtraction(A=vec, B=vec_2)  # disabled

# ---- group: PACKING
separatedata = Ladybug_SeparateData(Code=file_9, X_keep_omit="27.0,25.0", Y_keep_omit="27.0,25.0", Seperation_ref="-1", Run=Toggle(True))

# ---- group: HEIGHT
miru = PythonScript(Code=file_11, Height=Slider(16.5, range=0..100), Run=Toggle(True))

# ---- group: EXTRACT_SLICE
miru_2 = PythonScript(Code=file_16, Run=Toggle(False))

# ---- group: DIVIDE
miru_3 = PythonScript(
    Code=file_7,
    Divide_num=Slider(2, range=0..10),
    Divide_cut=Slider(0, range=0..100),
    Divide_type=list_2,
    Divide_ratio=Slider(0.5, range=0..1),
    Axis=list_3,
    Run=Toggle(False))

# ---- group: PERIMETER
miru_4 = PythonScript(Code=file_8, Width=Slider(20, range=0..100), Cut_width=Slider(0, range=0..100), Court_ref="0", Run=Toggle(False))

# ---- group: TREE RULES
miru_5 = PythonScript(Code=file_13, Run=Toggle(False))

# ---- group: SHAPE2HEIGHT
miru_6 = PythonScript(Code=file_15, Run=Toggle(False))

# ----
geo = Geometry([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])  # disabled
move = Move(Geometry=geo, Motion=subtraction)  # -> Geometry, Transform; disabled
geo_2 = Geometry(move.Geometry)  # disabled
panel = Panel("""7.5:3.0
13.5:9.0""")
geo_3 = Geometry([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])
panel_2 = Panel("""0.0:7.5
7.5:15.0
13.5:18.0""")
panel_3 = Panel("""7.5:3.0
16.5:6.0
19.5:9.0
21.5:12.0""")
panel_4 = Panel("""0.0:7.5
7.5:15.0
13.5:18.0""")
geo_4 = Geometry([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])
geo_5 = Geometry(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)

# ---- group: FRONT SETBACK
miru_7 = PythonScript(Code=file_10, Height_stepback=panel, Stepback_ref=geo_3, Run=Toggle(True))

# ---- group: REAR SETBACK
miru_8 = PythonScript(Code=file_10, Height_stepback=panel_2, Stepback_ref=geo_4, Run=Toggle(True))

# ---- group: FRONT SETBACK
miru_9 = PythonScript(Code=file_10, Height_stepback=panel_3, Stepback_ref=geo_3, Run=Toggle(True))

# ---- group: REAR SETBACK
miru_10 = PythonScript(Code=file_10, Height_stepback=panel_4, Stepback_ref=geo_4, Run=Toggle(False))

# ---- group: HEIGHT
miru_11 = PythonScript(Code=file_11, Height=Slider(16.5, range=0..100), Run=Toggle(True))

miru_12 = PythonScript(Code=file_11, Height=Slider(25.5, range=0..100), Run=Toggle(True))

# ----
number_slider = Slider(-45, range=-45..100)
geo_6 = Geometry(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)
geo_7 = Geometry(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)
Z = UnitZ(Factor=Slider(40, range=0..100))
geo_8 = Geometry(geo_5)
Z_2 = UnitZ(Factor=Slider(40, range=0..100))
Z_3 = UnitZ(Factor=Slider(80, range=0..100))
geo_9 = Geometry(geo_3)
geo_10 = Geometry(geo_4)
rad = Radians(Degrees=number_slider)
extr = Extrude(Base=geo_9, Direction=Z_2)
rad_2 = Radians(Degrees=Slider(-45, range=-45..100))
rad_3 = Radians(Degrees=number_slider)
extr_2 = Extrude(Base=geo_8, Direction=Z)
previewlw = CustomPreviewLineweights(Geometry=geo_4, Shader=ColourSwatch(SwatchColor=RGB(255, 0, 255)), Thickness=Slider(5, range=0..10), Absolute=False)
extr_3 = Extrude(Base=geo_10, Direction=Z_3)
rotax = RotateAxis(Geometry=extr_2, Angle=rad, Axis=geo_8)  # -> Geometry, Transform
rotax_2 = RotateAxis(Geometry=extr, Angle=rad_2, Axis=geo_9)  # -> Geometry, Transform
rotax_3 = RotateAxis(Geometry=extr_3, Angle=rad_3, Axis=geo_10)  # -> Geometry, Transform
Z_4 = UnitZ(Factor=Slider(0, range=0..100))
Z_5 = UnitZ(Factor=Slider(12.8, range=0..100))
Z_6 = UnitZ(Factor=Slider(0, range=0..100))

# ---- group: SHAPENODE
# volume of east office:
# 7068 m3
bibil_7 = PythonScript(Code=file_6, Rule_in=flatten([miru_11, miru_7, miru_8]), Node_in=flatten(geo_6), Run=Toggle(True))  # -> Node_out, Debug

# volume of west office:
# 124911 m3
bibil_8 = PythonScript(Code=file_6, Rule_in=flatten([miru_12, miru_9, miru_10]), Node_in=flatten(geo_7), Run=Toggle(True))  # -> Node_out, Debug

# ----
move_2 = Move(Geometry=rotax.Geometry, Motion=Z_4)  # -> Geometry, Transform
number_slider_2 = Slider(49.5, range=0..100)
geo_11 = Geometry([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])
move_3 = Move(Geometry=rotax_2.Geometry, Motion=Z_5)  # -> Geometry, Transform
move_4 = Move(Geometry=rotax_3.Geometry, Motion=Z_6)  # -> Geometry, Transform
multiplication = Multiplication(A=Slider(25, range=0..100), B=-1)
geo_12 = Geometry([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])
offset = Offset(Curve=geo_11, Distance=multiplication, Plane=PlaneXY(0, 0, 0), Corners=Slider(3, range=0..10))
offset_2 = Offset(Curve=geo_12, Distance=Slider(25, range=0..100), Plane=PlaneXY(0, 0, 0), Corners=Slider(3, range=0..10))
g = PythonScript(node=bibil_7.Node_out)  # -> geom; inputs node: list
# ---------- g: Python ----------
node = filter(lambda n: n!=None,node)
if node and node != []:
    geom = []
    for n in node:
        if n.shape.z_dist < 1.2:
            geom.append(n.shape.bottom_crv)
        else:
            geom.append(n.shape.geom)
    print geom
# ---------- end g ----------
g_2 = PythonScript(node=bibil_8.Node_out)  # -> geom; inputs node: list; same code as g

# ---- group: HEIGHT
miru_13 = PythonScript(Code=file_11, Height=Slider(43.5, range=0..100), Run=Toggle(True))

miru_14 = PythonScript(Code=file_11, Height=Slider(82.5, range=0..100), Run=Toggle(True))

# ----
bibil_9 = PythonScript(Code=file_6, Rule_in=flatten(miru_13), Node_in=flatten(geo_11), Run=Toggle(True))  # -> Node_out, Debug
bibil_10 = PythonScript(Code=file_6, Rule_in=flatten(miru_14), Node_in=flatten(geo_12), Run=Toggle(True))  # -> Node_out, Debug
path = FilePath("C:\Users\vasanthakumars\Documents\GitHub\bibil\src\reference\CAN_ON_Toronto.716240_CWEC\CAN_ON_Toronto.716240_CWEC.epw")
g_3 = PythonScript(node=bibil_9.Node_out)  # -> geom; inputs node: list; same code as g
g_4 = PythonScript(node=bibil_10.Node_out)  # -> geom; inputs node: list; same code as g
geo_13 = Geometry([g_2, g])
importepw = Ladybug_ImportEpw(epwFile=path)  # -> readMe, latitude, location, dryBulbTemperature, dewPointTemperature, relativeHumidity, windSpeed, windDirection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; plug-in component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
ladybug = Ladybug_Ladybug()  # -> Vviiiiiiiiiizzz; plug-in component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
geo_14 = Geometry([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])
wires = BrepWireframe(Brep=geo_14, Density=-1)
number_slider_3 = Slider(9, range=0..10)
number_slider_4 = Slider(21, range=0..100)
material = CreateMaterial(
    Diffuse=ColourSwatch(SwatchColor=RGB(0, 255, 255)),
    Specular=RGB(255, 255, 255),
    Emission=RGB(0, 0, 0),
    Transparency=Slider(0.5, range=0..1),
    Shine=0)
mesh = Mesh()

# ---- group: SHAPENODE
bibil_11 = PythonScript(node_in=flatten([geo_14, geo_13]), label="buildings4analysis", run=Toggle(True))  # -> node_out, debug; inputs rule_in: tree, node_in: list, label: list, run: Boolean
# ---------- bibil_11: Python ----------
"""
Trinco UI
"""

import scriptcontext as sc
import clr

Grammar = sc.sticky["Grammar"]
clr.AddReference("Grasshopper")
from Grasshopper.Kernel.Data import GH_Path
from Grasshopper import DataTree

if run and node_in != []:
    node_in = filter(lambda n: n!=None,node_in)
    if rule_in.BranchCount < 0.5:
        rule_in = DataTree[object]()
        rule_ = []
        for i, r in enumerate(rule_):
            rule_in.Add(r)
        
    G = Grammar()
    sc.sticky["debug"] = []
    debug = sc.sticky["debug"]
    node_out = G.main_UI(node_in,rule_in,label_)
else:
    print 'Add inputs!'
# ---------- end bibil_11 ----------

# ----
preview = CustomPreview(
    Geometry=wires,
    Shader={ambient=RGB(0, 0, 0), diffuse=RGB(255, 105, 180), emission=RGB(76, 32, 54), shine=0.5, specular=RGB(255, 255, 255), transparency=0})
preview_2 = CustomPreview(Geometry=mesh, Shader=material)
geo_15 = Geometry(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)
g_5 = PythonScript(node=bibil_11.node_out)  # -> label; inputs node: list
# ---------- g_5: Python ----------
node = filter(lambda n: n!=None,node)
if node and node != []:
    label = []
    if True:#for i,n in enumerate(node):
        #print i
        root = node[0].get_root()
        L = root.traverse_tree(lambda n:n,internal=True) 
        for i in L:
            print i
            label.append(i)
        #label.append('--')
        #print '---'
# ---------- end g_5 ----------
analysisperiod = Ladybug_AnalysisPeriod(
    fromMonth=number_slider_3,
    fromDay=number_slider_4,
    fromHour=Slider(8.25, range=0..100),
    toMonth=number_slider_3,
    toDay=number_slider_4,
    toHour=Slider(12.25, range=0..100))  # -> readMe, analysisPeriod; plug-in component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
toggle = BooleanToggle(True)
solarfanbasic = Ladybug_SolarFanBasic(
    boundary=geo_15,
    location=importepw.location,
    requiredHours=Slider(1, range=0..10),
    height=Slider(175, range=0..1000),
    analysisPeriod=analysisperiod.analysisPeriod)  # -> readMe, solarFan; plug-in component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
solarfan = Ladybug_SolarFan()  # -> readMe, solarFan; plug-in component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

# ---- group: ANALYSIS
miru_15 = PythonScript(
    node_in=bibil_11.node_out,
    groundFloor_ht=Slider(4.5, range=0..10),
    restFloor_ht=Slider(3, range=0..10),
    height=toggle,
    GFA=toggle)  # -> ReadMe, geom_out, pt_out, label_out, analysis_out, debug; inputs node_in: list
# ---------- miru_15: Python ----------
import rhinoscriptsyntax as rs
import Rhino as rc
import random
import scriptcontext as sc
import copy
import math
import ghpythonlib.components as ghcomp

"""import classes"""
Shape = sc.sticky["Shape"]
Tree = sc.sticky["Tree"]

sc.sticky['debug'] = []
debug = sc.sticky["debug"]

TOL = sc.doc.ModelAbsoluteTolerance

def get_label(n):
    label_ = []
    root = n[0].get_root()
    L = root.traverse_tree(lambda n:n,internal=True) 
    for nl in L:
        #print nl
        label_.append(nl)
    return label_

def make_analysis(nodelen,pd):
    ## Input: dictionary of parameter key, list of data value 
    ## Output: Filtered list of str: with keys and value
    L = [""] * nodelen
    if pd.has_key('height'):
        for i,ht in enumerate(pd['height']):
            valstr = 'height: %s' % (ht)
            L[i] += valstr
    if pd.has_key('GFA'):
        for i,gfa in enumerate(pd['GFA']):
            valstr = '\nGFA: %s' % (gfa)
            L[i] += valstr
    return L

def get_ht(node_):
    L = []
    for n_ in node_:
        storey = str(round(n_.shape.ht,1))
        L.append(storey)
    return L

def get_GFA(node_,ght,rht):
    def helper_by_floor_div(n__,groundht):
        ratio = groundht/n__.shape.ht
        PD = {}
        PD['div_num'] = 1
        PD['div_deg'] = 0.
        PD['div_cut'] = 0.
        PD['div_ratio'] = ratio
        PD['div_type'] = 'simple_divide'
        PD['axis'] = "Z"
        divnode = n__.grammar.divide(n_,PD)
        
        if abs(divnode.loc[0].shape.ht - groundht) < 0.01:
            groundfloor = divnode.loc[0]
            restfloor = divnode.loc[1]
        else:
            groundfloor = divnode.loc[1]
            restfloor = divnode.loc[0]
        return groundfloor,restfloor
    def helper_by_floor_calc(n__,htdiv):
        n__.shape.geom = ghcomp.CapHolesEx(n__.shape.geom)[0]
        shapevol = rc.Geometry.VolumeMassProperties.Compute(n__.shape.geom).Volume
        shapegfa = shapevol/htdiv
        return shapegfa
        
    debug = sc.sticky['debug']
    ReadMe_ = ""
    L = []
    for n_ in node_:
        if abs(ght-rht)<0.1:
            gfacalc = helper_by_floor_calc(n_,rht)
        else:
            try:
                grndshape,rstshape = helper_by_floor_div(n_,ght)
                grndgfa = grndshape.shape.get_area()
                rstgfa = helper_by_floor_calc(rstshape,rht)
                gfacalc = grndgfa + rstgfa
            except:
                ReadMe_ = "Calculating by specific floor heights has failed, probably because the geometry was too complicated. GFA is now based on restfloorht."
                gfacalc = helper_by_floor_calc(rstshape,3.)
        #debug.extend(map(lambda n:n.shape.geom,divnode.loc))
        L.append(str(round(abs(gfacalc),1)))
    return L,ReadMe_

node = filter(lambda n: n!=None,node_in)
if node and node != []:
    node = map(lambda n: copy.deepcopy(n),node)
    sc.sticky['debug'] = []
    debug = sc.sticky['debug']
    ReadMe = ""
    
    #These always appear by default
    label_out = get_label(node)
    geom_out = map(lambda n:n.shape.geom,node)
    pt_out = map(lambda n:n.shape.cpt,node)
    #Analysis paramaters
    param_dict = {}
    if height==True:
        ht_out = get_ht(node)
        param_dict['height'] = ht_out
    if GFA == True:
        if not groundFloor_ht:
            groundFloor_ht = 3.0
        if not restFloor_ht:
            restFloor_ht = 3.0
        gfa_out,readmegfa = get_GFA(node,groundFloor_ht,restFloor_ht)
        param_dict['GFA'] = gfa_out
        ReadMe += readmegfa
    analysis_out = make_analysis(len(node),param_dict)
    if not ReadMe:
        ReadMe = "Successfully calculated"
# ---------- end miru_15 ----------

# ----
geo_16 = Geometry(solarfanbasic.solarFan)
wires_2 = BrepWireframe(Brep=geo_16, Density=-1)
material_2 = CreateMaterial(
    Diffuse=ColourSwatch(SwatchColor=RGB(0, 255, 107)),
    Specular=RGB(255, 255, 255),
    Emission=RGB(0, 0, 0),
    Transparency=Slider(0.91, range=0..1),
    Shine=0)

# ---- group: Height of Line for visualization
number_slider_5 = Slider(50, range=0..200)

# ----
preview_3 = CustomPreview(Geometry=solarfanbasic.solarFan, Shader=material_2)
geo_17 = Geometry(miru_15.pt_out)
python = PythonScript(num=geo_17, x=number_slider_5, reset=Button())  # -> a; inputs num: list
# ---------- python: Python ----------
import random 
import Rhino as rc

if not num:
    num = 1
if reset==False:
    vary = 10
    z = []
    for n in num:
        randint = random.randrange(-100,100)/int(vary)
        z.append(x + randint)
else:
    z = [10.] * len(num)

a = []
for n,z_ in zip(num,z):
    a.append(rc.Geometry.Vector3d(0,0,z_))
    #print a
# ---------- end python ----------
geo_18 = Geometry(miru_15.geom_out)
panel_5 = Panel(miru_15.ReadMe)
panel_6 = Panel(miru_15.analysis_out)
move_5 = Move(Geometry=geo_17, Motion=python)  # -> Geometry, Transform
ln = Line(StartPoint=geo_17, EndPoint=move_5.Geometry)
swatch = ColourSwatch(SwatchColor=RGB(255, 0, 255))
preview_4 = CustomPreview(Geometry=ln, Shader=swatch)
tag = TextTag(Location=move_5.Geometry, Text=miru_15.analysis_out, Colour=swatch)
