# Grasshopper definition bibil_trial_101_solar_envelopes.gh (Grasshopper 0.9.76)
# plug-ins: Python Interpreter

list = ValueList({"dir", "file"}, selected="dir")

# ---- group: find directory
bibil = PythonScript(
    dir=["C:\\Users\\vasanthakumars\\Documents\\GitHub\\bibil\\src", "C:\\saeran\\master\\git\\bibil\\src"],
    type=list,
    run=Toggle(True))  # -> dir; inputs dir: list
# ---------- bibil: Python ----------
import os
import sys

ghenv.Component.Params.Output[0].Name = "null"
ghenv.Component.Params.Output[0].NickName = "null"

#sys.path.append("C:\Program Files\Rhinoceros 5.0 (64-bit)\System")

if run:
    confirm_dir = None
    for d in dir:
        try:
            if type == "file":
                file_ = open(d)
                file_.close()
            else:
                print os.listdir(d)
            confirm_dir = d
            break
        except Exception as e:
            #print str(e)
            continue
    if confirm_dir != None:
        ghenv.Component.Params.Output[0].Name = type
        ghenv.Component.Params.Output[0].NickName = type
        dir = confirm_dir
        file = confirm_dir
null = None
# ---------- end bibil ----------

# ---- group: node_bucket
python_script = PythonScript(i=bibil)  # -> o
# ---------- python_script: Python ----------
import os

if i:
    o = os.path.join(str(i),"miru\\miru_shape_bucket.py")
# ---------- end python_script ----------
file = ReadFile(File=python_script, PerLineParse=False)

# ---- group: tree
python_script_2 = PythonScript(i=bibil)  # -> o
# ---------- python_script_2: Python ----------
import os

if i:
    o = os.path.join(str(i),"bibil\\bibil_tree.py")
# ---------- end python_script_2 ----------
file_2 = ReadFile(File=python_script_2, PerLineParse=False)
bibil_2 = PythonScript(Code=file_2)

# ---- group: grammar
python_script_3 = PythonScript(i=bibil)  # -> o
# ---------- python_script_3: Python ----------
import os

if i:
    o = os.path.join(str(i),"bibil\\bibil_grammar.py")
# ---------- end python_script_3 ----------
file_3 = ReadFile(File=python_script_3, PerLineParse=False)
bibil_3 = PythonScript(Code=file_3)

# ---- group: shape
python_script_4 = PythonScript(i=bibil)  # -> o
# ---------- python_script_4: Python ----------
import os

if i:
    o = os.path.join(str(i),"bibil\\bibil_shape.py")
#o = os.path.join(str(i),"research\\bibil_shape_shape_3d_2d.py")
# ---------- end python_script_4 ----------
file_4 = ReadFile(File=python_script_4, PerLineParse=False)
bibil_4 = PythonScript(Code=file_4)

# ---- group: bula
python_script_5 = PythonScript(i=bibil)  # -> o
# ---------- python_script_5: Python ----------
import os

if i:
    o = os.path.join(str(i),"bula\\bula_minimal.py")
# ---------- end python_script_5 ----------
file_5 = ReadFile(File=python_script_5, PerLineParse=False)
bibil_5 = PythonScript(Code=file_5)

# ---- group: UI
python_script_6 = PythonScript(i=bibil)  # -> o
# ---------- python_script_6: Python ----------
import os

if i:
    o = os.path.join(str(i),"bibil\\bibil_UI.py")
# ---------- end python_script_6 ----------
file_6 = ReadFile(File=python_script_6, PerLineParse=False)

# ---- group: grammar_divide
python_script_7 = PythonScript(i=bibil)  # -> o
# ---------- python_script_7: Python ----------
import os

if i:
    o = os.path.join(str(i),"miru\\miru_divide.py")
# ---------- end python_script_7 ----------
file_7 = ReadFile(File=python_script_7, PerLineParse=False)

# ---- group: grammar_courtyard
python_script_8 = PythonScript(i=bibil)  # -> o
# ---------- python_script_8: Python ----------
import os

if i:
    o = os.path.join(str(i),"miru\\miru_court.py")
# ---------- end python_script_8 ----------
file_8 = ReadFile(File=python_script_8, PerLineParse=False)

# ---- group: grammar_tower
python_script_9 = PythonScript(i=bibil)  # -> o
# ---------- python_script_9: Python ----------
import os

if i:
    o = os.path.join(str(i),"miru\\miru_packing.py")
# ---------- end python_script_9 ----------
file_9 = ReadFile(File=python_script_9, PerLineParse=False)

# ---- group: stepback
python_script_10 = PythonScript(i=bibil)  # -> o
# ---------- python_script_10: Python ----------
import os

if i:
    o = os.path.join(str(i),"miru\\miru_stepback.py")
# ---------- end python_script_10 ----------
file_10 = ReadFile(File=python_script_10, PerLineParse=False)

# ---- group: grammar_height
python_script_11 = PythonScript(i=bibil)  # -> o
# ---------- python_script_11: Python ----------
import os

if i:
    o = os.path.join(str(i),"miru\\miru_height.py")
# ---------- end python_script_11 ----------
file_11 = ReadFile(File=python_script_11, PerLineParse=False)

# ---- group: grammar_analysis_pts
python_script_12 = PythonScript(i=bibil)  # -> o
# ---------- python_script_12: Python ----------
import os

if i:
    o = os.path.join(str(i),"miru\\miru_analysis.py")
# ---------- end python_script_12 ----------
file_12 = ReadFile(File=python_script_12, PerLineParse=False)

# ---- group: meta_tree
python_script_13 = PythonScript(i=bibil)  # -> o
# ---------- python_script_13: Python ----------
import os

if i:
    o = os.path.join(str(i),"miru\\miru_meta_tree.py")
# ---------- end python_script_13 ----------
file_13 = ReadFile(File=python_script_13, PerLineParse=False)

# ---- group: land_use
python_script_14 = PythonScript(i=bibil)  # -> o
# ---------- python_script_14: Python ----------
import os

if i:
    o = os.path.join(str(i),"miru\\miru_landuse.py")
# ---------- end python_script_14 ----------
file_14 = ReadFile(File=python_script_14, PerLineParse=False)

# ---- group: shape2height
python_script_15 = PythonScript(i=bibil)  # -> o
# ---------- python_script_15: Python ----------
import os

if i:
    o = os.path.join(str(i),"miru\\miru_shape2height.py")
# ---------- end python_script_15 ----------
file_15 = ReadFile(File=python_script_15, PerLineParse=False)

# ---- group: extract_slice
python_script_16 = PythonScript(i=bibil)  # -> o
# ---------- python_script_16: Python ----------
import os

if i:
    o = os.path.join(str(i),"miru\\miru_extract_slice.py")
# ---------- end python_script_16 ----------
file_16 = ReadFile(File=python_script_16, PerLineParse=False)

# ----
list_2 = ValueList({"divide by depth": "subdivide_depth", "divide by same depth": "subdivide_depth_same", "divide by dim": "subdivide_dim"}, selected="divide by same depth")
list_3 = ValueList({"YZ": "NS", "XZ": "EW", "XY": "Z"}, selected="XZ")

# ---- group: ENERGY_MODEL_BUCKET
miru = PythonScript(Code=file, Run=Toggle(True))

# ---- group: SETBACK
miru_2 = PythonScript(Code=file_10, Height_stepback="22.5:6.0", Run=Toggle(False))

# ---- group: PACKING
separatedata = Ladybug_SeparateData(Code=file_9, X_keep_omit="27.0,25.0", Y_keep_omit="27.0,25.0", Seperation_ref="-1", Run=Toggle(True))

# ---- group: EXTRACT_SLICE
miru_3 = PythonScript(Code=file_16, Run=Toggle(False))

# ---- group: DIVIDE
miru_4 = PythonScript(
    Code=file_7,
    Divide_num=Slider(2, range=0..10),
    Divide_cut=Slider(0, range=0..100),
    Divide_type=list_2,
    Divide_ratio=Slider(0.5, range=0..1),
    Axis=list_3,
    Run=Toggle(False))

# ---- group: PERIMETER
# Note: Change this number with caution,
# Increase bounds iterratively.
miru_5 = PythonScript(Code=file_8, Width=Slider(20, range=0..100), Cut_width=Slider(0, range=0..100), Court_ref="0", Run=Toggle(False))

# ---- group: HEIGHT
miru_6 = PythonScript(Code=file_11, Height=Slider(16.5, range=0..100), Run=Toggle(True))

# ---- group: TREE RULES
miru_7 = PythonScript(Code=file_13, Run=Toggle(False))

# ---- group: SHAPE2HEIGHT
miru_8 = PythonScript(Code=file_15, Run=Toggle(False))

# ----
path = FilePath("C:\Users\vasanthakumars\Documents\GitHub\bibil\src\reference\CAN_ON_Toronto.716240_CWEC\CAN_ON_Toronto.716240_CWEC.epw")
importepw = Ladybug_ImportEpw(epwFile=path)  # -> readMe, latitude, location, dryBulbTemperature, dewPointTemperature, relativeHumidity, windSpeed, windDirection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; plug-in component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
ladybug = Ladybug_Ladybug()  # -> Vviiiiiiiiiizzz; plug-in component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
number_slider = Slider(9, range=0..10)
number_slider_2 = Slider(21, range=0..100)
number_slider_3 = Slider(9, range=0..10)
number_slider_4 = Slider(21, range=0..100)
number_slider_5 = Slider(250, range=0..1000)
Z = UnitZ(Factor=Slider(82, range=0..100))
Z_2 = UnitZ(Factor=Slider(211.5, range=0..1000))

# ---- group: DV
geo = Geometry(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)

# ---- group: YE
geo_2 = Geometry(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)

# ---- group: solar input curve
geo_3 = Geometry(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)

# ----
analysisperiod = Ladybug_AnalysisPeriod(
    fromMonth=number_slider,
    fromDay=number_slider_2,
    fromHour=Slider(8.25, range=0..10),
    toMonth=number_slider,
    toDay=number_slider_2,
    toHour=Slider(17.25, range=0..100))  # -> readMe, analysisPeriod; plug-in component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
analysisperiod_2 = Ladybug_AnalysisPeriod(
    fromMonth=number_slider_3,
    fromDay=number_slider_4,
    fromHour=Slider(8.25, range=0..10),
    toMonth=number_slider_3,
    toDay=number_slider_4,
    toHour=Slider(17.25, range=0..100))  # -> readMe, analysisPeriod; plug-in component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

# ---- group: solar input curve
geo_4 = Geometry(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)

# ----
extr = Extrude(Base=geo_2, Direction=Z_2)
extr_2 = Extrude(Base=geo, Direction=Z)
solarfanbasic = Ladybug_SolarFanBasic(
    boundary=geo_4,
    location=importepw.location,
    requiredHours=Slider(1, range=0..10),
    height=number_slider_5,
    analysisPeriod=analysisperiod.analysisPeriod)  # -> readMe, solarFan; plug-in component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
solarfan = Ladybug_SolarFan()  # -> readMe, solarFan; disabled; plug-in component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
solarfan_2 = Ladybug_SolarFan()  # -> readMe, solarFan; disabled; plug-in component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
solarfanbasic_2 = Ladybug_SolarFanBasic(
    boundary=geo_3,
    location=importepw.location,
    requiredHours=Slider(1, range=0..10),
    height=number_slider_5,
    analysisPeriod=analysisperiod_2.analysisPeriod)  # -> readMe, solarFan; plug-in component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
capex = CapHolesEx(Brep=extr)  # -> Brep, Caps, Solid
capex_2 = CapHolesEx(Brep=extr_2)  # -> Brep, Caps, Solid
boundary = BoundarySurfaces(Edges=geo)
material = CreateMaterial(
    Diffuse=ColourSwatch(SwatchColor=RGB(17, 255, 0)),
    Specular=RGB(255, 255, 255),
    Emission=RGB(0, 0, 0),
    Transparency=Slider(0.75, range=0..1),
    Shine=0)
material_2 = CreateMaterial(
    Diffuse=ColourSwatch(SwatchColor=RGB(0, 255, 107)),
    Specular=RGB(255, 255, 255),
    Emission=RGB(0, 0, 0),
    Transparency=Slider(0.75, range=0..1),
    Shine=0)
boundary_2 = BoundarySurfaces(Edges=geo_2)
geo_5 = Geometry(solarfanbasic_2.solarFan)
geo_6 = Geometry(solarfanbasic.solarFan)
preview = CustomPreview(Geometry=solarfanbasic.solarFan, Shader=material)
preview_2 = CustomPreview(Geometry=solarfanbasic_2.solarFan, Shader=material_2)
gentestpts = Honeybee_GenerateTestPoints(testGeometry=boundary, gridSize="40", distBaseSrf="1", moveTestMesh=True)  # -> readMe, simplify(testPoints), simplify(ptsVectors), simplify(facesArea), simplify(mesh); plug-in component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
gentestpts_2 = Honeybee_GenerateTestPoints(testGeometry=boundary_2, gridSize="40", distBaseSrf="1", moveTestMesh=True)  # -> readMe, simplify(testPoints), simplify(ptsVectors), simplify(facesArea), simplify(mesh); plug-in component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
geo_7 = Geometry(gentestpts.testPoints)
geo_8 = Geometry(gentestpts_2.testPoints)
Z_3 = UnitZ(Factor=Slider(82, range=0..100))
pt = Point(Point(-545876.8178, 3980605.953, 0))
pt_2 = Point(Point(-545083.5034, 3980721.771, 0))
pt_3 = Point(Point(-546034.6363, 3981515.595, 0))
pt_4 = Point(Point(-545351.6008, 3981730.604, 0))
pt_5 = Point(Point(-545569.618, 3981667.31, 0))
move = Move(Geometry=pt, Motion=Z_3)  # -> Geometry, Transform
Z_4 = UnitZ(Factor=Slider(121.5, range=0..1000))
Z_5 = UnitZ(Factor=Slider(133.5, range=0..1000))
circle = CircleCNR(Center=pt, Normal=Vector(0, 0, 1), Radius=Slider(25, range=0..100))
Z_6 = UnitZ(Factor=Slider(211.5, range=0..1000))

# ---- group: FORMULA
python = PythonScript(formula="1 / math.exp(0.005*dist)", focal_ref=[pt, pt_2], height_ref="82.0,50.0", smooth=Slider(1.7, range=0..5))  # -> value_ref; inputs focal_ref: list
# ---------- python: Python ----------
"""
Bula Formula
"""
import rhinoscriptsyntax as rs

#Formula handling
#dist = 10.
#val = eval(formula)

focal_ref = map(lambda fr: rs.coerce3dpoint(fr),focal_ref)
focal_heights = map(lambda fw: float(fw), height_ref.split(','))
smooth_factor = smooth 
value_ref = [formula,focal_ref,focal_heights,smooth_factor]
# ---------- end python ----------

# ----
ln = Line(StartPoint=move.Geometry, EndPoint=pt)
circle_2 = CircleCNR(Center=[pt_3, pt_4, pt_5], Normal=Vector(0, 0, 1), Radius=Slider(25, range=0..100))
move_2 = Move(Geometry=pt_4, Motion=Z_4)  # -> Geometry, Transform

# ---- group: FORMULA
python_2 = PythonScript(
    formula="1 / math.exp(0.005*dist)",
    focal_ref=[pt_3, pt_4, pt_5],
    height_ref="211.5,121.5,133.5,91.5",
    smooth=Slider(1.7, range=0..5))  # -> value_ref; inputs focal_ref: list; same code as python

# ----
move_3 = Move(Geometry=pt_5, Motion=Z_5)  # -> Geometry, Transform
move_4 = Move(Geometry=pt_3, Motion=Z_6)  # -> Geometry, Transform
ln_2 = Line(StartPoint=move_2.Geometry, EndPoint=pt_4)
ln_3 = Line(StartPoint=move_3.Geometry, EndPoint=pt_5)
ln_4 = Line(StartPoint=move_4.Geometry, EndPoint=pt_3)
bula = PythonScript(Code=file_12, Analysis_ref=gentestpts.testPoints, Value_ref=python, Scale=Slider(1, range=0..10), Run=Toggle(True))
bula_2 = PythonScript(Code=file_12, Analysis_ref=gentestpts_2.testPoints, Value_ref=python_2, Scale=Slider(1, range=0..10), Run=Toggle(True))
trinco_park = PythonScript(Code=file_6, Rule_in=flatten(bula), Node_in=flatten(boundary), Label_="site_root", Run=Toggle(True))  # -> Node_out, Debug
trinco_park_2 = PythonScript(Code=file_6, Rule_in=flatten(bula_2), Node_in=flatten(boundary_2), Label_="site_root", Run=Toggle(True))  # -> Node_out, Debug
g = PythonScript(node=trinco_park.Node_out)  # -> geom; inputs node: list
# ---------- g: Python ----------
if node and node != []:
    geom = []
    #lot_lst = node.traverse_tree(lambda n:n,internal=False)
    for n in node:
        #print n.grammar.type.has_key('bula')
        print n.grammar.type['bula']
        geom.append(n.shape.bottom_crv)
    print geom
# ---------- end g ----------
g_2 = PythonScript(node=trinco_park.Node_out)  # -> bula; inputs node: list
# ---------- g_2: Python ----------
if node and node != []:
    geom = []
    #lot_lst = node.traverse_tree(lambda n:n,internal=False)
    #n = node[0].get_root()
    for n in node:
        
        print n.grammar.type['label']
        print n.grammar.type['bula']
        if n.grammar.type['bula'] == True:
            geom.extend(n.grammar.type['bula_data'].bpt_viz_lst)
    bula = geom
# ---------- end g_2 ----------
g_3 = PythonScript(node=trinco_park.Node_out)  # -> data; inputs node: list
# ---------- g_3: Python ----------
if node and node != []:
    L = []
    #lot_lst = node.traverse_tree(lambda n:n,internal=False)
    #n = node[0].get_root()
    for n in node:
        print n.grammar.type['label']
        if n.grammar.type['bula']:
            L.extend(n.grammar.type['bula_data'].value_lst)
    data = map(lambda d: str(round(d,2))+'%',L)
   
    print data
# ---------- end g_3 ----------
g_4 = PythonScript(node=trinco_park_2.Node_out)  # -> geom; inputs node: list; same code as g
g_5 = PythonScript(node=trinco_park_2.Node_out)  # -> bula; inputs node: list; same code as g_2
g_6 = PythonScript(node=trinco_park_2.Node_out)  # -> data; inputs node: list; same code as g_3
geometry = Geometry(g_5)
tag = TextTag(Location=g_2, Text=g_3)
tag_2 = TextTag(Location=g_5, Text=g_6)
geometry_2 = Geometry(g_2)
number_slider_6 = Slider(400, range=0..1000)
Z_7 = UnitZ(Factor=Slider(300, range=0..1000))
geo_9 = Geometry(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)
Z_8 = UnitZ(Factor=Slider(300, range=0..1000))
geo_10 = Geometry(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)
geo_11 = Geometry(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)
extr_3 = Extrude(Base=geo_10, Direction=Z_7)
neg = Negative(Value=Slider(22.5, range=0..100))
neg_2 = Negative(Value=Slider(45, range=0..100))
geo_12 = Geometry(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)
extr_4 = Extrude(Base=geo_9, Direction=Z_8)
rad = Radians(Degrees=neg)
rad_2 = Radians(Degrees=neg_2)
geo_13 = Geometry(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)
scale = Scale(Geometry=geo_11, Center=Point(-545614.4767, 3982311.641, 0), Factor=Slider(1.5, range=0..10))  # -> Geometry, Transform
geo_14 = Geometry(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)
neg_3 = Negative(Value=Slider(75, range=0..1000))
geo_15 = Geometry(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)
geo_16 = Geometry(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)
Z_9 = UnitZ(Factor=number_slider_6)
Z_10 = UnitZ(Factor=number_slider_6)
Z_11 = UnitZ(Factor=number_slider_6)
Z_12 = UnitZ(Factor=number_slider_6)
Z_13 = UnitZ(Factor=number_slider_6)
Z_14 = UnitZ(Factor=neg_3)
neg_4 = Negative(Value=Slider(45, range=0..100))
neg_5 = Negative(Value=Slider(45, range=0..100))
neg_6 = Negative(Value=Slider(45, range=0..100))
neg_7 = Negative(Value=Slider(45, range=0..100))
neg_8 = Negative(Value=Slider(45, range=0..100))
neg_9 = Negative(Value=Slider(45, range=0..100))
extr_5 = Extrude(Base=geo_15, Direction=Z_10)
extr_6 = Extrude(Base=geo_16, Direction=Z_11)
extr_7 = Extrude(Base=geo_12, Direction=Z_12)
extr_8 = Extrude(Base=scale.Geometry, Direction=Z_9)
extr_9 = Extrude(Base=geo_14, Direction=Z_13)
extr_10 = Extrude(Base=geo_14, Direction=Z_14)
rad_3 = Radians(Degrees=neg_4)
line = Line(Line((-545323.9472, 3981811.777, 0), (-545342.2737, 3981875.173, 0)))
rad_4 = Radians(Degrees=neg_5)
rad_5 = Radians(Degrees=neg_6)
rad_6 = Radians(Degrees=neg_7)
line_2 = Line(Line((-546176.6839, 3982204.04, 0), (-546137.8441, 3981957.556, 0)))
rad_7 = Radians(Degrees=neg_8)
rad_8 = Radians(Degrees=neg_9)
line_3 = Line(Line((-546229.9396, 3981676.683, 0), (-546183.5515, 3981515.154, 0)))
line_4 = Line(Line((-546229.9396, 3981676.683, 0), (-546183.5515, 3981515.154, 0)))
rotax = RotateAxis(Geometry=extr_3, Angle=rad, Axis=geo_10)  # -> Geometry, Transform
rotax_2 = RotateAxis(Geometry=extr_4, Angle=rad_2, Axis=geo_9)  # -> Geometry, Transform
line_5 = Line(Line((-545533.7844, 3982334.296, 0), (-546102.1252, 3982174.689, 0)))
rotax_3 = RotateAxis(Geometry=extr_5, Angle=rad_3, Axis=geo_15)  # -> Geometry, Transform
rotax_4 = RotateAxis(Geometry=extr_6, Angle=rad_4, Axis=line)  # -> Geometry, Transform
rotax_5 = RotateAxis(Geometry=extr_7, Angle=rad_5, Axis=line_2)  # -> Geometry, Transform
rotax_6 = RotateAxis(Geometry=extr_8, Angle=rad_6, Axis=line_5)  # -> Geometry, Transform
rotax_7 = RotateAxis(Geometry=extr_9, Angle=rad_7, Axis=line_3)  # -> Geometry, Transform
rotax_8 = RotateAxis(Geometry=extr_10, Angle=rad_8, Axis=line_4)  # -> Geometry, Transform
