# Grasshopper definition nirvik_tower_seperation_debugging_2.gh (Grasshopper 0.9.76)
# plug-ins: Python Interpreter

# ---- group: site
geo = Geometry(<curve referenced from the Rhino model>)

# ---- group: htsrf
geo_2 = Geometry(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)

# ---- group: footprint
geo_3 = Geometry(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)

# ---- group: refsite
geo_4 = Geometry(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)

# ---- group: Total Grid for reference/practise
geo_5 = Geometry([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])

# ----
python = PythonScript(x=geo, y=geo_3, z=geo_2)  # -> a, c, debug; inputs y: list
# ---------- python: Python ----------
import rhinoscriptsyntax as rs
import math
import operator
import random


def eq_dis_tower(crv, a, b, block_dis):
    bb=rs.BoundingBox(crv)
    rs.EnableRedraw(False)
    bb_crv=rs.AddPolyline([bb[0],bb[1],bb[2],bb[3],bb[0]])
    srf=rs.AddPlanarSrf(bb_crv)
    srfUdom=rs.SurfaceDomain(srf,0)
    print 'srf', srfUdom
    srfVdom=rs.SurfaceDomain(srf,1)
    print 'srf', srfVdom
    umax=srfUdom[1]
    umin=srfUdom[0]
    m=((umax-umin)/(a+block_dis))
    ustep=(umax-umin)/m
    vmax=srfVdom[1]
    vmin=srfVdom[0]
    n=((vmax-vmin)/(b+block_dis))
    vstep=((vmax-vmin)/n)
    srf_pts=[]
    i=umin
    while(i<umax):
        j=vmin
        while(j<vmax):
            pl=[]
            pts=[]
            pts.append(rs.EvaluateSurface(srf, i, j))
            pts.append(rs.EvaluateSurface(srf, i+ustep, j))
            pts.append(rs.EvaluateSurface(srf, i+ustep, j+vstep))
            pts.append(rs.EvaluateSurface(srf, i, j+vstep))
            pts.append(rs.EvaluateSurface(srf, i, j))
            pl=rs.AddPolyline(pts)
            crvCen=rs.CurveAreaCentroid(pl)[0]
            x=crvCen[0]
            y=crvCen[1]
            srf_pts.append([x,y,0])
            rs.DeleteObject(pl)
            j+=vstep
        i+=ustep
    new_pts=[]
    temp_pts=[]
    cirs=[]
    for pt in srf_pts:
        m=rs.PointInPlanarClosedCurve(pt, crv)
        if(m==1):
            temp_pts.append(pt)

    tower_crv=[]
    for pt in temp_pts:
        #rs.AddPoint(pt)
        x=pt[0]
        y=pt[1]
        dx=a/2
        dy=b/2
        x0=x-dx
        y0=y-dy
        pt0=[x0,y0,0]
        x1=x+dx
        y1=y-dy
        pt1=[x1,y1,0]
        x2=x+dx
        y2=y+dy
        pt2=[x2,y2,0]
        x3=x-dx
        y3=y+dy
        pt3=[x3,y3,0]
        m0=rs.PointInPlanarClosedCurve(pt0, crv)
        m1=rs.PointInPlanarClosedCurve(pt1, crv)
        m2=rs.PointInPlanarClosedCurve(pt2, crv)
        m3=rs.PointInPlanarClosedCurve(pt3, crv)
        if(m0==1 and m1==1 and m2==1 and m3==1):
            tower_crv.append([pt0,pt1,pt2,pt3,pt0])
    rs.DeleteObject(srf)
    rs.DeleteObject(bb_crv)
    rs.EnableRedraw(True)
    return tower_crv

def findSides(crvs):
    i=0
    n=len(crvs)    
    crv_li=[]
    for crv in crvs:
        bb=rs.BoundingBox(crv)
        dX=rs.Distance(bb[0], bb[1])
        dY=rs.Distance(bb[1], bb[2])
        crv_li.append([dX, dY, i])
        i+=1
    crv_li_X=sorted(crv_li, key=operator.itemgetter(0))
    crv_li_X.reverse()
    crv_li_Y=sorted(crv_li, key=operator.itemgetter(1))
    crv_li_Y.reverse()
    final_dim=[]
    final_dim.append([crv_li_X[0][0], crv_li_Y[0][1]])
    return final_dim

def place_tower(tower_crvs, block_crvs):
    footprint_crv=[]
    for crv in tower_crvs:
        r=random.randrange(0,len(block_crvs))
        tower_crv=rs.AddPolyline(crv)
        tower_crv_cen=rs.CurveAreaCentroid(tower_crv)[0]         
        bb=rs.BoundingBox(block_crvs[r])        
        pl=rs.AddPolyline([bb[0],bb[1],bb[2],bb[3],bb[0]])
        block_crv_cen=rs.CurveAreaCentroid(pl)[0]
        vec=(tower_crv_cen-block_crv_cen)
        block_crv_dup=rs.CopyObject(block_crvs[r], vec)
        footprint_crv.append(block_crv_dup)
        rs.DeleteObject(tower_crv)
        rs.DeleteObject(pl)
    return footprint_crv



def street_sys(site_crv, a, b, block_dis, street_width):
    bb=rs.BoundingBox(site_crv)
    rs.EnableRedraw(False)
    bb_crv=rs.AddPolyline([bb[0],bb[1],bb[2],bb[3],bb[0]])
    srf=rs.AddPlanarSrf(bb_crv)
    srfUdom=rs.SurfaceDomain(srf,0)
    srfVdom=rs.SurfaceDomain(srf,1)
    umax=srfUdom[1]
    umin=srfUdom[0]
    m=((umax-umin)/(a+block_dis))
    ustep=(umax-umin)/m
    vmax=srfVdom[1]
    vmin=srfVdom[0]
    n=((vmax-vmin)/(b+block_dis))
    vstep=((vmax-vmin)/n)
    i=umin
    street_pl=[]
    while(i<umax):
        j=vmin
        while(j<vmax):
            pt0=rs.EvaluateSurface(srf, i, j)
            pt1=rs.EvaluateSurface(srf, i+ustep, j)
            pt2=rs.EvaluateSurface(srf, i+ustep, j+vstep)
            pt3=rs.EvaluateSurface(srf, i, j+vstep)
            temp_crv=rs.AddPolyline([pt0,pt1,pt2,pt3,pt0])
            crv_cen=rs.CurveAreaCentroid(temp_crv)[0]
            m=rs.PointInPlanarClosedCurve(crv_cen, site_crv)
            rs.DeleteObject(temp_crv)
            if(m==1):
                street_pl.append([pt0,pt1,pt2,pt3,pt0])
            j+=vstep
        i+=ustep

    sw=street_width/2
    st_offset=[]
    for crv in street_pl:
        crvpl=rs.AddPolyline(crv)
        crvpl_cen=rs.CurveAreaCentroid(crvpl)[0]
        crvx=rs.OffsetCurve(crvpl,crvpl_cen,sw)
        st_offset.append(crvx)
        rs.DeleteObject(crvpl)

    rs.DeleteObject(srf)
    rs.DeleteObject(bb_crv)
    rs.EnableRedraw(True)


def build_tower(footprint_crvs, guide_srf):
    L = []
    for crv in footprint_crvs:
        bb=rs.BoundingBox(crv)
        bb_crv=rs.AddPolyline([bb[0],bb[1],bb[2],bb[3],bb[0]])
        pl_srf=rs.AddPlanarSrf(crv)
        bb_crv_cen=rs.CurveAreaCentroid(bb_crv)[0]
        pt=[bb_crv_cen[0],bb_crv_cen[1],500]
        lext=rs.AddLine(bb_crv_cen, pt)
        #ext_crv=rs.ExtrudeCurve(crv, lext)
        ext_srf=rs.ExtrudeSurface(pl_srf,lext)
        tr_srf=rs.TrimBrep(ext_srf,guide_srf)
        rs.DeleteObject(lext)
        rs.CapPlanarHoles(tr_srf)
    return L





#################
#   Main Loop   #
#################




site_crv= x#rs.GetObjects("Pick the site")
block_dis=25. #rs.GetReal("Enter the tower distance",50,10,100)
block_crvs=y#rs.GetObjects("Select the patterns of tower footprint")
street_width=0.15#rs.GetReal("Enter street width",3,0.15,10)
guide_srf=z#rs.GetObject("Select guide surface for height")

a=findSides(block_crvs)[0][0]
b=findSides(block_crvs)[0][1]
a,b = 27.4, 27.4
tower_crvs=eq_dis_tower(site_crv, a, b, block_dis)

a_=place_tower(tower_crvs, block_crvs)
street_sys(site_crv, a, b, block_dis,street_width)
a = build_tower(footprint_crvs, guide_srf)
print a
# ---------- end python ----------

# ---- group: IDEAL TOWER ALLOCATION
geometry = Geometry([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])

# ----
geo_6 = Geometry(python.a)
geo_7 = Geometry(python.debug)
geo_8 = Geometry(python.c)
