# Grasshopper definition srf_issue_gh.gh (Grasshopper 0.9.76)
# plug-ins: Python Interpreter

ladybug = Ladybug_Ladybug()  # -> Vviiiiiiiiiizzz; plug-in component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
honeybee = Honeybee_Honeybee()  # -> Vviiiiiiiiiizzz; plug-in component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
geo = Geometry([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])
listzoneprograms = Honeybee_ListZonePrograms(bldgProgram=Slider(0, range=0..100))  # -> OfficeZonePrograms; plug-in component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
wires = BrepWireframe(Brep=geo, Density=-1)
splitmass = Honeybee_SplitBuildingMass(bldgMasses=geo, bldgsFlr2FloorHeights="@4", runIt=Toggle(True))  # -> readMe, splitBldgMasses; plug-in component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
item = ListItem(List=listzoneprograms, Index=0, Wrap=True)
toggle = BooleanToggle(True)
number_slider = Slider(0.3, range=0..1)
concat = Concatenate(FragmentA="2")
concat_2 = Concatenate(FragmentA="2", FragmentB="window", JoinSeparator=" ")
callfromepconstrlibrary = Honeybee_CallFromEPConstructionLibrary(keywords=concat)  # -> ThermMaterials, EPMaterials, EPWindowMaterials, EPConstructions; plug-in component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
callfromepconstrlibrary_2 = Honeybee_CallFromEPConstructionLibrary(keywords=concat_2)  # -> ThermMaterials, EPMaterials, EPWindowMaterials, EPConstructions; plug-in component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
glzparamlist = Honeybee_GlazingParametersList(northGlzParam=number_slider, westGlzParam=number_slider, southGlzParam=number_slider, eastGlzParam=number_slider)  # -> glzParamList; plug-in component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
mass2zone = Honeybee_Masses2Zones(
    zoneMasses=flatten(splitmass.splitBldgMasses),
    zonePrograms=item,
    isConditioned=True,
    maxRoofAngle=30,
    createHBZones=toggle)  # -> readMe, HBZones; plug-in component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
item_2 = ListItem(List=callfromepconstrlibrary.EPConstructions, Index=198, Wrap=True)
item_3 = ListItem(List=callfromepconstrlibrary_2.EPConstructions, Index=44, Wrap=True)
solveadjc = Honeybee_SolveAdjacencies(HBZones=flatten(mass2zone.HBZones), removeCurrentAdjc=False, findAdjc=Toggle(True))  # -> readMe, HBZonesWADJ; plug-in component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
panel = Panel(item_3)
panel_2 = Panel(item_2)
glazingcreator = Honeybee_GlazingBasedOnRatio(HBObjects=solveadjc.HBZonesWADJ, glzRatio=glzparamlist, breakUpWindow=Toggle(False), runIt=toggle)  # -> readMe, HBObjWGLZ; plug-in component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
toggle_2 = BooleanToggle(True)
setepzonecnstr = Honeybee_SetEPZoneConstruction(HBZone=glazingcreator.HBObjWGLZ, wallEPConstruction=item_2, windowEPConstruction=item_3)  # -> simplify(modifiedHBZone); plug-in component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
epoutput = Honeybee_GenerateEPOutput(
    zoneEnergyUse=toggle_2,
    zoneGainsAndLosses=toggle_2,
    zoneComfortMetrics="False",
    comfortMapVariables=toggle_2,
    zoneHVACParams=toggle_2,
    surfaceTempAnalysis=toggle_2,
    surfaceEnergyAnalysis=toggle_2,
    glazingSolarAnalysis=toggle_2,
    timestep="annual")  # -> report, flatten(simulationOutputs); plug-in component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
geo_2 = Geometry(setepzonecnstr)
open_weather_file = Ladybug_OpenEPWWeatherFile(open=Toggle(True))  # -> epwFile; plug-in component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
panel_3 = Panel("C:\Users\vasanthakumars\Desktop\temp_folder")
toggle_3 = BooleanToggle(True)
panel_4 = Panel(setepzonecnstr)
exporttoopenstudio = Honeybee_ExportToOpenStudio(
    epwWeatherFile=open_weather_file,
    HBZones=flatten(setepzonecnstr),
    simulationOutputs=flatten(epoutput.simulationOutputs),
    writeOSM=toggle_3,
    runSimulation=toggle_3)  # -> readMe, osmFileAddress, idfFileAddress, resultsFileAddress, rddFileAddress, studyFolder; plug-in component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
panel_5 = Panel(exporttoopenstudio.readMe)
readepresult = Honeybee_ReadEPResult(resultFileAddress=exporttoopenstudio.resultsFileAddress)  # -> totalThermalLoad, thermalLoadBalance, cooling, heating, electricLight, electricEquip, fanElectric, pumpElectric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; plug-in component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
readepsrfresult = Honeybee_ReadEPSurfaceResult(resultFileAddress=exporttoopenstudio.resultsFileAddress)  # -> surfaceIndoorTemp, surfaceOutdoorTemp, surfaceEnergyFlow, opaqueEnergyFlow, glazEnergyFlow, windowTotalSolarEnergy, windowBeamEnergy, windowDiffEnergy, windowTransmissivity, otherSurfaceData; plug-in component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
data = Data(setepzonecnstr)
decomposebytype = Honeybee_DecomposeBasedOnType(HBZone=data)  # -> walls, interiorWalls, airWalls, flatten(windows), interiorWindows, skylights, roofs, ceilings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; plug-in component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
colorzones = Honeybee_ColorZonesByEPResult(zoneData=readepresult.cooling, HBZones=flatten(data), normalizeByFloorArea=Toggle(True), runIt=Toggle(True))  # -> readMe, zoneColoredMesh, zoneWireFrame, legend, legendBasePt, analysisTitle, zoneBreps, zoneColors, zoneValues, floorNormZoneData; plug-in component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
wires_2 = BrepWireframe(Brep=decomposebytype.walls, Density=-1)
mesh = Mesh(colorzones.zoneColoredMesh)
preview = CustomPreview(Geometry=decomposebytype.windows, Shader=ColourSwatch(SwatchColor=RGB(0, 255, 255)))
preview_2 = CustomPreview(Geometry=wires_2, Shader=ColourSwatch(SwatchColor=RGBA(255, 255, 0, 122)))
geo_3 = Geometry([colorzones.analysisTitle, colorzones.legend])
preview_3 = CustomPreview(Geometry=colorzones.zoneWireFrame, Shader=colorzones.zoneColors)
