# Grasshopper definition splitBuildingMassissue_bibil_1.gh (Grasshopper 0.9.76)
# plug-ins: Python Interpreter

honeybee = Honeybee_Honeybee()  # -> Vviiiiiiiiiizzz; plug-in component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
ladybug = Ladybug_Ladybug()  # -> Vviiiiiiiiiizzz; plug-in component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
panel = Panel("C:\\Users\\vasanthakumars\\Documents\\GitHub\\bibil\\src\\reference\\honeybee_work\\")
panel_2 = Panel("C:\\saeran\\master\\git\\bibil\\src\\reference\\honeybee_work\\")

# ---- group: D04
geo = Geometry(Tree({0;0;0;0}: [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], {0;0;1;0}: [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], {0;1;2;0}: [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], {0;1;3;0}: [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], {0;2;4;0}: [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], {0;2;5;0}: [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]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))

# ---- group: D05
geo_2 = Geometry(Tree({0;0;0;0}: [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], {0;0;1;0}: [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], {0;0;2;0}: [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], {0;0;3;0}: [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], {0;0;4;0}: [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], {0;0;5;0}: [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]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))

# ---- group: D06
geo_3 = Geometry([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])

# ---- group: C05
geo_4 = Geometry(Tree({0;0;0;0}: [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], {0;0;1;0}: [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], {0;1;2;0}: [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], {0;1;3;0}: [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], {0;2;4;0}: [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], {0;2;5;0}: [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]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))

# ----
list = ValueList({"dir", "file"}, selected="dir")
Z = UnitZ(Factor=3)
extr = Extrude(Base=geo_2, Direction=Z)

# ---- group: find directory
bibil = PythonScript(dir=[panel, panel_2], type=list, run=Toggle(True))  # -> dir; inputs dir: list
# ---------- bibil: Python ----------
import os

ghenv.Component.Params.Output[0].Name = "null"
ghenv.Component.Params.Output[0].NickName = "null"

if run:
    confirm_dir = None
    for d in dir:
        try:
            if type == "file":
                file_ = open(d)
                file_.close()
            else:
                print os.listdir(d)
            confirm_dir = d
            break
        except Exception as e:
            #print str(e)
            continue
    if confirm_dir != None:
        ghenv.Component.Params.Output[0].Name = type
        ghenv.Component.Params.Output[0].NickName = type
        dir = confirm_dir
        file = confirm_dir
null = None
# ---------- end bibil ----------

# ----
wires = BrepWireframe(Brep=extr, Density=-1)
geo_5 = Geometry([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])
python_script = PythonScript(i=bibil)  # -> o
# ---------- python_script: Python ----------
import os

if i:
    o = os.path.join(str(i),"Honeybee_SplitZone.py")
    print o
# ---------- end python_script ----------
python_script_2 = PythonScript(i=bibil)  # -> o
# ---------- python_script_2: Python ----------
import os

if i:
    o = os.path.join(str(i),"Honeybee_SplitBuildingMass.py")
# ---------- end python_script_2 ----------
file = ReadFile(File=python_script_2, PerLineParse=False)
file_2 = ReadFile(File=python_script, PerLineParse=False)
splitmass = Honeybee_SplitBuildingMass(Code=file, _bldgMasses=geo_5, BldgsFlr2FloorHeights_="@3", _runIt=Toggle(True))  # -> ReadMe, SplitBldgMasses, Debug
geo_6 = Geometry(splitmass.SplitBldgMasses)
python = PythonScript(Code=file_2, _bldgMasses=flatten(splitmass.SplitBldgMasses), PerimeterZoneDepth_="@3", _runIt=Toggle(True))  # -> ReadMe, SplitBldgMasses, Debug
geo_7 = Geometry(python.Debug)
geo_8 = Geometry(python.SplitBldgMasses)
