# Grasshopper definition derivation_volume_of_cube.gh (Grasshopper 0.9.76)
# plug-ins: Python Interpreter, HDTReference

pt = Point(Point(121, 49, 0))
python = PythonScript()  # -> a
# ---------- python: Python ----------
a = range(1,5,1)

print a
# ---------- end python ----------
Y = UnitY(Factor=python)
Z = UnitZ(Factor=python)
X = UnitX(Factor=python)
move = Move(Geometry=pt, Motion=Z)  # -> Geometry, Transform
move_2 = Move(Geometry=pt, Motion=Y)  # -> Geometry, Transform
move_3 = Move(Geometry=pt, Motion=X)  # -> Geometry, Transform
ln = Line(StartPoint=move.Geometry, EndPoint=pt)
ln_2 = Line(StartPoint=move_2.Geometry, EndPoint=pt)
ln_3 = Line(StartPoint=move_3.Geometry, EndPoint=pt)
extr = Extrude(Base=ln, Direction=X)
extr_2 = Extrude(Base=ln_3, Direction=Y)
extr_3 = Extrude(Base=ln_2, Direction=Z)
move_4 = Move(Geometry=extr, Motion=Y)  # -> Geometry, Transform
move_5 = Move(Geometry=extr_2, Motion=Z)  # -> Geometry, Transform
move_6 = Move(Geometry=extr_3, Motion=X)  # -> Geometry, Transform
number_slider = Slider(1, range=0..1)
wires = BrepWireframe(Brep=[move_4.Geometry, move_6.Geometry, move_5.Geometry], Density=-1)
preview = CustomPreview(Geometry=[move_6.Geometry, move_5.Geometry, move_4.Geometry], Shader=ColourSwatch(SwatchColor=RGBA(150, 150, 150, 161)))  # disabled
previewlw = CustomPreviewLineweights(Geometry=wires, Shader=ColourSwatch(SwatchColor=RGB(0, 0, 0)), Thickness=Slider(2, range=0..10))
